# Dynamo graph 1032773.dyn (Dynamo 4.0.0.3277)

# group: Don't touch this ground
code_block = CodeBlock { -5000; -5000; -200; }
byCoordinates = Point.ByCoordinates(x=code_block.out0, y=code_block.out1, z=code_block.out2)
code_block_2 = CodeBlock { 5000; 5000; 0; }
byCoordinates_2 = Point.ByCoordinates(x=code_block_2.out0, y=code_block_2.out1, z=code_block_2.out2)
byCorners = Cuboid.ByCorners(lowPoint=byCoordinates, highPoint=byCoordinates_2)
code_block_3 = CodeBlock { 0; 100; 0; }
byARGB = Color.ByARGB(red=code_block_3.out0, green=code_block_3.out1, blue=code_block_3.out2)
byGeometryColor = Modifiers.GeometryColor.ByGeometryColor(geometry=byCorners, color=byARGB)

steel_centre_support_class = Python()  # PythonNet3; unwired: IN[0]
# ---------- steel_centre_support_class.python (33 lines) ----------
# Load the Python Standard and DesignScript Libraries
import sys
import clr
clr.AddReference('ProtoGeometry')
from Autodesk.DesignScript.Geometry import *
import math

# Creates a cylindrical support at the origin and returns total volume of the support
class CentreSupportClass:
        
    def __init__(self, height, radius):
        self.height = height
        self.radius = radius
        self.geometry = None
        
    #Creates a cylinder and stores it
    def create_support(self):
        startPoint = Point.ByCoordinates(0, 0, 0)
        endPoint = Point.ByCoordinates(0, 0, self.height)
        
        #Creating a geometry of a cylinder
        self.geometry = Cylinder.ByPointsRadius(startPoint, endPoint, self.radius)
        return self.geometry 
        
#Calculates the volume of the support located at the origin
    def measure_volume(self):
        if not self.geometry:
            self.create_support()
            
        vol_mm3 = self.geometry.Volume
        return "{} mm³".format(vol_mm3)
        
OUT = CentreSupportClass   
# ----------------------------------------
steel_support_height = DoubleSlider(5500, range=3500..6000 step 100)
radius_centre_support = CodeBlock { 200; }
centre_support_instance = Python(IN[0]=steel_centre_support_class, IN[1]=steel_support_height, IN[2]=radius_centre_support)  # PythonNet3
# ---------- centre_support_instance.python (17 lines) ----------
#Steel centre column (instance)

CentreSupportClass = IN[0]
height = IN[1]      # slider: column height
radius = IN[2]      # slider: column radius

support = CentreSupportClass(height, radius)

geoCylinder1 = support.create_support()
volCylinder1 = support.measure_volume()

OUT = [
    geoCylinder1,   # index 0
    volCylinder1,   # index 1
    height,         # index 2
    radius          # index 3  <-- column outer radius
]
# ----------------------------------------
watch = Watch(centre_support_instance)
code_block_4 = CodeBlock { 3; }
get_steel_column_radius = List.GetItemAtIndex(list=centre_support_instance, index=code_block_4)  # graph output
watch_2 = Watch(get_steel_column_radius)
concrete_base_class = Python()  # PythonNet3; unwired: IN[0]
# ---------- concrete_base_class.python (32 lines) ----------
import sys
import clr
clr.AddReference('ProtoGeometry')
from Autodesk.DesignScript.Geometry import *
import math

class ConcreteBaseClass:
    
    def __init__(self, height, outer_radius, column_radius):
        self.height        = height
        self.outer_radius  = outer_radius
        self.column_radius = column_radius
        self.base_solid    = None

    def create_base(self):
        p0 = Point.ByCoordinates(0, 0, 0)
        p1 = Point.ByCoordinates(0, 0, self.height)

        outer_cyl = Cylinder.ByPointsRadius(p0, p1, self.outer_radius)
        inner_cyl = Cylinder.ByPointsRadius(p0, p1, self.column_radius)

        self.base_solid = Solid.Difference(outer_cyl, inner_cyl)
        return self.base_solid

    def measure_volume(self):
        if not self.base_solid:
            self.create_base()
            
        vol_mm3 = self.base_solid.Volume
        return "{} mm³".format(vol_mm3)

OUT = ConcreteBaseClass
# ----------------------------------------
concrete_base_height = CodeBlock { 300; }
radius_of_steel_base = DoubleSlider(3500, range=3500..4000 step 100)
cylinder_base_instance = Python(IN[0]=concrete_base_class, IN[1]=concrete_base_height, IN[2]=radius_of_steel_base, IN[3]=get_steel_column_radius)  # PythonNet3
# ---------- cylinder_base_instance.python (13 lines) ----------
# STEP 2 – concrete base (instance)

ConcreteBaseClass = IN[0]
base_height       = IN[1]  # slider: e.g. 300
base_outer_radius = IN[2]  # slider: e.g. 3500–4000
column_radius     = IN[3]  # from Step 1 (single number!)

base = ConcreteBaseClass(base_height, base_outer_radius, column_radius)

geoBase = base.create_base()
volBase = base.measure_volume()

OUT = [geoBase, volBase, base_height]
# ----------------------------------------
end_height_of_base = CodeBlock { 2; }
get_max_height_of_base = List.GetItemAtIndex(list=cylinder_base_instance, index=end_height_of_base)
watch_3 = Watch(get_max_height_of_base)
concrete_mid_section_class = Python()  # PythonNet3; unwired: IN[0]
# ---------- concrete_mid_section_class.python (50 lines) ----------
import sys
import clr
clr.AddReference('ProtoGeometry')
from Autodesk.DesignScript.Geometry import *
import math

class ConcreteMidSectionClass:

    def __init__(self, start_height, height, top_bottom_radius, column_radius, fillet_radius):
        self.start_height      = start_height
        self.height            = height
        self.top_bottom_radius = top_bottom_radius
        self.mid_radius        = top_bottom_radius + 400.0  # bulge
        self.column_radius     = column_radius
        self.fillet_radius     = fillet_radius
        self.mid_solid         = None

    def create_mid_section(self):
        z0    = self.start_height
        z1    = self.start_height + self.height
        z_mid = (z0 + z1) / 2.0

        c0    = Point.ByCoordinates(0, 0, z0)
        c_mid = Point.ByCoordinates(0, 0, z_mid)
        c1    = Point.ByCoordinates(0, 0, z1)

        circ_bottom = Circle.ByCenterPointRadius(c0, self.top_bottom_radius)
        circ_mid    = Circle.ByCenterPointRadius(c_mid, self.mid_radius)
        circ_top    = Circle.ByCenterPointRadius(c1, self.top_bottom_radius)

        profiles   = [circ_bottom, circ_mid, circ_top]
        loftSolid  = Solid.ByLoft(profiles)

        # keep it solid right into the column (no cut)
        solid_filled = loftSolid

        # fillet edges
        edges = solid_filled.Edges
        self.mid_solid = Solid.Fillet(solid_filled, edges, self.fillet_radius)

        return self.mid_solid

    def measure_volume(self):
        if not self.mid_solid:
            self.create_mid_section()
            
        vol_mm3 = self.mid_solid.Volume
        return "{} mm³".format(vol_mm3)

OUT = ConcreteMidSectionClass
# ----------------------------------------
mid_section_height = CodeBlock { 300; }
mid_section_radius = DoubleSlider(3800, range=3800..4300 step 50)
fillet_of_the_outer_radius = DoubleSlider(20, range=20..50 step 5)
mid_section_instance = Python(IN[0]=concrete_mid_section_class, IN[1]=get_max_height_of_base, IN[2]=mid_section_height, IN[3]=mid_section_radius, IN[4]=get_steel_column_radius, IN[5]=fillet_of_the_outer_radius)  # PythonNet3
# ---------- mid_section_instance.python (19 lines) ----------
ConcreteMidSectionClass = IN[0]
start_height   = IN[1]  # from base
mid_height     = IN[2]  # slider
top_bottom_rad = IN[3]  # slider
column_radius  = IN[4]  # from Step 1
fillet_radius  = IN[5]  # slider

mid = ConcreteMidSectionClass(
    start_height,
    mid_height,
    top_bottom_rad,
    column_radius,
    fillet_radius
)

geoMid = mid.create_mid_section()
volMid = mid.measure_volume()

OUT = [geoMid, volMid]
# ----------------------------------------
watch_4 = Watch(mid_section_instance)
tilted_stainless_steel_disk = Python()  # "Tilted Stainless Steel Disk Class"; PythonNet3; unwired: IN[0]
# ---------- tilted_stainless_steel_disk.python (53 lines) ----------
import sys
import clr
clr.AddReference('ProtoGeometry')
from Autodesk.DesignScript.Geometry import *
import math

class TiltedDiskClass:

    def __init__(self, column_height, radius, thickness, angle_deg):
        """
        column_height : height of centre steel column
        radius        : disk radius (2500–3000 mm)
        thickness     : disk thickness along its axis (150 mm)
        angle_deg     : tilt of disk axis from vertical (e.g. 10°)
        """
        self.column_height = column_height
        self.radius        = radius
        self.thickness     = thickness
        self.angle_deg     = angle_deg
        self.disk_solid    = None

    def create_disk(self):
        H = self.column_height

        # centre of the disk is at 1/8 from top
        z_center = H - H / 8.0

        # start point for cylinder axis at disk centre
        p0 = Point.ByCoordinates(0, 0, z_center)

        # axis direction tilted by angle from vertical in XZ plane
        ang = math.radians(self.angle_deg)
        dx  = math.sin(ang)
        dz  = math.cos(ang)

        # end point of axis (length = thickness)
        x1 = dx * self.thickness
        y1 = 0
        z1 = z_center + dz * self.thickness

        p1 = Point.ByCoordinates(x1, y1, z1)

        self.disk_solid = Cylinder.ByPointsRadius(p0, p1, self.radius)
        return self.disk_solid

    def measure_volume(self):
        if self.disk_solid is None:
            self.create_disk()
            
        vol_mm3 = self.disk_solid.Volume
        return "{} mm³".format(vol_mm3)

OUT = TiltedDiskClass
# ----------------------------------------
steel_column_index = CodeBlock { 2; }
get_steel_column_height = List.GetItemAtIndex(list=centre_support_instance, index=steel_column_index)
ss_disk_radius = DoubleSlider(3500, range=2800..3500 step 100)
ss_disk_thickness = DoubleSlider(100, range=100..200 step 10)
ss_disk_angle = DoubleSlider(8, range=8..15 step 0.5)
tilted_disk_instance = Python(IN[0]=tilted_stainless_steel_disk, IN[1]=get_steel_column_height, IN[2]=ss_disk_radius, IN[3]=ss_disk_thickness, IN[4]=ss_disk_angle)  # PythonNet3
# ---------- tilted_disk_instance.python (20 lines) ----------
# STEP 5 – tilted circular disk (instance)

TiltedDiskClass = IN[0]

column_height = IN[1]  # from Step 1
radius        = IN[2]  # slider 2500–3000
thickness     = IN[3]  # slider or number 150
angle_deg     = IN[4]  # slider or number 10

disk = TiltedDiskClass(
    column_height,
    radius,
    thickness,
    angle_deg
)

geoDisk = disk.create_disk()
volDisk = disk.measure_volume()

OUT = [geoDisk, volDisk]
# ----------------------------------------
watch_5 = Watch(tilted_disk_instance)
code_block_5 = CodeBlock { 0; }
get_ss_disk_instance_for_color = List.GetItemAtIndex(list=tilted_disk_instance, index=code_block_5)  # "Get SS Disk Instance for Color Setup"
color_creation = CodeBlock { 255; 255; 255; 153; }
byARGB_2 = Color.ByARGB(alpha=color_creation.out0, red=color_creation.out1, green=color_creation.out2, blue=color_creation.out3)
ss_disk_geometrycolor = Modifiers.GeometryColor.ByGeometryColor(geometry=get_ss_disk_instance_for_color, color=byARGB_2)
slanted_stainless_steel_columns = Python()  # "Slanted Stainless Steel Columns Class"; PythonNet3; unwired: IN[0]
# ---------- slanted_stainless_steel_columns.python (66 lines) ----------
import sys
import clr
clr.AddReference('ProtoGeometry')
from Autodesk.DesignScript.Geometry import *
import math

class SlantedColumnsClass:

    def __init__(self, length, radius, radial_offset, base_height, angle_deg):
        """
        length        : length of each slanted column (6000 mm)
        radius        : column radius (e.g. 200 mm)
        radial_offset : distance from centre steel column (3000 mm)
        base_height   : starting height (0 on Z axis)
        angle_deg     : angle from vertical (controls how much they lean)
        """
        self.length        = length
        self.radius        = radius
        self.radial_offset = radial_offset
        self.base_height   = base_height
        self.angle_deg     = angle_deg
        self.columns       = None

    def create_columns(self):
        cols = []

        # convert angle to radians (angle from vertical)
        ang = math.radians(self.angle_deg)

        # vertical & horizontal components of the length
        dz = self.length * math.cos(ang)     # rise in Z
        dh = self.length * math.sin(ang)     # horizontal movement towards centre

        # 3 columns at 0°, 120°, 240°
        for theta_deg in [0, 120, 240]:
            theta = math.radians(theta_deg)

            # start point on circle of radius = radial_offset at z = base_height
            x0 = self.radial_offset * math.cos(theta)
            y0 = self.radial_offset * math.sin(theta)
            z0 = self.base_height

            # end point moves inward and up
            end_radius = max(0, self.radial_offset - dh)
            x1 = end_radius * math.cos(theta)
            y1 = end_radius * math.sin(theta)
            z1 = self.base_height + dz

            p0 = Point.ByCoordinates(x0, y0, z0)
            p1 = Point.ByCoordinates(x1, y1, z1)

            col = Cylinder.ByPointsRadius(p0, p1, self.radius)
            cols.append(col)

        self.columns = cols
        return self.columns

    def measure_total_volume(self):
        if self.columns is None:
            self.create_columns()
        total = 0
        for c in self.columns:
            total += c.Volume
        return total

OUT = SlantedColumnsClass
# ----------------------------------------
ss_column_length = DoubleSlider(7500, range=6000..7500 step 100)
ss_column_radius = CodeBlock { 200; }
ss_offset_angle = CodeBlock { 3000; }
slant_base_height = CodeBlock { 0; }
ss_slanted_angle = DoubleSlider(40, range=40..70 step 5)
slanted_columns_instance = Python(IN[0]=slanted_stainless_steel_columns, IN[1]=ss_column_length, IN[2]=ss_column_radius, IN[3]=ss_offset_angle, IN[4]=slant_base_height, IN[5]=ss_slanted_angle)  # PythonNet3
# ---------- slanted_columns_instance.python (22 lines) ----------
#Three slanted columns (instance)

SlantedColumnsClass = IN[0]

length        = IN[1]  # slider, default 6000
radius        = IN[2]  # slider, default 200
radial_offset = IN[3]  # slider, default 3000
base_height   = IN[4]  # usually 0.0
angle_deg     = IN[5]  # slider, e.g. 20–40 degrees

slants = SlantedColumnsClass(
    length,
    radius,
    radial_offset,
    base_height,
    angle_deg
)

geoSlants = slants.create_columns()
volSlants = slants.measure_total_volume()

OUT = [geoSlants, volSlants]
# ----------------------------------------
watch_6 = Watch(slanted_columns_instance)
code_block_6 = CodeBlock { 0; }
get_ss_column_instance_for_color = List.GetItemAtIndex(list=watch_6, index=code_block_6)  # "Get SS Column Instance for Color Setup"
color_creation_2 = CodeBlock { 255; 0; 100; 0; }
byARGB_3 = Color.ByARGB(alpha=color_creation_2.out0, red=color_creation_2.out1, green=color_creation_2.out2, blue=color_creation_2.out3)
ss_column_geometrycolor = Modifiers.GeometryColor.ByGeometryColor(geometry=get_ss_column_instance_for_color, color=byARGB_3)
code_block_7 = CodeBlock { 0; }
get_conc_mid_section_instance = List.GetItemAtIndex(list=mid_section_instance, index=code_block_7)  # "Get Conc. Mid-section Instance for Color Setup"
color_creation_3 = CodeBlock { 255; 205; 133; 63; }
byARGB_4 = Color.ByARGB(alpha=color_creation_3.out0, red=color_creation_3.out1, green=color_creation_3.out2, blue=color_creation_3.out3)
conc_mid_section_geometrycolor = Modifiers.GeometryColor.ByGeometryColor(geometry=get_conc_mid_section_instance, color=byARGB_4)
watch_7 = Watch(cylinder_base_instance)
code_block_8 = CodeBlock { 0; }
get_conc_base_instance_for_color = List.GetItemAtIndex(list=watch_7, index=code_block_8)  # "Get Conc. Base Instance for Color Setup"
color_creation_4 = CodeBlock { 255; 255; 230; 0; }
byARGB_5 = Color.ByARGB(alpha=color_creation_4.out0, red=color_creation_4.out1, green=color_creation_4.out2, blue=color_creation_4.out3)
conc_base_geometrycolor = Modifiers.GeometryColor.ByGeometryColor(geometry=get_conc_base_instance_for_color, color=byARGB_5)
code_block_9 = CodeBlock { 0; }
get_steel_column_instance_for = List.GetItemAtIndex(list=centre_support_instance, index=code_block_9)  # "Get Steel Column Instance for Color Setup"
color_creation_5 = CodeBlock { 255; 255; 255; 153; }
byARGB_6 = Color.ByARGB(alpha=color_creation_5.out0, red=color_creation_5.out1, green=color_creation_5.out2, blue=color_creation_5.out3)
steel_column_geometrycolor = Modifiers.GeometryColor.ByGeometryColor(geometry=get_steel_column_instance_for, color=byARGB_6)
