# Dynamo graph 1484079.dyn "1484979" (Dynamo 4.0.0.3277)

# group: Don't touch this ground
code_block = CodeBlock { -5000; -5000; -200; }  # frozen
byCoordinates = Point.ByCoordinates(x=code_block.out0, y=code_block.out1, z=code_block.out2)  # frozen
code_block_2 = CodeBlock { 5000; 5000; 0; }  # frozen
byCoordinates_2 = Point.ByCoordinates(x=code_block_2.out0, y=code_block_2.out1, z=code_block_2.out2)  # frozen
byCorners = Cuboid.ByCorners(lowPoint=byCoordinates, highPoint=byCoordinates_2)  # frozen
code_block_3 = CodeBlock { 0; 100; 0; }  # frozen
byARGB = Color.ByARGB(red=code_block_3.out0, green=code_block_3.out1, blue=code_block_3.out2)  # frozen
byGeometryColor = Modifiers.GeometryColor.ByGeometryColor(geometry=byCorners, color=byARGB)  # frozen

# group: Stainless Steel Support
base_point_for_arches = CodeBlock { radius = 4500; half = 2; in_mm = 25.4; }
peak_height = IntegerSlider(4000, range=3000..4200 step 100)
beam_length_and_width = DoubleSlider(125, range=100..150 step 5)
class_stainless_steel = Python()  # "Class: Stainless Steel Cylindrical Column"; PythonNet3; unwired: IN[0]
# ---------- class_stainless_steel.python (22 lines) ----------
# Load the Python Standard and DesignScript Libraries
import sys
import clr
clr.AddReference('ProtoGeometry')
from Autodesk.DesignScript.Geometry import *

class Column_Supp:
    def __init__(self, top, thickness):
        self.height = top
        self.radius = thickness
        
    def create_column(height, radius):
        #Creates a central column that the arches will be connected to
        base_p = Point.ByCoordinates(0,0,0)
        max_p = Point.ByCoordinates(0,0,height)
        return Cylinder.ByPointsRadius(base_p, max_p, radius)
       
    def find_vol(Column):
        #Calculates the volume of the column
        return Column.Volume

OUT = Column_Supp      
# ----------------------------------------
instance_of_central_column = Python(IN[0]=peak_height, IN[1]=beam_length_and_width, IN[2]=class_stainless_steel)  # PythonNet3
# ---------- instance_of_central_column.python (9 lines) ----------
Column_Supp = IN[2]

Center_Column = Column_Supp.create_column(IN[0], IN[1])

Col_Vol = Column_Supp.find_vol(Center_Column)

Col_Dict = {"Solid": Center_Column, "Volume": Col_Vol}

OUT = Col_Dict
# ----------------------------------------
class_stainless_steel_arch = Python()  # PythonNet3; unwired: IN[0]
# ---------- class_stainless_steel_arch.python (42 lines) ----------
# Load the Python Standard and DesignScript Libraries
import sys
import clr
clr.AddReference('ProtoGeometry')
from Autodesk.DesignScript.Geometry import *

class TwoCenterArch:
    def __init__(self, Outer_Point, Mid_Point, Center_Height, Cross_Sec):
        self.out = Outer_Point
        self.mid = Mid_Point
        self.inner = Center_Height
        self.cross_sec = Cross_Sec
        
    def make_arc(P1, P2, P3):
        return Arc.ByThreePoints(P1, P2, P3)
        
    def join_curve(curve_list):
        #Joins the 2 curves into a polyline
        return PolyCurve.ByJoinedCurves(curve_list)
        
    def cross_section(outer, thick):
        #Creates a cross section of the arch to be generated
        P1 = Point.ByCoordinates(outer, thick/2, 0)
        P2 = Point.ByCoordinates(outer - thick, thick/2, 0)
        P3 = Point.ByCoordinates(outer - thick, -thick/2, 0)
        P4 = Point.ByCoordinates(outer, -thick/2, 0)
        return Rectangle.ByCornerPoints(P1,P2,P3,P4)
        
    def fill_solid(cross_sec, path):
        #Creates a solid arch with a square profile along the arch that was crated
        return Solid.BySweep(cross_sec, path)
        
    def remove_core(filled_area, cut_shape):
        #Cuts out the core of the arch that would intersect the center column
        return Solid.Difference(filled_area, cut_shape)
        
    def calc_volume(trimmed_arch):
        #Calculates the volume of a single arch support
        #return trimmed_arch
        return trimmed_arch.Volume
                     
OUT = TwoCenterArch
# ----------------------------------------
number_of_support_legs = IntegerSlider(16, range=5..20 step 1)

# group: Plywood Roof
dictionary_keys = CodeBlock { Solid_Geo = "Solid"; Vol = "Volume"; Track = "Track"; Curt = "Curtain"; }
radius_of_plywood_roof = base_point_for_arches.radius / base_point_for_arches.half
class_plywood_roof = Python()  # PythonNet3; unwired: IN[0]
# ---------- class_plywood_roof.python (30 lines) ----------
# Load the Python Standard and DesignScript Libraries
import sys
import clr
clr.AddReference('ProtoGeometry')
from Autodesk.DesignScript.Geometry import *

class PlywoodCap:
    def __init__(self, thickness, radius, base_height):
        self.thick = thickness
        self.radius = radius
        self.base = base_height
        
    def Create_Cap(thick, radius, base):
        #Creates a plywood cap to rest on the top of the stainless steel support structure
        base_p = Point.ByCoordinates(0,0,base)
        top_p = Point.ByCoordinates(0,0,(thick + base))
        return Cylinder.ByPointsRadius(base_p,top_p,radius)
        
    def find_vol(cap):
        #Finds the volume of the plywood cap
        return cap.Volume
        
    def set_mat(cap):
        #Sets the material of the cap to a birch plywood
        colour = Color.ByARGB(255, 239, 208, 181)
        return GeometryColor.ByGeometryColor(cap, colour)
        
        

OUT = PlywoodCap
# ----------------------------------------
instance_of_plywood_roof = Python(IN[0]=base_point_for_arches.in_mm, IN[1]=radius_of_plywood_roof, IN[2]=peak_height, IN[3]=class_plywood_roof)  # PythonNet3
# ---------- instance_of_plywood_roof.python (10 lines) ----------
PlywoodCap = IN[3]
thickness = IN[0]
radius = IN[1]
start = IN[2]

make_cap = PlywoodCap.Create_Cap(thickness, radius, start)

cap_vol = PlywoodCap.find_vol(make_cap)

OUT = {"Solid": make_cap, "Volume": cap_vol}
# ----------------------------------------
retrieve_roof_volume = DesignScript.Builtin.Dictionary.ValueAtKey(dictionary=instance_of_plywood_roof, key=dictionary_keys.Vol)
watch = Watch(retrieve_roof_volume)
retrieve_roof_geometry = DesignScript.Builtin.Dictionary.ValueAtKey(dictionary=instance_of_plywood_roof, key=dictionary_keys.Solid_Geo)
birch_rgb_values = CodeBlock { R = 239; G = 208; B = 181; }
birch_colour = Color.ByARGB(red=birch_rgb_values.R, green=birch_rgb_values.G, blue=birch_rgb_values.B)
change_roof_colour = Modifiers.GeometryColor.ByGeometryColor(geometry=retrieve_roof_geometry, color=birch_colour)

# group (continued): Stainless Steel Support
retrieve_column_geometry = DesignScript.Builtin.Dictionary.ValueAtKey(dictionary=instance_of_central_column, key=dictionary_keys.Solid_Geo)
instance_of_a_stainless_steel = Python(IN[0]=base_point_for_arches.radius, IN[1]=peak_height, IN[2]=beam_length_and_width, IN[3]=retrieve_column_geometry, IN[4]=class_stainless_steel_arch)  # "Instance of a Stainless Steel Arch"; PythonNet3; graph output
# ---------- instance_of_a_stainless_steel.python (34 lines) ----------
# Load the Python Standard and DesignScript Libraries
import sys
import clr
clr.AddReference('ProtoGeometry')
from Autodesk.DesignScript.Geometry import *

'''Creates a single stainless steel support arch'''

TwoCenterArch = IN[4]
radius = IN[0] #Outermost point of the arches
height = IN[1] #Maximum height of the arches, center is derived as half of this

P1 = Point.ByCoordinates(radius,0,0) #Generating points to create the lines
P12 = Point.ByCoordinates((radius *(3/4)),0,height/(4/3))
P2 = Point.ByCoordinates(radius/2.25,0,height)
P23 = Point.ByCoordinates((radius/2)/2,0,(height*1.5)/(5/3))
P3 = Point.ByCoordinates(0,0,height/2)

Line1 = TwoCenterArch.make_arc(P1,P12,P2)
Line2 = TwoCenterArch.make_arc(P2,P23,P3)

CurveA = TwoCenterArch.join_curve([Line1, Line2])

Cross_Sec = TwoCenterArch.cross_section(radius, IN[2]) #IN[2] is the length of the square cross section the arches are built from

Filled = TwoCenterArch.fill_solid(Cross_Sec, CurveA)

Cut_Arch = TwoCenterArch.remove_core(Filled, IN[3]) #IN[3] is the Central Column support that the arches need the intersecting areas cut from

Arch_Vol = TwoCenterArch.calc_volume(Cut_Arch)

Arch_Props = {"Solid": Cut_Arch, "Volume": Arch_Vol}

OUT = Arch_Props# + radius/2.25
# ----------------------------------------
series_of_stainless_steel_arches = Python(IN[0]=instance_of_a_stainless_steel, IN[1]=number_of_support_legs)  # PythonNet3
# ---------- series_of_stainless_steel_arches.python (17 lines) ----------
# Load the Python Standard and DesignScript Libraries
import sys
import clr
clr.AddReference('ProtoGeometry')
from Autodesk.DesignScript.Geometry import *

rot_axis = Vector.ByCoordinates(0,0,1)
origin_p = Point.ByCoordinates(0,0,0)
arch_set = []
arch_solid = IN[0]["Solid"]
for ang in range(IN[1]):
    rot_angle = (270 / (IN[1] - 1)) * ang
    arch_set.append(Geometry.Rotate(arch_solid, origin_p, rot_axis, rot_angle))

Arches_Vol = IN[0]["Volume"] * IN[1]

OUT = {"Solid":arch_set , "Volume": Arches_Vol}
# ----------------------------------------
volume_of_all_arches = DesignScript.Builtin.Dictionary.ValueAtKey(dictionary=series_of_stainless_steel_arches, key=dictionary_keys.Vol)
retrieve_column_volume = DesignScript.Builtin.Dictionary.ValueAtKey(dictionary=instance_of_central_column, key=dictionary_keys.Vol)
total_stainless_steel_volume_mm = volume_of_all_arches + retrieve_column_volume  # "Total Stainless Steel Volume (mm^3)"
watch_2 = Watch(total_stainless_steel_volume_mm)
all_arch_geometry = DesignScript.Builtin.Dictionary.ValueAtKey(dictionary=series_of_stainless_steel_arches, key=dictionary_keys.Solid_Geo)

# group: Outdoor Curtain
curtain_revolution_angle = DoubleSlider(260, range=90..360 step 10)
class_outdoor_curtain = Python()  # PythonNet3; unwired: IN[0]
# ---------- class_outdoor_curtain.python (51 lines) ----------
# Load the Python Standard and DesignScript Libraries
import sys
import clr
clr.AddReference('ProtoGeometry')
from Autodesk.DesignScript.Geometry import *
'''Creates a stainless steel crutain track and an outdoor curtain that hangs from it'''

class OutdoorCurtain:
    def __init__(self, rod_pos, rot_angle):
        self.position = rod_pos
        self.angle = rot_angle
        
    def create_track(rod_pos):
        #Builds the curtain track that the curtain hangs from
        P1 = Point.ByCoordinates(rod_pos[0] -5,0 , rod_pos[2])
        P2 = Point.ByCoordinates(rod_pos[0] -25, 0, rod_pos[2])
        P3 = Point.ByCoordinates(rod_pos[0] -25, 0, rod_pos[2] -20)
        P4 = Point.ByCoordinates(rod_pos[0] -5, 0, rod_pos[2] -20)
        cross_sec = Rectangle.ByCornerPoints(P1,P2,P3,P4)
        origin = Point.ByCoordinates(0,0,0)
        rot_axis = Vector.ByCoordinates(0,0,1)
        track = Solid.ByRevolve(cross_sec, origin, rot_axis, 0, 360)
        return track
        
    def draw_curtain(start_coord, mid_coord, max_rad):
        #Creates a curve to set the curtain
        P1 = Point.ByCoordinates(start_coord[0],start_coord[1],start_coord[2])
        P2 = Point.ByCoordinates(mid_coord[0]+50,mid_coord[1],mid_coord[2])
        P3 = Point.ByCoordinates(max_rad+40,0,0)
        return Arc.ByThreePoints(P1,P2,P3)
        
    def revolved_curtain(curtain, angle):
        #creats the surface of the rotated curtain
        origin = Point.ByCoordinates(0,0,0)
        rot_axis = Vector.ByCoordinates(0,0,1)
        revolved = Surface.ByRevolve(curtain, origin, rot_axis, 0, angle)
        return Surface.Thicken(revolved, 2.5)
        
    def full_curtain(curtain):
        #Calculates the volume of the curtain when fully pulled, note: the curtain should always have this volume, even when not fully closed
        origin = Point.ByCoordinates(0,0,0)
        rot_axis = Vector.ByCoordinates(0,0,1)
        rotated = Surface.ByRevolve(curtain, origin, rot_axis, 0, 360)
        full_curt = Surface.Thicken(rotated, 2.5)
        return full_curt.Volume
        
    def find_vol(solid):
        #Finds the volume of a solid
        return solid.Volume
        
OUT = OutdoorCurtain
# ----------------------------------------
instance_of_outdoor_curtain = Python(IN[0]=peak_height, IN[1]=radius_of_plywood_roof, IN[2]=base_point_for_arches.radius, IN[3]=curtain_revolution_angle, IN[4]=class_outdoor_curtain)  # PythonNet3
# ---------- instance_of_outdoor_curtain.python (18 lines) ----------
OutdoorCurtain = IN[4]
height = IN[0]
cap_rad = IN[1]
tot_rad = IN[2]
top_coords = [cap_rad, 0, height]
r_angle = IN[3]

curtain_track = OutdoorCurtain.create_track(top_coords)

curtain_line = OutdoorCurtain.draw_curtain([cap_rad -15, 0, height -20], [(tot_rad*(3/4)),0,height/(4/3)], tot_rad)

revolved = OutdoorCurtain.revolved_curtain(curtain_line, r_angle)

curt_vol = OutdoorCurtain.full_curtain(curtain_line)

track_vol = OutdoorCurtain.find_vol(curtain_track)

OUT = {"Track": {"Volume": track_vol, "Solid": curtain_track}, "Curtain": {"Volume": curt_vol, "Solid": revolved}}
# ----------------------------------------
valueAtKey = DesignScript.Builtin.Dictionary.ValueAtKey(dictionary=instance_of_outdoor_curtain, key=dictionary_keys.Curt)
valueAtKey_2 = DesignScript.Builtin.Dictionary.ValueAtKey(dictionary=valueAtKey, key=dictionary_keys.Vol)
outdoor_curtain_volume = Watch(valueAtKey_2)
valueAtKey_3 = DesignScript.Builtin.Dictionary.ValueAtKey(dictionary=valueAtKey, key=dictionary_keys.Solid_Geo)
curtain_rgb_values = CodeBlock { R = 0; G = 124; B = 65; }
curtain_color = Color.ByARGB(red=curtain_rgb_values.R, green=curtain_rgb_values.G, blue=curtain_rgb_values.B)
change_curtain_colour = Modifiers.GeometryColor.ByGeometryColor(geometry=valueAtKey_3, color=curtain_color)

extract_track_dictionary = DesignScript.Builtin.Dictionary.ValueAtKey(dictionary=instance_of_outdoor_curtain, key=dictionary_keys.Track)

# group (continued): Outdoor Curtain
valueAtKey_4 = DesignScript.Builtin.Dictionary.ValueAtKey(dictionary=extract_track_dictionary, key=dictionary_keys.Vol)
valueAtKey_5 = DesignScript.Builtin.Dictionary.ValueAtKey(dictionary=extract_track_dictionary, key=dictionary_keys.Solid_Geo)

stainless_steel_track_volume = Watch(valueAtKey_4)
