# Dynamo graph 1508429.dyn "Start (without the group)" (Dynamo 3.6.0.9395)

code_block = CodeBlock { -5000; -5000; -200; }
byCoordinates = Point.ByCoordinates(x=code_block.out0, y=code_block.out1, z=code_block.out2)
code_block_2 = CodeBlock { 5000; 5000; 0; }
byCoordinates_2 = Point.ByCoordinates(x=code_block_2.out0, y=code_block_2.out1, z=code_block_2.out2)
byCorners = Cuboid.ByCorners(lowPoint=byCoordinates, highPoint=byCoordinates_2)
code_block_3 = CodeBlock { 0; 100; 0; }
byARGB = Color.ByARGB(red=code_block_3.out0, green=code_block_3.out1, blue=code_block_3.out2)
byGeometryColor = Modifiers.GeometryColor.ByGeometryColor(geometry=byCorners, color=byARGB)
code_block_4 = CodeBlock { 0; 0; 0; }
byCoordinates_3 = Point.ByCoordinates(x=code_block_4.out0, y=code_block_4.out1, z=code_block_4.out2)
radiusOfBottom = DoubleSlider(3310, range=3000..3600 step 10)
myCircle = Python()  # CPython3; unwired: IN[0]
# ---------- myCircle.python (13 lines) ----------
# Load the Python Standard and DesignScript Libraries
import sys
import clr
clr.AddReference('ProtoGeometry')
from Autodesk.DesignScript.Geometry import *

class MyCircle:
    def __init__(self, center_point, radius):
        self.center = center_point
        self.radius = radius
    def make_geometry(self):
        return Circle.ByCenterPointRadius(self.center, self.radius)
OUT = MyCircle
# ----------------------------------------
botOfCircle = Python(IN[0]=byCoordinates_3, IN[1]=radiusOfBottom, IN[2]=myCircle)  # CPython3
# ---------- botOfCircle.python (3 lines) ----------
MyCircle = IN[2]
b = MyCircle(IN[0],IN[1])
OUT = b.make_geometry()
# ----------------------------------------
code_block_5 = CodeBlock { 0; 20; 1/19; }
sequence = Sequence(start=code_block_5.out0, amount=code_block_5.out1, step=code_block_5.out2)
pointAtParameter = Curve.PointAtParameter(curve=botOfCircle, param=sequence)
code_block_6 = CodeBlock { 0; 0; }
height = DoubleSlider(3030, range=2700..3300 step 10)
byCoordinates_4 = Point.ByCoordinates(x=code_block_6.out0, y=code_block_6.out1, z=height)
byStartPointEndPoint = Line.ByStartPointEndPoint(startPoint=byCoordinates_4, endPoint=pointAtParameter)
code_block_7 = CodeBlock { 0; 20; 1/19; }
sequence_2 = Sequence(start=code_block_7.out0, amount=code_block_7.out1, step=code_block_7.out2)
pointAtParameter_2 = Curve.PointAtParameter(curve=byStartPointEndPoint, param=sequence_2)
radiusOfCylinder = DoubleSlider(90, range=50..100 step 10)
steelRod = Python()  # CPython3; unwired: IN[0]
# ---------- steelRod.python (18 lines) ----------
# Load the Python Standard and DesignScript Libraries
import sys
import clr
clr.AddReference('ProtoGeometry')
from Autodesk.DesignScript.Geometry import *
import math

class SteelRod:
    def __init__(self,start_point,end_point,radius):
        self.start = start_point
        self.end = end_point
        self.radius = radius
        self.height = start_point.DistanceTo(end_point)
    def make_geometry(self):
        return Cylinder.ByPointsRadius(self.start,self.end,self.radius)
    def calculate_volume(self):
        return math.pi * (self.radius ** 2) * self.height
OUT = SteelRod        
# ----------------------------------------
radiusOfCylinder_2 = DoubleSlider(0.9, range=0..1 step 0.1)
botOfCylinder = Python(IN[0]=pointAtParameter, IN[1]=pointAtParameter_2, IN[2]=radiusOfCylinder, IN[3]=steelRod, IN[4]=radiusOfCylinder_2)  # CPython3
# ---------- botOfCylinder.python (43 lines) ----------
import clr
clr.AddReference('ProtoGeometry')
from Autodesk.DesignScript.Geometry import *

SteelRod = IN[3]
bottom_points = IN[0]
top_points = IN[1]
base_radius = IN[2]
scale_factor = IN[4]

all_points = bottom_points + top_points
z_coords = [p.Z for p in all_points]
min_z = min(z_coords)
max_z = max(z_coords)
z_range = max_z - min_z if max_z - min_z > 0 else 1

cylinders = []
total_volume = 0  

for i in range(len(bottom_points)):
    bottom_point = bottom_points[i]
    next_index = (i + 1) % len(top_points)
    top_point = top_points[next_index]
    
    distance = bottom_point.DistanceTo(top_point)
    
    if distance > 0.1:
        try:
            mid_z = (bottom_point.Z + top_point.Z) / 2.0
            normalized_height = (mid_z - min_z) / z_range
            
            radius = base_radius * (1.0 - normalized_height * scale_factor)
            radius = max(radius, base_radius * 0.05)
            
            cylinder_instance = SteelRod(bottom_point, top_point, radius)
            cylinder = cylinder_instance.make_geometry()
            cylinders.append(cylinder)
            
            total_volume += cylinder_instance.calculate_volume()  
        except:
            pass

OUT = [cylinders, total_volume]  
# ----------------------------------------
code_block_8 = CodeBlock { 1; }
getItemAtIndex = List.GetItemAtIndex(list=botOfCylinder, index=code_block_8)
botOfCylinder_2 = Python(IN[0]=pointAtParameter, IN[1]=pointAtParameter_2, IN[2]=radiusOfCylinder, IN[3]=steelRod, IN[4]=radiusOfCylinder_2)  # CPython3
# ---------- botOfCylinder_2.python (38 lines) ----------
import clr
clr.AddReference('ProtoGeometry')
from Autodesk.DesignScript.Geometry import *

SteelRod = IN[3]
bottom_points = IN[0]
top_points = IN[1]
base_radius = IN[2]
scale_factor = IN[4]

all_points = bottom_points + top_points
z_coords = [p.Z for p in all_points]
min_z = min(z_coords)
max_z = max(z_coords)
z_range = max_z - min_z if max_z - min_z > 0 else 1

cylinders = []
total_volume = 0  

for bottom_point, top_point in zip(bottom_points, top_points):
    distance = bottom_point.DistanceTo(top_point)
    
    if distance > 0.1:
        try:
            mid_z = (bottom_point.Z + top_point.Z) / 2.0
            normalized_height = (mid_z - min_z) / z_range
            radius = base_radius * (1.0 - normalized_height * scale_factor)
            radius = max(radius, base_radius * 0.05)
            
            cylinder_instance = SteelRod(bottom_point, top_point, radius)
            cylinder = cylinder_instance.make_geometry()
            cylinders.append(cylinder)
            
            total_volume += cylinder_instance.calculate_volume() 
        except Exception as e:
            pass

OUT = [cylinders, total_volume]  
# ----------------------------------------
getItemAtIndex_2 = List.GetItemAtIndex(list=botOfCylinder_2, index=code_block_8)
code_block_9 = CodeBlock(x=height) { x; y = x+1000; y; }
byCoordinates_5 = Point.ByCoordinates(x=code_block_6.out0, y=code_block_6.out1, z=code_block_9.out2)
code_block_10 = CodeBlock { 4000; }
topOfCircle = Python(IN[0]=byCoordinates_5, IN[1]=code_block_10, IN[2]=myCircle)  # CPython3; same code as botOfCircle
pointAtParameter_3 = Curve.PointAtParameter(curve=topOfCircle, param=sequence)
byStartPointEndPoint_2 = Line.ByStartPointEndPoint(startPoint=byCoordinates_4, endPoint=pointAtParameter_3)
code_block_11 = CodeBlock { 0.5; }
pointAtParameter_4 = Curve.PointAtParameter(curve=byStartPointEndPoint_2, param=code_block_11)
code_block_12 = CodeBlock { 0; 0; 500; }
translate = Geometry.Translate(geometry=pointAtParameter_4, xTranslation=code_block_12.out0, yTranslation=code_block_12.out1, zTranslation=code_block_12.out2)
code_block_13 = CodeBlock { 40; }
topCrossCylinder = Python(IN[0]=translate, IN[1]=pointAtParameter_3, IN[2]=code_block_13, IN[3]=steelRod, IN[4]=radiusOfCylinder_2)  # CPython3; same code as botOfCylinder
getItemAtIndex_3 = List.GetItemAtIndex(list=topCrossCylinder, index=code_block_8)
topCrossCylinder_2 = Python(IN[0]=pointAtParameter_3, IN[1]=translate, IN[2]=code_block_13, IN[3]=steelRod, IN[4]=radiusOfCylinder_2)  # CPython3; same code as botOfCylinder
getItemAtIndex_4 = List.GetItemAtIndex(list=topCrossCylinder_2, index=code_block_8)
code_block_14 = CodeBlock { 40; }
byCenterPointRadius = Circle.ByCenterPointRadius(centerPoint=byCoordinates_4, radius=code_block_14)
byThreePoints = Arc.ByThreePoints(firstPoint=byCoordinates_4, secondPoint=translate, thirdPoint=pointAtParameter_3)
bySweep = Solid.BySweep(profile=byCenterPointRadius, path=byThreePoints)
volume = Solid.Volume(solid=bySweep)
sum = Math.Sum(values=volume)
code_block_15 = CodeBlock(y=getItemAtIndex, z=getItemAtIndex_2, a=getItemAtIndex_3, b=getItemAtIndex_4, c=sum) { y; z; a; b; c; y+z+a+b+c+"mm^3"; }
cylinderVolume = Watch(code_block_15.out5)
code_block_16 = CodeBlock { 70; }
stainless_steel_sphere = Python()  # CPython3; unwired: IN[0]
# ---------- stainless_steel_sphere.python (14 lines) ----------
import sys
import clr
clr.AddReference('ProtoGeometry')
from Autodesk.DesignScript.Geometry import *
import math
class Stainless_Steel_Sphere:
    def __init__(self, center_point, radius):
        self.center = center_point
        self.radius = radius
    def make_geometry(self):
        return Sphere.ByCenterPointRadius(self.center, self.radius)
    def calculate_volume(self):
        return (4.0 / 3.0) * math.pi * (self.radius ** 3)
OUT = Stainless_Steel_Sphere        
# ----------------------------------------
topOfBall = Python(IN[0]=pointAtParameter_3, IN[1]=code_block_16, IN[2]=stainless_steel_sphere)  # CPython3
# ---------- topOfBall.python (19 lines) ----------
import clr
clr.AddReference('ProtoGeometry')
from Autodesk.DesignScript.Geometry import *

Stainless_Steel_Sphere = IN[2]
points_list = IN[0]
radius = IN[1]

spheres = []
total_volume = 0  

for point in points_list:
    sphere_instance = Stainless_Steel_Sphere(point, radius)
    sphere = sphere_instance.make_geometry()
    spheres.append(sphere)
    
    total_volume += sphere_instance.calculate_volume()  

OUT = [spheres, total_volume]
# ----------------------------------------
getItemAtIndex_5 = List.GetItemAtIndex(list=topOfBall, index=code_block_8)
index = CodeBlock { 200; }
sizeOfBall = DoubleSlider(0.7, range=0..1 step 0.1)
spiralSpheres = Python(IN[0]=pointAtParameter_2, IN[1]=index, IN[2]=stainless_steel_sphere, IN[3]=sizeOfBall)  # CPython3
# ---------- spiralSpheres.python (30 lines) ----------
import clr
clr.AddReference('ProtoGeometry')
from Autodesk.DesignScript.Geometry import *

Stainless_Steel_Sphere = IN[2]
points_list = IN[0]
base_radius = IN[1]
scale_factor = IN[3]

z_coords = [p.Z for p in points_list]
min_z = min(z_coords)
max_z = max(z_coords)
z_range = max_z - min_z if max_z != min_z else 1

spheres = []
total_volume = 0  

for point in points_list:
    normalized_height = (point.Z - min_z) / z_range if z_range > 0 else 0
    
    radius = base_radius * (1 - normalized_height * scale_factor)
    radius = max(radius, base_radius * 0.1)
    
    sphere_instance = Stainless_Steel_Sphere(point, radius)
    sphere = sphere_instance.make_geometry()
    spheres.append(sphere)
    
    total_volume += sphere_instance.calculate_volume()  

OUT = [spheres, total_volume]
# ----------------------------------------
getItemAtIndex_6 = List.GetItemAtIndex(list=spiralSpheres, index=code_block_8)
radiusOfSphere = DoubleSlider(240, range=200..250 step 20)
botOfBall = Python(IN[0]=pointAtParameter, IN[1]=radiusOfSphere, IN[2]=stainless_steel_sphere)  # CPython3
# ---------- botOfBall.python (19 lines) ----------
import clr
clr.AddReference('ProtoGeometry')
from Autodesk.DesignScript.Geometry import *

Stainless_Steel_Sphere = IN[2]
points_list = IN[0]
radius = IN[1]

spheres = []
total_volume = 0  

for point in points_list:
    sphere_instance = Stainless_Steel_Sphere(point, radius)
    sphere = sphere_instance.make_geometry()
    spheres.append(sphere)
    
    total_volume += sphere_instance.calculate_volume()  

OUT = [spheres, total_volume]  
# ----------------------------------------
getItemAtIndex_7 = List.GetItemAtIndex(list=botOfBall, index=code_block_8)
code_block_17 = CodeBlock(x=getItemAtIndex_5, y=getItemAtIndex_6, z=getItemAtIndex_7) { x; y; z; x+y+z+"mm^3"; }
sphereVolume = Watch(code_block_17.out3)
code_block_18 = CodeBlock(x=height) { x; y = x+2000; y; }
byCoordinates_6 = Point.ByCoordinates(x=code_block_6.out0, y=code_block_6.out1, z=code_block_18.out2)
code_block_19 = CodeBlock { 1000; 500; 200; 10; 500; 10; }
woodChair = Python(IN[0]=byCoordinates_3, IN[1]=code_block_19.out0, IN[2]=code_block_19.out1, IN[3]=code_block_19.out2, IN[4]=code_block_19.out3, IN[5]=code_block_19.out4, IN[6]=code_block_19.out5)  # CPython3
# ---------- woodChair.python (87 lines) ----------
import clr
clr.AddReference('ProtoGeometry')
from Autodesk.DesignScript.Geometry import *
import math

center_point = IN[0] if len(IN) > 0 else Point.ByCoordinates(0, 0, 0)
bench_radius = IN[1] if len(IN) > 1 else 3.0
bench_height = IN[2] if len(IN) > 2 else 0.5
num_slices = IN[3] if len(IN) > 3 else 48
slice_width = IN[4] if len(IN) > 4 else 0.08
slice_depth = IN[5] if len(IN) > 5 else 0.4
slice_thickness = IN[6] if len(IN) > 6 else 0.03

bench_slices = []
total_volume = 0  # 添加总体积变量

for i in range(num_slices):
    try:
        angle = i * 2 * math.pi / num_slices
        
        center_x = center_point.X + bench_radius * math.cos(angle)
        center_y = center_point.Y + bench_radius * math.sin(angle)
        
        radial_direction = Vector.ByCoordinates(
            math.cos(angle),
            math.sin(angle),
            0
        )
        
        tangent_direction = Vector.ByCoordinates(
            -math.sin(angle),
            math.cos(angle),
            0
        )
        
        inner_offset = -slice_depth / 2
        pt1_bottom = Point.ByCoordinates(
            center_x + radial_direction.X * inner_offset - tangent_direction.X * slice_width / 2,
            center_y + radial_direction.Y * inner_offset - tangent_direction.Y * slice_width / 2,
            0
        )
        pt2_bottom = Point.ByCoordinates(
            center_x + radial_direction.X * inner_offset + tangent_direction.X * slice_width / 2,
            center_y + radial_direction.Y * inner_offset + tangent_direction.Y * slice_width / 2,
            0
        )
        
        outer_offset = slice_depth / 2
        pt3_bottom = Point.ByCoordinates(
            center_x + radial_direction.X * outer_offset + tangent_direction.X * slice_width / 2,
            center_y + radial_direction.Y * outer_offset + tangent_direction.Y * slice_width / 2,
            0
        )
        pt4_bottom = Point.ByCoordinates(
            center_x + radial_direction.X * outer_offset - tangent_direction.X * slice_width / 2,
            center_y + radial_direction.Y * outer_offset - tangent_direction.Y * slice_width / 2,
            0
        )
        
        pt1_top = Point.ByCoordinates(pt1_bottom.X, pt1_bottom.Y, bench_height)
        pt2_top = Point.ByCoordinates(pt2_bottom.X, pt2_bottom.Y, bench_height)
        pt3_top = Point.ByCoordinates(pt3_bottom.X, pt3_bottom.Y, bench_height)
        pt4_top = Point.ByCoordinates(pt4_bottom.X, pt4_bottom.Y, bench_height)
        
        bottom_points = [pt1_bottom, pt2_bottom, pt3_bottom, pt4_bottom, pt1_bottom]
        top_points = [pt1_top, pt2_top, pt3_top, pt4_top, pt1_top]
        
        bottom_curve = PolyCurve.ByPoints(bottom_points)
        top_curve = PolyCurve.ByPoints(top_points)
        
        slice_solid = Surface.ByLoft([bottom_curve, top_curve])
        slice_thick = Surface.Thicken(slice_solid, slice_thickness, True)
        
        bench_slices.append(slice_thick)
        
        # 计算每个切片的体积并累加
        try:
            volume = slice_thick.Volume
            total_volume += volume
        except:
            pass
        
    except Exception as e:
        pass

# 输出切片列表和总体积
OUT = [bench_slices, total_volume]
# ----------------------------------------
code_block_20 = CodeBlock { 0; }
getItemAtIndex_8 = List.GetItemAtIndex(list=woodChair, index=code_block_20)
code_block_21 = CodeBlock { 255; 160; 82; 45; }
byARGB_2 = Color.ByARGB(alpha=code_block_21.out0, red=code_block_21.out1, green=code_block_21.out2, blue=code_block_21.out3)
byGeometryColor_2 = Modifiers.GeometryColor.ByGeometryColor(geometry=getItemAtIndex_8, color=byARGB_2)
midOfCylinder = Python(IN[0]=byCoordinates_3, IN[1]=byCoordinates_4, IN[2]=radiusOfCylinder, IN[3]=steelRod)  # CPython3
# ---------- midOfCylinder.python (3 lines) ----------
SteelRod = IN[3]
b = SteelRod(IN[0],IN[1],IN[2])
OUT = b.make_geometry()
# ----------------------------------------
list_create = List.Create(item0=topCrossCylinder_2, item1=topCrossCylinder, item2=bySweep, item3=botOfCylinder_2, item4=midOfCylinder, item5=botOfCylinder)
code_block_22 = CodeBlock { 255; 47; 79; 47; }
byARGB_3 = Color.ByARGB(alpha=code_block_22.out0, red=code_block_22.out1, green=code_block_22.out2, blue=code_block_22.out3)
byGeometryColor_3 = Modifiers.GeometryColor.ByGeometryColor(geometry=list_create, color=byARGB_3)
code_block_23 = CodeBlock { 0; }
getItemAtIndex_9 = List.GetItemAtIndex(list=list_create, index=code_block_23)
byPoints = PolyCurve.ByPoints(points=translate)
list_create_2 = List.Create(item0=byPoints, item1=topOfCircle)
byLoft = Surface.ByLoft(crossSections=list_create_2)
code_block_24 = CodeBlock { 255; 212; 175; 55; }
byARGB_4 = Color.ByARGB(alpha=code_block_24.out0, red=code_block_24.out1, green=code_block_24.out2, blue=code_block_24.out3)
byGeometryColor_4 = Modifiers.GeometryColor.ByGeometryColor(geometry=byLoft, color=byARGB_4)
list_create_3 = List.Create(item0=topOfBall, item1=spiralSpheres, item2=botOfBall)
code_block_25 = CodeBlock { 255; 212; 175; 55; }
byARGB_5 = Color.ByARGB(alpha=code_block_25.out0, red=code_block_25.out1, green=code_block_25.out2, blue=code_block_25.out3)
byGeometryColor_5 = Modifiers.GeometryColor.ByGeometryColor(geometry=list_create_3, color=byARGB_5)
getItemAtIndex_10 = List.GetItemAtIndex(list=list_create_3, index=code_block_23)
code_block_26 = CodeBlock { 1; }
getItemAtIndex_11 = List.GetItemAtIndex(list=woodChair, index=code_block_26)
code_block_27 = CodeBlock(x=getItemAtIndex_11) { x+"mm^3"; }
woodVolume = Watch(code_block_27)
