# Dynamo graph 1544064.dyn "KAEEE" (Dynamo 4.0.0.3277)

# group: Don't touch this ground
code_block = CodeBlock { -5000; -5000; -200; }
byCoordinates = Point.ByCoordinates(x=code_block.out0, y=code_block.out1, z=code_block.out2)
code_block_2 = CodeBlock { 5000; 5000; 0; }
byCoordinates_2 = Point.ByCoordinates(x=code_block_2.out0, y=code_block_2.out1, z=code_block_2.out2)
byCorners = Cuboid.ByCorners(lowPoint=byCoordinates, highPoint=byCoordinates_2)
code_block_3 = CodeBlock { 0; 100; 0; }
byARGB = Color.ByARGB(red=code_block_3.out0, green=code_block_3.out1, blue=code_block_3.out2)
byGeometryColor = Modifiers.GeometryColor.ByGeometryColor(geometry=byCorners, color=byARGB)

# group: Initial set up the roof points and set upthe curvey part of the roof and addition of colour
# setting up the intial points of the roof to create the curve movement
# also sliders are incorperated to control the width, height, bend ratio of the curves and pavilion depth to make sure to keep all the structrues within the parameter
# *ChatGpt assitance used to debug the code block instructions and identify some function of the nodes*
pavilion_width = DoubleSlider(9000, range=3000..10000 step 100)
rib_count = IntegerSlider(24, range=6..30 step 1)
ribXList = CodeBlock(PavilionWidth=pavilion_width, ribcount=rib_count) { -PavilionWidth/2..PavilionWidth/2..#ribcount; }
pavilion_depth = DoubleSlider(9000, range=3000..10000 step 100)
RIB_Y_Position = CodeBlock(PavilionDepth=pavilion_depth)
# ---------- RIB_Y_Position.designscript (10 lines) ----------
y0 = -PavilionDepth/2;
       // very front;
y1 = -PavilionDepth/4;
       // front-mid;
y2 = 0;
// centre;
y3 =  PavilionDepth/4;
       // back-mid;
y4 =  PavilionDepth/2;
       // very back;
# ----------------------------------------
roof_height = DoubleSlider(2800, range=2500..4000 step 100)
roof_sag_factor = DoubleSlider(0.3, range=0..0.6 step 0.1)
rib_z_positions = CodeBlock(roofheight=roof_height, RoofSagFactor=roof_sag_factor)
# ---------- rib_z_positions.designscript (6 lines) ----------
// inputs: roofheight, RoofSagFactor
frontLowZ  = roofheight - RoofSagFactor * roofheight * 0.9;
frontHighZ = roofheight;
midZ       = roofheight - RoofSagFactor * roofheight;
backHighZ  = roofheight;
backLowZ   = roofheight - RoofSagFactor * roofheight * 0.9;
# ----------------------------------------
rib_fornt_lower_pts = Point.ByCoordinates(x=ribXList, y=RIB_Y_Position.y0, z=rib_z_positions.frontLowZ, lacing=CrossProduct)
rib_front_high_pts = Point.ByCoordinates(x=ribXList, y=RIB_Y_Position.y1, z=rib_z_positions.frontHighZ, lacing=CrossProduct)
rib_mid_pts = Point.ByCoordinates(x=ribXList, y=RIB_Y_Position.y2, z=rib_z_positions.midZ, lacing=CrossProduct)
rib_back_mid_pts = Point.ByCoordinates(x=ribXList, y=RIB_Y_Position.y3, z=rib_z_positions.backHighZ, lacing=CrossProduct)
rib_back_lower_pts = Point.ByCoordinates(x=ribXList, y=RIB_Y_Position.y4, z=rib_z_positions.backLowZ, lacing=CrossProduct)
rib_point_rows = List.Create(item0=rib_fornt_lower_pts, item1=rib_front_high_pts, item2=rib_mid_pts, item3=rib_back_mid_pts, item4=rib_back_lower_pts)
transpose = List.Transpose(lists=rib_point_rows)
roofribcurves = NurbsCurve.ByPoints(points=transpose)
code_block_4 = CodeBlock(ribCount=rib_count) { 0..(ribCount-1); }
number = DoubleInput(150)
fronttilt = code_block_4 * number
HALFWIDTH = CodeBlock(PavilionWidth=pavilion_width) { PavilionWidth/2; }
halfwidth = CodeBlock(PavilionWidth=pavilion_width) { PavilionWidth/2; }

# group: Back and front columns connecting to the rib curves of the roof( Back supoort + roof curves + front support)
# Created the side columns from eachside of the roof and riased them and connected to the roof cruve which gives me the full rib curves going from one end to another
# I used the list fuction to add the roof and columns  ribs make them a one rib point list
number_2 = DoubleInput(1)
backpoints = Curve.PointAtParameter(curve=roofribcurves, param=number_2)
X = Point.X(point=backpoints)
Y = Point.Y(point=backpoints)
background_coordinates = Point.ByCoordinates(x=X, y=Y, z=number_2)
back_support_lines = Line.ByStartPointEndPoint(startPoint=backpoints, endPoint=background_coordinates)
rib_and_support_lists = List.Create(item0=roofribcurves, item1=back_support_lines)
transpose_2 = List.Transpose(lists=rib_and_support_lists)
roofPlusBackCurve = PolyCurve.ByJoinedCurves(curves=transpose_2, lacing=CrossProduct)
code_block_5 = CodeBlock { 0; }
front_top_points = Curve.PointAtParameter(curve=roofPlusBackCurve, param=code_block_5)
Y_2 = Point.Y(point=front_top_points)
frontground_pts = Point.ByCoordinates(x=fronttilt, y=Y_2, z=code_block_5)
front_support_lines = Line.ByStartPointEndPoint(startPoint=front_top_points, endPoint=frontground_pts)
list_create = List.Create(item0=roofPlusBackCurve, item1=front_support_lines)
transpose_3 = List.Transpose(lists=list_create)
rib_full_curves = PolyCurve.ByJoinedCurves(curves=transpose_3)
X_2 = Point.X(point=front_top_points)

# group: Material 1 Volume (mm^3)- Timber Ribs
# This section is used to the quantity take off of the Rib curves - timber
# i created a python scrip to calcuate the material volume in cubic milimeter
# *ChatGpt assitance used to debug and  identify some python fuctions to build the code*
ribwidth_left_right = DoubleSlider(120, range=80..200 step 10)
ribdepth_vertical = DoubleSlider(120, range=80..200 step 10)
timber_class = Python(IN[0]=rib_full_curves, IN[1]=ribwidth_left_right, IN[2]=ribdepth_vertical)  # PythonNet3
# ---------- timber_class.python (49 lines) ----------
import clr
clr.AddReference('ProtoGeometry')
from Autodesk.DesignScript.Geometry import *

# INPUTS

ribCurves = IN[0]   # list of curves representing rib centre-lines
ribW      = IN[1]   # rib width  (mm)
ribD      = IN[2]   # rib depth  (mm)

if ribCurves is None:
    ribCurves = []


# CLASS DEFINITION

class TimberRib:
    """
    Material 1: timber rib
    - geometry() -> returns the rib geometry
    - volume()   -> returns volume in mm^3
    """
    def __init__(self, curve, width, depth):
        self.curve  = curve
        self.width  = width
        self.depth  = depth

    def geometry(self):
        # here the 'geometry' is the centre-line curve
        return self.curve

    def volume(self):
        # rectangular cross-section: length * width * depth
        if self.curve is None:
            return 0.0
        L = self.curve.Length    # mm
        return L * self.width * self.depth   # mm^3

instances = []   # list of TimberRib objects (for the marker)
geoms     = []   # list of geometry returned by geometry()
volumes   = []   # list of volumes (mm^3)

for c in ribCurves:
    rib = TimberRib(c, ribW, ribD)  # create an instance
    instances.append(rib)
    geoms.append(rib.geometry())
    volumes.append(rib.volume())

OUT = [geoms, volumes]
# ----------------------------------------
code_block_6 = CodeBlock { 0; 1; }
RIBSOLIDS_GET = List.GetItemAtIndex(list=timber_class, index=code_block_6.out0)
timber__rib__volumes = List.GetItemAtIndex(list=timber_class, index=code_block_6.out1)
list_create_2 = List.Create(item0=timber__rib__volumes)
material_1_volume_mm_3_timber = Watch(list_create_2)  # "Material 1 Volume (mm^3)- TImber Ribs"

# group: Setting Up the floor parameter and surface of the floor and floor colour
# Width and depth sliders used to control the surface parameter within the given 10mX10m  parameter
# This new parameter is used to build the rest of the structures so they dont go past the given parameters
# *ChatGpt assitance used to debug the code block instructions and identify some function of the nodes*
pavilion_width_2 = DoubleSlider(9000, range=1000..10000 step 100)
pavilion_depth_2 = DoubleSlider(9000, range=1000..10000 step 100)
x_and_y_positions = CodeBlock(pavilionwidth=pavilion_width_2, paviliondepth=pavilion_depth_2) { pavilionwidth/2; -pavilionwidth/2; z=0; -paviliondepth/2; paviliondepth/2; }
FR = Point.ByCoordinates(x=x_and_y_positions.out0, y=x_and_y_positions.out3, z=x_and_y_positions.z)
BR = Point.ByCoordinates(x=x_and_y_positions.out0, y=x_and_y_positions.out4, z=x_and_y_positions.z)
BL = Point.ByCoordinates(x=x_and_y_positions.out1, y=x_and_y_positions.out4, z=x_and_y_positions.z)
FL = Point.ByCoordinates(x=x_and_y_positions.out1, y=x_and_y_positions.out3, z=x_and_y_positions.z)
list_create_3 = List.Create(item0=FR, item1=BR, item2=BL, item3=FL, item4=FR)
boolean = BoolSelector(false)
byPoints = PolyCurve.ByPoints(points=list_create_3, connectLastToFirst=boolean)
byPatch = Surface.ByPatch(closedCurve=byPoints)
floor_thickness = DoubleSlider(170, range=100..300 step 10)
thicken = Surface.Thicken(surface=byPatch, thickness=floor_thickness)
code_block_7 = CodeBlock { 255; 200; 195; 190; }
rib_colours = Color.ByARGB(alpha=code_block_7.out0, red=code_block_7.out1, green=code_block_7.out2, blue=code_block_7.out3)
byGeometryColor_2 = Modifiers.GeometryColor.ByGeometryColor(geometry=thicken, color=rib_colours)

# group: Seating - Ring Circle
# In this section - I created the ring circle shape seating and made look like sections of a full circle by reducing area of the cricle at 0,90,180 and 270 degree
# reduction of  the cricle area  is done using a python code , also include the slider to control the seat width, height and radius of the ring circle
# total solid area used as seats and floor surface is added using list fucntion - total_concrete, this is used to calculate material volumn 2  in this case concerete
# *ChatGpt assitance used to debug and  identify some python fuctions to build the code*
code_block_8 = CodeBlock { 0; }
byCoordinates_3 = Point.ByCoordinates(x=code_block_8, y=code_block_8, z=code_block_8)
ring_radius = DoubleSlider(3400, range=2500..3500 step 100)
byCenterPointRadius = Circle.ByCenterPointRadius(centerPoint=byCoordinates_3, radius=ring_radius)
seat_segments = IntegerSlider(21, range=5..25 step 1)
code_block_9 = CodeBlock(RingSegments=seat_segments) { 0..1..#RingSegments; }
pointAtParameter = Curve.PointAtParameter(curve=byCenterPointRadius, param=code_block_9)
python_script = Python(IN[0]=pointAtParameter)  # PythonNet3
# ---------- python_script.python (65 lines) ----------
import clr
clr.AddReference('ProtoGeometry')
from Autodesk.DesignScript.Geometry import *

import math

# IN[0]: points around the circle (RingPoints)

ring_points = IN[0]

# Flatten the list to create a simple Python list of Point objects
pts = []
if isinstance(ring_points, list):
    for item in ring_points:
        if isinstance(item, list):
            pts.extend(item)
        else:
            pts.append(item)
else:
    pts = [ring_points]

n = len(pts)

# If no points, just return empty
if n == 0:
    OUT = []
else:
    # Calculate angle of each point around the origin (0,0,0)
    angles = []
    for p in pts:
        x = p.X
        y = p.Y
        ang = math.atan2(y, x)  # -pi..+pi
        if ang < 0:
            ang += 2.0 * math.pi  # convert to 0..2pi
        angles.append(ang)

    # directions for the gaps: 0°, 90°, 180°, 270°
    targets = [
        0.0,
        0.5 * math.pi,
        1.0 * math.pi,
        1.5 * math.pi
    ]

    # tolerance ~ 60% of one segment
    # (so even if you have both 0° and 360° points they count as "front")
    tol = (2.0 * math.pi / n) * 0.6

    def is_near_any_target(angle):
        for t in targets:
            # shortest angular distance between angle and target
            diff = (angle - t + math.pi) % (2.0 * math.pi) - math.pi
            if abs(diff) < tol:
                return True
        return False

    # Build filtered list: keep points NOT around the traget  directions
    filtered = []
    for a, p in zip(angles, pts):
        if not is_near_any_target(a):
            filtered.append(p)

    # Output filtered ring points
    OUT = filtered
# ----------------------------------------
seat_wide = DoubleSlider(1300, range=600..2000 step 100)
seat_depth = DoubleSlider(1300, range=600..2000 step 100)
ring_height = DoubleSlider(380, range=200..800 step 100)
byLengths = Cuboid.ByLengths(coordinateSystem=python_script, width=seat_wide, length=seat_depth, height=ring_height)
material_2_solids_total = List.Create(item0=thicken, item1=byLengths)  # "material 2 solids - total- Concerete"
flatten = List.Flatten(list=material_2_solids_total)
code_block_10 = CodeBlock { 255; 225; 225; 230; }
rib_colours_2 = Color.ByARGB(alpha=code_block_10.out0, red=code_block_10.out1, green=code_block_10.out2, blue=code_block_10.out3)
seat_colour = Modifiers.GeometryColor.ByGeometryColor(geometry=byLengths, color=rib_colours_2)

# group: Material 2 Volume (mm^3)- Seating Blocks + Floor Surface
# In this section total solid volume of the material 2 (concrete)  is calcuated and displayed through a watch node
# python class is used to calcuate the volume
# *ChatGpt assitance used to debug and  identify some python fuctions to build the code*
seatBlock = Python(IN[0]=flatten)  # PythonNet3
# ---------- seatBlock.python (29 lines) ----------
import clr
clr.AddReference("ProtoGeometry")
from Autodesk.DesignScript.Geometry import *

seats = IN[0] or []

class ConcreteSeat:
    def __init__(self, solid):
        self.solid = solid

    def geometry(self):
        return self.solid

    def volume(self):
        if self.solid is None:
            return 0.0
        return self.solid.Volume  # mm^3

instances = []
geoms = []
volumes = []

for s in seats:
    c = ConcreteSeat(s)
    instances.append(c)
    geoms.append(c.geometry())
    volumes.append(c.volume())

OUT = [geoms, volumes]
# ----------------------------------------
code_block_11 = CodeBlock { 0; 1; }
seatblock__geometry = List.GetItemAtIndex(list=seatBlock, index=code_block_11.out0)
seatblock_volume = List.GetItemAtIndex(list=seatBlock, index=code_block_11.out1)
seatblock_volumes = List.Create(item0=seatblock_volume)
material_2_volume_mm_3_seating = Watch(seatblock_volumes)  # "Material 2 Volume (mm^3)- Seating Blocks"

# group: Rib Curves Solid and Colour
# In this section I used the combied rib curve point list to cerate the solid surface of the ribs and add colour to them
# *ChatGpt assitance and class notes infromation used to identify some function of the nodes*
ribStartPTS = Curve.PointAtParameter(curve=rib_full_curves, param=code_block_6.out0)
tangentAtParameter = Curve.TangentAtParameter(curve=roofribcurves, param=code_block_6.out0)
ribplane = Plane.ByOriginNormal(origin=ribStartPTS, normal=tangentAtParameter)
byWidthLength = Rectangle.ByWidthLength(plane=ribplane, width=ribwidth_left_right, length=ribdepth_vertical)
bySweep = Solid.BySweep(profile=byWidthLength, path=rib_full_curves)
code_block_12 = CodeBlock { 255; 200; 170; 105; }
rib_colours_3 = Color.ByARGB(alpha=code_block_12.out0, red=code_block_12.out1, green=code_block_12.out2, blue=code_block_12.out3)
byGeometryColor_3 = Modifiers.GeometryColor.ByGeometryColor(geometry=bySweep, color=rib_colours_3)
