# Dynamo graph 1574522.dyn (Dynamo 4.0.0.3277)

# group: Don't touch this ground
code_block = CodeBlock { -5000; -5000; -200; }  # frozen
byCoordinates = Point.ByCoordinates(x=code_block.out0, y=code_block.out1, z=code_block.out2)  # frozen
code_block_2 = CodeBlock { 5000; 5000; 0; }  # frozen
byCoordinates_2 = Point.ByCoordinates(x=code_block_2.out0, y=code_block_2.out1, z=code_block_2.out2)  # frozen
byCorners = Cuboid.ByCorners(lowPoint=byCoordinates, highPoint=byCoordinates_2)  # frozen
code_block_3 = CodeBlock { 0; 100; 0; }  # frozen
byARGB = Color.ByARGB(red=code_block_3.out0, green=code_block_3.out1, blue=code_block_3.out2)  # frozen
byGeometryColor = Modifiers.GeometryColor.ByGeometryColor(geometry=byCorners, color=byARGB)  # frozen

class_steel_column = Python()  # PythonNet3; unwired: IN[0]
# ---------- class_steel_column.python (16 lines) ----------
# Load the Python Standard and DesignScript Libraries
import sys
import clr
clr.AddReference('ProtoGeometry')
from Autodesk.DesignScript.Geometry import *

class column:
    def __init__(self, start_point, end_point, radius):
        self.start = start_point
        self.end = end_point
        self.radius = radius
        
    def make_geometry(self):
        return Cylinder.ByPointsRadius(self.start, self.end, self.radius)
        
OUT = column
# ----------------------------------------
width_of_pavilion = DoubleSlider(3035, range=2000..5000 step 1)
number_of_columns = DoubleSlider(14, range=5..20 step 1)
code_block_4 = CodeBlock(x=width_of_pavilion, columns=number_of_columns) { x; -4500..4500..#columns; }
code_block_5 = CodeBlock(x=code_block_4.x, y=code_block_4.out1) { x + (600 * Math.Sin(y)); y; }
byCoordinates_3 = Point.ByCoordinates(x=code_block_5.out0, y=code_block_5.y)
height_of_columns = DoubleSlider(2957, range=0..5000 step 1)
byCoordinates_4 = Point.ByCoordinates(x=code_block_4.x, y=code_block_4.out1, z=height_of_columns)
radius_of_columns = DoubleSlider(99.9, range=50..150 step 0.1)
steel_column_series = Python(IN[0]=class_steel_column, IN[1]=byCoordinates_3, IN[2]=byCoordinates_4, IN[3]=radius_of_columns)  # PythonNet3
# ---------- steel_column_series.python (24 lines) ----------
import math

column = IN[0]
start_points = IN[1]
end_points = IN[2]
radius = IN[3]

v = []
rods = []
count = min(len(start_points),len(end_points))

for i in range(count):
    r = radius
    btm = start_points[i]
    top = end_points[i]
    
    rod = column(btm, top, r)
    rods.append(rod.make_geometry())
    
    h = btm.DistanceTo(top)
    v.append(math.pi*r*r*h)
    
total_volume = sum(v)
OUT = (rods, total_volume)
# ----------------------------------------
code_block_6 = CodeBlock { 1; }
getItemAtIndex = List.GetItemAtIndex(list=steel_column_series, index=code_block_6)
code_block_7 = CodeBlock(x=width_of_pavilion, columns=number_of_columns) { -x; -4500..4500..#columns; }
code_block_8 = CodeBlock(x=code_block_7.out0, y=code_block_7.out1) { x - (600 * Math.Sin(y)); y; }
byCoordinates_5 = Point.ByCoordinates(x=code_block_8.out0, y=code_block_8.y)
byCoordinates_6 = Point.ByCoordinates(x=code_block_7.out0, y=code_block_7.out1, z=height_of_columns)
steel_column_series_2 = Python(IN[0]=class_steel_column, IN[1]=byCoordinates_5, IN[2]=byCoordinates_6, IN[3]=radius_of_columns)  # PythonNet3; same code as steel_column_series
getItemAtIndex_2 = List.GetItemAtIndex(list=steel_column_series_2, index=code_block_6)
volume_string = Python(IN[0]=getItemAtIndex, IN[1]=getItemAtIndex_2)  # PythonNet3
# ---------- volume_string.python (6 lines) ----------
vol1 = IN[0]
vol2 = IN[1]

volume = str(vol1 + vol2) + " mm³"

OUT = volume
# ----------------------------------------
total_volume_of_steel_columns = Watch(volume_string)
roof_height = DoubleSlider(335, range=0..1000 step 1)
code_block_9 = CodeBlock(z=roof_height) { 0; 0; -z; }
byCoordinates_7 = Vector.ByCoordinates(x=code_block_9.out0, y=code_block_9.out1, z=code_block_9.out2)
translate = Geometry.Translate(geometry=byCoordinates_6, direction=byCoordinates_7)
X = Point.X(point=translate)
translate_2 = Geometry.Translate(geometry=byCoordinates_4, direction=byCoordinates_7)
X_2 = Point.X(point=translate_2)
curvature_of_wooden_beams = DoubleSlider(22, range=0..50 step 1)
Z = Point.Z(point=translate)
code_block_10 = CodeBlock(x1=X, x2=X_2, points=curvature_of_wooden_beams, height=Z) { x=x1..x2..#points; z = height - 7*Math.Sqrt(Math.Abs(x))*(Math.Sin(x)); }
Y = Point.Y(point=translate)
byCoordinates_8 = Point.ByCoordinates(x=code_block_10.x, y=Y, z=code_block_10.z)
code_block_11 = CodeBlock { 3; }
byPoints = NurbsCurve.ByPoints(points=byCoordinates_8, degree=code_block_11)
height_of_wood_beams = DoubleSlider(137, range=0..200 step 1)
byThickeningCurveNormal = PolyCurve.ByThickeningCurveNormal(curve=byPoints, thickness=height_of_wood_beams)
byPatch = Surface.ByPatch(closedCurve=byThickeningCurveNormal)
thickness_of_wood_beams = IntegerSlider(80, range=0..150 step 1)
class_wood_beams = Python(IN[0]=byPatch, IN[1]=thickness_of_wood_beams)  # PythonNet3
# ---------- class_wood_beams.python (30 lines) ----------
# Load the Python Standard and DesignScript Libraries
import sys
import clr
clr.AddReference('ProtoGeometry')
from Autodesk.DesignScript.Geometry import *

surfaces = IN[0]
thickness = IN[1]

solids = []
volumes = []

for surf in surfaces:
    if surf is None:
        solids.append(None)
        volumes.append(0)
        continue

    try:
        solid = surf.Thicken(thickness, True)  
        solids.append(solid)
        volumes.append(solid.Volume)
    except:
        solids.append(None)
        volumes.append(0)


total_volume = sum(volumes)

OUT = solids, volumes, total_volume
# ----------------------------------------
code_block_12 = CodeBlock { 2; }
getItemAtIndex_3 = List.GetItemAtIndex(list=class_wood_beams, index=code_block_12)
volume_string_2 = Python(IN[0]=getItemAtIndex_3)  # PythonNet3
# ---------- volume_string_2.python (5 lines) ----------
vol = IN[0]

total_volume = str(vol) + " mm³"

OUT = total_volume
# ----------------------------------------
total_volume_of_wood_beams = Watch(volume_string_2)
code_block_13 = CodeBlock { 0; }
getItemAtIndex_4 = List.GetItemAtIndex(list=class_wood_beams, index=code_block_13)
color_palette = ColorPalette({R: 0, G: 39, B: 153, A: 255})
wood_beam_color = Modifiers.GeometryColor.ByGeometryColor(geometry=getItemAtIndex_4, color=color_palette)
code_block_14 = CodeBlock { 0; }
getItemAtIndex_5 = List.GetItemAtIndex(list=steel_column_series, index=code_block_14)
color_palette_2 = ColorPalette({R: 77, G: 38, B: 0, A: 255})
byGeometryColor_2 = Modifiers.GeometryColor.ByGeometryColor(geometry=getItemAtIndex_5, color=color_palette_2)
getItemAtIndex_6 = List.GetItemAtIndex(list=steel_column_series_2, index=code_block_14)
color_palette_3 = ColorPalette({R: 77, G: 38, B: 0, A: 255})
byGeometryColor_3 = Modifiers.GeometryColor.ByGeometryColor(geometry=getItemAtIndex_6, color=color_palette_3)
