# Dynamo graph 1662605.dyn (Dynamo 3.6.0.9395)

# group: Don't touch this ground
code_block = CodeBlock { -5000; -5000; -200; }
byCoordinates = Point.ByCoordinates(x=code_block.out0, y=code_block.out1, z=code_block.out2)
code_block_2 = CodeBlock { 5000; 5000; 0; }
byCoordinates_2 = Point.ByCoordinates(x=code_block_2.out0, y=code_block_2.out1, z=code_block_2.out2)
byCorners = Cuboid.ByCorners(lowPoint=byCoordinates, highPoint=byCoordinates_2)
code_block_3 = CodeBlock { 0; 100; 0; }
byARGB = Color.ByARGB(red=code_block_3.out0, green=code_block_3.out1, blue=code_block_3.out2)
byGeometryColor = Modifiers.GeometryColor.ByGeometryColor(geometry=byCorners, color=byARGB)

# group: Slider #1
space_between_columns = DoubleSlider(3800, range=3000..4000 step 100)

n1 = DoubleInput(-1)  # "(-1)"
negative_value_of_space = space_between_columns * n1
x_coordinates_base_of_beams = List.Create(item0=space_between_columns, item1=space_between_columns, item2=negative_value_of_space, item3=negative_value_of_space)
y_coordinates_base_of_beams = List.Create(item0=space_between_columns, item1=negative_value_of_space, item2=negative_value_of_space, item3=space_between_columns)
base_z_value = DoubleInput(0)
bottom_column_coordinates = Point.ByCoordinates(x=x_coordinates_base_of_beams, y=y_coordinates_base_of_beams, z=base_z_value)
height_of_lower_columns = DoubleInput(3000)

# group: Slider #2
height_of_taller_columns = DoubleSlider(4400, range=3000..5000 step 100)

z_values_of_columns = List.Create(item0=height_of_lower_columns, item1=height_of_lower_columns, item2=height_of_taller_columns, item3=height_of_taller_columns)
top_column_coordinates = Point.ByCoordinates(x=x_coordinates_base_of_beams, y=y_coordinates_base_of_beams, z=z_values_of_columns)
code_block_4 = CodeBlock { 2; }
half_of_shorter_columns = height_of_lower_columns / code_block_4
half_of_taller_columns = height_of_taller_columns / code_block_4
half_of_the_beam_heights = List.Create(item0=half_of_shorter_columns, item1=half_of_shorter_columns, item2=half_of_taller_columns, item3=half_of_taller_columns)
center_point_of_columns = Point.ByCoordinates(x=x_coordinates_base_of_beams, y=y_coordinates_base_of_beams, z=half_of_the_beam_heights)
column_width_length = DoubleInput(350)
colums = Cuboid.ByLengths(origin=center_point_of_columns, width=column_width_length, length=column_width_length, height=z_values_of_columns)

# group: Slider #3
overhang_of_roof = DoubleSlider(1.25, range=1.05..1.25 step 0.05)

roof_coordinate = space_between_columns * overhang_of_roof
overhang_distance = roof_coordinate - space_between_columns
opposite = height_of_taller_columns - height_of_lower_columns
number = DoubleInput(2)
adjacent = space_between_columns * number
tan_opp_adj = opposite / adjacent
angle = Math.Atan(ratio=tan_opp_adj)
tan = Math.Tan(angle=angle)
change_in_z_direction = overhang_distance * tan
number_2 = DoubleInput(-1)
negative_change_in_z_direction = change_in_z_direction * number_2
low_side = negative_change_in_z_direction + height_of_lower_columns
tall_side = change_in_z_direction + height_of_taller_columns
roof_edge_coordinates = List.Create(item0=low_side, item1=low_side, item2=tall_side, item3=tall_side)

# group: Class#1
circular_steel_class_base_of = Python()  # "Circular Steel Class (base of tables)"; CPython3; unwired: IN[0]
# ---------- circular_steel_class_base_of.python (28 lines) ----------
# Load the Python Standard and DesignScript Libraries
import sys
import clr
clr.AddReference('ProtoGeometry')
from Autodesk.DesignScript.Geometry import *

class CircularSteel:
    def __init__(self, centerline, radius):
        self.centerline = centerline
        self.radius = radius
        
    def endpoints(self):
        return self.centerline.StartPoint, self.centerline.EndPoint
        
    def make_geometry(self):
        end1, end2 = self.endpoints()
        
        return Cylinder.ByPointsRadius(end1,end2,self.radius) 
        
    def measure_volume(self):
        end1, end2 = self.endpoints()
        return end1.DistanceTo(end2)*self.radius*self.radius*3.14
        
 
OUT = CircularSteel  
    
    
        
# ----------------------------------------

code_block_5 = CodeBlock { 0; 760; 100; 2000; -2000; 300; 800; 800; }
bottom_of_table_leg = Point.ByCoordinates(x=code_block_5.out0, y=code_block_5.out0, z=code_block_5.out0)

# group: Slider #5
height_of_table = DoubleSlider(750, range=600..1000 step 50)

top_of_table_leg = Point.ByCoordinates(x=code_block_5.out0, y=code_block_5.out0, z=height_of_table)
table_leg_line = Line.ByStartPointEndPoint(startPoint=bottom_of_table_leg, endPoint=top_of_table_leg)
table_2_leg = Geometry.Translate(geometry=table_leg_line, xTranslation=code_block_5.out3, yTranslation=code_block_5.out3, zTranslation=code_block_5.out0)
circular_steel_instance2 = Python(IN[0]=circular_steel_class_base_of, IN[1]=table_2_leg, IN[2]=code_block_5.out2)  # CPython3
# ---------- circular_steel_instance2.python (4 lines) ----------
CircularSteel = IN[0]
bottomSteel = CircularSteel(IN[1],IN[2])

OUT = [bottomSteel.make_geometry(), bottomSteel.measure_volume()]
# ----------------------------------------
table_3_leg = Geometry.Translate(geometry=table_leg_line, xTranslation=code_block_5.out3, yTranslation=code_block_5.out4, zTranslation=code_block_5.out0)
circular_steel_instance3 = Python(IN[0]=circular_steel_class_base_of, IN[1]=table_3_leg, IN[2]=code_block_5.out2)  # CPython3; same code as circular_steel_instance2
table_4_leg = Geometry.Translate(geometry=table_leg_line, xTranslation=code_block_5.out4, yTranslation=code_block_5.out4, zTranslation=code_block_5.out0)
circular_steel_instance4 = Python(IN[0]=circular_steel_class_base_of, IN[1]=table_4_leg, IN[2]=code_block_5.out2)  # CPython3; same code as circular_steel_instance2
table_5_leg = Geometry.Translate(geometry=table_leg_line, xTranslation=code_block_5.out4, yTranslation=code_block_5.out3, zTranslation=code_block_5.out0)
circular_steel_instance5 = Python(IN[0]=circular_steel_class_base_of, IN[1]=table_5_leg, IN[2]=code_block_5.out2)  # CPython3; same code as circular_steel_instance2
table_thickness = height_of_table + code_block_5.out2
top_of_table_surface = Point.ByCoordinates(x=code_block_5.out0, y=code_block_5.out0, z=table_thickness)
table_1_tabletop = Cylinder.ByPointsRadius(startPoint=top_of_table_leg, endPoint=top_of_table_surface, radius=code_block_5.out6)
table_2_tabletop = Geometry.Translate(geometry=table_1_tabletop, xTranslation=code_block_5.out3, yTranslation=code_block_5.out3, zTranslation=code_block_5.out0)
table_3_tabletop = Geometry.Translate(geometry=table_1_tabletop, xTranslation=code_block_5.out3, yTranslation=code_block_5.out4, zTranslation=code_block_5.out0)
table_4_tabletop = Geometry.Translate(geometry=table_1_tabletop, xTranslation=code_block_5.out4, yTranslation=code_block_5.out4, zTranslation=code_block_5.out0)
table_5_tabletop = Geometry.Translate(geometry=table_1_tabletop, xTranslation=code_block_5.out4, yTranslation=code_block_5.out3, zTranslation=code_block_5.out0)
circular_steel_instance_1 = Python(IN[0]=circular_steel_class_base_of, IN[1]=table_leg_line, IN[2]=code_block_5.out2)  # CPython3; same code as circular_steel_instance2

# group: Volume
watch = Watch(circular_steel_instance_1)

x_y = space_between_columns * overhang_of_roof
code_block_6 = CodeBlock { -1; 10; 500; 200; 0; 1; 2; -2; }
mul = space_between_columns * overhang_of_roof
x_y_2 = code_block_6.out0 * mul

# group: Slider#4
how_many_roof_cylinders_do_we = DoubleSlider(24, range=20..59 step 2)  # "How many Roof Cylinders do we want?"

add = how_many_roof_cylinders_do_we + code_block_6.out5
div = code_block_6.out7 / how_many_roof_cylinders_do_we
STEP = x_y_2 * div
sequence = Sequence(start=x_y_2, amount=add, step=STEP)
byCoordinates_3 = Point.ByCoordinates(x=x_y, y=sequence, z=low_side)
tall_side_points = Point.ByCoordinates(x=x_y_2, y=sequence, z=tall_side)
div_2 = STEP / code_block_6.out6
sequence_2 = Sequence(start=div_2, amount=add, step=code_block_6.out4)

# group: Class #2
circular_rods_class_roof = Python()  # CPython3; unwired: IN[0]
# ---------- circular_rods_class_roof.python (30 lines) ----------
# Load the Python Standard and DesignScript Libraries
import sys
import clr
clr.AddReference('ProtoGeometry')
from Autodesk.DesignScript.Geometry import *

# The inputs to this node will be stored as a list in the IN variables.


# Place your code below this line

class CircularRod:
    def __init__(self, bottom_point, top_point, radius):
        self.bottom = bottom_point
        self.top = top_point
        self.radius = radius
       
    def endpoints(self):
        return self.bottom, self.top
        
    def make_geometry(self):
        return Cylinder.ByPointsRadius(self.bottom, self.top, self.radius)
        
    def measure_volume(self):
        bottom, top = self.endpoints()
        return bottom.DistanceTo(top)*self.radius*self.radius*3.14
        
    
# Assign your output to the OUT variable.
OUT = CircularRod
# ----------------------------------------

# group: Series of Instances#1
series_of_instances = Python(IN[0]=byCoordinates_3, IN[1]=tall_side_points, IN[2]=sequence_2, IN[3]=circular_rods_class_roof)  # CPython3
# ---------- series_of_instances.python (18 lines) ----------
CircularRod = IN[3]
bottom_points = IN[0]
top_points = IN[1]
radii = IN[2]

rods = []
count = min(len(bottom_points),len(top_points))

for i in range(count):
    r = radii[i] if i < len(radii) else radii[-1]
    btm = bottom_points[i]
    top = top_points[i]
    
    rod = CircularRod(btm, top, r)
    rods.append(rod.make_geometry())
    
OUT = [rods, rod.measure_volume()]
    
# ----------------------------------------

# group: Volume (very bottom)
watch_2 = Watch(series_of_instances)

code_block_7 = CodeBlock {  }
