# Dynamo graph 1717927.dyn "dynamo.bearpaw" (Dynamo 3.5.2.8914)

# group: Don't touch this ground
code_block = CodeBlock { -5000; -5000; -200; }
byCoordinates = Point.ByCoordinates(x=code_block.out0, y=code_block.out1, z=code_block.out2)
code_block_2 = CodeBlock { 5000; 5000; 0; }
byCoordinates_2 = Point.ByCoordinates(x=code_block_2.out0, y=code_block_2.out1, z=code_block_2.out2)
byCorners = Cuboid.ByCorners(lowPoint=byCoordinates, highPoint=byCoordinates_2)
code_block_3 = CodeBlock { 0; 100; 0; }
byARGB = Color.ByARGB(red=code_block_3.out0, green=code_block_3.out1, blue=code_block_3.out2)
byGeometryColor = Modifiers.GeometryColor.ByGeometryColor(geometry=byCorners, color=byARGB)

number_slider = DoubleSlider(8, range=1..20 step 1)
branch_count = CodeBlock(branch_count=number_slider) { branch_count; }
code_block_4 = CodeBlock(branch_count=number_slider) { step = 360/branch_count; }
sequence = Sequence(amount=branch_count, step=code_block_4)
trunk_height = IntegerSlider(1100, range=0..3500 step 100)
trunk_radius_mid = IntegerSlider(300, range=100..500 step 50)
branch_base = Point.ByCylindricalCoordinates(angle=sequence, elevation=trunk_height, radius=trunk_radius_mid)
canopy_height = IntegerSlider(3300, range=1500..4000 step 100)
palm_radius = IntegerSlider(2600, range=2500..4500 step 100)
branch_tip = Point.ByCylindricalCoordinates(angle=sequence, elevation=canopy_height, radius=palm_radius)
integer_slider = IntegerSlider(100, range=100..1000 step 100)
toe_arc_angle = IntegerSlider(120, range=80..120 step 10)
code_block_5 = CodeBlock(toe_arc_angle=toe_arc_angle) { start = -toe_arc_angle/2; }
code_block_6 = CodeBlock(toe_arc_angle=toe_arc_angle) { start = toe_arc_angle/2; }
toe_count = IntegerSlider(25, range=0..100 step 1)
range = Range(start=code_block_5, end=code_block_6, step=toe_count)
trunk_radius_base = IntegerSlider(600, range=300..800 step 100)
toe_base_on_trunk = Point.ByCylindricalCoordinates(angle=range, radius=trunk_radius_base)
toe_spacing_radius = IntegerSlider(3600, range=2000..6000 step 100)
toe_centre = Point.ByCylindricalCoordinates(angle=range, elevation=canopy_height, radius=toe_spacing_radius)
toe_radius_y = IntegerSlider(800, range=500..1200 step 100)
toe_radius_x = IntegerSlider(400, range=300..800 step 100)
toe_ellipse = Ellipse.ByOriginRadii(origin=toe_centre, xAxisRadius=toe_radius_y, yAxisRadius=toe_radius_x)
centerPoint = Ellipse.CenterPoint(ellipse=toe_ellipse)
toerad = DoubleSlider(140, range=10..300 step 10)
python_script = Python(IN[0]=branch_base, IN[1]=branch_tip, IN[2]=integer_slider, IN[3]=toe_base_on_trunk, IN[4]=centerPoint, IN[5]=toerad)  # CPython3
# ---------- python_script.python (98 lines) ----------
import clr
clr.AddReference('ProtoGeometry')
from Autodesk.DesignScript.Geometry import *

# ---------- CLASSES ----------

class SteelBranch:
    """
    Material 1: steel branch members
    Geometry: cylinder between two points
    """
    def __init__(self, start_point, end_point, radius):
        self.start = start_point
        self.end = end_point
        self.radius = radius

    def geometry(self):
        # Create a cylindrical branch
        return Cylinder.ByPointsRadius(self.start, self.end, self.radius)

    def volume(self):
        # Volume in mm^3 
        return self.geometry().Volume


class ConcreteToeSupport:
    """
    Material 2: concrete toe supports
    Geometry: cylinder between toe and ground
    """
    def __init__(self, bottom_point, top_point, radius):
        self.bottom = bottom_point
        self.top = top_point
        self.radius = radius

    def geometry(self):
        return Cylinder.ByPointsRadius(self.bottom, self.top, self.radius)

    def volume(self):
        return self.geometry().Volume




branch_start = IN[0]  # list of branch base points
branch_end   = IN[1]  # list of branch tip points
branch_r     = IN[2]  # single radius value

toe_bottom   = IN[3]  # list of toe ground points
toe_top      = IN[4]  # list of toe centre points
toe_r        = IN[5]  # single radius value


# ---------- CREATE BRANCH INSTANCES ----------

branch_geoms = []
branch_vols  = []

if isinstance(branch_start, list):
    for s, e in zip(branch_start, branch_end):
        b = SteelBranch(s, e, branch_r)
        geom = b.geometry()
        branch_geoms.append(geom)
        branch_vols.append(b.volume())
else:
    b = SteelBranch(branch_start, branch_end, branch_r)
    geom = b.geometry()
    branch_geoms = [geom]
    branch_vols  = [b.volume()]

total_branch_volume = sum(branch_vols)


# ---------- CREATE TOE SUPPORT INSTANCES ----------

toe_geoms = []
toe_vols  = []

if isinstance(toe_bottom, list):
    for btm, top in zip(toe_bottom, toe_top):
        t = ConcreteToeSupport(btm, top, toe_r)
        geom = t.geometry()
        toe_geoms.append(geom)
        toe_vols.append(t.volume())
else:
    t = ConcreteToeSupport(toe_bottom, toe_top, toe_r)
    geom = t.geometry()
    toe_geoms = [geom]
    toe_vols  = [t.volume()]

total_toe_volume = sum(toe_vols)

OUT = [
    branch_geoms,
    total_branch_volume,
    toe_geoms,
    total_toe_volume
]
# ----------------------------------------
code_block_7 = CodeBlock { 1; }
getItemAtIndex = List.GetItemAtIndex(list=python_script, index=code_block_7)
branches_volume_mm_3 = Watch(getItemAtIndex)
code_block_8 = CodeBlock { 3; }
getItemAtIndex_2 = List.GetItemAtIndex(list=python_script, index=code_block_8)
toe_supports_volume_mm_3 = Watch(getItemAtIndex_2)
trunk_base_coord = Point.ByCoordinates()
trunk_base = Circle.ByCenterPointRadius(centerPoint=trunk_base_coord, radius=trunk_radius_base)
trunk_mid_coord = Point.ByCoordinates(z=trunk_height)
trunk_mid = Circle.ByCenterPointRadius(centerPoint=trunk_mid_coord, radius=trunk_radius_mid)
number_slider_2 = DoubleSlider(0, range=0..100 step 0.1)
number_slider_3 = DoubleSlider(0, range=0..100 step 0.1)
trunk_top_coord = Point.ByCoordinates(x=number_slider_2, y=number_slider_3, z=canopy_height)
trunk_radius_top = IntegerSlider(900, range=150..1000 step 50)
trunk_top = Circle.ByCenterPointRadius(centerPoint=trunk_top_coord, radius=trunk_radius_top)
list_create = List.Create(item0=trunk_base, item1=trunk_mid, item2=trunk_top)
byLoft = Surface.ByLoft(crossSections=list_create)
color_palette = ColorPalette({R: 77, G: 19, B: 0, A: 255})
byGeometryColor_2 = Modifiers.GeometryColor.ByGeometryColor(geometry=byLoft, color=color_palette)
byPatch = Surface.ByPatch(closedCurve=toe_ellipse)
thickness = DoubleSlider(50, range=50..150 step 10)
thicken = Surface.Thicken(surface=byPatch, thickness=thickness)
color_palette_2 = ColorPalette({R: 255, G: 218, B: 33, A: 255})
byGeometryColor_3 = Modifiers.GeometryColor.ByGeometryColor(geometry=thicken, color=color_palette_2)
code_block_9 = CodeBlock { 0; }
code_block_10 = CodeBlock { 0; }
palm_center = Point.ByCoordinates(x=code_block_9, y=code_block_10, z=canopy_height)
palm = Circle.ByCenterPointRadius(centerPoint=palm_center, radius=palm_radius)
byPatch_2 = Surface.ByPatch(closedCurve=palm)
thicken_2 = Surface.Thicken(surface=byPatch_2, thickness=thickness)
color_palette_3 = ColorPalette({R: 0, G: 204, B: 51, A: 255})
byGeometryColor_4 = Modifiers.GeometryColor.ByGeometryColor(geometry=thicken_2, color=color_palette_3)
byPointsRadius = Cylinder.ByPointsRadius(startPoint=centerPoint, endPoint=toe_base_on_trunk, radius=toerad)
color_palette_4 = ColorPalette({R: 119, G: 65, B: 12, A: 255})
byGeometryColor_5 = Modifiers.GeometryColor.ByGeometryColor(geometry=byPointsRadius, color=color_palette_4)
branch = Cylinder.ByPointsRadius(startPoint=branch_base, endPoint=branch_tip, radius=integer_slider)
byGeometryColor_6 = Modifiers.GeometryColor.ByGeometryColor(geometry=branch, color=color_palette_4)
