# Dynamo graph 1748171.dyn "DynamoAssignment_szadnik" (Dynamo 3.6.0.9395)

code_block = CodeBlock { -5000; -5000; -200; }
byCoordinates = Point.ByCoordinates(x=code_block.out0, y=code_block.out1, z=code_block.out2)
code_block_2 = CodeBlock { 5000; 5000; 0; }
byCoordinates_2 = Point.ByCoordinates(x=code_block_2.out0, y=code_block_2.out1, z=code_block_2.out2)
byCorners = Cuboid.ByCorners(lowPoint=byCoordinates, highPoint=byCoordinates_2)
code_block_3 = CodeBlock { 0; 100; 0; }
byARGB = Color.ByARGB(red=code_block_3.out0, green=code_block_3.out1, blue=code_block_3.out2)
byGeometryColor = Modifiers.GeometryColor.ByGeometryColor(geometry=byCorners, color=byARGB)
code_block_4 = CodeBlock { 4000; 4000; 0; }
byCoordinates_3 = Point.ByCoordinates(x=code_block_4.out0, y=code_block_4.out1, z=code_block_4.out2)
code_block_5 = CodeBlock { 4000; 4000; 2000; }
byCoordinates_4 = Point.ByCoordinates(x=code_block_5.out0, y=code_block_5.out1, z=code_block_5.out2)
number_slider = DoubleSlider(201, range=1..5000 step 50)
circular_rod = Python()  # CPython3; unwired: IN[0]
# ---------- circular_rod.python (15 lines) ----------
# Load the Python Standard and DesignScript Libraries
import sys
import clr
clr.AddReference('ProtoGeometry')
from Autodesk.DesignScript.Geometry import *

class CircularRod:
    def __init__(self, bottom_point, top_point, radius):
        self.bottom = bottom_point
        self.top = top_point
        self.radius = radius
        
    def make_geometry(self):
     return Cylinder.ByPointsRadius (self.bottom, self.top, self.radius)
OUT = CircularRod   
# ----------------------------------------
single_instance = Python(IN[0]=byCoordinates_3, IN[1]=byCoordinates_4, IN[2]=number_slider, IN[3]=circular_rod)  # CPython3
# ---------- single_instance.python (3 lines) ----------
CircularRod = IN[3]
b = CircularRod(IN[0], IN[1], IN[2])
OUT = b.make_geometry()
# ----------------------------------------
code_block_6 = CodeBlock { -4000; -4000; 0; }
byCoordinates_5 = Point.ByCoordinates(x=code_block_6.out0, y=code_block_6.out1, z=code_block_6.out2)
code_block_7 = CodeBlock { -4000; -4000; 2000; }
byCoordinates_6 = Point.ByCoordinates(x=code_block_7.out0, y=code_block_7.out1, z=code_block_7.out2)
number_slider_2 = DoubleSlider(201, range=1..5000 step 50)
circular_rod_2 = Python()  # CPython3; unwired: IN[0]; same code as circular_rod
single_instance_2 = Python(IN[0]=byCoordinates_5, IN[1]=byCoordinates_6, IN[2]=number_slider_2, IN[3]=circular_rod_2)  # CPython3; same code as single_instance
