# Dynamo graph 1756233.dyn "ibssa" (Dynamo 3.6.0.9395)

# group: Don't touch this ground
code_block = CodeBlock { -5000; -5000; -200; }
byCoordinates = Point.ByCoordinates(x=code_block.out0, y=code_block.out1, z=code_block.out2)
code_block_2 = CodeBlock { 5000; 5000; 0; }
byCoordinates_2 = Point.ByCoordinates(x=code_block_2.out0, y=code_block_2.out1, z=code_block_2.out2)
byCorners = Cuboid.ByCorners(lowPoint=byCoordinates, highPoint=byCoordinates_2)
code_block_3 = CodeBlock { 0; 100; 0; }
byARGB = Color.ByARGB(red=code_block_3.out0, green=code_block_3.out1, blue=code_block_3.out2)
byGeometryColor = Modifiers.GeometryColor.ByGeometryColor(geometry=byCorners, color=byARGB)

pav_length = DoubleSlider(6000, range=4000..10000 step 500)
pav_width = DoubleSlider(5000, range=4000..10000 step 500)
frame_count = IntegerSlider(3, range=3..10 step 1)
roof_height = DoubleSlider(1600, range=1000..3000 step 100)
python_script = Python(IN[0]=pav_length, IN[1]=pav_width, IN[2]=frame_count, IN[3]=roof_height)  # CPython3
# ---------- python_script.python (86 lines) ----------
import sys
import clr
clr.AddReference('ProtoGeometry')
from Autodesk.DesignScript.Geometry import *



class TimberFrame:
   
    def __init__(self, y_loc, width, col_h, roof_h, thick):
        self.y = y_loc
        self.w = width
        self.ch = col_h
        self.rh = roof_h
        self.t = thick
        
    def generate_geometry(self):
       
        col_l = Cuboid.ByLengths(Point.ByCoordinates(-self.w/2, self.y, 0), self.t, self.t, self.ch)
        col_r = Cuboid.ByLengths(Point.ByCoordinates(self.w/2, self.y, 0), self.t, self.t, self.ch)
        
        
        peak = Point.ByCoordinates(0, self.y, self.ch + self.rh)
        base_l = Point.ByCoordinates(-self.w/2, self.y, self.ch/2) 
        base_r = Point.ByCoordinates(self.w/2, self.y, self.ch/2)
        return [col_l, col_r]

    def get_peak_point(self):
   
        return Point.ByCoordinates(0, self.y, self.ch + self.rh/2 + self.rh) 

class SteelRoof:
 
    def __init__(self, length, width, col_h, roof_h):
        self.l = length
        self.w = width
        self.ch = col_h
        self.rh = roof_h
        
    def generate_geometry(self):
        p1 = Point.ByCoordinates(-self.w/2, -self.l/2, self.ch/2)
        p2 = Point.ByCoordinates(0, -self.l/2, self.ch/2 + self.rh)
        p3 = Point.ByCoordinates(self.w/2, -self.l/2, self.ch/2)
        
        
        profile = PolyCurve.ByPoints([p1, p2, p3])
        surface = profile.Extrude(Vector.ByCoordinates(0, 1, 0), self.l)
        solid_roof = surface.Thicken(50) 
        return solid_roof

    def get_volume(self):
        return 0.0 


pav_len = IN[0]
pav_wid = IN[1]
num_frames = IN[2]
roof_h = IN[3]
col_h = 3000 
beam_thick = 200 



timber_geometry = []
frame_instances = []


spacing = pav_len / (num_frames - 1)
start_y = -pav_len / 2

 
for i in range(num_frames):
    current_y = start_y + (i * spacing)
    
    
    frame = TimberFrame(current_y, pav_wid, col_h, roof_h, beam_thick)
    frame_instances.append(frame)
    
    
    timber_geometry.extend(frame.generate_geometry())


roof_obj = SteelRoof(pav_len, pav_wid, col_h, roof_h)
roof_geometry = roof_obj.generate_geometry()

OUT = timber_geometry, roof_geometry
# ----------------------------------------
code_block_4 = CodeBlock(data=python_script) { Timber = data[0]; Steel = data[1]; }
volume = Solid.Volume(solid=code_block_4.Timber)
sum = Math.Sum(values=volume)
watch = Watch(sum)
volume_2 = Solid.Volume(solid=code_block_4.Steel)
sum_2 = Math.Sum(values=volume_2)
watch_2 = Watch(sum_2)
color_palette = ColorPalette({R: 155, G: 76, B: 3, A: 255})
byGeometryColor_2 = Modifiers.GeometryColor.ByGeometryColor(geometry=code_block_4.Timber, color=color_palette)
color_palette_2 = ColorPalette({R: 255, G: 255, B: 0, A: 255})
byGeometryColor_3 = Modifiers.GeometryColor.ByGeometryColor(geometry=code_block_4.Steel, color=color_palette_2)
