# Dynamo graph 1762304.dyn (Dynamo 3.6.0.9395)

# group: Don't touch this ground
code_block = CodeBlock { -5000; -5000; -200; }
byCoordinates = Point.ByCoordinates(x=code_block.out0, y=code_block.out1, z=code_block.out2)
code_block_2 = CodeBlock { 5000; 5000; 0; }
byCoordinates_2 = Point.ByCoordinates(x=code_block_2.out0, y=code_block_2.out1, z=code_block_2.out2)
byCorners = Cuboid.ByCorners(lowPoint=byCoordinates, highPoint=byCoordinates_2)
code_block_3 = CodeBlock { 0; 100; 0; }
byARGB = Color.ByARGB(red=code_block_3.out0, green=code_block_3.out1, blue=code_block_3.out2)
byGeometryColor = Modifiers.GeometryColor.ByGeometryColor(geometry=byCorners, color=byARGB)

left_leg_x = IntegerSlider(-4500, range=-4500..-2000 step 1)
left_leg_y = IntegerSlider(-3200, range=-3200..-1 step 1)
bottom_left_leg = Point.ByCoordinates(x=left_leg_x, y=left_leg_y)
code_block_4 = CodeBlock(x=left_leg_y) { x; y = -x; }
bottom_middle_left = Point.ByCoordinates(x=left_leg_x, y=code_block_4.y)
bottom_left = Line.ByStartPointEndPoint(startPoint=bottom_left_leg, endPoint=bottom_middle_left)
middle_x = IntegerSlider(-3500, range=-3500..-1 step 1)
middle_y = IntegerSlider(4000, range=4000..4600 step 1)
bottom_middle_left_2 = Point.ByCoordinates(x=middle_x, y=middle_y)
code_block_5 = CodeBlock(x=middle_x) { x; y = -x; }
bottom_middle_right = Point.ByCoordinates(x=code_block_5.y, y=middle_y)
bottom_middle = Line.ByStartPointEndPoint(startPoint=bottom_middle_left_2, endPoint=bottom_middle_right)
right_leg_x = IntegerSlider(4500, range=2000..4500 step 1)
right_leg_y = IntegerSlider(-3200, range=-3200..-1 step 1)
code_block_6 = CodeBlock(x=right_leg_y) { x; y = -x; }
bottom_middle_right_2 = Point.ByCoordinates(x=right_leg_x, y=code_block_6.y)
bottom_right_leg = Point.ByCoordinates(x=right_leg_x, y=right_leg_y)
bottom_right = Line.ByStartPointEndPoint(startPoint=bottom_middle_right_2, endPoint=bottom_right_leg)
left_glass_height = IntegerSlider(6000, range=1000..15000 step 1)
upper_left_leg = Point.ByCoordinates(x=left_leg_x, y=left_leg_y, z=left_glass_height)
upper_middle_left = Point.ByCoordinates(x=left_leg_x, y=code_block_4.y, z=left_glass_height)
upper_left = Line.ByStartPointEndPoint(startPoint=upper_left_leg, endPoint=upper_middle_left)
middle_glass_height = IntegerSlider(6000, range=1000..15000 step 1)
upper_middle_left_2 = Point.ByCoordinates(x=middle_x, y=middle_y, z=middle_glass_height)
upper_middle_right = Point.ByCoordinates(x=code_block_5.y, y=middle_y, z=middle_glass_height)
upper_middle = Line.ByStartPointEndPoint(startPoint=upper_middle_left_2, endPoint=upper_middle_right)
right_glass_height = IntegerSlider(6000, range=1000..15000 step 1)
upper_right_leg = Point.ByCoordinates(x=right_leg_x, y=right_leg_y, z=right_glass_height)
upper_middle_right_2 = Point.ByCoordinates(x=right_leg_x, y=code_block_6.y, z=right_glass_height)
upper_right = Line.ByStartPointEndPoint(startPoint=upper_right_leg, endPoint=upper_middle_right_2)
stainedglass_sg_class = Python()  # CPython3; unwired: IN[0]
# ---------- stainedglass_sg_class.python (27 lines) ----------
# Load the Python Standard and DesignScript Libraries
import sys
import clr
clr.AddReference('ProtoGeometry')
from Autodesk.DesignScript.Geometry import *
import math

class StainedGlass:
    def __init__(self, high_point, low_point, thickness, height, length):
        self.high = high_point
        self.low = low_point
        self.thickness = thickness
        self.height = height
        self.length = length
        
    def endpoints(self):
        return self.high, self.low
    
    def make_geometry(self):
        high, low = self.endpoints()
        
        return Cuboid.ByCorners(low, high)
    
    def measure_volume(self):
        volume = (self.length * 2) * self.height * (self.thickness *2)
        return volume
OUT = StainedGlass   
# ----------------------------------------
thickness_left = IntegerSlider(200, range=1..500 step 1)
code_block_7 = CodeBlock(x=left_leg_x, y=thickness_left) { x; y; z = x + y; }
byCoordinates_3 = Point.ByCoordinates(x=code_block_7.z, y=code_block_4.y, z=left_glass_height)
code_block_8 = CodeBlock(x=left_leg_x, y=thickness_left) { x; y; z = x - y; }
byCoordinates_4 = Point.ByCoordinates(x=code_block_8.z, y=left_leg_y)
sg_instance_left = Python(IN[0]=stainedglass_sg_class, IN[1]=byCoordinates_3, IN[2]=byCoordinates_4, IN[3]=thickness_left, IN[4]=left_glass_height, IN[5]=code_block_4.y)  # CPython3
# ---------- sg_instance_left.python (18 lines) ----------
# Load the Python Standard and DesignScript Libraries
import sys
import clr
clr.AddReference('ProtoGeometry')
from Autodesk.DesignScript.Geometry import *
import math

StainedGlass = IN[0]
high = IN[1]
low = IN[2]
thickness = IN[3]
height = IN[4]
length = IN[5]

wall = StainedGlass(high, low, thickness, height, length)
volume = wall.measure_volume()

OUT = wall.make_geometry(), volume
# ----------------------------------------
volume_left = Python(IN[0]=sg_instance_left)  # CPython3
# ---------- volume_left.python (9 lines) ----------
# Load the Python Standard and DesignScript Libraries
import sys
import clr
clr.AddReference('ProtoGeometry')
from Autodesk.DesignScript.Geometry import *

discard, volume = IN[0]

OUT = volume
# ----------------------------------------
thickness_right = IntegerSlider(200, range=1..500 step 1)
code_block_9 = CodeBlock(x=right_leg_x, y=thickness_right) { x; y; z = x + y; }
rightCube_Bottom_Left = Point.ByCoordinates(x=code_block_9.z, y=code_block_6.y, z=right_glass_height)
code_block_10 = CodeBlock(x=right_leg_x, y=thickness_right) { x; y; z = x - y; }
rightCube_Bottom_Left_2 = Point.ByCoordinates(x=code_block_10.z, y=right_leg_y)
sg_instance_right = Python(IN[0]=stainedglass_sg_class, IN[1]=rightCube_Bottom_Left, IN[2]=rightCube_Bottom_Left_2, IN[3]=thickness_right, IN[4]=right_glass_height, IN[5]=code_block_6.y)  # CPython3; same code as sg_instance_left
volume_right = Python(IN[0]=sg_instance_right)  # CPython3; same code as volume_left
middle_thickness = IntegerSlider(200, range=1..500 step 1)
code_block_11 = CodeBlock(x=middle_y, y=middle_thickness) { x; y; z = x + y; }
byCoordinates_5 = Point.ByCoordinates(x=code_block_5.y, y=code_block_11.z, z=middle_glass_height)
code_block_12 = CodeBlock(x=middle_y, y=middle_thickness) { x; y; z = x - y; }
byCoordinates_6 = Point.ByCoordinates(x=middle_x, y=code_block_12.z)
sg_instance_middle = Python(IN[0]=stainedglass_sg_class, IN[1]=byCoordinates_5, IN[2]=byCoordinates_6, IN[3]=middle_thickness, IN[4]=code_block_5.y, IN[5]=middle_glass_height)  # CPython3; same code as sg_instance_left
volume_middle = Python(IN[0]=sg_instance_middle)  # CPython3; same code as volume_left
stained_glass_volume_1 = Python(IN[0]=volume_left, IN[1]=volume_right, IN[2]=volume_middle)  # CPython3
# ---------- stained_glass_volume_1.python (12 lines) ----------
# Load the Python Standard and DesignScript Libraries
import sys
import clr
clr.AddReference('ProtoGeometry')
from Autodesk.DesignScript.Geometry import *

volume1 = IN[0]
volume2 = IN[1]
volume3 = IN[2]
total = volume1+volume2+volume3
str_total = str(total)
OUT = str_total + " mm^2"
# ----------------------------------------
stained_glass_volume_1_2 = Watch(stained_glass_volume_1)
bamboo_class = Python()  # CPython3; unwired: IN[0]
# ---------- bamboo_class.python (35 lines) ----------
# Load the Python Standard and DesignScript Libraries
import sys
import clr
clr.AddReference('ProtoGeometry')
from Autodesk.DesignScript.Geometry import *
import math

class Bamboo:
    def __init__(self, upper_point, lower_point, outer_radius, inner_radius, height):
        
        self.upper = upper_point
        self.lower = lower_point
        self.outer = outer_radius
        self.inner = inner_radius
        self.height = height
        
    def ends(self):
        return self.upper, self.lower
    
    def radii(self):
        return self.outer, self.inner
            
    def make_geometry(self):
        top, bottom = self.ends()
        outside, inside = self.radii()
        outer_cylinder = Cylinder.ByPointsRadius(top, bottom, outside)
        inner_cylinder = Cylinder.ByPointsRadius(top, bottom, inside)
        
        return Solid.Difference(outer_cylinder, inner_cylinder)
    
    def measure_volume(self):
        volume = math.pi * (self.outer - self.inner)**2 * self.height      
        return volume

OUT = Bamboo
# ----------------------------------------
bamboo_left = IntegerSlider(-4000, range=-4000..-1 step 1)
positive_length_left_bamboo = IntegerSlider(2500, range=1..2500 step 1)
numOfSlices = IntegerSlider(15, range=10..50 step 1)
negative_length = CodeBlock(x=positive_length_left_bamboo) { x; y = -x; }
code_block_13 = CodeBlock(length=positive_length_left_bamboo, numofslices=numOfSlices, neglength=negative_length.y)
# ---------- code_block_13.designscript (6 lines) ----------
length;
numofslices;
neglength;
interval = 0..1..#numofslices;
ypoint = interval * length;
ypoint2 = interval * neglength;
# ----------------------------------------
height_modifier = IntegerSlider(5000, range=1000..10000 step 1)
code_block_14 = CodeBlock(y=height_modifier, points=code_block_13.ypoint) { y; points; z = y + (227 *Math.Sin(25*points + 27)); }
bamboo_upper_left_up = Point.ByCoordinates(x=bamboo_left, y=code_block_13.ypoint, z=code_block_14.z)
bamboo_bottom_left_up = Point.ByCoordinates(x=bamboo_left, y=code_block_13.ypoint)
bamboo_thickness = IntegerSlider(25, range=1..100 step 1)
code_block_15 = CodeBlock(length=positive_length_left_bamboo, slices=numOfSlices, bamboo_thickness=bamboo_thickness) { length; slices; bamboo_thickness; radius = (length/(slices - 1))/2; radius2 = radius - bamboo_thickness; }
series_of_instances_of_bamboo = Python(IN[0]=bamboo_class, IN[1]=bamboo_upper_left_up, IN[2]=bamboo_bottom_left_up, IN[3]=code_block_15.radius, IN[4]=code_block_15.radius2, IN[5]=code_block_14.z)  # "Series of Instances of Bamboo (Upper Left Side)"; CPython3
# ---------- series_of_instances_of_bamboo.python (24 lines) ----------
# Load the Python Standard and DesignScript Libraries
import sys
import clr
clr.AddReference('ProtoGeometry')
from Autodesk.DesignScript.Geometry import *
import math

Bamboo = IN[0]
uppers = IN[1]
lowers = IN[2]
bigger_r = IN[3]
smaller_r = IN[4]
z = IN[5]
measured_volume = 0.0
shoots = []
volumes = []

for i in range(len(uppers)):
    stalk = Bamboo(uppers[i], lowers[i], bigger_r, smaller_r, z[i])
    measured_volume += stalk.measure_volume()
    shoots.append(stalk.make_geometry())
    volumes.append(str(stalk.measure_volume()))
 
OUT = shoots, measured_volume, volumes
# ----------------------------------------
volume_1 = Python(IN[0]=series_of_instances_of_bamboo)  # CPython3
# ---------- volume_1.python (8 lines) ----------
# Load the Python Standard and DesignScript Libraries
import sys
import clr
clr.AddReference('ProtoGeometry')
from Autodesk.DesignScript.Geometry import *
import math

OUT = IN[0][1]
# ----------------------------------------
bamboo_upper_left_down = Point.ByCoordinates(x=bamboo_left, y=code_block_13.ypoint2, z=code_block_14.z)
bamboo_bottom_left_down = Point.ByCoordinates(x=bamboo_left, y=code_block_13.ypoint2)
series_of_instances_of_bamboo_2 = Python(IN[0]=bamboo_class, IN[1]=bamboo_upper_left_down, IN[2]=bamboo_bottom_left_down, IN[3]=code_block_15.radius, IN[4]=code_block_15.radius2, IN[5]=code_block_14.z)  # "Series of Instances of Bamboo (Lower Left Side)"; CPython3; same code as series_of_instances_of_bamboo
volume_2 = Python(IN[0]=series_of_instances_of_bamboo_2)  # CPython3; same code as volume_1
bamboo_right = IntegerSlider(4000, range=1..4000 step 1)
positive_length_right_bamboo = IntegerSlider(2500, range=1..2500 step 1)
numOfSlices_2 = IntegerSlider(15, range=10..50 step 1)
negative_length_2 = CodeBlock(x=positive_length_right_bamboo) { x; y = -x; }
code_block_16 = CodeBlock(length=positive_length_right_bamboo, numofslices=numOfSlices_2, neglength=negative_length_2.y)  # same code as code_block_13
height_modifier_2 = IntegerSlider(5000, range=1000..10000 step 1)
code_block_17 = CodeBlock(y=height_modifier_2, points=code_block_16.ypoint) { y; points; z = y + (227 *Math.Sin(25*points + 27)); }
bamboo_upper_right_up = Point.ByCoordinates(x=bamboo_right, y=code_block_16.ypoint, z=code_block_17.z)
bamboo_bottom_right_up = Point.ByCoordinates(x=bamboo_right, y=code_block_16.ypoint)
bamboo_thickness_2 = IntegerSlider(25, range=1..100 step 1)
code_block_18 = CodeBlock(length=positive_length_right_bamboo, slices=numOfSlices_2, bamboo_thickness=bamboo_thickness_2) { length; slices; bamboo_thickness; radius = (length/(slices - 1))/2; radius2 = radius - bamboo_thickness; }
series_of_instances_of_bamboo_3 = Python(IN[0]=bamboo_class, IN[1]=bamboo_upper_right_up, IN[2]=bamboo_bottom_right_up, IN[3]=code_block_18.radius, IN[4]=code_block_18.radius2, IN[5]=code_block_17.z)  # "Series of Instances of Bamboo (Upper Left Side)"; CPython3; same code as series_of_instances_of_bamboo
volume_3 = Python(IN[0]=series_of_instances_of_bamboo_3)  # CPython3; same code as volume_1
bamboo_upper_right_down = Point.ByCoordinates(x=bamboo_right, y=code_block_16.ypoint2, z=code_block_17.z)
bamboo_bottom_right_down = Point.ByCoordinates(x=bamboo_right, y=code_block_16.ypoint2)
series_of_instances_of_bamboo_4 = Python(IN[0]=bamboo_class, IN[1]=bamboo_upper_right_down, IN[2]=bamboo_bottom_right_down, IN[3]=code_block_18.radius, IN[4]=code_block_18.radius2, IN[5]=code_block_17.z)  # "Series of Instances of Bamboo (Upper Left Side)"; CPython3; same code as series_of_instances_of_bamboo
volume_4 = Python(IN[0]=series_of_instances_of_bamboo_4)  # CPython3; same code as volume_1
positive_length_middle_bamboo = IntegerSlider(3000, range=1..3000 step 1)
numOfSlices_3 = IntegerSlider(15, range=10..50 step 1)
negative_length_3 = CodeBlock(x=positive_length_middle_bamboo) { x; y = -x; }
code_block_19 = CodeBlock(length=positive_length_middle_bamboo, numofslices=numOfSlices_3, neglength=negative_length_3.y)  # same code as code_block_13
bamboo_front_back = IntegerSlider(3500, range=1..3500 step 1)
height_modifier_3 = IntegerSlider(5000, range=1000..10000 step 1)
code_block_20 = CodeBlock(y=height_modifier_3, points=code_block_19.ypoint) { y; points; z = y + (227 *Math.Sin(25*points + 27)); }
bamboo_middle_left_upper = Point.ByCoordinates(x=code_block_19.ypoint2, y=bamboo_front_back, z=code_block_20.z)
bamboo_middle_left_lower = Point.ByCoordinates(x=code_block_19.ypoint2, y=bamboo_front_back)
bamboo_thickness_3 = IntegerSlider(25, range=1..100 step 1)
code_block_21 = CodeBlock(length=positive_length_middle_bamboo, slices=numOfSlices_3, bamboo_thickness=bamboo_thickness_3) { length; slices; bamboo_thickness; radius = (length/(slices - 1))/2; radius2 = radius - bamboo_thickness; }
series_of_instances_of_bamboo_5 = Python(IN[0]=bamboo_class, IN[1]=bamboo_middle_left_upper, IN[2]=bamboo_middle_left_lower, IN[3]=code_block_21.radius, IN[4]=code_block_21.radius2, IN[5]=code_block_20.z)  # "Series of Instances of Bamboo (Upper Left Side)"; CPython3; same code as series_of_instances_of_bamboo
volume_5 = Python(IN[0]=series_of_instances_of_bamboo_5)  # CPython3; same code as volume_1
bamboo_middle_right_upper = Point.ByCoordinates(x=code_block_19.ypoint, y=bamboo_front_back, z=code_block_20.z)
bamboo_middle_right_lower = Point.ByCoordinates(x=code_block_19.ypoint, y=bamboo_front_back)
series_of_instances_of_bamboo_6 = Python(IN[0]=bamboo_class, IN[1]=bamboo_middle_right_upper, IN[2]=bamboo_middle_right_lower, IN[3]=code_block_21.radius, IN[4]=code_block_21.radius2, IN[5]=code_block_20.z)  # "Series of Instances of Bamboo (Upper Left Side)"; CPython3; same code as series_of_instances_of_bamboo
volume_6 = Python(IN[0]=series_of_instances_of_bamboo_6)  # CPython3; same code as volume_1
bamboo_volume_2 = Python(IN[0]=volume_1, IN[1]=volume_2, IN[2]=volume_3, IN[3]=volume_4, IN[4]=volume_5, IN[5]=volume_6)  # CPython3
# ---------- bamboo_volume_2.python (8 lines) ----------
# Load the Python Standard and DesignScript Libraries
import sys
import clr
clr.AddReference('ProtoGeometry')
from Autodesk.DesignScript.Geometry import *
import math

OUT = str(IN[0] + IN[1] + IN[2] + IN[3] + IN[4] + IN[5]) + " mm^2"
# ----------------------------------------
bamboo_volume_2_2 = Watch(bamboo_volume_2)
