# Dynamo graph 1763484.dyn (Dynamo 4.0.0.3277)

# group: Don't touch this ground
code_block = CodeBlock { -5000; -5000; -200; }
byCoordinates = Point.ByCoordinates(x=code_block.out0, y=code_block.out1, z=code_block.out2)
code_block_2 = CodeBlock { 5000; 5000; 0; }
byCoordinates_2 = Point.ByCoordinates(x=code_block_2.out0, y=code_block_2.out1, z=code_block_2.out2)
byCorners = Cuboid.ByCorners(lowPoint=byCoordinates, highPoint=byCoordinates_2)
code_block_3 = CodeBlock { 0; 100; 0; }
byARGB = Color.ByARGB(red=code_block_3.out0, green=code_block_3.out1, blue=code_block_3.out2)
byGeometryColor = Modifiers.GeometryColor.ByGeometryColor(geometry=byCorners, color=byARGB)

code_block_4 = CodeBlock { x=0; y=0; z=0; }
p_center = Point.ByCoordinates(x=code_block_4.x, y=code_block_4.y, z=code_block_4.z)
pav_radius = DoubleSlider(4400, range=3000..4500 step 100)
n1 = Circle.ByCenterPointRadius(centerPoint=p_center, radius=pav_radius)  # "1"
ring_count_steel = DoubleSlider(4, range=2..5 step 1)
bench_radius = DoubleSlider(1700, range=1500..3000 step 100)
bench_width = DoubleSlider(400, range=300..800 step 25)
bench_height = DoubleSlider(350, range=350..500 step 25)
bench_z = DoubleSlider(300, range=300..500 step 25)
leg_count = DoubleSlider(5, range=4..24 step 1)
leg_radius = DoubleSlider(50, range=40..120 step 5)
bench_ring_and_legs = Python(IN[0]=p_center, IN[1]=bench_radius, IN[2]=bench_width, IN[3]=bench_height, IN[4]=bench_z, IN[5]=leg_count, IN[6]=leg_radius)  # PythonNet3
# ---------- bench_ring_and_legs.python (95 lines) ----------
# Load the Python Standard and DesignScript Libraries
import sys
import clr
clr.AddReference('ProtoGeometry')
from Autodesk.DesignScript.Geometry import *

import math

# Chatgpt has helped me figure out what functions do and has corrected my errors
center = IN[0]
bench_radius = float(IN[1])
bench_width = float(IN[2])
bench_height = float(IN[3])
bench_z = float(IN[4])
leg_count = int(IN[5])
leg_radius = float(IN[6])


# Location of bench
def polar_point(center, r, z, angle_deg):
    a = math.radians(angle_deg)
    x = center.X + r * math.cos(a)
    y = center.Y + r * math.sin(a)
    return Point.ByCoordinates(x, y, z)


# bench ring
class BenchRing(object):
    def __init__(self, center, mid_radius, radial_width, height, base_z):
        self.center = center
        self.mid_radius = float(mid_radius)
        self.radial_width = float(radial_width)
        self.height = float(height)
        self.base_z = float(base_z)

    def make_solid(self):
        outer_r = self.mid_radius + self.radial_width * 0.5
        inner_r = self.mid_radius - self.radial_width * 0.5
        if inner_r < 0:
            inner_r = 0.0

        base_pt = Point.ByCoordinates(self.center.X, self.center.Y, self.base_z)

        cs = CoordinateSystem.ByOriginVectors(
            base_pt,
            Vector.XAxis(),
            Vector.YAxis(),
            Vector.ZAxis()
        )

        outer_cyl = Cylinder.ByRadiusHeight(cs, outer_r, self.height)

        if inner_r <= 1e-6:
            bench_solid = outer_cyl
        else:
            inner_cyl = Cylinder.ByRadiusHeight(cs, inner_r, self.height)
            bench_solid = Solid.Difference(outer_cyl, inner_cyl)

        vol = bench_solid.Volume
        return bench_solid, vol


# leg series 
leg_solids = []
leg_volumes = []

if leg_count > 0:
    step = 360.0 / float(leg_count)

    for i in range(leg_count):
        angle_deg = i * step

        base_pt = polar_point(center, bench_radius, 0.0, angle_deg)

        cs = CoordinateSystem.ByOriginVectors(
            base_pt,
            Vector.XAxis(),
            Vector.YAxis(),
            Vector.ZAxis()
        )

        leg_height = bench_z
        leg = Cylinder.ByRadiusHeight(cs, leg_radius, leg_height)

        leg_solids.append(leg)
        leg_volumes.append(leg.Volume)


# bench
bench = BenchRing(center, bench_radius, bench_width, bench_height, bench_z)
bench_solid, bench_volume = bench.make_solid()

total_leg_volume = sum(leg_volumes) if leg_volumes else 0.0

OUT = [bench_solid, leg_solids, bench_volume, total_leg_volume]
# ----------------------------------------
roof_height = DoubleSlider(3800, range=2500..4000 step 100)
rib_count = DoubleSlider(40, range=16..48 step 2)
angles_deg = CodeBlock(rib_count=rib_count) { 0..360..#rib_count; }
entrance_half_angle = DoubleSlider(22, range=10..35 step 1)
rib_thickness = DoubleSlider(120, range=40..120 step 5)
rib_Width = DoubleSlider(300, range=120..300 step 10)
timber_rib = Python(IN[0]=p_center, IN[1]=pav_radius, IN[2]=roof_height, IN[3]=angles_deg, IN[4]=entrance_half_angle, IN[5]=rib_thickness, IN[6]=rib_Width)  # PythonNet3
# ---------- timber_rib.python (103 lines) ----------
# Load the Python Standard and DesignScript Libraries
import sys
import clr
clr.AddReference('ProtoGeometry')
from Autodesk.DesignScript.Geometry import *

import math

# Chatgpt has helped me understand functions and provided correction of my errors
center = IN[0]
pav_radius = float(IN[1])
roof_height = float(IN[2])
angles_deg = IN[3]
entrance_half = float(IN[4])
rib_thickness = float(IN[5])
rib_width = float(IN[6])


inner_ratio = 0.25
inner_radius = pav_radius * inner_ratio

# connection of roof height and circles inner radius
apex_factor = 1.0 / (1.0 - inner_ratio)
apex_height = roof_height * apex_factor


# Center point
def polar_point(center, r, z, angle_deg):
    a = math.radians(angle_deg)
    x = center.X + r * math.cos(a)
    y = center.Y + r * math.sin(a)
    return Point.ByCoordinates(x, y, z)


# Different entrances at differetn Angles
def is_in_entrance(angle_deg, half_angle_deg):
    entrance_centers = [0.0, 90.0, 180.0, 270.0]

   # difference in circle angles
    def wrapped_diff(a, b):
        d = (a - b + 180.0) % 360.0 - 180.0
        return abs(d)

    for c in entrance_centers:
        if wrapped_diff(angle_deg, c) <= half_angle_deg:
            return True
    return False


# Timber rib
class TimberRib(object):
    def __init__(self, center, pav_radius, apex_height, angle_deg, rib_width, rib_thickness):
        self.center = center
        self.pav_radius = float(pav_radius)
        self.apex_height = float(apex_height)
        self.angle_deg = float(angle_deg)
        self.rib_width = float(rib_width)
        self.rib_thickness = float(rib_thickness)

    def make_solid(self):
      
        p_base = polar_point(self.center, self.pav_radius, 0.0, self.angle_deg)

        # apex point at center
        p_apex = Point.ByCoordinates(self.center.X, self.center.Y, self.apex_height)

        
        path = Line.ByStartPointEndPoint(p_base, p_apex)

      # Coordinate system
        cs = CoordinateSystem.ByOrigin(p_base)

       
        profile = Rectangle.ByWidthLength(cs, self.rib_width, self.rib_thickness)

      
        solid = Solid.BySweep(profile, path)

        # volume
        vol = solid.Volume
        return solid, vol


# Rib series 
rib_solids = []
rib_volumes = []

for ang in angles_deg:
    a = float(ang)


    if is_in_entrance(a, entrance_half):
        continue

    rib = TimberRib(center, pav_radius, apex_height, a, rib_width, rib_thickness)
    solid, vol = rib.make_solid()

    rib_solids.append(solid)
    rib_volumes.append(vol)

total_timber_volume = sum(rib_volumes) if rib_volumes else 0.0

OUT = [rib_solids, total_timber_volume, inner_radius, apex_height]
# ----------------------------------------
getItemAtIndex = List.GetItemAtIndex(list=timber_rib, index=code_block_4.z)
code_block_5 = CodeBlock { 255; 180; 120; 60; }
byARGB_2 = Color.ByARGB(alpha=code_block_5.out0, red=code_block_5.out1, green=code_block_5.out2, blue=code_block_5.out3)
byGeometryColor_2 = Modifiers.GeometryColor.ByGeometryColor(geometry=getItemAtIndex, color=byARGB_2)
code_block_6 = CodeBlock(pav_radius=pav_radius, ring_count=rib_count) { pav_radius * 0.9..pav_radius * 0.4..#ring_count; }
ring_thickness_steel = DoubleSlider(300, range=100..300 step 10)
ring_height_steel = DoubleSlider(180, range=80..200 step 10)
steel_ring = Python(IN[0]=p_center, IN[1]=code_block_6, IN[2]=ring_thickness_steel, IN[3]=ring_height_steel, IN[4]=roof_height)  # PythonNet3
# ---------- steel_ring.python (78 lines) ----------
# Load the Python Standard and DesignScript Libraries
import sys
import clr
clr.AddReference('ProtoGeometry')
from Autodesk.DesignScript.Geometry import *

import math

# Chatgpt helped me to understand different functions, as well helped me fix errors that had occured
center = IN[0]
ring_radii = IN[1]
ring_thickness = float(IN[2])
ring_height = float(IN[3])
roof_height = float(IN[4])

# ring location
z_for_rings = roof_height * 0.95


# steel ring
class SteelRing(object):
    def __init__(self, center, mid_radius, radial_thickness, height, z_top):
        self.center = center
        self.mid_radius = float(mid_radius)
        self.radial_thickness = float(radial_thickness)
        self.height = float(height)
        self.z_top = float(z_top)

    def make_solid(self):
       
        outer_r = self.mid_radius + self.radial_thickness * 0.5
        inner_r = self.mid_radius - self.radial_thickness * 0.5
        if inner_r < 0:
            inner_r = 0.0

        
        z_base = self.z_top - self.height

     
        base_pt = Point.ByCoordinates(self.center.X, self.center.Y, z_base)

      # cylinder Coordinates 
        cs = CoordinateSystem.ByOriginVectors(
            base_pt,
            Vector.XAxis(),
            Vector.YAxis(),
            Vector.ZAxis()
        )

       # outer cylinder
        outer_cyl = Cylinder.ByRadiusHeight(cs, outer_r, self.height)

      
        if inner_r <= 1e-6:
            ring_solid = outer_cyl
        else:
            inner_cyl = Cylinder.ByRadiusHeight(cs, inner_r, self.height)
            ring_solid = Solid.Difference(outer_cyl, inner_cyl)

        vol = ring_solid.Volume
        return ring_solid, vol


# ring series 
ring_solids = []
ring_volumes = []

for r in ring_radii:
    ring = SteelRing(center, r, ring_thickness, ring_height, z_for_rings)
    solid, vol = ring.make_solid()

    ring_solids.append(solid)
    ring_volumes.append(vol)

total_steel_volume = sum(ring_volumes) if ring_volumes else 0.0


OUT = [ring_solids, total_steel_volume, z_for_rings]
# ----------------------------------------
code_block_7 = CodeBlock { 0; }
getItemAtIndex_2 = List.GetItemAtIndex(list=steel_ring, index=code_block_7)
code_block_8 = CodeBlock { 255; 30; 90; 40; }
byARGB_3 = Color.ByARGB(alpha=code_block_8.out0, red=code_block_8.out1, green=code_block_8.out2, blue=code_block_8.out3)
byGeometryColor_3 = Modifiers.GeometryColor.ByGeometryColor(geometry=getItemAtIndex_2, color=byARGB_3)
