# Dynamo graph 1769300.dyn (Dynamo 4.0.0.3277)

# group: Don't touch this ground
code_block = CodeBlock { -5000; -5000; -200; }
byCoordinates = Point.ByCoordinates(x=code_block.out0, y=code_block.out1, z=code_block.out2)
code_block_2 = CodeBlock { 5000; 5000; 0; }
byCoordinates_2 = Point.ByCoordinates(x=code_block_2.out0, y=code_block_2.out1, z=code_block_2.out2)
byCorners = Cuboid.ByCorners(lowPoint=byCoordinates, highPoint=byCoordinates_2)
code_block_3 = CodeBlock { 0; 100; 0; }
byARGB = Color.ByARGB(red=code_block_3.out0, green=code_block_3.out1, blue=code_block_3.out2)
byGeometryColor = Modifiers.GeometryColor.ByGeometryColor(geometry=byCorners, color=byARGB)

# group: BASEPOINT
code_block_4 = CodeBlock {  }
code_block_5 = CodeBlock { -3000; -4000; 0; }
l1 = Point.ByCoordinates(x=code_block_5.out0, y=code_block_5.out1, z=code_block_5.out2)
code_block_6 = CodeBlock { -4000; -2000; 0; }
l2 = Point.ByCoordinates(x=code_block_6.out0, y=code_block_6.out1, z=code_block_6.out2)
code_block_7 = CodeBlock { -2000; 500; 0; }
l3 = Point.ByCoordinates(x=code_block_7.out0, y=code_block_7.out1, z=code_block_7.out2)
code_block_8 = CodeBlock { -3500; 3000; 0; }
l4 = Point.ByCoordinates(x=code_block_8.out0, y=code_block_8.out1, z=code_block_8.out2)
left = List.Create(item0=l1, item1=l2, item2=l3, item3=l4)
leftcurve = NurbsCurve.ByPoints(points=left)
code_block_9 = CodeBlock { 2000; -4000; 0; }
r1 = Point.ByCoordinates(x=code_block_9.out0, y=code_block_9.out1, z=code_block_9.out2)
code_block_10 = CodeBlock { 500; -2000; 0; }
r2 = Point.ByCoordinates(x=code_block_10.out0, y=code_block_10.out1, z=code_block_10.out2)
code_block_11 = CodeBlock { 2000; 500; 0; }
r3 = Point.ByCoordinates(x=code_block_11.out0, y=code_block_11.out1, z=code_block_11.out2)
code_block_12 = CodeBlock { 500; 3000; 0; }
r4 = Point.ByCoordinates(x=code_block_12.out0, y=code_block_12.out1, z=code_block_12.out2)
right = List.Create(item0=r1, item1=r2, item2=r3, item3=r4)
rightcurve = NurbsCurve.ByPoints(points=right)

# group: SteelBenches
code_block_13 = CodeBlock { 600; -500; 0; }
byCoordinates_3 = Point.ByCoordinates(x=code_block_13.out0, y=code_block_13.out1, z=code_block_13.out2)
list_create = List.Create(item0=byCoordinates_3)
benchLength = DoubleSlider(1900, range=1200..3000 step 100)
benchDepth = DoubleSlider(475, range=350..700 step 25)
benchHeight = DoubleSlider(275, range=200..700 step 25)
thickness = DoubleSlider(60, range=30..140 step 10)
legWidth = DoubleSlider(120, range=80..180 step 10)
legDepth = DoubleSlider(130, range=80..180 step 10)
benchAngleDegrees = DoubleSlider(55, range=0..90 step 5)
steelbench_class = Python(IN[0]=benchLength, IN[1]=benchDepth, IN[2]=benchHeight, IN[3]=thickness, IN[4]=legWidth, IN[5]=legDepth, IN[6]=benchAngleDegrees)  # PythonNet3
# ---------- steelbench_class.python (60 lines) ----------
import clr
clr.AddReference('ProtoGeometry')
from Autodesk.DesignScript.Geometry import *

L    = IN[0]
D    = IN[1]
H    = IN[2]
T    = IN[3]
W    = IN[4]
Dleg = IN[5]
ANG  = IN[6]

class SteelBench:
    def __init__(self, origin, angleDeg):
        self.origin   = origin
        self.angleDeg = angleDeg

    def _raw_geometry(self):
        o = self.origin

        seat_center_z = o.Z + H + T / 2.0
        seat_center   = Point.ByCoordinates(o.X, o.Y, seat_center_z)
        seat = Cuboid.ByLengths(seat_center, L, D, T)

        leg_height   = H
        leg_center_z = o.Z + leg_height / 2.0

        halfL = L / 2.0
        halfW = W / 2.0

        leg1_center = Point.ByCoordinates(o.X - (halfL - halfW), o.Y, leg_center_z)
        leg2_center = Point.ByCoordinates(o.X + (halfL - halfW), o.Y, leg_center_z)

        leg1 = Cuboid.ByLengths(leg1_center, W, Dleg, leg_height)
        leg2 = Cuboid.ByLengths(leg2_center, W, Dleg, leg_height)

        return [seat, leg1, leg2]

    def make_geometry(self):
        geos = self._raw_geometry()

        o    = self.origin
        axis = Vector.ZAxis()
        ang  = self.angleDeg

        rotated = []
        for g in geos:
            rotated.append(g.Rotate(o, axis, ang))

        return rotated

    def volume(self):
        geos = self._raw_geometry()
        v = 0.0
        for g in geos:
            if g is not None:
                v += g.Volume
        return v

OUT = SteelBench
# ----------------------------------------
steelbench_instance = Python(IN[0]=list_create, IN[1]=steelbench_class, IN[2]=benchAngleDegrees)  # PythonNet3
# ---------- steelbench_instance.python (19 lines) ----------
angleDeg      = IN[2]
bench_origins = IN[0]
SteelBench    = IN[1]

benches = []
vols    = []

if not isinstance(bench_origins, list):
    bench_origins = [bench_origins]

for p in bench_origins:
    if p is None:
        continue
    bench = SteelBench(p, angleDeg)
    geo   = bench.make_geometry()
    benches.append(geo)
    vols.append(bench.volume())

OUT = benches, vols
# ----------------------------------------
volumeOnly = Python(IN[0]=steelbench_instance)  # PythonNet3
# ---------- volumeOnly.python (17 lines) ----------
vols_in = IN[0]

flat = []

for item in vols_in:
    if isinstance(item, list):
        for sub in item:
            flat.append(sub)
    else:
        flat.append(item)

total = 0.0
for v in flat:
    if isinstance(v, float) or isinstance(v, int):
        total += v

OUT = total
# ----------------------------------------
volume_steelbench_mm_3 = Watch(volumeOnly)
code_block_14 = CodeBlock { -1600; 2250; 0; }
point_bycoordinates_2 = Point.ByCoordinates(x=code_block_14.out0, y=code_block_14.out1, z=code_block_14.out2)
list_create_2 = List.Create(item0=point_bycoordinates_2)
steelbench_class_2 = Python(IN[0]=benchLength, IN[1]=benchDepth, IN[2]=benchHeight, IN[3]=thickness, IN[4]=legWidth, IN[5]=legDepth, IN[6]=benchAngleDegrees)  # PythonNet3; same code as steelbench_class
benchangledegrees_2 = DoubleSlider(125, range=0..150 step 5)
steelbench_instance_2 = Python(IN[0]=list_create_2, IN[1]=steelbench_class_2, IN[2]=benchangledegrees_2)  # PythonNet3; same code as steelbench_instance
volumeOnly_2 = Python(IN[0]=steelbench_instance_2)  # PythonNet3; same code as volumeOnly
volume_steelbench_2_mm_3 = Watch(volumeOnly_2)
code_block_15 = CodeBlock { 0; }
getItemAtIndex = List.GetItemAtIndex(list=steelbench_instance_2, index=code_block_15)
code_block_16 = CodeBlock { 255; 255; 219; 5; }
byARGB_2 = Color.ByARGB(alpha=code_block_16.out0, red=code_block_16.out1, green=code_block_16.out2, blue=code_block_16.out3)
byGeometryColor_2 = Modifiers.GeometryColor.ByGeometryColor(geometry=getItemAtIndex, color=byARGB_2)
code_block_17 = CodeBlock { 0; }
getItemAtIndex_2 = List.GetItemAtIndex(list=steelbench_instance, index=code_block_17)
code_block_18 = CodeBlock { 255; 0; 124; 65; }
byARGB_3 = Color.ByARGB(alpha=code_block_18.out0, red=code_block_18.out1, green=code_block_18.out2, blue=code_block_18.out3)
byGeometryColor_3 = Modifiers.GeometryColor.ByGeometryColor(geometry=getItemAtIndex_2, color=byARGB_3)

# group: WoodBeam
code_block_19 = CodeBlock {  }
code_block_20 = CodeBlock {  }
code_block_21 = CodeBlock { 0; }
frameCount = IntegerSlider(20, range=8..40 step 1)
code_block_22 = CodeBlock(FrameCount=frameCount) { FrameCount; }
code_block_23 = CodeBlock(FrameCount=frameCount) { 1.0 / (FrameCount - 1); }
sequence = Sequence(start=code_block_21, amount=code_block_22, step=code_block_23)
leftpoints = Curve.PointAtParameter(curve=leftcurve, param=sequence)
point_x_l = Point.X(point=leftpoints)
point_y_l = Point.Y(point=leftpoints)
point_z_l = Point.Z(point=leftpoints)
hillHeightMM = DoubleSlider(2200, range=1500..3500 step 100)
peakPosition = DoubleSlider(0.75, range=0.5..1 step 0.05)
smoothness = DoubleSlider(1.7, range=1..3 step 0.1)
frameHeights = Python(IN[0]=sequence, IN[1]=hillHeightMM, IN[2]=peakPosition, IN[3]=smoothness)  # PythonNet3
# ---------- frameHeights.python (13 lines) ----------
tList      = IN[0]  
amp_mm     = IN[1]  
peak_pos   = IN[2]  
smoothness = IN[3]  

heights = []

for t in tList:
    d = abs(t - peak_pos)
    h = amp_mm * max(0.0, 1.0 - (d ** smoothness) * 2.0)
    heights.append(h)

OUT = heights
# ----------------------------------------
ztopleft = point_z_l + frameHeights
lefttoppoints = Point.ByCoordinates(x=point_x_l, y=point_y_l, z=ztopleft)
beamRadiusMM = DoubleSlider(160, range=100..300 step 10)
roofbeam_class = Python()  # PythonNet3; unwired: IN[0]
# ---------- roofbeam_class.python (17 lines) ----------
import clr
clr.AddReference('ProtoGeometry')
from Autodesk.DesignScript.Geometry import *

class RoofBeam:
    def __init__(self, start_point, end_point, radius):
        self.start  = start_point
        self.end    = end_point
        self.radius = radius

    def make_geometry(self):
        return Cylinder.ByPointsRadius(self.start, self.end, self.radius)

    def volume(self):
        return self.make_geometry().Volume

OUT = RoofBeam
# ----------------------------------------
sidebeam_left = Python(IN[0]=lefttoppoints, IN[1]=beamRadiusMM, IN[2]=roofbeam_class)  # PythonNet3
# ---------- sidebeam_left.python (27 lines) ----------
import clr
clr.AddReference('ProtoGeometry')
from Autodesk.DesignScript.Geometry import *

top_points = IN[0]   
radius     = IN[1]
RoofBeam   = IN[2]

beams = []
vols  = []

count = len(top_points)

for i in range(count - 1):
    start = top_points[i]
    end   = top_points[i + 1]

    if start.DistanceTo(end) < 1:
        continue

    b = RoofBeam(start, end, radius)
    geo = b.make_geometry()

    beams.append(geo)
    vols.append(b.volume())

OUT = beams, vols
# ----------------------------------------
code_block_24 = CodeBlock { 0; }
getItemAtIndex_3 = List.GetItemAtIndex(list=sidebeam_left, index=code_block_24)
rightpoints = Curve.PointAtParameter(curve=rightcurve, param=sequence)
X = Point.X(point=rightpoints)
Y = Point.Y(point=rightpoints)
Z = Point.Z(point=rightpoints)
ztopright = Z + frameHeights
righttoppoints = Point.ByCoordinates(x=X, y=Y, z=ztopright)
roofbeam_instances = Python(IN[0]=lefttoppoints, IN[1]=righttoppoints, IN[2]=beamRadiusMM, IN[3]=roofbeam_class)  # PythonNet3
# ---------- roofbeam_instances.python (29 lines) ----------
import clr
clr.AddReference('ProtoGeometry')
from Autodesk.DesignScript.Geometry import *

left_tops  = IN[0]   
right_tops = IN[1]   
radius     = IN[2]   
RoofBeam   = IN[3]   

beams = []
vols  = []

count = min(len(left_tops), len(right_tops))

for i in range(count):
    start = left_tops[i]
    end   = right_tops[i]

   
    if start.DistanceTo(end) < 1:
        continue

    beam = RoofBeam(start, end, radius)
    geo  = beam.make_geometry()

    beams.append(geo)
    vols.append(beam.volume())

OUT = beams, vols
# ----------------------------------------
code_block_25 = CodeBlock { 0; }
getItemAtIndex_4 = List.GetItemAtIndex(list=roofbeam_instances, index=code_block_25)
columnRadiusMM = DoubleSlider(120, range=75..200 step 5)
framecolumn_class = Python()  # PythonNet3; unwired: IN[0]
# ---------- framecolumn_class.python (17 lines) ----------
import clr
clr.AddReference('ProtoGeometry')
from Autodesk.DesignScript.Geometry import *

class FrameColumn:
    def __init__(self, bottom_point, top_point, radius):
        self.bottom = bottom_point
        self.top    = top_point
        self.radius = radius

    def make_geometry(self):
        return Cylinder.ByPointsRadius(self.bottom, self.top, self.radius)

    def volume(self):
        return self.make_geometry().Volume

OUT = FrameColumn
# ----------------------------------------
framecolumn_instance_l = Python(IN[0]=leftpoints, IN[1]=lefttoppoints, IN[2]=columnRadiusMM, IN[3]=framecolumn_class)  # PythonNet3
# ---------- framecolumn_instance_l.python (29 lines) ----------
import clr
clr.AddReference('ProtoGeometry')
from Autodesk.DesignScript.Geometry import *

bottom_points = IN[0]  
top_points    = IN[1]  
radius        = IN[2] 
FrameColumn   = IN[3]  

cols = []
vols = []

count = min(len(bottom_points), len(top_points))

for i in range(count):
    btm = bottom_points[i]
    top = top_points[i]

    
    if btm.DistanceTo(top) < 1:   
        continue

    col = FrameColumn(btm, top, radius)
    geo = col.make_geometry()

    cols.append(geo)
    vols.append(col.volume())

OUT = cols, vols
# ----------------------------------------
code_block_26 = CodeBlock { 0; }
getItemAtIndex_5 = List.GetItemAtIndex(list=framecolumn_instance_l, index=code_block_26)
sidebeam_right = Python(IN[0]=righttoppoints, IN[1]=beamRadiusMM, IN[2]=roofbeam_class)  # PythonNet3; same code as sidebeam_left
code_block_27 = CodeBlock { 0; }
getItemAtIndex_6 = List.GetItemAtIndex(list=sidebeam_right, index=code_block_27)
framecolumn_instance_r = Python(IN[0]=rightpoints, IN[1]=righttoppoints, IN[2]=columnRadiusMM, IN[3]=framecolumn_class)  # PythonNet3; same code as framecolumn_instance_l
code_block_28 = CodeBlock { 0; }
getItemAtIndex_7 = List.GetItemAtIndex(list=framecolumn_instance_r, index=code_block_28)
list_create_3 = List.Create(item0=getItemAtIndex_3, item1=getItemAtIndex_4, item2=getItemAtIndex_5, item3=getItemAtIndex_6, item4=getItemAtIndex_7)
code_block_29 = CodeBlock { 255; 70; 50; 30; }
byARGB_4 = Color.ByARGB(alpha=code_block_29.out0, red=code_block_29.out1, green=code_block_29.out2, blue=code_block_29.out3)
byGeometryColor_4 = Modifiers.GeometryColor.ByGeometryColor(geometry=list_create_3, color=byARGB_4)
python_script = Python(IN[0]=framecolumn_instance_r, IN[1]=sidebeam_right, IN[2]=framecolumn_instance_l, IN[3]=sidebeam_left, IN[4]=roofbeam_instances)  # PythonNet3
# ---------- python_script.python (24 lines) ----------
vol_sets = IN

def flatten(x):
    result = []
    if isinstance(x, list):
        for item in x:
            result.extend(flatten(item))
    else:
        result.append(x)
    return result

totals = []
grand = 0.0

for data in vol_sets:
    flat = flatten(data)
    t = 0.0
    for v in flat:
        if isinstance(v, (int, float)):
            t += v
    totals.append(t)
    grand += t

OUT = totals, grand
# ----------------------------------------
volumeofrespectiveframingandroof = Watch(python_script)  # "VolumeOfRespectiveFramingAndRoofBeams mm^2"
