# Dynamo graph 1795931.dyn "Campbell_1795931_Home_Assignment2" (Dynamo 3.5.2.8914)

# group: Don't touch this ground
code_block = CodeBlock { 5000; 5000; 0; }
byCoordinates = Point.ByCoordinates(x=code_block.out0, y=code_block.out1, z=code_block.out2)
code_block_2 = CodeBlock { -5000; -5000; -200; }
byCoordinates_2 = Point.ByCoordinates(x=code_block_2.out0, y=code_block_2.out1, z=code_block_2.out2)
byCorners = Cuboid.ByCorners(lowPoint=byCoordinates, highPoint=byCoordinates_2)
code_block_3 = CodeBlock { 0; 255; 0; }
byARGB = Color.ByARGB(red=code_block_3.out0, green=code_block_3.out1, blue=code_block_3.out2)
byGeometryColor = Modifiers.GeometryColor.ByGeometryColor(geometry=byCorners, color=byARGB)

# group: Sliders
post_height = DoubleSlider(5300, range=2500..7000 step 100)
origin_arc_for_overhang = DoubleSlider(2620, range=2600..3200 step 20)
number_of_posts = IntegerSlider(7, range=5..9 step 2)
overhang_thickness = DoubleSlider(380, range=300..600 step 10)
outer_fire_pit_radius = DoubleSlider(1380, range=800..2000 step 20)
number_of_wooden_bars = IntegerSlider(3, range=1..5 step 1)

# group: Arcs, Positioning, Creating Points (Outputs to Lightbulb, Overhang Loop, Steel Posts)
arc_center_points_and_radii = CodeBlock(z=post_height, Inner_Arc_Radius=origin_arc_for_overhang, n=number_of_posts)
# ---------- arc_center_points_and_radii.designscript (15 lines) ----------
x = 0;
y = 0;
z_b = 150;
z;

outerRadius = 4300;
Inner_Arc_Radius;
overhang_radius = outerRadius - Inner_Arc_Radius;

startAngle = 0;
endAngle = 180;

0..1..#n;

post_radius = 300;
# ----------------------------------------
center_for_bottom_arc = Point.ByCoordinates(x=arc_center_points_and_radii.x, y=arc_center_points_and_radii.y, z=arc_center_points_and_radii.z_b)
bottom_arc = Arc.ByCenterPointRadiusAngle(center=center_for_bottom_arc, radius=arc_center_points_and_radii.outerRadius, startAngle=arc_center_points_and_radii.startAngle, endAngle=arc_center_points_and_radii.endAngle)
bottom_post_points = Curve.PointAtParameter(curve=bottom_arc, param=arc_center_points_and_radii.out9)
center_for_top_arc = Point.ByCoordinates(x=arc_center_points_and_radii.x, y=arc_center_points_and_radii.y, z=arc_center_points_and_radii.z)
top_arc = Arc.ByCenterPointRadiusAngle(center=center_for_top_arc, radius=arc_center_points_and_radii.outerRadius, startAngle=arc_center_points_and_radii.startAngle, endAngle=arc_center_points_and_radii.endAngle)
top_points_for_post = Curve.PointAtParameter(curve=top_arc, param=arc_center_points_and_radii.out9)
origin_points_for_overhang_arc = Arc.ByCenterPointRadiusAngle(center=center_for_top_arc, radius=arc_center_points_and_radii.Inner_Arc_Radius, startAngle=arc_center_points_and_radii.startAngle, endAngle=arc_center_points_and_radii.endAngle)
overhang_origin_points = Curve.PointAtParameter(curve=origin_points_for_overhang_arc, param=arc_center_points_and_radii.out9)
list_of_origin_points = List.Create(item0=overhang_origin_points)

# group: Overhang Loop
code_block_4 = CodeBlock(radius=arc_center_points_and_radii.overhang_radius, overhang_thickness=overhang_thickness) { radius; overhang_thickness; insideRadius = radius - overhang_thickness; z_offset = -300; [0, 0.5, 1]; }
overhang_radius = Watch(code_block_4.radius)
contains = List.Contains(list=code_block_4.out4, item=arc_center_points_and_radii.out9, lacing=CrossProduct)
filterByBoolMask = List.FilterByBoolMask(list=list_of_origin_points, mask=contains, lacing=CrossProduct)
outer_overhang_arc = Circle.ByCenterPointRadius(centerPoint=filterByBoolMask.in, radius=code_block_4.radius)
solid_object = Curve.ExtrudeAsSolid(curve=outer_overhang_arc, distance=code_block_4.z_offset)
inner_overhang_arc = Circle.ByCenterPointRadius(centerPoint=filterByBoolMask.in, radius=code_block_4.insideRadius)
hole_object = Curve.ExtrudeAsSolid(curve=inner_overhang_arc, distance=code_block_4.z_offset)
overhang_loops = Solid.Difference(solid=solid_object, other=hole_object)
colour = CodeBlock { 170; 255; 0; }
green = Color.ByARGB(red=colour.out0, green=colour.out1, blue=colour.out2)
overhang_loops_2 = Modifiers.GeometryColor.ByGeometryColor(geometry=overhang_loops, color=green)
volume = Solid.Volume(solid=overhang_loops)
flatten = List.Flatten(list=volume)
volume_to_string = Python(IN[0]=flatten)  # CPython3
# ---------- volume_to_string.python (16 lines) ----------
# Load the Python Standard and DesignScript Libraries
import sys
import clr
clr.AddReference('ProtoGeometry')
from Autodesk.DesignScript.Geometry import *

volumes = IN[0]

total_volume = 0

for objects in volumes:
    total_volume += objects

vs = "Volume = {0:.2f} {1}".format(total_volume, "mm^3")

OUT = vs
# ----------------------------------------
volume_2 = Watch(volume_to_string)

# group: Firepit
code_block_5 = CodeBlock { 0; z1 = 150; base_pad_radius = 4700; firepit_height = 1000; firepit_hole_radius = 600; }
top_of_pad_point_bottom_of_fire = Point.ByCoordinates(x=code_block_5.out0, y=code_block_5.out0, z=code_block_5.z1)  # "Top of Pad Point & Bottom of Fire Pit"
top_of_fire_pit_point = Point.ByCoordinates(x=code_block_5.out0, y=code_block_5.out0, z=code_block_5.firepit_height)
outside_of_fire_pit = Cylinder.ByPointsRadius(startPoint=top_of_pad_point_bottom_of_fire, endPoint=top_of_fire_pit_point, radius=outer_fire_pit_radius)
fire_pit = Cylinder.ByPointsRadius(startPoint=top_of_pad_point_bottom_of_fire, endPoint=top_of_fire_pit_point, radius=code_block_5.firepit_hole_radius)
final_firepit = Solid.Difference(solid=outside_of_fire_pit, other=fire_pit)
colours = CodeBlock { 211; }
byARGB_2 = Color.ByARGB(red=colours, green=colours, blue=colours)
byGeometryColor_2 = Modifiers.GeometryColor.ByGeometryColor(geometry=final_firepit, color=byARGB_2)
origin_point = Point.ByCoordinates(x=code_block_5.out0, y=code_block_5.out0, z=code_block_5.out0)
base_pad = Cylinder.ByPointsRadius(startPoint=origin_point, endPoint=top_of_pad_point_bottom_of_fire, radius=code_block_5.base_pad_radius)
byARGB_3 = Color.ByARGB(red=colours, green=colours, blue=colours)
byGeometryColor_3 = Modifiers.GeometryColor.ByGeometryColor(geometry=base_pad, color=byARGB_3)
volume_3 = Solid.Volume(solid=base_pad)
volume_4 = Solid.Volume(solid=final_firepit)

# group: Steel Posts
class_steel_post = Python()  # CPython3; unwired: IN[0]
# ---------- class_steel_post.python (19 lines) ----------
# Load the Python Standard and DesignScript Libraries
import sys
import clr
import math
clr.AddReference('ProtoGeometry')
from Autodesk.DesignScript.Geometry import *

class Steel_Post:
    def __init__(self, bottom_points, top_points, post_radius):
        #Post stuff:
        self.post_radius = post_radius
        self.bottom_points = bottom_points
        self.top_points = top_points
    
    def make_geometry(self):
        
        return Cylinder.ByPointsRadius(self.bottom_points, self.top_points, self.post_radius)
        
OUT = Steel_Post
# ----------------------------------------
series_of_instances_steel_posts = Python(IN[0]=bottom_post_points, IN[1]=top_points_for_post, IN[2]=arc_center_points_and_radii.post_radius, IN[3]=class_steel_post)  # CPython3
# ---------- series_of_instances_steel_posts.python (26 lines) ----------
import math

bottom_points = IN[0]
top_points = IN[1]
post_radius = IN[2]
Steel_Post = IN[3]

post_height = bottom_points[0].DistanceTo(top_points[0])

posts_output = []

for i in range(len(bottom_points)):
    
    bp = bottom_points[i]
    tp = top_points[i]
    
    new_post = Steel_Post(bp, tp, post_radius)
    
    posts_output.append(new_post.make_geometry())
    

v = len(bottom_points) * post_height * math.pi * post_radius**2

vs = "{0:.2f} {1}".format(v, "mm^3")

OUT = posts_output, vs
# ----------------------------------------

# group: Lightbulbs and Post Modifications
code_block_6 = CodeBlock(postRadius=arc_center_points_and_radii.post_radius, param=arc_center_points_and_radii.out9)
# ---------- code_block_6.designscript (15 lines) ----------
postRadius;
bulbRadius = 0.6 * postRadius;
bulbHolderRadius = 0.2 * postRadius;

rectangle1_width = postRadius;
rectangle1_length = 2.5 * postRadius;
rectangle2_width = rectangle1_length;
rectangle2_length = rectangle1_width;
rectange_height = 6 * bulbRadius;

z_translation = -3 * bulbRadius;

param != 0 && param != 0.5 && param != 1;

-1;
# ----------------------------------------
dropItems = List.DropItems(list=series_of_instances_steel_posts, amount=code_block_6.out10)
flatten_2 = List.Flatten(list=dropItems)
filterByBoolMask_2 = List.FilterByBoolMask(list=top_points_for_post, mask=code_block_6.out9)
lightbulb_point_generator = Python(IN[0]=filterByBoolMask_2.in)  # CPython3
# ---------- lightbulb_point_generator.python (25 lines) ----------
# Load the Python Standard and DesignScript Libraries
import sys
import clr
clr.AddReference('ProtoGeometry')
from Autodesk.DesignScript.Geometry import *

TopPoints = IN[0]

if len(TopPoints) == 0:
    OUT = []
    
else:
    
    LightbulbPoints = []
    
    for i in range(len(TopPoints)):
        x = TopPoints[i].X
        y = TopPoints[i].Y
        z = TopPoints[i].Z - 1500 
        
        new_point = Point.ByCoordinates(x,y,z)
        
        LightbulbPoints.append(new_point)
        
    OUT = LightbulbPoints
# ----------------------------------------
cuboid2 = Cuboid.ByLengths(coordinateSystem=lightbulb_point_generator, width=code_block_6.rectangle2_width, length=code_block_6.rectangle2_length, height=code_block_6.rectange_height)
cuboid1 = Cuboid.ByLengths(coordinateSystem=lightbulb_point_generator, width=code_block_6.rectangle1_width, length=code_block_6.rectangle1_length, height=code_block_6.rectange_height)
hole_object_unification = Solid.Union(solid=cuboid2, solid_2=cuboid1)
single_discontinuous_hole_object = Solid.ByUnion(solids=hole_object_unification)
final_posts_w_lightbulbs = Solid.Difference(solid=flatten_2, other=single_discontinuous_hole_object, lacing=Longest)
colours_2 = CodeBlock { 254; 0; 255; }
grey = Color.ByARGB(red=colours_2.out0, green=colours_2.out0, blue=colours_2.out0)
posts = Modifiers.GeometryColor.ByGeometryColor(geometry=final_posts_w_lightbulbs, color=grey)
lightbulb = Sphere.ByCenterPointRadius(centerPoint=lightbulb_point_generator, radius=code_block_6.bulbRadius)
yellow = Color.ByARGB(red=colours_2.out2, green=colours_2.out2, blue=colours_2.out1)
lightbulb_2 = Modifiers.GeometryColor.ByGeometryColor(geometry=lightbulb, color=yellow)
translate = Geometry.Translate(geometry=lightbulb_point_generator, zTranslation=code_block_6.z_translation)
lightbulb_holder = Cylinder.ByPointsRadius(startPoint=translate, endPoint=lightbulb_point_generator, radius=code_block_6.bulbHolderRadius)
lightbulb_holder_2 = Modifiers.GeometryColor.ByGeometryColor(geometry=lightbulb_holder, color=grey)
lightbulb_holder_volume = Solid.Volume(solid=lightbulb_holder)
lightbulb_volume = Solid.Volume(solid=lightbulb)
post_volume = Solid.Volume(solid=final_posts_w_lightbulbs)
list_create = List.Create(item0=lightbulb_holder_volume, item1=lightbulb_volume, item2=post_volume)
flatten_3 = List.Flatten(list=list_create)
volume_to_string_2 = Python(IN[0]=flatten_3)  # CPython3; same code as volume_to_string
volume_5 = Watch(volume_to_string_2)

# group: Wooden Grill
filtered_overhang_points = List.Create(item0=filterByBoolMask.in)
code_block_7 = CodeBlock { barThickness = 300; barHeight = 200; }
class_wood_grill = Python()  # CPython3; unwired: IN[0]
# ---------- class_wood_grill.python (61 lines) ----------
import sys
import clr
import math
clr.AddReference('ProtoGeometry')
from Autodesk.DesignScript.Geometry import *

def flatten(input_list):
    flat_list = []
    for i in input_list:
        if isinstance(i, list):
            flat_list.extend(flatten(i))
        else:
            flat_list.append(i)
    return flat_list

class WoodenGrill:
    def __init__(self, center_point, bounding_radius, num_bars, bar_thickness, bar_height):
        
        self.center = center_point
        self.BR = bounding_radius
        self.NB = num_bars #from slider
        self.BT = bar_thickness
        self.BH = bar_height #from slider
        
    def make_geometry(self):
        bars = []
        
        extrusion_vector = Vector.ByCoordinates(0,0,self.BH)
        
        #spacing
        diameter = 2 * self.BR
        spacing = diameter/self.NB
        y_offset = -self.BR + spacing/2.0
        
        for i in range(self.NB):
            y_start = y_offset + i*spacing
            
            if abs(y_start) < self.BR:
                
                half_length = math.sqrt(self.BR**2 - y_start**2)
                bar_length = 2.4*half_length
                
                x = self.center.X
                y = self.center.Y + y_start
                z = self.center.Z - 220
                
                bar_origin = Point.ByCoordinates(x,y,z)
                
                #rectangles
                
                bar_cs = CoordinateSystem.ByOrigin(bar_origin)
                bar_geometry = Rectangle.ByWidthLength(bar_cs, bar_length, self.BT)
                
                bar_profile = Rectangle.ByWidthLength(bar_cs, bar_length, self.BT)
                
                bar_solid = bar_profile.ExtrudeAsSolid(extrusion_vector)
                bars.append(bar_solid)
                
        return Solid.ByUnion(bars)
        
OUT = WoodenGrill
# ----------------------------------------
instance_wooden_bars = Python(IN[0]=filtered_overhang_points, IN[1]=code_block_4.insideRadius, IN[2]=number_of_wooden_bars, IN[3]=code_block_7.barThickness, IN[4]=code_block_7.barHeight, IN[5]=class_wood_grill)  # CPython3
# ---------- instance_wooden_bars.python (29 lines) ----------
def flatten(input_list):
    flat_list = []
    for i in input_list:
        if isinstance(i, list):
            flat_list.extend(flatten(i))
        else:
            flat_list.append(i)
    return flat_list

center_point_raw = IN[0]
flattened_center_points = flatten(center_point_raw)
bounding_radius = IN[1]
num_bars = IN[2]
bar_thickness = IN[3]
bar_height = IN[4]
WoodenGrill = IN[5]

grills = []

for point in flattened_center_points:
    
    grill_instance = WoodenGrill(point, bounding_radius, num_bars, bar_thickness, bar_height)
    
    grills.append(grill_instance.make_geometry())
    
v = num_bars * bar_thickness * bar_height
vs = "Volume = {0:.2f} {1}".format(v, "mm^3")

OUT = grills, vs
# ----------------------------------------
code_block_8 = CodeBlock { -1; }
dropItems_2 = List.DropItems(list=instance_wooden_bars, amount=code_block_8)
color = CodeBlock { 196; 164; 132; }
brown = Color.ByARGB(red=color.out0, green=color.out1, blue=color.out2)
wood_grill = Modifiers.GeometryColor.ByGeometryColor(geometry=dropItems_2, color=brown)
getItemAtIndex = List.GetItemAtIndex(list=instance_wooden_bars, index=code_block_8)
volume_6 = Watch(getItemAtIndex)

list_create_2 = List.Create(item0=volume_3, item1=volume_4)

# group (continued): Firepit
volume_to_string_3 = Python(IN[0]=list_create_2)  # CPython3; same code as volume_to_string
volume_7 = Watch(volume_to_string_3)
