# Dynamo graph 1799621.dyn (Dynamo 3.6.0.9395)

# group: Floor - DO NOT MODIFY
code_block = CodeBlock { -5000; -5000; -200; }
byCoordinates = Point.ByCoordinates(x=code_block.out0, y=code_block.out1, z=code_block.out2)
code_block_2 = CodeBlock { 5000; 5000; 0; }
byCoordinates_2 = Point.ByCoordinates(x=code_block_2.out0, y=code_block_2.out1, z=code_block_2.out2)
byCorners = Cuboid.ByCorners(lowPoint=byCoordinates, highPoint=byCoordinates_2)
code_block_3 = CodeBlock { 0; 100; 0; }
byARGB = Color.ByARGB(red=code_block_3.out0, green=code_block_3.out1, blue=code_block_3.out2)
byGeometryColor = Modifiers.GeometryColor.ByGeometryColor(geometry=byCorners, color=byARGB)

# group: Main structure (not the python portion of this assignment) > ORIGIN POINT (0,0,0)
code_block_4 = CodeBlock { 0; }
code_block_5 = CodeBlock { 0; }
code_block_6 = CodeBlock { 0; }
origin_point = Point.ByCoordinates(x=code_block_4, y=code_block_5, z=code_block_6)

# group: Main structure (not the python portion of this assignment) > RotationVector for Z (0,0,1)
# rotation vector
code_block_7 = CodeBlock { 0; }
code_block_8 = CodeBlock { 0; }
code_block_9 = CodeBlock { 1; }
rotationvector_z = Vector.ByCoordinates(x=code_block_7, y=code_block_8, z=code_block_9)

# group: Main structure (not the python portion of this assignment)
# In this group I used strictly dynamo nodes to create the shape, orientations, and colours of the shell and ribs, which composed the main structure of the pavillion.
code_block_10 = CodeBlock { 0; }
code_block_11 = CodeBlock { 0; }
code_block_12 = CodeBlock { 0; }
byCoordinates_3 = Point.ByCoordinates(x=code_block_10, y=code_block_11, z=code_block_12)
shellThickness_mm = DoubleSlider(400, range=50..600 step 10)
byCenterPointRadius = Circle.ByCenterPointRadius(centerPoint=byCoordinates_3, radius=shellThickness_mm)
byPatch = Surface.ByPatch(closedCurve=byCenterPointRadius)
offsetFromCenter_mm = DoubleSlider(0, range=0..2000 step 100)
number = DoubleInput(0)
numLayers = DoubleSlider(9, range=2..20 step 1)
code_block_13 = CodeBlock(NumLayers=numLayers) { 0..1..#NumLayers; }
number_2 = DoubleInput(0)
height_mm = DoubleSlider(9000, range=2000..10000 step 100)
math_remaprange_heights = Math.RemapRange(numbers=code_block_13, newMin=number_2, newMax=height_mm)
layer_center_points = Point.ByCoordinates(x=offsetFromCenter_mm, y=number, z=math_remaprange_heights)
baseRadius_mm = DoubleSlider(1500, range=1000..4500 step 100)
byCenterPointRadius_2 = Circle.ByCenterPointRadius(centerPoint=layer_center_points, radius=baseRadius_mm)
number_3 = DoubleInput(6)
regularPolygon = Polygon.RegularPolygon(circle=byCenterPointRadius_2, numberSides=number_3)
number_4 = DoubleInput(0)
twistAngle_deg = DoubleSlider(7630, range=0..9000 step 10)
math_remaprange_twist_angles = Math.RemapRange(numbers=code_block_13, newMin=number_4, newMax=twistAngle_deg)
degreesToRadians = Math.DegreesToRadians(degrees=math_remaprange_twist_angles)
rotate = Geometry.Rotate(geometry=regularPolygon, origin=origin_point, axis=rotationvector_z, degrees=degreesToRadians)
loftsurface = Surface.ByLoft(crossSections=rotate)
thicken = Surface.Thicken(surface=loftsurface, thickness=shellThickness_mm)
code_block_14 = CodeBlock { 0; }
code_block_15 = CodeBlock { 0; }
byCoordinates_4 = Point.ByCoordinates(x=code_block_14, y=code_block_15, z=height_mm)
byCenterPointRadius_3 = Circle.ByCenterPointRadius(centerPoint=byCoordinates_4, radius=baseRadius_mm)
code_block_16 = CodeBlock { 0..1..#20; }
pointAtParameter = Curve.PointAtParameter(curve=byCenterPointRadius_3, param=code_block_16)
perimeterCurves = Surface.PerimeterCurves(surface=loftsurface)

# group: Main structure (not the python portion of this assignment) > Green colour (shell)
# This group encompasses all the properties of the green colour in the pavillion (the shell)
code_block_17 = CodeBlock { 255; }
code_block_18 = CodeBlock { 31; }
code_block_19 = CodeBlock { 74; }
code_block_20 = CodeBlock { 46; }
green = Color.ByARGB(alpha=code_block_17, red=code_block_18, green=code_block_19, blue=code_block_20)
shell_colour = Modifiers.GeometryColor.ByGeometryColor(geometry=thicken, color=green)

# group: Main structure (not the python portion of this assignment) > Geometry.Translate for golden ribs (0,-9000,0)
number_5 = DoubleInput(0)
number_6 = DoubleInput(0)
number_7 = DoubleInput(-9000)
translate = Geometry.Translate(geometry=pointAtParameter, xTranslation=number_5, yTranslation=number_6, zTranslation=number_7)

# group (continued): Main structure (not the python portion of this assignment)
byStartPointEndPoint = Line.ByStartPointEndPoint(startPoint=pointAtParameter, endPoint=translate)

# group: Main structure (not the python portion of this assignment) > Gold colour (ribs)
# This group encompasses all items in the pavillion that were coloured gold. (excluding the components built with python)
code_block_21 = CodeBlock { 255; }
code_block_22 = CodeBlock { 184; }
code_block_23 = CodeBlock { 140; }
code_block_24 = CodeBlock { 20; }
gold = Color.ByARGB(alpha=code_block_21, red=code_block_22, green=code_block_23, blue=code_block_24)
ribs_colour = Modifiers.GeometryColor.ByGeometryColor(geometry=byStartPointEndPoint, color=gold)
byGeometryColor_2 = Modifiers.GeometryColor.ByGeometryColor(geometry=byCenterPointRadius_3, color=gold)

code_block_25 = CodeBlock { 0; }
code_block_26 = CodeBlock { 0; }
byCoordinates_5 = Point.ByCoordinates(x=code_block_25, y=code_block_26, z=height_mm)
rimBoundary = DoubleSlider(1500, range=0..5000 step 0.1)
byCenterPointRadius_4 = Circle.ByCenterPointRadius(centerPoint=byCoordinates_5, radius=rimBoundary)
petalHeight_mm = DoubleSlider(2000, range=100..2000 step 0.1)
petalRotation_mm = DoubleSlider(228.8, range=5..360 step 0.1)
petalThickness_mm = DoubleSlider(78.3, range=0..100 step 0.1)
class_petalelement = Python(IN[0]=byCenterPointRadius_4, IN[1]=petalHeight_mm, IN[2]=petalRotation_mm, IN[3]=petalThickness_mm)  # CPython3
# ---------- class_petalelement.python (66 lines) ----------
import sys
import clr
clr.AddReference('ProtoGeometry')
from Autodesk.DesignScript.Geometry import *

# Inputs:
# rimCurve : Polycurve 
# petalHeight : height of petal peak
# petalRotation : rotation degrees
# petalThickness : thickness to convert surface to solid

rimCurve       = IN[0]
petalHeight    = IN[1]
petalRotation  = IN[2]
petalThickness = IN[3]   

count = 24

# divide the rim
tList = [float(i) / count for i in range(count + 1)]
ptList = [rimCurve.PointAtParameter(t) for t in tList]

class Petal:
    def __init__(self, pA, pB, height, rotation, thickness):
        self.pA = pA
        self.pB = pB
        self.height = height
        self.rotation = rotation
        self.thickness = thickness

    def create(self):
        # midpoint + lift
        midZ = (self.pA.Z + self.pB.Z) * 0.5 + self.height
        mid = Point.ByCoordinates(
            (self.pA.X + self.pB.X) * 0.5,
            (self.pA.Y + self.pB.Y) * 0.5,
            midZ
        )

        # rotate midpoint
        axis = Vector.ZAxis()
        midRot = mid.Rotate(self.pA, axis, self.rotation)

        # polygon to surface
        poly = Polygon.ByPoints([self.pA, midRot, self.pB, self.pA])
        surf = Surface.ByPatch(poly)

        # surface to solid
        solid = surf.Thicken(self.thickness, False)

        # compute true volume mm^3
        vol = solid.Volume

        return solid, vol

# Output lists
petalSolids = []
petalVolumes = []

for i in range(len(ptList) - 1):
    petal = Petal(ptList[i], ptList[i + 1], petalHeight, petalRotation, petalThickness)
    s, v = petal.create()
    petalSolids.append(s)
    petalVolumes.append(v)

OUT = petalSolids, petalVolumes
# ----------------------------------------
code_block_27 = CodeBlock { 0; }
getItemAtIndex = List.GetItemAtIndex(list=class_petalelement, index=code_block_27)

# group: Gold colour for class: PetalElement
# this group is for the gold colour in the PetalElement class.
code_block_28 = CodeBlock { 255; }
code_block_29 = CodeBlock { 184; }
code_block_30 = CodeBlock { 140; }
code_block_31 = CodeBlock { 20; }
gold_2 = Color.ByARGB(alpha=code_block_28, red=code_block_29, green=code_block_30, blue=code_block_31)
byGeometryColor_3 = Modifiers.GeometryColor.ByGeometryColor(geometry=getItemAtIndex, color=gold_2)

x = CodeBlock { 0; }
y = CodeBlock { 0; }
z = CodeBlock { 0; }
base_starting_point_0_0_0 = Point.ByCoordinates(x=x, y=y, z=z)
baseradius_mm = DoubleSlider(2588.4, range=0..5000 step 0.1)
panelheight_mm = DoubleSlider(50, range=0..5000 step 0.1)
divisions = DoubleSlider(896.8, range=0..5000 step 0.1)
supportradius_mm = DoubleSlider(726.6, range=0..5000 step 0.1)
basethickness_mm = DoubleSlider(200, range=0..5000 step 0.1)
railingoffset_mm = DoubleSlider(461.7, range=0..5000 step 0.1)
railingradius_mm = DoubleSlider(467.1, range=0..5000 step 0.1)
wave_amp_mm = DoubleSlider(90, range=0..100 step 0.1)
wave_freq_mm = DoubleSlider(6, range=0..100 step 0.1)
wave_phase_deg = DoubleSlider(2, range=0..100 step 0.1)
panelthickness = DoubleSlider(152.1, range=0..2000 step 0.1)
class_basecomponents = Python(IN[0]=base_starting_point_0_0_0, IN[1]=baseradius_mm, IN[2]=panelheight_mm, IN[3]=divisions, IN[4]=supportradius_mm, IN[5]=basethickness_mm, IN[6]=railingoffset_mm, IN[7]=railingradius_mm, IN[8]=wave_amp_mm, IN[9]=wave_freq_mm, IN[10]=wave_phase_deg, IN[11]=panelthickness)  # CPython3
# ---------- class_basecomponents.python (126 lines) ----------
import sys
import clr
import math
clr.AddReference('ProtoGeometry')
from Autodesk.DesignScript.Geometry import *

center          = IN[0]
base_radius     = IN[1]
panel_height    = IN[2]
divisions       = int(IN[3])
support_radius  = IN[4]
base_thickness  = IN[5]
railing_offset  = IN[6]
railing_radius  = IN[7]
wave_amp        = IN[8]
wave_freq       = IN[9]
wave_phase_deg  = IN[10]
panel_thickness = IN[11]

wave_phase = math.radians(wave_phase_deg)

base_circle = Circle.ByCenterPointRadius(center, base_radius)
direction = Vector.ByCoordinates(0, 0, -base_thickness)
base_solid = base_circle.Extrude(direction)

ts   = [i / float(divisions) for i in range(divisions + 1)]
pts  = [base_circle.PointAtParameter(t) for t in ts]

panels = []
panel_volumes = []
supports = []
support_volumes = []
railings = []
railing_volumes = []

def wavy_height(index):
    theta = 2 * math.pi * index / divisions
    return wave_amp * math.sin(wave_freq * theta + wave_phase)

class FencePanel:
    def __init__(self, p0, p1, base_h, index, thick):
        self.p0 = p0
        self.p1 = p1
        self.base_h = base_h
        self.index = index
        self.thick = thick

    def create(self):
        extra = wavy_height(self.index)
        a = self.p0
        b = self.p1
        a_top = Point.ByCoordinates(a.X, a.Y, a.Z + self.base_h + extra)
        b_top = Point.ByCoordinates(b.X, b.Y, b.Z + self.base_h + extra)
        poly = Polygon.ByPoints([a, b, b_top, a_top, a])
        surf = Surface.ByPatch(poly)
        solid = surf.Thicken(self.thick, False)
        return solid, solid.Volume

class SupportBar:
    def __init__(self, p, height, radius):
        self.p = p
        self.height = height
        self.radius = radius

    def create(self):
        bottom = self.p
        top = Point.ByCoordinates(self.p.X, self.p.Y, self.p.Z + self.height)
        cyl = Cylinder.ByPointsRadius(bottom, top, self.radius)
        return cyl, cyl.Volume

class TopRailing:
    def __init__(self, center, radius, height_list, tube_radius, divisions):
        self.center = center
        self.radius = radius
        self.height_list = height_list
        self.tube_radius = tube_radius
        self.divisions = divisions

    def create(self):
        segs = []
        vols = []
        for i in range(self.divisions):
            h1 = self.height_list[i]
            h2 = self.height_list[(i+1) % self.divisions]
            t1 = 2*math.pi*i/self.divisions
            t2 = 2*math.pi*(i+1)/self.divisions
            p1 = Point.ByCoordinates(
                self.center.X + self.radius*math.cos(t1),
                self.center.Y + self.radius*math.sin(t1),
                h1
            )
            p2 = Point.ByCoordinates(
                self.center.X + self.radius*math.cos(t2),
                self.center.Y + self.radius*math.sin(t2),
                h2
            )
            cyl = Cylinder.ByPointsRadius(p1, p2, self.tube_radius)
            segs.append(cyl)
            vols.append(cyl.Volume)
        return segs, vols

top_heights = []

for i in range(divisions):
    p0 = pts[i]
    p1 = pts[i+1]

    panel, panel_vol = FencePanel(p0, p1, panel_height, i, panel_thickness).create()
    panels.append(panel)
    panel_volumes.append(panel_vol)

    sb, sb_vol = SupportBar(p0, panel_height, support_radius).create()
    supports.append(sb)
    support_volumes.append(sb_vol)

    top_heights.append(panel_height + wavy_height(i) + railing_offset)

railings, railing_volumes = TopRailing(
    center,
    base_radius,
    top_heights,
    railing_radius,
    divisions
).create()

OUT = base_solid, panels, panel_volumes, supports, support_volumes, railings, railing_volumes
# ----------------------------------------

# group: Gold colour for classes: FencePanel, SupportBar, TopRailing
# This group contains all the colour used for the BaseComponents
code_block_32 = CodeBlock { 3; }
getItemAtIndex_2 = List.GetItemAtIndex(list=class_basecomponents, index=code_block_32)
number_8 = DoubleInput(255)
number_9 = DoubleInput(184)
number_10 = DoubleInput(134)
number_11 = DoubleInput(11)
byARGB_2 = Color.ByARGB(alpha=number_8, red=number_9, green=number_10, blue=number_11)
byGeometryColor_4 = Modifiers.GeometryColor.ByGeometryColor(geometry=getItemAtIndex_2, color=byARGB_2)
code_block_33 = CodeBlock { 1; }
getItemAtIndex_3 = List.GetItemAtIndex(list=class_basecomponents, index=code_block_33)
number_12 = DoubleInput(255)
number_13 = DoubleInput(184)
number_14 = DoubleInput(134)
number_15 = DoubleInput(11)
byARGB_3 = Color.ByARGB(alpha=number_12, red=number_13, green=number_14, blue=number_15)
byGeometryColor_5 = Modifiers.GeometryColor.ByGeometryColor(geometry=getItemAtIndex_3, color=byARGB_3)
code_block_34 = CodeBlock { 5; }
getItemAtIndex_4 = List.GetItemAtIndex(list=class_basecomponents, index=code_block_34)
number_16 = DoubleInput(255)
number_17 = DoubleInput(184)
number_18 = DoubleInput(134)
number_19 = DoubleInput(11)
byARGB_4 = Color.ByARGB(alpha=number_16, red=number_17, green=number_18, blue=number_19)
byGeometryColor_6 = Modifiers.GeometryColor.ByGeometryColor(geometry=getItemAtIndex_4, color=byARGB_4)

code_block_35 = CodeBlock { 1; }
getItemAtIndex_5 = List.GetItemAtIndex(list=class_petalelement, index=code_block_35)
petal_surface_volume_mm_3 = Watch(getItemAtIndex_5)
code_block_36 = CodeBlock { 2; }
getItemAtIndex_6 = List.GetItemAtIndex(list=class_basecomponents, index=code_block_36)
panel_material_volume_mm_3 = Watch(getItemAtIndex_6)
code_block_37 = CodeBlock { 4; }
getItemAtIndex_7 = List.GetItemAtIndex(list=class_basecomponents, index=code_block_37)
support_material_volume_mm_3 = Watch(getItemAtIndex_7)
code_block_38 = CodeBlock { 6; }
getItemAtIndex_8 = List.GetItemAtIndex(list=class_basecomponents, index=code_block_38)
railing_material_volume_mm_3 = Watch(getItemAtIndex_8)
