# Dynamo graph 1799789.dyn (Dynamo 3.6.0.9395)

# group: Don't touch this ground
code_block = CodeBlock { -5000; -5000; -200; }
byCoordinates = Point.ByCoordinates(x=code_block.out0, y=code_block.out1, z=code_block.out2)
code_block_2 = CodeBlock { 5000; 5000; 0; }
byCoordinates_2 = Point.ByCoordinates(x=code_block_2.out0, y=code_block_2.out1, z=code_block_2.out2)
byCorners = Cuboid.ByCorners(lowPoint=byCoordinates, highPoint=byCoordinates_2)
code_block_3 = CodeBlock { 0; 100; 0; }
byARGB = Color.ByARGB(red=code_block_3.out0, green=code_block_3.out1, blue=code_block_3.out2)
byGeometryColor = Modifiers.GeometryColor.ByGeometryColor(geometry=byCorners, color=byARGB)

wavecurve_class = Python()  # CPython3
# ---------- wavecurve_class.python (39 lines) ----------
# Load the Python Standard and DesignScript Libraries
import sys
import clr
clr.AddReference('ProtoGeometry')
from Autodesk.DesignScript.Geometry import *

# Load the Python Standard and DesignScript Libraries
import sys
import clr
clr.AddReference('ProtoGeometry')
from Autodesk.DesignScript.Geometry import *
import math


class waveCurve:
    def __init__(self, points, amplitude, waves):
        self.points = points
        self.amplitude = amplitude
        self.waves = waves
    def makeElevatedPoints(self):
        n = len(self.points)
        outputPoints = []
        end = math.sin(math.pi * self.waves)
        for i in range(n):
            point = self.points[i]
            norm = float(i)/float(n-1)
            base = math.sin(math.pi * self.waves * norm)
            corrected = base - norm * end
            deltaZ = self.amplitude * corrected**2
            if deltaZ <0:
                deltaZ = -deltaZ
            newPoint = Point.ByCoordinates(point.X, point.Y, deltaZ)
            outputPoints.append(newPoint)
        return outputPoints
    def curveFromPoints(self):
        finalCurve = NurbsCurve.ByPoints(self.makeElevatedPoints())
        return finalCurve   
        
OUT = waveCurve
# ----------------------------------------
code_block_4 = CodeBlock { -2000; -5000; 0; }
byCoordinates_3 = Point.ByCoordinates(x=code_block_4.out0, y=code_block_4.out1, z=code_block_4.out2)
code_block_5 = CodeBlock { -5000; 0; 0; }
byCoordinates_4 = Point.ByCoordinates(x=code_block_5.out0, y=code_block_5.out1, z=code_block_5.out2)
code_block_6 = CodeBlock { -2000; 5000; 0; }
byCoordinates_5 = Point.ByCoordinates(x=code_block_6.out0, y=code_block_6.out1, z=code_block_6.out2)
byThreePoints = Arc.ByThreePoints(firstPoint=byCoordinates_3, secondPoint=byCoordinates_4, thirdPoint=byCoordinates_5)
number_of_divisions_boards_and = DoubleSlider(72, range=30..200 step 1)  # "Number of Divisions(Boards and tubes)"
code_block_7 = CodeBlock(n=number_of_divisions_boards_and) { n; x = 0..1..#n; }
pointAtParameter = Curve.PointAtParameter(curve=byThreePoints, param=code_block_7.x)
long_outer_curve_amplitude = DoubleSlider(3500, range=2500..3500 step 10)
number_of_outer_curve_waves = IntegerSlider(2, range=1..4 step 1)
longer_curve_instance = Python(IN[0]=wavecurve_class, IN[1]=pointAtParameter, IN[2]=long_outer_curve_amplitude, IN[3]=number_of_outer_curve_waves)  # CPython3
# ---------- longer_curve_instance.python (13 lines) ----------
# Load the Python Standard and DesignScript Libraries
import sys
import clr
clr.AddReference('ProtoGeometry')
from Autodesk.DesignScript.Geometry import *
waveCurve = IN[0]
points = IN[1]
amplitude = IN[2]
waves = IN[3]
curve = waveCurve(points, amplitude, waves)
constructedPoints =curve.makeElevatedPoints()    
constructedCurve= curve.curveFromPoints()
OUT = constructedPoints, constructedCurve
# ----------------------------------------
code_block_8 = CodeBlock(datas=longer_curve_instance) { datas; points = datas[0]; curve = datas[1]; }
code_block_9 = CodeBlock { 1000; -4000; 0; }
byCoordinates_6 = Point.ByCoordinates(x=code_block_9.out0, y=code_block_9.out1, z=code_block_9.out2)
code_block_10 = CodeBlock { -1000; 0; 0; }
byCoordinates_7 = Point.ByCoordinates(x=code_block_10.out0, y=code_block_10.out1, z=code_block_10.out2)
code_block_11 = CodeBlock { 1000; 4000; 0; }
byCoordinates_8 = Point.ByCoordinates(x=code_block_11.out0, y=code_block_11.out1, z=code_block_11.out2)
byThreePoints_2 = Arc.ByThreePoints(firstPoint=byCoordinates_6, secondPoint=byCoordinates_7, thirdPoint=byCoordinates_8)
code_block_12 = CodeBlock(n=number_of_divisions_boards_and) { n; x = 0..1..#n; }
pointAtParameter_2 = Curve.PointAtParameter(curve=byThreePoints_2, param=code_block_12.x)
lower_middle_curve_amplitude = DoubleSlider(2000, range=1500..2000 step 10)
upper_mid_curve_amplitude = CodeBlock(amp=lower_middle_curve_amplitude) { amp; newAmp = amp + 1000; newAmp; }  # "Upper Mid Curve Amplitude Adjustment"
mid_curve_waves = CodeBlock { 1; }
upper_mid_curve_instance = Python(IN[0]=wavecurve_class, IN[1]=pointAtParameter_2, IN[2]=upper_mid_curve_amplitude.out2, IN[3]=mid_curve_waves)  # CPython3; same code as longer_curve_instance
code_block_13 = CodeBlock(datas=upper_mid_curve_instance) { datas; points = datas[0]; curve = datas[1]; }
list_create = List.Create(item0=code_block_8.points, item1=code_block_13.points)
transpose = List.Transpose(lists=list_create)
byPoints = NurbsCurve.ByPoints(points=transpose)
lower_mid_curve_instance = Python(IN[0]=wavecurve_class, IN[1]=pointAtParameter_2, IN[2]=lower_middle_curve_amplitude, IN[3]=mid_curve_waves)  # CPython3; same code as longer_curve_instance
code_block_14 = CodeBlock(datas=lower_mid_curve_instance) { datas; points = datas[0]; curve = datas[1]; }
code_block_15 = CodeBlock { 5000; -3000; 0; }
byCoordinates_9 = Point.ByCoordinates(x=code_block_15.out0, y=code_block_15.out1, z=code_block_15.out2)
code_block_16 = CodeBlock { 3000; 0; 0; }
byCoordinates_10 = Point.ByCoordinates(x=code_block_16.out0, y=code_block_16.out1, z=code_block_16.out2)
code_block_17 = CodeBlock { 5000; 3000; 0; }
byCoordinates_11 = Point.ByCoordinates(x=code_block_17.out0, y=code_block_17.out1, z=code_block_17.out2)
byThreePoints_3 = Arc.ByThreePoints(firstPoint=byCoordinates_9, secondPoint=byCoordinates_10, thirdPoint=byCoordinates_11)
code_block_18 = CodeBlock(n=number_of_divisions_boards_and) { n; x = 0..1..#n; }
pointAtParameter_3 = Curve.PointAtParameter(curve=byThreePoints_3, param=code_block_18.x)
short_outer_curve_amplitude = DoubleSlider(1400, range=1000..2000 step 10)
shorter_curve_instance = Python(IN[0]=wavecurve_class, IN[1]=pointAtParameter_3, IN[2]=short_outer_curve_amplitude, IN[3]=number_of_outer_curve_waves)  # CPython3; same code as longer_curve_instance
code_block_19 = CodeBlock(datas=shorter_curve_instance) { datas; points = datas[0]; curve = datas[1]; }
list_create_2 = List.Create(item0=code_block_14.points, item1=code_block_19.points)
transpose_2 = List.Transpose(lists=list_create_2)
byPoints_2 = NurbsCurve.ByPoints(points=transpose_2)
wood_blind_thickness = DoubleSlider(70, range=15..100 step 0.1)
wood_blind_rotation_angle = DoubleSlider(51.9, range=0..70 step 0.1)
rotated_wood_blind_class = Python()  # CPython3; unwired: IN[0]
# ---------- rotated_wood_blind_class.python (177 lines) ----------
# Load the Python Standard and DesignScript Libraries
import sys
import clr
clr.AddReference('ProtoGeometry')
from Autodesk.DesignScript.Geometry import *
import random
from DSCore import Color
import math

class blinds:
    def __init__(self, point1, point2, point3, point4, thickness, rotation):
        self.point1 = point1
        self.point2 = point2
        self.point3 = point3
        self.point4 = point4
        self.thickness = thickness
        self.rotation = rotation
    def buildSolid(self, point1, point2, point3, point4):
        
        mid12 = Point.ByCoordinates((point1.X + point2.X)/2, (point1.Y + point2.Y)/2, (point1.Z + point2.Z)/2)
        mid34 = Point.ByCoordinates((point3.X + point4.X)/2, (point3.Y + point4.Y)/2, (point3.Z + point4.Z)/2)
        axis = Vector.ByTwoPoints(mid12, mid34)
        axisLen = axis.Length
        u = Vector.ByCoordinates(axis.X/axisLen, axis.Y/axisLen, axis.Z/axisLen)
        bottomPlane = Plane.ByBestFitThroughPoints([point1, point2, point3, point4])
        normal = bottomPlane.Normal
        normalLength = normal.Length
        w = Vector.ByCoordinates(normal.X/normalLength, normal.Y/normalLength, normal.Z/normalLength)
        v = Vector.Cross(w, u)
        vLength = v.Length
        v = Vector.ByCoordinates(v.X/vLength, v.Y/vLength, v.Z/vLength)
        
        d12 = Point.DistanceTo(point1, point2)
        d34 = Point.DistanceTo(point3, point4)
        halfWidth = 0.25 * (d12 + d34)
        halfThickness = self.thickness/2.0
        
        def offsetPoint(basePoint, vScale, wScale):
            vector = Vector.ByCoordinates(v.X *vScale + w.X * wScale, v.Y *vScale + w.Y * wScale, v.Z *vScale + w.Z * wScale)
            return basePoint.Translate(vector)
            
        bot1 = offsetPoint(mid12, 0.55 * halfWidth, -halfThickness)
        bot2 = offsetPoint(mid12, 0.55 * -halfWidth, -halfThickness)
        top1 = offsetPoint(mid12, 0.55 * halfWidth, halfThickness)
        top2 = offsetPoint(mid12, 0.55 * -halfWidth, halfThickness)
        
        bot3 = offsetPoint(mid34, 0.55* halfWidth, -halfThickness)
        bot4 = offsetPoint(mid34, 0.55*-halfWidth, -halfThickness)
        top3 = offsetPoint(mid34, 0.55*halfWidth, halfThickness)
        top4 = offsetPoint(mid34, 0.55*-halfWidth, halfThickness)
        bottom = NurbsSurface.ByPoints([[bot1, bot2], [bot3, bot4]])
        top = NurbsSurface.ByPoints([[top1, top2], [top3, top4]])
        
        surf1 = NurbsSurface.ByPoints([[bot1, bot2],[top1, top2]])
        surf2 = NurbsSurface.ByPoints([[bot2, bot4],[top2, top4]])
        surf3 = NurbsSurface.ByPoints([[bot4, bot3],[top4, top3]])
        surf4 = NurbsSurface.ByPoints([[bot3, bot1],[top3, top1]])
        solid = Solid.ByJoinedSurfaces([bottom, top, surf1, surf2, surf3, surf4])
        cx = (point1.X + point2.X + point3.X + point4.X)/4
        cy = (point1.Y + point2.Y + point3.Y + point4.Y)/4
        cz = (point1.Z + point2.Z + point3.Z + point4.Z)/4
        center = Point.ByCoordinates(cx, cy, cz)
        
        axis = Vector.ByTwoPoints(mid12, mid34)
        noisyAngle = self.rotation + random.uniform(-0.5, 0.5) * self.rotation
        rotated = Geometry.Rotate(solid, center, axis, noisyAngle)
        return rotated 
    def makeSurface(self):
        solid = self.buildSolid(self.point1, self.point2, self.point3, self.point4)
        if solid is not None:
            return solid
        else:
            return None

    def addColour(self):
        baseR, baseG, baseB = 139, 69, 19
        noise = 15
        newR = baseR + random.randint(-noise, noise)
        newG = baseG + random.randint(-noise, noise)
        newB = baseB + random.randint(-noise, noise)
        return Color.ByARGB(255, newR, newG, newB)
OUT = blinds
"""
class blinds:
    def __init__(self, point1, point2, point3, point4, thickness, rotation):
        self.point1 = point1
        self.point2 = point2
        self.point3 = point3
        self.point4 = point4
        self.thickness = thickness
        self.rotation = rotation
    def makeSurface(self):
        bottomPlane = Plane.ByBestFitThroughPoints([self.point1, self.point2, self.point3, self.point4])
        normal = bottomPlane.Normal
        bottomPoints = [self.point1, self.point2, self.point3, self.point4, self.point1]
        topPoints = [Point.Translate(pt, normal, self.thickness) for pt in bottomPoints]
        
        bottomSurface = Surface.ByPatch(PolyCurve.ByPoints(bottomPoints))
        topSurface = Surface.ByPatch(PolyCurve.ByPoints(topPoints))
        sideSurfaces = []
        for i in range(4):
            bottom0 = bottomPoints[i]
            bottom1 = bottomPoints[i + 1]
            top1 = topPoints[i + 1]
            top2 = topPoints[i]
            sideSurfaces.append(Surface.ByPatch(PolyCurve.ByPoints([bottom0, bottom1, top1, top2, bottom0])))
        allSurfaces = [bottomSurface, topSurface] + sideSurfaces
        solid = Solid.ByJoinedSurfaces(allSurfaces)
            
        cx = (self.point1.X + self.point2.X + self.point3.X + self.point4.X)/4
        cy = (self.point1.Y + self.point2.Y + self.point3.Y + self.point4.Y)/4
        cz = (self.point1.Z + self.point2.Z + self.point3.Z + self.point4.Z)/4
        center = Point.ByCoordinates(cx, cy, cz)
        averageLowerPoint = Point.ByCoordinates((self.point3.X + self.point4.X)/2, (self.point3.Y + self.point4.Y)/2, (self.point3.Z + self.point4.Z)/2)
        averageUpperPoint = Point.ByCoordinates((self.point1.X + self.point2.X)/2, (self.point1.Y + self.point2.Y)/2, (self.point1.Z + self.point2.Z)/2)
        axis = Vector.ByTwoPoints(averageLowerPoint, averageUpperPoint)
        noisyAngle = self.rotation + random.uniform(-0.5, 0.5) * self.rotation
        rotated = Geometry.Rotate(solid, center, axis, noisyAngle)
        return rotated
"""
"""
bottomPlane = Plane.ByBestFitThroughPoints([point1, point2, point3, point4])
            normal = bottomPlane.Normal
            offsetVector = Vector.ByCoordinates(normal.X * self.thickness, normal.Y * self.thickness, normal.Z * self.thickness)
            bottom1, bottom2, bottom3, bottom4 = point1, point2, point3, point4
            top1 = Point.Translate(bottom1, offsetVector)
            top2 = Point.Translate(bottom2, offsetVector)
            top3 = Point.Translate(bottom3, offsetVector)
            top4 = Point.Translate(bottom4, offsetVector)
            bottomSurface = NurbsSurface.ByPoints([[bottom1, bottom2], [bottom4, bottom3]])
            topSurface = NurbsSurface.ByPoints([[top1, top2], [top4, top3]])
            side1 = NurbsSurface.ByPoints([[bottom1, bottom2], [top1, top2]])
            side2 = NurbsSurface.ByPoints([[bottom2, bottom3], [top2, top3]])
            side3 = NurbsSurface.ByPoints([[bottom3, bottom4], [top3, top4]])
            side4 = NurbsSurface.ByPoints([[bottom4, bottom1], [top4, top1]])
            surfaces = [bottomSurface, topSurface, side1, side2, side3, side4]
            if any(surface is None for surface in surfaces):
                return None
            solid = Solid.ByJoinedSurfaces(surfaces)
            if solid is None:
                return None
            cx = (point1.X + point2.X + point3.X + point4.X)/4
            cy = (point1.Y + point2.Y + point3.Y + point4.Y)/4
            cz = (point1.Z + point2.Z + point3.Z + point4.Z)/4
            center = Point.ByCoordinates(cx, cy, cz)
            averageLowerPoint = Point.ByCoordinates((point3.X + point4.X)/2, (point3.Y + point4.Y)/2, (point3.Z + point4.Z)/2)
            averageUpperPoint = Point.ByCoordinates((point1.X + point2.X)/2, (point1.Y + point2.Y)/2, (point1.Z + point2.Z)/2)
            axis = Vector.ByTwoPoints(averageLowerPoint, averageUpperPoint)
            noisyAngle = self.rotation + random.uniform(-0.5, 0.5) * self.rotation
            rotated = Geometry.Rotate(solid, center, axis, noisyAngle)
            return rotated
        except:
            return None    
    def makeSurface(self):
        main = self.buildSolid(self.point1, self.point2, self.point3, self.point4)
        if main is not None:
            return main

        mid14 = Point.ByCoordinates((self.point1.X + self.point4.X)/2, (self.point1.Y + self.point4.Y)/2, (self.point1.Z + self.point4.Z)/2)
        mid23 = Point.ByCoordinates((self.point3.X + self.point2.X)/2, (self.point3.Y + self.point2.Y)/2, (self.point3.Z + self.point2.Z)/2)
        solidA = self.buildSolid(self.point1, self.point2, mid23, mid14)
        solidB = self.buildSolid(mid14, mid23, self.point3, self.point4)
        solids = [solid for solid in [solidA, solidB] if solid is not None]
        if len(solids) ==0:
            return None
        if len(solids) ==1:
            return solids[0]
        return solids
    def addColour(self):
        baseR, baseG, baseB = 139, 69, 19
        noise = 15
        newR = baseR + random.randint(-noise, noise)
        newG = baseG + random.randint(-noise, noise)
        newB = baseB + random.randint(-noise, noise)
        return Color.ByARGB(255, newR, newG, newB)
OUT = blinds
"""
# ----------------------------------------
lower_rotated_wood_blind = Python(IN[0]=list_create_2, IN[1]=wood_blind_thickness, IN[2]=wood_blind_rotation_angle, IN[3]=rotated_wood_blind_class)  # "Lower Rotated Wood Blind Sequence Instance"; CPython3
# ---------- lower_rotated_wood_blind.python (36 lines) ----------
# Load the Python Standard and DesignScript Libraries
import sys
import clr
clr.AddReference('ProtoGeometry')
from Autodesk.DesignScript.Geometry import *
from Modifiers import GeometryColor
points1 = IN[0][0]
points2 = IN[0][1]
thickness = IN[1]
rotation = IN[2]
blinds = IN[3]
finalBlinds = []
totalVolume = 0
volumeList = []
colored = []
for i in range(len(points1) - 1):
    point1 = points1[i]
    point2 = points1[i + 1]
    point3 = points2[i + 1]
    point4 = points2[i]
    theBlind = blinds(point1, point2, point3, point4, thickness, rotation)
    try:
        solid = theBlind.makeSurface()
        finalBlinds.append(solid)
        colour = theBlind.addColour()
        colored.append(GeometryColor.ByGeometryColor(solid, colour))
        try:
            totalVolume += solid.Volume
            volumeList.append(solid.Volume)
        except:
            totalVolume += Geometry.DistanceTo(point1, point2) * Geometry.DistanceTo(point2, point4) * thickness
            volumeList.append(Geometry.DistanceTo(point1, point2) * Geometry.DistanceTo(point2, point4) * thickness)
    except:
        finalBlinds.append(None)
volumeString = f'Wood Volume = {totalVolume} mm^3'   
OUT = None, volumeString, totalVolume, volumeList, colored
# ----------------------------------------
code_block_20 = CodeBlock { 1; 2; }
getItemAtIndex = List.GetItemAtIndex(list=lower_rotated_wood_blind, index=code_block_20.out0)
wood_volume_for_lower_series_of = Watch(getItemAtIndex)  # "Wood Volume For Lower Series of Rotated Blinds"
upper_rotated_wood_blind = Python(IN[0]=list_create, IN[1]=wood_blind_thickness, IN[2]=wood_blind_rotation_angle, IN[3]=rotated_wood_blind_class)  # "Upper Rotated Wood Blind Sequence Instance"; CPython3; same code as lower_rotated_wood_blind
getItemAtIndex_2 = List.GetItemAtIndex(list=upper_rotated_wood_blind, index=code_block_20.out0)
wood_volume_for_upper_series_of = Watch(getItemAtIndex_2)  # "Wood Volume For Upper Series of Rotated Blinds"
getItemAtIndex_3 = List.GetItemAtIndex(list=lower_rotated_wood_blind, index=code_block_20.out1)
getItemAtIndex_4 = List.GetItemAtIndex(list=upper_rotated_wood_blind, index=code_block_20.out1)
code_block_21 = CodeBlock(v1=getItemAtIndex_3, v2=getItemAtIndex_4) { v1; v2; vTot = v1 + v2; }
python_script = Python(IN[0]=code_block_21.vTot)  # CPython3
# ---------- python_script.python (9 lines) ----------
# Load the Python Standard and DesignScript Libraries
import sys
import clr
clr.AddReference('ProtoGeometry')
from Autodesk.DesignScript.Geometry import *

v = IN[0]
volumeString = f'Total Wood Volume = {v} mm^3'
OUT = volumeString
# ----------------------------------------
total_wood_volume = Watch(python_script)
steel_tube_class = Python()  # CPython3; unwired: IN[0]
# ---------- steel_tube_class.python (27 lines) ----------
# Load the Python Standard and DesignScript Libraries
import sys
import clr
clr.AddReference('ProtoGeometry')
from Autodesk.DesignScript.Geometry import *
from DSCore import Color
import random
class tube:
    def __init__(self, ogCurve, radius):
        self.ogCurve = ogCurve
        self.radius = radius 
    def tubeFromCurve(self):
        radius = float(self.radius)
        startPoint = self.ogCurve.StartPoint
        tangent = self.ogCurve.TangentAtParameter(0.0)
        plane = Plane.ByOriginNormal(startPoint, tangent)
        circle = Circle.ByPlaneRadius(plane, radius)
        tube = Solid.BySweep(circle, self.ogCurve)
        return tube 
    def addColour(self):
        noise = 30
        randomNoise = random.randint(-noise, noise)
        r = 135 + randomNoise
        g = 135 + randomNoise
        b = 135 + randomNoise
        return Color.ByARGB(255, r, g, b)
OUT = tube
# ----------------------------------------
steel_tube_radius = DoubleSlider(40, range=10..75 step 1)
shorter_steel_tube_instance = Python(IN[0]=steel_tube_class, IN[1]=code_block_19.curve, IN[2]=steel_tube_radius)  # CPython3
# ---------- shorter_steel_tube_instance.python (17 lines) ----------
# Load the Python Standard and DesignScript Libraries
import sys
import clr
clr.AddReference('ProtoGeometry')
from Autodesk.DesignScript.Geometry import *
from Modifiers import GeometryColor

tube = IN[0]
ogCurve = IN[1]
radius = IN[2]
myTube = tube(ogCurve, radius)
finalTube = myTube.tubeFromCurve()
tubeVolume = finalTube.Volume
volumeString = f'Steel Volume = {tubeVolume} mm^3'
colour = myTube.addColour()
coloured = GeometryColor.ByGeometryColor(finalTube, colour)
OUT = None, tubeVolume, volumeString, coloured
# ----------------------------------------
code_block_22 = CodeBlock { 1; 2; }
getItemAtIndex_5 = List.GetItemAtIndex(list=shorter_steel_tube_instance, index=code_block_22.out1)
shorter_outside_tube_steel = Watch(getItemAtIndex_5)  # "Shorter Outside Tube Steel Volume"
longer_steel_tube_instance = Python(IN[0]=steel_tube_class, IN[1]=code_block_8.curve, IN[2]=steel_tube_radius)  # CPython3; same code as shorter_steel_tube_instance
code_block_23 = CodeBlock { 1; 2; }
getItemAtIndex_6 = List.GetItemAtIndex(list=longer_steel_tube_instance, index=code_block_23.out1)
longer_outside_tube_steel_volume = Watch(getItemAtIndex_6)
lower_mid_steel_tube_instance = Python(IN[0]=steel_tube_class, IN[1]=code_block_14.curve, IN[2]=steel_tube_radius)  # CPython3; same code as shorter_steel_tube_instance
code_block_24 = CodeBlock { 1; 2; }
getItemAtIndex_7 = List.GetItemAtIndex(list=lower_mid_steel_tube_instance, index=code_block_24.out1)
lower_mid_tube_steel_volume = Watch(getItemAtIndex_7)
upper_mid_steel_tube_instance = Python(IN[0]=steel_tube_class, IN[1]=code_block_13.curve, IN[2]=steel_tube_radius)  # CPython3; same code as shorter_steel_tube_instance
code_block_25 = CodeBlock { 1; 2; }
getItemAtIndex_8 = List.GetItemAtIndex(list=upper_mid_steel_tube_instance, index=code_block_25.out1)
upper_mid_tube_steel_volume = Watch(getItemAtIndex_8)
getItemAtIndex_9 = List.GetItemAtIndex(list=shorter_steel_tube_instance, index=code_block_22.out0)
getItemAtIndex_10 = List.GetItemAtIndex(list=longer_steel_tube_instance, index=code_block_23.out0)
getItemAtIndex_11 = List.GetItemAtIndex(list=lower_mid_steel_tube_instance, index=code_block_24.out0)
getItemAtIndex_12 = List.GetItemAtIndex(list=upper_mid_steel_tube_instance, index=code_block_25.out0)
list_create_3 = List.Create(item0=code_block_14.points, item1=code_block_13.points)
transpose_3 = List.Transpose(lists=list_create_3)
python_script_2 = Python(IN[0]=transpose_3)  # CPython3
# ---------- python_script_2.python (9 lines) ----------
# Load the Python Standard and DesignScript Libraries
import sys
import clr
clr.AddReference('ProtoGeometry')
from Autodesk.DesignScript.Geometry import *

ogList = IN[0]
newList = ogList[1:len(ogList)-1]
OUT = newList
# ----------------------------------------
byPoints_3 = NurbsCurve.ByPoints(points=python_script_2)
first_slanted_steel_tubes_series = Python(IN[0]=steel_tube_class, IN[1]=byPoints_3, IN[2]=steel_tube_radius)  # "First Slanted Steel Tubes Series of Instances"; CPython3
# ---------- first_slanted_steel_tubes_series.python (22 lines) ----------
# Load the Python Standard and DesignScript Libraries
import sys
import clr
clr.AddReference('ProtoGeometry')
from Autodesk.DesignScript.Geometry import *
from Modifiers import GeometryColor 
tube = IN[0]
ogCurve = IN[1]
radius = IN[2]
finalTubes = []
colouredTubes = []
totalVolume = 0
for i in range(len(ogCurve)):
    myTube = tube(ogCurve[i], radius)
    theTube = myTube.tubeFromCurve()
    finalTubes.append(theTube)
    colour = myTube.addColour()
    coloured = GeometryColor.ByGeometryColor(theTube, colour)
    colouredTubes.append(coloured)
    totalVolume += theTube.Volume
volumeString = f'Steel Volume = {totalVolume} mm^3'
OUT = colouredTubes, totalVolume, volumeString
# ----------------------------------------
code_block_26 = CodeBlock { 1; 2; }
getItemAtIndex_13 = List.GetItemAtIndex(list=first_slanted_steel_tubes_series, index=code_block_26.out0)
python_script_3 = Python(IN[0]=list_create_3)  # CPython3
# ---------- python_script_3.python (13 lines) ----------
# Load the Python Standard and DesignScript Libraries
import sys
import clr
clr.AddReference('ProtoGeometry')
from Autodesk.DesignScript.Geometry import *

ogList = IN[0]
lowerPoints = ogList[0]
upperPoints = ogList[1]
newLower = lowerPoints[2:len(lowerPoints)-1]
newUpper = upperPoints[1:len(upperPoints)-2]
newList = [newLower, newUpper]
OUT = newList
# ----------------------------------------
transpose_4 = List.Transpose(lists=python_script_3)
byPoints_4 = NurbsCurve.ByPoints(points=transpose_4)
second_slanted_steel_tubes = Python(IN[0]=steel_tube_class, IN[1]=byPoints_4, IN[2]=steel_tube_radius)  # "Second Slanted Steel Tubes Series of Instances"; CPython3
# ---------- second_slanted_steel_tubes.python (23 lines) ----------
# Load the Python Standard and DesignScript Libraries
import sys
import clr
clr.AddReference('ProtoGeometry')
from Autodesk.DesignScript.Geometry import *
from Modifiers import GeometryColor 

tube = IN[0]
ogCurve = IN[1]
radius = IN[2]
finalTubes = []
colouredTubes = []
totalVolume = 0
for i in range(len(ogCurve)):
    myTube = tube(ogCurve[i], radius)
    theTube = myTube.tubeFromCurve()
    finalTubes.append(theTube)
    colour = myTube.addColour()
    coloured = GeometryColor.ByGeometryColor(theTube, colour)
    colouredTubes.append(coloured)
    totalVolume += theTube.Volume
volumeString = f'Steel Volume = {totalVolume} mm^3'
OUT = colouredTubes, totalVolume, volumeString
# ----------------------------------------
getItemAtIndex_14 = List.GetItemAtIndex(list=second_slanted_steel_tubes, index=code_block_26.out0)
code_block_27 = CodeBlock(v1=getItemAtIndex_9, v2=getItemAtIndex_10, v3=getItemAtIndex_11, v4=getItemAtIndex_12, v5=getItemAtIndex_13, v6=getItemAtIndex_14) { v1; v2; v3; v4; v5; v6; vTot = v1 + v2 + v3 + v4 + v5 + v6; vTot; }
python_script_4 = Python(IN[0]=code_block_27.out7)  # CPython3
# ---------- python_script_4.python (9 lines) ----------
# Load the Python Standard and DesignScript Libraries
import sys
import clr
clr.AddReference('ProtoGeometry')
from Autodesk.DesignScript.Geometry import *

v = IN[0]
volumeString = f'Total Steel Volume = {v} mm^3'
OUT = volumeString
# ----------------------------------------
total_steel_volume = Watch(python_script_4)
getItemAtIndex_15 = List.GetItemAtIndex(list=first_slanted_steel_tubes_series, index=code_block_26.out1)
first_slanted_series_of_tubes = Watch(getItemAtIndex_15)  # "First Slanted Series of Tubes Steel Volume"
getItemAtIndex_16 = List.GetItemAtIndex(list=second_slanted_steel_tubes, index=code_block_26.out1)
second_slanted_series_of_tubes = Watch(getItemAtIndex_16)  # "Second Slanted Series of Tubes Steel Volume"
