# Dynamo graph 1800628.dyn (Dynamo 3.6.0.9395)

code_block = CodeBlock { -5000; -5000; -200; }
byCoordinates = Point.ByCoordinates(x=code_block.out0, y=code_block.out1, z=code_block.out2)
code_block_2 = CodeBlock { 5000; 5000; 0; }
byCoordinates_2 = Point.ByCoordinates(x=code_block_2.out0, y=code_block_2.out1, z=code_block_2.out2)
byCorners = Cuboid.ByCorners(lowPoint=byCoordinates, highPoint=byCoordinates_2)
code_block_3 = CodeBlock { 0; 100; 0; }
byARGB = Color.ByARGB(red=code_block_3.out0, green=code_block_3.out1, blue=code_block_3.out2)
byGeometryColor = Modifiers.GeometryColor.ByGeometryColor(geometry=byCorners, color=byARGB)
code_block_4 = CodeBlock { -4000; -4000; 0; }
byCoordinates_3 = Point.ByCoordinates(x=code_block_4.out0, y=code_block_4.out1, z=code_block_4.out2)
code_block_5 = CodeBlock { 4000; -4000; 0; }
byCoordinates_4 = Point.ByCoordinates(x=code_block_5.out0, y=code_block_5.out1, z=code_block_5.out2)
byStartPointEndPoint = Line.ByStartPointEndPoint(startPoint=byCoordinates_3, endPoint=byCoordinates_4)
code_block_6 = CodeBlock { 0; 5; 1/4; }
sequence = Sequence(start=code_block_6.out0, amount=code_block_6.out1, step=code_block_6.out2)
bottom_1 = Curve.PointAtParameter(curve=byStartPointEndPoint, param=sequence)
code_block_7 = CodeBlock { -4500; 0; 10000; }
byCoordinates_5 = Point.ByCoordinates(x=code_block_7.out0, y=code_block_7.out1, z=code_block_7.out2)
code_block_8 = CodeBlock { 4500; 0; 3000; }
byCoordinates_6 = Point.ByCoordinates(x=code_block_8.out0, y=code_block_8.out1, z=code_block_8.out2)
byStartPointEndPoint_2 = Line.ByStartPointEndPoint(startPoint=byCoordinates_5, endPoint=byCoordinates_6)
code_block_9 = CodeBlock { 0; 5; 1/4; }
sequence_2 = Sequence(start=code_block_9.out0, amount=code_block_9.out1, step=code_block_9.out2)
top_1 = Curve.PointAtParameter(curve=byStartPointEndPoint_2, param=sequence_2)
code_block_10 = CodeBlock { 500; 10; 0; }
sequence_3 = Sequence(start=code_block_10.out0, amount=code_block_10.out1, step=code_block_10.out2)
steel_rod_class = Python()  # CPython3; unwired: IN[0]
# ---------- steel_rod_class.python (17 lines) ----------
# Load the Python Standard and DesignScript Libraries
import sys
import clr
clr.AddReference('ProtoGeometry')
from Autodesk.DesignScript.Geometry import *
import math

class Rod:
    def __init__(self, bottom_point, top_point, radius):
        self.bottom = bottom_point
        self.top = top_point
        self.radius = radius
        
    def geometry(self):
        return Cylinder.ByPointsRadius(self.bottom, self.top, self.radius)
      
OUT = Rod
# ----------------------------------------
series_of_stl_rods_1 = Python(IN[0]=bottom_1, IN[1]=top_1, IN[2]=sequence_3, IN[3]=steel_rod_class)  # CPython3
# ---------- series_of_stl_rods_1.python (18 lines) ----------
bottom_points = IN[0]
top_points =IN[1]
radii = IN[2]
Rod = IN[3]

rods = []
count = min(len(bottom_points), len(top_points))


for i in range(count):
    r = radii[i] if i < len(radii) else radii[-1]
    btm = bottom_points[i]
    top = top_points[i]
    
    rod = Rod(btm,top,r)
    rods.append(rod.geometry())
    
OUT = rods
# ----------------------------------------
volume = Solid.Volume(solid=series_of_stl_rods_1)
volume_of_steel_rods = Watch(volume)
sum = Math.Sum(values=volume_of_steel_rods)
code_block_11 = CodeBlock { 4000; 4000; 0; }
byCoordinates_7 = Point.ByCoordinates(x=code_block_11.out0, y=code_block_11.out1, z=code_block_11.out2)
code_block_12 = CodeBlock { -4000; 4000; 0; }
byCoordinates_8 = Point.ByCoordinates(x=code_block_12.out0, y=code_block_12.out1, z=code_block_12.out2)
byStartPointEndPoint_3 = Line.ByStartPointEndPoint(startPoint=byCoordinates_7, endPoint=byCoordinates_8)
code_block_13 = CodeBlock { 0; 5; 1/4; }
sequence_4 = Sequence(start=code_block_13.out0, amount=code_block_13.out1, step=code_block_13.out2)
bottom_2 = Curve.PointAtParameter(curve=byStartPointEndPoint_3, param=sequence_4)
code_block_14 = CodeBlock { 4500; 0; 3000; }
byCoordinates_9 = Point.ByCoordinates(x=code_block_14.out0, y=code_block_14.out1, z=code_block_14.out2)
code_block_15 = CodeBlock { -4500; 0; 10000; }
byCoordinates_10 = Point.ByCoordinates(x=code_block_15.out0, y=code_block_15.out1, z=code_block_15.out2)
byStartPointEndPoint_4 = Line.ByStartPointEndPoint(startPoint=byCoordinates_9, endPoint=byCoordinates_10)
code_block_16 = CodeBlock { 0; 5; 1/4; }
sequence_5 = Sequence(start=code_block_16.out0, amount=code_block_16.out1, step=code_block_16.out2)
top_2 = Curve.PointAtParameter(curve=byStartPointEndPoint_4, param=sequence_5)
code_block_17 = CodeBlock { 500; 10; 0; }
sequence_6 = Sequence(start=code_block_17.out0, amount=code_block_17.out1, step=code_block_17.out2)
series_of_stl_rods_2 = Python(IN[0]=bottom_2, IN[1]=top_2, IN[2]=sequence_6, IN[3]=steel_rod_class)  # CPython3
# ---------- series_of_stl_rods_2.python (17 lines) ----------
bottom_points = IN[0]
top_points =IN[1]
radii = IN[2]
Rod = IN[3]

rods = []
count = min(len(bottom_points), len(top_points))

for i in range(count):
    r = radii[i] if i < len(radii) else radii[-1]
    btm = bottom_points[i]
    top = top_points[i]
    
    rod = Rod(btm,top,r)
    rods.append(rod.geometry())
    
OUT = rods
# ----------------------------------------
volume_2 = Solid.Volume(solid=series_of_stl_rods_2)
volume_of_steel_rods_2 = Watch(volume_2)
sum_2 = Math.Sum(values=volume_of_steel_rods_2)
list_create = List.Create(item0=sum, item1=sum_2)
sum_3 = Math.Sum(values=list_create)
total_volume_of_rods = Watch(sum_3)
color_palette = ColorPalette({R: 105, G: 0, B: 163, A: 255})
byGeometryColor_2 = Modifiers.GeometryColor.ByGeometryColor(geometry=series_of_stl_rods_2, color=color_palette)
timberbeam_class = Python()  # CPython3; unwired: IN[0]
# ---------- timberbeam_class.python (25 lines) ----------
# Load the Python Standard and DesignScript Libraries
import sys
import clr
clr.AddReference('ProtoGeometry')
from Autodesk.DesignScript.Geometry import *
import math

class Beam:
    def __init__(self,centerline,radius):
        self.centerline = centerline
        self.radius = radius
        
    def endpoints(self):
        return self.centerline.StartPoint, self.centerline.EndPoint
        
    def geometry(self):
        end1, end2 = self.endpoints()
        
        return Cylinder.ByPointsRadius (end1, end2, self.radius)
        
    def volume(self):
        end1, end2 = self.endpoints()
        return math.pi*end1.DistanceTo(end2)*(self.radius**2)
        
OUT = Beam
# ----------------------------------------
code_block_18 = CodeBlock { -4500; 0; 10000; }
byCoordinates_11 = Point.ByCoordinates(x=code_block_18.out0, y=code_block_18.out1, z=code_block_18.out2)
code_block_19 = CodeBlock { 4500; 0; 3000; }
byCoordinates_12 = Point.ByCoordinates(x=code_block_19.out0, y=code_block_19.out1, z=code_block_19.out2)
byStartPointEndPoint_5 = Line.ByStartPointEndPoint(startPoint=byCoordinates_11, endPoint=byCoordinates_12)
radius_of_top_beam = DoubleSlider(700, range=0..1000 step 1)
top_beam = Python(IN[0]=timberbeam_class, IN[1]=byStartPointEndPoint_5, IN[2]=radius_of_top_beam)  # CPython3
# ---------- top_beam.python (4 lines) ----------
Beam = IN[0]
topBeam= Beam(IN[1], IN[2])

OUT = [topBeam.geometry(), topBeam.volume()]
# ----------------------------------------
volume_3 = Solid.Volume(solid=top_beam)
watch = Watch(volume_3)
code_block_20 = CodeBlock { -4900; -4900; 0; }
byCoordinates_13 = Point.ByCoordinates(x=code_block_20.out0, y=code_block_20.out1, z=code_block_20.out2)
code_block_21 = CodeBlock { 4900; -4900; 0; }
byCoordinates_14 = Point.ByCoordinates(x=code_block_21.out0, y=code_block_21.out1, z=code_block_21.out2)
byStartPointEndPoint_6 = Line.ByStartPointEndPoint(startPoint=byCoordinates_13, endPoint=byCoordinates_14)
number_of_beams_minus_2 = DoubleSlider(15, range=0..30 step 1)
code_block_22 = CodeBlock(n=number_of_beams_minus_2) { n; 0..1..#n; }
splitByParameter = Curve.SplitByParameter(curve=byStartPointEndPoint_6, parameters=code_block_22.out1)
endPoint = Curve.EndPoint(curve=splitByParameter)
code_block_23 = CodeBlock { 2; 0; }
dropEveryNthItem = List.DropEveryNthItem(list=endPoint, n=code_block_23.out0, offset=code_block_23.out1)
code_block_24 = CodeBlock { -4000; -3500; 3500; }
byCoordinates_15 = Point.ByCoordinates(x=code_block_24.out0, y=code_block_24.out1, z=code_block_24.out2)
change_angle_of_truss_columns = DoubleSlider(4117, range=-10000..10000 step 1)
code_block_25 = CodeBlock { -5000; 10000; }
byCoordinates_16 = Point.ByCoordinates(x=change_angle_of_truss_columns, z=code_block_25.out1)
byStartPointEndPoint_7 = Line.ByStartPointEndPoint(startPoint=byCoordinates_15, endPoint=byCoordinates_16)
splitByParameter_2 = Curve.SplitByParameter(curve=byStartPointEndPoint_7, parameters=code_block_22.out1)
endPoint_2 = Curve.EndPoint(curve=splitByParameter_2)
addItemToFront = List.AddItemToFront(item=byCoordinates_15, list=endPoint_2)
dropEveryNthItem_2 = List.DropEveryNthItem(list=addItemToFront, n=code_block_23.out0, offset=code_block_23.out1)
byStartPointEndPoint_8 = Line.ByStartPointEndPoint(startPoint=dropEveryNthItem, endPoint=dropEveryNthItem_2)
code_block_26 = CodeBlock { 0; }
removeItemAtIndex = List.RemoveItemAtIndex(list=dropEveryNthItem_2, indices=code_block_26)
byStartPointEndPoint_9 = Line.ByStartPointEndPoint(startPoint=dropEveryNthItem, endPoint=removeItemAtIndex)
list_create_2 = List.Create(item0=byStartPointEndPoint_8, item1=byStartPointEndPoint_9)
number_slider = DoubleSlider(150, range=0..300 step 1)
truss_columns_instances = Python(IN[0]=timberbeam_class, IN[1]=list_create_2, IN[2]=number_slider)  # CPython3
# ---------- truss_columns_instances.python (21 lines) ----------
Beam = IN[0]
lines = IN[1]
radius = IN[2]

def convert(item):
    bm = Beam(item,radius)
    return bm.geometry(), bm.volume()
    
def walk(data):
    if isinstance(data, list):
        geos, vols = [],[]
        for d in data:
            g,v = walk(d)
            geos.append(g)
            vols.append(v)
        return geos,vols
    else:
        return convert(data)
     
geos, vols = walk(lines)
OUT = (geos,vols)    
# ----------------------------------------
volume_4 = Solid.Volume(solid=truss_columns_instances)
watch_2 = Watch(volume_4)
sum_4 = Math.Sum(values=watch_2)
watch_3 = Watch(sum_4)
code_block_27 = CodeBlock { 4900; 4900; 0; }
byCoordinates_17 = Point.ByCoordinates(x=code_block_27.out0, y=code_block_27.out1, z=code_block_27.out2)
code_block_28 = CodeBlock { -4900; 4900; 0; }
byCoordinates_18 = Point.ByCoordinates(x=code_block_28.out0, y=code_block_28.out1, z=code_block_28.out2)
byStartPointEndPoint_10 = Line.ByStartPointEndPoint(startPoint=byCoordinates_17, endPoint=byCoordinates_18)
number_of_truss_sections = DoubleSlider(15, range=0..30 step 1)
code_block_29 = CodeBlock(n=number_of_truss_sections) { n; 0..1..#n; }
splitByParameter_3 = Curve.SplitByParameter(curve=byStartPointEndPoint_10, parameters=code_block_29.out1)
endPoint_3 = Curve.EndPoint(curve=splitByParameter_3)
code_block_30 = CodeBlock { 2; 1; }
dropEveryNthItem_3 = List.DropEveryNthItem(list=endPoint_3, n=code_block_30.out0, offset=code_block_30.out1)
change_angle_of_truss_columns_2 = DoubleSlider(4117, range=0..10000 step 1)
code_block_31 = CodeBlock { 10000; }
byCoordinates_19 = Point.ByCoordinates(x=change_angle_of_truss_columns_2, z=code_block_31)
code_block_32 = CodeBlock { -4000; 3500; 3500; }
byCoordinates_20 = Point.ByCoordinates(x=code_block_32.out0, y=code_block_32.out1, z=code_block_32.out2)
byStartPointEndPoint_11 = Line.ByStartPointEndPoint(startPoint=byCoordinates_19, endPoint=byCoordinates_20)
splitByParameter_4 = Curve.SplitByParameter(curve=byStartPointEndPoint_11, parameters=code_block_29.out1)
endPoint_4 = Curve.EndPoint(curve=splitByParameter_4)
addItemToFront_2 = List.AddItemToFront(item=byCoordinates_19, list=endPoint_4)
dropEveryNthItem_4 = List.DropEveryNthItem(list=addItemToFront_2, n=code_block_30.out0, offset=code_block_30.out1)
byStartPointEndPoint_12 = Line.ByStartPointEndPoint(startPoint=dropEveryNthItem_3, endPoint=dropEveryNthItem_4)
code_block_33 = CodeBlock { 0; }
removeItemAtIndex_2 = List.RemoveItemAtIndex(list=dropEveryNthItem_4, indices=code_block_33)
byStartPointEndPoint_13 = Line.ByStartPointEndPoint(startPoint=dropEveryNthItem_3, endPoint=removeItemAtIndex_2)
list_create_3 = List.Create(item0=byStartPointEndPoint_12, item1=byStartPointEndPoint_13)
number_slider_2 = DoubleSlider(188, range=0..300 step 1)
truss_column_instances = Python(IN[0]=timberbeam_class, IN[1]=list_create_3, IN[2]=number_slider_2)  # CPython3; same code as truss_columns_instances
volume_5 = Solid.Volume(solid=truss_column_instances)
watch_4 = Watch(volume_5)
sum_5 = Math.Sum(values=watch_4)
watch_5 = Watch(sum_5)
color_palette_2 = ColorPalette({R: 129, G: 63, B: 0, A: 255})
byGeometryColor_3 = Modifiers.GeometryColor.ByGeometryColor(geometry=truss_column_instances, color=color_palette_2)
color_palette_3 = ColorPalette({R: 129, G: 63, B: 0, A: 255})
byGeometryColor_4 = Modifiers.GeometryColor.ByGeometryColor(geometry=truss_columns_instances, color=color_palette_3)
color_palette_4 = ColorPalette({R: 105, G: 0, B: 163, A: 255})
byGeometryColor_5 = Modifiers.GeometryColor.ByGeometryColor(geometry=series_of_stl_rods_1, color=color_palette_4)
color_palette_5 = ColorPalette({R: 129, G: 63, B: 0, A: 255})
byGeometryColor_6 = Modifiers.GeometryColor.ByGeometryColor(geometry=top_beam, color=color_palette_5)
