# Dynamo graph 1803055.dyn (Dynamo 3.6.0.9395)

# group: Don't touch this ground
code_block = CodeBlock { -5000; -5000; -200; }
byCoordinates = Point.ByCoordinates(x=code_block.out0, y=code_block.out1, z=code_block.out2)
code_block_2 = CodeBlock { 5000; 5000; 0; }
byCoordinates_2 = Point.ByCoordinates(x=code_block_2.out0, y=code_block_2.out1, z=code_block_2.out2)
byCorners = Cuboid.ByCorners(lowPoint=byCoordinates, highPoint=byCoordinates_2)
code_block_3 = CodeBlock { 0; 100; 0; }
byARGB = Color.ByARGB(red=code_block_3.out0, green=code_block_3.out1, blue=code_block_3.out2)
byGeometryColor = Modifiers.GeometryColor.ByGeometryColor(geometry=byCorners, color=byARGB)

number_slider = DoubleSlider(5000, range=-10000..10000 step 0.1)
number_slider_2 = DoubleSlider(0, range=0..6000 step 0.1)
byCoordinates_3 = Point.ByCoordinates(x=number_slider, y=number_slider, z=number_slider_2)
number_slider_3 = DoubleSlider(-5000, range=-10000..10000 step 0.1)
byCoordinates_4 = Point.ByCoordinates(x=number_slider, y=number_slider_3, z=number_slider_2)
byStartPointEndPoint = Line.ByStartPointEndPoint(startPoint=byCoordinates_3, endPoint=byCoordinates_4)
byCoordinates_5 = Point.ByCoordinates(x=number_slider_3, y=number_slider, z=number_slider_2)
byStartPointEndPoint_2 = Line.ByStartPointEndPoint(startPoint=byCoordinates_3, endPoint=byCoordinates_5)
byCoordinates_6 = Point.ByCoordinates(x=number_slider_3, y=number_slider_3, z=number_slider_2)
byStartPointEndPoint_3 = Line.ByStartPointEndPoint(startPoint=byCoordinates_4, endPoint=byCoordinates_6)
byStartPointEndPoint_4 = Line.ByStartPointEndPoint(startPoint=byCoordinates_6, endPoint=byCoordinates_5)
number_slider_4 = DoubleSlider(4500, range=-10000..10000 step 0.1)
number_slider_5 = DoubleSlider(0, range=0..100 step 0.1)
byCoordinates_7 = Point.ByCoordinates(x=number_slider_4, y=number_slider_4, z=number_slider_5)
number_slider_6 = DoubleSlider(-4500, range=-10000..10000 step 0.1)
byCoordinates_8 = Point.ByCoordinates(x=number_slider_4, y=number_slider_6, z=number_slider_5)
byStartPointEndPoint_5 = Line.ByStartPointEndPoint(startPoint=byCoordinates_7, endPoint=byCoordinates_8)
byCoordinates_9 = Point.ByCoordinates(x=number_slider_6, y=number_slider_6, z=number_slider_5)
byStartPointEndPoint_6 = Line.ByStartPointEndPoint(startPoint=byCoordinates_8, endPoint=byCoordinates_9)
byCoordinates_10 = Point.ByCoordinates(x=number_slider_6, y=number_slider_4, z=number_slider_5)
byStartPointEndPoint_7 = Line.ByStartPointEndPoint(startPoint=byCoordinates_9, endPoint=byCoordinates_10)
code_block_4 = CodeBlock { -4500; 21; 450; }
sequence = Sequence(start=code_block_4.out0, amount=code_block_4.out1, step=code_block_4.out2)
byCoordinates_11 = Point.ByCoordinates(x=number_slider_4, y=sequence, z=number_slider_5)
watch = Watch(byCoordinates_11)
number_slider_7 = DoubleSlider(-4500, range=-10000..10000 step 0.1)
byStartPointEndPoint_8 = Line.ByStartPointEndPoint(startPoint=byCoordinates_7, endPoint=byCoordinates_10)
code_block_5 = CodeBlock { -4500; 21; 450; }
sequence_2 = Sequence(start=code_block_5.out0, amount=code_block_5.out1, step=code_block_5.out2)
number_slider_8 = DoubleSlider(4500, range=-10000..10000 step 0.1)
number_slider_9 = DoubleSlider(0, range=0..100 step 0.1)
byCoordinates_12 = Point.ByCoordinates(x=sequence_2, y=number_slider_8, z=number_slider_9)
watch_2 = Watch(byCoordinates_12)
number_slider_10 = DoubleSlider(4500, range=-10000..10000 step 0.1)
number_slider_11 = DoubleSlider(50.3, range=0..100 step 0.1)
number_slider_12 = DoubleSlider(4500, range=-10000..10000 step 0.1)
code_block_6 = CodeBlock { -4500; 21; 450; }
sequence_3 = Sequence(start=code_block_6.out0, amount=code_block_6.out1, step=code_block_6.out2)
number_slider_13 = DoubleSlider(-4500, range=-10000..10000 step 0.1)
number_slider_14 = DoubleSlider(0, range=0..100 step 0.1)
byCoordinates_13 = Point.ByCoordinates(x=sequence_3, y=number_slider_13, z=number_slider_14)
watch_3 = Watch(byCoordinates_13)
byStartPointEndPoint_9 = Line.ByStartPointEndPoint(startPoint=byCoordinates_9, endPoint=byCoordinates_10)
code_block_7 = CodeBlock { 0; 2000; 6000; }
byCoordinates_14 = Point.ByCoordinates(x=code_block_7.out0, y=code_block_7.out1, z=code_block_7.out2)
code_block_8 = CodeBlock { 9500; 5500; 200; }
roof_1 = Cuboid.ByLengths(origin=byCoordinates_14, width=code_block_8.out0, length=code_block_8.out1, height=code_block_8.out2)
code_block_9 = CodeBlock { 0; 2000; 6400; }
byCoordinates_15 = Point.ByCoordinates(x=code_block_9.out0, y=code_block_9.out1, z=code_block_9.out2)
code_block_10 = CodeBlock { 8500; 4500; 200; }
roof_3 = Cuboid.ByLengths(origin=byCoordinates_15, width=code_block_10.out0, length=code_block_10.out1, height=code_block_10.out2)
code_block_11 = CodeBlock { 0; 2000; 6200; }
byCoordinates_16 = Point.ByCoordinates(x=code_block_11.out0, y=code_block_11.out1, z=code_block_11.out2)
code_block_12 = CodeBlock { 9000; 5000; 200; }
roof_2 = Cuboid.ByLengths(origin=byCoordinates_16, width=code_block_12.out0, length=code_block_12.out1, height=code_block_12.out2)
class_concrete_surface_stairs = Python()  # CPython3; unwired: IN[0]
# ---------- class_concrete_surface_stairs.python (44 lines) ----------
import clr
clr.AddReference('ProtoGeometry')
from Autodesk.DesignScript.Geometry import *

class StraightStairs:
    def __init__(self, base_point, tread, riser, width, num_steps):
        
        self.base = base_point
        self.tread = tread
        self.riser = riser
        self.width = width
        self.num_steps = int(num_steps)

    def make_geometry(self):
        b = self.base
        t = self.tread
        r = self.riser
        w = self.width
        n = self.num_steps

        steps = []

        for i in range(n):
            
            x0 = b.X + i * t
            y0 = b.Y
            z0 = b.Z + i * r

            
            p0 = Point.ByCoordinates(x0,     y0,     z0)
            p1 = Point.ByCoordinates(x0 + t, y0,     z0)
            p2 = Point.ByCoordinates(x0 + t, y0 + w, z0)
            p3 = Point.ByCoordinates(x0,     y0 + w, z0)

            poly = Polygon.ByPoints([p0, p1, p2, p3])

            
            tread_surface = Surface.ByPatch(poly)

            steps.append(tread_surface)

        return steps
        
OUT = StraightStairs
# ----------------------------------------
code_block_13 = CodeBlock { -4500; 0; 0; }
byCoordinates_17 = Point.ByCoordinates(x=code_block_13.out0, y=code_block_13.out1, z=code_block_13.out2)
tread = DoubleSlider(300, range=0..300 step 0.1)
width = DoubleSlider(100, range=0..150 step 0.1)
riser = DoubleSlider(9000, range=0..9000 step 0.1)
number_of_riser = DoubleSlider(5, range=0..100 step 1)
instances_of_concrete_stairs = Python(IN[0]=class_concrete_surface_stairs, IN[1]=byCoordinates_17, IN[2]=tread, IN[3]=width, IN[4]=riser, IN[5]=number_of_riser)  # CPython3
# ---------- instances_of_concrete_stairs.python (10 lines) ----------
StairsClass = IN[0]  
base_point  = IN[1]
tread       = IN[2]
riser       = IN[3]
width       = IN[4]
num_steps   = IN[5]

stairs = StairsClass(base_point, tread, riser, width, num_steps)

OUT = stairs.make_geometry()
# ----------------------------------------
ZAxis = Vector.ZAxis()
number_slider_15 = DoubleSlider(270, range=0..360 step 0.1)
rotate = Geometry.Rotate(geometry=instances_of_concrete_stairs, origin=byCoordinates_17, axis=ZAxis, degrees=number_slider_15)
number_slider_16 = DoubleSlider(225, range=0..225 step 0.1)
number_slider_17 = DoubleSlider(0, range=0..225 step 0.1)
number_slider_18 = DoubleSlider(225, range=0..225 step 0.1)
number_slider_19 = DoubleSlider(0, range=0..225 step 0.1)
byARGB_2 = Color.ByARGB(alpha=number_slider_16, red=number_slider_17, green=number_slider_18, blue=number_slider_19)
byGeometryColor_2 = Modifiers.GeometryColor.ByGeometryColor(geometry=rotate, color=byARGB_2)
code_block_14 = CodeBlock { 0; -2400; 40; }
byCoordinates_18 = Point.ByCoordinates(x=code_block_14.out0, y=code_block_14.out1, z=code_block_14.out2)
code_block_15 = CodeBlock { 9000; 4200; 100; }
byLengths = Cuboid.ByLengths(origin=byCoordinates_18, width=code_block_15.out0, length=code_block_15.out1, height=code_block_15.out2)
number_slider_20 = DoubleSlider(225, range=0..225 step 0.1)
number_slider_21 = DoubleSlider(225, range=0..225 step 0.1)
number_slider_22 = DoubleSlider(225, range=0..225 step 0.1)
number_slider_23 = DoubleSlider(0, range=0..225 step 0.1)
byARGB_3 = Color.ByARGB(alpha=number_slider_20, red=number_slider_21, green=number_slider_22, blue=number_slider_23)
byGeometryColor_3 = Modifiers.GeometryColor.ByGeometryColor(geometry=byLengths, color=byARGB_3)
code_block_16 = CodeBlock { 0; -2550; 140; }
byCoordinates_19 = Point.ByCoordinates(x=code_block_16.out0, y=code_block_16.out1, z=code_block_16.out2)
code_block_17 = CodeBlock { 9000; 3850; 100; }
byLengths_2 = Cuboid.ByLengths(origin=byCoordinates_19, width=code_block_17.out0, length=code_block_17.out1, height=code_block_17.out2)
number_slider_24 = DoubleSlider(225, range=0..225 step 0.1)
number_slider_25 = DoubleSlider(0, range=0..225 step 0.1)
number_slider_26 = DoubleSlider(225, range=0..225 step 0.1)
number_slider_27 = DoubleSlider(0, range=0..225 step 0.1)
byARGB_4 = Color.ByARGB(alpha=number_slider_24, red=number_slider_25, green=number_slider_26, blue=number_slider_27)
byGeometryColor_4 = Modifiers.GeometryColor.ByGeometryColor(geometry=byLengths_2, color=byARGB_4)
code_block_18 = CodeBlock { 0; -2700; 240; }
byCoordinates_20 = Point.ByCoordinates(x=code_block_18.out0, y=code_block_18.out1, z=code_block_18.out2)
code_block_19 = CodeBlock { 9000; 3550; 100; }
byLengths_3 = Cuboid.ByLengths(origin=byCoordinates_20, width=code_block_19.out0, length=code_block_19.out1, height=code_block_19.out2)
number_slider_28 = DoubleSlider(225, range=0..225 step 0.1)
number_slider_29 = DoubleSlider(225, range=0..225 step 0.1)
number_slider_30 = DoubleSlider(225, range=0..225 step 0.1)
number_slider_31 = DoubleSlider(0, range=0..225 step 0.1)
byARGB_5 = Color.ByARGB(alpha=number_slider_28, red=number_slider_29, green=number_slider_30, blue=number_slider_31)
byGeometryColor_5 = Modifiers.GeometryColor.ByGeometryColor(geometry=byLengths_3, color=byARGB_5)
code_block_20 = CodeBlock { 0; -2850; 340; }
byCoordinates_21 = Point.ByCoordinates(x=code_block_20.out0, y=code_block_20.out1, z=code_block_20.out2)
code_block_21 = CodeBlock { 9000; 3250; 100; }
byLengths_4 = Cuboid.ByLengths(origin=byCoordinates_21, width=code_block_21.out0, length=code_block_21.out1, height=code_block_21.out2)
number_slider_32 = DoubleSlider(225, range=0..225 step 0.1)
number_slider_33 = DoubleSlider(0, range=0..225 step 0.1)
number_slider_34 = DoubleSlider(225, range=0..225 step 0.1)
number_slider_35 = DoubleSlider(0, range=0..225 step 0.1)
byARGB_6 = Color.ByARGB(alpha=number_slider_32, red=number_slider_33, green=number_slider_34, blue=number_slider_35)
byGeometryColor_6 = Modifiers.GeometryColor.ByGeometryColor(geometry=byLengths_4, color=byARGB_6)
code_block_22 = CodeBlock(tread=tread, width=width, riser=riser, number_ofsteps=number_of_riser) { tread * width * riser * number_ofsteps; }
volume_of_stairs_in_mm_3 = Watch(code_block_22)
ZAxis_2 = Vector.ZAxis()
number_slider_36 = DoubleSlider(3000, range=0..10000 step 0.1)
translate = Geometry.Translate(geometry=byCoordinates_12, direction=ZAxis_2, distance=number_slider_36)
code_block_23 = CodeBlock { -4500; 21; 450; }
sequence_4 = Sequence(start=code_block_23.out0, amount=code_block_23.out1, step=code_block_23.out2)
number_slider_37 = DoubleSlider(9000, range=0..10000 step 0.1)
byCoordinates_22 = Point.ByCoordinates(x=sequence_4, y=number_slider_8, z=number_slider_37)
width_of_wall = DoubleSlider(300, range=0..300 step 10)
count = List.Count(list=byCoordinates_12)
ofRepeatedItem = List.OfRepeatedItem(item=width_of_wall, amount=count)
depth_of_wall = DoubleSlider(300, range=0..1000 step 10)
count_2 = List.Count(list=byCoordinates_22)
ofRepeatedItem_2 = List.OfRepeatedItem(item=depth_of_wall, amount=count_2)
class_rectangular_rod = Python()  # CPython3; unwired: IN[0]
# ---------- class_rectangular_rod.python (17 lines) ----------
import sys
import clr
clr.AddReference('ProtoGeometry')
from Autodesk.DesignScript.Geometry import *

class RectangularRod:
    def __init__(self, bottom_point, top_point, width, depth):
        self.bottom = bottom_point
        self.top = top_point
        self.width = width
        self.depth = depth
        
    def make_geometry(self):
        height = self.bottom.DistanceTo(self.top)
        return Cuboid.ByLengths(self.bottom, self.width, self.depth, height)
    
OUT = RectangularRod
# ----------------------------------------
series_of_instances_of = Python(IN[0]=translate, IN[1]=byCoordinates_22, IN[2]=ofRepeatedItem, IN[3]=ofRepeatedItem_2, IN[4]=class_rectangular_rod)  # "Series of Instances of rectangular rods"; CPython3
# ---------- series_of_instances_of.python (21 lines) ----------
RectangularRod = IN[4]
bottom_points  = IN[0]
top_points     = IN[1]
widths         = IN[2]
depths         = IN[3]

rods = []
count = min(len(bottom_points), len(top_points))

for i in range(count):
    
    w = widths[i] if i < len(widths) else widths[-1]
    d = depths[i] if i < len(depths) else depths[-1]
    
    btm = bottom_points[i]
    top = top_points[i]
    
    rod = RectangularRod(btm, top, w, d)
    rods.append(rod.make_geometry())

OUT = rods
# ----------------------------------------
list_create = List.Create(item0=series_of_instances_of)
volume = Solid.Volume(solid=list_create)
code_block_24 = CodeBlock(vols=volume) { Sum(vols); }
volume_of_wall_1 = Watch(code_block_24)
ZAxis_3 = Vector.ZAxis()
number_slider_38 = DoubleSlider(3000, range=0..10000 step 0.1)
translate_2 = Geometry.Translate(geometry=byCoordinates_11, direction=ZAxis_3, distance=number_slider_38)
code_block_25 = CodeBlock { -4500; 10; 450; }
sequence_5 = Sequence(start=code_block_25.out0, amount=code_block_25.out1, step=code_block_25.out2)
number_slider_39 = DoubleSlider(9000, range=0..1000000 step 0.1)
byCoordinates_23 = Point.ByCoordinates(x=number_slider_4, y=sequence_5, z=number_slider_39)
width_of_wall_2 = DoubleSlider(300, range=0..300 step 10)
count_3 = List.Count(list=byCoordinates_11)
ofRepeatedItem_3 = List.OfRepeatedItem(item=width_of_wall_2, amount=count_3)
depth_of_wall_2 = DoubleSlider(300, range=0..1000 step 10)
count_4 = List.Count(list=byCoordinates_23)
ofRepeatedItem_4 = List.OfRepeatedItem(item=depth_of_wall_2, amount=count_4)
class_rectangular_rod_2 = Python()  # CPython3; unwired: IN[0]; same code as class_rectangular_rod
series_of_instances_of_2 = Python(IN[0]=translate_2, IN[1]=byCoordinates_23, IN[2]=ofRepeatedItem_3, IN[3]=ofRepeatedItem_4, IN[4]=class_rectangular_rod_2)  # "Series of Instances of rectangular rods"; CPython3; same code as series_of_instances_of
list_create_2 = List.Create(item0=series_of_instances_of_2)
volume_2 = Solid.Volume(solid=list_create_2)
code_block_26 = CodeBlock(vols=volume_2) { Sum(vols); }
volume_of_wall_2 = Watch(code_block_26)
ZAxis_4 = Vector.ZAxis()
number_slider_40 = DoubleSlider(3000, range=0..10000 step 0.1)
elevation_of_rectangular_rods = Geometry.Translate(geometry=byCoordinates_13, direction=ZAxis_4, distance=number_slider_40)
code_block_27 = CodeBlock { -4500; 21; 450; }
sequence_6 = Sequence(start=code_block_27.out0, amount=code_block_27.out1, step=code_block_27.out2)
number_slider_41 = DoubleSlider(9000, range=0..10000 step 0.1)
byCoordinates_24 = Point.ByCoordinates(x=sequence_6, y=number_slider_13, z=number_slider_41)
width_of_wall_3 = DoubleSlider(300, range=0..500 step 10)
count_5 = List.Count(list=byCoordinates_13)
ofRepeatedItem_5 = List.OfRepeatedItem(item=width_of_wall_3, amount=count_5)
depth_of_wall_3 = DoubleSlider(300, range=0..1000 step 10)
count_6 = List.Count(list=byCoordinates_24)
ofRepeatedItem_6 = List.OfRepeatedItem(item=depth_of_wall_3, amount=count_6)
class_rectangular_rod_3 = Python()  # CPython3; unwired: IN[0]; same code as class_rectangular_rod
series_of_instances_of_3 = Python(IN[0]=elevation_of_rectangular_rods, IN[1]=byCoordinates_24, IN[2]=ofRepeatedItem_5, IN[3]=ofRepeatedItem_6, IN[4]=class_rectangular_rod_3)  # "Series of Instances of rectangular rods"; CPython3; same code as series_of_instances_of
list_create_3 = List.Create(item0=series_of_instances_of_3)
volume_3 = Solid.Volume(solid=list_create_3)
code_block_28 = CodeBlock(vols=volume_3) { Sum(vols); }
volume_of_wall_3 = Watch(code_block_28)
number_slider_42 = DoubleSlider(-4500, range=-10000..10000 step 0.1)
code_block_29 = CodeBlock { -4500; 21; 450; }
sequence_7 = Sequence(start=code_block_29.out0, amount=code_block_29.out1, step=code_block_29.out2)
byCoordinates_25 = Point.ByCoordinates(x=number_slider_42, y=sequence_7, z=number_slider_5)
ZAxis_5 = Vector.ZAxis()
number_slider_43 = DoubleSlider(3000, range=0..10000 step 0.1)
translate_3 = Geometry.Translate(geometry=byCoordinates_25, direction=ZAxis_5, distance=number_slider_43)
code_block_30 = CodeBlock { -4500; 10; 450; }
sequence_8 = Sequence(start=code_block_30.out0, amount=code_block_30.out1, step=code_block_30.out2)
number_slider_44 = DoubleSlider(9000, range=0..10000 step 0.1)
byCoordinates_26 = Point.ByCoordinates(x=number_slider_42, y=sequence_8, z=number_slider_44)
width_of_wall_4 = DoubleSlider(300, range=0..300 step 10)
count_7 = List.Count(list=byCoordinates_25)
ofRepeatedItem_7 = List.OfRepeatedItem(item=width_of_wall_4, amount=count_7)
depth_of_wall_4 = DoubleSlider(300, range=0..1000 step 10)
count_8 = List.Count(list=byCoordinates_26)
ofRepeatedItem_8 = List.OfRepeatedItem(item=depth_of_wall_4, amount=count_8)
class_rectangular_rod_4 = Python()  # CPython3; unwired: IN[0]; same code as class_rectangular_rod
series_of_instances_of_4 = Python(IN[0]=translate_3, IN[1]=byCoordinates_26, IN[2]=ofRepeatedItem_7, IN[3]=ofRepeatedItem_8, IN[4]=class_rectangular_rod_4)  # "Series of Instances of rectangular rods"; CPython3; same code as series_of_instances_of
list_create_4 = List.Create(item0=series_of_instances_of_4)
volume_4 = Solid.Volume(solid=list_create_4)
code_block_31 = CodeBlock(vols=volume_4) { Sum(vols); }
volume_of_wall_4 = Watch(code_block_31)
code_block_32 = CodeBlock(Vol_wall_1=volume_of_wall_1, Vol_wall_2=volume_of_wall_2, Vol_wall_3=volume_of_wall_3, Vol_wall_4=volume_of_wall_4) { Vol_wall_1 + Vol_wall_2 + Vol_wall_3 + Vol_wall_4; }
volume_of_all_four_walla = Watch(code_block_32)
