# Dynamo graph 1803570.dyn (Dynamo 4.0.0.3277)

code_block = CodeBlock { -5000; -5000; -200; }
byCoordinates = Point.ByCoordinates(x=code_block.out0, y=code_block.out1, z=code_block.out2)
code_block_2 = CodeBlock { 5000; 5000; 0; }
byCoordinates_2 = Point.ByCoordinates(x=code_block_2.out0, y=code_block_2.out1, z=code_block_2.out2)
byCorners = Cuboid.ByCorners(lowPoint=byCoordinates, highPoint=byCoordinates_2)
code_block_3 = CodeBlock { 0; 100; 0; }
byARGB = Color.ByARGB(red=code_block_3.out0, blue=code_block_3.out2)
byGeometryColor = Modifiers.GeometryColor.ByGeometryColor(geometry=byCorners, color=byARGB)
metalpipe_class = Python()  # PythonNet3; unwired: IN[0]
# ---------- metalpipe_class.python (26 lines) ----------
import sys
import clr
clr.AddReference('ProtoGeometry')
from Autodesk.DesignScript.Geometry import *
import math

class MetalPipe:
    def __init__(self, center, rad):
        self.centerline = center
        self.radius = rad

    def endpoints(self):
        return self.centerline.StartPoint, self.centerline.EndPoint

    def make_geometry(self):
        end1, end2 = self.endpoints()
        return Cylinder.ByPointsRadius(end1, end2, self.radius)

    def measure_volume(self):
        end1, end2 = self.endpoints()
        length = end1.DistanceTo(end2)
        return length * self.radius * self.radius * math.pi

    
# Output the cylinder geometry
OUT = MetalPipe
# ----------------------------------------
code_block_4 = CodeBlock { 4000; -4000; 0; }
byCoordinates_3 = Point.ByCoordinates(x=code_block_4.out0, y=code_block_4.out1, z=code_block_4.out2)
ZAxis = Vector.ZAxis()
height_of_small_wall = DoubleSlider(3000, range=2500..5000 step 0.1)
translate = Geometry.Translate(geometry=byCoordinates_3, direction=ZAxis, distance=height_of_small_wall)
code_block_5 = CodeBlock { -4000; -4000; 0; }
byCoordinates_4 = Point.ByCoordinates(x=code_block_5.out0, y=code_block_5.out1, z=code_block_5.out2)
translate_2 = Geometry.Translate(geometry=byCoordinates_4, direction=ZAxis, distance=height_of_small_wall)
byStartPointEndPoint = Line.ByStartPointEndPoint(startPoint=translate, endPoint=translate_2)
vertical_pipe_size = DoubleSlider(300, range=300..400 step 0)
top_pipe = Python(IN[0]=metalpipe_class, IN[1]=byStartPointEndPoint, IN[2]=vertical_pipe_size)  # PythonNet3
# ---------- top_pipe.python (4 lines) ----------
MetalPipe = IN[0] 
MetalTop = MetalPipe(IN[1], IN[2]) 

OUT = [MetalTop.make_geometry(), MetalTop.measure_volume()]
# ----------------------------------------
metalpipe_class_2 = Python()  # PythonNet3; unwired: IN[0]
# ---------- metalpipe_class_2.python (26 lines) ----------
import sys
import clr
clr.AddReference('ProtoGeometry')
from Autodesk.DesignScript.Geometry import *
import math

class MetalPipe:
    def __init__(self, center, rad):
        self.centerline = center
        self.radius = rad

    def endpoints(self):
        return self.centerline.StartPoint, self.centerline.EndPoint

    def make_geometry(self):
        end1, end2 = self.endpoints()
        return Cylinder.ByPointsRadius(end1, end2, self.radius)

    def measure_volume(self):
        end1, end2 = self.endpoints()
        length = end1.DistanceTo(end2)
        return length * self.radius * self.radius * math.pi


# Output the cylinder geometry
OUT = MetalPipe
# ----------------------------------------
code_block_6 = CodeBlock { 4000; 4000; 0; }
byCoordinates_5 = Point.ByCoordinates(x=code_block_6.out0, y=code_block_6.out1, z=code_block_6.out2)
code_block_7 = CodeBlock { -4000; 4000; 0; }
byCoordinates_6 = Point.ByCoordinates(x=code_block_7.out0, y=code_block_7.out1, z=code_block_7.out2)
byStartPointEndPoint_2 = Line.ByStartPointEndPoint(startPoint=byCoordinates_5, endPoint=byCoordinates_6)
bottom_pipe = Python(IN[0]=metalpipe_class_2, IN[1]=byStartPointEndPoint_2, IN[2]=vertical_pipe_size)  # PythonNet3
# ---------- bottom_pipe.python (6 lines) ----------
MetalPipe = IN[0]
bottompipe = MetalPipe(IN[1], IN[2])

solid = bottompipe.make_geometry()
vol = bottompipe.measure_volume()
OUT = [solid,vol ]
# ----------------------------------------
wood_class = Python()  # PythonNet3; unwired: IN[0], IN[1], IN[2]
# ---------- wood_class.python (37 lines) ----------
import sys
import clr
clr.AddReference('ProtoGeometry')
from Autodesk.DesignScript.Geometry import *

import math

class Wood:
    def __init__(self, center, width, height, rotation):
        self.center = center
        self.width = width
        self.height = height
        self.rotation = math.radians(rotation)

    def make_geometry(self):
        pt1 = self.center.StartPoint
        pt2 = self.center.EndPoint

        axis = Vector.ByTwoPoints(pt1, pt2)

        rect = Rectangle.ByWidthLength(self.width, self.height)

        rect = rect.Translate(Vector.ByCoordinates(pt1.X, pt1.Y, pt1.Z))

        rect = rect.Rotate(pt1, axis, math.degrees(self.rotation))

        solid = rect.Extrude(axis)

        return solid

    def measure_volume(self):
        pt1 = self.center.StartPoint
        pt2 = self.center.EndPoint
        length = pt1.DistanceTo(pt2)
        return self.width * self.height * length

OUT = Wood
# ----------------------------------------
points_along_line = DoubleSlider(20, range=1..30 step 1)
code_block_8 = CodeBlock(n=points_along_line) { n; 0..1..#n; }
splitByParameter = Curve.SplitByParameter(curve=byStartPointEndPoint, parameters=code_block_8.out1)
endPoint = Curve.EndPoint(curve=splitByParameter)
ZAxis_2 = Vector.ZAxis()
height_of_large_wall = DoubleSlider(5000, range=0..5000 step 0.1)
translate_3 = Geometry.Translate(geometry=byCoordinates_5, direction=ZAxis_2, distance=height_of_large_wall)
translate_4 = Geometry.Translate(geometry=byCoordinates_6, direction=ZAxis_2, distance=height_of_large_wall)
byStartPointEndPoint_3 = Line.ByStartPointEndPoint(startPoint=translate_3, endPoint=translate_4)
points_along_line_2 = DoubleSlider(20, range=1..30 step 1)
code_block_9 = CodeBlock(n=points_along_line_2) { n; 0..1..#n; }
splitByParameter_2 = Curve.SplitByParameter(curve=byStartPointEndPoint_3, parameters=code_block_9.out1)
endPoint_2 = Curve.EndPoint(curve=splitByParameter_2)
vertical_lines = Line.ByStartPointEndPoint(startPoint=endPoint, endPoint=endPoint_2)
width_of_wood = DoubleSlider(400, range=0..500 step 0.1)
height_of_wood = DoubleSlider(400, range=0..700 step 0.1)
rotation_of_wood = DoubleSlider(160, range=-45..360 step 0.1)
series_of_wood_instance = Python(IN[0]=wood_class, IN[1]=vertical_lines, IN[2]=width_of_wood, IN[3]=height_of_wood, IN[4]=rotation_of_wood)  # PythonNet3
# ---------- series_of_wood_instance.python (26 lines) ----------
WoodClass = IN[0]     
centers   = IN[1]     
width     = IN[2]     
height    = IN[3]     
rotation  = IN[4]     

# Ensure centers is list
if not isinstance(centers, list):
    centers = [centers]

solids  = []
vol = []

for i in centers:
    if i is None:
        solids.append(None)
        vol.append(None)
        continue

    wood = WoodClass(i, width, height, rotation)

    solids.append(wood.make_geometry())
    vol.append(wood.measure_volume())
    Tot_vol=sum(vol)

OUT = [solids, Tot_vol]
# ----------------------------------------
code_block_10 = CodeBlock { 1; }
getItemAtIndex = List.GetItemAtIndex(list=series_of_wood_instance, index=code_block_10)
volume_of_wood = Watch(getItemAtIndex)
byStartPointEndPoint_4 = Line.ByStartPointEndPoint(startPoint=byCoordinates_3, endPoint=byCoordinates_4)
bottom_pipe_2 = Python(IN[0]=metalpipe_class, IN[1]=byStartPointEndPoint_4, IN[2]=vertical_pipe_size)  # PythonNet3
# ---------- bottom_pipe_2.python (6 lines) ----------
MetalPipe = IN[0]
bottompipe = MetalPipe(IN[1], IN[2])

solid = bottompipe.make_geometry()
vol = bottompipe.measure_volume()
OUT = [solid, vol]
# ----------------------------------------
getItemAtIndex_2 = List.GetItemAtIndex(list=bottom_pipe_2, index=code_block_10)
volume_of_pipe1 = Watch(getItemAtIndex_2)
splitByParameter_3 = Curve.SplitByParameter(curve=byStartPointEndPoint_4, parameters=code_block_8.out1)
endPoint_3 = Curve.EndPoint(curve=splitByParameter_3)
addItemToFront = List.AddItemToFront(item=translate, list=endPoint)
vertical_lines_2 = Line.ByStartPointEndPoint(startPoint=endPoint_3, endPoint=addItemToFront)
diagonal_pipe_size = DoubleSlider(150, range=150..300 step 0.1)
series_of_diagonal_pipes = Python(IN[0]=metalpipe_class, IN[1]=vertical_lines_2, IN[2]=diagonal_pipe_size)  # PythonNet3
# ---------- series_of_diagonal_pipes.python (13 lines) ----------
MetalPipeClass = IN[0]   # class
center = IN[1]      # list of lines
rad = IN[2]              # pipe radius

solid = []
vol = []

for line in center:
    pipe = MetalPipeClass(line, rad)
    solid.append(pipe.make_geometry())
    vol.append(pipe.measure_volume())
    Tot_vol = sum(vol)
OUT = [solid, Tot_vol]
# ----------------------------------------
getItemAtIndex_3 = List.GetItemAtIndex(list=series_of_diagonal_pipes, index=code_block_10)
volume_of_pipes2 = Watch(getItemAtIndex_3)
top_pipe_2 = Python(IN[0]=metalpipe_class_2, IN[1]=byStartPointEndPoint_3, IN[2]=vertical_pipe_size)  # PythonNet3
# ---------- top_pipe_2.python (7 lines) ----------
MetalPipe = IN[0] 
MetalTop = MetalPipe(IN[1], IN[2]) 

solid = MetalTop.make_geometry()
vol = MetalTop.measure_volume()

OUT = [solid,vol ]
# ----------------------------------------
getItemAtIndex_4 = List.GetItemAtIndex(list=top_pipe_2, index=code_block_10)
volume_of_pipe3 = Watch(getItemAtIndex_4)
splitByParameter_4 = Curve.SplitByParameter(curve=byStartPointEndPoint_2, parameters=code_block_9.out1)
endPoint_4 = Curve.EndPoint(curve=splitByParameter_4)
addItemToFront_2 = List.AddItemToFront(item=translate_3, list=endPoint_2)
vertical_lines_3 = Line.ByStartPointEndPoint(startPoint=endPoint_4, endPoint=addItemToFront_2)
series_of_diagonal_pipes_2 = Python(IN[0]=metalpipe_class, IN[1]=vertical_lines_3, IN[2]=diagonal_pipe_size)  # PythonNet3; same code as series_of_diagonal_pipes
getItemAtIndex_5 = List.GetItemAtIndex(list=series_of_diagonal_pipes_2, index=code_block_10)
volume_of_pipes4 = Watch(getItemAtIndex_5)
code_block_11 = CodeBlock(a=volume_of_pipe1, b=volume_of_pipes2, c=volume_of_pipe3, d=volume_of_pipes4) { a+b+c+d; }
volume_of_pipes = Watch(code_block_11)
