# Dynamo graph 1803762.dyn (Dynamo 3.6.0.9395)

# group: Don't touch this ground
code_block = CodeBlock { -5000; -5000; -200; }  # frozen
byCoordinates = Point.ByCoordinates(x=code_block.out0, y=code_block.out1, z=code_block.out2)  # frozen
code_block_2 = CodeBlock { 5000; 5000; 0; }  # frozen
byCoordinates_2 = Point.ByCoordinates(x=code_block_2.out0, y=code_block_2.out1, z=code_block_2.out2)  # frozen
byCorners = Cuboid.ByCorners(lowPoint=byCoordinates, highPoint=byCoordinates_2)  # frozen
code_block_3 = CodeBlock { 0; 100; 0; }  # frozen
byARGB = Color.ByARGB(red=code_block_3.out0, green=code_block_3.out1, blue=code_block_3.out2)  # frozen
byGeometryColor = Modifiers.GeometryColor.ByGeometryColor(geometry=byCorners, color=byARGB)  # frozen

number = DoubleInput(0)
byCoordinates_3 = Point.ByCoordinates(x=number, y=number, z=number)
number_2 = DoubleInput(-1250)
number_3 = DoubleInput(2165)
byCoordinates_4 = Point.ByCoordinates(x=number_2, y=number_3, z=number)
number_4 = DoubleInput(3000)
byCoordinates_5 = Point.ByCoordinates(x=number_2, y=number_3, z=number_4)
byCenterPointStartPointEndPoint = Arc.ByCenterPointStartPointEndPoint(centerPoint=byCoordinates_3, startPoint=byCoordinates_4, endPoint=byCoordinates_5)
reverse = Curve.Reverse(curve=byCenterPointStartPointEndPoint)
number_5 = DoubleInput(-2165)
byCoordinates_6 = Point.ByCoordinates(x=number_2, y=number_5, z=number)
byCoordinates_7 = Point.ByCoordinates(x=number_2, y=number_5, z=number_4)
byCenterPointStartPointEndPoint_2 = Arc.ByCenterPointStartPointEndPoint(centerPoint=byCoordinates_3, startPoint=byCoordinates_6, endPoint=byCoordinates_7)
number_6 = DoubleInput(2500)
byCoordinates_8 = Point.ByCoordinates(x=number_6, y=number, z=number)
byCoordinates_9 = Point.ByCoordinates(x=number_6, y=number, z=number_4)
byCenterPointStartPointEndPoint_3 = Arc.ByCenterPointStartPointEndPoint(centerPoint=byCoordinates_3, startPoint=byCoordinates_8, endPoint=byCoordinates_9)
reverse_2 = Curve.Reverse(curve=byCenterPointStartPointEndPoint_3)
list_create = List.Create(item0=reverse, item1=byCenterPointStartPointEndPoint_2, item2=reverse_2)
byLoft = Surface.ByLoft(crossSections=list_create)
number_7 = DoubleInput(0)
number_8 = DoubleInput(3000)
byCoordinates_10 = Point.ByCoordinates(x=number_7, y=number_7, z=number_8)
number_9 = DoubleInput(2500)
byCenterPointRadius = Circle.ByCenterPointRadius(centerPoint=byCoordinates_10, radius=number_9)
byPatch = Surface.ByPatch(closedCurve=byCenterPointRadius)
reverse_3 = Curve.Reverse(curve=byCenterPointStartPointEndPoint_2)
code_block_4 = CodeBlock()
# ---------- code_block_4.designscript (46 lines) ----------
h = 3000;
        // roof height;
r = 2500;
        // radius of arcs;
pts = 20;
        // number of samples;
zshift = h;

// ARC START POINTS — using Math.Cos and Math.Sin
start1 = Point.ByCoordinates(r, 0, zshift);
start2 = Point.ByCoordinates(r*Math.Cos(120*Math.PI/180), r*Math.Sin(120*Math.PI/180), zshift);
start3 = Point.ByCoordinates(r*Math.Cos(240*Math.PI/180), r*Math.Sin(240*Math.PI/180), zshift);

// ROOF PEAK POINT
endPoint = Point.ByCoordinates(0,0,zshift + 800);

// TANGENT VECTORS
tan1 = Vector.ByCoordinates(-1,0,0);
tan2 = Vector.ByCoordinates(0.5,-0.86,0);
tan3 = Vector.ByCoordinates(0.5,0.86,0);

// ARC GEOMETRY
arc1 = Arc.ByStartPointEndPointStartTangent(start1, endPoint, tan1);
arc2 = Arc.ByStartPointEndPointStartTangent(start2, endPoint, tan2);
arc3 = Arc.ByStartPointEndPointStartTangent(start3, endPoint, tan3);

// SAMPLE PARAMETERS (range syntax)
t = 0..1..#pts;

// SAMPLE POINTS
p1 = arc1.PointAtParameter(t);
p2 = arc2.PointAtParameter(t);
p3 = arc3.PointAtParameter(t);

// NURBS CURVES
n1 = NurbsCurve.ByPoints(p1);
n2 = NurbsCurve.ByPoints(p2);
n3 = NurbsCurve.ByPoints(p3);

// CURVE LIST — USE SQUARE BRACKETS
curveList = [n1, n2, n3];

// LOFT ROOF
roof = Surface.ByLoft(curveList);

roof;
# ----------------------------------------
