# Dynamo graph 1803984.dyn (Dynamo 3.6.0.9395)

# group: Don't touch this ground
code_block = CodeBlock { -5000; -5000; -200; }
byCoordinates = Point.ByCoordinates(x=code_block.out0, y=code_block.out1, z=code_block.out2)
code_block_2 = CodeBlock { 5000; 5000; 0; }
byCoordinates_2 = Point.ByCoordinates(x=code_block_2.out0, y=code_block_2.out1, z=code_block_2.out2)
byCorners = Cuboid.ByCorners(lowPoint=byCoordinates, highPoint=byCoordinates_2)
code_block_3 = CodeBlock { 0; 100; 0; }
byARGB = Color.ByARGB(red=code_block_3.out0, green=code_block_3.out1, blue=code_block_3.out2)
byGeometryColor = Modifiers.GeometryColor.ByGeometryColor(geometry=byCorners, color=byARGB)

origin = Point.ByCoordinates()
radius_of_ring_s = IntegerSlider(3000, range=0..4500 step 500)
lowest_ring = Circle.ByCenterPointRadius(centerPoint=origin, radius=radius_of_ring_s)
of_support_columns = IntegerSlider(8, range=4..12 step 1)
segmenting_lowest_ring = Curve.PointsAtEqualSegmentLength(curve=lowest_ring, divisions=of_support_columns)
lowest_ring_points = List.Create(item0=segmenting_lowest_ring)
above_origin = CodeBlock { 0; 0; }
height = IntegerSlider(4000, range=0..10000 step 1000)
highest_point = Point.ByCoordinates(x=above_origin.out0, y=above_origin.out1, z=height)
center_reference_line = Line.ByStartPointEndPoint(startPoint=origin, endPoint=highest_point)
mid_ring_reference = DoubleSlider(0.5, range=0..1 step 0.1)
mid_ring_height_reference = Curve.PointAtParameter(curve=center_reference_line, param=mid_ring_reference)
mid_ring = Circle.ByCenterPointRadius(centerPoint=mid_ring_height_reference, radius=radius_of_ring_s)
segmenting_mid_ring = Curve.PointsAtEqualSegmentLength(curve=mid_ring, divisions=of_support_columns)
mid_ring_points = List.Create(item0=segmenting_mid_ring)
radius_of_circularrod = IntegerSlider(70, range=0..250 step 10)
placing_cylinderrods = Python(IN[0]=lowest_ring_points, IN[1]=mid_ring_points, IN[2]=radius_of_circularrod)  # CPython3
# ---------- placing_cylinderrods.python (47 lines) ----------
import clr
clr.AddReference("ProtoGeometry")
from Autodesk.DesignScript.Geometry import *
#A is Start, B is End
pointsA = IN[0]
pointsB = IN[1]
radius = IN[2]

def flatten(obj):
    flat = []
    if isinstance(obj, list):
        for item in obj:
            flat.extend(flatten(item))
    else:
        flat.append(obj)
    return flat

def to_point(obj):
    if isinstance(obj, Point):
        return obj
    if isinstance(obj, list) and len(obj) == 3:
        return Point.ByCoordinates(obj[0], obj[1], obj[2])
    return None

class SteelRod:
    def __init__(self, p_start, p_end, radius):
        self.p_start = p_start
        self.p_end = p_end
        self.radius = radius
    def make_geometry(self):
        return Cylinder.ByPointsRadius(self.p_start, self.p_end, self.radius)

listA = [to_point(x) for x in flatten(pointsA)]
listA = [p for p in listA if p is not None]

listB = [to_point(x) for x in flatten(pointsB)]
listB = [p for p in listB if p is not None]

cylinders = []
for pA, pB in zip(listA, listB):
    if pA and pB and pA.DistanceTo(pB) >= 1e-6:
        try:
            cylinders.append(SteelRod(pA, pB, radius).make_geometry())
        except:
            pass

OUT = cylinders
# ----------------------------------------
upper_ring_reference = DoubleSlider(0.9, range=0..1 step 0.1)
upper_ring_height_reference = Curve.PointAtParameter(curve=center_reference_line, param=upper_ring_reference)
upper_ring_radius_calc = CodeBlock(radius=radius_of_ring_s) { radius; UpperRingRadius; UpperRingRadius = radius / 2; }
upper_ring = Circle.ByCenterPointRadius(centerPoint=upper_ring_height_reference, radius=upper_ring_radius_calc.out2)
segmenting_upper_ring = Curve.PointsAtEqualSegmentLength(curve=upper_ring, divisions=of_support_columns)
upper_ring_points = List.Create(item0=segmenting_upper_ring)
mid_upper_cylinders = Cylinder.ByPointsRadius(startPoint=mid_ring_points, endPoint=upper_ring_points, radius=radius_of_circularrod)
upper_top_cylinders = Cylinder.ByPointsRadius(startPoint=upper_ring_points, endPoint=highest_point, radius=radius_of_circularrod)
upper_ring_spheres = Sphere.ByCenterPointRadius(centerPoint=upper_ring_points, radius=radius_of_circularrod)
mid_top_cylinders = Cylinder.ByPointsRadius(startPoint=mid_ring_points, endPoint=highest_point, radius=radius_of_circularrod)
top_sphere = Sphere.ByCenterPointRadius(centerPoint=highest_point, radius=radius_of_circularrod)
all_parts = List.Join(list0=placing_cylinderrods, list1=mid_upper_cylinders, list2=upper_top_cylinders, list3=upper_ring_spheres, list4=mid_top_cylinders, list5=top_sphere)
volume_calc = Solid.Volume(solid=all_parts)
volume = Watch(volume_calc)
list_create = List.Create(item0=lowest_ring_points)
mid_ring_spheres = Sphere.ByCenterPointRadius(centerPoint=mid_ring_points, radius=radius_of_circularrod)
upper_ring_spheres_2 = Sphere.ByCenterPointRadius(centerPoint=upper_ring_points, radius=radius_of_circularrod)
union = Solid.Union(solid=upper_ring_spheres_2, solid_2=upper_top_cylinders)
placing_steeljoints = Python(IN[0]=mid_ring_points, IN[1]=radius_of_circularrod)  # CPython3
# ---------- placing_steeljoints.python (37 lines) ----------
import clr
clr.AddReference('ProtoGeometry')
from Autodesk.DesignScript.Geometry import *

points = IN[0]
radius = IN[1]

class SteelJoint:
    def __init__(self, center, radius):
        self.center = center
        self.radius = radius
    def make_geometry(self):
        return Sphere.ByCenterPointRadius(self.center, self.radius)

def flatten(obj):
    flat = []
    if isinstance(obj, list):
        for item in obj:
            flat.extend(flatten(item))
    else:
        flat.append(obj)
    return flat


def to_point(obj):
    if isinstance(obj, Point):
        return obj
    if isinstance(obj, list) and len(obj) == 3:
        return Point.ByCoordinates(obj[0], obj[1], obj[2])
    return None

flat_points = flatten(points)
converted = [to_point(p) for p in flat_points if to_point(p) is not None]

joints = [SteelJoint(point, radius).make_geometry() for point in converted]

OUT = joints
# ----------------------------------------
union_2 = Solid.Union(solid=mid_top_cylinders, solid_2=placing_steeljoints)
union_3 = Solid.Union(solid=union, solid_2=union_2)
union_4 = Solid.Union(solid=placing_cylinderrods, solid_2=placing_steeljoints)
union_5 = Solid.Union(solid=mid_upper_cylinders, solid_2=placing_steeljoints)
union_6 = Solid.Union(solid=union_4, solid_2=union_5)
union_7 = Solid.Union(solid=union_3, solid_2=union_6)
volume_calc_2 = Solid.Volume(solid=union_7)
volume_2 = Watch(volume_calc_2)
