# Dynamo graph 1804292.dyn (Dynamo 3.6.0.9395)

# group: Don't touch this ground
code_block = CodeBlock { -5000; -5000; -200; }
byCoordinates = Point.ByCoordinates(x=code_block.out0, y=code_block.out1, z=code_block.out2)
code_block_2 = CodeBlock { 5000; 5000; 0; }
byCoordinates_2 = Point.ByCoordinates(x=code_block_2.out0, y=code_block_2.out1, z=code_block_2.out2)
byCorners = Cuboid.ByCorners(lowPoint=byCoordinates, highPoint=byCoordinates_2)
code_block_3 = CodeBlock { 0; 100; 0; }
byARGB = Color.ByARGB(red=code_block_3.out0, green=code_block_3.out1, blue=code_block_3.out2)
byGeometryColor = Modifiers.GeometryColor.ByGeometryColor(geometry=byCorners, color=byARGB)

# group: Parameters
pavRadius = DoubleSlider(4500, range=1000..4500 step 1)
nRibs = DoubleSlider(16, range=6..40 step 1)
ribHeight = DoubleSlider(3000, range=2000..5000 step 1)
curvepull = DoubleSlider(900, range=0..2000 step 1)
ribThickness = DoubleSlider(150, range=50..300 step 1)
colHeight = DoubleSlider(2800, range=2000..3500 step 1)
colRadius = DoubleSlider(100, range=30..200 step 1)

# group: Circle
code_block_4 = CodeBlock { 0; }
code_block_5 = CodeBlock(nRibs=nRibs) { 0..1..#nRibs; }

byCoordinates_3 = Point.ByCoordinates(x=code_block_4, y=code_block_4, z=code_block_4)

# group (continued): Circle
code_block_6 = CodeBlock(point1=byCoordinates_3, t1=pavRadius) { circle1 = Circle.ByCenterPointRadius(point1, t1); }
pts = Curve.PointAtParameter(curve=code_block_6, param=code_block_5)

X = Point.X(point=pts)
Y = Point.Y(point=pts)
code_block_7 = CodeBlock { 0; }
basePts = Point.ByCoordinates(x=X, y=Y, z=code_block_7)
topPts = Point.ByCoordinates(x=X, y=Y, z=ribHeight)
centerHigh = Point.ByCoordinates(x=code_block_7, y=code_block_7, z=ribHeight)
dirVecs_raw = Vector.ByTwoPoints(start=topPts, end=centerHigh)
dirVecs = Vector.Normalized(vector=dirVecs_raw)
scaledVecs = Vector.Scale(vector=dirVecs, scale_factor=curvepull)
midPts = Point.Add(point=topPts, vectorToAdd=scaledVecs)
list_create = List.Create(item0=basePts, item1=midPts, item2=topPts)
transpose = List.Transpose(lists=list_create)
ribCurves = NurbsCurve.ByPoints(points=transpose)
class_timberrib_material_1 = Python(IN[0]=ribCurves, IN[1]=ribThickness)  # CPython3
# ---------- class_timberrib_material_1.python (54 lines) ----------
import clr
clr.AddReference('ProtoGeometry')
from Autodesk.DesignScript.Geometry import *

curves = IN[0]  # list of rib center curves
t = IN[1]       # rib thickness (mm)

class TimberRib(object):
    def __init__(self, centerCurve, thickness):
        self.centerCurve = centerCurve
        self.thickness = thickness
        self.solid = None

    def make_geometry(self):
        # Profile at start of curve
        p0 = self.centerCurve.StartPoint
        cs = CoordinateSystem.ByOrigin(p0)
        # Square cross-section
        rect = Rectangle.ByWidthLength(cs, self.thickness, self.thickness)
        # Sweep rectangle along the rib curve
        solid = Solid.BySweep(rect, self.centerCurve)
        self.solid = solid
        return self.solid

    def volume(self):
        if not self.solid:
            self.make_geometry()
        return self.solid.Volume

rib_instances = []
rib_solids = []
rib_vols = []

# Make sure curves is a list
if isinstance(curves, list):
    curve_list = curves
else:
    curve_list = [curves]

for c in curve_list:
    rib = TimberRib(c, t)
    s = rib.make_geometry()
    v = rib.volume()
    rib_instances.append(rib)
    rib_solids.append(s)
    rib_vols.append(v)

total_vol = sum(rib_vols) if rib_vols else 0

# OUT:
# [0] list of solids
# [1] list of volumes
# [2] total volume
OUT = (rib_solids, rib_vols, total_vol)
# ----------------------------------------
material_1_total_volume_mm_3 = Watch(class_timberrib_material_1)  # "material 1 total volume (mm^3) - timber ribs"

# group: column axes
colTopPts = Point.ByCoordinates(x=X, y=Y, z=colHeight)
colAxes = Line.ByStartPointEndPoint(startPoint=basePts, endPoint=colTopPts)

class_steelcolumn_material_2 = Python(IN[0]=colAxes, IN[1]=colRadius)  # CPython3
# ---------- class_steelcolumn_material_2.python (46 lines) ----------
import clr
clr.AddReference('ProtoGeometry')
from Autodesk.DesignScript.Geometry import *

axes = IN[0]   # list of column axis lines
r = IN[1]      # column radius (mm)

class SteelColumn(object):
    def __init__(self, axis, radius):
        self.axis = axis
        self.radius = radius
        self.solid = None

    def make_geometry(self):
        start = self.axis.StartPoint
        end = self.axis.EndPoint
        # Use a built-in cylinder creator
        cyl = Cylinder.ByPointsRadius(start, end, self.radius)
        self.solid = cyl
        return self.solid

    def volume(self):
        if not self.solid:
            self.make_geometry()
        return self.solid.Volume

col_instances = []
col_solids = []
col_vols = []

if isinstance(axes, list):
    axis_list = axes
else:
    axis_list = [axes]

for a in axis_list:
    col = SteelColumn(a, r)
    s = col.make_geometry()
    v = col.volume()
    col_instances.append(col)
    col_solids.append(s)
    col_vols.append(v)

total_vol = sum(col_vols) if col_vols else 0

OUT = (col_solids, col_vols, total_vol)
# ----------------------------------------
material_2_total_volume_mm_3 = Watch(class_steelcolumn_material_2)  # "Material 2 total volume (mm^3) - columns"
list_create_2 = List.Create(item0=class_timberrib_material_1, item1=class_steelcolumn_material_2)
flatten = List.Flatten(list=list_create_2)
