# Dynamo graph 1804492.dyn (Dynamo 3.6.0.9395)

# group: Don't touch this ground
code_block = CodeBlock { -5000; -5000; -200; }
byCoordinates = Point.ByCoordinates(x=code_block.out0, y=code_block.out1, z=code_block.out2)
code_block_2 = CodeBlock { 5000; 5000; 0; }
byCoordinates_2 = Point.ByCoordinates(x=code_block_2.out0, y=code_block_2.out1, z=code_block_2.out2)
byCorners = Cuboid.ByCorners(lowPoint=byCoordinates, highPoint=byCoordinates_2)
code_block_3 = CodeBlock { 0; 100; 0; }
byARGB = Color.ByARGB(red=code_block_3.out0, green=code_block_3.out1, blue=code_block_3.out2)
byGeometryColor = Modifiers.GeometryColor.ByGeometryColor(geometry=byCorners, color=byARGB)

grid_density = DoubleSlider(7, range=2..10 step 1)
dome_height = DoubleSlider(4849, range=0..5000 step 1)
curve = DoubleSlider(1.6, range=0.1..2 step 0.1)
grid_points = Python(IN[0]=grid_density, IN[1]=dome_height, IN[2]=curve)  # CPython3
# ---------- grid_points.python (66 lines) ----------
# Load the Python Standard and DesignScript Libraries
import sys
import clr
clr.AddReference('ProtoGeometry')
from Autodesk.DesignScript.Geometry import *
import math

try:
    rings_raw = IN[0]
    height_raw = IN[1]
    curve_raw = IN[2] 
    


# Convert to proper types
    rings = int(math.floor(float(rings_raw))) # Force floats to turn to integers by rounding down
    height = float(height_raw)
    curve = float(curve_raw)

# Safety limits
    if rings < 1: rings = 1
    if rings > 20: rings = 20 # Prevent too many points

#maximum number of rings in the dome
except Exception as e:
    rings = 6 # Default fallback
    height = 3000
    curve = 1.0

radius = 5000.0
points = []

# Create center of dome 
center = Point.ByCoordinates(0, 0, height)
points.append(center)

# Create rings (skip if rings = 0)
if rings > 0:
    for r in range(1, rings + 1):
        current_radius = radius * float(r) / float(rings)

# Calculate points in each ring (this is the simplified formula)
# First ring has 6 points
        if r == 1:
            points_in_ring = 6 
        else:
            # Subsequent rings have more points
            points_in_ring = 6 * r 

        for i in range(points_in_ring):
            angle = 2.0 * math.pi * float(i) / float(points_in_ring)
            x = current_radius * math.cos(angle)
            y = current_radius * math.sin(angle)

# Simple dome formula (according to online research)
            dist_from_center = math.sqrt(x*x + y*y) / 5000
            z = height * (1.0 - (dist_from_center ** curve))
            
            if dist_from_center > 0.9:
                z = 0.0

# Only add if points are above ground
            if z > 10: # 10mm minimum
                 points.append(Point.ByCoordinates(x, y, z))

OUT = points
# ----------------------------------------
connectinggroundpoints = Python(IN[0]=grid_points)  # CPython3
# ---------- connectinggroundpoints.python (24 lines) ----------
# Load the Python Standard and DesignScript Libraries
import sys
import clr
clr.AddReference('ProtoGeometry')
from Autodesk.DesignScript.Geometry import *
import math
# Keep all original dome points 
pts = IN[0]
new_points = list(pts)

# Add a ring on the ground
num_ground_points = 12 # Enough for full circle

#formula for simple ring 
for i in range(num_ground_points):
    angle = 2.0 * math.pi * i / num_ground_points
    # Full 5000mm radius
    x = 5000.0 * math.cos(angle) 
    y = 5000.0 * math.sin(angle)
    z = 0.0 # Ground level

    new_points.append(Point.ByCoordinates(x, y, z))

OUT = new_points
# ----------------------------------------
class_woodbeam = Python(IN[0]=connectinggroundpoints, IN[1]=grid_density)  # CPython3
# ---------- class_woodbeam.python (72 lines) ----------
# Load the Python Standard and DesignScript Libraries
#for outer dome pattern
import sys
import clr
clr.AddReference('ProtoGeometry')
from Autodesk.DesignScript.Geometry import *
import math


class WoodBeam:
    # code for circular beam
    def __init__(self, start_pt, end_pt, diameter=80):
        self.start = start_pt
        self.end = end_pt
        self.diameter = diameter 

    def create_geometry(self):
# create a line to eventually turn into a cylinder
        line = Line.ByStartPointEndPoint(self.start, self.end)
        length = line.Length
        if length > 0:
# Create cylinder along line from before (online research)
            direction = Vector.ByTwoPoints(self.start, self.end)
            plane = Plane.ByOriginNormal(self.start, direction)
            beam = Cylinder.ByRadiusHeight(plane, self.diameter/2, length)
            return beam
        return None

    def calculate_volume(self):
# Volume of cylinder: π * r² * h
        line = Line.ByStartPointEndPoint(self.start, self.end)
        length = line.Length
        radius = self.diameter / 2
        volume = math.pi * (radius**2) * length
        return volume

 
# INPUTS
# circular grid points
grid_points = list(IN[0]) 
beam_diameter = float(IN[1]) if len(IN) > 1 else 80.0

# Output
beam_lines = []
total_volume = 0.0

# Connect each point to its neighbors
for i in range(len(grid_points)):
    for j in range(i + 1, len(grid_points)):
        pt1 = grid_points[i]
        pt2 = grid_points[j]

# Calculate distance between lines
        dx = pt2.X - pt1.X
        dy = pt2.Y - pt1.Y
        dz = pt2.Z - pt1.Z
        distance = math.sqrt(dx*dx + dy*dy + dz*dz)

# Only connect if points are close enough 
        if distance < 2000 and distance > 100: # Between 100mm and 2m
# Create beam as line
            line = Line.ByStartPointEndPoint(pt1, pt2)
            beam_lines.append(line)

# Calculate beam volume
            radius = beam_diameter / 2.0
            volume = math.pi * radius * radius * distance
            total_volume += volume


volume_with_units = str(round(total_volume, 2)) + "mm³"
OUT = beam_lines, volume_with_units
# ----------------------------------------
code_block_4 = CodeBlock { 1; }
getItemAtIndex = List.GetItemAtIndex(list=class_woodbeam, index=code_block_4)
woodbeam_volume = Watch(getItemAtIndex)
panelthickness = DoubleSlider(6, range=1..50 step 1)
paneldensity = DoubleSlider(1, range=1..5 step 1)
class_steelpanel = Python(IN[0]=connectinggroundpoints, IN[1]=panelthickness, IN[2]=paneldensity)  # CPython3
# ---------- class_steelpanel.python (131 lines) ----------
# Load the Python Standard and DesignScript Libraries
import sys
import clr
clr.AddReference('ProtoGeometry')
from Autodesk.DesignScript.Geometry import *
import math

class SteelPanel:
    def __init__(self, p1, p2, p3, thickness=30.0):
        self.points = [p1, p2, p3]
        self.thickness = thickness

    def create_geometry(self):
        #create 3D geometry for the panel (went with triangle shape)
        try:
            pc = PolyCurve.ByPoints(self.points, True)
            surf = Surface.ByPatch(pc)
            return surf.Thicken(self.thickness)
        except:
            return None
#calculate volume of the material used in the panel (had to use Heron's formula)
    def calculate_volume(self):
        p1, p2, p3 = self.points
        a = p1.DistanceTo(p2)
        b = p2.DistanceTo(p3)
        c = p3.DistanceTo(p1)
        s = (a + b + c) / 2.0
        area = math.sqrt(s * (s - a) * (s - b) * (s - c))
        return area * self.thickness

# MAIN CODE
#convert input into a list 
pts = list(IN[0]) if hasattr(IN[0], '__iter__') else []
#get panel thickness from thickness slider
thickness = float(IN[1]) if len(IN) > 1 and IN[1] is not None else 30.0
#get panel density from slider 
density = int(IN[2]) if len(IN) > 2 and IN[2] is not None else 1

panels = []
total_vol = 0.0

if len(pts) > 10:
# Group points into rings by their distance from the center
    rings = {}
    for p in pts:
        if p.Z < 300 or p.Z > 5000:
            continue 
# Distance from the center
        r = math.sqrt(p.X*p.X + p.Y*p.Y)
# Group by 1000mm rings
        ring_num = int(r / 1000)
        if ring_num not in rings:
            rings[ring_num] = []
        rings[ring_num].append(p)

# Sort ring numbers
    ring_numbers = sorted(rings.keys())

#Add higher rings to reach the top of the dome
    if rings: 
        max_height = max(rings.keys())

# If the highest ring is below 4000mm, add more rings above
    if max_height < 4000:
# Add rings at higher elevations
        extra_heights = [3000, 3500, 4000, 4500]

# Get a base ring to copy the point distribution from
        if 0 in rings:
            base_ring = rings[0]
        elif len(rings) > 0:
            base_ring = rings[min(rings.keys())]
        else:
            base_ring = []

# Create new higher rings
        for height in extra_heights:
            if height > max_height:
                new_ring = []
            for base_pt in base_ring:
# Create point at higher elevation
                new_z = min(height, 5000)
                new_pt = Point.ByCoordinates(base_pt.X, base_pt.Y, new_z)
new_ring.append(new_pt)

rings[height] = new_ring

# Update ring_numbers with new heights
ring_numbers = sorted(rings.keys())


# Create panels between rings (to make sure it goes all around)
for r in range(len(ring_numbers) - 1):

    for r in range(len(ring_numbers) - 1):
        inner_ring = rings[ring_numbers[r]]
        outer_ring = rings[ring_numbers[r + 1]]

# Sort points in each ring by angle
        inner_ring.sort(key=lambda p: math.atan2(p.Y, p.X))
        outer_ring.sort(key=lambda p: math.atan2(p.Y, p.X))

# Create triangles connecting rings (like a mesh)
    for i in range(len(inner_ring)):
# Skip based on density
        if i % density != 0:
            continue

# Get 4 points forming a group
        p1 = inner_ring[i]
        p2 = inner_ring[(i + 1) % len(inner_ring)] 
        p3 = outer_ring[i % len(outer_ring)]
        p4 = outer_ring[(i + 1) % len(outer_ring)] 

# Create TWO triangles for each group
# Triangle 1
        panel1 = SteelPanel(p1, p2, p3, thickness)
        geom1 = panel1.create_geometry()
        if geom1:
            panels.append(geom1)
            total_vol += panel1.calculate_volume()

# Triangle 2
        panel2 = SteelPanel(p2, p4, p3, thickness)
        geom2 = panel2.create_geometry()
        if geom2:
            panels.append(geom2)
            total_vol += panel2.calculate_volume()
#calculate volume
volume_with_units = str(round(total_vol, 2)) + "mm³"
OUT = panels, volume_with_units
# ----------------------------------------
code_block_5 = CodeBlock { 1; }
getItemAtIndex_2 = List.GetItemAtIndex(list=class_steelpanel, index=code_block_5)
steelvolume = Watch(getItemAtIndex_2)
