# Dynamo graph 1805141.dyn (Dynamo 3.5.2.8914)

code_block = CodeBlock { -5000; -5000; -200; }
byCoordinates = Point.ByCoordinates(x=code_block.out0, y=code_block.out1, z=code_block.out2)
code_block_2 = CodeBlock { 5000; 5000; 0; }
byCoordinates_2 = Point.ByCoordinates(x=code_block_2.out0, y=code_block_2.out1, z=code_block_2.out2)
byCorners = Cuboid.ByCorners(lowPoint=byCoordinates, highPoint=byCoordinates_2)
code_block_3 = CodeBlock { 0; 100; 0; }
byARGB = Color.ByARGB(red=code_block_3.out0, green=code_block_3.out1, blue=code_block_3.out2)
byGeometryColor = Modifiers.GeometryColor.ByGeometryColor(geometry=byCorners, color=byARGB)
count_x = IntegerSlider(10, range=3..20 step 1)
count_y = IntegerSlider(5, range=5..20 step 1)
wave_height = DoubleSlider(1200, range=500..3000 step 0.1)
post_radius = DoubleSlider(100, range=50..200 step 0.1)
python_script = Python(IN[0]=count_x, IN[1]=count_y, IN[2]=wave_height, IN[3]=post_radius)  # CPython3
# ---------- python_script.python (90 lines) ----------
import clr
import math

# Import Geometry libraries from Dynamo
clr.AddReference('ProtoGeometry')
from Autodesk.DesignScript.Geometry import *

# --- CLASS 1: TIMBER POST ---
class TimberPost:
    def __init__(self, x, y, h, r):
        self.x = x
        self.y = y
        self.h = h
        self.r = r

    def create_geo(self):
        cs = CoordinateSystem.ByOrigin(self.x, self.y, 0)
        return Cylinder.ByRadiusHeight(cs, self.r, self.h)

    def get_volume(self):
        return (math.pi * self.r**2) * self.h

# --- CLASS 2: ROOF PANEL ---
class RoofPanel:
    def __init__(self, x, y, h, width, length):
        self.x = x
        self.y = y
        self.h = h
        self.w = width
        self.l = length

    def create_geo(self):
        cs = CoordinateSystem.ByOrigin(self.x, self.y, self.h)
        # Add slight overlap (+20mm) to ensure 3D printability
        return Cuboid.ByLengths(cs, self.w + 50, self.l + 50, 600)

    def get_volume(self):
        return (self.w + 50) * (self.l + 50) * 600

# --- INPUTS ---
count_x = IN[0]
count_y = IN[1]
wave_amp = IN[2]
radius = IN[3]

# Safety Check: prevent division by zero or negative numbers
if count_x < 2: count_x = 2
if count_y < 2: count_y = 2

# Lists to hold our output
timber_geometry = []
roof_geometry = []
total_timber_vol = 0.0
total_roof_vol = 0.0

# --- LOGIC: CENTERED GRID ---
# We use a span of 8000mm (-4000 to +4000).
# This leaves room for the roof panels to stick out without hitting the -5000 boundary.
span_x = 8000.0
span_y = 8000.0

# Calculate step size based on GAPS, not counts
# (Count - 1) gives us the number of spaces between posts
step_x = span_x / (count_x - 1)
step_y = span_y / (count_y - 1)

for i in range(count_x):
    for j in range(count_y):
        # Calculate X and Y coordinates
        # Start at -4000 and add steps
        x = -4000 + (i * step_x)
        y = -4000 + (j * step_y)

        # MATH: Sine wave formula
        angle = x / 2500.0 
        height = 3000 + (math.sin(angle) * wave_amp)

        # Create Timber Post
        post = TimberPost(x, y, height, radius)
        timber_geometry.append(post.create_geo())
        total_timber_vol += post.get_volume()

        # Create Roof Panel
        # We pass the calculated step size so the panels touch perfectly
        roof = RoofPanel(x, y, height, step_x, step_y)
        roof_geometry.append(roof.create_geo())
        total_roof_vol += roof.get_volume()

# --- OUTPUT ---
OUT = [timber_geometry, roof_geometry, total_timber_vol, total_roof_vol]
# ----------------------------------------
code_block_4 = CodeBlock(data=python_script) { data[0]; data[1]; data[2]; data[3]; }
timber_volume_in_mm = Watch(code_block_4.out2)
roof_material_volume_in_mm = Watch(code_block_4.out3)
