# Dynamo graph 1805299.dyn (Dynamo 3.6.0.9395)

# group: Don't touch this ground
code_block = CodeBlock { -5000; -5000; -200; }
byCoordinates = Point.ByCoordinates(x=code_block.out0, y=code_block.out1, z=code_block.out2)
code_block_2 = CodeBlock { 5000; 5000; 0; }
byCoordinates_2 = Point.ByCoordinates(x=code_block_2.out0, y=code_block_2.out1, z=code_block_2.out2)
byCorners = Cuboid.ByCorners(lowPoint=byCoordinates, highPoint=byCoordinates_2)
code_block_3 = CodeBlock { 0; 100; 0; }
byARGB = Color.ByARGB(red=code_block_3.out0, green=code_block_3.out1, blue=code_block_3.out2)
byGeometryColor = Modifiers.GeometryColor.ByGeometryColor(geometry=byCorners, color=byARGB)

amplitude = DoubleSlider(4953.2, range=1000..5000 step 0.1)
class_timbercolumn = Python(IN[0]=amplitude)  # CPython3
# ---------- class_timbercolumn.python (44 lines) ----------
import clr
clr.AddReference('ProtoGeometry')
from Autodesk.DesignScript.Geometry import *

# INPUT: want my amp slider to be the input
column_height = IN[0]  
#making columns
class TimberColumn:
    def __init__(self, base_point, height, radius=100):
        self.base_point = base_point
        self.height = height
        self.radius = radius
        
    def create_geometry(self):
        top_point = Point.ByCoordinates(
            self.base_point.X, 
            self.base_point.Y, 
            self.base_point.Z + self.height
        )
        column = Cylinder.ByPointsRadius(self.base_point, top_point, self.radius)
        return column
        
    def calculate_volume(self):
        volume = 3.14159 * (self.radius * self.radius) * self.height
        return volume

# putting a column at each corner
columns = []
total_volume = 0

corners = [
    Point.ByCoordinates(-4500, -4500, 0),
    Point.ByCoordinates(4500, -4500, 0),  
    Point.ByCoordinates(-4500, 4500, 0),
    Point.ByCoordinates(4500, 4500, 0)
]

for corner in corners:
    column = TimberColumn(corner, column_height, 120)
    column_geo = column.create_geometry()
    columns.append(column_geo)
    total_volume += column.calculate_volume()
#output
OUT = columns, total_volume
# ----------------------------------------
timber_volume_mm³ = Watch(class_timbercolumn)
star_count_x = DoubleSlider(14, range=5..15 step 0.1)
star_count_y = DoubleSlider(72.9, range=0..100 step 0.1)
star_height = DoubleSlider(14.4, range=0..15 step 0.1)
series_starinstances = Python(IN[0]=star_count_x, IN[1]=star_count_y, IN[2]=star_height, IN[3]=amplitude)  # CPython3
# ---------- series_starinstances.python (105 lines) ----------
import clr
clr.AddReference('ProtoGeometry')
from Autodesk.DesignScript.Geometry import *
import math
import random

# INPUTS
star_count_x = IN[0]  # number of stars
star_count_y = IN[1]  # how spread out they are  
rib_count = IN[2]     #  star height 
column_height = IN[3]  # amplitude should connect to work with the roof height


random.seed(42)

total_stars = int(star_count_x * star_count_y)
stars = []
support_wires = []
total_star_volume = 0
total_wire_volume = 0

# star height slider controls the height range of stars
base_height = 2000
height_range = 1000
star_height = base_height + (height_range * (rib_count / 10.0))

# Simple beam class for support wires that stars hang from (makes the deign feasible so stars dont float)
class SupportWire:
    def __init__(self, start_pt, end_pt, radius=3):
        self.start_pt = start_pt
        self.end_pt = end_pt
        self.radius = radius
        
    def create_geometry(self):
        wire = Cylinder.ByPointsRadius(self.start_pt, self.end_pt, self.radius)
        return wire
        
    def calculate_volume(self):
        line = Line.ByStartPointEndPoint(self.start_pt, self.end_pt)
        length = line.Length
        volume = 3.14159 * (self.radius * self.radius) * length
        return volume

star_centers = []  # remember star centers for support wires

for i in range(total_stars):
    # random positions within the 10m x 10m area
    x = random.uniform(-4500, 4500)
    y = random.uniform(-4500, 4500)
    
    # random height variation around the main star_height
    height_variation = random.uniform(-200, 200)
    z = star_height + height_variation
    
    center = Point.ByCoordinates(x, y, z)
    star_centers.append(center)
    
    # make 5-pointed star using pyramids
    star_points = []
    
    # make 5 outer points of the star
    for k in range(5):
        angle = 2 * math.pi * k / 5 - math.pi/2  # from top
        point_x = x + 80 * math.cos(angle)  # Outer points
        point_y = y + 80 * math.sin(angle)
        point_z = z
        star_points.append(Point.ByCoordinates(point_x, point_y, point_z))
    
    # try small pyramid at each outer point pointing toward center?
    for point in star_points:
        # pyramid points inward slightly
        pyramid_top = Point.ByCoordinates(
            x + (point.X - x) * 0.3,  # 30% toward center
            y + (point.Y - y) * 0.3,
            z + 40  # 40mm height
        )
        pyramid = Cone.ByPointsRadius(point, pyramid_top, 25)  # 25mm base
        stars.append(pyramid)
        
        # Volume calculation for cone
        volume = (1/3) * 3.14159 * (25 * 25) * 40
        total_star_volume += volume
    
    # Add a center piece to connect the star
    center_base = Point.ByCoordinates(x, y, z)
    center_top = Point.ByCoordinates(x, y, z + 30)
    center_piece = Cone.ByPointsRadius(center_base, center_top, 40)
    stars.append(center_piece)
    total_star_volume += (1/3) * 3.14159 * (40 * 40) * 30

# need support wires from each star to the roof
for star_center in star_centers:
    # wire goes straight up to roof level
    roof_attachment = Point.ByCoordinates(star_center.X, star_center.Y, column_height)
    wire = SupportWire(star_center, roof_attachment, 3)  # 3mm thin wire
    
    support_wires.append(wire.create_geometry())
    total_wire_volume += wire.calculate_volume()

# combine stars and support wires for output
all_geometry = stars + support_wires
total_combined_volume = total_star_volume + total_wire_volume

#output
OUT = all_geometry, total_combined_volume
# ----------------------------------------
steel_volume_mm³ = Watch(series_starinstances)
class_roofbeam = Python(IN[0]=amplitude)  # CPython3
# ---------- class_roofbeam.python (62 lines) ----------
import clr
clr.AddReference('ProtoGeometry')
from Autodesk.DesignScript.Geometry import *

# INPUTS
column_height = IN[0]
#making the beams
class RoofBeam:
    def __init__(self, start_pt, end_pt, radius=60):
        self.start_pt = start_pt
        self.end_pt = end_pt
        self.radius = radius
        
    def create_geometry(self):
        beam = Cylinder.ByPointsRadius(self.start_pt, self.end_pt, self.radius)
        return beam
        
    def calculate_volume(self):
        line = Line.ByStartPointEndPoint(self.start_pt, self.end_pt)
        length = line.Length
        volume = 3.14159 * (self.radius * self.radius) * length
        return volume

beams = []
total_volume = 0

# Create a dense grid of beams (looks like a solid roof from distance)
grid_density = 8  # Number of beams in each direction

# Perimeter beams first
corners = [
    Point.ByCoordinates(-4500, -4500, column_height),
    Point.ByCoordinates(4500, -4500, column_height),  
    Point.ByCoordinates(-4500, 4500, column_height),
    Point.ByCoordinates(4500, 4500, column_height)
]

perimeter_connections = [(0,1), (1,3), (3,2), (2,0)]
for start_idx, end_idx in perimeter_connections:
    beam = RoofBeam(corners[start_idx], corners[end_idx], 80)
    beams.append(beam.create_geometry())
    total_volume += beam.calculate_volume()

# make grid in X direction
for i in range(grid_density + 1):
    y_pos = -4500 + (9000 * i / grid_density)
    start_pt = Point.ByCoordinates(-4500, y_pos, column_height)
    end_pt = Point.ByCoordinates(4500, y_pos, column_height)
    beam = RoofBeam(start_pt, end_pt, 40)
    beams.append(beam.create_geometry())
    total_volume += beam.calculate_volume()

# make grid in Y direction  
for i in range(grid_density + 1):
    x_pos = -4500 + (9000 * i / grid_density)
    start_pt = Point.ByCoordinates(x_pos, -4500, column_height)
    end_pt = Point.ByCoordinates(x_pos, 4500, column_height)
    beam = RoofBeam(start_pt, end_pt, 40)
    beams.append(beam.create_geometry())
    total_volume += beam.calculate_volume()
#output
OUT = beams, total_volume
# ----------------------------------------
roof_volume_mm³ = Watch(class_roofbeam)
