# Dynamo graph 1805569.dyn (Dynamo 3.6.0.9395)

code_block = CodeBlock { -5000; -5000; -200; }
byCoordinates = Point.ByCoordinates(x=code_block.out0, y=code_block.out1, z=code_block.out2)
code_block_2 = CodeBlock { 5000; 5000; 0; }
byCoordinates_2 = Point.ByCoordinates(x=code_block_2.out0, y=code_block_2.out1, z=code_block_2.out2)
byCorners = Cuboid.ByCorners(lowPoint=byCoordinates, highPoint=byCoordinates_2)
code_block_3 = CodeBlock { 0; 100; 0; }
byARGB = Color.ByARGB(red=code_block_3.out0, green=code_block_3.out1, blue=code_block_3.out2)
byGeometryColor = Modifiers.GeometryColor.ByGeometryColor(geometry=byCorners, color=byARGB)
number_of_beams = DoubleSlider(80, range=20..100 step 1)
parameter_for_number_of_beams = CodeBlock(n=number_of_beams) { n; 0..1..#n; }
watch = Watch(parameter_for_number_of_beams.out1)
number_of_rotations = DoubleSlider(3, range=0..6 step 0.025)
parameter_for_rotations = CodeBlock(N_of_components=number_of_beams, N_of_Rotations=number_of_rotations) { N_of_components; N_of_Rotations; 0..N_of_Rotations*360..#N_of_components; }
watch_2 = Watch(parameter_for_rotations.out2)
startX = DoubleInput(-4250)
endX = DoubleInput(4250)
radius_of_sphere = DoubleSlider(250, range=0..250 step 10)
number_of_spheres = DoubleSlider(10, range=0..12 step 1)
amplitude_of_sine_wave = DoubleSlider(2000, range=-2000..2000 step 100)
class_concrete_sphere = Python()  # CPython3; unwired: IN[0]
# ---------- class_concrete_sphere.python (15 lines) ----------
# Load the Python Standard and DesignScript Libraries
import sys
import clr
clr.AddReference('ProtoGeometry')
from Autodesk.DesignScript.Geometry import *

class SphereObject:
    def __init__(self, center_point, radius):
        self.center = center_point
        self.radius = radius

    def make_geometry(self):
        return Sphere.ByCenterPointRadius(self.center, self.radius)

OUT = SphereObject
# ----------------------------------------
series_of_instances_of_concrete = Python(IN[0]=startX, IN[1]=endX, IN[2]=radius_of_sphere, IN[3]=radius_of_sphere, IN[4]=number_of_spheres, IN[5]=amplitude_of_sine_wave, IN[6]=class_concrete_sphere)  # "Series of Instances of Concrete Spheres in Sine Wave"; CPython3
# ---------- series_of_instances_of_concrete.python (90 lines) ----------
import clr
clr.AddReference('ProtoGeometry')
from Autodesk.DesignScript.Geometry import *
import math

# INPUTS
# IN[0] startX      (number)
# IN[1] endX        (number)
# IN[2] z           (number)
# IN[3] radius      (number)
# IN[4] count       (integer)
# IN[5] amplitude   (number)
# IN[6] sphereClass (sphere class)

# Safe read helper: try to coerce numeric inputs
def to_float(v, fallback=0.0):
    try:
        return float(v)
    except:
        return fallback

def to_int(v, fallback=0):
    try:
        return int(v)
    except:
        try:
            return int(float(v))
        except:
            return fallback

# Read inputs with safe defaults
startX = to_float(IN[0], -4250.0)
endX   = to_float(IN[1], 4250.0)
z      = to_float(IN[2], 0.0)
radius = to_float(IN[3], 250.0)
count  = to_int(IN[4], 8)
amplitude = to_float(IN[5], 1000.0)
sphereClass = IN[6] if len(IN) > 6 else None

# Build X positions and angles
if count == 1:
    xs = [(startX + endX) / 2.0]
    angles_rad = [0.0]
else:
    xs = [ startX + (endX - startX) * (float(i) / (count - 1)) for i in range(count) ]
    angles_deg = [ i * (360.0 / (count - 1)) for i in range(count) ]
    angles_rad = [ math.radians(a) for a in angles_deg ]

spheres = []
centers = []
errors = []

# Determine whether sphereClass is usable
use_class = False
if sphereClass is not None:
    
    try:
        # attempt to call make_geometry on a test instance if possible
        test_center = Point.ByCoordinates(xs[0], amplitude * math.sin(angles_rad[0]), z)
        test_inst = sphereClass(test_center, radius)
        # if the instance has a make_geometry method, assume it's okay
        if hasattr(test_inst, "make_geometry"):
            use_class = True
    except Exception:
        use_class = False

# Create geometry
for x, ang in zip(xs, angles_rad):
    y = amplitude * math.sin(ang)
    center = Point.ByCoordinates(x, y, z)
    centers.append(center)

    try:
        if use_class:
            
            inst = sphereClass(center, radius)
            geom = inst.make_geometry()
        else:
            
            geom = Sphere.ByCenterPointRadius(center, radius)

        if geom is None:
            errors.append("Null geometry at x={}".format(x))
        else:
            spheres.append(geom)

    except Exception as e:
        errors.append("Error at x={}: {}".format(x, str(e)))

OUT = spheres
# ----------------------------------------
volume = Solid.Volume(solid=series_of_instances_of_concrete)
watch_3 = Watch(volume)
sum = Math.Sum(values=volume)
volume_of_spheres_display_python = Python(IN[0]=sum)  # "Volume of Spheres Display Python Script"; CPython3
# ---------- volume_of_spheres_display_python.python (11 lines) ----------
# Load the Python Standard and DesignScript Libraries
import sys
import clr
clr.AddReference('ProtoGeometry')
from Autodesk.DesignScript.Geometry import *

value = IN[0]

output_string = "{:.2f} mm³".format(value)

OUT = output_string
# ----------------------------------------
volume_of_concrete_spheres = Watch(volume_of_spheres_display_python)  # "Volume of Concrete Spheres Display"
watch_4 = Watch(sum)
class_wood_beam = Python()  # CPython3; unwired: IN[0]
# ---------- class_wood_beam.python (23 lines) ----------
# Load the Python Standard and DesignScript Libraries
import sys
import clr
clr.AddReference('ProtoGeometry')
from Autodesk.DesignScript.Geometry import *

class CuboidObject:
    def __init__(self, origin, width, length, height):
        self.origin = origin
        self.width = width
        self.length = length
        self.height = height

    def make_geometry(self):
        """Return a cuboid like Cuboid.ByLengths."""
        return Cuboid.ByLengths(
            self.origin,
            self.width,
            self.length,
            self.height
        )

OUT = CuboidObject
# ----------------------------------------
distance_along_ground = DoubleSlider(9750, range=50..9750 step 50)
code_block_4 = CodeBlock(N=distance_along_ground) { N; N/-2; 0; 0; }
startpoint = Point.ByCoordinates(x=code_block_4.out1, y=code_block_4.out2, z=code_block_4.out3)
code_block_5 = CodeBlock { 0; 0; }
height = DoubleSlider(3000, range=100..5000 step 100)
midpoint = Point.ByCoordinates(x=code_block_5.out0, y=code_block_5.out1, z=height)
code_block_6 = CodeBlock(N=distance_along_ground) { N; N/2; 0; 0; }
endpoint = Point.ByCoordinates(x=code_block_6.out1, y=code_block_6.out2, z=code_block_6.out3)
byThreePoints = Arc.ByThreePoints(firstPoint=startpoint, secondPoint=midpoint, thirdPoint=endpoint)
pointAtParameter = Curve.PointAtParameter(curve=byThreePoints, param=parameter_for_number_of_beams.out1)
length = Curve.Length(curve=byThreePoints)
code_block_for_width_of_beams = CodeBlock(L_of_curve=length, N_of_components=number_of_beams) { L_of_curve; N_of_components; W_of_components = L_of_curve/N_of_components; }
length_of_beams = DoubleSlider(750, range=10..1000 step 10)
thickness_of_beams = DoubleSlider(150, range=10..1000 step 10)
series_of_instances_of_wood = Python(IN[0]=class_wood_beam, IN[1]=pointAtParameter, IN[2]=code_block_for_width_of_beams.W_of_components, IN[3]=length_of_beams, IN[4]=thickness_of_beams)  # "Series of Instances of Wood Beams"; CPython3
# ---------- series_of_instances_of_wood.python (19 lines) ----------
# Load the Python Standard and DesignScript Libraries
import sys
import clr
clr.AddReference('ProtoGeometry')
from Autodesk.DesignScript.Geometry import *

CuboidClass = IN[0]
origins = IN[1]      # (list of origins)
width = IN[2]
length = IN[3]
height = IN[4]

cuboids = []

for o in origins:
    inst = CuboidClass(o, width, length, height)
    cuboids.append(inst.make_geometry())

OUT = cuboids
# ----------------------------------------
XAxis = Vector.XAxis()
rotate = Geometry.Rotate(geometry=series_of_instances_of_wood, origin=pointAtParameter, axis=XAxis, degrees=parameter_for_rotations.out2)
code_block_for_translation_up = CodeBlock(T_of_components=thickness_of_beams) { T_of_components/2; }
translate = Geometry.Translate(geometry=rotate, zTranslation=code_block_for_translation_up)
volume_2 = Solid.Volume(solid=translate)
sum_2 = Math.Sum(values=volume_2)
volume_of_beams_display_python = Python(IN[0]=sum_2)  # "Volume of Beams Display Python Script"; CPython3; same code as volume_of_spheres_display_python
volume_of_wood_beams_display = Watch(volume_of_beams_display_python)
watch_5 = Watch(sum_2)
watch_6 = Watch(volume_2)
alpha = DoubleSlider(255, range=0..255 step 1)
red = DoubleSlider(229, range=0..255 step 1)
green = DoubleSlider(170, range=0..255 step 1)
blue = DoubleSlider(112, range=0..255 step 1)
byARGB_2 = Color.ByARGB(alpha=alpha, red=red, green=green, blue=blue)
byGeometryColor_2 = Modifiers.GeometryColor.ByGeometryColor(geometry=translate, color=byARGB_2)
