# Dynamo graph 1807110.dyn (Dynamo 3.6.0.9395)

# group: Don't touch this ground
code_block = CodeBlock { -5000; -5000; -200; }
byCoordinates = Point.ByCoordinates(x=code_block.out0, y=code_block.out1, z=code_block.out2)
code_block_2 = CodeBlock { 5000; 5000; 0; }
byCoordinates_2 = Point.ByCoordinates(x=code_block_2.out0, y=code_block_2.out1, z=code_block_2.out2)
byCorners = Cuboid.ByCorners(lowPoint=byCoordinates, highPoint=byCoordinates_2)
code_block_3 = CodeBlock { 0; 100; 0; }
byARGB = Color.ByARGB(red=code_block_3.out0, green=code_block_3.out1, blue=code_block_3.out2)
byGeometryColor = Modifiers.GeometryColor.ByGeometryColor(geometry=byCorners, color=byARGB)

code_block_4 = CodeBlock { -4750; -4750; 4300; }
byCoordinates_3 = Point.ByCoordinates(x=code_block_4.out0, y=code_block_4.out1, z=code_block_4.out2)
code_block_5 = CodeBlock { 4750; -4750; 4300; }
byCoordinates_4 = Point.ByCoordinates(x=code_block_5.out0, y=code_block_5.out1, z=code_block_5.out2)
code_block_6 = CodeBlock { 4750; 4750; 4050; }
byCoordinates_5 = Point.ByCoordinates(x=code_block_6.out0, y=code_block_6.out1, z=code_block_6.out2)
code_block_7 = CodeBlock { -4750; 4750; 4050; }
byCoordinates_6 = Point.ByCoordinates(x=code_block_7.out0, y=code_block_7.out1, z=code_block_7.out2)
pts = List.Create(item0=byCoordinates_3, item1=byCoordinates_4, item2=byCoordinates_5, item3=byCoordinates_6)
aluminum_roof_panel = Python(IN[0]=pts)  # CPython3
# ---------- aluminum_roof_panel.python (30 lines) ----------
# Load the Python Standard and DesignScript Libraries
import sys
import clr
clr.AddReference('ProtoGeometry')
from Autodesk.DesignScript.Geometry import *


pts = IN[0]

cx = sum([p.X for p in pts]) / len(pts)
cy = sum([p.Y for p in pts]) / len(pts)

def angle(p):
    import math
    return math.atan2(p.Y - cy, p.X - cx)

pts_sorted = sorted(pts, key=angle)


lines = []
for i in range(4):
    p1 = pts_sorted[i]
    p2 = pts_sorted[(i+1) % 4]
    lines.append(Line.ByStartPointEndPoint(p1, p2))

roof_boundary = PolyCurve.ByJoinedCurves(lines)

roof_surface = Surface.ByPatch(roof_boundary)

OUT = roof_surface
# ----------------------------------------
code_block_8 = CodeBlock { 4500; 4500; 0; }
byCoordinates_7 = Point.ByCoordinates(x=code_block_8.out0, y=code_block_8.out1, z=code_block_8.out2)
ZAxis = Vector.ZAxis()
byOriginNormal = Plane.ByOriginNormal(origin=byCoordinates_7, normal=ZAxis)
support_poles_side_length_mm = DoubleSlider(649, range=200..1000 step 1)
byWidthLength = Rectangle.ByWidthLength(plane=byOriginNormal, width=support_poles_side_length_mm, length=support_poles_side_length_mm)
center_guide_points = CodeBlock { 4500; 4500; 0; }
bottom_left_pole_point = Point.ByCoordinates(x=center_guide_points.out0, y=center_guide_points.out1, z=center_guide_points.out2)
center_guide_points_2 = CodeBlock { 4500; 4500; 500; }
bottom_left_pole_point_2 = Point.ByCoordinates(x=center_guide_points_2.out0, y=center_guide_points_2.out1, z=center_guide_points_2.out2)
center_guide_points_3 = CodeBlock { 4500; 4500; 1000; }
bottom_left_pole_point_3 = Point.ByCoordinates(x=center_guide_points_3.out0, y=center_guide_points_3.out1, z=center_guide_points_3.out2)
center_guide_points_4 = CodeBlock { 4500; 4500; 1500; }
bottom_left_pole_point_4 = Point.ByCoordinates(x=center_guide_points_4.out0, y=center_guide_points_4.out1, z=center_guide_points_4.out2)
center_guide_points_5 = CodeBlock { 4500; 4500; 2000; }
bottom_left_pole_point_5 = Point.ByCoordinates(x=center_guide_points_5.out0, y=center_guide_points_5.out1, z=center_guide_points_5.out2)
center_guide_points_6 = CodeBlock { 4600; 4600; 3000; }
bottom_left_pole_point_6 = Point.ByCoordinates(x=center_guide_points_6.out0, y=center_guide_points_6.out1, z=center_guide_points_6.out2)
center_guide_points_7 = CodeBlock { 4750; 4750; 4000; }
bottom_left_pole_point_7 = Point.ByCoordinates(x=center_guide_points_7.out0, y=center_guide_points_7.out1, z=center_guide_points_7.out2)
center_guide_points_8 = CodeBlock { 4750; 4750; 4050; }
bottom_left_pole_point_8 = Point.ByCoordinates(x=center_guide_points_8.out0, y=center_guide_points_8.out1, z=center_guide_points_8.out2)
bottom_left_pole_points = List.Create(item0=bottom_left_pole_point, item1=bottom_left_pole_point_2, item2=bottom_left_pole_point_3, item3=bottom_left_pole_point_4, item4=bottom_left_pole_point_5, item5=bottom_left_pole_point_6, item6=bottom_left_pole_point_7, item7=bottom_left_pole_point_8)
pole_center_line = NurbsCurve.ByPoints(points=bottom_left_pole_points)
hollow_steel_support_pole = Solid.BySweep(profile=byWidthLength, path=pole_center_line)
volume = Solid.Volume(solid=hollow_steel_support_pole)
steel_support_pole_materal = Watch(volume)  # "Steel Support pole materal volume (mm^2)"
code_block_9 = CodeBlock { -4500; 4500; 0; }
byCoordinates_8 = Point.ByCoordinates(x=code_block_9.out0, y=code_block_9.out1, z=code_block_9.out2)
ZAxis_2 = Vector.ZAxis()
byOriginNormal_2 = Plane.ByOriginNormal(origin=byCoordinates_8, normal=ZAxis_2)
byWidthLength_2 = Rectangle.ByWidthLength(plane=byOriginNormal_2, width=support_poles_side_length_mm, length=support_poles_side_length_mm)
center_guide_points_9 = CodeBlock { -4500; 4500; 0; }
bottom_left_pole_point_9 = Point.ByCoordinates(x=center_guide_points_9.out0, y=center_guide_points_9.out1, z=center_guide_points_9.out2)
center_guide_points_10 = CodeBlock { -4500; 4500; 500; }
bottom_left_pole_point_10 = Point.ByCoordinates(x=center_guide_points_10.out0, y=center_guide_points_10.out1, z=center_guide_points_10.out2)
center_guide_points_11 = CodeBlock { -4500; 4500; 1000; }
bottom_left_pole_point_11 = Point.ByCoordinates(x=center_guide_points_11.out0, y=center_guide_points_11.out1, z=center_guide_points_11.out2)
center_guide_points_12 = CodeBlock { -4500; 4500; 1500; }
bottom_left_pole_point_12 = Point.ByCoordinates(x=center_guide_points_12.out0, y=center_guide_points_12.out1, z=center_guide_points_12.out2)
center_guide_points_13 = CodeBlock { -4500; 4500; 2000; }
bottom_left_pole_point_13 = Point.ByCoordinates(x=center_guide_points_13.out0, y=center_guide_points_13.out1, z=center_guide_points_13.out2)
center_guide_points_14 = CodeBlock { -4600; 4600; 3000; }
bottom_left_pole_point_14 = Point.ByCoordinates(x=center_guide_points_14.out0, y=center_guide_points_14.out1, z=center_guide_points_14.out2)
center_guide_points_15 = CodeBlock { -4750; 4750; 4000; }
bottom_left_pole_point_15 = Point.ByCoordinates(x=center_guide_points_15.out0, y=center_guide_points_15.out1, z=center_guide_points_15.out2)
center_guide_points_16 = CodeBlock { -4750; 4750; 4050; }
bottom_left_pole_point_16 = Point.ByCoordinates(x=center_guide_points_16.out0, y=center_guide_points_16.out1, z=center_guide_points_16.out2)
bottom_left_pole_points_2 = List.Create(item0=bottom_left_pole_point_9, item1=bottom_left_pole_point_10, item2=bottom_left_pole_point_11, item3=bottom_left_pole_point_12, item4=bottom_left_pole_point_13, item5=bottom_left_pole_point_14, item6=bottom_left_pole_point_15, item7=bottom_left_pole_point_16)
pole_center_line_2 = NurbsCurve.ByPoints(points=bottom_left_pole_points_2)
support_pole_profile = Solid.BySweep(profile=byWidthLength_2, path=pole_center_line_2)
volume_2 = Solid.Volume(solid=support_pole_profile)
support_pole_materal_volume_mm_2 = Watch(volume_2)
code_block_10 = CodeBlock { -4500; -4500; 0; }
byCoordinates_9 = Point.ByCoordinates(x=code_block_10.out0, y=code_block_10.out1, z=code_block_10.out2)
ZAxis_3 = Vector.ZAxis()
byOriginNormal_3 = Plane.ByOriginNormal(origin=byCoordinates_9, normal=ZAxis_3)
byWidthLength_3 = Rectangle.ByWidthLength(plane=byOriginNormal_3, width=support_poles_side_length_mm, length=support_poles_side_length_mm)
center_guide_points_17 = CodeBlock { -4500; -4500; 0; }
bottom_left_pole_point_17 = Point.ByCoordinates(x=center_guide_points_17.out0, y=center_guide_points_17.out1, z=center_guide_points_17.out2)
center_guide_points_18 = CodeBlock { -4500; -4500; 500; }
bottom_left_pole_point_18 = Point.ByCoordinates(x=center_guide_points_18.out0, y=center_guide_points_18.out1, z=center_guide_points_18.out2)
center_guide_points_19 = CodeBlock { -4500; -4500; 1000; }
bottom_left_pole_point_19 = Point.ByCoordinates(x=center_guide_points_19.out0, y=center_guide_points_19.out1, z=center_guide_points_19.out2)
center_guide_points_20 = CodeBlock { -4500; -4500; 1500; }
bottom_left_pole_point_20 = Point.ByCoordinates(x=center_guide_points_20.out0, y=center_guide_points_20.out1, z=center_guide_points_20.out2)
center_guide_points_21 = CodeBlock { -4500; -4500; 2000; }
bottom_left_pole_point_21 = Point.ByCoordinates(x=center_guide_points_21.out0, y=center_guide_points_21.out1, z=center_guide_points_21.out2)
center_guide_points_22 = CodeBlock { -4600; -4600; 3000; }
bottom_left_pole_point_22 = Point.ByCoordinates(x=center_guide_points_22.out0, y=center_guide_points_22.out1, z=center_guide_points_22.out2)
center_guide_points_23 = CodeBlock { -4750; -4750; 4000; }
bottom_left_pole_point_23 = Point.ByCoordinates(x=center_guide_points_23.out0, y=center_guide_points_23.out1, z=center_guide_points_23.out2)
center_guide_points_24 = CodeBlock { -4750; -4750; 4050; }
bottom_left_pole_point_24 = Point.ByCoordinates(x=center_guide_points_24.out0, y=center_guide_points_24.out1, z=center_guide_points_24.out2)
bottom_left_pole_points_3 = List.Create(item0=bottom_left_pole_point_17, item1=bottom_left_pole_point_18, item2=bottom_left_pole_point_19, item3=bottom_left_pole_point_20, item4=bottom_left_pole_point_21, item5=bottom_left_pole_point_22, item6=bottom_left_pole_point_23, item7=bottom_left_pole_point_24)
pole_center_line_3 = NurbsCurve.ByPoints(points=bottom_left_pole_points_3)
support_pole_profile_2 = Solid.BySweep(profile=byWidthLength_3, path=pole_center_line_3)
volume_3 = Solid.Volume(solid=support_pole_profile_2)
support_pole_materal_volume_mm_2_2 = Watch(volume_3)
code_block_11 = CodeBlock { 4500; -4500; 0; }
byCoordinates_10 = Point.ByCoordinates(x=code_block_11.out0, y=code_block_11.out1, z=code_block_11.out2)
ZAxis_4 = Vector.ZAxis()
byOriginNormal_4 = Plane.ByOriginNormal(origin=byCoordinates_10, normal=ZAxis_4)
byWidthLength_4 = Rectangle.ByWidthLength(plane=byOriginNormal_4, width=support_poles_side_length_mm, length=support_poles_side_length_mm)
center_guide_points_25 = CodeBlock { 4500; -4500; 0; }
bottom_left_pole_point_25 = Point.ByCoordinates(x=center_guide_points_25.out0, y=center_guide_points_25.out1, z=center_guide_points_25.out2)
center_guide_points_26 = CodeBlock { 4500; -4500; 500; }
bottom_left_pole_point_26 = Point.ByCoordinates(x=center_guide_points_26.out0, y=center_guide_points_26.out1, z=center_guide_points_26.out2)
center_guide_points_27 = CodeBlock { 4500; -4500; 1000; }
bottom_left_pole_point_27 = Point.ByCoordinates(x=center_guide_points_27.out0, y=center_guide_points_27.out1, z=center_guide_points_27.out2)
center_guide_points_28 = CodeBlock { 4500; -4500; 1500; }
bottom_left_pole_point_28 = Point.ByCoordinates(x=center_guide_points_28.out0, y=center_guide_points_28.out1, z=center_guide_points_28.out2)
center_guide_points_29 = CodeBlock { 4500; -4500; 2000; }
bottom_left_pole_point_29 = Point.ByCoordinates(x=center_guide_points_29.out0, y=center_guide_points_29.out1, z=center_guide_points_29.out2)
center_guide_points_30 = CodeBlock { 4600; -4600; 3000; }
bottom_left_pole_point_30 = Point.ByCoordinates(x=center_guide_points_30.out0, y=center_guide_points_30.out1, z=center_guide_points_30.out2)
center_guide_points_31 = CodeBlock { 4750; -4750; 4000; }
bottom_left_pole_point_31 = Point.ByCoordinates(x=center_guide_points_31.out0, y=center_guide_points_31.out1, z=center_guide_points_31.out2)
center_guide_points_32 = CodeBlock { 4750; -4750; 4050; }
bottom_left_pole_point_32 = Point.ByCoordinates(x=center_guide_points_32.out0, y=center_guide_points_32.out1, z=center_guide_points_32.out2)
bottom_left_pole_points_4 = List.Create(item0=bottom_left_pole_point_25, item1=bottom_left_pole_point_26, item2=bottom_left_pole_point_27, item3=bottom_left_pole_point_28, item4=bottom_left_pole_point_29, item5=bottom_left_pole_point_30, item6=bottom_left_pole_point_31, item7=bottom_left_pole_point_32)
pole_center_line_4 = NurbsCurve.ByPoints(points=bottom_left_pole_points_4)
hollow_steel_support_pole_2 = Solid.BySweep(profile=byWidthLength_4, path=pole_center_line_4)
volume_4 = Solid.Volume(solid=hollow_steel_support_pole_2)
support_pole_materal_volume_mm_2_3 = Watch(volume_4)
code_block_12 = CodeBlock { -4750; -4750; 4200; }
byCoordinates_11 = Point.ByCoordinates(x=code_block_12.out0, y=code_block_12.out1, z=code_block_12.out2)
center_guide_points_33 = CodeBlock { 4750; -4750; 4200; }
bottom_left_pole_point_33 = Point.ByCoordinates(x=center_guide_points_33.out0, y=center_guide_points_33.out1, z=center_guide_points_33.out2)
wood_roof_pole_diamter = DoubleSlider(164, range=50..250 step 1)
roof_pieces = Python()  # CPython3; unwired: IN[0]
# ---------- roof_pieces.python (14 lines) ----------
# Load the Python Standard and DesignScript Libraries
import sys
import clr
clr.AddReference('ProtoGeometry')
from Autodesk.DesignScript.Geometry import *

class RoofPiece:
    def __init__(self, bottom_point, top_point, radius):
        self.bottom = bottom_point
        self.top = top_point
        self.radius = radius
    def make_roofpiece(self):
        return Cylinder.ByPointsRadius(self.bottom, self.top, self.radius)
OUT = RoofPiece
# ----------------------------------------
wood_roof_rod = Python(IN[0]=byCoordinates_11, IN[1]=bottom_left_pole_point_33, IN[2]=wood_roof_pole_diamter, IN[3]=roof_pieces)  # CPython3
# ---------- wood_roof_rod.python (3 lines) ----------
RoofPiece = IN[3]
b = RoofPiece(IN[0],IN[1],IN[2])
OUT = b.make_roofpiece()
# ----------------------------------------
volume_5 = Solid.Volume(solid=wood_roof_rod)
wood_roof_support_materal_volume = Watch(volume_5)  # "wood roof support materal volume (mm^2)"
