# Dynamo graph 1807543.dyn (Dynamo 3.6.0.9395)

# group: Ground Square
code_block = CodeBlock { -5000; -5000; -200; }
byCoordinates = Point.ByCoordinates(x=code_block.out0, y=code_block.out1, z=code_block.out2)
code_block_2 = CodeBlock { 5000; 5000; 0; }
byCoordinates_2 = Point.ByCoordinates(x=code_block_2.out0, y=code_block_2.out1, z=code_block_2.out2)
byCorners = Cuboid.ByCorners(lowPoint=byCoordinates, highPoint=byCoordinates_2)
code_block_3 = CodeBlock { 0; 100; 0; }
byARGB = Color.ByARGB(red=code_block_3.out0, green=code_block_3.out1, blue=code_block_3.out2)
byGeometryColor = Modifiers.GeometryColor.ByGeometryColor(geometry=byCorners, color=byARGB)

# group: Pillars
height_of_pillars = DoubleSlider(4000, range=1000..15000 step 100)
height_of_center_pillar = DoubleSlider(3000, range=1000..15000 step 100)
code_block_4 = CodeBlock { -4000; }
amount_of_pillars = IntegerSlider(3, range=2..10 step 1)
pillar_spacing = DoubleSlider(4000, range=0..8000 step 100)
sequence = Sequence(start=code_block_4, amount=amount_of_pillars, step=pillar_spacing)
code_block_5 = CodeBlock { 4000; 0; }
pillars1BottomPoints = Point.ByCoordinates(x=sequence, y=code_block_5.out0, z=code_block_5.out1)
code_block_6 = CodeBlock { -4000; }
sequence_2 = Sequence(start=code_block_6, amount=amount_of_pillars, step=pillar_spacing)
pillars1TopPoints = Point.ByCoordinates(x=sequence_2, y=code_block_5.out0, z=height_of_pillars)
radius_of_pillars = DoubleSlider(300, range=0..2000 step 100)
code_block_7 = CodeBlock { 0; }
sequence_3 = Sequence(start=radius_of_pillars, amount=amount_of_pillars, step=code_block_7)
steel_pillar_class = Python()  # CPython3; unwired: IN[0]
# ---------- steel_pillar_class.python (32 lines) ----------
import clr
clr.AddReference('ProtoGeometry')
from Autodesk.DesignScript.Geometry import *

class SteelPillar:
    def __init__(self, bottom_point, top_point, radius):
        self.bottom = bottom_point
        self.top = top_point
        self.radius = radius
        
    def make_geometry(self):
        return Cylinder.ByPointsRadius(self.bottom, self.top, self.radius)

    def solid(self):
        cyl = self.make_geometry()
        return Solid.ByUnion([cyl])

    def volume(self):
        return self.solid().Volume

    def surface_area(self):
        s = self.solid()
        faces = s.Faces
        
        total_area = 0
        for f in faces:
            surf = f.SurfaceGeometry()
            total_area += surf.Area
        
        return total_area

OUT = SteelPillar
# ----------------------------------------
series_of_pillars_1 = Python(IN[0]=pillars1BottomPoints, IN[1]=pillars1TopPoints, IN[2]=sequence_3, IN[3]=steel_pillar_class)  # CPython3
# ---------- series_of_pillars_1.python (28 lines) ----------
SteelPillar = IN[3]
bottom_points = IN[0]
top_points = IN[1]
radii = IN[2]

pillars_geo = []
volumes = []
areas = []

count = min(len(bottom_points), len(top_points))

for i in range(count):
    r = radii[i] if i < len(radii) else radii[-1]
    btm = bottom_points[i]
    top = top_points[i]

    pillar = SteelPillar(btm, top, r)

    solid_geo = pillar.solid()
    pillars_geo.append(solid_geo)

    volumes.append(pillar.volume())
    areas.append(pillar.surface_area())

total_volume = sum(volumes)
total_area = sum(areas)

OUT = [pillars_geo, total_volume, total_area]
# ----------------------------------------
code_block_8 = CodeBlock { 1; }
getItemAtIndex = List.GetItemAtIndex(list=series_of_pillars_1, index=code_block_8)
pillars_1_volume = Watch(getItemAtIndex)
code_block_9 = CodeBlock { 2; }
getItemAtIndex_2 = List.GetItemAtIndex(list=series_of_pillars_1, index=code_block_9)
pillars_1_area = Watch(getItemAtIndex_2)
code_block_10 = CodeBlock { 0; 0; 0; }
byCoordinates_3 = Point.ByCoordinates(x=code_block_10.out0, y=code_block_10.out1, z=code_block_10.out2)
code_block_11 = CodeBlock { 0; 0; }
byCoordinates_4 = Point.ByCoordinates(x=code_block_11.out0, y=code_block_11.out1, z=height_of_center_pillar)
central_pillar = Python(IN[0]=byCoordinates_3, IN[1]=byCoordinates_4, IN[2]=radius_of_pillars, IN[3]=steel_pillar_class)  # CPython3
# ---------- central_pillar.python (13 lines) ----------
SteelPillar = IN[3]

bottom = IN[0]
top = IN[1]
radius = IN[2]

pillar = SteelPillar(bottom, top, radius)

geo = pillar.make_geometry()
vol = pillar.volume()
area = pillar.surface_area()

OUT = [geo, vol, area]
# ----------------------------------------
code_block_12 = CodeBlock { 1; }
getItemAtIndex_3 = List.GetItemAtIndex(list=central_pillar, index=code_block_12)
central_pillar_volume = Watch(getItemAtIndex_3)
code_block_13 = CodeBlock { 2; }
getItemAtIndex_4 = List.GetItemAtIndex(list=central_pillar, index=code_block_13)
central_pillar_surface_area = Watch(getItemAtIndex_4)
code_block_14 = CodeBlock { -4000; }
sequence_4 = Sequence(start=code_block_14, amount=amount_of_pillars, step=pillar_spacing)
code_block_15 = CodeBlock { 0; }
pillars2BottomPoints = Point.ByCoordinates(x=sequence_4, y=code_block_14, z=code_block_15)
code_block_16 = CodeBlock { -4000; }
sequence_5 = Sequence(start=code_block_16, amount=amount_of_pillars, step=pillar_spacing)
pillars2TopPoints = Point.ByCoordinates(x=sequence_5, y=code_block_16, z=height_of_pillars)
sequence_6 = Sequence(start=radius_of_pillars, amount=amount_of_pillars, step=code_block_7)
series_of_pillars_2 = Python(IN[0]=pillars2BottomPoints, IN[1]=pillars2TopPoints, IN[2]=sequence_6, IN[3]=steel_pillar_class)  # CPython3; same code as series_of_pillars_1
code_block_17 = CodeBlock { 2; }
getItemAtIndex_5 = List.GetItemAtIndex(list=series_of_pillars_2, index=code_block_17)
pillars_2_area = Watch(getItemAtIndex_5)
code_block_18 = CodeBlock { 1; }
getItemAtIndex_6 = List.GetItemAtIndex(list=series_of_pillars_2, index=code_block_18)
pillars_2_volume = Watch(getItemAtIndex_6)

# group: Timber Roof
timber_frame_class = Python()  # CPython3; unwired: IN[0]
# ---------- timber_frame_class.python (24 lines) ----------
# Load the Python Standard and DesignScript Libraries
import sys
import clr
clr.AddReference('ProtoGeometry')
from Autodesk.DesignScript.Geometry import *
import math

class TimberFrame:
    def __init__(self, centerline, radius):
        self.centerline = centerline
        self.radius = radius
   
    def endpoints(self):
        return self.centerline.StartPoint, self.centerline.EndPoint
        
    def make_geometry(self):
        end1, end2 = self.endpoints()
        
        return Cylinder.ByPointsRadius(end1,end2,self.radius)
        
    def measure_volume(self):
        end1, end2 = self.endpoints()
        return end1.DistanceTo(end2)*self.radius*self.radius*math.pi
OUT = TimberFrame
# ----------------------------------------
code_block_19 = CodeBlock { -3700; 4000; }
topLeft = Point.ByCoordinates(x=code_block_19.out0, y=code_block_19.out1, z=height_of_pillars)
code_block_20 = CodeBlock { 3700; 4000; }
topRight = Point.ByCoordinates(x=code_block_20.out0, y=code_block_20.out1, z=height_of_pillars)
pillars1 = Line.ByStartPointEndPoint(startPoint=topLeft, endPoint=topRight)
frame_radius = DoubleSlider(100, range=1..500 step 10)
pillars1_2 = Python(IN[0]=timber_frame_class, IN[1]=pillars1, IN[2]=frame_radius)  # CPython3
# ---------- pillars1_2.python (4 lines) ----------
TimberFrame = IN[0]
FrameMember = TimberFrame(IN[1],IN[2])

OUT = [FrameMember.make_geometry(), FrameMember.measure_volume()]
# ----------------------------------------
code_block_21 = CodeBlock { 0; 0; }
centerLeft = Point.ByCoordinates(x=code_block_21.out0, y=code_block_21.out1, z=height_of_center_pillar)
topLeft_2 = Line.ByStartPointEndPoint(startPoint=topLeft, endPoint=centerLeft)
top_left = Python(IN[0]=timber_frame_class, IN[1]=topLeft_2, IN[2]=frame_radius)  # CPython3; same code as pillars1_2
code_block_22 = CodeBlock { 0; 0; }
centerRight = Point.ByCoordinates(x=code_block_22.out0, y=code_block_22.out1, z=height_of_center_pillar)
topRight_2 = Line.ByStartPointEndPoint(startPoint=centerRight, endPoint=topRight)
top_right = Python(IN[0]=timber_frame_class, IN[1]=topRight_2, IN[2]=frame_radius)  # CPython3; same code as pillars1_2
code_block_23 = CodeBlock { -3700; -4000; }
bottomLeft = Point.ByCoordinates(x=code_block_23.out0, y=code_block_23.out1, z=height_of_pillars)
code_block_24 = CodeBlock { 3700; -4000; }
bottomRight = Point.ByCoordinates(x=code_block_24.out0, y=code_block_24.out1, z=height_of_pillars)
pillars2 = Line.ByStartPointEndPoint(startPoint=bottomLeft, endPoint=bottomRight)
pillars2_2 = Python(IN[0]=timber_frame_class, IN[1]=pillars2, IN[2]=frame_radius)  # CPython3; same code as pillars1_2
bottomLeft_2 = Line.ByStartPointEndPoint(startPoint=bottomLeft, endPoint=centerLeft)
bottom_left = Python(IN[0]=timber_frame_class, IN[1]=bottomLeft_2, IN[2]=frame_radius)  # CPython3; same code as pillars1_2
bottomRight_2 = Line.ByStartPointEndPoint(startPoint=centerRight, endPoint=bottomRight)
bottom_right = Python(IN[0]=timber_frame_class, IN[1]=bottomRight_2, IN[2]=frame_radius)  # CPython3; same code as pillars1_2
number_slider = DoubleSlider(10, range=0..20 step 1)
code_block_25 = CodeBlock(n=number_slider) { n; 0..1..#n; }
splitByParameter = Curve.SplitByParameter(curve=pillars1, parameters=code_block_25.out1)
endPoint = Curve.EndPoint(curve=splitByParameter)
code_block_26 = CodeBlock(n=number_slider) { n; 0..1..#n; }
splitByParameter_2 = Curve.SplitByParameter(curve=topLeft_2, parameters=code_block_26.out1)
endPoint_2 = Curve.EndPoint(curve=splitByParameter_2)
diagonal_1_top = Line.ByStartPointEndPoint(startPoint=endPoint, endPoint=endPoint_2)
code_block_27 = CodeBlock(n=number_slider) { n; 0..1..#n; }
splitByParameter_3 = Curve.SplitByParameter(curve=pillars2, parameters=code_block_27.out1)
endPoint_3 = Curve.EndPoint(curve=splitByParameter_3)
code_block_28 = CodeBlock(n=number_slider) { n; 0..1..#n; }
splitByParameter_4 = Curve.SplitByParameter(curve=bottomLeft_2, parameters=code_block_28.out1)
endPoint_4 = Curve.EndPoint(curve=splitByParameter_4)
diagonal_1_top_2 = Line.ByStartPointEndPoint(startPoint=endPoint_3, endPoint=endPoint_4)
list_create = List.Create(item0=diagonal_1_top, item1=diagonal_1_top_2)
python_script = Python(IN[0]=timber_frame_class, IN[1]=list_create, IN[2]=frame_radius)  # CPython3
# ---------- python_script.python (22 lines) ----------
TimberFrame = IN[0]
lines = IN[1]
radius = IN[2]

def convert(item):
    tf = TimberFrame(item, radius)
    return tf.make_geometry(), tf.measure_volume()

def walk(data):
    if isinstance(data, list):
        geos = []
        vols = []
        for d in data:
            g, v = walk(d)
            geos.append(g)
            vols.append(v)
        return geos, vols
    else:
        return convert(data)

geos, vols = walk(lines)
OUT = (geos, vols)
# ----------------------------------------
