# Dynamo graph 1809199.dyn (Dynamo 3.6.0.9395)

# group: Don't touch this ground
code_block = CodeBlock { -5000; -5000; -200; }
byCoordinates = Point.ByCoordinates(x=code_block.out0, y=code_block.out1, z=code_block.out2)
code_block_2 = CodeBlock { 5000; 5000; 0; }
byCoordinates_2 = Point.ByCoordinates(x=code_block_2.out0, y=code_block_2.out1, z=code_block_2.out2)
byCorners = Cuboid.ByCorners(lowPoint=byCoordinates, highPoint=byCoordinates_2)
code_block_3 = CodeBlock { 0; 100; 0; }
byARGB = Color.ByARGB(red=code_block_3.out0, green=code_block_3.out1, blue=code_block_3.out2)
byGeometryColor = Modifiers.GeometryColor.ByGeometryColor(geometry=byCorners, color=byARGB)

class_steel_rod = Python()  # CPython3; unwired: IN[0]
# ---------- class_steel_rod.python (17 lines) ----------
# Load the Python Standard and DesignScript Libraries
import math
import sys
import clr
clr.AddReference('ProtoGeometry')
from Autodesk.DesignScript.Geometry import *
class SteelRod:
    def __init__(self, curve, radius):
        self.start = curve.StartPoint
        self.end = curve.EndPoint
        self.radius = radius
        self.length = self.start.DistanceTo(self.end)
    def make_geometry(self):
        return Cylinder.ByPointsRadius(self.start, self.end, self.radius)
    def volume(self):
        return math.pi * (self.radius ** 2) * self.length
OUT = SteelRod
# ----------------------------------------
xlength = CodeBlock { -5000; 5000; }
n4_line_spacer = IntegerSlider(1000, range=500..1000 step 100)  # "4. Line Spacer"
XRange = Range(start=xlength.out0, end=xlength.out1, step=n4_line_spacer)
n5_curvature_of_parabola = IntegerSlider(80, range=80..100 step 1)  # "5. Curvature of Parabola"
x_and_z_points = CodeBlock(xpoint=XRange, a=n5_curvature_of_parabola) { xpoint; zmax = List.MaximumItem(xpoint); offset = Math.Pow(zmax/a,2); point = xpoint/a; z1 = -Math.Pow(point,2)+offset; }
n1_ymin = IntegerSlider(-5000, range=-5000..0 step 1000)  # "1. Ymin"
n2_ymax = IntegerSlider(5000, range=0..5000 step 1000)  # "2. Ymax"
n3_number_of_parabolas = IntegerSlider(1000, range=700..1000 step 100)  # "3. Number of Parabolas"
YRange = Range(start=n1_ymin, end=n2_ymax, step=n3_number_of_parabolas)
points = Python(IN[0]=x_and_z_points.xpoint, IN[1]=YRange, IN[2]=x_and_z_points.z1)  # CPython3
# ---------- points.python (19 lines) ----------
# Load the Python Standard and DesignScript Libraries
import sys
import clr
clr.AddReference('ProtoGeometry')
from Autodesk.DesignScript.Geometry import Point

xList = IN[0]
yList = IN[1]
zList = IN[2]
result = []

for y in yList:
    curve_points = []
    for x, z in zip(xList, zList):
        pt = Point.ByCoordinates(x, y, z)
        curve_points.append(pt)
    result.append(curve_points)

OUT = result
# ----------------------------------------
lines = Python(IN[0]=points)  # CPython3
# ---------- lines.python (30 lines) ----------
# Load the Python Standard and DesignScript Libraries
import sys
import clr
clr.AddReference('ProtoGeometry')
from Autodesk.DesignScript.Geometry import Line


points = IN[0]      

parabolaLines = []        
crossLines = []          

#ALONG EACH PARABOLA
for curvePts in points:       
    for i in range(len(curvePts)-1):
        l = Line.ByStartPointEndPoint(curvePts[i], curvePts[i+1])
        parabolaLines.append(l)

#BETWEEN PARABOLAS
for row in range(len(points)-1):
    ptsA = points[row]
    ptsB = points[row+1]
    
    count = min(len(ptsA), len(ptsB))
    
    for i in range(count):
        l = Line.ByStartPointEndPoint(ptsA[i], ptsB[i])
        crossLines.append(l)

OUT = parabolaLines + crossLines
# ----------------------------------------
n6_radius_of_steelrod = IntegerSlider(70, range=70..120 step 10)  # "6. Radius of SteelRod"
series_of_instances_of_steel_rod = Python(IN[0]=class_steel_rod, IN[1]=lines, IN[2]=n6_radius_of_steelrod)  # CPython3
# ---------- series_of_instances_of_steel_rod.python (11 lines) ----------
SteelRod = IN[0]    
lines     = IN[1]    
radius    = IN[2]   

rods = []
volumes = []
for l in lines:
    rod = SteelRod(l, radius)
    rods.append(rod.make_geometry())
    volumes.append(rod.volume())
OUT = rods, volumes
# ----------------------------------------
steel_rod_volume_calculations = Python(IN[0]=series_of_instances_of_steel_rod)  # CPython3
# ---------- steel_rod_volume_calculations.python (4 lines) ----------
data = IN[0]
volumes = data[1]
total_volumes = sum(volumes)
OUT = total_volumes
# ----------------------------------------
steel_rod_volume_mm_2 = Watch(steel_rod_volume_calculations)
class_cedar_support_beam = Python()  # CPython3; unwired: IN[0]
# ---------- class_cedar_support_beam.python (19 lines) ----------
# Load the Python Standard and DesignScript Libraries
import sys
import clr
clr.AddReference('ProtoGeometry')
from Autodesk.DesignScript.Geometry import *
class WoodenSupportBeam:
    def __init__(self, origin, width, length, height):
        self.origin = origin
        self.width = width
        self.length = length
        self.height = height

    def make_geometry(self):
        return Cuboid.ByLengths(self.origin, self.width, self.length, self.height)
        
    def volume(self):
        return self.width * self.length * self.height
        
OUT = WoodenSupportBeam
# ----------------------------------------
middle_point = CodeBlock(PointTop=x_and_z_points.offset) { PointTop; 0; PointMid = PointTop/2; }
middle_points = Point.ByCoordinates(x=middle_point.out1, y=YRange, z=middle_point.PointMid)
n7_length_of_beam = IntegerSlider(100, range=50..100 step 10)  # "7. Length of beam"
n8_width_of_beam = IntegerSlider(100, range=50..100 step 10)  # "8. Width of beam"
series_of_instances_of_cedar = Python(IN[0]=class_cedar_support_beam, IN[1]=middle_points, IN[2]=n7_length_of_beam, IN[3]=n8_width_of_beam, IN[4]=middle_point.PointTop)  # "Series of instances of Cedar Support Beam"; CPython3
# ---------- series_of_instances_of_cedar.python (13 lines) ----------
WoodenSupportBeam = IN[0]
origins = IN[1] 
width   = IN[2]
length  = IN[3]
height  = IN[4]

beams = []
volumes = []
for o in origins:
    b = WoodenSupportBeam(o, width, length, height)
    beams.append(b.make_geometry())
    volumes.append(b.volume())
OUT = beams, volumes
# ----------------------------------------
cedar_support_beam_volume = Python(IN[0]=series_of_instances_of_cedar)  # "Cedar Support Beam Volume Calculations"; CPython3; same code as steel_rod_volume_calculations
cedar_support_beam_volume_mm_2 = Watch(cedar_support_beam_volume)
