# Dynamo graph 1810164.dyn (Dynamo 3.6.0.9395)

code_block = CodeBlock { -5000; -5000; -200; }
byCoordinates = Point.ByCoordinates(x=code_block.out0, y=code_block.out1, z=code_block.out2)
code_block_2 = CodeBlock { 5000; 5000; 0; }
byCoordinates_2 = Point.ByCoordinates(x=code_block_2.out0, y=code_block_2.out1, z=code_block_2.out2)
byCorners = Cuboid.ByCorners(lowPoint=byCoordinates, highPoint=byCoordinates_2)
code_block_3 = CodeBlock { 0; 100; 0; }
byARGB = Color.ByARGB(red=code_block_3.out0, green=code_block_3.out1, blue=code_block_3.out2)
byGeometryColor = Modifiers.GeometryColor.ByGeometryColor(geometry=byCorners, color=byARGB)
tent_length = DoubleSlider(8000, range=5000..9000 step 100)
tent_width = DoubleSlider(6500, range=5000..8000 step 100)
tent_height = DoubleSlider(4500, range=3000..6000 step 100)
post_thickness = DoubleSlider(200, range=100..300 step 10)
python_script = Python(IN[0]=tent_length, IN[1]=tent_width, IN[2]=tent_height, IN[3]=post_thickness)  # CPython3
# ---------- python_script.python (96 lines) ----------
import clr # THIS MUST BE THE FIRST LINE

# Import Geometry library
clr.AddReference('ProtoGeometry')
from Autodesk.DesignScript.Geometry import *

# --- CLASS DEFINITIONS ---

class TentPost:
    """Class for the structural wood columns at the ends"""
    def __init__(self, base_point, height, radius):
        self.base = base_point
        self.h = height
        self.r = radius
        self.geometry = None
        self.volume = 0
    
    def create(self):
        # Create the top point based on height
        top_point = Point.ByCoordinates(self.base.X, self.base.Y, self.base.Z + self.h)
        # Create Cylinder
        self.geometry = Cylinder.ByPointsRadius(self.base, top_point, self.r)
        self.volume = self.geometry.Volume
        return self.geometry

class TentCanopy:
    """Class for the fabric draped over the ridge"""
    def __init__(self, ridge_start, ridge_end, width):
        self.p1 = ridge_start # Top of Post 1
        self.p2 = ridge_end   # Top of Post 2
        self.w = width
        self.geometry = [] # Will hold a list of solids
        self.volume = 0
        
    def create(self):
        # 1. Define the 4 corners of the "Ground" footprint
        base_L_start = Point.ByCoordinates(self.p1.X - self.w/2, self.p1.Y, 0)
        base_L_end = Point.ByCoordinates(self.p2.X - self.w/2, self.p2.Y, 0)
        
        base_R_start = Point.ByCoordinates(self.p1.X + self.w/2, self.p1.Y, 0)
        base_R_end = Point.ByCoordinates(self.p2.X + self.w/2, self.p2.Y, 0)
        
        # 2. Create the two sloped surfaces SEPARATELY
        slope_left = Surface.ByPerimeterPoints([self.p1, self.p2, base_L_end, base_L_start])
        slope_right = Surface.ByPerimeterPoints([self.p1, self.p2, base_R_end, base_R_start])
        
        # 3. Thicken them individually
        solid_left = slope_left.Thicken(20)
        solid_right = slope_right.Thicken(20)
        
        # 4. Save results (return a single list of the two solids)
        self.geometry = [solid_left, solid_right]
        
        # Sum the volume of both sides
        self.volume = solid_left.Volume + solid_right.Volume
        return self.geometry # Returns the list of two solids

# --- INPUTS ---
length = IN[0]
width = IN[1]
height = IN[2]
post_r = IN[3]

# --- MAIN LOGIC ---

post_instances = []
total_wood_vol = 0

# 1. Define Positions for the Two Columns
y_offset = length / 2.0

pos1 = Point.ByCoordinates(0, -y_offset, 0) # Front Post Base
pos2 = Point.ByCoordinates(0, y_offset, 0)  # Back Post Base

# 2. Instantiate and Create the Two Posts
post_locations = [pos1, pos2]

for loc in post_locations:
    # Create Instance
    post_obj = TentPost(loc, height, post_r)
    # Generate Geometry
    post_instances.append(post_obj.create())
    # Add Volume
    total_wood_vol += post_obj.volume

# 3. Create the Canopy
ridge_pt1 = Point.ByCoordinates(0, -y_offset, height)
ridge_pt2 = Point.ByCoordinates(0, y_offset, height)

canopy_obj = TentCanopy(ridge_pt1, ridge_pt2, width)
canopy_geo = canopy_obj.create()
canopy_vol = canopy_obj.volume

# --- OUTPUT ---
# canopy_geo is now a list of two solids, which is handled correctly by the Code Block
OUT = [[post_instances, canopy_geo], total_wood_vol, canopy_vol]
# ----------------------------------------
code_block_4 = CodeBlock(data=python_script) { data[0][0]; data[0][1]; data[1]; data[2]; }
color_palette = ColorPalette({R: 215, G: 214, B: 23, A: 255})
byGeometryColor_2 = Modifiers.GeometryColor.ByGeometryColor(geometry=code_block_4.out0, color=color_palette)
color_palette_2 = ColorPalette({R: 0, G: 254, B: 63, A: 255})
byGeometryColor_3 = Modifiers.GeometryColor.ByGeometryColor(geometry=code_block_4.out1, color=color_palette_2)
watch = Watch(code_block_4.out2)
watch_2 = Watch(code_block_4.out3)
