# Dynamo graph 1810326.dyn (Dynamo 4.0.0.3277)

# group: Don't touch this ground
code_block = CodeBlock { -5000; -5000; -200; }  # frozen
byCoordinates = Point.ByCoordinates(x=code_block.out0, y=code_block.out1, z=code_block.out2)  # frozen
code_block_2 = CodeBlock { 5000; 5000; 0; }  # frozen
byCoordinates_2 = Point.ByCoordinates(x=code_block_2.out0, y=code_block_2.out1, z=code_block_2.out2)  # frozen
byCorners = Cuboid.ByCorners(lowPoint=byCoordinates, highPoint=byCoordinates_2)  # frozen
code_block_3 = CodeBlock { 0; 100; 0; }  # frozen
byARGB = Color.ByARGB(red=code_block_3.out0, green=code_block_3.out1, blue=code_block_3.out2)  # frozen
byGeometryColor = Modifiers.GeometryColor.ByGeometryColor(geometry=byCorners, color=byARGB)  # frozen

outer_arc_origin = CodeBlock { 0; 0; 0; }
outer_arc_origin_2 = Point.ByCoordinates(x=outer_arc_origin.out0, y=outer_arc_origin.out1, z=outer_arc_origin.out2)
outer_arc_x_start_points = CodeBlock { -3300; -3300; 0; }
outer_arc_start_point = Point.ByCoordinates(x=outer_arc_x_start_points.out0, y=outer_arc_x_start_points.out1, z=outer_arc_x_start_points.out2)
outer_arc_x_end_points = CodeBlock { 3300; 3300; 0; }
outer_arc_end_point = Point.ByCoordinates(x=outer_arc_x_end_points.out0, y=outer_arc_x_end_points.out1, z=outer_arc_x_end_points.out2)
outer_arc_line = Arc.ByCenterPointStartPointEndPoint(centerPoint=outer_arc_origin_2, startPoint=outer_arc_start_point, endPoint=outer_arc_end_point)
number_of_outer_vertical_rods = DoubleSlider(21, range=4..30 step 1)
code_block_4 = CodeBlock(n=number_of_outer_vertical_rods) { n; 0..1..#n; }
origin_of_outer_vertical_rods = Curve.PointAtParameter(curve=outer_arc_line, param=code_block_4.out1)
outer_arc_x_points = Point.X(point=origin_of_outer_vertical_rods)
outer_arc_y_points = Point.Y(point=origin_of_outer_vertical_rods)
outer_arc_lower_z_point = Point.Z(point=origin_of_outer_vertical_rods)
outer_inner_arc_points = Point.ByCoordinates(x=outer_arc_x_points, y=outer_arc_y_points, z=outer_arc_lower_z_point)
outer_rod_height_upper_z_points = DoubleSlider(7100, range=6000..8000 step 100)
outer_inner_arc_points_2 = Point.ByCoordinates(x=outer_arc_x_points, y=outer_arc_y_points, z=outer_rod_height_upper_z_points)
radius_of_outer_rods = CodeBlock { 100; 0; }
defining_the_radii_of_the_outer = Sequence(start=radius_of_outer_rods.out0, amount=number_of_outer_vertical_rods, step=radius_of_outer_rods.out1)  # "Defining the Radii of the Outer Rods"
class_circular_steel_rod_outer = Python()  # PythonNet3; unwired: IN[0]
# ---------- class_circular_steel_rod_outer.python (17 lines) ----------
# Load the Python Standard and DesignScript Libraries
import sys
import clr
clr.AddReference('ProtoGeometry')
from Autodesk.DesignScript.Geometry import *

class CircularRod:
    def __init__(self, bottom_point, top_point, radius):
        self.bottom = bottom_point
        self.top = top_point
        self.radius = radius
        
    def make_geometry(self): 
        return Cylinder.ByPointsRadius(self.bottom, self.top, self.radius)
        
OUT = CircularRod
        
# ----------------------------------------
series_of_instances_of_outer = Python(IN[0]=outer_inner_arc_points, IN[1]=outer_inner_arc_points_2, IN[2]=defining_the_radii_of_the_outer, IN[3]=class_circular_steel_rod_outer)  # "Series of Instances of Outer Circular Steel Rods"; PythonNet3
# ---------- series_of_instances_of_outer.python (30 lines) ----------
SteelCircularRod = IN[3]
bottom_points = IN[0]
top_points = IN[1]
radii = IN[2]

rods = []
count = min(len(bottom_points), len(top_points))

for i in range(count):
    r = radii[i] if i < len(radii) else radii[-1]
    btm = bottom_points[i]
    top = top_points[i]
    
    rod = SteelCircularRod(btm, top, r)
    rods.append(rod.make_geometry())

volumes = []

for rod_geometry in rods:
    try:
        volumes.append(rod_geometry.Volume)
    except:
        volumes.append(0.0)

total_volume = sum(volumes)

unit = "mm³"  
total_volume_label = "{:.2f} {}".format(total_volume, unit)

OUT = [rods, total_volume_label]
# ----------------------------------------
code_block_5 = CodeBlock { 1; }
getItemAtIndex = List.GetItemAtIndex(list=series_of_instances_of_outer, index=code_block_5)
volume_of_outer_circular_steel = Watch(getItemAtIndex)  # "Volume of Outer Circular Steel Rods"
inner_arc_origin = CodeBlock { 0; 0; 0; }
inner_arc_origin_2 = Point.ByCoordinates(x=inner_arc_origin.out0, y=inner_arc_origin.out1, z=inner_arc_origin.out2)
inner_arc_start_points = CodeBlock { 1600; 1600; 0; }
inner_arc_start_point = Point.ByCoordinates(x=inner_arc_start_points.out0, y=inner_arc_start_points.out1, z=inner_arc_start_points.out2)
inner_arc_end_points = CodeBlock { -1600; -1600; 0; }
inner_arc_end_point = Point.ByCoordinates(x=inner_arc_end_points.out0, y=inner_arc_end_points.out1, z=inner_arc_end_points.out2)
inner_arc_line = Arc.ByCenterPointStartPointEndPoint(centerPoint=inner_arc_origin_2, startPoint=inner_arc_start_point, endPoint=inner_arc_end_point)
number_of_inner_vertical_rods = DoubleSlider(13, range=4..15 step 1)
code_block_6 = CodeBlock(n=number_of_inner_vertical_rods) { n; 0..1..#n; }
origin_of_inner_vertical_rods = Curve.PointAtParameter(curve=inner_arc_line, param=code_block_6.out1)  # graph output
inner_arc_x_points = Point.X(point=origin_of_inner_vertical_rods)
inner_arc_y_points = Point.Y(point=origin_of_inner_vertical_rods)
inner_arc_lower_z_point = Point.Z(point=origin_of_inner_vertical_rods)
lower_inner_arc_points = Point.ByCoordinates(x=inner_arc_x_points, y=inner_arc_y_points, z=inner_arc_lower_z_point)
inner_rod_height_upper_z_points = DoubleSlider(5200, range=4000..6000 step 100)
upper_inner_arc_points = Point.ByCoordinates(x=inner_arc_x_points, y=inner_arc_y_points, z=inner_rod_height_upper_z_points)
radius_of_inner_rods = CodeBlock { 100; 0; }
defining_the_radii_of_the_inner = Sequence(start=radius_of_inner_rods.out0, amount=number_of_inner_vertical_rods, step=radius_of_inner_rods.out1)  # "Defining the Radii of the Inner Rods"
class_circular_steel_rod_inner = Python()  # PythonNet3; unwired: IN[0]
# ---------- class_circular_steel_rod_inner.python (20 lines) ----------
# Load the Python Standard and DesignScript Libraries
import sys
import clr
clr.AddReference('ProtoGeometry')
from Autodesk.DesignScript.Geometry import *

class SteelCircularRod:
    def __init__(self, bottom_point, top_point, radius):
        self.bottom = bottom_point
        self.top = top_point
        self.radius = radius
        
    def make_geometry(self): 
        return Cylinder.ByPointsRadius(self.bottom, self.top, self.radius)
   
    def volume(self):
        return self.make_geometry().Volume
           
OUT = SteelCircularRod
        
# ----------------------------------------
series_of_instances_of_inner = Python(IN[0]=lower_inner_arc_points, IN[1]=upper_inner_arc_points, IN[2]=defining_the_radii_of_the_inner, IN[3]=class_circular_steel_rod_inner)  # "Series of Instances of Inner Circular Steel Rods"; PythonNet3; same code as series_of_instances_of_outer
selecting_volume_index = CodeBlock { 1; }
getItemAtIndex_2 = List.GetItemAtIndex(list=series_of_instances_of_inner, index=selecting_volume_index)
volume_of_inner_circular_steel = Watch(getItemAtIndex_2)  # "Volume of Inner Circular Steel Rods"
center_line_for_outer_rods = CodeBlock(H=outer_rod_height_upper_z_points) { 0; 0; H; }  # "Center Line for Outer Rods Aluminum Roof"
outer_aluminum_roof_start_point = Point.ByCoordinates(x=center_line_for_outer_rods.out0, y=center_line_for_outer_rods.out1, z=center_line_for_outer_rods.H)
aluminum_roof_thickness = DoubleSlider(50, range=10..100 step 10)
center_line_for_outer_rods_2 = CodeBlock(H=outer_rod_height_upper_z_points, T=aluminum_roof_thickness) { 0; 0; H+T; }  # "Center Line for Outer Rods Aluminum Roof"
outer_aluminum_roof_end_point = Point.ByCoordinates(x=center_line_for_outer_rods_2.out0, y=center_line_for_outer_rods_2.out1, z=center_line_for_outer_rods_2.out2)
aluminum_roof_radius = CodeBlock { 4700; }
class_aluminum_roof = Python()  # PythonNet3; unwired: IN[0]
# ---------- class_aluminum_roof.python (16 lines) ----------
# Load the Python Standard and DesignScript Libraries
import sys
import clr
clr.AddReference('ProtoGeometry')
from Autodesk.DesignScript.Geometry import *

class AluminumRoof:
    def __init__(self, bottom_point, top_point, radius):
        self.bottom = bottom_point
        self.top = top_point
        self.radius = radius
        
    def make_geometry(self): 
        return Cylinder.ByPointsRadius(self.bottom, self.top, self.radius)
        
OUT = AluminumRoof
# ----------------------------------------
singular_instance_for_aluminum = Python(IN[0]=outer_aluminum_roof_start_point, IN[1]=outer_aluminum_roof_end_point, IN[2]=aluminum_roof_radius, IN[3]=class_aluminum_roof)  # "Singular Instance for Aluminum Roof"; PythonNet3
# ---------- singular_instance_for_aluminum.python (13 lines) ----------
AluminumRoof = IN[3]
b = AluminumRoof(IN[0], IN[1], IN[2])
roof = b.make_geometry()

try:
    volume = roof.Volume
except:
    volume = 0.0
    
unit = "mm³" 
volume_label = "{:.2f}{}".format(volume, unit)

OUT = [roof, volume_label]
# ----------------------------------------
code_block_7 = CodeBlock { 1; }
getItemAtIndex_3 = List.GetItemAtIndex(list=singular_instance_for_aluminum, index=code_block_7)
volume_of_aluminum_roof = Watch(getItemAtIndex_3)
