# Dynamo graph 1812450.dyn "Dynamo home assignment" (Dynamo 3.6.0.9395)

# group: Don't touch this ground
code_block = CodeBlock { -5000; -5000; -200; }
byCoordinates = Point.ByCoordinates(x=code_block.out0, y=code_block.out1, z=code_block.out2)
code_block_2 = CodeBlock { 5000; 5000; 0; }
byCoordinates_2 = Point.ByCoordinates(x=code_block_2.out0, y=code_block_2.out1, z=code_block_2.out2)
byCorners = Cuboid.ByCorners(lowPoint=byCoordinates, highPoint=byCoordinates_2)
code_block_3 = CodeBlock { 0; 100; 0; }
byARGB = Color.ByARGB(red=code_block_3.out0, green=code_block_3.out1, blue=code_block_3.out2)
byGeometryColor = Modifiers.GeometryColor.ByGeometryColor(geometry=byCorners, color=byARGB)

steelroofpanel_class = Python()  # CPython3; unwired: IN[0]
# ---------- steelroofpanel_class.python (26 lines) ----------
import clr
clr.AddReference('ProtoGeometry')
from Autodesk.DesignScript.Geometry import *

class SteelRoofPanel:
    def __init__(self, corner_points, thickness):
        self.corner_points = corner_points
        self.thickness = thickness
    
    def generate_geometry(self):
        try:
            if len(self.corner_points) < 3:
                return None
            surface = Surface.ByPerimeterPoints(self.corner_points)
            return surface.Thicken(self.thickness, True)
        except:
            return None
    
    def compute_volume(self):
        try:
            surface = Surface.ByPerimeterPoints(self.corner_points)
            return surface.Area * 1000000 * self.thickness
        except:
            return 12000 * self.thickness

OUT = SteelRoofPanel
# ----------------------------------------
timbercolumn_class = Python()  # CPython3; unwired: IN[0]
# ---------- timbercolumn_class.python (22 lines) ----------
import clr
clr.AddReference('ProtoGeometry')
from Autodesk.DesignScript.Geometry import *

class TimberColumn:
    def __init__(self, position, height, diameter):
        self.position = position
        self.height = height
        self.diameter = diameter
    
    def generate_geometry(self):
        try:
            base_point = Point.ByCoordinates(self.position.X, self.position.Y, 0)
            return Cylinder.ByPointsHeight(base_point, self.height, self.diameter/2)
        except:
            return None
    
    def compute_volume(self):
        import math
        return math.pi * (self.diameter/2)**2 * self.height

OUT = TimberColumn
# ----------------------------------------
column_count = DoubleSlider(12, range=4..12 step 1)
roof_height = DoubleSlider(3100, range=1500..3500 step 100)
roof_density = DoubleSlider(45, range=3..45 step 1)
base_radius = DoubleSlider(4400, range=3000..5000 step 100)
main_geometry = Python(IN[0]=column_count, IN[1]=roof_height, IN[2]=roof_density, IN[3]=base_radius)  # CPython3
# ---------- main_geometry.python (129 lines) ----------
import clr
clr.AddReference('ProtoGeometry')
from Autodesk.DesignScript.Geometry import *
import math

# Get inputs DIRECTLY from sliders
col_count = int(IN[0])
roof_height = IN[1]
density = int(IN[2])
radius = IN[3]
column_radius = 100  # Fixed column radius

# Generate column base positions (ON THE GROUND)
angles = [i * (360.0/col_count) for i in range(col_count)]
column_positions = []
vertical_columns = []

for angle in angles:
    rad = math.radians(angle)
    x = radius * math.cos(rad)
    y = radius * math.sin(rad)
    base_point = Point.ByCoordinates(x, y, 0)
    column_positions.append(base_point)
    
    # CREATE VERTICAL CYLINDRICAL COLUMNS
    coordinate_system = CoordinateSystem.ByOrigin(base_point)
    column = Cylinder.ByRadiusHeight(coordinate_system, column_radius, roof_height)
    vertical_columns.append(column)

# Generate roof ring positions
roof_rings = []
for level in range(density + 1):
    level_ratio = level / float(density)
    
    # Roof gets smaller as it goes up
    current_radius = radius * (1 - level_ratio * 0.5)
    
    # Roof height increases from column tops to center
    if level == 0:
        level_height = roof_height  # Bottom ring at column top
    else:
        level_height = roof_height + (level_ratio * 1500)  # Slope upward
    
    ring_points = []
    for angle in angles:
        rad = math.radians(angle)
        x = current_radius * math.cos(rad)
        y = current_radius * math.sin(rad)
        ring_points.append(Point.ByCoordinates(x, y, level_height))
    roof_rings.append(ring_points)

# Generate beam lines
horizontal_beams = []
vertical_beams = []
diagonal_supports = []

# Horizontal beams (around each ring)
for ring in roof_rings:
    for i in range(len(ring)):
        start = ring[i]
        end = ring[(i + 1) % len(ring)]
        horizontal_beams.append([start, end])

# Vertical beams (between rings)
for ring_idx in range(len(roof_rings) - 1):
    current_ring = roof_rings[ring_idx]
    next_ring = roof_rings[ring_idx + 1]
    for i in range(len(current_ring)):
        start = current_ring[i]
        end = next_ring[i]
        vertical_beams.append([start, end])

# Diagonal supports from columns to roof
for i, col_pos in enumerate(column_positions):
    # Column top point
    col_top = Point.ByCoordinates(col_pos.X, col_pos.Y, roof_height)
    
    # Connect to roof point above for support
    if i % 2 == 0:  # Every other column gets diagonal brace
        roof_point = roof_rings[1][i] if len(roof_rings) > 1 else roof_rings[0][i]
        diagonal_supports.append([col_top, roof_point])

# GENERATE COMPLETE ROOF PANELS - NO GAPS
roof_panels = []

# NEW: Add center point for dome completion
center_height = roof_height + 1500  # Peak height
center_point = Point.ByCoordinates(0, 0, center_height)

# Method 1: Create triangular panels between all rings
for ring_idx in range(len(roof_rings) - 1):
    current_ring = roof_rings[ring_idx]
    next_ring = roof_rings[ring_idx + 1]
    
    for i in range(len(current_ring)):
        next_i = (i + 1) % len(current_ring)
        
        # Create two triangles to form a quadrilateral
        triangle1 = [current_ring[i], current_ring[next_i], next_ring[i]]
        triangle2 = [current_ring[next_i], next_ring[next_i], next_ring[i]]
        
        roof_panels.append(triangle1)
        roof_panels.append(triangle2)

# NEW: Create top cap panels to cover the center
if len(roof_rings) > 0:
    top_ring = roof_rings[-1]  # The highest ring
    
    for i in range(len(top_ring)):
        next_i = (i + 1) % len(top_ring)
        
        # Create triangular panels from top ring to center point
        top_triangle = [top_ring[i], top_ring[next_i], center_point]
        roof_panels.append(top_triangle)

# NEW: Create side panels to cover gaps between bottom ring and columns
bottom_ring = roof_rings[0]  # The lowest ring (at column tops)
for i in range(len(bottom_ring)):
    next_i = (i + 1) % len(bottom_ring)
    
    # Create vertical side panels between roof edge and columns
    column_top = Point.ByCoordinates(column_positions[i].X, column_positions[i].Y, roof_height)
    next_column_top = Point.ByCoordinates(column_positions[next_i].X, column_positions[next_i].Y, roof_height)
    
    side_panel = [column_top, next_column_top, bottom_ring[next_i], bottom_ring[i]]
    roof_panels.append(side_panel)

# SINGLE OUTPUT as list
OUT = [vertical_columns, column_positions, horizontal_beams, vertical_beams, diagonal_supports, roof_panels]
# ----------------------------------------
code_block_4 = CodeBlock { 0; 1; 2; 3; }
column_position = List.GetItemAtIndex(list=main_geometry, index=code_block_4.out0)
code_block_5 = CodeBlock()
# ---------- code_block_5.designscript (4 lines) ----------
// Fixed Dimensions
Column_Diameter = 200;
Beam_Width = 120;
Beam_Height = 80;
# ----------------------------------------
column_instances = Python(IN[0]=timbercolumn_class, IN[1]=column_position, IN[2]=roof_height, IN[3]=code_block_5.Column_Diameter)  # CPython3
# ---------- column_instances.python (20 lines) ----------
TimberClass = IN[0]
positions = IN[1]
height = IN[2]
diameter = IN[3]

geometries = []
total_volume = 0

if positions and len(positions) > 0:
    for pos in positions:
        try:
            col = TimberClass(pos, height, diameter)
            geo = col.generate_geometry()
            if geo:
                geometries.append(geo)
            total_volume += col.compute_volume()
        except:
            continue

OUT = geometries, total_volume
# ----------------------------------------
steelbeam_class = Python()  # CPython3; unwired: IN[0]
# ---------- steelbeam_class.python (25 lines) ----------
import clr
clr.AddReference('ProtoGeometry')
from Autodesk.DesignScript.Geometry import *

class RectangularBeam:
    def __init__(self, start_point, end_point, width, height):
        self.start_point = start_point
        self.end_point = end_point
        self.width = width
        self.height = height
        self.length = start_point.DistanceTo(end_point)
    
    def generate_geometry(self):
        try:
            direction = Vector.ByTwoPoints(self.start_point, self.end_point)
            plane = Plane.ByOriginNormal(self.start_point, direction)
            rectangle = Rectangle.ByWidthLength(plane, self.width, self.height)
            return rectangle.Extrude(direction, self.length)
        except:
            return None
    
    def compute_volume(self):
        return self.width * self.height * self.length

OUT = RectangularBeam
# ----------------------------------------
diagonal_support = List.GetItemAtIndex(list=main_geometry, index=code_block_4.out3)
diagonalsuppport_instance = Python(IN[0]=steelbeam_class, IN[1]=diagonal_support, IN[2]=code_block_5.Beam_Width, IN[3]=code_block_5.Beam_Height)  # CPython3
# ---------- diagonalsuppport_instance.python (21 lines) ----------
BeamClass = IN[0]
beam_lines = IN[1]
beam_width = IN[2]
beam_height = IN[3]

geometries = []
total_volume = 0

if beam_lines and len(beam_lines) > 0:
    for line in beam_lines:
        try:
            if len(line) == 2:
                beam = BeamClass(line[0], line[1], beam_width, beam_height)
                geo = beam.generate_geometry()
                if geo:
                    geometries.append(geo)
                total_volume += beam.compute_volume()
        except:
            continue

OUT = geometries, total_volume
# ----------------------------------------
horizontal_beam = List.GetItemAtIndex(list=main_geometry, index=code_block_4.out1)
horizontalbeam_instance = Python(IN[0]=steelbeam_class, IN[1]=horizontal_beam, IN[2]=code_block_5.Beam_Width, IN[3]=code_block_5.Beam_Height)  # CPython3; same code as diagonalsuppport_instance
vertical_beam = List.GetItemAtIndex(list=main_geometry, index=code_block_4.out2)
verticalbeam_instance = Python(IN[0]=steelbeam_class, IN[1]=vertical_beam, IN[2]=code_block_5.Beam_Width, IN[3]=code_block_5.Beam_Height)  # CPython3; same code as diagonalsuppport_instance
code_block_6 = CodeBlock(col_vol=column_instances, support_vol=diagonalsuppport_instance, beam_h_vol=horizontalbeam_instance, beam_v_vol=verticalbeam_instance)
# ---------- code_block_6.designscript (5 lines) ----------
Timber = col_vol + support_vol;
Steel = beam_h_vol + beam_v_vol;

"TIMBER: " + Timber + " mm³";
"STEEL: " + Steel + " mm³";
# ----------------------------------------
watch = Watch(code_block_6.out2)
watch_2 = Watch(code_block_6.out3)
