# Dynamo graph 1813046.dyn (Dynamo 4.0.0.3277)

# group: Don't touch this ground
code_block = CodeBlock { -5000; -5000; -200; }
byCoordinates = Point.ByCoordinates(x=code_block.out0, y=code_block.out1, z=code_block.out2)
code_block_2 = CodeBlock { 5000; 5000; 0; }
byCoordinates_2 = Point.ByCoordinates(x=code_block_2.out0, y=code_block_2.out1, z=code_block_2.out2)
byCorners = Cuboid.ByCorners(lowPoint=byCoordinates, highPoint=byCoordinates_2)
code_block_3 = CodeBlock { 0; 100; 0; }
byARGB = Color.ByARGB(red=code_block_3.out0, green=code_block_3.out1, blue=code_block_3.out2)
byGeometryColor = Modifiers.GeometryColor.ByGeometryColor(geometry=byCorners, color=byARGB)

number = DoubleInput(300)
number_2 = DoubleInput(300)
column_height = DoubleSlider(4000, range=2000..4500 step 100)
byLengths = Cuboid.ByLengths(width=number, length=number_2, height=column_height)
pavillion_length = DoubleSlider(5600, range=3000..8000 step 100)
number_3 = DoubleInput(2)
halfL = pavillion_length / number_3
number_4 = DoubleInput(-1)
HL = halfL * number_4
pavillion_width = DoubleSlider(7800, range=3000..8000 step 100)
halfW = pavillion_width / number_3
HW = halfW * number_4
number_5 = DoubleInput(0)
translate = Geometry.Translate(geometry=byLengths, xTranslation=HL, yTranslation=HW, zTranslation=number_5)
translate_2 = Geometry.Translate(geometry=byLengths, xTranslation=halfL, yTranslation=HW, zTranslation=number_5)
translate_3 = Geometry.Translate(geometry=byLengths, xTranslation=HL, yTranslation=halfW, zTranslation=number_5)
translate_4 = Geometry.Translate(geometry=byLengths, xTranslation=halfL, yTranslation=halfW, zTranslation=number_5)
number_6 = DoubleInput(250)
number_7 = DoubleInput(230)
byLengths_2 = Cuboid.ByLengths(width=number_6, length=pavillion_width, height=number_7)
number_8 = DoubleInput(0)
number_9 = DoubleInput(2000)
sub = number_9 - number_7
translate_5 = Geometry.Translate(geometry=byLengths_2, xTranslation=HL, yTranslation=number_8, zTranslation=sub)
translate_6 = Geometry.Translate(geometry=byLengths_2, xTranslation=halfL, yTranslation=number_8, zTranslation=sub)
list_create = List.Create(item0=translate, item1=translate_2, item2=translate_3, item3=translate_4, item4=translate_5, item5=translate_6)
material_1_columns_and_beams = Python(IN[0]=list_create)  # PythonNet3
# ---------- material_1_columns_and_beams.python (33 lines) ----------
import clr
clr.AddReference("ProtoGeometry")
from Autodesk.DesignScript.Geometry import *

# List of parts from the input
Parts = IN[0]

# Defining a class to store material information
class Material1:
    
    def __init__(self, g):
        self.g = g

    # Method must be indented inside the class
    def volume(self):
        return self.g.Volume

objects = []
vols = []

# Go through each part in the list
for p in Parts:
    # Create a new material object
    obj = Material1(p)
    objects.append(obj)
    # Calculate volume and save it (indentation fixed)
    vols.append(obj.volume())

# Add all volumes together
total = sum(vols)

# Send the results to the output
OUT = objects, vols,["Material 1 total volume(mm^2)", total]
# ----------------------------------------
watch = Watch(material_1_columns_and_beams)
slat_length = DoubleSlider(6200, range=3000..8000 step 100)
slat_width = DoubleSlider(210, range=100..800 step 10)
slat_thickness = DoubleSlider(210, range=50..500 step 10)
byLengths_3 = Cuboid.ByLengths(width=slat_length, length=slat_width, height=slat_thickness)
number_10 = DoubleInput(0)
number_11 = DoubleInput(-0.475)
mul = pavillion_width * number_11
num_slats = DoubleSlider(20, range=1..30 step 1)
div = pavillion_width / num_slats
sequence = Sequence(start=mul, amount=num_slats, step=div)
translate_7 = Geometry.Translate(geometry=byLengths_3, xTranslation=number_10, yTranslation=sequence, zTranslation=number_9)
list_create_2 = List.Create(item0=translate_7)
material_2_slat = Python(IN[0]=list_create_2)  # PythonNet3
# ---------- material_2_slat.python (31 lines) ----------
import clr
clr.AddReference('ProtoGeometry')
from Autodesk.DesignScript.Geometry import *

#List for the Slats 
slat_list = IN[0]
#class representing the one roof slat element 

class Slat:
    def __init__(self, geometry):
        self.geometry = geometry
       

    def volume(self):
        return self.geometry.Volume
#returning the volume from the dynamo geometry 
slat_objects = []
vols = []

for s in slat_list:
    #if the item is list go through its element 
    if isinstance(s, list):
        s = s[0]

    obj = Slat(s)
    slat_objects.append(obj)
    vols.append(obj.volume())
#Total Volume for Material 2 
total = sum(vols)
#Output= Objecxts, volumes, total
OUT = slat_objects, vols,["Material 2 total volume(mm^2)", total]
# ----------------------------------------
watch_2 = Watch(material_2_slat)
