# Dynamo graph 1814548#.dyn (Dynamo 3.6.1.9895)

code_block = CodeBlock { -5000; -5000; -200; }
byCoordinates = Point.ByCoordinates(x=code_block.out0, y=code_block.out1, z=code_block.out2)
code_block_2 = CodeBlock { 5000; 5000; 0; }
byCoordinates_2 = Point.ByCoordinates(x=code_block_2.out0, y=code_block_2.out1, z=code_block_2.out2)
byCorners = Cuboid.ByCorners(lowPoint=byCoordinates, highPoint=byCoordinates_2)
code_block_3 = CodeBlock { 0; 100; 0; }
byARGB = Color.ByARGB(red=code_block_3.out0, green=code_block_3.out1, blue=code_block_3.out2)
byGeometryColor = Modifiers.GeometryColor.ByGeometryColor(geometry=byCorners, color=byARGB)
width = DoubleSlider(5750, range=3000..9000 step 250)
depth = DoubleSlider(8000, range=3000..9000 step 250)
overhang = DoubleSlider(550, range=0..1000 step 50)
roof_thickness = DoubleSlider(100, range=100..600 step 25)
post_height = DoubleSlider(2300, range=2000..4000 step 100)
post_radius = DoubleSlider(80, range=80..250 step 10)
python_script = Python(IN[0]=width, IN[1]=depth, IN[2]=overhang, IN[3]=roof_thickness, IN[4]=post_height, IN[5]=post_radius)  # CPython3
# ---------- python_script.python (96 lines) ----------
import clr
clr.AddReference('ProtoGeometry')
from Autodesk.DesignScript.Geometry import *

# ---------- CLASSES ----------

class SteelRoof(object):
    """
    Rectangular flat roof made of steel.
    width, depth, thickness in mm.
    center_pt is the geometric center of the slab.
    """
    def __init__(self, center_pt, width, depth, thickness):
        self.center_pt = center_pt
        self.width = width
        self.depth = depth
        self.thickness = thickness

    def make_geometry(self):
        # local coordinate system at center point
        cs = CoordinateSystem.ByOrigin(self.center_pt)
        # Cuboid is centered on the coordinate system origin
        roof = Cuboid.ByLengths(cs, self.width, self.depth, self.thickness)
        return roof

    def volume(self):
        return self.make_geometry().Volume


class TimberPost(object):
    """
    Vertical timber post, circular cross-section.
    base_pt is the point on the ground.
    """
    def __init__(self, base_pt, height, radius):
        self.base_pt = base_pt
        self.height = height
        self.radius = radius

    def make_geometry(self):
        top_pt = Point.ByCoordinates(
            self.base_pt.X,
            self.base_pt.Y,
            self.base_pt.Z + self.height
        )
        post = Cylinder.ByPointsRadius(self.base_pt, top_pt, self.radius)
        return post

    def volume(self):
        return self.make_geometry().Volume

# ---------- INPUTS ----------

width      = IN[0]    # between posts in X
depth      = IN[1]    # between posts in Y
overhang   = IN[2]
roof_thk   = IN[3]
post_h     = IN[4]
post_r     = IN[5]

# ---------- ROOF INSTANCE (STEEL) ----------

roof_width  = width  + 2 * overhang
roof_depth  = depth  + 2 * overhang

# center of the slab: just above top of posts
roof_center = Point.ByCoordinates(0, 0, post_h + roof_thk / 2.0)

steel_roof = SteelRoof(roof_center, roof_width, roof_depth, roof_thk)
roof_solid = steel_roof.make_geometry()
roof_vol   = steel_roof.volume()

# ---------- POST INSTANCES (TIMBER) ----------

half_w = width / 2.0
half_d = depth / 2.0

base_points = [
    Point.ByCoordinates(-half_w, -half_d, 0),
    Point.ByCoordinates( half_w, -half_d, 0),
    Point.ByCoordinates( half_w,  half_d, 0),
    Point.ByCoordinates(-half_w,  half_d, 0)
]

posts = [TimberPost(pt, post_h, post_r) for pt in base_points]

post_solids = [p.make_geometry() for p in posts]
post_vols   = [p.volume() for p in posts]
total_post_vol = sum(post_vols)

# ---------- OUTPUT ----------
# OUT[0] -> roof solid
# OUT[1] -> list of post solids (series of instances)
# OUT[2] -> roof volume (steel) in mm^3
# OUT[3] -> total timber volume in mm^3
OUT = (roof_solid, post_solids, roof_vol, total_post_vol)
# ----------------------------------------
number = DoubleInput(0)
getItemAtIndex = List.GetItemAtIndex(list=python_script, index=number)
code_block_4 = CodeBlock { 255; 180; 180; 180; }
byARGB_2 = Color.ByARGB(alpha=code_block_4.out0, red=code_block_4.out1, green=code_block_4.out2, blue=code_block_4.out3)
byGeometryColor_2 = Modifiers.GeometryColor.ByGeometryColor(geometry=getItemAtIndex, color=byARGB_2)
number_2 = DoubleInput(1)
getItemAtIndex_2 = List.GetItemAtIndex(list=python_script, index=number_2)
code_block_5 = CodeBlock { 255; 160; 110; 60; }
byARGB_3 = Color.ByARGB(alpha=code_block_5.out0, red=code_block_5.out1, green=code_block_5.out2, blue=code_block_5.out3)
byGeometryColor_3 = Modifiers.GeometryColor.ByGeometryColor(geometry=getItemAtIndex_2, color=byARGB_3)
number_3 = DoubleInput(2)
getItemAtIndex_3 = List.GetItemAtIndex(list=python_script, index=number_3)
steel_volume_mm_3 = Watch(getItemAtIndex_3)
number_4 = DoubleInput(3)
getItemAtIndex_4 = List.GetItemAtIndex(list=python_script, index=number_4)
timber_volume_mm_3 = Watch(getItemAtIndex_4)
