# Dynamo graph 1816613.dyn (Dynamo 4.0.0.3277)

# group: Don't touch this ground
code_block = CodeBlock { -5000; -5000; -200; }  # frozen
byCoordinates = Point.ByCoordinates(x=code_block.out0, y=code_block.out1, z=code_block.out2)  # frozen
code_block_2 = CodeBlock { 5000; 5000; 0; }  # frozen
byCoordinates_2 = Point.ByCoordinates(x=code_block_2.out0, y=code_block_2.out1, z=code_block_2.out2)  # frozen
byCorners = Cuboid.ByCorners(lowPoint=byCoordinates, highPoint=byCoordinates_2)  # frozen
code_block_3 = CodeBlock { 0; 100; 0; }  # frozen
byARGB = Color.ByARGB(red=code_block_3.out0, green=code_block_3.out1, blue=code_block_3.out2)  # frozen
byGeometryColor = Modifiers.GeometryColor.ByGeometryColor(geometry=byCorners, color=byARGB)  # frozen

H = DoubleSlider(3000, range=1800..4000 step 1)
A = DoubleSlider(2500, range=500..5000 step 1)
L = DoubleSlider(9000, range=6000..9000 step 1)
W = DoubleSlider(8000, range=4000..8000 step 1)
nFrameLine = DoubleSlider(9, range=5..13 step 1)
code_block_4 = CodeBlock(H=H, A=A, L=L, W=W, nFrameLine=nFrameLine)
# ---------- code_block_4.designscript (32 lines) ----------
xCount = 40;
  // number of sample points along each FrameLine;

// force these to become inputs on the node
Variable = [H, A];

FrameLinePoints =
[Imperative]
{
    FrameLine = [];

    // sample positions along X and across Y (ribs)
    xs = -L/2..L/2..#xCount;
    ys = -W/2..W/2..#nFrameLine;

    // for each FrameLine (each Y)
    for (y in ys)
    {
        pts = [];
        // points along that FrameLine (varying X)
        for (x in xs)
        {
            zValue = H + A * Math.Sin(5*Math.PI * x / L) * Math.Cos(70*Math.PI * y / W);
            p = Point.ByCoordinates(x, y, zValue);
            pts = List.AddItemToEnd(p, pts);
        }
        FrameLine = List.AddItemToEnd(pts, FrameLine);
    }

    return = FrameLine;
    // [ [Point,Point,...], [Point,...], ... ];
};
# ----------------------------------------
byPoints = NurbsCurve.ByPoints(points=code_block_4.FrameLinePoints)
byLoft = Surface.ByLoft(crossSections=byPoints)
frameLineThickness = DoubleSlider(200, range=20..400 step 1)
thicken = Surface.Thicken(surface=byLoft, thickness=frameLineThickness)
roof_volume_mm_3 = Solid.Volume(solid=thicken)
material_1_volume_mm_3 = Watch(roof_volume_mm_3)
code_block_5 = CodeBlock(L=L, W=W, H=H)
# ---------- code_block_5.designscript (14 lines) ----------
// corner posts on the ground (z = 0)
p1 = Point.ByCoordinates(-L/2, -W/2, 0);
p2 = Point.ByCoordinates( L/2, -W/2, 0);
p3 = Point.ByCoordinates( L/2,  W/2, 0);
p4 = Point.ByCoordinates(-L/2,  W/2, 0);

basePoints = [p1, p2, p3, p4];

// top of the posts at height H
topPoints = Point.ByCoordinates(
    basePoints.X,
    basePoints.Y,
    1.05*H
);
# ----------------------------------------
byStartPointEndPoint = Line.ByStartPointEndPoint(startPoint=code_block_5.basePoints, endPoint=code_block_5.topPoints)
legRadius = DoubleSlider(200, range=60..200 step 1)
byPointsRadius = Cylinder.ByPointsRadius(startPoint=code_block_5.basePoints, endPoint=code_block_5.topPoints, radius=legRadius)
leg_volume_mm_3 = Solid.Volume(solid=byPointsRadius)
material_2_volume = Watch(leg_volume_mm_3)
sum = Math.Sum(values=material_2_volume)
material_2_volume_mm_3 = Watch(sum)
class_steel_circular_post = Python(IN[0]=code_block_5.basePoints, IN[1]=code_block_5.topPoints, IN[2]=legRadius)  # "Class: Steel Circular Post (Matrial 2)"; PythonNet3
# ---------- class_steel_circular_post.python (47 lines) ----------
# Load the Python Standard and DesignScript Libraries
import sys
import clr
clr.AddReference('ProtoGeometry')
from Autodesk.DesignScript.Geometry import Cylinder

# The inputs to this node will be stored as a list in the IN variables.
dataEnteringNode = IN

# Place your code below this line

import math

class CylPost(object):
    def __init__(self, start_point, end_point, radius):
        self.start = start_point
        self.end = end_point
        self.radius = radius

    def create_geometry(self):
        # generates the cylinder geometry in Dynamo
        return Cylinder.ByPointsRadius(self.start, self.end, self.radius)

    def compute_volume(self):
        solid = self.create_geometry()
        return solid, solid.Volume


# --- INPUTS FROM DYNAMO ---
bases = IN[0]   # list of base points
tops  = IN[1]   # list of top points
radius = IN[2]  # single radius for all posts

posts_geometry = []
posts_volumes  = []

# make one instance per base/top pair
for b, t in zip(bases, tops):
    post = CylPost(b, t, radius)
    solid, vol = post.compute_volume()
    posts_geometry.append(solid)
    posts_volumes.append(vol)

total_volume = sum(posts_volumes)

# OUT[0] = geometries, OUT[1] = list of volumes, OUT[2] = total volume
OUT = posts_geometry, posts_volumes, total_volume
# ----------------------------------------
code_block_6 = CodeBlock { 0; 1; 2; }
getItemAtIndex = List.GetItemAtIndex(list=class_steel_circular_post, index=code_block_6.out0)
cylinder_geometry = Watch(getItemAtIndex)
getItemAtIndex_2 = List.GetItemAtIndex(list=class_steel_circular_post, index=code_block_6.out1)
post_volume_mm_3 = Watch(getItemAtIndex_2)
getItemAtIndex_3 = List.GetItemAtIndex(list=class_steel_circular_post, index=code_block_6.out2)
total_post_volume_mm_3 = Watch(getItemAtIndex_3)
class_timber_beam_roof_material = Python(IN[0]=thicken)  # "Class: Timber Beam Roof (Material 1)"; PythonNet3
# ---------- class_timber_beam_roof_material.python (39 lines) ----------
# Load the Python Standard and DesignScript Libraries
import sys
import clr
clr.AddReference('ProtoGeometry')
from Autodesk.DesignScript.Geometry import Solid

# The inputs to this node will be stored as a list in the IN variables.
dataEnteringNode = IN

# Place your code below this line

class TimberBeam(object):
    def __init__(self, solids, name="Roof shell"):
        # solids can be a single solid or a list
        if isinstance(solids, list):
            self.solids = solids
        else:
            self.solids = [solids]
        self.name = name

    def create_geometry(self):
        # here geometry is already made upstream; we just pass it through
        return self.solids

    def compute_volume(self):
        total = 0.0
        for s in self.solids:
            if s is not None:
                total += s.Volume
        return total


roof_input = IN[0]

roof = TimberBeam(roof_input)
roof_geometry = roof.create_geometry()
roof_volume   = roof.compute_volume()

OUT = roof_geometry, roof_volume
# ----------------------------------------
code_block_7 = CodeBlock { 1; }
getItemAtIndex_4 = List.GetItemAtIndex(list=class_timber_beam_roof_material, index=code_block_7)
total_roof_volume_mm_3 = Watch(getItemAtIndex_4)
code_block_8 = CodeBlock { 255; 200; 160; 110; }
byARGB_2 = Color.ByARGB(alpha=code_block_8.out0, red=code_block_8.out1, green=code_block_8.out2, blue=code_block_8.out3)
byGeometryColor_2 = Modifiers.GeometryColor.ByGeometryColor(geometry=thicken, color=byARGB_2)
transpose = List.Transpose(lists=code_block_4.FrameLinePoints)
byPoints_2 = NurbsCurve.ByPoints(points=transpose)
