# Dynamo graph 1818645.dyn (Dynamo 3.6.0.9395)

code_block = CodeBlock { -5000; -5000; -200; }
byCoordinates = Point.ByCoordinates(x=code_block.out0, y=code_block.out1, z=code_block.out2)
code_block_2 = CodeBlock { 5000; 5000; 0; }
byCoordinates_2 = Point.ByCoordinates(x=code_block_2.out0, y=code_block_2.out1, z=code_block_2.out2)
byCorners = Cuboid.ByCorners(lowPoint=byCoordinates, highPoint=byCoordinates_2)
code_block_3 = CodeBlock { 0; 100; 0; }
byARGB = Color.ByARGB(red=code_block_3.out0, green=code_block_3.out1, blue=code_block_3.out2)
byGeometryColor = Modifiers.GeometryColor.ByGeometryColor(geometry=byCorners, color=byARGB)

# group: Wooden roof
radius = DoubleSlider(4900, range=4000..8000 step 100)
thickness = DoubleSlider(410, range=400..700 step 10)
code_block_4 = CodeBlock { 0; 0; 1000; }
byCoordinates_3 = Point.ByCoordinates(x=code_block_4.out0, y=code_block_4.out1, z=code_block_4.out2)
dome_roof = Python(IN[0]=radius, IN[1]=thickness, IN[2]=byCoordinates_3)  # CPython3
# ---------- dome_roof.python (31 lines) ----------
# Load the Python Standard and DesignScript Libraries
import sys
import clr
clr.AddReference('ProtoGeometry')
from Autodesk.DesignScript.Geometry import *

R = IN[0]          
t = IN[1]          
center = IN[2] if IN[2] else Point.ByCoordinates(0,0,0)


if t >= R:
    t = R * 0.5

R_inner = R - t


outer_sphere = Sphere.ByCenterPointRadius(center, R)
inner_sphere = Sphere.ByCenterPointRadius(center, R_inner)


result = outer_sphere.Difference(inner_sphere)


if isinstance(result, list):
    hollow_sphere = result[0]
else:
    hollow_sphere = result


OUT = hollow_sphere
# ----------------------------------------
code_block_5 = CodeBlock { 0; 0; -1000; }
byCoordinates_4 = Point.ByCoordinates(x=code_block_5.out0, y=code_block_5.out1, z=code_block_5.out2)
code_block_6 = CodeBlock { 9990; }
code_block_7 = CodeBlock { 10000; }
code_block_8 = CodeBlock { 8000; }
byLengths = Cuboid.ByLengths(origin=byCoordinates_4, width=code_block_6, length=code_block_7, height=code_block_8)
difference = Solid.Difference(solid=dome_roof, other=byLengths)
dome_roof_volume_calculation = Python(IN[0]=radius, IN[1]=thickness, IN[2]=byCoordinates_3)  # CPython3
# ---------- dome_roof_volume_calculation.python (21 lines) ----------
# Load the Python Standard and DesignScript Libraries
import sys
import clr
clr.AddReference('ProtoGeometry')
from Autodesk.DesignScript.Geometry import *
import math

R = IN[0]          
t = IN[1]          
center = IN[2] if IN[2] else Point.ByCoordinates(0,0,0)


if t >= R:
    t = R * 0.5

R_inner = R - t

total_volume = (4.0/3.0)*math.pi*(R**3 - R_inner**3)
vol = "{0:.2f} mm^3".format(total_volume)

OUT = vol
# ----------------------------------------
code_block_9 = CodeBlock { 0; }
getItemAtIndex = List.GetItemAtIndex(list=dome_roof_volume_calculation, index=code_block_9)
volume_of_dome_roof = Watch(getItemAtIndex)

# group: Cylinder posts
bottom_points = CodeBlock { -3000; 2; 6000; }
sequence = Sequence(start=bottom_points.out0, amount=bottom_points.out1, step=bottom_points.out2)
code_block_10 = CodeBlock { -3000; 0; }
byCoordinates_5 = Point.ByCoordinates(x=sequence, y=code_block_10.out0, z=code_block_10.out1)
code_block_11 = CodeBlock { -3000; 3000; }
byCoordinates_6 = Point.ByCoordinates(x=sequence, y=code_block_11.out0, z=code_block_11.out1)
bottom_points_2 = CodeBlock { 200; 2; 0; }
sequence_2 = Sequence(start=bottom_points_2.out0, amount=bottom_points_2.out1, step=bottom_points_2.out2)
class_cylinder_post = Python()  # CPython3; unwired: IN[0]
# ---------- class_cylinder_post.python (18 lines) ----------
# Load the Python Standard and DesignScript Libraries
import sys
import clr
clr.AddReference('ProtoGeometry')
from Autodesk.DesignScript.Geometry import *

class CylinderPost:
    def __init__(self, bottom_point, top_point, radius):
        self.bottom = bottom_point
        self.top = top_point
        self.radius = radius
        
    def make_geometry(self):
        return Cylinder.ByPointsRadius(self.bottom, self.top, self.radius)

        
OUT = CylinderPost
        
# ----------------------------------------
series_of_instances_of_steel = Python(IN[0]=byCoordinates_5, IN[1]=byCoordinates_6, IN[2]=sequence_2, IN[3]=class_cylinder_post)  # "Series of Instances of steel cylinder posts"; CPython3
# ---------- series_of_instances_of_steel.python (26 lines) ----------
CylinderPost = IN[3]
bottom_points = IN[0]
top_points = IN[1]
radii = IN[2]

posts = []
volumes = []
count = min(len(bottom_points),len(top_points))

for i in range(count):
    rad = radii[i] if i < len(radii) else radii[-1]
    bot = bottom_points[i]
    top = top_points[i]
    r = radii[i]
    
    post = CylinderPost(bot, top, r)
    geo = post.make_geometry()
    posts.append(geo)
    
    try:
        total_volume_label = "{0:.2f} mm^3".format(geo.Volume)
        volumes.append(total_volume_label)
    except:
        volumes.append(None)
    
OUT = posts, volumes
# ----------------------------------------
code_block_12 = CodeBlock { 1; }
getItemAtIndex_2 = List.GetItemAtIndex(list=series_of_instances_of_steel, index=code_block_12)
cylinder_posts_volume = Watch(getItemAtIndex_2)
bottom_points_3 = CodeBlock { -3000; 2; 6000; }
sequence_3 = Sequence(start=bottom_points_3.out0, amount=bottom_points_3.out1, step=bottom_points_3.out2)
code_block_13 = CodeBlock { 3000; 0; }
byCoordinates_7 = Point.ByCoordinates(x=sequence_3, y=code_block_13.out0, z=code_block_13.out1)
code_block_14 = CodeBlock { 3000; 3000; }
byCoordinates_8 = Point.ByCoordinates(x=sequence_3, y=code_block_14.out0, z=code_block_14.out1)
series_of_instances_of_steel_2 = Python(IN[0]=byCoordinates_7, IN[1]=byCoordinates_8, IN[2]=sequence_2, IN[3]=class_cylinder_post)  # "Series of Instances of steel cylinder posts"; CPython3; same code as series_of_instances_of_steel
code_block_15 = CodeBlock { 1; }
getItemAtIndex_3 = List.GetItemAtIndex(list=series_of_instances_of_steel_2, index=code_block_15)
cylinder_post_volumes = Watch(getItemAtIndex_3)

# group: Wooden benches
start_points = CodeBlock { 3000; 0; 1000; }
byCoordinates_9 = Point.ByCoordinates(x=start_points.out0, y=start_points.out1, z=start_points.out2)
length = IntegerSlider(500, range=0..9000 step 500)
height_horizontal = DoubleSlider(6001, range=1..9000 step 1000)
vertical_width = DoubleSlider(201, range=1..1000 step 100)
class_woodcube = Python()  # CPython3; unwired: IN[0]
# ---------- class_woodcube.python (17 lines) ----------
# Load the Python Standard and DesignScript Libraries
import sys
import clr
clr.AddReference('ProtoGeometry')
from Autodesk.DesignScript.Geometry import *

import math
class WoodCube:
    def __init__(self, center, length, height, width):
        self.center = center
        self.length = length
        self.height = height
        self.width = width
    
    def make_geometry(self):
       return Cuboid.ByLengths(self.center, self.length, self.height, self.width)
OUT = WoodCube
# ----------------------------------------
instance_of_right_wooden_bench = Python(IN[0]=byCoordinates_9, IN[1]=length, IN[2]=height_horizontal, IN[3]=vertical_width, IN[4]=class_woodcube)  # CPython3
# ---------- instance_of_right_wooden_bench.python (17 lines) ----------
WoodCube = IN[4]
center = IN[0]
length = IN[1]
height = IN[2]
width = IN[3]
   
cube = WoodCube(center, length, height, width)

try:
    vol = length * height * width
    total_volume = "{0:.2f} mm³".format(vol)

except:
    total_volume = "None"
    
OUT = cube.make_geometry(), total_volume
#WoodCube.MeasureVol()    
# ----------------------------------------
code_block_16 = CodeBlock { 1; }
getItemAtIndex_4 = List.GetItemAtIndex(list=instance_of_right_wooden_bench, index=code_block_16)
volume_of_right_bench = Watch(getItemAtIndex_4)
start_points_2 = CodeBlock { -3000; 0; 1000; }
byCoordinates_10 = Point.ByCoordinates(x=start_points_2.out0, y=start_points_2.out1, z=start_points_2.out2)
instance_of_left_wooden_bench = Python(IN[0]=byCoordinates_10, IN[1]=length, IN[2]=height_horizontal, IN[3]=vertical_width, IN[4]=class_woodcube)  # CPython3
# ---------- instance_of_left_wooden_bench.python (16 lines) ----------
WoodCube = IN[4]
center = IN[0]
length = IN[1]
height = IN[2]
width = IN[3]
   
cube = WoodCube(center, length, height, width)

try:
    vol = length * height * width    
    total_volume = "{0:.2f} mm³".format(vol)

except:
    total_volume = "None"
    
OUT = cube.make_geometry(), total_volume
# ----------------------------------------
code_block_17 = CodeBlock { 1; }
getItemAtIndex_5 = List.GetItemAtIndex(list=instance_of_left_wooden_bench, index=code_block_17)
volume_of_left_bench = Watch(getItemAtIndex_5)
