# Dynamo graph 1819341.dyn (Dynamo 3.3.0.6316)

# group: Node group - ground
code_block = CodeBlock { -5000; -5000; -200; }
byCoordinates = Point.ByCoordinates(x=code_block.out0, y=code_block.out1, z=code_block.out2)
code_block_2 = CodeBlock { 5000; 5000; 0; }
byCoordinates_2 = Point.ByCoordinates(x=code_block_2.out0, y=code_block_2.out1, z=code_block_2.out2)
byCorners = Cuboid.ByCorners(lowPoint=byCoordinates, highPoint=byCoordinates_2)
code_block_3 = CodeBlock { 0; 100; 0; }
byARGB = Color.ByARGB(red=code_block_3.out0, green=code_block_3.out1, blue=code_block_3.out2)
byGeometryColor = Modifiers.GeometryColor.ByGeometryColor(geometry=byCorners, color=byARGB)

pavilion_length = DoubleSlider(10000, range=6000..10000 step 200)
pavilion_width = DoubleSlider(9000, range=6000..9000 step 500)
height = CodeBlock { 2700; }
number_of_beams = IntegerSlider(20, range=4..60 step 1)
frequency = CodeBlock { 15; }
class_series_timber_beams = Python(IN[0]=pavilion_length, IN[1]=pavilion_width, IN[2]=height, IN[3]=number_of_beams, IN[4]=frequency)  # CPython3
# ---------- class_series_timber_beams.python (108 lines) ----------
import sys
import clr
import math
clr.AddReference('ProtoGeometry')
from Autodesk.DesignScript.Geometry import *

# --- HELPER ---
def unwrap(item):
    if isinstance(item, list): return item[0]
    return item

# --- CLASS DEFINITION ---
class TimberBeam:
    def __init__(self, x, len, amp, freq, d, t, progress):
        self.x = x
        self.len = len
        self.amp = amp
        self.freq = freq
        self.depth = d
        self.thick = t
        self.prog = progress # 0.0 = Start, 1.0 = End
        self.top_curve = None 
        self.solid = None 

    def generate(self):
        bot_pts = []
        top_pts = []
        
        # High resolution for smooth morphing
        steps = 30 
        for i in range(steps + 1):
            t = i / float(steps)
            
            # --- 1. HORIZONTAL COMPLEXITY (The Hourglass) ---
            # We squeeze the Y-values in the middle of the tunnel
            # If beam is in the middle (prog=0.5), it gets narrower (0.6x width)
            waist_factor = 1.0 - (0.4 * math.sin(self.prog * math.pi))
            
            # Apply the squeeze to the Width (Y)
            raw_y = -self.len/2 + (self.len * t)
            y = raw_y * waist_factor
            
            # --- 2. VERTICAL COMPLEXITY (The Splitting) ---
            # Shape A: One single big arch (Sine Wave)
            shape_one = math.sin(t * math.pi)
            
            # Shape B: Two smaller arches (Double Sine)
            # We take Absolute value so it creates an 'M' shape
            shape_two = abs(math.sin(t * math.pi * 2))
            
            # MORPH: Linear Interpolation (Lerp)
            # We blend Shape A into Shape B based on progress down the tunnel
            # Start (0.0) = Mostly Shape A
            # End (1.0) = Mostly Shape B
            current_shape = (shape_one * (1 - self.prog)) + (shape_two * self.prog)
            
            # Final Z Height
            # We add some "Noise" texture too (using freq)
            texture = 100 * math.cos(t * math.pi * self.freq)
            z = 4000 + (self.amp * current_shape) + texture
            
            # Create Points
            bot_pts.append(Point.ByCoordinates(self.x, y, z))
            top_pts.append(Point.ByCoordinates(self.x, y, z + self.depth))
            
        c_bot = NurbsCurve.ByPoints(bot_pts)
        c_top = NurbsCurve.ByPoints(top_pts)
        self.top_curve = c_top
        
        surf = Surface.ByLoft([c_bot, c_top])
        self.solid = surf.Thicken(self.thick)
        return self.solid

    def get_vol(self):
        if self.solid: return self.solid.Volume
        return 0

# --- INPUTS ---
L = unwrap(IN[0])
W = unwrap(IN[1])
Amp = unwrap(IN[2])
Num = int(unwrap(IN[3])) 
Freq = unwrap(IN[4])

geom_list = []
obj_list = [] 
total_vol = 0

spacing = 0
if Num > 1: spacing = W / (Num - 1)

for i in range(Num):
    cur_x = -W/2 + (i * spacing)
    
    # CALCULATE PROGRESS (0.0 to 1.0)
    # This tells the beam where it lives in the tunnel
    progress = i / float(max(Num - 1, 1))
    
    # Create Instance (Passing 'progress' as a new argument)
    beam = TimberBeam(cur_x, L, Amp, Freq, 400, 150, progress)
    
    # Generate
    g = beam.generate()
    geom_list.append(g)
    obj_list.append(beam)
    total_vol += beam.get_vol()

OUT = [geom_list, obj_list, total_vol]
# ----------------------------------------
code_block_4 = CodeBlock(x=class_series_timber_beams) { x[2]; }
volume_of_timber_beams_mm3 = Watch(code_block_4)
class_definition_roof_panel = Python(IN[0]=class_series_timber_beams)  # CPython3
# ---------- class_definition_roof_panel.python (43 lines) ----------
import sys
import clr
clr.AddReference('ProtoGeometry')
from Autodesk.DesignScript.Geometry import *

# Class Definition: Roof Panel
class RoofPanel:
    def __init__(self, b1, b2):
        # Use curves from beam instances
        self.c1 = b1.top_curve
        self.c2 = b2.top_curve
        self.solid = None
        
    def generate(self):
        
        s = Surface.ByLoft([self.c1, self.c2])
        self.solid = s.Thicken(20) # 20mm panels
        return self.solid
        
    def get_vol(self):
        if self.solid: return self.solid.Volume
        return 0

# Input: List of Beam Instances
beam_objs = IN[0][1] 

panels = []
total_vol = 0

# Loop through beams to place panels
for i in range(len(beam_objs) - 1):
    b1 = beam_objs[i]
    b2 = beam_objs[i+1]
    
    # Create Instance
    p = RoofPanel(b1, b2)
    
    # Generate and Calc Volume
    panels.append(p.generate())
    total_vol += p.get_vol()

# Output: Geometry, Material Volume
OUT = [panels, total_vol]
# ----------------------------------------
code_block_5 = CodeBlock(x=class_definition_roof_panel) { x[1]; }
volume_of_polycarbonate_roof = Watch(code_block_5)  # "Volume of Polycarbonate Roof Panel (mm3)"
column_thickness = DoubleSlider(450, range=0..500 step 0.1)
steel_column = Python(IN[0]=pavilion_width, IN[1]=pavilion_length, IN[2]=height, IN[3]=column_thickness)  # CPython3
# ---------- steel_column.python (60 lines) ----------
import sys
import clr
import math
clr.AddReference('ProtoGeometry')
from Autodesk.DesignScript.Geometry import *

def val(x):
    if isinstance(x, list): return float(x[0])
    return float(x)


W_Tunnel = val(IN[0])
try: L_Span = val(IN[1])
except: L_Span = 8800
Amp = val(IN[2])
T = val(IN[3]) # BASE Diameter

cols = []
vol_total = 0 


x_positions = [-W_Tunnel/2.0, 0, W_Tunnel/2.0]

for x in x_positions:
    
    # 1. CALCULATE HEIGHT 
    progress = (x + (W_Tunnel/2.0)) / W_Tunnel
    
    # Base Height (Must match Beam Code)
    base_h = 4000 
    
    # Roof Shape Logic
    height_factor = 1.0 - progress
    roof_z = base_h + (Amp * height_factor)
    
    # Offset adjustment
    gap_fix = 50 
    col_height = roof_z + gap_fix
    
    
    
    
    
    pt_base = Point.ByCoordinates(x, 0, 0)
    circ_base = Circle.ByCenterPointRadiusNormal(pt_base, T/2.0, Vector.ZAxis())
    
    
    taper_factor = 0.6 
    
    pt_top = Point.ByCoordinates(x, 0, col_height)
    circ_top = Circle.ByCenterPointRadiusNormal(pt_top, (T/2.0) * taper_factor, Vector.ZAxis())
    
    
    solid = Solid.ByLoft([circ_base, circ_top])
    cols.append(solid)
    
    # Volume Math (Exact from Geometry)
    vol_total += solid.Volume

OUT = [cols, vol_total]
# ----------------------------------------
code_block_6 = CodeBlock(x=steel_column) { x[1]; }
volume_of_column_mm3 = Watch(code_block_6)
class_definition_steel_central = Python()  # "Class Definition: Steel Central Spine"; CPython3
# ---------- class_definition_steel_central.python (37 lines) ----------
import sys
import clr
import math

clr.AddReference('ProtoGeometry')
from Autodesk.DesignScript.Geometry import *

# CLASS DEFINITION
class CentralSpine:
    def __init__(self, curve_geometry):
        self.curve = curve_geometry
        self.role = "Structural Backbone"
        self.solid = None

    def create_solid(self, radius):
        
        start = self.curve.StartPoint
        tangent = self.curve.TangentAtParameter(0)
        
        
        profile = Circle.ByCenterPointRadiusNormal(start, radius, tangent)
        
        
        surf = Surface.BySweep(profile, self.curve)
        
        # Thicken to make it solid
        self.solid = surf.Thicken(1)
        return self.solid

    def get_vol(self, radius):
        # Math: Volume = Pi * r^2 * Length
        length = self.curve.Length
        area = math.pi * (radius ** 2)
        return area * length


OUT = CentralSpine
# ----------------------------------------
code_block_7 = CodeBlock(W=pavilion_width) { -W/2; }
byCoordinates_3 = Point.ByCoordinates(x=code_block_7)
byCoordinates_4 = Point.ByCoordinates(z=height)
code_block_8 = CodeBlock(W=pavilion_width) { W/2; }
byCoordinates_5 = Point.ByCoordinates(x=code_block_8)
byThreePoints = Arc.ByThreePoints(firstPoint=byCoordinates_3, secondPoint=byCoordinates_4, thirdPoint=byCoordinates_5)
radius_of_middle_arc = DoubleSlider(25, range=0..150 step 0.1)
instance_steel_central_spine = Python(IN[0]=class_definition_steel_central, IN[1]=byThreePoints, IN[2]=radius_of_middle_arc)  # CPython3
# ---------- instance_steel_central_spine.python (20 lines) ----------
import sys
import clr
clr.AddReference('ProtoGeometry')
from Autodesk.DesignScript.Geometry import *



CentralSpine_Class = IN[0] 
input_curve = IN[1]
try: radius = float(IN[2])
except: radius = 60.0

my_instance = CentralSpine_Class(input_curve)
geometry = my_instance.create_solid(radius)

# Volume
volume = my_instance.get_vol(radius)

# Output [Geometry, Volume]
OUT = [geometry, volume]
# ----------------------------------------
code_block_9 = CodeBlock(x=instance_steel_central_spine) { x[1]; }
volume_of_central_spine_mm3 = Watch(code_block_9)
code_block_10 = CodeBlock(x=class_series_timber_beams) { x[0]; }
code_block_11 = CodeBlock { 255; 180; 100; 30; }
byARGB_2 = Color.ByARGB(alpha=code_block_11.out0, red=code_block_11.out1, green=code_block_11.out2, blue=code_block_11.out3)
color_for_timber_beam = Modifiers.GeometryColor.ByGeometryColor(geometry=code_block_10, color=byARGB_2)
code_block_12 = CodeBlock(x=class_definition_roof_panel) { x[0]; }
code_block_13 = CodeBlock { 100; 200; 200; 255; }
byARGB_3 = Color.ByARGB(alpha=code_block_13.out0, red=code_block_13.out1, green=code_block_13.out2, blue=code_block_13.out3)
color_for_roof_polycarbonate = Modifiers.GeometryColor.ByGeometryColor(geometry=code_block_12, color=byARGB_3)
code_block_14 = CodeBlock(x=steel_column) { x[0]; }
code_block_15 = CodeBlock { 255; 150; 150; 150; }
byARGB_4 = Color.ByARGB(alpha=code_block_15.out0, red=code_block_15.out1, green=code_block_15.out2, blue=code_block_15.out3)
color_for_steel_column = Modifiers.GeometryColor.ByGeometryColor(geometry=code_block_14, color=byARGB_4)
code_block_16 = CodeBlock(x=instance_steel_central_spine) { x[0]; }
code_block_17 = CodeBlock { 255; 150; 150; 150; }
byARGB_5 = Color.ByARGB(alpha=code_block_17.out0, red=code_block_17.out1, green=code_block_17.out2, blue=code_block_17.out3)
color_for_steel_spine = Modifiers.GeometryColor.ByGeometryColor(geometry=code_block_16, color=byARGB_5)
