# Dynamo graph 1822429.dyn (Dynamo 4.0.0.3277)

code_block = CodeBlock { -5000; -5000; -200; }
byCoordinates = Point.ByCoordinates(x=code_block.out0, y=code_block.out1, z=code_block.out2)
code_block_2 = CodeBlock { 5000; 5000; 0; }
byCoordinates_2 = Point.ByCoordinates(x=code_block_2.out0, y=code_block_2.out1, z=code_block_2.out2)
byCorners = Cuboid.ByCorners(lowPoint=byCoordinates, highPoint=byCoordinates_2)
code_block_3 = CodeBlock { 0; 100; 0; }
byARGB = Color.ByARGB(red=code_block_3.out0, green=code_block_3.out1, blue=code_block_3.out2)
byGeometryColor = Modifiers.GeometryColor.ByGeometryColor(geometry=byCorners, color=byARGB)
pavilion_radius = DoubleSlider(4500, range=1000..5000 step 100)
pavilion_height = DoubleSlider(4600, range=2000..8000 step 100)
number_of_posts = DoubleSlider(11, range=3..20 step 1)
post_thickness = DoubleSlider(100, range=20..100 step 5)
python_script = Python(IN[0]=pavilion_radius, IN[1]=pavilion_height, IN[2]=number_of_posts, IN[3]=post_thickness)  # PythonNet3
# ---------- python_script.python (116 lines) ----------
import clr
import math

# Import Geometry library
clr.AddReference('ProtoGeometry')
from Autodesk.DesignScript.Geometry import *

# --- CLASS DEFINITIONS ---

class TeepeePost:
    """Class for the structural wooden posts"""
    def __init__(self, base_point, top_point, radius):
        self.base = base_point
        self.top = top_point
        self.r = radius
        self.geometry = None
        self.volume = 0
    
    def create(self):
        # Create a cylinder representing the post
        self.geometry = Cylinder.ByPointsRadius(self.base, self.top, self.r)
        self.volume = self.geometry.Volume 
        return self.geometry

class TeepeeCover:
    """Class for the fabric cone cover with a Door Void"""
    def __init__(self, base_point, height, bottom_radius):
        self.center = base_point
        self.h = height
        self.r = bottom_radius
        self.geometry = None
        self.volume = 0
        
    def create(self):
        # 1. Create Base Cone Surface
        base_plane = Plane.ByOriginNormal(self.center, Vector.ZAxis())
        bottom_circle = Circle.ByPlaneRadius(base_plane, self.r)
        
        # Top circle (Smoke hole) - 
        top_pt = Point.ByCoordinates(self.center.X, self.center.Y, self.center.Z + self.h)
        top_plane = Plane.ByOriginNormal(top_pt, Vector.ZAxis())
        top_circle = Circle.ByPlaneRadius(top_plane, 150.0) 
        
        # Loft and Thicken
        surface = Surface.ByLoft([bottom_circle, top_circle])
        solid_cone = surface.Thicken(50) 
        
        # 2. Create the Door Void
        door_w = 1500 # 1.5m wide
        door_h = 2400 # 2.4m high
        
        # Define 3 Points for the Triangle Profile (Standing up on Y-Z plane)
        # We start X at -500 to ensure the cut goes all the way through the wall
        p1 = Point.ByCoordinates(-500, -door_w/2, 0) # Bottom Left
        p2 = Point.ByCoordinates(-500, door_w/2, 0)  # Bottom Right
        p3 = Point.ByCoordinates(-500, 0, door_h)    # Top Tip
        
        # Extrude the triangle to make a "cutting" solid
        door_polygon = Polygon.ByPoints([p1, p2, p3])
        door_solid = door_polygon.ExtrudeAsSolid(Vector.XAxis(), self.r * 2.5)
        
        # 3. Subtract Door from Cone
        self.geometry = Solid.Difference(solid_cone, door_solid)
        
        self.volume = self.geometry.Volume
        return self.geometry

# --- INPUTS ---
radius = IN[0]
height = IN[1]
num_posts = int(IN[2]) 
post_r = IN[3]

# --- MAIN LOGIC ---

post_geometries = []
post_volumes = 0

# 1. Create the Posts (Smart Spacing)
center_pt = Point.ByCoordinates(0,0,0)
apex_pt = Point.ByCoordinates(0, 0, height) 

# DEFINE THE GAP: 50 degrees of open space for the door
door_gap = 50.0 
start_angle = door_gap / 2.0  # Starts at +25 deg
end_angle = 360.0 - (door_gap / 2.0) # Ends at 335 deg (-25 deg)
angle_span = end_angle - start_angle

for i in range(num_posts):
    # Calculate angle to distribute posts evenly along the "C" shape
    if num_posts > 1:
        # 't' goes from 0.0 to 1.0
        t = float(i) / (num_posts - 1)
        angle = start_angle + (t * angle_span)
    else:
        angle = 180 # If only 1 post, put it at the back
        
    angle_rad = math.radians(angle)
    
    # Calculate Position
    x = radius * math.cos(angle_rad)
    y = radius * math.sin(angle_rad)
    base_pt = Point.ByCoordinates(x, y, 0)
    
    # Instantiate and Create Post
    new_post = TeepeePost(base_pt, apex_pt, post_r)
    post_geometries.append(new_post.create())
    post_volumes += new_post.volume

# 2. Create the Cover 
cover_instance = TeepeeCover(center_pt, height * 0.9, radius * 0.90)
cover_geo = cover_instance.create()
cover_vol = cover_instance.volume

# --- OUTPUT ---
OUT = [[post_geometries, cover_geo], post_volumes, cover_vol]
# ----------------------------------------
code_block_4 = CodeBlock(data=python_script) { geom = data[0]; posts = geom[0]; cover = geom[1]; vol_wood = data[1]; vol_fabric = data[2]; }
total_wood_volume_mm_3 = Watch(code_block_4.vol_wood)
total_steel_volume_mm_3 = Watch(code_block_4.vol_fabric)
color_palette = ColorPalette({R: 77, G: 19, B: 0, A: 255})
byGeometryColor_2 = Modifiers.GeometryColor.ByGeometryColor(geometry=code_block_4.posts, color=color_palette)
color_palette_2 = ColorPalette({R: 201, G: 185, B: 139, A: 255})
byGeometryColor_3 = Modifiers.GeometryColor.ByGeometryColor(geometry=code_block_4.cover, color=color_palette_2)
