# Dynamo graph 1827419.dyn (Dynamo 3.6.0.9395)

# group: Don't touch this ground
code_block = CodeBlock { -5000; -5000; -200; }
byCoordinates = Point.ByCoordinates(x=code_block.out0, y=code_block.out1, z=code_block.out2)
code_block_2 = CodeBlock { 5000; 5000; 0; }
byCoordinates_2 = Point.ByCoordinates(x=code_block_2.out0, y=code_block_2.out1, z=code_block_2.out2)
byCorners = Cuboid.ByCorners(lowPoint=byCoordinates, highPoint=byCoordinates_2)
code_block_3 = CodeBlock { 0; 100; 0; }
byARGB = Color.ByARGB(red=code_block_3.out0, green=code_block_3.out1, blue=code_block_3.out2)
byGeometryColor = Modifiers.GeometryColor.ByGeometryColor(geometry=byCorners, color=byARGB)

timber_column_class = Python()  # CPython3; unwired: IN[0]
# ---------- timber_column_class.python (23 lines) ----------
import clr
clr.AddReference('ProtoGeometry')
from Autodesk.DesignScript.Geometry import *

class TimberColumn:
    def __init__(self, position, height, diameter):
        self.position = position
        self.height = height
        self.diameter = diameter
    
    def generate_geometry(self):
        try:
            base = Point.ByCoordinates(self.position.X, self.position.Y, 0)
            cs = CoordinateSystem.ByOrigin(base)
            return Cylinder.ByRadiusHeight(cs, self.diameter/2, self.height)
        except:
            return None
    
    def compute_volume(self):
        import math
        return math.pi * (self.diameter/2)**2 * self.height

OUT = TimberColumn
# ----------------------------------------
number_of_columns = DoubleSlider(8.4, range=4..12 step 0.1)
gazebo_height = DoubleSlider(3756.8, range=2000..4000 step 0.1)
roof_thickness = DoubleSlider(46.1, range=3..100 step 0.1)
gazebo_radius = DoubleSlider(3815.4, range=3000..5000 step 0.1)
main_geometry_generator = Python(IN[0]=number_of_columns, IN[1]=gazebo_height, IN[2]=roof_thickness, IN[3]=gazebo_radius)  # CPython3
# ---------- main_geometry_generator.python (63 lines) ----------
import clr
clr.AddReference('ProtoGeometry')
from Autodesk.DesignScript.Geometry import *
import math

# GET SLIDERS
col_count = int(IN[0])
roof_height = IN[1]
roof_thickness = IN[2]
base_radius = IN[3]

# 1. CREATE COLUMNS
angles = [i * (360.0/col_count) for i in range(col_count)]
all_columns = []
col_positions = []

for angle in angles:
    rad = math.radians(angle)
    x = base_radius * math.cos(rad)
    y = base_radius * math.sin(rad)
    base = Point.ByCoordinates(x, y, 0)
    col_positions.append(base)
    
    cs = CoordinateSystem.ByOrigin(base)
    column = Cylinder.ByRadiusHeight(cs, 75, roof_height)
    all_columns.append(column)

# 2. CREATE ROOF WITH VISIBLE THICKNESS
roof_panels = []

# Points at column tops
col_tops = []
for pos in col_positions:
    col_tops.append(Point.ByCoordinates(pos.X, pos.Y, roof_height))

# Roof peak
peak = Point.ByCoordinates(0, 0, roof_height + 1400)

# Create SOLID roof panels using thickness slider
for i in range(len(col_tops)):
    next_i = (i + 1) % len(col_tops)
    triangle_points = [col_tops[i], col_tops[next_i], peak]
    
    try:
        triangle_surface = Surface.ByPerimeterPoints(triangle_points)
        
        if roof_thickness > 0:
            solid_panel = triangle_surface.Thicken(roof_thickness, True)
            if solid_panel:
                roof_panels.append(solid_panel)
        else:
            roof_panels.append(triangle_surface)
            
    except:
        continue

# 3. EMPTY BEAMS (KEEP STRUCTURE)
hor_beams = []
vert_beams = []
diag_supports = []

# OUTPUT - 6 ITEMS (ORIGINAL STRUCTURE)
OUT = [all_columns, col_positions, hor_beams, vert_beams, diag_supports, roof_panels]
# ----------------------------------------
get_columns = List.GetItemAtIndex(list=main_geometry_generator)  # unwired: index
fixed_dimensions = CodeBlock { Column_Diameter = 150; }
timber_column_instances = Python(IN[0]=timber_column_class, IN[1]=get_columns, IN[2]=gazebo_height, IN[3]=[fixed_dimensions, fixed_dimensions], IN[4]=number_of_columns)  # CPython3
# ---------- timber_column_instances.python (15 lines) ----------
# GET ALL INPUTS
columns_geometry = IN[1]    # 3D columns from Main Generator
height_mm = IN[2]           # Roof Height slider  
diameter_mm = IN[3]         # Column Diameter (150)
col_count = int(IN[4])      # NEW: Column Count slider!

import math

# CALCULATE
radius = diameter_mm / 2.0
area = math.pi * radius * radius
volume_per_column = area * height_mm
total_volume = volume_per_column * col_count  # USES SLIDER!

OUT = columns_geometry, total_volume
# ----------------------------------------
steel_roof_class = Python()  # CPython3; unwired: IN[0]
# ---------- steel_roof_class.python (11 lines) ----------
class SteelRoofPanel:
    def __init__(self, surface_geometry, thickness):
        self.surface = surface_geometry
        self.thickness = thickness  # Store thickness
    
    def generate_geometry(self):
        try:
            # ACTUALLY THICKEN the surface with slider value
            return self.surface.Thicken(self.thickness, True)
        except:
            return self.surface  # Fallback
# ----------------------------------------
get_roof_panels = List.GetItemAtIndex(list=main_geometry_generator)  # unwired: index
roof_instance = Python(IN[0]=steel_roof_class, IN[1]=get_roof_panels, IN[2]=roof_thickness, IN[3]=gazebo_radius)  # CPython3
# ---------- roof_instance.python (25 lines) ----------
# ROOF VOLUME THAT CHANGES WITH THICKNESS AND RADIUS
roof_data = IN[1]
thickness_mm = IN[2]    # Thickness slider (20-200mm)
radius_mm = IN[3]       # Base Radius slider (3000-5000mm)

import math

# ROOF VOLUME CALCULATION:
# Volume = Roof Surface Area × Thickness
# Roof area ≈ 4 × π × (radius × 0.85)²  (simplified cone/pyramid area)
roof_radius = radius_mm * 0.85  # Roof is 85% of base radius
roof_area = 4.0 * math.pi * roof_radius * roof_radius

# FINAL VOLUME = area × thickness
roof_volume = roof_area * thickness_mm

# Handle geometry (error-proof)
if roof_data is None:
    geometries = []
elif isinstance(roof_data, list):
    geometries = roof_data
else:
    geometries = [roof_data]

OUT = geometries, roof_volume
# ----------------------------------------
volume_display_format = CodeBlock(col_vol=timber_column_instances, roof_vol=roof_instance) { timberVol = col_vol; steelVol = roof_vol; "TIMBER: " + timber_raw + " mm³"; "STEEL: " + steel_raw + " mm³"; }  # unwired: timber_raw, steel_raw
timber_columns_volume = Watch(volume_display_format.timberVol)
steel_roof_volume = Watch(volume_display_format.steelVol)
floor_generator = Python(IN[0]=gazebo_radius, IN[1]=number_of_columns)  # CPython3
# ---------- floor_generator.python (16 lines) ----------
import clr
clr.AddReference('ProtoGeometry')
from Autodesk.DesignScript.Geometry import *

base_radius = IN[0]

try:
    # Simple flat floor
    floor = Cylinder.ByRadiusHeight(
        CoordinateSystem.ByOrigin(Point.ByCoordinates(0, 0, 0)),
        base_radius,
        100  # 100mm thick
    )
    OUT = [floor]
except:
    OUT = []
# ----------------------------------------
fire_pit_generator = Python(IN[0]=gazebo_radius)  # CPython3
# ---------- fire_pit_generator.python (106 lines) ----------
import clr
clr.AddReference('ProtoGeometry')
from Autodesk.DesignScript.Geometry import *

base_radius = IN[0]

fire_pit_geometry = []

try:
    # FIRE PIT SIZE BASED ON GAZEBO SCALE
    pit_radius = min(800, base_radius * 0.2)  # Max 800mm, or 20% of gazebo radius
    
    # 1. CIRCULAR FIRE PIT BASIN
    # Outer ring (stone border)
    outer_circle = Circle.ByCenterPointRadius(Point.ByCoordinates(0, 0, 50), pit_radius)
    inner_circle = Circle.ByCenterPointRadius(Point.ByCoordinates(0, 0, 50), pit_radius - 150)
    
    # Create stone ring
    ring_surface = Surface.ByLoft([outer_circle, inner_circle])
    if ring_surface:
        stone_ring = ring_surface.Thicken(200, True)  # 200mm thick stone
        if stone_ring:
            fire_pit_geometry.append(stone_ring)
    
    # 2. FIRE PIT INTERIOR (gravel/sand base)
    interior_circle = Circle.ByCenterPointRadius(Point.ByCoordinates(0, 0, 0), pit_radius - 175)
    interior_surface = Surface.ByPatch(interior_circle)
    if interior_surface:
        gravel_base = interior_surface.Thicken(50, True)  # 50mm gravel layer
        if gravel_base:
            fire_pit_geometry.append(gravel_base)
    
    # 3. DECORATIVE STONES AROUND EDGE
    for i in range(8):  # 8 decorative stones
        angle = i * (360.0 / 8)
        import math
        rad = math.radians(angle)
        x = (pit_radius + 50) * math.cos(rad)
        y = (pit_radius + 50) * math.sin(rad)
        
        # Create irregular stone shape (simplified as box)
        stone_base = Point.ByCoordinates(x, y, 0)
        cs = CoordinateSystem.ByOrigin(stone_base)
        
        # Rotate to face center
        center_vec = Vector.ByCoordinates(-x, -y, 0)
        rotated_cs = cs.Rotate(stone_base, center_vec, 90)
        
        # Create stone
        stone = Cuboid.ByLengths(rotated_cs, 150, 100, 80)  # Rough stone size
        if stone:
            fire_pit_geometry.append(stone)
    
    # 4. SYMBOLIC "FIRE" (yellow/orange pyramid for visualization)
    fire_height = 300
    fire_base = Polygon.RegularPolygon(
        CoordinateSystem.ByOrigin(Point.ByCoordinates(0, 0, 50)),
        pit_radius - 200,
        8  # Octagonal fire shape
    )
    fire_apex = Point.ByCoordinates(0, 0, 50 + fire_height)
    
    # Create fire volume (as pyramid)
    fire_surfaces = []
    fire_points = fire_base.Points
    
    for i in range(len(fire_points)):
        next_i = (i + 1) % len(fire_points)
        triangle = [fire_points[i], fire_points[next_i], fire_apex]
        tri_surface = Surface.ByPerimeterPoints(triangle)
        if tri_surface:
            fire_surfaces.append(tri_surface)
    
    # Optional: create solid fire (comment out if too heavy)
    # if fire_surfaces:
    #     fire_volume = fire_surfaces[0]
    #     for surf in fire_surfaces[1:]:
    #         try:
    #             fire_volume = fire_volume.Union(surf)
    #         except:
    #             pass
    #     fire_pit_geometry.append(fire_volume)
            
except Exception as e:
    # SIMPLE FALLBACK FIRE PIT
    try:
        # Simple stone ring
        simple_ring = Cylinder.ByRadiusHeight(
            CoordinateSystem.ByOrigin(Point.ByCoordinates(0, 0, 0)),
            600,  # 600mm radius
            200   # 200mm tall
        )
        fire_pit_geometry.append(simple_ring)
        
        # Cut out center
        center_hole = Cylinder.ByRadiusHeight(
            CoordinateSystem.ByOrigin(Point.ByCoordinates(0, 0, -10)),
            450,  # 450mm hole
            220   # Taller to cut through
        )
        # Note: Would need Boolean operation to cut hole
        
    except:
        pass

OUT = fire_pit_geometry
# ----------------------------------------
