# Dynamo graph 1827841.dyn (Dynamo 4.0.0.3277)

code_block = CodeBlock { -5000; -5000; -200; }
byCoordinates = Point.ByCoordinates(x=code_block.out0, y=code_block.out1, z=code_block.out2)
code_block_2 = CodeBlock { 5000; 5000; 0; }
byCoordinates_2 = Point.ByCoordinates(x=code_block_2.out0, y=code_block_2.out1, z=code_block_2.out2)
byCorners = Cuboid.ByCorners(lowPoint=byCoordinates, highPoint=byCoordinates_2)
code_block_3 = CodeBlock { 0; 100; 0; }
byARGB = Color.ByARGB(red=code_block_3.out0, green=code_block_3.out1, blue=code_block_3.out2)
byGeometryColor = Modifiers.GeometryColor.ByGeometryColor(geometry=byCorners, color=byARGB)
code_block_4 = CodeBlock { 0; 0; 0; }
origin = Point.ByCoordinates(x=code_block_4.out0, y=code_block_4.out1, z=code_block_4.out2)
circle_radius = DoubleSlider(3750, range=1000..4000 step 50)
circle_curve = Circle.ByCenterPointRadius(centerPoint=origin, radius=circle_radius)
number_of_pillars = DoubleSlider(10, range=3..20 step 1)
code_block_5 = CodeBlock(n=number_of_pillars) { n; 0..1..#n+1; }
watch = Watch(code_block_5.out1)
cylinder_points = Curve.PointAtParameter(curve=circle_curve, param=watch)
code_block_6 = CodeBlock { 0; 0; }
base_height = DoubleSlider(150, range=50..200 step 10)
move_cylinder_points_up = Vector.ByCoordinates(x=code_block_6.out0, y=code_block_6.out1, z=base_height)
bottom_of_cylinders = Point.Add(point=cylinder_points, vectorToAdd=move_cylinder_points_up)
cylinder_height = DoubleSlider(5000, range=3000..7000 step 50)
move_cylinder_points_up_2 = Vector.ByCoordinates(x=code_block_6.out0, y=code_block_6.out1, z=cylinder_height)
vector_to_cylinder_top = Vector.Add(vector=move_cylinder_points_up, vectorToAdd=move_cylinder_points_up_2)
top_of_cylinders = Point.Add(point=cylinder_points, vectorToAdd=vector_to_cylinder_top)
cylinder_radius = DoubleSlider(220, range=20..500 step 20)
class_circular_steel_rod = Python()  # PythonNet3; unwired: IN[0]
# ---------- class_circular_steel_rod.python (19 lines) ----------
# Load the Python Standard and DesignScript Libraries
import sys
import clr
clr.AddReference('ProtoGeometry')
from Autodesk.DesignScript.Geometry import *
import math

class CircularSteelRod:
    def __init__(self, top_point, bottom_point, radius):
        self.top = top_point
        self.bottom = bottom_point
        self.radius = radius
    
    def make_geometry(self):
        return Cylinder.ByPointsRadius(self.top,self.bottom,self.radius) 
    
    def measure_volume(self):
        return self.bottom.DistanceTo(self.top)  *self.radius*self.radius*math.pi  
OUT = CircularSteelRod
# ----------------------------------------
series_of_circular_steel_rods = Python(IN[0]=bottom_of_cylinders, IN[1]=top_of_cylinders, IN[2]=cylinder_radius, IN[3]=class_circular_steel_rod)  # PythonNet3
# ---------- series_of_circular_steel_rods.python (16 lines) ----------
CircularSteelRod =  IN[3]
bottom_points = IN[0]
top_points = IN[1]
radii = IN[2]

rods = []

bottom = bottom_points
top = top_points
r = radii

for bottom, top in zip(bottom_points, top_points):
    rod = CircularSteelRod(bottom, top, r)
    rods.append(rod.make_geometry())
   
OUT = rods
# ----------------------------------------
bottom_center_roof = Point.Add(point=origin, vectorToAdd=vector_to_cylinder_top)
volume_of_circular_steel_rods = Python(IN[0]=bottom_of_cylinders, IN[1]=top_of_cylinders, IN[2]=cylinder_radius, IN[3]=class_circular_steel_rod)  # PythonNet3
# ---------- volume_of_circular_steel_rods.python (20 lines) ----------
CircularSteelRod =  IN[3]
bottom_points = IN[0]
top_points = IN[1]
radii = IN[2]

rods = []
volumes = []

bottom = bottom_points
top = top_points
r = radii

for bottom, top in zip(bottom_points, top_points):
    rod = CircularSteelRod(bottom, top, r)
    rods.append(rod.make_geometry())
    volumes.append(rod.measure_volume())
   
TotalVolume = sum(volumes)

OUT = TotalVolume
# ----------------------------------------
total_volume_of_steel_rods_mm_3 = Watch(volume_of_circular_steel_rods)
top_center_base = Point.ByCoordinates(x=code_block_6.out0, y=code_block_6.out1, z=base_height)
timber_radius = CodeBlock { 4500; }
class_timber_base = Python()  # PythonNet3; unwired: IN[0]
# ---------- class_timber_base.python (19 lines) ----------
# Load the Python Standard and DesignScript Libraries
import sys
import clr
clr.AddReference('ProtoGeometry')
from Autodesk.DesignScript.Geometry import *
import math

class TimberBase:
    def __init__(self, startPoint, endPoint, radius):
        self.startPoint = startPoint
        self.endPoint = endPoint
        self.radius = radius
    
    def make_geometry(self):
        return Cylinder.ByPointsRadius(self.startPoint,self.endPoint,self.radius) 
    
    def measure_volume(self):
        return self.startPoint.DistanceTo(self.endPoint)  *self.radius*self.radius*math.pi  
OUT = TimberBase    
# ----------------------------------------
instance_of_timber_base = Python(IN[0]=origin, IN[1]=top_center_base, IN[2]=timber_radius, IN[3]=class_timber_base)  # PythonNet3
# ---------- instance_of_timber_base.python (3 lines) ----------
TimberBase = IN[3]
b = TimberBase(IN[0],IN[1],IN[2])
OUT = [b.make_geometry(), b.measure_volume()]
# ----------------------------------------
height_of_cylinders = Vector.Add(vector=move_cylinder_points_up, vectorToAdd=move_cylinder_points_up_2)
bottom_ceiling_center = Point.Add(point=origin, vectorToAdd=height_of_cylinders)
top_ceiling_center = Point.Add(point=bottom_ceiling_center, vectorToAdd=move_cylinder_points_up)
class_timber_ceiling = Python()  # PythonNet3; unwired: IN[0]
# ---------- class_timber_ceiling.python (19 lines) ----------
# Load the Python Standard and DesignScript Libraries
import sys
import clr
clr.AddReference('ProtoGeometry')
from Autodesk.DesignScript.Geometry import *
import math

class TimberCeiling:
    def __init__(self, startPoint, endPoint, radius):
        self.startPoint = startPoint
        self.endPoint = endPoint
        self.radius = radius
    
    def make_geometry(self):
        return Cylinder.ByPointsRadius(self.startPoint,self.endPoint,self.radius) 
    
    def measure_volume(self):
        return self.startPoint.DistanceTo(self.endPoint)  *self.radius*self.radius*math.pi  
OUT = TimberCeiling   
# ----------------------------------------
instance_of_timber_ceiling = Python(IN[0]=bottom_ceiling_center, IN[1]=top_ceiling_center, IN[2]=timber_radius, IN[3]=class_timber_ceiling)  # PythonNet3
# ---------- instance_of_timber_ceiling.python (3 lines) ----------
TimberCeiling = IN[3]
b = TimberCeiling(IN[0],IN[1],IN[2])
OUT = [b.make_geometry(), b.measure_volume()]
# ----------------------------------------
volume_of_timber_base = Python(IN[0]=origin, IN[1]=top_center_base, IN[2]=timber_radius, IN[3]=class_timber_base)  # PythonNet3
# ---------- volume_of_timber_base.python (3 lines) ----------
TimberBase = IN[3]
b = TimberBase(IN[0],IN[1],IN[2])
OUT = b.measure_volume()
# ----------------------------------------
volume_of_timber_ceiling = Python(IN[0]=bottom_ceiling_center, IN[1]=top_ceiling_center, IN[2]=timber_radius, IN[3]=class_timber_ceiling)  # PythonNet3
# ---------- volume_of_timber_ceiling.python (3 lines) ----------
TimberCeiling = IN[3]
b = TimberCeiling(IN[0],IN[1],IN[2])
OUT = b.measure_volume()
# ----------------------------------------
total_timber_volume = Python(IN[0]=volume_of_timber_base, IN[1]=volume_of_timber_ceiling)  # PythonNet3
# ---------- total_timber_volume.python (9 lines) ----------
# Load the Python Standard and DesignScript Libraries
import sys
import clr
clr.AddReference('ProtoGeometry')
from Autodesk.DesignScript.Geometry import *

TotalVolume = IN[0] + IN[1]

OUT = TotalVolume 
# ----------------------------------------
total_timber_volume_mm_3 = Watch(total_timber_volume)
code_block_7 = CodeBlock { 0; 0; }
height_of_roof = DoubleSlider(1500, range=1000..2000 step 50)
move_roof_center_up = Vector.ByCoordinates(x=code_block_7.out0, y=code_block_7.out1, z=height_of_roof)
top_center_roof = Point.Add(point=top_ceiling_center, vectorToAdd=move_roof_center_up)
class_aluminum_roof = Python()  # PythonNet3; unwired: IN[0]
# ---------- class_aluminum_roof.python (19 lines) ----------
# Load the Python Standard and DesignScript Libraries
import sys
import clr
clr.AddReference('ProtoGeometry')
from Autodesk.DesignScript.Geometry import *
import math

class AluminumRoof:
    def __init__(self, startPoint, endPoint, startRadius):
        self.startPoint = startPoint
        self.endPoint = endPoint
        self.startRadius = startRadius
    
    def make_geometry(self):
        return Cone.ByPointsRadius(self.startPoint,self.endPoint,self.startRadius) 
    
    def measure_volume(self):
        return self.startPoint.DistanceTo(self.endPoint)  *self.startRadius*self.startRadius*math.pi*(1/3)  
OUT = AluminumRoof 
# ----------------------------------------
instance_of_aluminum_roof = Python(IN[0]=top_ceiling_center, IN[1]=top_center_roof, IN[2]=timber_radius, IN[3]=class_aluminum_roof)  # PythonNet3
# ---------- instance_of_aluminum_roof.python (3 lines) ----------
AluminumRoof = IN[3]
b = AluminumRoof(IN[0],IN[1],IN[2])
OUT = [b.make_geometry(), b.measure_volume()]
# ----------------------------------------
volume_of_aluminium_roof = Python(IN[0]=top_ceiling_center, IN[1]=top_center_roof, IN[2]=timber_radius, IN[3]=class_aluminum_roof)  # PythonNet3
# ---------- volume_of_aluminium_roof.python (3 lines) ----------
AluminumRoof = IN[3]
b = AluminumRoof(IN[0],IN[1],IN[2])
OUT = b.measure_volume()
# ----------------------------------------
total_aluminum_volume_mm_3 = Watch(volume_of_aluminium_roof)
