# Dynamo graph 1828463.dyn "Start (without the group)" (Dynamo 3.5.2.8914)

# group: Start Slab
code_block = CodeBlock { -5000; -5000; -200; }
byCoordinates = Point.ByCoordinates(x=code_block.out0, y=code_block.out1, z=code_block.out2)
code_block_2 = CodeBlock { 5000; 5000; 0; }
byCoordinates_2 = Point.ByCoordinates(x=code_block_2.out0, y=code_block_2.out1, z=code_block_2.out2)
byCorners = Cuboid.ByCorners(lowPoint=byCoordinates, highPoint=byCoordinates_2)
code_block_3 = CodeBlock { 0; 100; 0; }
byARGB = Color.ByARGB(red=code_block_3.out0, green=code_block_3.out1, blue=code_block_3.out2)
byGeometryColor = Modifiers.GeometryColor.ByGeometryColor(geometry=byCorners, color=byARGB)

code_block_4 = CodeBlock { 0; }
origin_point_for_curve = Point.ByCoordinates(x=code_block_4, y=code_block_4, z=code_block_4)
timber_beam = Python()  # CPython3; unwired: IN[0]
# ---------- timber_beam.python (29 lines) ----------
import clr
clr.AddReference('ProtoGeometry')
from Autodesk.DesignScript.Geometry import *

# Define the TimberBeam class
class TimberBeam:
    def __init__(self, curve):
        self.curve = curve
        # Assume a square cross-section of 100mm x 100mm
        self.width = 100.0
        self.height = 100.0

    def generate_geometry(self):
        # Sweep the curve with a square profile for a structural beam
        profile = Rectangle.ByWidthLength(Plane.ByOrigin(Point.ByCoordinates(0,0,0)), self.width, self.height)
        # Ensure the curve has a length > 0 before sweeping
        if self.curve.Length > 0:
            solid = Solid.BySweep(profile, self.curve)
            return solid
        return None

    def compute_volume(self):
        # Volume = Cross-sectional Area * Length
        length = self.curve.Length
        volume = self.width * self.height * length
        return volume

# Output the class definition
OUT = TimberBeam
# ----------------------------------------
code_block_5 = CodeBlock(timberbeam=timber_beam) { timberbeam; }
watch = Watch(code_block_5)
code_block_6 = CodeBlock(TC=timber_beam) { TC_in = TC; TC_in(x); }  # unwired: x
steel_panel = Python()  # CPython3; unwired: IN[0]
# ---------- steel_panel.python (24 lines) ----------
import clr
clr.AddReference('ProtoGeometry')
from Autodesk.DesignScript.Geometry import *

# Define the SteelPanel class
class SteelPanel:
    def __init__(self, surface):
        self.surface = surface
        # Assume a thickness of 10mm
        self.thickness = 10.0

    def generate_geometry(self):
        # Thicken the surface to create a solid panel
        solid = self.surface.Thicken(self.thickness)
        return solid

    def compute_volume(self):
        # Volume is Surface Area * Thickness
        area = self.surface.Area
        volume = area * self.thickness
        return volume

# Output the class definition
OUT = SteelPanel
# ----------------------------------------
arch_Radius = DoubleSlider(5000, range=4000..5000 step 100)
code_block_7 = CodeBlock(r=arch_Radius) { -r; -5000; 0; }
left_point_start = Point.ByCoordinates(x=code_block_7.out0, y=code_block_7.out1, z=code_block_7.out2)
pavilion_Height = DoubleSlider(5100, range=3000..8000 step 100)
code_block_8 = CodeBlock(h=pavilion_Height) { 0; -5000; h; }
top_point_peak = Point.ByCoordinates(x=code_block_8.out0, y=code_block_8.out1, z=code_block_8.h)
code_block_9 = CodeBlock(r=arch_Radius) { r; -5000; 0; }
right_point_end = Point.ByCoordinates(x=code_block_9.r, y=code_block_9.out1, z=code_block_9.out2)
byThreePoints = Arc.ByThreePoints(firstPoint=left_point_start, secondPoint=top_point_peak, thirdPoint=right_point_end)
code_block_10 = CodeBlock { 0; 10000; 0; }
byCoordinates_3 = Vector.ByCoordinates(x=code_block_10.out0, y=code_block_10.out1, z=code_block_10.out2)
extrude = Curve.Extrude(curve=byThreePoints, direction=byCoordinates_3)
generate_skin = Python(IN[0]=steel_panel, IN[1]=extrude)  # CPython3
# ---------- generate_skin.python (19 lines) ----------
# IN[0] = The Steel Panel Class
# IN[1] = The Main Surface

panel_class = IN[0]
surface_geometry = IN[1]

# 1. Create the Instance inside Python (Safe)
my_panel = panel_class(surface_geometry)

# 2. Generate the Solid Geometry
solid = my_panel.generate_geometry()

# 3. Calculate Volume
volume = my_panel.compute_volume()

# Output both clearly
# OUT[0] will be the Solid
# OUT[1] will be the Volume Number
OUT = [solid, volume]
# ----------------------------------------
code_block_11 = CodeBlock(list=generate_skin) { list[0]; }
code_block_12 = CodeBlock(list=generate_skin) { list[1]; }
volume_of_steel_panel_mm_3 = Watch(code_block_12)
U_Division = DoubleSlider(10, range=10..40 step 1)
V_Division = DoubleSlider(5, range=5..20 step 1)
code_block_13 = CodeBlock(U_Division=U_Division, V_Division=V_Division) { U_Range = 0..1..#U_Division; V_Range = 0..1..#V_Division; }
pointAtParameter = Surface.PointAtParameter(surface=extrude, u=code_block_13.U_Range, v=code_block_13.V_Range, lacing=CrossProduct)
n1st_polycurve_bypoints = PolyCurve.ByPoints(points=pointAtParameter@L2)
transpose = List.Transpose(lists=pointAtParameter)
n2nd_polycurve_bypoints = PolyCurve.ByPoints(points=transpose)
list_join_curves_that_make_the = List.Join(list0=n1st_polycurve_bypoints, list1=n2nd_polycurve_bypoints)  # "List.Join (curves that make the pavilion lattice)"
instantiate_beams = Python(IN[0]=timber_beam, IN[1]=list_join_curves_that_make_the)  # CPython3
# ---------- instantiate_beams.python (31 lines) ----------
import sys

# IN[0] = The TimberBeam Class
# IN[1] = The List of Curves from List.Join
beam_class = IN[0]
curves_list = IN[1]

beam_instances = []

# Helper function to flatten lists (in case curves are nested)
def flatten(lst):
    flat = []
    if isinstance(lst, list):
        for i in lst:
            flat.extend(flatten(i))
    else:
        flat.append(lst)
    return flat

# 1. Flatten the list of curves so we have a simple list
flat_curves = flatten(curves_list)

# 2. Loop through every curve and create a TimberBeam instance
for curve in flat_curves:
    if curve:
        # Create the instance
        new_beam = beam_class(curve)
        beam_instances.append(new_beam)

# Output the list of TimberBeam objects
OUT = beam_instances
# ----------------------------------------
generate = Python(IN[0]=instantiate_beams)  # CPython3
# ---------- generate.python (38 lines) ----------
import sys

# Input from 1st List.Map
data = IN[0]

# Lists to hold our results
all_solids = []
total_volume = 0.0

# --- THE ROBUST HELPER FUNCTION ---
# This function digs through any list structure to find your beams
def process_items(current_item):
    global total_volume # Allow updating the total variable
    
    # 1. If it is a list, loop through it and dig deeper
    if isinstance(current_item, list):
        for item in current_item:
            process_items(item)
            
    # 2. If it is a TimberBeam, do the work
    elif hasattr(current_item, "generate_geometry"):
        try:
            # A. Generate Geometry
            geo = current_item.generate_geometry()
            if geo:
                all_solids.append(geo)
            
            # B. Calculate Volume
            vol = current_item.compute_volume()
            total_volume += vol
        except:
            pass

# --- EXECUTE ---
process_items(data)

# Output: [List of Geometry, Total Volume Number]
OUT = [all_solids, total_volume]
# ----------------------------------------
code_block_14 = CodeBlock(list=generate) { list[0]; }
code_block_15 = CodeBlock(list=generate) { list[1]; }
material_volume_1_timber_mm_3 = Watch(code_block_15)
