# Dynamo graph 1829525.dyn (Dynamo 3.6.0.9395)

# group: Don't touch this ground
code_block = CodeBlock { -5000; -5000; -200; }  # frozen
byCoordinates = Point.ByCoordinates(x=code_block.out0, y=code_block.out1, z=code_block.out2)  # frozen
code_block_2 = CodeBlock { 5000; 5000; 0; }  # frozen
byCoordinates_2 = Point.ByCoordinates(x=code_block_2.out0, y=code_block_2.out1, z=code_block_2.out2)  # frozen
byCorners = Cuboid.ByCorners(lowPoint=byCoordinates, highPoint=byCoordinates_2)  # frozen
code_block_3 = CodeBlock { 0; 100; 0; }  # frozen
byARGB = Color.ByARGB(red=code_block_3.out0, green=code_block_3.out1, blue=code_block_3.out2)  # frozen
byGeometryColor = Modifiers.GeometryColor.ByGeometryColor(geometry=byCorners, color=byARGB)  # frozen

code_block_4 = CodeBlock { x = -3000; y = -3000; z = 0; }
byCoordinates_3 = Point.ByCoordinates(x=code_block_4.x, y=code_block_4.y, z=code_block_4.z)
length = DoubleSlider(3000, range=0..10000 step 1)
code_block_5 = CodeBlock(length=length) { length; y = -3000; z = 0; }
byCoordinates_4 = Point.ByCoordinates(x=code_block_5.length, y=code_block_5.y, z=code_block_5.z)
width = DoubleSlider(4000, range=0..5000 step 1)
code_block_6 = CodeBlock(length=length, width=width) { length; width; z = 0; }
byCoordinates_5 = Point.ByCoordinates(x=code_block_6.length, y=code_block_6.width, z=code_block_6.z)
code_block_7 = CodeBlock(width=width) { -3000; width; z = 0; }
byCoordinates_6 = Point.ByCoordinates(x=code_block_7.out0, y=code_block_7.width, z=code_block_7.z)
code_block_8 = CodeBlock { x = 0; y = -3000; z = 0; }
byCoordinates_7 = Point.ByCoordinates(x=code_block_8.x, y=code_block_8.y, z=code_block_8.z)
roofHeight = DoubleSlider(4000, range=0..5000 step 1)
archRiseFactor = DoubleSlider(0.4, range=0.1..0.6 step 0.1)
code_block_9 = CodeBlock(width=width, roofHeight=roofHeight, archRiseFactor=archRiseFactor) { x = 0; y = (-3000 + width/2); z = roofHeight + archRiseFactor * width; }
byCoordinates_8 = Point.ByCoordinates(x=code_block_9.x, y=code_block_9.y, z=code_block_9.z)
code_block_10 = CodeBlock(width=width) { x = 0; y = width; z = 0; }
byCoordinates_9 = Point.ByCoordinates(x=code_block_10.x, y=code_block_10.y, z=code_block_10.z)
middle_arch = Arc.ByThreePoints(firstPoint=byCoordinates_7, secondPoint=byCoordinates_8, thirdPoint=byCoordinates_9)
numFrames = DoubleSlider(5, range=3..8 step 1)
code_block_11 = CodeBlock(length=length, numFrames=numFrames) { -3000..length..#numFrames; }
arches = Geometry.Translate(geometry=middle_arch, xTranslation=code_block_11)
code_block_12 = CodeBlock { 4; }
getItemAtIndex = List.GetItemAtIndex(list=arches, index=code_block_12)
x_y_z_for_instance = CodeBlock { 3000; 500; 3700; }
frontpointsingle = Point.ByCoordinates(x=x_y_z_for_instance.out0, y=x_y_z_for_instance.out1, z=x_y_z_for_instance.out2)
x_y_z_for_instance_2 = CodeBlock { -3000; 500; 3700; }
backpointsingle = Point.ByCoordinates(x=x_y_z_for_instance_2.out0, y=x_y_z_for_instance_2.out1, z=x_y_z_for_instance_2.out2)
single_instance = Line.ByStartPointEndPoint(startPoint=frontpointsingle, endPoint=backpointsingle)
steelRadius = DoubleSlider(122, range=50..200 step 1)
steel_single_instance = Python(IN[0]=single_instance, IN[1]=steelRadius)  # CPython3
# ---------- steel_single_instance.python (34 lines) ----------
# Load the Python Standard and DesignScript Libraries
import sys
import clr
clr.AddReference('ProtoGeometry')
from Autodesk.DesignScript.Geometry import *
import math

class CircularSteel:
    def __init__(self, centerline, radius):
        self.radius = radius
        self.centerline = centerline
        

    def endpoints(self):
        return self.centerline.StartPoint, self.centerline.EndPoint

    def make_geometry(self):
        end1, end2 = self.endpoints()
        return Cylinder.ByPointsRadius(end1, end2, self.radius)

    def measure_volume(self):
        end1, end2 = self.endpoints()
        length = end1.DistanceTo(end2)
        return length * self.radius * self.radius * math.pi

# inputs from Dynamo
centerline = IN[0]   # single arch 
radius     = IN[1]   # steelRadius slider

member = CircularSteel(centerline, radius)
geo    = member.make_geometry()
vol    = member.measure_volume()

OUT = member, geo, vol
# ----------------------------------------
bottomLeft = Point.ByCoordinates(x=code_block_11, y=code_block_4.y, z=code_block_7.z)
columnHeight = DoubleSlider(3500, range=0..5000 step 1)
byCoordinates_10 = Point.ByCoordinates(x=code_block_11, y=code_block_4.y, z=columnHeight)
leftVertical = Line.ByStartPointEndPoint(startPoint=bottomLeft, endPoint=byCoordinates_10)
bottomRight = Point.ByCoordinates(x=code_block_11, y=width, z=code_block_6.z)
all_top_points = Point.ByCoordinates(x=code_block_11, y=width, z=columnHeight)
rightVertical = Line.ByStartPointEndPoint(startPoint=bottomRight, endPoint=all_top_points)
allVertical = List.Create(item0=leftVertical, item1=rightVertical)
vertical_lines = List.Flatten(list=allVertical)
first_points = CodeBlock { 4; -1; }
front_left_beam = List.GetItemAtIndex(list=byCoordinates_10, index=first_points.out0)
x_y_for_midfront = CodeBlock { 3000; 500; }
height_of_steel_arches = DoubleSlider(5780, range=4000..7000 step 1)
midFront = Point.ByCoordinates(x=x_y_for_midfront.out0, y=x_y_for_midfront.out1, z=height_of_steel_arches)
front_right_beam = List.GetItemAtIndex(list=all_top_points, index=first_points.out1)
front_arc = Arc.ByThreePoints(firstPoint=front_left_beam, secondPoint=midFront, thirdPoint=front_right_beam)
middle_points = CodeBlock { 2; -3; }
leftmidPoint = List.GetItemAtIndex(list=byCoordinates_10, index=middle_points.out0)
code_block_13 = CodeBlock { 0; 500; }
midMiddle = Point.ByCoordinates(x=code_block_13.out0, y=code_block_13.out1, z=height_of_steel_arches)
rightmidPoint = List.GetItemAtIndex(list=all_top_points, index=middle_points.out1)
middle_arc = Arc.ByThreePoints(firstPoint=leftmidPoint, secondPoint=midMiddle, thirdPoint=rightmidPoint)
code_block_14 = CodeBlock { 0; 0; }
leftbackPoint = List.GetItemAtIndex(list=byCoordinates_10, index=code_block_14.out0)
code_block_15 = CodeBlock { -3000; 500; }
midBack = Point.ByCoordinates(x=code_block_15.out0, y=code_block_15.out1, z=height_of_steel_arches)
rightbackPoint = List.GetItemAtIndex(list=all_top_points, index=code_block_14.out1)
back_arc = Arc.ByThreePoints(firstPoint=leftbackPoint, secondPoint=midBack, thirdPoint=rightbackPoint)
three_arcs = List.Create(item0=front_arc, item1=middle_arc, item2=back_arc)
steel_lines = List.Create(item0=vertical_lines, item1=three_arcs, item2=single_instance)
flatten = List.Flatten(list=steel_lines)
steel_sheet = Surface.ByLoft(crossSections=arches)
roof_thickness = DoubleSlider(20, range=2..6000 step 1)
steel_arch_thickness = Surface.Thicken(surface=steel_sheet, thickness=roof_thickness)
code_block_16 = CodeBlock { 0; 0; }
roofLift = DoubleSlider(0, range=0..100 step 1)
steel_arch = Geometry.Translate(geometry=steel_arch_thickness, xTranslation=code_block_16.out0, yTranslation=code_block_16.out1, zTranslation=roofLift)
steel_series = Python(IN[0]=flatten, IN[1]=steelRadius, IN[2]=steel_arch)  # CPython3
# ---------- steel_series.python (102 lines) ----------
# Load the Python Standard and DesignScript Libraries
import sys
import clr
clr.AddReference('ProtoGeometry')
from Autodesk.DesignScript.Geometry import *
import math

class CircularSteel:
    def __init__(self, centerline, radius):
        self.radius = radius
        self.centerline = centerline
        

    def make_geometry(self):
        # Straight line to one cylinder
        if isinstance(self.centerline, Line):# Checking whether the curve is a straight line
            s = self.centerline.StartPoint 
            e = self.centerline.EndPoint
            return Cylinder.ByPointsRadius(s, e, self.radius) # Creates one straight steel member using the start point, end point, and the radius

        # Curve to many small cylinders
        n_seg = 30 # pieces the curved steel arch will be sliced into
        parts = [] # empty list to store all the small cylinder pieces
        for i in range(n_seg): # Loops from 0 to 29 to build each small cylinder segment of the arch
        # The loop index is transformed into uniformly spaced floating-point parameters between 0 and 1 by these two lines
            t0 = float(i)   / n_seg # Computes two curve parameters between 0 and 1 to gives evenly spaced points
            t1 = float(i+1) / n_seg
            # Getting points along the curved path
            p0 = self.centerline.PointAtParameter(t0)
            p1 = self.centerline.PointAtParameter(t1)
            parts.append(Cylinder.ByPointsRadius(p0, p1, self.radius)) # Creating a small cylinder between two points

        try: # combine all segments into a single smooth solid
            return Solid.ByUnion(parts)
        except:
            return parts

    def volume(self, geo):
        if isinstance(geo, list): # If curved steel returned many cylinders
        # Start adding volume piece by piece:
            v = 0.0
            for g in geo: 
                try:
                    v += g.Volume # tries to add the volume of each geometry piece
                except:
                    pass
            return v
        else:
            try:
                return geo.Volume
            except:
                return 0.0

# IN[0] = steel centerlines (columns + beams + arches)
# IN[1] = steel radius
# IN[2] = roof solid(s)
lines         = IN[0]
radius        = IN[1]
roof_geometry = IN[2]

# storage for results to required for Watch nodes
all_geometries = []
member_volumes = []

for ln in lines: # Loop through every steel centerline
    m   = CircularSteel(ln, radius) # Create a steel member instance
    geo = m.make_geometry()
    vol = m.volume(geo)
# Storing all geometry in a single list for output:
    if isinstance(geo, list):
        all_geometries.extend(geo)
    else:
        all_geometries.append(geo)

    member_volumes.append(vol)

steel_frame_total = sum(member_volumes)

# roof steel
def roof_vol(obj):
    if obj is None: # If the input roof object doesnt exist (none)
        return 0.0
    # I wasn't sure if the roof node would output a single solid or a list of solids, so this function handles both cases safely:
    if isinstance(obj, list):
        return sum(roof_vol(x) for x in obj) # The function calculates each piece's volume and returns the total sum if the roof object is a list of several pieces.
    try:
        return obj.Volume # If the object is a single solid
    except:
        return 0.0

roof_volume = roof_vol(roof_geometry)

# totals
total_steel_volume = steel_frame_total + roof_volume

OUT = (
    all_geometries,       # 0: all frame steel geometry
    member_volumes,       # 1: per-member volumes
    steel_frame_total,    # 2: frame-only steel volume
    roof_volume,          # 3: roof steel volume
    total_steel_volume    # 4: total steel volume (frame + roof)
)
# ----------------------------------------
getItemAtIndex_2 = List.GetItemAtIndex(list=steel_series, index=code_block_12)
total_volume_steel = Watch(getItemAtIndex_2)
top_horizontal_lines = Line.ByStartPointEndPoint(startPoint=all_top_points, endPoint=byCoordinates_10)
timberRadius = DoubleSlider(80, range=20..80 step 1)
timber_series = Python(IN[0]=top_horizontal_lines, IN[1]=timberRadius)  # CPython3
# ---------- timber_series.python (47 lines) ----------
# Load the Python Standard and DesignScript Libraries
import sys
import clr
clr.AddReference('ProtoGeometry')
from Autodesk.DesignScript.Geometry import *
import math

# Simple timber member class
class CircularTimber:
    def __init__(self, centerline, radius):
        self.centerline = centerline
        self.radius = radius

    def make_geometry(self):
        start = self.centerline.StartPoint
        end   = self.centerline.EndPoint
        return Cylinder.ByPointsRadius(start, end, self.radius)

    def measure_volume(self):
        start = self.centerline.StartPoint
        end   = self.centerline.EndPoint
        length = start.DistanceTo(end)
        return length * self.radius * self.radius * math.pi

# Inputs from Dynamo
lines  = IN[0]      # arch curves
radius = IN[1]      # timberRadius slider

geometries = []     # all timber cylinders
volumes    = []     # numeric volume for each timber member

# Loop over every arch
for ln in lines:
    member = CircularTimber(ln, radius)
    geo = member.make_geometry()
    vol = member.measure_volume()
    geometries.append(geo)
    volumes.append(vol)

# Total timber volume
total_volume = sum(volumes)

# OUT:
# [0] = timber geometry
# [1] = list of each timber volume
# [2] = single number: total volume
OUT = (geometries, volumes, total_volume)
# ----------------------------------------
code_block_17 = CodeBlock { 2; }
getItemAtIndex_3 = List.GetItemAtIndex(list=timber_series, index=code_block_17)
watch = Watch(getItemAtIndex_3)
