# Dynamo graph 1831931.dyn (Dynamo 4.0.0.3277)

# group: Don't touch this ground
code_block = CodeBlock { -5000; -5000; -200; }
byCoordinates = Point.ByCoordinates(x=code_block.out0, y=code_block.out1, z=code_block.out2)
code_block_2 = CodeBlock { 5000; 5000; 0; }
byCoordinates_2 = Point.ByCoordinates(x=code_block_2.out0, y=code_block_2.out1, z=code_block_2.out2)
byCorners = Cuboid.ByCorners(lowPoint=byCoordinates, highPoint=byCoordinates_2)
code_block_3 = CodeBlock { 0; 100; 0; }
byARGB = Color.ByARGB(red=code_block_3.out0, green=code_block_3.out1, blue=code_block_3.out2)
byGeometryColor = Modifiers.GeometryColor.ByGeometryColor(geometry=byCorners, color=byARGB)

number_of_wooden_columns_in_each = DoubleSlider(5, range=4..7 step 1)  # "Number of Wooden Columns in each direction"
code_block_4 = CodeBlock(n=number_of_wooden_columns_in_each) { -5000..5000..#n; }
byCoordinates_3 = Point.ByCoordinates(x=code_block_4, y=code_block_4, lacing=CrossProduct)
X = Point.X(point=byCoordinates_3)
flatten = List.Flatten(list=X)
Y = Point.Y(point=byCoordinates_3)
flatten_2 = List.Flatten(list=Y)
wave_shape = DoubleSlider(40, range=20..40 step 1)
div = X / wave_shape
flatten_3 = List.Flatten(list=div)
sin = Math.Sin(angle=flatten_3)
minimum_column_height = DoubleSlider(3000, range=2500..3500 step 10)
maximum_column_height = DoubleSlider(4690, range=4000..5000 step 10)
remapRange = Math.RemapRange(numbers=sin, newMin=minimum_column_height, newMax=maximum_column_height)
byCoordinates_4 = Point.ByCoordinates(x=flatten, y=flatten_2, z=remapRange)
width_of_metal_panels = DoubleSlider(2030, range=1000..2500 step 10)
thickness_of_metal_panels = DoubleSlider(4, range=3..10 step 1)
metal_panels_class_definition = Python(IN[0]=byCoordinates_4, IN[1]=width_of_metal_panels, IN[2]=thickness_of_metal_panels, IN[3]=minimum_column_height, IN[4]=maximum_column_height, IN[5]=wave_shape)  # "(Metal Panels) Class definition and series of instances"; PythonNet3
# ---------- metal_panels_class_definition.python (66 lines) ----------
import clr
import math
clr.AddReference('ProtoGeometry')
from Autodesk.DesignScript.Geometry import *

# --- CLASS DEFINITION ---
class SteelPanel:
    def __init__(self, center_point, width, thickness, slope_angle):
        self.center = center_point
        self.width = width
        self.thickness = thickness
        self.angle = slope_angle
        self.geometry = None
        
    def generate(self):
        # 1. Create flat box at Origin
        base_geo = Cuboid.ByLengths(Point.ByCoordinates(0,0,0), self.width, self.width, self.thickness)
        
        # 2. Rotate to match wave slope (Around Y Axis)
        rotated_geo = base_geo.Rotate(Point.ByCoordinates(0,0,0), Vector.YAxis(), self.angle)
        
        # 3. Move to correct position
        self.geometry = rotated_geo.Translate(self.center.X, self.center.Y, self.center.Z)
        return self.geometry
        
    def get_volume(self):
        return self.geometry.Volume if self.geometry else 0.0

# --- INPUTS ---
wave_points = IN[0]
width = IN[1]
thick = IN[2]
min_h = IN[3]  # Min Height Slider
max_h = IN[4]  # Max Height Slider
freq = IN[5]   # Frequency Slider (e.g. 25)

# --- CALCULATE AMPLITUDE ---
amplitude = (max_h - min_h) / 2.0

# --- FACTORY LOOP ---
geometry_list = []
total_vol = 0.0

for p in wave_points:
    x_value = p.X
    
    # --- THE FIXED MATH ---
    # 1. Convert Dynamo's degrees (x/freq) into Radians for Python
    angle_in_radians = math.radians(x_value / freq)
    
    # 2. Calculate Slope
    # We multiply by (pi/180) because of the chain rule for degrees
    slope = amplitude * math.cos(angle_in_radians) * (1.0 / freq) * (math.pi / 180.0)
    
    # 3. Convert Slope to Degrees for Rotation
    # We use negative angle to rotate "down" into the wave
    tilt_degrees = -math.degrees(math.atan(slope))
    
    # Create Instance
    panel = SteelPanel(p, width, thick, tilt_degrees)
    
    # Generate and Count
    geometry_list.append(panel.generate())
    total_vol += panel.get_volume()

OUT = geometry_list, total_vol
# ----------------------------------------
code_block_5 = CodeBlock(x=metal_panels_class_definition) { x[1]; }
metal_material_volume_mm_3 = Watch(code_block_5)
radius_of_wooden_columns = DoubleSlider(140, range=100..200 step 10)
wooden_columns_class_definition = Python(IN[0]=byCoordinates_4, IN[1]=radius_of_wooden_columns, IN[2]=minimum_column_height, IN[3]=maximum_column_height, IN[4]=wave_shape)  # "(Wooden Columns) Class Definition and series of instances"; PythonNet3
# ---------- wooden_columns_class_definition.python (73 lines) ----------
import clr
import math
clr.AddReference('ProtoGeometry')
from Autodesk.DesignScript.Geometry import *

# --- CLASS DEFINITION ---
class TimberColumn:
    def __init__(self, top_point, radius, slope_angle):
        self.top_point = top_point
        # Calculate base point at Z=0
        self.base_point = Point.ByCoordinates(top_point.X, top_point.Y, 0)
        self.radius = radius
        self.angle = slope_angle
        self.geometry = None
        
    def generate(self):
        # 1. Create the Bottom Circle (Flat on ground)
        base_plane = Plane.ByOriginNormal(self.base_point, Vector.ZAxis())
        base_circle = Circle.ByPlaneRadius(base_plane, self.radius)
        
        # 2. Create the Top Circle (Tilted to match roof)
        # First, create a flat plane at the top
        flat_top_plane = Plane.ByOriginNormal(self.top_point, Vector.ZAxis())
        
        # Rotate the plane to match the slope (around the top point's local Y axis)
        # We use the same negative angle logic as the panels
        tilted_plane = flat_top_plane.Rotate(self.top_point, Vector.YAxis(), self.angle)
        
        # Draw the top circle on this tilted plane
        top_circle = Circle.ByPlaneRadius(tilted_plane, self.radius)
        
        # 3. Loft them together
        self.geometry = Solid.ByLoft([base_circle, top_circle])
        return self.geometry
        
    def get_volume(self):
        return self.geometry.Volume if self.geometry else 0.0

# --- INPUTS ---
wave_points = IN[0]
radius = IN[1]
min_h = IN[2]   # Min Height Slider
max_h = IN[3]   # Max Height Slider
freq = IN[4]    # Frequency (e.g. 25)

# --- CALCULATE AMPLITUDE ---
amplitude = (max_h - min_h) / 2.0

# --- FACTORY LOOP ---
geometry_list = []
total_vol = 0.0

for p in wave_points:
    x_value = p.X
    
    # --- MATH (Same as Panels) ---
    # 1. Convert to Radians
    angle_in_radians = math.radians(x_value / freq)
    
    # 2. Calculate Slope
    slope = amplitude * math.cos(angle_in_radians) * (1.0 / freq) * (math.pi / 180.0)
    
    # 3. Convert to Degrees
    tilt_degrees = -math.degrees(math.atan(slope))
    
    # Create Instance (Pass the angle this time)
    col = TimberColumn(p, radius, tilt_degrees)
    
    # Generate and Count
    geometry_list.append(col.generate())
    total_vol += col.get_volume()

OUT = geometry_list, total_vol
# ----------------------------------------
code_block_6 = CodeBlock(x=wooden_columns_class_definition) { x[1]; }
wood_material_volume_mm_3 = Watch(code_block_6)
