# Dynamo graph 1834694.dyn "Test-Slate" (Dynamo 3.6.0.9395)

# group: Don't touch this ground
code_block = CodeBlock { -5000; -5000; -200; }
byCoordinates = Point.ByCoordinates(x=code_block.out0, y=code_block.out1, z=code_block.out2)
code_block_2 = CodeBlock { 5000; 5000; 0; }
byCoordinates_2 = Point.ByCoordinates(x=code_block_2.out0, y=code_block_2.out1, z=code_block_2.out2)
byCorners = Cuboid.ByCorners(lowPoint=byCoordinates, highPoint=byCoordinates_2)
code_block_3 = CodeBlock { 0; 100; 0; }
byARGB = Color.ByARGB(red=code_block_3.out0, green=code_block_3.out1, blue=code_block_3.out2)
byGeometryColor = Modifiers.GeometryColor.ByGeometryColor(geometry=byCorners, color=byARGB)

code_block_4 = CodeBlock { 0; 0; 0; }
center = Point.ByCoordinates(x=code_block_4.out0, y=code_block_4.out1, z=code_block_4.out2)
nRods = DoubleSlider(8, range=3..16 step 1)
baseRadius = DoubleSlider(3600, range=1000..5000 step 100)
topRadius = DoubleSlider(750, range=0..3000 step 100)
height = DoubleSlider(4600, range=2000..6000 step 100)
rodRadius = DoubleSlider(120, range=25..150 step 5)
teepee_design = Python(IN[0]=center, IN[1]=nRods, IN[2]=baseRadius, IN[3]=topRadius, IN[4]=height, IN[5]=rodRadius)  # CPython3
# ---------- teepee_design.python (71 lines) ----------
import clr
clr.AddReference('ProtoGeometry')
from Autodesk.DesignScript.Geometry import Point, Cylinder

import math

center    = IN[0]
nRods_in  = IN[1]
baseR     = IN[2]
topR      = IN[3]
height    = IN[4]
rodRadius = IN[5]

try:
    nRods = int(nRods_in)
except:
    nRods = 8

class CircularRod(object):
    def __init__(self, base_point, top_point, radius):
        self.base   = base_point
        self.top    = top_point
        self.radius = radius

    def create_geometry(self):
        return Cylinder.ByPointsRadius(self.base, self.top, self.radius)

    def volume(self):
        g = self.create_geometry()
        try:
            return g.Volume
        except:
            return None

rods_geom = []
rod_vols  = []
base_pts  = []
top_pts   = []

for i in range(nRods):
    angle = 2.0 * math.pi * float(i) / float(nRods)

    # base point
    bx = center.X + baseR * math.cos(angle)
    by = center.Y + baseR * math.sin(angle)
    base_pt = Point.ByCoordinates(bx, by, center.Z)

    # top point
    if topR == 0:
        tx = center.X
        ty = center.Y
    else:
        tx = center.X + topR * math.cos(angle)
        ty = center.Y + topR * math.sin(angle)
    top_pt = Point.ByCoordinates(tx, ty, center.Z + height)

    rod = CircularRod(base_pt, top_pt, rodRadius)
    g   = rod.create_geometry()
    v   = rod.volume()

    rods_geom.append(g)
    rod_vols.append(v)
    base_pts.append(base_pt)
    top_pts.append(top_pt)

if rod_vols and rod_vols[0] is not None:
    total_volume = sum(rod_vols)
else:
    total_volume = None

OUT = rods_geom, rod_vols, total_volume, base_pts, top_pts
# ----------------------------------------
code_block_5 = CodeBlock { 2; }
totalvolume_out_2 = List.GetItemAtIndex(list=teepee_design, index=code_block_5)
code_block_6 = CodeBlock { 1; }
rodvolumes_out_1 = List.GetItemAtIndex(list=teepee_design, index=code_block_6)
baseCircle = Circle.ByCenterPointRadius(centerPoint=center, radius=baseRadius)
topCenter = Point.ByCoordinates(x=code_block_4.out0, y=code_block_4.out1, z=height)
topCircle = Circle.ByCenterPointRadius(centerPoint=topCenter, radius=topRadius)
code_block_7 = CodeBlock { 0; }
rodsolids_out_0 = List.GetItemAtIndex(list=teepee_design, index=code_block_7)
code_block_8 = CodeBlock { 3; }
basepts_out_3 = List.GetItemAtIndex(list=teepee_design, index=code_block_8)
code_block_9 = CodeBlock { 4; }
toppts_out_4 = List.GetItemAtIndex(list=teepee_design, index=code_block_9)

# group: Top and Bottom points
code_block_10 = CodeBlock { 0; }
b0 = List.GetItemAtIndex(list=basepts_out_3, index=code_block_10)
code_block_11 = CodeBlock { 0; }
t0 = List.GetItemAtIndex(list=toppts_out_4, index=code_block_11)
code_block_12 = CodeBlock { 1; }
b1 = List.GetItemAtIndex(list=basepts_out_3, index=code_block_12)
code_block_13 = CodeBlock { 1; }
t1 = List.GetItemAtIndex(list=toppts_out_4, index=code_block_13)
code_block_14 = CodeBlock { 2; }
b2 = List.GetItemAtIndex(list=basepts_out_3, index=code_block_14)
code_block_15 = CodeBlock { 2; }
t2 = List.GetItemAtIndex(list=toppts_out_4, index=code_block_15)
code_block_16 = CodeBlock { 3; }
b3 = List.GetItemAtIndex(list=basepts_out_3, index=code_block_16)
code_block_17 = CodeBlock { 3; }
t3 = List.GetItemAtIndex(list=toppts_out_4, index=code_block_17)

nSlats = DoubleSlider(15, range=2..30 step 1)
indices = CodeBlock(n=nSlats) { 1..n; }
code_block_18 = CodeBlock(i=indices, n=nSlats) { i / (n + 1.0); }

# group: Lines for Shading
L0 = Line.ByStartPointEndPoint(startPoint=b0, endPoint=t0)
p0 = Curve.PointAtParameter(curve=L0, param=code_block_18)
L1 = Line.ByStartPointEndPoint(startPoint=b1, endPoint=t1)
p1 = Curve.PointAtParameter(curve=L1, param=code_block_18)
L2 = Line.ByStartPointEndPoint(startPoint=b2, endPoint=t2)
p2 = Curve.PointAtParameter(curve=L2, param=code_block_18)
L3 = Line.ByStartPointEndPoint(startPoint=b3, endPoint=t3)
p3 = Curve.PointAtParameter(curve=L3, param=code_block_18)

connecting_p0_p3 = List.Create(item0=p0, item1=p1, item2=p2, item3=p3)
transpose = List.Transpose(lists=connecting_p0_p3)
boolean = BoolSelector(true)
byPoints = PolyCurve.ByPoints(points=transpose, connectLastToFirst=boolean)
byPatch = Surface.ByPatch(closedCurve=byPoints)
slatThickness = DoubleSlider(64, range=10..100 step 1)
thicken = Surface.Thicken(surface=byPatch, thickness=slatThickness)

# group: Material Volume
volume = Solid.Volume(solid=rodsolids_out_0)
sum = Math.Sum(values=volume)
material_1_mm3_rods = Watch(sum)
volume_2 = Solid.Volume(solid=thicken)
sum_2 = Math.Sum(values=volume_2)
material_2_mm3_shade_panels = Watch(sum_2)
