# Dynamo graph 1838228.dyn (Dynamo 3.6.0.9395)

code_block = CodeBlock { -5000; -5000; -200; }
byCoordinates = Point.ByCoordinates(x=code_block.out0, y=code_block.out1, z=code_block.out2)
code_block_2 = CodeBlock { 5000; 5000; 0; }
byCoordinates_2 = Point.ByCoordinates(x=code_block_2.out0, y=code_block_2.out1, z=code_block_2.out2)
byCorners = Cuboid.ByCorners(lowPoint=byCoordinates, highPoint=byCoordinates_2)
code_block_3 = CodeBlock { 0; 100; 0; }
byARGB = Color.ByARGB(red=code_block_3.out0, green=code_block_3.out1, blue=code_block_3.out2)
byGeometryColor = Modifiers.GeometryColor.ByGeometryColor(geometry=byCorners, color=byARGB)
base_radius_mm = DoubleSlider(4500, range=2000..4500 step 100)
top_radius_mm = DoubleSlider(3000, range=1000..3000 step 100)
pavilion_height_mm = DoubleSlider(4700, range=3000..6000 step 100)
twist_angle_deg = DoubleSlider(75, range=0..90 step 1)
number_of_trees = DoubleSlider(12, range=6..16 step 1)
code_block_4 = CodeBlock(base_radius=base_radius_mm, top_radius=top_radius_mm, height=pavilion_height_mm, twist_angle=twist_angle_deg, num_petals=number_of_trees)
# ---------- code_block_4.designscript (30 lines) ----------
// Inputs
r_base = base_radius;
r_top = top_radius;
h = height;
twist = twist_angle;
n = num_petals;

// 1. Generate Angles
// 0 to 360 degrees, split by the number of trees
angs = 0..359..#n;

// 2. Create Base Points (on Ground Z=0)
// Simple Trig: X = R*cos(a), Y = R*sin(a)
bx = r_base * Math.Cos(angs);
by = r_base * Math.Sin(angs);
pts_base = Point.ByCoordinates(bx, by, 0);

// 3. Create Top Points (at Height Z=h) with TWIST
tx = r_top * Math.Cos(angs + twist);
ty = r_top * Math.Sin(angs + twist);
pts_top = Point.ByCoordinates(tx, ty, h);

// 4. Create Timber Columns
// Straight lines connecting base to top
wood_lines = Line.ByStartPointEndPoint(pts_base, pts_top);

// 5. Create Steel Ring
// Straight lines connecting each top point to the next one
pts_top_shifted = List.ShiftIndices(pts_top, 1);
steel_lines = Line.ByStartPointEndPoint(pts_top, pts_top_shifted);
# ----------------------------------------
timber_column_width = DoubleSlider(300, range=100..300 step 20)
steel_beam_radius = DoubleSlider(100, range=20..100 step 20)
python_script = Python(IN[0]=code_block_4.wood_lines, IN[1]=code_block_4.steel_lines, IN[2]=timber_column_width, IN[3]=steel_beam_radius, IN[4]=top_radius_mm, IN[5]=pavilion_height_mm)  # CPython3
# ---------- python_script.python (126 lines) ----------
import clr
import math

clr.AddReference('ProtoGeometry')
from Autodesk.DesignScript.Geometry import *

# --- CLASS DEFINITIONS ---

class TimberColumn:
    """Class for straight timber posts"""
    def __init__(self, curve, width):
        self.curve = curve
        self.width = float(width)

    def generate_geometry(self):
        start_pt = self.curve.StartPoint
        end_pt = self.curve.EndPoint
        line_vec = self.curve.Direction.Normalized()
        
        # Consistent orientation
        if abs(line_vec.Z) > 0.99:
            up_ref = Vector.ByCoordinates(0, 1, 0)
        else:
            up_ref = Vector.ByCoordinates(0, 0, 1)
            
        vec_x = line_vec.Cross(up_ref).Normalized()
        vec_y = line_vec.Cross(vec_x).Normalized()
        
        hw = self.width / 2.0
        
        # Start Profile
        s1 = start_pt.Add(vec_x.Scale(hw)).Add(vec_y.Scale(hw))
        s2 = start_pt.Add(vec_x.Scale(-hw)).Add(vec_y.Scale(hw))
        s3 = start_pt.Add(vec_x.Scale(-hw)).Add(vec_y.Scale(-hw))
        s4 = start_pt.Add(vec_x.Scale(hw)).Add(vec_y.Scale(-hw))
        
        # End Profile
        e1 = end_pt.Add(vec_x.Scale(hw)).Add(vec_y.Scale(hw))
        e2 = end_pt.Add(vec_x.Scale(-hw)).Add(vec_y.Scale(hw))
        e3 = end_pt.Add(vec_x.Scale(-hw)).Add(vec_y.Scale(-hw))
        e4 = end_pt.Add(vec_x.Scale(hw)).Add(vec_y.Scale(-hw))
        
        # PolyCurves
        poly_start = PolyCurve.ByPoints([s1, s2, s3, s4], True)
        poly_end = PolyCurve.ByPoints([e1, e2, e3, e4], True)
        
        # Loft
        solid = Solid.ByLoft([poly_start, poly_end])
        
        poly_start.Dispose()
        poly_end.Dispose()
        return solid

    def compute_volume(self):
        return self.curve.Length * self.width * self.width

class SteelBeam:
    """Class for connecting beams"""
    def __init__(self, curve, radius):
        self.curve = curve
        self.radius = float(radius)

    def generate_geometry(self):
        return Cylinder.ByPointsRadius(self.curve.StartPoint, self.curve.EndPoint, self.radius)

    def compute_volume(self):
        return self.curve.Length * math.pi * (self.radius ** 2)

class SimpleRoof:
    """Class for a simple Cone roof"""
    def __init__(self, top_radius, height):
        self.radius = float(top_radius)
        self.base_height = float(height)
        self.roof_height = 1500.0 # 1.5m tall hat

    def generate_geometry(self):
        base_pt = Point.ByCoordinates(0, 0, self.base_height)
        base_cs = CoordinateSystem.ByOrigin(base_pt)
        roof_solid = Cone.ByCoordinateSystemHeightRadii(base_cs, self.roof_height, self.radius, 0)
        
        return roof_solid

    def compute_volume(self):
        # V = (1/3) * Pi * r^2 * h
        return (1.0/3.0) * math.pi * (self.radius ** 2) * self.roof_height

# --- INSTANTIATION ---

wood_lines = IN[0]  
steel_lines = IN[1] 

col_width = IN[2]
beam_rad = IN[3] 

in_top_rad = IN[4]
in_height = IN[5]

# Outputs
out_wood_geo = []
out_wood_vol = []
out_steel_geo = []
out_steel_vol = []
out_roof_geo = []
out_roof_vol = []

# 1. Timber
if wood_lines:
    for line in wood_lines:
        col = TimberColumn(line, col_width)
        out_wood_geo.append(col.generate_geometry())
        out_wood_vol.append(col.compute_volume())

# 2. Steel
if steel_lines:
    for line in steel_lines:
        bm = SteelBeam(line, beam_rad)
        out_steel_geo.append(bm.generate_geometry())
        out_steel_vol.append(bm.compute_volume())

# 3. Roof (One Instance)
roof = SimpleRoof(in_top_rad, in_height)
out_roof_geo.append(roof.generate_geometry())
out_roof_vol.append(roof.compute_volume())

# --- FINAL OUTPUT ---
OUT = [out_wood_geo, out_steel_geo, out_wood_vol, out_steel_vol, out_roof_geo, out_roof_vol]
# ----------------------------------------
code_block_5 = CodeBlock(data=python_script)
# ---------- code_block_5.designscript (6 lines) ----------
geo_wood = data[0];
geo_steel = data[1];
vol_wood = data[2];
vol_steel = data[3];
geo_roof = data[4];
vol_roof = data[5];
# ----------------------------------------
sum = Math.Sum(values=code_block_5.vol_steel)
material_volume_2_steel_in_mm_2 = Watch(sum)
sum_2 = Math.Sum(values=code_block_5.vol_wood)
material_volume_1_timber_in_mm_2 = Watch(sum_2)
color_palette = ColorPalette({R: 77, G: 38, B: 0, A: 255})
byGeometryColor_2 = Modifiers.GeometryColor.ByGeometryColor(geometry=code_block_5.geo_wood, color=color_palette)
color_palette_2 = ColorPalette({R: 0, G: 77, B: 20, A: 255})
byGeometryColor_3 = Modifiers.GeometryColor.ByGeometryColor(geometry=code_block_5.geo_steel, color=color_palette_2)
color_palette_3 = ColorPalette({R: 0, G: 77, B: 20, A: 255})
byGeometryColor_4 = Modifiers.GeometryColor.ByGeometryColor(geometry=code_block_5.geo_roof, color=color_palette_3)
sum_3 = Math.Sum(values=code_block_5.vol_roof)
material_volume_3_roof_in_mm_2 = Watch(sum_3)
