# Dynamo graph 1838842.dyn (Dynamo 4.0.0.3277)

code_block = CodeBlock { -5000; -5000; -200; }
byCoordinates = Point.ByCoordinates(x=code_block.out0, y=code_block.out1, z=code_block.out2)
code_block_2 = CodeBlock { 5000; 5000; 0; }
byCoordinates_2 = Point.ByCoordinates(x=code_block_2.out0, y=code_block_2.out1, z=code_block_2.out2)
byCorners = Cuboid.ByCorners(lowPoint=byCoordinates, highPoint=byCoordinates_2)
code_block_3 = CodeBlock { 0; 100; 0; }
byARGB = Color.ByARGB(red=code_block_3.out0, green=code_block_3.out1, blue=code_block_3.out2)
byGeometryColor = Modifiers.GeometryColor.ByGeometryColor(geometry=byCorners, color=byARGB)
concrete_height = DoubleSlider(2500, range=2000..3000 step 10)
concrete_northeast_pillar_xyz = CodeBlock(h_block=concrete_height) { 2500; 2500; 1/2*h_block; }
concrete_ne_xyz = Point.ByCoordinates(x=concrete_northeast_pillar_xyz.out0, y=concrete_northeast_pillar_xyz.out1, z=concrete_northeast_pillar_xyz.out2)
concrete_width = DoubleSlider(1000, range=800..1200 step 10)
concrete_length = DoubleSlider(1000, range=800..1200 step 10)
concrete_width_and_length = CodeBlock(width=concrete_width, length=concrete_length) { width; length; }
concrete_ne_pillar = Cuboid.ByLengths(origin=concrete_ne_xyz, width=concrete_width_and_length.width, length=concrete_width_and_length.length, height=concrete_height)
concrete_southeast_pillar_xyz = CodeBlock(h_block=concrete_height) { 2500; -2500; 1/2*h_block; }
concrete_se_xyz = Point.ByCoordinates(x=concrete_southeast_pillar_xyz.out0, y=concrete_southeast_pillar_xyz.out1, z=concrete_southeast_pillar_xyz.out2)
concrete_se_pillar = Cuboid.ByLengths(origin=concrete_se_xyz, width=concrete_width_and_length.width, length=concrete_width_and_length.length, height=concrete_height)
concrete_northwest_pillar_xyz = CodeBlock(h_block=concrete_height) { -2500; 2500; 1/2*h_block; }
concrete_nw_xyz = Point.ByCoordinates(x=concrete_northwest_pillar_xyz.out0, y=concrete_northwest_pillar_xyz.out1, z=concrete_northwest_pillar_xyz.out2)
concrete_nw_pillar = Cuboid.ByLengths(origin=concrete_nw_xyz, width=concrete_width_and_length.width, length=concrete_width_and_length.length, height=concrete_height)
concrete_southwest_pillar_xyz = CodeBlock(h_block=concrete_height) { -2500; -2500; 1/2*h_block; }
concrete_sw_xyz = Point.ByCoordinates(x=concrete_southwest_pillar_xyz.out0, y=concrete_southwest_pillar_xyz.out1, z=concrete_southwest_pillar_xyz.out2)
concrete_sw_pillar = Cuboid.ByLengths(origin=concrete_sw_xyz, width=concrete_width_and_length.width, length=concrete_width_and_length.length, height=concrete_height)
concrete_class = Python()  # PythonNet3; unwired: IN[0]; starter script, not edited (OUT = 0)
timber_class = Python()  # PythonNet3; unwired: IN[0]; starter script, not edited (OUT = 0)
timber_number_of_timber_panels = DoubleSlider(13, range=12..19 step 1)
timber_panel_length = CodeBlock(xsw=concrete_southwest_pillar_xyz.out0, xse=concrete_southeast_pillar_xyz.out0, num_tim_pan=timber_number_of_timber_panels) { (-xsw+xse)/(num_tim_pan+2); }
timber_panel_width = CodeBlock(ysw=concrete_southwest_pillar_xyz.out1, ynw=concrete_northwest_pillar_xyz.out1, length=concrete_width_and_length.length) { (-ysw+ynw+length); }
timber_thickness_of_timber = DoubleSlider(38.7, range=0..100 step 0.1)  # "Timber: Thickness of Timber Panels"
timber_support_panel_length = CodeBlock(ysw=concrete_southwest_pillar_xyz.out1, nsw=concrete_northwest_pillar_xyz.out1, length=concrete_width_and_length.length) { -ysw+nsw+length; }
timber_timber_volume_calculation = CodeBlock(num_tim_pan=timber_number_of_timber_panels, length=timber_panel_length, width=timber_panel_width, t=timber_thickness_of_timber, w=concrete_width_and_length.width, l=timber_support_panel_length) { num_tim_pan*length*width*t+2*w*l*t; }
concrete_volume_calculation = CodeBlock(width=concrete_width_and_length.width, length=concrete_width_and_length.length, height=concrete_height) { 4*width*length*height; }
volume_instance_code = Python(IN[0]=timber_timber_volume_calculation, IN[1]=concrete_volume_calculation)  # PythonNet3
# ---------- volume_instance_code.python (22 lines) ----------
# Load the Python Standard and DesignScript Libraries
import sys
import clr
clr.AddReference('ProtoGeometry')
from Autodesk.DesignScript.Geometry import *

# The inputs to this node will be stored as a list in the IN variables.
dataEnteringNode = IN

# Place your code below this line

# Assign your output to the OUT variable.

tim_vol=IN[0]
conc_vol=IN[1]

tim_vol_r=round(tim_vol,2)
conc_vol_r=round(conc_vol,2)

vol=[tim_vol_r,conc_vol_r]

OUT = vol
# ----------------------------------------
timber_volume_index = CodeBlock { 0; }
timber_list_volume = List.GetItemAtIndex(list=volume_instance_code, index=timber_volume_index)
timber_volume_mm_3 = Watch(timber_list_volume)
concrete_volume_index = CodeBlock { 1; }
concrete_list_volume = List.GetItemAtIndex(list=volume_instance_code, index=concrete_volume_index)
concrete_volume_mm_3 = Watch(concrete_list_volume)
timber_east_support_panel = CodeBlock(xe=concrete_southeast_pillar_xyz.out0, h_conc=concrete_height, h_tim=timber_thickness_of_timber) { xe; 0; h_conc+1/2*h_tim; }
timber_east_support_panel_xyz = Point.ByCoordinates(x=timber_east_support_panel.xe, y=timber_east_support_panel.out1, z=timber_east_support_panel.out2)
timber_west_support_panel = CodeBlock(xw=concrete_southwest_pillar_xyz.out0, h_conc=concrete_height, h_tim=timber_thickness_of_timber) { xw; 0; h_conc+1/2*h_tim; }
timber_west_support_panel_xyz = Point.ByCoordinates(x=timber_west_support_panel.xw, y=timber_west_support_panel.out1, z=timber_west_support_panel.out2)
timber_support_panel_list = List.Create(item0=timber_east_support_panel_xyz, item1=timber_west_support_panel_xyz)
timber_support_panels = Cuboid.ByLengths(origin=timber_support_panel_list, width=concrete_width_and_length.width, length=timber_support_panel_length, height=timber_thickness_of_timber)
timber_support_rgb = CodeBlock { 70; 0; 0; }
timber_support_rgb_colours = Color.ByARGB(red=timber_support_rgb.out0, green=timber_support_rgb.out1, blue=timber_support_rgb.out2)
timber_support_colour = Modifiers.GeometryColor.ByGeometryColor(geometry=timber_support_panels, color=timber_support_rgb_colours)
timber_southernmost_panel = CodeBlock(y_block=concrete_southwest_pillar_xyz.out1, l_block=concrete_width_and_length.length, h_block=concrete_height, t_block=timber_thickness_of_timber) { 0; y_block-1/2*l_block; h_block+3/2*t_block; }
timber_southernmost_panel_xyz = Point.ByCoordinates(x=timber_southernmost_panel.out0, y=timber_southernmost_panel.out1, z=timber_southernmost_panel.out2)
timber_northernmost_panel = CodeBlock(y_block=concrete_northwest_pillar_xyz.out1, l_block=concrete_width_and_length.length, h_block=concrete_height, t_block=timber_thickness_of_timber) { 0; y_block+1/2*l_block; h_block+3/2*t_block; }
timber_northernmost_panel_xyz = Point.ByCoordinates(x=timber_northernmost_panel.out0, y=timber_northernmost_panel.out1, z=timber_northernmost_panel.out2)
timber_loctaions_of_timber = Line.ByStartPointEndPoint(startPoint=timber_southernmost_panel_xyz, endPoint=timber_northernmost_panel_xyz)  # "Timber: Loctaions of Timber Panels"
timber_segments_of_timber_panels = Curve.PointsAtEqualSegmentLength(curve=timber_loctaions_of_timber, divisions=timber_number_of_timber_panels)
timber_panels = Cuboid.ByLengths(origin=timber_segments_of_timber_panels, width=timber_panel_width, length=timber_panel_length, height=timber_thickness_of_timber)
timber_panel_rgb = CodeBlock { 70; 0; 0; }
timber_panel_rgb_colours = Color.ByARGB(red=timber_panel_rgb.out0, green=timber_panel_rgb.out1, blue=timber_panel_rgb.out2)
timber_panel_colour = Modifiers.GeometryColor.ByGeometryColor(geometry=timber_panels, color=timber_panel_rgb_colours)
