# Dynamo graph 1841356.dyn (Dynamo 3.5.2.8914)

# group: Don't touch this ground
code_block = CodeBlock { -5000; -5000; -200; }  # frozen
byCoordinates = Point.ByCoordinates(x=code_block.out0, y=code_block.out1, z=code_block.out2)  # frozen
code_block_2 = CodeBlock { 5000; 5000; 0; }  # frozen
byCoordinates_2 = Point.ByCoordinates(x=code_block_2.out0, y=code_block_2.out1, z=code_block_2.out2)  # frozen
byCorners = Cuboid.ByCorners(lowPoint=byCoordinates, highPoint=byCoordinates_2)  # frozen
code_block_3 = CodeBlock { 0; 100; 0; }  # frozen
byARGB = Color.ByARGB(red=code_block_3.out0, green=code_block_3.out1, blue=code_block_3.out2)  # frozen
byGeometryColor = Modifiers.GeometryColor.ByGeometryColor(geometry=byCorners, color=byARGB)  # frozen

nRibsPerPetal = DoubleSlider(14, range=4..15 step 1)
innerradius_m = DoubleSlider(1.4, range=0..3 step 0.1)
outerRadius = DoubleSlider(4.5, range=2.5..5 step 0.1)
heightpetal1_highest = DoubleSlider(3.2, range=2..5 step 0.1)
hieghtpetal_2 = DoubleSlider(2.8, range=2..5 step 0.1)
heightPetal3 = DoubleSlider(2.3, range=2..5 step 0.1)
thinckness_for_petal_shell = DoubleSlider(0.1, range=0.05..0.2 step 0.1)
baseOffset = DoubleSlider(1.6, range=1..2.5 step 0.1)
seatHeigh = DoubleSlider(0.45, range=0.3..1 step 0.1)
petalClassesAndInstances = Python(IN[0]=nRibsPerPetal, IN[1]=innerradius_m, IN[2]=outerRadius, IN[3]=heightpetal1_highest, IN[4]=hieghtpetal_2, IN[5]=heightPetal3, IN[6]=thinckness_for_petal_shell, IN[7]=baseOffset, IN[8]=seatHeigh)  # CPython3
# ---------- petalClassesAndInstances.python (98 lines) ----------
import clr
clr.AddReference("ProtoGeometry")
from Autodesk.DesignScript.Geometry import *
import math

nDiv       = int(IN[0])
innerR     = float(IN[1])
outerR     = float(IN[2])
h1         = float(IN[3])
h2         = float(IN[4])
h3         = float(IN[5])
thickness  = float(IN[6])
seatH      = float(IN[7])
baseOffset = float(IN[8])

if nDiv < 2:
    nDiv = 2


class FlowerPetal:
    def __init__(self, inner_radius, outer_radius,
                 start_angle, end_angle,
                 max_height, divisions, shell_thickness):
        self.inner_radius    = inner_radius
        self.outer_radius    = outer_radius
        self.start_angle     = start_angle
        self.end_angle       = end_angle
        self.max_height      = max_height
        self.divisions       = max(2, int(divisions))
        self.shell_thickness = shell_thickness

    def make_solid(self):
        inner_pts = []
        outer_pts = []
        total_angle = self.end_angle - self.start_angle

        for i in range(self.divisions):
            t = float(i) / float(self.divisions - 1)
            ang = self.start_angle + t * total_angle

            x_in = self.inner_radius * math.cos(ang)
            y_in = self.inner_radius * math.sin(ang)
            z_in = seatH + baseOffset

            x_out = self.outer_radius * math.cos(ang)
            y_out = self.outer_radius * math.sin(ang)
            z_out = seatH + baseOffset + self.max_height * t

            inner_pts.append(Point.ByCoordinates(x_in,  y_in,  z_in))
            outer_pts.append(Point.ByCoordinates(x_out, y_out, z_out))

        crv_in  = PolyCurve.ByPoints(inner_pts)
        crv_out = PolyCurve.ByPoints(outer_pts)
        surf    = Surface.ByLoft([crv_in, crv_out])
        solid   = surf.Thicken(self.shell_thickness, False)
        return solid

    def volume(self):
        return self.make_solid().Volume


class SeatBlock:
    def __init__(self, radius, height):
        self.radius = radius
        self.height = height

    def make_solid(self):
        p0 = Point.ByCoordinates(0, 0, 0)
        p1 = Point.ByCoordinates(0, 0, self.height)
        return Cylinder.ByPointsRadius(p0, p1, self.radius)

    def volume(self):
        return self.make_solid().Volume


angle_step = 2.0 * math.pi / 3.0
heights    = [h1, h2, h3]

petals    = []
pet_vols  = []

for i in range(3):
    start_a = i * angle_step
    end_a   = (i + 1) * angle_step
    h_max   = heights[i]

    pet = FlowerPetal(innerR, outerR, start_a, end_a,
                      h_max, nDiv, thickness)
    solid = pet.make_solid()
    petals.append(solid)
    pet_vols.append(pet.volume())

total_petal_volume = sum(pet_vols)

seat_obj = SeatBlock(innerR, baseOffset)
seat_volume_from_class = seat_obj.volume()

OUT = [petals, total_petal_volume, pet_vols, seat_volume_from_class]
# ----------------------------------------
watch = Watch(petalClassesAndInstances)
code_block_4 = CodeBlock { 1; }
total_petal_volume = List.GetItemAtIndex(list=petalClassesAndInstances, index=code_block_4)
volume_Material1_WoodPetals = Watch(total_petal_volume)
code_block_5 = CodeBlock { 0; }
petalSolid = List.GetItemAtIndex(list=petalClassesAndInstances, index=code_block_5)
code_block_6 = CodeBlock { x = 0; y = 0; z = 0; }
basePtBottom = Point.ByCoordinates(x=code_block_6.x, y=code_block_6.y, z=code_block_6.z)
code_block_7 = CodeBlock { x = 0; y = 0; z = 0.5; }
basePtTop = Point.ByCoordinates(x=code_block_7.x, y=code_block_7.y, z=code_block_7.z)
seatRadius = DoubleSlider(2.5, range=0.8..3 step 0.1)
bypointsradius = Cylinder.ByPointsRadius(startPoint=basePtBottom, endPoint=basePtTop, radius=seatRadius)  # "baseSolid."
code_block_8 = CodeBlock(seatHeight=seatHeigh) { x = 0; y = 0; z = seatHeight; }
columnPtBottom = Point.ByCoordinates(x=code_block_8.x, y=code_block_8.y, z=code_block_8.z)
code_block_9 = CodeBlock(seatHeight=seatHeigh, baseOffset=baseOffset) { x = 0; y = 0; z = seatHeight + baseOffset; }
columnPtTop = Point.ByCoordinates(x=code_block_9.x, y=code_block_9.y, z=code_block_9.z)
columnSolid = Cylinder.ByPointsRadius(startPoint=columnPtBottom, endPoint=columnPtTop, radius=innerradius_m)
create = List.Create(item0=bypointsradius, item1=columnSolid)
seatSolid = Solid.ByUnion(solids=create)
list_create = List.Create(item0=petalSolid, item1=seatSolid)
code_block_10 = CodeBlock { 1; }
flatten = List.Flatten(list=list_create, amount=code_block_10)
pavilionsolid_final = Solid.ByUnion(solids=flatten)
volume = Solid.Volume(solid=seatSolid)
volume_Material2_BaseAndColumn = Watch(volume)
