# Dynamo graph 1843464.dyn (Dynamo 3.6.0.9395)

# group: Don't touch this ground
code_block = CodeBlock { -5000; -5000; -200; }  # frozen
byCoordinates = Point.ByCoordinates(x=code_block.out0, y=code_block.out1, z=code_block.out2)  # frozen
code_block_2 = CodeBlock { 5000; 5000; 0; }  # frozen
byCoordinates_2 = Point.ByCoordinates(x=code_block_2.out0, y=code_block_2.out1, z=code_block_2.out2)  # frozen
byCorners = Cuboid.ByCorners(lowPoint=byCoordinates, highPoint=byCoordinates_2)  # frozen
code_block_3 = CodeBlock { 0; 100; 0; }  # frozen
byARGB = Color.ByARGB(red=code_block_3.out0, green=code_block_3.out1, blue=code_block_3.out2)  # frozen
byGeometryColor = Modifiers.GeometryColor.ByGeometryColor(geometry=byCorners, color=byARGB)  # frozen

origin = CodeBlock { 0; 0; 0; }
bottom_points_of_cylinder = Point.ByCoordinates(x=origin.out0, y=origin.out1, z=origin.out2)
radius_of_wood_column = DoubleSlider(800, range=100..800 step 50)
circle = Circle.ByCenterPointRadius(centerPoint=bottom_points_of_cylinder, radius=radius_of_wood_column)
height = DoubleSlider(2400, range=2000..4000 step 500)
start_of_arc = Geometry.Translate(geometry=circle, zTranslation=height)
number_of_petals_1 = DoubleSlider(6, range=3..7 step 1)
code_block_4 = CodeBlock(n=number_of_petals_1) { 0..1..#n; }
coordinateSystemAtParameter = Curve.CoordinateSystemAtParameter(curve=start_of_arc, param=code_block_4)
byCartesianCoordinates = Point.ByCartesianCoordinates(coordinateSystem=coordinateSystemAtParameter)
code_block_5 = CodeBlock { 0; 0; 0; }
start_point = Point.ByCoordinates(x=code_block_5.out0, y=code_block_5.out1, z=height)
center = CodeBlock { 1; }
scale = Geometry.Scale(geometry=circle, xamount=center, yamount=center)
height_of_petal_core_midpoint = CodeBlock { 3000; }
center_of_arc = Geometry.Translate(geometry=scale, zTranslation=height_of_petal_core_midpoint)
coordinateSystemAtParameter_2 = Curve.CoordinateSystemAtParameter(curve=center_of_arc, param=code_block_4)
byCartesianCoordinates_2 = Point.ByCartesianCoordinates(coordinateSystem=coordinateSystemAtParameter_2)
top = CodeBlock { 1.5; }
scale_2 = Geometry.Scale(geometry=circle, xamount=top, yamount=top)
height_of_petal_core_end_point = CodeBlock { 2500; }
tip_of_arc = Geometry.Translate(geometry=scale_2, zTranslation=height_of_petal_core_end_point)
coordinateSystemAtParameter_3 = Curve.CoordinateSystemAtParameter(curve=tip_of_arc, param=code_block_4)
byCartesianCoordinates_3 = Point.ByCartesianCoordinates(coordinateSystem=coordinateSystemAtParameter_3)
byThreePoints = Arc.ByThreePoints(firstPoint=start_point, secondPoint=byCartesianCoordinates_2, thirdPoint=byCartesianCoordinates_3)
ZAxis = Vector.ZAxis()
byStartPointEndPointStartTangent = Arc.ByStartPointEndPointStartTangent(startPoint=start_point, endPoint=byCartesianCoordinates_3, startTangent=ZAxis)
list_create = List.Create(item0=byThreePoints, item1=byStartPointEndPointStartTangent)
transpose = List.Transpose(lists=list_create)
byJoinedCurves = PolyCurve.ByJoinedCurves(curves=transpose)
byPatch = Surface.ByPatch(closedCurve=byJoinedCurves)
petal_thickness = DoubleSlider(50, range=2..500 step 1)
thicken = Surface.Thicken(surface=byPatch, thickness=petal_thickness)
angle_divisions = CodeBlock(n=number_of_petals_1) { 0..360..#n; }
watch = Watch(angle_divisions)
code_block_6 = CodeBlock { 0; 0; }
start_point_2 = Point.ByCoordinates(x=code_block_6.out0, y=code_block_6.out1, z=height)
petal_width = DoubleSlider(600, range=500..8000 step 50)
code_block_7 = CodeBlock(petal_width=petal_width) { 500; petal_width; }
center_point = Point.ByCoordinates(x=code_block_7.out0, y=code_block_7.petal_width, z=height)
code_block_8 = CodeBlock { 4500; 0; }
edge_height = DoubleSlider(3000, range=2000..4000 step 500)
end_point = Point.ByCoordinates(x=code_block_8.out0, y=code_block_8.out1, z=edge_height)
petal_arc = Arc.ByThreePoints(firstPoint=start_point_2, secondPoint=center_point, thirdPoint=end_point)
code_block_9 = CodeBlock { 0; 0; 1000; }
byCoordinates_3 = Point.ByCoordinates(x=code_block_9.out0, y=code_block_9.out1, z=code_block_9.out2)
YAxis = Vector.YAxis()
byOriginNormal = Plane.ByOriginNormal(origin=byCoordinates_3, normal=YAxis)
mirror = Geometry.Mirror(geometry=petal_arc, mirrorPlane=byOriginNormal)
list_create_2 = List.Create(item0=petal_arc, item1=mirror)
one_joined_petal = PolyCurve.ByJoinedCurves(curves=list_create_2)
ZAxis_2 = Vector.ZAxis()
all_petals = Geometry.Rotate(geometry=one_joined_petal, origin=start_point_2, axis=ZAxis_2, degrees=angle_divisions)
watch_2 = Watch(all_petals)
transpose_2 = List.Transpose(lists=all_petals)
watch_3 = Watch(transpose_2)
class_petal_surface = Python()  # CPython3; unwired: IN[0]
# ---------- class_petal_surface.python (14 lines) ----------
# Load the Python Standard and DesignScript Libraries
import sys
import clr
clr.AddReference('ProtoGeometry')
from Autodesk.DesignScript.Geometry import *

class PetalSurface:
    def __init__(self, closed_boundary):
        self.boundary = closed_boundary
        
    def make_geometry(self):
        return Surface.ByPatch(self.boundary)
        
OUT = PetalSurface
# ----------------------------------------
petal_thickness_2 = DoubleSlider(100, range=10..100 step 5)
instance_of_petals = Python(IN[0]=transpose_2, IN[1]=class_petal_surface, IN[2]=petal_thickness_2)  # CPython3
# ---------- instance_of_petals.python (19 lines) ----------
PetalSurface = IN[1]
petal = IN[0]
thickness = IN[2]

flower = []
total_volume = 0.0

for item in petal:
    f = PetalSurface(item)
    surface = f.make_geometry()
    
    thickened_petal = surface.Thicken(thickness)
    flower.append(thickened_petal)
    
    vol = thickened_petal.Volume
    total_volume += vol
    
    
OUT = (total_volume, flower)
# ----------------------------------------
petals_total_volume_mm_3 = Watch(instance_of_petals)
top_points_of_cylinder = Point.ByCoordinates(x=origin.out0, y=origin.out1, z=height)
class_wood_rod = Python()  # CPython3; unwired: IN[0]
# ---------- class_wood_rod.python (16 lines) ----------
# Load the Python Standard and DesignScript Libraries
import sys
import clr
clr.AddReference('ProtoGeometry')
from Autodesk.DesignScript.Geometry import *

class Wood_Support:
    def __init__(self, bottom_point, top_point, radius):
        self.bottom = bottom_point
        self.top = top_point
        self.radius = radius
        
    def make_geometry(self):
        return Cylinder.ByPointsRadius(self.bottom, self.top, self.radius)   
        
OUT = Wood_Support
# ----------------------------------------
instance_of_a_wood_rod = Python(IN[0]=bottom_points_of_cylinder, IN[1]=top_points_of_cylinder, IN[2]=radius_of_wood_column, IN[3]=class_wood_rod)  # CPython3
# ---------- instance_of_a_wood_rod.python (7 lines) ----------
Wood_Support = IN[3]
b = Wood_Support(IN[0],IN[1],IN[2])

support = b.make_geometry()
total_volume = support.Volume

OUT = (total_volume, support)
# ----------------------------------------
cylinder_support_total_volume_mm = Watch(instance_of_a_wood_rod)  # "Cylinder Support Total Volume (mm^3)"
code_block_10 = CodeBlock { 1; }
petals = List.GetItemAtIndex(list=instance_of_petals, index=code_block_10)
code_block_11 = CodeBlock { 255; 255; 120; 180; }
byARGB_2 = Color.ByARGB(alpha=code_block_11.out0, red=code_block_11.out1, green=code_block_11.out2, blue=code_block_11.out3)
petal_color = Modifiers.GeometryColor.ByGeometryColor(geometry=petals, color=byARGB_2)
watch_4 = Watch(petals)
