# Dynamo graph 1848599.dyn (Dynamo 4.0.0.3277)

# group: Don't touch this ground
code_block = CodeBlock { -5000; -5000; -200; }
byCoordinates = Point.ByCoordinates(x=code_block.out0, y=code_block.out1, z=code_block.out2)
code_block_2 = CodeBlock { 5000; 5000; 0; }
byCoordinates_2 = Point.ByCoordinates(x=code_block_2.out0, y=code_block_2.out1, z=code_block_2.out2)
byCorners = Cuboid.ByCorners(lowPoint=byCoordinates, highPoint=byCoordinates_2)
code_block_3 = CodeBlock { 0; 100; 0; }
byARGB = Color.ByARGB(red=code_block_3.out0, green=code_block_3.out1, blue=code_block_3.out2)
byGeometryColor = Modifiers.GeometryColor.ByGeometryColor(geometry=byCorners, color=byARGB)

bending_support_beams_total = DoubleSlider(6000, range=4000..6000 step 500)  # "Bending Support Beams Total Height"
width_of_bending_support_beams = DoubleSlider(700, range=500..1000 step 100)
thickness_of_bending_support = DoubleSlider(700, range=500..1000 step 100)  # "Thickness of Bending Support Beams"
bending_support_beam_s_bend = DoubleSlider(0.3, range=0..0.7 step 0.1)  # "Bending Support Beam's Bend Position Ratio (0-0.7)"
amount_of_bend_in_bending = DoubleSlider(3000, range=3000..6000 step 1000)  # "Amount Of Bend in Bending Support Beams"
radius_of_crown_jewel = DoubleSlider(2000, range=1000..3000 step 500)
class_steel_bending_support = Python(IN[0]=bending_support_beams_total, IN[1]=width_of_bending_support_beams, IN[2]=thickness_of_bending_support, IN[3]=bending_support_beam_s_bend, IN[4]=amount_of_bend_in_bending, IN[5]=radius_of_crown_jewel)  # "Class : Steel Bending Support Beams"; PythonNet3
# ---------- class_steel_bending_support.python (52 lines) ----------
import clr
clr.AddReference("ProtoGeometry")
from Autodesk.DesignScript.Geometry import *
import math

class SmoothBendingPillar:
    def __init__(self, height, width, thickness, baseY, material):
        self.height = height
        self.width = width
        self.thickness = thickness
        self.baseY = baseY
        self.material = material

    def create(self, bendPos, bendAmount):
        bendPos = max(0.1, min(0.9, bendPos))
        bendHeight = self.height * bendPos
        by = self.baseY

        p_bottom = Point.ByCoordinates(0, by, 0)
        p_bendL  = Point.ByCoordinates(0, by, bendHeight)
        p_bendR  = Point.ByCoordinates(self.width, by, bendHeight)

        ctrlL1 = Point.ByCoordinates(0, by + bendAmount, bendHeight + bendAmount)
        ctrlL2 = Point.ByCoordinates(0, by + bendAmount/2, self.height)

        ctrlR1 = Point.ByCoordinates(self.width, by + bendAmount, bendHeight + bendAmount)
        ctrlR2 = Point.ByCoordinates(self.width, by + bendAmount/2, self.height)

        p_topL  = Point.ByCoordinates(0, by, self.height)
        p_topR  = Point.ByCoordinates(self.width, by, self.height)

        leftCurve  = NurbsCurve.ByControlPoints([p_bottom, p_bendL, ctrlL1, ctrlL2, p_topL])
        rightCurve = NurbsCurve.ByControlPoints([
            p_bottom.Translate(Vector.ByCoordinates(self.width,0,0)),
            p_bendR, ctrlR1, ctrlR2, p_topR
        ])

        surface = Surface.ByLoft([leftCurve, rightCurve])
        solid = surface.Thicken(self.thickness, True)

        return [solid, material]

h = IN[0]
w = IN[1]
t = IN[2]
bendPos = IN[3]
bendAmt = IN[4]
baseY = IN[5]
material = "Steel"

pillar = SmoothBendingPillar(h, w, t, baseY, "Steel")
OUT = pillar.create(bendPos, bendAmt)
# ----------------------------------------
first_item_of_list_solid = CodeBlock { 0; }
getItemAtIndex = List.GetItemAtIndex(list=class_steel_bending_support, index=first_item_of_list_solid)
number_of_bending_support_beams = IntegerSlider(6, range=4..12 step 2)
instances_of_steel_bending = Python(IN[0]=getItemAtIndex, IN[1]=number_of_bending_support_beams, IN[2]=radius_of_crown_jewel)  # "Instances of Steel Bending Support Beams"; PythonNet3
# ---------- instances_of_steel_bending.python (40 lines) ----------
import clr
clr.AddReference("ProtoGeometry")
from Autodesk.DesignScript.Geometry import *
import math

pillar = IN[0]
count = IN[1]
radius = IN[2]

instances = []
step = 360.0 / count

origin = Point.ByCoordinates(0,0,0)
axis = Vector.ZAxis()

offset = 270


bbox = pillar.BoundingBox
width = bbox.MaxPoint.X - bbox.MinPoint.X
centerShift = -width / 2

for i in range(count):
    ang = i * step

    shifted = pillar.Translate(Vector.ByCoordinates(centerShift, 0, 0))

    moved_to_origin = shifted.Translate(Vector.ByCoordinates(0, -radius, 0))

    rotated = moved_to_origin.Rotate(origin, axis, ang + offset)

    rad = math.radians(ang)
    x = radius * math.cos(rad)
    y = radius * math.sin(rad)

    final = rotated.Translate(Vector.ByCoordinates(x, y, 0))

    instances.append(final)

OUT = instances
# ----------------------------------------
point_bycoordinates_gernerates = Point.ByCoordinates(z=bending_support_beams_total)  # "Point.ByCoordinates (Gernerates point on Z-axis to Place Center of Jewel)"
crown_jewel = Sphere.ByCenterPointRadius(centerPoint=point_bycoordinates_gernerates, radius=radius_of_crown_jewel)
coordinatesystem_byoriginvectors = CoordinateSystem.ByOriginVectors()  # "CoordinateSystem.ByOriginVectors (Orgin and Up)"
half_1_2 = CodeBlock { 0.5; }
multiplier_takes_half_of = thickness_of_bending_support * half_1_2  # "Multiplier (Takes Half of Thickness of Bending Support Beams)"
sum_of_radius_of_crown_jewel_and = radius_of_crown_jewel + multiplier_takes_half_of  # "Sum (Of Radius of Crown Jewel and Half of Thickness of Bending Support Beams)"
crown_s_base_cylinderheight = DoubleSlider(400, range=50..500 step 50)
crown_s_base_cylinder = Cylinder.ByRadiusHeight(coordinateSystem=coordinatesystem_byoriginvectors, radius=sum_of_radius_of_crown_jewel_and, height=crown_s_base_cylinderheight)
volume = Solid.Volume(solid=getItemAtIndex)
multiplier_of_number_of_supports = volume * number_of_bending_support_beams
watch_volume_of_all_support = Watch(multiplier_of_number_of_supports)  # "Watch (Volume of All Support Beams (mm^3))"
connector_ring_thickness = DoubleSlider(200, range=0..300 step 50)
connector_ring_s_vertical = DoubleSlider(100, range=50..200 step 50)  # "Connector Ring's Vertical Thickness"
class_wooden_connector_ring = Python(IN[0]=radius_of_crown_jewel, IN[1]=connector_ring_thickness, IN[2]=connector_ring_s_vertical, IN[3]=bending_support_beams_total)  # PythonNet3
# ---------- class_wooden_connector_ring.python (33 lines) ----------
import clr
clr.AddReference("ProtoGeometry")
from Autodesk.DesignScript.Geometry import *

class ConnectorRing:
    def __init__(self, sphereRadius, ringThickness, ringHeight, zLevel, material):
        self.sphereRadius = sphereRadius
        self.ringThickness = ringThickness
        self.ringHeight = ringHeight
        self.zLevel = zLevel
        self.material = material

    def create(self):
        innerRadius = self.sphereRadius
        outerRadius = self.sphereRadius + self.ringThickness

        origin = Point.ByCoordinates(0,0,self.zLevel)
        cs = CoordinateSystem.ByOrigin(origin)

        outer = Cylinder.ByRadiusHeight(cs, outerRadius, self.ringHeight)
        inner = Cylinder.ByRadiusHeight(cs, innerRadius, self.ringHeight)

        ring = outer.Difference(inner)
        return [ring, material]

sphereRadius  = IN[0]
ringThickness = IN[1]
ringHeight    = IN[2]
zLevel        = IN[3]
material      = "Wood"

obj = ConnectorRing(sphereRadius, ringThickness, ringHeight, zLevel, material)
OUT = obj.create()
# ----------------------------------------
getItemAtIndex_2 = List.GetItemAtIndex(list=class_wooden_connector_ring, index=first_item_of_list_solid)
volume_2 = Solid.Volume(solid=getItemAtIndex_2)
watch_volume_of_ring_mm_3 = Watch(volume_2)
watch_volume_of_single_support = Watch(volume)  # "Watch (Volume of Single Support Beam (mm^3))"
watch_output_of_class = Watch(class_wooden_connector_ring)
watch_output_of_class_2 = Watch(class_steel_bending_support)
