# Dynamo graph 1848673.dyn (Dynamo 3.6.0.9395)

code_block = CodeBlock { -5000; -5000; -200; }
byCoordinates = Point.ByCoordinates(x=code_block.out0, y=code_block.out1, z=code_block.out2)
code_block_2 = CodeBlock { 5000; 5000; 0; }
byCoordinates_2 = Point.ByCoordinates(x=code_block_2.out0, y=code_block_2.out1, z=code_block_2.out2)
byCorners = Cuboid.ByCorners(lowPoint=byCoordinates, highPoint=byCoordinates_2)
code_block_3 = CodeBlock { 0; 100; 0; }
byARGB = Color.ByARGB(red=code_block_3.out0, green=code_block_3.out1, blue=code_block_3.out2)
byGeometryColor = Modifiers.GeometryColor.ByGeometryColor(geometry=byCorners, color=byARGB)
code_block_4 = CodeBlock { 0; 0; 0; }
byCoordinates_3 = Point.ByCoordinates(x=code_block_4.out0, y=code_block_4.out1, z=code_block_4.out2)
pavillion_radius = DoubleSlider(4278.7, range=2500..5000 step 0.1)
byCenterPointRadius = Circle.ByCenterPointRadius(centerPoint=byCoordinates_3, radius=pavillion_radius)
number_of_ribs = IntegerSlider(47, range=1..100 step 1)
code_block_5 = CodeBlock(num_ribs=number_of_ribs) { 0; num_ribs; angle_step = 80*Math.PI / num_ribs; angles = (0..num_ribs-1) * angle_step; }
sequence = Sequence(start=code_block_5.out0, amount=code_block_5.num_ribs, step=code_block_5.angle_step)
rib_height = DoubleSlider(2872.7, range=1500..5000 step 0.1)
curvature_factor = CodeBlock { rib_curvature = 0.9; }
base_middle_and_top_points = CodeBlock(angle=sequence, pav_radius=pavillion_radius, rib_height=rib_height, cf=curvature_factor)
# ---------- base_middle_and_top_points.designscript (16 lines) ----------
angle;
pav_radius;
rib_height;
cf;

x_b=Math.Cos(angle)*pav_radius;
y_b=Math.Sin(angle)*pav_radius;
z_b=0;

x_m = x_b * 0.8 + 500;
y_m = y_b * 0.8 + 500;
z_m = rib_height * cf;

x_t = x_b * 0.2;
y_t = y_b * 0.2;
z_t = rib_height;
# ----------------------------------------
base_point = Point.ByCoordinates(x=base_middle_and_top_points.x_b, y=base_middle_and_top_points.y_b, z=base_middle_and_top_points.z_b)
mid_point = Point.ByCoordinates(x=base_middle_and_top_points.x_m, y=base_middle_and_top_points.y_m, z=base_middle_and_top_points.z_m)
top_point = Point.ByCoordinates(x=base_middle_and_top_points.x_t, y=base_middle_and_top_points.y_t, z=base_middle_and_top_points.z_t)
ribs_connection = Python(IN[0]=base_point, IN[1]=mid_point, IN[2]=top_point, IN[3]=number_of_ribs)  # CPython3
# ---------- ribs_connection.python (24 lines) ----------
# Load the Python Standard and DesignScript Libraries
import sys
import clr
clr.AddReference('ProtoGeometry')
from Autodesk.DesignScript.Geometry import *

# This code block is conecting each of the base mid and top points into a curve

base_points = IN[0]
mid_points = IN[1]
top_points = IN[2]
num_ribs = IN[3] #int

curves = []

for i in range(num_ribs):
    curves.append([])

for j in range(num_ribs):
    curves[j].append(base_points[j])
    curves[j].append(mid_points[j])
    curves[j].append(top_points[j])
    
OUT = curves
# ----------------------------------------
watch = Watch(ribs_connection)
byPoints = NurbsCurve.ByPoints(points=ribs_connection)
rib_radius = DoubleSlider(200, range=10..250 step 0.1)
ribs_class = Python()  # CPython3
# ---------- ribs_class.python (26 lines) ----------
import sys
import clr
clr.AddReference('ProtoGeometry')
from Autodesk.DesignScript.Geometry import *

class Rib(object):
    def __init__(self, curve, radius):
        self.curve = curve
        self.radius = radius
        self._geom = None

    def make_geometry(self):
        if self._geom is not None:
            return self._geom

        start_pt = self.curve.StartPoint
        profile = Circle.ByCenterPointRadius(start_pt, self.radius)
        solid = Solid.BySweep(profile, self.curve)
        self._geom = solid
        return self._geom

    def volume(self):
        geom = self.make_geometry()
        return geom.Volume

OUT = Rib
# ----------------------------------------
ribs_instances = Python(IN[0]=byPoints, IN[1]=rib_radius, IN[2]=ribs_class)  # CPython3
# ---------- ribs_instances.python (26 lines) ----------
import sys
import clr
clr.AddReference('ProtoGeometry')
from Autodesk.DesignScript.Geometry import *

curves    = IN[0]   # list of curves
ribRadius = IN[1]   # slider value
ribClass  = IN[2]   # Rib class 

rib_geoms = []
rib_vols  = []

for c in curves:
    if c is None:
        continue

    rib = ribClass(c, ribRadius)

    geom = rib.make_geometry()
    rib_geoms.append(geom)

    rib_vols.append(rib.volume())

total_rib_volume = sum(rib_vols)

OUT = (rib_geoms, rib_vols, total_rib_volume)
# ----------------------------------------
watch_2 = Watch(ribs_instances)
code_block_6 = CodeBlock { rrf = 0.177; }
code_block_7 = CodeBlock(pavillion_radius=pavillion_radius, rrf=code_block_6) { pavillion_radius; rrf; ring_radius = pavillion_radius * rrf; }
ringRadius = DoubleSlider(150, range=10..150 step 0.1)
ring_class = Python()  # CPython3
# ---------- ring_class.python (44 lines) ----------
import sys
import clr
clr.AddReference('ProtoGeometry')
from Autodesk.DesignScript.Geometry import *

class Ring(object):
    def __init__(self, origin, outer_radius, height, inner_radius):
        self.origin = origin
        self.outer_radius = outer_radius
        self.inner_radius = inner_radius
        self.height = height
        self._geom = None

    def make_geometry(self):
        if self._geom is not None:
            return self._geom

        orad = float(self.outer_radius)
        irad = float(self.inner_radius)
        irad = min(irad, orad)

        # Create base circles
        outer_circle = Circle.ByCenterPointRadius(self.origin, orad)
        inner_circle = Circle.ByCenterPointRadius(self.origin, irad)

        start = self.origin
        end = Point.ByCoordinates(start.X, start.Y, start.Z + self.height)
        path = Line.ByStartPointEndPoint(start, end)

        outer_surface = Surface.BySweep(outer_circle, path)
        inner_surface = Surface.BySweep(inner_circle, path)

        outer_solid = outer_surface.Thicken(self.inner_radius*0 + self.height, True)
        inner_solid = inner_surface.Thicken(self.inner_radius*0 + self.height, True)

        ring = Solid.Difference(outer_solid, inner_solid)

        self._geom = ring
        return ring

    def volume(self):
        return self.make_geometry().Volume

OUT = Ring
# ----------------------------------------
ring_instance = Python(IN[0]=byCoordinates_3, IN[1]=code_block_7.ring_radius, IN[2]=ringRadius, IN[3]=rib_height, IN[4]=ring_class)  # CPython3
# ---------- ring_instance.python (35 lines) ----------
import sys
import clr
clr.AddReference('ProtoGeometry')
from Autodesk.DesignScript.Geometry import *

# --- INPUTS ---
center      = IN[0]  # Point
ringRadius  = IN[1]  # path radius
crossRadius = IN[2]  # wall thickness
ringHeight  = IN[3]  # elevation
RingClass   = IN[4]  # class from Ring Class node

# ignore null inputs
if center is None:
    OUT = (None, None)
else:
    # reposition center at desired Z height
    origin = Point.ByCoordinates(center.X, center.Y, ringHeight)

    # derive outer / inner radii from thickness
    half_t = crossRadius * 0.5
    outerR = ringRadius + half_t
    innerR = max(ringRadius - half_t, 0)

    # vertical thickness = crossRadius
    height = crossRadius

    # create one Ring instance
    ring = RingClass(origin, outerR, height, innerR)

    # geometry + volume
    solid = ring.make_geometry()
    vol   = ring.volume()

    OUT = (solid, vol)
# ----------------------------------------
watch_3 = Watch(code_block_7.ring_radius)
