# Dynamo graph 1848717.dyn (Dynamo 3.6.0.9395)

# group: Don't touch this ground
code_block = CodeBlock { -5000; -5000; -200; }
byCoordinates = Point.ByCoordinates(x=code_block.out0, y=code_block.out1, z=code_block.out2)
code_block_2 = CodeBlock { 5000; 5000; 0; }
byCoordinates_2 = Point.ByCoordinates(x=code_block_2.out0, y=code_block_2.out1, z=code_block_2.out2)
byCorners = Cuboid.ByCorners(lowPoint=byCoordinates, highPoint=byCoordinates_2)
code_block_3 = CodeBlock { 0; 100; 0; }
byARGB = Color.ByARGB(red=code_block_3.out0, green=code_block_3.out1, blue=code_block_3.out2)
byGeometryColor = Modifiers.GeometryColor.ByGeometryColor(geometry=byCorners, color=byARGB)

# group: Golden Painted Ball Structure in Middle
spheres = Python()  # CPython3; unwired: IN[0]
# ---------- spheres.python (20 lines) ----------
# Load the Python Standard and DesignScript Libraries
import sys
import clr
clr.AddReference('ProtoGeometry')
from Autodesk.DesignScript.Geometry import *
import math

class StackModule:
    def __init__(self, base_point, radius):
        self.base = base_point
        self.radius = radius

    def sphere(self):
        return Sphere.ByCenterPointRadius(self.base, self.radius)
        
    def volume(self):
        return (4/3) * math.pi * (self.radius ** 3)

    
OUT = StackModule
# ----------------------------------------
start_radius_of_spheres = DoubleSlider(500, range=200..500 step 100)
number_of_spheres = DoubleSlider(5, range=2..5 step 1)
sphere_instances = Python(IN[0]=spheres, IN[1]=start_radius_of_spheres, IN[2]=number_of_spheres)  # CPython3
# ---------- sphere_instances.python (40 lines) ----------
# Load the Python Standard and DesignScript Libraries
import sys
import clr
clr.AddReference('ProtoGeometry')
from Autodesk.DesignScript.Geometry import *
import math

Class = IN[0]
start_radius = IN[1]
count  = IN[2]

modules = []
volume = []

radius = start_radius
decrement = 0.5
prev_radius = 0
z = 0

for i in range(int(count)):
    if radius <= 0:
        break
    if i == 0:
        z = radius
    else:
        z += prev_radius + radius
    
    base = Point.ByCoordinates(0,0,z)
    obj = Class(base, radius) 
    
    sphere = obj.sphere()
    vol = obj.volume()
    modules.append(sphere)
    volume.append(vol)
    
    prev_radius = radius
    radius -= decrement
    
    
OUT = (modules,volume)
# ----------------------------------------
sphere_volume_list_1 = Watch(sphere_instances)
code_block_4 = CodeBlock { 254; 203; 0; }
byARGB_2 = Color.ByARGB(red=code_block_4.out0, green=code_block_4.out1, blue=code_block_4.out2)
byGeometryColor_2 = Modifiers.GeometryColor.ByGeometryColor(geometry=sphere_instances, color=byARGB_2)

# group: Ceiling and Rods
circular_rods = Python()  # CPython3; unwired: IN[0]
# ---------- circular_rods.python (23 lines) ----------
# Load the Python Standard and DesignScript Libraries
import sys
import clr
clr.AddReference('ProtoGeometry')
from Autodesk.DesignScript.Geometry import *
import math

class CircularRod:
    def __init__(self, bottom_point, top_point, radius):
        self.bottom = bottom_point
        self.top = top_point
        self.radius = radius
    

    def make_geometry(self):
        return Cylinder.ByPointsRadius(self.bottom, self.top, self.radius)
        
    def volume(self):
        height = self.bottom.DistanceTo(self.top)
        return math.pi * (self.radius ** 2) * height
    

OUT = CircularRod
# ----------------------------------------
radius_of_rod = DoubleSlider(700, range=300..700 step 1)
height_of_rods = IntegerSlider(8000, range=5500..8000 step 1)
two_rods_on_other_side = Python(IN[0]=circular_rods, IN[1]=radius_of_rod, IN[2]=height_of_rods)  # CPython3
# ---------- two_rods_on_other_side.python (38 lines) ----------
import sys
import clr
clr.AddReference('ProtoGeometry')
from Autodesk.DesignScript.Geometry import *


CircularRodClass = IN[0]   
r = IN[1]                             
height = IN[2]            

bottom_points = []
top_points = []
rods = []
volume = []

x_change = 0
for i in range(2):
    
    bottom = Point.ByCoordinates(-4000 + x_change, -4000, 0)
    bottom_points.append(bottom)

    top = Point.ByCoordinates(-4000 + x_change, -4000, height)
    top_points.append(top)

    
    rod = CircularRodClass(bottom_points[i], top_points[i], r)
    
   
    rods.append(rod.make_geometry())
    vol = rod.volume()
    
    volume.append(vol)
   

   
    x_change += 8000

OUT = rods,volume 
# ----------------------------------------
volume_of_two_rods_on_one_side = Watch(two_rods_on_other_side)  # "Volume of Two rods on one side (List 1)"
amount_of_rods_in_middle_of_rod = IntegerSlider(4, range=1..4 step 1)  # "Amount of rods in middle of rod series"
rod_sequence_on_one_side = Python(IN[0]=circular_rods, IN[1]=radius_of_rod, IN[2]=amount_of_rods_in_middle_of_rod, IN[3]=height_of_rods)  # CPython3
# ---------- rod_sequence_on_one_side.python (47 lines) ----------
import sys
import clr
clr.AddReference('ProtoGeometry')
from Autodesk.DesignScript.Geometry import *


CircularRodClass = IN[0]   
r = IN[1]                  
number = IN[2]             
height = IN[3]             

bottom_points = []
top_points = []
rods = []
volume = []

x_change = 0
for i in range(number):
   
    bottom = Point.ByCoordinates(-4000 + x_change, 4000, 0)
    bottom_points.append(bottom)

    top = Point.ByCoordinates(-4000 + x_change, 4000, height)
    top_points.append(top)

    
    rod = CircularRodClass(bottom_points[i], top_points[i], r)
    
 
    rods.append(rod.make_geometry())
    vol = rod.volume()
    
    
    volume.append(vol)
    

    
    x_change += 2000
    

 
final_bottom = Point.ByCoordinates(4000, 4000, 0)
final_top = Point.ByCoordinates(4000, 4000, height)
final_rod = CircularRodClass(final_bottom, final_top, r)
rods.append(final_rod.make_geometry())

OUT = rods, volume
# ----------------------------------------
volume_of_sequence_of_rods_on = Watch(rod_sequence_on_one_side)  # "Volume of sequence of rods on other side (List 1)"
code_block_5 = CodeBlock { 216; 181; 137; }
byARGB_3 = Color.ByARGB(red=code_block_5.out0, green=code_block_5.out1, blue=code_block_5.out2)
tudor_oak_material = Modifiers.GeometryColor.ByGeometryColor(geometry=two_rods_on_other_side, color=byARGB_3)
code_block_6 = CodeBlock { -4500; -4500; }
byCoordinates_3 = Point.ByCoordinates(x=code_block_6.out0, y=code_block_6.out1, z=height_of_rods)
code_block_7 = CodeBlock { -4500; 4500; }
byCoordinates_4 = Point.ByCoordinates(x=code_block_7.out0, y=code_block_7.out1, z=height_of_rods)
code_block_8 = CodeBlock { 4500; 4500; }
byCoordinates_5 = Point.ByCoordinates(x=code_block_8.out0, y=code_block_8.out1, z=height_of_rods)
code_block_9 = CodeBlock { 4500; -4500; }
byCoordinates_6 = Point.ByCoordinates(x=code_block_9.out0, y=code_block_9.out1, z=height_of_rods)
list_of_points_for_ceiling = List.Create(item0=byCoordinates_3, item1=byCoordinates_4, item2=byCoordinates_5, item3=byCoordinates_6, item4=byCoordinates_3)
byPoints = Polygon.ByPoints(points=list_of_points_for_ceiling)
ceiling_surface = Surface.ByPatch(closedCurve=byPoints)
ceiling_thickness = DoubleSlider(200, range=100..500 step 100)
ceiling_thickness_2 = Surface.Thicken(surface=ceiling_surface, thickness=ceiling_thickness)
code_block_10 = CodeBlock { 230; 100; 160; 100; }
byARGB_4 = Color.ByARGB(alpha=code_block_10.out0, red=code_block_10.out1, green=code_block_10.out2, blue=code_block_10.out3)
green_stained_glass = Modifiers.GeometryColor.ByGeometryColor(geometry=ceiling_thickness_2, color=byARGB_4)
code_block_11 = CodeBlock { 216; 181; 137; }
byARGB_5 = Color.ByARGB(red=code_block_11.out0, green=code_block_11.out1, blue=code_block_11.out2)
tudor_oak_material_2 = Modifiers.GeometryColor.ByGeometryColor(geometry=rod_sequence_on_one_side, color=byARGB_5)
