# Dynamo graph 1848830.dyn (Dynamo 3.6.0.9395)

code_block = CodeBlock { -5000; -5000; -200; }
byCoordinates = Point.ByCoordinates(x=code_block.out0, y=code_block.out1, z=code_block.out2)
code_block_2 = CodeBlock { 5000; 5000; 0; }
byCoordinates_2 = Point.ByCoordinates(x=code_block_2.out0, y=code_block_2.out1, z=code_block_2.out2)
byCorners = Cuboid.ByCorners(lowPoint=byCoordinates, highPoint=byCoordinates_2)
code_block_3 = CodeBlock { 0; 100; 0; }
byARGB = Color.ByARGB(red=code_block_3.out0, green=code_block_3.out1, blue=code_block_3.out2)
byGeometryColor = Modifiers.GeometryColor.ByGeometryColor(geometry=byCorners, color=byARGB)
timber_ribs_profile_depth = CodeBlock { profile_depth=100; }
timber_rib_profile_length = CodeBlock { profile_length=200; }
steps_for_ribs_and_rods = CodeBlock { steps=50; }
grid_size = CodeBlock { grid_size=10000; }
entrance_height = CodeBlock { entrance_height=2000; }
maximum_height = DoubleSlider(3780, range=2500..5000 step 10)
curvature = DoubleSlider(2260, range=0..2500 step 10)
function_to_compute_the_height = Python(IN[0]=grid_size, IN[1]=entrance_height, IN[2]=maximum_height, IN[3]=curvature)  # "Function to compute the height at every point"; CPython3
# ---------- function_to_compute_the_height.python (41 lines) ----------
# Load the Libraries
import math


# --- INPUTS ---
#Index 0: Size of the grid (10000)
#Index 1: Entrance height (2000)
#Index 2: Maximum height of the pavilion
#Index 3: Curvature - amplitude of the S curving

size=IN[0]
entrance_h=IN[1]
MAX_HEIGHT=IN[2]
CURVATURE=IN[3]

# --- FUNCTION - computes the height at pont x,y ---

def calculate_z(x, y):
    half_size=size/2
    norm_x = (x + half_size) / size #normalizes x (between 0 and 1)
    norm_y = (y + half_size) / size #normalizes y (between 0 and 1)
    
    # 1. SYMMETRIC ARCH (Ends=Entrance height, Center=Max Height )
    sym_arch_height_factor = math.sin(norm_x * math.pi) #factor to be aplied to the height (from symmetry)
    sym_height = entrance_h + (MAX_HEIGHT - entrance_h) * sym_arch_height_factor #height based on symmetry only (sin)
    
    # 2. WAVEING LOGIC (S form of height)
    wave_strength = CURVATURE / half_size #Amplitude of wave
    wave_height_factor = wave_strength * math.cos(norm_x * math.pi*2) #factor to be applied to the height (from waveing)
    
    # 3. FINAL HEIGHT
    primary = math.sin(norm_y * math.pi) #factor to be aplied to the height (from symmetry)
    secondary = math.sin(norm_y * math.pi*2) #factro to be applied to the height to incorporate waveing
    
    z = sym_height * (primary + (wave_height_factor * secondary)) #final height at point x,y
    return z

    
# --- OUTPUT 
#One value - the height of the point x,y on the surface
OUT = calculate_z
# ----------------------------------------
class_timber_rib = Python(IN[0]=timber_ribs_profile_depth, IN[1]=timber_rib_profile_length, IN[2]=steps_for_ribs_and_rods, IN[3]=grid_size, IN[4]=function_to_compute_the_height)  # CPython3
# ---------- class_timber_rib.python (60 lines) ----------
# Load the Libraries
from Autodesk.DesignScript.Geometry import *


# --- INPUTS ---
#Index 0: width of the rib profile (rectangle)
#Index 1: length of the rib profile (rectangle)
#Index 2: number of steps in the length of the beam
#Index 3: size of the grid (10000) 
#Index 4: auxiliary function to compute the height

profile_width=IN[0]
profile_lenght=IN[1]
steps=IN[2]
size=IN[3]
calculate_z=IN[4]



# --- CLASS TIMBER RIB ---
#Creates a timber rib
class TimberRib:
    # Constructor
    def __init__(self, x_loc):
        self.x = x_loc #Defines x
        self.geometry = None #Initializes Geometry
        self.volume = 0 #Initializes volume
        self.pl=profile_lenght #Initializes profile length
        self.pw=profile_width #Initializes profile width
   
    # Method to create the geometry
    def create_geometry(self):
        points = [] #Empty points list
        step_size = size / steps #Calculates the size of each step
        for i in range(steps + 1): 
            y = -size/2 + (i * step_size) #Calculates y
            z = calculate_z(self.x, y) #Calculates z
            points.append(Point.ByCoordinates(self.x, y, z)) #Add new point to the list
            
        curve = NurbsCurve.ByPoints(points) #Interpolates curve
        plane = curve.PlaneAtParameter(0) #Orients the plane
        profile = Rectangle.ByWidthLength(plane, profile_width, profile_lenght) #Creates the rectangle profile
        solid = Solid.BySweep(profile, curve) #Creates the 3D beam
        self.geometry = solid #Saves the beam
        
        
    #Method to calculate the volume of the beam
    def calculate_volume(self): 
        self.volume =self.geometry.Volume #Sets volume to the volume of the beam
    
    #Method to create the beam and calculate the volume    
    def build(self):
        self.create_geometry() #Creates the beam
        self.calculate_volume() #Computes the volume
        return self


# --- OUTPUT ---
#Outputs the Class Timber Rib
OUT = TimberRib
# ----------------------------------------
wood_rib_count = IntegerSlider(49, range=25..60 step 1)
steel_rod_count = DoubleSlider(14, range=5..15 step 1)
n2d_surface_generation = CodeBlock(Size=grid_size, Rib_Count=wood_rib_count, Rod_Count=steel_rod_count)  # "2D surface generation"
# ---------- n2d_surface_generation.designscript (9 lines) ----------
// PARAMETERS
W = Size;
L = Size;

// RANGES
x_range = -W/2..W/2..#Rib_Count;
/*Creates the beam position list*/
y_range = -L/2..L/2..#Rod_Count;
/*Creates the rod position list*/;
# ----------------------------------------
series_of_instances_of_class = Python(IN[0]=class_timber_rib, IN[1]=n2d_surface_generation.x_range)  # "SERIES OF INSTANCES OF CLASS TIMBER RIB"; CPython3
# ---------- series_of_instances_of_class.python (23 lines) ----------
# Load the Libraries
from Autodesk.DesignScript.Geometry import *

# --- INPUTS ---
#Index 0: Class Timber Rib
#Index 1: List of the x positions of the ribs
TimberRib_Class = IN[0]
x_vals=IN[1]


#--- MAIN CODE ---
#  BUILDS LIST OF TIMBER RIBS

timber_ribs=[] #Empty list of timber ribs

for x in x_vals:
    rib = TimberRib_Class(x) #Creates new Timber Rib object 
    timber_ribs.append(rib.build()) #Builds it and adds it to the list
    

# --- OUTPUT ---
#Outputs the list of timber ribs
OUT=timber_ribs
# ----------------------------------------
rod_diameter = CodeBlock { rod_diameter=15; }
class_steel_rod = Python(IN[0]=steps_for_ribs_and_rods, IN[1]=rod_diameter, IN[2]=grid_size, IN[3]=function_to_compute_the_height)  # CPython3
# ---------- class_steel_rod.python (54 lines) ----------
# Load the Libraries
from Autodesk.DesignScript.Geometry import *


# --- INPUTS ---
#Index 0: number of steps in the length of the rod
#Index 1:radius of the rod profile (circle)
#Index 2: size of the grid (10000) 
#Index 3: auxiliary function to compute the height

steps=IN[0]
rod_radius=IN[1]
size=IN[2]
calculate_z=IN[3]


# --- CLASS: STEEL ROD ---
#Creates a steel rod
class SteelRod:
    # Constructor
    def __init__(self, y_loc):
        self.y = y_loc #Defines y
        self.geometry = None #Initializes Geometry
        self.volume = 0 #Initializes volume
        self.radius=rod_radius #Initializes profile radius
        
    # Method to create the geometry
    def create_geometry(self):
        points = [] #Empty points list
        step_size = size / steps #Calculates the size of each step
        for i in range(steps + 1):
            x = -size/2 + (i * step_size) #Calculates x
            z = calculate_z(x, self.y) #Calculates z
            points.append (Point.ByCoordinates(x, self.y, z))#Add new point to the list
            
        curve = NurbsCurve.ByPoints(points) #Interpolates curve
        plane = curve.PlaneAtParameter(0) #Orients the plane
        profile = Circle.ByPlaneRadius(plane, rod_radius) #Creates the circular profile
        solid = Solid.BySweep(profile, curve) #Creates the 3D rod
        self.geometry = solid #Saves the rod
        
     #Method to calculate the volume of the rod   
    def calculate_volume(self):                      
       self.volume=self.geometry.Volume #Sets volume to the volume of the rod
 
 #Method to create the rod and calculate the volume          
    def build(self):
        self.create_geometry() #Creates the rod
        self.calculate_volume() #Computes the volume
        return self

# --- OUTPUT ---
#Outputs the Class Steel Rod
OUT = SteelRod
# ----------------------------------------
series_of_instances_of_class_2 = Python(IN[0]=class_steel_rod, IN[1]=n2d_surface_generation.y_range)  # "SERIES OF INSTANCES OF CLASS STEEL ROD"; CPython3
# ---------- series_of_instances_of_class_2.python (23 lines) ----------
# Load the Libraries
from Autodesk.DesignScript.Geometry import *

# --- INPUTS ---
#Index 0: Class Steel Rod
#Index 1: List of the y positions of the rods

SteelRod_Class = IN[0]
y_vals=IN[1]


#--- MAIN CODE ---
#  BUILDS LIST OF STEEL RODS

steel_rods=[] #Empty list of steel rods

for y in y_vals:
    rod = SteelRod_Class(y) #Create new Steel Rod object 
    steel_rods.append(rod.build())  #Builds it and adds it to the list

# --- OUTPUT ---
#Outputs the list of steel ribs
OUT=steel_rods
# ----------------------------------------
steps_for_beam = CodeBlock { steps=70; /* Forc onsistency this hsoud be sqrt(2)*steps_for_ribs */; }
beam_diameter = CodeBlock { beam_diameter=45; }
class_steel_beam = Python(IN[0]=steps_for_beam, IN[1]=beam_diameter, IN[2]=function_to_compute_the_height, IN[3]=grid_size)  # CPython3
# ---------- class_steel_beam.python (59 lines) ----------
# Load the Libraries
from Autodesk.DesignScript.Geometry import *


# --- INPUTS ---
#Index 0: number of steps in the length of the beam
#Index 1: radius of the beam profile (circle)
#Index 2: auxiliary function to compute the height
#Index 3: size of the grid (10000)

steps=IN[0]
beam_radius=IN[1]
calculate_z=IN[2]
size=IN[3]



# --- CLASS STEEL BEAM  ---
#Creates a steel beam
class SteelBeam:
    # Constructor
    def __init__(self, x1, y1, x2, y2):
        self.x1 = x1 #Initial x
        self.y1 = y1 #Initial y
        self.x2 = x2 #Final x
        self.y2 = y2 #Final y
        self.geometry = None #Initializes Geometry
        self.volume = 0 #Initializes volume
        self.radius=beam_radius #Initializes profile radius

    # Method to create the geometry
    def create_geometry(self):
        points = [] #Empty points list
        for i in range(steps + 1):
            t = i / float(steps) #Calculates fraction of steps
            curr_x = self.x1 + (self.x2 - self.x1) * t #Calculates x
            curr_y = self.y1 + (self.y2 - self.y1) * t #Calculates y
            curr_z = calculate_z(curr_x, curr_y) #Calculates z
            points.append(Point.ByCoordinates(curr_x, curr_y, curr_z)) #Add new point to the list
            
        curve = NurbsCurve.ByPoints(points) #Interpolates curve
        plane = curve.PlaneAtParameter(0) #Orients the plane
        profile = Circle.ByPlaneRadius(plane, beam_radius) #Creates the circular profile
        solid = Solid.BySweep(profile, curve) #Creates the 3D beam
        self.geometry = solid #Saves the rod
    
    #Method to calculate the volume of the beam
    def calculate_volume(self):
        self.volume = self.geometry.Volume #Sets volume to the volume of the beam
   
    #Method to create the beam and calculate the volume   
    def build(self):
        self.create_geometry() #Creates the rod
        self.calculate_volume() #Computes the volume
        return self

# --- OUTPUT ---
#Outputs the Class Steel Beam
OUT = SteelBeam
# ----------------------------------------
instance_of_steel_beam_diagonal = Python(IN[0]=class_steel_beam, IN[1]=grid_size)  # "INSTANCE OF STEEL BEAM DIAGONAL 1"; CPython3
# ---------- instance_of_steel_beam_diagonal.python (22 lines) ----------
# Load the Libraries
from Autodesk.DesignScript.Geometry import *

# --- INPUTS ---
#Index 0: Class Steel Beam
#Index 1: Size of the grid
         
SteelBeam_Class = IN[0]
size=IN[1]

#--- MAIN CODE ---
#  BUILDS A TIMBER BEAM
# Diagonal 1: Bottom-Left to Top-Right

half_size=size/2 #Computes half size

diag_1 = SteelBeam_Class(-half_size, -half_size, half_size, half_size) #Creates a new steel beam objects
diag_1.build() #Builds it

# --- OUTPUT ---
#Outputs the newly created steel beam
OUT = diag_1
# ----------------------------------------
instance_of_steel_beam_diagonal_2 = Python(IN[0]=class_steel_beam, IN[1]=grid_size)  # "INSTANCE OF STEEL BEAM DIAGONAL 2"; CPython3
# ---------- instance_of_steel_beam_diagonal_2.python (22 lines) ----------
# Load the Libraries
from Autodesk.DesignScript.Geometry import *

# --- INPUTS ---
#Index 0: Class Steel Beam
#Index 1: Size of the grid
         
SteelBeam_Class = IN[0]
size=IN[1]

#--- MAIN CODE ---
#  BUILDS A TIMBER BEAM
# Diagonal 2: Top-Left to Bottom-Right
half_size=size/2 #Computes half size


diag_2 = SteelBeam_Class(-half_size, half_size, half_size, -half_size) #Creates a new steel beam objects
diag_2.build() #Builds it

# --- OUTPUT ---
#Outputs the newly created steel beam
OUT=diag_2
# ----------------------------------------
display_geo_and_calculate = Python(IN[0]=series_of_instances_of_class, IN[1]=series_of_instances_of_class_2, IN[2]=instance_of_steel_beam_diagonal, IN[3]=instance_of_steel_beam_diagonal_2)  # "DISPLAY GEO AND CALCULATE VOLUMES"; CPython3
# ---------- display_geo_and_calculate.python (50 lines) ----------
# Load the Libraries
import clr
clr.AddReference('ProtoGeometry')
from Autodesk.DesignScript.Geometry import *

# --- INPUTS ---
#Index 0: List of Timber Ribs
#Index 1: List of Steel Rods
#Index 2: Steel Beam - first bisector
#Index 3: Steel Beam - second bisector
timber_ribs=IN[0]
steel_rods=IN[1]
diag_1=IN[2]
diag_2=IN[3]
         
#--- MAIN CODE ---
#  Creates the pavilion and computes the volumes

display_geo = [] #Empty list to display
total_timber_vol = 0.0 #Initializes volume to 0
total_steel_rod_vol = 0.0 #Initializes volume to 0
total_steel_beam_vol=0.0 #Initializes volume to 0


# ADD THE DIAGONAL BEAMS

display_geo.append(diag_1.geometry) #Adds Diagonal 1 beam
total_steel_beam_vol += diag_1.volume #Updates volume


display_geo.append(diag_2.geometry) #Adds Diagonal 2 beam
total_steel_beam_vol += diag_2.volume #Updates volume


#  ADD THE STEEL RODS
for rod in steel_rods: #Iterates through the list of steel rods
    display_geo.append(rod.geometry) #Adds the rod
    total_steel_rod_vol += rod.volume #Updates volume

# ADD TIMBER RIBS
for rib in timber_ribs: ##Iterates through the list of timber ribs
    display_geo.append(rib.geometry) #add the rib
    total_timber_vol += rib.volume #Updates volume

# --- OUTPUT ---
# Index 0: Display Geometry
# Index 1: Timber Volume
# Index 2: Steel Rod Volume
# Index 3: Stel Beam Volume
OUT = display_geo, total_timber_vol, total_steel_rod_vol, total_steel_beam_vol
# ----------------------------------------
split_output = CodeBlock(out=display_geo_and_calculate) { out[0]; out[1]; out[2]; out[3]; }
material_volume_1_timber = Watch(split_output.out1)
material_volume_2_steel_rods = Watch(split_output.out2)
material_volume_3_steel_beams = Watch(split_output.out3)
