# Dynamo graph 1848841.dyn "Ivan Arpia Homeassignment2" (Dynamo 3.6.0.9395)

# group: Don't touch this ground
code_block = CodeBlock { -5000; -5000; -200; }
byCoordinates = Point.ByCoordinates(x=code_block.out0, y=code_block.out1, z=code_block.out2)
code_block_2 = CodeBlock { 5000; 5000; 0; }
byCoordinates_2 = Point.ByCoordinates(x=code_block_2.out0, y=code_block_2.out1, z=code_block_2.out2)
byCorners = Cuboid.ByCorners(lowPoint=byCoordinates, highPoint=byCoordinates_2)
code_block_3 = CodeBlock { 0; 100; 0; }
byARGB = Color.ByARGB(red=code_block_3.out0, green=code_block_3.out1, blue=code_block_3.out2)
byGeometryColor = Modifiers.GeometryColor.ByGeometryColor(geometry=byCorners, color=byARGB)

python_script = Python()  # CPython3; unwired: IN[0], IN[1], IN[2], IN[3], IN[4], IN[5]
# ---------- python_script.python (57 lines) ----------
# Load the Python Standard and DesignScript Libraries
import sys
import clr
clr.AddReference('ProtoGeometry')
from Autodesk.DesignScript.Geometry import *

# I want to get the positions of the two corresponding points and see if they intersect and if they do intersect connect else 
# either make a connection bar or leave it as a space 

"""
def covert(item):
    cs = CircularSteel(item,radius)
    return cs.make_geometry(),cs.measure_volume()
    
def walk(data):
    if isinstance(data,list):
        geos,vols = [], []
        for d in data:
            g,v = walk(d)
            geos.append(g)
            vols.append(v)
        return geos,vols
    else:
        return covert(data)
geos,vols = walk(lines)
"""
CircularSteel = IN[0]
numstructures = IN[1]
Outbarthick = IN[2]
Inbarthick = IN[3]

bottomSteel = IN[4] #  first input  referes to top portion of support which is a line
# i.e() ---- <= this part
#       XXXX
#       ----

topSteel = IN[5]) # referes to first input is top second is bottom exists as the lowest portion of support which is a line
# i.e() ---- 
#       XXXX
#       ---- <= this part
crossSteel = IN[6]# referes to first input is top second is bottom exists as the lowest portion of support which is a line
# i.e() ---- 
#       XXXX
#       ---- <= this part




Angles = float(360)/numstructures
"""
lines = IN[1]
radius = IN[2]
"""
for i in range(0,numstructures):
    print("hello")

OUT = Angles
# ----------------------------------------
height_of_the_bottome_arch = DoubleSlider(6000, range=0..10000 step 10)
# note: This essential translates bottom portion of the bar up and down we can likely do arch with this
code_block_4 = CodeBlock(z=height_of_the_bottome_arch) { 0; 0; z; }
byCoordinates_3 = Point.ByCoordinates(x=code_block_4.out0, y=code_block_4.out1, z=code_block_4.z)
ZAxis = Vector.ZAxis()
tot_height_diference = DoubleSlider(3000, range=10..10000 step 10)
translate = Geometry.Translate(geometry=byCoordinates_3, direction=ZAxis, distance=tot_height_diference)
width_of_base = DoubleSlider(4760, range=0..10000 step 10)
code_block_5 = CodeBlock(y=width_of_base) { 0; y; 100; }
byCoordinates_4 = Point.ByCoordinates(x=code_block_5.out0, y=code_block_5.y, z=code_block_5.out2)
byStartPointEndPoint = Line.ByStartPointEndPoint(startPoint=byCoordinates_3, endPoint=byCoordinates_4)
number_of_division = DoubleSlider(5, range=0..25 step 0.1)
code_block_6 = CodeBlock(n=number_of_division) { n; 0..1..#n; }
watch = Watch(code_block_6.out1)
splitByParameter = Curve.SplitByParameter(curve=byStartPointEndPoint, parameters=watch)
endPoint = Curve.EndPoint(curve=splitByParameter)
addItemToFront = List.AddItemToFront(item=translate, list=endPoint)
firstItem = List.FirstItem(list=addItemToFront)
ZAxis_2 = CoordinateSystem.ZAxis()  # unwired: coordinateSystem
rotate = Geometry.Rotate(axis=ZAxis_2)  # unwired: geometry, origin
code_block_7 = CodeBlock { 1; 1; 0; }
mirror = Geometry.Mirror()  # unwired: geometry, mirrorPlane
translate_2 = Geometry.Translate()  # unwired: geometry
rotate_2 = Geometry.Rotate()  # unwired: geometry, origin, axis
watch_2 = Watch()  # unwired: arg0
ZAxis_3 = Vector.ZAxis()
num_structures = IntegerSlider(4, range=0..100 step 1)
initialization_of_cylinders = Python()  # CPython3; unwired: IN[0]
# ---------- initialization_of_cylinders.python (22 lines) ----------
import sys
import clr
import math
clr.AddReference('ProtoGeometry')
from Autodesk.DesignScript.Geometry import *

class CircularSteel:
    def __init__(self, centerline ,radius):
        self.centerline = centerline
        self.radius = radius
    
    def endpoints(self):
        return self.centerline.StartPoint,self.centerline.EndPoint
    def make_geometry(self):
        end1,end2 = self.endpoints()
        
        return Cylinder.ByPointsRadius(end1,end2,self.radius)
    def measure_volume(self):
        end1, end2 = self.endpoints()
        return end1.DistanceTo(end2)*self.radius*self.radius*math.pi
        
OUT = CircularSteel
# ----------------------------------------
translate_3 = Geometry.Translate(geometry=byCoordinates_4, direction=ZAxis, distance=tot_height_diference)
byStartPointEndPoint_2 = Line.ByStartPointEndPoint(startPoint=translate, endPoint=translate_3)
thickness_of_side_bars = DoubleSlider(55, range=0..100 step 1)
instance_1 = Python(IN[0]=initialization_of_cylinders, IN[1]=byStartPointEndPoint_2, IN[2]=thickness_of_side_bars)  # CPython3
# ---------- instance_1.python (4 lines) ----------
CircularSteel = IN[0]
bottomSteel = CircularSteel(IN[1],IN[2]) # first input is top second is bottom 

OUT = [bottomSteel.make_geometry(),bottomSteel.measure_volume()]
# ----------------------------------------
instance_1_2 = Python(IN[0]=initialization_of_cylinders, IN[1]=byStartPointEndPoint, IN[2]=thickness_of_side_bars)  # CPython3; same code as instance_1
splitByParameter_2 = Curve.SplitByParameter(curve=byStartPointEndPoint_2, parameters=watch)
endPoint_2 = Curve.EndPoint(curve=splitByParameter_2)
addItemToFront_2 = List.AddItemToFront(item=byCoordinates_3, list=endPoint_2)
internal_vertical = Line.ByStartPointEndPoint(startPoint=addItemToFront_2, endPoint=addItemToFront)
code_block_8 = CodeBlock()
# ---------- code_block_8.designscript (6 lines) ----------
2;
 // for orginal offset;
0;

1;
// for cross barring cyliylinder offset;
# ----------------------------------------
dropEveryNthItem = List.DropEveryNthItem(list=addItemToFront, n=code_block_8.out0, offset=code_block_8.out1)
dropEveryNthItem_2 = List.DropEveryNthItem(list=endPoint_2, n=code_block_8.out0, offset=code_block_8.out1)
diagonal_1 = Line.ByStartPointEndPoint(startPoint=dropEveryNthItem, endPoint=dropEveryNthItem_2)
code_block_9 = CodeBlock { 0; -1; }
removeItemAtIndex = List.RemoveItemAtIndex(list=dropEveryNthItem, indices=code_block_9.out0)
diagonal_2 = Line.ByStartPointEndPoint(startPoint=dropEveryNthItem_2, endPoint=removeItemAtIndex)
code_block_10 = CodeBlock { 2; 0; }
dropEveryNthItem_3 = List.DropEveryNthItem(list=endPoint, n=code_block_10.out0, offset=code_block_10.out1)
dropEveryNthItem_4 = List.DropEveryNthItem(list=addItemToFront, n=code_block_10.out0, offset=code_block_10.out1)
diagonal_1_n_1 = Line.ByStartPointEndPoint(startPoint=dropEveryNthItem_3, endPoint=dropEveryNthItem_4)
dropEveryNthItem_5 = List.DropEveryNthItem(list=endPoint_2, n=code_block_8.out0, offset=code_block_8.out2)
diagnoal_3 = Line.ByStartPointEndPoint(startPoint=dropEveryNthItem_3, endPoint=dropEveryNthItem_5)
list_create = List.Create(item0=internal_vertical, item1=diagonal_1, item2=diagonal_2, item3=diagonal_1_n_1, item4=diagnoal_3)
thickness_of_inner_bars = DoubleSlider(40, range=0..310 step 1)
python_script_2 = Python(IN[0]=initialization_of_cylinders, IN[1]=list_create, IN[2]=thickness_of_inner_bars)  # CPython3
# ---------- python_script_2.python (20 lines) ----------
CircularSteel = IN[0]
lines = IN[1]
radius = IN[2]

def covert(item):
    cs = CircularSteel(item,radius)
    return cs.make_geometry(),cs.measure_volume()
    
def walk(data):
    if isinstance(data,list):
        geos,vols = [], []
        for d in data:
            g,v = walk(d)
            geos.append(g)
            vols.append(v)
        return geos,vols
    else:
        return covert(data)
geos,vols = walk(lines)
OUT = (geos,vols)
# ----------------------------------------
cross_volume = Python(IN[0]=python_script_2)  # CPython3
# ---------- cross_volume.python (20 lines) ----------
# Load the Python Standard and DesignScript Libraries
import sys
import clr
clr.AddReference('ProtoGeometry')
from Autodesk.DesignScript.Geometry import *

# The inputs to this node will be stored as a list in the IN variables
Crossgeo = IN[0]
totalvolume = float(0)
#"""
for i in range(0,len(Crossgeo[1])):
    for o in range(0,len(Crossgeo[1][i])):
        totalvolume = totalvolume + abs((Crossgeo[1][i][o])) 
    
#"""

# Place your code below this line

# Assign your output to the OUT variable.
OUT = totalvolume
# ----------------------------------------
integer_slider = IntegerSlider(0, range=0..100 step 1)
integer_slider_2 = IntegerSlider(0, range=0..100 step 1)
x = IntegerSlider(0, range=0..10000 step 1)
integer_slider_3 = IntegerSlider(81, range=0..100 step 1)
z = IntegerSlider(10000000, range=0..10000000000 step 1)  # graph output
anglle = IntegerSlider(0, range=0..360 step 1)
anglle_2 = IntegerSlider(150, range=0..360 step 1)
main_supporting_structure = CodeBlock(numstruture=num_structures, top=instance_1, bottom=instance_1_2, cross=python_script_2, totcross=cross_volume, a=integer_slider, b=integer_slider_2, c=x, d=integer_slider_3, e=z, totalangle=anglle, degrees=anglle_2)
# ---------- main_supporting_structure.designscript (54 lines) ----------
numstruture;
top;
bottom;
cross;
// sadly I can't have it automatically count how many structures there are since I have to do manual input

totcross;

totvolume = (bottom[1] + top[1] + totcross)*numstruture;


a;
b;
c;
d;
e;

totalangle;

degrees;



// why is there no while loop???


	bottom.Rotate(Point.ByCoordinates(a, b),Vector.ByCoordinates(c,d,e), (1*degrees));
    //note if you want to rotate on one axis put x,y,z to a max or just very big
	top.Rotate(Point.ByCoordinates(a, b),Vector.ByCoordinates(c,d,e), (1*degrees));
	cross.Rotate(Point.ByCoordinates(a, b),Vector.ByCoordinates(c,d,e),(1*degrees));

	bottom.Rotate(Point.ByCoordinates(a, b),Vector.ByCoordinates(c,d,e), (2*degrees));
    //note if you want to rotate on one axis put x,y,z to a max or just very big
	top.Rotate(Point.ByCoordinates(a, b),Vector.ByCoordinates(c,d,e), (2*degrees));
	cross.Rotate(Point.ByCoordinates(a, b),Vector.ByCoordinates(c,d,e),(2*degrees));

	bottom.Rotate(Point.ByCoordinates(a, b),Vector.ByCoordinates(c,d,e), (3*degrees));
    //note if you want to rotate on one axis put x,y,z to a max or just very big
	top.Rotate(Point.ByCoordinates(a, b),Vector.ByCoordinates(c,d,e), (3*degrees));
	cross.Rotate(Point.ByCoordinates(a, b),Vector.ByCoordinates(c,d,e),(3*degrees));

[Imperative]
{
for(i in 0..(numstruture))
	{

	bottom.Rotate(Point.ByCoordinates(a, b),Vector.ByCoordinates(c,d,e), 2*degrees);
    //note if you want to rotate on one axis put x,y,z to a max or just very big
	top.Rotate(Point.ByCoordinates(a, b),Vector.ByCoordinates(c,d,e), 2*degrees);
	cross.Rotate(Point.ByCoordinates(a, b),Vector.ByCoordinates(c,d,e), 2*degrees);


	};
};
# ----------------------------------------
watch_3 = Watch(main_supporting_structure.numstruture)
testonloops = CodeBlock()
# ---------- testonloops.designscript (10 lines) ----------
b = 0;
a = 1;
[Imperative]
{
for(i in 0..(2))
	{
	 b = a + b;
	}
	return b;
};
# ----------------------------------------
watch_4 = Watch(testonloops.out2)
code_block_11 = CodeBlock {  }
watch_5 = Watch()  # unwired: arg0
watch_6 = Watch(testonloops.b)
input_variable_management = Python()  # CPython3; unwired: IN[0], IN[1], IN[2]; starter script, not edited (OUT = 0)
watch_7 = Watch(main_supporting_structure.a)
watch_8 = Watch()  # unwired: arg0

# group: Human refrence
dimension_of_ref_person = CodeBlock()
# ---------- dimension_of_ref_person.designscript (9 lines) ----------
height= (1.81)*1000;
// already converts to m;
wandl = (1)*1000;


x= (0)*1000;
y= (0)*1000;
z= (wandl);
// adjusts so that it's not touching the ground;
# ----------------------------------------
byCoordinates_5 = Point.ByCoordinates(x=dimension_of_ref_person.x, y=dimension_of_ref_person.y, z=dimension_of_ref_person.z)
refrence_person = Cuboid.ByLengths(origin=byCoordinates_5, width=dimension_of_ref_person.wandl, length=dimension_of_ref_person.wandl, height=dimension_of_ref_person.height)
code_block_12 = CodeBlock { alpha = 255; r =255; g = 255; b = 0; }
byARGB_2 = Color.ByARGB(alpha=code_block_12.alpha, red=code_block_12.r, green=code_block_12.g, blue=code_block_12.b)
byGeometryColor_2 = Modifiers.GeometryColor.ByGeometryColor(geometry=refrence_person, color=byARGB_2)
watch_9 = Watch(byARGB_2)

# group: Cone
code_block_13 = CodeBlock {  }
XAxis = CoordinateSystem.XAxis()  # unwired: coordinateSystem
number_slider = DoubleSlider(200, range=0..1000 step 10)
number_slider_2 = DoubleSlider(2530, range=0..10000 step 10)
tip_of_support = CodeBlock(useraddon=number_slider, heightdiff=tot_height_diference, heightbottom=height_of_the_bottome_arch, ztrans=number_slider_2) { useraddon; heightdiff; heightbottom; heighttip = useraddon+heightbottom; radscale; ztrans; }  # unwired: radscale
byOrigin = CoordinateSystem.ByOrigin(z=tip_of_support.heightdiff)
inner_thickness_of_cone = DoubleSlider(400, range=0..1000 step 10)
code_block_14 = CodeBlock(height=tip_of_support.heighttip, Useraddonrad=inner_thickness_of_cone, startRadius=width_of_base) { height; Useraddonrad; startRadius; temp = startRadius + Useraddonrad; endRadius=Useraddonrad; }
outer_cone = Cone.ByCoordinateSystemHeightRadii(cs=byOrigin, height=tip_of_support.heighttip, startRadius=code_block_14.temp, endRadius=code_block_14.endRadius)
code_block_15 = CodeBlock(oldheight=tip_of_support.heighttip) { oldheight; newheight = oldheight + 150; endrad = 100; }
inner_cone = Cone.ByCoordinateSystemHeightRadii(cs=byOrigin, height=code_block_15.newheight, startRadius=width_of_base, endRadius=code_block_15.endrad)
difference = Solid.Difference(solid=outer_cone, other=inner_cone)
volume = Solid.Volume(solid=difference)
watch_10 = Watch(volume)
code_block_16 = CodeBlock {  }
byCoordinates_6 = Point.ByCoordinates(z=tip_of_support.heightdiff)
code_block_17 = CodeBlock { 180; }
rotate_3 = Geometry.Rotate(geometry=inner_cone, origin=byCoordinates_6, axis=byCoordinates_6, degrees=code_block_17)
color_palette = ColorPalette({R: 0, G: 0, B: 0, A: 255})

rotate_4 = Geometry.Rotate()  # frozen; unwired: geometry, origin, axis
length = DoubleSlider(10000, range=20..100000 step 1)  # frozen
sliceNumber = IntegerSlider(45, range=10..100 step 1)  # frozen
code_block_18 = CodeBlock(Lengths=length, SliceNumber=sliceNumber) { Lengths; SliceNumber; Interval = 0..1..#SliceNumber; Xpoint = Interval * Lengths; }  # frozen
code_block_19 = CodeBlock(x=code_block_18.Xpoint) { x; z1 = 5.7 * Math.Sin(19.1*x +14.5)- 5.5*Math.Cos(7.5*x) +18.3; z1; }  # frozen
code_block_20 = CodeBlock { 0; }  # frozen
number_slider_3 = DoubleSlider(9128, range=0..100000 step 1)  # frozen
number_slider_4 = DoubleSlider(68, range=0..100 step 0.1)  # frozen
code_block_21 = CodeBlock(x=code_block_18.Xpoint, yCenter=code_block_20, yAmplitude=number_slider_3, yFrequency=number_slider_4) { x; yCenter; yAmplitude; yFrequency; y = yCenter + yAmplitude * Math.Sin(yFrequency*x); }  # frozen
code_block_22 = CodeBlock { 5.7; 19.1; 14.5; 5.5; 7.5; 0; 18.3; }  # frozen
code_block_23 = CodeBlock(sineAmplitude=code_block_22.out0, sineFrequency=code_block_22.out1, sinePhaseShift=code_block_22.out2, cosineAmplitude=code_block_22.out3, cosineFrequency=code_block_22.out4, cosinePhaseShift=code_block_22.out5, verticalOffset=code_block_22.out6, x=code_block_18.Xpoint)  # frozen
# ---------- code_block_23.designscript (11 lines) ----------
sineAmplitude;
sineFrequency;
sinePhaseShift;
cosineAmplitude;
cosineFrequency;
cosinePhaseShift;
verticalOffset;

x;
z1 = sineAmplitude * Math.Sin(sineFrequency*x+sinePhaseShift) - cosineAmplitude *Math.Cos(cosineFrequency *x +cosinePhaseShift) + verticalOffset;
z1;
# ----------------------------------------
byCoordinates_7 = Point.ByCoordinates(x=code_block_18.Xpoint, y=code_block_21.y, z=code_block_23.out9)  # frozen
integer_slider_4 = IntegerSlider(4, range=1..5 step 1)  # frozen
byPoints = NurbsCurve.ByPoints(points=byCoordinates_7, degree=integer_slider_4)  # frozen
code_block_24 = CodeBlock { -40; }  # frozen
code_block_25 = CodeBlock(x=code_block_18.Xpoint) { x; z3 = -5.0; z3; }  # frozen
byCoordinates_8 = Point.ByCoordinates(x=code_block_18.Xpoint, y=code_block_24, z=code_block_25.out2)  # frozen
byPoints_2 = NurbsCurve.ByPoints(points=byCoordinates_8, degree=integer_slider_4)  # frozen
code_block_26 = CodeBlock { 10; }  # frozen
code_block_27 = CodeBlock(x=code_block_18.Xpoint) { x; z5 = -6.0 * Math.Pow(Math.Sin(7.8*x),2) -0.5*x-9.5; z5; }  # frozen
byCoordinates_9 = Point.ByCoordinates(x=code_block_18.Xpoint, y=code_block_26, z=code_block_27.out2)  # frozen
byPoints_3 = NurbsCurve.ByPoints(points=byCoordinates_9, degree=integer_slider_4)  # frozen
code_block_28 = CodeBlock { -42; }  # frozen
code_block_29 = CodeBlock(x=code_block_18.Xpoint) { x; z4 = -5.0 * Math.Sin(6.6 * x +38.7) +5.2* Math.Cos(22.3*x) -16.5; z4; }  # frozen
byCoordinates_10 = Point.ByCoordinates(x=code_block_18.Xpoint, y=code_block_28, z=code_block_29.out2)  # frozen
byPoints_4 = NurbsCurve.ByPoints(points=byCoordinates_10, degree=integer_slider_4)  # frozen
code_block_30 = CodeBlock { -15; }  # frozen
code_block_31 = CodeBlock(x=code_block_18.Xpoint) { x; z2 = 2.2 * Math.Sin(5.5*x+12.3) +3.3; z2; }  # frozen
byCoordinates_11 = Point.ByCoordinates(x=code_block_18.Xpoint, y=code_block_30, z=code_block_31.out2)  # frozen
byPoints_5 = NurbsCurve.ByPoints(points=byCoordinates_11, degree=integer_slider_4)  # frozen
slice5 = Python()  # CPython3; frozen; unwired: IN[0]
# ---------- slice5.python (134 lines) ----------
import clr
clr.AddReference('ProtoGeometry')
from Autodesk.DesignScript.Geometry import *
import math

class Slice5:
    def __init__(self, pts_by_curve, fillet_radius=0.0):
        
        self.pts_by_curve = pts_by_curve
   
        r = fillet_radius
        if isinstance(r, list):
            r = r[0] if len(r) > 0 else 0.0
        if r is None:
            r = 0.0
        self.fillet_radius = float(r)


    def slice_count(self):

        return len(self.pts_by_curve[0])

    def points_at_index(self, i):

        return [curve_pts[i] for curve_pts in self.pts_by_curve]

    def ordered_points_at_index(self, i):

        pts = list(self.points_at_index(i))
        if len(pts) <= 2:
            return pts

        cy = sum(p.Y for p in pts) / len(pts)
        cz = sum(p.Z for p in pts) / len(pts)

        def ang(p):
            return math.atan2(p.Z - cz, p.Y - cy)

        pts_sorted = sorted(pts, key=ang)
        return pts_sorted


    def polycurve_at_index(self, i):
        pts = self.ordered_points_at_index(i)
        if len(pts) < 3:
            return None

        closed_pts = pts + [pts[0]]
        poly = PolyCurve.ByPoints(closed_pts)

        if self.fillet_radius <= 0:
            return poly

        lengths = []
        for k in range(len(pts)):
            a = pts[k]
            b = pts[(k + 1) % len(pts)]
            lengths.append(a.DistanceTo(b))

        if not lengths:
            return poly

        min_len = min(lengths)
        if min_len <= 1e-6:
            return poly

        max_r = 0.4 * min_len
        r = min(self.fillet_radius, max_r)
        if r <= 1e-6:
            return poly

        try:
            poly_f = PolyCurve.Fillet(poly, r)
            return poly_f
        except:
            return poly


    def surface_at_index(self, i):

        pc = self.polycurve_at_index(i)
        if pc is None:
            return None
        try:
            srf = Surface.ByPatch(pc)
            return srf
        except:
            return None

    def solid_at_index(self, i, thickness):

        srf = self.surface_at_index(i)
        if srf is None:
            return None

        t = thickness
        if isinstance(t, list):
            t = t[0] if len(t) > 0 else 0.0
        if t is None:
            t = 0.0
        t = float(t)

        if abs(t) <= 1e-6:
            return srf

        try:
            solid = srf.Thicken(t)
            return solid
        except:
            return srf
    # --------------------------------------------------------------------
    # OPTIONAL: 
    #
    # def area_at_index(self, i):
    #     
    #     srf = self.surface_at_index(i)
    #     if srf is None:
    #         return None
    #     try:
    #         return srf.Area
    #     except:
    #         return None
    #
    # def volume_at_index(self, i, thickness):
    #     
    #     solid = self.solid_at_index(i, thickness)
    #     if solid is None:
    #         return None
    #     try:
    #         return solid.Volume
    #     except:
    #         return None

OUT = Slice5 
# ----------------------------------------
list_create_2 = List.Create(item0=byCoordinates_7, item1=byCoordinates_11, item2=byCoordinates_8, item3=byCoordinates_10, item4=byCoordinates_9)  # frozen
code_block_32 = CodeBlock { 2; }  # frozen
code_block_33 = CodeBlock { 3; }  # frozen
target_instance = Python(IN[0]=slice5, IN[1]=list_create_2, IN[2]=code_block_32, IN[3]=code_block_33, IN[4]=length, IN[5]=code_block_30, IN[6]=code_block_25.out2)  # CPython3; frozen
# ---------- target_instance.python (121 lines) ----------
import clr
clr.AddReference('ProtoGeometry')
from Autodesk.DesignScript.Geometry import *
import math

# IN[0] = Slice5 class
# IN[1] = pts_by_curve: list of point-lists (one list per curve)
# IN[2] = fillet_radius: corner fillet radius
# IN[3] = thickness: slice thickness (scalar or single-item list)
# IN[4] = total_length: total length of the slice system along X
# IN[5] = rod_center_y: Y coordinate of the rod center
# IN[6] = rod_center_z: Z coordinate of the rod center

Slice5        = IN[0]
pts_by_curve  = IN[1]
fillet_radius = IN[2]
thickness     = IN[3]

total_length  = IN[4]
rod_center_y  = IN[5]
rod_center_z  = IN[6]

# Instantiate Slice5 object
slice_obj = Slice5(pts_by_curve, fillet_radius)
n = slice_obj.slice_count()

profiles = []   # polycurves for each slice
solids   = []   # solids (or surfaces if thicken fails or thickness = 0)
surfaces = []   # patch surfaces for area calculation
areas    = []   # numeric areas (internal use only)
volumes  = []   # numeric volumes (internal use only)

for i in range(n):
    # Profile polycurve
    pc = slice_obj.polycurve_at_index(i)
    profiles.append(pc)

    # Surface for this slice
    srf = slice_obj.surface_at_index(i)
    surfaces.append(srf)

    # Area for this slice (numeric, internal)
    a = None
    if srf is not None:
        try:
            a = srf.Area
        except:
            a = None
    areas.append(a)

    # Solid for this slice
    solid = slice_obj.solid_at_index(i, thickness)
    solids.append(solid)

    # Volume for this slice (numeric, internal)
    v = 0.0
    if solid is not None:
        try:
            v = solid.Volume
        except:
            v = 0.0
    volumes.append(v)

# ----- Build unit-labeled strings -----

# Assumption: model units are millimeters
area_unit   = "mm²"
volume_unit = "mm³"

# Per-slice area labels: "123.45 mm²"
area_labels = []
for a in areas:
    if a is None:
        area_labels.append(None)
    else:
        area_labels.append("{0:.2f} {1}".format(a, area_unit))

# Per-slice volume labels: "123.45 mm³"
volume_labels = []
for v in volumes:
    volume_labels.append("{0:.2f} {1}".format(v, volume_unit))

# Total area / total volume (numeric, internal)
total_area   = sum(a for a in areas if a is not None)
total_volume = sum(volumes)

# Total labels: "1234.56 mm²", "7890.12 mm³"
total_area_label   = "{0:.2f} {1}".format(total_area, area_unit)
total_volume_label = "{0:.2f} {1}".format(total_volume, volume_unit)

# ----- Create a horizontal rod (cylinder) using Length + Y + Z -----

# Use the bounding box only to find the starting X position
bbox   = BoundingBox.ByGeometry(solids)
min_pt = bbox.MinPoint

start_x = min_pt.X
end_x   = min_pt.X + float(total_length)

# You can also set rod_radius manually or relate it to thickness
try:
    rod_radius = float(thickness) * 0.5
except:
    rod_radius = 5.0  # fallback radius in mm

rod_start = Point.ByCoordinates(start_x, rod_center_y, rod_center_z)
rod_end   = Point.ByCoordinates(end_x,   rod_center_y, rod_center_z)

rod = Cylinder.ByPointsRadius(rod_start, rod_end, rod_radius)

# Final output: geometry + strings with units, plus the rod
OUT = (
    profiles,           # 0: slice profiles (PolyCurves)
    solids,             # 1: slice solids (or surfaces if thicken failed)
    surfaces,           # 2: slice surfaces
    area_labels,        # 3: per-slice area labels ("xx mm²")
    total_area_label,   # 4: total area label ("xx mm²")
    volume_labels,      # 5: per-slice volume labels ("xx mm³")
    total_volume_label, # 6: total volume label ("xx mm³")
    rod                 # 7: horizontal rod (Cylinder)
) 
# ----------------------------------------
code_block_34 = CodeBlock { 4; }  # frozen
getItemAtIndex = List.GetItemAtIndex(list=target_instance, index=code_block_34)  # frozen
watch_11 = Watch(getItemAtIndex)  # frozen
code_block_35 = CodeBlock { 6; }  # frozen
getItemAtIndex_2 = List.GetItemAtIndex(list=target_instance, index=code_block_35)  # frozen
watch_12 = Watch(getItemAtIndex_2)  # frozen

# group: rectangle class script test
code_block_36 = CodeBlock {  }
formation_of_complex_connectors = Python()  # CPython3; unwired: IN[0]
# ---------- formation_of_complex_connectors.python (45 lines) ----------
import sys
import clr
import math
clr.AddReference('ProtoGeometry')
from Autodesk.DesignScript.Geometry import *

class CompBoxes:
    def __init__(self, cornerpoints, thickness):
        self.cornerpoints = cornerpoints
        self.thickness = thickness
        
        if len(cornerpoints) !=4: # needs intial inputs to have points
            print("Not right # points")
         # initallizing wonder if I have to state \

        
        
    
    
    def endpoints(self):
        return self.centerline.StartPoint,self.centerline.EndPoint
    def make_geometry(self):## creates the rectangle using the given points
    
        templist = []
        
        
        self.l1 = Line.ByStartPointEndPoint(self.cornerpoints[0], self.cornerpoints[1]);
        
        self.l2 = Line.ByStartPointEndPoint(self.cornerpoints[2], self.cornerpoints[3]);
        
        
        #creates lines

        
        surf = Surface.ByLoft([self.l1, self.l2]);
        
        solid = surf.Thicken(self.thickness, True);
        return solid
    def measure_volume(self):# note that there are 
        l1dist = self.l1.Length
        l2dist = self.l2.Length
        
        return l1dist*l2dist*self.thickness
        
OUT = CompBoxes 
# ----------------------------------------
code_block_37 = CodeBlock { 0; 0; 0; }
byCoordinates_12 = Point.ByCoordinates(x=code_block_37.out0, y=code_block_37.out1, z=code_block_37.out2)
code_block_38 = CodeBlock { 10000; 0; 0; }
byCoordinates_13 = Point.ByCoordinates(x=code_block_38.out0, y=code_block_38.out1, z=code_block_38.out2)
code_block_39 = CodeBlock { 10000; 10000; 0; }
byCoordinates_14 = Point.ByCoordinates(x=code_block_39.out0, y=code_block_39.out1, z=code_block_39.out2)
code_block_40 = CodeBlock { 0; 10000; 0; }
byCoordinates_15 = Point.ByCoordinates(x=code_block_40.out0, y=code_block_40.out1, z=code_block_40.out2)
list_create_3 = List.Create(item0=byCoordinates_12, item1=byCoordinates_13, item2=byCoordinates_14, item3=byCoordinates_15)
number_slider_5 = DoubleSlider(1440, range=0..10000 step 10)
python_script_3 = Python(IN[0]=formation_of_complex_connectors, IN[1]=list_create_3, IN[2]=number_slider_5)  # CPython3
# ---------- python_script_3.python (11 lines) ----------
# Load the Python Standard and DesignScript Libraries
import sys
import clr
clr.AddReference('ProtoGeometry')
from Autodesk.DesignScript.Geometry import *

CompBox = IN[0] #intializaton of class script

CompBox = CompBox(IN[1],IN[2]) # first input is inputs of a base of points and second input is a float for thickness

OUT = [CompBox.make_geometry(),CompBox.measure_volume()]
# ----------------------------------------
watch_13 = Watch(python_script_3)

formation_of_complex_connectors_2 = Python()  # CPython3; unwired: IN[0]; same code as formation_of_complex_connectors
useradj = DoubleSlider(1.05, range=0.8..1.2 step 0.005)
xy_scale = DoubleSlider(0.49, range=0.4..1.5 step 0.005)
data_list_managment1 = Python(IN[0]=useradj, IN[1]=tot_height_diference, IN[2]=xy_scale, IN[3]=main_supporting_structure.out14, IN[4]=main_supporting_structure.out20)  # CPython3
# ---------- data_list_managment1.python (28 lines) ----------
# Load the Python Standard and DesignScript Libraries
import sys
import clr
clr.AddReference('ProtoGeometry')
from Autodesk.DesignScript.Geometry import *

# The inputs to this node will be stored as a list in the IN variables.


# Place your code below this line

# Assign your output to the OUT variable.


useradj = IN[0]
height = IN[1]
xyscale = IN[2] # for proper fitting
funs = [IN[3],IN[4]]
points = []
for i in funs:
    vectortemp = [(i[0].Axis.X)*xyscale ,(i[0].Axis.Y)*xyscale,height]
    vectortempadj = [(i[0].Axis.X)*useradj*xyscale ,(i[0].Axis.Y)*useradj*xyscale,height]
    temppoints = Point.ByCoordinates(vectortemp[0],vectortemp[1],vectortemp[2])
    temppointsadj = Point.ByCoordinates(vectortempadj[0],vectortempadj[1],vectortempadj[2])
    points.append(temppoints)
    points.append(temppointsadj)
    
OUT = points
# ----------------------------------------
number_slider_6 = DoubleSlider(450, range=0..1000 step 10)
python_script_4 = Python(IN[0]=formation_of_complex_connectors_2, IN[1]=data_list_managment1, IN[2]=number_slider_6)  # CPython3; same code as python_script_3
firstItem_2 = List.FirstItem(list=python_script_4)
code_block_41 = CodeBlock { alpha =  150; r =139; g = 69; b = 19; }
byARGB_3 = Color.ByARGB(red=code_block_41.r, green=code_block_41.g, blue=code_block_41.b)
byGeometryColor_3 = Modifiers.GeometryColor.ByGeometryColor(geometry=firstItem_2, color=byARGB_3)
data_list_managment1_2 = Python(IN[0]=useradj, IN[1]=tot_height_diference, IN[2]=xy_scale, IN[3]=main_supporting_structure.out14, IN[4]=main_supporting_structure.out16)  # CPython3; same code as data_list_managment1
python_script_5 = Python(IN[0]=formation_of_complex_connectors_2, IN[1]=data_list_managment1_2, IN[2]=number_slider_6)  # CPython3; same code as python_script_3
firstItem_3 = List.FirstItem(list=python_script_5)
code_block_42 = CodeBlock { alpha =  150; r =139; g = 69; b = 19; }
byARGB_4 = Color.ByARGB(red=code_block_42.r, green=code_block_42.g, blue=code_block_42.b)
byGeometryColor_4 = Modifiers.GeometryColor.ByGeometryColor(geometry=firstItem_3, color=byARGB_4)
data_list_managment1_3 = Python(IN[0]=useradj, IN[1]=tot_height_diference, IN[2]=xy_scale, IN[3]=main_supporting_structure.bottom, IN[4]=main_supporting_structure.out20)  # CPython3; same code as data_list_managment1
python_script_6 = Python(IN[0]=formation_of_complex_connectors_2, IN[1]=data_list_managment1_3, IN[2]=number_slider_6)  # CPython3; same code as python_script_3
firstItem_4 = List.FirstItem(list=python_script_6)
code_block_43 = CodeBlock { alpha =  150; r =139; g = 69; b = 19; }
byARGB_5 = Color.ByARGB(red=code_block_43.r, green=code_block_43.g, blue=code_block_43.b)
byGeometryColor_5 = Modifiers.GeometryColor.ByGeometryColor(geometry=firstItem_4, color=byARGB_5)
data_list_managment1_4 = Python(IN[0]=useradj, IN[1]=tot_height_diference, IN[2]=xy_scale, IN[3]=main_supporting_structure.bottom, IN[4]=main_supporting_structure.out16)  # CPython3; same code as data_list_managment1
python_script_7 = Python(IN[0]=formation_of_complex_connectors_2, IN[1]=data_list_managment1_4, IN[2]=number_slider_6)  # CPython3; same code as python_script_3
firstItem_5 = List.FirstItem(list=python_script_7)
code_block_44 = CodeBlock { alpha =  150; r =139; g = 69; b = 19; }
byARGB_6 = Color.ByARGB(red=code_block_44.r, green=code_block_44.g, blue=code_block_44.b)
byGeometryColor_6 = Modifiers.GeometryColor.ByGeometryColor(geometry=firstItem_5, color=byARGB_6)
lastItem = List.LastItem(list=python_script_5)
lastItem_2 = List.LastItem(list=python_script_7)
lastItem_3 = List.LastItem(list=python_script_6)
lastItem_4 = List.LastItem(list=python_script_4)
summation_of_volume = Python(IN[0]=lastItem_2, IN[1]=lastItem_3, IN[2]=lastItem_3, IN[3]=lastItem_4, IN[4]=main_supporting_structure.totvolume, IN[5]=volume)  # CPython3
# ---------- summation_of_volume.python (14 lines) ----------
# The inputs to this node will be stored as a list in the IN variables.

# Place your code below this line
stru1 = float(IN[0])
stru2 = float(IN[1])
stru3 = float(IN[2])
stru4 = float(IN[3])
stru5 = IN[4]
stru6 = float(IN[5])

#volume = stru1 + stru2 + stru3 + stru4 + stru5 + stru6

# Assign your output to the OUT variable.
OUT = stru5
# ----------------------------------------
total_volume_in_mm_3 = Watch(summation_of_volume)
watch_14 = Watch(main_supporting_structure.totvolume)
