# Dynamo graph 1848918.dyn (Dynamo 3.6.0.9395)

# group: Don't touch this ground
code_block = CodeBlock { -5000; -5000; -200; }
byCoordinates = Point.ByCoordinates(x=code_block.out0, y=code_block.out1, z=code_block.out2)
code_block_2 = CodeBlock { 5000; 5000; 0; }
byCoordinates_2 = Point.ByCoordinates(x=code_block_2.out0, y=code_block_2.out1, z=code_block_2.out2)
byCorners = Cuboid.ByCorners(lowPoint=byCoordinates, highPoint=byCoordinates_2)
code_block_3 = CodeBlock { 0; 100; 0; }
byARGB = Color.ByARGB(red=code_block_3.out0, green=code_block_3.out1, blue=code_block_3.out2)
byGeometryColor = Modifiers.GeometryColor.ByGeometryColor(geometry=byCorners, color=byARGB)

code_block_4 = CodeBlock()
# ---------- code_block_4.designscript (9 lines) ----------
x = [0, 500, 800, 500, 0, -500, -800, -500, 0];
y = [0, 2000, 5000, 2000, 0, -2000, -5000, -2000, 0];
z = 0;

pts = Point.ByCoordinates(x, y, z);
crv = NurbsCurve.ByPoints(pts);

// Output the curve
crv;
# ----------------------------------------

# group: Pavilion
pavilionRadius = DoubleSlider(3000, range=2000..4999 step 1)
numPetals = IntegerSlider(5, range=3..9 step 2)
polarRose1Curve = Python(IN[0]=pavilionRadius, IN[1]=numPetals)  # CPython3
# ---------- polarRose1Curve.python (44 lines) ----------
# Load the Python Standard and DesignScript Libraries
import sys
import clr
clr.AddReference('ProtoGeometry')
from Autodesk.DesignScript.Geometry import *
import numpy as np 
import math 


# The inputs to this node will be stored as a list in the IN variables.
dataEnteringNode = IN

# Place your code below this line
# Inputs
pavilionRadius = IN[0]     
numPetals = IN[1]         
numSamples = 6000          


# Generate theta values
theta = np.linspace(0, 2*math.pi, numSamples, endpoint = False)

# Polar rose equation
r = pavilionRadius * np.cos(numPetals * theta)

# Convert to Cartesian points
points = []
for i in range(numSamples):
    x = r[i] * math.cos(theta[i])
    y = r[i] * math.sin(theta[i])
    
    inside = pavilionRadius**2 - x**2 - y**2
    if inside < 0:
        z = 0   # outside sphere, clamp
    else:
        z = math.sqrt(inside)
    points.append(Point.ByCoordinates(x, y, z))
step = 3
pointSmooth = points[::step]
curve = NurbsCurve.ByPoints(pointSmooth, 5)


# Assign your output to the OUT variable.
OUT = curve
# ----------------------------------------
polarRose2Curve = Python(IN[0]=pavilionRadius, IN[1]=numPetals)  # CPython3
# ---------- polarRose2Curve.python (42 lines) ----------
# Load the Python Standard and DesignScript Libraries
import sys
import clr
clr.AddReference('ProtoGeometry')
from Autodesk.DesignScript.Geometry import *
import numpy as np 
import math 


# The inputs to this node will be stored as a list in the IN variables.
dataEnteringNode = IN

# Place your code below this line
# Inputs
pavilionRadius = IN[0]     
numPetals = IN[1]         
numSamples = 6000           


# Generate theta values
theta = np.linspace(0, 2*math.pi, numSamples, endpoint = False)

# Polar rose equation
r = pavilionRadius * np.cos(numPetals * theta)

# Convert to Cartesian points
points = []
for i in range(numSamples):
    x = r[i] * math.cos(theta[i])
    y = r[i] * math.sin(theta[i])
    inside = pavilionRadius**2 - x**2 - y**2
    if inside < 0:
        z = 0   # outside sphere, clamp
    else:
        z = math.sqrt(inside)
    points.append(Point.ByCoordinates(x, y, z))

step = 3
pointSmooth = points[::step]
curve = NurbsCurve.ByPoints(pointSmooth, 5)
# Assign your output to the OUT variable.
OUT = curve
# ----------------------------------------
origin = Point.ByCoordinates()
zAxis = Vector.ZAxis()
code_block_5 = CodeBlock { 180; }
rotation = Geometry.Rotate(geometry=polarRose2Curve, origin=origin, axis=zAxis, degrees=code_block_5)
combinePolarRoseCurves = List.Create(item0=polarRose1Curve, item1=rotation)
polarRoseCurve = List.Flatten(list=combinePolarRoseCurves)
aluminiumBeamClass = Python()  # CPython3
# ---------- aluminiumBeamClass.python (33 lines) ----------
# Load the Python Standard and DesignScript Libraries
import sys
import clr
clr.AddReference('ProtoGeometry')
from Autodesk.DesignScript.Geometry import *

# The inputs to this node will be stored as a list in the IN variables.
dataEnteringNode = IN

# Place your code below this line
import clr
clr.AddReference('ProtoGeometry')
from Autodesk.DesignScript.Geometry import *
import math

import clr
clr.AddReference('ProtoGeometry')
from Autodesk.DesignScript.Geometry import *

class Beam:
    def __init__(self, p1, p2, radius):
        self.p1 = p1
        self.p2 = p2
        self.radius = radius

    def Geometry(self):
        return Cylinder.ByPointsRadius(self.p1, self.p2, self.radius)

    def Volume(self):
        return self.Geometry().Volume

# Assign your output to the OUT variable.
OUT = Beam
# ----------------------------------------
beamRadius = DoubleSlider(150, range=10..500 step 0.1)
aluminumBeamInstanceSeriesGenerator = Python(IN[0]=polarRoseCurve, IN[1]=aluminiumBeamClass, IN[2]=beamRadius)  # CPython3
# ---------- aluminumBeamInstanceSeriesGenerator.python (32 lines) ----------
# Load the Python Standard and DesignScript Libraries
import sys
import clr
clr.AddReference('ProtoGeometry')
from Autodesk.DesignScript.Geometry import *
clr.AddReference("DSCoreNodes")
from DSCore import Color

# The inputs to this node will be stored as a list in the IN variables.
dataEnteringNode = IN
curves = IN[0]
BeamClass = IN[1]
radius = IN[2]

# Place your code below this line
divisions = 1000
allBeams = []
totalVol = 0
for curve in curves:
    ts = [i/float(divisions) for i in range(divisions+1)]
    pts = [curve.PointAtParameter(t) for t in ts]
    
    for i in range(len(pts)-1):
        b = BeamClass(pts[i], pts[i+1], radius)
        solid = b.Geometry()
        allBeams.append(solid)
        
        totalVol += b.Volume()

    
# Assign your output to the OUT variable.
OUT = allBeams, totalVol
# ----------------------------------------
geometryIndex = CodeBlock { 0; }
beamGeometry = List.GetItemAtIndex(list=aluminumBeamInstanceSeriesGenerator, index=geometryIndex)
yellow = ColorPalette({R: 236, G: 222, B: 90, A: 255})
alumiumColour = Modifiers.GeometryColor.ByGeometryColor(geometry=beamGeometry, color=yellow)
stainlessSteelCentralColumnClass = Python()  # CPython3
# ---------- stainlessSteelCentralColumnClass.python (23 lines) ----------
# Load the Python Standard and DesignScript Libraries
import sys
import clr
clr.AddReference('ProtoGeometry')
from Autodesk.DesignScript.Geometry import *

# The inputs to this node will be stored as a list in the IN variables.
dataEnteringNode = IN

# Place your code below this line
class CentralColumn:
    def __init__(self, basePoint, topPoint, radius):
        self.basePoint = basePoint
        self.topPoint = topPoint
        self.radius = radius

    def Geometry(self):
        return Cylinder.ByPointsRadius(self.basePoint, self.topPoint, self.radius)

    def Volume(self):
        return self.Geometry().Volume
# Assign your output to the OUT variable.
OUT = CentralColumn
# ----------------------------------------
centralColumnRadius = DoubleSlider(200, range=0..200 step 0.1)
centralColumnInstance = Python(IN[0]=polarRoseCurve, IN[1]=stainlessSteelCentralColumnClass, IN[2]=centralColumnRadius)  # CPython3
# ---------- centralColumnInstance.python (32 lines) ----------
# Load the Python Standard and DesignScript Libraries
import sys
import clr
clr.AddReference('ProtoGeometry')
from Autodesk.DesignScript.Geometry import *

# The inputs to this node will be stored as a list in the IN variables.
dataEnteringNode = IN
ribs = IN[0]              
ColumnClass = IN[1]       
radius = IN[2]     

# Place your code below this line
center = Point.ByCoordinates(0, 0, 0)

# Compute top Z based on highest rib point
maxZ = 0
for rib in ribs:
    pts = [rib.PointAtParameter(t) for t in [0, 0.25, 0.5, 0.75, 1]]
    for p in pts:
        if p.Z > maxZ:
            maxZ = p.Z

top = Point.ByCoordinates(0, 0, maxZ)

# Create one instance
column = ColumnClass(center, top, radius)
geom = column.Geometry()
vol = column.Volume()

# Assign your output to the OUT variable.
OUT = geom, vol
# ----------------------------------------
columnGeometry = List.GetItemAtIndex(list=centralColumnInstance, index=geometryIndex)
green = ColorPalette({R: 0, G: 153, B: 4, A: 255})
columnColour = Modifiers.GeometryColor.ByGeometryColor(geometry=columnGeometry, color=green)
volumeIndex = CodeBlock { 1; }
beamVolume = List.GetItemAtIndex(list=aluminumBeamInstanceSeriesGenerator, index=volumeIndex)
columnVolume = List.GetItemAtIndex(list=centralColumnInstance, index=volumeIndex)

beam_volume_mm_2 = Watch(beamVolume)
column_volume_mm_2 = Watch(columnVolume)
