# Dynamo graph 1848920.dyn "Start-1" (Dynamo 3.6.0.9395)

# group: Don't touch this ground
code_block = CodeBlock { -5000; -5000; -200; }
byCoordinates = Point.ByCoordinates(x=code_block.out0, y=code_block.out1, z=code_block.out2)
code_block_2 = CodeBlock { 5000; 5000; 0; }
byCoordinates_2 = Point.ByCoordinates(x=code_block_2.out0, y=code_block_2.out1, z=code_block_2.out2)
byCorners = Cuboid.ByCorners(lowPoint=byCoordinates, highPoint=byCoordinates_2)
code_block_3 = CodeBlock { 0; 100; 0; }
byARGB = Color.ByARGB(red=code_block_3.out0, green=code_block_3.out1, blue=code_block_3.out2)
byGeometryColor = Modifiers.GeometryColor.ByGeometryColor(geometry=byCorners, color=byARGB)

code_block_4 = CodeBlock { 0; 0; 0; }
byCoordinates_3 = Point.ByCoordinates(x=code_block_4.out0, y=code_block_4.out1, z=code_block_4.out2)
radius = IntegerSlider(4100, range=2000..4500 step 100)
byCenterPointRadius = Circle.ByCenterPointRadius(centerPoint=byCoordinates_3, radius=radius)
code_block_5 = CodeBlock { 8; }
regularPolygon = Polygon.RegularPolygon(circle=byCenterPointRadius, numberSides=code_block_5)
corners = Polygon.Corners(polygon=regularPolygon)
height = DoubleSlider(5000, range=3000..6000 step 100)
column_thickness = DoubleSlider(100, range=100..300 step 10)
roof_thickness = DoubleSlider(50, range=50..200 step 1)
roof_arch_height = DoubleSlider(850, range=0..1500 step 10)
python_script = Python(IN[0]=corners, IN[1]=height, IN[2]=column_thickness, IN[3]=roof_thickness, IN[4]=roof_arch_height)  # CPython3
# ---------- python_script.python (95 lines) ----------
# Load the Python Standard and DesignScript Libraries
import sys
import clr
clr.AddReference('ProtoGeometry')
from Autodesk.DesignScript.Geometry import *

# Timber Beam Class
class TimberColumn:
    def __init__(self, base_point, height, radius):
        self.base = base_point
        self.height = height
        self.radius = radius
        self.geometry = None
        
    def generate(self):
        top_pt = Point.ByCoordinates(self.base.X, self.base.Y, self.base.Z + self.height)
        line = Line.ByStartPointEndPoint(self.base, top_pt)
        base_circle = Circle.ByCenterPointRadius(self.base, self.radius)
        self.geometry = Solid.BySweep(base_circle, line, False)
        return self.geometry
    
    def get_volume(self):
        if self.geometry:
            return self.geometry.Volume
        return 0.0
       

#Steel Panel Class
class SteelRoofPanel:
    def __init__(self, pt1, pt2, peak_pt, thickness, arch_height):
        self.p1 = pt1
        self.p2 = pt2
        self.peak = peak_pt
        self.thickness = thickness
        self.arch_height = arch_height
        self.geometry = None
    
    def generate(self):
       mid_base_x = (self.p1.X + self.p2.X) / 2
       mid_base_y = (self.p1.Y + self.p2.Y) / 2
       mid_base_z = self.p1.Z
       
       mid_base_point = Point.ByCoordinates(mid_base_x, mid_base_y, mid_base_z)
       
       arch_point = Point.ByCoordinates(mid_base_x, mid_base_y, mid_base_z + self.arch_height)
       
       arc_profile = NurbsCurve.ByPoints([self.p1, arch_point, self.p2])
       
       peak_line = Line.ByStartPointEndPoint(self.peak, self.p2)
       
       surf = Surface.ByLoft([arc_profile, peak_line])
       
       self.geometry = surf.Thicken(self.thickness)
       return self.geometry
        
    def get_volume(self):
        if self.geometry:
            return self.geometry.Volume
        return 0.0

#Inputs
octagon_points = IN[0]
pav_h = IN[1]
col_r = IN[2]
roof_th = IN[3]
arch_h = IN[4]

#Outputs
column_geometries = []
roof_geometries = []
total_timber_vol = 0.0
total_steel_vol = 0.0

center_peak = Point.ByCoordinates(0, 0, pav_h + 1500)

for i in range(len(octagon_points)):
    current_pt = octagon_points[i]
    
    my_column = TimberColumn(current_pt, pav_h, col_r)
    col_geo = my_column.generate()
    column_geometries.append(col_geo)
    total_timber_vol += my_column.get_volume()
    
    next_index = (i + 1) % len(octagon_points)
    next_pt = octagon_points[next_index]
    
    roof_base_1 = Point.ByCoordinates(current_pt.X, current_pt.Y, pav_h)
    roof_base_2 = Point.ByCoordinates(next_pt.X, next_pt.Y, pav_h)
    
    my_roof = SteelRoofPanel(roof_base_1, roof_base_2, center_peak, roof_th, arch_h)
    roof_geo = my_roof.generate()
    roof_geometries.append(roof_geo)
    total_steel_vol += my_roof.get_volume()
    
OUT = [column_geometries, roof_geometries, total_timber_vol, total_steel_vol]
# ----------------------------------------
code_block_6 = CodeBlock(x=python_script) { columns = x[0]; roof = x[1]; vol_timber = x[2]; vol_steel = x[3]; }
volume_of_steel_mm_2 = Watch(code_block_6.vol_steel)
volume_of_timber_mm_2 = Watch(code_block_6.vol_timber)
color_palette = ColorPalette({R: 149, G: 71, B: 6, A: 255})
byGeometryColor_2 = Modifiers.GeometryColor.ByGeometryColor(geometry=code_block_6.columns, color=color_palette)
color_palette_2 = ColorPalette({R: 67, G: 73, B: 81, A: 255})
byGeometryColor_3 = Modifiers.GeometryColor.ByGeometryColor(geometry=code_block_6.roof, color=color_palette_2)
