# Dynamo graph 1849119.dyn (Dynamo 4.0.0.3277)

# group: Don't touch this ground
code_block = CodeBlock { -5000; -5000; -200; }
byCoordinates = Point.ByCoordinates(x=code_block.out0, y=code_block.out1, z=code_block.out2)
code_block_2 = CodeBlock { 5000; 5000; 0; }
byCoordinates_2 = Point.ByCoordinates(x=code_block_2.out0, y=code_block_2.out1, z=code_block_2.out2)
byCorners = Cuboid.ByCorners(lowPoint=byCoordinates, highPoint=byCoordinates_2)
code_block_3 = CodeBlock { 0; 100; 0; }
byARGB = Color.ByARGB(red=code_block_3.out0, green=code_block_3.out1, blue=code_block_3.out2)
byGeometryColor = Modifiers.GeometryColor.ByGeometryColor(geometry=byCorners, color=byARGB)
code_block_4 = CodeBlock {  }

number = DoubleInput(5000)
byCoordinates_3 = Point.ByCoordinates(x=number, y=number)
number_2 = DoubleInput(5000)
entrance_height_slinder = DoubleSlider(5000, range=5000..7000 step 10)
byCoordinates_4 = Point.ByCoordinates(y=number_2, z=entrance_height_slinder)
number_3 = DoubleInput(-5000)
number_4 = DoubleInput(5000)
byCoordinates_5 = Point.ByCoordinates(x=number_3, y=number_4)
byThreePoints = Arc.ByThreePoints(firstPoint=byCoordinates_3, secondPoint=byCoordinates_4, thirdPoint=byCoordinates_5)
code_block_5 = CodeBlock { 0..1..0.1; }
pointAtParameter = Curve.PointAtParameter(curve=byThreePoints, param=code_block_5)
number_5 = DoubleInput(5000)
number_6 = DoubleInput(-3000)
byCoordinates_6 = Point.ByCoordinates(x=number_5, y=number_6)
number_7 = DoubleInput(-5000)
byCoordinates_7 = Point.ByCoordinates(y=number_7)
number_8 = DoubleInput(-5000)
number_9 = DoubleInput(-3000)
byCoordinates_8 = Point.ByCoordinates(x=number_8, y=number_9)
byThreePoints_2 = Arc.ByThreePoints(firstPoint=byCoordinates_6, secondPoint=byCoordinates_7, thirdPoint=byCoordinates_8)
pointAtParameter_2 = Curve.PointAtParameter(curve=byThreePoints_2, param=code_block_5)
byStartPointEndPoint = Line.ByStartPointEndPoint(startPoint=pointAtParameter, endPoint=pointAtParameter_2)
byLoft = Surface.ByLoft(crossSections=byStartPointEndPoint)
glass_thickness = DoubleSlider(25, range=25..250 step 1)
thicken = Surface.Thicken(surface=byLoft, thickness=glass_thickness)
class_glass_panel = Python(IN[0]=byLoft, IN[1]=glass_thickness)  # PythonNet3
# ---------- class_glass_panel.python (54 lines) ----------
# Load the Python Standard and DesignScript Libraries
import sys
import clr
clr.AddReference('ProtoGeometry')
from Autodesk.DesignScript.Geometry import *

# The inputs to this node will be stored as a list in the IN variables.
dataEnteringNode = IN

# Place your code below this line

surfaces = IN[0]
glass_thk = IN[1]
if not isinstance(surfaces, list):
    surfaces = [surfaces]
    
    


class GlassPanel:
    def __init__(self, surface, thickness):
        self.surface = surface
        self.thickness = thickness

    def generateGeometry(self):
        return Surface.Thicken(self.surface, self.thickness, False)

    def volume(self):
        return self.generateGeometry().Volume

glass_solids = []
glass_volumes = []
raw_volumes = []


for srf in surfaces:
    
    panel = GlassPanel(srf, glass_thk)
    
    volume_value = panel.volume()
    
    raw_volumes.append(volume_value)



if raw_volumes:
   
    first_volume = raw_volumes[0]
    
    
    formatted_output = f"{first_volume:.2f} mm^3"


OUT = formatted_output
# ----------------------------------------
firstItem = List.FirstItem(list=class_glass_panel)
watch = Watch(firstItem)
beam_density = DoubleSlider(20, range=10..20 step 1)
code_block_6 = CodeBlock(beam_density=beam_density) { beam_density*1; }
code_block_7 = CodeBlock(beam_density=beam_density) { beam_density/(beam_density*beam_density); }
sequence = Sequence(amount=code_block_6, step=code_block_7)
getIsoline = Surface.GetIsoline(surface=byLoft, parameter=sequence)
code_block_8 = CodeBlock { 100; }
XAxis = Vector.XAxis()
byThickeningCurveNormal = PolyCurve.ByThickeningCurveNormal(curve=getIsoline, thickness=code_block_8, normal=XAxis)
beam_thickness = DoubleSlider(100, range=50..150 step 1)
extrudeAsSolid = Curve.ExtrudeAsSolid(curve=byThickeningCurveNormal, distance=beam_thickness)
code_block_9 = CodeBlock { 1; }
sequence_2 = Sequence(amount=code_block_6, step=code_block_7)
getIsoline_2 = Surface.GetIsoline(surface=byLoft, isoDirection=code_block_9, parameter=sequence_2)
YAxis = Vector.YAxis()
byThickeningCurveNormal_2 = PolyCurve.ByThickeningCurveNormal(curve=getIsoline_2, thickness=code_block_8, normal=YAxis)
extrudeAsSolid_2 = Curve.ExtrudeAsSolid(curve=byThickeningCurveNormal_2, distance=beam_thickness)
union = Solid.Union(solid=extrudeAsSolid, solid_2=extrudeAsSolid_2)
class_steel_beam = Python(IN[0]=union)  # PythonNet3
# ---------- class_steel_beam.python (69 lines) ----------
# Load the Python Standard and DesignScript Libraries
import sys
import clr
clr.AddReference('ProtoGeometry')
from Autodesk.DesignScript.Geometry import *
clr.AddReference('System')
from System.Collections.Generic import List as DSNList

# The inputs to this node will be stored as a list in the IN variables.
dataEnteringNode = IN

# Place your code below this line
class SteelBeamAnalyzer:
    
  

    def __init__(self, beam_solid):
        
        self.geometry = beam_solid
        self.volume = 0.0

    def calculate_volume(self):
        
        if isinstance(self.geometry, Solid):
            self.volume = self.geometry.Volume
        elif self.geometry:
          
            try:
                
                self.volume = sum(s.Volume for s in self.geometry if isinstance(s, Solid))
            except:
                self.volume = 0.0
        else:
            self.volume = 0.0
            
        return self.volume

    def get_geometry_and_volume(self):
       
        if self.volume == 0.0:
            self.calculate_volume()
            
        return self.geometry, self.volume


solids_input = IN[0] if isinstance(IN[0], DSNList) else [IN[0]]

output_geometry = []
output_volume = []
raw_volume_numbers = []
for solid in solids_input:
    
    beam_analysis = SteelBeamAnalyzer(solid)
    
   
    geom, vol = beam_analysis.get_geometry_and_volume()
    
    raw_volume_numbers.append(vol)


formatted_volume_output = []

for volume_number in raw_volume_numbers:
   
    formatted_string = f"{volume_number:.2f} mm^3"
    formatted_volume_output.append(formatted_string)


OUT = formatted_volume_output
# ----------------------------------------
firstItem_2 = List.FirstItem(list=class_steel_beam)
watch_2 = Watch(firstItem_2)
