# Dynamo graph 1849136.dyn (Dynamo 3.6.0.9395)

# group: Don't touch this ground
code_block = CodeBlock { -5000; -5000; -200; }
byCoordinates = Point.ByCoordinates(x=code_block.out0, y=code_block.out1, z=code_block.out2)
code_block_2 = CodeBlock { 5000; 5000; 0; }
byCoordinates_2 = Point.ByCoordinates(x=code_block_2.out0, y=code_block_2.out1, z=code_block_2.out2)
byCorners = Cuboid.ByCorners(lowPoint=byCoordinates, highPoint=byCoordinates_2)
code_block_3 = CodeBlock { 0; 100; 0; }
byARGB = Color.ByARGB(red=code_block_3.out0, green=code_block_3.out1, blue=code_block_3.out2)
byGeometryColor = Modifiers.GeometryColor.ByGeometryColor(geometry=byCorners, color=byARGB)

# group: Concrete Base
square_base_side_length = IntegerSlider(8500, range=5000..10000 step 100)  # "Square Base Side Length (PARAMETER)"
code_block_4 = CodeBlock(l=square_base_side_length) { height = 100; length = l; }
concrete_base = Python()  # CPython3; unwired: IN[0]
# ---------- concrete_base.python (33 lines) ----------
# Load the Python Standard and DesignScript Libraries
import sys
import clr
clr.AddReference('ProtoGeometry')
from Autodesk.DesignScript.Geometry import *

class squareConcreteSlab:
    
    def __init__ (self, sidelength, height):
        self.arret = sidelength
        self.height = height
        
    def corners(self):
        
        corner1 = Point.ByCoordinates(self.arret/2, self.arret/2, self.height/2)
        
        corner2 = Point.ByCoordinates(-self.arret/2, -self.arret/2, -self.height/2)
        
        return corner1, corner2
        
    def makeGeo(self):
        
        corner1, corner2 = self.corners()
        
        return Cuboid.ByCorners(corner1, corner2)
        
    def calcVol(self):
        
        volume = self.arret**2 * self.height
        
        return volume
        
OUT = squareConcreteSlab
# ----------------------------------------
slab_instance = Python(IN[0]=concrete_base, IN[1]=code_block_4.length, IN[2]=code_block_4.height)  # CPython3
# ---------- slab_instance.python (7 lines) ----------
object = IN[0]
length = IN[1]
height = IN[2]

object = object(length,height)

OUT = [object.makeGeo(),object.calcVol()]
# ----------------------------------------

# group: Column Rails
column_radius_parameter = DoubleSlider(325, range=0..2000 step 10)
column_base_offset_factor_of = DoubleSlider(2.7, range=1.75..5 step 0.05)  # "Column-Base Offset Factor (of radius) (PARAMETER)"
offset_for_column_rails = CodeBlock(radius=column_radius_parameter, offsetFactor=column_base_offset_factor_of) { radius; offset = radius * offsetFactor; }
coordinates_for_column_rails = CodeBlock(offset=offset_for_column_rails.offset, arret=code_block_4.length) { offset; arret; xpos = arret/2 - offset; ypos = xpos; xneg = 0 - xpos; yneg = - xpos; }
z_coord_column_base = CodeBlock(height=code_block_4.height) { height; zbot = height/2; ztop = zbot + columnHeight; }  # unwired: columnHeight
column_corner_x_y = Point.ByCoordinates(x=coordinates_for_column_rails.xpos, y=coordinates_for_column_rails.ypos, z=z_coord_column_base.zbot)
column_corner_x_y_2 = Point.ByCoordinates(x=coordinates_for_column_rails.xpos, y=coordinates_for_column_rails.yneg, z=z_coord_column_base.zbot)
column_bottom_rails1 = Line.ByStartPointEndPoint(startPoint=column_corner_x_y, endPoint=column_corner_x_y_2)
ZAxis = Vector.ZAxis()
column_height_parameter = DoubleSlider(4000, range=0..5000 step 100)
column_top_rails_1 = Geometry.Translate(geometry=column_bottom_rails1, direction=ZAxis, distance=column_height_parameter)

# group: Columns [DEPRECATED]
sandstone_column = Python()  # CPython3
# ---------- sandstone_column.python (17 lines) ----------
# Load the Python Standard and DesignScript Libraries
import sys
import clr
clr.AddReference('ProtoGeometry')
from Autodesk.DesignScript.Geometry import *

class columnSandstone:
    
    def __init__ (self, centreline, radius):
        self.centreline = centreline
        self.radius = radius
        
    def makeGeometry(self):
        
        return Cylinder.ByPointsRadius(self.centreline.StartPoint,self.centreline.EndPoint,self.radius)
        
OUT = columnSandstone
# ----------------------------------------
origin = Point.Origin()
code_block_5 = CodeBlock { 0; 2500; }
byCoordinates_3 = Point.ByCoordinates(x=code_block_5.out0, y=code_block_5.out0, z=code_block_5.out1)
centreline = Line.ByStartPointEndPoint(startPoint=origin, endPoint=byCoordinates_3)
column_instance = Python(IN[0]=sandstone_column, IN[1]=centreline, IN[2]=column_radius_parameter)  # CPython3
# ---------- column_instance.python (7 lines) ----------
object = IN[0]
centreline = IN[1]
radius = IN[2]

object = object(centreline,radius)

OUT = object.makeGeometry()
# ----------------------------------------

length = Curve.Length(curve=column_top_rails_1)
concrete_base_slab_volume = Watch(slab_instance)
roof_width_double_of_column = CodeBlock(columnRadius=column_radius_parameter) { columnRadius; roofWidth = columnRadius * 2; }  # "Roof Width (double of column radius)"

# group: Roof Frame
roof_half_width = CodeBlock(roofWidth=roof_width_double_of_column.roofWidth) { roofHalfWidth = roofWidth /2; }
roof_triangle_corner_correction = CodeBlock(offset=offset_for_column_rails.offset) { rtccf = offset * 0.75; }  # "Roof Triangle corner correction factor"
roof_height_parameter = IntegerSlider(2250, range=0..5000 step 100)
coordinate_of_tip_of_roof = CodeBlock(roofLow=z_coord_column_base.zbot, columnHeight=column_height_parameter, roofHeight=roof_height_parameter) { roofLow; columnHeight; roofHigh = roofLow + columnHeight + roofHeight; }

correction_for_roof_frame = CodeBlock(offset=roof_triangle_corner_correction, y1=coordinates_for_column_rails.ypos, y2=coordinates_for_column_rails.yneg) { rfFix = offset; y1real = y1 + rfFix; y2real = y2 - rfFix; }

# group (continued): Roof Frame
front = Point.ByCoordinates(y=correction_for_roof_frame.y1real, z=coordinate_of_tip_of_roof.roofHigh)
back = Point.ByCoordinates(y=correction_for_roof_frame.y2real, z=coordinate_of_tip_of_roof.roofHigh)
roof_centreline = Line.ByStartPointEndPoint(startPoint=front, endPoint=back)

code_block_6 = CodeBlock(roofWidth=roof_width_double_of_column.roofWidth) { roofWidth; }
geo_extractor_less_cool_function = CodeBlock(input=slab_instance) { geo = input[0]; }  # "Geo Extractor (Less cool function, but Dynamo might be crashing without it)"
column_corner_x_y_3 = Point.ByCoordinates(x=coordinates_for_column_rails.xneg, y=coordinates_for_column_rails.ypos, z=z_coord_column_base.zbot)
column_corner_x_y_4 = Point.ByCoordinates(x=coordinates_for_column_rails.xneg, y=coordinates_for_column_rails.yneg, z=z_coord_column_base.zbot)

# group (continued): Column Rails
column_bottom_rails2 = Line.ByStartPointEndPoint(startPoint=column_corner_x_y_3, endPoint=column_corner_x_y_4)
column_top_rails_2 = Geometry.Translate(geometry=column_bottom_rails2, direction=ZAxis, distance=column_height_parameter)

# group: Columns
code_block_7 = CodeBlock(length=length) { start = 0; end = start + length; }
number_of_columns_per_row = IntegerSlider(5, range=0..10 step 1)  # "Number of Columns per row (PARAMETER)"
step_value_calculation = CodeBlock(start=code_block_7.start, end=code_block_7.end, n=number_of_columns_per_row) { start; end; n; step = (end - start) / (n-1); }
sequence = Sequence(start=code_block_7.start, amount=number_of_columns_per_row, step=step_value_calculation.step)
watch = Watch(sequence)
subdiv_top_1 = Curve.PointAtSegmentLength(curve=column_top_rails_1, segmentLength=sequence)
subdiv_bottom_1 = Curve.PointAtSegmentLength(curve=column_bottom_rails1, segmentLength=sequence)
column_centrelines_1 = Line.ByStartPointEndPoint(startPoint=subdiv_top_1, endPoint=subdiv_bottom_1)
watch_2 = Watch(column_centrelines_1)
sandstone_column_2 = Python()  # CPython3
# ---------- sandstone_column_2.python (28 lines) ----------
# Load the Python Standard and DesignScript Libraries
import sys
import clr
clr.AddReference('ProtoGeometry')
from Autodesk.DesignScript.Geometry import *

import math

class columnSandstone:
    
    def __init__ (self, centreline, radius):
        self.centreline = centreline
        self.radius = radius
        
    def makeGeometry(self):
        
        return Cylinder.ByPointsRadius(self.centreline.StartPoint,self.centreline.EndPoint,self.radius)
        
    def calcVol(self):
        
        h = self.centreline.Length
        r = self.radius
        
        volume = math.pi*r**2*h
        
        return volume
        
OUT = columnSandstone
# ----------------------------------------
columns_1 = Python(IN[0]=sandstone_column_2, IN[1]=column_centrelines_1, IN[2]=column_radius_parameter)  # CPython3
# ---------- columns_1.python (19 lines) ----------
object = IN[0]
centrelines = IN[1]
radius = IN[2]

geometry = []

totVol = 0

for n in range(len(centrelines)):
    
    centreline = centrelines[n]
    
    column = object(centreline,radius)
    
    geometry.append(column.makeGeometry())
    
    totVol = totVol + column.calcVol()

OUT = [geometry, totVol]
# ----------------------------------------
columns_1_calcvol = Watch(columns_1)
subdiv_top_2 = Curve.PointAtSegmentLength(curve=column_top_rails_2, segmentLength=sequence)
subdiv_bottom_2 = Curve.PointAtSegmentLength(curve=column_bottom_rails2, segmentLength=sequence)
column_centreline_2 = Line.ByStartPointEndPoint(startPoint=subdiv_top_2, endPoint=subdiv_bottom_2)
columns_2 = Python(IN[0]=sandstone_column_2, IN[1]=column_centreline_2, IN[2]=column_radius_parameter)  # CPython3
# ---------- columns_2.python (18 lines) ----------
object = IN[0]
centrelines = IN[1]
radius = IN[2]

geometry = []
totVol = 0

for n in range(len(centrelines)):
    
    centreline = centrelines[n]
    
    column = object(centreline,radius)
    
    geometry.append(column.makeGeometry())
    
    totVol = totVol + column.calcVol()

OUT = [geometry, totVol]
# ----------------------------------------
watch_3 = Watch(columns_2)

# group: Roof Bed
roof_thickness_parameter = DoubleSlider(200, range=0..2000 step 100)
roof_bed = Python()  # CPython3; unwired: IN[0]
# ---------- roof_bed.python (40 lines) ----------
# Load the Python Standard and DesignScript Libraries
import sys
import clr
clr.AddReference('ProtoGeometry')
from Autodesk.DesignScript.Geometry import *

class roofBed:
    
    def __init__ (self, baseline, width, height, axialCorrection):
        
        self.baseline = baseline
        self.width = width
        self.height = height
        self.fix = axialCorrection
        
    def processBaseline(self):
        
        length = self.baseline.Length
        origin = self.baseline.PointAtParameter(0.5)
        
        length = length + self.fix * 1.5
        origin = origin.Translate(0,0,self.height / 2)
        
        return length, origin
        
    def makeGeo(self):
        
        length, origin = self.processBaseline()
        
        return Cuboid.ByLengths(origin, self.width, length, self.height)
        
    def calcVol(self):
        
        length, origin = self.processBaseline()
        
        volume = length * self.width * self.height
        
        return volume
    
OUT = roofBed
# ----------------------------------------
roof_bed_instance = Python(IN[0]=roof_bed, IN[1]=column_top_rails_1, IN[2]=roof_width_double_of_column.roofWidth, IN[3]=roof_thickness_parameter, IN[4]=offset_for_column_rails.offset)  # CPython3
# ---------- roof_bed_instance.python (9 lines) ----------
object = IN[0]
baseline = IN[1]
width = IN[2]
height = IN[3]
axialCorrection = IN[4]

object = object(baseline,width,height,axialCorrection)

OUT = [object.makeGeo(),object.calcVol()]
# ----------------------------------------
roof_bed_instance_2 = Python(IN[0]=roof_bed, IN[1]=column_top_rails_2, IN[2]=roof_width_double_of_column.roofWidth, IN[3]=roof_thickness_parameter, IN[4]=offset_for_column_rails.offset)  # CPython3; same code as roof_bed_instance
roof_bed_volume_1 = Watch(roof_bed_instance)
roof_bed_volume_2 = Watch(roof_bed_instance_2)

# group: Roof Frame > Base corner of roof triangle frame super awesome black box of epicness that you definitely do not need to see inside of (pls don't open me, the inefficiency of these nodes is rly embarassing)
# There is a chance that this would've been better as a python script but that ship set sail an hour ago						this also could have been much more efficient but I am NOT redoing these nodes
startPoint = Curve.StartPoint(curve=column_top_rails_1)
XAxis = Vector.XAxis()
x_y = Geometry.Translate(geometry=startPoint, direction=XAxis, distance=roof_half_width)
YAxis = Vector.YAxis()
x_y_2 = Geometry.Translate(geometry=x_y, direction=YAxis, distance=roof_triangle_corner_correction)
ZAxis_2 = Vector.ZAxis()
x_y_3 = Geometry.Translate(geometry=x_y_2, direction=ZAxis_2, distance=roof_thickness_parameter)
endPoint = Curve.EndPoint(curve=column_top_rails_1)
x_y_4 = Geometry.Translate(geometry=endPoint, direction=XAxis, distance=roof_half_width)
reverse = Vector.Reverse(vector=YAxis)
x_y_2_2 = Geometry.Translate(geometry=x_y_4, direction=reverse, distance=roof_triangle_corner_correction)
x_y_3_2 = Geometry.Translate(geometry=x_y_2_2, direction=ZAxis_2, distance=roof_thickness_parameter)
startPoint_2 = Curve.StartPoint(curve=column_top_rails_2)
reverse_2 = Vector.Reverse(vector=XAxis)
x_y_5 = Geometry.Translate(geometry=startPoint_2, direction=reverse_2, distance=roof_half_width)
x_y_2_3 = Geometry.Translate(geometry=x_y_5, direction=YAxis, distance=roof_triangle_corner_correction)
x_y_3_3 = Geometry.Translate(geometry=x_y_2_3, direction=ZAxis_2, distance=roof_thickness_parameter)
endPoint_2 = Curve.EndPoint(curve=column_top_rails_2)
x_y_6 = Geometry.Translate(geometry=endPoint_2, direction=reverse_2, distance=roof_half_width)
x_y_2_4 = Geometry.Translate(geometry=x_y_6, direction=reverse, distance=roof_triangle_corner_correction)
x_y_3_4 = Geometry.Translate(geometry=x_y_2_4, direction=ZAxis_2, distance=roof_thickness_parameter)

# group (continued): Roof Frame
watch_4 = Watch(x_y_3)
fl_hypoteneuse = Line.ByStartPointEndPoint(startPoint=front, endPoint=x_y_3)
rl_hypoteneuse = Line.ByStartPointEndPoint(startPoint=back, endPoint=x_y_3_2)
fr_hypoteneuse = Line.ByStartPointEndPoint(startPoint=front, endPoint=x_y_3_3)
rr_hypoteneuse = Line.ByStartPointEndPoint(startPoint=back, endPoint=x_y_3_4)

# group: Triangle Part of Roof
length_2 = Curve.Length(curve=fl_hypoteneuse)
origin_2 = Point.Origin()
YAxis_2 = Vector.YAxis()
code_block_8 = CodeBlock(opp=roof_height_parameter, correction=roof_thickness_parameter, hyp=length_2) { angleRatio = (opp-correction)/hyp; }
asin = Math.Asin(ratio=code_block_8)
code_block_9 = CodeBlock(theta=asin) { theta2 = -theta; }
endPoint_3 = Curve.EndPoint(curve=fl_hypoteneuse)
endPoint_4 = Curve.EndPoint(curve=rl_hypoteneuse)
endPoint_5 = Curve.EndPoint(curve=fr_hypoteneuse)
endPoint_6 = Curve.EndPoint(curve=rr_hypoteneuse)
roof_concrete_frame = Cuboid.ByLengths(width=length_2, length=roof_width_double_of_column.roofWidth, height=roof_thickness_parameter)
left = Geometry.Rotate(geometry=roof_concrete_frame, origin=origin_2, axis=YAxis_2, degrees=asin)
vertex_selector_not_a_parameter = IntegerSlider(1, range=0..7 step 1)  # "Vertex Selector (NOT A PARAMETER. DO NOT TOUCH)"
vertices = Topology.Vertices(topology=left)
code_block_10 = CodeBlock(n=vertex_selector_not_a_parameter, vertex=vertices) { n; transPoint = vertex[n]; }
pointGeometry = Vertex.PointGeometry(vertex=code_block_10.transPoint)
fl_trans_vector = Vector.ByTwoPoints(start=pointGeometry, end=endPoint_3)
length_3 = Vector.Length(vector=fl_trans_vector)
final_fl_angled_frame_blocl = Geometry.Translate(geometry=left, direction=fl_trans_vector, distance=length_3)
vertex_selector_not_a_parameter_2 = IntegerSlider(0, range=0..7 step 1)  # "Vertex Selector (NOT A PARAMETER. DO NOT TOUCH)"
code_block_11 = CodeBlock(n=vertex_selector_not_a_parameter_2, vertex=vertices) { n; transPoint = vertex[n]; }
pointGeometry_2 = Vertex.PointGeometry(vertex=code_block_11.transPoint)
rl_trans_vector = Vector.ByTwoPoints(start=pointGeometry_2, end=endPoint_4)
length_4 = Vector.Length(vector=rl_trans_vector)
final_rl_angled_frame_blocl = Geometry.Translate(geometry=left, direction=rl_trans_vector, distance=length_4)
right = Geometry.Rotate(geometry=roof_concrete_frame, origin=origin_2, axis=YAxis_2, degrees=code_block_9)
vertex_selector_not_a_parameter_3 = IntegerSlider(2, range=0..7 step 1)  # "Vertex Selector (NOT A PARAMETER. DO NOT TOUCH)"
vertices_2 = Topology.Vertices(topology=right)
code_block_12 = CodeBlock(n=vertex_selector_not_a_parameter_3, vertex=vertices_2) { n; transPoint = vertex[n]; }
pointGeometry_3 = Vertex.PointGeometry(vertex=code_block_12.transPoint)
fr_trans_vector = Vector.ByTwoPoints(start=pointGeometry_3, end=endPoint_5)
length_5 = Vector.Length(vector=fr_trans_vector)
final_fr_angled_frame_blocl = Geometry.Translate(geometry=right, direction=fr_trans_vector, distance=length_5)
vertex_selector_not_a_parameter_4 = IntegerSlider(3, range=0..7 step 1)  # "Vertex Selector (NOT A PARAMETER. DO NOT TOUCH)"
code_block_13 = CodeBlock(n=vertex_selector_not_a_parameter_4, vertex=vertices_2) { n; transPoint = vertex[n]; }
pointGeometry_4 = Vertex.PointGeometry(vertex=code_block_13.transPoint)
fr_trans_vector_2 = Vector.ByTwoPoints(start=pointGeometry_4, end=endPoint_6)
length_6 = Vector.Length(vector=fr_trans_vector_2)
final_rr_angled_frame_blocl = Geometry.Translate(geometry=right, direction=fr_trans_vector_2, distance=length_6)

# group: Glass Roof
centerline_length = Curve.Length(curve=roof_centreline)
glass_roof_dimensions = CodeBlock(w0=length_2, l0=centerline_length, h0=roof_thickness_parameter, offset=code_block_6) { w0; l0; h0; width = w0 + offset; length = l0 + offset * 2; }
glass_roof = Cuboid.ByLengths(width=glass_roof_dimensions.width, length=glass_roof_dimensions.length, height=glass_roof_dimensions.h0)
left_2 = Geometry.Rotate(geometry=glass_roof, origin=origin_2, axis=YAxis_2, degrees=asin)
vertex_selector_not_a_parameter_5 = IntegerSlider(2, range=0..7 step 1)  # "Vertex Selector (NOT A PARAMETER. DO NOT TOUCH)"
vertices_3 = Topology.Vertices(topology=left_2)
code_block_14 = CodeBlock(n=vertex_selector_not_a_parameter_5, vertex=vertices_3) { n; transPoint = vertex[n]; }
pointGeometry_5 = Vertex.PointGeometry(vertex=code_block_14.transPoint)
roof_end_point = Geometry.Translate(geometry=front, yTranslation=code_block_6)
left_glass_trans_vect = Vector.ByTwoPoints(start=pointGeometry_5, end=roof_end_point)
length_7 = Vector.Length(vector=left_glass_trans_vect)
left_glass_roof = Geometry.Translate(geometry=left_2, direction=left_glass_trans_vect, distance=length_7)
a_slider = IntegerSlider(55, range=0..255 step 1)
r_slider = IntegerSlider(0, range=0..255 step 1)
g_slider = IntegerSlider(120, range=0..255 step 1)
b_slider = IntegerSlider(255, range=0..255 step 1)
code_block_15 = CodeBlock(a=a_slider, r=r_slider, g=g_slider, b=b_slider) { a; r; g; b; }
glass_colour = Color.ByARGB(alpha=code_block_15.a, red=code_block_15.r, green=code_block_15.g, blue=code_block_15.b)
byGeometryColor_2 = Modifiers.GeometryColor.ByGeometryColor(geometry=left_glass_roof, color=glass_colour)
right_2 = Geometry.Rotate(geometry=glass_roof, origin=origin_2, axis=YAxis_2, degrees=code_block_9)
vertex_selector_not_a_parameter_6 = IntegerSlider(1, range=0..7 step 1)  # "Vertex Selector (NOT A PARAMETER. DO NOT TOUCH)"
vertices_4 = Topology.Vertices(topology=right_2)
code_block_16 = CodeBlock(n=vertex_selector_not_a_parameter_6, vertex=vertices_4) { n; transPoint = vertex[n]; }
pointGeometry_6 = Vertex.PointGeometry(vertex=code_block_16.transPoint)
right_glass_trans_vect = Vector.ByTwoPoints(start=pointGeometry_6, end=roof_end_point)
right_glass_roof = Geometry.Translate(geometry=right_2, direction=right_glass_trans_vect, distance=length_7)
byGeometryColor_3 = Modifiers.GeometryColor.ByGeometryColor(geometry=right_glass_roof, color=glass_colour)

# group: Angled Roof Bed
left_vector = Vector.ByTwoPoints(start=endPoint_3, end=endPoint_4)
reverse_3 = Vector.Reverse(vector=left_vector)
angled_bed_l = Geometry.Rotate(geometry=roof_bed_instance, origin=endPoint_3, axis=reverse_3, degrees=asin)
right_vector = Vector.ByTwoPoints(start=endPoint_6, end=endPoint_5)
reverse_4 = Vector.Reverse(vector=right_vector)
angled_bed_l_2 = Geometry.Rotate(geometry=roof_bed_instance_2, origin=endPoint_5, axis=reverse_4, degrees=asin)

geo_extractor_less_cool_function_2 = CodeBlock(input=angled_bed_l) { geo = input[0]; }  # "Geo Extractor (Less cool function, but Dynamo might be crashing without it)"
geo_extractor_less_cool_function_3 = CodeBlock(input=angled_bed_l_2) { geo = input[0]; }  # "Geo Extractor (Less cool function, but Dynamo might be crashing without it)"
geo_extractor_less_cool_function_4 = CodeBlock(input=columns_1_calcvol) { geo = input[0]; }  # "Geo Extractor (Less cool function, but Dynamo might be crashing without it)"
solid_consolidator_function = Python(IN[0]=geo_extractor_less_cool_function_4)  # "Solid Consolidator Function (super cool!) (this is an intermediate instance for the column rows)"; CPython3
# ---------- solid_consolidator_function.python (18 lines) ----------
# Load the Python Standard and DesignScript Libraries
import sys
import clr
clr.AddReference('ProtoGeometry')
from Autodesk.DesignScript.Geometry import *

inSolids = IN[0]

outSolid = inSolids[0]


for n in range(len(inSolids) - 1):
    
    outSolid = Solid.Union(outSolid,inSolids[n+1])
    
OUT = outSolid
    
    
# ----------------------------------------
watch_5 = Watch(solid_consolidator_function)
geo_extractor_less_cool_function_5 = CodeBlock(input=watch_3) { geo = input[0]; }  # "Geo Extractor (Less cool function, but Dynamo might be crashing without it)"
solid_consolidator_function_2 = Python(IN[0]=geo_extractor_less_cool_function_5)  # "Solid Consolidator Function (super cool!) (this is an intermediate instance for the column rows)"; CPython3; same code as solid_consolidator_function
watch_6 = Watch(solid_consolidator_function_2)
geo_extractor_less_cool_function_6 = CodeBlock(input=roof_bed_volume_1) { geo = input[0]; }  # "Geo Extractor (Less cool function, but Dynamo might be crashing without it)"
geo_extractor_less_cool_function_7 = CodeBlock(input=roof_bed_volume_2) { geo = input[0]; }  # "Geo Extractor (Less cool function, but Dynamo might be crashing without it)"

# group: Surface Consolidation
# Uses unions and differences to consolidate surfaces into one remove overlap on all surfaces, allowing for correct volume calculation, easier colouring, and removing z-fighting and double opacity on texturues
glass_solid = List.Create(item0=left_glass_roof, item1=right_glass_roof)
solid_consolidator_function_3 = Python(IN[0]=glass_solid)  # "Solid Consolidator Function (super cool!)"; CPython3; same code as solid_consolidator_function
concrete_pseudosandstone_solid = List.Create(item0=geo_extractor_less_cool_function, item1=geo_extractor_less_cool_function_2, item2=geo_extractor_less_cool_function_3, item3=watch_5, item4=watch_6, item5=final_fl_angled_frame_blocl, item6=final_rl_angled_frame_blocl, item7=final_fr_angled_frame_blocl, item8=final_rr_angled_frame_blocl, item9=geo_extractor_less_cool_function_6, item10=geo_extractor_less_cool_function_7)
solid_consolidator_function_4 = Python(IN[0]=concrete_pseudosandstone_solid)  # "Solid Consolidator Function (super cool!)"; CPython3; same code as solid_consolidator_function
difference = Solid.Difference(solid=solid_consolidator_function_3, other=solid_consolidator_function_4)
a_slider_2 = IntegerSlider(55, range=0..255 step 1)
r_slider_2 = IntegerSlider(155, range=0..255 step 1)
g_slider_2 = IntegerSlider(200, range=0..255 step 1)
b_slider_2 = IntegerSlider(255, range=0..255 step 1)
code_block_17 = CodeBlock(a=a_slider_2, r=r_slider_2, g=g_slider_2, b=b_slider_2) { a; r; g; b; }
glass_colour_2 = Color.ByARGB(alpha=code_block_17.a, red=code_block_17.r, green=code_block_17.g, blue=code_block_17.b)
final_glass_geometry = Modifiers.GeometryColor.ByGeometryColor(geometry=difference, color=glass_colour_2)
a_slider_3 = IntegerSlider(255, range=0..255 step 1)
r_slider_3 = IntegerSlider(212, range=0..255 step 1)
g_slider_3 = IntegerSlider(191, range=0..255 step 1)
b_slider_3 = IntegerSlider(142, range=0..255 step 1)
code_block_18 = CodeBlock(a=a_slider_3, r=r_slider_3, g=g_slider_3, b=b_slider_3) { a; r; g; b; }
concrete_pseudosandstone_colour = Color.ByARGB(alpha=code_block_18.a, red=code_block_18.r, green=code_block_18.g, blue=code_block_18.b)
final_concrete_pseudosandstone = Modifiers.GeometryColor.ByGeometryColor(geometry=solid_consolidator_function_4, color=concrete_pseudosandstone_colour)  # "Final Concrete/Pseudosandstone Geometry"
volume = Solid.Volume(solid=difference)
total_glass_volume_mm_2 = Watch(volume)
volume_2 = Solid.Volume(solid=solid_consolidator_function_4)
total_concrete_volume_mm_2 = Watch(volume_2)

watch_7 = Watch(geo_extractor_less_cool_function)
watch_8 = Watch(angled_bed_l)
watch_9 = Watch(angled_bed_l_2)
