# Dynamo graph 1849236.dyn (Dynamo 3.6.0.9395)

# group: Don't touch this ground
code_block = CodeBlock { -5000; -5000; -200; }
byCoordinates = Point.ByCoordinates(x=code_block.out0, y=code_block.out1, z=code_block.out2)
code_block_2 = CodeBlock { 5000; 5000; 0; }
byCoordinates_2 = Point.ByCoordinates(x=code_block_2.out0, y=code_block_2.out1, z=code_block_2.out2)
byCorners = Cuboid.ByCorners(lowPoint=byCoordinates, highPoint=byCoordinates_2)
code_block_3 = CodeBlock { 0; 100; 0; }
byARGB = Color.ByARGB(red=code_block_3.out0, green=code_block_3.out1, blue=code_block_3.out2)
byGeometryColor = Modifiers.GeometryColor.ByGeometryColor(geometry=byCorners, color=byARGB)

code_block_4 = CodeBlock { 0; }
pavilionBasePoint2 = Point.ByCoordinates(x=code_block_4, y=code_block_4, z=code_block_4)
roof2shifter = DoubleSlider(-1721.4, range=-5000..5000 step 0.1)
code_block_5 = CodeBlock(PavilionBasePoint=pavilionBasePoint2, Roof2Shifter=roof2shifter)
# ---------- code_block_5.designscript (8 lines) ----------
PavilionBase = PavilionBasePoint;
shift = Roof2Shifter;

Point.ByCoordinates(
	PavilionBase.X+shift,
	PavilionBase.Y,
	PavilionBase.Z
);
# ----------------------------------------

# group: Roof 1 Parameters
roof1WidthOffset = DoubleSlider(2000, range=1000..4500 step 0.1)
roof1LengthOffset = DoubleSlider(3000, range=2000..4500 step 0.1)
roof1HeightFront = DoubleSlider(2626.5, range=2500..3000 step 0.1)
roof1HeightBack = DoubleSlider(4000, range=3000..4500 step 0.1)

code_block_6 = CodeBlock(PavilionBasePoint=code_block_5.out2, RoofWidthOffset=roof1WidthOffset, RoofLengthOffset=roof1LengthOffset, RoofHeightFront=roof1HeightFront, RoofHeightBack=roof1HeightBack)
# ---------- code_block_6.designscript (12 lines) ----------
p = PavilionBasePoint;
w = RoofWidthOffset;
l = RoofLengthOffset;
hf = RoofHeightFront;
hb = RoofHeightBack;

frontLeft   = Point.ByCoordinates(p.X - w, p.Y - l, hf);
frontRight  = Point.ByCoordinates(p.X + w, p.Y - l, hf);
backLeft    = Point.ByCoordinates(p.X - w, p.Y + l, hb);
backRight   = Point.ByCoordinates(p.X + w, p.Y + l, hb);

[frontLeft, frontRight, backLeft, backRight];
# ----------------------------------------

# group: Roof 1 Corners/Lines
code_block_7 = CodeBlock { frontleft = 0; frontright = 1; backleft = 2; backright = 3; }
backleft_corner = List.GetItemAtIndex(list=code_block_6.out9, index=code_block_7.backleft)
watch = Watch(backleft_corner)
frontleft_corner = List.GetItemAtIndex(list=code_block_6.out9, index=code_block_7.frontleft)
frontright_corner = List.GetItemAtIndex(list=code_block_6.out9, index=code_block_7.frontright)
front_roof_line = Line.ByStartPointEndPoint(startPoint=frontleft_corner, endPoint=frontright_corner)
backright_corner = List.GetItemAtIndex(list=code_block_6.out9, index=code_block_7.backright)
back_roof_line = Line.ByStartPointEndPoint(startPoint=backleft_corner, endPoint=backright_corner)
leftside = Line.ByStartPointEndPoint(startPoint=frontleft_corner, endPoint=backleft_corner)
rightside = Line.ByStartPointEndPoint(startPoint=frontright_corner, endPoint=backright_corner)
list_create = List.Create(item0=front_roof_line, item1=back_roof_line)
roof_surface = Surface.ByLoft(crossSections=list_create)
roof_thickness = DoubleSlider(250, range=150..400 step 1)
thicken = Surface.Thicken(surface=roof_surface, thickness=roof_thickness)

python_script = Python()  # CPython3; unwired: IN[0]
# ---------- python_script.python (50 lines) ----------
import clr
clr.AddReference('ProtoGeometry')
from Autodesk.DesignScript.Geometry import *

# ---- Class 1: SteelPiece ----
class SteelPiece:
    def __init__(self, length, width, thickness):
        self.length = length
        self.width = width
        self.thickness = thickness

    def geometry(self):
        return Cuboid.ByLengths(self.length, self.width, self.thickness)

    def volume(self):
        return self.length * self.width * self.thickness


# ---- Class 2: GlassPiece ----
class GlassPiece:
    def __init__(self, length, width, thickness):
        self.length = length
        self.width = width
        self.thickness = thickness

    def geometry(self):
        return Cuboid.ByLengths(self.length, self.width, self.thickness)

    def volume(self):
        return self.length * self.width * self.thickness


# ---- Make a few simple instances ----

# 2 steel border pieces
steel1 = SteelPiece(2000, 100, 50)
steel2 = SteelPiece(2000, 100, 50)

# 1 glass panel piece
glass1 = GlassPiece(1500, 900, 25)

# put geometry + volume into outputs
OUT = [
    steel1.geometry(),
    steel1.volume(),
    steel2.geometry(),
    steel2.volume(),
    glass1.geometry(),
    glass1.volume()
]
# ----------------------------------------

# group: Bench
code_block_8 = CodeBlock { length = 1000; width = 3800; height = 120; }
byLengths = Cuboid.ByLengths(width=code_block_8.width, length=code_block_8.length, height=code_block_8.height)
code_block_9 = CodeBlock { X = -1715; Y = 1500; Z = 500; }
translate = Geometry.Translate(geometry=byLengths, xTranslation=code_block_9.X, yTranslation=code_block_9.Y, zTranslation=code_block_9.Z)

# group: Bench
code_block_10 = CodeBlock { length = 1000; width = 3800; height = 120; }
byLengths_2 = Cuboid.ByLengths(width=code_block_10.width, length=code_block_10.length, height=code_block_10.height)
code_block_11 = CodeBlock { X = 1715; Y = -1500; Z = 500; }
translate_2 = Geometry.Translate(geometry=byLengths_2, xTranslation=code_block_11.X, yTranslation=code_block_11.Y, zTranslation=code_block_11.Z)

# group: Back Wall
code_block_12 = CodeBlock { x=278.600; y=2000.000; z=0; }
ground_backright_corner = Point.ByCoordinates(x=[code_block_12.x, code_block_12.x], y=[code_block_12.y, code_block_12.y], z=[code_block_12.z, code_block_12.z])
inner_sideline = Line.ByStartPointEndPoint(startPoint=backright_corner, endPoint=ground_backright_corner)
code_block_13 = CodeBlock { x=-3721.400; y=2000.000; z=0; }
ground_backleft_corner = Point.ByCoordinates(x=code_block_13.x, y=code_block_13.y, z=code_block_13.z)
outer_sideline = Line.ByStartPointEndPoint(startPoint=backleft_corner, endPoint=ground_backleft_corner)
ground_line = Line.ByStartPointEndPoint(startPoint=ground_backleft_corner, endPoint=ground_backright_corner)
list_create_2 = List.Create(item0=ground_line, item1=back_roof_line)
byLoft = Surface.ByLoft(crossSections=list_create_2)
number_slider = DoubleSlider(220, range=200..500 step 0.1)
thicken_2 = Surface.Thicken(surface=byLoft, thickness=number_slider)

# group: Steel Bars 1
front_side_sp = Curve.PointAtParameter(curve=front_roof_line)
code_block_14 = CodeBlock { 1; }
front_side_ep = Curve.PointAtParameter(curve=front_roof_line, param=code_block_14)
radius = CodeBlock { 150; }
byPointsRadius = Cylinder.ByPointsRadius(startPoint=front_side_sp, endPoint=front_side_ep, radius=radius)
inner_sideline_sp = Curve.PointAtParameter(curve=inner_sideline)
code_block_15 = CodeBlock { 1; }
inner_sideline_ep = Curve.PointAtParameter(curve=inner_sideline, param=code_block_15)
radius_2 = CodeBlock { 150; }
byPointsRadius_2 = Cylinder.ByPointsRadius(startPoint=inner_sideline_sp, endPoint=inner_sideline_ep, radius=radius_2)
outer_sideline_sp = Curve.PointAtParameter(curve=outer_sideline)
code_block_16 = CodeBlock { 1; }
outer_sideline_ep = Curve.PointAtParameter(curve=outer_sideline, param=code_block_16)
radius_3 = CodeBlock { 150; }
byPointsRadius_3 = Cylinder.ByPointsRadius(startPoint=outer_sideline_sp, endPoint=outer_sideline_ep, radius=radius_3)
back_side_sp = Curve.PointAtParameter(curve=back_roof_line)
code_block_17 = CodeBlock { 1; }
back_side_ep = Curve.PointAtParameter(curve=back_roof_line, param=code_block_17)
radius_4 = CodeBlock { 150; }
byPointsRadius_4 = Cylinder.ByPointsRadius(startPoint=back_side_sp, endPoint=back_side_ep, radius=radius_4)
left_sideline_sp = Curve.PointAtParameter(curve=leftside)
code_block_18 = CodeBlock { 1; }
left_sideline_ep = Curve.PointAtParameter(curve=leftside, param=code_block_18)
radius_5 = CodeBlock { 150; }
byPointsRadius_5 = Cylinder.ByPointsRadius(startPoint=left_sideline_sp, endPoint=left_sideline_ep, radius=radius_5)
right_sideline_sp = Curve.PointAtParameter(curve=rightside)
code_block_19 = CodeBlock { 1; }
right_sideline_ep = Curve.PointAtParameter(curve=rightside, param=code_block_19)
radius_6 = CodeBlock { 150; }
byPointsRadius_6 = Cylinder.ByPointsRadius(startPoint=right_sideline_sp, endPoint=right_sideline_ep, radius=radius_6)
list_create_3 = List.Create(item0=byPointsRadius_3, item1=byPointsRadius_2, item2=byPointsRadius, item3=byPointsRadius_4, item4=byPointsRadius_5, item5=byPointsRadius_6)
color_palette = ColorPalette({R: 0, G: 0, B: 0, A: 255})
byGeometryColor_2 = Modifiers.GeometryColor.ByGeometryColor(geometry=list_create_3, color=color_palette)

code_block_20 = CodeBlock { 0; }
pavilionBasePoint2_2 = Point.ByCoordinates(x=code_block_20, y=code_block_20, z=code_block_20)
roof2shifter_2 = DoubleSlider(1600, range=-5000..5000 step 0.1)
code_block_21 = CodeBlock(PavilionBasePoint=pavilionBasePoint2_2, Roof2Shifter=roof2shifter_2)  # same code as code_block_5

# group: Roof 2 Parameters
roo2fWidthOffset = DoubleSlider(2000, range=2000..4500 step 0.1)
roof2LengthOffset = DoubleSlider(3000, range=2000..4500 step 0.1)
roof2HeightFront = DoubleSlider(4092, range=3500..4500 step 1)
roof2HeightBack = DoubleSlider(3000, range=2500..3000 step 0.1)

code_block_22 = CodeBlock(PavilionBasePoint=code_block_21.out2, RoofWidthOffset=roo2fWidthOffset, RoofLengthOffset=roof2LengthOffset, RoofHeightFront=roof2HeightFront, RoofHeightBack=roof2HeightBack)  # same code as code_block_6

# group: Roof 2 Corners/Lines
code_block_23 = CodeBlock { frontleft = 0; frontright = 1; backleft = 2; backright = 3; }
backright_corner_2 = List.GetItemAtIndex(list=code_block_22.out9, index=code_block_23.frontright)
backleft_corner_2 = List.GetItemAtIndex(list=code_block_22.out9, index=code_block_23.frontleft)
frontleft_corner_2 = List.GetItemAtIndex(list=code_block_22.out9, index=code_block_23.backleft)
frontright_corner_2 = List.GetItemAtIndex(list=code_block_22.out9, index=code_block_23.backright)
front_roof_line_2 = Line.ByStartPointEndPoint(startPoint=frontleft_corner_2, endPoint=frontright_corner_2)
back_roof_line_2 = Line.ByStartPointEndPoint(startPoint=backleft_corner_2, endPoint=backright_corner_2)
leftside_2 = Line.ByStartPointEndPoint(startPoint=backleft_corner_2, endPoint=frontleft_corner_2)
rightside_2 = Line.ByStartPointEndPoint(startPoint=backright_corner_2, endPoint=frontright_corner_2)
list_create_4 = List.Create(item0=back_roof_line_2, item1=front_roof_line_2)
roof_surface_2 = Surface.ByLoft(crossSections=list_create_4)
roof_thickness_2 = DoubleSlider(250, range=150..400 step 1)
thicken_3 = Surface.Thicken(surface=roof_surface_2, thickness=roof_thickness_2)

# group: Back Wall
code_block_24 = CodeBlock { x=3600; y=-2000.000; z=0; }
ground_backleft_corner_2 = Point.ByCoordinates(x=code_block_24.x, y=code_block_24.y, z=code_block_24.z)
outer_sideline_2 = Line.ByStartPointEndPoint(startPoint=backright_corner_2, endPoint=ground_backleft_corner_2)
code_block_25 = CodeBlock { x=-400; y=-2000.000; z=0; }
ground_backright_corner_2 = Point.ByCoordinates(x=code_block_25.x, y=code_block_25.y, z=code_block_25.z)
inner_sideline_2 = Line.ByStartPointEndPoint(startPoint=backleft_corner_2, endPoint=ground_backright_corner_2)
ground_line_2 = Line.ByStartPointEndPoint(startPoint=ground_backleft_corner_2, endPoint=ground_backright_corner_2)
list_create_5 = List.Create(item0=ground_line_2, item1=back_roof_line_2)
byLoft_2 = Surface.ByLoft(crossSections=list_create_5)
number_slider_2 = DoubleSlider(220, range=200..500 step 0.1)
thicken_4 = Surface.Thicken(surface=byLoft_2, thickness=number_slider_2)

# group: Steel Bars 2
outer_sideline_sp_2 = Curve.PointAtParameter(curve=outer_sideline_2)
code_block_26 = CodeBlock { 1; }
outer_sideline_ep_2 = Curve.PointAtParameter(curve=outer_sideline_2, param=code_block_26)
radius_7 = CodeBlock { 150; }
byPointsRadius_7 = Cylinder.ByPointsRadius(startPoint=outer_sideline_sp_2, endPoint=outer_sideline_ep_2, radius=radius_7)
inner_sideline_sp_2 = Curve.PointAtParameter(curve=inner_sideline_2)
code_block_27 = CodeBlock { 1; }
inner_sideline_ep_2 = Curve.PointAtParameter(curve=inner_sideline_2, param=code_block_27)
radius_8 = CodeBlock { 150; }
byPointsRadius_8 = Cylinder.ByPointsRadius(startPoint=inner_sideline_sp_2, endPoint=inner_sideline_ep_2, radius=radius_8)
front_side_sp_2 = Curve.PointAtParameter(curve=front_roof_line_2)
code_block_28 = CodeBlock { 1; }
front_side_ep_2 = Curve.PointAtParameter(curve=front_roof_line_2, param=code_block_28)
radius_9 = CodeBlock { 150; }
byPointsRadius_9 = Cylinder.ByPointsRadius(startPoint=front_side_sp_2, endPoint=front_side_ep_2, radius=radius_9)
back_side_sp_2 = Curve.PointAtParameter(curve=back_roof_line_2)
code_block_29 = CodeBlock { 1; }
back_side_ep_2 = Curve.PointAtParameter(curve=back_roof_line_2, param=code_block_29)
radius_10 = CodeBlock { 150; }
byPointsRadius_10 = Cylinder.ByPointsRadius(startPoint=back_side_sp_2, endPoint=back_side_ep_2, radius=radius_10)
left_sideline_sp_2 = Curve.PointAtParameter(curve=leftside_2)
code_block_30 = CodeBlock { 1; }
left_sideline_ep_2 = Curve.PointAtParameter(curve=leftside_2, param=code_block_30)
radius_11 = CodeBlock { 150; }
byPointsRadius_11 = Cylinder.ByPointsRadius(startPoint=left_sideline_sp_2, endPoint=left_sideline_ep_2, radius=radius_11)
right_sideline_sp_2 = Curve.PointAtParameter(curve=rightside_2)
code_block_31 = CodeBlock { 1; }
right_sideline_ep_2 = Curve.PointAtParameter(curve=rightside_2, param=code_block_31)
radius_12 = CodeBlock { 150; }
byPointsRadius_12 = Cylinder.ByPointsRadius(startPoint=right_sideline_sp_2, endPoint=right_sideline_ep_2, radius=radius_12)
list_create_6 = List.Create(item0=byPointsRadius_7, item1=byPointsRadius_8, item2=byPointsRadius_9, item3=byPointsRadius_10, item4=byPointsRadius_11, item5=byPointsRadius_12)
color_palette_2 = ColorPalette({R: 0, G: 21, B: 76, A: 255})
byGeometryColor_3 = Modifiers.GeometryColor.ByGeometryColor()  # unwired: geometry, color

steel_cylinders = List.Create(item0=byPointsRadius, item1=byPointsRadius_2, item2=byPointsRadius_3, item3=byPointsRadius_4, item4=byPointsRadius_5, item5=byPointsRadius_6, item6=byPointsRadius_7, item7=byPointsRadius_8, item8=byPointsRadius_9, item9=byPointsRadius_10, item10=byPointsRadius_11, item11=byPointsRadius_12)
volume = Solid.Volume(solid=steel_cylinders)
sum = Math.Sum(values=volume)
glass_panes = List.Create(item0=thicken_2, item1=thicken, item2=thicken_4, item3=thicken_3)
volume_2 = Solid.Volume(solid=glass_panes)
sum_2 = Math.Sum(values=volume_2)
byGeometryColor_4 = Modifiers.GeometryColor.ByGeometryColor()  # unwired: geometry, color
