# Dynamo graph 1849290.dyn (Dynamo 3.6.0.9395)

code_block = CodeBlock { -5000; -5000; -200; }
byCoordinates = Point.ByCoordinates(x=code_block.out0, y=code_block.out1, z=code_block.out2)
code_block_2 = CodeBlock { 5000; 5000; 0; }
byCoordinates_2 = Point.ByCoordinates(x=code_block_2.out0, y=code_block_2.out1, z=code_block_2.out2)
byCorners = Cuboid.ByCorners(lowPoint=byCoordinates, highPoint=byCoordinates_2)
code_block_3 = CodeBlock { 0; 100; 0; }
byARGB = Color.ByARGB(red=code_block_3.out0, green=code_block_3.out1, blue=code_block_3.out2)
byGeometryColor = Modifiers.GeometryColor.ByGeometryColor(geometry=byCorners, color=byARGB)
code_block_4 = CodeBlock { 0; -5000; 0; }
start = Point.ByCoordinates(x=code_block_4.out0, y=code_block_4.out1, z=code_block_4.out2)
code_block_5 = CodeBlock { 0; 0; }
arch_height = DoubleSlider(4000, range=3000..5000 step 1)
mid = Point.ByCoordinates(x=code_block_5.out0, y=code_block_5.out1, z=arch_height)
code_block_6 = CodeBlock { 0; 5000; 0; }
end = Point.ByCoordinates(x=code_block_6.out0, y=code_block_6.out1, z=code_block_6.out2)
byThreePoints = Arc.ByThreePoints(firstPoint=start, secondPoint=mid, thirdPoint=end)
num_ribs = DoubleSlider(7, range=4..12 step 1)
code_block_7 = CodeBlock(N_ribs=num_ribs) { -4500..4500..#N_ribs; }
code_block_8 = CodeBlock { 0; 0; }
translate = Geometry.Translate(geometry=byThreePoints, xTranslation=code_block_7, yTranslation=code_block_8.out0, zTranslation=code_block_8.out1)
XAxis = Vector.XAxis()
rib_thickness = DoubleSlider(142, range=100..300 step 1)
extrude = Curve.Extrude(curve=translate, direction=XAxis, distance=rib_thickness)
thicken = Surface.Thicken(surface=extrude, thickness=rib_thickness)
timber = StringInput("Timber")
class_1_timber_rib = Python(IN[0]=thicken, IN[1]=timber)  # CPython3
# ---------- class_1_timber_rib.python (39 lines) ----------
# Load the Python Standard and DesignScript Libraries
import sys
import clr
clr.AddReference('ProtoGeometry')
from Autodesk.DesignScript.Geometry import *

# The inputs to this node will be stored as a list in the IN variables.
dataEnteringNode = IN

# Place your code below this line
class TimberRib:
    # Constructor: initializes the object with geometry and material, and calculates volume
    def __init__(self, geometry, material):
        self.geometry = geometry
        self.material = material
        # **This line now works because 'geometry' is a Solid object.**
        self.volume = geometry.Volume

    # Method to return the geometry (for display)
    def GetGeometry(self):
        return self.geometry

    # Method to return the volume
    def GetVolume(self):
        return self.volume

# Inputs
geometry_list = IN[0]
material_name = IN[1]

# Create a list to store the class instances
rib_instances = []

# Loop through the list of geometries and create instances
for geo in geometry_list:
    rib_instances.append(TimberRib(geo, material_name))

# Output the list of instances
OUT = rib_instances
# ----------------------------------------
calc_total_volume = Python(IN[0]=class_1_timber_rib)  # CPython3
# ---------- calc_total_volume.python (15 lines) ----------
# Load the Python Standard and DesignScript Libraries
import sys
import clr
clr.AddReference('ProtoGeometry')
from Autodesk.DesignScript.Geometry import *

# The inputs to this node will be stored as a list in the IN variables.
dataEnteringNode = IN

# Place your code below this line
total_volume = 0;
for rib in IN[0]:
    total_volume = total_volume + rib.GetVolume();

OUT = total_volume;
# ----------------------------------------
timber_volume_mm_3 = Watch(calc_total_volume)
bench_length = DoubleInput(0)
bench_width = DoubleSlider(900, range=500..1500 step 1)
code_block_9 = CodeBlock(W=bench_width) { W/2*-1; }
bench_length_2 = DoubleInput(200)
base = Point.ByCoordinates(x=bench_length, y=code_block_9, z=bench_length_2)
width = DoubleInput(9500)
heigth = DoubleInput(450)
byLengths = Cuboid.ByLengths(origin=base, width=width, length=bench_width, height=heigth)
dist_y = CodeBlock(W=bench_width) { 5000-(W/2); }
translate_2 = Geometry.Translate(geometry=byLengths, yTranslation=dist_y)
number = DoubleInput(0)
num_sections = DoubleSlider(15, range=5..30 step 1)
step_size_u = CodeBlock(N=num_sections) { 1/(N-1); }
sequence = Sequence(start=number, amount=num_sections, step=step_size_u)
pointAtParameter = Curve.PointAtParameter(curve=byThreePoints, param=sequence)
number_2 = DoubleInput(-4500)
step_size_v = CodeBlock(R=num_ribs) { 9000/(R-1); }
sequence_2 = Sequence(start=number_2, amount=num_ribs, step=step_size_v)
translate_3 = Geometry.Translate(geometry=pointAtParameter, xTranslation=sequence_2, lacing=CrossProduct)
rod_lines = Python(IN[0]=translate_3, IN[1]=num_ribs, IN[2]=num_sections)  # CPython3
# ---------- rod_lines.python (25 lines) ----------
# Load the Python Standard and DesignScript Libraries
import sys
import clr
clr.AddReference('ProtoGeometry')
from Autodesk.DesignScript.Geometry import *

# The inputs to this node will be stored as a list in the IN variables.
dataEnteringNode = IN

# Place your code below this line
points_grid = IN[0]
num_ribs = int(IN[1])
num_sections = int(IN[2])
rods = []

# Loop through the grid
for i in range(num_sections - 1): 
    for j in range(num_ribs - 1):
        # Diagonal 1: Connects point (i, j) to the diagonal point (i+1, j+1)
        rods.append(Line.ByStartPointEndPoint(points_grid[i][j], points_grid[i+1][j+1]))

        # Diagonal 2: Connects point (i+1, j) to the other diagonal point (i, j+1)
        rods.append(Line.ByStartPointEndPoint(points_grid[i+1][j], points_grid[i][j+1]))

OUT = rods
# ----------------------------------------
number_3 = DoubleInput(0)
pointAtParameter_2 = Curve.PointAtParameter(curve=rod_lines, param=number_3)
rod_diameter = DoubleSlider(20, range=10..50 step 1)
rod_radius = CodeBlock(D=rod_diameter) { D/2; }
byCenterPointRadius = Circle.ByCenterPointRadius(centerPoint=pointAtParameter_2, radius=rod_radius)
sweepAsSolid = Curve.SweepAsSolid(curve=byCenterPointRadius, path=rod_lines)
steel = StringInput("Steel")
class_steel_rods = Python(IN[0]=sweepAsSolid, IN[1]=steel)  # CPython3
# ---------- class_steel_rods.python (33 lines) ----------
# Load the Python Standard and DesignScript Libraries
import sys
import clr
clr.AddReference('ProtoGeometry')
from Autodesk.DesignScript.Geometry import *

# The inputs to this node will be stored as a list in the IN variables.
dataEnteringNode = IN

# Place your code below this line
class SteelRod:
    # Constructor
    def __init__(self, geometry, material):
        self.geometry = geometry
        self.material = material
        # Calculates volume for solid geometry
        self.volume = geometry.Volume 

    # Methods
    def GetGeometry(self):
        return self.geometry
    def GetVolume(self):
        return self.volume

geometry_list = IN[0]
material_name = IN[1]
rod_instances = []

# Create instances
for geo in geometry_list:
    rod_instances.append(SteelRod(geo, material_name))

OUT = rod_instances
# ----------------------------------------
calc_volume_2 = Python(IN[0]=class_steel_rods)  # CPython3
# ---------- calc_volume_2.python (15 lines) ----------
# Load the Python Standard and DesignScript Libraries
import sys
import clr
clr.AddReference('ProtoGeometry')
from Autodesk.DesignScript.Geometry import *

# The inputs to this node will be stored as a list in the IN variables.
dataEnteringNode = IN

# Place your code below this line
total_volume = 0
for rod in IN[0]:
    total_volume = total_volume + rod.GetVolume()

OUT = total_volume
# ----------------------------------------
steel_volume_mm_3 = Watch(calc_volume_2)
