# Dynamo graph 1849302.dyn (Dynamo 3.6.0.9395)

# group: Don't touch this ground
code_block = CodeBlock { -5000; -5000; -200; }
byCoordinates = Point.ByCoordinates(x=code_block.out0, y=code_block.out1, z=code_block.out2)
code_block_2 = CodeBlock { 5000; 5000; 0; }
byCoordinates_2 = Point.ByCoordinates(x=code_block_2.out0, y=code_block_2.out1, z=code_block_2.out2)
byCorners = Cuboid.ByCorners(lowPoint=byCoordinates, highPoint=byCoordinates_2)
code_block_3 = CodeBlock { 0; 100; 0; }
byARGB = Color.ByARGB(red=code_block_3.out0, green=code_block_3.out1, blue=code_block_3.out2)
byGeometryColor = Modifiers.GeometryColor.ByGeometryColor(geometry=byCorners, color=byARGB)

# group: Parameters of Pavillion
height_of_pavillion = DoubleSlider(4000, range=4000..5000 step 0.1)
radius_of_canopy = DoubleSlider(4000, range=3000..4000 step 0.1)
rib_thickness = DoubleSlider(200, range=200..400 step 0.1)
number_of_ribs = DoubleSlider(12, range=4..12 step 1)

# group: Two Python Classes
# Two material python classes
number = DoubleInput(2000)
class_1_wooden_base = Python(IN[0]=height_of_pavillion, IN[1]=number, IN[2]=radius_of_canopy)  # CPython3
# ---------- class_1_wooden_base.python (61 lines) ----------
# Class: Material 1 - Wooden base
import clr
clr.AddReference('ProtoGeometry')
from Autodesk.DesignScript.Geometry import *
import math

# IN[0]: Base Height 
# IN[1]: middle point of arc 
# IN[2]: Top canopy radius

class WoodStructure:
    def __init__(self, base_height, arc_x, top_radius):
        self.base_height = base_height
        self.arc_x = arc_x
        self.top_radius = top_radius
        self.BaseR = 800      
        self.solid = self.generate_geometry()
        self.material_name = "Wood (Composite Column)"
    
    def generate_geometry(self):
        BASE_R = self.BaseR
        TOP_R = self.top_radius
        THICKNESS = 200
        TOTAL_HEIGHT = self.base_height + 200
        arc_bottom_z = self.base_height - 3000
        arc_middle_z = self.base_height - 500  
        arc_top_z = self.base_height
        base_cyl = Cylinder.ByPointsRadius(
            Point.ByCoordinates(0, 0, 0),
            Point.ByCoordinates(0, 0, self.base_height),
            BASE_R)
        pt_start = Point.ByCoordinates(BASE_R, 0, arc_bottom_z)
        pt_mid = Point.ByCoordinates(self.arc_x, 0, arc_middle_z)
        pt_end = Point.ByCoordinates(TOP_R, 0, arc_top_z)
        profile_arc = Arc.ByThreePoints(pt_start, pt_mid, pt_end)
        axis_start = Point.ByCoordinates(0, 0, 0)
        axis_end = Point.ByCoordinates(0, 0, 1)  
        revolve_surface = Surface.ByRevolve(
            profile_arc, 
            axis_start, 
            Vector.ByTwoPoints(axis_start, axis_end), 
            0, 360)
        revolve_solid = revolve_surface.Thicken(20) 
        top_cyl = Cylinder.ByPointsRadius(
            Point.ByCoordinates(0, 0, arc_top_z),
            Point.ByCoordinates(0, 0, TOTAL_HEIGHT),
            TOP_R)
        unified_solid = base_cyl.Union(revolve_solid)
        final_solid = unified_solid.Union(top_cyl)
        revolve_surface.Dispose()
        return final_solid
        
    def compute_volume(self):
        if self.solid:
            return self.solid.Volume
        return 0.0

Column_Instance = WoodStructure(IN[0], IN[1], IN[2])
geometry_out = Column_Instance.solid
volume_mm3 = Column_Instance.compute_volume()
OUT = geometry_out, volume_mm3
# ----------------------------------------
number_2 = DoubleInput(0)
getItemAtIndex = List.GetItemAtIndex(list=class_1_wooden_base, index=number_2)
code_block_4 = CodeBlock { 255; 215; 195; 163; }
byARGB_2 = Color.ByARGB(alpha=code_block_4.out0, red=code_block_4.out1, green=code_block_4.out2, blue=code_block_4.out3)
byGeometryColor_2 = Modifiers.GeometryColor.ByGeometryColor(geometry=getItemAtIndex, color=byARGB_2)
class_2_steel_ribs = Python(IN[0]=height_of_pavillion, IN[1]=number, IN[2]=radius_of_canopy, IN[3]=rib_thickness)  # CPython3
# ---------- class_2_steel_ribs.python (99 lines) ----------
#Class 2: Steel Ribs
import clr
clr.AddReference('ProtoGeometry')
from Autodesk.DesignScript.Geometry import *

# IN[0]: Base Height 
# IN[1]: middle point X of the arc
# IN[2]: Top Radius 
# IN[3]: Rib Thickness 

class SteelRib:
    def __init__(self, base_height, arc_x, top_radius, rib_thickness):
        self.base_height = base_height
        self.arc_x = arc_x
        self.top_radius = top_radius
        self.rib_thickness = rib_thickness
        self.BaseR = 800  
        self.RectangleWidth = 300  
        self.solid = self.create_rib_with_arc()
    
    def create_rib_with_arc(self):
        rectangle_height = self.base_height - 3000
        arc_start_z = rectangle_height
        arc_mid_z = self.base_height - 500
        arc_end_z = self.base_height  
        rect_points = [
            Point.ByCoordinates(self.BaseR,0, 0),
            Point.ByCoordinates(self.BaseR + self.RectangleWidth,0, 0),
            Point.ByCoordinates(self.BaseR + self.RectangleWidth, 0, rectangle_height),
            Point.ByCoordinates(self.BaseR, 0, rectangle_height)]
            
        rect_profile = PolyCurve.ByPoints(rect_points, True)
        rect_surface = rect_profile.Patch()
        rectangular_solid = rect_surface.Thicken(self.rib_thickness, True)  # Small thickness for now

        inner_start = Point.ByCoordinates(800, 0, arc_start_z)
        inner_mid = Point.ByCoordinates(2000, 0, arc_mid_z)
        inner_end = Point.ByCoordinates(self.top_radius, 0, arc_end_z)
        inner_arc = Arc.ByThreePoints(inner_start, inner_mid, inner_end)

        outer_start = Point.ByCoordinates(1100, 0, arc_start_z)
        outer_mid = Point.ByCoordinates(2300, 0, arc_mid_z)  
        outer_end = Point.ByCoordinates(self.top_radius, 0, arc_end_z)  
        outer_arc = Arc.ByThreePoints(outer_start, outer_mid, outer_end)
        
        bottom_line = Line.ByStartPointEndPoint(inner_start, outer_start)
        curved_profile_curves = [bottom_line, outer_arc, inner_arc.Reverse()]
        curved_profile = PolyCurve.ByJoinedCurves(curved_profile_curves)
        curved_surface = curved_profile.Patch()
        curved_solid = curved_surface.Thicken(self.rib_thickness, True)
        
        final_solid = rectangular_solid.Union(curved_solid)
        
        return final_solid
            
     
    def create_simple_arc_rib(self):
        rectangle_height = self.base_height - 3000
        arc_start_z = rectangle_height
        arc_end_z = self.base_height
        straight_solid = Cuboid.ByLengths(
            self.RectangleWidth, 
            self.rib_thickness, 
            rectangle_height
        )
        straight_solid = straight_solid.Translate(self.BaseR, 0, 0)
        taper_width_start = self.RectangleWidth 
        taper_width_end = 10 
        taper_bottom = Rectangle.ByWidthLength(taper_width_start, self.rib_thickness)
        taper_bottom = taper_bottom.Translate(self.BaseR, 0, arc_start_z) 
        taper_top = Rectangle.ByWidthLength(taper_width_end, self.rib_thickness)
        taper_top = taper_top.Translate(self.top_radius, 0, arc_end_z)
        tapered_solid = Solid.ByLoft([taper_bottom, taper_top])
        final_solid = straight_solid.Union(tapered_solid)
        return final_solid
            
    def create_parameter_visualization(self):
        arc_start = Point.ByCoordinates(self.BaseR, 0, self.base_height - 3000)
        arc_mid = Point.ByCoordinates(self.arc_x, 0, self.base_height - 500)
        arc_end = Point.ByCoordinates(self.top_radius, 0, self.base_height)
        line1 = Line.ByStartPointEndPoint(arc_start, arc_mid)
        line2 = Line.ByStartPointEndPoint(arc_mid, arc_end)
        path = PolyCurve.ByJoinedCurves([line1, line2])
        rib_solid = path.Thicken(self.rib_thickness, False)
        return rib_solid

    def compute_volume(self):
        if self.solid:
            return self.solid.Volume
        return 0.0

base_h = IN[0] 
arc_x = IN[1] 
top_r = IN[2] 
rib_t = IN[3] 
    
steel_rib = SteelRib(base_h, arc_x, top_r, rib_t)
OUT = steel_rib.solid, steel_rib.compute_volume()
    
# ----------------------------------------
getItemAtIndex_2 = List.GetItemAtIndex(list=class_2_steel_ribs, index=number_2)

# group: Series of Instances of Class 2: Steel Ribs
instances_of_steel_ribs = Python(IN[0]=getItemAtIndex_2, IN[1]=number_of_ribs)  # CPython3
# ---------- instances_of_steel_ribs.python (39 lines) ----------
# Multiple Steel Ribs 
import clr
clr.AddReference('ProtoGeometry')
from Autodesk.DesignScript.Geometry import *

# Inputs:
# IN[0]: Single Rib Geometry (solid from SteelRib class)
# IN[1]: Number of Ribs

def generate_rotated_ribs(single_rib, count):

    rib_base = single_rib.Translate(0, 0, 0)
    ribs = []
    angle_step = 360.0 / float(count)

    origin = Point.ByCoordinates(0, 0, 0)
    axis = Vector.ZAxis()

    for i in range(count):
        angle = i * angle_step

        rib_rot = rib_base.Rotate(
            origin=origin,
            axis=axis,
            degrees=angle
        )

        ribs.append(rib_rot)

    return ribs

single_rib_geometry = IN[0]
rib_count = IN[1]

rib_count = int(rib_count)

rotated_ribs = generate_rotated_ribs(single_rib_geometry, rib_count)

OUT = rotated_ribs
# ----------------------------------------

# group: Volume of each material class:
number_3 = DoubleInput(1)
getItemAtIndex_3 = List.GetItemAtIndex(list=class_1_wooden_base, index=number_3)
volume_of_class_1_wooden_base = Watch(getItemAtIndex_3)
getItemAtIndex_4 = List.GetItemAtIndex(list=class_2_steel_ribs, index=number_3)
code_block_5 = CodeBlock(v=getItemAtIndex_4, c=number_of_ribs) { v*c; }
volume_of_class_2_steel_ribs = Watch(code_block_5)
