# Dynamo graph 1849453.dyn "HomeAssignment2-Dynamo-NaveedIqbal - Before edit" (Dynamo 3.6.0.9395)

# group: Don't touch this ground
code_block = CodeBlock { -5000; -5000; -200; }
byCoordinates = Point.ByCoordinates(x=code_block.out0, y=code_block.out1, z=code_block.out2)
code_block_2 = CodeBlock { 5000; 5000; 0; }
byCoordinates_2 = Point.ByCoordinates(x=code_block_2.out0, y=code_block_2.out1, z=code_block_2.out2)
byCorners = Cuboid.ByCorners(lowPoint=byCoordinates, highPoint=byCoordinates_2)
code_block_3 = CodeBlock { 0; 100; 0; }
byARGB = Color.ByARGB(red=code_block_3.out0, green=code_block_3.out1, blue=code_block_3.out2)
byGeometryColor = Modifiers.GeometryColor.ByGeometryColor(geometry=byCorners, color=byARGB)

# group: Parameters
pavilionLength = DoubleSlider(7500, range=4000..9000 step 100)
pavilionWidth = DoubleSlider(7000, range=3000..9000 step 100)
columnHeight = DoubleSlider(3500, range=2500..4500 step 100)
roofAmplitude = DoubleSlider(700, range=0..2000 step 100)
roofFrequency = DoubleSlider(0.7, range=0.1..1 step 0.1)
numRoofStrips = DoubleSlider(30, range=5..45 step 5)
roofRodRadius = DoubleSlider(130, range=50..200 step 10)

# group: Base grid along X - List of X-positions
x_positions = CodeBlock(L=pavilionLength) { startX = -L/2; }
number_of_columns_fixed = DoubleInput(9)
step_size = CodeBlock(L=pavilionLength, n=number_of_columns_fixed) { stepX = L/(n-1); }
sequence = Sequence(start=x_positions, amount=number_of_columns_fixed, step=step_size)

# group: COLUMNS - Material 1 - STEEL
circular_steel_rod = Python()  # CPython3
# ---------- circular_steel_rod.python (28 lines) ----------
# Load the Python Standard and DesignScript Libraries
import sys
import clr
clr.AddReference('ProtoGeometry')
from Autodesk.DesignScript.Geometry import *

class CircularSteelRod(object):
    def __init__(self, start, end, radius):
        self.start = start
        self.end = end
        self.radius = radius
        self.solid = self._make_solid()
        self.volume = self.solid.Volume

    def _make_solid(self):
        line = Line.ByStartPointEndPoint(self.start, self.end)
        circle = Circle.ByCenterPointRadius(self.start, self.radius)
        return Surface.BySweep(circle, line).Thicken(self.radius, True)

    def GetSolid(self):
        return self.solid

    def GetVolume(self):
        return self.volume


# Assign your output to the OUT variable.
OUT = CircularSteelRod
# ----------------------------------------
y_positions_for_the_two_column = CodeBlock(W=pavilionWidth) { Y1 = -W/2; Y2 = W/2; }  # "Y positions for the two column lines"
code_block_4 = CodeBlock { 0; }
colBaseLeft = Point.ByCoordinates(x=sequence, y=y_positions_for_the_two_column.Y1, z=code_block_4)
colBaseRight = Point.ByCoordinates(x=sequence, y=y_positions_for_the_two_column.Y2, z=code_block_4)
list_create = List.Create(item0=colBaseLeft, item1=colBaseRight)
ZAxis = Vector.ZAxis()
colTopLeft = Geometry.Translate(geometry=colBaseLeft, direction=ZAxis, distance=columnHeight)
colTopRight = Geometry.Translate(geometry=colBaseRight, direction=ZAxis, distance=columnHeight)
list_create_2 = List.Create(item0=colTopLeft, item1=colTopRight)
series_of_instances_steel = Python(IN[0]=circular_steel_rod, IN[1]=list_create, IN[2]=list_create_2)  # "Series of instances: steel columns"; CPython3
# ---------- series_of_instances_steel.python (29 lines) ----------
# IN[0] = CircularSteelColumn class
# IN[1] = list (or list of lists) of start points
# IN[2] = list (or list of lists) of end points

CircularSteelColumn = IN[0]
starts_raw = IN[1]
ends_raw = IN[2]

def flatten(points):
    flat = []
    for item in points:
        if isinstance(item, list):
            flat.extend(item)
        else:
            flat.append(item)
    return flat

starts = flatten(starts_raw)
ends   = flatten(ends_raw)

solids = []
volumes = []

for s, e in zip(starts, ends):
    col = CircularSteelColumn(s, e, 150)
    solids.append(col.GetSolid())
    volumes.append(col.GetVolume())

OUT = solids, volumes
# ----------------------------------------
number = DoubleInput(1)
getItemAtIndex = List.GetItemAtIndex(list=series_of_instances_steel, index=number)
sum = Math.Sum(values=getItemAtIndex)
volume_for_material_1_mm_3 = Watch(sum)
number_2 = DoubleInput(0)
getItemAtIndex_2 = List.GetItemAtIndex(list=series_of_instances_steel, index=number_2)
code_block_5 = CodeBlock { 255; 15; 25; 65; }
byARGB_2 = Color.ByARGB(alpha=code_block_5.out0, red=code_block_5.out1, green=code_block_5.out2, blue=code_block_5.out3)
byGeometryColor_2 = Modifiers.GeometryColor.ByGeometryColor(geometry=getItemAtIndex_2, color=byARGB_2)

# group: Material 2 - Timber
timber_roof_rod = Python()  # CPython3
# ---------- timber_roof_rod.python (29 lines) ----------
# Load the Python Standard and DesignScript Libraries
import sys
import clr
clr.AddReference('ProtoGeometry')
from Autodesk.DesignScript.Geometry import *

class TimberRod(object):
    def __init__(self, path_curve, radius):
        self.path = path_curve
        self.radius = radius
        self.solid = self._make_solid()
        self.volume = self.solid.Volume

    def _make_solid(self):
        start_pt = self.path.StartPoint
        profile = Circle.ByCenterPointRadius(start_pt, self.radius)

        solid = Solid.BySweep(profile, self.path)

        profile.Dispose()
        return solid

    def GetSolid(self):
        return self.solid

    def GetVolume(self):
        return self.volume

OUT = TimberRod
# ----------------------------------------
number_3 = DoubleInput(0)
code_block_6 = CodeBlock(ColumnHeight=columnHeight, RoofAmplitude=roofAmplitude, RoofFrequency=roofFrequency, xPos=sequence) { zRoof = ColumnHeight + RoofAmplitude * Math.Sin(RoofFrequency * xPos); }
roofWavePoints = Point.ByCoordinates(x=sequence, y=number_3, z=code_block_6)
roofWaveCurve = NurbsCurve.ByPoints(points=roofWavePoints)
YAxis = Vector.YAxis()
code_block_7 = CodeBlock(PavilionWidth=pavilionWidth, NumRoofStrips=numRoofStrips) { step = PavilionWidth / (NumRoofStrips - 1); startY = -PavilionWidth/2; }
ypositionsForTheStrip = Sequence(start=code_block_7.startY, amount=numRoofStrips, step=code_block_7.step)
curveStripsForTheRoof = Geometry.Translate(geometry=roofWaveCurve, direction=YAxis, distance=ypositionsForTheStrip)
series_of_instances_rooof_rods = Python(IN[0]=timber_roof_rod, IN[1]=curveStripsForTheRoof, IN[2]=roofRodRadius)  # CPython3
# ---------- series_of_instances_rooof_rods.python (22 lines) ----------
# IN[0] = TimberRod class
# IN[1] = list of curves
# IN[2] = radius of the rods

TimberRod = IN[0]
curves    = IN[1]
radius    = IN[2]

if not isinstance(curves, list):
    curves = [curves]

solids = []
volumes = []

for c in curves:
    if c is None:
        continue
    rod = TimberRod(c, radius)
    solids.append(rod.GetSolid())
    volumes.append(rod.GetVolume())

OUT = solids, volumes
# ----------------------------------------
number_4 = DoubleInput(1)
getItemAtIndex_3 = List.GetItemAtIndex(list=series_of_instances_rooof_rods, index=number_4)
sum_2 = Math.Sum(values=getItemAtIndex_3)
volume_for_material_2_timber_mm = Watch(sum_2)  # "VOLUME FOR MATERIAL 2 - TIMBER (mm^3)"
number_5 = DoubleInput(0)
getItemAtIndex_4 = List.GetItemAtIndex(list=series_of_instances_rooof_rods, index=number_5)
code_block_8 = CodeBlock { 255; 140; 120; 255; }
byARGB_3 = Color.ByARGB(alpha=code_block_8.out0, red=code_block_8.out1, green=code_block_8.out2, blue=code_block_8.out3)
byGeometryColor_3 = Modifiers.GeometryColor.ByGeometryColor(geometry=getItemAtIndex_4, color=byARGB_3)
