# Dynamo graph 1849462.dyn (Dynamo 3.6.0.9395)

# group: Don't touch this ground
code_block = CodeBlock { -5000; -5000; -200; }  # frozen
byCoordinates = Point.ByCoordinates(x=code_block.out0, y=code_block.out1, z=code_block.out2)  # frozen
code_block_2 = CodeBlock { 5000; 5000; 0; }  # frozen
byCoordinates_2 = Point.ByCoordinates(x=code_block_2.out0, y=code_block_2.out1, z=code_block_2.out2)  # frozen
byCorners = Cuboid.ByCorners(lowPoint=byCoordinates, highPoint=byCoordinates_2)  # frozen
code_block_3 = CodeBlock { 0; 100; 0; }  # frozen
byARGB = Color.ByARGB(red=code_block_3.out0, green=code_block_3.out1, blue=code_block_3.out2)  # frozen
byGeometryColor = Modifiers.GeometryColor.ByGeometryColor(geometry=byCorners, color=byARGB)  # frozen

# group: Creating Base Circle
radius_of_circle = DoubleSlider(4000, range=0..5000 step 10)
z_coordinate_of_points = DoubleSlider(750, range=0..1250 step 10)
beginning_y_coordinate = CodeBlock(radius=radius_of_circle) { First_Y_Coordinate = -radius; }
code_block_4 = CodeBlock { 1000; }
number_of_points = CodeBlock(radius=radius_of_circle, Increment=code_block_4) { N_of_Y_values = ((2 * radius) / Increment) + 1; }
y_coordinates_of_points = Sequence(start=beginning_y_coordinate, amount=number_of_points, step=code_block_4)
x_coordinates_of_points = CodeBlock(r=radius_of_circle, y=y_coordinates_of_points) { x1 = Math.Sqrt(r*r - y*y); x2 = -Math.Sqrt(r*r - y*y); x1; x2; }
byCoordinates_3 = Point.ByCoordinates(x=x_coordinates_of_points.out2, y=y_coordinates_of_points, z=z_coordinate_of_points)
byPoints = NurbsCurve.ByPoints(points=byCoordinates_3)
byCoordinates_4 = Point.ByCoordinates(x=x_coordinates_of_points.out3, y=y_coordinates_of_points, z=z_coordinate_of_points)
byPoints_2 = NurbsCurve.ByPoints(points=byCoordinates_4)
join = Curve.Join(curve=byPoints, curves=byPoints_2)

# group: Generate Concrete Bench Geometry and Volume
class_concrete_bench = Python()  # CPython3; unwired: IN[0]
# ---------- class_concrete_bench.python (26 lines) ----------
# Load the Python Standard and DesignScript Libraries
import sys
import clr
clr.AddReference('ProtoGeometry')
from Autodesk.DesignScript.Geometry import *
import math

class ConcreteBench:
    def __init__(self, base_shape, centerline):
        self.base_shape = base_shape
        self.centerline = centerline
        
    def filled_region(self):
        try:
            return Surface.ByPatch(self.base_shape)
        except:
            return self.base_shape.Patch()
    
    def make_geometry(self):
        return Solid.BySweep(self.base_shape, self.centerline)
        
    def solid_volume(self):
        solid = self.make_geometry()
        return solid.Volume
          
OUT = ConcreteBench
# ----------------------------------------
code_block_5 = CodeBlock(radius=radius_of_circle) { x = radius + 250; x1 = radius - 250; }
code_block_6 = CodeBlock { y = 0; }
code_block_7 = CodeBlock(z_coordinate_of_points=z_coordinate_of_points) { z = z_coordinate_of_points + 100; z1 = z_coordinate_of_points - 100; }
byCoordinates_5 = Point.ByCoordinates(x=code_block_5.x1, y=code_block_6, z=code_block_7.z)
byCoordinates_6 = Point.ByCoordinates(x=code_block_5.x1, y=code_block_6, z=code_block_7.z1)
byCoordinates_7 = Point.ByCoordinates(x=code_block_5.x, y=code_block_6, z=code_block_7.z1)
byCoordinates_8 = Point.ByCoordinates(x=code_block_5.x, y=code_block_6, z=code_block_7.z)
list_create = List.Create(item0=byCoordinates_5, item1=byCoordinates_6, item2=byCoordinates_7, item3=byCoordinates_8)
code_block_8 = CodeBlock { true; }
byPoints_3 = PolyCurve.ByPoints(points=list_create, connectLastToFirst=code_block_8)
instance_of_concrete_bench = Python(IN[0]=class_concrete_bench, IN[1]=byPoints_3, IN[2]=join)  # CPython3
# ---------- instance_of_concrete_bench.python (10 lines) ----------
ConcreteBench = IN[0]
base_shape = IN[1]
centerline = IN[2]

bench = ConcreteBench(base_shape, centerline)

volume_unit = "mm³"
volume = "{0:.2f} {1}".format(bench.solid_volume(), volume_unit)

OUT = [bench.make_geometry(), bench.filled_region(), volume]
# ----------------------------------------
code_block_9 = CodeBlock { 2; }
getItemAtIndex = List.GetItemAtIndex(list=instance_of_concrete_bench, index=code_block_9)

# group: Creating Vertical Line In design of Upper Segment
code_block_10 = CodeBlock { x=0; y=0; z=0; }
byOrigin = CoordinateSystem.ByOrigin(x=code_block_10.x, y=code_block_10.y, z=code_block_10.z)
code_block_11 = CodeBlock { angle_to_positive_x_axis = 0; }
z_value_of_base_point = DoubleSlider(0, range=0..5000 step 10)
byCylindricalCoordinates = Point.ByCylindricalCoordinates(coordinateSystem=byOrigin, angle=code_block_11, elevation=z_value_of_base_point, radius=radius_of_circle)

# group: Create Top Curve
X = Point.X(point=byCylindricalCoordinates)
Y = Point.Y(point=byCylindricalCoordinates)
code_block_12 = CodeBlock { 9000; }
byCoordinates_9 = Point.ByCoordinates(x=X, y=Y, z=code_block_12)
byStartPointEndPoint = Line.ByStartPointEndPoint(startPoint=byCylindricalCoordinates, endPoint=byCoordinates_9)
code_block_13 = CodeBlock(radius=radius_of_circle) { Length_top_of_curve = radius + 500; }
slice_number = DoubleSlider(10, range=0..50 step 1)
code_block_14 = CodeBlock(Lengths=code_block_13, SliceNumber=slice_number) { Lengths; SliceNumber; Interval = 0..1..#SliceNumber; Xpoint = Interval * Lengths; }
amplitude_of_top_curve = DoubleSlider(610, range=0..1000 step 0.1)
reciprocal_of_period_length_of = DoubleSlider(0.06, range=0..10 step 0.001)  # "Reciprocal of Period Length of Top Curve"
phase_shift_of_top_curve = DoubleSlider(0, range=0..100 step 0.1)
elevation = DoubleSlider(3500, range=0..5000 step 10)
code_block_15 = CodeBlock(sinAmplitude=amplitude_of_top_curve, sinFrequency=reciprocal_of_period_length_of, x=code_block_14.Xpoint, PhaseShift=phase_shift_of_top_curve, Elevation=elevation) { z = sinAmplitude * Math.Sin(sinFrequency * x + PhaseShift) + Elevation; }
byCoordinates_10 = Point.ByCoordinates(x=code_block_14.Xpoint, y=code_block_10.y, z=code_block_15)
byPoints_4 = NurbsCurve.ByPoints(points=byCoordinates_10)
intersect = Geometry.Intersect(geometry=byStartPointEndPoint, other=byPoints_4)
Z = Point.Z(point=intersect)

# group (continued): Creating Vertical Line In design of Upper Segment
byCylindricalCoordinates_2 = Point.ByCylindricalCoordinates(coordinateSystem=byOrigin, angle=code_block_11, elevation=Z, radius=radius_of_circle)
byStartPointEndPoint_2 = Line.ByStartPointEndPoint(startPoint=byCylindricalCoordinates, endPoint=byCylindricalCoordinates_2)

# group: Create Support Curve
code_block_16 = CodeBlock(x=code_block_14.Xpoint) { z = 1000 * Math.Log(x); }
reverse = List.Reverse(list=code_block_16)
code_block_17 = CodeBlock { -1; }
dropItems = List.DropItems(list=reverse, amount=code_block_17)
code_block_18 = CodeBlock { 0; }
getItemAtIndex_2 = List.GetItemAtIndex(list=dropItems, index=code_block_18)
code_block_19 = CodeBlock(height=getItemAtIndex_2, Elevation=elevation) { change_in_elevation = height - Elevation; }
code_block_20 = CodeBlock(x=code_block_14.Xpoint, change_in_elevation=code_block_19) { z1 = 1000 * Math.Log(x) - change_in_elevation; }
reverse_2 = List.Reverse(list=code_block_20)
dropItems_2 = List.DropItems(list=reverse_2, amount=code_block_17)
byCoordinates_11 = Point.ByCoordinates(x=code_block_14.Xpoint, y=code_block_10.y, z=dropItems_2)
byPoints_5 = NurbsCurve.ByPoints(points=byCoordinates_11)

# group: Join Curves Together
join_2 = Curve.Join(curve=byPoints_4, curves=byPoints_5)
list_create_2 = List.Create(item0=byStartPointEndPoint_2, item1=join_2)
byJoinedCurves = PolyCurve.ByJoinedCurves(curves=list_create_2)

# group: Generate Vertical Structure's Geometry and Volume
number_of_upper_arches = DoubleSlider(6, range=0..360 step 1)
class_cylindrical_steel_beam = Python()  # CPython3; unwired: IN[0]
# ---------- class_cylindrical_steel_beam.python (33 lines) ----------
# Load the Python Standard and DesignScript Libraries
import sys
import clr
clr.AddReference('ProtoGeometry')
from Autodesk.DesignScript.Geometry import *
import math

class CircularSteel:
    def __init__(self, centerline, radius):
        self.centerline = centerline
        self.radius = radius
        
    def center(self):
        return self.centerline.StartPoint
        
    def normal(self):
        return self.centerline.TangentAtParameter(0.0)
    
    def circle(self):
        center = self.center()
        radius = self.radius
        normal = self.normal()
        return Circle.ByCenterPointRadiusNormal(center, radius, normal)
    
    def make_geometry(self):
        return Solid.BySweep(self.circle(), self.centerline)
        
    def solid_volume(self):
        solid = self.make_geometry()
        return solid.Volume
          
OUT = CircularSteel
        
# ----------------------------------------
radius_of_steel_beam = DoubleSlider(112.5, range=0..1000 step 0.1)
series_of_instances_of = Python(IN[0]=class_cylindrical_steel_beam, IN[1]=byJoinedCurves, IN[2]=radius_of_steel_beam)  # "Series of Instances of Cylindrical Steel Beam"; CPython3
# ---------- series_of_instances_of.python (14 lines) ----------
CircularSteel = IN[0]
centerlines = IN[1]
radius = IN[2]

beams = []
volumes = []
for i in centerlines:
    beam = CircularSteel(i, radius)
    beams.append(beam.make_geometry())
    volumes.append(beam.solid_volume())

total_volume = sum(volumes)

OUT = [beams, total_volume]
# ----------------------------------------
code_block_21 = CodeBlock { 1; }
dropItems_3 = List.DropItems(list=series_of_instances_of, amount=code_block_21)
code_block_22 = CodeBlock(n=number_of_upper_arches, volume_curve=dropItems_3) { volume_total = n * volume_curve; }
code_block_23 = CodeBlock { 0; }
getItemAtIndex_3 = List.GetItemAtIndex(list=code_block_22, index=code_block_23)
finding_volume = Python(IN[0]=getItemAtIndex_3)  # CPython3
# ---------- finding_volume.python (6 lines) ----------
volume_total = IN[0]

volume_unit = "mm³"
volume = "{0:.2f} {1}".format(volume_total, volume_unit)

OUT = volume
# ----------------------------------------
code_block_24 = CodeBlock { -1; }
dropItems_4 = List.DropItems(list=series_of_instances_of, amount=code_block_24)
byCoordinates_12 = Point.ByCoordinates(x=code_block_10.x, y=code_block_10.y, z=code_block_10.z)
ZAxis = CoordinateSystem.ZAxis(coordinateSystem=byOrigin)
code_block_25 = CodeBlock(number_of_arches=number_of_upper_arches) { angle = 0..360..(360/number_of_arches); }
code_block_26 = CodeBlock { -1; }
dropItems_5 = List.DropItems(list=code_block_25, amount=code_block_26)
rotate = Geometry.Rotate(geometry=dropItems_4, origin=byCoordinates_12, axis=ZAxis, degrees=dropItems_5, lacing=CrossProduct)
color_palette = ColorPalette({R: 132, G: 148, B: 172, A: 255})
byGeometryColor_2 = Modifiers.GeometryColor.ByGeometryColor(geometry=rotate, color=color_palette)

# group: Display Volumes
volume_of_concrete_bench = Watch(getItemAtIndex)
volume_of_cylindical_steel_beams = Watch(finding_volume)
