# Dynamo graph 1849469.dyn "Start (1" (Dynamo 3.6.0.9395)

code_block = CodeBlock { -5000; -5000; -200; }
byCoordinates = Point.ByCoordinates(x=code_block.out0, y=code_block.out1, z=code_block.out2)
code_block_2 = CodeBlock { 5000; 5000; 0; }
byCoordinates_2 = Point.ByCoordinates(x=code_block_2.out0, y=code_block_2.out1, z=code_block_2.out2)
byCorners = Cuboid.ByCorners(lowPoint=byCoordinates, highPoint=byCoordinates_2)
code_block_3 = CodeBlock { 0; 100; 0; }
byARGB = Color.ByARGB(red=code_block_3.out0, green=code_block_3.out1, blue=code_block_3.out2)
byGeometryColor = Modifiers.GeometryColor.ByGeometryColor(geometry=byCorners, color=byARGB)
roofThickness = DoubleSlider(100, range=100..500 step 10)
beamWidth = DoubleSlider(100, range=100..300 step 0.1)
number = DoubleInput(-4000)
number_2 = DoubleInput(4000)
colsX = DoubleSlider(2, range=2..10 step 1)
code_block_4 = CodeBlock(colsX=colsX) { (4000 - (-4000)) / (colsX - 1); }
range = Range(start=number, end=number_2, step=code_block_4)
number_3 = DoubleInput(-4000)
number_4 = DoubleInput(4000)
colsY = DoubleSlider(3, range=2..10 step 1)
code_block_5 = CodeBlock(colsY=colsY) { (4000 - (-4000)) / (colsY - 1); }
range_2 = Range(start=number_3, end=number_4, step=code_block_5)
number_5 = DoubleInput(0)
byCoordinates_3 = Point.ByCoordinates(x=range, y=range_2, z=number_5, lacing=CrossProduct)
pavilionHeight = DoubleSlider(2100, range=2000..5000 step 100)
column_radius_mm = DoubleSlider(50, range=50..250 step 0.1)
series_of_instances_of = Python(basePoints=byCoordinates_3, height=pavilionHeight, radius=column_radius_mm)  # "series of instances of SteelPoles (Material 1 – steel poles)"; CPython3
# ---------- series_of_instances_of.python (58 lines) ----------
import clr
clr.AddReference('ProtoGeometry')
from Autodesk.DesignScript.Geometry import *

import math


base_points = IN[0]   # list of Points
height = IN[1]        # column height in mm
radius = IN[2]        # column radius in mm

# --- Material 1: Column class (steel poles) ---
class Column:
    def __init__(self, base_point, height, radius):
        self.base_point = base_point
        self.height = height
        self.radius = radius

    def make_geometry(self):
        
        top_point = Point.ByCoordinates(
            self.base_point.X,
            self.base_point.Y,
            self.base_point.Z + self.height
        )
       
        cyl = Cylinder.ByPointsRadius(self.base_point, top_point, self.radius)
        return cyl

    def volume(self):
        """Volume in mm^3"""
        return math.pi * (self.radius ** 2) * self.height


columns = []
volumes = []


def flatten(lst):
    for item in lst:
        if isinstance(item, list):
            for sub in flatten(item):
                yield sub
        else:
            yield item

flat_points = list(flatten(base_points))

for p in flat_points:
    col = Column(p, height, radius)
    geom = col.make_geometry()
    columns.append(geom)
    volumes.append(col.volume())

total_volume = sum(volumes)


OUT = (columns, volumes, total_volume)
# ----------------------------------------
watch = Watch(series_of_instances_of)
number_6 = DoubleInput(0)
getItemAtIndex = List.GetItemAtIndex(list=series_of_instances_of, index=number_6)
number_7 = DoubleInput(2)
getItemAtIndex_2 = List.GetItemAtIndex(list=series_of_instances_of, index=number_7)
material_1_total_volume_mm³ = Watch(getItemAtIndex_2)
code_block_6 = CodeBlock { 8; }
byCoordinates_4 = Point.ByCoordinates(z=code_block_6)
code_block_7 = CodeBlock { 6; }
byCoordinates_5 = Point.ByCoordinates(x=code_block_7)
topPointsGrid = Point.ByCoordinates(x=range, y=range_2, z=number_5, lacing=CrossProduct)
roof_panel_length_in_x_mm = DoubleSlider(500, range=500..4000 step 100)
roof_panel_length_in_y_mm = DoubleSlider(500, range=500..4000 step 100)
roof_panel_thickness_mm = DoubleSlider(50, range=50..500 step 10)
class_woodbase_material_2_wood = Python(roofCentersGrid=topPointsGrid, sizeX=roof_panel_length_in_x_mm, sizeY=roof_panel_length_in_y_mm, thickness=roof_panel_thickness_mm, IN[4]=pavilionHeight)  # "class: WoodBase (Material 2 – wood base for columns) + series of instances"; CPython3
# ---------- class_woodbase_material_2_wood.python (54 lines) ----------
import clr
clr.AddReference('ProtoGeometry')
from Autodesk.DesignScript.Geometry import *


roof_centers_grid = IN[0]  
sizeX = IN[1]               # wood panel length in X (mm)
sizeY = IN[2]               # wood panel length in Y (mm)
thickness = IN[3]           # wood panel thickness (mm)

# --------------------------------------
# Material 2: WoodPanel class (wood roof)
# --------------------------------------
class WoodPanel:
    def __init__(self, center, sizeX, sizeY, thickness):
        self.center = center
        self.sizeX = sizeX
        self.sizeY = sizeY
        self.thickness = thickness

    def make_geometry(self):
      
        cs = CoordinateSystem.ByOrigin(self.center)
        panel = Cuboid.ByLengths(cs, self.sizeX, self.sizeY, self.thickness)
        return panel

    def volume(self):
        
        return self.sizeX * self.sizeY * self.thickness


wood_panels = []   # list of panel solids (geometry)
volumes = []       # list of volumes for each panel


for row_index, row in enumerate(roof_centers_grid):
    for col_index, pt in enumerate(row):
      
        if (row_index + col_index) % 2 == 0:
            
            continue

        
        panel = WoodPanel(pt, sizeX, sizeY, thickness)
        geom = panel.make_geometry()
        wood_panels.append(geom)
        volumes.append(panel.volume())

total_volume = sum(volumes)

# OUT[0] = list of wood roof panel geometry (series of instances)
# OUT[1] = list of panel volumes
# OUT[2] = total volume of wood material (Material 2)
OUT = [wood_panels, volumes, total_volume]
# ----------------------------------------
watch_2 = Watch(class_woodbase_material_2_wood)
number_8 = DoubleInput(0)
getItemAtIndex_3 = List.GetItemAtIndex(list=watch_2, index=number_8)
number_9 = DoubleInput(2)
getItemAtIndex_4 = List.GetItemAtIndex(list=class_woodbase_material_2_wood, index=number_9)
material_2_total_volume_mm³ = Watch(getItemAtIndex_4)
code_block_8 = CodeBlock { 5000; }
byCoordinates_6 = Point.ByCoordinates(x=code_block_8)
code_block_9 = CodeBlock { 4000; }
byCoordinates_7 = Point.ByCoordinates(z=code_block_9)
code_block_10 = CodeBlock { -5000; }
byCoordinates_8 = Point.ByCoordinates(x=code_block_10)
byThreePoints = Arc.ByThreePoints(firstPoint=byCoordinates_6, secondPoint=byCoordinates_7, thirdPoint=byCoordinates_8)
planeAtParameter = Curve.PlaneAtParameter(curve=byThreePoints)
code_block_11 = CodeBlock { 50; }
byPlaneRadius = Circle.ByPlaneRadius(plane=planeAtParameter, radius=code_block_11)
bySweep = Solid.BySweep(profile=byPlaneRadius, path=byThreePoints)
code_block_12 = CodeBlock { 5000; 100; }
byCoordinates_9 = Point.ByCoordinates(x=code_block_12.out0)
code_block_13 = CodeBlock { 5000; }
byCoordinates_10 = Point.ByCoordinates(y=code_block_13)
code_block_14 = CodeBlock { -5000; 100; }
byCoordinates_11 = Point.ByCoordinates(x=code_block_14.out0, y=code_block_14.out1)
byThreePoints_2 = Arc.ByThreePoints(firstPoint=byCoordinates_9, secondPoint=byCoordinates_10, thirdPoint=byCoordinates_11)
code_block_15 = CodeBlock { 0..1..#48; }
pointAtParameter = Curve.PointAtParameter(curve=byThreePoints_2, param=code_block_15)
curvature = IntegerSlider(48, range=0..100 step 1)
code_block_16 = CodeBlock(n=curvature) { a=0..15*n..#48; z=2000-2000*Math.Cos(a); }
translate = Geometry.Translate(geometry=pointAtParameter, zTranslation=code_block_16.z)
byPoints = NurbsCurve.ByPoints(points=translate)
code_block_17 = CodeBlock { 0.05..0.95..#128; }
pointAtParameter_2 = Curve.PointAtParameter(curve=byPoints, param=code_block_17)
pointAtParameter_3 = Curve.PointAtParameter(curve=byThreePoints, param=code_block_17)
byStartPointEndPoint = Line.ByStartPointEndPoint(startPoint=pointAtParameter_2, endPoint=pointAtParameter_3)
code_block_18 = CodeBlock { 0.5; }
pointAtParameter_4 = Curve.PointAtParameter(curve=byStartPointEndPoint, param=code_block_18)
code_block_19 = CodeBlock { -500; }
translate_2 = Geometry.Translate(geometry=pointAtParameter_4, zTranslation=code_block_19)
byThreePoints_3 = Arc.ByThreePoints(firstPoint=pointAtParameter_2, secondPoint=translate_2, thirdPoint=pointAtParameter_3)
planeAtParameter_2 = Curve.PlaneAtParameter(curve=byThreePoints_3)
code_block_20 = CodeBlock { 25; }
byPlaneRadius_2 = Circle.ByPlaneRadius(plane=planeAtParameter_2, radius=code_block_20)
bySweep_2 = Solid.BySweep(profile=byPlaneRadius_2, path=byThreePoints_3)
XZ = Plane.XZ()
mirror = Geometry.Mirror(geometry=bySweep_2, mirrorPlane=XZ)
number_slider = DoubleSlider(1, range=0..100 step 0.1)
planeAtParameter_3 = Curve.PlaneAtParameter(curve=byPoints)
code_block_21 = CodeBlock { 100; }
byPlaneRadius_3 = Circle.ByPlaneRadius(plane=planeAtParameter_3, radius=code_block_21)
bySweep_3 = Solid.BySweep(profile=byPlaneRadius_3, path=byPoints)
XZ_2 = Plane.XZ()
mirror_2 = Geometry.Mirror(geometry=bySweep_3, mirrorPlane=XZ_2)
code_block_22 = CodeBlock {  }
code_block_23 = CodeBlock {  }
number_slider_2 = DoubleSlider(1, range=0..100 step 0.1)
