# Dynamo graph 1849473.dyn (Dynamo 3.6.0.9395)

# group: Don't touch this ground
code_block = CodeBlock { -5000; -5000; -200; }
byCoordinates = Point.ByCoordinates(x=code_block.out0, y=code_block.out1, z=code_block.out2)
code_block_2 = CodeBlock { 5000; 5000; 0; }
byCoordinates_2 = Point.ByCoordinates(x=code_block_2.out0, y=code_block_2.out1, z=code_block_2.out2)
byCorners = Cuboid.ByCorners(lowPoint=byCoordinates, highPoint=byCoordinates_2)
code_block_3 = CodeBlock { 0; 100; 0; }
byARGB = Color.ByARGB(red=code_block_3.out0, green=code_block_3.out1, blue=code_block_3.out2)
byGeometryColor = Modifiers.GeometryColor.ByGeometryColor(geometry=byCorners, color=byARGB)

roof_slope = DoubleSlider(5336.5, range=4000..6000 step 0.1)

# group: Wood Roof
code_block_4 = CodeBlock { [-4500, -4500]; [4500, 0]; [4000, 4000]; }
start_coordinates = Point.ByCoordinates(x=code_block_4.out0, y=code_block_4.out1, z=code_block_4.out2)
code_block_5 = CodeBlock { [-4500, -4500]; [0, -4500]; }
end_coordinates = Point.ByCoordinates(x=code_block_5.out0, y=code_block_5.out1, z=roof_slope)
roof_class = Python()  # CPython3; unwired: IN[0]
# ---------- roof_class.python (14 lines) ----------
import sys
import clr
clr.AddReference('ProtoGeometry')
from Autodesk.DesignScript.Geometry import *

class Roof:
    def __init__(self, start_point, end_point):
        self.start = start_point
        self.end = end_point
    
    def makegeometry(self):
        return Line.ByStartPointEndPoint(self.start, self.end)
        
OUT = Roof
# ----------------------------------------
series_of_roof_instances = Python(IN[0]=start_coordinates, IN[1]=end_coordinates, IN[2]=roof_class)  # CPython3
# ---------- series_of_roof_instances.python (13 lines) ----------
start_points = IN[0]
end_points = IN[1]
Roof = IN[2]

Roofs = []

for i in range(len(start_points)):
    start = start_points[i]
    end = end_points[i]
    a = Roof(start, end)
    Roofs.append(a.makegeometry())
    
OUT = Roofs
# ----------------------------------------
code_block_6 = CodeBlock { -9000; }
extrude = Curve.Extrude(curve=series_of_roof_instances, distance=code_block_6)
roof_thickness_slider = IntegerSlider(150, range=0..500 step 1)
thicken = Surface.Thicken(surface=extrude, thickness=roof_thickness_slider)
color_palette = ColorPalette({R: 136, G: 114, B: 83, A: 255})
byGeometryColor_2 = Modifiers.GeometryColor.ByGeometryColor(geometry=thicken, color=color_palette)
roof_volumes = Solid.Volume(solid=thicken)
sum = Math.Sum(values=roof_volumes)
code_block_7 = CodeBlock { -4500; 0; 4000; }
start_point = Point.ByCoordinates(x=code_block_7.out0, y=code_block_7.out1, z=code_block_7.out2)
code_block_8 = CodeBlock { 4500; 0; 4000; }
end_point = Point.ByCoordinates(x=code_block_8.out0, y=code_block_8.out1, z=code_block_8.out2)
roof_connector_instance = Python(IN[0]=start_point, IN[1]=end_point, IN[2]=roof_class)  # CPython3
# ---------- roof_connector_instance.python (7 lines) ----------
start = IN[0]
end = IN[1]
Roof = IN[2]

a = Roof(start, end) 

OUT = a.makegeometry()
# ----------------------------------------
code_block_9 = CodeBlock { 1; }
extrude_direction = Vector.ByCoordinates(z=code_block_9)
code_block_10 = CodeBlock { 4000; }
connector_height = roof_slope - code_block_10
connector_extrude = Curve.Extrude(curve=roof_connector_instance, direction=extrude_direction, distance=connector_height)
connector_solid = Surface.Thicken(surface=connector_extrude, thickness=roof_thickness_slider)
connector_volume = Solid.Volume(solid=connector_solid)
add = sum + connector_volume
wood_volume_mm_3 = Watch(add)
code_block_11 = CodeBlock { -4000; 5; 1700; }
sequence = Sequence(start=code_block_11.out0, amount=code_block_11.out1, step=code_block_11.out2)
byGeometryColor_3 = Modifiers.GeometryColor.ByGeometryColor(geometry=connector_solid, color=color_palette)

# group: Steel Posts
post_radius = DoubleSlider(93.7, range=50..250 step 0.1)
post_x_coordinates = CodeBlock { -4500; 3; 0; }
sequence_of_post_x_coordinates = Sequence(start=post_x_coordinates.out0, amount=post_x_coordinates.out1, step=post_x_coordinates.out2)
post_y_coordinates = CodeBlock { -4500; 3; 4500; }
sequence_of_post_y_coordinates = Sequence(start=post_y_coordinates.out0, amount=post_y_coordinates.out1, step=post_y_coordinates.out2)
post_coordinates = Point.ByCoordinates(x=sequence_of_post_x_coordinates, y=sequence_of_post_y_coordinates)
code_block_12 = CodeBlock { 4000; }
list_create = List.Create(item0=roof_slope, item1=roof_slope, item2=code_block_12)
byCoordinates_3 = Point.ByCoordinates(x=sequence_of_post_x_coordinates, y=sequence_of_post_y_coordinates, z=list_create)
posts_class = Python()  # CPython3; unwired: IN[0]
# ---------- posts_class.python (16 lines) ----------
import sys
import clr
clr.AddReference('ProtoGeometry')
from Autodesk.DesignScript.Geometry import *

class Post:
    def __init__(self, top_point, bottom_point, radius):
        self.top = top_point
        self.bottom = bottom_point
        self.radius = radius
        
    def MakeGeometry(self):
        return Cylinder.ByPointsRadius(self.top, self.bottom, self.radius)
        
        
OUT = Post       
# ----------------------------------------
series_of_posts_instances = Python(IN[0]=post_radius, IN[1]=post_coordinates, IN[2]=byCoordinates_3, IN[3]=posts_class)  # CPython3
# ---------- series_of_posts_instances.python (14 lines) ----------
Post = IN[3]
bottom_points = IN[1]
top_points = IN[2]
radius = IN[0]

Posts = []

for i in range(len(bottom_points)):
    top_point = top_points[i]
    bottom_point = bottom_points[i]
    a = Post(top_point, bottom_point, radius)
    Posts.append(a.MakeGeometry())

OUT = Posts
# ----------------------------------------
translation = CodeBlock { 9000; 0; 0; }
translation_vector = Vector.ByCoordinates(x=translation.out0, y=translation.out1, z=translation.out2)
duplicate_posts = Geometry.Translate(geometry=series_of_posts_instances, direction=translation_vector)
color_palette_2 = ColorPalette({R: 79, G: 83, B: 75, A: 255})
byGeometryColor_4 = Modifiers.GeometryColor.ByGeometryColor(geometry=duplicate_posts, color=color_palette_2)
byGeometryColor_5 = Modifiers.GeometryColor.ByGeometryColor(geometry=series_of_posts_instances, color=color_palette_2)
volume = Solid.Volume(solid=series_of_posts_instances)
sum_2 = Math.Sum(values=volume)
code_block_13 = CodeBlock { 2; }
mul = sum_2 * code_block_13
steel_volume_mm_3 = Watch(mul)

# group: Wall and Info Table Feature
code_block_14 = CodeBlock { -4000; -1000; 0; }
byCoordinates_4 = Point.ByCoordinates(x=code_block_14.out0, y=code_block_14.out1, z=code_block_14.out2)
code_block_15 = CodeBlock { -1000; -800; 4000; }
byCoordinates_5 = Point.ByCoordinates(x=code_block_15.out0, y=code_block_15.out1, z=code_block_15.out2)
wall = Cuboid.ByCorners(lowPoint=byCoordinates_4, highPoint=byCoordinates_5)
code_block_16 = CodeBlock { -3700; -1000; 2500; }
byCoordinates_6 = Point.ByCoordinates(x=code_block_16.out0, y=code_block_16.out1, z=code_block_16.out2)
code_block_17 = CodeBlock { -3000; -800; 3500; }
byCoordinates_7 = Point.ByCoordinates(x=code_block_17.out0, y=code_block_17.out1, z=code_block_17.out2)
decorative_window = Cuboid.ByCorners(lowPoint=byCoordinates_6, highPoint=byCoordinates_7)
difference = Solid.Difference(solid=wall, other=decorative_window)
color_palette_3 = ColorPalette({R: 201, G: 179, B: 159, A: 255})
byGeometryColor_6 = Modifiers.GeometryColor.ByGeometryColor(geometry=difference, color=color_palette_3)
code_block_18 = CodeBlock { -4000; -1800; 0; }
byCoordinates_8 = Point.ByCoordinates(x=code_block_18.out0, y=code_block_18.out1, z=code_block_18.out2)
code_block_19 = CodeBlock { -1000; -2500; 1250; }
byCoordinates_9 = Point.ByCoordinates(x=code_block_19.out0, y=code_block_19.out1, z=code_block_19.out2)
table = Cuboid.ByCorners(lowPoint=byCoordinates_8, highPoint=byCoordinates_9)
byGeometryColor_7 = Modifiers.GeometryColor.ByGeometryColor(geometry=table, color=color_palette_3)

# group: Chairs
chair_class = Python()  # CPython3; unwired: IN[0]
# ---------- chair_class.python (19 lines) ----------
# Load the Python Standard and DesignScript Libraries
import sys
import clr
clr.AddReference('ProtoGeometry')
from Autodesk.DesignScript.Geometry import *

class Chair:
    def __init__(self, center, radius, subcenter, subradius):
        self.center = center
        self.radius = radius
        self.subcenter = subcenter
        self.subradius = subradius
       
    def makeGeometry(self):
        a = Sphere.ByCenterPointRadius(self.center, self.radius)
        b = Sphere.ByCenterPointRadius(self.subcenter, self.subradius) 
        return Solid.Difference(a,b)
        
OUT = Chair
# ----------------------------------------
chair_radius = IntegerSlider(727, range=100..850 step 1)
code_block_20 = CodeBlock { 550; }
code_block_21 = CodeBlock { [-2900,-2900,0]; [3000,1000,0]; 300; }
center_points = Point.ByCoordinates(x=code_block_21.out0, y=code_block_21.out1, z=code_block_21.out2)
code_block_22 = CodeBlock { [-3250,-3250,250]; [2500,1500,250]; 800; }
subcenter_points = Point.ByCoordinates(x=code_block_22.out0, y=code_block_22.out1, z=code_block_22.out2)
chair_instances = Python(IN[0]=chair_class, IN[1]=chair_radius, IN[2]=code_block_20, IN[3]=center_points, IN[4]=subcenter_points)  # CPython3
# ---------- chair_instances.python (15 lines) ----------
Chair = IN[0]
radius = IN[1]
subradius = IN[2]
centers = IN[3]
subcenters = IN[4]

Chairs = []

for i in range(len(centers)):
    center = centers[i]
    subcenter = subcenters[i]
    a = Chair(center, radius, subcenter, subradius)
    Chairs.append(a.makeGeometry())
    
OUT = Chairs
# ----------------------------------------
color_palette_4 = ColorPalette({R: 205, G: 204, B: 0, A: 255})
byGeometryColor_8 = Modifiers.GeometryColor.ByGeometryColor(geometry=chair_instances, color=color_palette_4)

# group: Cylinder Bench Feature
center = CodeBlock { x=1500; y=2000; z=0; }
center_2 = Point.ByCoordinates(x=center.x, y=center.y, z=center.z)
radius = IntegerSlider(2540, range=1000..3200 step 10)
start_angle = DoubleSlider(313.4, range=0..360 step 0.1)
end_angle = DoubleSlider(-187.4, range=-360..100 step 0.1)
normal_vector = CodeBlock { x=0; y=0; z=1; }
normal = Vector.ByCoordinates(x=normal_vector.x, y=normal_vector.y, z=normal_vector.z)
cylinder_wall = Arc.ByCenterPointRadiusAngle(center=center_2, radius=radius, startAngle=start_angle, endAngle=end_angle, normal=normal)
wall_height = IntegerSlider(2604, range=1000..4000 step 1)
extrude_2 = Curve.Extrude(curve=cylinder_wall, distance=wall_height)
wall_thickness = IntegerSlider(150, range=100..150 step 1)
wall_2 = Surface.Thicken(surface=extrude_2, thickness=wall_thickness)
color_palette_5 = ColorPalette({R: 0, G: 127, B: 2, A: 255})
byGeometryColor_9 = Modifiers.GeometryColor.ByGeometryColor(geometry=wall_2, color=color_palette_5)
code_block_23 = CodeBlock { 500; }
sub = radius - code_block_23
seat = Arc.ByCenterPointRadiusAngle(center=center_2, radius=sub, startAngle=start_angle, endAngle=end_angle, normal=normal)
code_block_24 = CodeBlock { 600; }
extrude_3 = Curve.Extrude(curve=seat, distance=code_block_24)
code_block_25 = CodeBlock { 600; }
seat_2 = Surface.Thicken(surface=extrude_3, thickness=code_block_25)
byGeometryColor_10 = Modifiers.GeometryColor.ByGeometryColor(geometry=seat_2, color=color_palette_5)
