# Dynamo graph 1849576.dyn (Dynamo 3.6.0.9395)

code_block = CodeBlock { -5000; -5000; -200; }
byCoordinates = Point.ByCoordinates(x=code_block.out0, y=code_block.out1, z=code_block.out2)
code_block_2 = CodeBlock { 5000; 5000; 0; }
byCoordinates_2 = Point.ByCoordinates(x=code_block_2.out0, y=code_block_2.out1, z=code_block_2.out2)
byCorners = Cuboid.ByCorners(lowPoint=byCoordinates, highPoint=byCoordinates_2)
code_block_3 = CodeBlock { 0; 100; 0; }
byARGB = Color.ByARGB(red=code_block_3.out0, green=code_block_3.out1, blue=code_block_3.out2)
byGeometryColor = Modifiers.GeometryColor.ByGeometryColor(geometry=byCorners, color=byARGB)
code_block_4 = CodeBlock { -4800; 19; 500; }
code_block_5 = CodeBlock { 0; 0; 0; }
slider_3_structural_density = DoubleSlider(5000, range=1..5500 step 0.1)
byCoordinates_3 = Point.ByCoordinates(x=code_block_5.out0, y=code_block_5.out1, z=slider_3_structural_density)
code_block_6 = CodeBlock { 4000; }
byCenterPointRadius = Circle.ByCenterPointRadius(centerPoint=byCoordinates_3, radius=code_block_6)
code_block_7 = CodeBlock { 0; 0; }
slider_4_bottom_of_roof_slab = DoubleSlider(5000, range=5000..5200 step 1)
bottom_of_roof = Point.ByCoordinates(x=code_block_7.out0, y=code_block_7.out1, z=slider_4_bottom_of_roof_slab)
code_block_8 = CodeBlock { 0; 0; }
slider_5_top_of_roof_slab = DoubleSlider(5100, range=5000..5100 step 0.1)
top_of_roof = Point.ByCoordinates(x=code_block_8.out0, y=code_block_8.out1, z=slider_5_top_of_roof_slab)
code_block_9 = CodeBlock { 5000; 5000; }
circular_glass_roof = Cylinder.ByPointsRadius(startPoint=top_of_roof, endPoint=bottom_of_roof, radius=code_block_9.out1)
class_of_glass_circular_slab = Python(IN[0]=circular_glass_roof)  # CPython3
# ---------- class_of_glass_circular_slab.python (17 lines) ----------
# Load the Python Standard and DesignScript Libraries
import sys
import clr
clr.AddReference('ProtoGeometry')
from Autodesk.DesignScript.Geometry import *

class CircularSlab:
    def __init__(self, bottom_point, top_point, radius):
       self.bottom = bottom_point
       self.top = top_point
       self.radius = radius
       
    def make_geometry(self):
        return Cylinder.ByPointsRadius(self.bottom, self.top, self.radius)
        
OUT = CircularSlab
        
# ----------------------------------------
instance_of_glass_circular_slab = Python(IN[0]=bottom_of_roof, IN[1]=top_of_roof, IN[2]=code_block_9.out0, IN[3]=class_of_glass_circular_slab)  # "Instance of Glass Circular slab: Glass Panel Circular Roof"; CPython3
# ---------- instance_of_glass_circular_slab.python (36 lines) ----------
CircularSlab = IN[3]
bottom_points = IN[0]
top_points = IN[1]
radii = IN[2]

def ensure_list(obj):
    try:
        iter(obj)
        return list(obj)
    except:
        return [obj]

bottom_points = ensure_list(bottom_points)
top_points = ensure_list(top_points)
radii = ensure_list(radii)

roof = []
volume = []

count = min(len(bottom_points), len(top_points))

for i in range(count):
    r = radii[i] if i < len(radii) else radii[-1]
    btm = bottom_points[i]
    top = top_points[i]
    
    slab = CircularSlab(btm, top, r)
    geom = slab.make_geometry()
   
    roof.append(geom)
    
    height = btm.DistanceTo(top)
    
    vol = 3.1415936*((r)**2)*height
    volume.append(vol)
OUT = roof, volume
# ----------------------------------------
volume_of_glass_panel_circular = Watch(instance_of_glass_circular_slab)  # "Volume of Glass Panel Circular Roof (mm^3)"
code_block_10 = CodeBlock { 0; 0; 0; }
byCoordinates_4 = Point.ByCoordinates(x=code_block_10.out0, y=code_block_10.out1, z=code_block_10.out2)
code_block_11 = CodeBlock { 4000; }
bottom_circle = Circle.ByCenterPointRadius(centerPoint=byCoordinates_4, radius=code_block_11)
slider_1_number_of_circular_rods = IntegerSlider(150, range=0..1000 step 1)
bottom = CodeBlock(x=slider_1_number_of_circular_rods) { 0.2..0.8..#x; }
curve_of_bottom_circle = Curve.PointAtParameter(curve=bottom_circle, param=[bottom, bottom])
code_block_12 = CodeBlock { 0; 0; 0; }
slider_2_spacing_from_ground = DoubleSlider(5000, range=0..10000 step 10)
byCoordinates_5 = Point.ByCoordinates(x=code_block_12.out0, y=code_block_12.out1, z=slider_2_spacing_from_ground)
code_block_13 = CodeBlock { 4000; }
top_circle = Circle.ByCenterPointRadius(centerPoint=byCoordinates_5, radius=code_block_13)
top = CodeBlock(x=slider_1_number_of_circular_rods) { 0..1..#x; }
curve_of_top_circle = Curve.PointAtParameter(curve=top_circle, param=top)
code_block_14 = CodeBlock(x=slider_1_number_of_circular_rods) { 50; x; 0; }
sequence = Sequence(start=code_block_14.out0, amount=code_block_14.x, step=code_block_14.out2)
class_of_steel_circular_rod = Python()  # CPython3; unwired: IN[0]
# ---------- class_of_steel_circular_rod.python (16 lines) ----------
# Load the Python Standard and DesignScript Libraries
import sys
import clr
clr.AddReference('ProtoGeometry')
from Autodesk.DesignScript.Geometry import *

class CircularRod:
    def __init__(self, bottom_point, top_point, radius):
        self.bottom = bottom_point
        self.top = top_point
        self.radius = radius 
        
    def make_geometry(self):
        return Cylinder.ByPointsRadius(self.bottom, self.top, self.radius)
            
OUT = CircularRod
# ----------------------------------------
series_of_instances_of_steel = Python(IN[0]=curve_of_bottom_circle, IN[1]=curve_of_top_circle, IN[2]=sequence, IN[3]=class_of_steel_circular_rod)  # "Series of Instances of Steel Circular rods: Final Steel Rods"; CPython3
# ---------- series_of_instances_of_steel.python (22 lines) ----------
CircularRod = IN[3]
bottom_points = IN[0]
top_points = IN[1]
radii = IN[2]

rods = []
volume = []
count = min(len(bottom_points), len(top_points))

for i in range(count):
    r = radii[i] if i < len(radii) else radii[-1]
    btm = bottom_points[i]
    top = top_points[i]
    
    rod = CircularRod(btm, top, r)
    rods.append(rod.make_geometry())
    
    height = btm.DistanceTo(top)
    
    vol = 3.1415936*((r)**2)*height
    volume.append(vol)
OUT = rods, volume
# ----------------------------------------
volumes_of_steel_circular_rods = Watch(series_of_instances_of_steel)  # "Volumes of Steel Circular Rods (mm^3)"
python_script = Python(IN[0]=volumes_of_steel_circular_rods)  # CPython3
# ---------- python_script.python (1 lines) ----------
OUT = IN[0][1]
# ----------------------------------------
sum = Math.Sum(values=python_script)
python_script_2 = Python(IN[0]=volumes_of_steel_circular_rods)  # CPython3
# ---------- python_script_2.python (1 lines) ----------
OUT = IN[0][0]
# ----------------------------------------
code_block_15 = CodeBlock { 255; 173; 216; 230; }
byARGB_2 = Color.ByARGB(alpha=code_block_15.out0, red=code_block_15.out1, green=code_block_15.out2, blue=code_block_15.out3)
byGeometryColor_2 = Modifiers.GeometryColor.ByGeometryColor(geometry=python_script_2, color=byARGB_2)
