# Dynamo graph 1849654.dyn (Dynamo 3.6.1.9895)

# group: Ground Block (DON'T TOUCH THESE)
code_block = CodeBlock { -5000; -5000; -200; }
byCoordinates = Point.ByCoordinates(x=code_block.out0, y=code_block.out1, z=code_block.out2)
code_block_2 = CodeBlock { 5000; 5000; 0; }
byCoordinates_2 = Point.ByCoordinates(x=code_block_2.out0, y=code_block_2.out1, z=code_block_2.out2)
byCorners = Cuboid.ByCorners(lowPoint=byCoordinates, highPoint=byCoordinates_2)
code_block_3 = CodeBlock { 0; 100; 0; }
byARGB = Color.ByARGB(red=code_block_3.out0, green=code_block_3.out1, blue=code_block_3.out2)
byGeometryColor = Modifiers.GeometryColor.ByGeometryColor(geometry=byCorners, color=byARGB)

bone_thickness = DoubleSlider(272, range=80..300 step 1)
wing_Height = DoubleSlider(3100, range=2500..5000 step 50)
lower_wing_point_guide = CodeBlock(Wing_Height=wing_Height)
# ---------- lower_wing_point_guide.designscript (12 lines) ----------
C1 = Point.ByCoordinates(3250, 4500, 0);
C15 = Point.ByCoordinates(4500, 250, Wing_Height*0.4);
C2 = Point.ByCoordinates(3500, -2750, Wing_Height*0.6);
C3 = Point.ByCoordinates(1000, -4500, Wing_Height*0);
C4 = Point.ByCoordinates(-3500, -2750, Wing_Height*0.6);
C45 = Point.ByCoordinates(-4500, 250, Wing_Height*0.4);
C5 = Point.ByCoordinates(-3250, 4500, 0);

[C1, C15, C2, C3];
[C1, C15, C2, C3, C4, C45, C5];

50;
# ----------------------------------------
lower_wing_curve = NurbsCurve.ByPoints(points=lower_wing_point_guide.out7)
YZ = Plane.YZ()
mirror = Geometry.Mirror(geometry=lower_wing_curve, mirrorPlane=YZ)
upper_wing_point_guide = CodeBlock(Wing_Height=wing_Height)
# ---------- upper_wing_point_guide.designscript (12 lines) ----------
B1 = Point.ByCoordinates(3500, 2000, Wing_Height);
B15 = Point.ByCoordinates(3750, 0, Wing_Height*1.05);
B2 = Point.ByCoordinates(1500, -2500, Wing_Height*1.2);
B3 = Point.ByCoordinates(0, -4000, Wing_Height*0.8);
B4 = Point.ByCoordinates(-1500, -2500, Wing_Height*1.2);
B45 = Point.ByCoordinates(-3750, 0, Wing_Height*1.05);
B5 = Point.ByCoordinates(-3500, 2000, Wing_Height);

[B1, B15, B2, B3];

0;
1;
# ----------------------------------------
upper_wing_curve = NurbsCurve.ByPoints(points=upper_wing_point_guide.out7)
mirror_2 = Geometry.Mirror(geometry=upper_wing_curve, mirrorPlane=YZ)
mid_wing_point_guide = Python(IN[0]=upper_wing_point_guide.out7, IN[1]=lower_wing_point_guide.out7)  # CPython3
# ---------- mid_wing_point_guide.python (17 lines) ----------
# Load the Python Standard and DesignScript Libraries
import sys
import clr
clr.AddReference('ProtoGeometry')
from Autodesk.DesignScript.Geometry import *

topPts = IN[0]
botPts = IN[1]

midPts = []
for i in range(len(topPts)):
    x = (topPts[i].X + botPts[i].X)/2
    y = (topPts[i].Y + botPts[i].Y)/2
    z = (topPts[i].Z + botPts[i].Z)/2
    midPts.append(Point.ByCoordinates(x, y, z))
    
OUT = midPts
# ----------------------------------------
upper_quarter_wing_point_guide = Python(IN[0]=upper_wing_point_guide.out7, IN[1]=mid_wing_point_guide)  # CPython3
# ---------- upper_quarter_wing_point_guide.python (17 lines) ----------
# Load the Python Standard and DesignScript Libraries
import sys
import clr
clr.AddReference('ProtoGeometry')
from Autodesk.DesignScript.Geometry import *

topPts = IN[0]
midPts = IN[1]

upQuarterPts = []
for i in range(len(topPts)):
    x = (topPts[i].X + midPts[i].X)/2
    y = (topPts[i].Y + midPts[i].Y)/2
    z = (topPts[i].Z + midPts[i].Z)/2
    upQuarterPts.append(Point.ByCoordinates(x, y, z))
    
OUT = upQuarterPts
# ----------------------------------------
lower_quarter_wing_point_guide = Python(IN[0]=upper_quarter_wing_point_guide, IN[1]=lower_wing_point_guide.out7)  # CPython3
# ---------- lower_quarter_wing_point_guide.python (17 lines) ----------
# Load the Python Standard and DesignScript Libraries
import sys
import clr
clr.AddReference('ProtoGeometry')
from Autodesk.DesignScript.Geometry import *

midPts = IN[0]
botPts = IN[1]

quarterPts = []
for i in range(len(midPts)):
    x = (midPts[i].X + botPts[i].X)/2
    y = (midPts[i].Y + botPts[i].Y)/2
    z = (midPts[i].Z + botPts[i].Z)/2
    quarterPts.append(Point.ByCoordinates(x, y, z))
    
OUT = quarterPts
# ----------------------------------------
lower_quarter_wing_curve = NurbsCurve.ByPoints(points=lower_quarter_wing_point_guide)
feather_and_rachis_count = DoubleSlider(25, range=15..40 step 2)
rachis_and_feather_sequence_prep = CodeBlock(count=feather_and_rachis_count) { step = count >= 1 ? 1/(count-1) : 1.0; start = 0.0; 0; }  # "Rachis and Feather Sequence prep (spacing)"
holy_spacing_sequence_do_not = Sequence(start=rachis_and_feather_sequence_prep.start, amount=feather_and_rachis_count, step=rachis_and_feather_sequence_prep.step)  # "Holy Spacing Sequence (DO NOT MESS WITH IT)"
center_feather_add_on_points = Curve.PointAtParameter(curve=lower_quarter_wing_curve, param=holy_spacing_sequence_do_not)
lower_curve_points = Curve.PointAtParameter(curve=lower_wing_curve, param=holy_spacing_sequence_do_not)
upper_quarter_wing_curve = NurbsCurve.ByPoints(points=upper_quarter_wing_point_guide)
center_feather_add_on_points_2 = Curve.PointAtParameter(curve=upper_quarter_wing_curve, param=holy_spacing_sequence_do_not)
wing_width = DoubleSlider(225, range=150..250 step 5)
outer_and_inner_wing_point_guide = Python(IN[0]=lower_quarter_wing_point_guide, IN[1]=wing_width)  # CPython3
# ---------- outer_and_inner_wing_point_guide.python (27 lines) ----------
# Load the Python Standard and DesignScript Libraries
import sys
import clr
clr.AddReference('ProtoGeometry')
from Autodesk.DesignScript.Geometry import *

centerPts = IN[0]
side_dist = IN[1]

outerPts = []
innerPts = []

for i in range(len(centerPts)):
    # this is outer points, should be higher height (z), bigger x, and bigger y. Use number slider?
    x1 = (centerPts[i].X + side_dist)
    y1 = (centerPts[i].Y + side_dist)
    z1 = (centerPts[i].Z + side_dist)
    
    #this is for inner points, should be lower z, smaller x, smaller y.
    x2 = (centerPts[i].X - side_dist)
    y2 = (centerPts[i].Y - side_dist)
    z2 = (centerPts[i].Z - side_dist)
    
    outerPts.append(Point.ByCoordinates(x1, y1, z1))
    innerPts.append(Point.ByCoordinates(x2, y2, z2))
    
OUT = [outerPts, innerPts]
# ----------------------------------------
getItemAtIndex = List.GetItemAtIndex(list=outer_and_inner_wing_point_guide, index=upper_wing_point_guide.out8)
outer_wing_curve = NurbsCurve.ByPoints(points=getItemAtIndex)
outer_wing_points = Curve.PointAtParameter(curve=outer_wing_curve, param=holy_spacing_sequence_do_not)
getItemAtIndex_2 = List.GetItemAtIndex(list=outer_and_inner_wing_point_guide, index=upper_wing_point_guide.out9)
inner_wing_curve = NurbsCurve.ByPoints(points=getItemAtIndex_2)
inner_wing_points = Curve.PointAtParameter(curve=inner_wing_curve, param=holy_spacing_sequence_do_not)
feather_thickness = DoubleSlider(25, range=20..50 step 5)
class_aluminium_feathers_try_4 = Python()  # CPython3; unwired: IN[0]
# ---------- class_aluminium_feathers_try_4.python (41 lines) ----------
import sys
import clr
clr.AddReference('ProtoGeometry')
from Autodesk.DesignScript.Geometry import *

class Aluminium_Feathers:
    def __init__(self, bottom_point, top_point, left_side, right_side, thickness):
        self.bottom = bottom_point
        self.top = top_point
        self.left = left_side
        self.right = right_side
        self.thickness = thickness
        self.volume = None
        
        
    def project_point_to_plane(self, point, plane):
        vector = Vector.ByTwoPoints(plane.Origin, point)
        distance = vector.Dot(plane.Normal)
        return point.Translate(plane.Normal.Scale(-distance))

    def make_geometry(self):

        base_plane = Plane.ByBestFitThroughPoints([self.bottom, self.top, self.left, self.right])

        bottom = self.project_point_to_plane(self.bottom, base_plane)
        top = self.project_point_to_plane(self.top, base_plane)
        left = self.project_point_to_plane(self.left, base_plane)
        right = self.project_point_to_plane(self.right, base_plane)

        pts = [top, right, bottom, left, top] #Second top isnt a mistake DONT DELETE
        
        ring = NurbsCurve.ByPoints(pts)
        loft_direction = base_plane.Normal.Normalized()
        top_ring = ring.Translate(loft_direction.Scale(self.thickness))

        solid = Solid.ByLoft([ring, top_ring])
        volume = solid.Volume
        self.volume = volume
        return solid

OUT = Aluminium_Feathers
# ----------------------------------------
series_of_instances_of_aluminium = Python(IN[0]=lower_curve_points, IN[1]=center_feather_add_on_points_2, IN[2]=outer_wing_points, IN[3]=inner_wing_points, IN[4]=feather_thickness, IN[5]=class_aluminium_feathers_try_4)  # "Series of Instances of Aluminium Feathers"; CPython3
# ---------- series_of_instances_of_aluminium.python (29 lines) ----------
# Load the Python Standard and DesignScript Libraries
import sys
import clr
clr.AddReference('ProtoGeometry')
from Autodesk.DesignScript.Geometry import *

Aluminium_Feathers = IN[5]
bottom_point = IN[0]
top_point = IN[1]
left_side = IN[2]
right_side = IN[3]
thickness = IN[4] #use a number slider

feathers = []
feathers_volume = []

for i in range(len(top_point)):
    bot = bottom_point[i]
    top = top_point[i]
    left = left_side[i]
    right = right_side[i]
    
    feather = Aluminium_Feathers(bot, top, left, right, thickness)
    feathers.append(feather.make_geometry())
    feathers_volume.append(feather.volume)

total_material_volume = sum(feathers_volume)
    
OUT = [feathers, total_material_volume]
# ----------------------------------------
getItemAtIndex_3 = List.GetItemAtIndex(list=series_of_instances_of_aluminium, index=upper_wing_point_guide.out8)
mirror_3 = Geometry.Mirror(geometry=getItemAtIndex_3, mirrorPlane=YZ)
getItemAtIndex_4 = List.GetItemAtIndex(list=series_of_instances_of_aluminium, index=upper_wing_point_guide.out9)
code_block_4 = CodeBlock()
# ---------- code_block_4.designscript (17 lines) ----------
T1 = Point.ByCoordinates(0, -4612.5, 930);
T2 = Point.ByCoordinates(0, -4617.5, 930);
[T1, T2];
300;

T3 = Point.ByCoordinates(0, -4225, 1860);
T4 = Point.ByCoordinates(0, -4230, 1860);
[T3, T4];

T5 = Point.ByCoordinates(0, -4850, 0);
T6 = Point.ByCoordinates(0, -4855, 0);
[T5, T6];

1;

T7 = Point.ByCoordinates(0.000, -4000.000, 2480.000);
T8 = Point.ByCoordinates(0, -4613.000, 1240.000);
# ----------------------------------------
tail_feather_width = DoubleSlider(350, range=250..400 step 10)
outer_and_inner_wing_point_guide_2 = Python(IN[0]=code_block_4.out2, IN[1]=tail_feather_width)  # CPython3
# ---------- outer_and_inner_wing_point_guide_2.python (27 lines) ----------
# Load the Python Standard and DesignScript Libraries
import sys
import clr
clr.AddReference('ProtoGeometry')
from Autodesk.DesignScript.Geometry import *

centerPts = IN[0]
side_dist = IN[1]

outerPts = []
innerPts = []

for i in range(len(centerPts)):
    # this is outer points, should be higher height (z), bigger x, and bigger y. Use number slider?
    x1 = (centerPts[i].X + side_dist)
    y1 = centerPts[i].Y
    z1 = centerPts[i].Z 
    
    #this is for inner points, should be lower z, smaller x, smaller y.
    x2 = (centerPts[i].X - side_dist)
    y2 = centerPts[i].Y
    z2 = centerPts[i].Z
    
    outerPts.append(Point.ByCoordinates(x1, y1, z1))
    innerPts.append(Point.ByCoordinates(x2, y2, z2))
    
OUT = [outerPts, innerPts]
# ----------------------------------------
getItemAtIndex_5 = List.GetItemAtIndex(list=outer_and_inner_wing_point_guide_2, index=upper_wing_point_guide.out8)
outer_wing_curve_2 = NurbsCurve.ByPoints(points=getItemAtIndex_5)
outer_wing_points_2 = Curve.PointAtParameter(curve=outer_wing_curve_2, param=holy_spacing_sequence_do_not)
getItemAtIndex_6 = List.GetItemAtIndex(list=outer_and_inner_wing_point_guide_2, index=upper_wing_point_guide.out9)
inner_wing_curve_2 = NurbsCurve.ByPoints(points=getItemAtIndex_6)
inner_wing_points_2 = Curve.PointAtParameter(curve=inner_wing_curve_2, param=holy_spacing_sequence_do_not)
instance_of_aluminium_feather = Python(IN[0]=code_block_4.out9, IN[1]=code_block_4.out6, IN[2]=outer_wing_points_2, IN[3]=inner_wing_points_2, IN[4]=feather_thickness, IN[5]=class_aluminium_feathers_try_4)  # "Instance of Aluminium Feather (Tail)"; CPython3; same code as series_of_instances_of_aluminium
getItemAtIndex_7 = List.GetItemAtIndex(list=instance_of_aluminium_feather, index=code_block_4.out10)
class_timber_rachis = Python()  # CPython3; unwired: IN[0]
# ---------- class_timber_rachis.python (21 lines) ----------
# Load the Python Standard and DesignScript Libraries
import sys
import clr
clr.AddReference('ProtoGeometry')
from Autodesk.DesignScript.Geometry import *

class Timber_Rachis:
    def __init__(self, bottom_point, top_point, radius):
        self.bottom = bottom_point
        self.top = top_point
        self.radius = radius
        self.volume = None
        
    def make_geometry(self):
        cone = Cone.ByPointsRadius(self.top, self.bottom, self.radius)
        volume = cone.Volume
        self.volume = volume
        return cone
        

OUT = Timber_Rachis
# ----------------------------------------
mid_wing_curve = NurbsCurve.ByPoints(points=mid_wing_point_guide)
mid_curve_rachis_points = Curve.PointAtParameter(curve=mid_wing_curve, param=holy_spacing_sequence_do_not)
upper_curve_rachis_points = Curve.PointAtParameter(curve=upper_wing_curve, param=holy_spacing_sequence_do_not)
rachis_radius = DoubleSlider(50, range=10..100 step 5)
series_of_instances_of_timber = Python(IN[0]=class_timber_rachis, IN[1]=mid_curve_rachis_points, IN[2]=upper_curve_rachis_points, IN[3]=rachis_radius)  # "Series of Instances of Timber Rachis"; CPython3
# ---------- series_of_instances_of_timber.python (25 lines) ----------
# Load the Python Standard and DesignScript Libraries
import sys
import clr
clr.AddReference('ProtoGeometry')
from Autodesk.DesignScript.Geometry import *

Timber_Rachis = IN[0]
bottom_points = IN[1]
top_points = IN[2]
radius = IN[3]

rachises = []
rachises_volume = []

for i in range(len(top_points)):
    bot = bottom_points[i]
    top = top_points[i]
    
    rachis = Timber_Rachis(bot, top, radius)
    rachises.append(rachis.make_geometry())
    rachises_volume.append(rachis.volume)
    
total_material_volume = sum(rachises_volume)

OUT = [rachises, total_material_volume]
# ----------------------------------------
getItemAtIndex_8 = List.GetItemAtIndex(list=series_of_instances_of_timber, index=upper_wing_point_guide.out9)
instance_of_timber_rachis = Python(IN[0]=class_timber_rachis, IN[1]=code_block_4.T8, IN[2]=code_block_4.T7, IN[3]=rachis_radius)  # CPython3
# ---------- instance_of_timber_rachis.python (24 lines) ----------
# Load the Python Standard and DesignScript Libraries
import sys
import clr
clr.AddReference('ProtoGeometry')
from Autodesk.DesignScript.Geometry import *

Timber_Rachis = IN[0]
bottom_points = IN[1]
top_points = IN[2]
radius = IN[3]

rachises = []
rachises_volume = []

bot = bottom_points
top = top_points

rachis = Timber_Rachis(bot, top, radius)
rachises.append(rachis.make_geometry())
rachises_volume.append(rachis.volume)

total_material_volume = sum(rachises_volume)

OUT = [rachises, total_material_volume]
# ----------------------------------------
getItemAtIndex_9 = List.GetItemAtIndex(list=instance_of_timber_rachis, index=code_block_4.out10)
class_steel_swept_cylinder = Python()  # CPython3; unwired: IN[0]
# ---------- class_steel_swept_cylinder.python (30 lines) ----------
# Load the Python Standard and DesignScript Libraries
import sys
import clr
clr.AddReference('ProtoGeometry')
from Autodesk.DesignScript.Geometry import *

class Steel_Bone:
    def __init__(self, curve, radius):
        self.curve = curve
        self.radius = radius
        self.volume = None
        
    def make_geometry(self):
        
        start = self.curve.StartPoint
        end = self.curve.EndPoint
        tangent = self.curve.TangentAtParameter(0)
        plane = Plane.ByOriginNormal(start, tangent)
        cross_section = Circle.ByPlaneRadius(plane, self.radius)
        tube = Solid.BySweep(cross_section, self.curve, False)
        
        start_ball = Sphere.ByCenterPointRadius(start, self.radius)
        end_ball = Sphere.ByCenterPointRadius(end, self.radius)
        solid = Solid.ByUnion([tube, start_ball, end_ball])
        
        volume = solid.Volume
        self.volume = volume
        return solid
        
OUT = Steel_Bone
# ----------------------------------------
rachis_radius_2 = DoubleSlider(70, range=50..100 step 5)
instance_1_of_steel_swept = Python(IN[0]=class_steel_swept_cylinder, IN[1]=upper_wing_curve, IN[2]=rachis_radius_2)  # "Instance (1) of Steel Swept Cylinder"; CPython3
# ---------- instance_1_of_steel_swept.python (18 lines) ----------
# Load the Python Standard and DesignScript Libraries
import sys
import clr
clr.AddReference('ProtoGeometry')
from Autodesk.DesignScript.Geometry import *

Steel_Bone = IN[0]
curve = IN[1]
radius = IN[2]

bones = []
bones_volume = []

bone = Steel_Bone(curve, radius)
bones.append(bone.make_geometry())
bones_volume.append(bone.volume)

OUT = [bones, bones_volume]
# ----------------------------------------
getItemAtIndex_10 = List.GetItemAtIndex(list=instance_1_of_steel_swept, index=upper_wing_point_guide.out9)
ground_curve_not_a_class = Python(IN[0]=lower_wing_point_guide.out8)  # CPython3
# ---------- ground_curve_not_a_class.python (19 lines) ----------
# Load the Python Standard and DesignScript Libraries
import sys
import clr
clr.AddReference('ProtoGeometry')
from Autodesk.DesignScript.Geometry import *

point_list = IN[0]
new_points = []

for i in range(len(point_list)):
    floating = point_list[i]
    
    new_z = floating.Z * 0
    new_point = Point.ByCoordinates(floating.X, floating.Y, new_z)
    new_points.append(new_point)
     
zero_curve = NurbsCurve.ByPoints(new_points)

OUT = zero_curve
# ----------------------------------------
instance_2_of_steel_curved = Python(IN[0]=class_steel_swept_cylinder, IN[1]=ground_curve_not_a_class, IN[2]=lower_wing_point_guide.out9)  # "Instance (2) of Steel Curved Cylinder"; CPython3
# ---------- instance_2_of_steel_curved.python (18 lines) ----------
# Load the Python Standard and DesignScript Libraries
import sys
import clr
clr.AddReference('ProtoGeometry')
from Autodesk.DesignScript.Geometry import *

Timber_Bone = IN[0]
curve = IN[1]
radius = IN[2]

bones = []
bones_volume = []

bone = Timber_Bone(curve, radius)
bones.append(bone.make_geometry())
bones_volume.append(bone.volume)

OUT = [bones, bones_volume]
# ----------------------------------------
getItemAtIndex_11 = List.GetItemAtIndex(list=instance_2_of_steel_curved, index=upper_wing_point_guide.out9)
volume_sum_not_a_class = Python(IN[0]=getItemAtIndex_10, IN[1]=getItemAtIndex_11)  # CPython3
# ---------- volume_sum_not_a_class.python (12 lines) ----------
# Load the Python Standard and DesignScript Libraries
import sys
import clr
clr.AddReference('ProtoGeometry')
from Autodesk.DesignScript.Geometry import *

volume1 = IN[0][0]
volume2 = IN[1][0]

total_volume = volume1 + volume2

OUT = total_volume
# ----------------------------------------
volumes_accounting_for_mirrored = CodeBlock(Al=getItemAtIndex_4, Tail=getItemAtIndex_7, Tim=getItemAtIndex_8, TailR=getItemAtIndex_9, St=volume_sum_not_a_class) { Al_volume = Al*2 + Tail; Tim_volume = Tim*2 + TailR; St_volume = St*2; }  # "Volumes accounting for mirrored side too"

# group: Total Material Volumes in mm^3
total_aluminium_volume_mm_3 = Watch(volumes_accounting_for_mirrored.Al_volume)
total_timber_volume_mm_3 = Watch(volumes_accounting_for_mirrored.Tim_volume)
total_steel_volume_mm_3 = Watch(volumes_accounting_for_mirrored.St_volume)

getItemAtIndex_12 = List.GetItemAtIndex(list=series_of_instances_of_timber, index=upper_wing_point_guide.out8)
mirror_4 = Geometry.Mirror(geometry=getItemAtIndex_12, mirrorPlane=YZ)
trial_wing_point_guide = CodeBlock()
# ---------- trial_wing_point_guide.designscript (8 lines) ----------
W1 = Point.ByCoordinates(-3000, 2000, 500);
W2 = Point.ByCoordinates(-3000,0, 500);
W3 = Point.ByCoordinates(-3250, 1000, 500);
W5 = Point.ByCoordinates(-2750, 1000, 500);
W4 = Point.ByCoordinates(-3000, 1000, 500);

Point.ByCoordinates(-5000, -5000, 0);
Point.ByCoordinates(5000, 5000, 5000);
# ----------------------------------------

# group: Checker Box to make sure nothing is outside the ground domain (turn it on and look to see if anything is poking out of the yellow box)
byCorners_2 = Cuboid.ByCorners(lowPoint=trial_wing_point_guide.out5, highPoint=trial_wing_point_guide.out6)
color_palette = ColorPalette({R: 255, G: 192, B: 0, A: 255})
byGeometryColor_2 = Modifiers.GeometryColor.ByGeometryColor(geometry=byCorners_2, color=color_palette)

getItemAtIndex_13 = List.GetItemAtIndex(list=instance_1_of_steel_swept, index=upper_wing_point_guide.out8)
mirror_5 = Geometry.Mirror(geometry=getItemAtIndex_13, mirrorPlane=YZ)
