# Dynamo graph 1849675.dyn (Dynamo 3.6.0.9395)

# group: Don't touch this ground
code_block = CodeBlock { -5000; -5000; -200; }
byCoordinates = Point.ByCoordinates(x=code_block.out0, y=code_block.out1, z=code_block.out2)
code_block_2 = CodeBlock { 5000; 5000; 0; }
byCoordinates_2 = Point.ByCoordinates(x=code_block_2.out0, y=code_block_2.out1, z=code_block_2.out2)
byCorners = Cuboid.ByCorners(lowPoint=byCoordinates, highPoint=byCoordinates_2)
code_block_3 = CodeBlock { 0; 100; 0; }
byARGB = Color.ByARGB(red=code_block_3.out0, green=code_block_3.out1, blue=code_block_3.out2)
byGeometryColor = Modifiers.GeometryColor.ByGeometryColor(geometry=byCorners, color=byARGB)

amount_of_steel_circular_rods = DoubleSlider(17, range=8..17 step 1)
height_of_steel_circular_rods = DoubleSlider(5400, range=4000..8000 step 100)
steel_circular_rod_radius = DoubleSlider(200, range=100..200 step 5)

# group: Steel Rods > Short Steel Rods
code_block_4 = CodeBlock { -4000; 16; 500; }
sequence = Sequence(start=code_block_4.out0, amount=amount_of_steel_circular_rods, step=code_block_4.out2)
code_block_5 = CodeBlock { -4000; 16; 0; }
sequence_2 = Sequence(start=code_block_5.out0, amount=amount_of_steel_circular_rods, step=code_block_5.out2)
code_block_6 = CodeBlock { 0; 16; 0; }
sequence_3 = Sequence(start=code_block_6.out0, amount=amount_of_steel_circular_rods, step=code_block_6.out2)
byCoordinates_3 = Point.ByCoordinates(x=sequence, y=sequence_2, z=sequence_3)
code_block_7 = CodeBlock { -4000; 16; 500; }
sequence_4 = Sequence(start=code_block_7.out0, amount=amount_of_steel_circular_rods, step=code_block_7.out2)
code_block_8 = CodeBlock { -4000; 16; 0; }
sequence_5 = Sequence(start=code_block_8.out0, amount=amount_of_steel_circular_rods, step=code_block_8.out2)
code_block_9 = CodeBlock { 8000; 16; 0; }
sequence_6 = Sequence(start=height_of_steel_circular_rods, amount=amount_of_steel_circular_rods, step=code_block_9.out2)
byCoordinates_4 = Point.ByCoordinates(x=sequence_4, y=sequence_5, z=sequence_6)
code_block_10 = CodeBlock { 200; 16; 0; }
sequence_7 = Sequence(start=steel_circular_rod_radius, amount=amount_of_steel_circular_rods, step=code_block_10.out2)
class_steel_circular_rod = Python()  # CPython3; unwired: IN[0]
# ---------- class_steel_circular_rod.python (22 lines) ----------
# Load the Python Standard and DesignScript Libraries
import sys
import clr
import math
clr.AddReference('ProtoGeometry')
from Autodesk.DesignScript.Geometry import *

class CircularRod:
    def __init__(self, bottom_point, top_point, radius):
        self.bottom = bottom_point
        self.top = top_point
        self.radius = radius
        
    def make_geometry(self):
        return Cylinder.ByPointsRadius(self.bottom, self.top, self.radius)
       
    def volume(self):
        height = self.bottom.DistanceTo(self.top)
        return math.pi * self.radius**2 * height

OUT = CircularRod
 
# ----------------------------------------
series_of_steel_circular_rods = Python(IN[0]=byCoordinates_3, IN[1]=byCoordinates_4, IN[2]=sequence_7, IN[3]=class_steel_circular_rod)  # CPython3
# ---------- series_of_steel_circular_rods.python (20 lines) ----------
CircularRod = IN[3]
bottom_points = IN[0]
top_points = IN[1]
radii = IN[2]

# Calculate height from second items

rods = []

counter = min(len(bottom_points), len(top_points))

for i in range(counter):
    r = radii[i] if i < len(radii) else radii[-1]
    btm = bottom_points[i]
    top = top_points[i]

    rod = CircularRod(btm, top, r)
    rods.append(rod.make_geometry())

OUT = rods
# ----------------------------------------

amount_of_steel_circular_rods_2 = DoubleSlider(17, range=8..20 step 1)
height_of_steel_circular_rods_2 = DoubleSlider(8000, range=4000..8000 step 100)
steel_circular_rod_radius_2 = DoubleSlider(200, range=100..200 step 5)

# group: Steel Rods
code_block_11 = CodeBlock { -4000; 16; 500; }
sequence_8 = Sequence(start=code_block_11.out0, amount=amount_of_steel_circular_rods_2, step=code_block_11.out2)
code_block_12 = CodeBlock { 4000; 16; 0; }
sequence_9 = Sequence(start=code_block_12.out0, amount=amount_of_steel_circular_rods_2, step=code_block_12.out2)
code_block_13 = CodeBlock { 0; 16; 0; }
sequence_10 = Sequence(start=code_block_13.out0, amount=amount_of_steel_circular_rods_2, step=code_block_13.out2)
byCoordinates_5 = Point.ByCoordinates(x=sequence_8, y=sequence_9, z=sequence_10)
code_block_14 = CodeBlock { -4000; 16; 500; }
sequence_11 = Sequence(start=code_block_14.out0, amount=amount_of_steel_circular_rods_2, step=code_block_14.out2)
code_block_15 = CodeBlock { 4000; 16; 0; }
sequence_12 = Sequence(start=code_block_15.out0, amount=amount_of_steel_circular_rods_2, step=code_block_15.out2)
code_block_16 = CodeBlock { 8000; 16; 0; }
sequence_13 = Sequence(start=height_of_steel_circular_rods_2, amount=amount_of_steel_circular_rods_2, step=code_block_16.out2)
byCoordinates_6 = Point.ByCoordinates(x=sequence_11, y=sequence_12, z=sequence_13)
code_block_17 = CodeBlock { 200; 16; 0; }
sequence_14 = Sequence(start=steel_circular_rod_radius_2, amount=amount_of_steel_circular_rods_2, step=code_block_17.out2)
series_of_steel_circular_rods_2 = Python(IN[0]=byCoordinates_5, IN[1]=byCoordinates_6, IN[2]=sequence_14, IN[3]=class_steel_circular_rod)  # CPython3; same code as series_of_steel_circular_rods
volume_of_short_cylinders = Python(IN[0]=byCoordinates_3, IN[1]=byCoordinates_4, IN[2]=sequence_7, IN[3]=class_steel_circular_rod)  # CPython3
# ---------- volume_of_short_cylinders.python (20 lines) ----------
CircularRod = IN[3]
bottom_points = IN[0]
top_points = IN[1]
radii = IN[2]

volumes = []

counter = min(len(bottom_points), len(top_points))

for i in range(counter):
    r = radii[i] if i < len(radii) else radii[-1]
    btm = bottom_points[i]
    top = top_points[i]

    rod = CircularRod(btm, top, r)
    volumes.append(rod.volume())
    
total_volume = sum(volumes)

OUT = total_volume
# ----------------------------------------
volume_of_short_cylinders_2 = Watch(volume_of_short_cylinders)
volume_of_tall_cylinders = Python(IN[0]=byCoordinates_5, IN[1]=byCoordinates_6, IN[2]=sequence_14, IN[3]=class_steel_circular_rod)  # CPython3; same code as volume_of_short_cylinders
volume_of_tall_cylinders_2 = Watch(volume_of_tall_cylinders)
total_steel_rod_volume = Python(IN[0]=volume_of_short_cylinders_2, IN[1]=volume_of_tall_cylinders_2)  # CPython3
# ---------- total_steel_rod_volume.python (5 lines) ----------
# Load the Python Standard and DesignScript Libraries
import sys
import clr

OUT = IN[0] + IN[1]
# ----------------------------------------

total_volume_of_steel_rods_mm_3 = Watch(total_steel_rod_volume)
thickness_of_the_glass = DoubleSlider(25.2, range=0..100 step 0.1)

# group: Glass Panel
code_block_18 = CodeBlock { -4500; 4500; 7000; }
byCoordinates_7 = Point.ByCoordinates(x=code_block_18.out0, y=code_block_18.out1, z=code_block_18.out2)
code_block_19 = CodeBlock { 4500; 4500; 7000; }
byCoordinates_8 = Point.ByCoordinates(x=code_block_19.out0, y=code_block_19.out1, z=code_block_19.out2)
code_block_20 = CodeBlock { -4500; -4500; 4500; }
byCoordinates_9 = Point.ByCoordinates(x=code_block_20.out0, y=code_block_20.out1, z=code_block_20.out2)
code_block_21 = CodeBlock { 4500; -4500; 4500; }
byCoordinates_10 = Point.ByCoordinates(x=code_block_21.out0, y=code_block_21.out1, z=code_block_21.out2)
list_create = List.Create(item0=byCoordinates_7, item1=byCoordinates_8, item2=byCoordinates_9, item3=byCoordinates_10)
glass_panel_class_and_instance = Python(IN[0]=list_create, IN[1]=thickness_of_the_glass)  # CPython3
# ---------- glass_panel_class_and_instance.python (34 lines) ----------
import clr
clr.AddReference('ProtoGeometry')
from Autodesk.DesignScript.Geometry import *
import math

points = IN[0]
thickness = IN[1]

# Flatten points if nested
flat_pts = []
for p in points:
    if isinstance(p, list):
        flat_pts.extend(p)
    else:
        flat_pts.append(p)

if len(flat_pts) != 4:
    raise ValueError("Exactly 4 points required.")

# Sort points counter-clockwise
cx = sum(p.X for p in flat_pts) / 4.0
cy = sum(p.Y for p in flat_pts) / 4.0
sorted_pts = sorted(flat_pts, key=lambda p: math.atan2(p.Y - cy, p.X - cx))
loop = sorted_pts + [sorted_pts[0]]

# Create geometry
boundary = PolyCurve.ByPoints(loop)
if isinstance(boundary, list): boundary = boundary[0]
surf = Surface.ByPatch(boundary)
if isinstance(surf, list): surf = surf[0]
solid = surf.Thicken(float(thickness), True)

# Output
OUT = (solid, sorted_pts, float(thickness))
# ----------------------------------------
volume_of_the_glass_panel = Python(IN[0]=glass_panel_class_and_instance)  # CPython3
# ---------- volume_of_the_glass_panel.python (29 lines) ----------
import clr
clr.AddReference('ProtoGeometry')
from Autodesk.DesignScript.Geometry import *

# IN[0] -> tuple from Instance Node: (solid, points, thickness)
data = IN[0]

if data is None:
    OUT = "Error: input is None"
else:
    solid, points, thickness = data

    # Assign points
    p0, p1, p2, p3 = points

    # Create vectors for triangles
    v0 = Vector.ByTwoPoints(p0, p1)
    v1 = Vector.ByTwoPoints(p0, p2)
    tri1 = 0.5 * Vector.Cross(v0, v1).Length

    v2 = Vector.ByTwoPoints(p0, p2)
    v3 = Vector.ByTwoPoints(p0, p3)
    tri2 = 0.5 * Vector.Cross(v2, v3).Length

    # Compute area and volume
    area = tri1 + tri2
    volume = area * thickness

    OUT = volume
# ----------------------------------------

volume_of_the_glass_panel_mm_3 = Watch(volume_of_the_glass_panel)
