# Dynamo graph 1849699.dyn (Dynamo 3.6.0.9395)

# group: Don't touch this ground
code_block = CodeBlock { -5000; -5000; -200; }
byCoordinates = Point.ByCoordinates(x=code_block.out0, y=code_block.out1, z=code_block.out2)
code_block_2 = CodeBlock { 5000; 5000; 0; }
byCoordinates_2 = Point.ByCoordinates(x=code_block_2.out0, y=code_block_2.out1, z=code_block_2.out2)
byCorners = Cuboid.ByCorners(lowPoint=byCoordinates, highPoint=byCoordinates_2)
code_block_3 = CodeBlock { 0; 100; 0; }
byARGB = Color.ByARGB(red=code_block_3.out0, green=code_block_3.out1, blue=code_block_3.out2)
byGeometryColor = Modifiers.GeometryColor.ByGeometryColor(geometry=byCorners, color=byARGB)

initial_point_base_1 = CodeBlock { 0; 0; -25; }
center_point_surface_trace_1 = Point.ByCoordinates(x=initial_point_base_1.out0, y=initial_point_base_1.out1, z=initial_point_base_1.out2)
radius_start_angle_and_end_angle = CodeBlock { 4875; 0; 90; }
code_block_4 = CodeBlock { 0; 0; 1; }
byCoordinates_3 = Vector.ByCoordinates(x=code_block_4.out0, y=code_block_4.out1, z=code_block_4.out2)
support_surface_trace_1 = Arc.ByCenterPointRadiusAngle(center=center_point_surface_trace_1, radius=radius_start_angle_and_end_angle.out0, startAngle=radius_start_angle_and_end_angle.out1, endAngle=radius_start_angle_and_end_angle.out2, normal=byCoordinates_3)
number_of_columns = DoubleSlider(5, range=5..20 step 1)
code_block_5 = CodeBlock(n=number_of_columns) { n; 0..1..#n+1; }
support_surface_trace_1_support = Curve.PointAtParameter(curve=support_surface_trace_1, param=code_block_5.out1)  # "Support Surface Trace 1 Support Points"
point_output_surface_trace_1 = Watch(support_surface_trace_1_support)
initial_point_base_2 = CodeBlock { 0; 0; -25; }
center_point_surface_trace_2 = Point.ByCoordinates(x=initial_point_base_2.out0, y=initial_point_base_2.out1, z=initial_point_base_2.out2)
radius_start_angle_and_end_angle_2 = CodeBlock { 4875; 180; 270; }
normal_vector_components = CodeBlock { 0; 0; 1; }
surface_trace_2_normal_vector = Vector.ByCoordinates(x=normal_vector_components.out0, y=normal_vector_components.out1, z=normal_vector_components.out2)
support_surface_trace_2 = Arc.ByCenterPointRadiusAngle(center=center_point_surface_trace_2, radius=radius_start_angle_and_end_angle_2.out0, startAngle=radius_start_angle_and_end_angle_2.out1, endAngle=radius_start_angle_and_end_angle_2.out2, normal=surface_trace_2_normal_vector)
code_block_6 = CodeBlock(n=number_of_columns) { n; 0..1..#n+1; }
support_trace_2_support_points = Curve.PointAtParameter(curve=support_surface_trace_2, param=code_block_6.out1)
point_output_surface_trace_2 = Watch(support_trace_2_support_points)
center_point_column_arc_1 = CodeBlock { 0; 0; 5000; }
center_point_roof_trace_1 = Point.ByCoordinates(x=center_point_column_arc_1.out0, y=center_point_column_arc_1.out1, z=center_point_column_arc_1.out2)
radius_start_angle_and_end_angle_3 = CodeBlock { 3875; 0; 90; }
roof_trace_2_normal_components = CodeBlock { 0; 0; 1; }
roof_trace_2_normal_vector = Vector.ByCoordinates(x=roof_trace_2_normal_components.out0, y=roof_trace_2_normal_components.out1, z=roof_trace_2_normal_components.out2)
support_roof_trace_1 = Arc.ByCenterPointRadiusAngle(center=center_point_roof_trace_1, radius=radius_start_angle_and_end_angle_3.out0, startAngle=radius_start_angle_and_end_angle_3.out1, endAngle=radius_start_angle_and_end_angle_3.out2, normal=roof_trace_2_normal_vector)
code_block_7 = CodeBlock(n=number_of_columns) { n; 0..1..#n+1; }
support_roof_trace_1_support = Curve.PointAtParameter(curve=support_roof_trace_1, param=code_block_7.out1)  # "Support Roof Trace 1 Support Points"
point_output_roof_trace_1 = Watch(support_roof_trace_1_support)
radius_start_angle_and_end_angle_4 = CodeBlock { 3875; 180; 270; }
support_roof_trace_2 = Arc.ByCenterPointRadiusAngle(center=center_point_roof_trace_1, radius=radius_start_angle_and_end_angle_4.out0, startAngle=radius_start_angle_and_end_angle_4.out1, endAngle=radius_start_angle_and_end_angle_4.out2, normal=roof_trace_2_normal_vector)
code_block_8 = CodeBlock(n=number_of_columns) { n; 0..1..#n+1; }
pointAtParameter = Curve.PointAtParameter(curve=support_roof_trace_2, param=code_block_8.out1)
point_output_roof_trace_2 = Watch(pointAtParameter)
code_block_9 = CodeBlock { 0; 0; 5000; }
bottom_center_point = Point.ByCoordinates(x=code_block_9.out0, y=code_block_9.out1, z=code_block_9.out2)
code_block_10 = CodeBlock { 0; 0; }
bottom_cone_depth = IntegerSlider(4000, range=3850..4250 step 25)
top_center_point = Point.ByCoordinates(x=code_block_10.out0, y=code_block_10.out1, z=bottom_cone_depth)
roof_radius = IntegerSlider(4750, range=4250..4750 step 50)
polycarbonate_discroof = Python()  # CPython3; unwired: IN[0]
# ---------- polycarbonate_discroof.python (17 lines) ----------
# Load the Python Standard and DesignScript Libraries
import sys
import clr
clr.AddReference('ProtoGeometry')
from Autodesk.DesignScript.Geometry import *

class DiscRoof:
    def __init__(self, base_point, top_point, radius):
        self.base = base_point
        self.top = top_point
        self.radius = radius
        
    def make_geometry(self):
        shape = Cone.ByPointsRadius(self.base, self.top, self.radius)
        return shape
        
OUT = DiscRoof
# ----------------------------------------
instance_of_discroof_inverted = Python(IN[0]=bottom_center_point, IN[1]=top_center_point, IN[2]=roof_radius, IN[3]=polycarbonate_discroof, IN[4]=bottom_cone_depth)  # "Instance of DiscRoof: Inverted Cone"; CPython3
# ---------- instance_of_discroof_inverted.python (11 lines) ----------
import math
pi_value = math.pi

DiscRoof = IN[3]
b = DiscRoof(IN[0], IN[1], IN[2])
radius = IN[2]
height = 5000 - IN[4]

volume = pi_value * (IN[2] ** 2) * height

OUT = b.make_geometry(), volume
# ----------------------------------------
inverted_cone = Watch(instance_of_discroof_inverted)
polycarbonate_volume_1 = List.LastItem(list=inverted_cone)
code_block_11 = CodeBlock { 0; 0; 5000; }
bottom_center_point_2 = Point.ByCoordinates(x=code_block_11.out0, y=code_block_11.out1, z=code_block_11.out2)
code_block_12 = CodeBlock { 0; 0; }
height_top_cone = IntegerSlider(5750, range=5500..6150 step 50)
byCoordinates_4 = Point.ByCoordinates(x=code_block_12.out0, y=code_block_12.out1, z=height_top_cone)
instance_of_discroof = Python(IN[0]=bottom_center_point_2, IN[1]=byCoordinates_4, IN[2]=roof_radius, IN[3]=polycarbonate_discroof, IN[4]=height_top_cone)  # CPython3
# ---------- instance_of_discroof.python (11 lines) ----------
import math
pi_value = math.pi

DiscRoof = IN[3]
b = DiscRoof(IN[0], IN[1], IN[2])
radius = IN[2]
height = IN[4] - 5000

volume = pi_value * (IN[2] ** 2) * height

OUT = b.make_geometry(), volume
# ----------------------------------------
cone = Watch(instance_of_discroof)
polycarbonate_volume_2 = List.LastItem(list=cone)
sum_pcrbn_volumes = Python(IN[0]=polycarbonate_volume_1, IN[1]=polycarbonate_volume_2)  # CPython3
# ---------- sum_pcrbn_volumes.python (6 lines) ----------
a = IN[0]
b = IN[1]

sum = a + b

OUT = sum
# ----------------------------------------
watch = Watch(sum_pcrbn_volumes)
cylinder_radius = DoubleSlider(125, range=125..150 step 1)
class_cylindrical_rod = Python()  # CPython3; unwired: IN[0]
# ---------- class_cylindrical_rod.python (17 lines) ----------
# Load the Python Standard and DesignScript Libraries
import sys
import clr
clr.AddReference('ProtoGeometry')
from Autodesk.DesignScript.Geometry import *

class CylindricalRod:
    def __init__(self, bottom_point, top_point, radius):
        self.bottom = bottom_point
        self.top = top_point
        self.radius = radius
        
    def make_geometry(self):
         shape = Cylinder.ByPointsRadius(self.bottom, self.top, self.radius)
         return shape
         
OUT = CylindricalRod
# ----------------------------------------
series_steel_cylindrical_rod_2 = Python(IN[0]=support_surface_trace_1_support, IN[1]=support_roof_trace_1_support, IN[2]=cylinder_radius, IN[3]=class_cylindrical_rod)  # CPython3
# ---------- series_steel_cylindrical_rod_2.python (34 lines) ----------
import math 
pi_value = math.pi

CylindricalRod = IN[3]
bottom_points = IN[0]
top_points = IN[1]
radii = IN[2]
height = 5025

rods = []
count = min(len(bottom_points),len(top_points))

for i in range(count):
    if isinstance(radii, list):
        if i < len(radii):
            r = radii[i]
        else:
            r = radii[len(radii) - 1]
    else:
        r = radii
 
    btm = bottom_points[i]
    top = top_points[i]


    
    rod = CylindricalRod(btm, top, r)

   
    rods.append(rod.make_geometry())

volume = pi_value * (IN[2] ** 2) * height

OUT = rods, volume
# ----------------------------------------
series_cylindrical_rod_2 = Watch(series_steel_cylindrical_rod_2)
steel_volume_2 = List.LastItem(list=series_cylindrical_rod_2)
series_steel_cylindrical_rod = Python(IN[0]=support_trace_2_support_points, IN[1]=pointAtParameter, IN[2]=cylinder_radius, IN[3]=class_cylindrical_rod)  # CPython3
# ---------- series_steel_cylindrical_rod.python (34 lines) ----------
import math 
pi_value = math.pi

CylindricalRod = IN[3]
bottom_points = IN[0]
top_points = IN[1]
radii = IN[2]
height = 5025

rods = []
count = min(len(bottom_points),len(top_points))

for i in range(count):
    if isinstance(radii, list):
        if i < len(radii):
            r = radii[i]
        else:
            r = radii[len(radii) - 1]
    else:
        r = radii
        
    btm = bottom_points[i]
    top = top_points[i]


    
    rod = CylindricalRod(btm, top, r)

   
    rods.append(rod.make_geometry())

volume = pi_value * (IN[2] ** 2) * height

OUT = rods, volume
# ----------------------------------------
series_cylindrical_rod_1 = Watch(series_steel_cylindrical_rod)
steel_volume_1 = List.LastItem(list=series_cylindrical_rod_1)
sum_steel_volumes = Python(IN[0]=steel_volume_2, IN[1]=steel_volume_1)  # CPython3; same code as sum_pcrbn_volumes
watch_2 = Watch(sum_steel_volumes)
