# Dynamo graph 1849775.dyn "Start (without the group) 1" (Dynamo 4.0.0.3277)

# group: Ground
code_block = CodeBlock { -5000; -5000; -200; }
byCoordinates = Point.ByCoordinates(x=code_block.out0, y=code_block.out1, z=code_block.out2)
code_block_2 = CodeBlock { 5000; 5000; 0; }
byCoordinates_2 = Point.ByCoordinates(x=code_block_2.out0, y=code_block_2.out1, z=code_block_2.out2)
byCorners = Cuboid.ByCorners(lowPoint=byCoordinates, highPoint=byCoordinates_2)
code_block_3 = CodeBlock { 0; 100; 0; }
byARGB = Color.ByARGB(red=code_block_3.out0, green=code_block_3.out1, blue=code_block_3.out2)
byGeometryColor = Modifiers.GeometryColor.ByGeometryColor(geometry=byCorners, color=byARGB)

# group: Ground Points
# Ground Points
gridXCount = DoubleSlider(4, range=3..20 step 1)
gridYCount = DoubleSlider(4, range=3..20 step 1)
xValues = CodeBlock(GridXCount=gridXCount)
# ---------- xValues.designscript (2 lines) ----------
/// code block 1
-5000..5000..#GridXCount;
# ----------------------------------------
yValues = CodeBlock(GridYCount=gridYCount)
# ---------- yValues.designscript (2 lines) ----------
/// code block 2
-5000..5000..#GridYCount;
# ----------------------------------------
bottom_points = Python(IN[0]=xValues, IN[1]=yValues)  # PythonNet3
# ---------- bottom_points.python (13 lines) ----------
import clr
clr.AddReference('ProtoGeometry')
from Autodesk.DesignScript.Geometry import Point

xs = IN[0]
ys = IN[1]

pts = []
for x in xs:
    for y in ys:
        pts.append(Point.ByCoordinates(x, y, 0))

OUT = pts
# ----------------------------------------

# group: Columns
height = DoubleSlider(8000, range=2000..10000 step 100)
column_radius = DoubleSlider(200, range=75..250 step 25)
steel_column_class = Python(IN[0]=height, IN[1]=column_radius)  # PythonNet3
# ---------- steel_column_class.python (23 lines) ----------
import clr
clr.AddReference('ProtoGeometry')
from Autodesk.DesignScript.Geometry import *

h = float(IN[0])   # height slider
r = float(IN[1])   # radius slider

# bottom & top centers
p0 = Point.ByCoordinates(0, 0, 0)
p1 = Point.ByCoordinates(0, 0, h)

# circles at bottom and top
c0 = Circle.ByCenterPointRadius(p0, r)
c1 = Circle.ByCenterPointRadius(p1, r)

# loft into a cylinder
cyl = Solid.ByLoft([c0, c1])

# calculate volume (mm³)
vol = cyl.Volume

# output both
OUT = cyl, vol
# ----------------------------------------
X = Point.X(point=bottom_points)
Y = Point.Y(point=bottom_points)
top_point = Point.ByCoordinates(x=X, y=Y, z=height)
number = DoubleInput(0)
getItemAtIndex = List.GetItemAtIndex(list=steel_column_class, index=number)
steel_column_instance = Python(IN[0]=bottom_points, IN[1]=top_point, IN[2]=column_radius, IN[3]=getItemAtIndex)  # PythonNet3
# ---------- steel_column_instance.python (25 lines) ----------
import clr
clr.AddReference('ProtoGeometry')
from Autodesk.DesignScript.Geometry import *

# Inputs
bottom_points = IN[0]     # list of Points
top_points    = IN[1]     # list of Points
radius        = float(IN[2])

cylinders = []
volumes = []

for b, t in zip(bottom_points, top_points):

    # circles exactly like your cylinder script
    c0 = Circle.ByCenterPointRadius(b, radius)
    c1 = Circle.ByCenterPointRadius(t, radius)

    # loft into the cylinder (your exact geometry)
    cyl = Solid.ByLoft([c0, c1])

    cylinders.append(cyl)
    volumes.append(cyl.Volume)

OUT = cylinders, volumes
# ----------------------------------------
getItemAtIndex_2 = List.GetItemAtIndex(list=steel_column_instance, index=number)
code_block_4 = CodeBlock { 255; 5; 96; 223; }
byARGB_2 = Color.ByARGB(alpha=code_block_4.out0, red=code_block_4.out1, green=code_block_4.out2, blue=code_block_4.out3)
byGeometryColor_2 = Modifiers.GeometryColor.ByGeometryColor(geometry=getItemAtIndex_2, color=byARGB_2)

# group: Roof
curvatureAmplitude = DoubleSlider(2000, range=0..2000 step 100)
concrete_roof_class = Python(IN[0]=bottom_points, IN[1]=gridXCount, IN[2]=gridYCount, IN[3]=curvatureAmplitude, IN[4]=height)  # PythonNet3
# ---------- concrete_roof_class.python (66 lines) ----------
import clr
clr.AddReference("ProtoGeometry")
from Autodesk.DesignScript.Geometry import *
import math

class SimpleRoofStructure:
    def __init__(self, pts, nx, ny, amp, base_height):
        self.pts = pts
        self.nx = int(nx)
        self.ny = int(ny)
        self.amp = float(amp)
        self.base_height = float(base_height)
        self.thickness = 400   
        self.solid = self.generate_geometry()

    def generate_geometry(self):
        pts = self.pts

        # Bounding rectangle
        xs = [p.X for p in pts]
        ys = [p.Y for p in pts]

        min_x, max_x = min(xs), max(xs)
        min_y, max_y = min(ys), max(ys)

        W = max_x - min_x
        D = max_y - min_y

      
        z1 = self.base_height + self.amp * 0.2
        z2 = self.base_height + self.amp * (self.nx / 20.0)
        z3 = self.base_height + self.amp * (self.ny / 20.0)
        z4 = self.base_height - self.amp * 0.2

        # Top surface corners (NOT flat)
        p1 = Point.ByCoordinates(min_x, min_y, z1)
        p2 = Point.ByCoordinates(max_x, min_y, z2)
        p3 = Point.ByCoordinates(max_x, max_y, z3)
        p4 = Point.ByCoordinates(min_x, max_y, z4)

        top_loop = PolyCurve.ByPoints([p1, p2, p3, p4, p1])

        # Bottom surface (flat)
        q1 = Point.ByCoordinates(min_x, min_y, min(z1,z2,z3,z4) - self.thickness)
        q2 = Point.ByCoordinates(max_x, min_y, min(z1,z2,z3,z4) - self.thickness)
        q3 = Point.ByCoordinates(max_x, max_y, min(z1,z2,z3,z4) - self.thickness)
        q4 = Point.ByCoordinates(min_x, max_y, min(z1,z2,z3,z4) - self.thickness)

        bottom_loop = PolyCurve.ByPoints([q1, q2, q3, q4, q1])

        # Loft into solid
        solid_roof = Solid.ByLoft([top_loop, bottom_loop])

        return solid_roof

    def compute_volume(self):
        return self.solid.Volume if self.solid else 0.0



Roof_Instance = SimpleRoofStructure(IN[0], IN[1], IN[2], IN[3], IN[4])

geometry_out = Roof_Instance.solid
volume_mm3 = Roof_Instance.compute_volume()

OUT = geometry_out, volume_mm3
# ----------------------------------------

# group: Volume
code_block_5 = CodeBlock(x=gridXCount, y=gridYCount) { x+y; }
number_2 = DoubleInput(1)
getItemAtIndex_3 = List.GetItemAtIndex(list=steel_column_class, index=number_2)
code_block_6 = CodeBlock(n=code_block_5, v=getItemAtIndex_3) { n*v; }
watch = Watch(code_block_6)
getItemAtIndex_4 = List.GetItemAtIndex(list=concrete_roof_class, index=number_2)
watch_2 = Watch(getItemAtIndex_4)
