# Dynamo graph 1850206.dyn (Dynamo 3.6.0.9395)

# group: Don't touch this ground
code_block = CodeBlock { -5000; -5000; -200; }
byCoordinates = Point.ByCoordinates(x=code_block.out0, y=code_block.out1, z=code_block.out2)
code_block_2 = CodeBlock { 5000; 5000; 0; }
byCoordinates_2 = Point.ByCoordinates(x=code_block_2.out0, y=code_block_2.out1, z=code_block_2.out2)
byCorners = Cuboid.ByCorners(lowPoint=byCoordinates, highPoint=byCoordinates_2)
code_block_3 = CodeBlock { 0; 100; 0; }
byARGB = Color.ByARGB(red=code_block_3.out0, green=code_block_3.out1, blue=code_block_3.out2)
byGeometryColor = Modifiers.GeometryColor.ByGeometryColor(geometry=byCorners, color=byARGB)

woden_arches_class = Python()  # CPython3; unwired: IN[0]
# ---------- woden_arches_class.python (86 lines) ----------
import clr
clr.AddReference('ProtoGeometry')
from Autodesk.DesignScript.Geometry import *
import math


class ArcCylinder(object):

    def __init__(self, center, arc_radius, arc_angle_deg, cylinder_radius, normal):
        self.center = center
        self.arc_radius = arc_radius
        self.arc_angle_deg = float(arc_angle_deg)
        self.cylinder_radius = cylinder_radius
        self.normal = normal.Normalized()

        self.arc = None
        self.profile = None
        self.solid = None

    def build_arc(self):

        p1 = Point.ByCoordinates(self.arc_radius, 0, 0)

        mid_angle = math.radians(self.arc_angle_deg / 2.0)
        p2 = Point.ByCoordinates(
            self.arc_radius * math.cos(mid_angle),
            self.arc_radius * math.sin(mid_angle),
            0
        )

        end_angle = math.radians(self.arc_angle_deg)
        p3 = Point.ByCoordinates(
            self.arc_radius * math.cos(end_angle),
            self.arc_radius * math.sin(end_angle),
            0
        )

        arc2d = Arc.ByThreePoints(p1, p2, p3)

        z = self.normal
        
        if abs(z.Dot(Vector.ZAxis())) > 0.99:
            x = Vector.XAxis()
        else:
            x = z.Cross(Vector.ZAxis()).Normalized()

        y = z.Cross(x).Normalized()

        cs = CoordinateSystem.ByOriginVectors(self.center, x, y, z)

        self.arc = arc2d.Transform(cs)

        return self.arc

    def build_profile(self):

        if not self.arc:
            self.build_arc()

        profile_normal = self.normal.Add(Vector.ByCoordinates(0,0,1)).Normalized()

        pl = Plane.ByOriginNormal(self.arc.StartPoint, profile_normal)
        self.profile = Circle.ByPlaneRadius(pl, self.cylinder_radius)

        return self.profile

    def build_solid(self):

        if not self.arc:
            self.build_arc()
        if not self.profile:
            self.build_profile()

        self.solid = Solid.BySweep(self.profile, self.arc)
        return self.solid

    def get_volume(self):
        if not self.solid:
            self.build_solid()
        return self.solid.Volume

    def create(self):
        return self.build_solid()


OUT = ArcCylinder
# ----------------------------------------
centre_point_of_wooden_arches = CodeBlock { 0; 0; 0; }
byCoordinates_3 = Point.ByCoordinates(x=centre_point_of_wooden_arches.out0, y=centre_point_of_wooden_arches.out1, z=centre_point_of_wooden_arches.out2)
cylindar_radius_support_arch = DoubleSlider(180, range=5..1000 step 5)
top_hole_radius = DoubleSlider(450, range=0..1000 step 50)
add = cylindar_radius_support_arch + top_hole_radius
number_of_arches = IntegerSlider(12, range=0..50 step 1)
maximum_overall_radius_of_wooden = DoubleSlider(4950, range=500..5000 step 50)  # "Maximum Overall Radius of Wooden Arches"
add_2 = maximum_overall_radius_of_wooden + top_hole_radius
sub = add_2 - add
arc_angle_degrees = DoubleSlider(-180, range=-180..0 step 1)
wooden_arches_series_of = Python(IN[0]=woden_arches_class, IN[1]=byCoordinates_3, IN[2]=add, IN[3]=number_of_arches, IN[4]=sub, IN[5]=arc_angle_degrees, IN[6]=cylindar_radius_support_arch)  # "Wooden Arches Series of Instances"; CPython3
# ---------- wooden_arches_series_of.python (42 lines) ----------
import clr
clr.AddReference('ProtoGeometry')
from Autodesk.DesignScript.Geometry import *
import math

ArcCylinder = IN[0]
path_center = IN[1]
path_radius = IN[2]
n_instances = IN[3]
arc_radius = IN[4]
arc_angle_deg = IN[5]
cylinder_radius = IN[6]

solids = []
volumes = []

for i in range(n_instances):

    angle = i * 2 * math.pi / n_instances

    x = path_center.X + path_radius * math.cos(angle)
    y = path_center.Y + path_radius * math.sin(angle)
    z = path_center.Z
    center_pt = Point.ByCoordinates(x, y, z)

    normal = Vector.ByTwoPoints(path_center, center_pt).Normalized()

    ac = ArcCylinder(
        center=center_pt,
        arc_radius=arc_radius,
        arc_angle_deg=arc_angle_deg,
        cylinder_radius=cylinder_radius,
        normal=normal
    )

    solid = ac.create()
    solids.append(solid)
    volumes.append(ac.get_volume())

total_volume = sum(volumes)

OUT = solids, total_volume
# ----------------------------------------
code_block_4 = CodeBlock { 1; }
getItemAtIndex = List.GetItemAtIndex(list=wooden_arches_series_of, index=code_block_4)
total_volume_of_wooden_arches_in = Watch(getItemAtIndex)  # "Total Volume of Wooden Arches in mm^3"
metal_benches_class = Python()  # CPython3; unwired: IN[0]
# ---------- metal_benches_class.python (19 lines) ----------
import clr
clr.AddReference('ProtoGeometry')
from Autodesk.DesignScript.Geometry import Point, Cuboid

class Bench:
    def __init__(self, base_point, height, depth, width):
        self.base_point = base_point
        self.height = height
        self.depth = depth
        self.width = width

    def make_geometry(self):
        cuboid = Cuboid.ByLengths(self.width, self.depth, self.height)
        return cuboid.Translate(self.base_point.X, self.base_point.Y, self.base_point.Z)

    def volume(self):
        return self.width * self.depth * self.height

OUT = Bench
# ----------------------------------------
base_point_of_bench_1 = CodeBlock { 0; -2000; 0; }
byCoordinates_4 = Point.ByCoordinates(x=base_point_of_bench_1.out0, y=base_point_of_bench_1.out1, z=base_point_of_bench_1.out2)
height_of_bench_1 = DoubleSlider(450, range=50..1000 step 5)
depth_of_bench_1 = DoubleSlider(610, range=50..2000 step 5)
width_of_bench_1 = DoubleSlider(5500, range=50..5500 step 5)
metal_bench_1_single_instance = Python(IN[0]=metal_benches_class, IN[1]=byCoordinates_4, IN[2]=height_of_bench_1, IN[3]=depth_of_bench_1, IN[4]=width_of_bench_1)  # CPython3
# ---------- metal_bench_1_single_instance.python (12 lines) ----------
Bench = IN[0]
base_point = IN[1]
height = IN[2]
depth = IN[3]
width = IN[4]

bench = Bench(base_point, height, depth, width)

geometry = bench.make_geometry()
volume = bench.volume()

OUT = geometry, volume
# ----------------------------------------
base_point_of_bench_2 = CodeBlock { 0; 2000; 0; }
byCoordinates_5 = Point.ByCoordinates(x=base_point_of_bench_2.out0, y=base_point_of_bench_2.out1, z=base_point_of_bench_2.out2)
height_of_bench_2 = DoubleSlider(450, range=50..1000 step 5)
depth_of_bench_2 = DoubleSlider(610, range=50..2000 step 5)
width_of_bench_2 = DoubleSlider(5500, range=50..9058 step 5)
metal_bench_2_single_instance = Python(IN[0]=metal_benches_class, IN[1]=byCoordinates_5, IN[2]=height_of_bench_2, IN[3]=depth_of_bench_2, IN[4]=width_of_bench_2)  # CPython3; same code as metal_bench_1_single_instance
add_3 = metal_bench_1_single_instance + metal_bench_2_single_instance
code_block_5 = CodeBlock { 1; }
getItemAtIndex_2 = List.GetItemAtIndex(list=add_3, index=code_block_5)
volume_of_metal_benches_in_mm_3 = Watch(getItemAtIndex_2)
