# Dynamo graph 1850215.dyn (Dynamo 3.6.0.9395)

# group: Don't touch this ground
code_block = CodeBlock { -5000; -5000; -200; }
byCoordinates = Point.ByCoordinates(x=code_block.out0, y=code_block.out1, z=code_block.out2)
code_block_2 = CodeBlock { 5000; 5000; 0; }
byCoordinates_2 = Point.ByCoordinates(x=code_block_2.out0, y=code_block_2.out1, z=code_block_2.out2)
byCorners = Cuboid.ByCorners(lowPoint=byCoordinates, highPoint=byCoordinates_2)
code_block_3 = CodeBlock { 0; 100; 0; }
byARGB = Color.ByARGB(red=code_block_3.out0, green=code_block_3.out1, blue=code_block_3.out2)
byGeometryColor = Modifiers.GeometryColor.ByGeometryColor(geometry=byCorners, color=byARGB)

# group: Sliders
post_top_location = DoubleSlider(3328.2, range=500..4450 step 0.1)
post_height = DoubleSlider(3959.7, range=0..10000 step 0.1)
radius_of_wooden_beaam = DoubleSlider(178, range=0..1000 step 0.1)
top_of_roof_height = DoubleSlider(6471.7, range=500..10000 step 0.1)
number_of_plates = IntegerSlider(15, range=1..30 step 1)
post_base_location = DoubleSlider(3119.8, range=500..4450 step 0.1)
post_base_z_top = DoubleSlider(305.8, range=0..1000 step 0.1)
radius_of_cone_bases = DoubleSlider(473.8, range=100..1000 step 0.1)
plateWidth = DoubleSlider(500, range=300..750 step 0.1)
plateHieght = DoubleSlider(42, range=0..100 step 0.1)

# group: Cone Supports (Not Included In material Volume Calculations)
post_1 = CodeBlock(x_loc=post_base_location) { x_loc; x = x_loc; y= x; }
post_base_z_bottom = CodeBlock { Z_bottom = 0; }
byCoordinates_3 = Point.ByCoordinates(x=post_1.x, y=post_1.y, z=post_base_z_bottom)
byCoordinates_4 = Point.ByCoordinates(x=post_1.x, y=post_1.y, z=post_base_z_top)
byPointsRadii = Cone.ByPointsRadii(startPoint=byCoordinates_3, endPoint=byCoordinates_4, startRadius=radius_of_cone_bases, endRadius=radius_of_wooden_beaam)
post_2 = CodeBlock(x_loc=post_base_location) { x_loc; x = x_loc; y= -x; }
byCoordinates_5 = Point.ByCoordinates(x=post_2.x, y=post_2.y, z=post_base_z_bottom)
byCoordinates_6 = Point.ByCoordinates(x=post_2.x, y=post_2.y, z=post_base_z_top)
byPointsRadii_2 = Cone.ByPointsRadii(startPoint=byCoordinates_5, endPoint=byCoordinates_6, startRadius=radius_of_cone_bases, endRadius=radius_of_wooden_beaam)
post_3 = CodeBlock(x_loc=post_base_location) { x_loc; x = -x_loc; y= -x; }
byCoordinates_7 = Point.ByCoordinates(x=post_3.x, y=post_3.y, z=post_base_z_bottom)
byCoordinates_8 = Point.ByCoordinates(x=post_3.x, y=post_3.y, z=post_base_z_top)
byPointsRadii_3 = Cone.ByPointsRadii(startPoint=byCoordinates_7, endPoint=byCoordinates_8, startRadius=radius_of_cone_bases, endRadius=radius_of_wooden_beaam)
post_4 = CodeBlock(x_loc=post_base_location) { x_loc; x = -x_loc; y= x; }
byCoordinates_9 = Point.ByCoordinates(x=post_4.x, y=post_4.y, z=post_base_z_bottom)
byCoordinates_10 = Point.ByCoordinates(x=post_4.x, y=post_4.y, z=post_base_z_top)
byPointsRadii_4 = Cone.ByPointsRadii(startPoint=byCoordinates_9, endPoint=byCoordinates_10, startRadius=radius_of_cone_bases, endRadius=radius_of_wooden_beaam)

# group: Poles and Supports (Made From Material 1)
post_1_2 = CodeBlock(x_loc=post_top_location) { x_loc; x = x_loc; y= x; }
byCoordinates_11 = Point.ByCoordinates(x=post_1_2.x, y=post_1_2.y, z=post_height)
post_2_2 = CodeBlock(x_loc=post_top_location) { x_loc; x = x_loc; y= -x; }
byCoordinates_12 = Point.ByCoordinates(x=post_2_2.x, y=post_2_2.y, z=post_height)
post_3_2 = CodeBlock(x_loc=post_top_location) { x_loc; x = -x_loc; y= -x; }
byCoordinates_13 = Point.ByCoordinates(x=post_3_2.x, y=post_3_2.y, z=post_height)
post_4_2 = CodeBlock(x_loc=post_top_location) { x_loc; x = -x_loc; y= x; }
byCoordinates_14 = Point.ByCoordinates(x=post_4_2.x, y=post_4_2.y, z=post_height)
center_location = CodeBlock(z_loc=top_of_roof_height) { z_loc; x = 0; y = 0; z = z_loc; }
center_of_supports = Point.ByCoordinates(x=center_location.x, y=center_location.y, z=center_location.z)
byStartPointEndPoint = Line.ByStartPointEndPoint(startPoint=byCoordinates_12, endPoint=center_of_supports)
wooden_beam_class = Python()  # CPython3; unwired: IN[0]
# ---------- wooden_beam_class.python (22 lines) ----------
import sys
import clr
clr.AddReference('ProtoGeometry')
from Autodesk.DesignScript.Geometry import *

class WoodenBeam:
    def __init__(self, centerline, radius):
        self.centerline = centerline
        self.radius = radius
    
    def endpoints(self):
        return self.centerline.StartPoint, self.centerline.EndPoint
    
    def make_geometry(self):
        end1, end2 = self.endpoints()
        
        return Cylinder.ByPointsRadius(end1,end2,self.radius)
    
    def measure_vol(self):
        end1, end2 = self.endpoints()
        return end1.DistanceTo(end2)*self.radius*self.radius*3.14
OUT = WoodenBeam          
# ----------------------------------------
pole3 = Line.ByStartPointEndPoint(startPoint=byCoordinates_10, endPoint=byCoordinates_14)
instance4 = Python(IN[0]=wooden_beam_class, IN[1]=pole3, IN[2]=radius_of_wooden_beaam)  # CPython3
# ---------- instance4.python (4 lines) ----------
WoodenBeam = IN[0]
WoodenB = WoodenBeam(IN[1],IN[2])

OUT = [WoodenB.make_geometry(), WoodenB.measure_vol()]
# ----------------------------------------
code_block_4 = CodeBlock(x=instance4) { x[0]; x[1]; }
code_block_5 = CodeBlock { x=255; y=150; z=75; t=0; }
byARGB_2 = Color.ByARGB(alpha=code_block_5.x, red=code_block_5.y, green=code_block_5.z, blue=code_block_5.t)
byGeometryColor_2 = Modifiers.GeometryColor.ByGeometryColor(geometry=code_block_4.out0, color=byARGB_2)
pole2 = Line.ByStartPointEndPoint(startPoint=byCoordinates_8, endPoint=byCoordinates_13)
instance3 = Python(IN[0]=wooden_beam_class, IN[1]=pole2, IN[2]=radius_of_wooden_beaam)  # CPython3; same code as instance4
code_block_6 = CodeBlock(x=instance3) { x[0]; x[1]; }
byGeometryColor_3 = Modifiers.GeometryColor.ByGeometryColor(geometry=code_block_6.out0, color=byARGB_2)
pole1 = Line.ByStartPointEndPoint(startPoint=byCoordinates_6, endPoint=byCoordinates_12)
instance2 = Python(IN[0]=wooden_beam_class, IN[1]=pole1, IN[2]=radius_of_wooden_beaam)  # CPython3; same code as instance4
code_block_7 = CodeBlock(x=instance2) { x[0]; x[1]; }
byGeometryColor_4 = Modifiers.GeometryColor.ByGeometryColor(geometry=code_block_7.out0, color=byARGB_2)
pole4 = Line.ByStartPointEndPoint(startPoint=byCoordinates_4, endPoint=byCoordinates_11)
instance1 = Python(IN[0]=wooden_beam_class, IN[1]=pole4, IN[2]=radius_of_wooden_beaam)  # CPython3; same code as instance4
code_block_8 = CodeBlock(x=instance1) { x[0]; x[1]; }
byGeometryColor_5 = Modifiers.GeometryColor.ByGeometryColor(geometry=code_block_8.out0, color=byARGB_2)
byStartPointEndPoint_2 = Line.ByStartPointEndPoint(startPoint=byCoordinates_11, endPoint=center_of_supports)
instance5 = Python(IN[0]=wooden_beam_class, IN[1]=byStartPointEndPoint_2, IN[2]=radius_of_wooden_beaam)  # CPython3; same code as instance4
code_block_9 = CodeBlock(x=instance5) { x[0]; x[1]; }
instance6 = Python(IN[0]=wooden_beam_class, IN[1]=byStartPointEndPoint, IN[2]=radius_of_wooden_beaam)  # CPython3; same code as instance4
code_block_10 = CodeBlock(x=instance6) { x[0]; x[1]; }
byStartPointEndPoint_3 = Line.ByStartPointEndPoint(startPoint=byCoordinates_13, endPoint=center_of_supports)
instance7 = Python(IN[0]=wooden_beam_class, IN[1]=byStartPointEndPoint_3, IN[2]=radius_of_wooden_beaam)  # CPython3; same code as instance4
code_block_11 = CodeBlock(x=instance7) { x[0]; x[1]; }
byStartPointEndPoint_4 = Line.ByStartPointEndPoint(startPoint=byCoordinates_14, endPoint=center_of_supports)
instance8 = Python(IN[0]=wooden_beam_class, IN[1]=byStartPointEndPoint_4, IN[2]=radius_of_wooden_beaam)  # CPython3; same code as instance4
code_block_12 = CodeBlock(x=instance8) { x[0]; x[1]; }
code_block_13 = CodeBlock { x=255; y=150; z=75; t=0; }
byARGB_3 = Color.ByARGB(alpha=code_block_13.x, red=code_block_13.y, green=code_block_13.z, blue=code_block_13.t)
byGeometryColor_6 = Modifiers.GeometryColor.ByGeometryColor(geometry=code_block_12.out0, color=byARGB_3)
byGeometryColor_7 = Modifiers.GeometryColor.ByGeometryColor(geometry=code_block_11.out0, color=byARGB_3)
byGeometryColor_8 = Modifiers.GeometryColor.ByGeometryColor(geometry=code_block_10.out0, color=byARGB_3)
byGeometryColor_9 = Modifiers.GeometryColor.ByGeometryColor(geometry=code_block_9.out0, color=byARGB_3)

# group: Spheres Use to Cover Gaps Between Poles and Supports (Not Included In material Volume Calculations)
byCenterPointRadius = Sphere.ByCenterPointRadius(centerPoint=byCoordinates_11, radius=radius_of_wooden_beaam)
byCenterPointRadius_2 = Sphere.ByCenterPointRadius(centerPoint=byCoordinates_13, radius=radius_of_wooden_beaam)
byCenterPointRadius_3 = Sphere.ByCenterPointRadius(centerPoint=byCoordinates_14, radius=radius_of_wooden_beaam)
byCenterPointRadius_4 = Sphere.ByCenterPointRadius(centerPoint=center_of_supports, radius=radius_of_wooden_beaam)

byCenterPointRadius_5 = Sphere.ByCenterPointRadius(centerPoint=byCoordinates_12, radius=radius_of_wooden_beaam)

# group: Steel Plates Rings (Made from Material 2)
code_block_14 = CodeBlock { x=0; y=0; }
code_block_15 = CodeBlock(n=number_of_plates) { n; 0..1..#n; }
reverse = List.Reverse(list=code_block_15.out1)
splitByParameter = Curve.SplitByParameter(curve=byStartPointEndPoint, parameters=reverse)
endPoint = Curve.EndPoint(curve=splitByParameter)
code_block_16 = CodeBlock(pts=endPoint) { pts.Z; }
addItemToFront = List.AddItemToFront(item=post_height, list=code_block_16)
byCoordinates_15 = Point.ByCoordinates(x=code_block_14.x, y=code_block_14.y, z=addItemToFront)
addItemToFront_2 = List.AddItemToFront(item=byCoordinates_12, list=endPoint)
code_block_17 = CodeBlock(pts=addItemToFront_2) { pts.X; }
code_block_18 = CodeBlock(x=code_block_17) { x; newx = Math.Pow(x,2); newestx = Math.Sqrt(2*newx); }
code_block_19 = CodeBlock { x= -1; }
dropItems = List.DropItems(list=code_block_18.newestx, amount=code_block_19)
byCenterPointRadius_6 = Circle.ByCenterPointRadius(centerPoint=byCoordinates_15, radius=dropItems)
steel_circular_plates_class = Python()  # CPython3; unwired: IN[0]
# ---------- steel_circular_plates_class.python (31 lines) ----------
import sys
import clr
clr.AddReference('ProtoGeometry')
from Autodesk.DesignScript.Geometry import *
import math

class SteelPlates:
    def __init__(self, start_point, outer_radius, inner_radius, height):
       
        self.start_point = start_point
        self.outer_radius = outer_radius
        self.inner_radius = inner_radius
        self.height = height
        
        self.end_point = Point.ByCoordinates(
            self.start_point.X,
            self.start_point.Y,
            self.start_point.Z + self.height
        )
        
        outer_cyl = Cylinder.ByPointsRadius(self.start_point, self.end_point, self.outer_radius)
        inner_cyl = Cylinder.ByPointsRadius(self.start_point, self.end_point, self.inner_radius)
        self.steel_plate = outer_cyl.Difference(inner_cyl)
    
    def get_plate(self):
        return self.steel_plate
    
    def calculate_volume(self):
        return math.pi * self.height * (self.outer_radius**2 - self.inner_radius**2)

OUT = SteelPlates
# ----------------------------------------
code_block_20 = CodeBlock(oldRad=dropItems, AddRad=plateWidth) { oldRad; AddRad; newRad = oldRad+AddRad; }
instance1_2 = Python(IN[0]=steel_circular_plates_class, IN[1]=byCoordinates_15, IN[2]=code_block_20.newRad, IN[3]=dropItems, IN[4]=plateHieght)  # CPython3
# ---------- instance1_2.python (15 lines) ----------
SteelPlatesClass = IN[0]
start_points = IN[1]
outer_radii = IN[2]
inner_radii = IN[3]
height = IN[4]

result_plates = []
plate_volumes = []

for start, outer, inner in zip(start_points, outer_radii, inner_radii):
    plate = SteelPlatesClass(start, outer, inner, height)
    result_plates.append(plate.get_plate())
    plate_volumes.append(plate.calculate_volume())
Volumes = sum(plate_volumes)
OUT = result_plates, Volumes
# ----------------------------------------

# group: Volumes of Materails in mm^3
code_block_21 = CodeBlock(Pole1=code_block_8.out1, Pole2=code_block_7.out1, Pole3=code_block_6.out1, Pole4=code_block_4.out1, Support1=code_block_9.out1, Support2=code_block_10.out1, Support3=code_block_11.out1, Support4=code_block_12.out1)
# ---------- code_block_21.designscript (10 lines) ----------
Pole1;
Pole2;
Pole3;
Pole4;

Support1;
Support2;
Support3;
Support4;
TotalVolMat1 = Pole1+Pole2+Pole3+Pole4+Support1+Support2+Support3+Support4;
# ----------------------------------------
material_1_in_mm_3 = Watch(code_block_21.TotalVolMat1)
code_block_22 = CodeBlock(x=instance1_2) { Volumes =x[1]; }
material_2_in_mm_3 = Watch(code_block_22)
