# Dynamo graph 1850278.dyn (Dynamo 4.0.0.3277)

# group: Don't touch this ground
code_block = CodeBlock { -5000; -5000; -200; }
byCoordinates = Point.ByCoordinates(x=code_block.out0, y=code_block.out1, z=code_block.out2)
code_block_2 = CodeBlock { 5000; 5000; 0; }
byCoordinates_2 = Point.ByCoordinates(x=code_block_2.out0, y=code_block_2.out1, z=code_block_2.out2)
byCorners = Cuboid.ByCorners(lowPoint=byCoordinates, highPoint=byCoordinates_2)
code_block_3 = CodeBlock { 0; 100; 0; }
byARGB = Color.ByARGB(red=code_block_3.out0, green=code_block_3.out1, blue=code_block_3.out2)
byGeometryColor = Modifiers.GeometryColor.ByGeometryColor(geometry=byCorners, color=byARGB)

number_slider = DoubleSlider(0, range=0..100 step 0.1)
numberOfCurves = PolyCurve.NumberOfCurves()  # unwired: polyCurve
numberOfCurves_2 = PolyCurve.NumberOfCurves()  # unwired: polyCurve
numberOfCurves_3 = PolyCurve.NumberOfCurves()  # unwired: polyCurve
numberOfCurves_4 = PolyCurve.NumberOfCurves()  # unwired: polyCurve
sheet_height = IntegerSlider(1000, range=-1200..1500 step 1)
byCoordinates_3 = Point.ByCoordinates(z=sheet_height)
sheet_coords = CodeBlock { 2000; 1500; }
byCoordinates_4 = Point.ByCoordinates(y=sheet_coords.out0, z=sheet_coords.out1)
sheet_coords_2 = CodeBlock { -4000; -1000; 1500; }
byCoordinates_5 = Point.ByCoordinates(x=sheet_coords_2.out0, y=sheet_coords_2.out1, z=sheet_coords_2.out2)
byThreePoints = Arc.ByThreePoints(firstPoint=byCoordinates_3, secondPoint=byCoordinates_4, thirdPoint=byCoordinates_5)
param = CodeBlock { 0..1..#48; }
pointAtParameter = Curve.PointAtParameter(curve=byThreePoints, param=param)
integer_slider = IntegerSlider(67, range=0..100 step 1)
z_translate = CodeBlock(n=integer_slider) { a = 0..15*n..#48; z = 2000-2000*Math.Cos(a); }
translate = Geometry.Translate(geometry=pointAtParameter, zTranslation=z_translate.z)
byPoints = NurbsCurve.ByPoints(points=translate)
param_2 = CodeBlock { 0.05..0.95..#128; }
pointAtParameter_2 = Curve.PointAtParameter(curve=byPoints, param=param_2)
rod_coords = CodeBlock { 5000; }
byCoordinates_6 = Point.ByCoordinates(x=rod_coords)
rod_coords_2 = CodeBlock { 2000; }
byCoordinates_7 = Point.ByCoordinates(z=rod_coords_2)
byCoordinates_8 = Point.ByCoordinates()
byThreePoints_2 = Arc.ByThreePoints(firstPoint=byCoordinates_6, secondPoint=byCoordinates_7, thirdPoint=byCoordinates_8)
pointAtParameter_3 = Curve.PointAtParameter(curve=byThreePoints_2)
byStartPointEndPoint = Line.ByStartPointEndPoint(startPoint=pointAtParameter_2, endPoint=pointAtParameter_3)
parameter = CodeBlock { 0.5; }
pointAtParameter_4 = Curve.PointAtParameter(curve=byStartPointEndPoint, param=parameter)
z_translation = CodeBlock { -500; }
translate_2 = Geometry.Translate(geometry=pointAtParameter_4, zTranslation=z_translation)
byThreePoints_3 = Arc.ByThreePoints(firstPoint=pointAtParameter_2, secondPoint=translate_2, thirdPoint=pointAtParameter_3)
planeAtParameter = Curve.PlaneAtParameter(curve=byThreePoints_3)
radius = IntegerSlider(100, range=0..200 step 1)
byPlaneRadius = Circle.ByPlaneRadius(plane=planeAtParameter, radius=radius)
bySweep = Solid.BySweep(profile=byPlaneRadius, path=byThreePoints_3)
planeAtParameter_2 = Curve.PlaneAtParameter(curve=byPoints)
radius_2 = IntegerSlider(150, range=0..200 step 1)
byPlaneRadius_2 = Circle.ByPlaneRadius(plane=planeAtParameter_2, radius=radius_2)
bySweep_2 = Solid.BySweep(profile=byPlaneRadius_2, path=byPoints)
metal_rod_coords = CodeBlock { 0; 0; 0; }
start_point = Point.ByCoordinates(x=metal_rod_coords.out0, y=metal_rod_coords.out1, z=metal_rod_coords.out2)
metal_rod_coords_2 = CodeBlock { 0; 0; 2200; }
end_point = Point.ByCoordinates(x=metal_rod_coords_2.out0, y=metal_rod_coords_2.out1, z=metal_rod_coords_2.out2)
radius_3 = DoubleSlider(130, range=0..200 step 0.1)
metalRod = Python()  # PythonNet3; unwired: IN[0]
# ---------- metalRod.python (17 lines) ----------
# Load the Python Standard and DesignScript Libraries
import sys
import clr
clr.AddReference('ProtoGeometry')
from Autodesk.DesignScript.Geometry import *

class MetalRod:
    def __init__(self, bottom_point,top_point, radius):
        self.bottom = bottom_point
        self.top = top_point
        self.radius = radius
        
        
    def make_geometry(self):
        return Cylinder.ByPointsRadius(self.bottom, self.top, self.radius)
        
OUT = MetalRod
# ----------------------------------------
metalrod_instance = Python(IN[0]=start_point, IN[1]=end_point, IN[2]=radius_3, IN[3]=metalRod)  # PythonNet3
# ---------- metalrod_instance.python (9 lines) ----------
MetalRodClass = IN[3]

bottom = IN[0]
top = IN[1]
radius = IN[2]

rod = MetalRodClass(bottom, top, radius)

OUT = rod.make_geometry()
# ----------------------------------------
vector_coords = CodeBlock { -1400; 3250; 0; }
byCoordinates_9 = Vector.ByCoordinates(x=vector_coords.out0, y=vector_coords.out1, z=vector_coords.out2)
translate_3 = Geometry.Translate(geometry=metalrod_instance, direction=byCoordinates_9)
metal_rod_coords_3 = CodeBlock { 0; 0; 0; }
start_point_2 = Point.ByCoordinates(x=metal_rod_coords_3.out0, y=metal_rod_coords_3.out1, z=metal_rod_coords_3.out2)
end_point_2 = CodeBlock { 0; 0; 3050; }
endpoint = Point.ByCoordinates(x=end_point_2.out0, y=end_point_2.out1, z=end_point_2.out2)
radius_4 = DoubleSlider(130, range=0..200 step 0.1)
metalRod_2 = Python()  # PythonNet3; unwired: IN[0]
# ---------- metalRod_2.python (24 lines) ----------
# Load the Python Standard and DesignScript Libraries
import sys
import clr
clr.AddReference('ProtoGeometry')
from Autodesk.DesignScript.Geometry import *

class MetalRod:
    def __init__(self, bottom_point,top_point, radius):
        self.bottom = bottom_point
        self.top = top_point
        self.radius = radius
        
        
    def make_geometry(self):
        return Cylinder.ByPointsRadius(self.bottom, self.top, self.radius)
        
    def volume(self):
        cyl = self.make_geometry()
        
        return cyl.Volume
    
    
        
OUT = MetalRod
# ----------------------------------------
metalrod_instance_2 = Python(IN[0]=start_point_2, IN[1]=endpoint, IN[2]=radius_4, IN[3]=metalRod_2)  # PythonNet3
# ---------- metalrod_instance_2.python (12 lines) ----------
MetalRodClass = IN[3]

bottom = IN[0]
top = IN[1]
radius = IN[2]

rod = MetalRodClass(bottom, top, radius)

OUT = [
    "Volume = {}".format(rod.volume()),
    rod.make_geometry()
]
# ----------------------------------------
vector_coords_2 = CodeBlock { -4005; -1005; 0; }
byCoordinates_10 = Vector.ByCoordinates(x=vector_coords_2.out0, y=vector_coords_2.out1, z=vector_coords_2.out2)
translate_4 = Geometry.Translate(geometry=metalrod_instance_2, direction=byCoordinates_10)
woodenRod = Python()  # PythonNet3; unwired: IN[0]
# ---------- woodenRod.python (24 lines) ----------
# Load the Python Standard and DesignScript Libraries
import sys
import clr
clr.AddReference('ProtoGeometry')
from Autodesk.DesignScript.Geometry import *

class WoodenRod:
    def __init__(self, bottom_point,top_point, radius):
        self.bottom = bottom_point
        self.top = top_point
        self.radius = radius
        
        
    def make_geometry(self):
        return Cylinder.ByPointsRadius(self.bottom, self.top, self.radius)
        
    def volume(self):
        cyl = self.make_geometry()
        
        return cyl.Volume
    
    
        
OUT = WoodenRod
# ----------------------------------------
woodenrod_coords = CodeBlock { 0; 0; 0; }
bottom = Point.ByCoordinates(x=woodenrod_coords.out0, y=woodenrod_coords.out1, z=woodenrod_coords.out2)
list_create = List.Create(item0=bottom)
woodenrod_coords_2 = CodeBlock { 0; 0; 2300; }
top = Point.ByCoordinates(x=woodenrod_coords_2.out0, y=woodenrod_coords_2.out1, z=woodenrod_coords_2.out2)
list_create_2 = List.Create(item0=top)
radius_5 = DoubleSlider(133.2, range=0..200 step 0.1)
list_create_3 = List.Create(item0=radius_5)
woodenrod_series = Python(IN[0]=woodenRod, IN[1]=list_create, IN[2]=list_create_2, IN[3]=list_create_3)  # PythonNet3
# ---------- woodenrod_series.python (24 lines) ----------
import clr
clr.AddReference("ProtoGeometry")
from Autodesk.DesignScript.Geometry import *

RodClass = IN[0]
bottom = IN[1]
top = IN[2]
radius = IN[3]


rods = []

count = min(len(bottom), len(top))

for i in range(count):
   rod = RodClass(bottom[i], top[i], radius[i])
    
   rods.append(rod.make_geometry())
    
OUT = [
    rods,
    "Volume = {}".format(rod.volume()),
    rod.make_geometry()
]
# ----------------------------------------
vector_coords_3 = CodeBlock { -4550; 1720; 0; }
byCoordinates_11 = Vector.ByCoordinates(x=vector_coords_3.out0, y=vector_coords_3.out1, z=vector_coords_3.out2)
translate_5 = Geometry.Translate(geometry=woodenrod_series, direction=byCoordinates_11)
watch = Watch(metalrod_instance_2)
watch_2 = Watch(woodenrod_series)
