# Dynamo graph 1850361.dyn (Dynamo 3.6.0.9395)

# group: Don't touch this ground
code_block = CodeBlock { -5000; -5000; -200; }  # frozen
byCoordinates = Point.ByCoordinates(x=code_block.out0, y=code_block.out1, z=code_block.out2)  # frozen
code_block_2 = CodeBlock { 5000; 5000; 0; }  # frozen
byCoordinates_2 = Point.ByCoordinates(x=code_block_2.out0, y=code_block_2.out1, z=code_block_2.out2)  # frozen
byCorners = Cuboid.ByCorners(lowPoint=byCoordinates, highPoint=byCoordinates_2)  # frozen
code_block_3 = CodeBlock { 0; 100; 0; }  # frozen
byARGB = Color.ByARGB(red=code_block_3.out0, green=code_block_3.out1, blue=code_block_3.out2)  # frozen
byGeometryColor = Modifiers.GeometryColor.ByGeometryColor(geometry=byCorners, color=byARGB)  # frozen

bottom_of_steel_rod = CodeBlock { -4400; -4400; 0; }
byCoordinates_3 = Point.ByCoordinates(x=bottom_of_steel_rod.out0, y=bottom_of_steel_rod.out1, z=bottom_of_steel_rod.out2)
top_of_steel_rod = CodeBlock { -4400; -4400; 5000; }
byCoordinates_4 = Point.ByCoordinates(x=top_of_steel_rod.out0, y=top_of_steel_rod.out1, z=top_of_steel_rod.out2)
front_left_corner_steel_rod = DoubleSlider(300, range=300..600 step 0.1)  # "Front left corner Steel rod radius"
class_circular_steel_rod = Python()  # CPython3; unwired: IN[0]
# ---------- class_circular_steel_rod.python (14 lines) ----------
# Load the Python Standard and DesignScript Libraries
import sys
import clr
clr.AddReference('ProtoGeometry')
from Autodesk.DesignScript.Geometry import *

class CircularRod:
    def __init__(self, bottom_p, top_p, R):
        self.bottom = bottom_p
        self.top = top_p
        self.radius = R
    def make_geometry(self):
        return Cylinder.ByPointsRadius(self.bottom, self.top, self.radius)
OUT = CircularRod
# ----------------------------------------
instance_of_a_circular_steel_rod = Python(IN[0]=byCoordinates_3, IN[1]=byCoordinates_4, IN[2]=front_left_corner_steel_rod, IN[3]=class_circular_steel_rod)  # CPython3
# ---------- instance_of_a_circular_steel_rod.python (3 lines) ----------
CircularRod = IN[3]
a = CircularRod(IN[0], IN[1], IN[2])
OUT = a.make_geometry()
# ----------------------------------------
code_block_4 = CodeBlock { -4400; 0; }
code_block_5 = CodeBlock { -4400; 5; 2200; }
sequence = Sequence(start=code_block_5.out0, amount=code_block_5.out1, step=code_block_5.out2)
byCoordinates_5 = Point.ByCoordinates(x=code_block_4.out0, y=sequence, z=code_block_4.out1)
code_block_6 = CodeBlock { -4400; 5000; }
byCoordinates_6 = Point.ByCoordinates(x=code_block_6.out0, y=sequence, z=code_block_6.out1)
code_block_7 = CodeBlock { 300; 50; }
thickness_of_supporting_steel = IntegerSlider(5, range=1..5 step 1)  # "Thickness of Supporting Steel Rods"
sequence_2 = Sequence(start=code_block_7.out0, amount=thickness_of_supporting_steel, step=code_block_7.out1)
series_of_instances_of_circular = Python(IN[0]=byCoordinates_5, IN[1]=byCoordinates_6, IN[2]=sequence_2, IN[3]=class_circular_steel_rod)  # "Series of instances of Circular Rods"; CPython3
# ---------- series_of_instances_of_circular.python (14 lines) ----------
CircularRod = IN[3]
bottom_p = IN[0]
top_p = IN[1]
R = IN[2]
SteelRods = []
count = min(len(bottom_p), len(top_p))

for i in range(count):
    r = R[i] if i < len(R) else R[-1]
    btm = bottom_p[i]
    top = top_p[i]
    rod = CircularRod(btm, top, r)
    SteelRods.append(rod.make_geometry())
OUT = SteelRods
# ----------------------------------------
code_block_8 = CodeBlock { 4400; 0; }
code_block_9 = CodeBlock { 4400; 5; -2200; }
sequence_3 = Sequence(start=code_block_9.out0, amount=code_block_9.out1, step=code_block_9.out2)
byCoordinates_7 = Point.ByCoordinates(x=code_block_8.out0, y=sequence_3, z=code_block_8.out1)
code_block_10 = CodeBlock { 5000; }
byCoordinates_8 = Point.ByCoordinates(x=code_block_8.out0, y=sequence_3, z=code_block_10)
series_of_instances_of_circular_2 = Python(IN[0]=byCoordinates_7, IN[1]=byCoordinates_8, IN[2]=sequence_2, IN[3]=class_circular_steel_rod)  # "Series of instances of circular Rods"; CPython3; same code as series_of_instances_of_circular
code_block_11 = CodeBlock { -4400; -4400; 5000; }
byCoordinates_9 = Point.ByCoordinates(x=code_block_11.out0, y=code_block_11.out1, z=code_block_11.out2)
code_block_12 = CodeBlock { 0; -4400; 9500; }
byCoordinates_10 = Point.ByCoordinates(x=code_block_12.out0, y=code_block_12.out1, z=code_block_12.out2)
code_block_13 = CodeBlock { 4400; -4400; 5000; }
byCoordinates_11 = Point.ByCoordinates(x=code_block_13.out0, y=code_block_13.out1, z=code_block_13.out2)
wooden_arc_beam = Arc.ByThreePoints(firstPoint=byCoordinates_9, secondPoint=byCoordinates_10, thirdPoint=byCoordinates_11)
number_of_points_on_arc = DoubleSlider(1, range=1..50 step 0.1)
code_block_14 = CodeBlock(n=number_of_points_on_arc) { n; 0..8000..#n+1; }
planeAtParameter = Curve.PlaneAtParameter(curve=wooden_arc_beam, param=code_block_14.out1)
radius_of_wooden_arc_beam_front = IntegerSlider(233, range=200..450 step 1)  # "Radius of wooden arc beam (Front one)"
byPlaneRadius = Circle.ByPlaneRadius(plane=planeAtParameter, radius=radius_of_wooden_arc_beam_front)
value_of_n = IntegerSlider(73, range=1..100 step 1)
code_block_15 = CodeBlock(n=value_of_n) { 0..1-1/n..#n; }
pointAtParameter = Curve.PointAtParameter(curve=byPlaneRadius, param=code_block_15, lacing=CrossProduct)
firstItem = List.FirstItem(list=byPlaneRadius)
bySweep = Solid.BySweep(profile=firstItem, path=wooden_arc_beam)
code_block_16 = CodeBlock { -4400; 4400; 5000; }
byCoordinates_12 = Point.ByCoordinates(x=code_block_16.out0, y=code_block_16.out1, z=code_block_16.out2)
code_block_17 = CodeBlock { 0; 4400; 9500; }
byCoordinates_13 = Point.ByCoordinates(x=code_block_17.out0, y=code_block_17.out1, z=code_block_17.out2)
code_block_18 = CodeBlock { 4400; 4400; 5000; }
byCoordinates_14 = Point.ByCoordinates(x=code_block_18.out0, y=code_block_18.out1, z=code_block_18.out2)
wooden_arc_beam_2 = Arc.ByThreePoints(firstPoint=byCoordinates_12, secondPoint=byCoordinates_13, thirdPoint=byCoordinates_14)
number_of_points_on_arc_2 = DoubleSlider(1, range=1..50 step 0.1)
code_block_19 = CodeBlock(n=number_of_points_on_arc_2) { n; 0..8000..#n+1; }
planeAtParameter_2 = Curve.PlaneAtParameter(curve=wooden_arc_beam_2, param=code_block_19.out1)
radius_of_wooden_arc_beam_back = IntegerSlider(260, range=200..450 step 1)  # "Radius of wooden arc beam (back one)"
byPlaneRadius_2 = Circle.ByPlaneRadius(plane=planeAtParameter_2, radius=radius_of_wooden_arc_beam_back)
firstItem_2 = List.FirstItem(list=byPlaneRadius_2)
bySweep_2 = Solid.BySweep(profile=firstItem_2, path=wooden_arc_beam_2)
value_of_n_2 = IntegerSlider(73, range=1..100 step 1)
code_block_20 = CodeBlock(n=value_of_n_2) { 0..1-1/n..#n; }
pointAtParameter_2 = Curve.PointAtParameter(curve=byPlaneRadius_2, param=code_block_20, lacing=CrossProduct)
bottom_point_of_steel_rod = CodeBlock { -4400; 4400; 5000; }
byCoordinates_15 = Point.ByCoordinates(x=bottom_point_of_steel_rod.out0, y=bottom_point_of_steel_rod.out1, z=bottom_point_of_steel_rod.out2)
top_point_of_steel_rod = CodeBlock { 0; -4400; 9500; }
byCoordinates_16 = Point.ByCoordinates(x=top_point_of_steel_rod.out0, y=top_point_of_steel_rod.out1, z=top_point_of_steel_rod.out2)
top_beam_steel_rod_radius = DoubleSlider(250, range=50..250 step 0.1)
class_circular_steel_rod_2 = Python()  # CPython3; unwired: IN[0]; same code as class_circular_steel_rod
instance_of_a_circular_steel_rod_2 = Python(IN[0]=byCoordinates_15, IN[1]=byCoordinates_16, IN[2]=top_beam_steel_rod_radius, IN[3]=class_circular_steel_rod_2)  # CPython3; same code as instance_of_a_circular_steel_rod
bottom_point_of_steel_rod_2 = CodeBlock { 4400; -4400; 5000; }
byCoordinates_17 = Point.ByCoordinates(x=bottom_point_of_steel_rod_2.out0, y=bottom_point_of_steel_rod_2.out1, z=bottom_point_of_steel_rod_2.out2)
top_point_of_steel_rod_2 = CodeBlock { 0; 4400; 9500; }
byCoordinates_18 = Point.ByCoordinates(x=top_point_of_steel_rod_2.out0, y=top_point_of_steel_rod_2.out1, z=top_point_of_steel_rod_2.out2)
class_circular_steel_rod_3 = Python()  # CPython3; unwired: IN[0]; same code as class_circular_steel_rod
instance_of_a_circular_steel_rod_3 = Python(IN[0]=byCoordinates_17, IN[1]=byCoordinates_18, IN[2]=top_beam_steel_rod_radius, IN[3]=class_circular_steel_rod_3)  # CPython3; same code as instance_of_a_circular_steel_rod
bottom_point_of_steel_rod_3 = CodeBlock { 4400; 4400; 5000; }
byCoordinates_19 = Point.ByCoordinates(x=bottom_point_of_steel_rod_3.out0, y=bottom_point_of_steel_rod_3.out1, z=bottom_point_of_steel_rod_3.out2)
top_point_of_steel_rod_3 = CodeBlock { 0; -4400; 9500; }
byCoordinates_20 = Point.ByCoordinates(x=top_point_of_steel_rod_3.out0, y=top_point_of_steel_rod_3.out1, z=top_point_of_steel_rod_3.out2)
class_circular_steel_rod_4 = Python()  # CPython3; unwired: IN[0]; same code as class_circular_steel_rod
instance_of_a_circular_steel_rod_4 = Python(IN[0]=byCoordinates_19, IN[1]=byCoordinates_20, IN[2]=top_beam_steel_rod_radius, IN[3]=class_circular_steel_rod_4)  # CPython3; same code as instance_of_a_circular_steel_rod
bottom_point_of_steel_rod_4 = CodeBlock { -4400; -4400; 5000; }
byCoordinates_21 = Point.ByCoordinates(x=bottom_point_of_steel_rod_4.out0, y=bottom_point_of_steel_rod_4.out1, z=bottom_point_of_steel_rod_4.out2)
top_point_of_steel_rod_4 = CodeBlock { 0; -4400; 9500; }
byCoordinates_22 = Point.ByCoordinates(x=top_point_of_steel_rod_4.out0, y=top_point_of_steel_rod_4.out1, z=top_point_of_steel_rod_4.out2)
class_circular_steel_rod_5 = Python()  # CPython3; unwired: IN[0]; same code as class_circular_steel_rod
instance_of_a_circular_steel_rod_5 = Python(IN[0]=byCoordinates_21, IN[1]=byCoordinates_22, IN[2]=top_beam_steel_rod_radius, IN[3]=class_circular_steel_rod_5)  # CPython3; same code as instance_of_a_circular_steel_rod
bottom_point_of_steel_rod_5 = CodeBlock { 4400; -4400; 5000; }
byCoordinates_23 = Point.ByCoordinates(x=bottom_point_of_steel_rod_5.out0, y=bottom_point_of_steel_rod_5.out1, z=bottom_point_of_steel_rod_5.out2)
top_point_of_steel_rod_5 = CodeBlock { 0; -4400; 9500; }
byCoordinates_24 = Point.ByCoordinates(x=top_point_of_steel_rod_5.out0, y=top_point_of_steel_rod_5.out1, z=top_point_of_steel_rod_5.out2)
class_circular_steel_rod_6 = Python()  # CPython3; unwired: IN[0]; same code as class_circular_steel_rod
instance_of_a_circular_steel_rod_6 = Python(IN[0]=byCoordinates_23, IN[1]=byCoordinates_24, IN[2]=top_beam_steel_rod_radius, IN[3]=class_circular_steel_rod_6)  # CPython3; same code as instance_of_a_circular_steel_rod
bottom_point_of_steel_rod_6 = CodeBlock { -4400; 4400; 5000; }
byCoordinates_25 = Point.ByCoordinates(x=bottom_point_of_steel_rod_6.out0, y=bottom_point_of_steel_rod_6.out1, z=bottom_point_of_steel_rod_6.out2)
top_point_of_steel_rod_6 = CodeBlock { 0; 4400; 9500; }
byCoordinates_26 = Point.ByCoordinates(x=top_point_of_steel_rod_6.out0, y=top_point_of_steel_rod_6.out1, z=top_point_of_steel_rod_6.out2)
class_circular_steel_rod_7 = Python()  # CPython3; unwired: IN[0]; same code as class_circular_steel_rod
instance_of_a_circular_steel_rod_7 = Python(IN[0]=byCoordinates_25, IN[1]=byCoordinates_26, IN[2]=top_beam_steel_rod_radius, IN[3]=class_circular_steel_rod_7)  # CPython3; same code as instance_of_a_circular_steel_rod
code_block_21 = CodeBlock { -4400; 4400; 5000; }
byCoordinates_27 = Point.ByCoordinates(x=code_block_21.out0, y=code_block_21.out1, z=code_block_21.out2)
code_block_22 = CodeBlock { 4400; -4200; }
wood_support_beam_thickness = IntegerSlider(5210, range=5200..6000 step 1)
byCoordinates_28 = Point.ByCoordinates(x=code_block_22.out0, y=code_block_22.out1, z=wood_support_beam_thickness)
class_wood_beam = Python()  # CPython3; unwired: IN[0]
# ---------- class_wood_beam.python (24 lines) ----------
# Load the Python Standard and DesignScript Libraries
import sys
import clr
clr.AddReference('ProtoGeometry')
from Autodesk.DesignScript.Geometry import *

class CuboidRod:
    def __init__(self, c1, c2):
        self.corner1 = c1
        self.corner2 = c2
        self.solid = Cuboid.ByCorners(self.corner1, self.corner2)
        
    def make_geometry(self):
        return self.solid
        
    def get_volume(self):
        return self.solid.Volume
        
    def get_volume_with_units(self):
        vol = self.solid.Volume
        return "{} mm^3".format(vol)
        
        
OUT = CuboidRod
# ----------------------------------------
instances_of_wood_beam = Python(IN[0]=byCoordinates_27, IN[1]=byCoordinates_28, IN[2]=class_wood_beam)  # CPython3
# ---------- instances_of_wood_beam.python (5 lines) ----------
CuboidRod = IN[2]
a = CuboidRod( IN[0], IN[1])
p = a.get_volume_with_units()
b = a.make_geometry()
OUT = (p,b)
# ----------------------------------------
firstItem_3 = List.FirstItem(list=instances_of_wood_beam)
volume_of_wood_beam = Watch(firstItem_3)
bottom_point_of_steel_rod_7 = CodeBlock { -4400; -4400; 5000; }
byCoordinates_29 = Point.ByCoordinates(x=bottom_point_of_steel_rod_7.out0, y=bottom_point_of_steel_rod_7.out1, z=bottom_point_of_steel_rod_7.out2)
top_point_of_steel_rod_7 = CodeBlock { 0; 4400; 9500; }
byCoordinates_30 = Point.ByCoordinates(x=top_point_of_steel_rod_7.out0, y=top_point_of_steel_rod_7.out1, z=top_point_of_steel_rod_7.out2)
class_circular_steel_rod_8 = Python()  # CPython3; unwired: IN[0]
# ---------- class_circular_steel_rod_8.python (26 lines) ----------
# Load the Python Standard and DesignScript Libraries
import sys
import clr
clr.AddReference('ProtoGeometry')
from Autodesk.DesignScript.Geometry import *

class CircularRod:
    def __init__(self, bottom_p, top_p, R):
        self.bottom = bottom_p
        self.top = top_p
        self.radius = R
        length = Line.ByStartPointEndPoint(bottom_p, top_p)
        plane = Plane.ByOriginNormal(bottom_p, length.Direction)
        circle = Circle.ByPlaneRadius(plane, R)
        self.solid = Solid.BySweep(circle, length)
        
    def make_geometry(self):
        return self.solid
    
    def get_volume(self):
        return self.solid.Volume
        
    def get_volume_with_units(self):
        return "{} mm^3".format(self.solid.Volume)
        
OUT = CircularRod
# ----------------------------------------
instance_of_a_circular_steel_rod_8 = Python(IN[0]=byCoordinates_29, IN[1]=byCoordinates_30, IN[2]=top_beam_steel_rod_radius, IN[3]=class_circular_steel_rod_8)  # CPython3
# ---------- instance_of_a_circular_steel_rod_8.python (6 lines) ----------
CircularRod = IN[3]
a = CircularRod(IN[0], IN[1], IN[2])
p = a.make_geometry()
l = a.get_volume_with_units()

OUT = [l], p
# ----------------------------------------
firstItem_4 = List.FirstItem(list=instance_of_a_circular_steel_rod_8)
volume_of_each_individual = Watch(firstItem_4)  # "Volume of each Individual crossing circular rod"
bottom_point_of_steel_rod_8 = CodeBlock { 4400; 4400; 5000; }
byCoordinates_31 = Point.ByCoordinates(x=bottom_point_of_steel_rod_8.out0, y=bottom_point_of_steel_rod_8.out1, z=bottom_point_of_steel_rod_8.out2)
top_point_of_steel_rod_8 = CodeBlock { 0; 4400; 9500; }
byCoordinates_32 = Point.ByCoordinates(x=top_point_of_steel_rod_8.out0, y=top_point_of_steel_rod_8.out1, z=top_point_of_steel_rod_8.out2)
class_circular_steel_rod_9 = Python()  # CPython3; unwired: IN[0]; same code as class_circular_steel_rod_8
instance_of_a_circular_steel_rod_9 = Python(IN[0]=byCoordinates_31, IN[1]=byCoordinates_32, IN[2]=top_beam_steel_rod_radius, IN[3]=class_circular_steel_rod_9)  # CPython3; same code as instance_of_a_circular_steel_rod_8
firstItem_5 = List.FirstItem(list=instance_of_a_circular_steel_rod_9)
volume_of_each_individual_2 = Watch(firstItem_5)  # "Volume of each individual circular steel rod support in the arch"
