# Dynamo graph 1850366.dyn (Dynamo 3.6.1.9895)

# group: Don't touch this ground
code_block = CodeBlock { -5000; -5000; -200; }
byCoordinates = Point.ByCoordinates(x=code_block.out0, y=code_block.out1, z=code_block.out2)
code_block_2 = CodeBlock { 5000; 5000; 0; }
byCoordinates_2 = Point.ByCoordinates(x=code_block_2.out0, y=code_block_2.out1, z=code_block_2.out2)
byCorners = Cuboid.ByCorners(lowPoint=byCoordinates, highPoint=byCoordinates_2)
code_block_3 = CodeBlock { 0; 100; 0; }
byARGB = Color.ByARGB(red=code_block_3.out0, green=code_block_3.out1, blue=code_block_3.out2)
byGeometryColor = Modifiers.GeometryColor.ByGeometryColor(geometry=byCorners, color=byARGB)

code_block_4 = CodeBlock { -5000; -5000; 0; }
byCoordinates_3 = Point.ByCoordinates(x=code_block_4.out0, y=code_block_4.out1, z=code_block_4.out2)
code_block_5 = CodeBlock { -2500; -2500; 5000; }
byCoordinates_4 = Point.ByCoordinates(x=code_block_5.out0, y=code_block_5.out1, z=code_block_5.out2)
byStartPointEndPoint = Line.ByStartPointEndPoint(startPoint=byCoordinates_3, endPoint=byCoordinates_4)
code_block_6 = CodeBlock { 0; 25; 1/24; }
sequence = Sequence(start=code_block_6.out0, amount=code_block_6.out1, step=code_block_6.out2)
pointAtParameter = Curve.PointAtParameter(curve=byStartPointEndPoint, param=sequence)
code_block_7 = CodeBlock { 5000; -2500; 5000; }
byCoordinates_5 = Point.ByCoordinates(x=code_block_7.out0, y=code_block_7.out1, z=code_block_7.out2)
code_block_8 = CodeBlock { 4000; 4000; 0; }
byCoordinates_6 = Point.ByCoordinates(x=code_block_8.out0, y=code_block_8.out1, z=code_block_8.out2)
byStartPointEndPoint_2 = Line.ByStartPointEndPoint(startPoint=byCoordinates_5, endPoint=byCoordinates_6)
code_block_9 = CodeBlock { 0; 25; 1/24; }
sequence_2 = Sequence(start=code_block_9.out0, amount=code_block_9.out1, step=code_block_9.out2)
pointAtParameter_2 = Curve.PointAtParameter(curve=byStartPointEndPoint_2, param=sequence_2)
doubleSlider = DoubleSlider(90, range=0..100 step 0.1)
class_rectangular_wood_columns = Python()  # CPython3; unwired: IN[0]
# ---------- class_rectangular_wood_columns.python (14 lines) ----------
import clr
clr.AddReference('ProtoGeometry')
from Autodesk.DesignScript.Geometry import *

class CircularRod:
    def __init__(self, bottom_point, top_point, radius):
        self.bottom = bottom_point
        self.top = top_point
        self.radius = radius

    def make_geometry(self):
        return Cylinder.ByPointsRadius(self.bottom, self.top, self.radius)

OUT = CircularRod
# ----------------------------------------
instances_of_wood_columns = Python(IN[0]=pointAtParameter, IN[1]=pointAtParameter_2, IN[2]=doubleSlider, IN[3]=class_rectangular_wood_columns)  # CPython3
# ---------- instances_of_wood_columns.python (17 lines) ----------
CircularRod = IN[3]
bottom_points = IN[0]
top_points = IN[1]
radius = IN[2]

rods = []
count = min(len(bottom_points),len(top_points))

for i in range(count):
    
    btm = bottom_points[i]
    top = top_points[i]
    
    rod = CircularRod(btm, top, radius)
    rods.append(rod.make_geometry())
    
OUT = rods
# ----------------------------------------
code_block_10 = CodeBlock { -2500; 5000; 5000; }
byCoordinates_7 = Point.ByCoordinates(x=code_block_10.out0, y=code_block_10.out1, z=code_block_10.out2)
code_block_11 = CodeBlock { 4000; 4000; 0; }
byCoordinates_8 = Point.ByCoordinates(x=code_block_11.out0, y=code_block_11.out1, z=code_block_11.out2)
byStartPointEndPoint_3 = Line.ByStartPointEndPoint(startPoint=byCoordinates_7, endPoint=byCoordinates_8)
code_block_12 = CodeBlock { 0; 25; 1/24; }
sequence_3 = Sequence(start=code_block_12.out0, amount=code_block_12.out1, step=code_block_12.out2)
pointAtParameter_3 = Curve.PointAtParameter(curve=byStartPointEndPoint_3, param=sequence_3)
code_block_13 = CodeBlock { -5000; -5000; 0; }
byCoordinates_9 = Point.ByCoordinates(x=code_block_13.out0, y=code_block_13.out1, z=code_block_13.out2)
code_block_14 = CodeBlock { -2500; -2500; 5000; }
byCoordinates_10 = Point.ByCoordinates(x=code_block_14.out0, y=code_block_14.out1, z=code_block_14.out2)
byStartPointEndPoint_4 = Line.ByStartPointEndPoint(startPoint=byCoordinates_9, endPoint=byCoordinates_10)
code_block_15 = CodeBlock { 0; 25; 1/24; }
sequence_4 = Sequence(start=code_block_15.out0, amount=code_block_15.out1, step=code_block_15.out2)
pointAtParameter_4 = Curve.PointAtParameter(curve=byStartPointEndPoint_4, param=sequence_4)
doubleSlider_2 = DoubleSlider(90, range=0..100 step 0.1)
instances_if_wood_cloumns = Python(IN[0]=pointAtParameter_3, IN[1]=pointAtParameter_4, IN[2]=doubleSlider_2, IN[3]=class_rectangular_wood_columns)  # CPython3; same code as instances_of_wood_columns
wood_material_list = List.Create(item0=instances_of_wood_columns, item1=instances_if_wood_cloumns)
volume = Solid.Volume(solid=wood_material_list)
number = DoubleInput(1000000000)
mul = volume * number
sum = Math.Sum(values=mul)
watch = Watch(sum)
code_block_16 = CodeBlock { 5000; 5000; 0; }
lower_right_bottom_point = Point.ByCoordinates(x=code_block_16.out0, y=code_block_16.out1, z=code_block_16.out2)
code_block_17 = CodeBlock { 5000; 5000; 0; }
upper_left_bottom_point = Point.ByCoordinates(x=code_block_17.out0, y=code_block_17.out1, z=code_block_17.out2)
code_block_18 = CodeBlock { -5000; -5000; 0; }
mid_bottom_point = Point.ByCoordinates(x=code_block_18.out0, y=code_block_18.out1, z=code_block_18.out2)
list_create = List.Create(item0=lower_right_bottom_point, item1=upper_left_bottom_point, item2=mid_bottom_point)
code_block_19 = CodeBlock { 5000; -2500; 5000; }
lower_right_top_point = Point.ByCoordinates(x=code_block_19.out0, y=code_block_19.out1, z=code_block_19.out2)
code_block_20 = CodeBlock { -2500; 5000; 5000; }
upper_left_top_point = Point.ByCoordinates(x=code_block_20.out0, y=code_block_20.out1, z=code_block_20.out2)
code_block_21 = CodeBlock { -2500; -2500; 5000; }
mid_top_point = Point.ByCoordinates(x=code_block_21.out0, y=code_block_21.out1, z=code_block_21.out2)
list_create_2 = List.Create(item0=lower_right_top_point, item1=upper_left_top_point, item2=mid_top_point)
radius_of_aluminum_rods = DoubleSlider(95, range=0..100 step 0.1)
instances_of_circular_aluminum = Python(IN[0]=list_create, IN[1]=list_create_2, IN[2]=radius_of_aluminum_rods, IN[3]=class_rectangular_wood_columns)  # "Instances of Circular Aluminum Rods"; CPython3; same code as instances_of_wood_columns
aluminum_material_list = List.Create(item0=instances_of_circular_aluminum)
volume_2 = Solid.Volume(solid=aluminum_material_list)
number_2 = DoubleInput(1000000000)
mul_2 = volume_2 * number_2
sum_2 = Math.Sum(values=mul_2)
watch_2 = Watch(sum_2)
