# Dynamo graph 1850410.dyn "Home Assignment 2 - Brock Thomas - 1850410" (Dynamo 4.0.0.3277)

# group: Don't touch this ground
code_block = CodeBlock { -5000; -5000; -200; }
byCoordinates = Point.ByCoordinates(x=code_block.out0, y=code_block.out1, z=code_block.out2)
code_block_2 = CodeBlock { 5000; 5000; 0; }
byCoordinates_2 = Point.ByCoordinates(x=code_block_2.out0, y=code_block_2.out1, z=code_block_2.out2)
byCorners = Cuboid.ByCorners(lowPoint=byCoordinates, highPoint=byCoordinates_2)
code_block_3 = CodeBlock { 0; 100; 0; }
byARGB = Color.ByARGB(red=code_block_3.out0, green=code_block_3.out1, blue=code_block_3.out2)
byGeometryColor = Modifiers.GeometryColor.ByGeometryColor(geometry=byCorners, color=byARGB)

code_block_4 = CodeBlock { 1200; 100; }
byCoordinates_3 = Point.ByCoordinates(x=code_block_4.out0, y=code_block_4.out1)
code_block_5 = CodeBlock { 600; }
byCoordinates_4 = Point.ByCoordinates(y=code_block_5)
code_block_6 = CodeBlock { -1200; 100; }
byCoordinates_5 = Point.ByCoordinates(x=code_block_6.out0, y=code_block_6.out1)
byThreePoints = Arc.ByThreePoints(firstPoint=byCoordinates_3, secondPoint=byCoordinates_4, thirdPoint=byCoordinates_5)
code_block_7 = CodeBlock { 0..1..#48; }
pointAtParameter = Curve.PointAtParameter(curve=byThreePoints, param=code_block_7)
code_block_8 = CodeBlock { 1200; }
byCoordinates_6 = Point.ByCoordinates(x=code_block_8)
code_block_9 = CodeBlock { 600; }
byCoordinates_7 = Point.ByCoordinates(z=code_block_9)
code_block_10 = CodeBlock { -1200; }
byCoordinates_8 = Point.ByCoordinates(x=code_block_10)
byThreePoints_2 = Arc.ByThreePoints(firstPoint=byCoordinates_6, secondPoint=byCoordinates_7, thirdPoint=byCoordinates_8)
code_block_11 = CodeBlock { 0..1..#48; }
pointAtParameter_2 = Curve.PointAtParameter(curve=byThreePoints_2, param=code_block_11)
byStartPointEndPoint = Line.ByStartPointEndPoint(startPoint=pointAtParameter, endPoint=pointAtParameter_2)
code_block_12 = CodeBlock { 1200; -100; }
code_block_13 = CodeBlock { -1200; -100; }
byCoordinates_9 = Point.ByCoordinates(x=code_block_12.out0, y=code_block_13.out1)
code_block_14 = CodeBlock { -600; }
byCoordinates_10 = Point.ByCoordinates(y=code_block_14)
byCoordinates_11 = Point.ByCoordinates(x=code_block_13.out0, y=code_block_12.out1)
byThreePoints_3 = Arc.ByThreePoints(firstPoint=byCoordinates_9, secondPoint=byCoordinates_10, thirdPoint=byCoordinates_11)
code_block_15 = CodeBlock { 0..1..#48; }
pointAtParameter_3 = Curve.PointAtParameter(curve=byThreePoints_3, param=code_block_15)
integer_slider = IntegerSlider(49, range=0..100 step 1)
code_block_16 = CodeBlock(n=integer_slider) { a = 0..15*n..#48; z = 200-200*Math.Cos(a); }
translate = Geometry.Translate(geometry=pointAtParameter_3, zTranslation=code_block_16.z)
byStartPointEndPoint_2 = Line.ByStartPointEndPoint(startPoint=translate, endPoint=pointAtParameter_2)
