# Dynamo graph 1850444.dyn (Dynamo 4.0.0.3277)

box_location = CodeBlock { -8000; -8000; 500; }
box_coords = Point.ByCoordinates(x=box_location.out0, y=box_location.out1, z=box_location.out2)
box_location_2 = CodeBlock { -8000; 8000; 500; }
box_coords_2 = Point.ByCoordinates(x=box_location_2.out0, y=box_location_2.out1, z=box_location_2.out2)
connecting_line = Line.ByStartPointEndPoint(startPoint=box_coords, endPoint=box_coords_2)
number_of_boxes_line = DoubleSlider(30, range=0..100 step 0.1)
code_block = CodeBlock(n=number_of_boxes_line) { n; 0..1..#n+1; }
pointAtParameter = Curve.PointAtParameter(curve=connecting_line, param=code_block.out1)
code_block_2 = CodeBlock { 500; 500; 500; }
byLengths = Cuboid.ByLengths(origin=pointAtParameter, width=code_block_2.out0, length=code_block_2.out1, height=code_block_2.out2)
box_location_3 = CodeBlock { 8000; 8000; 500; }
box_coords_3 = Point.ByCoordinates(x=box_location_3.out0, y=box_location_3.out1, z=box_location_3.out2)
box_location_4 = CodeBlock { -8000; 8000; 500; }
box_coords_4 = Point.ByCoordinates(x=box_location_4.out0, y=box_location_4.out1, z=box_location_4.out2)
back_line = Line.ByStartPointEndPoint(startPoint=box_coords_3, endPoint=box_coords_4)
number_of_boxes_line_2 = DoubleSlider(25, range=0..100 step 0.1)
code_block_3 = CodeBlock(n=number_of_boxes_line_2) { n; 0..1..#n+1; }
pointAtParameter_2 = Curve.PointAtParameter(curve=back_line, param=code_block_3.out1)
code_block_4 = CodeBlock { 500; 500; 1000; }
byLengths_2 = Cuboid.ByLengths(origin=pointAtParameter_2, width=code_block_4.out0, length=code_block_4.out1, height=code_block_4.out2)
code_block_5 = CodeBlock { 500; }
translate = Geometry.Translate(geometry=pointAtParameter_2, zTranslation=code_block_5)
ZAxis = Vector.ZAxis()
rotation_degrees_control = DoubleSlider(50, range=0..100 step 0.1)
rotation_of_boxes = Geometry.Rotate(geometry=byLengths_2, origin=translate, axis=ZAxis, degrees=rotation_degrees_control)
distanceTo = Geometry.DistanceTo(geometry=box_coords_4, other=box_coords_3)
watch = Watch(distanceTo)
box_location_5 = CodeBlock { 8000; -8000; 500; }
box_coords_5 = Point.ByCoordinates(x=box_location_5.out0, y=box_location_5.out1, z=box_location_5.out2)
box_location_6 = CodeBlock { -8000; -8000; 500; }
box_coords_6 = Point.ByCoordinates(x=box_location_6.out0, y=box_location_6.out1, z=box_location_6.out2)
front_line = Line.ByStartPointEndPoint(startPoint=box_coords_5, endPoint=box_coords_6)
number_of_boxes_line_3 = DoubleSlider(25, range=0..100 step 0.1)
code_block_6 = CodeBlock(n=number_of_boxes_line_3) { n; 0..1..#n+1; }
pointAtParameter_3 = Curve.PointAtParameter(curve=front_line, param=code_block_6.out1)
code_block_7 = CodeBlock { 500; 500; 1000; }
byLengths_3 = Cuboid.ByLengths(origin=pointAtParameter_3, width=code_block_7.out0, length=code_block_7.out1, height=code_block_7.out2)
code_block_8 = CodeBlock { 500; }
translate_2 = Geometry.Translate(geometry=pointAtParameter_3, zTranslation=code_block_8)
ZAxis_2 = Vector.ZAxis()
rotation_degrees_control_2 = DoubleSlider(50, range=0..100 step 0.1)
rotation_of_boxes_2 = Geometry.Rotate(geometry=byLengths_3, origin=translate_2, axis=ZAxis_2, degrees=rotation_degrees_control_2)
code_block_9 = CodeBlock { -8000; -8000; 1000; }
byCoordinates = Point.ByCoordinates(x=code_block_9.out0, y=code_block_9.out1, z=code_block_9.out2)
code_block_10 = CodeBlock { 8000; 8000; 1000; }
byCoordinates_2 = Point.ByCoordinates(x=code_block_10.out0, y=code_block_10.out1, z=code_block_10.out2)
line_for_roof = Line.ByStartPointEndPoint(startPoint=byCoordinates, endPoint=byCoordinates_2)
code_block_11 = CodeBlock { 6500; }
pointAtParameter_4 = Curve.PointAtParameter(curve=line_for_roof, param=code_block_11)
number_slider = DoubleSlider(0, range=0..100 step 0.1)
number_slider_2 = DoubleSlider(1, range=0..100 step 0.1)
roof_lines = Python()  # PythonNet3; unwired: IN[0]
# ---------- roof_lines.python (15 lines) ----------
# Load the Python Standard and DesignScript Libraries
import sys
import clr
clr.AddReference('ProtoGeometry')
from Autodesk.DesignScript.Geometry import *

import Autodesk.DesignScript.Geometry as DSG

p0 = DSG.Point.ByCoordinates(-8000, 8000, 1000)
p1 = DSG.Point.ByCoordinates(4000, 3000,1300 )
p2 = DSG.Point.ByCoordinates(8000, -8000, 1000)

arc = DSG.Arc.ByThreePoints(p0, p1, p2)

OUT = arc
# ----------------------------------------
roof_lines_2 = Python()  # PythonNet3; unwired: IN[0]
# ---------- roof_lines_2.python (15 lines) ----------
# Load the Python Standard and DesignScript Libraries
import sys
import clr
clr.AddReference('ProtoGeometry')
from Autodesk.DesignScript.Geometry import *

import Autodesk.DesignScript.Geometry as DSG

p0 = DSG.Point.ByCoordinates(-8000, 8000, 1000)
p1 = DSG.Point.ByCoordinates(3000, 6000,1600 )
p2 = DSG.Point.ByCoordinates(8000, -8000, 1000)

arc = DSG.Arc.ByThreePoints(p0, p1, p2)

OUT = arc
# ----------------------------------------
roof_lines_3 = Python()  # PythonNet3; unwired: IN[0]
# ---------- roof_lines_3.python (15 lines) ----------
# Load the Python Standard and DesignScript Libraries
import sys
import clr
clr.AddReference('ProtoGeometry')
from Autodesk.DesignScript.Geometry import *

import Autodesk.DesignScript.Geometry as DSG

p0 = DSG.Point.ByCoordinates(-8000, 8000, 1000)
p1 = DSG.Point.ByCoordinates(2000, 7000,850 )
p2 = DSG.Point.ByCoordinates(8000, -8000, 1000)

arc = DSG.Arc.ByThreePoints(p0, p1, p2)

OUT = arc
# ----------------------------------------
roof_lines_4 = Python()  # PythonNet3; unwired: IN[0]
# ---------- roof_lines_4.python (15 lines) ----------
# Load the Python Standard and DesignScript Libraries
import sys
import clr
clr.AddReference('ProtoGeometry')
from Autodesk.DesignScript.Geometry import *

import Autodesk.DesignScript.Geometry as DSG

p0 = DSG.Point.ByCoordinates(-8000, -8000, 1000)
p1 = DSG.Point.ByCoordinates(-4000, -3000,1300 )
p2 = DSG.Point.ByCoordinates(8000, 8000, 1000)

arc = DSG.Arc.ByThreePoints(p0, p1, p2)

OUT = arc
# ----------------------------------------
roof_lines_5 = Python()  # PythonNet3; unwired: IN[0]
# ---------- roof_lines_5.python (15 lines) ----------
# Load the Python Standard and DesignScript Libraries
import sys
import clr
clr.AddReference('ProtoGeometry')
from Autodesk.DesignScript.Geometry import *

import Autodesk.DesignScript.Geometry as DSG

p0 = DSG.Point.ByCoordinates(-8000, -8000, 1000)
p1 = DSG.Point.ByCoordinates(-3000, -6000,1600 )
p2 = DSG.Point.ByCoordinates(8000, 8000, 1000)

arc = DSG.Arc.ByThreePoints(p0, p1, p2)

OUT = arc
# ----------------------------------------
roof_lines_6 = Python()  # PythonNet3; unwired: IN[0]
# ---------- roof_lines_6.python (15 lines) ----------
# Load the Python Standard and DesignScript Libraries
import sys
import clr
clr.AddReference('ProtoGeometry')
from Autodesk.DesignScript.Geometry import *

import Autodesk.DesignScript.Geometry as DSG

p0 = DSG.Point.ByCoordinates(-8000, -8000, 1000)
p1 = DSG.Point.ByCoordinates(-2000, -7000,850 )
p2 = DSG.Point.ByCoordinates(8000, 8000, 1000)

arc = DSG.Arc.ByThreePoints(p0, p1, p2)

OUT = arc
# ----------------------------------------
roof_lines_7 = Python()  # PythonNet3; unwired: IN[0]
# ---------- roof_lines_7.python (15 lines) ----------
# Load the Python Standard and DesignScript Libraries
import sys
import clr
clr.AddReference('ProtoGeometry')
from Autodesk.DesignScript.Geometry import *

import Autodesk.DesignScript.Geometry as DSG

p0 = DSG.Point.ByCoordinates(-8000, 8000, 1000)
p1 = DSG.Point.ByCoordinates(7000, 3000,850 )
p2 = DSG.Point.ByCoordinates(8000, -8000, 1000)

arc = DSG.Arc.ByThreePoints(p0, p1, p2)

OUT = arc
# ----------------------------------------
rood_lines = Python()  # PythonNet3; unwired: IN[0]
# ---------- rood_lines.python (15 lines) ----------
# Load the Python Standard and DesignScript Libraries
import sys
import clr
clr.AddReference('ProtoGeometry')
from Autodesk.DesignScript.Geometry import *

import Autodesk.DesignScript.Geometry as DSG

p0 = DSG.Point.ByCoordinates(-8000, -8000, 1000)
p1 = DSG.Point.ByCoordinates(-7000, -3000,1300 )
p2 = DSG.Point.ByCoordinates(8000, 8000, 1000)

arc = DSG.Arc.ByThreePoints(p0, p1, p2)

OUT = arc
# ----------------------------------------
roof_lines_8 = Python()  # PythonNet3; unwired: IN[0]
# ---------- roof_lines_8.python (15 lines) ----------
# Load the Python Standard and DesignScript Libraries
import sys
import clr
clr.AddReference('ProtoGeometry')
from Autodesk.DesignScript.Geometry import *

import Autodesk.DesignScript.Geometry as DSG

p0 = DSG.Point.ByCoordinates(-8000, -8000, 1000)
p1 = DSG.Point.ByCoordinates(-4000, -7000,1300 )
p2 = DSG.Point.ByCoordinates(8000, 8000, 1000)

arc = DSG.Arc.ByThreePoints(p0, p1, p2)

OUT = arc
# ----------------------------------------
roof_lines_9 = Python()  # PythonNet3; unwired: IN[0]
# ---------- roof_lines_9.python (15 lines) ----------
# Load the Python Standard and DesignScript Libraries
import sys
import clr
clr.AddReference('ProtoGeometry')
from Autodesk.DesignScript.Geometry import *

import Autodesk.DesignScript.Geometry as DSG

p0 = DSG.Point.ByCoordinates(-8000, 8000, 1000)
p1 = DSG.Point.ByCoordinates(4000, 7000,850 )
p2 = DSG.Point.ByCoordinates(8000, -8000, 1000)

arc = DSG.Arc.ByThreePoints(p0, p1, p2)

OUT = arc
# ----------------------------------------
code_block_12 = CodeBlock { -8000; 8000; 1000; }
byCoordinates_3 = Point.ByCoordinates(x=code_block_12.out0, y=code_block_12.out1, z=code_block_12.out2)
code_block_13 = CodeBlock { 8000; -8000; 1000; }
byCoordinates_4 = Point.ByCoordinates(x=code_block_13.out0, y=code_block_13.out1, z=code_block_13.out2)
line_for_roof_2 = Line.ByStartPointEndPoint(startPoint=byCoordinates_3, endPoint=byCoordinates_4)
code_block_14 = CodeBlock { 6500; }
pointAtParameter_5 = Curve.PointAtParameter(curve=line_for_roof_2, param=code_block_14)
