# Dynamo graph 1850518.dyn (Dynamo 4.0.0.3277)

# group: Don't touch this ground
code_block = CodeBlock { -5000; -5000; -200; }
byCoordinates = Point.ByCoordinates(x=code_block.out0, y=code_block.out1, z=code_block.out2)
code_block_2 = CodeBlock { 5000; 5000; 0; }
byCoordinates_2 = Point.ByCoordinates(x=code_block_2.out0, y=code_block_2.out1, z=code_block_2.out2)
byCorners = Cuboid.ByCorners(lowPoint=byCoordinates, highPoint=byCoordinates_2)
code_block_3 = CodeBlock { 0; 100; 0; }
byARGB = Color.ByARGB(red=code_block_3.out0, green=code_block_3.out1, blue=code_block_3.out2)
byGeometryColor = Modifiers.GeometryColor.ByGeometryColor(color=byARGB)  # unwired: geometry

pillar_starting_point = CodeBlock { 1; 1; 3; }
pillar_starting_point_2 = Point.ByCoordinates(x=pillar_starting_point.out0, y=pillar_starting_point.out1, z=pillar_starting_point.out2)
pillar_ending_point = CodeBlock { 1; 1; }
height_of_pillars = DoubleSlider(3727.3, range=2000..6000 step 0.1)
pillar_ending_point_2 = Point.ByCoordinates(x=pillar_ending_point.out0, y=pillar_ending_point.out1, z=height_of_pillars)
radius_of_pillars = DoubleSlider(172.5, range=0..300 step 0.1)
concrete_pillar_class = Python()  # PythonNet3; unwired: IN[0]
# ---------- concrete_pillar_class.python (16 lines) ----------
import sys
import clr
clr.AddReference('ProtoGeometry')
from Autodesk.DesignScript.Geometry import *

class CircularRod:
    def __init__(self, bottom_point,    top_point, radius):
        self.bottom = bottom_point
        self.top = top_point
        self.radius = radius 
        
    def make_geometry(self):
        return Cylinder.ByPointsRadius
        (self.bottom, self.top, self.radius)
     
OUT = CircularRod
# ----------------------------------------
concrete_pillars_repetitive = Python(IN[0]=pillar_starting_point_2, IN[1]=pillar_ending_point_2, IN[2]=radius_of_pillars, IN[3]=concrete_pillar_class)  # "Concrete Pillars Repetitive Instance"; PythonNet3
# ---------- concrete_pillars_repetitive.python (46 lines) ----------
import sys
import clr
clr.AddReference('ProtoGeometry')
from Autodesk.DesignScript.Geometry import *


start_point = IN[0]  # Start coordinate 
end_point = IN[1]    # End coordinate  
radius = IN[2]       # Radius slider

# direction vector
dx = end_point.X - start_point.X
dy = end_point.Y - start_point.Y
dz = end_point.Z - start_point.Z

#4 pillars in 2x2
spacing = 4000
all_cylinders = []

#positions 2 rows 2 columns
grid_positions = [
    (0, 0),      
    (spacing, 0),  
    (0, spacing),
    (spacing, spacing) 
]

for x_offset, y_offset in grid_positions:
    #base position
    pillar_base_x = start_point.X + x_offset
    pillar_base_y = start_point.Y + y_offset
    pillar_base_z = start_point.Z
    
    #start/end points
    pillar_start = Point.ByCoordinates(pillar_base_x, pillar_base_y, pillar_base_z)
    pillar_end = Point.ByCoordinates(
        pillar_base_x + dx,
        pillar_base_y + dy, 
        pillar_base_z + dz
    )
    
    #cylinder
    cylinder = Cylinder.ByPointsRadius(pillar_start, pillar_end, radius)
    all_cylinders.append(cylinder)

OUT = all_cylinders
# ----------------------------------------
grass_roof_starting_point = CodeBlock { 1; 1; }
grass_roof_starting_point_2 = Point.ByCoordinates(x=grass_roof_starting_point.out0, y=grass_roof_starting_point.out1, z=height_of_pillars)
grass_roof_ending_point = CodeBlock { 4000; 4000; }
grass_roof_ending_point_2 = Point.ByCoordinates(x=grass_roof_ending_point.out0, y=grass_roof_ending_point.out1, z=height_of_pillars)
thickness_of_roof = DoubleSlider(85.6, range=0..300 step 0.1)
grass_roof_class = Python()  # PythonNet3; unwired: IN[0]
# ---------- grass_roof_class.python (22 lines) ----------
import sys
import clr
clr.AddReference('ProtoGeometry')
from Autodesk.DesignScript.Geometry import *

class RectangleRod:
    def __init__(self, start_point, end_point, width):
        self.start = start_point
        self.end = end_point
        self.width = width
        
    def make_geometry(self):
        direction = Vector.ByTwoPoints(self.start, self.end)
        length = self.start.DistanceTo(self.end)
        
        plane = Plane.ByOriginNormal(self.start, direction)
        
        rectangle = Rectangle.ByWidthLength(plane, self.width, length)
        
        return rectangle

OUT = RectangleRod
# ----------------------------------------
grass_roof_instnce = Python(IN[0]=grass_roof_starting_point_2, IN[1]=grass_roof_ending_point_2, IN[2]=thickness_of_roof, IN[3]=grass_roof_class)  # PythonNet3; unwired: IN[4]
# ---------- grass_roof_instnce.python (50 lines) ----------
import sys
import clr
clr.AddReference('ProtoGeometry')
from Autodesk.DesignScript.Geometry import *

if len(IN) >= 3:
    bottom_corner1 = IN[0]
    bottom_corner2 = IN[1]
    
    # Height slider
    if isinstance(IN[2], (int, float)):
        height = float(IN[2])
    else:
        height = 10.0  #avoid error use defult 
    
    #width
    width = abs(bottom_corner2.X - bottom_corner1.X)
    
    #thickness
    thickness = abs(bottom_corner2.Y - bottom_corner1.Y)
    
    #avoid error use defult
    if width == 0:
        width = 5.0
    if thickness == 0:
        thickness = 3.0
    
    #rectangle
    #min X,Y 
    min_x = min(bottom_corner1.X, bottom_corner2.X)
    min_y = min(bottom_corner1.Y, bottom_corner2.Y)
    base_z = bottom_corner1.Z  
    
    #base
    base_corner1 = Point.ByCoordinates(min_x, min_y, base_z)
    base_corner2 = Point.ByCoordinates(min_x + width, min_y + thickness, base_z)
    
    #top
    top_corner1 = Point.ByCoordinates(min_x, min_y, base_z + height)
    top_corner2 = Point.ByCoordinates(min_x + width, min_y + thickness, base_z + height)
    
    #3D box
    OUT = Cuboid.ByCorners(base_corner1, top_corner2)
    
else:
    # Default box avoid error
    OUT = Cuboid.ByCorners(
        Point.ByCoordinates(0, 0, 0),      
        Point.ByCoordinates(5, 3, 10)      
    )
# ----------------------------------------
pillar_starting_point_3 = CodeBlock { -1000; 1; }
pillar_starting = Point.ByCoordinates(x=pillar_starting_point_3.out0, y=pillar_starting_point_3.out1, z=height_of_pillars)
pillar_ending_point_3 = CodeBlock { 5000; 1; }
pillar_ending = Point.ByCoordinates(x=pillar_ending_point_3.out0, y=pillar_ending_point_3.out1, z=height_of_pillars)
wooden_pillar = Cylinder.ByPointsRadius(startPoint=pillar_starting, endPoint=pillar_ending, radius=radius_of_pillars)
pillar_ending_point_4 = CodeBlock { 1; -1000; }
pillar_starting_2 = Point.ByCoordinates(x=pillar_ending_point_4.out0, y=pillar_ending_point_4.out1, z=height_of_pillars)
pillar_ending_point_5 = CodeBlock { 1; 5000; }
pillar_ending_2 = Point.ByCoordinates(x=pillar_ending_point_5.out0, y=pillar_ending_point_5.out1, z=height_of_pillars)
wooden_pillar_2 = Cylinder.ByPointsRadius(startPoint=pillar_starting_2, endPoint=pillar_ending_2, radius=radius_of_pillars)
pillar_starting_point_4 = CodeBlock { 4000; -1000; }
pillar_starting_3 = Point.ByCoordinates(x=pillar_starting_point_4.out0, y=pillar_starting_point_4.out1, z=height_of_pillars)
pillar_ending_point_6 = CodeBlock { 4000; 5000; }
pillar_ending_3 = Point.ByCoordinates(x=pillar_ending_point_6.out0, y=pillar_ending_point_6.out1, z=height_of_pillars)
wooden_pillar_3 = Cylinder.ByPointsRadius(startPoint=pillar_starting_3, endPoint=pillar_ending_3, radius=radius_of_pillars)
pillar_starting_point_5 = CodeBlock { -1000; 4000; }
roof_ending = Point.ByCoordinates(x=pillar_starting_point_5.out0, y=pillar_starting_point_5.out1, z=height_of_pillars)
pillar_starting_point_6 = CodeBlock { 5000; 4000; }
roof_ending_2 = Point.ByCoordinates(x=pillar_starting_point_6.out0, y=pillar_starting_point_6.out1, z=height_of_pillars)
wooden_pillar_4 = Cylinder.ByPointsRadius(startPoint=roof_ending, endPoint=roof_ending_2, radius=radius_of_pillars)
radius_of_wooden_detailing = DoubleSlider(80.6, range=0..1000 step 0.1)
wooden_pillar_detailing = Cylinder.ByPointsRadius(startPoint=pillar_starting, endPoint=roof_ending, radius=radius_of_wooden_detailing)
wooden_pillar_detailing_2 = Cylinder.ByPointsRadius(startPoint=pillar_ending_2, endPoint=roof_ending, radius=radius_of_wooden_detailing)
wooden_pillar_detailing_3 = Cylinder.ByPointsRadius(startPoint=pillar_starting_2, endPoint=pillar_starting_3, radius=radius_of_wooden_detailing)
wooden_pillar_detailing_4 = Cylinder.ByPointsRadius(startPoint=pillar_ending, endPoint=roof_ending_2, radius=radius_of_wooden_detailing)
wooden_pillar_detailing_5 = Cylinder.ByPointsRadius(startPoint=pillar_ending_3, endPoint=pillar_ending_2, radius=radius_of_wooden_detailing)
wooden_pillar_detailing_6 = Cylinder.ByPointsRadius(startPoint=pillar_starting, endPoint=pillar_starting_2, radius=radius_of_wooden_detailing)
wooden_pillar_detailing_7 = Cylinder.ByPointsRadius(startPoint=pillar_starting_3, endPoint=pillar_ending, radius=radius_of_wooden_detailing)
wooden_pillar_detailing_8 = Cylinder.ByPointsRadius(startPoint=pillar_ending_3, endPoint=roof_ending_2, radius=radius_of_wooden_detailing)
pillar_starting_point_7 = CodeBlock { 2000; -1000; }
wooden_pillar_starting_point = Point.ByCoordinates(x=pillar_starting_point_7.out0, y=pillar_starting_point_7.out1, z=height_of_pillars)
pillar_ending_point_7 = CodeBlock { 2000; 5000; }
wooden_pillar_ending_point = Point.ByCoordinates(x=pillar_ending_point_7.out0, y=pillar_ending_point_7.out1, z=height_of_pillars)
wooden_pillar_detailing_9 = Cylinder.ByPointsRadius(startPoint=wooden_pillar_starting_point, endPoint=wooden_pillar_ending_point, radius=radius_of_wooden_detailing)
pillar_starting_point_8 = CodeBlock { -1000; 2000; }
wooden_pillar_starting_point_2 = Point.ByCoordinates(x=pillar_starting_point_8.out0, y=pillar_starting_point_8.out1, z=height_of_pillars)
pillar_ending_point_8 = CodeBlock { 5000; 2000; }
wooden_pillar_ending_point_2 = Point.ByCoordinates(x=pillar_ending_point_8.out0, y=pillar_ending_point_8.out1, z=height_of_pillars)
wooden_pillar_detailing_10 = Cylinder.ByPointsRadius(startPoint=wooden_pillar_starting_point_2, endPoint=wooden_pillar_ending_point_2, radius=radius_of_wooden_detailing)
concrete_pillars_volume = Python(IN[0]=pillar_starting_point_2, IN[1]=pillar_ending_point_2, IN[2]=radius_of_pillars)  # "Concrete Pillars Volume Calculation"; PythonNet3
# ---------- concrete_pillars_volume.python (44 lines) ----------
import sys
import clr
clr.AddReference('ProtoGeometry')
from Autodesk.DesignScript.Geometry import *


start_input = IN[0]    
end_input = IN[1]        
radius_input = IN[2]  

#points
if isinstance(start_input, list):
    start_point = start_input[0] if len(start_input) > 0 else None
else:
    start_point = start_input

if isinstance(end_input, list):
    end_point = end_input[0] if len(end_input) > 0 else None
else:
    end_point = end_input

#radius
if isinstance(radius_input, list):
    radius = radius_input[0] if len(radius_input) > 0 else 0
else:
    radius = radius_input

# Check points
if start_point is None or end_point is None:
    OUT = "Missing point"
else:
    #height
    dx = end_point.X - start_point.X
    dy = end_point.Y - start_point.Y
    dz = end_point.Z - start_point.Z

    height = (dx**2 + dy**2 + dz**2) ** 0.5

    #volume x4
    volume_per_pillar = 3.14159 * (radius ** 2) * height
    total_volume = volume_per_pillar * 4

    #Output
    OUT = "Total volume of concrete pillars in mm^3: " + str(round(total_volume, 2)) 
# ----------------------------------------
volume_of_concrete_pillars = Watch(concrete_pillars_volume)
python_script = Python(IN[0]=grass_roof_starting_point_2, IN[1]=grass_roof_ending_point_2, IN[2]=thickness_of_roof)  # PythonNet3
# ---------- python_script.python (30 lines) ----------
import sys


point1 = IN[0] 
point2 = IN[1] 
height = IN[2]

#single values if in list
def extract_value(item):
    if isinstance(item, list) and len(item) > 0:
        return item[0]
    return item

p1 = extract_value(point1)
p2 = extract_value(point2)
h = extract_value(height)

#volume
try:
    width = abs(p2.X - p1.X)
    depth = abs(p2.Y - p1.Y)
    volume = width * depth * h
except:
    # If input are just numbers
    width = abs(p2[0] - p1[0]) if isinstance(p2, (list, tuple)) else 0
    depth = abs(p2[1] - p1[1]) if isinstance(p2, (list, tuple)) else 0
    volume = width * depth * h


OUT = "Total volume of the grass roof: " + str(round(volume, 2)) + " mm³"
# ----------------------------------------
watch = Watch(python_script)
