# Dynamo graph 1850551.dyn (Dynamo 3.6.0.9395)

# group: Design Area Base
code_block = CodeBlock { -5000; -5000; -200; }  # frozen
byCoordinates = Point.ByCoordinates(x=code_block.out0, y=code_block.out1, z=code_block.out2)  # frozen
code_block_2 = CodeBlock { 5000; 5000; 0; }  # frozen
byCoordinates_2 = Point.ByCoordinates(x=code_block_2.out0, y=code_block_2.out1, z=code_block_2.out2)  # frozen
byCorners = Cuboid.ByCorners(lowPoint=byCoordinates, highPoint=byCoordinates_2)  # frozen
code_block_3 = CodeBlock { 0; 100; 0; }  # frozen
byARGB = Color.ByARGB(red=code_block_3.out0, green=code_block_3.out1, blue=code_block_3.out2)  # frozen
byGeometryColor = Modifiers.GeometryColor.ByGeometryColor(geometry=byCorners, color=byARGB)  # frozen

code_block_4 = CodeBlock {  }
class_Marble = Python()  # CPython3; unwired: IN[0]
# ---------- class_Marble.python (70 lines) ----------
import clr
clr.AddReference('ProtoGeometry')
from Autodesk.DesignScript.Geometry import *
import math


class Marble:
    def __init__(self, centerline, thickness):
        self.centerline = centerline  # ring or rib curve
        self.thickness = thickness    # diameter

    def geometry(self):
        return self.centerline

    def length(self):
        return self.centerline.Length

    def solid(self):
        """
        Create a solid representation of the steel member.
        
        - Ribs (open curves): use Solid.BySweep.
        - Rings (closed curves): approximate the ring with many small
          cylinders using Cylinder.ByPointsRadius.
        """
        r = self.thickness / 2.0

        # Detect closed curve
        try:
            is_closed = self.centerline.IsClosed
        except:
            # fallback: compare start and end points
            try:
                sp = self.centerline.StartPoint
                ep = self.centerline.EndPoint
                is_closed = sp.DistanceTo(ep) < 1e-6
            except:
                is_closed = False

        # ----- CLOSED: RINGS -----
        if is_closed:
            N = 1000  # number of segments around ring
            params = [i / float(N) for i in range(N + 1)]
            pts = [self.centerline.PointAtParameter(u) for u in params]

            seg_solids = []
            for i in range(N):
                p1 = pts[i]
                p2 = pts[i + 1]

                # make a small cylinder segment instead of sweep
                seg_cyl = Cylinder.ByPointsRadius(p1, p2, r)
                seg_solids.append(seg_cyl)

            if len(seg_solids) == 1:
                return seg_solids[0]
            else:
                return Solid.ByUnion(seg_solids)

        # ----- OPEN: RIBS -----
        start_pt = self.centerline.StartPoint
        profile = Circle.ByCenterPointRadius(start_pt, r)
        return Solid.BySweep(profile, self.centerline)

    def volume(self):
        L = self.length()
        r = self.thickness / 2.0
        area = math.pi * (r ** 2)
        return L * area  # mm^3
OUT = Marble
# ----------------------------------------
class_Steel = Python()  # CPython3; unwired: IN[0]
# ---------- class_Steel.python (70 lines) ----------
import clr
clr.AddReference('ProtoGeometry')
from Autodesk.DesignScript.Geometry import *
import math


class Steel:
    def __init__(self, centerline, thickness):
        self.centerline = centerline  # ring or rib curve
        self.thickness = thickness    # diameter

    def geometry(self):
        return self.centerline

    def length(self):
        return self.centerline.Length

    def solid(self):
        """
        Create a solid representation of the steel member.
        
        - Ribs (open curves): use Solid.BySweep.
        - Rings (closed curves): approximate the ring with many small
          cylinders using Cylinder.ByPointsRadius.
        """
        r = self.thickness / 2.0

        # Detect closed curve
        try:
            is_closed = self.centerline.IsClosed
        except:
            # fallback: compare start and end points
            try:
                sp = self.centerline.StartPoint
                ep = self.centerline.EndPoint
                is_closed = sp.DistanceTo(ep) < 1e-6
            except:
                is_closed = False

        # ----- CLOSED: RINGS -----
        if is_closed:
            N = 1000  # number of segments around ring
            params = [i / float(N) for i in range(N + 1)]
            pts = [self.centerline.PointAtParameter(u) for u in params]

            seg_solids = []
            for i in range(N):
                p1 = pts[i]
                p2 = pts[i + 1]

                # make a small cylinder segment instead of sweep
                seg_cyl = Cylinder.ByPointsRadius(p1, p2, r)
                seg_solids.append(seg_cyl)

            if len(seg_solids) == 1:
                return seg_solids[0]
            else:
                return Solid.ByUnion(seg_solids)

        # ----- OPEN: RIBS -----
        start_pt = self.centerline.StartPoint
        profile = Circle.ByCenterPointRadius(start_pt, r)
        return Solid.BySweep(profile, self.centerline)

    def volume(self):
        L = self.length()
        r = self.thickness / 2.0
        area = math.pi * (r ** 2)
        return L * area  # mm^3
OUT = Steel
# ----------------------------------------

# group: Rings
code_block_5 = CodeBlock { 0; 0; }
heightOuterRing = DoubleSlider(4000, range=2500..4000 step 1)
byCoordinates_3 = Point.ByCoordinates(x=code_block_5.out0, y=code_block_5.out1, z=heightOuterRing)
outerRingRadius = DoubleSlider(4500, range=2500..4500 step 1)
outerTopring = Circle.ByCenterPointRadius(centerPoint=byCoordinates_3, radius=outerRingRadius)
list_create = List.Create(item0=outerTopring)
outerRingThickness = DoubleSlider(600, range=100..1000 step 100)
instance_of_outerring = Python(IN[0]=list_create, IN[1]=class_Marble, IN[2]=outerRingThickness)  # CPython3
# ---------- instance_of_outerring.python (63 lines) ----------
import clr
clr.AddReference('ProtoGeometry')
from Autodesk.DesignScript.Geometry import *
import math

# -----------------------------
# Inputs from Dynamo
# -----------------------------
curves_in    = IN[0] # curve or list of curves (ribs)
Marble  = IN[1] # Marble class from class node
thickness_in = IN[2]   # diameter(s)
   
# -----------------------------
# Normalize inputs
# -----------------------------

# Ensure curves is a list
if isinstance(curves_in, list):
    curves = curves_in
else:
    curves = [curves_in]

# Allow single thickness or list of thicknesses
if isinstance(thickness_in, list):
    thicknesses = thickness_in
else:
    thicknesses = [thickness_in] * len(curves)

# -----------------------------
# Build Marble instances
# -----------------------------
instances = []   # list of Marble objects
solids    = []   # solid geometry for each member
lengths   = []   # length of each member
volumes   = []   # volume of each member

for i, c in enumerate(curves):
    if c is None:
        continue

    # choose thickness for this member
    t = thicknesses[i if i < len(thicknesses) else -1]

    # create INSTANCE of Marble
    m = Marble(c, t)
    instances.append(m)

    # use class methods
    solids.append(m.solid())
    lengths.append(m.length())
    volumes.append(m.volume())

total_volume = sum(volumes) if volumes else 0

# -----------------------------
# Outputs
# -----------------------------
# OUT[0] = solids
# OUT[1] = lengths per member
# OUT[2] = volumes per member
# OUT[3] = total volume (single number)
# OUT[4] = instances (for write-up, not geometry)
OUT = [solids, lengths, volumes, total_volume, instances]
# ----------------------------------------
code_block_6 = CodeBlock { 0; 0; }
heightInnerRing = DoubleSlider(6000, range=5000..6000 step 1)
byCoordinates_4 = Point.ByCoordinates(x=code_block_6.out0, y=code_block_6.out1, z=heightInnerRing)
innerRingRadius = DoubleSlider(500, range=100..500 step 1)
innerTopRing = Circle.ByCenterPointRadius(centerPoint=byCoordinates_4, radius=innerRingRadius)
list_create_2 = List.Create(item0=innerTopRing)
ineerRingThickness = DoubleSlider(300, range=100..1000 step 100)
instance_of_innerring = Python(IN[0]=list_create_2, IN[1]=class_Steel, IN[2]=ineerRingThickness)  # CPython3
# ---------- instance_of_innerring.python (63 lines) ----------
import clr
clr.AddReference('ProtoGeometry')
from Autodesk.DesignScript.Geometry import *
import math

# -----------------------------
# Inputs from Dynamo
# -----------------------------
curves_in    = IN[0] # curve or list of curves (ribs)
Steel  = IN[1] # Steel class from class node
thickness_in = IN[2]   # diameter(s)
   
# -----------------------------
# Normalize inputs
# -----------------------------

# Ensure curves is a list
if isinstance(curves_in, list):
    curves = curves_in
else:
    curves = [curves_in]

# Allow single thickness or list of thicknesses
if isinstance(thickness_in, list):
    thicknesses = thickness_in
else:
    thicknesses = [thickness_in] * len(curves)

# -----------------------------
# Build Steel instances
# -----------------------------
instances = []   # list of Steel objects
solids    = []   # solid geometry for each member
lengths   = []   # length of each member
volumes   = []   # volume of each member

for i, c in enumerate(curves):
    if c is None:
        continue

    # choose thickness for this member
    t = thicknesses[i if i < len(thicknesses) else -1]

    # create INSTANCE of Steel
    m = Steel(c, t)
    instances.append(m)

    # use class methods
    solids.append(m.solid())
    lengths.append(m.length())
    volumes.append(m.volume())

total_volume = sum(volumes) if volumes else 0

# -----------------------------
# Outputs
# -----------------------------
# OUT[0] = solids
# OUT[1] = lengths per member
# OUT[2] = volumes per member
# OUT[3] = total volume (single number)
# OUT[4] = instances (for write-up, not geometry)
OUT = [solids, lengths, volumes, total_volume, instances]
# ----------------------------------------

# group: Rib
code_block_7 = CodeBlock {  }
code_block_8 = CodeBlock { 0; 0; 0; }
centerPoint = Point.ByCoordinates(x=code_block_8.out0, y=code_block_8.out1, z=code_block_8.out2)
ribBase = Circle.ByCenterPointRadius(centerPoint=centerPoint, radius=outerRingRadius)
numberRibs = DoubleSlider(7, range=5..7 step 1)
rangeRibs = CodeBlock(number=numberRibs) { 0..1..#number; }
ribBottomPoints = Curve.PointAtParameter(curve=ribBase, param=rangeRibs)
ribTopPoints = Curve.PointAtParameter(curve=outerTopring, param=rangeRibs)
ribs = Line.ByStartPointEndPoint(startPoint=ribBottomPoints, endPoint=ribTopPoints)
ribThickness = DoubleSlider(800, range=100..1000 step 100)
instance_of_ribs = Python(IN[0]=ribs, IN[1]=class_Marble, IN[2]=ribThickness)  # CPython3; same code as instance_of_outerring

# group: Slats
numberSlats = DoubleSlider(50, range=7..50 step 1)
pointsParamater = CodeBlock(number=numberSlats) { 0..1..#number; }
outerSlatPoints = Curve.PointAtParameter(curve=outerTopring, param=pointsParamater)
innerSlatPoints = Curve.PointAtParameter(curve=innerTopRing, param=pointsParamater)
slats = Line.ByStartPointEndPoint(startPoint=outerSlatPoints, endPoint=innerSlatPoints)
code_block_9 = CodeBlock { 0.5; }
midSlatPoints = Curve.PointAtParameter(curve=slats, param=code_block_9)
slatsBending = DoubleSlider(800, range=0..1000 step 100)
code_block_10 = CodeBlock(p=midSlatPoints, slatBending=slatsBending) { Point.ByCoordinates(p.X, p.Y, p.Z + slatBending); }
curve_of_slats = Arc.ByThreePoints(firstPoint=outerSlatPoints, secondPoint=code_block_10, thirdPoint=innerSlatPoints)
slatsThickness = DoubleSlider(250, range=100..500 step 50)
instance_of_slats = Python(IN[0]=curve_of_slats, IN[1]=class_Steel, IN[2]=slatsThickness)  # CPython3; same code as instance_of_innerring

# group: Colors (Takes time to load)
code_block_11 = CodeBlock { 0; }
outerRing = List.GetItemAtIndex(list=instance_of_outerring, index=code_block_11)
code_block_12 = CodeBlock { 255; 245; 245; 240; }
marble_color = Color.ByARGB(red=code_block_12.out1, green=code_block_12.out2, blue=code_block_12.out3)
outerring_color = Modifiers.GeometryColor.ByGeometryColor(geometry=outerRing, color=marble_color)
ribs_2 = List.GetItemAtIndex(list=instance_of_ribs, index=code_block_11)
ribs_color = Modifiers.GeometryColor.ByGeometryColor(geometry=ribs_2, color=marble_color)
code_block_13 = CodeBlock { 0; }
innerRing = List.GetItemAtIndex(list=instance_of_innerring, index=code_block_13)
code_block_14 = CodeBlock { 255; 28; 32; 38; }
byARGB_2 = Color.ByARGB(red=code_block_14.out1, green=code_block_14.out2, blue=code_block_14.out3)
innerring_color = Modifiers.GeometryColor.ByGeometryColor(geometry=innerRing, color=byARGB_2)
slats_2 = List.GetItemAtIndex(list=instance_of_slats, index=code_block_13)
slat_color = Modifiers.GeometryColor.ByGeometryColor(geometry=slats_2, color=byARGB_2)

# group: Volume
code_block_15 = CodeBlock { 3; }
outerRing_2 = List.GetItemAtIndex(list=instance_of_outerring, index=code_block_15)
volume_of_outerring = Watch(outerRing_2)
innerRing_2 = List.GetItemAtIndex(list=instance_of_innerring, index=code_block_15)
volume_of_innerring = Watch(innerRing_2)
ribs_3 = List.GetItemAtIndex(list=instance_of_ribs, index=code_block_15)
volume_of_ribs = Watch(ribs_3)
slats_3 = List.GetItemAtIndex(list=instance_of_slats, index=code_block_15)
volume_of_slats = Watch(slats_3)
code_block_16 = CodeBlock(x=volume_of_outerring, y=volume_of_innerring, z=volume_of_ribs, d=volume_of_slats) { x+y+z+d; }
total_volume = Watch(code_block_16)
