# Dynamo graph 1850792.dyn (Dynamo 3.6.0.9395)

# group: Don't touch this ground
code_block = CodeBlock { -5000; -5000; -200; }
byCoordinates = Point.ByCoordinates(x=code_block.out0, y=code_block.out1, z=code_block.out2)
code_block_2 = CodeBlock { 5000; 5000; 0; }
byCoordinates_2 = Point.ByCoordinates(x=code_block_2.out0, y=code_block_2.out1, z=code_block_2.out2)
byCorners = Cuboid.ByCorners(lowPoint=byCoordinates, highPoint=byCoordinates_2)
code_block_3 = CodeBlock { 0; 100; 0; }
byARGB = Color.ByARGB(red=code_block_3.out0, green=code_block_3.out1, blue=code_block_3.out2)

base_side_length = DoubleSlider(6250, range=500..10000 step 250)
base_height = DoubleSlider(170, range=10..350 step 10)
X1 = CodeBlock(x=base_side_length, y=base_side_length, z=base_height) { x; y; z; x1 = x/2; y1 = y/4; z1 = z; }
byCoordinates_3 = Point.ByCoordinates(x=X1.x1, y=X1.y1, z=X1.z1)
code_block_4 = CodeBlock { 0; }
X1_2 = CodeBlock(x=base_side_length, y=base_side_length, z=code_block_4) { x; y; z; x1 = x/4; y1 = y/2; z1 = z; }
byCoordinates_4 = Point.ByCoordinates(x=X1_2.x1, y=X1_2.y1, z=X1_2.z1)
byCorners_2 = Cuboid.ByCorners(lowPoint=byCoordinates_3, highPoint=byCoordinates_4)
code_block_5 = CodeBlock { 0; }
X3 = CodeBlock(x=base_side_length, y=base_side_length, z=code_block_5) { x; y; z; x1 = x/4; y1 = -y/2; z1 = z; }
byCoordinates_5 = Point.ByCoordinates(x=X3.x1, y=X3.y1, z=X3.z1)
X3_2 = CodeBlock(x=base_side_length, y=base_side_length, z=base_height) { x; y; z; x1 = x/2; y1 = -y/4; z1 = z; }
byCoordinates_6 = Point.ByCoordinates(x=X3_2.x1, y=X3_2.y1, z=X3_2.z1)
byCorners_3 = Cuboid.ByCorners(lowPoint=byCoordinates_5, highPoint=byCoordinates_6)
code_block_6 = CodeBlock { 0; }
X4 = CodeBlock(x=base_side_length, y=base_side_length, z=code_block_6) { x; y; z; x1 = -x/4; y1 = y/2; z1 = z; }
byCoordinates_7 = Point.ByCoordinates(x=X4.x1, y=X4.y1, z=X4.z1)
X4_2 = CodeBlock(x=base_side_length, y=base_side_length, z=base_height) { x; y; z; x1 = -x/2; y1 = y/4; z1 = z; }
byCoordinates_8 = Point.ByCoordinates(x=X4_2.x1, y=X4_2.y1, z=X4_2.z1)
byCorners_4 = Cuboid.ByCorners(lowPoint=byCoordinates_7, highPoint=byCoordinates_8)
code_block_7 = CodeBlock(x=base_side_length, y=base_side_length, z=base_height) { x; y; z; xlist = [3*x/8, -3*x/8, 3*x/8, -3*x/8]; ylist = [3*y/8, -3*y/8, -3*y/8, 3*y/8]; }
pillar_height = DoubleSlider(2250, range=1000..3000 step 250)
pillar_start_point = Point.ByCoordinates(x=code_block_7.xlist, y=code_block_7.ylist, z=pillar_height)
pillar_end_point = Point.ByCoordinates(x=code_block_7.xlist, y=code_block_7.ylist, z=base_height)
pillar = Line.ByStartPointEndPoint(startPoint=pillar_start_point, endPoint=pillar_end_point)
number_of_balls_per_pillar = IntegerSlider(7, range=2..20 step 1)
code_block_8 = CodeBlock(n=number_of_balls_per_pillar) { n; 0..1..#n+1; }
removeItemAtIndex = List.RemoveItemAtIndex(list=code_block_8.out1, indices=number_of_balls_per_pillar)
pointAtParameter = Curve.PointAtParameter(curve=pillar, param=removeItemAtIndex, lacing=CrossProduct)
code_block_9 = CodeBlock(z1=base_height, z2=pillar_height, Number=number_of_balls_per_pillar) { z1; z2; length = z2 - z1; Number; height = length/(2*Number); z = -(height); }
byCenterPointRadius = Sphere.ByCenterPointRadius(centerPoint=pointAtParameter, radius=code_block_9.height)
translate = Geometry.Translate(geometry=byCenterPointRadius, zTranslation=code_block_9.z)
code_block_10 = CodeBlock(Number=code_block_9.Number, length=code_block_9.length) { Number; length; height = length/(2*Number); width = height/1.5; }
code_block_11 = CodeBlock(length=code_block_9.length, number=code_block_9.Number) { length; number; height = length/number; z = -height/2; }
byLengths = Cuboid.ByLengths(origin=pointAtParameter, width=code_block_10.width, length=code_block_10.width, height=code_block_11.height)
translate_2 = Geometry.Translate(geometry=byLengths, zTranslation=code_block_11.z)
roof_dip_angle = DoubleSlider(16.8, range=0..45 step 0.1)
code_block_12 = CodeBlock(x=base_side_length, z=pillar_height, theta=roof_dip_angle) { x; z; theta; x1 = 3*x/8; x2 = -3*x/8; z1 = ((3/4)*x*Math.Tan(theta)) + z; }
start = Point.ByCoordinates(x=code_block_12.x2, z=code_block_12.z1)
code_block_13 = CodeBlock(x=base_side_length, y=base_side_length, z=pillar_height, radius=code_block_9.height) { x; y; z; radius; x1 = 3*x/8 + radius*0.75; y1 = -3*y/8; x2 = -3*x/8 - radius*0.75; y2 = -3*y/8; }
truss_points = CodeBlock(x=code_block_12.x, z=code_block_12.z, p1=start, radius=code_block_13.radius)
# ---------- truss_points.designscript (6 lines) ----------
x;
z;
p1;
radius;
p2 = Point.ByCoordinates(-3*x/8 - radius*0.75, 0, z);
p3 = Point.ByCoordinates(3*x/8 + radius*0.75, 0, z);
# ----------------------------------------
byStartPointEndPoint = Line.ByStartPointEndPoint(startPoint=truss_points.p1, endPoint=truss_points.p2)
aluminum_truss_class = Python()  # CPython3; unwired: IN[0]
# ---------- aluminum_truss_class.python (21 lines) ----------
# Load the Python Standard and DesignScript Libraries
import sys
import clr
clr.AddReference('ProtoGeometry')
from Autodesk.DesignScript.Geometry import *
import math

class TimberTruss:
    def __init__(self, start_point, end_point, radius):
        self.start = start_point
        self.end = end_point
        self.radius = radius
    
    def make_geometry(self):
        return Cylinder.ByPointsRadius(self.start, self.end, self.radius)
        
    def measure_volume(self):
        length = self.start.DistanceTo(self.end)
        return length * self.radius * self.radius * math.pi

OUT = TimberTruss
# ----------------------------------------
code_block_14 = CodeBlock(x=base_side_length, y=base_side_length, z=pillar_height, radius=code_block_9.height) { x; y; z; radius; x1 = 3*x/8 + radius*0.75; y1 = 3*x/8; x2 = -3*x/8 - radius*0.75; y2 = 3*x/8; }
timber_end_point = Point.ByCoordinates(x=code_block_14.x2, y=code_block_14.y2, z=code_block_14.z)
byStartPointEndPoint_2 = Line.ByStartPointEndPoint(startPoint=start, endPoint=timber_end_point)
code_block_15 = CodeBlock { 0..1..#3; }
pointAtParameter_2 = Curve.PointAtParameter(curve=byStartPointEndPoint_2, param=code_block_15)
code_block_16 = CodeBlock(points=pointAtParameter_2) { points; p1 = points[1]; }
timber_end_point_2 = Point.ByCoordinates(x=code_block_13.x2, y=code_block_13.y2, z=code_block_13.z)
byStartPointEndPoint_3 = Line.ByStartPointEndPoint(startPoint=start, endPoint=timber_end_point_2)
pointAtParameter_3 = Curve.PointAtParameter(curve=byStartPointEndPoint_3, param=code_block_15)
code_block_17 = CodeBlock(points=pointAtParameter_3) { points; p1 = points[1]; }
end = Point.ByCoordinates(x=code_block_12.x1, z=code_block_12.z1)
timber_start_point = Point.ByCoordinates(x=code_block_14.x1, y=code_block_14.y1, z=code_block_14.z)
byStartPointEndPoint_4 = Line.ByStartPointEndPoint(startPoint=end, endPoint=timber_start_point)
pointAtParameter_4 = Curve.PointAtParameter(curve=byStartPointEndPoint_4, param=code_block_15)
code_block_18 = CodeBlock(points=pointAtParameter_4) { points; p1 = points[1]; }
timber_start_point_2 = Point.ByCoordinates(x=code_block_13.x1, y=code_block_13.y1, z=code_block_13.z)
byStartPointEndPoint_5 = Line.ByStartPointEndPoint(startPoint=end, endPoint=timber_start_point_2)
pointAtParameter_5 = Curve.PointAtParameter(curve=byStartPointEndPoint_5, param=code_block_15)
code_block_19 = CodeBlock(points=pointAtParameter_5) { points; p1 = points[1]; }
truss_points_2 = CodeBlock(p1=truss_points.p1, p2=code_block_16.p1, p3=truss_points.p2, p4=code_block_17.p1, p5=truss_points.p3, p6=code_block_18.p1, p7=end, p8=code_block_19.p1)
# ---------- truss_points_2.designscript (10 lines) ----------
p1;
p2;
p3;
p4;
points = [[p3, p1], [p3, p2], [p3, p4], [p2, p4],
[p5, p6], [p5, p7], [p5, p8], [p6, p8]];
p5;
p6;
p7;
p8;
# ----------------------------------------
timber_rod_radius = DoubleSlider(50, range=25..150 step 25)
truss_radius_factor = DoubleSlider(0.7, range=0.1..1 step 0.1)
radius_of_truss = CodeBlock(radius=timber_rod_radius, factor=truss_radius_factor) { radius; r = radius * factor; }
aluminum_truss_series_of = Python(IN[0]=aluminum_truss_class, IN[1]=truss_points_2.points, IN[2]=radius_of_truss.r)  # "Aluminum Truss Series of Instances"; CPython3
# ---------- aluminum_truss_series_of.python (11 lines) ----------
TimberTruss = IN[0]
point_pairs = IN[1]  
radius = IN[2]

trusses = [TimberTruss(pair[0], pair[1], radius) for pair in point_pairs]


geometries = [t.make_geometry() for t in trusses]
volumes    = [t.measure_volume() for t in trusses]

OUT = [geometries, volumes]
# ----------------------------------------
code_block_20 = CodeBlock(list=aluminum_truss_series_of) { list; list1 = list[1]; volume = Math.Round(Math.Sum(list[1]), 3); volume1 = volume + " mm^3"; }
aluminum_truss_volume = Watch(code_block_20.volume1)
timber_pole_class = Python()  # CPython3; unwired: IN[0]
# ---------- timber_pole_class.python (25 lines) ----------
# Load the Python Standard and DesignScript Libraries
import sys
import clr
clr.AddReference('ProtoGeometry')
from Autodesk.DesignScript.Geometry import *
import math

class TimberPole:
    def __init__(self, centerline, radius):
        self.centerline = centerline
        self.radius = radius
    
    def endpoints(self):
        return self.centerline.StartPoint, self.centerline.EndPoint
        
    def make_geometry(self):
        end1, end2 = self.endpoints()
        
        return Cylinder.ByPointsRadius(end1, end2, self.radius)
        
    def measure_volume(self):
        end1, end2 = self.endpoints()
        return end1.DistanceTo(end2)*self.radius*self.radius*math.pi
        
OUT = TimberPole
# ----------------------------------------
byStartPointEndPoint_6 = Line.ByStartPointEndPoint(startPoint=timber_start_point, endPoint=timber_end_point)
byStartPointEndPoint_7 = Line.ByStartPointEndPoint(startPoint=timber_start_point_2, endPoint=timber_end_point_2)
byStartPointEndPoint_8 = Line.ByStartPointEndPoint(startPoint=start, endPoint=end)
roof_panel = CodeBlock(p1=timber_start_point, p2=timber_end_point, p3=end, p4=start) { p1; p2; p3; p4; NurbsSurface.ByPoints([[p1, p2], [p3, p4]]); }
roof_panel_2 = CodeBlock(p1=timber_start_point_2, p2=timber_end_point_2, p3=end, p4=start)
# ---------- roof_panel_2.designscript (7 lines) ----------
p1;
p2;
p3;
p4;
x = NurbsSurface.ByPoints([[p1, p2], [p3, p4]]);
volume = x.Area *2;
volume1 = Math.Round(volume, 3) + " mm^3";
# ----------------------------------------
series_of_instances_of_steel = CodeBlock(p1=roof_panel.p1, p2=roof_panel.p2, p3=roof_panel.p3, p4=roof_panel.p4, p5=roof_panel_2.p1, p6=roof_panel_2.p2) { p1; p2; p3; p4; p5; p6; list = [p1, p2, p3, p4, p5, p6]; }  # "Series of Instances of Steel Sphere"
byStartPointEndPoint_9 = Line.ByStartPointEndPoint(startPoint=series_of_instances_of_steel.p1, endPoint=series_of_instances_of_steel.p5)
byStartPointEndPoint_10 = Line.ByStartPointEndPoint(startPoint=series_of_instances_of_steel.p2, endPoint=series_of_instances_of_steel.p6)
list_create = List.Create(item0=byStartPointEndPoint_6, item1=byStartPointEndPoint_7, item2=byStartPointEndPoint_8, item3=byStartPointEndPoint_9, item4=byStartPointEndPoint_10, item5=byStartPointEndPoint_3, item6=byStartPointEndPoint_5, item7=byStartPointEndPoint_4, item8=byStartPointEndPoint_2)
series_of_instances_of_timber = Python(IN[0]=timber_pole_class, IN[1]=list_create, IN[2]=timber_rod_radius)  # "Series of Instances of Timber Pole"; CPython3
# ---------- series_of_instances_of_timber.python (12 lines) ----------
TimberPole = IN[0]
centerlines = IN[1]   
radius = IN[2]


poles = [TimberPole(cl, radius) for cl in centerlines]


geometries = [p.make_geometry() for p in poles]
volumes    = [p.measure_volume() for p in poles]

OUT = [geometries, volumes]
# ----------------------------------------
code_block_21 = CodeBlock(list=series_of_instances_of_timber, volume2=roof_panel_2.volume)
# ---------- code_block_21.designscript (6 lines) ----------
list;
list1 = list[1];
volume = Math.Round(Math.Sum(list[1]), 3);
volume2;
volume1 = volume + " mm^3";
volumefinal = volume + volume2 + " mm^3";
# ----------------------------------------
timber_rod_volume = Watch(code_block_21.volume1)
steel_joints_class = Python()  # CPython3; unwired: IN[0]
# ---------- steel_joints_class.python (18 lines) ----------
import sys
import clr
clr.AddReference('ProtoGeometry')
from Autodesk.DesignScript.Geometry import *
import math

class SteelSphere:
    def __init__(self, center, radius):
        self.center = center
        self.radius = radius

    def make_geometry(self):
        return Sphere.ByCenterPointRadius(self.center, self.radius)

    def measure_volume(self):
        return (4.0/3.0) * math.pi * (self.radius ** 3)

OUT = SteelSphere
# ----------------------------------------
series_of_instances_of_steel_2 = Python(IN[0]=steel_joints_class, IN[1]=series_of_instances_of_steel.list, IN[2]=timber_rod_radius)  # "Series of Instances of Steel Joints"; CPython3
# ---------- series_of_instances_of_steel_2.python (10 lines) ----------
SteelSphere = IN[0]
centers = IN[1]   
radius = IN[2]

spheres = [SteelSphere(c, radius) for c in centers]

geometries = [s.make_geometry() for s in spheres]
volumes    = [s.measure_volume() for s in spheres]

OUT = [geometries, volumes]
# ----------------------------------------
spherical_pillar_volume = CodeBlock(number=code_block_9.Number, height=code_block_9.height)
# ---------- spherical_pillar_volume.designscript (4 lines) ----------
number;
height;
volume = 4 * number * (4/3) * 3.1415 * height * height * height;
volume1 = Math.Round(volume, 3) + " mm^3";
# ----------------------------------------
code_block_22 = CodeBlock(list=series_of_instances_of_steel_2, volume1=spherical_pillar_volume.volume)
# ---------- code_block_22.designscript (6 lines) ----------
list;
list1 = list[1];
volume1;
volume = Math.Round(Math.Sum(list[1]), 3);
volume3 = volume + " mm^3";
volume2 = volume + volume1 + " mm^3";
# ----------------------------------------
steel_joints_volume = Watch(code_block_22.volume3)
steel_spherical_pillar_volume = Watch(spherical_pillar_volume.volume1)
byLengths_2 = Cuboid.ByLengths(width=base_side_length, length=base_side_length, height=base_height)
edges = CodeBlock(Sld=byLengths_2) { Sld; list = Sld.Edges; list2 = [list[0], list[1], list[2], list[3]]; }
base_fillet_radius = DoubleSlider(1000, range=25..1000 step 25)
base_fillet = Solid.Fillet(solid=byLengths_2, edges=edges.list2, radius=base_fillet_radius)
volume = Solid.Volume(solid=base_fillet)
code_block_23 = CodeBlock { 0; }
X2 = CodeBlock(x=base_side_length, y=base_side_length, z=code_block_23) { x; y; z; x1 = -x/4; y1 = -y/2; z1 = z; }
byCoordinates_9 = Point.ByCoordinates(x=X2.x1, y=X2.y1, z=X2.z1)
X2_2 = CodeBlock(x=base_side_length, y=base_side_length, z=base_height) { x; y; z; x1 = -x/2; y1 = -y/4; z1 = z; }
byCoordinates_10 = Point.ByCoordinates(x=X2_2.x1, y=X2_2.y1, z=X2_2.z1)
byCorners_5 = Cuboid.ByCorners(lowPoint=byCoordinates_9, highPoint=byCoordinates_10)
volume_2 = Solid.Volume(solid=byCorners_5)
code_block_24 = CodeBlock(x1=volume, x2=volume_2) { x1; x2; volume = x1 + 4*x2; volume1 = Math.Round(volume, 3) + " mm^3"; }
concrete_base_volume = Watch(code_block_24.volume1)
timber_roof_volume = Watch(roof_panel_2.volume1)
total_steel_volume = Watch(code_block_22.volume2)
total_timber_volume = Watch(code_block_21.volumefinal)
