# Dynamo graph 1850884.dyn (Dynamo 3.5.2.8914)

code_block = CodeBlock { -5000; -5000; -200; }
byCoordinates = Point.ByCoordinates(x=code_block.out0, y=code_block.out1, z=code_block.out2)
code_block_2 = CodeBlock { 5000; 5000; 0; }
byCoordinates_2 = Point.ByCoordinates(x=code_block_2.out0, y=code_block_2.out1, z=code_block_2.out2)
byCorners = Cuboid.ByCorners(lowPoint=byCoordinates, highPoint=byCoordinates_2)
code_block_3 = CodeBlock { 0; 100; 0; }
byARGB = Color.ByARGB(red=code_block_3.out0, green=code_block_3.out1, blue=code_block_3.out2)
byGeometryColor = Modifiers.GeometryColor.ByGeometryColor(geometry=byCorners, color=byARGB)
heightofColumn = DoubleSlider(3000, range=2000..5000 step 100)
radiusofColumn = DoubleSlider(200, range=80..300 step 10)
class_timber_column = Python(IN[0]=heightofColumn, IN[1]=radiusofColumn)  # CPython3
# ---------- class_timber_column.python (33 lines) ----------
# Load the Python Standard and DesignScript Libraries
import sys
import clr
clr.AddReference('ProtoGeometry')
from Autodesk.DesignScript.Geometry import *
import math

#Inputs
height = IN[0]   # HeightofColumn
radius = IN[1]   # RadiusofColumn  

class TimberColumn:
    def __init__(self, base_point, height, radius):
        self.base = base_point
        self.height = height
        self.radius = radius
        # Defines the base height and radius of the columns.

    def build(self):
        r = self.radius
        h = self.height
        p1 = Point.ByCoordinates(self.base.X - r, self.base.Y - r, self.base.Z)
        p2 = Point.ByCoordinates(self.base.X + r, self.base.Y + r, self.base.Z + h)
        col = Cuboid.ByCorners(p1, p2)
        return col
        # Defines by calculating two opposite corner points which we can generate a cuboid.
    
    def volume(self):
        return 4 * (self.radius ** 2) * self.height
        # Calculates the volume of the column.
        
# Outputs
OUT = TimberColumn
# ----------------------------------------
columnOffset = DoubleSlider(2500, range=1000..3000 step 100)
code_block_4 = CodeBlock(ColumnOffset=columnOffset)
# ---------- code_block_4.designscript (10 lines) ----------
offset = ColumnOffset;

points = [
    Point.ByCoordinates(-offset, -offset, 0),
    Point.ByCoordinates( offset, -offset, 0),
    Point.ByCoordinates( offset,  offset, 0),
    Point.ByCoordinates(-offset,  offset, 0)
];

points;
# ----------------------------------------
series_of_instances_of_timber = Python(IN[0]=class_timber_column, IN[1]=code_block_4.out2, IN[2]=heightofColumn, IN[3]=radiusofColumn)  # "Series of instances of Timber Column"; CPython3
# ---------- series_of_instances_of_timber.python (34 lines) ----------
# Load the Python Standard and DesignScript Libraries
import sys
import clr
clr.AddReference('ProtoGeometry')
from Autodesk.DesignScript.Geometry import *
import math

# Inputs
TimberColumn = IN[0]
basePts = IN[1]
height  = IN[2]           
radius  = IN[3]

columns        = []
volumes        = []
# Stores the geometry of the columns and its volumes.

for p in basePts:
    c = TimberColumn(p, height, radius)
    colGeom = c.build()
    columns.append(colGeom)
    volumes.append(c.volume())
    # Loops through each base point which creates 4 timber columns.

totalVolume = sum(volumes)
volume_unit = "mm^3"
# Calculates the total volume.

volume_labels = ["{0:.2f} {1}".format(v, volume_unit) for v in volumes]
total_volume_label = "{0:.2f} {1}".format(totalVolume, volume_unit)
# Returns the units mm^3 and it will show on watch node.

#Outputs
OUT = (columns, volumes, totalVolume, volume_labels, total_volume_label)
# ----------------------------------------
code_block_5 = CodeBlock { 4; }
getItemAtIndex = List.GetItemAtIndex(list=series_of_instances_of_timber, index=code_block_5)
watch = Watch(getItemAtIndex)
thicknessofRoof = DoubleSlider(250, range=100..500 step 10)
class_steel_roof = Python(IN[0]=thicknessofRoof)  # CPython3
# ---------- class_steel_roof.python (41 lines) ----------
# Load the Python Standard and DesignScript Libraries
import sys
import clr
clr.AddReference('ProtoGeometry')
from Autodesk.DesignScript.Geometry import *

# Inputs
thickness = IN[0]

class SteelRoof:
    def __init__(self, pts, thickness):
        self.pts = pts
        self.t = thickness
        # Defines and store the steel roof.
        
    def build(self):
        xpoints = [p.X for p in self.pts]
        ypoints = [p.Y for p in self.pts]
        z  = self.pts[0].Z

        minX, maxX = min(xpoints), max(xpoints)
        minY, maxY = min(ypoints), max(ypoints)
        
        p1 = Point.ByCoordinates(minX, minY, z)
        p2 = Point.ByCoordinates(maxX, maxY, z + self.t)

        roof = Cuboid.ByCorners(p1, p2)
        return roof
        #Calculates the minimum and maximum coordinates of x and y, which we can generate a cuboid on top of the 4 timber columns.

    def volume(self):
        xpoints = [p.X for p in self.pts]
        ypoints = [p.Y for p in self.pts]
        width  = max(xpoints) - min(xpoints)
        depth  = max(ypoints) - min(ypoints)
        height = self.t
        return width * depth * height
        # Calculates the volume of the steel roof.
        
# Outputs
OUT = SteelRoof
# ----------------------------------------
code_block_6 = CodeBlock(HeightofColumn=heightofColumn, RadiusofColumn=radiusofColumn, ColumnOffset=columnOffset)
# ---------- code_block_6.designscript (12 lines) ----------
h = HeightofColumn;
r = RadiusofColumn;
o = ColumnOffset + r;

roofpoints = [
    Point.ByCoordinates(-o, -o, h),
    Point.ByCoordinates( o, -o, h),
    Point.ByCoordinates( o,  o, h),
    Point.ByCoordinates(-o,  o, h)
];

roofpoints;
# ----------------------------------------
instance_of_a_steel_roof = Python(IN[0]=class_steel_roof, IN[1]=code_block_6.out4, IN[2]=thicknessofRoof)  # CPython3
# ---------- instance_of_a_steel_roof.python (23 lines) ----------
# Load the Python Standard and DesignScript Libraries
import sys
import clr
clr.AddReference('ProtoGeometry')
from Autodesk.DesignScript.Geometry import *
import math

# Inputs
SteelRoof = IN[0]
cornerPts = IN[1]
thickness = IN[2]

roof = SteelRoof(cornerPts, thickness)
roofSolid  = roof.build()
roofVolume = roof.volume()
# Calls the class to create the roof and calculates its volume.

volume_unit = "mm^3"
volume_label = "{0:.2f} {1}".format(roofVolume, volume_unit)
# Returns the units mm^3 and it will show on watch node.

# Outputs
OUT = [roofSolid, roofVolume, volume_label]
# ----------------------------------------
code_block_7 = CodeBlock { 2; }
getItemAtIndex_2 = List.GetItemAtIndex(list=instance_of_a_steel_roof, index=code_block_7)
watch_2 = Watch(getItemAtIndex_2)
radiusofRoofBeam = DoubleSlider(150, range=50..200 step 10)
wooden_roof_beams = Python(IN[0]=code_block_6.out4, IN[1]=radiusofRoofBeam)  # CPython3
# ---------- wooden_roof_beams.python (39 lines) ----------
# Load the Python Standard and DesignScript Libraries
import sys
import clr
clr.AddReference('ProtoGeometry')
from Autodesk.DesignScript.Geometry import *
import math

# Inputs
roof_points = IN[0]
radius   = IN[1]
p0, p1, p2, p3 = roof_points
pairs = [(p0, p1), (p1, p2), (p2, p3), (p3, p0)]

beams   = []
volumes = []
#Initializes empty lists.

for a, b in pairs:
    beam = Cylinder.ByPointsRadius(a, b, radius)
    beams.append(beam)
    distancex = b.X - a.X
    distancey = b.Y - a.Y
    distancez = b.Z - a.Z
    L = math.sqrt(distancex **2 + distancey ** 2 + distancez **2)

    V = math.pi * (radius ** 2) * L      
    volumes.append(V)
    # Loops over each points to create a cylindrical wooden beam for all 4 sides.
    # Then computes the distance of x, y, and z coordinates, which i use the volume of cylinder formula to calculate.

total_volume = sum(volumes)

volume_unit        = "mm^3"
volume_labels      = ["{0:.2f} {1}".format(v, volume_unit) for v in volumes]
total_volume_label = "{0:.2f} {1}".format(total_volume, volume_unit)
# Adds all 4 beams to get the total volume and defines the units for watch node. 

#Outputs
OUT = (beams, volumes, total_volume, volume_labels, total_volume_label)
# ----------------------------------------
code_block_8 = CodeBlock { 4; }
getItemAtIndex_3 = List.GetItemAtIndex(list=wooden_roof_beams, index=code_block_8)
watch_3 = Watch(getItemAtIndex_3)
instance_of_a_steel_roof_2 = Python(IN[0]=code_block_6.out4, IN[1]=thicknessofRoof)  # "Instance of a Steel Roof Triangles"; CPython3
# ---------- instance_of_a_steel_roof_2.python (30 lines) ----------
# Load the Python Standard and DesignScript Libraries
import sys
import clr
clr.AddReference('ProtoGeometry')
from Autodesk.DesignScript.Geometry import *

# Inputs
RoofPoints = IN[0]
ThicknessofRoof = IN[1]          

p0, p1, p2, p3 = RoofPoints

cx = (p0.X + p1.X + p2.X + p3.X) / 4.0
cy = (p0.Y + p1.Y + p2.Y + p3.Y) / 4.0
cz = p0.Z + ThicknessofRoof + 2000.0

peakpoint = Point.ByCoordinates(cx, cy, cz)
# Calculates the center which defines the peak point of 4 triangles.

triangle_surfaces = []
pairs = [(p0, p1), (p1, p2), (p2, p3), (p3, p0)]

for a, b in pairs:
    polygon = Polygon.ByPoints([a, b, peakpoint])
    surface = Surface.ByPatch(polygon)
    triangle_surfaces.append(surface)
    # Creates 4 triangles between each roof edge and the peak point.

# Outputs
OUT = [triangle_surfaces, peakpoint]
# ----------------------------------------
code_block_9 = CodeBlock { 1; }
getItemAtIndex_4 = List.GetItemAtIndex(list=instance_of_a_steel_roof_2, index=code_block_9)
radiusofLight = DoubleSlider(250, range=50..500 step 10)
byCenterPointRadius = Sphere.ByCenterPointRadius(centerPoint=getItemAtIndex_4, radius=radiusofLight)
code_block_10 = CodeBlock { 255; 255; 245; 150; }
byARGB_2 = Color.ByARGB(alpha=code_block_10.out0, red=code_block_10.out1, green=code_block_10.out2, blue=code_block_10.out3)
byGeometryColor_2 = Modifiers.GeometryColor.ByGeometryColor(geometry=byCenterPointRadius, color=byARGB_2)
