# Dynamo graph 1850900.dyn (Dynamo 3.6.0.9395)

code_block = CodeBlock { 5000; 5000; 0; }
byCoordinates = Point.ByCoordinates(x=code_block.out0, y=code_block.out1, z=code_block.out2)
code_block_2 = CodeBlock { -5000; -5000; -200; }
byCoordinates_2 = Point.ByCoordinates(x=code_block_2.out0, y=code_block_2.out1, z=code_block_2.out2)
byCorners = Cuboid.ByCorners(lowPoint=byCoordinates, highPoint=byCoordinates_2)
code_block_3 = CodeBlock { 0; 100; 0; }
byARGB = Color.ByARGB(red=code_block_3.out0, green=code_block_3.out1, blue=code_block_3.out2)
byGeometryColor = Modifiers.GeometryColor.ByGeometryColor(geometry=byCorners, color=byARGB)
code_block_4 = CodeBlock { -3000; 4000; 0; }
byCoordinates_3 = Point.ByCoordinates(x=code_block_4.out0, y=code_block_4.out1, z=code_block_4.out2)
code_block_5 = CodeBlock { -3000; 4000; 3000; }
byCoordinates_4 = Point.ByCoordinates(x=code_block_5.out0, y=code_block_5.out1, z=code_block_5.out2)
line = Line.ByStartPointEndPoint(startPoint=byCoordinates_3, endPoint=byCoordinates_4)
radius = DoubleSlider(200, range=0..2000 step 0.2)
height = DoubleSlider(3000, range=1..5000 step 0.1)
angle = IntegerSlider(0, range=0..360 step 45)
tilt = DoubleSlider(0, range=0..100 step 0.1)
cyldnerical_steel_rod = Python(IN[0]=line, IN[1]=radius, IN[2]=height, IN[3]=angle, IN[4]=tilt)  # CPython3; graph output
# ---------- cyldnerical_steel_rod.python (144 lines) ----------
import clr
clr.AddReference('ProtoGeometry')
from Autodesk.DesignScript.Geometry import *
import math

# ---------- Helper utilities ----------
def single_value(v):
    """Return single numeric or point from possible list wrappers."""
    if v is None:
        return None
    # if list-like, take first item
    try:
        # treat Dynamo lists as Python lists
        if hasattr(v, '__iter__') and not isinstance(v, (str, Point, Vector)):
            # if it's a list of Points, return first Point
            if len(v) == 0:
                return None
            return v[0]
    except Exception:
        pass
    return v

def to_float(val, default=0.0):
    try:
        return float(val)
    except Exception:
        return default

def point_to_tuple(pt):
    return (to_float(pt.X), to_float(pt.Y), to_float(pt.Z))

# ---------- Read & sanitize inputs ----------
in_line = single_value(IN[0])
radius_in = single_value(IN[1])
height_in = single_value(IN[2])
angle_in = single_value(IN[3])
offset_in = single_value(IN[4])
axis_mode = single_value(IN[5]) if len(IN) > 5 else "Z"

# Convert numeric inputs to floats
radius = to_float(radius_in, 0.0)
height = to_float(height_in, 0.0)
angle_deg = to_float(angle_in, 0.0)
offset = to_float(offset_in, 0.0)

# Default checks
if in_line is None:
    OUT = "ERROR: connect a Line to IN[0]"
else:
    # Ensure bottom point exists
    try:
        bottom = in_line.StartPoint
    except Exception:
        OUT = "ERROR: IN[0] isn't a valid Line"
        # exit early
    else:
        # Normalize axis_mode
        axis_mode = str(axis_mode).upper() if axis_mode is not None else "Z"
        
        # Convert angle to radians for trig
        angle_rad = math.radians(angle_deg % 360.0)
        
        # Compute top depending on axis_mode
        if axis_mode == "LINE":
            # Rotate offset in plane perpendicular to the line direction.
            # Build a local coordinate system: origin=bottom, z=direction of line (unit), x = arbitrary perp
            dir_vec = Vector.ByTwoPoints(in_line.StartPoint, in_line.EndPoint)
            # handle zero-length line
            try:
                dir_len = dir_vec.Length
            except Exception:
                dir_len = 0.0
            if dir_len < 1e-9:
                # fallback to global Z
                axis_mode = "Z"
            
        if axis_mode == "LINE":
            # Create local X axis by projecting global X onto plane perpendicular to dir_vec
            # Build orthonormal basis (u, v, w) where w = dir_vec.Normalized
            try:
                w = dir_vec.Normalize()
            except Exception:
                w = Vector.ByCoordinates(0,0,1)
            # pick arbitrary vector not parallel to w
            arbitrary = Vector.ByCoordinates(1,0,0)
            # if nearly parallel, pick different arbitrary
            if abs(w.Dot(arbitrary)) > 0.9:
                arbitrary = Vector.ByCoordinates(0,1,0)
            # u = normalized(arbitrary - (arbitrary·w)w)
            proj = w.Scale(arbitrary.Dot(w))
            uvec = arbitrary.Subtract(proj)
            try:
                u = uvec.Normalize()
            except Exception:
                u = Vector.ByCoordinates(1,0,0)
            v = w.Cross(u)  # third orthonormal axis
            # offset in local plane = offset * (cos(angle)*u + sin(angle)*v)
            dx_vec = u.Scale(offset * math.cos(angle_rad))
            dy_vec = v.Scale(offset * math.sin(angle_rad))
            horiz_vec = dx_vec.Add(dy_vec)
            # vertical along w by height
            vert_vec = w.Scale(height)
            top_pt = bottom.Add(horiz_vec).Add(vert_vec)
        else:
            # axis_mode == "Z" or fallback
            # horizontal offset in XY plane
            dx = offset * math.cos(angle_rad)
            dy = offset * math.sin(angle_rad)
            dz = height
            top_pt = Point.ByCoordinates(bottom.X + dx, bottom.Y + dy, bottom.Z + dz)
        
        # create geometry only if top and bottom distinct
        # small tolerance check
        try:
            d = ((top_pt.X - bottom.X)**2 + (top_pt.Y - bottom.Y)**2 + (top_pt.Z - bottom.Z)**2)**0.5
        except Exception:
            d = 0.0
        
        rod = None
        info = {}
        if d < 1e-6:
            info['warning'] = "Top and bottom nearly coincident (d={:.6f}). Increase offset or height.".format(d)
        else:
            # ensure radius is positive
            if radius <= 0:
                info['warning'] = "Radius is zero or negative; rod won't be created."
            else:
                try:
                    rod = Cylinder.ByPointsRadius(bottom, top_pt, radius)
                except Exception as e:
                    info['error'] = "Cylinder creation failed: {}".format(e)
        
        # debug info
        info['bottom'] = point_to_tuple(bottom)
        info['top'] = point_to_tuple(top_pt)
        info['dx_dy_dz'] = (to_float(top_pt.X - bottom.X), to_float(top_pt.Y - bottom.Y), to_float(top_pt.Z - bottom.Z))
        info['distance'] = d
        info['radius'] = radius
        info['height_input'] = height
        info['angle_deg'] = angle_deg % 360.0
        info['offset'] = offset
        info['axis_mode'] = axis_mode
        
        OUT = (rod, info)
# ----------------------------------------
code_block_6 = CodeBlock { 2000; 2000; 0; }
byCoordinates_5 = Point.ByCoordinates(x=code_block_6.out0, y=code_block_6.out1, z=code_block_6.out2)
code_block_7 = CodeBlock { 2000; 2000; 3500; }
byCoordinates_6 = Point.ByCoordinates(x=code_block_7.out0, y=code_block_7.out1, z=code_block_7.out2)
line_2 = Line.ByStartPointEndPoint(startPoint=byCoordinates_5, endPoint=byCoordinates_6)
radius_2 = DoubleSlider(200, range=0..2000 step 0.2)
height_2 = DoubleSlider(4000, range=1..5000 step 0.1)
angle_2 = IntegerSlider(0, range=0..360 step 45)
tilt_2 = DoubleSlider(0, range=0..100 step 0.1)
cyldnerical_steel_rod_2 = Python(IN[0]=line_2, IN[1]=radius_2, IN[2]=height_2, IN[3]=angle_2, IN[4]=tilt_2)  # CPython3; graph output; same code as cyldnerical_steel_rod
code_block_8 = CodeBlock { 2000; 0; 4000; }
byCoordinates_7 = Point.ByCoordinates(x=code_block_8.out0, y=code_block_8.out1, z=code_block_8.out2)
code_block_9 = CodeBlock { -3000; 0; 2500; }
byCoordinates_8 = Point.ByCoordinates(x=code_block_9.out0, y=code_block_9.out1, z=code_block_9.out2)
byStartPointEndPoint = Line.ByStartPointEndPoint(startPoint=byCoordinates_7, endPoint=byCoordinates_8)
thickness = DoubleSlider(400, range=0..10000 step 100)
width = DoubleSlider(10000, range=0..10000 step 100)
rectangular_metal_rod = Python(IN[0]=byStartPointEndPoint, IN[1]=thickness, IN[2]=width)  # CPython3
# ---------- rectangular_metal_rod.python (52 lines) ----------
import clr
clr.AddReference('ProtoGeometry')
from Autodesk.DesignScript.Geometry import *

# --- Class Definition ---
class MetalRodRect:
    def __init__(self, line, width, depth):
        self.line = line
        self.width = max(width, 0.01)
        self.depth = max(depth, 0.01)
        self.bottom = line.StartPoint
        self.top = line.EndPoint

    def make_geometry(self):
        # If top and bottom are the same, lift top slightly
        if self.bottom.IsAlmostEqualTo(self.top):
            self.top = Point.ByCoordinates(self.bottom.X, self.bottom.Y, self.bottom.Z + 0.1)

        # Create 4 points for rectangular cross-section at bottom
        p1 = Point.ByCoordinates(self.bottom.X + self.width/2, self.bottom.Y + self.depth/2, self.bottom.Z)
        p2 = Point.ByCoordinates(self.bottom.X - self.width/2, self.bottom.Y + self.depth/2, self.bottom.Z)
        p3 = Point.ByCoordinates(self.bottom.X - self.width/2, self.bottom.Y - self.depth/2, self.bottom.Z)
        p4 = Point.ByCoordinates(self.bottom.X + self.width/2, self.bottom.Y - self.depth/2, self.bottom.Z)

        rectBottom = Polygon.ByPoints([p1,p2,p3,p4])

        # Translate rectangle to top point
        moveVec = Vector.ByTwoPoints(self.bottom, self.top)
        rectTop = rectBottom.Translate(moveVec)

        # Loft between bottom and top rectangles
        try:
            rod = Solid.ByLoft([rectBottom, rectTop])
        except:
            # fallback if loft fails
            rod = Surface.ByLoft([rectBottom, rectTop])

        return rod

    def volume(self):
        return self.make_geometry().Volume

# --- Inputs ---
line = IN[0]       # Line
width = IN[1]      # Width slider
depth = IN[2]      # Depth slider

# --- Create instance ---
metal_rod = MetalRodRect(line, width, depth)

# --- Output geometry ---
OUT = metal_rod.make_geometry()
# ----------------------------------------
volume = Solid.Volume(solid=rectangular_metal_rod)
watch = Watch(volume)
area = Solid.Area(solid=rectangular_metal_rod)
watch_2 = Watch(area)
code_block_10 = CodeBlock { 3000; 0; 5000; }
byCoordinates_9 = Point.ByCoordinates(x=code_block_10.out0, y=code_block_10.out1, z=code_block_10.out2)
code_block_11 = CodeBlock { -3000; 0; 3000; }
byCoordinates_10 = Point.ByCoordinates(x=code_block_11.out0, y=code_block_11.out1, z=code_block_11.out2)
byStartPointEndPoint_2 = Line.ByStartPointEndPoint(startPoint=byCoordinates_9, endPoint=byCoordinates_10)
thickness_2 = DoubleSlider(400, range=0..10000 step 100)
width_2 = DoubleSlider(10000, range=0..10000 step 100)
rectangular_metal_rod_2 = Python(IN[0]=byStartPointEndPoint_2, IN[1]=thickness_2, IN[2]=width_2)  # CPython3; same code as rectangular_metal_rod
volume_2 = Solid.Volume(solid=rectangular_metal_rod_2)
watch_3 = Watch(volume_2)
code_block_12 = CodeBlock { -3000; 0; 2000; }
byCoordinates_11 = Point.ByCoordinates(x=code_block_12.out0, y=code_block_12.out1, z=code_block_12.out2)
code_block_13 = CodeBlock { -3000; 0; 3000; }
byCoordinates_12 = Point.ByCoordinates(x=code_block_13.out0, y=code_block_13.out1, z=code_block_13.out2)
byStartPointEndPoint_3 = Line.ByStartPointEndPoint(startPoint=byCoordinates_11, endPoint=byCoordinates_12)
thickness_3 = DoubleSlider(400, range=0..10000 step 100)
width_3 = DoubleSlider(7900, range=0..10000 step 100)
rectangular_metal_rod_3 = Python(IN[0]=byStartPointEndPoint_3, IN[1]=thickness_3, IN[2]=width_3)  # CPython3; same code as rectangular_metal_rod
volume_3 = Solid.Volume(solid=rectangular_metal_rod_3)
watch_4 = Watch(volume_3)
code_block_14 = CodeBlock { 3000; 4000; 0; }
byCoordinates_13 = Point.ByCoordinates(x=code_block_14.out0, y=code_block_14.out1, z=code_block_14.out2)
code_block_15 = CodeBlock { 3000; 4000; 5000; }
byCoordinates_14 = Point.ByCoordinates(x=code_block_15.out0, y=code_block_15.out1, z=code_block_15.out2)
line_3 = Line.ByStartPointEndPoint(startPoint=byCoordinates_13, endPoint=byCoordinates_14)
radius_3 = DoubleSlider(200, range=0..2000 step 0.2)
height_3 = DoubleSlider(5000, range=1..5000 step 0.1)
angle_3 = IntegerSlider(0, range=0..360 step 45)
tilt_3 = DoubleSlider(0, range=0..100 step 0.1)
cyldnerical_steel_rod_3 = Python(IN[0]=line_3, IN[1]=radius_3, IN[2]=height_3, IN[3]=angle_3, IN[4]=tilt_3)  # CPython3; graph output; same code as cyldnerical_steel_rod
volume_4 = Solid.Volume(solid=cyldnerical_steel_rod_3)
watch_5 = Watch(volume_4)
code_block_16 = CodeBlock { -3000; -4000; 0; }
byCoordinates_15 = Point.ByCoordinates(x=code_block_16.out0, y=code_block_16.out1, z=code_block_16.out2)
code_block_17 = CodeBlock { -3000; -4000; 3000; }
byCoordinates_16 = Point.ByCoordinates(x=code_block_17.out0, y=code_block_17.out1, z=code_block_17.out2)
line_4 = Line.ByStartPointEndPoint(startPoint=byCoordinates_15, endPoint=byCoordinates_16)
radius_4 = DoubleSlider(200, range=0..2000 step 0.2)
height_4 = DoubleSlider(3000, range=1..5000 step 0.1)
integer_slider = IntegerSlider(0, range=0..360 step 45)
tilt_4 = DoubleSlider(0, range=0..100 step 0.1)
cyldnerical_steel_rod_4 = Python(IN[0]=line_4, IN[1]=radius_4, IN[2]=height_4, IN[3]=integer_slider, IN[4]=tilt_4)  # CPython3; graph output; same code as cyldnerical_steel_rod
volume_5 = Solid.Volume(solid=cyldnerical_steel_rod_4)
watch_6 = Watch(volume_5)
code_block_18 = CodeBlock { 3000; -4000; 0; }
byCoordinates_17 = Point.ByCoordinates(x=code_block_18.out0, y=code_block_18.out1, z=code_block_18.out2)
code_block_19 = CodeBlock { 3000; -4000; 5000; }
byCoordinates_18 = Point.ByCoordinates(x=code_block_19.out0, y=code_block_19.out1, z=code_block_19.out2)
line_5 = Line.ByStartPointEndPoint(startPoint=byCoordinates_17, endPoint=byCoordinates_18)
radius_5 = DoubleSlider(200, range=0..2000 step 0.2)
height_5 = DoubleSlider(5000, range=1..5000 step 0.1)
angle_4 = IntegerSlider(0, range=0..360 step 45)
tilt_5 = DoubleSlider(0, range=0..100 step 0.1)
cyldnerical_steel_rod_5 = Python(IN[0]=line_5, IN[1]=radius_5, IN[2]=height_5, IN[3]=angle_4, IN[4]=tilt_5)  # CPython3; graph output; same code as cyldnerical_steel_rod
volume_6 = Solid.Volume(solid=cyldnerical_steel_rod_5)
watch_7 = Watch(volume_6)
code_block_20 = CodeBlock { -3000; 0; 0; }
byCoordinates_19 = Point.ByCoordinates(x=code_block_20.out0, y=code_block_20.out1, z=code_block_20.out2)
code_block_21 = CodeBlock { -3000; 0; 3000; }
byCoordinates_20 = Point.ByCoordinates(x=code_block_21.out0, y=code_block_21.out1, z=code_block_21.out2)
line_6 = Line.ByStartPointEndPoint(startPoint=byCoordinates_19, endPoint=byCoordinates_20)
radius_6 = DoubleSlider(200, range=0..2000 step 0.2)
height_6 = DoubleSlider(3000, range=1..5000 step 0.1)
angle_5 = IntegerSlider(0, range=0..360 step 45)
tilt_6 = DoubleSlider(0, range=0..100 step 0.1)
cyldnerical_steel_rod_6 = Python(IN[0]=line_6, IN[1]=radius_6, IN[2]=height_6, IN[3]=angle_5, IN[4]=tilt_6)  # CPython3; graph output; same code as cyldnerical_steel_rod
volume_7 = Solid.Volume(solid=cyldnerical_steel_rod_6)
watch_8 = Watch(volume_7)
code_block_22 = CodeBlock { 2000; -2000; 0; }
byCoordinates_21 = Point.ByCoordinates(x=code_block_22.out0, y=code_block_22.out1, z=code_block_22.out2)
code_block_23 = CodeBlock { 2000; -2000; 3500; }
byCoordinates_22 = Point.ByCoordinates(x=code_block_23.out0, y=code_block_23.out1, z=code_block_23.out2)
line_7 = Line.ByStartPointEndPoint(startPoint=byCoordinates_21, endPoint=byCoordinates_22)
radius_7 = DoubleSlider(200, range=0..2000 step 0.2)
height_7 = DoubleSlider(4000, range=1..5000 step 0.1)
angle_6 = IntegerSlider(0, range=0..360 step 45)
tilt_7 = DoubleSlider(100, range=0..100 step 0.1)
cyldnerical_steel_rod_7 = Python(IN[0]=line_7, IN[1]=radius_7, IN[2]=height_7, IN[3]=angle_6, IN[4]=tilt_7)  # CPython3; graph output; same code as cyldnerical_steel_rod
volume_8 = Solid.Volume(solid=cyldnerical_steel_rod_7)
watch_9 = Watch(volume_8)
