# Dynamo graph 1850920.dyn (Dynamo 4.0.0.3277)

# group: Don't touch this ground
code_block = CodeBlock { -5500; -5000; -200; }  # frozen
byCoordinates = Point.ByCoordinates(x=code_block.out0, y=code_block.out1, z=code_block.out2)  # frozen
code_block_2 = CodeBlock { 4500; 5000; 0; }  # frozen
byCoordinates_2 = Point.ByCoordinates(x=code_block_2.out0, y=code_block_2.out1, z=code_block_2.out2)  # frozen
byCorners = Cuboid.ByCorners(lowPoint=byCoordinates, highPoint=byCoordinates_2)  # frozen
code_block_3 = CodeBlock { 0; 100; 0; }  # frozen
byARGB = Color.ByARGB(red=code_block_3.out0, green=code_block_3.out1, blue=code_block_3.out2)  # frozen
byGeometryColor = Modifiers.GeometryColor.ByGeometryColor(geometry=byCorners, color=byARGB)  # frozen

code_block_4 = CodeBlock { -5500; -5000; -200; }  # frozen
byCoordinates_3 = Point.ByCoordinates(x=code_block_4.out0, y=code_block_4.out1, z=code_block_4.out2)  # frozen
code_block_5 = CodeBlock { 4500; 5000; 0; }  # frozen
byCoordinates_4 = Point.ByCoordinates(x=code_block_5.out0, y=code_block_5.out1, z=code_block_5.out2)  # frozen
byCorners_2 = Cuboid.ByCorners(lowPoint=byCoordinates_3, highPoint=byCoordinates_4)  # frozen
code_block_6 = CodeBlock { 0; 100; 0; }  # frozen
byARGB_2 = Color.ByARGB(red=code_block_6.out0, green=code_block_6.out1, blue=code_block_6.out2)  # frozen
byGeometryColor_2 = Modifiers.GeometryColor.ByGeometryColor(geometry=byCorners_2, color=byARGB_2)  # frozen
number = DoubleInput(-500)
number_2 = DoubleInput(0)
byCoordinates_5 = Point.ByCoordinates(x=number, y=number_2)
integer_slider = IntegerSlider(10000, range=0..10000 step 1)
integer_slider_2 = IntegerSlider(50, range=0..10000 step 1)
integer_slider_3 = IntegerSlider(10000, range=0..10000 step 1)
class_oak_rectangular_board = Python()  # PythonNet3; unwired: IN[0]
# ---------- class_oak_rectangular_board.python (19 lines) ----------
# Load the Python Standard and DesignScript Libraries
import sys
import clr
import math
clr.AddReference('ProtoGeometry')
from Autodesk.DesignScript.Geometry import *

class OakBoard:
    def __init__(self, coordinates, width, height, length, material="Oak"):
      self.coordinate = coordinates
      self.width = width
      self.length = length
      self.height = height
      self.material = material
    def show_geometry(self):
      return Cuboid.ByLengths(self.coordinate,self.width, self.length, self.height)
    def Volume(self):
      return int(self.width*self.height*self.length)
OUT = OakBoard
# ----------------------------------------
single_instance_of_oak = Python(IN[0]=byCoordinates_5, IN[1]=integer_slider, IN[2]=integer_slider_2, IN[3]=integer_slider_3, IN[4]=class_oak_rectangular_board)  # "Single Instance of Oak Rectangular Board"; PythonNet3
# ---------- single_instance_of_oak.python (3 lines) ----------
OakBoard = IN[4]
O = OakBoard(IN[0],IN[1],IN[2],IN[3], material = "Oak")
OUT = O.show_geometry()
# ----------------------------------------
radius_of_diagonal_circular_rod = DoubleSlider(50, range=0..100 step 0.1)
number_slider = DoubleSlider(-5000, range=-5000..100 step 0.1)
number_slider_2 = DoubleSlider(-5125, range=-5125..100 step 0.1)
number_slider_3 = DoubleSlider(-5000, range=-5000..100 step 0.1)
number_slider_4 = DoubleSlider(-4625, range=-4625..100 step 0.1)
number_slider_5 = DoubleSlider(-4500, range=-4500..100 step 0.1)
number_slider_6 = DoubleSlider(-4000, range=-4000..100 step 0.1)
number_slider_7 = DoubleSlider(-3500, range=-3500..100 step 0.1)
number_slider_8 = DoubleSlider(-3125, range=-3125..100 step 0.1)
number_slider_9 = DoubleSlider(-3250, range=-3250..100 step 0.1)
number_slider_10 = DoubleSlider(-3375, range=-3375..100 step 0.1)
number_slider_11 = DoubleSlider(-3125, range=-3125..100 step 0.1)
number_slider_12 = DoubleSlider(-2800, range=-2800..100 step 0.1)
number_slider_13 = DoubleSlider(-2625, range=-2625..100 step 0.1)
number_slider_14 = DoubleSlider(-2500, range=-2500..100 step 0.1)
number_slider_15 = DoubleSlider(-2250, range=-2250..100 step 0.1)
number_slider_16 = DoubleSlider(-1875, range=-1875..100 step 0.1)
number_slider_17 = DoubleSlider(-1625, range=-1625..100 step 0.1)
number_slider_18 = DoubleSlider(-1625, range=-1625..100 step 0.1)
number_slider_19 = DoubleSlider(-1750, range=-1750..100 step 0.1)
number_slider_20 = DoubleSlider(-1500, range=-1500..100 step 0.1)
number_slider_21 = DoubleSlider(-1250, range=-1250..100 step 0.1)
number_slider_22 = DoubleSlider(-1000, range=-1000..100 step 0.1)
number_slider_23 = DoubleSlider(-750, range=-750..100 step 0.1)
number_slider_24 = DoubleSlider(-500, range=-500..100 step 0.1)
number_slider_25 = DoubleSlider(-250, range=-250..100 step 0.1)
number_slider_26 = DoubleSlider(0, range=0..100 step 0.1)
number_slider_27 = DoubleSlider(250, range=0..250 step 0.1)
number_slider_28 = DoubleSlider(500, range=0..500 step 0.1)
number_slider_29 = DoubleSlider(750, range=0..750 step 0.1)
number_slider_30 = DoubleSlider(1000, range=0..1000 step 0.1)
number_slider_31 = DoubleSlider(1250, range=0..1250 step 0.1)
number_slider_32 = DoubleSlider(1500, range=0..1500 step 0.1)
number_slider_33 = DoubleSlider(1750, range=0..1750 step 0.1)
number_slider_34 = DoubleSlider(2000, range=0..2000 step 0.1)
number_slider_35 = DoubleSlider(2125, range=-1..2125 step 0.1)
number_slider_36 = DoubleSlider(2250, range=-1..2250 step 0.1)
number_slider_37 = DoubleSlider(2250, range=0..2250 step 0.1)
number_slider_38 = DoubleSlider(2200, range=0..2200 step 0.1)
number_slider_39 = DoubleSlider(2375, range=0..2375 step 0.1)
number_slider_40 = DoubleSlider(2625, range=0..2625 step 0.1)
number_slider_41 = DoubleSlider(2875, range=0..2875 step 0.1)
number_slider_42 = DoubleSlider(3125, range=0..3125 step 0.1)
number_slider_43 = DoubleSlider(3375, range=0..3375 step 0.1)
number_slider_44 = DoubleSlider(3625, range=0..3625 step 0.1)
x_coordinates = List.Create(item0=number_slider, item1=number_slider_2, item2=number_slider_3, item3=number_slider_4, item4=number_slider_5, item5=number_slider_6, item6=number_slider_7, item7=number_slider_8, item8=number_slider_9, item9=number_slider_10, item10=number_slider_11, item11=number_slider_12, item12=number_slider_13, item13=number_slider_14, item14=number_slider_15, item15=number_slider_16, item16=number_slider_17, item17=number_slider_18, item18=number_slider_19, item19=number_slider_20, item20=number_slider_21, item21=number_slider_22, item22=number_slider_23, item23=number_slider_24, item24=number_slider_25, item25=number_slider_26, item26=number_slider_27, item27=number_slider_28, item28=number_slider_29, item29=number_slider_30, item30=number_slider_31, item31=number_slider_32, item32=number_slider_33, item33=number_slider_34, item34=number_slider_35, item35=number_slider_36, item36=number_slider_37, item37=number_slider_38, item38=number_slider_39, item39=number_slider_40, item40=number_slider_41, item41=number_slider_42, item42=number_slider_43, item43=number_slider_44)
number_slider_45 = DoubleSlider(-5000, range=-5000..100 step 0.1)
number_slider_46 = DoubleSlider(-4500, range=-5000..100 step 0.1)
number_slider_47 = DoubleSlider(-3750, range=-3750..100 step 0.1)
number_slider_48 = DoubleSlider(-3500, range=-3500..100 step 0.1)
number_slider_49 = DoubleSlider(-3000, range=-3000..100 step 0.1)
number_slider_50 = DoubleSlider(-2500, range=-2500..100 step 0.1)
number_slider_51 = DoubleSlider(-2000, range=-2000..100 step 0.1)
number_slider_52 = DoubleSlider(-1500, range=-1500..100 step 0.1)
number_slider_53 = DoubleSlider(-1000, range=-1000..100 step 0.1)
number_slider_54 = DoubleSlider(-500, range=-500..100 step 0.1)
number_slider_55 = DoubleSlider(-250, range=-250..100 step 0.1)
number_slider_56 = DoubleSlider(-300, range=-300..100 step 0.1)
number_slider_57 = DoubleSlider(-125, range=-125..100 step 0.1)
number_slider_58 = DoubleSlider(250, range=0..250 step 0.1)
number_slider_59 = DoubleSlider(500, range=0..500 step 0.1)
number_slider_60 = DoubleSlider(625, range=0..625 step 0.1)
number_slider_61 = DoubleSlider(875, range=0..875 step 0.1)
number_slider_62 = DoubleSlider(1375, range=0..1375 step 0.1)
number_slider_63 = DoubleSlider(1875, range=0..1875 step 0.1)
number_slider_64 = DoubleSlider(2250, range=0..2250 step 0.1)
number_slider_65 = DoubleSlider(2125, range=0..2125 step 0.1)
number_slider_66 = DoubleSlider(2000, range=0..2000 step 0.1)
number_slider_67 = DoubleSlider(1925, range=0..1925 step 0.1)
number_slider_68 = DoubleSlider(2125, range=0..2125 step 0.1)
number_slider_69 = DoubleSlider(2500, range=0..2500 step 0.1)
number_slider_70 = DoubleSlider(2750, range=0..2750 step 0.1)
number_slider_71 = DoubleSlider(2875, range=0..2875 step 0.1)
number_slider_72 = DoubleSlider(2900, range=0..2900 step 0.1)
number_slider_73 = DoubleSlider(3000, range=0..3000 step 0.1)
number_slider_74 = DoubleSlider(3125, range=0..3125 step 0.1)
number_slider_75 = DoubleSlider(3125, range=0..3125 step 0.1)
number_slider_76 = DoubleSlider(3000, range=0..3000 step 0.1)
number_slider_77 = DoubleSlider(2875, range=0..2875 step 0.1)
number_slider_78 = DoubleSlider(3000, range=0..3000 step 0.1)
number_slider_79 = DoubleSlider(3250, range=0..3250 step 0.1)
number_slider_80 = DoubleSlider(3375, range=0..3375 step 0.1)
number_slider_81 = DoubleSlider(3625, range=0..3625 step 0.1)
number_slider_82 = DoubleSlider(3875, range=0..3875 step 0.1)
number_slider_83 = DoubleSlider(4000, range=0..4000 step 0.1)
number_slider_84 = DoubleSlider(4000, range=0..4000 step 0.1)
number_slider_85 = DoubleSlider(3950, range=0..3950 step 0.1)
number_slider_86 = DoubleSlider(3900, range=0..3900 step 0.1)
number_slider_87 = DoubleSlider(3950, range=0..3950 step 0.1)
number_slider_88 = DoubleSlider(4000, range=0..4000 step 0.1)
y_coordinates = List.Create(item0=number_slider_45, item1=number_slider_46, item2=number_slider_47, item3=number_slider_48, item4=number_slider_49, item5=number_slider_50, item6=number_slider_51, item7=number_slider_52, item8=number_slider_53, item9=number_slider_54, item10=number_slider_55, item11=number_slider_56, item12=number_slider_57, item13=number_slider_58, item14=number_slider_59, item15=number_slider_60, item16=number_slider_61, item17=number_slider_62, item18=number_slider_63, item19=number_slider_64, item20=number_slider_65, item21=number_slider_66, item22=number_slider_67, item23=number_slider_68, item24=number_slider_69, item25=number_slider_70, item26=number_slider_71, item27=number_slider_72, item28=number_slider_73, item29=number_slider_74, item30=number_slider_75, item31=number_slider_76, item32=number_slider_77, item33=number_slider_78, item34=number_slider_79, item35=number_slider_80, item36=number_slider_81, item37=number_slider_82, item38=number_slider_83, item39=number_slider_84, item40=number_slider_85, item41=number_slider_86, item42=number_slider_87, item43=number_slider_88)
beginning_height = DoubleSlider(500, range=0..1000 step 0.1)
end_height = DoubleSlider(4500, range=0..5000 step 0.1)
number_slider_89 = DoubleSlider(43, range=0..100 step 0.1)
range = Range(start=beginning_height, end=end_height, step=number_slider_89)
byCoordinates_6 = Point.ByCoordinates(x=x_coordinates, y=y_coordinates, z=range)
byControlPoints = NurbsCurve.ByControlPoints(points=byCoordinates_6)
number_slider_90 = DoubleSlider(40, range=0..1000 step 0.1)
pointsAtEqualChordLength = Curve.PointsAtEqualChordLength(curve=byControlPoints, divisions=number_slider_90)
number_slider_91 = DoubleSlider(300, range=0..2000 step 0.1)
number_slider_92 = DoubleSlider(-100, range=-2000..2000 step 0.1)
number_slider_93 = DoubleSlider(500, range=0..6000 step 0.1)
translate = Geometry.Translate(geometry=pointsAtEqualChordLength, xTranslation=number_slider_91, yTranslation=number_slider_92, zTranslation=number_slider_93)
class_pine_circular_rod = Python()  # PythonNet3; unwired: IN[0]
# ---------- class_pine_circular_rod.python (19 lines) ----------
# Load the Python Standard and DesignScript Libraries
import sys
import clr
import math
clr.AddReference('ProtoGeometry')
from Autodesk.DesignScript.Geometry import *

class CircularRod:
    def __init__(self, bottomPoint, topPoint, radius, material = "Pine"):
      self.bottom = bottomPoint
      self.top = topPoint
      self.radius = radius
    def show_geometry(self):
      return Cylinder.ByPointsRadius (self.bottom, self.top, self.radius)
    def Volume(self):
      return int(abs((self.radius)**2*math.pi*abs(self.top.Z-self.bottom.Z)))
  
OUT = CircularRod 
          
# ----------------------------------------
multiple_instances_of_diagonal = Python(IN[0]=radius_of_diagonal_circular_rod, IN[1]=translate, IN[2]=pointsAtEqualChordLength, IN[3]=class_pine_circular_rod)  # "Multiple Instances of diagonal Circular Rods (Right)"; PythonNet3
# ---------- multiple_instances_of_diagonal.python (12 lines) ----------
CircularRod = IN[3]
bottomPoint = IN[2]
topPoint = IN[1]
radius = IN[0]
rods = []
count = min(len(bottomPoint), len(topPoint))
for i in range(count):
    bottom = bottomPoint[i]
    top = topPoint[i]
    rod = CircularRod(bottom,top,radius)
    rods.append(rod.show_geometry())
OUT = rods        
# ----------------------------------------
number_slider_94 = DoubleSlider(-300, range=-300..100 step 0.1)
number_slider_95 = DoubleSlider(100, range=0..100 step 0.1)
translate_2 = Geometry.Translate(geometry=pointsAtEqualChordLength, xTranslation=number_slider_94, yTranslation=number_slider_95, zTranslation=number_slider_93)
multiple_instances_of_diagonal_2 = Python(IN[0]=radius_of_diagonal_circular_rod, IN[1]=translate_2, IN[2]=pointsAtEqualChordLength, IN[3]=class_pine_circular_rod)  # "Multiple Instances of diagonal Circular Rods (Left)"; PythonNet3; same code as multiple_instances_of_diagonal
number_slider_96 = DoubleSlider(2000, range=0..5000 step 0.1)
number_slider_97 = DoubleSlider(-3000, range=-3000..5000 step 0.1)
byCoordinates_7 = Point.ByCoordinates(x=number_slider_96, y=number_slider_97)
number_slider_98 = DoubleSlider(1271.2, range=0..2000 step 0.1)
byCenterRadius = Sphere.ByCenterPointRadius(centerPoint=byCoordinates_7, radius=number_slider_98)  # "Sphere.ByCenterRadius"
code_block_7 = CodeBlock { 0; 0; 1; }
byCoordinates_8 = Vector.ByCoordinates(x=code_block_7.out0, y=code_block_7.out1, z=code_block_7.out2)
byOriginNormal = Plane.ByOriginNormal(normal=byCoordinates_8)
split = Geometry.Split(geometry=byCenterRadius, other=byOriginNormal)
code_block_8 = CodeBlock { true; false; }
list_create = List.Create(item0=code_block_8.out0, item1=code_block_8.out1)
filterByBoolMask = List.FilterByBoolMask(list=split, mask=list_create)
number_slider_99 = DoubleSlider(0, range=0..100 step 0.1)
getItemAtIndex = List.GetItemAtIndex(list=filterByBoolMask.in, index=number_slider_99)
number_slider_100 = DoubleSlider(100, range=0..1000 step 0.1)
thinShell = Solid.ThinShell(solid=getItemAtIndex, internalFaceThickness=number_slider_100)
number_slider_101 = DoubleSlider(250, range=0..250 step 0.1)
number_slider_102 = DoubleSlider(-2500, range=-2500..2500 step 0.1)
byCoordinates_9 = Point.ByCoordinates(x=number_slider_101, y=number_slider_102)
number_slider_103 = DoubleSlider(1000, range=0..2000 step 0.1)
byCenterRadius_2 = Sphere.ByCenterPointRadius(centerPoint=byCoordinates_9, radius=number_slider_103)  # "Sphere.ByCenterRadius"
number_slider_104 = DoubleSlider(100, range=0..100 step 0.1)
byCoordinates_10 = Point.ByCoordinates(z=number_slider_104)
byCoordinates_11 = Vector.ByCoordinates(x=code_block_7.out0, y=code_block_7.out1, z=code_block_7.out2)
byOriginNormal_2 = Plane.ByOriginNormal(origin=byCoordinates_10, normal=byCoordinates_11)
split_2 = Geometry.Split(geometry=byCenterRadius_2, other=byOriginNormal_2)
code_block_9 = CodeBlock { true; false; }
list_create_2 = List.Create(item0=code_block_9.out0, item1=code_block_9.out1)
filterByBoolMask_2 = List.FilterByBoolMask(list=split_2, mask=list_create_2)
number_slider_105 = DoubleSlider(0, range=0..100 step 0.1)
getItemAtIndex_2 = List.GetItemAtIndex(list=filterByBoolMask_2.in, index=number_slider_105)
differenceAll = Solid.DifferenceAll(solid=thinShell, others=getItemAtIndex_2)
number_slider_106 = DoubleSlider(150, range=0..250 step 0.1)
code_block_10 = CodeBlock { -5500; 4500; 500; }
range_2 = Range(start=code_block_10.out0, end=code_block_10.out1, step=code_block_10.out2)
code_block_11 = CodeBlock { 5000; }
byCoordinates_12 = Point.ByCoordinates(x=range_2, y=code_block_11)
number_slider_107 = DoubleSlider(2500, range=0..3000 step 0.1)
byCoordinates_13 = Point.ByCoordinates(x=range_2, y=code_block_11, z=number_slider_107)
multiple_instances_of_circular = Python(IN[0]=number_slider_106, IN[1]=byCoordinates_12, IN[2]=byCoordinates_13, IN[3]=class_pine_circular_rod)  # "Multiple Instances of Circular Rod"; PythonNet3
# ---------- multiple_instances_of_circular.python (17 lines) ----------
# Load the Python Standard and DesignScript Libraries
import sys
import clr
clr.AddReference('ProtoGeometry')
from Autodesk.DesignScript.Geometry import *
CircularRod = IN[3]
bottomPoint = IN[2]
topPoint = IN[1]
radius = IN[0]
rods = []
count = min(len(bottomPoint), len(topPoint))
for i in range(count):
    bottom = bottomPoint[i]
    top = topPoint[i]
    rod = CircularRod(bottom,top,radius)
    rods.append(rod.show_geometry())
OUT = rods 
# ----------------------------------------
code_block_12 = CodeBlock {  }
beginning_height_2 = DoubleSlider(1000, range=0..1000 step 0.1)
end_height_2 = DoubleSlider(5000, range=0..5000 step 0.1)
number_slider_108 = DoubleSlider(43, range=0..100 step 0.1)
range_3 = Range(start=beginning_height_2, end=end_height_2, step=number_slider_108)
byCoordinates_14 = Point.ByCoordinates(x=x_coordinates, y=y_coordinates, z=range_3)
byControlPoints_2 = NurbsCurve.ByControlPoints(points=byCoordinates_14)
number_slider_109 = DoubleSlider(40, range=0..1000 step 0.1)
pointsAtEqualChordLength_2 = Curve.PointsAtEqualChordLength(curve=byControlPoints_2, divisions=number_slider_109)
number_slider_110 = DoubleSlider(2.5, range=-2..100 step 0.1)
takeEveryNthItem = List.TakeEveryNthItem(list=pointsAtEqualChordLength_2, n=number_slider_110)
byStartPointEndPoint = Line.ByStartPointEndPoint(startPoint=byCoordinates_13, endPoint=takeEveryNthItem)
byLoft = Surface.ByLoft(crossSections=byStartPointEndPoint)
number_slider_111 = DoubleSlider(100, range=0..10000 step 0.1)
number_slider_112 = DoubleSlider(40, range=0..200 step 0.1)
number_slider_113 = DoubleSlider(1, range=0..100 step 0.1)
sequence = Sequence(start=number_slider_111, amount=number_slider_112, step=number_slider_113)
flatten = List.Flatten(list=sequence)
byCoordinates_15 = Point.ByCoordinates(x=x_coordinates, y=y_coordinates)
byControlPoints_3 = NurbsCurve.ByControlPoints(points=byCoordinates_15)
number_slider_114 = DoubleSlider(40, range=0..1000 step 0.1)
pointsAtEqualChordLength_3 = Curve.PointsAtEqualChordLength(curve=byControlPoints_3, divisions=number_slider_114)
flatten_2 = List.Flatten(list=pointsAtEqualChordLength_3)
flatten_3 = List.Flatten(list=pointsAtEqualChordLength_2)
multiple_instances_of_pine = Python(IN[0]=flatten, IN[1]=flatten_2, IN[2]=flatten_3, IN[3]=class_pine_circular_rod)  # "Multiple Instances of Pine Circular Rod"; PythonNet3
# ---------- multiple_instances_of_pine.python (17 lines) ----------
CircularRod = IN[3]
bottomPoint = IN[2]
topPoint = IN[1]
radius = IN[0]
material = "Pine"
rods = []
volumes=[]
count = min(len(bottomPoint), len(topPoint))
for i in range(count):
    r = radius[i] if i < len(radius) else radius[-1]
    bottom = bottomPoint[i]
    top = topPoint[i]
    rod = CircularRod(bottom,top,r,material = "Pine")
    V = rod.Volume()
    rods.append(rod.show_geometry())
    volumes.append(str(V)+ "mm³")
OUT = rods, volumes        
# ----------------------------------------
geometry_volume = Watch(multiple_instances_of_pine)
x_coordinate = DoubleInput(-5500)
y_coordinate = DoubleInput(0)
byCoordinates_16 = Point.ByCoordinates(x=x_coordinate, y=y_coordinate)
x_coordinate_2 = DoubleInput(4500)
y_coordinate_2 = DoubleInput(0)
byCoordinates_17 = Point.ByCoordinates(x=x_coordinate_2, y=y_coordinate_2)
byStartPointEndPoint_2 = Line.ByStartPointEndPoint(startPoint=byCoordinates_16, endPoint=byCoordinates_17)
number_3 = DoubleInput(150)
pointsAtEqualSegmentLength = Curve.PointsAtEqualSegmentLength(curve=byStartPointEndPoint_2, divisions=number_3)
width = IntegerSlider(1281, range=0..10000 step 1)
length = IntegerSlider(200, range=0..10000 step 1)
height = IntegerSlider(10000, range=0..10000 step 1)
multiple_instances_of_oak = Python(IN[0]=pointsAtEqualSegmentLength, IN[1]=width, IN[2]=length, IN[3]=height, IN[4]=class_oak_rectangular_board)  # "Multiple Instances of Oak Rectangular Board"; PythonNet3
# ---------- multiple_instances_of_oak.python (16 lines) ----------
material = "Oak"
coordinates = IN[0]
width = IN[1]
length = IN[2]
height = IN[3]
OakBoard = IN[4]
board = OakBoard(coordinates, width, length, height, material="Oak")
boards=[]
volumes = str(board.Volume()) + " mm³"
count = len(coordinates)
for i in range(count):
    cOordinates = coordinates[i]
    board = OakBoard(cOordinates, width, length, height, material="Oak")
    boards.append(board.show_geometry())
    
OUT = boards, volumes
# ----------------------------------------
watch = Watch(multiple_instances_of_oak)
