# Dynamo graph 1850932.dyn (Dynamo 3.6.0.9395)

# group: Don't touch this ground
code_block = CodeBlock { -5000; -5000; -200; }  # frozen
byCoordinates = Point.ByCoordinates(x=code_block.out0, y=code_block.out1, z=code_block.out2)  # frozen
code_block_2 = CodeBlock { 5000; 5000; 0; }  # frozen
byCoordinates_2 = Point.ByCoordinates(x=code_block_2.out0, y=code_block_2.out1, z=code_block_2.out2)  # frozen
byCorners = Cuboid.ByCorners(lowPoint=byCoordinates, highPoint=byCoordinates_2)  # frozen
code_block_3 = CodeBlock { 0; 100; 0; }  # frozen
byARGB = Color.ByARGB(red=code_block_3.out0, green=code_block_3.out1, blue=code_block_3.out2)  # frozen
byGeometryColor = Modifiers.GeometryColor.ByGeometryColor(geometry=byCorners, color=byARGB)  # frozen

code_block_4 = CodeBlock { 0; }
frame_count = DoubleSlider(20, range=5..20 step 1)
code_block_5 = CodeBlock { 1; }
sequence = Sequence(start=code_block_4, amount=frame_count, step=code_block_5)
depth_spacing = DoubleSlider(500, range=200..500 step 1)
frame_origin = CodeBlock(Sequence=sequence, Depth_spacing=depth_spacing) { Sequence*Depth_spacing; }
code_block_6 = CodeBlock { 0; }
frame_locations = Point.ByCoordinates(x=frame_origin, y=code_block_6, z=code_block_6)
left_vert_support_bottom_point = Point.ByCoordinates(x=frame_origin, y=code_block_6, z=code_block_6)
height_min = DoubleSlider(2500, range=1000..3000 step 1)
height_max = DoubleSlider(4000, range=3000..5000 step 1)
remapRange = Math.RemapRange(numbers=sequence, newMin=code_block_4, newMax=code_block_5)
parabolic_height_curve = CodeBlock(Height_Min=height_min, Height_Max=height_max, x=remapRange) { h = Height_Min - (Height_Min - Height_Max) * (4 * (x - 0.5) * (x - 0.5)); }
left_vert_support_top_point = Point.ByCoordinates(x=frame_origin, y=code_block_6, z=parabolic_height_curve)
left_vert_support_line = Line.ByStartPointEndPoint(startPoint=left_vert_support_bottom_point, endPoint=left_vert_support_top_point)
width = DoubleSlider(3000, range=-4900..4900 step 1)
right_vert_support_botto_point = Point.ByCoordinates(x=frame_origin, y=width, z=code_block_6)
right_vert_support_top_point = Point.ByCoordinates(x=frame_origin, y=width, z=parabolic_height_curve)
right_vert_support_line = Line.ByStartPointEndPoint(startPoint=right_vert_support_botto_point, endPoint=right_vert_support_top_point)
horiz_connecting_line = Line.ByStartPointEndPoint(startPoint=left_vert_support_top_point, endPoint=right_vert_support_top_point)
all_lines = List.Create(item0=left_vert_support_line, item1=right_vert_support_line, item2=horiz_connecting_line)
left_line = CodeBlock(bottomPoint=left_vert_support_bottom_point, topPoint=left_vert_support_top_point) { bottomPoint; topPoint; }
left_lines = List.Create(item0=left_line.bottomPoint, item1=left_line.topPoint)
all_4_points = List.Create(item0=left_vert_support_bottom_point, item1=right_vert_support_botto_point, item2=right_vert_support_top_point, item3=left_vert_support_top_point)
code_block_7 = CodeBlock { -4900; 0; 0; }
byCoordinates_3 = Vector.ByCoordinates(x=code_block_7.out0, y=code_block_7.out1, z=code_block_7.out2)
all_foujr_points_in_correct = Geometry.Translate(geometry=all_4_points, direction=byCoordinates_3)  # "All foujr points in correct spots"
code_block_8 = CodeBlock { 0; }
bottom_left_points_new = List.GetItemAtIndex(list=all_foujr_points_in_correct, index=code_block_8)
code_block_9 = CodeBlock { 3; }
top_left_points_new = List.GetItemAtIndex(list=all_foujr_points_in_correct, index=code_block_9)
beam_width = DoubleSlider(150, range=10..200 step 1)
beam_depth = DoubleSlider(150, range=10..200 step 1)
left_side_class_definition_and = Python(IN[0]=bottom_left_points_new, IN[1]=top_left_points_new, IN[2]=beam_width, IN[3]=beam_depth)  # "Left side class definition and instances timber"; CPython3
# ---------- left_side_class_definition_and.python (64 lines) ----------
import clr
clr.AddReference('ProtoGeometry')
from Autodesk.DesignScript.Geometry import *

class TimberBeam:
    def __init__(self, bottom_point, top_point, width, depth):
        self.bottom = bottom_point
        self.top = top_point
        self.width = width
        self.depth = depth
        self.geometry = None
        self.volume = None
        self.material = "Timber"
        
    def generate_geometry(self):
        vec = Vector.ByTwoPoints(self.bottom, self.top)
        height = vec.Length

        midpoint = self.bottom.Translate(vec.Scale(0.5))
        
        zAxis = vec.Normalized()
        xAxis = Vector.XAxis()

        if abs(zAxis.Dot(xAxis)) > 0.99:
            xAxis = Vector.YAxis()

        yAxis = zAxis.Cross(xAxis).Normalized()
        xAxis = yAxis.Cross(zAxis).Normalized()

        cs = CoordinateSystem.ByOriginVectors(midpoint, xAxis, yAxis, zAxis)
        self.geometry = Cuboid.ByLengths(cs, self.width, self.depth, height)
        return self.geometry

    def compute_volume(self):
        if not self.geometry:
            self.generate_geometry()
        self.volume = self.geometry.Volume
        return self.volume

# Inputs
bottom_points = IN[0]
top_points = IN[1]
width = IN[2]
depth = IN[3]

geometries = []
volumes = []
materials = []

total_volume = 0

for bottom, top in zip(bottom_points, top_points):
    beam = TimberBeam(bottom, top, width, depth)

    geom = beam.generate_geometry()
    vol = beam.compute_volume()

    geometries.append(geom)
    volumes.append(vol)
    materials.append(beam.material)

    total_volume += vol

OUT = (geometries, volumes, total_volume, materials)
# ----------------------------------------
code_block_10 = CodeBlock { 2; }
getItemAtIndex = List.GetItemAtIndex(list=left_side_class_definition_and, index=code_block_10)
code_block_11 = CodeBlock { 1; }
bottom_right_points_new = List.GetItemAtIndex(list=all_foujr_points_in_correct, index=code_block_11)
code_block_12 = CodeBlock { 2; }
top_right_points_new = List.GetItemAtIndex(list=all_foujr_points_in_correct, index=code_block_12)
right_side_class_definition_and = Python(IN[0]=bottom_right_points_new, IN[1]=top_right_points_new, IN[2]=beam_width, IN[3]=beam_depth)  # "Right side class definition and instances timber"; CPython3; same code as left_side_class_definition_and
getItemAtIndex_2 = List.GetItemAtIndex(list=right_side_class_definition_and, index=code_block_10)
code_block_13 = CodeBlock(leftsideVol=getItemAtIndex, rightsideVol=getItemAtIndex_2) { timberVol=leftsideVol+rightsideVol; }
total_timber_volume_mm_3 = Watch(code_block_13)
horizontal_class_definition_and = Python(IN[0]=top_left_points_new, IN[1]=top_right_points_new, IN[2]=beam_width, IN[3]=beam_depth)  # "Horizontal class definition and instances aluminum"; CPython3
# ---------- horizontal_class_definition_and.python (69 lines) ----------
import clr
clr.AddReference('ProtoGeometry')
from Autodesk.DesignScript.Geometry import *

class AluminumBeam:
    def __init__(self, left_point, right_point, width, depth):
        self.left = left_point
        self.right = right_point
        self.width = width
        self.depth = depth
        self.material = "Aluminum"
        self.geometry = None
        self.volume = None

    
    def generate_geometry(self):
        vec = Vector.ByTwoPoints(self.left, self.right)
        length = vec.Length
        midpoint = self.left.Translate(vec.Scale(0.5))
        xAxis = vec.Normalized()        
        zAxis = Vector.ZAxis()          
        
        if abs(xAxis.Dot(zAxis)) > 0.99:
            zAxis = Vector.YAxis()

        yAxis = zAxis.Cross(xAxis).Normalized()
        zAxis = xAxis.Cross(yAxis).Normalized()

        cs = CoordinateSystem.ByOriginVectors(midpoint, xAxis, yAxis, zAxis)

        cuboid = Cuboid.ByLengths(cs, length, self.width, self.depth)

        halfDown = -(self.depth / 2.0)
        downwardVector = Vector.ZAxis().Scale(halfDown)

        self.geometry = cuboid.Translate(downwardVector)

        return self.geometry

    def compute_volume(self):
        if not self.geometry:
            self.generate_geometry()
        self.volume = self.geometry.Volume
        return self.volume

top_left_points  = IN[0]
top_right_points = IN[1]
width = IN[2]
depth = IN[3]

geometries = []
volumes = []
materials = []
total_volume = 0

for left, right in zip(top_left_points, top_right_points):

    beam = AluminumBeam(left, right, width, depth)

    geom = beam.generate_geometry()
    vol  = beam.compute_volume()

    geometries.append(geom)
    volumes.append(vol)
    materials.append(beam.material)

    total_volume += vol

OUT = (geometries, volumes, total_volume, materials)
# ----------------------------------------
getItemAtIndex_3 = List.GetItemAtIndex(list=horizontal_class_definition_and, index=code_block_10)
total_aluminum_volume_mm_3 = Watch(getItemAtIndex_3)
