# Dynamo graph 1850962.dyn (Dynamo 3.6.0.9395)

# group: Don't touch this ground
code_block = CodeBlock { -5000; -5000; -200; }
byCoordinates = Point.ByCoordinates(x=code_block.out0, y=code_block.out1, z=code_block.out2)
code_block_2 = CodeBlock { 5000; 5000; 0; }
byCoordinates_2 = Point.ByCoordinates(x=code_block_2.out0, y=code_block_2.out1, z=code_block_2.out2)
byCorners = Cuboid.ByCorners(lowPoint=byCoordinates, highPoint=byCoordinates_2)
code_block_3 = CodeBlock { 0; 100; 0; }
byARGB = Color.ByARGB(red=code_block_3.out0, green=code_block_3.out1, blue=code_block_3.out2)
byGeometryColor = Modifiers.GeometryColor.ByGeometryColor(geometry=byCorners, color=byARGB)

code_block_4 = CodeBlock { x=3000; y=3000; z=0; }
point_a = Point.ByCoordinates(x=code_block_4.x, y=code_block_4.y, z=code_block_4.z)
code_block_5 = CodeBlock { x=3000; }
byCoordinates_3 = Point.ByCoordinates(x=code_block_5)
height_of_tent = DoubleSlider(3000, range=0..10000 step 100)
top_pt = Point.ByCoordinates(z=height_of_tent)
byStartPointEndPoint = Line.ByStartPointEndPoint(startPoint=byCoordinates_3, endPoint=top_pt)
point_of_legs_inflation_on_leg = DoubleSlider(0.121, range=0..1 step 0.001)
pointAtParameter = Curve.PointAtParameter(curve=byStartPointEndPoint, param=point_of_legs_inflation_on_leg)
opening_height = DoubleSlider(1245.8, range=0..3500 step 0.1)
translate = Geometry.Translate(geometry=pointAtParameter, zTranslation=opening_height)
code_block_6 = CodeBlock { x=3000; y=-3000; z=0; }
point_b = Point.ByCoordinates(x=code_block_6.x, y=code_block_6.y, z=code_block_6.z)
list_create = List.Create(item0=point_a, item1=translate, item2=point_b)
opening_arch_ab = NurbsCurve.ByPoints(points=list_create)
byStartPointEndPoint_2 = Line.ByStartPointEndPoint(startPoint=point_b, endPoint=top_pt)
pointAtParameter_2 = Curve.PointAtParameter(curve=byStartPointEndPoint_2, param=point_of_legs_inflation_on_leg)
tent_inflation = DoubleSlider(609.5, range=0..3500 step 0.1)
translate_2 = Geometry.Translate(geometry=pointAtParameter_2, zTranslation=tent_inflation)
list_create_2 = List.Create(item0=point_b, item1=translate_2, item2=top_pt)
leg_b = NurbsCurve.ByPoints(points=list_create_2)
byStartPointEndPoint_3 = Line.ByStartPointEndPoint(startPoint=point_a, endPoint=top_pt)
pointAtParameter_3 = Curve.PointAtParameter(curve=byStartPointEndPoint_3, param=point_of_legs_inflation_on_leg)
translate_3 = Geometry.Translate(geometry=pointAtParameter_3, zTranslation=tent_inflation)
list_create_3 = List.Create(item0=point_a, item1=translate_3, item2=top_pt)
leg_a = NurbsCurve.ByPoints(points=list_create_3)
list_create_4 = List.Create(item0=opening_arch_ab, item1=leg_b, item2=leg_a)
byJoinedCurves = PolyCurve.ByJoinedCurves(curves=list_create_4)
surface_ab = Surface.ByPatch(closedCurve=byJoinedCurves)
code_block_7 = CodeBlock { x=-3000; y=3000; z=0; }
point_d = Point.ByCoordinates(x=code_block_7.x, y=code_block_7.y, z=code_block_7.z)
code_block_8 = CodeBlock { x=-3000; }
byCoordinates_4 = Point.ByCoordinates(x=code_block_8)
byStartPointEndPoint_4 = Line.ByStartPointEndPoint(startPoint=byCoordinates_4, endPoint=top_pt)
pointAtParameter_4 = Curve.PointAtParameter(curve=byStartPointEndPoint_4, param=point_of_legs_inflation_on_leg)
translate_4 = Geometry.Translate(geometry=pointAtParameter_4, zTranslation=opening_height)
code_block_9 = CodeBlock { x=-3000; y=-3000; z=0; }
point_c = Point.ByCoordinates(x=code_block_9.x, y=code_block_9.y, z=code_block_9.z)
list_create_5 = List.Create(item0=point_d, item1=translate_4, item2=point_c)
opening_arch_cd = NurbsCurve.ByPoints(points=list_create_5)
byStartPointEndPoint_5 = Line.ByStartPointEndPoint(startPoint=point_c, endPoint=top_pt)
pointAtParameter_5 = Curve.PointAtParameter(curve=byStartPointEndPoint_5, param=point_of_legs_inflation_on_leg)
translate_5 = Geometry.Translate(geometry=pointAtParameter_5, zTranslation=tent_inflation)
list_create_6 = List.Create(item0=point_c, item1=translate_5, item2=top_pt)
leg_c = NurbsCurve.ByPoints(points=list_create_6)
byStartPointEndPoint_6 = Line.ByStartPointEndPoint(startPoint=point_d, endPoint=top_pt)
pointAtParameter_6 = Curve.PointAtParameter(curve=byStartPointEndPoint_6, param=point_of_legs_inflation_on_leg)
translate_6 = Geometry.Translate(geometry=pointAtParameter_6, zTranslation=tent_inflation)
list_create_7 = List.Create(item0=point_d, item1=translate_6, item2=top_pt)
leg_d = NurbsCurve.ByPoints(points=list_create_7)
list_create_8 = List.Create(item0=opening_arch_cd, item1=leg_c, item2=leg_d)
byJoinedCurves_2 = PolyCurve.ByJoinedCurves(curves=list_create_8)
surfae_cd = Surface.ByPatch(closedCurve=byJoinedCurves_2)
code_block_10 = CodeBlock { y=-3000; }
byCoordinates_5 = Point.ByCoordinates(y=code_block_10)
byStartPointEndPoint_7 = Line.ByStartPointEndPoint(startPoint=byCoordinates_5, endPoint=top_pt)
pointAtParameter_7 = Curve.PointAtParameter(curve=byStartPointEndPoint_7, param=point_of_legs_inflation_on_leg)
translate_7 = Geometry.Translate(geometry=pointAtParameter_7, zTranslation=opening_height)
list_create_9 = List.Create(item0=point_c, item1=translate_7, item2=point_b)
opening_arch_bc = NurbsCurve.ByPoints(points=list_create_9)
list_create_10 = List.Create(item0=opening_arch_bc, item1=leg_b, item2=leg_c)
byJoinedCurves_3 = PolyCurve.ByJoinedCurves(curves=list_create_10)
surface_bc = Surface.ByPatch(closedCurve=byJoinedCurves_3)
code_block_11 = CodeBlock { y=3000; }
byCoordinates_6 = Point.ByCoordinates(y=code_block_11)
byStartPointEndPoint_8 = Line.ByStartPointEndPoint(startPoint=byCoordinates_6, endPoint=top_pt)
pointAtParameter_8 = Curve.PointAtParameter(curve=byStartPointEndPoint_8, param=point_of_legs_inflation_on_leg)
translate_8 = Geometry.Translate(geometry=pointAtParameter_8, zTranslation=opening_height)
list_create_11 = List.Create(item0=point_a, item1=translate_8, item2=point_d)
opening_arch_da = NurbsCurve.ByPoints(points=list_create_11)
list_create_12 = List.Create(item0=opening_arch_da, item1=leg_a, item2=leg_d)
byJoinedCurves_4 = PolyCurve.ByJoinedCurves(curves=list_create_12)
surface_da = Surface.ByPatch(closedCurve=byJoinedCurves_4)
list_create_13 = List.Create()  # unwired: item0
list_create_14 = List.Create()  # unwired: item0
list_create_15 = List.Create()  # unwired: item0
list_create_16 = List.Create()  # unwired: item0
list_create_17 = List.Create()  # unwired: item0
all_left_points = List.Create()  # unwired: item0
all_middle_points = List.Create()  # unwired: item0
watch = Watch()  # unwired: arg0
pointsAtEqualSegmentLength = Curve.PointsAtEqualSegmentLength(curve=leg_a)
list_create_18 = List.Create(item0=byCoordinates_3, item1=translate, item2=top_pt)
byPoints = NurbsCurve.ByPoints(points=list_create_18)
ZAxis = Vector.ZAxis()
byOriginNormal = Plane.ByOriginNormal(origin=translate, normal=ZAxis)
code_block_12 = CodeBlock(plane1=byOriginNormal, nurbsCurve1=byPoints) { geometry1 = Geometry.Intersect(plane1, nurbsCurve1); }
parameterAtPoint = Curve.ParameterAtPoint(curve=byPoints, point=code_block_12)
code_block_13 = CodeBlock(start=parameterAtPoint) { start..1.0..#10; }
pointAtParameter_9 = Curve.PointAtParameter(curve=byPoints, param=code_block_13)
code_block_14 = CodeBlock { 1; }
flatten = List.Flatten(list=pointAtParameter_9, amount=code_block_14)
pointsAtEqualSegmentLength_2 = Curve.PointsAtEqualSegmentLength(curve=leg_b)
ribcage_ab = List.Create(item0=pointsAtEqualSegmentLength, item1=flatten, item2=pointsAtEqualSegmentLength_2)
transpose = List.Transpose(lists=ribcage_ab)
code_block_15 = CodeBlock { 9; }
removeItemAtIndex = List.RemoveItemAtIndex(list=transpose, indices=code_block_15)
byPoints_2 = NurbsCurve.ByPoints(points=removeItemAtIndex)
list_create_19 = List.Create(item0=byCoordinates_6, item1=translate_8, item2=top_pt)
byPoints_3 = NurbsCurve.ByPoints(points=list_create_19)
ZAxis_2 = Vector.ZAxis()
byOriginNormal_2 = Plane.ByOriginNormal(origin=translate_8, normal=ZAxis_2)
intersect = Geometry.Intersect(geometry=byOriginNormal_2, other=byPoints_3)
parameterAtPoint_2 = Curve.ParameterAtPoint(curve=byPoints_3, point=intersect)
code_block_16 = CodeBlock(start=parameterAtPoint_2) { start..1.0..#10; }
pointAtParameter_10 = Curve.PointAtParameter(curve=byPoints_3, param=code_block_16)
code_block_17 = CodeBlock { 1; }
flatten_2 = List.Flatten(list=pointAtParameter_10, amount=code_block_17)
pointsAtEqualSegmentLength_3 = Curve.PointsAtEqualSegmentLength(curve=leg_d)
ribcage_ad = List.Create(item0=pointsAtEqualSegmentLength, item1=flatten_2, item2=pointsAtEqualSegmentLength_3)
transpose_2 = List.Transpose(lists=ribcage_ad)
removeItemAtIndex_2 = List.RemoveItemAtIndex(list=transpose_2, indices=code_block_15)
byPoints_4 = NurbsCurve.ByPoints(points=removeItemAtIndex_2)
list_create_20 = List.Create(item0=byCoordinates_4, item1=translate_4, item2=top_pt)
byPoints_5 = NurbsCurve.ByPoints(points=list_create_20)
ZAxis_3 = Vector.ZAxis()
byOriginNormal_3 = Plane.ByOriginNormal(origin=translate_4, normal=ZAxis_3)
intersect_2 = Geometry.Intersect(geometry=byOriginNormal_3, other=byPoints_5)
parameterAtPoint_3 = Curve.ParameterAtPoint(curve=byPoints_5, point=intersect_2)
code_block_18 = CodeBlock(start=parameterAtPoint_3) { start..1.0..#10; }
pointAtParameter_11 = Curve.PointAtParameter(curve=byPoints_5, param=code_block_18)
code_block_19 = CodeBlock { 1; }
flatten_3 = List.Flatten(list=pointAtParameter_11, amount=code_block_19)
pointsAtEqualSegmentLength_4 = Curve.PointsAtEqualSegmentLength(curve=leg_c)
list_create_21 = List.Create(item0=pointsAtEqualSegmentLength_3, item1=flatten_3, item2=pointsAtEqualSegmentLength_4)
transpose_3 = List.Transpose(lists=list_create_21)
removeItemAtIndex_3 = List.RemoveItemAtIndex(list=transpose_3, indices=code_block_15)
byPoints_6 = NurbsCurve.ByPoints(points=removeItemAtIndex_3)
list_create_22 = List.Create(item0=byCoordinates_5, item1=translate_7, item2=top_pt)
byPoints_7 = NurbsCurve.ByPoints(points=list_create_22)
ZAxis_4 = Vector.ZAxis()
byOriginNormal_4 = Plane.ByOriginNormal(origin=translate_7, normal=ZAxis_4)
intersect_3 = Geometry.Intersect(geometry=byOriginNormal_4, other=byPoints_7)
parameterAtPoint_4 = Curve.ParameterAtPoint(curve=byPoints_7, point=intersect_3)
code_block_20 = CodeBlock(start=parameterAtPoint_4) { start..1.0..#10; }
pointAtParameter_12 = Curve.PointAtParameter(curve=byPoints_7, param=code_block_20)
code_block_21 = CodeBlock { 1; }
flatten_4 = List.Flatten(list=pointAtParameter_12, amount=code_block_21)
list_create_23 = List.Create(item0=pointsAtEqualSegmentLength_4, item1=flatten_4, item2=pointsAtEqualSegmentLength_2)
transpose_4 = List.Transpose(lists=list_create_23)
removeItemAtIndex_4 = List.RemoveItemAtIndex(list=transpose_4, indices=code_block_15)
byPoints_8 = NurbsCurve.ByPoints(points=removeItemAtIndex_4)
list_create_24 = List.Create(item0=byPoints_2, item1=byPoints_4, item2=byPoints_6, item3=byPoints_8)
flatten_5 = List.Flatten(list=list_create_24)
wood_strips_thickness = DoubleSlider(20, range=0..100 step 0.1)
wood_strips_width = DoubleSlider(58.1, range=0..1000 step 0.1)
wood_strips_class = Python()  # CPython3; unwired: IN[0]
# ---------- wood_strips_class.python (23 lines) ----------
import sys
import clr
clr.AddReference('ProtoGeometry')
from Autodesk.DesignScript.Geometry import *

class WoodStrips:
    def __init__(self, curve, width, height):
        self.curve=curve
        self.width=width
        self.height=height
        
    def make_geometry(self):
        startpoint=self.curve.PointAtParameter(0)
        starttangent=self.curve.TangentAtParameter(0)
        
        plane=Plane.ByOriginNormal(startpoint,starttangent)
        
        profile=Rectangle.ByWidthLength(plane, self.width, self.height)
        
        return Solid.BySweep(profile, self.curve, False)
        
        
OUT=WoodStrips       
# ----------------------------------------
series_of_wood_strips_instance = Python(IN[0]=flatten_5, IN[1]=wood_strips_thickness, IN[2]=wood_strips_width, IN[3]=wood_strips_class)  # CPython3
# ---------- series_of_wood_strips_instance.python (15 lines) ----------
import sys
import clr

curves=IN[0]
width=IN[1]
height=IN[2]
WoodStrips=IN[3]

geometry_out=[]

for curve in curves:
    strip=WoodStrips(curve, width, height)
    geometry_out.append(strip.make_geometry())
    
OUT=geometry_out
# ----------------------------------------
color_palette = ColorPalette({R: 0, G: 127, B: 2, A: 255})
byGeometryColor_2 = Modifiers.GeometryColor.ByGeometryColor(geometry=series_of_wood_strips_instance, color=color_palette)
list_create_25 = List.Create(item0=opening_arch_ab, item1=opening_arch_cd, item2=opening_arch_da, item3=opening_arch_bc, item4=leg_d, item5=leg_c, item6=leg_b, item7=leg_a)
steel_rod_radius = DoubleSlider(43.5, range=0..100 step 0.1)
steel_rod_class = Python()  # CPython3; unwired: IN[0]
# ---------- steel_rod_class.python (23 lines) ----------
# Load the Python Standard and DesignScript Libraries
import sys
import clr
clr.AddReference('ProtoGeometry')
from Autodesk.DesignScript.Geometry import *

class SteelRod:
    def __init__(self, curve, radius):
        self.curve=curve
        self.radius=radius
        
    def make_geometry(self):
        startpoint=self.curve.PointAtParameter(0)
        tangent=self.curve.TangentAtParameter(0)
        
        plane=Plane.ByOriginNormal(startpoint, tangent)
        
        profile=Circle.ByPlaneRadius(plane, self.radius)
        
        return Solid.BySweep(profile, self.curve, False)
        
        
OUT = SteelRod       
# ----------------------------------------
series_of_steel_rods_instance = Python(IN[0]=list_create_25, IN[1]=steel_rod_radius, IN[2]=steel_rod_class)  # CPython3
# ---------- series_of_steel_rods_instance.python (16 lines) ----------
# Load the Python Standard and DesignScript Libraries
import sys
import clr

input_curves = IN[0]
radius = IN[1]
SteelRod = IN[2]

if not isinstance(input_curves, list):
    input_curves = [input_curves]
steelrods = []

for curve in input_curves:
       b = SteelRod(curve, radius)
       steelrods.append(b.make_geometry())
OUT = steelrods      
# ----------------------------------------
color_palette_2 = ColorPalette({R: 255, G: 255, B: 0, A: 255})
byGeometryColor_3 = Modifiers.GeometryColor.ByGeometryColor(geometry=series_of_steel_rods_instance, color=color_palette_2)
code_block_22 = CodeBlock { 3000; 3000; }
byCoordinates_7 = Point.ByCoordinates(x=code_block_22.out0, y=code_block_22.out1)
code_block_23 = CodeBlock { 3000; 3000; }
foot_height = DoubleSlider(43.4, range=0..100 step 0.1)
byCoordinates_8 = Point.ByCoordinates(x=code_block_23.out0, y=code_block_23.out1, z=foot_height)
foot_radius = DoubleSlider(170, range=0..500 step 1)
python_script = Python()  # CPython3; unwired: IN[0]
# ---------- python_script.python (15 lines) ----------
# Load the Python Standard and DesignScript Libraries
import sys
import clr
clr.AddReference('ProtoGeometry')
from Autodesk.DesignScript.Geometry import *

class CircularBench:
    def __init__(self, bottom_point, top_point, radius):
        self.bottom = bottom_point
        self.top = top_point
        self.radius = radius
        
    def make_geometry(self):
        return Cylinder.ByPointsRadius(self.bottom, self.top, self.radius)
OUT = CircularBench                             
# ----------------------------------------
foot = Python(IN[0]=byCoordinates_7, IN[1]=byCoordinates_8, IN[2]=foot_radius, IN[3]=python_script)  # CPython3
# ---------- foot.python (3 lines) ----------
CircularBench = IN[3]
b = CircularBench(IN[0],IN[1],IN[2])
OUT = b.make_geometry()
# ----------------------------------------
color_palette_3 = ColorPalette({R: 128, G: 128, B: 128, A: 255})
byGeometryColor_4 = Modifiers.GeometryColor.ByGeometryColor(geometry=foot, color=color_palette_3)
code_block_24 = CodeBlock { -3000; 3000; }
byCoordinates_9 = Point.ByCoordinates(x=code_block_24.out0, y=code_block_24.out1)
code_block_25 = CodeBlock { -3000; 3000; }
byCoordinates_10 = Point.ByCoordinates(x=code_block_25.out0, y=code_block_25.out1, z=foot_height)
foot_2 = Python(IN[0]=byCoordinates_9, IN[1]=byCoordinates_10, IN[2]=foot_radius, IN[3]=python_script)  # CPython3; same code as foot
byGeometryColor_5 = Modifiers.GeometryColor.ByGeometryColor(geometry=foot_2, color=color_palette_3)
code_block_26 = CodeBlock { 3000; -3000; }
byCoordinates_11 = Point.ByCoordinates(x=code_block_26.out0, y=code_block_26.out1)
code_block_27 = CodeBlock { 3000; -3000; }
byCoordinates_12 = Point.ByCoordinates(x=code_block_27.out0, y=code_block_27.out1, z=foot_height)
foot_3 = Python(IN[0]=byCoordinates_11, IN[1]=byCoordinates_12, IN[2]=foot_radius, IN[3]=python_script)  # CPython3; same code as foot
byGeometryColor_6 = Modifiers.GeometryColor.ByGeometryColor(geometry=foot_3, color=color_palette_3)
code_block_28 = CodeBlock { -3000; -3000; }
byCoordinates_13 = Point.ByCoordinates(x=code_block_28.out0, y=code_block_28.out1)
code_block_29 = CodeBlock { -3000; -3000; }
byCoordinates_14 = Point.ByCoordinates(x=code_block_29.out0, y=code_block_29.out1, z=foot_height)
foot_4 = Python(IN[0]=byCoordinates_13, IN[1]=byCoordinates_14, IN[2]=foot_radius, IN[3]=python_script)  # CPython3; same code as foot
byGeometryColor_7 = Modifiers.GeometryColor.ByGeometryColor(geometry=foot_4, color=color_palette_3)
number_slider = DoubleSlider(59, range=0..100 step 0.1)
code_block_30 = CodeBlock { 0; 0; 0; }
byCoordinates_15 = Point.ByCoordinates(x=code_block_30.out0, y=code_block_30.out1, z=code_block_30.out2)
code_block_31 = CodeBlock { 0; 0; }
byCoordinates_16 = Point.ByCoordinates(x=code_block_31.out0, y=code_block_31.out1, z=height_of_tent)
number_slider_2 = DoubleSlider(43.6, range=0..100 step 0.1)
middle_support = Python(IN[0]=byCoordinates_15, IN[1]=byCoordinates_16, IN[2]=number_slider_2, IN[3]=python_script)  # CPython3; same code as foot
byGeometryColor_8 = Modifiers.GeometryColor.ByGeometryColor(geometry=middle_support, color=color_palette_3)
byCoordinates_17 = Point.ByCoordinates()
byCoordinates_18 = Point.ByCoordinates(z=foot_height)
foot_5 = Python(IN[0]=byCoordinates_17, IN[1]=byCoordinates_18, IN[2]=foot_radius, IN[3]=python_script)  # CPython3; same code as foot
byGeometryColor_9 = Modifiers.GeometryColor.ByGeometryColor(geometry=foot_5, color=color_palette_3)
volume = Solid.Volume(solid=series_of_wood_strips_instance)
sum = Math.Sum(values=volume)
wood_strips_volume_mm_3 = Watch(sum)
volume_2 = Solid.Volume(solid=series_of_steel_rods_instance)
sum_2 = Math.Sum(values=volume_2)
steel_rods_volume_mm_3 = Watch(sum_2)
python_script_2 = Python()  # CPython3; unwired: IN[0]; starter script, not edited (OUT = 0)
