# Dynamo graph 1850967.dyn (Dynamo 3.3.0.6316)

# group: Don't touch this ground
code_block = CodeBlock { -5000; -5000; -200; }
byCoordinates = Point.ByCoordinates(x=code_block.out0, y=code_block.out1, z=code_block.out2)
code_block_2 = CodeBlock { 5000; 5000; 0; }
byCoordinates_2 = Point.ByCoordinates(x=code_block_2.out0, y=code_block_2.out1, z=code_block_2.out2)
byCorners = Cuboid.ByCorners(lowPoint=byCoordinates, highPoint=byCoordinates_2)
code_block_3 = CodeBlock { 0; 100; 0; }
byARGB = Color.ByARGB(red=code_block_3.out0, green=code_block_3.out1, blue=code_block_3.out2)
byGeometryColor = Modifiers.GeometryColor.ByGeometryColor(geometry=byCorners, color=byARGB)

byUnion = Solid.ByUnion()  # unwired: solids
start = DoubleInput(-5000)
end = DoubleInput(5000)
length = DoubleInput(10000)
rib_count = IntegerSlider(12, range=3..30 step 1)
subtract_1 = DoubleInput(1)
sub = rib_count - subtract_1
div = length / sub
range = Range(start=start, end=end, step=div)
pillar_height = DoubleSlider(3000, range=1000..5000 step 0.1)
roof_left = Point.ByCoordinates(x=range, y=start, z=pillar_height)
curvature_amplitude = DoubleSlider(1000, range=0..2500 step 0.1)
add = pillar_height + curvature_amplitude
midpoint = Point.ByCoordinates(x=range, z=add)
roof_right = Point.ByCoordinates(x=range, y=end, z=pillar_height)
all_points = List.Create(item0=roof_left, item1=midpoint, item2=roof_right)
transpose = List.Transpose(lists=all_points)
ribs = NurbsCurve.ByPoints(points=transpose)
rib_and_panel_thickness = DoubleSlider(80, range=10..200 step 0.1)
dimeter_to_redius = DoubleInput(2)
rib_radius = rib_and_panel_thickness / dimeter_to_redius
curved_ribs = TSpline.TSplineSurface.BuildPipes(curves=ribs, defaultRadius=rib_radius)
roof_surface = Surface.ByLoft(crossSections=ribs)
roof = Surface.Thicken(surface=roof_surface, thickness=rib_and_panel_thickness)
bottom_left = Point.ByCoordinates(x=range, y=start)
left_columns = Cylinder.ByPointsRadius(startPoint=roof_left, endPoint=bottom_left, radius=rib_radius)
bottom_right = Point.ByCoordinates(x=range, y=end)
right_side = List.Create(item0=bottom_right, item1=roof_right)
transpose_2 = List.Transpose(lists=right_side)
left_side = NurbsCurve.ByPoints(points=transpose_2)
left_side_surface = Surface.ByLoft(crossSections=left_side)
left_panel = Surface.Thicken(surface=left_side_surface, thickness=rib_and_panel_thickness)
right_columns = Cylinder.ByPointsRadius(startPoint=roof_right, endPoint=bottom_right, radius=rib_radius)
left_side_2 = List.Create(item0=bottom_left, item1=roof_left)
transpose_3 = List.Transpose(lists=left_side_2)
right_side_2 = NurbsCurve.ByPoints(points=transpose_3)
right_side_surface = Surface.ByLoft(crossSections=right_side_2)
right_panel = Surface.Thicken(surface=right_side_surface, thickness=rib_and_panel_thickness)
list_create = List.Create(item0=curved_ribs, item1=roof, item2=left_columns, item3=left_panel, item4=right_columns, item5=right_panel)
flatten = List.Flatten(list=list_create)
firstItem = List.FirstItem(list=flatten)
reduce = List.Reduce(reduceFunction=byUnion, seed=firstItem, list0=flatten)
class_definitions = Python()  # CPython3; graph output; unwired: IN[0]
# ---------- class_definitions.python (57 lines) ----------
import clr
clr.AddReference('ProtoGeometry')
from Autodesk.DesignScript.Geometry import *

# -------------------------------------------------
# CLASS 1 — STEEL RIB (solid swept curve)
# -------------------------------------------------
class SteelRib:
    def __init__(self, curve, radius):
        self.curve = curve
        self.radius = radius
        self.solid = None
        self.volume = None

    def generate_geometry(self):
        # Profile circle at curve start
        center = self.curve.StartPoint
        profile = Circle.ByCenterPointRadius(center, self.radius)

        # Sweep into steel rib
        self.solid = Solid.BySweep(profile, self.curve)
        return self.solid

    def compute_volume(self):
        if self.solid is None:
            self.generate_geometry()
        self.volume = self.solid.Volume
        return self.volume


# -------------------------------------------------
# CLASS 2 — TIMBER PANEL (lofted & thickened surface)
# -------------------------------------------------
class TimberPanel:
    def __init__(self, curveA, curveB, thickness):
        self.curveA = curveA
        self.curveB = curveB
        self.thickness = thickness
        self.solid = None
        self.volume = None

    def generate_geometry(self):
        # Loft a surface between two curves
        surf = Surface.ByLoft([self.curveA, self.curveB])
        # Thicken the panel into a timber board
        self.solid = surf.Thicken(self.thickness, False)
        return self.solid

    def compute_volume(self):
        if self.solid is None:
            self.generate_geometry()
        self.volume = self.solid.Volume
        return self.volume


# OUTPUT CLASSES
OUT = [SteelRib, TimberPanel]
# ----------------------------------------
get_steel_rib = DoubleInput(0)
steel_rib = List.GetItemAtIndex(list=class_definitions, index=get_steel_rib)
get_wood_panel = DoubleInput(1)
wood_panel = List.GetItemAtIndex(list=class_definitions, index=get_wood_panel)
panel_a = NurbsCurve.ByPoints(points=transpose)
drop_last_point = DoubleInput(-1)
panel_a_2 = List.DropItems(list=panel_a, amount=drop_last_point)
shift_by = DoubleInput(1)
panel_b = List.ShiftIndices(list=panel_a, amount=shift_by)
panel_b_2 = List.DropItems(list=panel_b, amount=drop_last_point)
create_instances = Python(IN[0]=steel_rib, IN[1]=wood_panel, IN[2]=ribs, IN[3]=rib_radius, IN[4]=panel_a_2, IN[5]=panel_b_2, IN[6]=rib_and_panel_thickness)  # CPython3
# ---------- create_instances.python (44 lines) ----------
# Inputs:
# IN[0] = SteelRib class
# IN[1] = TimberPanel class
# IN[2] = ribCurves (list)
# IN[3] = steelRadius (number)
# IN[4] = panelCurvesA (list)
# IN[5] = panelCurvesB (list)
# IN[6] = timberThickness (number)

SteelRib = IN[0]
TimberPanel = IN[1]
ribCurves = IN[2]
steelRadius = IN[3]
panelA = IN[4]
panelB = IN[5]
timberThickness = IN[6]

# ------------------------------
# SERIES OF STEEL RIB INSTANCES
# ------------------------------
steel_solids = []
steel_volumes = []

for c in ribCurves:
    rib = SteelRib(c, steelRadius)
    solid = rib.generate_geometry()
    vol = rib.compute_volume()
    steel_solids.append(solid)
    steel_volumes.append(vol)

# ------------------------------
# SERIES OF TIMBER PANEL INSTANCES
# ------------------------------
timber_solids = []
timber_volumes = []

for a, b in zip(panelA, panelB):
    panel = TimberPanel(a, b, timberThickness)
    solid = panel.generate_geometry()
    vol = panel.compute_volume()
    timber_solids.append(solid)
    timber_volumes.append(vol)

OUT = [steel_solids, steel_volumes, timber_solids, timber_volumes]
# ----------------------------------------
get_steel_rib_volume = DoubleInput(1)
get_steel_rib_2 = List.GetItemAtIndex(list=create_instances, index=get_steel_rib_volume)
reduce_2 = List.Reduce(list0=get_steel_rib_2)  # unwired: reduceFunction, seed
both_sides = DoubleInput(2)
number_of_side_pillars = rib_count * both_sides
multiply_by_height = number_of_side_pillars * pillar_height
multiply_by_radius = rib_radius * multiply_by_height
multiply_by_radius_to_get_rib = rib_radius * multiply_by_radius  # "Multiply by radius to get rib volume of pillar columns"
add_2 = _ + _  # unwired: x, y
seed = DoubleInput(0)
calculate_steel_rib_volume_of = Reduce(reduceFunction=add_2, seed=seed, list0=get_steel_rib_2)  # "Calculate steel rib volume of roof"
total_steel_rib_volume = multiply_by_radius_to_get_rib + calculate_steel_rib_volume_of
steel_rib_volume_mm_3 = Watch(total_steel_rib_volume)
get_wood_panel_volume = DoubleInput(3)
get_wood_panel_2 = List.GetItemAtIndex(list=create_instances, index=get_wood_panel_volume)
calculate_wood_panel_volume_of = Reduce(reduceFunction=add_2, seed=seed, list0=get_wood_panel_2)  # "Calculate Wood panel volume of roof"
panel_thickness_times_side = rib_and_panel_thickness * pillar_height  # "Panel thickness times side height"
pavilion_length = DoubleInput(10000)
side_panel_volume = panel_thickness_times_side * pavilion_length
multiply_by_two_side_panels = DoubleInput(2)
total_side_volume = side_panel_volume * multiply_by_two_side_panels
total_wood_panel_side_volume = total_side_volume - multiply_by_radius_to_get_rib
total_wood_panel_volume = calculate_wood_panel_volume_of + total_wood_panel_side_volume
wood_panel_volume_mm_3 = Watch(total_wood_panel_volume)
