# Dynamo graph 1851072.dyn (Dynamo 3.3.0.6316)

code_block = CodeBlock { -5000; -5000; -200; }
byCoordinates = Point.ByCoordinates(x=code_block.out0, y=code_block.out1, z=code_block.out2)
code_block_2 = CodeBlock { 5000; 5000; 0; }
byCoordinates_2 = Point.ByCoordinates(x=code_block_2.out0, y=code_block_2.out1, z=code_block_2.out2)
byCorners = Cuboid.ByCorners(lowPoint=byCoordinates, highPoint=byCoordinates_2)
code_block_3 = CodeBlock { 0; 100; 0; }
byARGB = Color.ByARGB(red=code_block_3.out0, green=code_block_3.out1, blue=code_block_3.out2)
byGeometryColor = Modifiers.GeometryColor.ByGeometryColor(geometry=byCorners, color=byARGB)
code_block_4 = CodeBlock { -3300; }
code_block_5 = CodeBlock { 14200; }
byCoordinates_3 = Point.ByCoordinates(y=code_block_4, z=code_block_5)
code_block_6 = CodeBlock { 3300; }
byCoordinates_4 = Point.ByCoordinates(y=code_block_6, z=code_block_5)
code_block_7 = CodeBlock { 14000; }
byPointsRadius = Cylinder.ByPointsRadius(startPoint=byCoordinates_3, endPoint=byCoordinates_4, radius=code_block_7)
code_block_8 = CodeBlock(outer_radius=code_block_7) { r = outer_radius - 50; }
byPointsRadius_2 = Cylinder.ByPointsRadius(startPoint=byCoordinates_3, endPoint=byCoordinates_4, radius=code_block_8)
difference = Solid.Difference(solid=byPointsRadius, other=byPointsRadius_2)
code_block_9 = CodeBlock { -50000; -50000; 550; }
byCoordinates_5 = Point.ByCoordinates(x=code_block_9.out0, y=code_block_9.out1, z=code_block_9.out2)
code_block_10 = CodeBlock { 50000; 50000; 50000; }
byCoordinates_6 = Point.ByCoordinates(x=code_block_10.out0, y=code_block_10.out1, z=code_block_10.out2)
byCorners_2 = Cuboid.ByCorners(lowPoint=byCoordinates_5, highPoint=byCoordinates_6)
difference_2 = Solid.Difference(solid=difference, other=byCorners_2)
code_block_11 = CodeBlock { -3000; }
code_block_12 = CodeBlock { -3200; }
of_beams = DoubleSlider(8, range=0..8 step 1)
code_block_13 = CodeBlock { 900; }
sequence = Sequence(start=code_block_12, amount=of_beams, step=code_block_13)
byCoordinates_7 = Point.ByCoordinates(x=code_block_11, y=sequence)
radius_of_beam = DoubleSlider(100, range=50..100 step 0.1)
byCenterPointRadius = Circle.ByCenterPointRadius(centerPoint=byCoordinates_7, radius=radius_of_beam)
height_of_beam = DoubleSlider(500, range=400..1000 step 0.1)
extrudeAsSolid = Curve.ExtrudeAsSolid(curve=byCenterPointRadius, distance=height_of_beam)
code_block_14 = CodeBlock { 3000; }
sequence_2 = Sequence(start=code_block_12, amount=of_beams, step=code_block_13)
byCoordinates_8 = Point.ByCoordinates(x=code_block_14, y=sequence_2)
byCenterPointRadius_2 = Circle.ByCenterPointRadius(centerPoint=byCoordinates_8, radius=radius_of_beam)
extrudeAsSolid_2 = Curve.ExtrudeAsSolid(curve=byCenterPointRadius_2, distance=height_of_beam)
union = Solid.Union(solid=extrudeAsSolid, solid_2=extrudeAsSolid_2)
centroid = Solid.Centroid(solid=union)
X = Point.X(point=centroid)
centroid_2 = Solid.Centroid(solid=difference_2)
X_2 = Point.X(point=centroid_2)
sub = X - X_2
byGeometry = BoundingBox.ByGeometry(geom=union)
maxPoint = BoundingBox.MaxPoint(boundingBox=byGeometry)
Z = Point.Z(point=maxPoint)
byGeometry_2 = BoundingBox.ByGeometry(geom=difference_2)
maxPoint_2 = BoundingBox.MaxPoint(boundingBox=byGeometry_2)
Z_2 = Point.Z(point=maxPoint_2)
z_difference = Z - Z_2
byCoordinates_9 = Vector.ByCoordinates(x=sub, z=z_difference)
translate = Geometry.Translate(geometry=difference_2, direction=byCoordinates_9)
Y = Point.Y(point=maxPoint)
Y_2 = Point.Y(point=maxPoint_2)
sub_2 = Y - Y_2
length_of_cylinder = DoubleSlider(3300, range=3300..5000 step 0.1)
byCoordinates_10 = Point.ByCoordinates(x=length_of_cylinder)
code_block_15 = CodeBlock(length=length_of_cylinder) { l = -length; }
byCoordinates_11 = Point.ByCoordinates(x=code_block_15)
radius_of_cylinder = DoubleSlider(3600, range=3600..5000 step 0.1)
byPointsRadius_3 = Cylinder.ByPointsRadius(startPoint=byCoordinates_10, endPoint=byCoordinates_11, radius=radius_of_cylinder)
byCoordinates_12 = Point.ByCoordinates(x=length_of_cylinder)
byCoordinates_13 = Point.ByCoordinates(x=code_block_15)
code_block_16 = CodeBlock(outer_radius=radius_of_cylinder) { r = outer_radius -100; }
byPointsRadius_4 = Cylinder.ByPointsRadius(startPoint=byCoordinates_12, endPoint=byCoordinates_13, radius=code_block_16)
difference_3 = Solid.Difference(solid=byPointsRadius_3, other=byPointsRadius_4)
code_block_17 = CodeBlock { -5000; -5000; -5000; }
byCoordinates_14 = Point.ByCoordinates(x=code_block_17.out0, y=code_block_17.out1, z=code_block_17.out2)
code_block_18 = CodeBlock { 5000; 5000; -200; }
byCoordinates_15 = Point.ByCoordinates(x=code_block_18.out0, y=code_block_18.out1, z=code_block_18.out2)
byCorners_3 = Cuboid.ByCorners(lowPoint=byCoordinates_14, highPoint=byCoordinates_15)
difference_4 = Solid.Difference(solid=difference_3, other=byCorners_3)
union_2 = Solid.Union(solid=difference_4, solid_2=difference_2)
python_script = Python(IN[0]=radius_of_beam, IN[1]=height_of_beam, IN[2]=radius_of_cylinder, IN[3]=length_of_cylinder, IN[4]=code_block_7, IN[5]=code_block_6, IN[6]=of_beams)  # CPython3
# ---------- python_script.python (25 lines) ----------
import sys
import math


timber_radius = IN[0]
timber_height = IN[1]

outer_cylinder_radius = IN[2]
outer_cylinder_length = IN[3]*2

bench_cylinder_radius = IN[4]
bench_cylinder_length = IN[5]*2

number_of_beams = IN[6]

timber_volumes = timber_radius*timber_height*math.pi*number_of_beams

steel_volumes = (outer_cylinder_radius*outer_cylinder_length*math.pi/2)-((outer_cylinder_radius-100)*outer_cylinder_length*math.pi/2)+(bench_cylinder_radius*bench_cylinder_length*math.pi/13)-((bench_cylinder_radius-50)*bench_cylinder_length*math.pi/13)


OUT = {
    "Timber Volume": timber_volumes,
    "Steel Panel Volume": steel_volumes,
    "units": "mm^3"
}
# ----------------------------------------
watch = Watch(python_script)
