# Dynamo graph 1851101.dyn (Dynamo 3.3.0.6316)

code_block = CodeBlock { -5000; -5000; -200; }
byCoordinates = Point.ByCoordinates(x=code_block.out0, y=code_block.out1, z=code_block.out2)
code_block_2 = CodeBlock { 5000; 5000; 0; }
byCoordinates_2 = Point.ByCoordinates(x=code_block_2.out0, y=code_block_2.out1, z=code_block_2.out2)
byCorners = Cuboid.ByCorners(lowPoint=byCoordinates, highPoint=byCoordinates_2)
code_block_3 = CodeBlock { 0; 100; 0; }
byARGB = Color.ByARGB(red=code_block_3.out0, green=code_block_3.out1, blue=code_block_3.out2)
byGeometryColor = Modifiers.GeometryColor.ByGeometryColor(geometry=byCorners, color=byARGB)
beamWidth = DoubleSlider(100, range=50..150 step 1)
beamDepth = DoubleSlider(160, range=100..250 step 1)
rectangular_timber_beam = Python(IN[0]=beamWidth, IN[1]=beamDepth)  # CPython3
# ---------- rectangular_timber_beam.python (47 lines) ----------
import sys
import clr
clr.AddReference('ProtoGeometry')
from Autodesk.DesignScript.Geometry import *
import math

class TimberBeam:
    """Represents a rectangular timber beam structural component."""
   
    def __init__(self, width, depth):
        # Beam cross-section dimensions are directly set in mm
        self.width = width
        self.depth = depth

    def generate_geometry(self, center_curve):
        """Generates a simplified solid representation along a Dynamo Curve in mm."""
        if not center_curve:
            return None
       
        # We simplify the solid generation using Thicken, assuming Dynamo curves are in mm.
        # This solid thickness is parametric based on the depth slider (P7).
        solid = center_curve.Thicken(self.depth / 2.0)
        return solid

    def compute_volume(self, center_curve_list):
        """Calculates the total volume in mm^3 for a list of curves."""
        total_volume_mm3 = 0.0
       
        # Cross-sectional area in mm^2 (width * depth)
        area_mm2 = self.width * self.depth
       
        if isinstance(center_curve_list, list):
             for curve in center_curve_list:
                if curve:
                    # curve.Length is assumed to be directly in mm
                    length_mm = curve.Length
                    total_volume_mm3 += area_mm2 * length_mm
       
        return total_volume_mm3

# IN[0] is P6: Beam_Width_mm
# IN[1] is P7: Beam_Depth_mm
W_IN = IN[0] if IN[0] else 100
D_IN = IN[1] if IN[1] else 150

timber_beam = TimberBeam(W_IN, D_IN)
OUT = timber_beam
# ----------------------------------------
number = DoubleInput(-4500)
number_2 = DoubleInput(0)
point_1 = Point.ByCoordinates(x=number, y=number_2, z=number_2)
number_3 = DoubleInput(5000)
archHeight = DoubleSlider(4500, range=3000..6000 step 100)
point_2 = Point.ByCoordinates(x=number_3, y=number_2, z=archHeight)
number_4 = DoubleInput(4500)
point_3 = Point.ByCoordinates(x=number_4, y=number_2, z=number_2)
list_create = List.Create(item0=point_1, item1=point_2, item2=point_3)
master_arch_curve = NurbsCurve.ByPoints(points=list_create)
archLength = DoubleSlider(7500, range=6000..10000 step 100)
halfLength = CodeBlock(P2=archLength) { P2/2; }
code_block_4 = CodeBlock(A=halfLength) { -A; }
back_arch_curve_y = Geometry.Translate(geometry=master_arch_curve, xTranslation=number_2, yTranslation=code_block_4, zTranslation=number_2)
back_arch_curve_y_2 = Geometry.Translate(geometry=master_arch_curve, xTranslation=number_2, yTranslation=halfLength, zTranslation=number_2)
list_create_2 = List.Create(item0=back_arch_curve_y, item1=back_arch_curve_y_2)
archSurface = Surface.ByLoft(crossSections=list_create_2)
numRibs_X = DoubleSlider(25, range=10..50 step 1)
code_block_5 = CodeBlock(P3=numRibs_X) { 0..1..#P3; }
timber_rib_lines = Surface.GetIsoline(surface=archSurface, isoDirection=number_2, parameter=code_block_5, lacing=CrossProduct)
number_5 = DoubleInput(1)
numBays_Y = DoubleSlider(25, range=10..50 step 1)
code_block_6 = CodeBlock(P4=numBays_Y) { 0..1..#P4; }
timber_horizontal_lines = Surface.GetIsoline(surface=archSurface, isoDirection=number_5, parameter=code_block_6, lacing=CrossProduct)
list_create_3 = List.Create(item0=timber_rib_lines, item1=timber_horizontal_lines)
all_timber_lines = List.Flatten(list=list_create_3)
instance_of_timber_beam_the = Python(IN[0]=rectangular_timber_beam, IN[1]=all_timber_lines)  # "Instance of Timber Beam (The Geometry)"; CPython3
# ---------- instance_of_timber_beam_the.python (37 lines) ----------
import sys
import clr
clr.AddReference('ProtoGeometry')
from Autodesk.DesignScript.Geometry import *

geom_class = IN[0]
curves_input = IN[1]
output_geometry = []

# Manual recursive flatten function (bypasses complex Dynamo List module issues)
def flatten_list(input_list):
    flat_list = []
    if isinstance(input_list, list):
        for item in input_list:
            if isinstance(item, list):
                flat_list.extend(flatten_list(item))
            elif item is not None:
                flat_list.append(item)
    return flat_list

if geom_class is not None:
    # Safely flatten the list of lines before processing
    all_curves = flatten_list(curves_input)
    
    for curve in all_curves:
        if isinstance(curve, Curve):
            try:
                # Call the generate_geometry method
                geom = geom_class.generate_geometry(curve)
                if geom:
                    output_geometry.append(geom)
            except:
                output_geometry.append(None)
        else:
            output_geometry.append(None)

OUT = output_geometry
# ----------------------------------------
rodDiameter = DoubleSlider(50, range=10..100 step 1)
circular_steel_rod = Python(IN[0]=rodDiameter)  # CPython3
# ---------- circular_steel_rod.python (50 lines) ----------
import sys
import clr
clr.AddReference('ProtoGeometry')
from Autodesk.DesignScript.Geometry import *
import math

class SteelRod:
    """Represents a circular steel rod tension component."""
   
    def __init__(self, diameter):
        # Rod diameter in mm
        self.diameter = diameter

    def generate_geometry(self, center_curve):
        """Generates a circular rod (Solid) geometry along a Dynamo Curve in mm."""
        if not center_curve:
            return None
       
        # Radius in mm
        radius_mm = self.diameter / 2.0
       
        # Create a circular profile using a CoordinateSystem from the curve's start point
        start_cs = center_curve.StartCoordinateSystem()
        profile_circle = Circle.ByCenterPointRadius(start_cs.Origin, radius_mm)
       
        # Sweep the circular profile along the center curve (path)
        solid = center_curve.SweepAsSolid(profile_circle)
        return solid

    def compute_volume(self, center_curve_list):
        """Calculates the total volume in mm^3 for a list of curves."""
        total_volume_mm3 = 0.0
       
        # Cross-sectional area in mm^2 (pi * r^2)
        radius_mm = self.diameter / 2.0
        area_mm2 = math.pi * radius_mm**2
       
        if isinstance(center_curve_list, list):
             for curve in center_curve_list:
                if curve:
                    # curve.Length is assumed to be directly in mm
                    length_mm = curve.Length
                    total_volume_mm3 += area_mm2 * length_mm
       
        return total_volume_mm3

# IN[0] is the Rod_Diameter_mm from the slider P5
rod_diameter_mm = IN[0] if IN[0] else 50
steel_rod = SteelRod(rod_diameter_mm)
OUT = steel_rod
# ----------------------------------------
code_block_7 = CodeBlock(P3=numRibs_X, P4=numBays_Y) { U = 0..1..#P3; V = 0..1..#P4; [U,V]; }
pointAtParameter = Surface.PointAtParameter(surface=archSurface, u=code_block_7.U, v=code_block_7.V, lacing=CrossProduct)
chop = List.Chop(list=pointAtParameter, lengths=numRibs_X)
shiftIndices = List.ShiftIndices(list=chop, amount=number_5, lacing=Shortest)
byPoints = PolyCurve.ByPoints(points=shiftIndices)
byPoints_2 = PolyCurve.ByPoints(points=chop)
steel_bracing_lines = List.Create(item0=byPoints, item1=byPoints_2)
instance_of_steel_rod_the = Python(IN[0]=circular_steel_rod, IN[1]=steel_bracing_lines)  # "Instance of Steel Rod (The Geometry)"; CPython3
# ---------- instance_of_steel_rod_the.python (37 lines) ----------
import sys
import clr
clr.AddReference('ProtoGeometry')
from Autodesk.DesignScript.Geometry import *

geom_class = IN[0]
curves_input = IN[1]
output_geometry = []

# Manual recursive flatten function (bypasses complex Dynamo List module issues)
def flatten_list(input_list):
    flat_list = []
    if isinstance(input_list, list):
        for item in input_list:
            if isinstance(item, list):
                flat_list.extend(flatten_list(item))
            elif item is not None:
                flat_list.append(item)
    return flat_list

if geom_class is not None:
    # Safely flatten the list of lines before processing
    all_curves = flatten_list(curves_input)

    for curve in all_curves:
        if isinstance(curve, Curve):
            try:
                # Call the generate_geometry method
                geom = geom_class.generate_geometry(curve)
                if geom:
                    output_geometry.append(geom)
            except:
                output_geometry.append(None)
        else:
            output_geometry.append(None)

OUT = output_geometry
# ----------------------------------------
material_volume_1_timber_in_mm_3 = Python(IN[0]=rectangular_timber_beam, IN[1]=all_timber_lines)  # CPython3
# ---------- material_volume_1_timber_in_mm_3.python (29 lines) ----------
import sys
import clr
clr.AddReference('ProtoGeometry') 
from Autodesk.DesignScript.Geometry import *

timber_class = IN[0]
curves_list = IN[1]

# Manual recursive flatten function (avoids complex Dynamo List module issues)
def flatten_list(input_list):
    flat_list = []
    if isinstance(input_list, list):
        for item in input_list:
            if isinstance(item, list):
                flat_list.extend(flatten_list(item))
            elif item is not None:
                flat_list.append(item)
    return flat_list

if timber_class is not None:
    # CRITICAL: Flatten the list of curves before calling the method
    all_curves_flat = flatten_list(curves_list)
    
    # Pass the now flat list of curves to the class method
    total_volume = timber_class.compute_volume(all_curves_flat)
    
    OUT = total_volume
else:
    OUT = 0.0
# ----------------------------------------
quantity_take_off_timber_volume = Watch(material_volume_1_timber_in_mm_3)  # "Quantity Take-off: Timber Volume in mm^3"
material_volume_2_steel_in_mm_3 = Python(IN[0]=circular_steel_rod, IN[1]=steel_bracing_lines)  # CPython3
# ---------- material_volume_2_steel_in_mm_3.python (29 lines) ----------
import sys
import clr
clr.AddReference('ProtoGeometry') 
from Autodesk.DesignScript.Geometry import *

steel_class = IN[0]
curves_list = IN[1]

# Manual recursive flatten function (avoids complex Dynamo List module issues)
def flatten_list(input_list):
    flat_list = []
    if isinstance(input_list, list):
        for item in input_list:
            if isinstance(item, list):
                flat_list.extend(flatten_list(item))
            elif item is not None:
                flat_list.append(item)
    return flat_list

if steel_class is not None:
    # CRITICAL: Flatten the list of curves before calling the method
    all_curves_flat = flatten_list(curves_list)

    # Pass the now flat list of curves to the class method
    total_volume = steel_class.compute_volume(all_curves_flat)
    
    OUT = total_volume
else:
    OUT = 0.0
# ----------------------------------------
quantity_take_off_steel_volume = Watch(material_volume_2_steel_in_mm_3)  # "Quantity Take-off: Steel Volume in mm^3"
python_script = Python()  # CPython3; unwired: IN[0]; starter script, not edited (OUT = 0)
