# Dynamo graph 1851164.dyn (Dynamo 3.6.0.9395)

code_block = CodeBlock { -5000; -5000; -200; }
byCoordinates = Point.ByCoordinates(x=code_block.out0, y=code_block.out1, z=code_block.out2)
code_block_2 = CodeBlock { 5000; 5000; 0; }
byCoordinates_2 = Point.ByCoordinates(x=code_block_2.out0, y=code_block_2.out1, z=code_block_2.out2)
byCorners = Cuboid.ByCorners(lowPoint=byCoordinates, highPoint=byCoordinates_2)
code_block_3 = CodeBlock { 0; 100; 0; }
byARGB = Color.ByARGB(red=code_block_3.out0, green=code_block_3.out1, blue=code_block_3.out2)
byGeometryColor = Modifiers.GeometryColor.ByGeometryColor(geometry=byCorners, color=byARGB)
amount_of_steel_square_columns = DoubleSlider(25, range=0..30 step 1)
code_block_4 = CodeBlock(n=amount_of_steel_square_columns) { 0..1..#n; }
specific_column_to_remove_for = CodeBlock { 18; }  # "Specific Column To Remove For Entrance"
removeItemAtIndex = List.RemoveItemAtIndex(list=code_block_4, indices=specific_column_to_remove_for)
watch = Watch(removeItemAtIndex)
bottom_circle_curve = CodeBlock { 4500; }
byCenterPointRadius_Bottom = Circle.ByCenterPointRadius(radius=bottom_circle_curve)  # "Circle.ByCenterPointRadius_Bottom"
pointAtParameter_Bottom = Curve.PointAtParameter(curve=byCenterPointRadius_Bottom, param=removeItemAtIndex)  # "Curve.PointAtParameter_Bottom"
top_circle_curve = CodeBlock { 0; 0; 4000; 4550; }
byCoordinates_3 = Point.ByCoordinates(x=top_circle_curve.out0, y=top_circle_curve.out1, z=top_circle_curve.out2)
byCenterPointRadius_Top = Circle.ByCenterPointRadius(centerPoint=byCoordinates_3, radius=top_circle_curve.out3)  # "Circle.ByCenterPointRadius_Top"
byOrigin = CoordinateSystem.ByOrigin()
XAxis = CoordinateSystem.XAxis(coordinateSystem=byOrigin)
axis_rotation_for_top_curve = DoubleSlider(15, range=1..360 step 0.1)
top_curve_rotation = Geometry.Rotate(geometry=byCenterPointRadius_Top, origin=byCoordinates_3, axis=XAxis, degrees=axis_rotation_for_top_curve)
pointAtParameter_Top = Curve.PointAtParameter(curve=top_curve_rotation, param=removeItemAtIndex)  # "Curve.PointAtParameter_Top"
side_length_of_square_prisms = DoubleSlider(350, range=1..1000 step 0.1)
class_for_steel_square_prisms = Python()  # CPython3; unwired: IN[0]
# ---------- class_for_steel_square_prisms.python (47 lines) ----------
# Load the Python Standard and DesignScript Libraries
import sys
import clr
clr.AddReference('ProtoGeometry')
from Autodesk.DesignScript.Geometry import *

class SquarePrism:
    def __init__(self, bottom_point, top_point, side_length):
        self.bottom = bottom_point
        self.top = top_point
        self.a = side_length

    def height(self):
        return self.bottom.DistanceTo(self.top)

    def volume(self):
        return self.a * self.a * self.height()

    def make_geometry(self):
        axis = Line.ByStartPointEndPoint(self.bottom, self.top)

        cs = CoordinateSystem.ByOriginVectors(
            self.bottom,
            Vector.XAxis(),
            Vector.YAxis()
        )

        # Half side length
        half = self.a / 2.0

        # Square profile points
        p1 = Point.ByCartesianCoordinates(cs, -half, -half, 0)
        p2 = Point.ByCartesianCoordinates(cs,  half, -half, 0)
        p3 = Point.ByCartesianCoordinates(cs,  half,  half, 0)
        p4 = Point.ByCartesianCoordinates(cs, -half,  half, 0)

        square = PolyCurve.ByPoints([p1, p2, p3, p4, p1])

        # to make top and bottom faces
        prism = Solid.BySweep(square, axis)

        axis.Dispose()
        cs.Dispose()

        return prism

OUT = SquarePrism
# ----------------------------------------
series_of_instances_for_steel = Python(IN[0]=pointAtParameter_Bottom, IN[1]=pointAtParameter_Top, IN[2]=side_length_of_square_prisms, IN[3]=class_for_steel_square_prisms)  # "Series of Instances for Steel Square Prisms"; CPython3
# ---------- series_of_instances_for_steel.python (28 lines) ----------
# IN[0] = bottom points
# IN[1] = top points
# IN[2] = side lengths
# IN[3] = class node

bottom_points = IN[0]
top_points = IN[1]
side_lengths = IN[2]
SquarePrism = IN[3]

if isinstance(side_lengths,(float, int)):
    side_lengths = [side_lengths]

prisms = []
total_volume = 0
count = min(len(bottom_points), len(top_points))

for i in range(count):
    a = side_lengths[i] if i<len(side_lengths) else side_lengths[-1]

    prism = SquarePrism(bottom_points[i], top_points[i], a)
    geometry = prism.make_geometry()
    prisms.append(geometry)
    
    total_volume += prism.volume()

OUT = prisms, total_volume
# the number output in the watch node list should be the total volume (mm^3).
# ----------------------------------------
watch_2 = Watch(series_of_instances_for_steel)
lower_circle_points = CodeBlock { Point.ByCoordinates(4500,-2500,3500); Point.ByCoordinates(0,-5000,2800); Point.ByCoordinates(-4500,-2500,3500); }
byThreePoints = Arc.ByThreePoints(firstPoint=lower_circle_points.out0, secondPoint=lower_circle_points.out1, thirdPoint=lower_circle_points.out2)
code_block_5 = CodeBlock { 0; 13; 1/12; }
sequence = Sequence(start=code_block_5.out0, amount=code_block_5.out1, step=code_block_5.out2)
pointAtParameter = Curve.PointAtParameter(curve=byThreePoints, param=sequence)
upper_circle_points = CodeBlock { Point.ByCoordinates(4500,2500,4800); Point.ByCoordinates(0,5000,5450); Point.ByCoordinates(-4500,2500,4800); }
byThreePoints_2 = Arc.ByThreePoints(firstPoint=upper_circle_points.out0, secondPoint=upper_circle_points.out1, thirdPoint=upper_circle_points.out2)
code_block_6 = CodeBlock { 0; 13; 1/12; }
sequence_2 = Sequence(start=code_block_6.out0, amount=code_block_6.out1, step=code_block_6.out2)
pointAtParameter_2 = Curve.PointAtParameter(curve=byThreePoints_2, param=sequence_2)
timbre_rod_radius = DoubleSlider(175, range=1..1000 step 1)
code_block_7 = CodeBlock { 7; 0; }
sequence_3 = Sequence(start=timbre_rod_radius, amount=code_block_7.out0, step=code_block_7.out1)
class_for_timbre_circular_rods = Python()  # CPython3; unwired: IN[0]
# ---------- class_for_timbre_circular_rods.python (28 lines) ----------
# Load the Python Standard and DesignScript Libraries
import sys
import clr
clr.AddReference('ProtoGeometry')
from Autodesk.DesignScript.Geometry import *

class CircularRod:
    def __init__(self, bottom_point, top_point, radius):
        self.bottom = bottom_point
        self.top = top_point
        self.radius = radius

        if self.height() <= 0:
            raise ValueError(f"Invalid rod: bottom {self.bottom}, top {self.top} => height must be > 0")

    def height(self):
        return self.bottom.DistanceTo(self.top)

    def volume(self):
        h = self.height()
        return 3.141592653589793 * self.radius**2 * h

    def make_geometry(self):
        if self.height() <= 0:
            raise ValueError("Cannot create cylinder with zero or negative height")
        return Cylinder.ByPointsRadius(self.bottom, self.top, self.radius)

OUT = CircularRod
# ----------------------------------------
series_of_instances_for_timbre = Python(IN[0]=pointAtParameter, IN[1]=pointAtParameter_2, IN[2]=sequence_3, IN[3]=class_for_timbre_circular_rods)  # "Series of Instances for Timbre Rods"; CPython3
# ---------- series_of_instances_for_timbre.python (40 lines) ----------
# IN[0] = bottom_points
# IN[1] = top_points
# IN[2] = radii
# IN[3] = CircularRod class

bottom_points = IN[0]
top_points = IN[1]
radii = IN[2]
CircularRod = IN[3]

if hasattr(bottom_points, "X"):
    bottom_points = [bottom_points]

if hasattr(top_points, "X"):
    top_points = [top_points]

if isinstance(radii, (int, float)):
    radii = [radii]

count = min(len(bottom_points), len(top_points))

rods = []
geometries = []
total_volume = 0

for i in range(count):
    r = radii[i] if i < len(radii) else radii[-1]
    rod = CircularRod(bottom_points[i], top_points[i], r)
    
    if rod.height() <= 0:
        print(f"Skipping rod {i} due to zero or negative height.")
        continue

    geom = rod.make_geometry()
    geometries.append(geom)
    rods.append(rod)
    total_volume += rod.volume()

OUT = geometries, total_volume
# total volume of rods shown as the numerical value in the adjacent watch node
# ----------------------------------------
watch_3 = Watch(series_of_instances_for_timbre)
byOrigin_2 = CoordinateSystem.ByOrigin()
code_block_8 = CodeBlock { 0; 0; 0; }
translate = CoordinateSystem.Translate(coordinateSystem=byOrigin_2, xTranslation=code_block_8.out0, yTranslation=code_block_8.out1, zTranslation=code_block_8.out2)
code_block_9 = CodeBlock { 100; 10000; }
conjoining_rod = Cylinder.ByRadiusHeight(coordinateSystem=translate, radius=code_block_9.out0, height=code_block_9.out1)
code_block_10 = CodeBlock { -5000; 0; 4100; }
byCoordinates_4 = Vector.ByCoordinates(x=code_block_10.out0, y=code_block_10.out1, z=code_block_10.out2)
translate_2 = Geometry.Translate(geometry=conjoining_rod, direction=byCoordinates_4)
byCoordinates_5 = Point.ByCoordinates(x=code_block_10.out0, y=code_block_10.out1, z=code_block_10.out2)
YAxis = Vector.YAxis()
number_slider = DoubleSlider(90, range=0..360 step 1)
rotate = Geometry.Rotate(geometry=translate_2, origin=byCoordinates_5, axis=YAxis, degrees=number_slider)
byOrigin_3 = CoordinateSystem.ByOrigin()
code_block_11 = CodeBlock { 0; 0; 0; }
translate_3 = CoordinateSystem.Translate(coordinateSystem=byOrigin_3, xTranslation=code_block_11.out0, yTranslation=code_block_11.out1, zTranslation=code_block_11.out2)
code_block_12 = CodeBlock { 5000; 50; }
glass_roof = Cylinder.ByRadiusHeight(coordinateSystem=translate_3, radius=code_block_12.out0, height=code_block_12.out1)
code_block_13 = CodeBlock { 0; 0; 4050; }
byCoordinates_6 = Vector.ByCoordinates(x=code_block_13.out0, y=code_block_13.out1, z=code_block_13.out2)
translate_4 = Geometry.Translate(geometry=glass_roof, direction=byCoordinates_6)
byCoordinates_7 = Point.ByCoordinates(x=code_block_13.out0, y=code_block_13.out1, z=code_block_13.out2)
XAxis_2 = Vector.XAxis()
number_slider_2 = DoubleSlider(15, range=0..360 step 1)
rotate_2 = Geometry.Rotate(geometry=translate_4, origin=byCoordinates_7, axis=XAxis_2, degrees=number_slider_2)
opacity_of_boxes = DoubleSlider(47, range=0..110 step 0.1)
code_block_14 = CodeBlock { 128; }
byARGB_2 = Color.ByARGB(alpha=opacity_of_boxes, red=code_block_14, green=code_block_14, blue=code_block_14)
byGeometryColor_2 = Modifiers.GeometryColor.ByGeometryColor(geometry=rotate_2, color=byARGB_2)
