# Dynamo graph 1851328.dyn (Dynamo 3.6.0.9395)

# group: Don't touch this ground
code_block = CodeBlock { -5000; -5000; -200; }
byCoordinates = Point.ByCoordinates(x=code_block.out0, y=code_block.out1, z=code_block.out2)
code_block_2 = CodeBlock { 5000; 5000; 0; }
byCoordinates_2 = Point.ByCoordinates(x=code_block_2.out0, y=code_block_2.out1, z=code_block_2.out2)
byCorners = Cuboid.ByCorners(lowPoint=byCoordinates, highPoint=byCoordinates_2)
code_block_3 = CodeBlock { 0; 100; 0; }
byARGB = Color.ByARGB(red=code_block_3.out0, green=code_block_3.out1, blue=code_block_3.out2)
byGeometryColor = Modifiers.GeometryColor.ByGeometryColor(geometry=byCorners, color=byARGB)

number = DoubleInput(-4000)
number_2 = DoubleInput(-3000)
number_3 = DoubleInput(1800)
byCoordinates_3 = Point.ByCoordinates(x=number, y=number_2, z=number_3)
number_4 = DoubleInput(-2000)

# group: Sliders
# Parametric Patterning of Pavillion through 4 Slider Parameters
overhang_of_arc_openings = DoubleSlider(1450, range=1000..2500 step 50)
height_of_arc_peaks = DoubleSlider(2550, range=2000..3000 step 50)
number_of_ground_supporting = DoubleSlider(0.25, range=0.05..0.25 step 0.05)  # "Number of Ground Supporting Aluminum Beams"
thickness_radius_of_aluminum = DoubleSlider(65, range=50..200 step 5)  # "Thickness (radius) of Aluminum Beams"

code_block_4 = CodeBlock(master=overhang_of_arc_openings) { A=(master + 2000); B=-1*(master + 2000); }
byCoordinates_4 = Point.ByCoordinates(x=number_4, y=code_block_4.B, z=height_of_arc_peaks)
number_5 = DoubleInput(-3000)
byCoordinates_5 = Point.ByCoordinates(y=number_5)
byThreePoints = Arc.ByThreePoints(firstPoint=byCoordinates_3, secondPoint=byCoordinates_4, thirdPoint=byCoordinates_5)
number_6 = DoubleInput(-2000)
number_7 = DoubleInput(1800)
byCoordinates_6 = Point.ByCoordinates(x=number_6, z=number_7)
byCoordinates_7 = Point.ByCoordinates(z=height_of_arc_peaks)
number_8 = DoubleInput(2000)
byCoordinates_8 = Point.ByCoordinates(x=number_8)
byThreePoints_2 = Arc.ByThreePoints(firstPoint=byCoordinates_6, secondPoint=byCoordinates_7, thirdPoint=byCoordinates_8)
number_9 = DoubleInput(3000)
number_10 = DoubleInput(1800)
byCoordinates_9 = Point.ByCoordinates(y=number_9, z=number_10)
byStartPointEndPoint = Line.ByStartPointEndPoint(startPoint=byCoordinates_3, endPoint=byCoordinates_9)
byCoordinates_10 = Point.ByCoordinates(y=number_9)
byCoordinates_11 = Point.ByCoordinates(x=number, y=number_2)
byStartPointEndPoint_2 = Line.ByStartPointEndPoint(startPoint=byCoordinates_10, endPoint=byCoordinates_11)
list_create = List.Create(item0=byStartPointEndPoint, item1=byStartPointEndPoint_2)
code_block_5 = CodeBlock { 0; 1; }
range = Range(start=code_block_5.out0, end=code_block_5.out1, step=number_of_ground_supporting)
pointAtParameter = Curve.PointAtParameter(curve=list_create, param=range, lacing=CrossProduct)
code_block_6 = CodeBlock { 0; }
getItemAtIndex = List.GetItemAtIndex(list=pointAtParameter, index=code_block_6)
code_block_7 = CodeBlock { 1; }
getItemAtIndex_2 = List.GetItemAtIndex(list=pointAtParameter, index=code_block_7)
reverse = List.Reverse(list=getItemAtIndex_2)
byStartPointEndPoint_3 = Line.ByStartPointEndPoint(startPoint=getItemAtIndex, endPoint=reverse)
number_11 = DoubleInput(2000)
byCoordinates_12 = Point.ByCoordinates(x=number_11, y=code_block_4.A, z=height_of_arc_peaks)
number_12 = DoubleInput(4000)
byCoordinates_13 = Point.ByCoordinates(x=number_12, y=number_9)
byThreePoints_3 = Arc.ByThreePoints(firstPoint=byCoordinates_9, secondPoint=byCoordinates_12, thirdPoint=byCoordinates_13)
list_of_aluminum_beams = List.Create(item0=byThreePoints, item1=byThreePoints_2, item2=byStartPointEndPoint_3, item3=byThreePoints_3)
class_aluminum_beams_series_of = Python(IN[0]=list_of_aluminum_beams, IN[1]=thickness_radius_of_aluminum)  # "Class: Aluminum Beams - Series of Instances"; CPython3
# ---------- class_aluminum_beams_series_of.python (58 lines) ----------
import clr
clr.AddReference('ProtoGeometry')
from Autodesk.DesignScript.Geometry import *
import math

class AluminumBeams:
    #Class representing circular aluminum beams
    def __init__(self, curve_path, radius):
        self.curve_path = curve_path
        self.radius = radius
        self.geometry = None
        self.volume = 0
        
    def generate_geometry(self): #Cylindrical beam geometry
        start_point = self.curve_path.StartPoint
        direction = self.curve_path.TangentAtParameter(0.0)
        circle = Circle.ByCenterPointRadiusNormal(start_point, self.radius, direction)
        self.geometry = Solid.BySweep(circle, self.curve_path)
        return self.geometry
    
    def calculate_volume(self):
        path_length = self.curve_path.Length
        self.volume = math.pi * (self.radius ** 2) * path_length
        return self.volume
        
#Inputs from Dynamo connections
all_beam_curves = IN[0] if isinstance(IN[0], list) else [IN[0]]
beam_radius = IN[1]

def flatten(lst): #Flatten for nested lists
    result = []
    for item in lst:
        if isinstance(item, list):
            result.extend(flatten(item))
        else:
            result.append(item)
    return result

all_beam_curves = flatten(all_beam_curves)

#Series of Instances of aluminum beams, beam geometry, and beam volumes
al_beams = []
beam_geometries = []
beam_volumes = []

for curve in all_beam_curves:
    beam = AluminumBeams(curve, beam_radius)
    beam.generate_geometry()
    beam.calculate_volume()
    al_beams.append(beam)
    beam_geometries.append(beam.geometry)
    beam_volumes.append(beam.volume)

total_al_volume = sum(beam_volumes)

# OUT[0] = Geometries 
# OUT[1] = Total volume of the Aluminum Support Beams in mm^3
OUT = [beam_geometries, total_al_volume]
# ----------------------------------------
code_block_8 = CodeBlock(x=class_aluminum_beams_series_of) { x[0]; x[1]; }
list_create_2 = List.Create(item0=byThreePoints, item1=byThreePoints_2)
byLoft = Surface.ByLoft(crossSections=list_create_2)
list_create_3 = List.Create(item0=byThreePoints_3, item1=byThreePoints_2)
byLoft_2 = Surface.ByLoft(crossSections=list_create_3)
list_of_polycarbonate_panels = List.Create(item0=byLoft, item1=byLoft_2)
class_polycarbonate_roof_panels = Python(IN[0]=list_of_polycarbonate_panels, IN[1]=thickness_radius_of_aluminum)  # "Class: Polycarbonate Roof Panels - Series of Instances"; CPython3
# ---------- class_polycarbonate_roof_panels.python (54 lines) ----------
import clr
clr.AddReference('ProtoGeometry')
from Autodesk.DesignScript.Geometry import *

class PolycarbonateRoofPanels:
    #Class representing a roof panel
    def __init__(self, surface, thickness):
        self.surface = surface
        self.thickness = thickness
        self.geometry = None
        self.volume = 0
        
    def generate_geometry(self):  #Solid Panel Geometry
        self.geometry = self.surface.Thicken(self.thickness, True)
        return self.geometry
    
    def calculate_volume(self):  #Panel volume in mm^3
        surface_area = self.surface.Area
        self.volume = surface_area * self.thickness
        return self.volume

#Inputs from Dynamo Connections
panel_surfaces = IN[0] if isinstance(IN[0], list) else [IN[0]]
panel_thickness = IN[1]

def flatten(lst):  #Flatten for nested lists
    result = []
    for item in lst:
        if isinstance(item, list):
            result.extend(flatten(item))
        else:
            result.append(item)
    return result

panel_surfaces = flatten(panel_surfaces)

#Series of Instances for roof panels, panel geometry, and panel volumes
roof_panels = []
panel_geometries = []
panel_volumes = []

for surface in panel_surfaces:
    panel = PolycarbonateRoofPanels(surface, panel_thickness)
    panel.generate_geometry()
    panel.calculate_volume()
    roof_panels.append(panel)
    panel_geometries.append(panel.geometry)
    panel_volumes.append(panel.volume)

total_panel_volume = sum(panel_volumes)

# OUT[0] = Geometries 
# OUT[1] = Total volume of Polycarbonate Roof Panels in mm³
OUT = [panel_geometries, total_panel_volume]
# ----------------------------------------
code_block_9 = CodeBlock(x=class_polycarbonate_roof_panels) { x[0]; x[1]; }

# group: Volumes of Material 1 and 2 (mm^3)
# Calculated Volumes of Roof Panels (green) and Aluminum Beams (yellow)
volume_of_aluminum_beams_mm_3 = Watch(code_block_8.out1)
volume_of_polycarbonate_roof = Watch(code_block_9.out1)  # "Volume of Polycarbonate Roof Panel Sheets (mm^3)"

color_palette = ColorPalette({R: 255, G: 255, B: 0, A: 255})
byGeometryColor_2 = Modifiers.GeometryColor.ByGeometryColor(geometry=code_block_8.out0, color=color_palette)
color_palette_2 = ColorPalette({R: 63, G: 126, B: 3, A: 255})
byGeometryColor_3 = Modifiers.GeometryColor.ByGeometryColor(geometry=code_block_9.out0, color=color_palette_2)
