# Dynamo graph 1851442.dyn (Dynamo 3.6.0.9395)

# group: Don't touch this ground
code_block = CodeBlock { -5000; -5000; -200; }
byCoordinates = Point.ByCoordinates(x=code_block.out0, y=code_block.out1, z=code_block.out2)
code_block_2 = CodeBlock { 5000; 5000; 0; }
byCoordinates_2 = Point.ByCoordinates(x=code_block_2.out0, y=code_block_2.out1, z=code_block_2.out2)
byCorners = Cuboid.ByCorners(lowPoint=byCoordinates, highPoint=byCoordinates_2)
code_block_3 = CodeBlock { 0; 100; 0; }
byARGB = Color.ByARGB(red=code_block_3.out0, green=code_block_3.out1, blue=code_block_3.out2)
byGeometryColor = Modifiers.GeometryColor.ByGeometryColor(geometry=byCorners, color=byARGB)

class_parabolas_steel_beams = Python()  # CPython3; unwired: IN[0]
# ---------- class_parabolas_steel_beams.python (51 lines) ----------
# Load the Python Standard and DesignScript Libraries
import sys
import clr
clr.AddReference('ProtoGeometry')
clr.AddReference('DynamoServices')
import DynamoServices
from Autodesk.DesignScript.Geometry import *
import numpy as np

class parabolas:
    def __init__(self, NumArcs, Divisions, x, BarThickness, BarHeight):
        self.NumArcs = NumArcs
        self.Divisions = Divisions
        self.x = x
        self.BarThickness = BarThickness
        self.BarHeight = BarHeight
    def CreateArc(self):
        slope = 0.000375
        x = self.x
        Arcx = np.zeros((self.Divisions, 3))
        yrange = np.linspace(-4000, 4000, self.Divisions)
        zmax = 6000 - slope*x**2
        for i in range(self.Divisions):
          Arcx[i][0] = x
          Arcx[i][1] = yrange[i]
          Arcx[i][2] = zmax - slope*yrange[i]**2
        return(Arcx)
    
    def DrawPoint(self, point):
      return Point.ByCoordinates(point[0], point[1], point[2])
    
    def DrawArc(self):
      Arcx = self.CreateArc()
      drawnArc = []
      for i in range(self.Divisions):
        if Arcx[i][2] > 0 and Arcx[i][0] < 5000 and Arcx[i][0] > -5000 and Arcx[i][1] < 5000 and Arcx[i][1] > -5000:
          drawnArc.append(self.DrawPoint(Arcx[i]))
      return drawnArc
      
    def DrawCurve(self, DrawnArc):
        BarHeight = self.BarHeight
        BarThickness = self.BarThickness
        Curvex = NurbsCurve.ByControlPoints(DrawnArc)
        Curvex = Curve.Extrude(Curvex, -BarHeight)
        Curvex = Surface.Thicken(Curvex, BarThickness)
        return Curvex
        
        
      

OUT = parabolas
# ----------------------------------------
numArcs = IntegerSlider(9, range=2..20 step 1)
divisions = IntegerSlider(16, range=10..100 step 1)
x_mininum = DoubleSlider(-4000, range=-5000..5000 step 0.1)
x_maximum = DoubleSlider(4000, range=-5000..5000 step 0.1)
beam_thickness = DoubleSlider(100, range=0..3100 step 0.1)
beam_height = DoubleSlider(100, range=0..3100 step 0.1)
instance_steel_beams = Python(IN[0]=class_parabolas_steel_beams, IN[1]=numArcs, IN[2]=divisions, IN[3]=x_mininum, IN[4]=x_maximum, IN[5]=beam_thickness, IN[6]=beam_height)  # CPython3
# ---------- instance_steel_beams.python (46 lines) ----------
import numpy as np
import clr
clr.AddReference("DynamoServices")
import DynamoServices

parabolas = IN[0]
NumArcs = IN[1]
Divisions = IN[2]
XMin = IN[3]
XMax = IN[4]
BarThickness = IN[5]
BarHeight = IN[6]

xList = np.linspace(XMin, XMax, NumArcs)

Frame = []
Beams = []

for i in range(NumArcs):
    shape = parabolas(NumArcs, Divisions, xList[i], BarThickness, BarHeight)
    DrawnArc = shape.DrawArc()
    if len(DrawnArc) < 3:
       continue 
       
    Frame.append(DrawnArc)
    Beams.append(shape.DrawCurve(DrawnArc))
    


BeamVolumes = []
for b in Beams:
    if b is None:
        BeamVolumes.append(None)
    else:
        try:
            BeamVolumes.append(b.Volume) 
        except Exception as e:
            BeamVolumes.append("err: " + str(e))

ValidVols = [v for v in BeamVolumes if isinstance(v, (int, float))]
TotalVol = sum(ValidVols)

volume_unit = "mm³"
total_volume_label = "{0:.2f} {1}".format(TotalVol, volume_unit)

OUT = (tuple(Frame), tuple(Beams), total_volume_label)
# ----------------------------------------
code_block_4 = CodeBlock { 2; }
get_steel_beam_volume = List.GetItemAtIndex(list=instance_steel_beams, index=code_block_4)
steel_beam_volume = Watch(get_steel_beam_volume)
class_aluminum_triangle_surface = Python()  # CPython3; unwired: IN[0]
# ---------- class_aluminum_triangle_surface.python (144 lines) ----------
# Load the Python Standard and DesignScript Libraries
import sys
import clr
clr.AddReference('ProtoGeometry')
from Autodesk.DesignScript.Geometry import *
import numpy


class TriangleSurface:
    def __init__(self, points, SurfaceThickness):
        self.points = points
        self.NumArc = len(points)
        self.SurfaceThickness = SurfaceThickness

    def P2V(self, P):
        return numpy.array([P.X, P.Y, P.Z], dtype=float)

    def TriangleArea(self, A, B, C):
        A = self.P2V(A)
        B = self.P2V(B)
        C = self.P2V(C)
        return 0.5 * numpy.linalg.norm(numpy.cross(B - A, C - A))

    def PickVertices(self, T, B, iT, iB):
        # First triangle
        A1 = T[iT]
        B1 = B[iB]
        C1 = B[iB + 1]
        Set1 = [A1, B1, C1]
        Area1 = self.TriangleArea(A1, B1, C1)

        # Second triangle
        A2 = T[iT]
        B2 = T[iT + 1]
        C2 = B[iB + 1]
        Set2 = [A2, B2, C2]
        Area2 = self.TriangleArea(A2, B2, C2)

        return (Set1, Set2, Area1, Area2)

    def FanTriangles(self, anchor, row, start, end, out_list, area_accum):
        for k in range(start, end + 1):
            A = anchor
            B = row[k]
            C = row[k + 1]

            tri_area = self.TriangleArea(A, B, C)

            tri = Surface.ByPatch(Polygon.ByPoints([A, B, C]))
            tri = Surface.Thicken(tri, self.SurfaceThickness)

            out_list.append(tri)
            area_accum.append(tri_area)

    def DrawTriangles(self, points):
        TriangleSet = []
        TriangleAreas = []
        SurfaceThickness = self.SurfaceThickness

        for i in range(len(points) - 1):

            T = points[i]     # Top row
            B = points[i + 1] # Bottom row

            nT = len(T)
            nB = len(B)

            # CASE 1 — Top row ≥ Bottom row
            if nT >= nB:
                shift = (nT - nB) // 2

                p_min = shift
                p_max = shift + nB - 2

                # Middle aligned triangles
                for p in range(p_min, p_max + 1):
                    iT = p
                    iB = p - shift

                    Set1, Set2, Area1, Area2 = self.PickVertices(T, B, iT, iB)

                    tri1 = Surface.ByPatch(Polygon.ByPoints(Set1))
                    tri2 = Surface.ByPatch(Polygon.ByPoints(Set2))
                    tri1 = Surface.Thicken(tri1, SurfaceThickness)
                    tri2 = Surface.Thicken(tri2, SurfaceThickness)

                    TriangleSet.append(tri1)
                    TriangleAreas.append(Area1)
                    TriangleSet.append(tri2)
                    TriangleAreas.append(Area2)

                # Left fan
                if shift > 0:
                    anchor = B[0]
                    self.FanTriangles(anchor, T, 0, shift - 1, TriangleSet, TriangleAreas)

                # Right fan
                right_start = shift + nB - 1
                if right_start < nT - 1:
                    anchor = B[-1]
                    self.FanTriangles(anchor, T, right_start, nT - 2, TriangleSet, TriangleAreas)

            # CASE 2 — Bottom row > Top row
            else:
                shift = (nB - nT) // 2

                p_min = shift
                p_max = shift + nT - 2

                # Middle aligned triangles
                for p in range(p_min, p_max + 1):
                    iT = p - shift
                    iB = p

                    Set1, Set2, Area1, Area2 = self.PickVertices(T, B, iT, iB)

                    tri1 = Surface.ByPatch(Polygon.ByPoints(Set1))
                    tri2 = Surface.ByPatch(Polygon.ByPoints(Set2))
                    tri1 = Surface.Thicken(tri1, SurfaceThickness)
                    tri2 = Surface.Thicken(tri2, SurfaceThickness)

                    TriangleSet.append(tri1)
                    TriangleAreas.append(Area1)
                    TriangleSet.append(tri2)
                    TriangleAreas.append(Area2)

                # Left fan
                if shift > 0:
                    anchor = T[0]
                    self.FanTriangles(anchor, B, 0, shift - 1, TriangleSet, TriangleAreas)

                # Right fan
                right_start = shift + nT - 1
                if right_start < nB - 1:
                    anchor = T[-1]
                    self.FanTriangles(anchor, B, right_start, nB - 2, TriangleSet, TriangleAreas)

        total_area = sum(TriangleAreas)
        total_volume = total_area * self.SurfaceThickness

        return (TriangleSet, total_volume)


OUT = TriangleSurface
# ----------------------------------------
code_block_5 = CodeBlock { 0; }
getItemAtIndex = List.GetItemAtIndex(list=instance_steel_beams, index=code_block_5)
surfaceThickness = DoubleSlider(50, range=0..100 step 0.1)
instance_aluminum_triangle = Python(IN[0]=class_aluminum_triangle_surface, IN[1]=getItemAtIndex, IN[2]=surfaceThickness)  # "Instance: Aluminum Triangle Surface"; CPython3
# ---------- instance_aluminum_triangle.python (12 lines) ----------
import numpy as np
TriangleSurface = IN[0]
points = IN[1]
SurfaceThickness = IN[2]

Surf = TriangleSurface(points, SurfaceThickness)
TriangleSet, TriangleVolume = Surf.DrawTriangles(points)

volume_unit = "mm³"
total_volume_label = "{0:.2f} {1}".format(TriangleVolume, volume_unit)

OUT = (TriangleSet, total_volume_label)
# ----------------------------------------
code_block_6 = CodeBlock { 1; }
getItemAtIndex_2 = List.GetItemAtIndex(list=instance_aluminum_triangle, index=code_block_6)
aluminum_sheet_volune = Watch(getItemAtIndex_2)
copyFile = FileSystem.CopyFile()  # unwired: file, destinationPath
code_block_7 = CodeBlock { 1; }
getItemAtIndex_3 = List.GetItemAtIndex(list=instance_steel_beams, index=code_block_7)
code_block_8 = CodeBlock { 0; }
translate = Geometry.Translate(geometry=getItemAtIndex_3, xTranslation=code_block_8, yTranslation=code_block_8, zTranslation=code_block_8)
