# Dynamo graph 1851455.dyn (Dynamo 4.0.0.3277)

# group: Ground
code_block = CodeBlock { -5000; -5000; -200; }
byCoordinates = Point.ByCoordinates(x=code_block.out0, y=code_block.out1, z=code_block.out2)
code_block_2 = CodeBlock { 5000; 5000; 0; }
byCoordinates_2 = Point.ByCoordinates(x=code_block_2.out0, y=code_block_2.out1, z=code_block_2.out2)
byCorners = Cuboid.ByCorners(lowPoint=byCoordinates, highPoint=byCoordinates_2)
code_block_3 = CodeBlock { 0; 100; 0; }
byARGB = Color.ByARGB(red=code_block_3.out0, green=code_block_3.out1, blue=code_block_3.out2)
byGeometryColor = Modifiers.GeometryColor.ByGeometryColor(geometry=byCorners, color=byARGB)

# group: Fire Cylinders
# material = painted steel
fire_cylinders_class = Python()  # PythonNet3; unwired: IN[0]
# ---------- fire_cylinders_class.python (38 lines) ----------
import sys
import clr
import random
import math
clr.AddReference('ProtoGeometry')
from Autodesk.DesignScript.Geometry import *

class Fire_cylinders: 

    # constructor 
    def __init__(self, start, h, maxT):
        self.start_point = start  #will be at the origin  
        self.height = h
        self.maxTilt = maxT  #in degrees to make slider easier to use
        
        self.radius =  random.uniform(50,90)


    # make cylinders 
    def generate(self):
    #create original vertical cylinders which will be rotated
        end = Point.ByCoordinates(self.start_point.X, self.start_point.Y, self.start_point.Z + self.height)
        cyl = Cylinder.ByPointsRadius(self.start_point, end, self.radius)

        #rotate the cylinder 
        tilt_angle = random.uniform(0, self.maxTilt) #choose an angle to tilt between 0 and max tilt 
        axis_vector = Vector.ByCoordinates(random.uniform(-1,1), random.uniform(-1,1), random.uniform(-1,1)) # pick random x and y but keep z 0 for rotation axis  
        cyl_tilted = cyl.Rotate(self.start_point, axis_vector, tilt_angle) #rotate previously vertical cylinder 
        return cyl_tilted
        
    #calculate volume       
    def volume(self):
        return math.pi *self.radius ** 2 * self.height


OUT = Fire_cylinders 

  
# ----------------------------------------
number_of_cylinders = IntegerSlider(70, range=55..75 step 1)
average_height_of_fire = IntegerSlider(1413, range=600..2000 step 1)
max_cylinder_tilt = IntegerSlider(52, range=30..80 step 1)
series_of_instances_fire = Python(IN[0]=fire_cylinders_class, IN[1]=number_of_cylinders, IN[2]=average_height_of_fire, IN[3]=max_cylinder_tilt)  # "series_of_instances (fire_cylinders)"; PythonNet3
# ---------- series_of_instances_fire.python (38 lines) ----------
import random
import math
from Autodesk.DesignScript.Geometry import Point
import DSCore
from DSCore import Color

FireClass = IN[0]        
n = IN[1]               # number of flames 
avgHeight = IN[2]       # average height of flame cylinders 
maxTilt = IN[3]         # maximum tilt of each flame (in degrees)   

# empty lists/ variables will be added to soon 

startPoint = Point.ByCoordinates(0,0,0)
flames = []

colours = []
colour_choices = [Color.ByARGB(255, 255, 106, 0), Color.ByARGB(255, 255, 69, 0), Color.ByARGB(255, 255, 28, 0)  ]
totalVolume = 0

for i in range(n):
    # random height can be 20% more or less than set average
    height = avgHeight * random.uniform(0.4, 1.4)   
    
    # flame instance created 
    flame = FireClass(startPoint, height, maxTilt)
    
    # generate geometry of flame 
    geom = flame.generate()
    flames.append(geom)
    
    #get colour of flame 
    colours.append(random.choice(colour_choices))
    
    # accumulate volume
    totalVolume += flame.volume()

OUT = [flames, colours, totalVolume]
# ----------------------------------------
code_block_4 = CodeBlock { 0; }
flame_geometry = List.GetItemAtIndex(list=series_of_instances_fire, index=code_block_4)
code_block_5 = CodeBlock { 1; }
flame_colours = List.GetItemAtIndex(list=series_of_instances_fire, index=code_block_5)
byGeometryColor_2 = Modifiers.GeometryColor.ByGeometryColor(geometry=flame_geometry, color=flame_colours)
code_block_6 = CodeBlock { 2; }
volume = List.GetItemAtIndex(list=series_of_instances_fire, index=code_block_6)
python_script = Python(IN[0]=volume)  # PythonNet3
# ---------- python_script.python (5 lines) ----------
total_volume = IN[0]

volume_string = "Painted steel volume = " + str(total_volume) + " mm^3"

OUT = volume_string
# ----------------------------------------
display_paintedSteel_volume = Watch(python_script)

# group: Fire Pit Perimeter
# material = sandstone
code_block_7 = CodeBlock { 0; 0; 0; }
outer_cylinder_start_point = Point.ByCoordinates(x=code_block_7.out0, y=code_block_7.out1, z=code_block_7.out2)
code_block_8 = CodeBlock { 0; 0; }
height = DoubleSlider(154, range=100..300 step 1)
cylinder_end_point = Point.ByCoordinates(x=code_block_8.out0, y=code_block_8.out1, z=height)
outer_radius = DoubleSlider(700, range=600..1000 step 5)
outer_cylinder = Cylinder.ByPointsRadius(startPoint=outer_cylinder_start_point, endPoint=cylinder_end_point, radius=outer_radius)
code_block_9 = CodeBlock { 0; 0; 5; }
inner_cylinder_start_point = Point.ByCoordinates(x=code_block_9.out0, y=code_block_9.out1, z=code_block_9.out2)
inner_radius_slider = DoubleSlider(700, range=500..800 step 5)
inner_radius = Python(IN[0]=outer_radius, IN[1]=inner_radius_slider)  # PythonNet3
# ---------- inner_radius.python (18 lines) ----------
outer_r = IN[0]   
inner_r_input = IN[1]  

min_diff = 200
max_diff = 500

min_inner_r = outer_r - max_diff  
max_inner_r = outer_r - min_diff  

if inner_r_input > max_inner_r:
    inner_r = max_inner_r
elif inner_r_input < min_inner_r:
    inner_r = min_inner_r
else:
    inner_r = inner_r_input
    
OUT = inner_r
 
# ----------------------------------------
inner_cylinder = Cylinder.ByPointsRadius(startPoint=inner_cylinder_start_point, endPoint=cylinder_end_point, radius=inner_radius)
perimeter = Solid.Difference(solid=outer_cylinder, other=inner_cylinder)
sandstone_colour = Python()  # PythonNet3; unwired: IN[0]
# ---------- sandstone_colour.python (6 lines) ----------
import DSCore
from DSCore import Color

firepit_color = Color.ByARGB(255, 210, 166, 121)

OUT = firepit_color
# ----------------------------------------
final_perimeter_display = Modifiers.GeometryColor.ByGeometryColor(geometry=perimeter, color=sandstone_colour)
volume_calculator = Python(IN[0]=outer_radius, IN[1]=inner_radius, IN[2]=height, IN[3]=code_block_9.out2)  # PythonNet3
# ---------- volume_calculator.python (16 lines) ----------
import math

# inputs
r_outer = IN[0]
r_inner = IN[1]
h = IN[2]
inner_start_z = IN[3]

# calculate volume
bottom_volume = math.pi * r_outer**2 * inner_start_z
overlap_volume = math.pi * (r_outer**2 - r_inner**2) * (h - inner_start_z)
total_volume = bottom_volume + overlap_volume

volume_string = "Sandstone volume = " + str(total_volume) + " mm^3"

OUT = volume_string
# ----------------------------------------
display_sandstone_volume = Watch(volume_calculator)

# group: Seats
# Material = Teak wood
code_block_10 = CodeBlock { 1800; 0; Vector.ZAxis(); 60; 200; }
seat1_curve1 = Arc.ByCenterPointRadiusAngle(radius=code_block_10.out0, startAngle=code_block_10.out1, endAngle=code_block_10.out3, normal=code_block_10.out2)
seat1_curve2 = Curve.OffsetMany(curve=seat1_curve1, signedDistance=code_block_10.out4, planeNormal=code_block_10.out2)
list_create = List.Create(item0=seat1_curve1, item1=seat1_curve2)
seat1_surface = Surface.ByLoft(crossSections=list_create)
seats_thickness = IntegerSlider(399, range=150..399 step 1)
thicken = Surface.Thicken(surface=seat1_surface, thickness=seats_thickness)
code_block_11 = CodeBlock { 1700; 90; Vector.ZAxis(); 130; 200; }
seat2_curve1 = Arc.ByCenterPointRadiusAngle(radius=code_block_11.out0, startAngle=code_block_11.out1, endAngle=code_block_11.out3, normal=code_block_11.out2)
seat2_curve2 = Curve.OffsetMany(curve=seat2_curve1, signedDistance=code_block_11.out4, planeNormal=code_block_11.out2)
list_create_2 = List.Create(item0=seat2_curve1, item1=seat2_curve2)
seat2_surface = Surface.ByLoft(crossSections=list_create_2)
thicken_2 = Surface.Thicken(surface=seat2_surface, thickness=seats_thickness)
code_block_12 = CodeBlock { 1800; 160; Vector.ZAxis(); 210; 200; }
seat3_curve1 = Arc.ByCenterPointRadiusAngle(radius=code_block_12.out0, startAngle=code_block_12.out1, endAngle=code_block_12.out3, normal=code_block_12.out2)
seat3_curve2 = Curve.OffsetMany(curve=seat3_curve1, signedDistance=code_block_12.out4, planeNormal=code_block_12.out2)
list_create_3 = List.Create(item0=seat3_curve1, item1=seat3_curve2)
seat3_surface = Surface.ByLoft(crossSections=list_create_3)
thicken_3 = Surface.Thicken(surface=seat3_surface, thickness=seats_thickness)
code_block_13 = CodeBlock { 1700; 290; Vector.ZAxis(); 330; 200; }
seat4_curve1 = Arc.ByCenterPointRadiusAngle(radius=code_block_13.out0, startAngle=code_block_13.out1, endAngle=code_block_13.out3, normal=code_block_13.out2)
seat4_curve2 = Curve.OffsetMany(curve=seat4_curve1, signedDistance=code_block_13.out4, planeNormal=code_block_13.out2)
list_create_4 = List.Create(item0=seat4_curve1, item1=seat4_curve2)
seat4_surface = Surface.ByLoft(crossSections=list_create_4)
thicken_4 = Surface.Thicken(surface=seat4_surface, thickness=seats_thickness)
list_create_5 = List.Create(item0=thicken, item1=thicken_2, item2=thicken_3, item3=thicken_4)
seat_colour = Python()  # PythonNet3
# ---------- seat_colour.python (7 lines) ----------
import DSCore
from DSCore import Color

# Wood color for benches
bench_color = Color.ByARGB(255, 160, 110, 60)  # warm brown

OUT = bench_color
# ----------------------------------------
colour_seats = Modifiers.GeometryColor.ByGeometryColor(geometry=list_create_5, color=seat_colour)

# group: Dome posts
# Material = Douglas Fir
posts_class = Python()  # PythonNet3; unwired: IN[0]
# ---------- posts_class.python (40 lines) ----------
import clr
clr.AddReference('ProtoGeometry')
from Autodesk.DesignScript.Geometry import Point, Vector, Circle, Cylinder
import math

class Circle_points:
    
    def __init__(self, n_poles):
        self.n = n_poles

        self.circ_radius = 2800      
        self.height = 1500      
        self.cyl_radius = 55    
        
        self.center = Point.ByCoordinates(0, 0, 0)

      
        self.circle = Circle.ByCenterPointRadius(self.center, self.circ_radius)
        
    def base_points(self):
        step = 1.0 / self.n
        return [self.circle.PointAtParameter(i * step) for i in range(self.n)]

    def top_points(self, base_points):
        
        return [p.Translate(Vector.ZAxis(), self.height) for p in base_points]

    def cylinders(self, base_points, top_points):
        
        return [Cylinder.ByPointsRadius(base_points[i], top_points[i],self.cyl_radius)for i in range(self.n)]
        
    def posts_volume(self, n): 
        single_volume = math.pi*(self.cyl_radius ** 2) * self.height
        total_volume = single_volume*n
        volume_string = "Douglas fir volume = " + str(total_volume) + " mm^3"
        
        return volume_string 
        
     
OUT = Circle_points
# ----------------------------------------
number_of_posts = IntegerSlider(8, range=5..15 step 1)
series_of_instances_points_and = Python(IN[0]=posts_class, IN[1]=number_of_posts)  # "series_of_instances (points and posts)"; PythonNet3
# ---------- series_of_instances_points_and.python (11 lines) ----------
Circle_points = IN[0]
n = IN[1]

obj = Circle_points(n)

base = obj.base_points()
top  = obj.top_points(base)
cyls = obj.cylinders(base, top)
volume = obj.posts_volume(n)

OUT = (base, top, cyls, volume)
# ----------------------------------------
code_block_14 = CodeBlock { 3; }
getItemAtIndex = List.GetItemAtIndex(list=series_of_instances_points_and, index=code_block_14)
douglas_fir_volume = Watch(getItemAtIndex)

# group: Dome
# Material = Cedar
code_block_15 = CodeBlock { 2; }
getItemAtIndex_2 = List.GetItemAtIndex(list=series_of_instances_points_and, index=code_block_15)
code_block_16 = CodeBlock { 1; }
getItemAtIndex_3 = List.GetItemAtIndex(list=series_of_instances_points_and, index=code_block_16)
midpoints_heights = IntegerSlider(587, range=500..1000 step 1)
midpoints_between_posts = Python(IN[0]=getItemAtIndex_3, IN[1]=midpoints_heights)  # PythonNet3
# ---------- midpoints_between_posts.python (28 lines) ----------
import sys
import clr
clr.AddReference('ProtoGeometry')
from Autodesk.DesignScript.Geometry import Point


points = IN[0]
z_offset = IN[1] 

midpoints = []
n = len(points)


for i in range(n):
    p1 = points[i]
    
    if i == n - 1:
        p2 = points[0]
    else:
        p2 = points[i+1]
    
    mx = (p1.X + p2.X) / 2
    my = (p1.Y + p2.Y) / 2
    mz = ((p1.Z + p2.Z) / 2) + z_offset
    
    midpoints.append(Point.ByCoordinates(mx, my, mz))

OUT = midpoints
# ----------------------------------------
arcs_between_posts = Python(IN[0]=getItemAtIndex_3, IN[1]=midpoints_between_posts)  # PythonNet3
# ---------- arcs_between_posts.python (24 lines) ----------
import clr
clr.AddReference('ProtoGeometry')
from Autodesk.DesignScript.Geometry import Point, Arc

poles = IN[0]
midpoints = IN[1]
n = len(poles)
arcs = []

for i in range(n):
    start = poles[i]
    middle = midpoints[i]
    
    #match up points for arcs 
    if i == n - 1:
        end = poles[0]
    else:
        end = poles[i+1]
    
    #create arc 
    arc = Arc.ByThreePoints(start, middle, end)
    arcs.append(arc)

OUT = arcs
# ----------------------------------------
code_block_17 = CodeBlock { 50; }
offset_arcs_between_posts = Curve.OffsetMany(curve=arcs_between_posts, signedDistance=code_block_17)
arc_between_posts_surfaces = Python(IN[0]=arcs_between_posts, IN[1]=offset_arcs_between_posts)  # PythonNet3
# ---------- arc_between_posts_surfaces.python (17 lines) ----------
import clr
clr.AddReference('ProtoGeometry')
from Autodesk.DesignScript.Geometry import NurbsSurface


original_curves = IN[0]
offset_curves = IN[1]

lofted_surfaces = []


for i in range(len(original_curves)):
    orig = original_curves[i]
    off = offset_curves[i]
    lofted_surfaces.append(NurbsSurface.ByLoft([orig, off]))

OUT = lofted_surfaces
# ----------------------------------------
code_block_18 = CodeBlock { 60; }
thicken_arc_curves = Surface.Thicken(surface=arc_between_posts_surfaces, thickness=code_block_18)
parameters_side_points_around = Python(IN[0]=number_of_posts)  # "parameters_side_points (around midpoints)"; PythonNet3
# ---------- parameters_side_points_around.python (4 lines) ----------
n = IN[0]    # number of poles
pairs = [[0.3, 0.7] for i in range(n)]

OUT = pairs
# ----------------------------------------
side_points_start_points_for = Curve.PointAtParameter(curve=arcs_between_posts, param=parameters_side_points_around)  # "side_points(start points for dome arcs)"
dome_curves_bulge = DoubleSlider(0.3, range=0..1 step 0.1)
dome_curves = Python(IN[0]=side_points_start_points_for, IN[1]=dome_curves_bulge)  # PythonNet3
# ---------- dome_curves.python (34 lines) ----------
import clr
clr.AddReference('ProtoGeometry')
from Autodesk.DesignScript.Geometry import Point, Arc, Vector


start_pairs = IN[0]
offset = IN[1]

center = Point.ByCoordinates (0,0,1500)
end = Point.ByCoordinates (0,0,4800)
curves = []

for pair in start_pairs:
    s1 = pair[0]     
    s2 = pair[1]     
    
    for start in (s1, s2):

        mid = Point.ByCoordinates(
            (start.X + end.X)/2,
            (start.Y + end.Y)/2,
            (start.Z + end.Z)/2
        )
        

        vec = Vector.ByTwoPoints(center, mid)
        
        vec_scaled = vec.Scale(offset)
        
        mid_out = mid.Translate(vec_scaled)
        
        curves.append(Arc.ByThreePoints(start, mid_out, end))

OUT = curves
# ----------------------------------------
dome_curves_offset = Curve.OffsetMany(curve=dome_curves, signedDistance=code_block_17)
dome_curve_surfaces = Python(IN[0]=dome_curves, IN[1]=dome_curves_offset)  # PythonNet3
# ---------- dome_curve_surfaces.python (16 lines) ----------
import clr
clr.AddReference('ProtoGeometry')
from Autodesk.DesignScript.Geometry import NurbsSurface


original_curves = IN[0]
offset_curves = IN[1]

lofted_surfaces = []

for i in range(len(original_curves)):
    orig = original_curves[i]
    off = offset_curves[i]
    lofted_surfaces.append(NurbsSurface.ByLoft([orig, off]))

OUT = lofted_surfaces
# ----------------------------------------
code_block_19 = CodeBlock { 50; }
thicken_dome_curves = Surface.Thicken(surface=dome_curve_surfaces, thickness=code_block_19)
base_points_diagonals = Python(IN[0]=dome_curves)  # PythonNet3
# ---------- base_points_diagonals.python (18 lines) ----------
import clr
clr.AddReference('ProtoGeometry')
from Autodesk.DesignScript.Geometry import Point


curves = IN[0]

points_per_curve = []

for curve in curves:
  
    params = [i / 3 for i in range(3)]  
    
    pts = [curve.PointAtParameter(t) for t in params]
    
    points_per_curve.append(pts)

OUT = points_per_curve
# ----------------------------------------
diagonals_bulge = DoubleSlider(0.04, range=0.01..0.1 step 0.01)
diagonals = Python(IN[0]=base_points_diagonals, IN[1]=diagonals_bulge)  # PythonNet3
# ---------- diagonals.python (44 lines) ----------
import clr
clr.AddReference('ProtoGeometry')
from Autodesk.DesignScript.Geometry import Point, Arc, Vector

points_per_curve = IN[0]
offset = IN[1]

center = Point.ByCoordinates(0,0,1500)
curved_diagonals = []

num_curves = len(points_per_curve)
num_points = len(points_per_curve[0])


for r in range(num_curves):
    upper_row = points_per_curve[r]
    lower_row = points_per_curve[(r+1) % num_curves]  

    for i in range(num_points - 1):
        # diagonal to the right
        start = upper_row[i]
        end = lower_row[i+1]
        mid = Point.ByCoordinates(
            (start.X + end.X)/2,
            (start.Y + end.Y)/2,
            (start.Z + end.Z)/2
        )
        vec = Vector.ByTwoPoints(center, mid)
        mid_out = mid.Translate(vec.Scale(offset))
        curved_diagonals.append(Arc.ByThreePoints(start, mid_out, end))

        # diagonal to the left
        start = upper_row[i+1]
        end = lower_row[i]
        mid = Point.ByCoordinates(
            (start.X + end.X)/2,
            (start.Y + end.Y)/2,
            (start.Z + end.Z)/2
        )
        vec = Vector.ByTwoPoints(center, mid)
        mid_out = mid.Translate(vec.Scale(offset))
        curved_diagonals.append(Arc.ByThreePoints(start, mid_out, end))

OUT = curved_diagonals
# ----------------------------------------
code_block_20 = CodeBlock { 20; }
diagonals_offset = Curve.OffsetMany(curve=diagonals, signedDistance=code_block_20)
python_script_2 = Python(IN[0]=diagonals, IN[1]=diagonals_offset)  # PythonNet3
# ---------- python_script_2.python (20 lines) ----------
import clr
clr.AddReference('ProtoGeometry')
from Autodesk.DesignScript.Geometry import NurbsSurface

# --- INPUTS ---
# IN[0] = list of original curves
# IN[1] = list of offset curves (same order as originals)

original_curves = IN[0]
offset_curves = IN[1]

lofted_surfaces = []

# loop using index instead of zip
for i in range(len(original_curves)):
    orig = original_curves[i]
    off = offset_curves[i]
    lofted_surfaces.append(NurbsSurface.ByLoft([orig, off]))

OUT = lofted_surfaces
# ----------------------------------------
code_block_21 = CodeBlock { 50; }
thicken_arc_curves_2 = Surface.Thicken(surface=python_script_2, thickness=code_block_21)
all_geometry = List.Create(item0=getItemAtIndex_2, item1=thicken_arc_curves, item2=thicken_dome_curves, item3=thicken_arc_curves_2)
dome_colour = Python()  # PythonNet3; unwired: IN[0]
# ---------- dome_colour.python (6 lines) ----------
import DSCore
from DSCore import Color

dome_color = Color.ByARGB(255, 210, 180, 140)  

OUT = dome_color
# ----------------------------------------
colour_dome = Modifiers.GeometryColor.ByGeometryColor(geometry=all_geometry, color=dome_colour)

byCylindricalCoordinates = Point.ByCylindricalCoordinates()
code_block_22 = CodeBlock {  }
