# Dynamo graph 1851469.dyn "1851469.stl" (Dynamo 3.3.0.6316)

# group: Don't touch this ground
code_block = CodeBlock { -5000; -5000; -200; }  # frozen
byCoordinates = Point.ByCoordinates(x=code_block.out0, y=code_block.out1, z=code_block.out2)  # frozen
code_block_2 = CodeBlock { 5000; 5000; 0; }  # frozen
byCoordinates_2 = Point.ByCoordinates(x=code_block_2.out0, y=code_block_2.out1, z=code_block_2.out2)  # frozen
byCorners = Cuboid.ByCorners(lowPoint=byCoordinates, highPoint=byCoordinates_2)  # frozen
code_block_3 = CodeBlock { 0; 100; 0; }  # frozen
byARGB = Color.ByARGB(red=code_block_3.out0, green=code_block_3.out1, blue=code_block_3.out2)  # frozen
byGeometryColor = Modifiers.GeometryColor.ByGeometryColor(geometry=byCorners, color=byARGB)  # frozen

number = DoubleInput(0)
number_2 = DoubleInput(10000)
nX = DoubleSlider(4, range=2..10 step 1)
code_block_4 = CodeBlock(nx=nX) { 10000.0/(nx-1); }
xRange = Range(start=number, end=number_2, step=code_block_4)
nY = DoubleSlider(4, range=2..10 step 1)
code_block_5 = CodeBlock(ny=nY) { 10000.0/(ny-1); }
yRange = Range(start=number, end=number_2, step=code_block_5)
number_3 = DoubleInput(0)
byCoordinates_3 = Point.ByCoordinates(x=xRange, y=yRange, z=number_3, lacing=CrossProduct)
flatten = List.Flatten(list=byCoordinates_3)
colHeight = DoubleSlider(3000, range=2500..4000 step 100)
colRadius = DoubleSlider(150, range=75..200 step 150)
python_script = Python(POINTS=flatten, H=colHeight, R=colRadius)  # CPython3
# ---------- python_script.python (46 lines) ----------
# Load the Python Standard and DesignScript Libraries
import sys
import clr
clr.AddReference('ProtoGeometry')
from Autodesk.DesignScript.Geometry import *

# The inputs to this node will be stored as a list in the IN variables.
dataEnteringNode = IN

# Place your code below this line
import clr
clr.AddReference('ProtoGeometry')
from Autodesk.DesignScript.Geometry import Point, Cylinder

class TimberColumn(object):
    def __init__(self, base, height, radius):
        self.base = base
        self.height = height
        self.radius = radius
        self.geom = None
        
    def build(self):
        top = Point.ByCoordinates(self.base.X, self.base.Y, self.base.Z + self.height)
        self.geom = Cylinder.ByPointsRadius(self.base, top, self.radius)
        return self.geom
        
    def volume(self):
        if self.geom is None:
            self.build()
        return self.geom.Volume
        
pts = IN[0]
height = IN[1]
radius = IN[2]

cols = []
vols = []

for p in pts:
    c = TimberColumn(p, height, radius)
    g = c.build()
    cols.append(g)
    vols.append(c.volume())
     
# Assign your output to the OUT variable.
OUT = cols, sum(vols)
# ----------------------------------------
number_4 = DoubleInput(1)
getItemAtIndex = List.GetItemAtIndex(list=python_script, index=number_4)
watch = Watch(getItemAtIndex)
getItemAtIndex_2 = List.GetItemAtIndex()  # unwired: list, index
number_5 = DoubleInput(0)
getItemAtIndex_3 = List.GetItemAtIndex(list=python_script, index=number_5)
beamRadius = DoubleSlider(115, range=75..150 step 10)
python_script_2 = Python(IN[0]=flatten, IN[1]=nX, IN[2]=nY, IN[3]=colHeight, IN[4]=beamRadius)  # CPython3
# ---------- python_script_2.python (56 lines) ----------
# Load the Python Standard and DesignScript Libraries
import sys
import clr
clr.AddReference('ProtoGeometry')
from Autodesk.DesignScript.Geometry import *

# The inputs to this node will be stored as a list in the IN variables.
dataEnteringNode = IN

# Place your code below this line
import clr
clr.AddReference('ProtoGeometry')
from Autodesk.DesignScript.Geometry import Point, Cylinder

class SteelBeam(object):
    def __init__(self, start_pt, end_pt, radius):
        self.start = start_pt
        self.end = end_pt
        self.radius = radius
        self.geom = None

    def build(self):
        self.geom = Cylinder.ByPointsRadius(self.start, self.end, self.radius)
        return self.geom

    def volume(self):
        if self.geom is None:
            self.build()
        return self.geom.Volume

pts_flat = IN[0]
nX = int(IN[1])
nY = int(IN[2])
height = IN[3]
radius = IN[4]

# reshape flat list into rows of nX points
rows = [pts_flat[i * nX:(i + 1) * nX] for i in range(nY)]

beams = []
vols = []

for row in rows:
    for i in range(len(row) - 1):
        p1 = row[i]
        p2 = row[i + 1]
        t1 = Point.ByCoordinates(p1.X, p1.Y, p1.Z + height)
        t2 = Point.ByCoordinates(p2.X, p2.Y, p2.Z + height)
        b = SteelBeam(t1, t2, radius)
        g = b.build()
        beams.append(g)
        vols.append(b.volume())


# Assign your output to the OUT variable.
OUT = beams, sum(vols)
# ----------------------------------------
number_6 = DoubleInput(0)
getItemAtIndex_4 = List.GetItemAtIndex(list=python_script_2, index=number_6)
number_7 = DoubleInput(1)
getItemAtIndex_5 = List.GetItemAtIndex(list=python_script_2, index=number_7)
watch_2 = Watch(getItemAtIndex_5)
