# Dynamo graph 1851526.dyn (Dynamo 3.6.0.9395)

code_block = CodeBlock { -5000; -5000; -200; }
byCoordinates = Point.ByCoordinates(x=code_block.out0, y=code_block.out1, z=code_block.out2)
code_block_2 = CodeBlock { 5000; 5000; 0; }
byCoordinates_2 = Point.ByCoordinates(x=code_block_2.out0, y=code_block_2.out1, z=code_block_2.out2)
byCorners = Cuboid.ByCorners(lowPoint=byCoordinates, highPoint=byCoordinates_2)
code_block_3 = CodeBlock { 0; 100; 0; }
byARGB = Color.ByARGB(red=code_block_3.out0, green=code_block_3.out1, blue=code_block_3.out2)
byGeometryColor = Modifiers.GeometryColor.ByGeometryColor(geometry=byCorners, color=byARGB)
code_block_4 = CodeBlock { 0; 0; 0; 1200; }
byCoordinates_3 = Point.ByCoordinates(x=code_block_4.out0, y=code_block_4.out1, z=code_block_4.out2)
byCoordinates_4 = Point.ByCoordinates(x=code_block_4.out0, y=code_block_4.out1, z=code_block_4.out3)
byStartPointEndPoint = Line.ByStartPointEndPoint(startPoint=byCoordinates_3, endPoint=byCoordinates_4)
code_block_5 = CodeBlock { 0; 7; 0.2; }
height_of_the_steps_slider = DoubleSlider(0.2, range=0.1..0.3 step 0.05)
sequence = Sequence(start=code_block_5.out0, amount=code_block_5.out1, step=height_of_the_steps_slider)
pointAtParameter = Curve.PointAtParameter(curve=byStartPointEndPoint, param=sequence)
code_block_6 = CodeBlock { 0; 0; 200; 1400; }
byCoordinates_5 = Point.ByCoordinates(x=code_block_6.out0, y=code_block_6.out1, z=code_block_6.out2)
byCoordinates_6 = Point.ByCoordinates(x=code_block_6.out0, y=code_block_6.out1, z=code_block_6.out3)
byStartPointEndPoint_2 = Line.ByStartPointEndPoint(startPoint=byCoordinates_5, endPoint=byCoordinates_6)
code_block_7 = CodeBlock { 0.2; 7; 0.2; }
sequence_2 = Sequence(start=code_block_7.out0, amount=code_block_7.out1, step=height_of_the_steps_slider)
pointAtParameter_2 = Curve.PointAtParameter(curve=byStartPointEndPoint_2, param=sequence_2)
code_block_8 = CodeBlock { 3500; 7; -500; }
width_of_the_steps_slider = DoubleSlider(-500, range=-500..-100 step 100)
sequence_3 = Sequence(start=code_block_8.out0, amount=code_block_8.out1, step=width_of_the_steps_slider)
circular_composite_steps = Python()  # CPython3; unwired: IN[0]
# ---------- circular_composite_steps.python (15 lines) ----------
# Load the Python Standard and DesignScript Libraries
import sys
import clr
clr.AddReference('ProtoGeometry')
from Autodesk.DesignScript.Geometry import *

class CompositeSteps:
    def __init__(self, bottom_point, top_point, radius):
        self.bottom = bottom_point
        self.top = top_point
        self.radius = radius
        
    def make_geometry(self):
        return Cylinder.ByPointsRadius(self.bottom, self.top, self.radius)
OUT = CompositeSteps
# ----------------------------------------
instance_for_circular_steps = Python(IN[0]=pointAtParameter, IN[1]=pointAtParameter_2, IN[2]=sequence_3, IN[3]=circular_composite_steps)  # CPython3
# ---------- instance_for_circular_steps.python (17 lines) ----------
bottom_values = IN[0]
top_values = IN[1]
radii = IN[2]
CompositeFloor = IN[3]

steps = []
count = min(len(bottom_values),len(top_values))

for i in range(count):
    r = radii[i] if i < len(radii) else radii[-1]
    btm = bottom_values[i]
    top = top_values[i]
    
    step = CompositeFloor(btm, top, r)
    steps.append(step.make_geometry())
    
OUT = steps
# ----------------------------------------
code_block_9 = CodeBlock { 0; }
getItemAtIndex = List.GetItemAtIndex(list=instance_for_circular_steps, index=code_block_9)
color_palette = ColorPalette({R: 0, G: 0, B: 0, A: 255})
byGeometryColor_2 = Modifiers.GeometryColor.ByGeometryColor(geometry=getItemAtIndex, color=color_palette)
code_block_10 = CodeBlock { 1; }
getItemAtIndex_2 = List.GetItemAtIndex(list=instance_for_circular_steps, index=code_block_10)
color_palette_2 = ColorPalette({R: 117, G: 83, B: 50, A: 255})
byGeometryColor_3 = Modifiers.GeometryColor.ByGeometryColor(geometry=getItemAtIndex_2, color=color_palette_2)
code_block_11 = CodeBlock { 2; }
getItemAtIndex_3 = List.GetItemAtIndex(list=instance_for_circular_steps, index=code_block_11)
color_palette_3 = ColorPalette({R: 137, G: 223, B: 251, A: 255})
byGeometryColor_4 = Modifiers.GeometryColor.ByGeometryColor(geometry=getItemAtIndex_3, color=color_palette_3)
code_block_12 = CodeBlock { 3; }
getItemAtIndex_4 = List.GetItemAtIndex(list=instance_for_circular_steps, index=code_block_12)
color_palette_4 = ColorPalette({R: 234, G: 144, B: 241, A: 255})
byGeometryColor_5 = Modifiers.GeometryColor.ByGeometryColor(geometry=getItemAtIndex_4, color=color_palette_4)
code_block_13 = CodeBlock { 4; }
getItemAtIndex_5 = List.GetItemAtIndex(list=instance_for_circular_steps, index=code_block_13)
color_palette_5 = ColorPalette({R: 195, G: 195, B: 195, A: 255})
byGeometryColor_6 = Modifiers.GeometryColor.ByGeometryColor(geometry=getItemAtIndex_5, color=color_palette_5)
code_block_14 = CodeBlock { 5; }
getItemAtIndex_6 = List.GetItemAtIndex(list=instance_for_circular_steps, index=code_block_14)
color_palette_6 = ColorPalette({R: 255, G: 239, B: 0, A: 255})
byGeometryColor_7 = Modifiers.GeometryColor.ByGeometryColor(geometry=getItemAtIndex_6, color=color_palette_6)
code_block_15 = CodeBlock { 6; }
getItemAtIndex_7 = List.GetItemAtIndex(list=instance_for_circular_steps, index=code_block_15)
color_palette_7 = ColorPalette({R: 135, G: 0, B: 205, A: 255})
byGeometryColor_8 = Modifiers.GeometryColor.ByGeometryColor(geometry=getItemAtIndex_7, color=color_palette_7)
volume = Solid.Volume(solid=instance_for_circular_steps)
volume_1 = Watch(volume)
code_block_16 = CodeBlock { -4000; 4000; 0; }
byCoordinates_7 = Point.ByCoordinates(x=code_block_16.out0, y=code_block_16.out1, z=code_block_16.out2)
code_block_17 = CodeBlock { -4000; -4000; 0; }
byCoordinates_8 = Point.ByCoordinates(x=code_block_17.out0, y=code_block_17.out1, z=code_block_17.out2)
byStartPointEndPoint_3 = Line.ByStartPointEndPoint(startPoint=byCoordinates_7, endPoint=byCoordinates_8)
code_block_18 = CodeBlock { 0; 6; 0.8/4; }
sequence_4 = Sequence(start=code_block_18.out0, amount=code_block_18.out1, step=code_block_18.out2)
pointAtParameter_3 = Curve.PointAtParameter(curve=byStartPointEndPoint_3, param=sequence_4)
code_block_19 = CodeBlock { 4000; 4000; 8000; }
height_of_metal_canopy_slider = DoubleSlider(8000, range=6000..10000 step 500)
byCoordinates_9 = Point.ByCoordinates(x=code_block_19.out0, y=code_block_19.out1, z=height_of_metal_canopy_slider)
code_block_20 = CodeBlock { 4000; -4000; 6000; }
byCoordinates_10 = Point.ByCoordinates(x=code_block_20.out0, y=code_block_20.out1, z=height_of_metal_canopy_slider)
byStartPointEndPoint_4 = Line.ByStartPointEndPoint(startPoint=byCoordinates_9, endPoint=byCoordinates_10)
code_block_21 = CodeBlock { 0; 6; 0.8/4; }
sequence_5 = Sequence(start=code_block_21.out0, amount=code_block_21.out1, step=code_block_21.out2)
pointAtParameter_4 = Curve.PointAtParameter(curve=byStartPointEndPoint_4, param=sequence_5)
radius_of_metal_canopy_rods = DoubleSlider(300, range=100..500 step 100)  # "Radius of Metal Canopy Rods Slider"
code_block_22 = CodeBlock { 200; 6; 0; }
sequence_6 = Sequence(start=radius_of_metal_canopy_rods, amount=code_block_22.out1, step=code_block_22.out2)
metal_cylinder_canopy = Python()  # CPython3; unwired: IN[0]
# ---------- metal_cylinder_canopy.python (15 lines) ----------
# Load the Python Standard and DesignScript Libraries
import sys
import clr
clr.AddReference('ProtoGeometry')
from Autodesk.DesignScript.Geometry import *

class MetalCanopy:
    def __init__(self, bottom_value, top_value, radius):
        self.radius = radius
        self.bottom = bottom_value
        self.top = top_value
        
    def make_geometry(self):
        return Cylinder.ByPointsRadius(self.bottom, self.top, self.radius)
OUT = MetalCanopy
# ----------------------------------------
instance_for_side_1_metal_canopy = Python(IN[0]=pointAtParameter_3, IN[1]=pointAtParameter_4, IN[2]=sequence_6, IN[3]=metal_cylinder_canopy)  # CPython3
# ---------- instance_for_side_1_metal_canopy.python (17 lines) ----------
bottom_values = IN[0]
top_values = IN[1]
radii = IN[2]
MetalCanopy = IN[3]

steps = []
allowable = min(len(bottom_values),len(top_values))

for i in range(allowable):
    r = radii[i] if i < len(radii) else radii[-1]
    btm = bottom_values[i]
    top = top_values[i]
    
    step = MetalCanopy(btm, top, r)
    steps.append(step.make_geometry())
    
OUT = steps
# ----------------------------------------
code_block_23 = CodeBlock { 5; }
getItemAtIndex_8 = List.GetItemAtIndex(list=instance_for_side_1_metal_canopy, index=code_block_23)
color_palette_8 = ColorPalette({R: 255, G: 0, B: 0, A: 255})
byGeometryColor_9 = Modifiers.GeometryColor.ByGeometryColor(geometry=getItemAtIndex_8, color=color_palette_8)
code_block_24 = CodeBlock { 4; }
getItemAtIndex_9 = List.GetItemAtIndex(list=instance_for_side_1_metal_canopy, index=code_block_24)
color_palette_9 = ColorPalette({R: 255, G: 127, B: 1, A: 255})
byGeometryColor_10 = Modifiers.GeometryColor.ByGeometryColor(geometry=getItemAtIndex_9, color=color_palette_9)
code_block_25 = CodeBlock { 3; }
getItemAtIndex_10 = List.GetItemAtIndex(list=instance_for_side_1_metal_canopy, index=code_block_25)
color_palette_10 = ColorPalette({R: 255, G: 255, B: 0, A: 255})
byGeometryColor_11 = Modifiers.GeometryColor.ByGeometryColor(geometry=getItemAtIndex_10, color=color_palette_10)
code_block_26 = CodeBlock { 2; }
getItemAtIndex_11 = List.GetItemAtIndex(list=instance_for_side_1_metal_canopy, index=code_block_26)
color_palette_11 = ColorPalette({R: 0, G: 254, B: 1, A: 255})
byGeometryColor_12 = Modifiers.GeometryColor.ByGeometryColor(geometry=getItemAtIndex_11, color=color_palette_11)
code_block_27 = CodeBlock { 1; }
getItemAtIndex_12 = List.GetItemAtIndex(list=instance_for_side_1_metal_canopy, index=code_block_27)
color_palette_12 = ColorPalette({R: 0, G: 128, B: 254, A: 255})
byGeometryColor_13 = Modifiers.GeometryColor.ByGeometryColor(geometry=getItemAtIndex_12, color=color_palette_12)
code_block_28 = CodeBlock { 0; }
getItemAtIndex_13 = List.GetItemAtIndex(list=instance_for_side_1_metal_canopy, index=code_block_28)
color_palette_13 = ColorPalette({R: 83, G: 3, B: 191, A: 255})
byGeometryColor_14 = Modifiers.GeometryColor.ByGeometryColor(geometry=getItemAtIndex_13, color=color_palette_13)
code_block_29 = CodeBlock { 4000; -4000; 0; }
byCoordinates_11 = Point.ByCoordinates(x=code_block_29.out0, y=code_block_29.out1, z=code_block_29.out2)
code_block_30 = CodeBlock { 4000; 4000; 0; }
byCoordinates_12 = Point.ByCoordinates(x=code_block_30.out0, y=code_block_30.out1, z=code_block_30.out2)
byStartPointEndPoint_5 = Line.ByStartPointEndPoint(startPoint=byCoordinates_11, endPoint=byCoordinates_12)
code_block_31 = CodeBlock { 0; 6; 0.8/4; }
sequence_7 = Sequence(start=code_block_31.out0, amount=code_block_31.out1, step=code_block_31.out2)
pointAtParameter_5 = Curve.PointAtParameter(curve=byStartPointEndPoint_5, param=sequence_7)
code_block_32 = CodeBlock { -4000; -4000; 8000; }
byCoordinates_13 = Point.ByCoordinates(x=code_block_32.out0, y=code_block_32.out1, z=height_of_metal_canopy_slider)
code_block_33 = CodeBlock { -4000; 4000; 6000; }
byCoordinates_14 = Point.ByCoordinates(x=code_block_33.out0, y=code_block_33.out1, z=height_of_metal_canopy_slider)
byStartPointEndPoint_6 = Line.ByStartPointEndPoint(startPoint=byCoordinates_13, endPoint=byCoordinates_14)
code_block_34 = CodeBlock { 0; 6; 0.8/4; }
sequence_8 = Sequence(start=code_block_34.out0, amount=code_block_34.out1, step=code_block_34.out2)
pointAtParameter_6 = Curve.PointAtParameter(curve=byStartPointEndPoint_6, param=sequence_8)
code_block_35 = CodeBlock { 200; 6; 0; }
sequence_9 = Sequence(start=radius_of_metal_canopy_rods, amount=code_block_35.out1, step=code_block_35.out2)
instance_for_side_2_metal_canopy = Python(IN[0]=pointAtParameter_5, IN[1]=pointAtParameter_6, IN[2]=sequence_9, IN[3]=metal_cylinder_canopy)  # CPython3; same code as instance_for_side_1_metal_canopy
code_block_36 = CodeBlock { 5; }
getItemAtIndex_14 = List.GetItemAtIndex(list=instance_for_side_2_metal_canopy, index=code_block_36)
color_palette_14 = ColorPalette({R: 107, G: 12, B: 198, A: 255})
byGeometryColor_15 = Modifiers.GeometryColor.ByGeometryColor(geometry=getItemAtIndex_14, color=color_palette_14)
code_block_37 = CodeBlock { 4; }
getItemAtIndex_15 = List.GetItemAtIndex(list=instance_for_side_2_metal_canopy, index=code_block_37)
color_palette_15 = ColorPalette({R: 0, G: 128, B: 254, A: 255})
byGeometryColor_16 = Modifiers.GeometryColor.ByGeometryColor(geometry=getItemAtIndex_15, color=color_palette_15)
code_block_38 = CodeBlock { 3; }
getItemAtIndex_16 = List.GetItemAtIndex(list=instance_for_side_2_metal_canopy, index=code_block_38)
color_palette_16 = ColorPalette({R: 59, G: 254, B: 5, A: 255})
byGeometryColor_17 = Modifiers.GeometryColor.ByGeometryColor(geometry=getItemAtIndex_16, color=color_palette_16)
code_block_39 = CodeBlock { 2; }
getItemAtIndex_17 = List.GetItemAtIndex(list=instance_for_side_2_metal_canopy, index=code_block_39)
color_palette_17 = ColorPalette({R: 255, G: 255, B: 0, A: 255})
byGeometryColor_18 = Modifiers.GeometryColor.ByGeometryColor(geometry=getItemAtIndex_17, color=color_palette_17)
code_block_40 = CodeBlock { 1; }
getItemAtIndex_18 = List.GetItemAtIndex(list=instance_for_side_2_metal_canopy, index=code_block_40)
color_palette_18 = ColorPalette({R: 255, G: 127, B: 1, A: 255})
byGeometryColor_19 = Modifiers.GeometryColor.ByGeometryColor(geometry=getItemAtIndex_18, color=color_palette_18)
code_block_41 = CodeBlock { 0; }
getItemAtIndex_19 = List.GetItemAtIndex(list=instance_for_side_2_metal_canopy, index=code_block_41)
color_palette_19 = ColorPalette({R: 255, G: 0, B: 0, A: 255})
byGeometryColor_20 = Modifiers.GeometryColor.ByGeometryColor(geometry=getItemAtIndex_19, color=color_palette_19)
volume_2 = Solid.Volume(solid=instance_for_side_1_metal_canopy)
volume_2_part_1 = Watch(volume_2)
volume_3 = Solid.Volume(solid=instance_for_side_2_metal_canopy)
volume_2_part_2 = Watch(volume_3)
number_slider = DoubleSlider(1, range=0..100 step 0.1)
