# Dynamo graph 1851654.dyn (Dynamo 3.3.0.6316)

# group: Don't touch this ground
code_block = CodeBlock { -5000; -5000; -200; }  # frozen
byCoordinates = Point.ByCoordinates(x=code_block.out0, y=code_block.out1, z=code_block.out2)  # frozen
code_block_2 = CodeBlock { 5000; 5000; 0; }  # frozen
byCoordinates_2 = Point.ByCoordinates(x=code_block_2.out0, y=code_block_2.out1, z=code_block_2.out2)  # frozen
byCorners = Cuboid.ByCorners(lowPoint=byCoordinates, highPoint=byCoordinates_2)  # frozen
code_block_3 = CodeBlock { 0; 100; 0; }  # frozen
byARGB = Color.ByARGB(red=code_block_3.out0, green=code_block_3.out1, blue=code_block_3.out2)  # frozen
byGeometryColor = Modifiers.GeometryColor.ByGeometryColor(geometry=byCorners, color=byARGB)  # frozen

halfSpan = DoubleSlider(4000, range=2000..5000 step 0.1)
code_block_4 = CodeBlock(halfSpan=halfSpan) { -halfSpan..halfSpan..1000; }
code_block_5 = CodeBlock(halfSpan=halfSpan) { -halfSpan..halfSpan..1000; }
number = DoubleInput(0)
byCoordinates_3 = Point.ByCoordinates(x=code_block_4, y=code_block_5, z=number, lacing=CrossProduct)
X = Point.X(point=byCoordinates_3)
Y = Point.Y(point=byCoordinates_3)
columnHeight = DoubleSlider(3000, range=2000..4000 step 0.1)
byCoordinates_4 = Point.ByCoordinates(x=X, y=Y, z=columnHeight)
columnRadius = DoubleSlider(150, range=50..200 step 0.1)
byPointsRadius = Cylinder.ByPointsRadius(startPoint=byCoordinates_3, endPoint=byCoordinates_4, radius=columnRadius)
code_block_6 = CodeBlock(point1=byCoordinates_3) { t1 = List.Flatten(point1, -1); }
roofBaseHeight = DoubleSlider(4000, range=3000..6000 step 0.1)
roofAmplitude = DoubleSlider(1000, range=0..2000 step 0.1)
code_block_7 = CodeBlock(roofBaseHeight=roofBaseHeight, roofAmplitude=roofAmplitude, X=X, Y=Y)
# ---------- code_block_7.designscript (2 lines) ----------
/// Z = base + amp * sin(X/2000) * cos(Y/2000)
roofBaseHeight + roofAmplitude * Math.Sin(X/30) * Math.Cos(Y/30);
# ----------------------------------------
byCoordinates_5 = Point.ByCoordinates(x=X, y=Y, z=code_block_7)
flatten = List.Flatten(list=byCoordinates_5)
python_script = Python(IN[0]=code_block_6, IN[1]=flatten, IN[2]=columnRadius)  # CPython3
# ---------- python_script.python (40 lines) ----------
import clr
clr.AddReference('ProtoGeometry')
from Autodesk.DesignScript.Geometry import *

import math

basePts = IN[0]  
topPts  = IN[1]   
radius  = IN[2]  

class TimberColumn:
    def __init__(self, base_pt, top_pt, radius):
        self.base_pt = base_pt
        self.top_pt = top_pt
        self.radius = radius
        self.geo = None

    def make_geometry(self):
        
        self.geo = Cylinder.ByPointsRadius(self.base_pt, self.top_pt, self.radius)
        return self.geo

    def volume(self):
        if self.geo is None:
            self.make_geometry()
        
        h = self.base_pt.DistanceTo(self.top_pt)
        return math.pi * (self.radius ** 2) * h

geometries = []
volumes = []
for b, t in zip(basePts, topPts):
    col = TimberColumn(b, t, radius)
    g = col.make_geometry()
    v = col.volume()
    geometries.append(g)
    volumes.append(v)

total_volume = sum(volumes)
OUT = geometries, total_volume
# ----------------------------------------
# note: Volume of timber columns (mm^3)
watch = Watch(python_script)
count = List.Count(list=code_block_4)
chop = List.Chop(list=byCoordinates_5, lengths=count)
byPoints = NurbsSurface.ByPoints(points=chop)
code_block_8 = CodeBlock { 0; }
getItemAtIndex = List.GetItemAtIndex(list=byPoints, index=code_block_8)
roofThickness = DoubleSlider(100, range=50..500 step 0.1)
python_script_2 = Python(IN[0]=getItemAtIndex, IN[1]=roofThickness)  # CPython3
# ---------- python_script_2.python (28 lines) ----------
import clr
clr.AddReference('ProtoGeometry')
from Autodesk.DesignScript.Geometry import *

roof_surface = IN[0]  
thickness    = IN[1]   

class SteelRoof:
    def __init__(self, surface, thickness):
        self.surface = surface
        self.thickness = thickness
        self.geo = None

    def make_geometry(self):
       
        self.geo = self.surface.Thicken(self.thickness, False)
        return self.geo

    def volume(self):
        if self.geo is None:
            self.make_geometry()
        return self.geo.Volume

roof = SteelRoof(roof_surface, thickness)
roof_solid = roof.make_geometry()
roof_volume = roof.volume()

OUT = roof_solid, roof_volume
# ----------------------------------------
watch_2 = Watch(python_script_2)
code_block_9 = CodeBlock { 1; }
getItemAtIndex_2 = List.GetItemAtIndex(list=python_script_2, index=code_block_9)
# note: Volume of steel roof (mm^3)
watch_3 = Watch(getItemAtIndex_2)
code_block_10 = CodeBlock {  }
list_create = List.Create(item0=python_script, item1=python_script_2)
