# Dynamo graph 1851860.dyn (Dynamo 4.0.0.3277)

# group: Dont touch this ground
code_block = CodeBlock { -5000; -5000; -200; }
byCoordinates = Point.ByCoordinates(x=code_block.out0, y=code_block.out1, z=code_block.out2)
code_block_2 = CodeBlock { 5000; 5000; 0; }
# note: Don't touch this ground
byCoordinates_2 = Point.ByCoordinates(x=code_block_2.out0, y=code_block_2.out1, z=code_block_2.out2)
byCorners = Cuboid.ByCorners(lowPoint=byCoordinates, highPoint=byCoordinates_2)
code_block_3 = CodeBlock { 0; 100; 0; 100; }
byARGB = Color.ByARGB(alpha=code_block_3.out3, red=code_block_3.out0, green=code_block_3.out1, blue=code_block_3.out2)
byGeometryColor = Modifiers.GeometryColor.ByGeometryColor(geometry=byCorners, color=byARGB)

# group: Parameter Sliders
pavillion_footprint_scaling = IntegerSlider(5000, range=2500..5000 step 10)
relative_pavillion_height_arc = DoubleSlider(0.8, range=0.4..1.2 step 0.1)  # "Relative Pavillion Height/Arc Curvature Scaling"
steel_arc_cross_sectional_radius = IntegerSlider(40, range=1..100 step 1)
tent_segment_partitions = IntegerSlider(5, range=1..20 step 1)
truss_quantity = IntegerSlider(6, range=4..20 step 1)

# group: Classes
steel_support_arc = Python()  # PythonNet3; unwired: IN[0]
# ---------- steel_support_arc.python (39 lines) ----------
# Load the Python Standard and DesignScript Libraries
import sys
import clr
clr.AddReference('ProtoGeometry')
from Autodesk.DesignScript.Geometry import *

# Place your code below this line
class SupportArc:
    def __init__(self, point1, point2, point3, radius):
        self.firstPoint = point1
        self.secondPoint = point2
        self.thirdPoint = point3
        self.radius = radius
        self.solid = None
        self.curve = None
    
    def get_Curve(self):
        self.curve =  Arc.ByThreePoints(self.firstPoint, self.secondPoint, self.thirdPoint) 
        return self.curve   
    def make_arcGeometry(self):
        if self.curve is None:
            self.curve =  Arc.ByThreePoints(self.firstPoint, self.secondPoint, self.thirdPoint)
            
        tan = self.curve.TangentAtParameter(0)
        
        plane = Plane.ByOriginNormal(self.firstPoint, tan)
        
        circle = Circle.ByPlaneRadius(plane, self.radius)
        
        self.solid = Solid.BySweep(circle, self.curve, False)
        
        return self.solid
        
    def measure_volume(self):
        if self.solid is None:
            self.solid = make_arcGeometry(self)
        return self.solid.Volume
# Assign your output to the OUT variable.
OUT = SupportArc
# ----------------------------------------
canvas_tent_segment = Python()  # PythonNet3; unwired: IN[0]
# ---------- canvas_tent_segment.python (21 lines) ----------
# Load the Python Standard and DesignScript Libraries
import sys
import clr
clr.AddReference('ProtoGeometry')
from Autodesk.DesignScript.Geometry import *

class TentSegment:
    def __init__(self, curve1, curve2, rail1, rail2):
        self.closedCurve = PolyCurve.ByJoinedCurves([curve1, rail2, curve2, rail1])
        self.surface = None
        
    def make_tentGeometry(self):
        self.surface = Surface.ByPatch(self.closedCurve)
        return self.surface
    
    def measure_area(self):
        if self.surface is None:
            self.surface = make_tentGeometry(self)
        return self.surface.Area
        
OUT = TentSegment
# ----------------------------------------

# group: Steel Frame Creation
arc_scaling_factors = CodeBlock(scale=pavillion_footprint_scaling, scalefactor=relative_pavillion_height_arc) { scale; scalefactor; scale*scalefactor; scale*0.8*scalefactor; 0; 0.8*scale; }
byCoordinates_3 = Point.ByCoordinates(x=arc_scaling_factors.scale, y=arc_scaling_factors.scale, z=arc_scaling_factors.out4)
byCoordinates_4 = Point.ByCoordinates(x=arc_scaling_factors.out5, y=arc_scaling_factors.out4, z=arc_scaling_factors.out3)
edge_support_arc_series = Python(IN[0]=byCoordinates_3, IN[1]=byCoordinates_4, IN[2]=steel_support_arc, IN[3]=steel_arc_cross_sectional_radius)  # PythonNet3
# ---------- edge_support_arc_series.python (40 lines) ----------
# Load the Python Standard and DesignScript Libraries
import sys
import clr
clr.AddReference('ProtoGeometry')
from Autodesk.DesignScript.Geometry import *

SupportArc = IN[2]
point1 = IN[0]
point2 = IN[1]
radius = IN[3]

x = point1.X
y = point1.Y
z = point1.Z

points1 = [Point.ByCoordinates(x, y, z), Point.ByCoordinates(-x, y, z), Point.ByCoordinates(-x, -y, z), Point.ByCoordinates(x, -y, z)]

x = point2.X
y = point2.Y
z = point2.Z

points2 = [Point.ByCoordinates(0, x, z), Point.ByCoordinates(-x, 0, z), Point.ByCoordinates(0, -x, z), Point.ByCoordinates(x, 0, z)]

points3 = points1[1:] + points1[:1]

solids = []
arcs = []
volume = 0
for i in range(len(points1)):
    coord1 = points1[i]
    coord2 = points2[i]
    coord3 = points3[i]
    
    arc = SupportArc(coord1, coord2, coord3, radius)
    arcs.append(arc.get_Curve())
    solids.append(arc.make_arcGeometry())
    volume += arc.measure_volume()
   
OUT = [solids, {"arcs": arcs, "volume": volume}]
        
# ----------------------------------------
byCoordinates_5 = Point.ByCoordinates(x=arc_scaling_factors.out4, y=arc_scaling_factors.out4, z=arc_scaling_factors.out2)
upper_center_support_arc_series = Python(IN[0]=byCoordinates_3, IN[1]=byCoordinates_5, IN[2]=steel_support_arc, IN[3]=steel_arc_cross_sectional_radius)  # PythonNet3
# ---------- upper_center_support_arc_series.python (35 lines) ----------
# Load the Python Standard and DesignScript Libraries
import sys
import clr
clr.AddReference('ProtoGeometry')
from Autodesk.DesignScript.Geometry import *

point1 = IN[0]
point2 = IN[1]
SupportArc = IN[2]
radius = IN[3]

x = point1.X
y = point1.Y
z = point1.Z

points1 = [Point.ByCoordinates(x, y, z), Point.ByCoordinates(-x, y, z)]

points2 = [point2]*2

points3 = [Point.ByCoordinates(-x, -y, z), Point.ByCoordinates(x, -y, z)]

solids = []
arcs = []
volume = 0
for i in range(len(points1)):
    coord1 = points1[i]
    coord2 = points2[i]
    coord3 = points3[i]
    
    arc = SupportArc(coord1, coord2, coord3, radius)
    arcs.append(arc.get_Curve())
    solids.append(arc.make_arcGeometry())
    volume += arc.measure_volume()
   
OUT = [solids, {"arcs": arcs, "volume": volume}]
# ----------------------------------------
byCoordinates_6 = Point.ByCoordinates(x=arc_scaling_factors.out4, y=arc_scaling_factors.out4, z=arc_scaling_factors.out3)
lower_center_support_arc_series = Python(IN[0]=byCoordinates_3, IN[1]=byCoordinates_6, IN[2]=steel_support_arc, IN[3]=steel_arc_cross_sectional_radius)  # PythonNet3
# ---------- lower_center_support_arc_series.python (36 lines) ----------
# Load the Python Standard and DesignScript Libraries
import sys
import clr
clr.AddReference('ProtoGeometry')
from Autodesk.DesignScript.Geometry import *

point1 = IN[0]
point2 = IN[1]
SupportArc = IN[2]
radius = IN[3]

x = point1.X
y = point1.Y
z = point1.Z

points1 = [Point.ByCoordinates(x, y, z), Point.ByCoordinates(-x, y, z)]

points2 = [point2]*2

points3 = [Point.ByCoordinates(-x, -y, z), Point.ByCoordinates(x, -y, z)]

solids = []
arcs = []
volume = 0
for i in range(len(points1)):
    coord1 = points1[i]
    coord2 = points2[i]
    coord3 = points3[i]
    
    arc = SupportArc(coord1, coord2, coord3, radius)
    arcs.append(arc.get_Curve())
    solids.append(arc.make_arcGeometry())
    volume += arc.measure_volume()

   
OUT = [solids, {"arcs": arcs, "volume": volume}]
# ----------------------------------------

# group: Canvas Tent Creation
get_arcs_from_dictionaries = Python(IN[0]=edge_support_arc_series, IN[1]=upper_center_support_arc_series)  # PythonNet3
# ---------- get_arcs_from_dictionaries.python (14 lines) ----------
# Load the Python Standard and DesignScript Libraries
import sys
import clr
clr.AddReference('ProtoGeometry')
from Autodesk.DesignScript.Geometry import *

# The inputs to this node will be stored as a list in the IN variable
dict1 = IN[0][1]
dict2 = IN[1][1]

# Place your code below this line

# Assign your output to the OUT variable.
OUT = [dict1["arcs"], dict2["arcs"]]
# ----------------------------------------
parse_arcs_list = CodeBlock(n=get_arcs_from_dictionaries) { n; n[0]; n[1]; }
code_block_4 = CodeBlock { 0.5; }
splitByParameter = Curve.SplitByParameter(curve=parse_arcs_list.out2, parameters=code_block_4)
guideline_arc_creation = Python(IN[0]=splitByParameter, IN[1]=parse_arcs_list.out1)  # PythonNet3
# ---------- guideline_arc_creation.python (29 lines) ----------
# Load the Python Standard and DesignScript Libraries
import sys
import clr
clr.AddReference('ProtoGeometry')
from Autodesk.DesignScript.Geometry import *

# The inputs to this node will be stored as a list in the IN variables.
arc_segments = IN[0]
lower_arcs = IN[1]


new_arcs = []

arc1_segments = arc_segments[0]
arc2_segments = arc_segments[1]

new_arc0 = PolyCurve.ByJoinedCurves((arc1_segments[0], arc2_segments[0]))
new_arcs.append(new_arc0)

new_arc1 = PolyCurve.ByJoinedCurves((arc2_segments[0], arc1_segments[1]))
new_arcs.append(new_arc1)

new_arc2 = PolyCurve.ByJoinedCurves((arc1_segments[1], arc2_segments[1]))
new_arcs.append(new_arc2)

new_arc3 = PolyCurve.ByJoinedCurves((arc2_segments[1], arc1_segments[0]))
new_arcs.append(new_arc3)

OUT = new_arcs, lower_arcs
# ----------------------------------------
ZAxis = Vector.ZAxis()
translate = Geometry.Translate(geometry=guideline_arc_creation, direction=ZAxis, distance=steel_arc_cross_sectional_radius)
guideline_partition_factor = CodeBlock(n=tent_segment_partitions) { n; 2*n; }
pointsAtEqualSegmentLength = Curve.PointsAtEqualSegmentLength(curve=translate, divisions=guideline_partition_factor.out1)
tent_segment_instance = Python(IN[0]=pointsAtEqualSegmentLength, IN[1]=translate, IN[2]=canvas_tent_segment)  # PythonNet3
# ---------- tent_segment_instance.python (28 lines) ----------
# Load the Python Standard and DesignScript Libraries
import sys
import clr
clr.AddReference('ProtoGeometry')
from Autodesk.DesignScript.Geometry import *

all_points = IN[0]
all_curves = IN[1]
TentSegment = IN[2]

first_upper_points = all_points[0][0]
first_upper_curve = all_curves[0][0]
first_lower_points = all_points[1][0]
first_lower_curve = all_curves[1][0]

guideline1 = Line.ByStartPointEndPoint(first_lower_points[0], first_upper_points[0])
guideline2 = Line.ByStartPointEndPoint(first_lower_points[1], first_upper_points[1])

us1 = first_upper_curve.TrimByParameter(first_upper_curve.ParameterAtPoint(first_upper_points[0]), first_upper_curve.ParameterAtPoint(first_upper_points[1]))
ls1 = first_lower_curve.TrimByParameter(first_lower_curve.ParameterAtPoint(first_lower_points[0]), first_lower_curve.ParameterAtPoint(first_lower_points[1]))
segment1 = TentSegment(ls1, guideline2, us1, guideline1)

surface1 = segment1.make_tentGeometry()


    

OUT = surface1
# ----------------------------------------
tent_segment_series = Python(IN[0]=pointsAtEqualSegmentLength, IN[1]=translate, IN[2]=canvas_tent_segment)  # PythonNet3
# ---------- tent_segment_series.python (40 lines) ----------
# Load the Python Standard and DesignScript Libraries
import sys
import clr
clr.AddReference('ProtoGeometry')
from Autodesk.DesignScript.Geometry import *

all_points = IN[0]
all_curves = IN[1]
TentSegment = IN[2]
volume = 0
surfaces = []
for n in range(len(all_curves[0])):
    
    first_upper_points = all_points[0][n]
    first_upper_curve = all_curves[0][n]
    first_lower_points = all_points[1][n]
    first_lower_curve = all_curves[1][n]
    
    first_upper_points = [first_upper_curve.PointAtParameter(0.01)] +  first_upper_points + [first_upper_curve.PointAtParameter(0.99)]
    first_lower_points = [first_lower_curve.PointAtParameter(0.01)] +  first_lower_points + [first_lower_curve.PointAtParameter(0.99)]

    for i in range(len(first_upper_points)-1):
        
        guideline1 = Line.ByStartPointEndPoint(first_lower_points[i], first_upper_points[i])
        guideline2 = Line.ByStartPointEndPoint(first_lower_points[i+1], first_upper_points[i+1])
        
        upper_csegment = first_upper_curve.TrimByParameter(first_upper_curve.ParameterAtPoint(first_upper_points[i]), first_upper_curve.ParameterAtPoint(first_upper_points[i+1]))
        lower_csegment = first_lower_curve.TrimByParameter(first_lower_curve.ParameterAtPoint(first_lower_points[i]), first_lower_curve.ParameterAtPoint(first_lower_points[i+1]))
        
        segment = TentSegment(lower_csegment, guideline2, upper_csegment, guideline1)
        
        surfaces.append(segment.make_tentGeometry())
        
        volume += segment.measure_area()
    
    
    
    

OUT = surfaces, str(volume) + " mm²"
# ----------------------------------------
get_segments_from_list = CodeBlock(n=tent_segment_series) { n; n[0]; }
code_block_5 = CodeBlock { 2; }
dropEveryNthItem = List.DropEveryNthItem(list=get_segments_from_list.out1, n=code_block_5)
green = CodeBlock { 255; 0; 77; 52; }
byARGB_2 = Color.ByARGB(alpha=green.out0, red=green.out1, green=green.out2, blue=green.out3)
byGeometryColor_2 = Modifiers.GeometryColor.ByGeometryColor(geometry=dropEveryNthItem, color=byARGB_2)
takeEveryNthItem = List.TakeEveryNthItem(list=get_segments_from_list.out1, n=code_block_5)
gold = CodeBlock { 255; 249; 177; 23; }
byARGB_3 = Color.ByARGB(alpha=gold.out0, red=gold.out1, green=gold.out2, blue=gold.out3)
byGeometryColor_3 = Modifiers.GeometryColor.ByGeometryColor(geometry=takeEveryNthItem, color=byARGB_3)

# group: Steel Truss Creation
get_arcs_from_dictionaries_2 = Python(IN[0]=lower_center_support_arc_series, IN[1]=upper_center_support_arc_series)  # PythonNet3
# ---------- get_arcs_from_dictionaries_2.python (14 lines) ----------
# Load the Python Standard and DesignScript Libraries
import sys
import clr
clr.AddReference('ProtoGeometry')
from Autodesk.DesignScript.Geometry import *

# The inputs to this node will be stored as a list in the IN variable
dict1 = IN[0][1]
dict2 = IN[1][1]

# Place your code below this line

# Assign your output to the OUT variable.
OUT = dict1["arcs"] + dict2["arcs"]
# ----------------------------------------
truss_partition_factor = CodeBlock(n=truss_quantity) { n; 2*n; }
pointsAtEqualSegmentLength_2 = Curve.PointsAtEqualSegmentLength(curve=get_arcs_from_dictionaries_2, divisions=truss_partition_factor.out1)
truss_series = Python(IN[0]=pointsAtEqualSegmentLength_2, IN[1]=steel_arc_cross_sectional_radius)  # PythonNet3
# ---------- truss_series.python (39 lines) ----------
# Load the Python Standard and DesignScript Libraries
import sys
import clr
clr.AddReference('ProtoGeometry')
from Autodesk.DesignScript.Geometry import *

lower_points_1, lower_points_2, upper_points_1, upper_points_2 = IN[0]

radius = 0.75*IN[1]

#vertical truss creation
Trusses = []
for i in range(len(lower_points_1)):
    truss1 = Cylinder.ByPointsRadius(lower_points_1[i], upper_points_1[i], radius)
    Trusses.append(truss1)
    
    truss2 = Cylinder.ByPointsRadius(lower_points_2[i], upper_points_2[i], radius)
    Trusses.append(truss2)
    
#diagonal truss creation
for i in range(1, len(lower_points_1)):
        truss1 = Cylinder.ByPointsRadius(lower_points_1[i-1], upper_points_1[i], radius)
        Trusses.append(truss1)
    
        truss2 = Cylinder.ByPointsRadius(lower_points_2[i-1], upper_points_2[i], radius)
        Trusses.append(truss2)
        
        truss3 = Cylinder.ByPointsRadius(lower_points_1[i], upper_points_1[i-1], radius)
        Trusses.append(truss3)
    
        truss4 = Cylinder.ByPointsRadius(lower_points_2[i], upper_points_2[i-1], radius)
        Trusses.append(truss4)
        
volume = 0
for truss in Trusses:
    volume += truss.Volume
    

OUT = Trusses, volume
# ----------------------------------------

# group: Quantity Take-offs
steel_volume_calculation = Python(IN[0]=lower_center_support_arc_series, IN[1]=upper_center_support_arc_series, IN[2]=edge_support_arc_series, IN[3]=truss_series)  # PythonNet3; unwired: IN[4]
# ---------- steel_volume_calculation.python (14 lines) ----------
# Load the Python Standard and DesignScript Libraries
import sys
import clr
clr.AddReference('ProtoGeometry')
from Autodesk.DesignScript.Geometry import *
import Autodesk.DesignScript as DS

volume1 = IN[0][1]["volume"]
volume2 = IN[1][1]["volume"]
volume3 = IN[2][1]["volume"]
volume4 = IN[3][1]


OUT = str(volume1 + volume2 + volume3 + volume4) + " mm³"
# ----------------------------------------
steel_volume = Watch(steel_volume_calculation)
canvas_area_from_list = CodeBlock(n=tent_segment_series) { n; n[1]; }
canvas_surface_area = Watch(canvas_area_from_list.out1)
