# Dynamo graph 1851990.dyn (Dynamo 3.6.0.9395)

code_block = CodeBlock { -5000; -5000; -200; }
byCoordinates = Point.ByCoordinates(x=code_block.out0, y=code_block.out1, z=code_block.out2)
code_block_2 = CodeBlock { 5000; 5000; 0; }
byCoordinates_2 = Point.ByCoordinates(x=code_block_2.out0, y=code_block_2.out1, z=code_block_2.out2)
byCorners = Cuboid.ByCorners(lowPoint=byCoordinates, highPoint=byCoordinates_2)
code_block_3 = CodeBlock { 0; 100; 0; }
byARGB = Color.ByARGB(red=code_block_3.out0, green=code_block_3.out1, blue=code_block_3.out2)
byGeometryColor = Modifiers.GeometryColor.ByGeometryColor(geometry=byCorners, color=byARGB)
code_block_4 = CodeBlock { 1000; }
x_axis = CodeBlock { -4000; }
byCoordinates_3 = Point.ByCoordinates(x=code_block_4, y=x_axis)
code_block_5 = CodeBlock { 1000; }
height = DoubleSlider(2699.6, range=1500..3000 step 0.1)
byCoordinates_4 = Point.ByCoordinates(x=code_block_5, z=height)
code_block_6 = CodeBlock { 1000; }
y_axis = CodeBlock { 3500; }
byCoordinates_5 = Point.ByCoordinates(x=code_block_6, y=y_axis)
byThreePoints = Arc.ByThreePoints(firstPoint=byCoordinates_3, secondPoint=byCoordinates_4, thirdPoint=byCoordinates_5)

# group: MAIN
number_of_cylinders = DoubleSlider(16, range=10..60 step 2)
code_block_7 = CodeBlock(n=number_of_cylinders) { 0..1..#n+1; }
cylinder_height = DoubleSlider(145, range=100..250 step 5)
radius_of_cylinders = DoubleSlider(600, range=600..1000 step 1)
radius_of_pipe = DoubleSlider(70, range=60..200 step 1)
x_axis_2 = CodeBlock { -4000; }
byCoordinates_6 = Point.ByCoordinates(y=x_axis_2)
height_2 = DoubleSlider(2699.6, range=1500..3000 step 0.1)
byCoordinates_7 = Point.ByCoordinates(z=height_2)
y_axis_2 = CodeBlock { 3500; }
byCoordinates_8 = Point.ByCoordinates(y=y_axis_2)
byThreePoints_2 = Arc.ByThreePoints(firstPoint=byCoordinates_6, secondPoint=byCoordinates_7, thirdPoint=byCoordinates_8)
pointAtParameter = Curve.PointAtParameter(curve=byThreePoints_2, param=code_block_7)
ZAxis = Vector.ZAxis()
translate = Geometry.Translate(geometry=pointAtParameter, direction=ZAxis, distance=cylinder_height)
byPointsRadius = Cylinder.ByPointsRadius(startPoint=pointAtParameter, endPoint=translate, radius=radius_of_cylinders)
tangentAtParameter = Curve.TangentAtParameter(curve=byThreePoints_2)
byOriginNormal = Plane.ByOriginNormal(origin=pointAtParameter, normal=tangentAtParameter)
byPlaneRadius = Circle.ByPlaneRadius(plane=byOriginNormal, radius=radius_of_pipe)
bySweep = Solid.BySweep(profile=byPlaneRadius, path=byThreePoints_2)

pointAtParameter_2 = Curve.PointAtParameter(curve=byThreePoints, param=code_block_7)
ZAxis_2 = Vector.ZAxis()
translate_2 = Geometry.Translate(geometry=pointAtParameter_2, direction=ZAxis_2, distance=cylinder_height)
byPointsRadius_2 = Cylinder.ByPointsRadius(startPoint=pointAtParameter_2, endPoint=translate_2, radius=radius_of_cylinders)
tangentAtParameter_2 = Curve.TangentAtParameter(curve=byThreePoints)
byOriginNormal_2 = Plane.ByOriginNormal(origin=pointAtParameter_2, normal=tangentAtParameter_2)
byPlaneRadius_2 = Circle.ByPlaneRadius(plane=byOriginNormal_2, radius=radius_of_pipe)
bySweep_2 = Solid.BySweep(profile=byPlaneRadius_2, path=byThreePoints)
code_block_8 = CodeBlock { -1000; }
x_axis_3 = CodeBlock { -4000; }
byCoordinates_9 = Point.ByCoordinates(x=code_block_8, y=x_axis_3)
code_block_9 = CodeBlock { -1000; }
height_3 = DoubleSlider(2699.6, range=1500..3000 step 0.1)
byCoordinates_10 = Point.ByCoordinates(x=code_block_9, z=height_3)
code_block_10 = CodeBlock { -1000; }
y_axis_3 = CodeBlock { 3500; }
byCoordinates_11 = Point.ByCoordinates(x=code_block_10, y=y_axis_3)
byThreePoints_3 = Arc.ByThreePoints(firstPoint=byCoordinates_9, secondPoint=byCoordinates_10, thirdPoint=byCoordinates_11)
pointAtParameter_3 = Curve.PointAtParameter(curve=byThreePoints_3, param=code_block_7)
ZAxis_3 = Vector.ZAxis()
translate_3 = Geometry.Translate(geometry=pointAtParameter_3, direction=ZAxis_3, distance=cylinder_height)
byPointsRadius_3 = Cylinder.ByPointsRadius(startPoint=pointAtParameter_3, endPoint=translate_3, radius=radius_of_cylinders)
tangentAtParameter_3 = Curve.TangentAtParameter(curve=byThreePoints_3)
byOriginNormal_3 = Plane.ByOriginNormal(origin=pointAtParameter_3, normal=tangentAtParameter_3)
byPlaneRadius_3 = Circle.ByPlaneRadius(plane=byOriginNormal_3, radius=radius_of_pipe)
bySweep_3 = Solid.BySweep(profile=byPlaneRadius_3, path=byThreePoints_3)
code_block_11 = CodeBlock { 2000; }
x_axis_4 = CodeBlock { -4000; }
byCoordinates_12 = Point.ByCoordinates(x=code_block_11, y=x_axis_4)
code_block_12 = CodeBlock { 2000; }
height_4 = DoubleSlider(2699.6, range=1500..3000 step 0.1)
byCoordinates_13 = Point.ByCoordinates(x=code_block_12, z=height_4)
code_block_13 = CodeBlock { 2000; }
y_axis_4 = CodeBlock { 3500; }
byCoordinates_14 = Point.ByCoordinates(x=code_block_13, y=y_axis_4)
byThreePoints_4 = Arc.ByThreePoints(firstPoint=byCoordinates_12, secondPoint=byCoordinates_13, thirdPoint=byCoordinates_14)
pointAtParameter_4 = Curve.PointAtParameter(curve=byThreePoints_4, param=code_block_7)
ZAxis_4 = Vector.ZAxis()
translate_4 = Geometry.Translate(geometry=pointAtParameter_4, direction=ZAxis_4, distance=cylinder_height)
byPointsRadius_4 = Cylinder.ByPointsRadius(startPoint=pointAtParameter_4, endPoint=translate_4, radius=radius_of_cylinders)
tangentAtParameter_4 = Curve.TangentAtParameter(curve=byThreePoints_4)
byOriginNormal_4 = Plane.ByOriginNormal(origin=pointAtParameter_4, normal=tangentAtParameter_4)
byPlaneRadius_4 = Circle.ByPlaneRadius(plane=byOriginNormal_4, radius=radius_of_pipe)
bySweep_4 = Solid.BySweep(profile=byPlaneRadius_4, path=byThreePoints_4)
code_block_14 = CodeBlock { -2000; }
x_axis_5 = CodeBlock { -4000; }
byCoordinates_15 = Point.ByCoordinates(x=code_block_14, y=x_axis_5)
code_block_15 = CodeBlock { -2000; }
height_5 = DoubleSlider(2699.6, range=1500..3000 step 0.1)
byCoordinates_16 = Point.ByCoordinates(x=code_block_15, z=height_5)
code_block_16 = CodeBlock { -2000; }
y_axis_5 = CodeBlock { 3500; }
byCoordinates_17 = Point.ByCoordinates(x=code_block_16, y=y_axis_5)
byThreePoints_5 = Arc.ByThreePoints(firstPoint=byCoordinates_15, secondPoint=byCoordinates_16, thirdPoint=byCoordinates_17)
pointAtParameter_5 = Curve.PointAtParameter(curve=byThreePoints_5, param=code_block_7)
ZAxis_5 = Vector.ZAxis()
translate_5 = Geometry.Translate(geometry=pointAtParameter_5, direction=ZAxis_5, distance=cylinder_height)
byPointsRadius_5 = Cylinder.ByPointsRadius(startPoint=pointAtParameter_5, endPoint=translate_5, radius=radius_of_cylinders)
tangentAtParameter_5 = Curve.TangentAtParameter(curve=byThreePoints_5)
byOriginNormal_5 = Plane.ByOriginNormal(origin=pointAtParameter_5, normal=tangentAtParameter_5)
byPlaneRadius_5 = Circle.ByPlaneRadius(plane=byOriginNormal_5, radius=radius_of_pipe)
bySweep_5 = Solid.BySweep(profile=byPlaneRadius_5, path=byThreePoints_5)
steelrod_woodplates = Python()  # CPython3; unwired: IN[0]
# ---------- steelrod_woodplates.python (40 lines) ----------
# Load the Python Standard and DesignScript Libraries
import clr
clr.AddReference('ProtoGeometry')
from Autodesk.DesignScript.Geometry import *

# --- CLASS 1 : rods (your diagonal posts) ---
class SteelRod:
    def __init__(self, startPoint, endPoint, radius):
        self.start = startPoint
        self.end   = endPoint
        self.r     = radius

    # geometry method (not used to build your pavilion, but required)
    def makeGeometry(self):
        return Cylinder.ByPointsRadius(self.start, self.end, self.r)

    # volume in mm^3
    def volume(self):
        h = self.start.DistanceTo(self.end)
        return 3.14159265359 * self.r**2 * h


# --- CLASS 2 : plates (your big circular discs) ---
class WoodPlate:
    def __init__(self, centerPoint, radius, thickness):
        self.c = centerPoint
        self.r = radius
        self.t = thickness

    # geometry method (again, just to satisfy the requirement)
    def makeGeometry(self):
        return Cylinder.ByCenterPointRadiusHeight(self.c, self.r, self.t)

    # volume in mm^3
    def volume(self):
        return 3.14159265359 * self.r**2 * self.t


# Output both classes so the other Python node can use them
OUT = [SteelRod, WoodPlate]
# ----------------------------------------
volume_computations = Python(IN[0]=pointAtParameter, IN[1]=translate, IN[2]=radius_of_pipe, IN[3]=pointAtParameter, IN[4]=radius_of_cylinders, IN[5]=cylinder_height, IN[6]=steelrod_woodplates)  # CPython3
# ---------- volume_computations.python (77 lines) ----------
# Load the Python Standard and DesignScript Libraries
import clr
clr.AddReference('ProtoGeometry')
from Autodesk.DesignScript.Geometry import *

# Inputs:
rodStarts      = IN[0]# IN[0] : rod start points
rodEnds        = IN[1]# IN[1] : rod end points
rodRadius      = IN[2]# IN[2] : rod radius
plateCenters   = IN[3]# IN[3] : plate center points
plateRadius    = IN[4]# IN[4] : plate radius
plateThickness = IN[5]# IN[5] : plate thickness
SteelRod, WoodPlate = IN[6]# IN[6] : [SteelRod, WoodPlate]

# flatten if it is a python list/tuple, if not, return [data]
def flatten(data):
    if not isinstance(data, (list, tuple)):
        return [data]
    out = []
    for item in data:
        out.extend(flatten(item))
    return out

# if x is a list/tuple, take its first element; otherwise return x
def scalar(x):
    if isinstance(x, (list, tuple)):
        if len(x) == 0:
            return 0
        return scalar(x[0])
    return x

# flatten lists of points
rodStarts    = flatten(rodStarts)
rodEnds      = flatten(rodEnds)
plateCenters = flatten(plateCenters)

# convert radii / thickness to scalars
rodRadius      = scalar(rodRadius)
plateRadius    = scalar(plateRadius)
plateThickness = scalar(plateThickness)

# containers
rod_instances   = []
plate_instances = []
V_rods_total   = 0.0
V_plates_total = 0.0

# rods
for s, e in zip(rodStarts, rodEnds):
    if not hasattr(s, "DistanceTo") or not hasattr(e, "DistanceTo"):
        continue
    rod = SteelRod(s, e, rodRadius)
    rod_instances.append(rod)
    V_rods_total += rod.volume()

# plates
for c in plateCenters:
    if not hasattr(c, "DistanceTo"):
        continue
    plate = WoodPlate(c, plateRadius, plateThickness)
    plate_instances.append(plate)
    V_plates_total += plate.volume()

# formatted labels with units 
volume_unit = "mm³"
rod_volume_label   = "{0:.2f} {1}".format(V_rods_total,   volume_unit)
plate_volume_label = "{0:.2f} {1}".format(V_plates_total, volume_unit)

# outputs
OUT = [
    rod_instances,
    plate_instances,
    V_rods_total,# raw rod volume
    V_plates_total,# raw plate volume
    rod_volume_label,# Proper formatting of the volume of rods   
    plate_volume_label #Proper formatting of the volume of plates
]
# ----------------------------------------
code_block_17 = CodeBlock { 4; }
getItemAtIndex = List.GetItemAtIndex(list=volume_computations, index=code_block_17)
material_volume_of_rods = Watch(getItemAtIndex)
code_block_18 = CodeBlock { 5; }
getItemAtIndex_2 = List.GetItemAtIndex(list=volume_computations, index=code_block_18)
material_volume_of_plates = Watch(getItemAtIndex_2)
