# Dynamo graph 1852021.dyn (Dynamo 3.6.0.9395)

# group: Don't touch this ground
code_block = CodeBlock { -5000; -5000; -200; }
byCoordinates = Point.ByCoordinates(x=code_block.out0, y=code_block.out1, z=code_block.out2)
code_block_2 = CodeBlock { 5000; 5000; 0; }
byCoordinates_2 = Point.ByCoordinates(x=code_block_2.out0, y=code_block_2.out1, z=code_block_2.out2)
byCorners = Cuboid.ByCorners(lowPoint=byCoordinates, highPoint=byCoordinates_2)
code_block_3 = CodeBlock { 0; 100; 0; }
byARGB = Color.ByARGB(red=code_block_3.out0, green=code_block_3.out1, blue=code_block_3.out2)
byGeometryColor = Modifiers.GeometryColor.ByGeometryColor(geometry=byCorners, color=byARGB)

code_block_4 = CodeBlock { 0; 0; 0; }
origin_of_bundle_supports = Point.ByCoordinates(x=code_block_4.out0, y=code_block_4.out1, z=code_block_4.out2)
pavillionRadius = DoubleSlider(4000, range=3000..4000 step 1)
deck_pavillion = Circle.ByCenterPointRadius(centerPoint=origin_of_bundle_supports, radius=pavillionRadius)
bundle_supports = DoubleSlider(4, range=3..6 step 1)
bamboo_column_centers = Curve.PointsAtEqualSegmentLength(curve=deck_pavillion, divisions=bundle_supports)
bundle_radius = DoubleSlider(600, range=300..600 step 0.1)
bamboo_columns = Circle.ByCenterPointRadius(centerPoint=bamboo_column_centers, radius=bundle_radius)
columns_per_bundle_support = DoubleSlider(6, range=3..7 step 1)
bottom_points_of_columns = Curve.PointsAtEqualSegmentLength(curve=bamboo_columns, divisions=columns_per_bundle_support)
ZAxis = Vector.ZAxis()
max_height_of_columns = DoubleSlider(3508, range=1500..5000 step 2)
scale = Vector.Scale(vector=ZAxis, scale_factor=max_height_of_columns)
top_points_of_petal_columns = Geometry.Translate(geometry=bottom_points_of_columns, direction=scale)
outer_roof_edge_curves = PolyCurve.ByPoints(points=top_points_of_petal_columns, connectLastToFirst=top_points_of_petal_columns)
class_BambooColumn = Python()  # CPython3; unwired: IN[0], IN[1]
# ---------- class_BambooColumn.python (25 lines) ----------
# Load the Python Standard and DesignScript Libraries
import sys
import clr
clr.AddReference('ProtoGeometry')
from Autodesk.DesignScript.Geometry import *
import math

class BambooColumn:
    def __init__(self, centerline, radius):
        self.centerline = centerline
        self.radius = radius

    def endpoints(self):
        return self.centerline.StartPoint, self.centerline.EndPoint

    def make_geometry(self):
        p1, p2 = self.endpoints()
        return Cylinder.ByPointsRadius(p1, p2, self.radius)

    def volume(self):
        p1, p2 = self.endpoints()
        h = p1.DistanceTo(p2)
        return math.pi * self.radius**2 * h

OUT = BambooColumn
# ----------------------------------------
bamboocolumn_centerlines = Line.ByStartPointEndPoint(startPoint=bottom_points_of_columns, endPoint=top_points_of_petal_columns)
column_radius = DoubleSlider(88.3, range=60..150 step 0.1)
instances_of_bamboocolumns = Python(IN[0]=class_BambooColumn, IN[1]=bamboocolumn_centerlines, IN[2]=column_radius)  # CPython3
# ---------- instances_of_bamboocolumns.python (29 lines) ----------
BambooColumn = IN[0]
lines = IN[1]
radius = IN[2]

def flatten(items):
    if isinstance(items, list):
        for i in items:
            if isinstance(i, list):
                for j in flatten(i):
                    yield j
            else:
                yield i
    else:
        # single item passed in
        yield items

flat_lines = list(flatten(lines))

geos = []
vols = []

for ln in flat_lines:
    col = BambooColumn(ln, radius)
    geos.append(col.make_geometry())
    vols.append(col.volume())

total_vol = sum(vols)

OUT = (geos, str(total_vol) + " mm^3")
# ----------------------------------------
code_block_5 = CodeBlock { 1; }
getItemAtIndex = List.GetItemAtIndex(list=instances_of_bamboocolumns, index=code_block_5)
bamboo_column_volume_mm_3 = Watch(getItemAtIndex)
class_aluminum_roofshell = Python()  # CPython3; unwired: IN[0]
# ---------- class_aluminum_roofshell.python (18 lines) ----------
# Load the Python Standard and DesignScript Libraries
import sys
import clr
clr.AddReference('ProtoGeometry')
from Autodesk.DesignScript.Geometry import *

class RoofShell:
    def __init__(self, solid):
        self.solid = solid

    def make_geometry(self):
        # Just return the solid as-is
        return self.solid

    def volume(self):
        return self.solid.Volume

OUT = RoofShell
# ----------------------------------------
code_block_6 = CodeBlock { 0; 0; }
roof_base_point = Point.ByCoordinates(x=code_block_6.out0, y=code_block_6.out1, z=max_height_of_columns)
ZAxis_2 = Vector.ZAxis()
roof_top_point_slider = DoubleSlider(2000, range=2000..4000 step 0.1)
roof_top_point = Geometry.Translate(geometry=roof_base_point, direction=ZAxis_2, distance=roof_top_point_slider)
roof_overhang = DoubleSlider(1162.4, range=700..2000 step 0.1)
roof_radius = CodeBlock(PavillionRadius=pavillionRadius, RoofOverHang=roof_overhang) { PavillionRadius + RoofOverHang; }
byPointsRadius = Cone.ByPointsRadius(startPoint=roof_base_point, endPoint=roof_top_point, startRadius=roof_radius)
instance_aluminum_roofshell = Python(IN[0]=class_aluminum_roofshell, IN[1]=byPointsRadius)  # CPython3
# ---------- instance_aluminum_roofshell.python (9 lines) ----------
RoofShell = IN[0]   
roofSolid = IN[1]   

roof = RoofShell(roofSolid)

geo = roof.make_geometry()
vol = roof.volume()

OUT = (geo, str(vol) + " mm^3")
# ----------------------------------------
code_block_7 = CodeBlock { 1; }
getItemAtIndex_2 = List.GetItemAtIndex(list=instance_aluminum_roofshell, index=code_block_7)
aluminum_roof_shell_mm_3 = Watch(getItemAtIndex_2)
