# Dynamo graph 1852058.dyn (Dynamo 3.6.0.9395)

# group: Don't touch this ground
code_block = CodeBlock { -5000; -5000; -200; }
byCoordinates = Point.ByCoordinates(x=code_block.out0, y=code_block.out1, z=code_block.out2)
code_block_2 = CodeBlock { 5000; 5000; 0; }
byCoordinates_2 = Point.ByCoordinates(x=code_block_2.out0, y=code_block_2.out1, z=code_block_2.out2)
byCorners = Cuboid.ByCorners(lowPoint=byCoordinates, highPoint=byCoordinates_2)
code_block_3 = CodeBlock { 0; 100; 0; }
byARGB = Color.ByARGB(red=code_block_3.out0, green=code_block_3.out1, blue=code_block_3.out2)
byGeometryColor = Modifiers.GeometryColor.ByGeometryColor(geometry=byCorners, color=byARGB)

number = DoubleInput(0)
turns_slider_h1 = DoubleSlider(100, range=0..100 step 2)
number_2 = DoubleInput(2)
mul = turns_slider_h1 * number_2
PI = Math.PI()
n2_pi_turns = mul * PI  # "2 * Pi * Turns"
number_3 = DoubleInput(0.1)
range = Range(start=number, end=n2_pi_turns, step=number_3)
cos = Math.Cos(angle=range)
radius_slider_h1 = DoubleSlider(3000, range=-4500..5000 step 2)
x_list = cos * radius_slider_h1
sin = Math.Sin(angle=range)
y_list = radius_slider_h1 * sin
height_slider_h1 = DoubleSlider(4000, range=0..100000 step 6)
height_rad = height_slider_h1 / n2_pi_turns
z_list = height_rad * range
byCoordinates_3 = Point.ByCoordinates(x=x_list, y=y_list, z=z_list)
byPoints = PolyCurve.ByPoints(points=byCoordinates_3)
helix_thickness = DoubleSlider(500, range=0..1000 step 0.1)
helix_1_extra_instance = Python(IN[0]=byPoints, IN[1]=helix_thickness)  # CPython3
# ---------- helix_1_extra_instance.python (15 lines) ----------
# Load the Python Standard and DesignScript Libraries
import clr
clr.AddReference('ProtoGeometry')
from Autodesk.DesignScript.Geometry import *

helix_curve = IN[0]   
beam_radius = IN[1]   

smooth_curve = NurbsCurve.ByControlPoints(helix_curve.Points)

profile = Circle.ByCenterPointRadius(smooth_curve.PointAtParameter(0), beam_radius)

helix_solid = Solid.BySweep(profile, smooth_curve)

OUT = [helix_solid]
# ----------------------------------------
number_4 = DoubleInput(0)
turns_slider_h2 = DoubleSlider(100, range=0..100 step 2)
number_5 = DoubleInput(2)
mul_2 = turns_slider_h2 * number_5
PI_2 = Math.PI()
n2_pi_turns_2 = mul_2 * PI_2  # "2 * Pi * Turns"
number_6 = DoubleInput(0.1)
range_2 = Range(start=number_4, end=n2_pi_turns_2, step=number_6)
cos_2 = Math.Cos(angle=range_2)
radius_slider_h2 = DoubleSlider(-3000, range=-4500..5000 step 2)
x_list_2 = cos_2 * radius_slider_h2
sin_2 = Math.Sin(angle=range_2)
y_list_2 = radius_slider_h2 * sin_2
height_slider_h2 = DoubleSlider(4000, range=0..100000 step 6)
height_rad_2 = height_slider_h2 / n2_pi_turns_2
z_list_2 = height_rad_2 * range_2
byCoordinates_4 = Point.ByCoordinates(x=x_list_2, y=y_list_2, z=z_list_2)
byPoints_2 = PolyCurve.ByPoints(points=byCoordinates_4)
helix_thickness_2 = DoubleSlider(250, range=0..1000 step 0.1)
helix_2_extra_instance = Python(IN[0]=byPoints_2, IN[1]=helix_thickness_2)  # CPython3
# ---------- helix_2_extra_instance.python (16 lines) ----------
# Load the Python Standard and DesignScript Libraries
import clr
clr.AddReference('ProtoGeometry')
from Autodesk.DesignScript.Geometry import *

helix_curve = IN[0]  
beam_radius = IN[1]   

smooth_curve = NurbsCurve.ByControlPoints(helix_curve.Points)

profile = Circle.ByCenterPointRadius(smooth_curve.PointAtParameter(0), beam_radius)

helix_solid = Solid.BySweep(profile, smooth_curve)


OUT = [helix_solid]
# ----------------------------------------
base_side_length = DoubleSlider(7000, range=0..7000 step 0.1)
height_of_base = DoubleSlider(50, range=0..1000 step 0.1)
base = Cuboid.ByLengths(width=base_side_length, length=base_side_length, height=height_of_base)
sphere_origin = DoubleInput(0)
pillar_height = DoubleSlider(5000, range=0..7000 step 0.1)
sphere_indent_to_pillar = DoubleSlider(50, range=0..100 step 0.1)
sphere_height_relation_to_pillar = pillar_height - sphere_indent_to_pillar
sphere_height = Point.ByCoordinates(x=sphere_origin, y=sphere_origin, z=sphere_height_relation_to_pillar)
sphere_radius = DoubleSlider(1000, range=0..10000 step 0.1)
wooden_sphere_classes_instance = Python(IN[0]=sphere_height, IN[1]=sphere_radius)  # CPython3
# ---------- wooden_sphere_classes_instance.python (31 lines) ----------
# Load the Python Standard and DesignScript Libraries
import clr
clr.AddReference('ProtoGeometry')
from Autodesk.DesignScript.Geometry import *

import clr
clr.AddReference('ProtoGeometry')
from Autodesk.DesignScript.Geometry import *
#Class for Wooden SPhere
class SphereOnPillar:
    def __init__(self, pillar_top_point, radius):
        # Center is above the pillar top so the bottom touches it
        self.center = Point.ByCoordinates(
            pillar_top_point.X,
            pillar_top_point.Y,
            pillar_top_point.Z + radius
        )
        self.radius = radius

    def build(self):
        return Sphere.ByCenterPointRadius(self.center, self.radius)


pillar_top_point = IN[0]  
sphere_radius = IN[1]      
#Instances for Wooden Sphere
sphere = SphereOnPillar(pillar_top_point, sphere_radius)
sphere_solid = sphere.build()

OUT = sphere_solid
#Material of Sphere is Wood
# ----------------------------------------
volume = Solid.Volume(solid=wooden_sphere_classes_instance)
volume_sphere_mm_3 = Watch(volume)
pillar_origin = DoubleInput(0)
pillar_radius = DoubleSlider(750, range=0..3000 step 0.1)
steel_pillar_class_instance = Python(IN[0]=pillar_origin, IN[1]=pillar_origin, IN[2]=pillar_origin, IN[3]=pillar_height, IN[4]=pillar_radius)  # CPython3
# ---------- steel_pillar_class_instance.python (46 lines) ----------
import clr
clr.AddReference("ProtoGeometry")
from Autodesk.DesignScript.Geometry import *
import math

#Classes for Steel pillar
class PavilionPillar:
    def __init__(self, x, y, z, height, radius):
        self.base = Point.ByCoordinates(x, y, z)
        self.height = height
        self.radius = radius

    def build(self):
        circle_base = Circle.ByCenterPointRadius(self.base, self.radius)
        vec = Vector.ZAxis()
        pillar_solid = circle_base.Extrude(vec, self.height)
        return pillar_solid

    def volume(self):
        return math.pi * (self.radius ** 2) * self.height


class Ceiling:
    def __init__(self, pillar_top_point, radius):
        self.center = pillar_top_point
        self.radius = radius

    def build(self):
        return Surface.ByPatch(Circle.ByCenterPointRadius(self.center, self.radius))

x = IN[0]
y = IN[1]
z = IN[2]
pillar_height = IN[3]
pillar_radius = IN[4]

#Instances for Pillar
pillar = PavilionPillar(x, y, z, pillar_height, pillar_radius)
pillar_solid = pillar.build()
pillar_volume = pillar.volume()

top_point = Point.ByCoordinates(x, y, z + pillar_height)
ceiling = Ceiling(top_point, pillar_radius)
ceiling_surface = ceiling.build()

OUT = [pillar_solid, ceiling_surface, pillar_volume]
# ----------------------------------------
number_slider = DoubleSlider(2, range=0..100 step 0.1)
getItemAtIndex = List.GetItemAtIndex(list=steel_pillar_class_instance, index=number_slider)
pillar_volume_mm_3 = Watch(getItemAtIndex)
