# Dynamo graph 1852095.dyn (Dynamo 4.0.0.3277)

# group: Don't touch this ground
code_block = CodeBlock { -5000; -5000; -200; }
byCoordinates = Point.ByCoordinates(x=code_block.out0, y=code_block.out1, z=code_block.out2)
code_block_2 = CodeBlock { 5000; 5000; 0; }
byCoordinates_2 = Point.ByCoordinates(x=code_block_2.out0, y=code_block_2.out1, z=code_block_2.out2)
byCorners = Cuboid.ByCorners(lowPoint=byCoordinates, highPoint=byCoordinates_2)
code_block_3 = CodeBlock { 0; 100; 0; }
byARGB = Color.ByARGB(red=code_block_3.out0, green=code_block_3.out1, blue=code_block_3.out2)
byGeometryColor = Modifiers.GeometryColor.ByGeometryColor(geometry=byCorners, color=byARGB)

width = IntegerSlider(7500, range=7000..10000 step 500)
code_block_4 = CodeBlock(w=width) { A1=Point.ByCoordinates(w/2,w/2,0); A2=Point.ByCoordinates(-w/2,w/2,0); }
x = Point.X(point=code_block_4.A1)
ceiling_width = IntegerSlider(10000, range=7000..10000 step 500)
height = IntegerSlider(10000, range=7000..11000 step 500)
code_block_5 = CodeBlock(w=ceiling_width, z=height)
# ---------- code_block_5.designscript (4 lines) ----------
B1=Point.ByCoordinates(w/2,w/2,z);
B2=Point.ByCoordinates(-w/2,w/2,z);
B3=Point.ByCoordinates(-w/2,-w/2,z);
B4=Point.ByCoordinates(w/2,-w/2,z);
# ----------------------------------------
x_2 = Point.X(point=code_block_5.B1)
le = x <= x_2
if_ = RefactoredIf(test=le, true=x, false=x_2)
code_block_6 = CodeBlock(height=height) { z=height/2; }
byCoordinates_3 = Point.ByCoordinates(x=if_, y=if_, z=code_block_6)
integer_slider = IntegerSlider(-300, range=-300..0 step 10)
translate = Geometry.Translate(geometry=byCoordinates_3, xTranslation=integer_slider, yTranslation=integer_slider)
code_block_7 = CodeBlock(E1=translate, r=if_, t=integer_slider) { E1; E2=Geometry.Translate(E1,-2*r-2*t,0,0); }
code_block_8 = CodeBlock(A1=code_block_4.A1, E1=code_block_7.E1, B1=code_block_5.B1, A2=code_block_4.A2, E2=code_block_7.E2, B2=code_block_5.B2) { M1=[A1,E1,B1]; M2=[A2,E2,B2]; }
M1 = NurbsCurve.ByPoints(points=code_block_8.M1)
M2 = NurbsCurve.ByPoints(points=code_block_8.M2)
code_block_9 = CodeBlock(M1=M1, M2=M2) { M12=[M1,M2]; }
code_block_10 = CodeBlock(M12=code_block_9) { Surface.ByLoft(M12); }
code_block_11 = CodeBlock { 10; }
thicken = Surface.Thicken(surface=code_block_10, thickness=code_block_11)
archway_width = IntegerSlider(700, range=500..1000 step 100)
code_block_12 = CodeBlock(A1=code_block_4.A1, r=archway_width, A2=code_block_4.A2) { A1x=Geometry.Translate(A1, -r, 0, 0); A2x=Geometry.Translate(A2, r, 0, 0); }
archway_peaks = IntegerSlider(4500, range=3500..5000 step 500)
code_block_13 = CodeBlock(w=width, r=integer_slider, z=archway_peaks) { C1=Point.ByCoordinates(0,w/2+2*r,z); }
code_block_14 = CodeBlock(A1x=code_block_12.A1x, C1=code_block_13, A2x=code_block_12.A2x) { D1=[A1x,C1,A2x]; }
D1 = NurbsCurve.ByPoints(points=code_block_14)
code_block_15 = CodeBlock(A1x=code_block_12.A1x, A2x=code_block_12.A2x) { A12=Line.ByStartPointEndPoint(A1x,A2x); }
code_block_16 = CodeBlock(D1=D1, A12=code_block_15) { AD1=[D1,A12]; }
byLoft = Surface.ByLoft(crossSections=code_block_16)
code_block_17 = CodeBlock { 5000; }
thicken_2 = Surface.Thicken(surface=byLoft, thickness=code_block_17)
code_block_18 = CodeBlock { -10; }
translate_2 = Geometry.Translate(geometry=thicken_2, zTranslation=code_block_18)
difference = Solid.Difference(solid=thicken, other=translate_2)
faces = Topology.Faces(topology=difference)
surfaceGeometry = Face.SurfaceGeometry(face=faces)
flatten = List.Flatten(list=surfaceGeometry)
area = Surface.Area(surface=surfaceGeometry)
flatten_2 = List.Flatten(list=area)
sortByKey = List.SortByKey(list=flatten, keys=flatten_2)
reverse = List.Reverse(list=sortByKey.sortedList)
watch = Watch(reverse)
code_block_19 = CodeBlock { 0; }
getItemAtIndex = List.GetItemAtIndex(list=reverse, index=code_block_19)
origin = Point.Origin()
ZAxis = Vector.ZAxis()
code_block_20 = CodeBlock { [0.0, 90.0, 180.0, 270.0]; }
rotate = Geometry.Rotate(geometry=getItemAtIndex, origin=origin, axis=ZAxis, degrees=code_block_20)
integer_slider_2 = IntegerSlider(50, range=50..100 step 1)
code_block_21 = CodeBlock(n=integer_slider_2) { 0..1..#n; }
pointAtParameter = Surface.PointAtParameter(surface=rotate, u=code_block_21, v=code_block_21, lacing=CrossProduct)
origin_2 = Point.Origin()
ZAxis_2 = Vector.ZAxis()
code_block_22 = CodeBlock { [0.0, 90.0, 180.0, 270.0]; }
rotate_2 = Geometry.Rotate(geometry=difference, origin=origin_2, axis=ZAxis_2, degrees=code_block_22)
byCornerPoints = Rectangle.ByCornerPoints(p1=code_block_5.B1, p2=code_block_5.B2, p3=code_block_5.B3, p4=code_block_5.B4)
byPatch = Surface.ByPatch(closedCurve=byCornerPoints)
code_block_23 = CodeBlock { 0; 0; }
byCoordinates_4 = Point.ByCoordinates(x=code_block_23.out0, y=code_block_23.out1, z=height)
top_circle_radius = IntegerSlider(2000, range=1000..2000 step 100)
byCenterPointRadius = Circle.ByCenterPointRadius(centerPoint=byCoordinates_4, radius=top_circle_radius)
byPatch_2 = Surface.ByPatch(closedCurve=byCenterPointRadius)
difference_2 = Surface.Difference(surface=byPatch, others=byPatch_2)
code_block_24 = CodeBlock { 10; }
thicken_3 = Surface.Thicken(surface=difference_2, thickness=code_block_24)
union = Solid.Union(solid=rotate_2, solid_2=thicken_3)
distanceTo = Geometry.DistanceTo(geometry=union, other=pointAtParameter)
code_block_25 = CodeBlock { 1; }
le_2 = distanceTo <= code_block_25
filterByBoolMask = List.FilterByBoolMask(list=pointAtParameter, mask=le_2)
watch_2 = Watch(filterByBoolMask.in)
stainless_steel_rod = Python()  # PythonNet3; unwired: IN[0]
# ---------- stainless_steel_rod.python (23 lines) ----------
# Load the Python Standard and DesignScript Libraries
import sys
import clr
clr.AddReference('ProtoGeometry')
from Autodesk.DesignScript.Geometry import *

class Rod:
    def __init__(self, curve, path, radius, start_point, end_point):
        self.curve = curve
        self.path = path
        self.radius = radius
        self.sp = start_point
        self.ep = end_point
        
    def make_geometry(self):
        solid_rod = Curve.SweepAsSolid(self.curve, self.path)
        sphere_start = Sphere.ByCenterPointRadius(self.sp, self.radius)
        sphere_end = Sphere.ByCenterPointRadius(self.ep, self.radius)
        
        geometry = [solid_rod, sphere_start, sphere_end]
        return geometry
        
OUT = Rod
# ----------------------------------------

# group: Rod Instance
origin_3 = Point.Origin()
code_block_26 = CodeBlock { 4324; 323; 213; 767; 875; 75; }
byCoordinates_5 = Point.ByCoordinates(x=code_block_26.out0, y=code_block_26.out1, z=code_block_26.out2)
byCoordinates_6 = Point.ByCoordinates(x=code_block_26.out2, y=code_block_26.out5, z=code_block_26.out4)
list_create = List.Create(item0=origin_3, item1=byCoordinates_5, item2=byCoordinates_6)
byPoints = PolyCurve.ByPoints(points=list_create)
code_block_27 = CodeBlock { 100; }
code_block_28 = CodeBlock(s=byPoints, radius=code_block_27)
# ---------- code_block_28.designscript (6 lines) ----------
path = s;
sp = Curve.StartPoint(path);
ep = Curve.EndPoint(path);
tangent = Curve.TangentAtParameter(path,0.0);
planes = Plane.ByOriginNormal(sp, tangent);
curves = Circle.ByPlaneRadius(planes, radius);
# ----------------------------------------
single_instance = Python(IN[0]=code_block_28.curves, IN[1]=code_block_28.path, IN[2]=code_block_27, IN[3]=code_block_28.sp, IN[4]=code_block_28.ep, IN[5]=stainless_steel_rod)  # PythonNet3
# ---------- single_instance.python (3 lines) ----------
Rod = IN[5]
r = Rod(IN[0], IN[1], IN[2], IN[3], IN[4])
OUT = r.make_geometry()
# ----------------------------------------

list_create_2 = List.Create(item0=filterByBoolMask.in)
code_block_29 = CodeBlock(A1=code_block_12.A1x, A2=code_block_12.A2x)
# ---------- code_block_29.designscript (4 lines) ----------
A1up=Geometry.Translate(A1,0,0,50);
A1down=Geometry.Translate(A1,0,0,-50);
A2up=Geometry.Translate(A2,0,0,50);
A2down=Geometry.Translate(A2,0,0,-50);
# ----------------------------------------
byCornerPoints_2 = Rectangle.ByCornerPoints(p1=code_block_29.A1up, p2=code_block_29.A1down, p3=code_block_29.A2down, p4=code_block_29.A2up)
byPatch_3 = Surface.ByPatch(closedCurve=byCornerPoints_2)
code_block_30 = CodeBlock { 10; }
thicken_4 = Surface.Thicken(surface=byPatch_3, thickness=code_block_30)
origin_4 = Point.Origin()
ZAxis_3 = Vector.ZAxis()
code_block_31 = CodeBlock { [0.0, 90.0, 180.0, 270.0]; }
rotate_3 = Geometry.Rotate(geometry=thicken_4, origin=origin_4, axis=ZAxis_3, degrees=code_block_31)
list_create_3 = List.Create(item0=rotate_3)
distanceTo_2 = Geometry.DistanceTo(geometry=list_create_3, other=list_create_2)
code_block_32 = CodeBlock { 1; }
ge = distanceTo_2 >= code_block_32
filterByBoolMask_2 = List.FilterByBoolMask(list=list_create_2, mask=ge)
code_block_33 = CodeBlock { -1; }
flatten_3 = List.Flatten(list=filterByBoolMask_2.in, amount=code_block_33)
Z = Point.Z(point=flatten_3)
code_block_34 = CodeBlock { 1; }
round = Math.Round(number=Z, digits=code_block_34)
groupByKey = List.GroupByKey(list=flatten_3, keys=round)
code_block_35 = CodeBlock { 24; }
getItemAtIndex_2 = List.GetItemAtIndex(list=groupByKey.groups, index=code_block_35)
code_block_36 = CodeBlock { 1; }
faces_2 = Topology.Faces(topology=thicken_3)
surfaceGeometry_2 = Face.SurfaceGeometry(face=faces_2)
flatten_4 = List.Flatten(list=surfaceGeometry_2)
area_2 = Surface.Area(surface=surfaceGeometry_2)
flatten_5 = List.Flatten(list=area_2)
sortByKey_2 = List.SortByKey(list=flatten_4, keys=flatten_5)
reverse_2 = List.Reverse(list=sortByKey_2.sortedList)
code_block_37 = CodeBlock { 1; }
getItemAtIndex_3 = List.GetItemAtIndex(list=reverse_2, index=code_block_37)
pointAtParameter_2 = Surface.PointAtParameter(surface=getItemAtIndex_3, u=code_block_21, v=code_block_21, lacing=CrossProduct)
distanceTo_3 = Geometry.DistanceTo(geometry=thicken_3, other=pointAtParameter_2)
code_block_38 = CodeBlock { 1; }
le_3 = distanceTo_3 <= code_block_38
filterByBoolMask_3 = List.FilterByBoolMask(list=pointAtParameter_2, mask=le_3)
list_create_4 = List.Create(item0=filterByBoolMask_3.in)
list_create_5 = List.Create(item0=filterByBoolMask_2.in, item1=list_create_4)
flatten_6 = List.Flatten(list=list_create_5, amount=code_block_33)
code_block_39 = CodeBlock(w=width, n=integer_slider_2) { w/n*1.5; }
python_script = Python(IN[0]=flatten_6, IN[1]=code_block_39)  # PythonNet3
# ---------- python_script.python (19 lines) ----------
import clr
clr.AddReference('ProtoGeometry')
from Autodesk.DesignScript.Geometry import Line, Point
import math

points_flat = IN[0]  
max_length = IN[1]   
clean_segments = []

if points_flat is not None and isinstance(points_flat, list) and len(points_flat) > 1:
    for i in range(len(points_flat) - 1):
        start_point = points_flat[i]
        end_point = points_flat[i+1]
        if start_point and end_point:
            distance = start_point.DistanceTo(end_point)
            if distance <= max_length:
                segment = Line.ByStartPointEndPoint(start_point, end_point)
                clean_segments.append(segment)
OUT = clean_segments
# ----------------------------------------
startPoint = Curve.StartPoint(curve=python_script)
Z_2 = Point.Z(point=startPoint)
round_2 = Math.Round(number=Z_2, digits=code_block_34)
groupByKey_2 = List.GroupByKey(list=python_script, keys=round_2)
toNurbsCurve = Curve.ToNurbsCurve(curve=groupByKey_2.groups)
code_block_40 = CodeBlock { 21; }
getItemAtIndex_4 = List.GetItemAtIndex(list=toNurbsCurve, index=code_block_40)
structural_carbon_steel_ribs = Python()  # PythonNet3; unwired: IN[0]
# ---------- structural_carbon_steel_ribs.python (22 lines) ----------
# Load the Python Standard and DesignScript Libraries
import sys
import clr
clr.AddReference('ProtoGeometry')
from Autodesk.DesignScript.Geometry import *

# --- CLASS DEFINITION: STEEL STRIP ---
class Rib:

    def __init__(self, curve, depth):
        self.curve = curve
        self.depth = depth
        self.thickness = 50 

    def make_geometry(self):
        rib_surface = self.curve.Extrude(Vector.ZAxis(), -self.depth)
        raw_solid = rib_surface.Thicken(self.thickness)
        geometry = raw_solid.Translate(Vector.ZAxis(), self.depth)
        return geometry
        
        
OUT = Rib
# ----------------------------------------

# group: Rib Instance
origin_5 = Point.Origin()
code_block_41 = CodeBlock { 3213; 213; 645; }
byCoordinates_7 = Point.ByCoordinates(x=code_block_41.out0, y=code_block_41.out1, z=code_block_41.out2)
byStartPointEndPoint = Line.ByStartPointEndPoint(startPoint=origin_5, endPoint=byCoordinates_7)
code_block_42 = CodeBlock { 100; }
python_script_2 = Python(IN[0]=byStartPointEndPoint, IN[1]=code_block_42, IN[2]=structural_carbon_steel_ribs)  # PythonNet3
# ---------- python_script_2.python (3 lines) ----------
Rib = IN[2]
r = Rib(IN[0], IN[1])
OUT = r.make_geometry()
# ----------------------------------------

rib_depth = IntegerSlider(50, range=20..100 step 1)
series_of_all_ribs = Python(IN[0]=python_script, IN[1]=rib_depth, IN[2]=structural_carbon_steel_ribs)  # PythonNet3
# ---------- series_of_all_ribs.python (14 lines) ----------
curves = IN[0]
depth = IN[1]
Rib = IN[2]

ribs = []
count = len(curves)
for i in range(count):
    curve = curves[i]
    
    rib = Rib(curve, depth)
    ribs.append(rib.make_geometry())
    
OUT = ribs
    
# ----------------------------------------

# group: Rib volume
code_block_43 = CodeBlock { -1; }
flatten_7 = List.Flatten(list=series_of_all_ribs, amount=code_block_43)
volume = Solid.Volume(solid=flatten_7)
sum = Math.Sum(values=volume)
watch_3 = Watch(sum)

list_create_6 = List.Create(item0=rotate, item1=difference_2)
byUnion = Surface.ByUnion(surfaces=list_create_6)
perimeterCurves = Surface.PerimeterCurves(surface=byUnion)
rod_radius = IntegerSlider(210, range=200..300 step 5)
code_block_44 = CodeBlock(s=perimeterCurves, radius=rod_radius)
# ---------- code_block_44.designscript (6 lines) ----------
paths = List.Flatten(s, -1);
sp = Curve.StartPoint(paths);
ep = Curve.EndPoint(paths);
tangent = Curve.TangentAtParameter(paths,0);
planes = Plane.ByOriginNormal(sp, tangent);
curves = Circle.ByPlaneRadius(planes, radius);
# ----------------------------------------
series_of_all_rod = Python(IN[0]=code_block_44.curves, IN[1]=code_block_44.paths, IN[2]=rod_radius, IN[3]=code_block_44.sp, IN[4]=code_block_44.ep, IN[5]=stainless_steel_rod)  # PythonNet3
# ---------- series_of_all_rod.python (20 lines) ----------
Rod = IN[5]
curves = IN[0]
paths = IN[1]
radius = IN[2]
Start_points = IN[3]
End_points = IN[4]

rods = []
count = len(paths)
for i in range(count):
    curve = curves[i]
    path = paths[i]
    sp = Start_points[i]
    ep = End_points[i]
    
    rod = Rod(curve, path, radius, sp, ep)
    rods.append(rod.make_geometry())
    
OUT = rods
    
# ----------------------------------------

# group: Rod volume
code_block_45 = CodeBlock { -1; }
flatten_8 = List.Flatten(list=series_of_all_rod, amount=code_block_45)
volume_2 = Solid.Volume(solid=flatten_8)
sum_2 = Math.Sum(values=volume_2)
watch_4 = Watch(sum_2)
