# Dynamo graph 1852245.dyn (Dynamo 3.6.0.9395)

code_block = CodeBlock { -5000; -5000; -200; }
byCoordinates = Point.ByCoordinates(x=code_block.out0, y=code_block.out1, z=code_block.out2)
code_block_2 = CodeBlock { 5000; 5000; 0; }
byCoordinates_2 = Point.ByCoordinates(x=code_block_2.out0, y=code_block_2.out1, z=code_block_2.out2)
byCorners = Cuboid.ByCorners(lowPoint=byCoordinates, highPoint=byCoordinates_2)
code_block_3 = CodeBlock { 0; 100; 0; }
byARGB = Color.ByARGB(red=code_block_3.out0, green=code_block_3.out1, blue=code_block_3.out2)
byGeometryColor = Modifiers.GeometryColor.ByGeometryColor(geometry=byCorners, color=byARGB)
code_block_4 = CodeBlock { -2000; 5; 1000; -3000; 0; -2000; 5; 1000; 3000; 0; -2000; 5; 1000; 0; }
sequence = Sequence(start=code_block_4.out0, amount=code_block_4.out1, step=code_block_4.out2)
bottom_points_circularrod_left = Point.ByCoordinates(x=code_block_4.out3, y=sequence, z=code_block_4.out4)
height_of_circular_rod = DoubleSlider(8000, range=1000..8000 step 100)
top_points_circularrod_left = Point.ByCoordinates(x=code_block_4.out3, y=sequence, z=height_of_circular_rod)
code_block_5 = CodeBlock { 200; 5; 0; }
radius_of_steel_circular_steel = Sequence(start=code_block_5.out0, amount=code_block_5.out1, step=code_block_5.out2)  # "Radius of steel Circular Steel Rod"
steel_circular_rod = Python()  # CPython3; unwired: IN[0]
# ---------- steel_circular_rod.python (14 lines) ----------
import clr
clr.AddReference('ProtoGeometry')
from Autodesk.DesignScript.Geometry import *

class CircularRod:
    def __init__(self, bottom_point, top_point, radius):
        self.bottom = bottom_point
        self.top = top_point
        self.radius = radius

    def make_geometry(self):
        return Cylinder.ByPointsRadius(self.bottom, self.top, self.radius)

OUT = CircularRod
# ----------------------------------------
series_of_instances_of_circular = Python(IN[0]=bottom_points_circularrod_left, IN[1]=top_points_circularrod_left, IN[2]=radius_of_steel_circular_steel, IN[3]=steel_circular_rod)  # "Series of Instances of Circular steel rod"; CPython3
# ---------- series_of_instances_of_circular.python (23 lines) ----------
# IN[0] = list of bottom points
# IN[1] = list of top points
# IN[2] = list of radii
# IN[3] = class CircularRod from Box #1

CircularRod = IN[3]
bottom_points = IN[0]
top_points = IN[1]
radii = IN[2]

rods = []
count = min(len(bottom_points), len(top_points))

for i in range(count):
  
    r = radii[i] if i < len(radii) else radii[-1]
    btm = bottom_points[i]
    top = top_points[i]
    
    rod = CircularRod(btm, top, r)
    rods.append(rod.make_geometry())

OUT = rods
# ----------------------------------------
code_block_6 = CodeBlock { 0; 0; 7950; }
byCoordinates_3 = Point.ByCoordinates(x=code_block_6.out0, y=code_block_6.out1, z=code_block_6.out2)
cube_length = DoubleSlider(8000, range=1..10000 step 100)
cube_width = DoubleSlider(8000, range=1..10000 step 100)
cube_height = DoubleSlider(400, range=1..5000 step 100)
class_of_iron_cube = Python()  # CPython3; unwired: IN[0]
# ---------- class_of_iron_cube.python (29 lines) ----------
# Load the Python Standard and DesignScript Libraries
import sys
import clr
clr.AddReference('ProtoGeometry')
from Autodesk.DesignScript.Geometry import *

# Load the Python Standard and DesignScript Libraries
import sys
import clr
clr.AddReference('ProtoGeometry')
from Autodesk.DesignScript.Geometry import *

class AdjustableBox:
    def __init__(self, origin, length, width, height):
        """
        origin : Point — lower-left-front corner
        length : float — X dimension
        width  : float — Y dimension
        height : float — Z dimension
        """
        self.origin = origin
        self.length = length
        self.width = width
        self.height = height
        
    def make_geometry(self):
        return Cuboid.ByLengths(self.origin, self.length, self.width, self.height)

OUT = AdjustableBox
# ----------------------------------------
instance_of_iron_cube = Python(IN[0]=byCoordinates_3, IN[1]=cube_length, IN[2]=cube_width, IN[3]=cube_height, IN[4]=class_of_iron_cube)  # CPython3
# ---------- instance_of_iron_cube.python (8 lines) ----------
origin = IN[0]       # single Point
length = IN[1]       # number
width  = IN[2]       # number
height = IN[3]       # number
BoxCls = IN[4]       # the AdjustableBox class

box = BoxCls(origin, length, width, height)
OUT = box.make_geometry()
# ----------------------------------------
sequence_2 = Sequence(start=code_block_4.out5, amount=code_block_4.out6, step=code_block_4.out7)
bottom_points_circularrod = Point.ByCoordinates(x=code_block_4.out8, y=sequence_2, z=code_block_4.out9)  # "Bottom points (CircularRod, diagonal)"
top_points_circularrod_diagonal = Point.ByCoordinates(x=code_block_4.out8, y=sequence_2, z=height_of_circular_rod)
series_of_instances_of_circular_2 = Python(IN[0]=bottom_points_circularrod, IN[1]=top_points_circularrod_diagonal, IN[2]=radius_of_steel_circular_steel, IN[3]=steel_circular_rod)  # "Series of Instances of Circular steel rod"; CPython3; same code as series_of_instances_of_circular
sequence_3 = Sequence(start=code_block_4.out10, amount=code_block_4.out11, step=code_block_4.out12)
bottom_points_circularrod_right = Point.ByCoordinates(x=sequence_3, y=sequence_3, z=code_block_4.out9)
top_points_circularrod_right = Point.ByCoordinates(x=sequence_3, y=sequence_3, z=height_of_circular_rod)
series_of_instances_of_circular_3 = Python(IN[0]=bottom_points_circularrod_right, IN[1]=top_points_circularrod_right, IN[2]=radius_of_steel_circular_steel, IN[3]=steel_circular_rod)  # "Series of Instances of Circular steel rod"; CPython3; same code as series_of_instances_of_circular
instance_calculation_of_volume = Python(IN[0]=byCoordinates_3, IN[1]=cube_length, IN[2]=cube_width, IN[3]=cube_height, IN[4]=class_of_iron_cube)  # "Instance calculation of Volume of Iron Cube"; CPython3
# ---------- instance_calculation_of_volume.python (13 lines) ----------
origin = IN[0] 
length = IN[1]
width = IN[2]
height = IN[3]
BoxCls = IN[4]

box = BoxCls(origin, length, width, height)
geom = box.make_geometry()


volume_mm3 = geom.Volume

OUT = str(volume_mm3) + " mm³"
# ----------------------------------------
volume_of_iron_cube = Watch(instance_calculation_of_volume)
radius_of_steel_circular_rod = DoubleSlider(735, range=10..5000 step 1)
code_block_7 = CodeBlock(r=radius_of_steel_circular_rod, h=height_of_circular_rod)
# ---------- code_block_7.designscript (5 lines) ----------
r;
h;
Vol_CircularRods = 15*Math.PI*r*r*h+ " mm²";
//I multiplied the volume by 15 because thats how many
//circular rods I had and I wanted the volume of all the rods not just a single one
# ----------------------------------------
volume_of_total_number_of = Watch(code_block_7.Vol_CircularRods)  # "Volume of Total number of Circular Rods"
