# Dynamo graph 1852291.dyn (Dynamo 3.6.0.9395)

code_block = CodeBlock { -5000; -5000; -200; }
byCoordinates = Point.ByCoordinates(x=code_block.out0, y=code_block.out1, z=code_block.out2)
code_block_2 = CodeBlock { 5000; 5000; 0; }
byCoordinates_2 = Point.ByCoordinates(x=code_block_2.out0, y=code_block_2.out1, z=code_block_2.out2)
byCorners = Cuboid.ByCorners(lowPoint=byCoordinates, highPoint=byCoordinates_2)
code_block_3 = CodeBlock { 0; 100; 0; }
byARGB = Color.ByARGB(red=code_block_3.out0, green=code_block_3.out1, blue=code_block_3.out2)
byGeometryColor = Modifiers.GeometryColor.ByGeometryColor(geometry=byCorners, color=byARGB)
middle_and_top_circle_xy_coords = CodeBlock { 0; 0; }
height_of_middle_circle = IntegerSlider(4300, range=1000..5000 step 100)
middle_circle_centre = Point.ByCoordinates(x=middle_and_top_circle_xy_coords.out0, y=middle_and_top_circle_xy_coords.out1, z=height_of_middle_circle)
middle_circle_radius = CodeBlock { 4500; }
middle_circle = Circle.ByCenterPointRadius(centerPoint=middle_circle_centre, radius=middle_circle_radius)
number_of_rods_per_section = IntegerSlider(71, range=50..100 step 1)
middle_circle_points_descr = CodeBlock(x=number_of_rods_per_section) { 0.12..1..#x; }
middle_circle_points_on_curve = Curve.PointAtParameter(curve=middle_circle, param=middle_circle_points_descr)
prism_info = CodeBlock(x=number_of_rods_per_section) { 100; x; 0; }
translate_prism_info_width = Sequence(start=prism_info.out0, amount=prism_info.x, step=prism_info.out2)
translate_prism_info_length = Sequence(start=prism_info.out0, amount=prism_info.x, step=prism_info.out2)
beam_height = IntegerSlider(200, range=150..200 step 1)
class_prismatic_titanium_alloy = Python()  # "Class: Prismatic Titanium Alloy Beam"; CPython3; unwired: IN[0]
# ---------- class_prismatic_titanium_alloy.python (17 lines) ----------
# Load the Python Standard and DesignScript Libraries
import sys
import clr
clr.AddReference('ProtoGeometry')
from Autodesk.DesignScript.Geometry import *

class PrismaticBeam:
    def __init__(self, start_middle, width, length, height):
        self.start = start_middle
        self.height = height
        self.width = width
        self.length = length
    def make_geometry(self):
        return Cuboid.ByLengths(self.start, self.width, self.length, self.height)
        
OUT = PrismaticBeam
       
# ----------------------------------------
series_of_instances_middle = Python(IN[0]=middle_circle_points_on_curve, IN[1]=translate_prism_info_width, IN[2]=translate_prism_info_length, IN[3]=beam_height, IN[4]=class_prismatic_titanium_alloy)  # "Series of instances: Middle prismatic beams"; CPython3
# ---------- series_of_instances_middle.python (22 lines) ----------
PrismaticBeam = IN[4]
bottom_points = IN[0]
heights = IN[3]
widths = IN[1]
lengths = IN[2]

beams = []
volume = []
count = len(bottom_points)

for i in range(count):
    w = widths[i] if i < len(widths) else widths[-1]
    l = lengths[i] if i < len(lengths)else lengths[-1]
    btm = bottom_points[i]
    h = heights
    
    beam = PrismaticBeam(btm, w, l, h)
    beams.append(beam.make_geometry())
    vol = w*l*h
    volume.append(vol)
    
OUT = beams, volume
# ----------------------------------------
extract_middle_beams = Python(IN[0]=series_of_instances_middle)  # CPython3
# ---------- extract_middle_beams.python (1 lines) ----------
OUT = IN[0][0]
# ----------------------------------------
colour_argb_values = CodeBlock { 255; 255; 182; 193; }
colour_by_argb = Color.ByARGB(alpha=colour_argb_values.out0, red=colour_argb_values.out1, green=colour_argb_values.out2, blue=colour_argb_values.out3)
colour_bottom_beams = Modifiers.GeometryColor.ByGeometryColor(geometry=extract_middle_beams, color=colour_by_argb)
height_of_top_circle = CodeBlock(s=height_of_middle_circle) { s+2000; }
top_circle_centre = Point.ByCoordinates(x=middle_and_top_circle_xy_coords.out0, y=middle_and_top_circle_xy_coords.out1, z=height_of_top_circle)
bottom_and_top_circle_radius = CodeBlock { 2000; }
top_circle = Circle.ByCenterPointRadius(centerPoint=top_circle_centre, radius=bottom_and_top_circle_radius)
top_circle_points_descr = CodeBlock(x=number_of_rods_per_section) { 0..0.9..#x; }
top_circle_points_on_curve = Curve.PointAtParameter(curve=top_circle, param=top_circle_points_descr)
series_of_instances_top = Python(IN[0]=top_circle_points_on_curve, IN[1]=translate_prism_info_width, IN[2]=translate_prism_info_length, IN[3]=beam_height, IN[4]=class_prismatic_titanium_alloy)  # "Series of instances: Top prismatic beams"; CPython3; same code as series_of_instances_middle
extract_top_beams = Python(IN[0]=series_of_instances_top)  # CPython3; same code as extract_middle_beams
colour_top_beams = Modifiers.GeometryColor.ByGeometryColor(geometry=extract_top_beams, color=colour_by_argb)
bottom_to_middle_middle_to_top = CodeBlock(x=number_of_rods_per_section) { 50; x; 0; }  # "Bottom to middle & middle to top rods info"
translate_rod_info = Sequence(start=bottom_to_middle_middle_to_top.out0, amount=bottom_to_middle_middle_to_top.x, step=bottom_to_middle_middle_to_top.out2)
class_circular_rod = Python()  # CPython3; unwired: IN[0]
# ---------- class_circular_rod.python (16 lines) ----------
# Load the Python Standard and DesignScript Libraries
import sys
import clr
clr.AddReference('ProtoGeometry')
from Autodesk.DesignScript.Geometry import *

class CircularRod:
    def __init__(self, bottom_point, top_point, radius):
        self.bottom = bottom_point
        self.top = top_point
        self.radius = radius
    def make_geometry(self):
        return Cylinder.ByPointsRadius(self.bottom, self.top, self.radius)
        
OUT = CircularRod
       
# ----------------------------------------
middle_to_top_rods = Python(IN[0]=middle_circle_points_on_curve, IN[1]=top_circle_points_on_curve, IN[2]=translate_rod_info, IN[3]=class_circular_rod)  # CPython3
# ---------- middle_to_top_rods.python (22 lines) ----------
CircularRod = IN[3]
bottom_points = IN[0]
top_points = IN[1]
radii = IN[2]

rods = []
volume = []
count = min(len(bottom_points),len(top_points))

for i in range(count):
    r = radii[i] if i < len(radii) else radii[-1]
    btm = bottom_points[i]
    top = top_points[i]
    
    h = btm.DistanceTo(top)
    
    rod = CircularRod(btm, top, r)
    rods.append(rod.make_geometry())
    vol = 3.1415936*((r)**2)*h
    volume.append(vol)
    
OUT = rods, volume
# ----------------------------------------
extract_middle_to_top_rods = Python(IN[0]=middle_to_top_rods)  # CPython3; same code as extract_middle_beams
colour_middle_to_top_rods = Modifiers.GeometryColor.ByGeometryColor(geometry=extract_middle_to_top_rods, color=colour_by_argb)
bottom_circle_coords = CodeBlock { 0; 0; 0; }
bottom_circle_centre = Point.ByCoordinates(x=bottom_circle_coords.out0, y=bottom_circle_coords.out1, z=bottom_circle_coords.out2)
bottom_circle = Circle.ByCenterPointRadius(centerPoint=bottom_circle_centre, radius=bottom_and_top_circle_radius)
bottom_circle_points_descr = CodeBlock(x=number_of_rods_per_section) { 0..0.9..#x; }
bottom_circle_points_on_curve = Curve.PointAtParameter(curve=bottom_circle, param=bottom_circle_points_descr)
bottom_to_middle_rods = Python(IN[0]=bottom_circle_points_on_curve, IN[1]=middle_circle_points_on_curve, IN[2]=translate_rod_info, IN[3]=class_circular_rod)  # CPython3; same code as middle_to_top_rods
extract_bottom_to_middle_rods = Python(IN[0]=bottom_to_middle_rods)  # CPython3; same code as extract_middle_beams
colour_bottom_to_middle_rods = Modifiers.GeometryColor.ByGeometryColor(geometry=extract_bottom_to_middle_rods, color=colour_by_argb)
watch = Watch(series_of_instances_top)
extract_top_beam_volumes = Python(IN[0]=watch)  # CPython3
# ---------- extract_top_beam_volumes.python (1 lines) ----------
OUT = IN[0][1]
# ----------------------------------------
watch_2 = Watch(series_of_instances_middle)
extract_bottom_beam_volumes = Python(IN[0]=watch_2)  # CPython3; same code as extract_top_beam_volumes
combine_beam_section_volumes = Python(IN[0]=extract_top_beam_volumes, IN[1]=extract_bottom_beam_volumes)  # CPython3
# ---------- combine_beam_section_volumes.python (1 lines) ----------
OUT = IN[0]+IN[1]
# ----------------------------------------
total_volume_of_titanium_alloy = Math.Sum(values=combine_beam_section_volumes)  # "TOTAL VOLUME OF TITANIUM ALLOY PRISMS (BEAMS) mm^3"
watch_3 = Watch(middle_to_top_rods)
extract_middle_to_top_rod = Python(IN[0]=watch_3)  # "Extract middle to top rod volumes"; CPython3; same code as extract_top_beam_volumes
watch_4 = Watch(bottom_to_middle_rods)
extract_bottom_to_middle_rod = Python(IN[0]=watch_4)  # "Extract bottom to middle rod volumes"; CPython3; same code as extract_top_beam_volumes
vertical_support_rod_thickness = DoubleSlider(34, range=30..70 step 1)
vertical_support_rods_info = CodeBlock(t=vertical_support_rod_thickness, x=number_of_rods_per_section) { t; x; 0; }
translate_vertical_support_rod = Sequence(start=vertical_support_rods_info.t, amount=vertical_support_rods_info.x, step=vertical_support_rods_info.out2)  # "Translate vertical support rod info"
vertical_support_rods = Python(IN[0]=bottom_circle_points_on_curve, IN[1]=top_circle_points_on_curve, IN[2]=translate_vertical_support_rod, IN[3]=class_circular_rod)  # CPython3; same code as middle_to_top_rods
watch_5 = Watch(vertical_support_rods)
extract_vertical_support_rod = Python(IN[0]=watch_5)  # "Extract vertical support rod volumes"; CPython3; same code as extract_top_beam_volumes
combine_all_rod_section_volumes = Python(IN[0]=extract_middle_to_top_rod, IN[1]=extract_bottom_to_middle_rod, IN[2]=extract_vertical_support_rod)  # CPython3
# ---------- combine_all_rod_section_volumes.python (1 lines) ----------
OUT = IN[0]+IN[1]+IN[2]
# ----------------------------------------
total_volume_of_steel_rods_mm_3 = Math.Sum(values=combine_all_rod_section_volumes)
