# Dynamo graph 1852338.dyn (Dynamo 4.0.0.3277)

code_block = CodeBlock { -5000; -5000; -200; }
byCoordinates = Point.ByCoordinates(x=code_block.out0, y=code_block.out1, z=code_block.out2)
code_block_2 = CodeBlock { 5000; 5000; 0; }
byCoordinates_2 = Point.ByCoordinates(x=code_block_2.out0, y=code_block_2.out1, z=code_block_2.out2)
byCorners = Cuboid.ByCorners(lowPoint=byCoordinates, highPoint=byCoordinates_2)
code_block_3 = CodeBlock { 0; 100; 0; }
byARGB = Color.ByARGB(red=code_block_3.out0, green=code_block_3.out1, blue=code_block_3.out2)
byGeometryColor = Modifiers.GeometryColor.ByGeometryColor(geometry=byCorners, color=byARGB)

# group: Top of Pavilion
slant = CodeBlock { 35; }
height_of_ne_low = IntegerSlider(4500, range=1000..10000 step 500)
thickness = DoubleSlider(500, range=500..1000 step 100)
code_block_4 = CodeBlock(s=slant, h=height_of_ne_low, t=thickness) { x=2500-s/2; y=2500-s/2; z=h-t/2; }
byCoordinates_3 = Point.ByCoordinates(x=code_block_4.x, y=code_block_4.y, z=code_block_4.z)
code_block_5 = CodeBlock(s=slant, h=height_of_ne_low, t=thickness) { x=2500+s/2; y=2500+s/2; z=h+t/2; }
byCoordinates_4 = Point.ByCoordinates(x=code_block_5.x, y=code_block_5.y, z=code_block_5.z)
radius = DoubleSlider(2500, range=500..3500 step 500)
ne_low = Cylinder.ByPointsRadius(startPoint=byCoordinates_3, endPoint=byCoordinates_4, radius=radius)
code_block_6 = CodeBlock { 49; 142; 28; }
byARGB_2 = Color.ByARGB(red=code_block_6.out0, green=code_block_6.out1, blue=code_block_6.out2)
byGeometryColor_2 = Modifiers.GeometryColor.ByGeometryColor(geometry=ne_low, color=byARGB_2)
height_of_nw_se_med = IntegerSlider(6000, range=2500..10000 step 250)
code_block_7 = CodeBlock(s=slant, h=height_of_nw_se_med, t=thickness) { x=-2500-s/2; y=2500-s/2; z=h-t/2; }
byCoordinates_5 = Point.ByCoordinates(x=code_block_7.x, y=code_block_7.y, z=code_block_7.z)
code_block_8 = CodeBlock(s=slant, h=height_of_nw_se_med, t=thickness) { x=-2500+s/2; y=2500+s/2; z=h+t/2; }
byCoordinates_6 = Point.ByCoordinates(x=code_block_8.x, y=code_block_8.y, z=code_block_8.z)
nw_med = Cylinder.ByPointsRadius(startPoint=byCoordinates_5, endPoint=byCoordinates_6, radius=radius)
code_block_9 = CodeBlock { 203; 198; 71; }
byARGB_3 = Color.ByARGB(red=code_block_9.out0, green=code_block_9.out1, blue=code_block_9.out2)
byGeometryColor_3 = Modifiers.GeometryColor.ByGeometryColor(geometry=nw_med, color=byARGB_3)
code_block_10 = CodeBlock(s=slant, h=height_of_nw_se_med, t=thickness) { x=2500-s/2; y=-2500-s/2; z=h-t/2; }
byCoordinates_7 = Point.ByCoordinates(x=code_block_10.x, y=code_block_10.y, z=code_block_10.z)
code_block_11 = CodeBlock(s=slant, h=height_of_nw_se_med, t=thickness) { x=2500+s/2; y=-2500+s/2; z=h+t/2; }
byCoordinates_8 = Point.ByCoordinates(x=code_block_11.x, y=code_block_11.y, z=code_block_11.z)
se_med = Cylinder.ByPointsRadius(startPoint=byCoordinates_7, endPoint=byCoordinates_8, radius=radius)
code_block_12 = CodeBlock { 78; 56; 22; }
byARGB_4 = Color.ByARGB(red=code_block_12.out0, green=code_block_12.out1, blue=code_block_12.out2)
byGeometryColor_4 = Modifiers.GeometryColor.ByGeometryColor(geometry=se_med, color=byARGB_4)
height_of_sw_high = IntegerSlider(7500, range=5000..10000 step 500)
code_block_13 = CodeBlock(s=slant, h=height_of_sw_high, t=thickness) { x=-2500-s/2; y=-2500-s/2; z=h-t/2; }
byCoordinates_9 = Point.ByCoordinates(x=code_block_13.x, y=code_block_13.y, z=code_block_13.z)
code_block_14 = CodeBlock(s=slant, h=height_of_sw_high, t=thickness) { x=-2500+s/2; y=-2500+s/2; z=h+t/2; }
byCoordinates_10 = Point.ByCoordinates(x=code_block_14.x, y=code_block_14.y, z=code_block_14.z)
sw_high = Cylinder.ByPointsRadius(startPoint=byCoordinates_9, endPoint=byCoordinates_10, radius=radius)
code_block_15 = CodeBlock { 108; }
byARGB_5 = Color.ByARGB(red=code_block_15, green=code_block_15, blue=code_block_15)
byGeometryColor_5 = Modifiers.GeometryColor.ByGeometryColor(geometry=sw_high, color=byARGB_5)
python_script = Python(IN[0]=radius, IN[1]=thickness)  # PythonNet3
# ---------- python_script.python (12 lines) ----------
import math

radius = IN[0]     
thickness = IN[1]  

volume_single = math.pi * radius**2 * thickness

total_volume = 4 * volume_single

volumes = [volume_single] * 4

OUT = total_volume
# ----------------------------------------
volume_of_top_mm_3 = Watch(python_script)

# group: Pavilion Support Truss
circular_support = Python()  # PythonNet3
# ---------- circular_support.python (23 lines) ----------
import sys
import clr
clr.AddReference('ProtoGeometry')
from Autodesk.DesignScript.Geometry import *
import math

class CS:
    def __init__(self, centerline, radius):
        self.centerline = centerline
        self.radius = radius
    
    def endpoints(self):
        return self.centerline.StartPoint, self.centerline.EndPoint
    
    def make_geometry(self):
        end1, end2 = self.endpoints()
        
        return Cylinder.ByPointsRadius(end1,end2,self.radius) 
    
    def measure_volume(self):
        end1, end2 = self.endpoints()
        return end1.DistanceTo(end2)*self.radius*self.radius*math.pi  
OUT = CS   
# ----------------------------------------
code_block_16 = CodeBlock { R=700; x=2500; y=2500; x1=x+R; y1=y+R; r=150; r1=100; h1=1000; base=0; }
byCoordinates_11 = Point.ByCoordinates(x=code_block_16.x1, y=code_block_16.y1, z=code_block_16.base)
byCoordinates_12 = Point.ByCoordinates(x=code_block_16.x1, y=code_block_16.y1, z=height_of_ne_low)
byStartPointEndPoint = Line.ByStartPointEndPoint(startPoint=byCoordinates_11, endPoint=byCoordinates_12)
python_script_2 = Python(IN[0]=code_block_16.x, IN[1]=code_block_16.y, IN[2]=code_block_16.x1, IN[3]=code_block_16.y1)  # PythonNet3
# ---------- python_script_2.python (16 lines) ----------
import math

Cx, Cy = IN[0], IN[1]
Ax, Ay = IN[2], IN[3]
vx = Ax - Cx
vy = Ay - Cy

theta = math.radians(120)

Bx = Cx + (vx*math.cos(theta) - vy*math.sin(theta))
By = Cy + (vx*math.sin(theta) + vy*math.cos(theta))

Dx = Cx + (vx*math.cos(-theta) - vy*math.sin(-theta))
Dy = Cy + (vx*math.sin(-theta) + vy*math.cos(-theta))

OUT = Bx, By, Dx, Dy
# ----------------------------------------
code_block_17 = CodeBlock(input=python_script_2) { x2=input[0]; y2=input[1]; x3=input[2]; y3=input[3]; }
byCoordinates_13 = Point.ByCoordinates(x=code_block_17.x2, y=code_block_17.y2, z=code_block_16.base)
byCoordinates_14 = Point.ByCoordinates(x=code_block_17.x2, y=code_block_17.y2, z=height_of_ne_low)
byStartPointEndPoint_2 = Line.ByStartPointEndPoint(startPoint=byCoordinates_13, endPoint=byCoordinates_14)
byCoordinates_15 = Point.ByCoordinates(x=code_block_17.x3, y=code_block_17.y3, z=code_block_16.base)
byCoordinates_16 = Point.ByCoordinates(x=code_block_17.x3, y=code_block_17.y3, z=height_of_ne_low)
byStartPointEndPoint_3 = Line.ByStartPointEndPoint(startPoint=byCoordinates_15, endPoint=byCoordinates_16)
python_script_3 = Python(IN[0]=circular_support, IN[1]=code_block_16.r, IN[2]=byStartPointEndPoint, IN[3]=byStartPointEndPoint_2, IN[4]=byStartPointEndPoint_3)  # PythonNet3
# ---------- python_script_3.python (15 lines) ----------
CS = IN[0]
radius = IN[1]
line1 = IN[2]
line2 = IN[3]
line3 = IN[4]

c1 = CS(line1, radius)
c2 = CS(line2, radius)
c3 = CS(line3, radius)


geometries = [c1.make_geometry(), c2.make_geometry(), c3.make_geometry()]
volumes = [c1.measure_volume(), c2.measure_volume(), c3.measure_volume()]

OUT = [geometries, volumes]
# ----------------------------------------
lastItem = List.LastItem(list=python_script_3)
watch = Watch(lastItem)
list_create = List.Create(item0=byStartPointEndPoint, item1=byStartPointEndPoint_2, item2=byStartPointEndPoint_3)
number_of_cross_sections = DoubleSlider(3, range=0..10 step 1)
offset_from_bottom = DoubleSlider(1000, range=0..1500 step 500)
python_script_4 = Python(IN[0]=list_create, IN[1]=number_of_cross_sections, IN[2]=offset_from_bottom, IN[3]=circular_support, IN[4]=code_block_16.r1)  # PythonNet3
# ---------- python_script_4.python (110 lines) ----------
import clr
clr.AddReference('ProtoGeometry')
from Autodesk.DesignScript.Geometry import *
import math

lines = IN[0]
num_segments = int(IN[1])
offset = IN[2]
cs_class = IN[3]
radius = IN[4]
rotation_per_level = 120

if not isinstance(lines, list):
    lines = [lines]

all_points_flat = []
all_segments_flat = []
all_cylinders = []
all_spheres = []
all_volumes = []
all_line_points = []

for line in lines:
    start = line.StartPoint
    end = line.EndPoint
    start_z = start.Z
    end_z = end.Z
    bottom_z = min(start_z, end_z)
    top_z = max(start_z, end_z)
    segment_height = (top_z - bottom_z - offset) / num_segments
    points = []
    for i in range(num_segments + 1):
        height = bottom_z + offset + (i * segment_height)
        if height > top_z:
            height = top_z
        t = (height - start_z) / (end_z - start_z)
        point = line.PointAtParameter(t)
        points.append(point)
    all_line_points.append(points)

num_lines = len(lines)
num_levels = len(all_line_points[0])
rotated_points_per_level = []

for level in range(num_levels):
    level_points = [all_line_points[i][level] for i in range(num_lines)]
    cx = sum(p.X for p in level_points)/num_lines
    cy = sum(p.Y for p in level_points)/num_lines
    cz = sum(p.Z for p in level_points)/num_lines
    
    rotated_level_points = []
    angle = math.radians(rotation_per_level * level)
    for p in level_points:
        dx = p.X - cx
        dy = p.Y - cy
        x_rot = cx + dx*math.cos(angle) - dy*math.sin(angle)
        y_rot = cy + dx*math.sin(angle) + dy*math.cos(angle)
        newp = Point.ByCoordinates(x_rot, y_rot, p.Z)
        rotated_level_points.append(newp)
        all_points_flat.append(newp)
    rotated_points_per_level.append(rotated_level_points)

for i in range(num_lines):
    for level in range(num_levels - 1):
        p1 = rotated_points_per_level[level][i]
        p2 = rotated_points_per_level[level + 1][i]
        seg = Line.ByStartPointEndPoint(p1, p2)
        all_segments_flat.append(seg)
        cs = cs_class(seg, radius)
        cyl = cs.make_geometry()
        all_cylinders.append(cyl)
        all_volumes.append(cs.measure_volume())

median_points = []
for level_points in rotated_points_per_level:
    p_start = level_points[0]
    p_end = level_points[1]
    midpoint = Point.ByCoordinates((p_start.X + p_end.X)/2, (p_start.Y + p_end.Y)/2, (p_start.Z + p_end.Z)/2)
    all_points_flat.append(midpoint)
    median_points.append(midpoint)
    
    opposite = level_points[2]
    seg = Line.ByStartPointEndPoint(midpoint, opposite)
    all_segments_flat.append(seg)
    cs = cs_class(seg, radius)
    cyl = cs.make_geometry()
    all_cylinders.append(cyl)
    all_volumes.append(cs.measure_volume())
    
    seg1 = Line.ByStartPointEndPoint(midpoint, level_points[0])
    seg2 = Line.ByStartPointEndPoint(midpoint, level_points[1])
    all_segments_flat.append(seg1)
    all_segments_flat.append(seg2)
    cs1 = cs_class(seg1, radius)
    cs2 = cs_class(seg2, radius)
    cyl1 = cs1.make_geometry()
    cyl2 = cs2.make_geometry()
    all_cylinders.append(cyl1)
    all_cylinders.append(cyl2)
    all_volumes.append(cs1.measure_volume())
    all_volumes.append(cs2.measure_volume())

sphere_radius = 50 + radius

for i in range(num_lines):
    top_point = rotated_points_per_level[-1][i]
    sphere = Sphere.ByCenterPointRadius(top_point, sphere_radius)
    all_spheres.append(sphere)

OUT = all_points_flat, all_segments_flat, all_cylinders, all_spheres, all_volumes
# ----------------------------------------
lastItem_2 = List.LastItem(list=python_script_4)
watch_2 = Watch(lastItem_2)
code_block_18 = CodeBlock { R=700; x=-2500; y=2500; x1=x+R; y1=y+R; r=150; r1=100; h1=1000; base=0; }
byCoordinates_17 = Point.ByCoordinates(x=code_block_18.x1, y=code_block_18.y1, z=code_block_18.base)
byCoordinates_18 = Point.ByCoordinates(x=code_block_18.x1, y=code_block_18.y1, z=height_of_nw_se_med)
byStartPointEndPoint_4 = Line.ByStartPointEndPoint(startPoint=byCoordinates_17, endPoint=byCoordinates_18)
python_script_5 = Python(IN[0]=code_block_18.x, IN[1]=code_block_18.y, IN[2]=code_block_18.x1, IN[3]=code_block_18.y1)  # PythonNet3; same code as python_script_2
code_block_19 = CodeBlock(input=python_script_5) { x2=input[0]; y2=input[1]; x3=input[2]; y3=input[3]; }
byCoordinates_19 = Point.ByCoordinates(x=code_block_19.x2, y=code_block_19.y2, z=code_block_18.base)
byCoordinates_20 = Point.ByCoordinates(x=code_block_19.x2, y=code_block_19.y2, z=height_of_nw_se_med)
byStartPointEndPoint_5 = Line.ByStartPointEndPoint(startPoint=byCoordinates_19, endPoint=byCoordinates_20)
byCoordinates_21 = Point.ByCoordinates(x=code_block_19.x3, y=code_block_19.y3, z=code_block_18.base)
byCoordinates_22 = Point.ByCoordinates(x=code_block_19.x3, y=code_block_19.y3, z=height_of_nw_se_med)
byStartPointEndPoint_6 = Line.ByStartPointEndPoint(startPoint=byCoordinates_21, endPoint=byCoordinates_22)
python_script_6 = Python(IN[0]=circular_support, IN[1]=code_block_18.r, IN[2]=byStartPointEndPoint_4, IN[3]=byStartPointEndPoint_5, IN[4]=byStartPointEndPoint_6)  # PythonNet3; same code as python_script_3
lastItem_3 = List.LastItem(list=python_script_6)
watch_3 = Watch(lastItem_3)
list_create_2 = List.Create(item0=byStartPointEndPoint_4, item1=byStartPointEndPoint_5, item2=byStartPointEndPoint_6)
python_script_7 = Python(IN[0]=list_create_2, IN[1]=number_of_cross_sections, IN[2]=offset_from_bottom, IN[3]=circular_support, IN[4]=code_block_18.r1)  # PythonNet3; same code as python_script_4
lastItem_4 = List.LastItem(list=python_script_7)
watch_4 = Watch(lastItem_4)
code_block_20 = CodeBlock { R=700; x=2500; y=-2500; x1=x+R; y1=y+R; r=150; r1=100; h1=1000; base=0; }
byCoordinates_23 = Point.ByCoordinates(x=code_block_20.x1, y=code_block_20.y1, z=code_block_20.base)
byCoordinates_24 = Point.ByCoordinates(x=code_block_20.x1, y=code_block_20.y1, z=height_of_nw_se_med)
byStartPointEndPoint_7 = Line.ByStartPointEndPoint(startPoint=byCoordinates_23, endPoint=byCoordinates_24)
python_script_8 = Python(IN[0]=code_block_20.x, IN[1]=code_block_20.y, IN[2]=code_block_20.x1, IN[3]=code_block_20.y1)  # PythonNet3; same code as python_script_2
code_block_21 = CodeBlock(input=python_script_8) { x2=input[0]; y2=input[1]; x3=input[2]; y3=input[3]; }
byCoordinates_25 = Point.ByCoordinates(x=code_block_21.x2, y=code_block_21.y2, z=code_block_20.base)
byCoordinates_26 = Point.ByCoordinates(x=code_block_21.x2, y=code_block_21.y2, z=height_of_nw_se_med)
byStartPointEndPoint_8 = Line.ByStartPointEndPoint(startPoint=byCoordinates_25, endPoint=byCoordinates_26)
byCoordinates_27 = Point.ByCoordinates(x=code_block_21.x3, y=code_block_21.y3, z=code_block_20.base)
byCoordinates_28 = Point.ByCoordinates(x=code_block_21.x3, y=code_block_21.y3, z=height_of_nw_se_med)
byStartPointEndPoint_9 = Line.ByStartPointEndPoint(startPoint=byCoordinates_27, endPoint=byCoordinates_28)
python_script_9 = Python(IN[0]=circular_support, IN[1]=code_block_20.r, IN[2]=byStartPointEndPoint_7, IN[3]=byStartPointEndPoint_8, IN[4]=byStartPointEndPoint_9)  # PythonNet3; same code as python_script_3
lastItem_5 = List.LastItem(list=python_script_9)
watch_5 = Watch(lastItem_5)
list_create_3 = List.Create(item0=byStartPointEndPoint_7, item1=byStartPointEndPoint_8, item2=byStartPointEndPoint_9)
python_script_10 = Python(IN[0]=list_create_3, IN[1]=number_of_cross_sections, IN[2]=offset_from_bottom, IN[3]=circular_support, IN[4]=code_block_20.r1)  # PythonNet3; same code as python_script_4
lastItem_6 = List.LastItem(list=python_script_10)
watch_6 = Watch(lastItem_6)
code_block_22 = CodeBlock { R=700; x=-2500; y=-2500; x1=x+R; y1=y+R; r=150; r1=100; h1=1000; base=0; }
byCoordinates_29 = Point.ByCoordinates(x=code_block_22.x1, y=code_block_22.y1, z=code_block_22.base)
byCoordinates_30 = Point.ByCoordinates(x=code_block_22.x1, y=code_block_22.y1, z=height_of_sw_high)
byStartPointEndPoint_10 = Line.ByStartPointEndPoint(startPoint=byCoordinates_29, endPoint=byCoordinates_30)
python_script_11 = Python(IN[0]=code_block_22.x, IN[1]=code_block_22.y, IN[2]=code_block_22.x1, IN[3]=code_block_22.y1)  # PythonNet3; same code as python_script_2
code_block_23 = CodeBlock(input=python_script_11) { x2=input[0]; y2=input[1]; x3=input[2]; y3=input[3]; }
byCoordinates_31 = Point.ByCoordinates(x=code_block_23.x2, y=code_block_23.y2)
byCoordinates_32 = Point.ByCoordinates(x=code_block_23.x2, y=code_block_23.y2, z=height_of_sw_high)
byStartPointEndPoint_11 = Line.ByStartPointEndPoint(startPoint=byCoordinates_31, endPoint=byCoordinates_32)
byCoordinates_33 = Point.ByCoordinates(x=code_block_23.x3, y=code_block_23.y3, z=code_block_22.base)
byCoordinates_34 = Point.ByCoordinates(x=code_block_23.x3, y=code_block_23.y3, z=height_of_sw_high)
byStartPointEndPoint_12 = Line.ByStartPointEndPoint(startPoint=byCoordinates_33, endPoint=byCoordinates_34)
python_script_12 = Python(IN[0]=circular_support, IN[1]=code_block_22.r, IN[2]=byStartPointEndPoint_10, IN[3]=byStartPointEndPoint_11, IN[4]=byStartPointEndPoint_12)  # PythonNet3; same code as python_script_3
lastItem_7 = List.LastItem(list=python_script_12)
watch_7 = Watch(lastItem_7)
list_create_4 = List.Create(item0=byStartPointEndPoint_10, item1=byStartPointEndPoint_11, item2=byStartPointEndPoint_12)
python_script_13 = Python(IN[0]=list_create_4, IN[1]=number_of_cross_sections, IN[2]=offset_from_bottom, IN[3]=circular_support, IN[4]=code_block_22.r1)  # PythonNet3; same code as python_script_4
lastItem_8 = List.LastItem(list=python_script_13)
watch_8 = Watch(lastItem_8)
python_script_14 = Python(IN[0]=watch, IN[1]=watch_2, IN[2]=watch_3, IN[3]=watch_4, IN[4]=watch_5, IN[5]=watch_6, IN[6]=watch_7, IN[7]=watch_8)  # PythonNet3
# ---------- python_script_14.python (15 lines) ----------
l1 = IN[0]
l2 = IN[1]
l3 = IN[2]
l4 = IN[3]
l5 = IN[4]
l6 = IN[5]
l7 = IN[6]
l8 = IN[7]

total_sum = sum([
    sum(l1), sum(l2), sum(l3), sum(l4),
    sum(l5), sum(l6), sum(l7), sum(l8)
])

OUT = total_sum
# ----------------------------------------
volume_of_truss_mm_3 = Watch(python_script_14)
deconstruct = List.Deconstruct(list=python_script_13)
deconstruct_2 = List.Deconstruct(list=deconstruct.rest)
deconstruct_3 = List.Deconstruct(list=deconstruct_2.rest)
deconstruct_4 = List.Deconstruct(list=python_script_10)
deconstruct_5 = List.Deconstruct(list=deconstruct_4.rest)
deconstruct_6 = List.Deconstruct(list=deconstruct_5.rest)
deconstruct_7 = List.Deconstruct(list=python_script_7)
deconstruct_8 = List.Deconstruct(list=deconstruct_7.rest)
deconstruct_9 = List.Deconstruct(list=deconstruct_8.rest)
deconstruct_10 = List.Deconstruct(list=python_script_4)
deconstruct_11 = List.Deconstruct(list=deconstruct_10.rest)
deconstruct_12 = List.Deconstruct(list=deconstruct_11.rest)
