# Dynamo graph 1852349.dyn (Dynamo 3.6.0.9395)

code_block = CodeBlock { -5000; -5000; -200; }
byCoordinates = Point.ByCoordinates(x=code_block.out0, y=code_block.out1, z=code_block.out2)
code_block_2 = CodeBlock { 5000; 5000; 0; }
byCoordinates_2 = Point.ByCoordinates(x=code_block_2.out0, y=code_block_2.out1, z=code_block_2.out2)
byCorners = Cuboid.ByCorners(lowPoint=byCoordinates, highPoint=byCoordinates_2)
code_block_3 = CodeBlock { 0; 100; 0; }
byARGB = Color.ByARGB(red=code_block_3.out0, green=code_block_3.out1, blue=code_block_3.out2)
byGeometryColor = Modifiers.GeometryColor.ByGeometryColor(geometry=byCorners, color=byARGB)
class_wood_column = Python()  # CPython3
# ---------- class_wood_column.python (22 lines) ----------
# Load the Python Standard and DesignScript Libraries
import sys
import clr
clr.AddReference('ProtoGeometry')
from Autodesk.DesignScript.Geometry import *

class woodcolumn:
    def __init__(self, lower_points, upper_points, radius):
        
        self.lower_points = lower_points
        self.upper_points = upper_points
        self.radius = radius
          
    def make_geometry(self):
        cylinder = Cylinder.ByPointsRadius(self.lower_points,self.upper_points,self.radius)
        volume = cylinder.Volume
        self.volume = volume
        
        return cylinder
        
OUT = woodcolumn
   
# ----------------------------------------
height_of_the_metal_ring = DoubleSlider(2200, range=1500..2500 step 100)
code_block_4 = CodeBlock(x=height_of_the_metal_ring) { x*2; 0; 0; }
byCoordinates_3 = Point.ByCoordinates(x=code_block_4.out2, y=code_block_4.out1, z=code_block_4.out0)
radius_for_metal_ring = DoubleSlider(3500, range=2500..3500 step 10)
column_rotation_angle = IntegerSlider(45, range=0..45 step 1)
degreesToRadians = Math.DegreesToRadians(degrees=column_rotation_angle)
tan = Math.Tan(angle=degreesToRadians)
atan = Math.Atan(ratio=tan)
code_block_5 = CodeBlock(z=radius_for_metal_ring, y=height_of_the_metal_ring, x=atan) { z-(y*x)/2; }
byCenterPointRadius = Circle.ByCenterPointRadius(centerPoint=byCoordinates_3, radius=code_block_5)
amount_of_pillars = DoubleSlider(10, range=8..12 step 1)
pointsAtEqualSegmentLength = Curve.PointsAtEqualSegmentLength(curve=byCenterPointRadius, divisions=amount_of_pillars)
code_block_6 = CodeBlock { P1 = Point.ByCoordinates(0, 0, 0); }
code_block_7 = CodeBlock(z=radius_for_metal_ring, y=height_of_the_metal_ring, x=atan) { z+(y*x)/2; }
byCenterPointRadius_2 = Circle.ByCenterPointRadius(centerPoint=code_block_6, radius=code_block_7)
pointsAtEqualSegmentLength_2 = Curve.PointsAtEqualSegmentLength(curve=byCenterPointRadius_2, divisions=amount_of_pillars)
radius_of_wood_columns = IntegerSlider(216, range=200..250 step 1)
series_of_instances_of_wood = Python(IN[0]=class_wood_column, IN[1]=pointsAtEqualSegmentLength, IN[2]=pointsAtEqualSegmentLength_2, IN[3]=radius_of_wood_columns)  # "Series of instances of wood columns"; CPython3
# ---------- series_of_instances_of_wood.python (23 lines) ----------
woodcolumn = IN[0]
top = IN[1]
bottom = IN[2]
radius = IN[3]

columns = []
volumes = []
count = len(bottom)

for i in range(count):
    r = radius
    bottom_point = bottom[i]
    top_point = top[i]
    
    column = woodcolumn(bottom_point, top_point, radius)
    
    columns.append(column.make_geometry())
    
    volumes.append(column.volume)
    
total_volume = sum(volumes)

OUT = [columns, total_volume]
# ----------------------------------------
code_block_8 = CodeBlock { 1; }
getItemAtIndex = List.GetItemAtIndex(list=series_of_instances_of_wood, index=code_block_8)
wood_column_total_volume_mm_3 = Watch(getItemAtIndex)
class_metal_square = Python()  # CPython3
# ---------- class_metal_square.python (22 lines) ----------
# Load the Python Standard and DesignScript Libraries
import sys
import clr
clr.AddReference('ProtoGeometry')
from Autodesk.DesignScript.Geometry import *

class metalsquare:
    def __init__(self, lower_points, upper_points):
        
        self.lower_points = lower_points
        self.upper_points = upper_points
        
          
    def make_geometry(self):
        cuboid = Cuboid.ByCorners(self.lower_points,self.upper_points)
        volume = cuboid.Volume
        self.volume = volume
        
        return cuboid
        
OUT = metalsquare
   
# ----------------------------------------
code_block_9 = CodeBlock { 0; 0; }
code_block_10 = CodeBlock(x=height_of_the_metal_ring) { x-150; }
byCoordinates_4 = Point.ByCoordinates(x=code_block_9.out0, y=code_block_9.out1, z=code_block_10)
code_block_11 = CodeBlock(x=radius_for_metal_ring) { x-150; }
byCenterPointRadius_3 = Circle.ByCenterPointRadius(centerPoint=byCoordinates_4, radius=code_block_11)
pointsAtEqualSegmentLength_3 = Curve.PointsAtEqualSegmentLength(curve=byCenterPointRadius_3, divisions=amount_of_pillars)
code_block_12 = CodeBlock(x=height_of_the_metal_ring) { x+150; }
byCoordinates_5 = Point.ByCoordinates(x=code_block_9.out0, y=code_block_9.out1, z=code_block_12)
code_block_13 = CodeBlock(x=radius_for_metal_ring) { x+150; }
byCenterPointRadius_4 = Circle.ByCenterPointRadius(centerPoint=byCoordinates_5, radius=code_block_13)
pointsAtEqualSegmentLength_4 = Curve.PointsAtEqualSegmentLength(curve=byCenterPointRadius_4, divisions=amount_of_pillars)
series_of_instances_of_metal = Python(IN[0]=class_metal_square, IN[1]=pointsAtEqualSegmentLength_3, IN[2]=pointsAtEqualSegmentLength_4)  # "Series of instances of metal squares"; CPython3
# ---------- series_of_instances_of_metal.python (33 lines) ----------
metalsquare = IN[0]
bottom = IN[1]
top = IN[2]


square_cuboids = []
volumes = []
count = len(bottom)

for i in range(count - 1):
    bottom_point = bottom[i]
    top_point = top[i + 1]
    
    square_cuboid = metalsquare(bottom_point, top_point)
    
    square_cuboids.append(square_cuboid.make_geometry())
    
    volumes.append(square_cuboid.volume)
    
for i in range(count - 1, count):
    bottom_point = bottom[i]
    top_point = top[0]
    
    square_cuboid = metalsquare(bottom_point, top_point)
    
    square_cuboids.append(square_cuboid.make_geometry())
    
    volumes.append(square_cuboid.volume)

    
total_volume = sum(volumes)

OUT = [square_cuboids, total_volume]
# ----------------------------------------
code_block_14 = CodeBlock { 1; }
getItemAtIndex_2 = List.GetItemAtIndex(list=series_of_instances_of_metal, index=code_block_14)
metal_square_total_volume_mm_3 = Watch(getItemAtIndex_2)
code_block_15 = CodeBlock { 0; }
getItemAtIndex_3 = List.GetItemAtIndex(list=series_of_instances_of_wood, index=code_block_15)
code_block_16 = CodeBlock { 102; 51; 0; }
byARGB_2 = Color.ByARGB(red=code_block_16.out0, green=code_block_16.out1, blue=code_block_16.out2)
byGeometryColor_2 = Modifiers.GeometryColor.ByGeometryColor(geometry=getItemAtIndex_3, color=byARGB_2)
