# Dynamo graph 1852381.dyn.dyn "1852381" (Dynamo 4.0.0.3277)

# group: Don't touch this ground
code_block = CodeBlock { -5000; -5000; -200; }
byCoordinates = Point.ByCoordinates(x=code_block.out0, y=code_block.out1, z=code_block.out2)
code_block_2 = CodeBlock { 5000; 5000; 0; }
byCoordinates_2 = Point.ByCoordinates(x=code_block_2.out0, y=code_block_2.out1, z=code_block_2.out2)
byCorners = Cuboid.ByCorners(lowPoint=byCoordinates, highPoint=byCoordinates_2)
code_block_3 = CodeBlock { 0; 100; 0; }
byARGB = Color.ByARGB(red=code_block_3.out0, green=code_block_3.out1, blue=code_block_3.out2)
byGeometryColor = Modifiers.GeometryColor.ByGeometryColor(geometry=byCorners, color=byARGB)

height_of_structure_to_top_of = DoubleSlider(5000, range=3500..5000 step 100)  # "Height of Structure (To Top Of Cylinders)"
cone_height_cone_base_to_apex = DoubleSlider(1710, range=1000..2000 step 10)
upper_radius = DoubleSlider(1500, range=1000..1500 step 100)

# group: Generate Double Cone
code_block_4 = CodeBlock(Build_Height=height_of_structure_to_top_of, Cone_Height=cone_height_cone_base_to_apex) { zero = 0; Upper = (Build_Height + Cone_Height); Lower = (Build_Height - Cone_Height); }
byCoordinates_3 = Point.ByCoordinates(x=code_block_4.zero, y=code_block_4.zero, z=code_block_4.Upper)
byCoordinates_4 = Point.ByCoordinates(x=code_block_4.zero, y=code_block_4.zero, z=code_block_4.Lower)
double_cone = Python()  # PythonNet3; unwired: IN[0]
# ---------- double_cone.python (29 lines) ----------
# Load the Python Standard and DesignScript Libraries
import sys
import clr
clr.AddReference('ProtoGeometry')
from Autodesk.DesignScript.Geometry import *

# The inputs to this node will be stored as a list in the IN variables.
dataEnteringNode = IN

class DoubleCone:
    
    def __init__(self, apex_bottom_point, apex_top_point, mid_radius):
        self.apex_bottom = apex_bottom_point
        self.apex_top = apex_top_point
        self.radius = mid_radius

    def make_geometry(self):
        mx = (self.apex_bottom.X + self.apex_top.X) / 2.0
        my = (self.apex_bottom.Y + self.apex_top.Y) / 2.0
        mz = (self.apex_bottom.Z + self.apex_top.Z) / 2.0
        mid_point = Point.ByCoordinates(mx, my, mz)
        cone_bottom = Cone.ByPointsRadius(mid_point, self.apex_bottom, self.radius)
        cone_top    = Cone.ByPointsRadius(mid_point, self.apex_top, self.radius)
        try:
            return cone_bottom.Union(cone_top)
        except:
            return [cone_bottom, cone_top]
            
OUT = DoubleCone
# ----------------------------------------
single_instance_double_cone = Python(IN[0]=byCoordinates_3, IN[1]=byCoordinates_4, IN[2]=upper_radius, IN[3]=double_cone)  # PythonNet3
# ---------- single_instance_double_cone.python (19 lines) ----------
# Load the Python Standard and DesignScript Libraries
import sys
import clr
clr.AddReference('ProtoGeometry')
from Autodesk.DesignScript.Geometry import *

# The inputs to this node will be stored as a list in the IN variables.
dataEnteringNode = IN

# Place your code below this line

bottom = IN[0]
top = IN[1]
radius = IN[2]
DoubleCone = IN[3]

double_cone = DoubleCone(bottom, top, radius)

OUT = double_cone.make_geometry()
# ----------------------------------------
color_palette = ColorPalette({R: 39, G: 93, B: 56, A: 255})
byGeometryColor_2 = Modifiers.GeometryColor.ByGeometryColor(geometry=single_instance_double_cone, color=color_palette)

number_of_cylinders = DoubleSlider(40, range=35..50 step 1)
base_radius = DoubleSlider(4500, range=2500..5000 step 100)
cylinder_radius = DoubleSlider(171, range=100..250 step 1)

# group: Volume Computation
compute_volume_of_cylinders = Python(IN[0]=number_of_cylinders, IN[1]=height_of_structure_to_top_of, IN[2]=base_radius, IN[3]=upper_radius, IN[4]=cylinder_radius)  # PythonNet3
# ---------- compute_volume_of_cylinders.python (20 lines) ----------
# Load the Python Standard and DesignScript Libraries
import sys
import clr
clr.AddReference('ProtoGeometry')
from Autodesk.DesignScript.Geometry import *

# The inputs to this node will be stored as a list in the IN variables.
dataEnteringNode = IN

n = IN[0] #Number of Cylinders
h = IN[1]
outrad = IN[2]
inrad = IN[3]
r = IN[4]

len = (((outrad - inrad)**2) + (h**2))**(1/2)

Vol = (3.14*n*(r**2)*len)
# Assign your output to the OUT variable.
OUT = round(Vol)
# ----------------------------------------
compute_volume_of_doublecone = Python(IN[0]=cone_height_cone_base_to_apex, IN[1]=upper_radius)  # PythonNet3
# ---------- compute_volume_of_doublecone.python (17 lines) ----------
# Load the Python Standard and DesignScript Libraries
import sys
import clr
clr.AddReference('ProtoGeometry')
from Autodesk.DesignScript.Geometry import *

# The inputs to this node will be stored as a list in the IN variables.
dataEnteringNode = IN

# Place your code below this line

h = IN[0]
r = IN[1]

Vol = (3.14*(r**2)*h*2)/3

OUT = round(Vol)
# ----------------------------------------
code_block_5 = CodeBlock(CV=compute_volume_of_cylinders, n=number_of_cylinders, DCV=compute_volume_of_doublecone) { Single_Cylinder_Volume = CV/n; Total_Cylinder_Volume = CV; Total_Volume_Of_All_Shapes = CV + DCV; Cone_Volume = DCV; }
floor = Math.Floor(number=code_block_5.Single_Cylinder_Volume)
string_from_object = FromObject(object=floor)
floor_2 = Math.Floor(number=code_block_5.Total_Cylinder_Volume)
string_from_object_2 = FromObject(object=floor_2)
floor_3 = Math.Floor(number=code_block_5.Cone_Volume)
string_from_object_3 = FromObject(object=floor_3)
floor_4 = Math.Floor(number=code_block_5.Total_Volume_Of_All_Shapes)
string_from_object_4 = FromObject(object=floor_4)
code_block_6 = CodeBlock(SCV=string_from_object, TCV=string_from_object_2, Cv=string_from_object_3, TV=string_from_object_4)
# ---------- code_block_6.designscript (4 lines) ----------
Single_Cylinder_Volume = SCV + " mm^3";
Total_Cylinder_Volume = TCV + " mm^3";
Cone_Volume = Cv + " mm^3";
Total_Volume = TV + " mm^3";
# ----------------------------------------

double_cone_volume = Watch(code_block_6.Cone_Volume)
total_volume_of_all_cylinders = Watch(code_block_6.Total_Cylinder_Volume)

# group: Generate Cylinders
code_block_7 = CodeBlock {  }
code_block_8 = CodeBlock { 0; 270; }
byCoordinates_5 = Point.ByCoordinates(x=code_block_8.out0, y=code_block_8.out0, z=height_of_structure_to_top_of)
byCenterPointRadiusAngle = Arc.ByCenterPointRadiusAngle(center=byCoordinates_5, radius=upper_radius, startAngle=code_block_8.out0, endAngle=code_block_8.out1)
code_block_9 = CodeBlock(x=number_of_cylinders) { start = 0; amount = x+1; step = (1/x); }
sequence = Sequence(start=code_block_9.start, amount=code_block_9.amount, step=code_block_9.step)
pointAtParameter = Curve.PointAtParameter(curve=byCenterPointRadiusAngle, param=sequence)
byCoordinates_6 = Point.ByCoordinates(x=code_block_8.out0, y=code_block_8.out0, z=code_block_8.out0)
byCenterPointRadiusAngle_2 = Arc.ByCenterPointRadiusAngle(center=byCoordinates_6, radius=base_radius, startAngle=code_block_8.out0, endAngle=code_block_8.out1)
pointAtParameter_2 = Curve.PointAtParameter(curve=byCenterPointRadiusAngle_2, param=sequence)
list_create = List.Create(item0=cylinder_radius)
cylinder = Python()  # PythonNet3; unwired: IN[0]
# ---------- cylinder.python (19 lines) ----------
# Load the Python Standard and DesignScript Libraries
import sys
import clr
clr.AddReference('ProtoGeometry')
from Autodesk.DesignScript.Geometry import *

# The inputs to this node will be stored as a list in the IN variables.
dataEnteringNode = IN

class CircularRod:
    def __init__ (self, bottom_point, top_point, radius):
        self.bottom = bottom_point
        self.top = top_point
        self.radius = radius
        
    def make_geometry(self):
        return Cylinder.ByPointsRadius(self.bottom, self.top, self.radius)
      
OUT = CircularRod
# ----------------------------------------
create_cylinders = Python(IN[0]=pointAtParameter, IN[1]=pointAtParameter_2, IN[2]=list_create, IN[3]=cylinder)  # PythonNet3
# ---------- create_cylinders.python (29 lines) ----------
# Load the Python Standard and DesignScript Libraries
import sys
import clr
clr.AddReference('ProtoGeometry')
from Autodesk.DesignScript.Geometry import *

# The inputs to this node will be stored as a list in the IN variables.
dataEnteringNode = IN

# Place your code below this line

btm = IN[0]
top = IN[1]
rad = IN[2]
CircularRod = IN[3]
rods = []
count = min(len(btm), len(top))

for i in range(count):
 
    r = rad[i] if i < len(rad) else rad[-1]
        
    b = btm[i]
    t = top[i]
    
    rod = CircularRod(b,t,r)
    rods.append(rod.make_geometry())
    
OUT = rods
# ----------------------------------------
color_palette_2 = ColorPalette({R: 254, G: 203, B: 0, A: 255})
byGeometryColor_3 = Modifiers.GeometryColor.ByGeometryColor(geometry=create_cylinders, color=color_palette_2)

volume_of_individual_cylinders = Watch(code_block_6.Single_Cylinder_Volume)
total_volume_of_all_shapes = Watch(code_block_6.Total_Volume)  # "Total Volume of All Shapes (Cylinders + Cones)"
