# Dynamo graph 1852408.dyn (Dynamo 4.0.0.3277)

# group: Don't touch this ground
code_block = CodeBlock { -5000; -5000; -200; }
byCoordinates = Point.ByCoordinates(x=code_block.out0, y=code_block.out1, z=code_block.out2)
code_block_2 = CodeBlock { 5000; 5000; 0; }
byCoordinates_2 = Point.ByCoordinates(x=code_block_2.out0, y=code_block_2.out1, z=code_block_2.out2)
byCorners = Cuboid.ByCorners(lowPoint=byCoordinates, highPoint=byCoordinates_2)
code_block_3 = CodeBlock { 0; 100; 0; }
byARGB = Color.ByARGB(red=code_block_3.out0, green=code_block_3.out1, blue=code_block_3.out2)
byGeometryColor = Modifiers.GeometryColor.ByGeometryColor(geometry=byCorners, color=byARGB)

classes_timber_and_steel = Python()  # PythonNet3
# ---------- classes_timber_and_steel.python (67 lines) ----------
import clr
clr.AddReference("ProtoGeometry")
from Autodesk.DesignScript.Geometry import *

#class1 for Timber beams 
#here, I am creating cylindrical beams, connected to a slider with diameter  or thickness change
class TimberBeam:
    def __init__(self, start_pt, end_pt, radius):   
        self.start = start_pt
        self.end = end_pt
        self.radius = radius
        
        self.geometry = Cylinder.ByPointsRadius(start_pt, end_pt, radius)
        
        
        try:
            self.volume = self.geometry.Volume
        except:
            self.volume = None   

    def makegeometry(self):
        return self.geometry
    
    def getvolume(self):
        return self.volume
#Class 2 of SteelWalls
#Here, I added steelwaals, and steel arcs with a loft.
class SteelWalls:
    
    def __init__(self, pA, pB, apex, thickness, curveRise=0):
        self.A = pA
        self.B = pB
        self.C = apex
        self.t = thickness
#here, i am connecting appropriate points with midbase and, and making appropriate arc
        midBase = Point.ByCoordinates(
            (pA.X + pB.X)/2,
            (pA.Y + pB.Y)/2,
            (pA.Z + pB.Z)/2 + curveRise
        )
        baseArc = NurbsCurve.ByPoints([pA, midBase, pB])
        midTop = Point.ByCoordinates(
            (pA.X + apex.X)/2,
            (pA.Y + apex.Y)/2,
            (pA.Z + apex.Z)/2 + curveRise
        )

        topCurve = NurbsCurve.ByPoints([pA, midTop, apex])

        try:
            srf = Surface.ByLoft([baseArc, topCurve])
            self.solid = srf.Thicken(thickness, True)
        except:
            self.solid = None

        try:
            self.volume = self.solid.Volume
        except:
            self.volume = None

    def makegeometry(self):
        return self.solid
    
    def getvolume(self):
        return self.volume

OUT = [TimberBeam, SteelWalls]
# ----------------------------------------
groundsize = DoubleSlider(10000, range=1000..10000 step 10)
pavillionheight = DoubleSlider(5730, range=2000..7000 step 10)
code_block_4 = CodeBlock(groundsize=groundsize, pavillionheight=pavillionheight)
# ---------- code_block_4.designscript (9 lines) ----------
x = groundsize / 2;

p0 = Point.ByCoordinates(-x, -x, 0);
p1 = Point.ByCoordinates(x, -x, 0);
p2 = Point.ByCoordinates(x, x, 0);
p3 = Point.ByCoordinates(-x, x, 0);
apex = Point.ByCoordinates(0, 0, pavillionheight);

[p0, p1, p2, p3, apex];
# ----------------------------------------
beamThickness = IntegerSlider(155, range=20..300 step 5)
wallThickness = DoubleSlider(125, range=10..200 step 5)
instances_pavilion_beams_and = Python(IN[0]=classes_timber_and_steel, IN[1]=code_block_4.out6, IN[2]=beamThickness, IN[3]=wallThickness)  # "instances: pavilion beams and panels"; PythonNet3
# ---------- instances_pavilion_beams_and.python (75 lines) ----------
import clr
clr.AddReference("ProtoGeometry")
from Autodesk.DesignScript.Geometry import *

classes = IN[0]
TimberBeam = classes[0]
SteelWall = classes[1]     
listpoints = IN[1]     
Beamthickness = IN[2]
WallThickness = IN[3]
p0, p1, p2, p3, apex = listpoints
beamlist = []
beamvolume = []

for base in [p0, p1, p2, p3]:
    beam = TimberBeam(base, apex, Beamthickness)
    beamlist.append(beam.makegeometry())
    beamvolume.append(beam.getvolume())


#Here using the if, else statements,two of the four sides of the pavillion were made open, and can be altered based on needs 
opensides = [True, False, True, False]
wallpairs = [(p0,p1), (p1,p2), (p2,p3), (p3,p0)]

walllist = []
wallvolume = []

for i, (A, B) in enumerate(wallpairs):
    if opensides[i]:
        walllist.append(None)
        wallvolume.append(None)
    else:
        p = SteelWall(A, B, apex, WallThickness)  
        walllist.append(p.makegeometry())
        wallvolume.append(p.getvolume())    
def dividearc(curve, n):
    pts = []
    for i in range(n + 1):
        t = float(i) / n   
        pts.append(curve.PointAtParameter(t))
    return pts

#here, I added arcs to make the pavillion entrances look more aesthetic
def addarcpieces(A, B):
    mid = Point.ByCoordinates(
        (A.X + B.X)/2,
        (A.Y + B.Y)/2,
        apex.Z * 0.9
    )
    arc = Arc.ByThreePoints(A, mid, B)
    arcpoints = dividearc(arc, 10)

    for i in range(len(arcpoints) - 1):
        seg = TimberBeam(arcpoints[i], arcpoints[i+1], Beamthickness)
        beamlist.append(seg.makegeometry())
        beamvolume.append(seg.getvolume())


#here, I added arcs on open sides
if opensides[0]: addarcpieces(p0, p1)
if opensides[2]: addarcpieces(p2, p3)


#here, i am calculating for volume 
totalbeamvolume = sum(v for v in beamvolume if v)
totalwallvolume = sum(v for v in wallvolume if v)

OUT = [
    beamlist,
    walllist,
    beamvolume,
    wallvolume,
    totalbeamvolume,
    totalwallvolume
]
# ----------------------------------------
code_block_5 = CodeBlock { 4; }
getItemAtIndex = List.GetItemAtIndex(list=instances_pavilion_beams_and, index=code_block_5)
steel_wall_volume_mm_3 = Watch(getItemAtIndex)
code_block_6 = CodeBlock { 5; }
getItemAtIndex_2 = List.GetItemAtIndex(list=instances_pavilion_beams_and, index=code_block_6)
timber_beam_volume_mm_3 = Watch(getItemAtIndex_2)
code_block_7 = CodeBlock(pavillionheight=pavillionheight) { 0; 0; pavillionheight + 200; }
byCoordinates_3 = Point.ByCoordinates(x=code_block_7.out0, y=code_block_7.out1, z=code_block_7.out2)
code_block_8 = CodeBlock { 0; 0; 0; }
byCoordinates_4 = Point.ByCoordinates(x=code_block_8.out0, y=code_block_8.out1, z=code_block_8.out2)
towerthickness = DoubleSlider(580, range=100..1000 step 20)
byPointsRadius = Cylinder.ByPointsRadius(startPoint=byCoordinates_3, endPoint=byCoordinates_4, radius=towerthickness)
