# Dynamo graph 1852436.dyn (Dynamo 3.6.0.9395)

code_block = CodeBlock { -5000; -5000; -200; }
byCoordinates = Point.ByCoordinates(x=code_block.out0, y=code_block.out1, z=code_block.out2)
code_block_2 = CodeBlock { 5000; 5000; 0; }
byCoordinates_2 = Point.ByCoordinates(x=code_block_2.out0, y=code_block_2.out1, z=code_block_2.out2)
byCorners = Cuboid.ByCorners(lowPoint=byCoordinates, highPoint=byCoordinates_2)
code_block_3 = CodeBlock { 0; 100; 0; }
byARGB = Color.ByARGB(red=code_block_3.out0, green=code_block_3.out1, blue=code_block_3.out2)
byGeometryColor = Modifiers.GeometryColor.ByGeometryColor(geometry=byCorners, color=byARGB)
code_block_4 = CodeBlock { -4500; 0; }
code_block_5 = CodeBlock { 250; 10; 500; }
sequence = Sequence(start=code_block_5.out0, amount=code_block_5.out1, step=code_block_5.out2)
byCoordinates_3 = Point.ByCoordinates(x=code_block_4.out0, y=sequence, z=code_block_4.out1)
code_block_6 = CodeBlock { -4500; 3000; }
byCoordinates_4 = Point.ByCoordinates(x=code_block_6.out0, y=sequence, z=code_block_6.out1)
code_block_7 = CodeBlock { 150; 50; }
radius_multiplier = IntegerSlider(1, range=0..100 step 1)
sequence_2 = Sequence(start=code_block_7.out0, amount=radius_multiplier, step=code_block_7.out1)
class_circular_steel_rod = Python()  # CPython3; unwired: IN[0]
# ---------- class_circular_steel_rod.python (30 lines) ----------
# Load the Python Standard and DesignScript Libraries
import sys
import clr
clr.AddReference('ProtoGeometry')
from Autodesk.DesignScript.Geometry import *

class CylindricalRod:
    def __init__(self, p1, p2, r):
        self.p1 = p1
        self.p2 = p2
        self.radius = r

        path = Line.ByStartPointEndPoint(p1, p2)
        
        plane = Plane.ByOriginNormal(p1, path.Direction)
        
        circle = Circle.ByPlaneRadius(plane, r)
        
        self.solid = Solid.BySweep(circle, path)
        
    def make_geometry(self):
        return self.solid
        
    def get_volume(self):
        return self.solid.Volume
        
    def get_volume_with_units(self):
        return "{} mm^3".format(self.solid.Volume)

OUT = CylindricalRod
# ----------------------------------------
series_of_left_vertical_wood = Python(IN[0]=byCoordinates_3, IN[1]=byCoordinates_4, IN[2]=sequence_2, IN[3]=class_circular_steel_rod)  # "Series of Left Vertical Wood Logs (11-20)"; CPython3
# ---------- series_of_left_vertical_wood.python (14 lines) ----------
CircularRod = IN[3]
bottom_p = IN[0]
top_p = IN[1]
R = IN[2]
SteelRods = []
count = min(len(bottom_p), len(top_p))

for i in range(count):
    r = R[i] if i < len(R) else R[-1]
    btm = bottom_p[i]
    top = top_p[i]
    rod = CircularRod(btm, top, r)
    SteelRods.append(rod.make_geometry())
OUT = SteelRods
# ----------------------------------------
code_block_8 = CodeBlock { 4500; 0; }
code_block_9 = CodeBlock { 250; 10; 500; }
sequence_3 = Sequence(start=code_block_9.out0, amount=code_block_9.out1, step=code_block_9.out2)
byCoordinates_5 = Point.ByCoordinates(x=code_block_8.out0, y=sequence_3, z=code_block_8.out1)
code_block_10 = CodeBlock { 4500; 3000; }
byCoordinates_6 = Point.ByCoordinates(x=code_block_10.out0, y=sequence_3, z=code_block_10.out1)
series_of_right_vertical_wood = Python(IN[0]=byCoordinates_5, IN[1]=byCoordinates_6, IN[2]=sequence_2, IN[3]=class_circular_steel_rod)  # "Series of Right Vertical Wood Logs (11-20)"; CPython3; same code as series_of_left_vertical_wood
code_block_11 = CodeBlock { -4500; 3000; }
code_block_12 = CodeBlock { 250; 10; 500; }
sequence_4 = Sequence(start=code_block_12.out0, amount=code_block_12.out1, step=code_block_12.out2)
byCoordinates_7 = Point.ByCoordinates(x=code_block_11.out0, y=sequence_4, z=code_block_11.out1)
code_block_13 = CodeBlock { 0; 9000; }
byCoordinates_8 = Point.ByCoordinates(x=code_block_13.out0, y=sequence_4, z=code_block_13.out1)
code_block_14 = CodeBlock { 150; 50; }
radius_multiplier_2 = IntegerSlider(1, range=0..100 step 1)
sequence_5 = Sequence(start=code_block_14.out0, amount=radius_multiplier_2, step=code_block_14.out1)
series_of_left_slanted_wood_logs = Python(IN[0]=byCoordinates_7, IN[1]=byCoordinates_8, IN[2]=sequence_5, IN[3]=class_circular_steel_rod)  # "Series of Left Slanted Wood Logs (11-20)"; CPython3; same code as series_of_left_vertical_wood
code_block_15 = CodeBlock { 4500; 3000; }
code_block_16 = CodeBlock { 250; 10; 500; }
sequence_6 = Sequence(start=code_block_16.out0, amount=code_block_16.out1, step=code_block_16.out2)
byCoordinates_9 = Point.ByCoordinates(x=code_block_15.out0, y=sequence_6, z=code_block_15.out1)
code_block_17 = CodeBlock { 0; 9000; }
byCoordinates_10 = Point.ByCoordinates(x=code_block_17.out0, y=sequence_6, z=code_block_17.out1)
series_of_right_slanted_wood = Python(IN[0]=byCoordinates_9, IN[1]=byCoordinates_10, IN[2]=sequence_5, IN[3]=class_circular_steel_rod)  # "Series of Right Slanted Wood Logs (11-20)"; CPython3; same code as series_of_left_vertical_wood
code_block_18 = CodeBlock { 0; 0; 9000; }
byCoordinates_11 = Point.ByCoordinates(x=code_block_18.out0, y=code_block_18.out1, z=code_block_18.out2)
code_block_19 = CodeBlock { 0; 4800; 9000; }
byCoordinates_12 = Point.ByCoordinates(x=code_block_19.out0, y=code_block_19.out1, z=code_block_19.out2)
radius = DoubleSlider(200, range=0..10000 step 10)
instance_of_top_steel_pole = Python(IN[0]=byCoordinates_11, IN[1]=byCoordinates_12, IN[2]=radius, IN[3]=class_circular_steel_rod)  # CPython3
# ---------- instance_of_top_steel_pole.python (6 lines) ----------
CylindricalRod = IN[3]
a = CylindricalRod(IN[0], IN[1], IN[2])
p = a.get_volume_with_units()
b = a.make_geometry()

OUT = [p], b
# ----------------------------------------
firstItem = List.FirstItem(list=instance_of_top_steel_pole)
watch = Watch(firstItem)
code_block_20 = CodeBlock { 0; -4800; 4000; }
byCoordinates_13 = Point.ByCoordinates(x=code_block_20.out0, y=code_block_20.out1, z=code_block_20.out2)
code_block_21 = CodeBlock { 0; 0; 9000; }
byCoordinates_14 = Point.ByCoordinates(x=code_block_21.out0, y=code_block_21.out1, z=code_block_21.out2)
code_block_22 = CodeBlock { 200; }
instance_of_front_slant_steel = Python(IN[0]=byCoordinates_13, IN[1]=byCoordinates_14, IN[2]=code_block_22, IN[3]=class_circular_steel_rod)  # "Instance of Front Slant Steel Pole"; CPython3; same code as instance_of_top_steel_pole
firstItem_2 = List.FirstItem(list=instance_of_front_slant_steel)
watch_2 = Watch(firstItem_2)
code_block_23 = CodeBlock { 2500; -4800; 0; }
byCoordinates_15 = Point.ByCoordinates(x=code_block_23.out0, y=code_block_23.out1, z=code_block_23.out2)
code_block_24 = CodeBlock { 0; -4800; 4000; }
byCoordinates_16 = Point.ByCoordinates(x=code_block_24.out0, y=code_block_24.out1, z=code_block_24.out2)
radius_2 = DoubleSlider(200, range=0..10000 step 10)
instance_of_front_right_steel = Python(IN[0]=byCoordinates_15, IN[1]=byCoordinates_16, IN[2]=radius_2, IN[3]=class_circular_steel_rod)  # "Instance of Front Right Steel Pole"; CPython3; same code as instance_of_top_steel_pole
firstItem_3 = List.FirstItem(list=instance_of_front_right_steel)
watch_3 = Watch(firstItem_3)
code_block_25 = CodeBlock { -2500; -4800; 0; }
byCoordinates_17 = Point.ByCoordinates(x=code_block_25.out0, y=code_block_25.out1, z=code_block_25.out2)
code_block_26 = CodeBlock { 0; -4800; 4000; }
byCoordinates_18 = Point.ByCoordinates(x=code_block_26.out0, y=code_block_26.out1, z=code_block_26.out2)
radius_3 = DoubleSlider(200, range=0..10000 step 10)
instance_of_front_left_steel = Python(IN[0]=byCoordinates_17, IN[1]=byCoordinates_18, IN[2]=radius_3, IN[3]=class_circular_steel_rod)  # "Instance of Front Left Steel Pole"; CPython3; same code as instance_of_top_steel_pole
firstItem_4 = List.FirstItem(list=instance_of_front_left_steel)
watch_4 = Watch(firstItem_4)
code_block_27 = CodeBlock { 0; 4800; 0; }
byCoordinates_19 = Point.ByCoordinates(x=code_block_27.out0, y=code_block_27.out1, z=code_block_27.out2)
code_block_28 = CodeBlock { 0; 4800; 9000; }
byCoordinates_20 = Point.ByCoordinates(x=code_block_28.out0, y=code_block_28.out1, z=code_block_28.out2)
radius_4 = DoubleSlider(200, range=0..10000 step 10)
instance_of_back_steel_pole = Python(IN[0]=byCoordinates_19, IN[1]=byCoordinates_20, IN[2]=radius_4, IN[3]=class_circular_steel_rod)  # CPython3; same code as instance_of_top_steel_pole
firstItem_5 = List.FirstItem(list=instance_of_back_steel_pole)
watch_5 = Watch(firstItem_5)
code_block_29 = CodeBlock { 5000; 5000; 0; }
byCoordinates_21 = Point.ByCoordinates(x=code_block_29.out0, y=code_block_29.out1, z=code_block_29.out2)
code_block_30 = CodeBlock { 4000; 0; }
height = IntegerSlider(1000, range=0..10000 step 10)
byCoordinates_22 = Point.ByCoordinates(x=code_block_30.out0, y=code_block_30.out1, z=height)
class_concrete_block = Python()  # CPython3; unwired: IN[0]
# ---------- class_concrete_block.python (23 lines) ----------
# Load the Python Standard and DesignScript Libraries
import sys
import clr
clr.AddReference('ProtoGeometry')
from Autodesk.DesignScript.Geometry import *

class CuboidRod:
    def __init__(self, c1, c2):
        self.corner1 = c1
        self.corner2 = c2
        self.solid = Cuboid.ByCorners(self.corner1, self.corner2)
        
    def make_geometry(self):
        return self.solid
        
    def get_volume(self):
        returnself.solid.Volume
        
    def get_volume_with_units(self):
        vol = self.solid.Volume
        return "{} mm^3".format(vol)
          
OUT = CuboidRod
# ----------------------------------------
instances_of_right_concrete = Python(IN[0]=byCoordinates_21, IN[1]=byCoordinates_22, IN[2]=class_concrete_block)  # "Instances of Right Concrete Block"; CPython3
# ---------- instances_of_right_concrete.python (5 lines) ----------
CuboidRod = IN[2]
a = CuboidRod( IN[0], IN[1])
p = a.get_volume_with_units()
b = a.make_geometry()
OUT = (p,b)
# ----------------------------------------
firstItem_6 = List.FirstItem(list=instances_of_right_concrete)
right_block = Watch(firstItem_6)
code_block_31 = CodeBlock { -5000; 5000; 0; }
byCoordinates_23 = Point.ByCoordinates(x=code_block_31.out0, y=code_block_31.out1, z=code_block_31.out2)
code_block_32 = CodeBlock { -4000; 0; }
height_2 = IntegerSlider(1000, range=0..10000 step 10)
byCoordinates_24 = Point.ByCoordinates(x=code_block_32.out0, y=code_block_32.out1, z=height_2)
instances_of_left_concrete_block = Python(IN[0]=byCoordinates_23, IN[1]=byCoordinates_24, IN[2]=class_concrete_block)  # CPython3; same code as instances_of_right_concrete
firstItem_7 = List.FirstItem(list=instances_of_left_concrete_block)
left_block = Watch(firstItem_7)
code_block_33 = CodeBlock { 3550; -1632.5; 0; }
byCoordinates_25 = Point.ByCoordinates(x=code_block_33.out0, y=code_block_33.out1, z=code_block_33.out2)
code_block_34 = CodeBlock { 0; -1632.5; 7325; }
byCoordinates_26 = Point.ByCoordinates(x=code_block_34.out0, y=code_block_34.out1, z=code_block_34.out2)
code_block_35 = CodeBlock { 150; }
class_circular_wood_log = Python()  # CPython3; unwired: IN[0]; same code as class_circular_steel_rod
instance_of_slanted_right_wood = Python(IN[0]=byCoordinates_25, IN[1]=byCoordinates_26, IN[2]=code_block_35, IN[3]=class_circular_wood_log)  # "Instance of Slanted Right Wood Log (7)"; CPython3; same code as instance_of_top_steel_pole
firstItem_8 = List.FirstItem(list=instance_of_slanted_right_wood)
R7 = Watch(firstItem_8)
code_block_36 = CodeBlock { -2800; -3895; 0; }
byCoordinates_27 = Point.ByCoordinates(x=code_block_36.out0, y=code_block_36.out1, z=code_block_36.out2)
code_block_37 = CodeBlock { 0; -3895; 4950; }
byCoordinates_28 = Point.ByCoordinates(x=code_block_37.out0, y=code_block_37.out1, z=code_block_37.out2)
code_block_38 = CodeBlock { 150; }
instance_of_slanted_left_wood = Python(IN[0]=byCoordinates_27, IN[1]=byCoordinates_28, IN[2]=code_block_38, IN[3]=class_circular_wood_log)  # "Instance of Slanted Left Wood Log (2)"; CPython3; same code as instance_of_top_steel_pole
firstItem_9 = List.FirstItem(list=instance_of_slanted_left_wood)
L2 = Watch(firstItem_9)
code_block_39 = CodeBlock { 2800; -3895; 0; }
byCoordinates_29 = Point.ByCoordinates(x=code_block_39.out0, y=code_block_39.out1, z=code_block_39.out2)
code_block_40 = CodeBlock { 0; -3895; 4950; }
byCoordinates_30 = Point.ByCoordinates(x=code_block_40.out0, y=code_block_40.out1, z=code_block_40.out2)
code_block_41 = CodeBlock { 150; }
instance_of_slanted_right_wood_2 = Python(IN[0]=byCoordinates_29, IN[1]=byCoordinates_30, IN[2]=code_block_41, IN[3]=class_circular_wood_log)  # "Instance of Slanted Right Wood Log (2)"; CPython3; same code as instance_of_top_steel_pole
firstItem_10 = List.FirstItem(list=instance_of_slanted_right_wood_2)
R2 = Watch(firstItem_10)
code_block_42 = CodeBlock { 3400; -2085; 0; }
byCoordinates_31 = Point.ByCoordinates(x=code_block_42.out0, y=code_block_42.out1, z=code_block_42.out2)
code_block_43 = CodeBlock { 0; -2085; 6850; }
byCoordinates_32 = Point.ByCoordinates(x=code_block_43.out0, y=code_block_43.out1, z=code_block_43.out2)
code_block_44 = CodeBlock { 150; }
instance_of_slanted_right_wood_3 = Python(IN[0]=byCoordinates_31, IN[1]=byCoordinates_32, IN[2]=code_block_44, IN[3]=class_circular_wood_log)  # "Instance of Slanted Right Wood Log (6)"; CPython3; same code as instance_of_top_steel_pole
firstItem_11 = List.FirstItem(list=instance_of_slanted_right_wood_3)
R6 = Watch(firstItem_11)
code_block_45 = CodeBlock { 3700; -1180; 0; }
byCoordinates_33 = Point.ByCoordinates(x=code_block_45.out0, y=code_block_45.out1, z=code_block_45.out2)
code_block_46 = CodeBlock { 0; -1180; 7800; }
byCoordinates_34 = Point.ByCoordinates(x=code_block_46.out0, y=code_block_46.out1, z=code_block_46.out2)
code_block_47 = CodeBlock { 150; }
instance_of_slanted_right_wood_4 = Python(IN[0]=byCoordinates_33, IN[1]=byCoordinates_34, IN[2]=code_block_47, IN[3]=class_circular_wood_log)  # "Instance of Slanted Right Wood Log (8)"; CPython3; same code as instance_of_top_steel_pole
firstItem_12 = List.FirstItem(list=instance_of_slanted_right_wood_4)
R8 = Watch(firstItem_12)
code_block_48 = CodeBlock { 4100; -275; 0; }
byCoordinates_35 = Point.ByCoordinates(x=code_block_48.out0, y=code_block_48.out1, z=code_block_48.out2)
code_block_49 = CodeBlock { 0; -275; 8750; }
byCoordinates_36 = Point.ByCoordinates(x=code_block_49.out0, y=code_block_49.out1, z=code_block_49.out2)
code_block_50 = CodeBlock { 150; }
instance_of_slanted_right_wood_5 = Python(IN[0]=byCoordinates_35, IN[1]=byCoordinates_36, IN[2]=code_block_50, IN[3]=class_circular_wood_log)  # "Instance of Slanted Right Wood Log (10)"; CPython3; same code as instance_of_top_steel_pole
firstItem_13 = List.FirstItem(list=instance_of_slanted_right_wood_5)
R10 = Watch(firstItem_13)
code_block_51 = CodeBlock { 2650; -4347.5; 0; }
byCoordinates_37 = Point.ByCoordinates(x=code_block_51.out0, y=code_block_51.out1, z=code_block_51.out2)
code_block_52 = CodeBlock { 0; -4347.5; 4475; }
byCoordinates_38 = Point.ByCoordinates(x=code_block_52.out0, y=code_block_52.out1, z=code_block_52.out2)
code_block_53 = CodeBlock { 150; }
instance_of_slanted_right_wood_6 = Python(IN[0]=byCoordinates_37, IN[1]=byCoordinates_38, IN[2]=code_block_53, IN[3]=class_circular_wood_log)  # "Instance of Slanted Right Wood Log (1)"; CPython3; same code as instance_of_top_steel_pole
firstItem_14 = List.FirstItem(list=instance_of_slanted_right_wood_6)
R1 = Watch(firstItem_14)
code_block_54 = CodeBlock { -3700; -1180; 0; }
byCoordinates_39 = Point.ByCoordinates(x=code_block_54.out0, y=code_block_54.out1, z=code_block_54.out2)
code_block_55 = CodeBlock { 0; -1180; 7800; }
byCoordinates_40 = Point.ByCoordinates(x=code_block_55.out0, y=code_block_55.out1, z=code_block_55.out2)
code_block_56 = CodeBlock { 150; }
instance_of_slanted_left_wood_2 = Python(IN[0]=byCoordinates_39, IN[1]=byCoordinates_40, IN[2]=code_block_56, IN[3]=class_circular_wood_log)  # "Instance of Slanted Left Wood Log (8)"; CPython3; same code as instance_of_top_steel_pole
firstItem_15 = List.FirstItem(list=instance_of_slanted_left_wood_2)
L8 = Watch(firstItem_15)
code_block_57 = CodeBlock { 3950; -727.5; 0; }
byCoordinates_41 = Point.ByCoordinates(x=code_block_57.out0, y=code_block_57.out1, z=code_block_57.out2)
code_block_58 = CodeBlock { 0; -727.5; 8275; }
byCoordinates_42 = Point.ByCoordinates(x=code_block_58.out0, y=code_block_58.out1, z=code_block_58.out2)
code_block_59 = CodeBlock { 150; }
instance_of_slanted_right_wood_7 = Python(IN[0]=byCoordinates_41, IN[1]=byCoordinates_42, IN[2]=code_block_59, IN[3]=class_circular_wood_log)  # "Instance of Slanted Right Wood Log (9)"; CPython3; same code as instance_of_top_steel_pole
firstItem_16 = List.FirstItem(list=instance_of_slanted_right_wood_7)
R9 = Watch(firstItem_16)
code_block_60 = CodeBlock { 3250; -2537.5; 0; }
byCoordinates_43 = Point.ByCoordinates(x=code_block_60.out0, y=code_block_60.out1, z=code_block_60.out2)
code_block_61 = CodeBlock { 0; -2537.5; 6375; }
byCoordinates_44 = Point.ByCoordinates(x=code_block_61.out0, y=code_block_61.out1, z=code_block_61.out2)
code_block_62 = CodeBlock { 150; }
instance_of_slanted_right_wood_8 = Python(IN[0]=byCoordinates_43, IN[1]=byCoordinates_44, IN[2]=code_block_62, IN[3]=class_circular_wood_log)  # "Instance of Slanted Right Wood Log (5)"; CPython3; same code as instance_of_top_steel_pole
firstItem_17 = List.FirstItem(list=instance_of_slanted_right_wood_8)
R5 = Watch(firstItem_17)
code_block_63 = CodeBlock { -3250; -2537.5; 0; }
byCoordinates_45 = Point.ByCoordinates(x=code_block_63.out0, y=code_block_63.out1, z=code_block_63.out2)
code_block_64 = CodeBlock { 0; -2537.5; 6375; }
byCoordinates_46 = Point.ByCoordinates(x=code_block_64.out0, y=code_block_64.out1, z=code_block_64.out2)
code_block_65 = CodeBlock { 150; }
instance_of_slanted_left_wood_3 = Python(IN[0]=byCoordinates_45, IN[1]=byCoordinates_46, IN[2]=code_block_65, IN[3]=class_circular_wood_log)  # "Instance of Slanted Left Wood Log (5)"; CPython3; same code as instance_of_top_steel_pole
firstItem_18 = List.FirstItem(list=instance_of_slanted_left_wood_3)
L5 = Watch(firstItem_18)
code_block_66 = CodeBlock { -3400; -2085; 0; }
byCoordinates_47 = Point.ByCoordinates(x=code_block_66.out0, y=code_block_66.out1, z=code_block_66.out2)
code_block_67 = CodeBlock { 0; -2085; 6850; }
byCoordinates_48 = Point.ByCoordinates(x=code_block_67.out0, y=code_block_67.out1, z=code_block_67.out2)
code_block_68 = CodeBlock { 150; }
instance_of_slanted_left_wood_4 = Python(IN[0]=byCoordinates_47, IN[1]=byCoordinates_48, IN[2]=code_block_68, IN[3]=class_circular_wood_log)  # "Instance of Slanted Left Wood Log (6)"; CPython3; same code as instance_of_top_steel_pole
firstItem_19 = List.FirstItem(list=instance_of_slanted_left_wood_4)
L6 = Watch(firstItem_19)
code_block_69 = CodeBlock { -2950; -3442.5; 0; }
byCoordinates_49 = Point.ByCoordinates(x=code_block_69.out0, y=code_block_69.out1, z=code_block_69.out2)
code_block_70 = CodeBlock { 0; -3442.5; 5425; }
byCoordinates_50 = Point.ByCoordinates(x=code_block_70.out0, y=code_block_70.out1, z=code_block_70.out2)
code_block_71 = CodeBlock { 150; }
instance_of_slanted_left_wood_5 = Python(IN[0]=byCoordinates_49, IN[1]=byCoordinates_50, IN[2]=code_block_71, IN[3]=class_circular_wood_log)  # "Instance of Slanted Left Wood Log (3)"; CPython3; same code as instance_of_top_steel_pole
firstItem_20 = List.FirstItem(list=instance_of_slanted_left_wood_5)
L3 = Watch(firstItem_20)
code_block_72 = CodeBlock { -4100; -275; 0; }
byCoordinates_51 = Point.ByCoordinates(x=code_block_72.out0, y=code_block_72.out1, z=code_block_72.out2)
code_block_73 = CodeBlock { 0; -275; 8750; }
byCoordinates_52 = Point.ByCoordinates(x=code_block_73.out0, y=code_block_73.out1, z=code_block_73.out2)
code_block_74 = CodeBlock { 150; }
instance_of_slanted_left_wood_6 = Python(IN[0]=byCoordinates_51, IN[1]=byCoordinates_52, IN[2]=code_block_74, IN[3]=class_circular_wood_log)  # "Instance of Slanted Left Wood Log (10)"; CPython3; same code as instance_of_top_steel_pole
firstItem_21 = List.FirstItem(list=instance_of_slanted_left_wood_6)
L10 = Watch(firstItem_21)
code_block_75 = CodeBlock { 3100; -2990; 0; }
byCoordinates_53 = Point.ByCoordinates(x=code_block_75.out0, y=code_block_75.out1, z=code_block_75.out2)
code_block_76 = CodeBlock { 0; -2990; 5900; }
byCoordinates_54 = Point.ByCoordinates(x=code_block_76.out0, y=code_block_76.out1, z=code_block_76.out2)
code_block_77 = CodeBlock { 150; }
instance_of_slanted_right_wood_9 = Python(IN[0]=byCoordinates_53, IN[1]=byCoordinates_54, IN[2]=code_block_77, IN[3]=class_circular_wood_log)  # "Instance of Slanted Right Wood Log (4)"; CPython3; same code as instance_of_top_steel_pole
firstItem_22 = List.FirstItem(list=instance_of_slanted_right_wood_9)
R4 = Watch(firstItem_22)
code_block_78 = CodeBlock { -3950; -727.5; 0; }
byCoordinates_55 = Point.ByCoordinates(x=code_block_78.out0, y=code_block_78.out1, z=code_block_78.out2)
code_block_79 = CodeBlock { 0; -727.5; 8275; }
byCoordinates_56 = Point.ByCoordinates(x=code_block_79.out0, y=code_block_79.out1, z=code_block_79.out2)
code_block_80 = CodeBlock { 150; }
instance_of_slanted_left_wood_7 = Python(IN[0]=byCoordinates_55, IN[1]=byCoordinates_56, IN[2]=code_block_80, IN[3]=class_circular_wood_log)  # "Instance of Slanted Left Wood Log (9)"; CPython3; same code as instance_of_top_steel_pole
firstItem_23 = List.FirstItem(list=instance_of_slanted_left_wood_7)
L9 = Watch(firstItem_23)
code_block_81 = CodeBlock { -2650; -4347.5; 0; }
byCoordinates_57 = Point.ByCoordinates(x=code_block_81.out0, y=code_block_81.out1, z=code_block_81.out2)
code_block_82 = CodeBlock { 0; -4347.5; 4475; }
byCoordinates_58 = Point.ByCoordinates(x=code_block_82.out0, y=code_block_82.out1, z=code_block_82.out2)
code_block_83 = CodeBlock { 150; }
instance_of_slanted_left_wood_8 = Python(IN[0]=byCoordinates_57, IN[1]=byCoordinates_58, IN[2]=code_block_83, IN[3]=class_circular_wood_log)  # "Instance of Slanted Left Wood Log (1)"; CPython3; same code as instance_of_top_steel_pole
firstItem_24 = List.FirstItem(list=instance_of_slanted_left_wood_8)
L1 = Watch(firstItem_24)
code_block_84 = CodeBlock { -3550; -1632.5; 0; }
byCoordinates_59 = Point.ByCoordinates(x=code_block_84.out0, y=code_block_84.out1, z=code_block_84.out2)
code_block_85 = CodeBlock { 0; -1632.5; 7325; }
byCoordinates_60 = Point.ByCoordinates(x=code_block_85.out0, y=code_block_85.out1, z=code_block_85.out2)
code_block_86 = CodeBlock { 150; }
instance_of_slanted_left_wood_9 = Python(IN[0]=byCoordinates_59, IN[1]=byCoordinates_60, IN[2]=code_block_86, IN[3]=class_circular_wood_log)  # "Instance of Slanted Left Wood Log (7)"; CPython3; same code as instance_of_top_steel_pole
firstItem_25 = List.FirstItem(list=instance_of_slanted_left_wood_9)
L7 = Watch(firstItem_25)
code_block_87 = CodeBlock { 2950; -3442.5; 0; }
byCoordinates_61 = Point.ByCoordinates(x=code_block_87.out0, y=code_block_87.out1, z=code_block_87.out2)
code_block_88 = CodeBlock { 0; -3442.5; 5425; }
byCoordinates_62 = Point.ByCoordinates(x=code_block_88.out0, y=code_block_88.out1, z=code_block_88.out2)
code_block_89 = CodeBlock { 150; }
instance_of_slanted_right_wood_10 = Python(IN[0]=byCoordinates_61, IN[1]=byCoordinates_62, IN[2]=code_block_89, IN[3]=class_circular_wood_log)  # "Instance of Slanted Right Wood Log (3)"; CPython3; same code as instance_of_top_steel_pole
firstItem_26 = List.FirstItem(list=instance_of_slanted_right_wood_10)
R3 = Watch(firstItem_26)
code_block_90 = CodeBlock { -3100; -2990; 0; }
byCoordinates_63 = Point.ByCoordinates(x=code_block_90.out0, y=code_block_90.out1, z=code_block_90.out2)
code_block_91 = CodeBlock { 0; -2990; 5900; }
byCoordinates_64 = Point.ByCoordinates(x=code_block_91.out0, y=code_block_91.out1, z=code_block_91.out2)
code_block_92 = CodeBlock { 150; }
instance_of_slanted_left_wood_10 = Python(IN[0]=byCoordinates_63, IN[1]=byCoordinates_64, IN[2]=code_block_92, IN[3]=class_circular_wood_log)  # "Instance of Slanted Left Wood Log (4)"; CPython3; same code as instance_of_top_steel_pole
firstItem_27 = List.FirstItem(list=instance_of_slanted_left_wood_10)
L4 = Watch(firstItem_27)
