# Dynamo graph 1852539.dyn (Dynamo 3.6.1.9895)

code_block = CodeBlock { -5000; -5000; -200; }
byCoordinates = Point.ByCoordinates(x=code_block.out0, y=code_block.out1, z=code_block.out2)
code_block_2 = CodeBlock { 5000; 5000; 0; }
byCoordinates_2 = Point.ByCoordinates(x=code_block_2.out0, y=code_block_2.out1, z=code_block_2.out2)
byCorners = Cuboid.ByCorners(lowPoint=byCoordinates, highPoint=byCoordinates_2)
code_block_3 = CodeBlock { 0; 100; 0; }
byARGB = Color.ByARGB(red=code_block_3.out0, green=code_block_3.out1, blue=code_block_3.out2)
byGeometryColor = Modifiers.GeometryColor.ByGeometryColor(geometry=byCorners, color=byARGB)
outer_r = DoubleSlider(3000, range=2500..5000 step 250)
inner_r = DoubleSlider(800, range=500..3000 step 100)
roof_height = DoubleSlider(3100, range=2500..4500 step 100)
segments_n = CodeBlock { 117; }
points_instances = Python(IN[0]=outer_r, IN[1]=inner_r, IN[2]=roof_height, IN[3]=segments_n)  # CPython3
# ---------- points_instances.python (52 lines) ----------
# Load the Python Standard and DesignScript Libraries
import sys
import clr
clr.AddReference('ProtoGeometry')
from Autodesk.DesignScript.Geometry import *

# The inputs to this node will be stored as a list in the IN variables.
dataEnteringNode = IN

# Place your code below this line
import math
from Autodesk.DesignScript.Geometry import Point

r_out = IN[0]
r_in = IN[1]
h = IN[2]
n_segments = IN[3]
n = h + 2300

#this function makes it default if the input is none
def num(v, default): 
    if v is None:
        return default
    try:
        return float(v)
    except:
        return default

r_out = num(r_out, 2000.0)
r_in = num(r_in, 1000.0)
h       = num(h,       3000.0)
n_segments   = int(num(n_segments, 16))


outer_pts = []
inner_pts = []

#generating the points around both circles
for i in range(n_segments):
    t = 2.0 * math.pi * i / float(n_segments)
    x_out = r_out * math.cos(t)
    y_out = r_out * math.sin(t)
    z_out = h
    x_in  = r_in * math.cos(t)
    y_in  = r_in * math.sin(t)
    z_in  = n
    p_out = Point.ByCoordinates(x_out, y_out, z_out)
    p_in  = Point.ByCoordinates(x_in,  y_in,  z_in)
    outer_pts.append(p_out)
    inner_pts.append(p_in)

OUT = [outer_pts, inner_pts]
# ----------------------------------------
connections = Python(IN[0]=points_instances)  # CPython3
# ---------- connections.python (57 lines) ----------
# Load the Python Standard and DesignScript Libraries
import sys
import clr
clr.AddReference('ProtoGeometry')
from Autodesk.DesignScript.Geometry import *

# The inputs to this node will be stored as a list in the IN variables.
dataEnteringNode = IN

# Place your code below this line
clr.AddReference('ProtoGeometry')
from Autodesk.DesignScript.Geometry import Point

data = IN[0]

outer_pts = data[0]
inner_pts = data[1]

#if there are none then it replaces it with an empty list
if outer_pts is None:
    outer_pts = []
if inner_pts is None:
    inner_pts = []

ring_start_pts = []
ring_end_pts   = []

n = min(len(outer_pts), len(inner_pts))


if n < 2: #If n is less than 2 then the output is empty lists
    OUT = [[], [], [], []]
else:
    #outer ring segments
    for i in range(n):
        p1 = outer_pts[i]
        p2 = outer_pts[(i + 1) % n]
        ring_start_pts.append(p1)
        ring_end_pts.append(p2)
    #inner ring segments
    for i in range(n):
        p1 = inner_pts[i]
        p2 = inner_pts[(i + 1) % n]
        ring_start_pts.append(p1)
        ring_end_pts.append(p2)

#Makes a conection from inner cabels to outer cables
cable_start_pts = []
cable_end_pts   = []

for i in range(n):
    p_in  = inner_pts[i]
    p_out = outer_pts[i]
    cable_start_pts.append(p_in)
    cable_end_pts.append(p_out)
# Assign your output to the OUT variable.
OUT = [ring_start_pts, ring_end_pts, cable_start_pts, cable_end_pts]
# ----------------------------------------
ring_thicknes = CodeBlock { 80; }
cable_radius = DoubleSlider(40, range=20..120 step 10)
classes_metal_rings_and_metal = Python(IN[0]=connections, IN[1]=ring_thicknes, IN[2]=cable_radius)  # "Classes: Metal rings and metal cables +(instances, volumes, and geometry)"; CPython3
# ---------- classes_metal_rings_and_metal.python (96 lines) ----------
# Load the Python Standard and DesignScript Libraries
import sys
import clr
clr.AddReference('ProtoGeometry')
from Autodesk.DesignScript.Geometry import *

# The inputs to this node will be stored as a list in the IN variables.
dataEnteringNode = IN

# Place your code below this line import Cylinder

data    = IN[0]
ring_r  = IN[1]
cable_r = IN[2]

ring_start_pts  = data[0]
ring_end_pts    = data[1]
cable_start_pts = data[2]
cable_end_pts   = data[3]

#If any are none then make it an empty list
if ring_start_pts is None:
    ring_start_pts = []
if ring_end_pts is None:
    ring_end_pts = []
if cable_start_pts is None:
    cable_start_pts = []
if cable_end_pts is None:
    cable_end_pts = []

#makes the ring segments
class MetalRingBeam(object):
    def __init__(self, start_pt, end_pt, radius):
        self.start_pt = start_pt
        self.end_pt   = end_pt
        self.radius   = radius
        self.solid    = None
    def make_geometry(self):
        if self.solid is None:
            self.solid = Cylinder.ByPointsRadius(self.start_pt, self.end_pt, self.radius)
        return self.solid
    def volume(self):
        if self.solid is None:
            self.make_geometry()
        return self.solid.Volume

#makes the cables
class MetalCable(object):
    def __init__(self, start_pt, end_pt, radius):
        self.start_pt = start_pt
        self.end_pt   = end_pt
        self.radius   = radius
        self.solid    = None
    def make_geometry(self):
        if self.solid is None:
            self.solid = Cylinder.ByPointsRadius(self.start_pt, self.end_pt, self.radius)
        return self.solid
    def volume(self):
        if self.solid is None:
            self.make_geometry()
        return self.solid.Volume

#Generates the object intances
ring_instances = []
n_ring = min(len(ring_start_pts), len(ring_end_pts))
for i in range(n_ring):
    seg = MetalRingBeam(ring_start_pts[i], ring_end_pts[i], ring_r)
    ring_instances.append(seg)

cable_instances = []
n_cable = min(len(cable_start_pts), len(cable_end_pts))
for i in range(n_cable):
    cab = MetalCable(cable_start_pts[i], cable_end_pts[i], cable_r)
    cable_instances.append(cab)

ring_solids = []
ring_volume_total = 0.0
for seg in ring_instances:
    s = seg.make_geometry()
    ring_solids.append(s)
    ring_volume_total += seg.volume()

cable_solids = []
cable_volume_total = 0.0
for cab in cable_instances:
    s = cab.make_geometry()
    cable_solids.append(s)
    cable_volume_total += cab.volume()

# Assign your output to the OUT variable.
OUT =[ring_instances,    
    cable_instances,
    ring_solids,
    cable_solids,
    ring_volume_total,# 4: total volume Material 1
    cable_volume_total]    # 5: total volume Material 2
# ----------------------------------------
code_block_4 = CodeBlock { 4; 5; }
getItemAtIndex = List.GetItemAtIndex(list=classes_metal_rings_and_metal, index=code_block_4.out0)
metal_rings_volume_mm_3 = Watch(getItemAtIndex)
getItemAtIndex_2 = List.GetItemAtIndex(list=classes_metal_rings_and_metal, index=code_block_4.out1)
cables_volume_mm_3 = Watch(getItemAtIndex_2)
code_block_5 = CodeBlock { 0; }
byCoordinates_3 = Point.ByCoordinates(x=code_block_5, y=code_block_5, z=code_block_5)
code_block_6 = CodeBlock { 10; 410; }
byCoordinates_4 = Point.ByCoordinates(x=code_block_5, y=code_block_5, z=code_block_6.out0)
code_block_7 = CodeBlock { 2000; 1500; 500; }
base_floor_concrete = Cylinder.ByPointsRadius(startPoint=byCoordinates_3, endPoint=byCoordinates_4, radius=code_block_7.out0)
volume = Solid.Volume(solid=base_floor_concrete)
byCoordinates_5 = Point.ByCoordinates(x=code_block_5, y=code_block_5, z=code_block_6.out1)
seat = Cylinder.ByPointsRadius(startPoint=byCoordinates_4, endPoint=byCoordinates_5, radius=code_block_7.out1)
volume_2 = Solid.Volume(solid=seat)
code_block_8 = CodeBlock(z=roof_height) { z; top_cap=z+2300; bot_cap=top_cap-250; }
byCoordinates_6 = Point.ByCoordinates(x=code_block_5, y=code_block_5, z=code_block_8.bot_cap)
trunk = Cylinder.ByPointsRadius(startPoint=byCoordinates_5, endPoint=byCoordinates_6, radius=code_block_7.out2)
volume_3 = Solid.Volume(solid=trunk)
code_block_9 = CodeBlock(roof_height=roof_height) { roof_height; sphere_h=roof_height+800; }
byCoordinates_7 = Point.ByCoordinates(x=code_block_5, y=code_block_5, z=code_block_9.sphere_h)
code_block_10 = CodeBlock { 650; }
byCenterPointRadius = Sphere.ByCenterPointRadius(centerPoint=byCoordinates_7, radius=code_block_10)
difference = Solid.Difference(solid=byCenterPointRadius, other=trunk)
volume_4 = Solid.Volume(solid=difference)
code_block_11 = CodeBlock(base=volume, seat=volume_2, trunk=volume_3, difference=volume_4) { base; seat; trunk; difference; total=base+seat+trunk-difference; }
concrete_volume_mm_3 = Watch(code_block_11.total)
byCoordinates_8 = Point.ByCoordinates(x=code_block_5, y=code_block_5, z=code_block_8.top_cap)
byPointsRadius = Cylinder.ByPointsRadius(startPoint=byCoordinates_6, endPoint=byCoordinates_8, radius=inner_r)
volume_5 = Solid.Volume(solid=byPointsRadius)
metal_cap_volume_mm_3 = Watch(volume_5)
color_palette = ColorPalette({R: 255, G: 192, B: 0, A: 255})
byGeometryColor_2 = Modifiers.GeometryColor.ByGeometryColor(geometry=byCenterPointRadius, color=color_palette)
trunk_color = ColorPalette({R: 140, G: 138, B: 134, A: 255})
trunk_color_2 = Modifiers.GeometryColor.ByGeometryColor(geometry=trunk, color=trunk_color)
code_block_12 = CodeBlock { 2; 3; }
getItemAtIndex_3 = List.GetItemAtIndex(list=classes_metal_rings_and_metal, index=code_block_12.out1)
cover_color = ColorPalette({R: 164, G: 166, B: 154, A: 255})
byGeometryColor_3 = Modifiers.GeometryColor.ByGeometryColor(geometry=getItemAtIndex_3, color=cover_color)
byGeometryColor_4 = Modifiers.GeometryColor.ByGeometryColor(geometry=seat, color=trunk_color)
getItemAtIndex_4 = List.GetItemAtIndex(list=classes_metal_rings_and_metal, index=code_block_12.out0)
byGeometryColor_5 = Modifiers.GeometryColor.ByGeometryColor(geometry=getItemAtIndex_4, color=cover_color)
volume_6 = Solid.Volume(solid=byCenterPointRadius)
metal_ball_volume_mm_3 = Watch(volume_6)
