# Dynamo graph 1852554.dyn.dyn "Home Assignment" (Dynamo 3.6.0.9395)

# group: Don't touch this ground
code_block = CodeBlock { -5000; -5000; -200; }
byCoordinates = Point.ByCoordinates(x=code_block.out0, y=code_block.out1, z=code_block.out2)
code_block_2 = CodeBlock { 5000; 5000; 0; }
byCoordinates_2 = Point.ByCoordinates(x=code_block_2.out0, y=code_block_2.out1, z=code_block_2.out2)
byCorners = Cuboid.ByCorners(lowPoint=byCoordinates, highPoint=byCoordinates_2)
code_block_3 = CodeBlock { 0; 100; 0; }
byARGB = Color.ByARGB(red=code_block_3.out0, green=code_block_3.out1, blue=code_block_3.out2)
byGeometryColor = Modifiers.GeometryColor.ByGeometryColor(geometry=byCorners, color=byARGB)

code_block_4 = CodeBlock { 0; 0; 250; }
top = Point.ByCoordinates(x=code_block_4.out0, y=code_block_4.out1, z=code_block_4.out2)
code_block_5 = CodeBlock { 0; 0; 0; }
bottom = Point.ByCoordinates(y=code_block_5.out1, z=code_block_5.out2)
code_block_6 = CodeBlock { 4500; }
roof = Python()  # CPython3; unwired: IN[0]
# ---------- roof.python (15 lines) ----------
# Load the Python Standard and DesignScript Libraries
import sys
import clr
clr.AddReference('ProtoGeometry')
from Autodesk.DesignScript.Geometry import *

class Roof:
    def __init__(self, bottom_point, top_point, radius):
        self.bottom = bottom_point
        self.top = top_point
        self.radius = radius
    def make_geometry(self):
        return Cylinder.ByPointsRadius(self.bottom, self.top, self.radius)
        
OUT = Roof
# ----------------------------------------
instance = Python(IN[0]=top, IN[1]=bottom, IN[2]=code_block_6, IN[3]=roof)  # CPython3; unwired: IN[4]
# ---------- instance.python (3 lines) ----------
Roof = IN[3]
b = Roof(IN[0], IN[1], IN[2])
OUT = b.make_geometry()
# ----------------------------------------
code_block_7 = CodeBlock { 0; 0; }
height_of_roof = DoubleSlider(6358.8, range=5000..10000 step 0.1)
whole_roof = Geometry.Translate(geometry=instance, xTranslation=code_block_7.out0, yTranslation=code_block_7.out1, zTranslation=height_of_roof)
code_block_8 = CodeBlock { 3500; }
roof_2 = Python()  # CPython3; unwired: IN[0]; same code as roof
instance_2 = Python(IN[0]=top, IN[1]=bottom, IN[2]=code_block_8, IN[3]=roof_2)  # CPython3; unwired: IN[4]; same code as instance
code_block_9 = CodeBlock { 0; 0; }
inner_roof = Geometry.Translate(geometry=instance_2, xTranslation=code_block_9.out0, yTranslation=code_block_9.out1, zTranslation=height_of_roof)
outer_roof = Solid.DifferenceAll(solid=whole_roof, others=inner_roof)
code_block_10 = CodeBlock { 237; }
byARGB_2 = Color.ByARGB(red=code_block_10, green=code_block_10, blue=code_block_10)
code_block_11 = CodeBlock { 0; 0; 0; }
byCoordinates_3 = Point.ByCoordinates(x=code_block_11.out0, y=code_block_11.out1, z=code_block_11.out2)
code_block_12 = CodeBlock { 0; 0; 150; }
byCoordinates_4 = Point.ByCoordinates(x=code_block_12.out0, y=code_block_12.out1, z=code_block_12.out2)
code_block_13 = CodeBlock { 4500; }
base = Python()  # CPython3; unwired: IN[0]
# ---------- base.python (15 lines) ----------
# Load the Python Standard and DesignScript Libraries
import sys
import clr
clr.AddReference('ProtoGeometry')
from Autodesk.DesignScript.Geometry import *

class Base:
    def __init__(self, bottom_point, top_point, radius):
        self.bottom = bottom_point
        self.top = top_point
        self.radius = radius
    def make_geometry(self):
        return Cylinder.ByPointsRadius(self.bottom, self.top, self.radius)
        
OUT = Base
# ----------------------------------------
instance_base = Python(IN[0]=byCoordinates_3, IN[1]=byCoordinates_4, IN[2]=code_block_13, IN[3]=base)  # CPython3
# ---------- instance_base.python (3 lines) ----------
Base = IN[3]
b = Base(IN[0], IN[1], IN[2])
OUT = b.make_geometry()
# ----------------------------------------
code_block_14 = CodeBlock { 237; }
byARGB_3 = Color.ByARGB(red=code_block_14, green=code_block_14, blue=code_block_14)
depth = DoubleSlider(4134.1, range=4000..4310 step 0.1)
pillar_radius = DoubleSlider(125, range=35..125 step 0.1)
pillar = Python()  # CPython3; unwired: IN[0]
# ---------- pillar.python (52 lines) ----------
import clr
clr.AddReference('ProtoGeometry')
from Autodesk.DesignScript.Geometry import Point, Cylinder
import math

class Pillar:
    def __init__(self, location, height, radius):
        self.location = location
        self.height = height
        self.radius = radius
    
    def make_geometry(self):
        top = Point.ByCoordinates(self.location.X, self.location.Y, self.location.Z + self.height)
        return Cylinder.ByPointsRadius(self.location, top, self.radius)


class CircularPillars:
    """Generates a circular array of Pillars with gaps"""
    def __init__(self, N, R, H, PR, gap1=(0, 75), gap2=(180, 255)):
        self.N = N
        self.R = R
        self.H = H
        self.PR = PR
        self.gap1 = gap1
        self.gap2 = gap2
    
    def generate(self):
        pillars = []
        pillar_points = []
        gap1_points = []
        gap2_points = []
        
        angles = [i*(360/self.N) for i in range(self.N)]
        
        for angle in angles:
            x = self.R * math.cos(math.radians(angle))
            y = self.R * math.sin(math.radians(angle))
            base_pt = Point.ByCoordinates(x, y, 0)
            
            if self.gap1[0] <= angle <= self.gap1[1]:
                gap1_points.append(base_pt)
                continue
            if self.gap2[0] <= angle <= self.gap2[1]:
                gap2_points.append(base_pt)
                continue
            
            p = Pillar(location=base_pt, height=self.H, radius=self.PR)
            pillars.append(p.make_geometry())
            pillar_points.append(base_pt)
        
        return [pillars, pillar_points, gap1_points, gap2_points]
OUT = Pillar
# ----------------------------------------
circularPillars = Python(IN[0]=pillar)  # CPython3
# ---------- circularPillars.python (41 lines) ----------
import clr
clr.AddReference('ProtoGeometry')
from Autodesk.DesignScript.Geometry import Point, Cylinder
import math
Pillar = IN[0]
class CircularPillars:
    """Generates a circular array of Pillars with gaps"""
    def __init__(self, N, R, H, PR, gap1=(0, 75), gap2=(180, 255)):
        self.N = N
        self.R = R
        self.H = H
        self.PR = PR
        self.gap1 = gap1
        self.gap2 = gap2
    
    def generate(self):
        pillars = []
        pillar_points = []
        gap1_points = []
        gap2_points = []
        
        angles = [i*(360/self.N) for i in range(self.N)]
        
        for angle in angles:
            x = self.R * math.cos(math.radians(angle))
            y = self.R * math.sin(math.radians(angle))
            base_pt = Point.ByCoordinates(x, y, 0)
            
            if self.gap1[0] <= angle <= self.gap1[1]:
                gap1_points.append(base_pt)
                continue
            if self.gap2[0] <= angle <= self.gap2[1]:
                gap2_points.append(base_pt)
                continue
            
            p = Pillar(location=base_pt, height=self.H, radius=self.PR)
            pillars.append(p.make_geometry())
            pillar_points.append(base_pt)
        
        return [pillars, pillar_points, gap1_points, gap2_points]
OUT = CircularPillars
# ----------------------------------------
instance_3 = Python(IN[0]=depth, IN[1]=height_of_roof, IN[2]=pillar_radius, IN[3]=circularPillars)  # CPython3
# ---------- instance_3.python (12 lines) ----------
N = 100
gap1 = (0, 75)
gap2 = (180, 255)

CircularPillars = IN[3]
R = IN[0]   # Circle radius
H = IN[1]   # Pillar height
PR = IN[2]  # Pillar radius

my_pillars_instance = CircularPillars(N, R, H, PR, gap1, gap2)

OUT = my_pillars_instance.generate()
# ----------------------------------------
code_block_15 = CodeBlock { 0; }
pillars = List.GetItemAtIndex(list=instance_3, index=code_block_15)
code_block_16 = CodeBlock { 196; 164; 132; }
byARGB_4 = Color.ByARGB(red=code_block_16.out0, green=code_block_16.out1, blue=code_block_16.out2)
code_block_17 = CodeBlock { 0; 0; 0; }
byCoordinates_5 = Point.ByCoordinates(x=code_block_17.out0, y=code_block_17.out1, z=code_block_17.out2)
code_block_18 = CodeBlock { 0; 0; 150; }
border_height = DoubleSlider(866.1, range=0..1500 step 0.1)
byCoordinates_6 = Point.ByCoordinates(x=code_block_18.out0, y=code_block_18.out1, z=border_height)
code_block_19 = CodeBlock(Depth=depth) { Depth; inner = Depth - 250; inner; }
border_outer = Python()  # CPython3; unwired: IN[0]; same code as base
border_outer_2 = Python(IN[0]=byCoordinates_5, IN[1]=byCoordinates_6, IN[2]=code_block_19.out2, IN[3]=border_outer)  # CPython3; same code as instance_base
code_block_20 = CodeBlock { 0; 0; 0; }
byCoordinates_7 = Point.ByCoordinates(x=code_block_20.out0, y=code_block_20.out1, z=code_block_20.out2)
code_block_21 = CodeBlock { 0; 0; }
byCoordinates_8 = Point.ByCoordinates(x=code_block_21.out0, y=code_block_21.out1, z=border_height)
border_thickness = DoubleSlider(900, range=300..900 step 0.1)
code_block_22 = CodeBlock(Depth=depth, cut=border_thickness) { Depth; cut; inner = Depth - cut; inner; }
border_inner = Python()  # CPython3; unwired: IN[0]; same code as base
border_inner_2 = Python(IN[0]=byCoordinates_7, IN[1]=byCoordinates_8, IN[2]=code_block_22.out2, IN[3]=border_inner)  # CPython3; same code as instance_base
differenceAll = Solid.DifferenceAll(solid=border_outer_2, others=border_inner_2)
code_block_23 = CodeBlock { 2; 3; }
getItemAtIndex = List.GetItemAtIndex(list=instance_3, index=code_block_23.out1)
code_block_24 = CodeBlock { 20; }
getItemAtIndex_2 = List.GetItemAtIndex(list=getItemAtIndex, index=code_block_24)
getItemAtIndex_3 = List.GetItemAtIndex(list=instance_3, index=code_block_23.out0)
code_block_25 = CodeBlock { 0; }
getItemAtIndex_4 = List.GetItemAtIndex(list=getItemAtIndex_3, index=code_block_25)
byStartPointEndPoint = Line.ByStartPointEndPoint(startPoint=getItemAtIndex_2, endPoint=getItemAtIndex_4)
code_block_26 = CodeBlock { 0; }
getItemAtIndex_5 = List.GetItemAtIndex(list=getItemAtIndex, index=code_block_26)
code_block_27 = CodeBlock { 20; }
getItemAtIndex_6 = List.GetItemAtIndex(list=getItemAtIndex_3, index=code_block_27)
byStartPointEndPoint_2 = Line.ByStartPointEndPoint(startPoint=getItemAtIndex_5, endPoint=getItemAtIndex_6)
code_block_28 = CodeBlock { 10; }
getItemAtIndex_7 = List.GetItemAtIndex(list=getItemAtIndex_3, index=code_block_28)
byThreePoints = Arc.ByThreePoints(firstPoint=getItemAtIndex_6, secondPoint=getItemAtIndex_7, thirdPoint=getItemAtIndex_4)
code_block_29 = CodeBlock { 10; }
getItemAtIndex_8 = List.GetItemAtIndex(list=getItemAtIndex, index=code_block_29)
byThreePoints_2 = Arc.ByThreePoints(firstPoint=getItemAtIndex_2, secondPoint=getItemAtIndex_8, thirdPoint=getItemAtIndex_5)
list_create = List.Create(item0=byStartPointEndPoint, item1=byStartPointEndPoint_2, item2=byThreePoints, item3=byThreePoints_2)
byJoinedCurves = PolyCurve.ByJoinedCurves(curves=list_create)
extrudeAsSolid = Curve.ExtrudeAsSolid(curve=byJoinedCurves, distance=border_height)
border = Solid.DifferenceAll(solid=differenceAll, others=extrudeAsSolid)
code_block_30 = CodeBlock { 85; }
byARGB_5 = Color.ByARGB(red=code_block_30, green=code_block_30, blue=code_block_30)
code_block_31 = CodeBlock { 0; 0; 0; }
byCoordinates_9 = Point.ByCoordinates(x=code_block_31.out0, y=code_block_31.out1, z=code_block_31.out2)
XAxis = Vector.XAxis()
code_block_32 = CodeBlock { 1000; -1000; }
scale = Vector.Scale(vector=XAxis, scale_factor=code_block_32.out0)
top_middle_point = Geometry.Translate(geometry=byCoordinates_9, direction=scale)
XAxis_2 = Vector.XAxis()
scale_2 = Vector.Scale(vector=XAxis_2, scale_factor=code_block_32.out1)
bottom_middle_point = Geometry.Translate(geometry=byCoordinates_9, direction=scale_2)
code_block_33 = CodeBlock { width; thickness; width = 150; thickness = 40; }
python_script = Python()  # CPython3; unwired: IN[0]
# ---------- python_script.python (28 lines) ----------
from Autodesk.DesignScript.Geometry import Cuboid, Vector, Point

class RectPrism:
    def __init__(self, start_point, end_point, width, thickness):
        self.start = start_point
        self.end = end_point
        self.width = width
        self.thickness = thickness

    def make_geometry(self):
        axis_vec = Vector.ByTwoPoints(self.start, self.end)
        axis_dir = axis_vec.Normalized()

        up = Vector.ByCoordinates(0,0,1)
        if abs(axis_dir.Dot(up)) > 0.99:
            up = Vector.ByCoordinates(0,1,0)

        width_vec = axis_dir.Cross(up).Normalized().Scale(self.width / 2)
        thickness_vec = axis_dir.Cross(width_vec).Normalized().Scale(self.thickness / 2)

        corner1 = self.start.Add(width_vec).Add(thickness_vec)
        corner2 = self.end.Subtract(width_vec).Subtract(thickness_vec)

        prism = Cuboid.ByCorners(corner1, corner2)

        return prism

OUT = RectPrism
# ----------------------------------------
middle_wooden_plank = Python(IN[0]=top_middle_point, IN[1]=bottom_middle_point, IN[2]=code_block_33.out2, IN[3]=code_block_33.out3, IN[4]=python_script)  # CPython3
# ---------- middle_wooden_plank.python (3 lines) ----------
RectPrism = IN[4]
b = RectPrism(IN[0], IN[1], IN[2],IN[3])
OUT = b.make_geometry()
# ----------------------------------------
YAxis = Vector.YAxis()
code_block_34 = CodeBlock { 200; }
scale_3 = Vector.Scale(vector=YAxis, scale_factor=code_block_34)
left_wooden_plank_bottom_point = Geometry.Translate(geometry=top_middle_point, direction=scale_3)
YAxis_2 = Vector.YAxis()
scale_4 = Vector.Scale(vector=YAxis_2, scale_factor=code_block_34)
left_wooden_plank_top_point = Geometry.Translate(geometry=bottom_middle_point, direction=scale_4)
left_wooden_plank = Python(IN[0]=left_wooden_plank_bottom_point, IN[1]=left_wooden_plank_top_point, IN[2]=code_block_33.out2, IN[3]=code_block_33.out3, IN[4]=python_script)  # CPython3; same code as middle_wooden_plank
union = Solid.Union(solid=middle_wooden_plank, solid_2=left_wooden_plank)
YAxis_3 = Vector.YAxis()
code_block_35 = CodeBlock { -200; }
scale_5 = Vector.Scale(vector=YAxis_3, scale_factor=code_block_35)
right_wooden_plank_bottom_point = Geometry.Translate(geometry=top_middle_point, direction=scale_5)
YAxis_4 = Vector.YAxis()
scale_6 = Vector.Scale(vector=YAxis_4, scale_factor=code_block_35)
right_wooden_plank_top_point = Geometry.Translate(geometry=bottom_middle_point, direction=scale_6)
right_wooden_plank = Python(IN[0]=right_wooden_plank_bottom_point, IN[1]=right_wooden_plank_top_point, IN[2]=code_block_33.out2, IN[3]=code_block_33.out3, IN[4]=python_script)  # CPython3; same code as middle_wooden_plank
code_block_36 = CodeBlock { width; thickness; width = 100; thickness = 100; }
left_fix = Python(IN[0]=left_wooden_plank_bottom_point, IN[1]=right_wooden_plank_bottom_point, IN[2]=code_block_36.out2, IN[3]=code_block_36.out3, IN[4]=python_script)  # CPython3; same code as middle_wooden_plank
union_2 = Solid.Union(solid=right_wooden_plank, solid_2=left_fix)
union_3 = Solid.Union(solid=union, solid_2=union_2)
right_fix = Python(IN[0]=right_wooden_plank_top_point, IN[1]=left_wooden_plank_top_point, IN[2]=code_block_36.out2, IN[3]=code_block_36.out3, IN[4]=python_script)  # CPython3; same code as middle_wooden_plank
union_4 = Solid.Union(solid=union_3, solid_2=right_fix)
ZAxis = Vector.ZAxis()
code_block_37 = CodeBlock { 600; }
scale_7 = Vector.Scale(vector=ZAxis, scale_factor=code_block_37)
base_2 = Geometry.Translate(geometry=union_4, direction=scale_7)
ZAxis_2 = Vector.ZAxis()
code_block_38 = CodeBlock { 150; }
scale_8 = Vector.Scale(vector=ZAxis_2, scale_factor=code_block_38)
translate = Geometry.Translate(geometry=right_wooden_plank_top_point, direction=scale_8)
ZAxis_3 = Vector.ZAxis()
code_block_39 = CodeBlock { 600; }
scale_9 = Vector.Scale(vector=ZAxis_3, scale_factor=code_block_39)
translate_2 = Geometry.Translate(geometry=right_wooden_plank_top_point, direction=scale_9)
code_block_40 = CodeBlock { 100; 90; }
python_script_2 = Python()  # CPython3; unwired: IN[0]; same code as python_script
leg = Python(IN[0]=translate, IN[1]=translate_2, IN[2]=code_block_40.out1, IN[3]=code_block_40.out0, IN[4]=python_script_2)  # CPython3; same code as middle_wooden_plank
YAxis_5 = Vector.YAxis()
code_block_41 = CodeBlock { 400; }
scale_10 = Vector.Scale(vector=YAxis_5, scale_factor=code_block_41)
leg_2 = Geometry.Translate(geometry=leg, direction=scale_10)
union_5 = Solid.Union(solid=leg, solid_2=leg_2)
XAxis_3 = Vector.XAxis()
code_block_42 = CodeBlock { 2000; }
scale_11 = Vector.Scale(vector=XAxis_3, scale_factor=code_block_42)
leg_3_and_4 = Geometry.Translate(geometry=union_5, direction=scale_11)
legs = Solid.Union(solid=union_5, solid_2=leg_3_and_4)
frame_of_bench = Solid.Union(solid=base_2, solid_2=legs)
ZAxis_4 = Vector.ZAxis()
code_block_43 = CodeBlock { 450; }
scale_12 = Vector.Scale(vector=ZAxis_4, scale_factor=code_block_43)
translate_3 = Geometry.Translate(geometry=right_wooden_plank_top_point, direction=scale_12)
YAxis_6 = Vector.YAxis()
code_block_44 = CodeBlock { 400; }
scale_13 = Vector.Scale(vector=YAxis_6, scale_factor=code_block_44)
translate_4 = Geometry.Translate(geometry=translate_3, direction=scale_13)
code_block_45 = CodeBlock { 59; }
python_script_3 = Python()  # CPython3; unwired: IN[0]; same code as python_script
vertical_bar = Python(IN[0]=translate_3, IN[1]=translate_4, IN[2]=code_block_45, IN[3]=code_block_45, IN[4]=python_script_3)  # CPython3; same code as middle_wooden_plank
XAxis_4 = Vector.XAxis()
code_block_46 = CodeBlock { 2000; }
scale_14 = Vector.Scale(vector=XAxis_4, scale_factor=code_block_46)
translate_5 = Geometry.Translate(geometry=translate_3, direction=scale_14)
YAxis_7 = Vector.YAxis()
code_block_47 = CodeBlock { 400; }
scale_15 = Vector.Scale(vector=YAxis_7, scale_factor=code_block_47)
translate_6 = Geometry.Translate(geometry=translate_5, direction=scale_15)
horizontal_bar = Python(IN[0]=translate_4, IN[1]=translate_6, IN[2]=code_block_45, IN[3]=code_block_45, IN[4]=python_script_3)  # CPython3; same code as middle_wooden_plank
union_6 = Solid.Union(solid=vertical_bar, solid_2=horizontal_bar)
horizontal_bar_2 = Python(IN[0]=translate_3, IN[1]=translate_5, IN[2]=code_block_45, IN[3]=code_block_45, IN[4]=python_script_3)  # CPython3; same code as middle_wooden_plank
vertical_bar_2 = Python(IN[0]=translate_6, IN[1]=translate_5, IN[2]=code_block_45, IN[3]=code_block_45, IN[4]=python_script_3)  # CPython3; same code as middle_wooden_plank
union_7 = Solid.Union(solid=horizontal_bar_2, solid_2=vertical_bar_2)
union_8 = Solid.Union(solid=union_6, solid_2=union_7)
bench = Solid.Union(solid=frame_of_bench, solid_2=union_8)
code_block_48 = CodeBlock { 0; 0; 0; }
byCoordinates_10 = Point.ByCoordinates(x=code_block_48.out0, y=code_block_48.out1, z=code_block_48.out2)
byCenterPointRadius = Circle.ByCenterPointRadius(centerPoint=byCoordinates_10, radius=code_block_22.out2)
code_block_49 = CodeBlock { 100; }
pointsAtEqualSegmentLength = Curve.PointsAtEqualSegmentLength(curve=byCenterPointRadius, divisions=code_block_49)
code_block_50 = CodeBlock { 25; }
getItemAtIndex_9 = List.GetItemAtIndex(list=pointsAtEqualSegmentLength, index=code_block_50)
code_block_51 = CodeBlock { -50; -900; 0; }
byCoordinates_11 = Vector.ByCoordinates(x=code_block_51.out0, y=code_block_51.out1, z=code_block_51.out2)
add = Point.Add(point=getItemAtIndex_9, vectorToAdd=byCoordinates_11)
byTwoPoints = Vector.ByTwoPoints(start=byCoordinates_9, end=add)
bench_1 = Geometry.Translate(geometry=bench, direction=byTwoPoints)
code_block_52 = CodeBlock { 196; 164; 132; }
byARGB_6 = Color.ByARGB(red=code_block_52.out0, green=code_block_52.out1, blue=code_block_52.out2)
code_block_53 = CodeBlock { 0; 0; 0; }
byCoordinates_12 = Point.ByCoordinates(x=code_block_53.out0, y=code_block_53.out1, z=code_block_53.out2)
ZAxis_5 = Vector.ZAxis()
code_block_54 = CodeBlock { 59.4; }
rotate = Geometry.Rotate(geometry=bench_1, origin=byCoordinates_12, axis=ZAxis_5, degrees=code_block_54)
code_block_55 = CodeBlock { 70; 150; }
bench_2 = Geometry.Translate(geometry=rotate, xTranslation=code_block_55.out0, yTranslation=code_block_55.out1)
code_block_56 = CodeBlock { 196; 164; 132; }
byARGB_7 = Color.ByARGB(red=code_block_56.out0, green=code_block_56.out1, blue=code_block_56.out2)
ZAxis_6 = Vector.ZAxis()
code_block_57 = CodeBlock { 131.9; }
rotate_2 = Geometry.Rotate(geometry=bench_2, origin=byCoordinates_12, axis=ZAxis_6, degrees=code_block_57)
code_block_58 = CodeBlock { -100; 0; }
bench_3 = Geometry.Translate(geometry=rotate_2, xTranslation=code_block_58.out0, yTranslation=code_block_58.out1)
code_block_59 = CodeBlock { 196; 164; 132; }
byARGB_8 = Color.ByARGB(red=code_block_59.out0, green=code_block_59.out1, blue=code_block_59.out2)
ZAxis_7 = Vector.ZAxis()
code_block_60 = CodeBlock { 55.2; }
rotate_3 = Geometry.Rotate(geometry=bench_3, origin=byCoordinates_12, axis=ZAxis_7, degrees=code_block_60)
code_block_61 = CodeBlock { 100; -200; }
bench_4 = Geometry.Translate(geometry=rotate_3, xTranslation=code_block_61.out0, yTranslation=code_block_61.out1)
code_block_62 = CodeBlock { 196; 164; 132; }
byARGB_9 = Color.ByARGB(red=code_block_62.out0, green=code_block_62.out1, blue=code_block_62.out2)
code_block_63 = CodeBlock { 255; 185; }
byARGB_10 = Color.ByARGB(alpha=code_block_63.out1, red=code_block_63.out0, green=code_block_63.out0, blue=code_block_63.out0)

# group: Materials
aluminum_outer_roof = Modifiers.GeometryColor.ByGeometryColor(geometry=outer_roof, color=byARGB_2)
concrete_base = Modifiers.GeometryColor.ByGeometryColor(geometry=instance_base, color=byARGB_3)
oak_wood_pillars = Modifiers.GeometryColor.ByGeometryColor(geometry=pillars, color=byARGB_4)
dark_concrete_border = Modifiers.GeometryColor.ByGeometryColor(geometry=border, color=byARGB_5)
oak_wood_bench = Modifiers.GeometryColor.ByGeometryColor(geometry=bench_1, color=byARGB_6)
oak_wood_bench_2 = Modifiers.GeometryColor.ByGeometryColor(geometry=bench_2, color=byARGB_7)
oak_wood_bench_3 = Modifiers.GeometryColor.ByGeometryColor(geometry=bench_3, color=byARGB_8)
oak_wood_bench_4 = Modifiers.GeometryColor.ByGeometryColor(geometry=bench_4, color=byARGB_9)
gray_stained_glass_inner_roof = Modifiers.GeometryColor.ByGeometryColor(geometry=inner_roof, color=byARGB_10)

volume = Solid.Volume(solid=bench_4)
volume_2 = Solid.Volume(solid=border)
volume_3 = Solid.Volume(solid=pillars)
code_block_64 = CodeBlock { 0; }
getItemAtIndex_10 = List.GetItemAtIndex(list=volume_3, index=code_block_64)
volume_4 = Solid.Volume(solid=outer_roof)
volume_5 = Solid.Volume(solid=inner_roof)
volume_6 = Solid.Volume(solid=whole_roof)
volume_7 = Solid.Volume(solid=instance_base)
code_block_65 = CodeBlock(Bench_Volume=volume) { Bench_Volume; Total_Bench_Volume = 4*Bench_Volume; Total_Bench_Volume; }
sum = Math.Sum(values=volume_3)

# group: Volumes
one_bench_volume_oak_wood_mm_2 = Watch(volume)
dark_concrete_volume_border_mm_2 = Watch(volume_2)
one_pillar_volume_oak_wood_mm_2 = Watch(getItemAtIndex_10)
aluminum_volume_outer_roof_mm_2 = Watch(volume_4)
gray_stained_glass_volume_inner = Watch(volume_5)  # "Gray stained glass Volume (Inner Roof, mm^2)"
whole_roof_volume = Watch(volume_6)
base_concrete_volume_base_mm_2 = Watch(volume_7)
total_bench_volume_oak_wood_mm_2 = Watch(code_block_65.out2)
total_pillars_volume_oak_wood_mm = Watch(sum)  # "Total Pillars Volume (oak wood, mm^2)"
code_block_66 = CodeBlock(Total_Bench_Volume=total_bench_volume_oak_wood_mm_2, Total_Pillars_Volume=total_pillars_volume_oak_wood_mm) { Total_Bench_Volume; Total_Pillars_Volume; Total_Oak_Wood_Volume = Total_Bench_Volume + Total_Pillars_Volume; }
total_oak_wood_volume_mm_2 = Watch(code_block_66.Total_Oak_Wood_Volume)
