# Dynamo graph 1852566.dyn (Dynamo 3.3.0.6316)

code_block = CodeBlock { 0; 0; 0; }
seat_height = DoubleSlider(450, range=350..550 step 10)
byCoordinates = Point.ByCoordinates(x=code_block.out0, y=code_block.out1, z=seat_height)
code_block_2 = CodeBlock { 1000; }
byCenterPointRadius = Circle.ByCenterPointRadius(centerPoint=byCoordinates, radius=code_block_2)
code_block_3 = CodeBlock { 27; }
code_block_4 = CodeBlock(N=code_block_3) { t = 0..1..#N; }
pointAtParameter = Curve.PointAtParameter(curve=byCenterPointRadius, param=code_block_4)
byCoordinates_2 = Point.ByCoordinates()
code_block_5 = CodeBlock { 75; true; }
byCenterPointRadius_2 = Circle.ByCenterPointRadius(centerPoint=byCoordinates_2, radius=code_block_5.out0)
code_block_6 = CodeBlock(SeatHeight=seat_height) { 0; 0; SeatHeight; }
byCoordinates_3 = Point.ByCoordinates(x=code_block_6.out0, y=code_block_6.out1, z=code_block_6.SeatHeight)
code_block_7 = CodeBlock { 1095; }
byCenterPointRadius_3 = Circle.ByCenterPointRadius(centerPoint=byCoordinates_3, radius=code_block_7)
code_block_8 = CodeBlock { t = 0..0.8..#5; 1750; }
pointAtParameter_2 = Curve.PointAtParameter(curve=byCenterPointRadius_3, param=code_block_8.t)
roof_height = DoubleSlider(4250, range=3500..5000 step 10)
code_block_9 = CodeBlock(CanopyHeight=roof_height, SeatHeight=seat_height) { ((CanopyHeight - SeatHeight)/2); }
code_block_10 = CodeBlock(pillarBasePoints=pointAtParameter_2, MidHeight=code_block_9) { pillarBasePoints.X * 0.63; pillarBasePoints.Y * 0.63; MidHeight; }
byCoordinates_4 = Point.ByCoordinates(x=code_block_10.out0, y=code_block_10.out1, z=code_block_10.MidHeight)
roof_peak_height = DoubleSlider(500, range=400..1000 step 10)
code_block_11 = CodeBlock(CanopyHeight=roof_height, RoofAmplitude=roof_peak_height) { 0; 0; CanopyHeight*1.0458 + RoofAmplitude*0.568+ -55; }
byCoordinates_5 = Point.ByCoordinates(x=code_block_11.out0, y=code_block_11.out1, z=code_block_11.out2)
byCenterPointRadius_4 = Circle.ByCenterPointRadius(centerPoint=byCoordinates_5, radius=code_block_8.out1)
code_block_12 = CodeBlock { t = 0..0.8..#5; }
rods_twist = DoubleSlider(0.4, range=0..0.4 step 0.01)
code_block_13 = CodeBlock(t=code_block_12, TwistFraction=rods_twist) { tTop = t + TwistFraction; }
pointAtParameter_3 = Curve.PointAtParameter(curve=byCenterPointRadius_4, param=code_block_13)
list_create = List.Create(item0=pointAtParameter_2, item1=byCoordinates_4, item2=pointAtParameter_3)
transpose = List.Transpose(lists=list_create)
code_block_14 = CodeBlock { 3; }
piller_curves = NurbsCurve.ByPoints(points=transpose, degree=code_block_14)
startPoint = Curve.StartPoint(curve=piller_curves)
code_block_15 = CodeBlock { 104; }
byCenterPointRadius_5 = Circle.ByCenterPointRadius(centerPoint=startPoint, radius=code_block_15)
piller_profiles = Surface.ByPatch(closedCurve=byCenterPointRadius_5)
firstItem = List.FirstItem(list=byCenterPointRadius_5)
single_rod = List.FirstItem(list=piller_curves)
single_rod_2 = Solid.BySweep(profile=firstItem, path=single_rod)
watch = Watch(single_rod_2)
class_circular_steel_rod = Python(IN[0]=watch)  # CPython3
# ---------- class_circular_steel_rod.python (45 lines) ----------
import clr
clr.AddReference('ProtoGeometry')
from Autodesk.DesignScript.Geometry import *

class CircularSteelRod:
    """
    CircularSteelRod class

    Represents one steel pillar (rod) in the pavilion.

    Responsibilities:
    - Store a single solid representing the rod geometry.
    - Provide methods to get geometry and volume.
    """

    def __init__(self, solid):
        """
        Constructor.

        Parameters:
        - solid: a single solid for the pillar.
        """
        self.solid = solid

    def geometry(self):
        """
        Return the rod solid.
        """
        return self.solid

    def volume(self):
        """
        Return the rod volume (mm³).

        If volume cannot be computed, returns 0.0.
        """
        if self.solid is None:
            return 0.0
        try:
            return self.solid.Volume
        except:
            return 0.0


OUT = CircularSteelRod
# ----------------------------------------
rods = Solid.BySweep(profile=byCenterPointRadius_5, path=piller_curves)
rodSolids = Watch(rods)
series_of_instances_of_circular = Python(IN[0]=class_circular_steel_rod, IN[1]=rodSolids)  # "series of instances of circular steel rods"; CPython3
# ---------- series_of_instances_of_circular.python (42 lines) ----------
import clr
clr.AddReference('ProtoGeometry')
from Autodesk.DesignScript.Geometry import *

# IN[0] = CircularSteelRod class
# IN[1] = list of pillar solids

CircularSteelRod = IN[0]
pillar_solids_in = IN[1]

# Make sure we always work with a list
if pillar_solids_in is None:
    pillar_solids = []
elif isinstance(pillar_solids_in, list):
    pillar_solids = [s for s in pillar_solids_in if s is not None]
else:
    pillar_solids = [pillar_solids_in]

# Create one instance per pillar
rod_instances = []
rod_geometries = []
rod_volumes = []

for s in pillar_solids:
    rod = CircularSteelRod(s)
    rod_instances.append(rod)
    rod_geometries.append(rod.geometry())
    rod_volumes.append(rod.volume())

total_volume = sum(rod_volumes)

unit = "mm³"
volume_labels = ["{0:.2f} {1}".format(v, unit) for v in rod_volumes]
total_volume_label = "{0:.2f} {1}".format(total_volume, unit)

OUT = (
    rod_geometries,     # 0: solids
    rod_volumes,        # 1: numeric volumes per pillar
    volume_labels,      # 2: "xx mm³" per pillar
    total_volume,       # 3: total numeric
    total_volume_label  # 4: "xx mm³" total
)
# ----------------------------------------
steel_pillars_volume = Watch(series_of_instances_of_circular)
code_block_16 = CodeBlock { 16; 46; }
code_block_17 = CodeBlock(NTheta=code_block_16.out1) { -45; 15; 220; 4500; thetaDeg = 0..360..#NTheta; }
radii = CodeBlock(RoofRadius=code_block_17.out3, NRad=code_block_16.out0) { r = 0..RoofRadius..#NRad; }
roof_base_height = CodeBlock(HubHeight=roof_height) { HubHeight; HubHeight+165; }
roof_radius = DoubleSlider(4350, range=3750..5000 step 10)
code_block_18 = CodeBlock(r=radii, thetaRad=code_block_17.thetaDeg, RoofBaseHeight=roof_base_height.HubHeight, RoofAmpRadial=roof_peak_height, RoofRadius=roof_radius, RoofAmpAngular=code_block_17.out0, RoofWaves=code_block_17.out1, RoofTilt=code_block_17.out2)
# ---------- code_block_18.designscript (17 lines) ----------
ptsRoof =
    Point.ByCoordinates(
        r<1> * Math.Cos(thetaRad<2>),
        r<1> * Math.Sin(thetaRad<2>),

        RoofBaseHeight
      // very gentle dome – almost flat
      + RoofAmpRadial * (1 - (r<1>/RoofRadius))

      // broad, flat waves that are strongest near the edge
      + RoofAmpAngular
        * (0.3 + 0.7 * (r<1>/RoofRadius))     // 30% in centre, 100% at rim
        * Math.Sin(RoofWaves * thetaRad<2>)

      // small overall tilt
      + RoofTilt * (r<1>/RoofRadius) * Math.Cos(thetaRad<2>)
    );
# ----------------------------------------
transpose_2 = List.Transpose(lists=code_block_18, lacing=CrossProduct)
byPoints = NurbsSurface.ByPoints(points=transpose_2)
code_block_19 = CodeBlock(r=radii, thetaRad=code_block_17.thetaDeg, RoofBaseHeight=roof_base_height.out1, RoofAmpRadial=roof_peak_height, RoofRadius=roof_radius, RoofAmpAngular=code_block_17.out0, RoofWaves=code_block_17.out1, RoofTilt=code_block_17.out2)  # same code as code_block_18
transpose_3 = List.Transpose(lists=code_block_19, lacing=CrossProduct)
byPoints_2 = NurbsSurface.ByPoints(points=transpose_3)
perimeterCurves = Surface.PerimeterCurves(surface=byPoints_2)
code_block_20 = CodeBlock { 1; }
getItemAtIndex = List.GetItemAtIndex(list=perimeterCurves, index=code_block_20)
perimeterCurves_2 = Surface.PerimeterCurves(surface=byPoints)
getItemAtIndex_2 = List.GetItemAtIndex(list=perimeterCurves_2, index=code_block_20)
list_create_2 = List.Create(item0=getItemAtIndex, item1=getItemAtIndex_2)
byLoft = Surface.ByLoft(crossSections=list_create_2)
list_create_3 = List.Create(item0=byPoints, item1=byPoints_2, item2=byLoft)
roof = Solid.ByJoinedSurfaces(facesOfSolid=list_create_3)
roofSolid = Watch(roof)
class_glulam_roof_shell = Python(canopySolid=roofSolid)  # CPython3
# ---------- class_glulam_roof_shell.python (42 lines) ----------
import clr
clr.AddReference('ProtoGeometry')
from Autodesk.DesignScript.Geometry import *

class GlulamRoofShell:
    """
    GlulamRoofShell class

    Represents the timber / glulam roof shell of the pavilion.

    - Stores a single roof solid.
    - Computes volume.
    """

    def __init__(self, roof_solid):
        """
        Constructor.

        Parameters:
        - roof_solid: single solid for the roof shell.
        """
        self.roof_solid = roof_solid

    def geometry(self):
        """
        Return the roof solid.
        """
        return self.roof_solid

    def volume(self):
        """
        Return roof volume (mm³) or 0.0 if it fails.
        """
        if self.roof_solid is None:
            return 0.0
        try:
            return self.roof_solid.Volume
        except:
            return 0.0


OUT = GlulamRoofShell
# ----------------------------------------
instance_of_a_glulam_roof_shell = Python(IN[0]=class_glulam_roof_shell, IN[1]=roofSolid)  # CPython3
# ---------- instance_of_a_glulam_roof_shell.python (23 lines) ----------
import clr
clr.AddReference('ProtoGeometry')
from Autodesk.DesignScript.Geometry import *

# IN[0] = GlulamRoofShell class
# IN[1] = roof solid

GlulamRoofShell = IN[0]
roof_solid_in = IN[1]

roof_obj = GlulamRoofShell(roof_solid_in)

roof_geom = roof_obj.geometry()
roof_volume = roof_obj.volume()

unit = "mm³"
roof_volume_label = "{0:.2f} {1}".format(roof_volume, unit)

OUT = (
    roof_geom,         # 0
    roof_volume,       # 1
    roof_volume_label  # 2
)
# ----------------------------------------
gulam_roof_volume = Watch(instance_of_a_glulam_roof_shell)

# group: Surface Boundry
code_block_21 = CodeBlock { -5000; -5000; -200; }
byCoordinates_6 = Point.ByCoordinates(x=code_block_21.out0, y=code_block_21.out1, z=code_block_21.out2)
code_block_22 = CodeBlock { 5000; 5000; 0; }
byCoordinates_7 = Point.ByCoordinates(x=code_block_22.out0, y=code_block_22.out1, z=code_block_22.out2)
byCorners = Cuboid.ByCorners(lowPoint=byCoordinates_6, highPoint=byCoordinates_7)
code_block_23 = CodeBlock { 0; 100; 0; }
byARGB = Color.ByARGB(red=code_block_23.out0, green=code_block_23.out1, blue=code_block_23.out2)
byGeometryColor = Modifiers.GeometryColor.ByGeometryColor(geometry=byCorners, color=byARGB)

code_block_24 = CodeBlock { 1; }
code_block_25 = CodeBlock(n=code_block_24) { (Math.PI * -58); Math.PI * 58; (Math.PI * 2) / n; }
range = Range(start=code_block_25.out0, end=code_block_25.out1, step=code_block_25.out2)
code_block_26 = CodeBlock(theta=range) { r = 2000 + (1000.0 / 3.0) * Math.Cos(5 * theta); }
code_block_27 = CodeBlock(r=code_block_26, theta=range) { x = r * Math.Cos(theta); y = r * Math.Sin(theta); z = 0; }
byCoordinates_8 = Point.ByCoordinates(x=code_block_27.x, y=code_block_27.y, z=code_block_27.z)
code_block_28 = CodeBlock { true; }
byPoints_3 = NurbsCurve.ByPoints(points=byCoordinates_8, closeCurve=code_block_28)
code_block_29 = CodeBlock(SeatHeight=seat_height) { SeatHeight; }
code_block_30 = CodeBlock(x=code_block_27.x, y=code_block_27.y, SeatHeight=code_block_29) { ptsTop = Point.ByCoordinates(x, y, SeatHeight); }
byPoints_4 = NurbsCurve.ByPoints(points=code_block_30, closeCurve=code_block_28)
list_create_4 = List.Create(item0=byPoints_3, item1=byPoints_4)
byLoft_2 = Solid.ByLoft(crossSections=list_create_4)
byCoordinates_9 = Point.ByCoordinates(x=code_block.out0, y=code_block.out1, z=code_block.out2)
byCenterPointRadius_6 = Circle.ByCenterPointRadius(centerPoint=byCoordinates_9, radius=code_block_2)
list_create_5 = List.Create(item0=byCenterPointRadius_6, item1=byCenterPointRadius)
byLoft_3 = Solid.ByLoft(crossSections=list_create_5)
base = Solid.Difference(solid=byLoft_2, other=byLoft_3)
code_block_31 = CodeBlock(x=code_block_27.x, y=code_block_27.y, SeatHeight=code_block_29) { ptsTop = Point.ByCoordinates(x*1.008, y*1.008, SeatHeight-72); }
byPoints_5 = NurbsCurve.ByPoints(points=code_block_31, closeCurve=code_block_5.out1)
code_block_32 = CodeBlock { 0..1..#20; }
coordinateSystemAtParameter = Curve.CoordinateSystemAtParameter(curve=byPoints_5, param=code_block_32)
ZXPlane = CoordinateSystem.ZXPlane(coordinateSystem=coordinateSystemAtParameter)
byPlaneRadius = Circle.ByPlaneRadius(plane=ZXPlane, radius=code_block_5.out0)
base_rim = Solid.BySweep(profile=byPlaneRadius, path=byPoints_5, lacing=Shortest)
identity = CoordinateSystem.Identity()
code_block_33 = CodeBlock(SeatHeight=seat_height) { 1000; 0.75*SeatHeight; }
pot_base = Cylinder.ByRadiusHeight(coordinateSystem=identity, radius=code_block_33.out0, height=code_block_33.out1)
seat_assembly = List.Create(item0=base, item1=base_rim, item2=pot_base)
seat = Solid.ByUnion(solids=seat_assembly)
seatSolid = Watch(seat)
class_concrete_seat_assembly = Python(seatSolid=seatSolid)  # CPython3
# ---------- class_concrete_seat_assembly.python (76 lines) ----------
import clr
clr.AddReference('ProtoGeometry')
from Autodesk.DesignScript.Geometry import *

class ConcreteSeatAssembly:
    """
    ConcreteSeatAssembly class

    Represents the seating base made of concrete.

    Simple idea:
    - We receive one or more solids that represent the seat geometry.
    - We provide methods to:
        * return the solids
        * compute individual volumes
        * compute total volume
    - Volumes are reported in model units (assumed mm³).
    """

    def __init__(self, seat_solids):
        """
        Constructor.

        Parameters:
        - seat_solids:
            A single solid or a list of solids representing the seat.
        """

        # Make sure we always store a list of solids internally.
        if seat_solids is None:
            self.seat_solids = []
        elif isinstance(seat_solids, list):
            self.seat_solids = [s for s in seat_solids if s is not None]
        else:
            self.seat_solids = [seat_solids]

    # --------------------------------------------------------------
    # Geometry access
    # --------------------------------------------------------------

    def solids(self):
        """
        Return the list of solids for this seat.
        """
        return self.seat_solids

    # --------------------------------------------------------------
    # Volume calculations
    # --------------------------------------------------------------

    def volumes(self):
        """
        Return a list of numeric volumes (one per solid).

        If a volume cannot be computed, 0.0 is used instead.
        """
        vols = []
        for s in self.seat_solids:
            if s is None:
                vols.append(0.0)
            else:
                try:
                    vols.append(s.Volume)
                except:
                    vols.append(0.0)
        return vols

    def total_volume(self):
        """
        Return total volume of all seat solids.
        """
        return sum(self.volumes())


# The class node outputs only the class type, like Slice5 example.
OUT = ConcreteSeatAssembly
# ----------------------------------------
instance_of_a_concrete_seat = Python(Class=class_concrete_seat_assembly, Instance=seat)  # "instance of a concrete seat assembly"; CPython3
# ---------- instance_of_a_concrete_seat.python (33 lines) ----------
import clr
clr.AddReference('ProtoGeometry')
from Autodesk.DesignScript.Geometry import *

# IN[0] = ConcreteSeatAssembly class
# IN[1] = seat solids (single solid or list of solids)

ConcreteSeatAssembly = IN[0]
seat_solids_in = IN[1]

# Instantiate the seat object
seat_obj = ConcreteSeatAssembly(seat_solids_in)

# Geometry
seat_solids = seat_obj.solids()

# Volumes (numeric)
volumes = seat_obj.volumes()
total_volume = seat_obj.total_volume()

# Unit strings (assume mm³)
unit = "mm³"

volume_labels = ["{0:.2f} {1}".format(v, unit) for v in volumes]
total_volume_label = "{0:.2f} {1}".format(total_volume, unit)

OUT = (
    seat_solids,        # 0
    volumes,            # 1
    volume_labels,      # 2
    total_volume,       # 3
    total_volume_label  # 4
)
# ----------------------------------------
concrete_seat_volume = Watch(instance_of_a_concrete_seat)
