# Dynamo graph 1852572.dyn (Dynamo 3.6.0.9395)

# group: Don't touch this ground
code_block = CodeBlock { -5000; -5000; -200; }
byCoordinates = Point.ByCoordinates(x=code_block.out0, y=code_block.out1, z=code_block.out2)
code_block_2 = CodeBlock { 5000; 5000; 0; }
byCoordinates_2 = Point.ByCoordinates(x=code_block_2.out0, y=code_block_2.out1, z=code_block_2.out2)
byCorners = Cuboid.ByCorners(lowPoint=byCoordinates, highPoint=byCoordinates_2)
code_block_3 = CodeBlock { 0; 100; 0; }
byARGB = Color.ByARGB(red=code_block_3.out0, green=code_block_3.out1, blue=code_block_3.out2)
byGeometryColor = Modifiers.GeometryColor.ByGeometryColor(geometry=byCorners, color=byARGB)

code_block_4 = CodeBlock { 0; 0; }
columnHeight = DoubleSlider(2000, range=2000..3500 step 0.1)
byCoordinates_3 = Point.ByCoordinates(x=code_block_4.out0, y=code_block_4.out1, z=columnHeight)
roofSize = DoubleSlider(1500, range=800..1500 step 0.1)
byCenterPointRadius = Sphere.ByCenterPointRadius(centerPoint=byCoordinates_3, radius=roofSize)
code_block_5 = CodeBlock(RoofSize=roofSize, ColumnHeight=columnHeight)
# ---------- code_block_5.designscript (4 lines) ----------
ear1 = Point.ByCoordinates(RoofSize, RoofSize*0.5, ColumnHeight+RoofSize*0.7);
ear2 = Point.ByCoordinates(-RoofSize, RoofSize*0.5, ColumnHeight+RoofSize*0.7);
sphere1 = Sphere.ByCenterPointRadius(ear1, RoofSize*0.4);
sphere2 = Sphere.ByCenterPointRadius(ear2, RoofSize*0.4);
# ----------------------------------------
code_block_6 = CodeBlock { 10; }
steelPanel = Python(IN[0]=roofSize, IN[1]=code_block_6)  # CPython3
# ---------- steelPanel.python (15 lines) ----------
import clr
clr.AddReference('ProtoGeometry')
from Autodesk.DesignScript.Geometry import *

class SteelPanel:
    def __init__(self, radius, thickness):
        self.radius = radius
        self.thickness = thickness
        self.volume = (4/3) * 3.14159 * (radius * radius * radius)
    
    def get_volume(self):
        return self.volume

panel = SteelPanel(IN[0], IN[1])
OUT = panel
# ----------------------------------------
steal_volume = Watch(steelPanel)
code_block_7 = CodeBlock { 100; }
timberBeam = Python(IN[0]=columnHeight, IN[1]=code_block_7)  # CPython3
# ---------- timberBeam.python (15 lines) ----------
import clr
clr.AddReference('ProtoGeometry')
from Autodesk.DesignScript.Geometry import *

class TimberBeam:
    def __init__(self, length, radius):
        self.length = length
        self.radius = radius
        self.volume = 3.14159 * (radius * radius) * length
    
    def get_volume(self):
        return self.volume

beam = TimberBeam(IN[0], IN[1])
OUT = beam
# ----------------------------------------
timber_volume = Watch(timberBeam)
code_block_8 = CodeBlock(RoofSize=roofSize, ColumnHeight=columnHeight)
# ---------- code_block_8.designscript (3 lines) ----------
// Bear nose
nosePoint = Point.ByCoordinates(0, -RoofSize*0.8, ColumnHeight);
nose = Sphere.ByCenterPointRadius(nosePoint, RoofSize*0.2);
# ----------------------------------------
byThreePoints = Arc.ByThreePoints()  # unwired: firstPoint, secondPoint, thirdPoint
code_block_9 = CodeBlock { 0; 0; 0; }
byCoordinates_4 = Point.ByCoordinates(x=code_block_9.out0, y=code_block_9.out1, z=code_block_9.out2)
pawRadius = DoubleSlider(4000, range=2000..4000 step 0.1)
byCenterPointRadius_2 = Circle.ByCenterPointRadius(centerPoint=byCoordinates_4, radius=pawRadius)
numColumns = DoubleSlider(5, range=4..8 step 1)
code_block_10 = CodeBlock(NumColumns=numColumns) { 0..1..#NumColumns+1; }
pointAtParameter = Curve.PointAtParameter(curve=byCenterPointRadius_2, param=code_block_10)
code_block_11 = CodeBlock { 100; }
byPointsRadius = Cylinder.ByPointsRadius(startPoint=pointAtParameter, endPoint=byCoordinates_3, radius=code_block_11)
byPatch = Surface.ByPatch(closedCurve=byCenterPointRadius_2)
thicken = Surface.Thicken(surface=byPatch, thickness=code_block_11)
code_block_12 = CodeBlock { 80; }
byPointsRadius_2 = Cylinder.ByPointsRadius(radius=code_block_12)
