# Dynamo graph 1852738.dyn (Dynamo 3.6.0.9395)

# group: Don't touch this ground
code_block = CodeBlock { -5000; -5000; -200; }
byCoordinates = Point.ByCoordinates(x=code_block.out0, y=code_block.out1, z=code_block.out2)
code_block_2 = CodeBlock { 5000; 5000; 0; }
byCoordinates_2 = Point.ByCoordinates(x=code_block_2.out0, y=code_block_2.out1, z=code_block_2.out2)
byCorners = Cuboid.ByCorners(lowPoint=byCoordinates, highPoint=byCoordinates_2)
code_block_3 = CodeBlock { 0; 100; 0; }
byARGB = Color.ByARGB(red=code_block_3.out0, green=code_block_3.out1, blue=code_block_3.out2)
byGeometryColor = Modifiers.GeometryColor.ByGeometryColor(geometry=byCorners, color=byARGB)

class_TimberMember = Python()  # CPython3; unwired: IN[0]
# ---------- class_TimberMember.python (39 lines) ----------
import clr
clr.AddReference('ProtoGeometry')
from Autodesk.DesignScript.Geometry import *
import math

class TimberMember:
    def __init__(self, centerline, thickness):
        if centerline is None:
            raise ValueError("TimberMember: centerline is None")
        self.centerline = centerline
        self.thickness = thickness  # diameter

    def geometry(self):
        return self.centerline

    def length(self):
        try:
            return self.centerline.Length
        except:
            # if something is wrong with the curve, treat length as 0
            return 0.0

    def solid(self):
        r = self.thickness / 2.0
        try:
            start_pt = self.centerline.StartPoint
            profile = Circle.ByCenterPointRadius(start_pt, r)
            return Solid.BySweep(profile, self.centerline)
        except:
            # if Solid.BySweep fails for some reason, returns none insted of crushing 
            return None

    def volume(self):
        L = self.length()
        r = self.thickness / 2.0
        area = math.pi * (r ** 2)
        return L * area  # mm^3

OUT = TimberMember
# ----------------------------------------
class_SteelMember = Python()  # CPython3; unwired: IN[0]
# ---------- class_SteelMember.python (71 lines) ----------
import clr
clr.AddReference('ProtoGeometry')
from Autodesk.DesignScript.Geometry import *
import math

class SteelMember:
    def __init__(self, centerline, thickness):
        self.centerline = centerline  # ring or rib curve
        self.thickness = thickness    # diameter

    def geometry(self):
        return self.centerline

    def length(self):
        return self.centerline.Length

    def solid(self):
        """
        Ribs (open curves):
            - use Solid.BySweep (works fine).
        Rings (closed curves):
            - approximate the ring with many small cylinders
              using Cylinder.ByPointsRadius
        """
        r = self.thickness / 2.0

        # detect closed curve (rings)
        try:
            is_closed = self.centerline.IsClosed
        except:
            # fallback: compare start and end points
            try:
                sp = self.centerline.StartPoint
                ep = self.centerline.EndPoint
                is_closed = sp.DistanceTo(ep) < 1e-6
            except:
                is_closed = False

        # ----- CLOSED: RINGS -----
        if is_closed:
            N = 62  # number of segments around ring 

            params = [i / float(N) for i in range(N + 1)]
            pts = [self.centerline.PointAtParameter(u) for u in params]

            seg_solids = []
            for i in range(N):
                p1 = pts[i]
                p2 = pts[i + 1]

                # make a small cylinder segment instead of sweep
                seg_cyl = Cylinder.ByPointsRadius(p1, p2, r)
                seg_solids.append(seg_cyl)

            if len(seg_solids) == 1:
                return seg_solids[0]
            else:
                return Solid.ByUnion(seg_solids)

        # ----- OPEN: RIBS -----
        start_pt = self.centerline.StartPoint
        profile = Circle.ByCenterPointRadius(start_pt, r)
        return Solid.BySweep(profile, self.centerline)

    def volume(self):
        L = self.length()
        r = self.thickness / 2.0
        area = math.pi * (r ** 2)
        return L * area   # mm^3

OUT = SteelMember
# ----------------------------------------
code_block_4 = CodeBlock { a = 255; r = 181; g = 140; b = 70; }
byARGB_2 = Color.ByARGB(alpha=code_block_4.a, red=code_block_4.r, green=code_block_4.g, blue=code_block_4.b)

# group: Center Cylinder
bottomPoint = CodeBlock { x = 0; y = 0; z = 0; }
cylHeight = IntegerSlider(1300, range=400..1500 step 50)
centerPoint = Point.ByCoordinates(x=bottomPoint.x, y=bottomPoint.y, z=bottomPoint.z)
byCoordinates_3 = Point.ByCoordinates(x=bottomPoint.x, y=bottomPoint.y, z=bottomPoint.z)
topPoint = CodeBlock(p=byCoordinates_3, h=cylHeight) { Point.ByCoordinates(p.X, p.Y, p.Z + h); }
byStartPointEndPoint = Line.ByStartPointEndPoint(startPoint=centerPoint, endPoint=topPoint)
thickness = IntegerSlider(3000, range=500..3000 step 100)
instant_cylinder = Python(IN[0]=byStartPointEndPoint, IN[1]=thickness, IN[2]=class_TimberMember)  # CPython3
# ---------- instant_cylinder.python (56 lines) ----------
import clr
clr.AddReference('ProtoGeometry')
from Autodesk.DesignScript.Geometry import *
import math

# Inputs from Dynamo

centerline_in = IN[0]   # line (cylinder axis)
thickness_in  = IN[1]   # diameter of the cylinder
TimberMember  = IN[2]   # TimberMember class from class node

# Normalize inputs
# Ensure centerlines is a list
if isinstance(centerline_in, list):
    centerlines = centerline_in
else:
    centerlines = [centerline_in]

# Allow single thickness or list
if isinstance(thickness_in, list):
    thicknesses = thickness_in
else:
    thicknesses = [thickness_in] * len(centerlines)
    
# Build TimberMember instances

cyl_instances = []   # list of TimberMember objects
cyl_solids    = []   # solid geometry for cylinder
cyl_lengths   = []   # length of cylinder axis
cyl_volumes   = []   # volume of cylinder

for i, c in enumerate(centerlines):
    if c is None:
        continue

    t = thicknesses[i if i < len(thicknesses) else -1]

    # Create INSTANCE of TimberMember
    m = TimberMember(c, t)
    cyl_instances.append(m)
    cyl_solids.append(m.solid())
    cyl_lengths.append(m.length())
    cyl_volumes.append(m.volume())

total_cyl_volume = sum(cyl_volumes) if cyl_volumes else 0


# -----------------------------
# Outputs
# -----------------------------
# OUT[0] = solids
# OUT[1] = lengths per member
# OUT[2] = volumes per member
# OUT[3] = total volume (single number)
# OUT[4] = instances (for write-up, not geometry)
OUT = [cyl_solids, cyl_lengths, cyl_volumes, total_cyl_volume, cyl_instances]
# ----------------------------------------
code_block_5 = CodeBlock { 3; }
cylVolume = List.GetItemAtIndex(list=instant_cylinder, index=code_block_5)
code_block_6 = CodeBlock { 0; }
cylVolume_2 = List.GetItemAtIndex(list=instant_cylinder, index=code_block_6)
byGeometryColor_2 = Modifiers.GeometryColor.ByGeometryColor(geometry=cylVolume_2, color=byARGB_2)

code_block_7 = CodeBlock { a = 255; r = 80; g = 100; b = 140; }
byARGB_3 = Color.ByARGB(alpha=code_block_7.a, red=code_block_7.r, green=code_block_7.g, blue=code_block_7.b)

# group: Circular Rings
byCoordinates_4 = Point.ByCoordinates(x=bottomPoint.x, y=bottomPoint.y, z=cylHeight)
topHeight = IntegerSlider(4000, range=2500..4500 step 100)
byCoordinates_5 = Point.ByCoordinates(x=bottomPoint.x, y=bottomPoint.y, z=topHeight)
innerRadius = IntegerSlider(1500, range=500..2500 step 100)
innerRing = Circle.ByCenterPointRadius(centerPoint=byCoordinates_5, radius=innerRadius)
outerRadius = IntegerSlider(5000, range=2500..5000 step 100)
outerRing = Circle.ByCenterPointRadius(centerPoint=byCoordinates_5, radius=outerRadius)
list_create = List.Create(item0=innerRing, item1=outerRing)
ringThickness = IntegerSlider(170, range=50..500 step 10)
instance_rings = Python(IN[0]=list_create, IN[1]=ringThickness, IN[2]=class_SteelMember)  # CPython3
# ---------- instance_rings.python (66 lines) ----------
import clr
clr.AddReference('ProtoGeometry')
from Autodesk.DesignScript.Geometry import *
import math

SteelMember  = IN[2]   # SteelMember class from class node
curves_in    = IN[0]   # nested lists of circles
thickness_in = IN[1]   # diameter(s)


# ---------- helper: flatten any nested lists ----------
def flatten(items):
    result = []
    if isinstance(items, list) or isinstance(items, tuple):
        for it in items:
            if isinstance(it, list) or isinstance(it, tuple):
                result.extend(flatten(it))
            else:
                result.append(it)
    else:
        result.append(items)
    return result


# ---------- normalize inputs ----------

# flatten curves to a single list of circle curves
curves = flatten(curves_in)

# allow single thickness or list
if isinstance(thickness_in, list):
    thicknesses = thickness_in
else:
    thicknesses = [thickness_in] * len(curves)


instances = []
solids    = []
lengths   = []
volumes   = []

for i, c in enumerate(curves):
    if c is None:
        continue

    t = thicknesses[i if i < len(thicknesses) else -1]

    # make SteelMember instance
    m = SteelMember(c, t)
    instances.append(m)

    solids.append(m.solid())
    lengths.append(m.length())
    volumes.append(m.volume())

total_volume = sum(volumes) if volumes else 0

# -----------------------------
# Outputs
# -----------------------------
# OUT[0] = solids
# OUT[1] = lengths per member
# OUT[2] = volumes per member
# OUT[3] = total volume (single number)
# OUT[4] = instances (for write-up, not geometry)
OUT = [solids, lengths, volumes, total_volume, instances]
# ----------------------------------------
code_block_8 = CodeBlock { 3; }
ringsTotalVolume = List.GetItemAtIndex(list=instance_rings, index=code_block_8)
code_block_9 = CodeBlock { 0; }
ringsSolid = List.GetItemAtIndex(list=instance_rings, index=code_block_9)
byGeometryColor_3 = Modifiers.GeometryColor.ByGeometryColor(geometry=ringsSolid, color=byARGB_3)

# group: Slats
numSlats = IntegerSlider(200, range=0..200 step 1)
tParamater = CodeBlock(numSlats=numSlats) { 0..1..#numSlats; }
innerSlatsPts = Curve.PointAtParameter(curve=innerRing, param=tParamater)
outerSlatsPts = Curve.PointAtParameter(curve=outerRing, param=tParamater)
slats = Line.ByStartPointEndPoint(startPoint=innerSlatsPts, endPoint=outerSlatsPts)
code_block_10 = CodeBlock { 0.5; }
slatMidPtsFlat = Curve.PointAtParameter(curve=slats, param=code_block_10)
slatBendHeight = IntegerSlider(1000, range=-500..1000 step 100)
slatMidPts = CodeBlock(p=slatMidPtsFlat, slatBendHeight=slatBendHeight) { Point.ByCoordinates(p.X, p.Y, p.Z + slatBendHeight); }
byThreePoints = Arc.ByThreePoints(firstPoint=innerSlatsPts, secondPoint=slatMidPts, thirdPoint=outerSlatsPts)
slatThickness = IntegerSlider(100, range=50..200 step 10)
instance_slats = Python(IN[0]=byThreePoints, IN[1]=slatThickness, IN[2]=class_TimberMember)  # CPython3
# ---------- instance_slats.python (66 lines) ----------
import clr
clr.AddReference('ProtoGeometry')
from Autodesk.DesignScript.Geometry import *
import math

curves_in    = IN[0]
thickness_in = IN[1]
TimberClass  = IN[2]

if TimberClass is None:
    OUT = ["ERROR: TimberMember class is None", [], [], [], 0.0]
else:
    if isinstance(curves_in, list):
        curves = curves_in
    else:
        curves = [curves_in]

    if isinstance(thickness_in, list):
        thicknesses = thickness_in
    else:
        thicknesses = [thickness_in] * len(curves)

    slat_solids  = []
    lengths      = []
    volumes      = []

    for i, c in enumerate(curves):
        if c is None:
            continue

        t = thicknesses[i if i < len(thicknesses) else -1]

        try:
            m = TimberClass(c, t)
        except:
            # bad curve? skip it
            continue

        # try solid
        try:
            s = m.solid()
        except:
            s = None

        slat_solids.append(s)

        try:
            lengths.append(m.length())
        except:
            lengths.append(0.0)

        try:
            volumes.append(m.volume())
        except:
            volumes.append(0.0)

    total_volume = sum(volumes) if volumes else 0.0
# -----------------------------
# Outputs
# -----------------------------
# OUT[0] = slat_solids
# OUT[1] = lengths per member
# OUT[2] = volumes per member
# OUT[3] = total volume (single number)

    OUT = [slat_solids, lengths, volumes, total_volume]
# ----------------------------------------
code_block_11 = CodeBlock { 3; }
slatsTotalVolume = List.GetItemAtIndex(list=instance_slats, index=code_block_11)
code_block_12 = CodeBlock { 0; }
slatsSolid = List.GetItemAtIndex(list=instance_slats, index=code_block_12)
byGeometryColor_4 = Modifiers.GeometryColor.ByGeometryColor(geometry=slatsSolid, color=byARGB_2)

# group: Ribs
code_block_13 = CodeBlock { x = 0; y = 0; z = 0; }
baseRingCenter = Point.ByCoordinates(x=code_block_13.x, y=code_block_13.y, z=code_block_13.z)
ribBaseRadius = IntegerSlider(4000, range=1000..4000 step 100)
baseRing = Circle.ByCenterPointRadius(centerPoint=baseRingCenter, radius=ribBaseRadius)
ribParams = CodeBlock { [0, 0.25, 0.5, 0.75]; }
ribBasePts = Curve.PointAtParameter(curve=baseRing, param=ribParams)
ribTopPts = Curve.PointAtParameter(curve=outerRing, param=ribParams)
ribLines = Line.ByStartPointEndPoint(startPoint=ribBasePts, endPoint=ribTopPts)
code_block_14 = CodeBlock { 0.5; }
ribMidPtsFlat = Curve.PointAtParameter(curve=ribLines, param=code_block_14)
ribBendHeight = DoubleSlider(1500, range=0..2000 step 100)
ribMidPts = CodeBlock(p=ribMidPtsFlat, ribBendHeight=ribBendHeight) { Point.ByCoordinates(p.X, p.Y, p.Z + ribBendHeight); }
ribCurves = Arc.ByThreePoints(firstPoint=ribBasePts, secondPoint=ribMidPts, thirdPoint=ribTopPts)
ribThickness = IntegerSlider(400, range=100..1000 step 50)
instance_rings_2 = Python(IN[0]=ribCurves, IN[1]=ribThickness, IN[2]=class_SteelMember)  # CPython3
# ---------- instance_rings_2.python (65 lines) ----------
import clr
clr.AddReference('ProtoGeometry')
from Autodesk.DesignScript.Geometry import *
import math

# -----------------------------
# Inputs from Dynamo
# -----------------------------
curves_in    = IN[0]   # curve or list of curves (ribs)
thickness_in = IN[1]   # diameter(s)
SteelMember  = IN[2]   # SteelMember class from class node


# -----------------------------
# Normalize inputs
# -----------------------------

# Ensure curves is a list
if isinstance(curves_in, list):
    curves = curves_in
else:
    curves = [curves_in]

# Allow single thickness or list of thicknesses
if isinstance(thickness_in, list):
    thicknesses = thickness_in
else:
    thicknesses = [thickness_in] * len(curves)


# -----------------------------
# Build SteelMember instances
# -----------------------------
instances = []   # list of SteelMember objects
solids    = []   # solid geometry for each member
lengths   = []   # length of each member
volumes   = []   # volume of each member

for i, c in enumerate(curves):
    if c is None:
        continue

    # choose thickness for this member
    t = thicknesses[i if i < len(thicknesses) else -1]

    # create INSTANCE of SteelMember
    m = SteelMember(c, t)
    instances.append(m)

    # use class methods
    solids.append(m.solid())
    lengths.append(m.length())
    volumes.append(m.volume())

total_volume = sum(volumes) if volumes else 0

# -----------------------------
# Outputs
# -----------------------------
# OUT[0] = solids
# OUT[1] = lengths per member
# OUT[2] = volumes per member
# OUT[3] = total volume (single number)
# OUT[4] = instances (for write-up, not geometry)
OUT = [solids, lengths, volumes, total_volume, instances]
# ----------------------------------------
code_block_15 = CodeBlock { 3; }
ribsTotalVolume = List.GetItemAtIndex(list=instance_rings_2, index=code_block_15)
code_block_16 = CodeBlock { 0; }
ribsSolid = List.GetItemAtIndex(list=instance_rings_2, index=code_block_16)
byGeometryColor_5 = Modifiers.GeometryColor.ByGeometryColor(geometry=ribsSolid, color=byARGB_3)

sumOfValues = CodeBlock(cylVolume=cylVolume, slatsTotalVolume=slatsTotalVolume, ringsTotalVolume=ringsTotalVolume, ribsTotalVolume=ribsTotalVolume)
# ---------- sumOfValues.designscript (3 lines) ----------
timberTotal = cylVolume + slatsTotalVolume;
steelTotal  = ringsTotalVolume + ribsTotalVolume;
grandTotal  = timberTotal + steelTotal;
# ----------------------------------------
combinedTotalVolume = Watch(sumOfValues.grandTotal)
totalSteelVolume = Watch(sumOfValues.steelTotal)
totalTimberVolume = Watch(sumOfValues.timberTotal)
