# Dynamo graph 1853033.dyn (Dynamo 3.5.2.8914)

# group: Don't touch this ground
code_block = CodeBlock { -5000; -5000; -200; }
byCoordinates = Point.ByCoordinates(x=code_block.out0, y=code_block.out1, z=code_block.out2)
code_block_2 = CodeBlock { 5000; 5000; 0; }
byCoordinates_2 = Point.ByCoordinates(x=code_block_2.out0, y=code_block_2.out1, z=code_block_2.out2)
byCorners = Cuboid.ByCorners(lowPoint=byCoordinates, highPoint=byCoordinates_2)
code_block_3 = CodeBlock { 0; 100; 0; }
byARGB = Color.ByARGB(red=code_block_3.out0, green=code_block_3.out1, blue=code_block_3.out2)
byGeometryColor = Modifiers.GeometryColor.ByGeometryColor(geometry=byCorners, color=byARGB)

# group: bench
slice5 = Python()  # CPython3; unwired: IN[0]
# ---------- slice5.python (285 lines) ----------
import clr
clr.AddReference('ProtoGeometry')
from Autodesk.DesignScript.Geometry import *
import math

class Slice5:
    """
    Slice5 class

    Simple idea:
    - We have many curves. Each curve has many points.
    - Points with the same index (0, 1, 2, ...) form one "level" or "slice".
    - For each slice (index i), we:
        * collect all points at that level
        * sort them around in a circle
        * connect them into a closed polygon (PolyCurve)
        * optionally round the corners (fillet)
        * create a surface from the polygon
        * optionally give the surface some thickness to make a solid
    """

    def __init__(self, pts_by_curve, fillet_radius=0.0):
        """
        Constructor: this runs when you create a new Slice5 object.

        Parameters:
        - pts_by_curve:
            A list of curves, and each curve is a list of points.
            The structure looks like:
                [
                    [p00, p01, p02, ...],  # curve 0 points at different levels
                    [p10, p11, p12, ...],  # curve 1
                    [p20, p21, p22, ...],  # curve 2
                    ...
                ]
            For example:
            - All p?0 (p00, p10, p20, ...) are points at level 0
            - All p?1 (p01, p11, p21, ...) are at level 1, and so on.

        - fillet_radius:
            The radius of rounded corners (fillets) for the polygon.
            If 0, we do not round the corners.
        """

        # Store the points so other methods can use them later.
        self.pts_by_curve = pts_by_curve
   
        # We want to be careful with fillet_radius because
        # Dynamo often passes values as lists, or sometimes None.
        r = fillet_radius

        # If r is a list (e.g. [5.0, 6.0]), we only use the first value.
        if isinstance(r, list):
            r = r[0] if len(r) > 0 else 0.0

        # If r is None, treat it as 0.0 (no fillet).
        if r is None:
            r = 0.0

        # Make sure it is a float number and save it.
        self.fillet_radius = float(r)


    def slice_count(self):
        """
        Return how many "levels" or "slices" we have.

        Explanation:
        - pts_by_curve[0] is the first curve.
        - len(pts_by_curve[0]) tells us how many points that curve has.
        - Each point index (0, 1, 2, ...) is one slice.
        - We assume all curves have the same number of points.
        """
        return len(self.pts_by_curve[0])


    def points_at_index(self, i):
        """
        Get all points at level i from every curve.

        For example:
        - When i = 0, we get curve0[0], curve1[0], curve2[0], ...
        - When i = 1, we get curve0[1], curve1[1], curve2[1], ...

        Return:
        - A list of points at that level: [p0, p1, p2, ...]
        """
        return [curve_pts[i] for curve_pts in self.pts_by_curve]


    def ordered_points_at_index(self, i):
        """
        Get points at level i and order them around a circle.

        Why do we need ordering?
        - If we just connect points in random order, the polygon might cross itself
          and look messy.
        - We want to connect them in a "round" order, like people standing
          evenly around a circle.

        How:
        1. Take all points at level i.
        2. Find the "center" of these points in the YZ-plane (average Y and Z).
        3. For each point, compute the angle from the center using atan2.
        4. Sort the points by that angle. Now they are in circular order.
        """

        # Get a copy of all points at this level.
        pts = list(self.points_at_index(i))

        # If we have 0, 1, or 2 points, no need to sort; just return them.
        if len(pts) <= 2:
            return pts

        # Compute average Y and Z to find the "center" of all points.
        cy = sum(p.Y for p in pts) / len(pts)
        cz = sum(p.Z for p in pts) / len(pts)

        # This function returns the angle of point p relative to the center (cy, cz).
        # We use Y as "x-axis" and Z as "y-axis" here (YZ-plane).
        def ang(p):
            # p.Z - cz: vertical difference from center in Z
            # p.Y - cy: horizontal difference from center in Y
            return math.atan2(p.Z - cz, p.Y - cy)

        # Sort points by angle, so they go around in a nice order.
        pts_sorted = sorted(pts, key=ang)
        return pts_sorted


    def polycurve_at_index(self, i):
        """
        Create a closed PolyCurve (polygon) at level i.

        Steps:
        1. Get the ordered points at level i.
        2. Add the first point at the end to close the loop.
        3. Create a PolyCurve from these points.
        4. If fillet_radius > 0, try to fillet (round) the corners.
        """

        # Points in circular order at this level.
        pts = self.ordered_points_at_index(i)

        # If there are fewer than 3 points, we can't make a polygon.
        if len(pts) < 3:
            return None

        # Add the first point again at the end so the polygon closes.
        closed_pts = pts + [pts[0]]

        # Create a PolyCurve from the closed list of points.
        poly = PolyCurve.ByPoints(closed_pts)

        # If there is no fillet radius, just return the polygon as-is.
        if self.fillet_radius <= 0:
            return poly

        # To do fillets properly, we need to know the length of each edge.
        lengths = []
        for k in range(len(pts)):
            a = pts[k]
            b = pts[(k + 1) % len(pts)]  # next point, wrapping around
            lengths.append(a.DistanceTo(b))

        # If there are no lengths (should not normally happen), return polygon.
        if not lengths:
            return poly

        # Find the shortest edge.
        min_len = min(lengths)

        # If the shortest edge is extremely small, filleting can cause problems.
        # We just skip fillets in that case.
        if min_len <= 1e-6:
            return poly

        # To be safe, the fillet radius should not be too large.
        # We limit it to 40% of the shortest edge.
        max_r = 0.4 * min_len

        # Use the smaller value between user fillet_radius and max_r.
        r = min(self.fillet_radius, max_r)

        # If r is too small, treat it as no fillet.
        if r <= 1e-6:
            return poly

        # Try to fillet the polygon. If something goes wrong, fall back to original.
        try:
            poly_f = PolyCurve.Fillet(poly, r)
            return poly_f
        except:
            return poly


    def surface_at_index(self, i):
        """
        Create a Surface at level i.

        Steps:
        1. Get the PolyCurve (polygon) at that level.
        2. Use Surface.ByPatch(poly) to "fill" the polygon and create a surface.
        """

        # Get the polygon curve at this level.
        pc = self.polycurve_at_index(i)

        # If we could not create a polygon, we cannot create a surface.
        if pc is None:
            return None

        try:
            # Create a surface by patching the polygon.
            srf = Surface.ByPatch(pc)
            return srf
        except:
            # If something fails (bad geometry, etc.), return None.
            return None


    def solid_at_index(self, i, thickness):
        """
        Create a thickened solid (or just return a surface) at level i.

        Steps:
        1. Get the surface at level i.
        2. Clean and convert the thickness value.
           - It might be a list, None, etc.
        3. If thickness is almost zero, just return the surface.
        4. If thickness is non-zero, use srf.Thicken(thickness) to make a solid.

        Notes:
        - Positive thickness might thicken in one direction,
          negative thickness in the opposite direction (depends on API).
        """

        # Get the surface at this level.
        srf = self.surface_at_index(i)
        if srf is None:
            return None

        # Clean the thickness input. Sometimes Dynamo gives us a list or None.
        t = thickness
        if isinstance(t, list):
            t = t[0] if len(t) > 0 else 0.0
        if t is None:
            t = 0.0
        t = float(t)

        # If thickness is extremely small, treat it as zero: just return the surface.
        if abs(t) <= 1e-6:
            return srf

        # Try to thicken the surface into a solid.
        try:
            solid = srf.Thicken(t)
            return solid
        except:
            # If thickening fails, just return the surface instead of crashing.
            return srf
    # --------------------------------------------------------------------
    # OPTIONAL: 
    #
    # def area_at_index(self, i):
    #     
    #     srf = self.surface_at_index(i)
    #     if srf is None:
    #         return None
    #     try:
    #         return srf.Area
    #     except:
    #         return None
    #
    # def volume_at_index(self, i, thickness):
    #     
    #     solid = self.solid_at_index(i, thickness)
    #     if solid is None:
    #         return None
    #     try:
    #         return solid.Volume
    #     except:
    #         return None

OUT = Slice5 
# ----------------------------------------
length = DoubleSlider(181.1, range=20..500 step 0.1)
sliceNumber = IntegerSlider(45, range=10..100 step 1)
code_block_4 = CodeBlock(Lengths=length, SliceNumber=sliceNumber) { Lengths; SliceNumber; Interval = 0..1..#SliceNumber; Xpoint = Interval * Lengths; }
code_block_5 = CodeBlock { 0; }
number_slider = DoubleSlider(0.2, range=0..2 step 0.1)
number_slider_2 = DoubleSlider(50.4, range=0..100 step 0.1)
code_block_6 = CodeBlock(x=code_block_4.Xpoint, yCenter=code_block_5, yAmplitude=number_slider, yFrequency=number_slider_2) { x; yCenter; yAmplitude; yFrequency; y = yCenter + yAmplitude * Math.Sin(yFrequency*x); }
code_block_7 = CodeBlock { 5.7; 19.1; 14.5; 5.5; 7.5; 0; 18.3; }
code_block_8 = CodeBlock(sineAmplitude=code_block_7.out0, sineFrequency=code_block_7.out1, sinePhaseShift=code_block_7.out2, cosineAmplitude=code_block_7.out3, cosineFrequency=code_block_7.out4, cosinePhaseShift=code_block_7.out5, verticalOffset=code_block_7.out6, x=code_block_4.Xpoint)
# ---------- code_block_8.designscript (11 lines) ----------
sineAmplitude;
sineFrequency;
sinePhaseShift;
cosineAmplitude;
cosineFrequency;
cosinePhaseShift;
verticalOffset;

x;
z1 = sineAmplitude * Math.Sin(sineFrequency*x+sinePhaseShift) - cosineAmplitude *Math.Cos(cosineFrequency *x +cosinePhaseShift) + verticalOffset;
z1;
# ----------------------------------------
byCoordinates_3 = Point.ByCoordinates(x=code_block_4.Xpoint, y=code_block_6.y, z=code_block_8.out9)
code_block_9 = CodeBlock { -15; }
code_block_10 = CodeBlock(x=code_block_4.Xpoint) { x; z2 = 2.2 * Math.Sin(5.5*x+12.3) +3.3; z2; }
byCoordinates_4 = Point.ByCoordinates(x=code_block_4.Xpoint, y=code_block_9, z=code_block_10.out2)
code_block_11 = CodeBlock { -40; }
code_block_12 = CodeBlock(x=code_block_4.Xpoint) { x; z3 = -5.0; z3; }
byCoordinates_5 = Point.ByCoordinates(x=code_block_4.Xpoint, y=code_block_11, z=code_block_12.out2)
code_block_13 = CodeBlock { -42; }
code_block_14 = CodeBlock(x=code_block_4.Xpoint) { x; z4 = -5.0 * Math.Sin(6.6 * x +38.7) +5.2* Math.Cos(22.3*x) -16.5; z4; }
byCoordinates_6 = Point.ByCoordinates(x=code_block_4.Xpoint, y=code_block_13, z=code_block_14.out2)
code_block_15 = CodeBlock { 10; }
code_block_16 = CodeBlock(x=code_block_4.Xpoint) { x; z5 =-8.0 * Math.Sin(10.6 * x +30.7) +3.2* Math.Cos(20.3*x) -28.5; z5; }
byCoordinates_7 = Point.ByCoordinates(x=code_block_4.Xpoint, y=code_block_15, z=code_block_16.out2)
list_create = List.Create(item0=byCoordinates_3, item1=byCoordinates_4, item2=byCoordinates_5, item3=byCoordinates_6, item4=byCoordinates_7)
code_block_17 = CodeBlock { 2; }
code_block_18 = CodeBlock { 2.5; }
target_instance = Python(IN[0]=slice5, IN[1]=list_create, IN[2]=code_block_17, IN[3]=code_block_18, IN[4]=length, IN[5]=code_block_9, IN[6]=code_block_12.out2)  # CPython3
# ---------- target_instance.python (121 lines) ----------
import clr
clr.AddReference('ProtoGeometry')
from Autodesk.DesignScript.Geometry import *
import math

# IN[0] = Slice5 class
# IN[1] = pts_by_curve: list of point-lists (one list per curve)
# IN[2] = fillet_radius: corner fillet radius
# IN[3] = thickness: slice thickness (scalar or single-item list)
# IN[4] = total_length: total length of the slice system along X
# IN[5] = rod_center_y: Y coordinate of the rod center
# IN[6] = rod_center_z: Z coordinate of the rod center

Slice5        = IN[0]
pts_by_curve  = IN[1]
fillet_radius = IN[2]
thickness     = IN[3]

total_length  = IN[4]
rod_center_y  = IN[5]
rod_center_z  = IN[6]

# Instantiate Slice5 object
slice_obj = Slice5(pts_by_curve, fillet_radius)
n = slice_obj.slice_count()

profiles = []   # polycurves for each slice
solids   = []   # solids (or surfaces if thicken fails or thickness = 0)
surfaces = []   # patch surfaces for area calculation
areas    = []   # numeric areas (internal use only)
volumes  = []   # numeric volumes (internal use only)

for i in range(n):
    # Profile polycurve
    pc = slice_obj.polycurve_at_index(i)
    profiles.append(pc)

    # Surface for this slice
    srf = slice_obj.surface_at_index(i)
    surfaces.append(srf)

    # Area for this slice (numeric, internal)
    a = None
    if srf is not None:
        try:
            a = srf.Area
        except:
            a = None
    areas.append(a)

    # Solid for this slice
    solid = slice_obj.solid_at_index(i, thickness)
    solids.append(solid)

    # Volume for this slice (numeric, internal)
    v = 0.0
    if solid is not None:
        try:
            v = solid.Volume
        except:
            v = 0.0
    volumes.append(v)

# ----- Build unit-labeled strings -----

# Assumption: model units are millimeters
area_unit   = "mm²"
volume_unit = "mm³"

# Per-slice area labels: "123.45 mm²"
area_labels = []
for a in areas:
    if a is None:
        area_labels.append(None)
    else:
        area_labels.append("{0:.2f} {1}".format(a, area_unit))

# Per-slice volume labels: "123.45 mm³"
volume_labels = []
for v in volumes:
    volume_labels.append("{0:.2f} {1}".format(v, volume_unit))

# Total area / total volume (numeric, internal)
total_area   = sum(a for a in areas if a is not None)
total_volume = sum(volumes)

# Total labels: "1234.56 mm²", "7890.12 mm³"
total_area_label   = "{0:.2f} {1}".format(total_area, area_unit)
total_volume_label = "{0:.2f} {1}".format(total_volume, volume_unit)

# ----- Create a horizontal rod (cylinder) using Length + Y + Z -----

# Use the bounding box only to find the starting X position
bbox   = BoundingBox.ByGeometry(solids)
min_pt = bbox.MinPoint

start_x = min_pt.X
end_x   = min_pt.X + float(total_length)

# You can also set rod_radius manually or relate it to thickness
try:
    rod_radius = float(thickness) * 0.5
except:
    rod_radius = 5.0  # fallback radius in mm

rod_start = Point.ByCoordinates(start_x, rod_center_y, rod_center_z)
rod_end   = Point.ByCoordinates(end_x,   rod_center_y, rod_center_z)

rod = Cylinder.ByPointsRadius(rod_start, rod_end, rod_radius)

# Final output: geometry + strings with units, plus the rod
OUT = (
    profiles,           # 0: slice profiles (PolyCurves)
    solids,             # 1: slice solids (or surfaces if thicken failed)
    surfaces,           # 2: slice surfaces
    area_labels,        # 3: per-slice area labels ("xx mm²")
    total_area_label,   # 4: total area label ("xx mm²")
    volume_labels,      # 5: per-slice volume labels ("xx mm³")
    total_volume_label, # 6: total volume label ("xx mm³")
    rod,                # 7: horizontal rod (Cylinder)
) 
# ----------------------------------------
code_block_19 = CodeBlock { 6; }
getItemAtIndex = List.GetItemAtIndex(list=target_instance, index=code_block_19)
watch = Watch(getItemAtIndex)
code_block_20 = CodeBlock { 4; }
getItemAtIndex_2 = List.GetItemAtIndex(list=target_instance, index=code_block_20)
watch_2 = Watch(getItemAtIndex_2)
integer_slider = IntegerSlider(3, range=1..5 step 1)
byPoints = NurbsCurve.ByPoints(points=byCoordinates_6, degree=integer_slider)
byPoints_2 = NurbsCurve.ByPoints(points=byCoordinates_7, degree=integer_slider)
byPoints_3 = NurbsCurve.ByPoints(points=byCoordinates_5, degree=integer_slider)
byPoints_4 = NurbsCurve.ByPoints(points=byCoordinates_4, degree=integer_slider)
byPoints_5 = NurbsCurve.ByPoints(points=byCoordinates_3, degree=integer_slider)
code_block_21 = CodeBlock(x=code_block_4.Xpoint) { x; z1 = 5.7 * Math.Sin(19.1*x +14.5)- 5.5*Math.Cos(7.5*x) +18.3; z1; }

# group: truss thing
circular_steel_class = Python()  # CPython3; unwired: IN[0]
# ---------- circular_steel_class.python (24 lines) ----------
# Load the Python Standard and DesignScript Libraries
import sys
import clr
clr.AddReference('ProtoGeometry')
from Autodesk.DesignScript.Geometry import *
import math

class CircularSteel:
    def __init__(self, centerline, radius):
        self.centerline = centerline
        self.radius = radius
    
    def endpoints(self):
        return self.centerline.StartPoint, self.centerline.EndPoint
    
    def make_geometry(self):
        end1, end2 = self.endpoints()
        
        return Cylinder.ByPointsRadius(end1,end2,self.radius) 
    
    def measure_volume(self):
        end1, end2 = self.endpoints()
        return end1.DistanceTo(end2)*self.radius*self.radius*math.pi  
OUT = CircularSteel          
# ----------------------------------------
code_block_22 = CodeBlock { 0; 0; 0; }
byCoordinates_8 = Point.ByCoordinates(x=code_block_22.out0, y=code_block_22.out1, z=code_block_22.out2)
code_block_23 = CodeBlock { 0; 20; 0; }
byCoordinates_9 = Point.ByCoordinates(x=code_block_23.out0, y=code_block_23.out1, z=code_block_23.out2)
byStartPointEndPoint = Line.ByStartPointEndPoint(startPoint=byCoordinates_8, endPoint=byCoordinates_9)
number_slider_3 = DoubleSlider(13, range=1..25 step 1)
code_block_24 = CodeBlock(n=number_slider_3) { n; 0..1..#n; }
watch_3 = Watch(code_block_24.out1)
splitByParameter = Curve.SplitByParameter(curve=byStartPointEndPoint, parameters=watch_3)
endPoint = Curve.EndPoint(curve=splitByParameter)
code_block_25 = CodeBlock { 2; 0; }
dropEveryNthItem = List.DropEveryNthItem(list=endPoint, n=code_block_25.out0, offset=code_block_25.out1)
ZAxis = Vector.ZAxis()
number_slider_4 = DoubleSlider(4.8, range=1..10 step 0.1)
translate = Geometry.Translate(geometry=byCoordinates_8, direction=ZAxis, distance=number_slider_4)
translate_2 = Geometry.Translate(geometry=byCoordinates_9, direction=ZAxis, distance=number_slider_4)
byStartPointEndPoint_2 = Line.ByStartPointEndPoint(startPoint=translate, endPoint=translate_2)
splitByParameter_2 = Curve.SplitByParameter(curve=byStartPointEndPoint_2, parameters=watch_3)
endPoint_2 = Curve.EndPoint(curve=splitByParameter_2)
addItemToFront = List.AddItemToFront(item=translate, list=endPoint_2)
dropEveryNthItem_2 = List.DropEveryNthItem(list=addItemToFront, n=code_block_25.out0, offset=code_block_25.out1)
diagnoal_1 = Line.ByStartPointEndPoint(startPoint=dropEveryNthItem, endPoint=dropEveryNthItem_2)
code_block_26 = CodeBlock { 0; }
removeItemAtIndex = List.RemoveItemAtIndex(list=dropEveryNthItem_2, indices=code_block_26)
disgnoal_2 = Line.ByStartPointEndPoint(startPoint=dropEveryNthItem, endPoint=removeItemAtIndex)
addItemToFront_2 = List.AddItemToFront(item=byCoordinates_8, list=endPoint)
internal_vertical = Line.ByStartPointEndPoint(startPoint=addItemToFront_2, endPoint=addItemToFront)
list_create_2 = List.Create(item0=diagnoal_1, item1=disgnoal_2, item2=internal_vertical)
number_slider_5 = DoubleSlider(0.1, range=0..5 step 0.1)
python_script = Python(IN[0]=circular_steel_class, IN[1]=list_create_2, IN[2]=number_slider_5)  # CPython3
# ---------- python_script.python (21 lines) ----------
CircularSteel = IN[0]
lines = IN[1]
radius = IN[2]

def covert(item):
    cs = CircularSteel(item,radius)
    return cs.make_geometry(), cs.measure_volume()

def walk(data):
    if isinstance(data, list):
        geos, vols = [],[]
        for d in data:
            g,v = walk(d)
            geos.append(g)
            vols.append(v)
        return geos,vols   
    else:
        return covert(data)  
        
geos, vols = walk(lines)
OUT = (geos,vols)    
# ----------------------------------------
number_slider_6 = DoubleSlider(0.2, range=0..10 step 0.1)
instance2 = Python(IN[0]=circular_steel_class, IN[1]=byStartPointEndPoint_2, IN[2]=number_slider_6)  # CPython3
# ---------- instance2.python (4 lines) ----------
CircularSteel = IN[0]
bottomSteel = CircularSteel(IN[1],IN[2])

OUT = [bottomSteel.make_geometry(), bottomSteel.measure_volume()]
# ----------------------------------------
code_block_27 = CodeBlock(input=instance2) { item1 = input[0]; item2 = input[1]; }
watch_4 = Watch(diagnoal_1)
watch_5 = Watch(disgnoal_2)
instance1 = Python(IN[0]=circular_steel_class, IN[1]=byStartPointEndPoint, IN[2]=number_slider_6)  # CPython3; same code as instance2
code_block_28 = CodeBlock(input=instance1) { item1 = input[0]; item2 = input[1]; }

# group: cynlinder thing
code_block_29 = CodeBlock { -25; 0; 0; }
byCoordinates_10 = Point.ByCoordinates(x=code_block_29.out0, y=code_block_29.out1, z=code_block_29.out2)
code_block_30 = CodeBlock { 25; 0; 0; }
byCoordinates_11 = Point.ByCoordinates(x=code_block_30.out0, y=code_block_30.out1, z=code_block_30.out2)
byStartPointEndPoint_3 = Line.ByStartPointEndPoint(startPoint=byCoordinates_10, endPoint=byCoordinates_11)
code_block_31 = CodeBlock { 0; 12; 1/11; }
sequence = Sequence(start=code_block_31.out0, amount=code_block_31.out1, step=code_block_31.out2)
pointAtParameter = Curve.PointAtParameter(curve=byStartPointEndPoint_3, param=sequence)
code_block_32 = CodeBlock { 0; -25; 50; }
byCoordinates_12 = Point.ByCoordinates(x=code_block_32.out0, y=code_block_32.out1, z=code_block_32.out2)
code_block_33 = CodeBlock { 0; 25; 25; }
byCoordinates_13 = Point.ByCoordinates(x=code_block_33.out0, y=code_block_33.out1, z=code_block_33.out2)
byStartPointEndPoint_4 = Line.ByStartPointEndPoint(startPoint=byCoordinates_12, endPoint=byCoordinates_13)
code_block_34 = CodeBlock { 0; 10; 1/9; }
sequence_2 = Sequence(start=code_block_34.out0, amount=code_block_34.out1, step=code_block_34.out2)
pointAtParameter_2 = Curve.PointAtParameter(curve=byStartPointEndPoint_4, param=sequence_2)
code_block_35 = CodeBlock { 1.8; 10; 0; }
sequence_3 = Sequence(start=code_block_35.out0, amount=code_block_35.out1, step=code_block_35.out2)
circular_rod = Python()  # CPython3; unwired: IN[0]
# ---------- circular_rod.python (14 lines) ----------
import clr
clr.AddReference('ProtoGeometry')
from Autodesk.DesignScript.Geometry import *

class CircularRod:
    def __init__(self, bottom_point, top_point, radius):
        self.bottom = bottom_point
        self.top = top_point
        self.radius = radius

    def make_geometry(self):
        return Cylinder.ByPointsRadius(self.bottom, self.top, self.radius)

OUT = CircularRod
# ----------------------------------------
final_target = Python(IN[0]=pointAtParameter, IN[1]=pointAtParameter_2, IN[2]=sequence_3, IN[3]=circular_rod)  # CPython3
# ---------- final_target.python (23 lines) ----------
# IN[0] = list of bottom points
# IN[1] = list of top points
# IN[2] = list of radii
# IN[3] = class CircularRod from Box #1

CircularRod = IN[3]
bottom_points = IN[0]
top_points = IN[1]
radii = IN[2]

rods = []
count = min(len(bottom_points), len(top_points))

for i in range(count):
  
    r = radii[i] if i < len(radii) else radii[-1]
    btm = bottom_points[i]
    top = top_points[i]
    
    rod = CircularRod(btm, top, r)
    rods.append(rod.make_geometry())

OUT = rods
# ----------------------------------------
code_block_36 = CodeBlock { 0; 5; 5; }
sequence_4 = Sequence(start=code_block_36.out0, amount=code_block_36.out1, step=code_block_36.out2)
code_block_37 = CodeBlock { 0; 0; }
byCoordinates_14 = Point.ByCoordinates(x=sequence_4, y=code_block_37.out0, z=code_block_37.out1)
code_block_38 = CodeBlock { 0; 10; }
byCoordinates_15 = Point.ByCoordinates(x=sequence_4, y=code_block_38.out0, z=code_block_38.out1)
code_block_39 = CodeBlock { 1; 5; 0.5; }
sequence_5 = Sequence(start=code_block_39.out0, amount=code_block_39.out1, step=code_block_39.out2)
series_of_instances = Python(IN[0]=byCoordinates_14, IN[1]=byCoordinates_15, IN[2]=sequence_5, IN[3]=circular_rod)  # CPython3; same code as final_target
code_block_40 = CodeBlock { 0; 0; 0; }
byCoordinates_16 = Point.ByCoordinates(x=code_block_40.out0, y=code_block_40.out1, z=code_block_40.out2)
code_block_41 = CodeBlock { 0; 0; 15; }
byCoordinates_17 = Point.ByCoordinates(x=code_block_41.out0, y=code_block_41.out1, z=code_block_41.out2)
number_slider_7 = DoubleSlider(3, range=0..5 step 1)
single_instance = Python(IN[0]=byCoordinates_16, IN[1]=byCoordinates_17, IN[2]=number_slider_7, IN[3]=circular_rod)  # CPython3
# ---------- single_instance.python (8 lines) ----------
# IN[0] = bottom point
# IN[1] = top point
# IN[2] = radius
# IN[3] = class object from previous node

CircularRod = IN[3]
b = CircularRod(IN[0], IN[1], IN[2])
OUT = b.make_geometry()
# ----------------------------------------

# group: Top Points of Roof
height_of_roof = DoubleSlider(4000, range=0..4000 step 5)
byCoordinates_18 = Point.ByCoordinates(z=height_of_roof)
diameter_of_pavilion = DoubleSlider(1800, range=0..2000 step 0.1)
code_block_42 = CodeBlock(a=diameter_of_pavilion) { a+a*Math.Cos(30); }
roof_circle = Circle.ByCenterPointRadius(centerPoint=byCoordinates_18, radius=code_block_42)
number_of_points_for_circle = DoubleSlider(35, range=0..100 step 0.1)
code_block_43 = CodeBlock(n=number_of_points_for_circle) { 0..1..#n; }
pointAtParameter_3 = Curve.PointAtParameter(curve=roof_circle, param=code_block_43)

# group: Bottom Points of Roof
height_of_roof_2 = DoubleSlider(5000, range=0..5000 step 5)
byCoordinates_19 = Point.ByCoordinates(z=height_of_roof_2)
diameter_of_pavilion_2 = DoubleSlider(50, range=0..2000 step 0.1)
code_block_44 = CodeBlock(a=diameter_of_pavilion_2) { a+a*Math.Cos(30); }
roof_circle_2 = Circle.ByCenterPointRadius(centerPoint=byCoordinates_19, radius=code_block_44)
number_of_points_for_circle_2 = DoubleSlider(35, range=0..100 step 0.1)
code_block_45 = CodeBlock(n=number_of_points_for_circle_2) { 0..1..#n; }
pointAtParameter_4 = Curve.PointAtParameter(curve=roof_circle_2, param=code_block_45)

lines_connecting_the_base_of_the = Line.ByStartPointEndPoint(startPoint=pointAtParameter_3, endPoint=pointAtParameter_4)  # "Lines Connecting the Base of the Roof to the Top Centre"

# group: Top Points of Columns
height_of_column = DoubleSlider(4000, range=0..4000 step 5)
byCoordinates_20 = Point.ByCoordinates(z=height_of_column)
diameter_of_pavilion_3 = DoubleSlider(1600, range=0..2000 step 0.1)
code_block_46 = CodeBlock(a=diameter_of_pavilion_3) { a+a*Math.Cos(30); }
roof_circle_3 = Circle.ByCenterPointRadius(centerPoint=byCoordinates_20, radius=code_block_46)
number_of_points_for_circle_3 = DoubleSlider(8, range=0..100 step 0.1)
code_block_47 = CodeBlock(n=number_of_points_for_circle_3) { 0..1..#n; }
pointAtParameter_5 = Curve.PointAtParameter(curve=roof_circle_3, param=code_block_47)

# group: Bottom Points of Columns
ground = DoubleSlider(0, range=0..0 step 0)
byCoordinates_21 = Point.ByCoordinates(z=ground)
diameter_of_pavilion_4 = DoubleSlider(1600, range=0..2000 step 0.1)
code_block_48 = CodeBlock(a=diameter_of_pavilion_4) { a+a*Math.Cos(30); }
roof_circle_4 = Circle.ByCenterPointRadius(centerPoint=byCoordinates_21, radius=code_block_48)
number_of_points_for_circle_4 = DoubleSlider(8, range=2..20 step 1)
code_block_49 = CodeBlock(n=number_of_points_for_circle_4) { 0..1..#n; }
pointAtParameter_6 = Curve.PointAtParameter(curve=roof_circle_4, param=code_block_49)

lines_connecting_roof_to_ground = Line.ByStartPointEndPoint(startPoint=pointAtParameter_5, endPoint=pointAtParameter_6)  # "Lines Connecting Roof to Ground for the Posts"
wooden_panels_thickness = DoubleSlider(100, range=100..500 step 1)
wooden_panels_width = DoubleSlider(100, range=100..200 step 1)
class_wooden_rectangular_panels = Python()  # CPython3; unwired: IN[0]
# ---------- class_wooden_rectangular_panels.python (16 lines) ----------
import clr
clr.AddReference('ProtoGeometry')
from Autodesk.DesignScript.Geometry import *

class WoodenPanel:
    def __init__(self, cs, width, thickness, height):
        self.cs = cs
        self.width = width
        self.thickness = thickness
        self.height = height

    def make_geometry(self):
        panel = Cuboid.ByLengths(self.cs, self.width, self.thickness, self.height)
        return panel

OUT = WoodenPanel
# ----------------------------------------
series_of_instances_wooden_roof = Python(IN[0]=pointAtParameter_3, IN[1]=pointAtParameter_4, IN[2]=wooden_panels_thickness, IN[3]=wooden_panels_width, IN[4]=class_wooden_rectangular_panels)  # CPython3
# ---------- series_of_instances_wooden_roof.python (46 lines) ----------
import clr
clr.AddReference('ProtoGeometry')
from Autodesk.DesignScript.Geometry import *

bottom_points = IN[0]
top_points = IN[1]
thickness = IN[2]
width = IN[3]
WoodenPanel = IN[4]

if not isinstance(thickness, list):
    thickness = [thickness]
if not isinstance(width, list):
    width = [width]

panels = []
volumes = []

count = min(len(bottom_points), len(top_points))

for i in range(count):
    t = thickness[i] if i < len(thickness) else thickness[-1]
    w = width[i] if i < len(width) else width[-1]
    btm = bottom_points[i]
    top = top_points[i]

    height = btm.DistanceTo(top)
    
    vector_up = Vector.ByTwoPoints(btm, top)

    plane = Plane.ByOriginNormal(btm, vector_up)
    cs = CoordinateSystem.ByPlane(plane)

    panel_obj = WoodenPanel(cs, w, t, height)
    geom = panel_obj.make_geometry()
    
    panels.append(geom)

    vol = t * w * height
    volumes.append(vol)
    total_volume = sum(volumes)
    volume_unit = "mm³"
    total_volume_label = "{0:.2f} {1}".format(total_volume, volume_unit)
    

OUT = (panels, volumes, total_volume_label)
# ----------------------------------------
code_block_50 = CodeBlock { 2; }
getItemAtIndex_3 = List.GetItemAtIndex(list=series_of_instances_wooden_roof, index=code_block_50)
watch_6 = Watch(getItemAtIndex_3)
class_steel_circular_rod = Python()  # CPython3; unwired: IN[0]; same code as circular_rod
number_slider_8 = DoubleSlider(150, range=100..200 step 1)
series_of_instances_steel_posts = Python(IN[0]=class_steel_circular_rod, IN[1]=pointAtParameter_5, IN[2]=pointAtParameter_6, IN[3]=number_slider_8)  # CPython3
# ---------- series_of_instances_steel_posts.python (28 lines) ----------
import math

CircularRod = IN[0]          
bottom_points = IN[1]        
top_points = IN[2]           
radius = IN[3]               

geometries = []
volumes = []

for bottom, top in zip(bottom_points, top_points):
    rod = CircularRod(bottom, top, radius)
    geo = rod.make_geometry()
    geometries.append(geo)

    try:
        vol = rod.Volume
    except AttributeError:
        height = bottom.DistanceTo(top)
        vol = math.pi * (radius ** 2) * height

    volumes.append(vol)

total_volume = sum(volumes)
volume_unit = "mm³"
total_volume_label = "{0:.2f} {1}".format(total_volume, volume_unit)

OUT = (geometries, volumes, total_volume_label)
# ----------------------------------------
code_block_51 = CodeBlock { 2; }
getItemAtIndex_4 = List.GetItemAtIndex(list=series_of_instances_steel_posts, index=code_block_51)
watch_7 = Watch(getItemAtIndex_4)

# group: Connector Points
code_block_52 = CodeBlock { 0; 0; 4050; }
top_point_of_connector = Point.ByCoordinates(x=code_block_52.out0, y=code_block_52.out1, z=code_block_52.out2)
code_block_53 = CodeBlock { 0; 0; 3950; }
bottom_point_of_connector = Point.ByCoordinates(x=code_block_53.out0, y=code_block_53.out1, z=code_block_53.out2)

outer_radius = DoubleSlider(3200, range=3000..3500 step 0.1)
inner_radius = DoubleSlider(3000, range=3000..3500 step 0.1)
instance_of_steel_cylinder = Python(IN[0]=class_steel_circular_rod, IN[1]=top_point_of_connector, IN[2]=bottom_point_of_connector, IN[3]=outer_radius, IN[4]=inner_radius)  # "Instance of Steel Cylinder Connecting the Roof and Posts"; CPython3
# ---------- instance_of_steel_cylinder.python (23 lines) ----------
import sys
import clr
clr.AddReference('ProtoGeometry')
from Autodesk.DesignScript.Geometry import *

CircularRod = IN [0]
top_point = IN [1]
bottom_point = IN [2] 
outer_radius = IN [3]
inner_radius = IN [4]

positive_connector = Cylinder.ByPointsRadius(bottom_point, top_point, outer_radius)

negative_connector = Cylinder.ByPointsRadius(bottom_point, top_point, inner_radius)

connector = Solid.Difference(positive_connector, negative_connector)

vol = connector.Volume
volume_unit = "mm³"
volume_label = "{0:.2f} {1}".format(vol, volume_unit)
    

OUT = connector, volume_label
# ----------------------------------------
code_block_54 = CodeBlock { 1; }
getItemAtIndex_5 = List.GetItemAtIndex(list=instance_of_steel_cylinder, index=code_block_54)
watch_8 = Watch(getItemAtIndex_5)
