# Dynamo graph 1853110.dyn (Dynamo 3.6.0.9395)

# group: Don't touch this ground
code_block = CodeBlock { -5000; -5000; -200; }
byCoordinates = Point.ByCoordinates(x=code_block.out0, y=code_block.out1, z=code_block.out2)
code_block_2 = CodeBlock { 5000; 5000; 0; }
byCoordinates_2 = Point.ByCoordinates(x=code_block_2.out0, y=code_block_2.out1, z=code_block_2.out2)
byCorners = Cuboid.ByCorners(lowPoint=byCoordinates, highPoint=byCoordinates_2)
code_block_3 = CodeBlock { 0; 100; 0; }
byARGB = Color.ByARGB(red=code_block_3.out0, green=code_block_3.out1, blue=code_block_3.out2)
byGeometryColor = Modifiers.GeometryColor.ByGeometryColor(geometry=byCorners, color=byARGB)

code_block_4 = CodeBlock { x=-4500; y=2500; z=0; }
byCoordinates_3 = Point.ByCoordinates(x=code_block_4.x, y=code_block_4.y, z=code_block_4.z)
arc1_height = DoubleSlider(4764.8, range=2000..5000 step 0.1)
code_block_5 = CodeBlock(z=arc1_height) { x=-5000; y=0; z; }
byCoordinates_4 = Point.ByCoordinates(x=code_block_5.x, y=code_block_5.y, z=code_block_5.z)
code_block_6 = CodeBlock { x=-3000; y=-3000; z=0; }
byCoordinates_5 = Point.ByCoordinates(x=code_block_6.x, y=code_block_6.y, z=code_block_6.z)
arc_1 = Arc.ByThreePoints(firstPoint=byCoordinates_3, secondPoint=byCoordinates_4, thirdPoint=byCoordinates_5)
number_of_points_for_pillars = CodeBlock { 0..1..#30; }
arc1_points = Curve.PointAtParameter(curve=arc_1, param=number_of_points_for_pillars)
code_block_7 = CodeBlock { x=3000; y=3000; z=0; }
byCoordinates_6 = Point.ByCoordinates(x=code_block_7.x, y=code_block_7.y, z=code_block_7.z)
arc2_height = DoubleSlider(3456.1, range=2000..5000 step 0.1)
code_block_8 = CodeBlock(z=arc2_height) { x=5000; y=0; z; }
byCoordinates_7 = Point.ByCoordinates(x=code_block_8.x, y=code_block_8.y, z=code_block_8.z)
code_block_9 = CodeBlock { x=4500; y=-2500; z=0; }
byCoordinates_8 = Point.ByCoordinates(x=code_block_9.x, y=code_block_9.y, z=code_block_9.z)
arc_2 = Arc.ByThreePoints(firstPoint=byCoordinates_6, secondPoint=byCoordinates_7, thirdPoint=byCoordinates_8)
number_of_points_for_pillars_2 = CodeBlock { 0..1..#30; }
arc2_points = Curve.PointAtParameter(curve=arc_2, param=number_of_points_for_pillars_2)
number_slider = DoubleSlider(200, range=75..200 step 0.1)
code_block_10 = CodeBlock(x=number_slider) { x; 10; 0; }
sequence = Sequence(start=code_block_10.x, amount=code_block_10.out1, step=code_block_10.out2)
class_rods = Python()  # CPython3; unwired: IN[0]
# ---------- class_rods.python (17 lines) ----------
# Load the Python Standard and DesignScript Libraries
import sys
import clr
clr.AddReference('ProtoGeometry')
from Autodesk.DesignScript.Geometry import *

class c_rod:
    def __init__(self, bottom_point, top_point, radius):
        self.bottom = bottom_point
        self.top = top_point
        self.radius = radius
        
    def make_geometry(self):
        return Cylinder.ByPointsRadius(self.bottom, self.top, self.radius)
        
OUT = c_rod
           
# ----------------------------------------
series_of_instances_for_rods = Python(IN[0]=arc1_points, IN[1]=arc2_points, IN[2]=sequence, IN[3]=class_rods)  # CPython3
# ---------- series_of_instances_for_rods.python (20 lines) ----------
c_rod = IN[3]
bottom_p = IN[0]
top_p = IN[1]
radius = IN[2]

rods = []
count = min(len(bottom_p),len(top_p))

for i in range(count):
    if i < len(radius):
        r = radius[i]
    else:
        radius[-1]
    bottom = bottom_p[i]
    top = top_p[i]
    
    rod = c_rod(bottom, top, r)
    rods.append(rod.make_geometry())
    
OUT = rods
# ----------------------------------------
code_block_11 = CodeBlock(h=arc2_height) { x=4500; y=0; z=(h/2); }
origin_for_pillar = Point.ByCoordinates(x=code_block_11.x, y=code_block_11.y, z=code_block_11.z)
length_and_width_of_pillar = DoubleSlider(400.8, range=200..500 step 0.1)
class_rect_pillar = Python()  # CPython3; unwired: IN[0]
# ---------- class_rect_pillar.python (18 lines) ----------
# Load the Python Standard and DesignScript Libraries
import sys
import clr
clr.AddReference('ProtoGeometry')
from Autodesk.DesignScript.Geometry import *

class rect_pillar:
    def __init__(self, origin, width, length,  height):
        self.length = length
        self.width = width
        self.height = height
        self.origin = origin
        
    def make_geometry(self):
        return Cuboid.ByLengths(self.origin, self.width, self.length, self.height)
        
OUT = rect_pillar
           
# ----------------------------------------
instance_for_pillar = Python(IN[0]=origin_for_pillar, IN[1]=length_and_width_of_pillar, IN[2]=length_and_width_of_pillar, IN[3]=arc2_height, IN[4]=class_rect_pillar)  # CPython3
# ---------- instance_for_pillar.python (25 lines) ----------
# Load the Python Standard and DesignScript Libraries
import sys
import clr
clr.AddReference('ProtoGeometry')
from Autodesk.DesignScript.Geometry import *

origin = IN[0]
widths = IN[1] if isinstance(IN[1], list) else [IN[1]]
lengths = IN[2] if isinstance(IN[2], list) else [IN[2]]
heights = IN[3] if isinstance(IN[3], list) else [IN[3]]
rect_pillar = IN[4]

pillars = []

count = min(len(widths), len(lengths), len(heights))

for i in range(count):
    w = widths[i] if i < len(widths) else widths[-1]
    l = lengths[i] if i < len(lengths) else lengths[-1]
    h = heights[i] if i < len(heights) else heights[-1]
    
    pillar = rect_pillar(origin, w, l, h)
    pillars.append(pillar.make_geometry())

OUT = pillars
# ----------------------------------------
