# Dynamo graph 1853141.dyn (Dynamo 3.6.0.9395)

# group: Don't touch this ground
code_block = CodeBlock { -5000; -5000; -200; }
byCoordinates = Point.ByCoordinates(x=code_block.out0, y=code_block.out1, z=code_block.out2)
code_block_2 = CodeBlock { 5000; 5000; 0; }
byCoordinates_2 = Point.ByCoordinates(x=code_block_2.out0, y=code_block_2.out1, z=code_block_2.out2)
byCorners = Cuboid.ByCorners(lowPoint=byCoordinates, highPoint=byCoordinates_2)
code_block_3 = CodeBlock { 0; 150; 0; }
byARGB = Color.ByARGB(red=code_block_3.out0, green=code_block_3.out1, blue=code_block_3.out2)
byGeometryColor = Modifiers.GeometryColor.ByGeometryColor(geometry=byCorners, color=byARGB)

number_of_squares = DoubleSlider(44, range=1..50 step 1)

# group: Centerline
center_start_pt = CodeBlock { x = -4000; y = 0; z = 1500; }
centerline_start = Point.ByCoordinates(x=center_start_pt.x, y=center_start_pt.y, z=center_start_pt.z)
center_end_pt = CodeBlock { x = 4000; y = 0; z = 1500; }
centerline_end = Point.ByCoordinates(x=center_end_pt.x, y=center_end_pt.y, z=center_end_pt.z)
centerline = Line.ByStartPointEndPoint(startPoint=centerline_start, endPoint=centerline_end)
code_block_4 = CodeBlock(n=number_of_squares) { n; 0..1..#n+1; }
split_centerline = Curve.PointAtParameter(curve=centerline, param=code_block_4.out1)

# group: Class +Slider Dimensions
width_big = DoubleSlider(500, range=100..500 step 10)
length_big = DoubleSlider(5000, range=2000..5000 step 10)
class_steel_squares = Python()  # CPython3; unwired: IN[0]
# ---------- class_steel_squares.python (37 lines) ----------
# Load the Python Standard and DesignScript Libraries
import sys
import clr
clr.AddReference('ProtoGeometry')
from Autodesk.DesignScript.Geometry import *
import Autodesk.DesignScript.Geometry as geom

class steelFrames:
    
    def __init__(self, center_line, width, length, height):
        
        self.center_line = center_line
        self.width = width
        self.length = length
        self.height = height


    def createFrames(self):
        frames = []
        for pt in self.center_line:           
            frame = self.create_frame_at_point(pt)
            frames.append(frame)
        return frames


    def create_frame_at_point(self, pt):
        cuboid = Cuboid.ByLengths(pt, self.width, self.length, self.height)
        return cuboid
        
    def frameVolume(self,cuboid):
        return cuboid.Volume
        
    def totalVolume(self, frames):
        totVolume = sum(self.frameVolume(frame) for frame in frames)
        return totalVolume

OUT = steelFrames   
# ----------------------------------------

XAxis = Vector.XAxis()

# group: Rotation
rotation = DoubleSlider(168, range=0..360 step 1)
rotation_2 = CodeBlock(N_of_Boxes=number_of_squares, N_of_Rotations=rotation) { N_of_Boxes; N_of_Rotations; 0..N_of_Rotations*360..#N_of_Boxes; }

# group: Big Squares
series_of_big_squares = Python(IN[0]=split_centerline, IN[1]=width_big, IN[2]=length_big, IN[3]=class_steel_squares)  # CPython3
# ---------- series_of_big_squares.python (15 lines) ----------
center_line = IN[0]
width = IN[1]
length = IN[2]
steelFrames = IN[3]
height = 3000

bigSquare = steelFrames(center_line, width, length, height)
frames = bigSquare.createFrames()

frameVolumes = [bigSquare.frameVolume(frame) for frame in frames]

bigVolume = sum(frameVolumes) 
bigVolOut = "{0:.2f} {1}".format(bigVolume, "mm³")

OUT = (frames, bigVolOut, bigVolume)
# ----------------------------------------
volout_index = CodeBlock { 1; }
bigVolumeOut = List.GetItemAtIndex(list=series_of_big_squares, index=volout_index)
watch = Watch(bigVolumeOut)
frame_index = CodeBlock { 0; }
out_big_frames = List.GetItemAtIndex(list=series_of_big_squares, index=frame_index)
rotate = Geometry.Rotate(geometry=out_big_frames, origin=split_centerline, axis=XAxis, degrees=rotation_2.out2)

# group: Small Squares
series_of_small_squares = Python(IN[0]=split_centerline, IN[1]=width_big, IN[2]=length_big, IN[3]=class_steel_squares)  # CPython3
# ---------- series_of_small_squares.python (15 lines) ----------
steelFrames = IN[3]
center_line = IN[0]
width = IN[1]
length = IN[2]-100
height = 2800

smallSquare = steelFrames(center_line, width, length, height)
frames = smallSquare.createFrames()

frameVolumes = [smallSquare.frameVolume(frame) for frame in frames]

smallVolumes = sum(frameVolumes) 
smallVolOut = "{0:.2f} {1}".format(smallVolumes, "mm³")

OUT = (frames, smallVolOut, smallVolumes)
# ----------------------------------------
vol_index = CodeBlock { 1; }
small_volume = List.GetItemAtIndex(list=series_of_small_squares, index=vol_index)
watch_2 = Watch(small_volume)
frame_index_2 = CodeBlock { 0; }
out_small_frames = List.GetItemAtIndex(list=series_of_small_squares, index=frame_index_2)
rotate_2 = Geometry.Rotate(geometry=out_small_frames, origin=split_centerline, axis=XAxis, degrees=rotation_2.out2)

# group: Total Frame Volume (including ground and platform intersections)
vol_index_2 = CodeBlock { 2; }
big_volume = List.GetItemAtIndex(list=series_of_big_squares, index=vol_index_2)
small_volume_2 = List.GetItemAtIndex(list=series_of_small_squares, index=vol_index_2)
total_frame_vol = Python(IN[0]=big_volume, IN[1]=small_volume_2)  # CPython3
# ---------- total_frame_vol.python (12 lines) ----------
# Load the Python Standard and DesignScript Libraries
import sys
import clr
clr.AddReference('ProtoGeometry')
from Autodesk.DesignScript.Geometry import *

big = IN[0]
small = IN[1]

vol = big-small
volOut = "{0:.2f}{1}".format(vol, "mm")
OUT = (vol,volOut)
# ----------------------------------------
index = CodeBlock { 1; }
vol_label = List.GetItemAtIndex(list=total_frame_vol, index=index)
frames_total_volume = Watch(vol_label)
index_2 = CodeBlock { 0; }
vol_number = List.GetItemAtIndex(list=total_frame_vol, index=index_2)

frameMaker = Solid.DifferenceAll(solid=rotate, others=rotate_2)

# group: To get rid of frame parts below + intersecting with ground
coordinate = CodeBlock { x=0; y=0; z=-1000; wl=10000; h=1900; }
points = Point.ByCoordinates(x=coordinate.x, y=coordinate.y, z=coordinate.z)
ground = Cuboid.ByLengths(origin=points, width=coordinate.wl, length=coordinate.wl, height=coordinate.h)
ground_volume = Solid.Volume(solid=ground)
ground_frames = Solid.DifferenceAll(solid=ground, others=frameMaker)
function_node = Solid.Volume(solid=ground_frames)
sum = Math.Sum(values=function_node)
watch_3 = Watch(sum)
intersection = ground_volume - watch_3
frames_ground = Solid.DifferenceAll(solid=frameMaker, others=ground)

# group: Wooden Platform
platform_start_pt = CodeBlock { x = -4500; y = 0; z = 125; }
platform_start = Point.ByCoordinates(x=platform_start_pt.x, y=platform_start_pt.y, z=platform_start_pt.z)
platform_end_pt = CodeBlock { x = 4500; y = 0; z = 125; }
platform_end = Point.ByCoordinates(x=platform_end_pt.x, y=platform_end_pt.y, z=platform_end_pt.z)
platform_line = Line.ByStartPointEndPoint(startPoint=platform_start, endPoint=platform_end)
number_of_planks = DoubleSlider(33, range=1..100 step 1)
code_block_5 = CodeBlock(n=number_of_planks) { n; 0..1..#n+1; }
split_centerline_2 = Curve.PointAtParameter(curve=platform_line, param=code_block_5.out1)
width = DoubleSlider(200, range=100..500 step 100)
length = DoubleSlider(5000, range=1000..5000 step 100)
class_platform = Python()  # CPython3; unwired: IN[0]
# ---------- class_platform.python (31 lines) ----------
# Load the Python Standard and DesignScript Libraries
import sys
import clr
clr.AddReference('ProtoGeometry')
from Autodesk.DesignScript.Geometry import *

class platformCreate:
    
    def __init__(self, center_line, width, length, height):
        
        self.center_line = center_line
        self.width = width
        self.length = length
        self.height = height

    def createPlanks(self):
        planks = []
        for pt in self.center_line:           
            plank = self.create_plank_at_point(pt)
            planks.append(plank)
        return planks

    def create_plank_at_point(self, pt):
        cuboid = Cuboid.ByLengths(pt, self.width, self.length, self.height)
        return cuboid
        
    def planksVolume(self,cuboid):
        return cuboid.Volume
        

OUT = platformCreate   
# ----------------------------------------
series_of_wooden_planks = Python(IN[0]=split_centerline_2, IN[1]=width, IN[2]=length, IN[3]=class_platform)  # CPython3
# ---------- series_of_wooden_planks.python (15 lines) ----------
center_line = IN[0]
width = IN[1]/2
length = IN[2]
platformCreate = IN[3]
height = 300

plank = platformCreate(center_line, width, length, height)
platform = plank.createPlanks()

plankVolumes = [plank.planksVolume(p) for p in platform]

platformVol = sum(plankVolumes)
platformVolOut = "{0:.2f} {1}".format(platformVol, "mm")

OUT = (platform, platformVol, platformVolOut)
# ----------------------------------------
code_block_6 = CodeBlock { 0; }
platform_vol = List.GetItemAtIndex(list=series_of_wooden_planks, index=code_block_6)
code_block_7 = CodeBlock { 2; }
platform_vol_2 = List.GetItemAtIndex(list=series_of_wooden_planks, index=code_block_7)
watch_4 = Watch(platform_vol_2)
RGB = CodeBlock { r=189; g=150; b=107; }
byARGB_2 = Color.ByARGB(red=RGB.r, green=RGB.g, blue=RGB.b)
byGeometryColor_2 = Modifiers.GeometryColor.ByGeometryColor(geometry=platform_vol, color=byARGB_2)

# group: To find vol of frames intersecting with platform
platform_frames = Solid.DifferenceAll(solid=platform_vol, others=frameMaker)
volume = Solid.Volume(solid=platform_frames)
sum_2 = Math.Sum(values=volume)
frames_platform = Solid.DifferenceAll(solid=frameMaker, others=platform_vol)
volume_2 = Solid.Volume(solid=frames_platform)
sum_3 = Math.Sum(values=volume_2)
vol_of_frame_and_platform = sum_2 - sum_3  # "Vol of Frame and Platform Intersection"
watch_5 = Watch(vol_of_frame_and_platform)

# group: Final Steel Frame Information
frame_platform_ground = Python(IN[0]=vol_number, IN[1]=intersection, IN[2]=watch_5)  # "Frame - (platform + ground) intersections"; CPython3
# ---------- frame_platform_ground.python (13 lines) ----------
# Load the Python Standard and DesignScript Libraries
import sys
import clr
clr.AddReference('ProtoGeometry')
from Autodesk.DesignScript.Geometry import *

totalFrames = IN[0]
totalGroundIntersect = IN[1]
totalPlatform = IN[2]

vol = totalFrames-totalGroundIntersect-totalPlatform
volOut = "{0:.2f}{1}".format(vol, " mm³")
OUT = (volOut)
# ----------------------------------------
watch_6 = Watch(frame_platform_ground)

# group: Final Wooden Platform Information
final_wooden_platform_volume = Python(IN[0]=sum_2)  # CPython3
# ---------- final_wooden_platform_volume.python (5 lines) ----------
platformVol = IN[0]

platformVolOut = "{0:.2f} {1}".format(platformVol, "mm³")

OUT = platformVolOut
# ----------------------------------------
watch_7 = Watch(final_wooden_platform_volume)
