# Dynamo graph 1853152.dyn "Atlantis-jmankoo1853152" (Dynamo 3.6.0.9395)

# group: Starting 10m x 10m Base
code_block = CodeBlock { -5000; -5000; -200; }
byCoordinates = Point.ByCoordinates(x=code_block.out0, y=code_block.out1, z=code_block.out2)
code_block_2 = CodeBlock { 5000; 5000; 0; }
byCoordinates_2 = Point.ByCoordinates(x=code_block_2.out0, y=code_block_2.out1, z=code_block_2.out2)
byCorners = Cuboid.ByCorners(lowPoint=byCoordinates, highPoint=byCoordinates_2)
code_block_3 = CodeBlock { 0; 100; 0; }
byARGB = Color.ByARGB(red=code_block_3.out0, green=code_block_3.out1, blue=code_block_3.out2)
byGeometryColor = Modifiers.GeometryColor.ByGeometryColor(geometry=byCorners, color=byARGB)

# group: Pavilion Structure Base (Wood)
# One Sphere with Radius 4000 mm and then a smaller Sphere with Radius 3900 mm that wsa subtracted, a Plane to Create a Hemisphere, 2 Cylinder with Radius 2500 mm subtracted to Create the Base
pavilion_base = CodeBlock { x = 0; y = 0; z = 0; radius = 4900; radius2= 4800; }
byCoordinates_3 = Point.ByCoordinates(x=pavilion_base.x, y=pavilion_base.y, z=pavilion_base.z)
ZAxis = Vector.ZAxis()
byOriginNormal = Plane.ByOriginNormal(origin=byCoordinates_3, normal=ZAxis)
sphere_pavilion = Sphere.ByCenterPointRadius(centerPoint=byCoordinates_3, radius=pavilion_base.radius)
smaller_sphere_to_remove_inside = Sphere.ByCenterPointRadius(centerPoint=byCoordinates_3, radius=pavilion_base.radius2)
difference = Solid.Difference(solid=sphere_pavilion, other=smaller_sphere_to_remove_inside)
ZAxis_2 = Vector.ZAxis()
byOriginNormal_2 = Plane.ByOriginNormal(origin=byCoordinates_3, normal=ZAxis_2)
split = Geometry.Split(geometry=difference, other=byOriginNormal_2)
code_block_4 = CodeBlock { 0; }
getItemAtIndex = List.GetItemAtIndex(list=split, index=code_block_4)
code_block_5 = CodeBlock { -5000; 0; 0; }
byCoordinates_4 = Point.ByCoordinates(x=code_block_5.out0, y=code_block_5.out1, z=code_block_5.out2)
code_block_6 = CodeBlock { 5000; 0; 0; }
byCoordinates_5 = Point.ByCoordinates(x=code_block_6.out0, y=code_block_6.out1, z=code_block_6.out2)
radius_of_subtracting_cylinders = DoubleSlider(3000, range=1..3000 step 1)
byPointsRadius = Cylinder.ByPointsRadius(startPoint=byCoordinates_4, endPoint=byCoordinates_5, radius=radius_of_subtracting_cylinders)
difference_2 = Solid.Difference(solid=getItemAtIndex, other=byPointsRadius)
code_block_7 = CodeBlock { 0; }
getItemAtIndex_2 = List.GetItemAtIndex(list=difference_2, index=code_block_7)
code_block_8 = CodeBlock { 0; 5000; 0; }
byCoordinates_6 = Point.ByCoordinates(x=code_block_8.out0, y=code_block_8.out1, z=code_block_8.out2)
code_block_9 = CodeBlock { 0; -5000; 0; }
byCoordinates_7 = Point.ByCoordinates(x=code_block_9.out0, y=code_block_9.out1, z=code_block_9.out2)
byPointsRadius_2 = Cylinder.ByPointsRadius(startPoint=byCoordinates_6, endPoint=byCoordinates_7, radius=radius_of_subtracting_cylinders)
difference_3 = Solid.Difference(solid=difference_2, other=byPointsRadius_2)
watch = Watch(difference_3)
code_block_10 = CodeBlock { 0; }
getItemAtIndex_3 = List.GetItemAtIndex(list=difference_3, index=code_block_10)

# group: Wood Beams (Arcs, Class, 4 Instances)
# Created 4 Arcs by Three Points, 2 Instances are for Structural Support and 2 for the Design
class_for_wood_beams = Python()  # CPython3; unwired: IN[0]
# ---------- class_for_wood_beams.python (29 lines) ----------
# Load the Python Standard and DesignScript Libraries
import sys
import clr
clr.AddReference('ProtoGeometry')
from Autodesk.DesignScript.Geometry import *
import math 

class WoodBeams:
    def __init__(self, arc, radius):
        self.arc = arc
        self.radius = radius
        
    def EndPts(self):
        return self.arc.StartPoint,
        self.arcEndPoint
        
    def MakeGeometry(self):
        Beam = Circle.ByCenterPointRadius(self.arc.StartPoint, self.radius)
       
        CurvedBeam = Beam.SweepAsSolid(self.arc)
       
        return CurvedBeam
               
    def MeasureVol(self):
        LengthBeam = self.arc.Length
        
        return math.pi * (self.radius ** 2) * LengthBeam

OUT = WoodBeams 
# ----------------------------------------
code_block_11 = CodeBlock { 3360; 3360; 800; }
byCoordinates_8 = Point.ByCoordinates(x=code_block_11.out0, y=code_block_11.out1, z=code_block_11.out2)
code_block_12 = CodeBlock { 0; 0; 5000; }
byCoordinates_9 = Point.ByCoordinates(x=code_block_12.out0, y=code_block_12.out1, z=code_block_12.out2)
code_block_13 = CodeBlock { -3360; -3360; 800; }
byCoordinates_10 = Point.ByCoordinates(x=code_block_13.out0, y=code_block_13.out1, z=code_block_13.out2)
byThreePoints = Arc.ByThreePoints(firstPoint=byCoordinates_8, secondPoint=byCoordinates_9, thirdPoint=byCoordinates_10)
subtracted_wood_beam_radius = DoubleSlider(550, range=1..1000 step 1)
instance_3_for_wood_beam = Python(IN[0]=class_for_wood_beams, IN[1]=byThreePoints, IN[2]=subtracted_wood_beam_radius)  # "Instance 3 for Wood Beam - Subtracted from Pavilion Base"; CPython3
# ---------- instance_3_for_wood_beam.python (10 lines) ----------
WoodBeams = IN[0]
arc = IN[1]
radius = IN[2]

CurvedBeam = WoodBeams(arc, radius)
volume = CurvedBeam.MeasureVol()
volume_unit = "mm^3"

OUT = CurvedBeam.MakeGeometry(),"{:.2f} {}".format(volume, volume_unit)
 
# ----------------------------------------
code_block_14 = CodeBlock { 0; }
getItemAtIndex_4 = List.GetItemAtIndex(list=instance_3_for_wood_beam, index=code_block_14)
code_block_15 = CodeBlock { 3360; -3360; 800; }
byCoordinates_11 = Point.ByCoordinates(x=code_block_15.out0, y=code_block_15.out1, z=code_block_15.out2)
code_block_16 = CodeBlock { 0; 0; 5000; }
byCoordinates_12 = Point.ByCoordinates(x=code_block_16.out0, y=code_block_16.out1, z=code_block_16.out2)
code_block_17 = CodeBlock { -3360; 3360; 800; }
byCoordinates_13 = Point.ByCoordinates(x=code_block_17.out0, y=code_block_17.out1, z=code_block_17.out2)
byThreePoints_2 = Arc.ByThreePoints(firstPoint=byCoordinates_11, secondPoint=byCoordinates_12, thirdPoint=byCoordinates_13)
instance_4_for_wood_beam = Python(IN[0]=class_for_wood_beams, IN[1]=byThreePoints_2, IN[2]=subtracted_wood_beam_radius)  # "Instance 4 for Wood Beam - Subtracted from Pavilion Base"; CPython3; same code as instance_3_for_wood_beam
getItemAtIndex_5 = List.GetItemAtIndex(list=instance_4_for_wood_beam, index=code_block_14)
code_block_18 = CodeBlock { 3360; 3360; 0; }
byCoordinates_14 = Point.ByCoordinates(x=code_block_18.out0, y=code_block_18.out1, z=code_block_18.out2)
code_block_19 = CodeBlock { 0; 0; 4200; }
byCoordinates_15 = Point.ByCoordinates(x=code_block_19.out0, y=code_block_19.out1, z=code_block_19.out2)
code_block_20 = CodeBlock { -3360; -3360; 0; }
byCoordinates_16 = Point.ByCoordinates(x=code_block_20.out0, y=code_block_20.out1, z=code_block_20.out2)
byThreePoints_3 = Arc.ByThreePoints(firstPoint=byCoordinates_14, secondPoint=byCoordinates_15, thirdPoint=byCoordinates_16)
wood_beam_radius = DoubleSlider(150, range=1..500 step 1)
instance_1_for_wood_beam = Python(IN[0]=class_for_wood_beams, IN[1]=byThreePoints_3, IN[2]=wood_beam_radius)  # CPython3; same code as instance_3_for_wood_beam
watch_2 = Watch(instance_1_for_wood_beam)
code_block_21 = CodeBlock { 3360; -3360; 0; }
byCoordinates_17 = Point.ByCoordinates(x=code_block_21.out0, y=code_block_21.out1, z=code_block_21.out2)
code_block_22 = CodeBlock { 0; 0; 4200; }
byCoordinates_18 = Point.ByCoordinates(x=code_block_22.out0, y=code_block_22.out1, z=code_block_22.out2)
code_block_23 = CodeBlock { -3360; 3360; 0; }
byCoordinates_19 = Point.ByCoordinates(x=code_block_23.out0, y=code_block_23.out1, z=code_block_23.out2)
byThreePoints_4 = Arc.ByThreePoints(firstPoint=byCoordinates_17, secondPoint=byCoordinates_18, thirdPoint=byCoordinates_19)
instance_2_for_wood_beam = Python(IN[0]=class_for_wood_beams, IN[1]=byThreePoints_4, IN[2]=wood_beam_radius)  # CPython3; same code as instance_3_for_wood_beam
watch_3 = Watch(instance_2_for_wood_beam)
code_block_24 = CodeBlock { 3600; 0; 3000; }
byCoordinates_20 = Point.ByCoordinates(x=code_block_24.out0, y=code_block_24.out1, z=code_block_24.out2)
code_block_25 = CodeBlock { 0; 0; 4200; }
byCoordinates_21 = Point.ByCoordinates(x=code_block_25.out0, y=code_block_25.out1, z=code_block_25.out2)
code_block_26 = CodeBlock { -3600; 0; 3000; }
byCoordinates_22 = Point.ByCoordinates(x=code_block_26.out0, y=code_block_26.out1, z=code_block_26.out2)
byThreePoints_5 = Arc.ByThreePoints(firstPoint=byCoordinates_20, secondPoint=byCoordinates_21, thirdPoint=byCoordinates_22)
instance_5_for_wood_beam = Python(IN[0]=class_for_wood_beams, IN[1]=byThreePoints_5, IN[2]=wood_beam_radius)  # CPython3; same code as instance_3_for_wood_beam
watch_4 = Watch(instance_5_for_wood_beam)
code_block_27 = CodeBlock { 0; 3600; 3000; }
byCoordinates_23 = Point.ByCoordinates(x=code_block_27.out0, y=code_block_27.out1, z=code_block_27.out2)
code_block_28 = CodeBlock { 0; 0; 4200; }
byCoordinates_24 = Point.ByCoordinates(x=code_block_28.out0, y=code_block_28.out1, z=code_block_28.out2)
code_block_29 = CodeBlock { 0; -3600; 3000; }
byCoordinates_25 = Point.ByCoordinates(x=code_block_29.out0, y=code_block_29.out1, z=code_block_29.out2)
byThreePoints_6 = Arc.ByThreePoints(firstPoint=byCoordinates_23, secondPoint=byCoordinates_24, thirdPoint=byCoordinates_25)
instance_6_for_wood_beam = Python(IN[0]=class_for_wood_beams, IN[1]=byThreePoints_6, IN[2]=wood_beam_radius)  # CPython3; same code as instance_3_for_wood_beam
watch_5 = Watch(instance_6_for_wood_beam)

# group: Updated Pavilion Base
# Subtracted the 3rd and 4th Instance of Steel Beams
difference_4 = Solid.Difference(solid=getItemAtIndex_3, other=getItemAtIndex_4)
difference_5 = Solid.Difference(solid=difference_4, other=getItemAtIndex_5)
code_block_30 = CodeBlock { 0; }
getItemAtIndex_6 = List.GetItemAtIndex(list=difference_5, index=code_block_30)

# group: Glass Structure
# Created 5 Glass Cuboids using one Class and 5 instances
glass_structure = Python()  # CPython3; unwired: IN[0]
# ---------- glass_structure.python (25 lines) ----------
# Load the Python Standard and DesignScript Libraries
import sys
import clr
clr.AddReference('ProtoGeometry')
from Autodesk.DesignScript.Geometry import *
import math

class GlassStructure:
    def __init__(self, center, width, length, height):
        self.center = center
        self.width = width
        self.length = length
        self.height = height 
        
    def MakeGeometry(self):
        GlassBeam = Cuboid.ByLengths(self.center, self.width, self.length, self.height)
        
        return GlassBeam
        
    def MeasureVol(self):
        GlassBeam = self.MakeGeometry()
        
        return GlassBeam.Volume

OUT = GlassStructure
# ----------------------------------------
code_block_31 = CodeBlock { 0; 0; 2400; }
byCoordinates_26 = Point.ByCoordinates(x=code_block_31.out0, y=code_block_31.out1, z=code_block_31.out2)
length_and_width = DoubleSlider(600, range=1..1000 step 0.1)
height = DoubleSlider(4800, range=1..10000 step 0.1)
glassstructure_instance_1 = Python(IN[0]=glass_structure, IN[1]=byCoordinates_26, IN[2]=length_and_width, IN[3]=length_and_width, IN[4]=height)  # CPython3
# ---------- glassstructure_instance_1.python (11 lines) ----------
GlassStructure = IN[0]
center = IN[1]
width = IN[2]
length = IN[3]
height = IN[4]

Structure = GlassStructure(center, width, length, height)
volume = Structure.MeasureVol()
volume_unit = "mm^3"

OUT = Structure.MakeGeometry(), "{:.2f} {}".format(volume, volume_unit)
# ----------------------------------------
watch_6 = Watch(glassstructure_instance_1)
code_block_32 = CodeBlock { 300; 300; 1900; }
byCoordinates_27 = Point.ByCoordinates(x=code_block_32.out0, y=code_block_32.out1, z=code_block_32.out2)
height_2 = DoubleSlider(3800, range=1..10000 step 0.1)
glassstructure_instance_2 = Python(IN[0]=glass_structure, IN[1]=byCoordinates_27, IN[2]=length_and_width, IN[3]=length_and_width, IN[4]=height_2)  # CPython3; same code as glassstructure_instance_1
watch_7 = Watch(glassstructure_instance_2)
code_block_33 = CodeBlock { -300; -300; 1900; }
byCoordinates_28 = Point.ByCoordinates(x=code_block_33.out0, y=code_block_33.out1, z=code_block_33.out2)
height_3 = DoubleSlider(3800, range=1..10000 step 0.1)
glassstructure_instance_3 = Python(IN[0]=glass_structure, IN[1]=byCoordinates_28, IN[2]=length_and_width, IN[3]=length_and_width, IN[4]=height_3)  # CPython3; same code as glassstructure_instance_1
watch_8 = Watch(glassstructure_instance_3)
code_block_34 = CodeBlock { 600; 600; 1400; }
byCoordinates_29 = Point.ByCoordinates(x=code_block_34.out0, y=code_block_34.out1, z=code_block_34.out2)
height_4 = DoubleSlider(2800, range=1..10000 step 0.1)
glassstructure_instance_4 = Python(IN[0]=glass_structure, IN[1]=byCoordinates_29, IN[2]=length_and_width, IN[3]=length_and_width, IN[4]=height_4)  # CPython3; same code as glassstructure_instance_1
watch_9 = Watch(glassstructure_instance_4)
code_block_35 = CodeBlock { -600; -600; 1400; }
byCoordinates_30 = Point.ByCoordinates(x=code_block_35.out0, y=code_block_35.out1, z=code_block_35.out2)
height_5 = DoubleSlider(2800, range=1..10000 step 0.1)
glassstructure_instance_5 = Python(IN[0]=glass_structure, IN[1]=byCoordinates_30, IN[2]=length_and_width, IN[3]=length_and_width, IN[4]=height_5)  # CPython3; same code as glassstructure_instance_1
watch_10 = Watch(glassstructure_instance_5)
