# Dynamo graph 1853215.dyn (Dynamo 3.6.0.9395)

code_block = CodeBlock { -5000; -5000; -200; }
byCoordinates = Point.ByCoordinates(x=code_block.out0, y=code_block.out1, z=code_block.out2)
code_block_2 = CodeBlock { 5000; 5000; 0; }
byCoordinates_2 = Point.ByCoordinates(x=code_block_2.out0, y=code_block_2.out1, z=code_block_2.out2)
byCorners = Cuboid.ByCorners(lowPoint=byCoordinates, highPoint=byCoordinates_2)
code_block_3 = CodeBlock { 0; 100; 0; }
byARGB = Color.ByARGB(red=code_block_3.out0, green=code_block_3.out1, blue=code_block_3.out2)
byGeometryColor = Modifiers.GeometryColor.ByGeometryColor(geometry=byCorners, color=byARGB)
amt_of_rods = DoubleSlider(30, range=5..40 step 1)
diameter_of_teepee = DoubleSlider(4500, range=50..4500 step 1)
code_for_teepee_bottom_points = CodeBlock(rodCount=amt_of_rods, radius=diameter_of_teepee)  # "Code for Teepee bottom points circle"
# ---------- code_for_teepee_bottom_points.designscript (8 lines) ----------
rodCount;
         // connect slider here;
radius;

xs = radius * Math.Cos(0..360..#rodCount);
ys = radius * Math.Sin(0..360..#rodCount);

bottom_points = Point.ByCoordinates(xs, ys, 0);
# ----------------------------------------
height_of_teepee = DoubleSlider(5000, range=0..10000 step 500)
height_of_tp = Point.ByCoordinates(z=height_of_teepee)
tip_of_teepee = List.OfRepeatedItem(item=height_of_tp, amount=amt_of_rods)
circular_rod_radius = DoubleSlider(180, range=50..1200 step 10)
circular_steel_rod = Python()  # CPython3; unwired: IN[0]
# ---------- circular_steel_rod.python (19 lines) ----------
# Load the Python Standard and DesignScript Libraries
import sys
import clr
clr.AddReference('ProtoGeometry')
from Autodesk.DesignScript.Geometry import *

class CircularRod:
    def __init__(self, bottom_point, top_point, radius):
        self.bottom = bottom_point
        self.top = top_point
        self.radius = radius
        
    def make_geometry(self):
        return Cylinder.ByPointsRadius(self.bottom, self.top, self.radius)
        
    def volume(self):
        solid = self.make_geometry()
        return solid.Volume
OUT = CircularRod
# ----------------------------------------
final_target = Python(IN[0]=code_for_teepee_bottom_points.bottom_points, IN[1]=tip_of_teepee, IN[2]=circular_rod_radius, IN[3]=circular_steel_rod)  # CPython3
# ---------- final_target.python (36 lines) ----------
CircularRod = IN[3]
bottom_points = IN[0]
top_points = IN[1]
radius_input = IN[2]   # this can be a single number from a slider or a list

rods = [] #solids
volumes = [] #numbers (mm^3)

count = min(len(bottom_points), len(top_points))

# --- normalize radius input to a list ---
if isinstance(radius_input, list):
    # If it's already a list, pad or trim it to match count
    if len(radius_input) == 0:
        radii = [1.0] * count
    elif len(radius_input) < count:
        last = radius_input[-1]
        radii = radius_input + [last] * (count - len(radius_input))
    else:
        radii = radius_input[:count]
else:
    # Single value (e.g. from Number Slider) → use same radius for all rods
    radii = [radius_input] * count

# --- build rods ---
for i in range(count):
    r = radii[i]
    btm = bottom_points[i]
    top = top_points[i]
    
    rod = CircularRod(btm, top, r)
    solid = rod.make_geometry()
    rods.append(solid)
    volumes.append(rod.volume())

OUT = [rods, volumes]
# ----------------------------------------
number = DoubleInput(1)
volume_converter = List.GetItemAtIndex(list=final_target, index=number)
material_volume_1 = Math.Sum(values=volume_converter)
steel_rod_total_volume_mm_3 = Watch(material_volume_1)
slab_dimensions = CodeBlock { 9500; 9500; 200; }
wodden_slab = Python(IN[0]=slab_dimensions.out0, IN[1]=slab_dimensions.out1, IN[2]=slab_dimensions.out2)  # CPython3
# ---------- wodden_slab.python (24 lines) ----------
import clr
clr.AddReference('ProtoGeometry')
from Autodesk.DesignScript.Geometry import *

class Slab:
    def __init__(self, length, width, thickness):
        self.length = length
        self.width = width
        self.thickness = thickness

    def toSolid(self):
        # centered at origin, you can move it after
        return Cuboid.ByLengths(self.length, self.width, self.thickness)

    def volume(self):
        return self.toSolid().Volume

# Inputs
L = IN[0]   # length slider
W = IN[1]   # width slider
T = IN[2]   # thickness slider

slab = Slab(L, W, T)
OUT = slab.toSolid(), slab.volume()
# ----------------------------------------
number_2 = DoubleInput(1)
volume_converter_2 = List.GetItemAtIndex(list=wodden_slab, index=number_2)
wooden_slab_total_volume_mm_3 = Watch(volume_converter_2)
