# Dynamo graph 1853410.dyn (Dynamo 3.6.0.9395)

# group: Don't touch this ground
code_block = CodeBlock { -5000; -5000; -200; }
byCoordinates = Point.ByCoordinates(x=code_block.out0, y=code_block.out1, z=code_block.out2)
code_block_2 = CodeBlock { 5000; 5000; 0; }
byCoordinates_2 = Point.ByCoordinates(x=code_block_2.out0, y=code_block_2.out1, z=code_block_2.out2)
byCorners = Cuboid.ByCorners(lowPoint=byCoordinates, highPoint=byCoordinates_2)
code_block_3 = CodeBlock { 0; 100; 0; }
byARGB = Color.ByARGB(red=code_block_3.out0, green=code_block_3.out1, blue=code_block_3.out2)
byGeometryColor = Modifiers.GeometryColor.ByGeometryColor(geometry=byCorners, color=byARGB)

radius = DoubleSlider(3000, range=3000..4500 step 100)
column_height = DoubleSlider(2600, range=2600..3500 step 100)
columns = DoubleSlider(6, range=6..14 step 1)
timber_radius = DoubleSlider(80, range=80..200 step 10)
fabric_thickness = DoubleSlider(5, range=5..30 step 5)
roof = DoubleSlider(700, range=300..1200 step 100)
python_script = Python(IN[0]=radius, IN[1]=column_height, IN[2]=columns, IN[3]=timber_radius, IN[4]=fabric_thickness, IN[5]=roof)  # CPython3
# ---------- python_script.python (93 lines) ----------
# Load the Python Standard and DesignScript Libraries
import sys
import clr
import math
clr.AddReference('ProtoGeometry')
from Autodesk.DesignScript.Geometry import *

radius = IN[0]
columnHeight = IN[1]
nCols = int(IN[2])
timberRadius = IN[3]
plasticThickness = IN[4]
roofRise = IN[5]

innerRadiusFactor = 0.7
innerRadius = radius * innerRadiusFactor
zBase = 0.0
zTop = columnHeight
zInner = columnHeight + roofRise


class TimberMember:
    def __init__(self, startPt, endPt, radius):
        self.startPt = startPt
        self.endPt = endPt
        self.radius = radius
        self.solid = Cylinder.ByPointsRadius(self.startPt, self.endPt, self.radius)
        self.volume = self.solid.Volume

class PlasticPanel:
    def __init__(self, p0, p1, p2, p3, thickness):
        pts = [p0, p1, p2, p3, p0]
        crv = PolyCurve.ByPoints(pts)
        self.surface = Surface.ByPatch(crv)
        self.thickness = thickness
        self.area = self.surface.Area
        self.volume = self.area * self.thickness


def circle_points(radius, z):
    pts = []
    for i in range(nCols):
        angle = 2.0 * math.pi * i / float(nCols)
        x = radius * math.cos(angle)
        y = radius * math.sin(angle)
        pts.append(Point.ByCoordinates(x, y, z))
    return pts

basePts = circle_points(radius, zBase)
topPts = circle_points(radius, zTop)
innerPts = circle_points(innerRadius, zInner)


timberColumns = []
for b, t in zip(basePts, topPts):
    timberColumns.append(TimberMember(b, t, timberRadius))


timberBeams = []
for i in range(nCols):
    p0 = topPts[i]
    p1 = topPts[(i + 1) % nCols]
    timberBeams.append(TimberMember(p0, p1, timberRadius * 0.7))

for i in range(nCols):
    p0 = topPts[i]
    p1 = innerPts[i]
    timberBeams.append(TimberMember(p0, p1, timberRadius * 0.5))


plasticPanels = []
for i in range(nCols):
    p0 = topPts[i]
    p1 = topPts[(i + 1) % nCols]
    p2 = innerPts[(i + 1) % nCols]
    p3 = innerPts[i]
    plasticPanels.append(PlasticPanel(p0, p1, p2, p3, plasticThickness))
    
innerLoopPts = innerPts + [innerPts[0]]
innerLoop = PolyCurve.ByPoints(innerLoopPts)
centerPlasticSurface = Surface.ByPatch(innerLoop)
centerPlasticArea = centerPlasticSurface.Area
centerPlasticVolume = centerPlasticArea * plasticThickness


colSolids = [c.solid for c in timberColumns]
beamSolids = [b.solid for b in timberBeams]
plasticSurfs = [f.surface for f in plasticPanels] + [centerPlasticSurface]

timberVolume = sum([c.volume for c in timberColumns] + [b.volume for b in timberBeams])
plasticVolume = sum([f.volume for f in plasticPanels]) + centerPlasticVolume

OUT = [colSolids, beamSolids, plasticSurfs, timberVolume, plasticVolume]
# ----------------------------------------
