# Dynamo graph 1853739.dyn (Dynamo 3.6.0.9395)

code_block = CodeBlock { -5000; -5000; -200; }
byCoordinates = Point.ByCoordinates(x=code_block.out0, y=code_block.out1, z=code_block.out2)
code_block_2 = CodeBlock { 5000; 5000; 0; }
byCoordinates_2 = Point.ByCoordinates(x=code_block_2.out0, y=code_block_2.out1, z=code_block_2.out2)
byCorners = Cuboid.ByCorners(lowPoint=byCoordinates, highPoint=byCoordinates_2)
code_block_3 = CodeBlock { 0; 100; 0; }
byARGB = Color.ByARGB(red=code_block_3.out0, green=code_block_3.out1, blue=code_block_3.out2)
byGeometryColor = Modifiers.GeometryColor.ByGeometryColor(geometry=byCorners, color=byARGB)
code_block_4 = CodeBlock { x = 4500; y = -3000; z = 0; }
start_point = Point.ByCoordinates(x=code_block_4.x, y=code_block_4.y, z=code_block_4.z)
code_block_5 = CodeBlock { x = -4500; y = -3000; z = 0; }
end_point = Point.ByCoordinates(x=code_block_5.x, y=code_block_5.y, z=code_block_5.z)
bottom_line = Line.ByStartPointEndPoint(startPoint=start_point, endPoint=end_point)
code_block_6 = CodeBlock { 0; 6; 1/5; }
sequence = Sequence(start=code_block_6.out0, amount=code_block_6.out1, step=code_block_6.out2)
pointAtParameter = Curve.PointAtParameter(curve=bottom_line, param=sequence)
code_block_7 = CodeBlock { x = 4500; y = -1000; z = 8000; }
start_point_2 = Point.ByCoordinates(x=code_block_7.x, y=code_block_7.y, z=code_block_7.z)
code_block_8 = CodeBlock { x = -4500; y = -1000; z = 8000; }
end_point_2 = Point.ByCoordinates(x=code_block_8.x, y=code_block_8.y, z=code_block_8.z)
top_line = Line.ByStartPointEndPoint(startPoint=start_point_2, endPoint=end_point_2)
pointAtParameter_2 = Curve.PointAtParameter(curve=top_line, param=sequence)
code_block_9 = CodeBlock { 300; }
steel_beam_class = Python()  # CPython3; unwired: IN[0]
# ---------- steel_beam_class.python (29 lines) ----------
# Load the Python Standard and DesignScript Libraries
import sys
import clr
clr.AddReference('ProtoGeometry')
from Autodesk.DesignScript.Geometry import *

class steelBeam(object):
    def __init__(self, bottom_point, top_point, width, depth):
        self.bottom = bottom_point
        self.top    = top_point
        self.width  = width
        self.depth  = depth
        self._geom  = None

    def make_geometry(self):
        if self._geom is not None:
            return self._geom
        path    = Line.ByStartPointEndPoint(self.bottom, self.top)
        vec     = Vector.ByTwoPoints(self.bottom, self.top)
        pln     = Plane.ByOriginNormal(self.bottom, vec)
        profile = Rectangle.ByWidthLength(pln, self.width, self.depth)
        self._geom = Solid.BySweep(profile, path)
        return self._geom

    def volume(self):
        geom = self.make_geometry()
        return geom.Volume

OUT = steelBeam
# ----------------------------------------
steel_beam_series_of_instances_1 = Python(IN[0]=pointAtParameter, IN[1]=pointAtParameter_2, IN[2]=code_block_9, IN[3]=steel_beam_class)  # CPython3
# ---------- steel_beam_series_of_instances_1.python (29 lines) ----------
# Load the Python Standard and DesignScript Libraries
import sys
import clr
clr.AddReference('ProtoGeometry')
from Autodesk.DesignScript.Geometry import *

bottom_points = IN[0]
top_points = IN[1]
size = IN[2]
steelBeam = IN[3]

beams   = []
volumes = []

count = min(len(bottom_points), len(top_points))

for i in range(count):
    btm = bottom_points[i]
    top = top_points[i]

    beam = steelBeam(btm, top, size, size)

    geom = beam.make_geometry()
    beams.append(geom)

    vol = beam.volume()
    volumes.append(vol)

OUT = (beams, volumes)
# ----------------------------------------
code_block_10 = CodeBlock { 1; }
volume_1 = List.GetItemAtIndex(list=steel_beam_series_of_instances_1, index=code_block_10)
code_block_11 = CodeBlock { x = 4500; y = 3000; z = 0; }
start_point_3 = Point.ByCoordinates(x=code_block_11.x, y=code_block_11.y, z=code_block_11.z)
code_block_12 = CodeBlock { x = -4500; y = 3000; z = 0; }
end_point_3 = Point.ByCoordinates(x=code_block_12.x, y=code_block_12.y, z=code_block_12.z)
bottom_line_2 = Line.ByStartPointEndPoint(startPoint=start_point_3, endPoint=end_point_3)
pointAtParameter_3 = Curve.PointAtParameter(curve=bottom_line_2, param=sequence)
code_block_13 = CodeBlock { x = 4500; y = -1000; z = 8000; }
start_point_4 = Point.ByCoordinates(x=code_block_13.x, y=code_block_13.y, z=code_block_13.z)
code_block_14 = CodeBlock { x = -4500; y = -1000; z = 8000; }
end_point_4 = Point.ByCoordinates(x=code_block_14.x, y=code_block_14.y, z=code_block_14.z)
top_line_2 = Line.ByStartPointEndPoint(startPoint=start_point_4, endPoint=end_point_4)
pointAtParameter_4 = Curve.PointAtParameter(curve=top_line_2, param=sequence)
steel_beams_series_of_instances = Python(IN[0]=pointAtParameter_3, IN[1]=pointAtParameter_4, IN[2]=code_block_9, IN[3]=steel_beam_class)  # "Steel Beams - Series of Instances 1"; CPython3; same code as steel_beam_series_of_instances_1
volume_2 = List.GetItemAtIndex(list=steel_beams_series_of_instances, index=code_block_10)
code_block_15 = CodeBlock { 4650; -1000; 8100; }
start_point_5 = Point.ByCoordinates(x=code_block_15.out0, y=code_block_15.out1, z=code_block_15.out2)
code_block_16 = CodeBlock { -4650; -1000; 8100; }
end_point_5 = Point.ByCoordinates(x=code_block_16.out0, y=code_block_16.out1, z=code_block_16.out2)
size = CodeBlock { 200; }
steel_beam_instance = Python(IN[0]=start_point_5, IN[1]=end_point_5, IN[2]=size, IN[3]=steel_beam_class)  # CPython3
# ---------- steel_beam_instance.python (20 lines) ----------
# Load the Python Standard and DesignScript Libraries
import sys
import clr
clr.AddReference('ProtoGeometry')
from Autodesk.DesignScript.Geometry import *

start_pt  = IN[0]
end_pt    = IN[1]
size      = IN[2]
steelBeam = IN[3] 

width = size
depth = size

beam_obj = steelBeam(start_pt, end_pt, width, depth)

geom = beam_obj.make_geometry()
vol  = beam_obj.volume()

OUT = (geom, vol)
# ----------------------------------------
code_block_17 = CodeBlock { 1; }
volume_3 = List.GetItemAtIndex(list=steel_beam_instance, index=code_block_17)
code_block_18 = CodeBlock { x = 4500; y = 3000; z = 0; }
start_point_6 = Point.ByCoordinates(x=code_block_18.x, y=code_block_18.y, z=code_block_18.z)
code_block_19 = CodeBlock { x = -4500; y = 3000; z = 0; }
end_point_6 = Point.ByCoordinates(x=code_block_19.x, y=code_block_19.y, z=code_block_19.z)
bottom_line_3 = Line.ByStartPointEndPoint(startPoint=start_point_6, endPoint=end_point_6)
code_block_20 = CodeBlock { 0; 6; 1/5; }
sequence_2 = Sequence(start=code_block_20.out0, amount=code_block_20.out1, step=code_block_20.out2)
pointAtParameter_5 = Curve.PointAtParameter(curve=bottom_line_3, param=sequence_2)
offset_base_points = CodeBlock(p=pointAtParameter_5) { Point.ByCoordinates(p.X + 550, p.Y+1000, p.Z); }
code_block_21 = CodeBlock { x = 4500; y = 4000; z = 9999; }
start_point_7 = Point.ByCoordinates(x=code_block_21.x, y=code_block_21.y, z=code_block_21.z)
code_block_22 = CodeBlock { x = -4500; y = 4000; z = 9999; }
end_point_7 = Point.ByCoordinates(x=code_block_22.x, y=code_block_22.y, z=code_block_22.z)
top_line_3 = Line.ByStartPointEndPoint(startPoint=start_point_7, endPoint=end_point_7)
pointAtParameter_6 = Curve.PointAtParameter(curve=top_line_3, param=sequence_2)
byStartPointEndPoint = Line.ByStartPointEndPoint(startPoint=offset_base_points, endPoint=pointAtParameter_6)
n1st_point = CodeBlock { 4999; 4000; }  # "1st point"
end_curve_point_z_values = DoubleSlider(7358.9, range=6500..8000 step 0.1)
top_point_1 = Point.ByCoordinates(x=n1st_point.out0, y=n1st_point.out1, z=end_curve_point_z_values)
n2nd_point = CodeBlock { 0; 4000; }  # "2nd point"
middle_curve_point_z_value = DoubleSlider(4492.3, range=4000..5500 step 0.1)
bottom_point = Point.ByCoordinates(x=n2nd_point.out0, y=n2nd_point.out1, z=middle_curve_point_z_value)
n3rd_point = CodeBlock { -4500; 4000; }  # "3rd point"
top_point_2 = Point.ByCoordinates(x=n3rd_point.out0, y=n3rd_point.out1, z=end_curve_point_z_values)
positive_curve = Arc.ByThreePoints(firstPoint=top_point_1, secondPoint=bottom_point, thirdPoint=top_point_2)
intersect = Geometry.Intersect(geometry=byStartPointEndPoint, other=positive_curve)
code_block_23 = CodeBlock { x = 4500; y = -3000; z = 0; }
start_point_8 = Point.ByCoordinates(x=code_block_23.x, y=code_block_23.y, z=code_block_23.z)
code_block_24 = CodeBlock { x = -4500; y = -3000; z = 0; }
end_point_8 = Point.ByCoordinates(x=code_block_24.x, y=code_block_24.y, z=code_block_24.z)
bottom_line_4 = Line.ByStartPointEndPoint(startPoint=start_point_8, endPoint=end_point_8)
pointAtParameter_7 = Curve.PointAtParameter(curve=bottom_line_4, param=sequence_2)
offset_base_points_2 = CodeBlock(p=pointAtParameter_7) { Point.ByCoordinates(p.X + 550, p.Y - 1000, p.Z); }
code_block_25 = CodeBlock { x = 4500; y = -4000; z = 9999; }
start_point_9 = Point.ByCoordinates(x=code_block_25.x, y=code_block_25.y, z=code_block_25.z)
code_block_26 = CodeBlock { x = -4500; y = -4000; z = 9999; }
end_point_9 = Point.ByCoordinates(x=code_block_26.x, y=code_block_26.y, z=code_block_26.z)
top_line_4 = Line.ByStartPointEndPoint(startPoint=start_point_9, endPoint=end_point_9)
pointAtParameter_8 = Curve.PointAtParameter(curve=top_line_4, param=sequence_2)
byStartPointEndPoint_2 = Line.ByStartPointEndPoint(startPoint=offset_base_points_2, endPoint=pointAtParameter_8)
n1st_point_2 = CodeBlock { 4999; -4000; 4000; }  # "1st point"
bottom_point_1 = Point.ByCoordinates(x=n1st_point_2.out0, y=n1st_point_2.out1, z=n1st_point_2.out2)
n2nd_point_2 = CodeBlock { 0; -4000; 6500; }  # "2nd point"
top_point = Point.ByCoordinates(x=n2nd_point_2.out0, y=n2nd_point_2.out1, z=n2nd_point_2.out2)
n3rd_point_2 = CodeBlock { -4500; -4000; 4000; }  # "3rd point"
bottom_point_2 = Point.ByCoordinates(x=n3rd_point_2.out0, y=n3rd_point_2.out1, z=n3rd_point_2.out2)
negative_curve = Arc.ByThreePoints(firstPoint=bottom_point_1, secondPoint=top_point, thirdPoint=bottom_point_2)
intersect_2 = Geometry.Intersect(geometry=byStartPointEndPoint_2, other=negative_curve)
size_2 = CodeBlock { 200; }
steel_beams_series_of_instances_2 = Python(IN[0]=intersect, IN[1]=intersect_2, IN[2]=size_2, IN[3]=steel_beam_class)  # "Steel Beams - Series of Instances 2"; CPython3
# ---------- steel_beams_series_of_instances_2.python (41 lines) ----------
# Load the Python Standard and DesignScript Libraries
import sys
import clr
clr.AddReference('ProtoGeometry')
from Autodesk.DesignScript.Geometry import *

bottom_in = IN[0]
top_in    = IN[1]
size      = IN[2]
steelBeam = IN[3]

def flatten_points(data):
    pts = []
    if isinstance(data, list):
        for item in data:
            pts.extend(flatten_points(item))
    else:
        pts.append(data)
    return pts

bottomPoints = flatten_points(bottom_in)
topPoints    = flatten_points(top_in)

beams   = []
volumes = []

count = min(len(bottomPoints), len(topPoints))

for i in range(count):
    btm = bottomPoints[i]
    top = topPoints[i]

    beam_obj = steelBeam(btm, top, size, size)

    geom = beam_obj.make_geometry()
    vol  = beam_obj.volume()

    beams.append(geom)
    volumes.append(vol)

OUT = (beams, volumes)
# ----------------------------------------
code_block_27 = CodeBlock { 1; }
volume_4 = List.GetItemAtIndex(list=steel_beams_series_of_instances_2, index=code_block_27)
steel_beams_total_volume = Python(IN[0]=volume_1, IN[1]=volume_2, IN[2]=volume_3, IN[3]=volume_4)  # CPython3
# ---------- steel_beams_total_volume.python (33 lines) ----------
# Load the Python Standard and DesignScript Libraries
import sys
import clr
clr.AddReference('ProtoGeometry')
from Autodesk.DesignScript.Geometry import *

volumes_1 = IN[0]
volumes_2 = IN[1]
volumes_3 = IN[2]
volumes_4 = IN[3]

inputs = [volumes_1, volumes_2, volumes_3, volumes_4]

all_volumes = []

for item in inputs:
    if item is None:
        continue

    if isinstance(item, list):
        for v in item:
            if v is not None:
                all_volumes.append(v)
    else:
        all_volumes.append(item)

total_volume = 0
for v in all_volumes:

    if v is not None:
        total_volume = total_volume + v

OUT = total_volume
# ----------------------------------------
watch = Watch(steel_beams_total_volume)
code_block_28 = CodeBlock { 0; -2800; 250; }
byCoordinates_3 = Point.ByCoordinates(y=code_block_28.out1, z=code_block_28.out2)
code_block_29 = CodeBlock { 3600; -2800; 250; }
byCoordinates_4 = Point.ByCoordinates(x=code_block_29.out0, y=code_block_29.out1, z=code_block_29.out2)
code_block_30 = CodeBlock { -3600; -2800; 250; }
byCoordinates_5 = Point.ByCoordinates(x=code_block_30.out0, y=code_block_30.out1, z=code_block_30.out2)
code_block_31 = CodeBlock { -3600; 2800; 250; }
byCoordinates_6 = Point.ByCoordinates(x=code_block_31.out0, y=code_block_31.out1, z=code_block_31.out2)
code_block_32 = CodeBlock { 3600; 2800; 250; }
byCoordinates_7 = Point.ByCoordinates(x=code_block_32.out0, y=code_block_32.out1, z=code_block_32.out2)
code_block_33 = CodeBlock { 0; 2800; 250; }
byCoordinates_8 = Point.ByCoordinates(x=code_block_33.out0, y=code_block_33.out1, z=code_block_33.out2)
list_create = List.Create(item0=byCoordinates_3, item1=byCoordinates_4, item2=byCoordinates_5, item3=byCoordinates_6, item4=byCoordinates_7, item5=byCoordinates_8)
bench_length = DoubleSlider(1812.4, range=1000..2000 step 0.1)
code_block_34 = CodeBlock { width = 1500; height = 500; }
width_adjustment = DoubleSlider(1045.5, range=900..1350 step 0.1)
height_adjustment = DoubleSlider(303.4, range=250..350 step 0.1)
wood_bench_class_2 = Python()  # CPython3; unwired: IN[0]
# ---------- wood_bench_class_2.python (37 lines) ----------
# Load the Python Standard and DesignScript Libraries
import sys
import clr
clr.AddReference('ProtoGeometry')
from Autodesk.DesignScript.Geometry import *

class bench(object):
    def __init__(self, origin, length, outer_width, outer_height, inner_width, inner_height):
        self.origin = origin
        self.length = length
        self.outer_width = outer_width
        self.outer_height = outer_height
        self.inner_width = inner_width
        self.inner_height = inner_height
        self._geom = None

    def make_geometry(self):
        if self._geom is not None:
            return self._geom

        outer = Cuboid.ByLengths(
            self.origin, self.outer_width, self.length, self.outer_height)

        iw = min(self.inner_width,  self.outer_width)
        ih = min(self.inner_height, self.outer_height)

        inner = Cuboid.ByLengths(
            self.origin, iw, self.length, ih)

        self._geom = Solid.Difference(outer, inner)
        return self._geom

    def volume(self):
        geom = self.make_geometry()
        return geom.Volume

OUT = bench
# ----------------------------------------
wood_bench_series_of_instances_3 = Python(IN[0]=list_create, IN[1]=bench_length, IN[2]=code_block_34.width, IN[3]=code_block_34.height, IN[4]=width_adjustment, IN[5]=height_adjustment, IN[6]=wood_bench_class_2)  # CPython3
# ---------- wood_bench_series_of_instances_3.python (32 lines) ----------
# Load the Python Standard and DesignScript Libraries
import sys
import clr
clr.AddReference('ProtoGeometry')
from Autodesk.DesignScript.Geometry import *

origins     = IN[0]
benchLength = IN[1]
outerWidth  = IN[2]
outerHeight = IN[3]
innerWidth  = IN[4]
innerHeight = IN[5]
benchClass  = IN[6]

bench_geoms = []
bench_vols  = []

for origin in origins:
    if origin is None:
        continue

    iw = min(innerWidth,  outerWidth)
    ih = min(innerHeight, outerHeight)

    b = benchClass(origin, benchLength, outerWidth, outerHeight, iw, ih)

    geom = b.make_geometry()
    bench_geoms.append(geom)

    bench_vols.append(b.volume())

OUT = (bench_geoms, bench_vols)
# ----------------------------------------
code_block_35 = CodeBlock { 1; }
getItemAtIndex = List.GetItemAtIndex(list=wood_bench_series_of_instances_3, index=code_block_35)
wood_benches_total_volume = Python(IN[0]=getItemAtIndex)  # CPython3
# ---------- wood_benches_total_volume.python (18 lines) ----------
# Load the Python Standard and DesignScript Libraries
import sys
import clr
clr.AddReference('ProtoGeometry')
from Autodesk.DesignScript.Geometry import *

bench_vols = IN[0]

if not isinstance(bench_vols, list):
    bench_vols = [bench_vols]

total_volume = 0

for v in bench_vols:
    if v is not None:
        total_volume = total_volume + v

OUT = total_volume
# ----------------------------------------
watch_2 = Watch(wood_benches_total_volume)
code_block_36 = CodeBlock {  }
