# Dynamo graph 1853916.dyn (Dynamo 3.6.0.9395)

# group: Don't touch this ground
code_block = CodeBlock { -5000; -5000; -200; }
byCoordinates = Point.ByCoordinates(x=code_block.out0, y=code_block.out1, z=code_block.out2)
code_block_2 = CodeBlock { 5000; 5000; 0; }
byCoordinates_2 = Point.ByCoordinates(x=code_block_2.out0, y=code_block_2.out1, z=code_block_2.out2)
byCorners = Cuboid.ByCorners(lowPoint=byCoordinates, highPoint=byCoordinates_2)
code_block_3 = CodeBlock { 0; 100; 0; }
byARGB = Color.ByARGB(red=code_block_3.out0, green=code_block_3.out1, blue=code_block_3.out2)
byGeometryColor = Modifiers.GeometryColor.ByGeometryColor(geometry=byCorners, color=byARGB)

coord = CodeBlock { 0; }
coord_2 = CodeBlock { 0; 0; }
inner_circular_beam_height = DoubleSlider(4400, range=3000..9000 step 50)
center_point = Point.ByCoordinates(x=coord_2.out0, y=coord_2.out1, z=inner_circular_beam_height)
radius_of_circular_beam = DoubleSlider(600, range=500..1000 step 10)
inner_circle = Circle.ByCenterPointRadius(centerPoint=center_point, radius=radius_of_circular_beam)
negative_half_of_inner_circle = CodeBlock { 0.25; 0.75; }
trim_original_curve_points_on = Curve.TrimByParameter(curve=inner_circle, startParameter=negative_half_of_inner_circle.out0, endParameter=negative_half_of_inner_circle.out1)  # "Trim Original Curve - Points on negative half of inner circle"
number_of_timber_columns = DoubleSlider(50, range=10..50 step 1)
num_of_points_on_negative_half = CodeBlock(num_timber_columns=number_of_timber_columns) { divisions = 1 + num_timber_columns; }  # "Num of points on negative half of inner circle"
points_along_negative_half_of = Curve.PointsAtEqualSegmentLength(curve=trim_original_curve_points_on, divisions=num_of_points_on_negative_half)  # "points along negative half of Circular beam"
points_x_y_z_on_left_half_of = Watch(points_along_negative_half_of)  # "Points (x,y,z) on left half of inner circle"
bottom_quarter_positive_half_of = CodeBlock { 0.75; 1; }  # "Bottom Quarter Positive Half of Inner Circle"
trim_original_curve_points_on_2 = Curve.TrimByParameter(curve=inner_circle, startParameter=bottom_quarter_positive_half_of.out0, endParameter=bottom_quarter_positive_half_of.out1)  # "Trim original Curve - Points on Positive bottom quarter of inner circle"
top_quarter_positive_half_of = CodeBlock { 0; 0.25; }  # "Top Quarter positive Half of Inner Circle"
trim_original_curve_points_on_3 = Curve.TrimByParameter(curve=inner_circle, startParameter=top_quarter_positive_half_of.out0, endParameter=top_quarter_positive_half_of.out1)  # "Trim original Curve - Points on positive top quarter of inner circle"
join_positive_quarters_of_inner = Curve.Join(curve=trim_original_curve_points_on_2, curves=trim_original_curve_points_on_3)  # "Join Positive Quarters of inner circle"
num_of_points_on_positive_half = CodeBlock(num_timber_columns=number_of_timber_columns) { divisions = 1 + num_timber_columns; }  # "Num of points on Positive half of inner circle"
points_along_positive_half_of = Curve.PointsAtEqualSegmentLength(curve=join_positive_quarters_of_inner, divisions=num_of_points_on_positive_half)  # "points along Positive half of Circular beam"
point_x_y_z_on_positive_half_of = Watch(points_along_positive_half_of)  # "Point(x,y,z) on Positive half of inner circle"
coord_3 = CodeBlock { -1000; -4500; 0; }
arc_start_point = Point.ByCoordinates(x=coord_3.out0, y=coord_3.out1, z=coord_3.out2)
coord_4 = CodeBlock { -1000; 4500; 0; }
arc_end_point = Point.ByCoordinates(x=coord_4.out0, y=coord_4.out1, z=coord_4.out2)
timber_columns_angle_parameter = DoubleSlider(-4500, range=-4500..-3000 step 50)  # "Timber columns Angle Parameter Negative Side Bottom"
coord_5 = CodeBlock { 0; 0; }
arc_control_point = Point.ByCoordinates(x=timber_columns_angle_parameter, y=coord_5.out0, z=coord_5.out1)
arc_pathway_bottom_points = Python(IN[0]=arc_start_point, IN[1]=arc_end_point, IN[2]=arc_control_point, IN[3]=number_of_timber_columns)  # "Arc pathway bottom points - Negative side"; CPython3
# ---------- arc_pathway_bottom_points.python (15 lines) ----------
# Load the Python Standard and DesignScript Libraries
import clr
clr.AddReference('ProtoGeometry')
from Autodesk.DesignScript.Geometry import *

start = IN[0]    
end = IN[1]      
control = IN[2]  
Num_columns = int(IN[3])

arc = Arc.ByThreePoints(start, control, end)

points_on_arc = [arc.PointAtParameter(i / (Num_columns - 1)) for i in range(Num_columns)]

OUT = points_on_arc
# ----------------------------------------
coord_6 = CodeBlock { -1000; -4500; }
timber_columns_lowest_level = DoubleSlider(4000, range=3000..4500 step 50)
arc_start_point_2 = Point.ByCoordinates(x=coord_6.out0, y=coord_6.out1, z=timber_columns_lowest_level)
coord_7 = CodeBlock { -1000; 4500; }
timber_columns_highest_level = DoubleSlider(6400, range=4500..9000 step 50)
arc_end_point_2 = Point.ByCoordinates(x=coord_7.out0, y=coord_7.out1, z=timber_columns_highest_level)
timber_columns_angle_parameter_2 = DoubleSlider(-4500, range=-4500..-3000 step 50)  # "Timber columns Angle Parameter Negative Side Top"
timber_columns_control_height = DoubleSlider(4500, range=3000..9000 step 50)
arc_control_point_2 = Point.ByCoordinates(x=timber_columns_angle_parameter_2, z=timber_columns_control_height)
arc_pathway_top_points_negative = Python(IN[0]=arc_start_point_2, IN[1]=arc_end_point_2, IN[2]=arc_control_point_2, IN[3]=number_of_timber_columns)  # "Arc pathway top points - negative side"; CPython3; same code as arc_pathway_bottom_points
radius_of_timber_columns = DoubleSlider(50, range=50..300 step 1)
timber_Columns_Negative_Side_Class = Python()  # CPython3; unwired: IN[0], IN[1]
# ---------- timber_Columns_Negative_Side_Class.python (14 lines) ----------
import sys
import clr
clr.AddReference('ProtoGeometry')
from Autodesk.DesignScript.Geometry import *

class Timber_Columns:
    def __init__(self, bottom_point, top_point, radius):
        self.bottom = bottom_point
        self.top = top_point
        self.radius = radius
        
    def make_geometry(self) :
        return Cylinder.ByPointsRadius(self.bottom, self.top, self.radius)
OUT = Timber_Columns
# ----------------------------------------
series_of_instances_timber = Python(IN[0]=arc_pathway_bottom_points, IN[1]=arc_pathway_top_points_negative, IN[2]=radius_of_timber_columns, IN[3]=timber_Columns_Negative_Side_Class)  # "Series of Instances- Timber Circular Columns negative Side"; CPython3
# ---------- series_of_instances_timber.python (20 lines) ----------
Timber_Columns = IN[3]
bottom_points = IN[0]
top_points = IN[1]
radius = IN[2]


rods = []
count = min(len(bottom_points), len(top_points))


for i in range(count):
    r = radius
    btm = bottom_points[i]
    top = top_points[i]
   
    
    rod = Timber_Columns(btm, top, r)
    rods.append(rod.make_geometry())
    
OUT = rods
# ----------------------------------------
cylinder_radius_height_axis_y_z = Watch(series_of_instances_timber)  # "Cylinder(Radius, Height, Axis, Y, Z, Length )"
coord_8 = CodeBlock { 1000; -4500; 0; }
arc_start_point_3 = Point.ByCoordinates(x=coord_8.out0, y=coord_8.out1, z=coord_8.out2)
coord_9 = CodeBlock { 1000; 4500; 0; }
arc_end_point_3 = Point.ByCoordinates(x=coord_9.out0, y=coord_9.out1, z=coord_9.out2)
timber_columns_angle_parameter_3 = DoubleSlider(4500, range=3000..4500 step 50)  # "Timber columns Angle Parameter positive Side Bottom"
coord_10 = CodeBlock { 0; 0; }
arc_control_point_3 = Point.ByCoordinates(x=timber_columns_angle_parameter_3, y=coord_10.out1)
arc_pathway_bottom_points_2 = Python(IN[0]=arc_start_point_3, IN[1]=arc_end_point_3, IN[2]=arc_control_point_3, IN[3]=number_of_timber_columns)  # "Arc pathway bottom points - positive side"; CPython3; same code as arc_pathway_bottom_points
coord_11 = CodeBlock { 1000; -4500; }
arc_start_point_4 = Point.ByCoordinates(x=coord_11.out0, y=coord_11.out1, z=timber_columns_highest_level)
coord_12 = CodeBlock { 1000; 4500; }
arc_end_point_4 = Point.ByCoordinates(x=coord_12.out0, y=coord_12.out1, z=timber_columns_lowest_level)
timber_columns_angle_parameter_4 = DoubleSlider(4500, range=3000..4500 step 50)  # "Timber columns Angle Parameter Positive Side Top"
coord_13 = CodeBlock { 0; }
arc_control_point_4 = Point.ByCoordinates(x=timber_columns_angle_parameter_4, y=coord_13, z=timber_columns_control_height)
arc_pathway_top_points_positive = Python(IN[0]=arc_start_point_4, IN[1]=arc_end_point_4, IN[2]=arc_control_point_4, IN[3]=number_of_timber_columns)  # "Arc pathway top points - positive side"; CPython3; same code as arc_pathway_bottom_points
timber_Columns_Positive_Side_Class = Python()  # CPython3; unwired: IN[0], IN[1]
# ---------- timber_Columns_Positive_Side_Class.python (14 lines) ----------
import sys
import clr
clr.AddReference('ProtoGeometry')
from Autodesk.DesignScript.Geometry import *

class Timber_Columns:
    def __init__(self, bottom_point, top_point, radius):
        self.bottom = bottom_point
        self.top = top_point
        self. radius = radius
        
    def make_geometry(self) :
        return Cylinder.ByPointsRadius(self.bottom, self.top, self.radius)
OUT = Timber_Columns
# ----------------------------------------
series_of_instances_timber_2 = Python(IN[0]=arc_pathway_bottom_points_2, IN[1]=arc_pathway_top_points_positive, IN[2]=radius_of_timber_columns, IN[3]=timber_Columns_Positive_Side_Class)  # "Series of Instances- Timber Circular Columns Positive Side"; CPython3
# ---------- series_of_instances_timber_2.python (17 lines) ----------
Timber_Columns = IN[3]
bottom_points = IN[0]
top_points = IN[1]
radius = IN[2]

rods = []
count = min(len(bottom_points), len(top_points))

for i in range(count):
    r = radius
    btm = bottom_points[i]
    top = top_points[i]
    
    rod = Timber_Columns(btm, top, r)
    rods.append(rod.make_geometry())
    
OUT = rods
# ----------------------------------------
cylinder_radius_height_axis_y_z_2 = Watch(series_of_instances_timber_2)  # "Cylinder(Radius, Height, Axis, Y, Z, Length )"
width_of_timber_beams = CodeBlock(radius_cylindrical_columns=radius_of_timber_columns) { Width = 1.75*radius_cylindrical_columns; }
rectangular_timber_beams = Python()  # "Rectangular Timber Beams_negative Half - Class"; CPython3; unwired: IN[0]
# ---------- rectangular_timber_beams.python (23 lines) ----------
import sys
import clr
clr.AddReference('ProtoGeometry')
from Autodesk.DesignScript.Geometry import *

class Rectangular_Timber_Beams:
    def __init__(self, start_point, end_point, width):  
        self.start = start_point
        self.end = end_point
        self.width = width
        
    def make_geometry(self):
        line = Line.ByStartPointEndPoint(self.start, self.end)
        
        direction = line.Direction
        
        plane = Plane.ByOriginNormal(self.start, direction)
        
        rectangle = Rectangle.ByWidthLength(plane, self.width, self.width)
        
        beam = Solid.BySweep(rectangle, line)  
        return beam 
OUT = Rectangular_Timber_Beams  
# ----------------------------------------
series_of_instances_rectangular = Python(IN[0]=arc_pathway_top_points_negative, IN[1]=points_along_negative_half_of, IN[2]=width_of_timber_beams, IN[3]=rectangular_timber_beams)  # "Series of Instances - Rectangular Timber Beams - negative Half"; CPython3
# ---------- series_of_instances_rectangular.python (19 lines) ----------
Rectangular_Timber_Beams = IN[3]  
start_points = IN[0]
end_points = IN[1]
thickness = IN[2]

beams = []
count = min(len(start_points), len(end_points))


for start in start_points:
    distances = [start.DistanceTo(end) for end in end_points]
    
    minimum_distance = distances.index(min(distances))
    
    closest_point = end_points[minimum_distance]
    
    beam = Rectangular_Timber_Beams(start, closest_point, thickness)
    beams.append(beam.make_geometry())
OUT = beams
# ----------------------------------------
vertical_translation_beam = CodeBlock(width=width_of_timber_beams) { z= -(width/2); }
translate_beam_down = Geometry.Translate(geometry=series_of_instances_rectangular, zTranslation=vertical_translation_beam)
number_of_beams = Watch(translate_beam_down)
width_of_timber_beams_2 = CodeBlock(radius_cylindrical_columns=radius_of_timber_columns) { Width = 1.75*radius_cylindrical_columns; }
rectangular_timber_beams_2 = Python()  # "Rectangular Timber Beams_Positive Half - Class"; CPython3; unwired: IN[0]; same code as rectangular_timber_beams
series_of_instances_rectangular_2 = Python(IN[0]=arc_pathway_top_points_positive, IN[1]=points_along_positive_half_of, IN[2]=width_of_timber_beams_2, IN[3]=rectangular_timber_beams_2)  # "Series of Instances - Rectangular Timber Beams - positive Half"; CPython3
# ---------- series_of_instances_rectangular_2.python (18 lines) ----------
Rectangular_Timber_Beams = IN[3]  
start_points = IN[0]
end_points = IN[1]
thickness = IN[2]

beams = []
count = min(len(start_points), len(end_points))

for start in start_points:
    distances = [start.DistanceTo(end) for end in end_points]
    
    minimum_distance = distances.index(min(distances))
    
    closest_point = end_points[minimum_distance]
    
    beam = Rectangular_Timber_Beams(start, closest_point, thickness)
    beams.append(beam.make_geometry())
OUT = beams
# ----------------------------------------
vertical_translation_beam_2 = CodeBlock(width=width_of_timber_beams_2) { z= -(width/2); }
translate_beam_down_2 = Geometry.Translate(geometry=series_of_instances_rectangular_2, zTranslation=vertical_translation_beam_2)
number_of_beams_2 = Watch(translate_beam_down_2)
coord_14 = CodeBlock { 0; 0; 0; }
center_point_2 = Point.ByCoordinates(x=coord_14.out0, y=coord_14.out1, z=coord_14.out2)
bottom_inner_circle_for_steel = Circle.ByCenterPointRadius(centerPoint=center_point_2, radius=radius_of_circular_beam)  # "Bottom Inner circle for Steel Supports"
inner_circle_2 = CodeBlock { 0; 1; }
points_on_inner_circle = Curve.TrimByParameter(curve=bottom_inner_circle_for_steel, startParameter=inner_circle_2.out0, endParameter=inner_circle_2.out1)
number_of_steel_support_columns = DoubleSlider(6, range=4..15 step 1)  # "Number of Steel Support Columns Parameter"
point_at_bottom_inner_circle = Curve.PointsAtEqualSegmentLength(curve=points_on_inner_circle, divisions=number_of_steel_support_columns)
points_x_y_z_of_inner_circle = Watch(point_at_bottom_inner_circle)
coord_15 = CodeBlock { 0; 0; }
center_point_3 = Point.ByCoordinates(x=coord_15.out0, y=coord_15.out1, z=inner_circular_beam_height)
top_inner_circle_for_steel = Circle.ByCenterPointRadius(centerPoint=center_point_3, radius=radius_of_circular_beam)  # "top Inner Circle For steel supports"
inner_circle_3 = CodeBlock { 0; 1; }
points_on_inner_circle_2 = Curve.TrimByParameter(curve=top_inner_circle_for_steel, startParameter=inner_circle_3.out0, endParameter=inner_circle_3.out1)
point_at_4_top_inner_circle = Curve.PointsAtEqualSegmentLength(curve=points_on_inner_circle_2, divisions=number_of_steel_support_columns)
points_x_y_z_of_inner_circle_2 = Watch(point_at_4_top_inner_circle)
thickness_of_circular_beam = DoubleSlider(150, range=150..300 step 1)
radius_of_steel_supports = CodeBlock(t=thickness_of_circular_beam) { r = t/2; }
steel_center_support_columns = Python()  # CPython3; unwired: IN[0]
# ---------- steel_center_support_columns.python (14 lines) ----------
import sys
import clr
clr.AddReference('ProtoGeometry')
from Autodesk.DesignScript.Geometry import *

class Steel_Support_Columns:
    def __init__(self, bottom_point, top_point, radius):
        self.bottom = bottom_point
        self.top = top_point
        self. radius = radius
        
    def make_geometry(self) :
        return Cylinder.ByPointsRadius(self.bottom, self.top, self.radius)
OUT = Steel_Support_Columns
# ----------------------------------------
series_of_instances_steel_center = Python(IN[0]=point_at_4_top_inner_circle, IN[1]=point_at_bottom_inner_circle, IN[2]=radius_of_steel_supports, IN[3]=steel_center_support_columns)  # "Series of Instances - Steel Center Support Columns"; CPython3
# ---------- series_of_instances_steel_center.python (17 lines) ----------
Steel_Support_Columns = IN[3]
bottom_points = IN[0]
top_points = IN[1]
radius = IN[2]

rods = []
count = min(len(bottom_points), len(top_points))

for i in range(count):
    r = radius
    btm = bottom_points[i]
    top = top_points[i]
    
    rod = Steel_Support_Columns(btm, top, r)
    rods.append(rod.make_geometry())
    
OUT = rods
# ----------------------------------------
num_of_steel_supports = Watch(series_of_instances_steel_center)
inner_circle_curve_start_point = Curve.StartPoint(curve=inner_circle)
value = CodeBlock { 0; }
tangent_vector_at_start_of_path = Curve.TangentAtParameter(curve=inner_circle, param=value)
normal_plane_to_path = Plane.ByOriginNormal(origin=inner_circle_curve_start_point, normal=tangent_vector_at_start_of_path)
thickness_of_circular_beam_2 = CodeBlock(radius_cylindrical_columns=radius_of_timber_columns) { t=1.75*radius_cylindrical_columns; }
rectangle_to_be_swept_into_a = Rectangle.ByWidthLength(plane=normal_plane_to_path, width=thickness_of_circular_beam_2, length=thickness_of_circular_beam)  # "Rectangle to be swept into a circular beam"
timber_circular_beam = Surface.BySweep(profile=rectangle_to_be_swept_into_a, path=inner_circle)
timber = Python(IN[0]=series_of_instances_timber, IN[1]=series_of_instances_timber_2, IN[2]=translate_beam_down, IN[3]=translate_beam_down_2, IN[4]=timber_circular_beam)  # CPython3
# ---------- timber.python (22 lines) ----------
Timber_Columns_1 = IN[0]
Timber_Columns_2 = IN[1]
Timber_Beams_1 = IN[2]
Timber_Beams_2 = IN[3]
Timber_Circular_Beam = IN[4]

Timber_Structures = []

for Timber_list in [Timber_Columns_1, Timber_Columns_2, Timber_Beams_1, Timber_Beams_2, Timber_Circular_Beam]:
    if isinstance(Timber_list, list):
        Timber_Structures.extend(Timber_list)
    else:
        Timber_Structures.append(Timber_list)

total_volume = 0
for geo in Timber_Structures:
    if hasattr(geo, 'Volume'):
        total_volume += geo.Volume

OUT = total_volume

#Had some help from AI to calculate Volumes
# ----------------------------------------
timber_structures_total_volume = Watch(timber)  # "Timber Structures Total Volume in mm^3"
steel = Python(IN[0]=series_of_instances_steel_center)  # CPython3
# ---------- steel.python (11 lines) ----------
Steel_Support_Columns = IN[0]

if not isinstance(Steel_Support_Columns, list):
    Steel_Support_Columns = [Steel_Support_Columns]

total_volume = 0
for geo in Steel_Support_Columns:
    if hasattr(geo, 'Volume'):
        total_volume += geo.Volume

OUT = total_volume
# ----------------------------------------
steel_structures_total_volume_in = Watch(steel)  # "Steel Structures Total Volume in mm^3"
radius_of_concrete = DoubleSlider(4700, range=3000..5000 step 10)
height_of_concrete = DoubleSlider(70, range=20..70 step 10)
concrete_ground = Cylinder.ByRadiusHeight(radius=radius_of_concrete, height=height_of_concrete)
concrete = Python(IN[0]=concrete_ground)  # CPython3
# ---------- concrete.python (11 lines) ----------
Concrete = IN[0]

if not isinstance(Concrete, list):
    Concrete = [Concrete]

total_volume = 0
for geo in Concrete:
    if hasattr(geo, 'Volume'):
        total_volume += geo.Volume

OUT = total_volume
# ----------------------------------------
concrete_volume_in_mm_3 = Watch(concrete)
