# Dynamo graph 1853983.dyn (Dynamo 3.6.0.9395)

# group: Don't touch this ground
code_block = CodeBlock { -5000; -5000; -200; }
byCoordinates = Point.ByCoordinates(x=code_block.out0, y=code_block.out1, z=code_block.out2)
code_block_2 = CodeBlock { 5000; 5000; 0; }
byCoordinates_2 = Point.ByCoordinates(x=code_block_2.out0, y=code_block_2.out1, z=code_block_2.out2)
byCorners = Cuboid.ByCorners(lowPoint=byCoordinates, highPoint=byCoordinates_2)
code_block_3 = CodeBlock { 0; 100; 0; }
byARGB = Color.ByARGB(red=code_block_3.out0, green=code_block_3.out1, blue=code_block_3.out2)
byGeometryColor = Modifiers.GeometryColor.ByGeometryColor(geometry=byCorners, color=byARGB)

# group: Python Classes
# Two defined python classes here.
frp_fiber_reinforced_plastic = Python()  # "FRP (fiber-reinforced plastic) Petal"; CPython3; unwired: IN[0]
# ---------- frp_fiber_reinforced_plastic.python (86 lines) ----------
# Load the Python Standard and DesignScript Libraries
import sys
import clr
import math
clr.AddReference('ProtoGeometry')
from Autodesk.DesignScript.Geometry import *

class FRP_Petal:
    def __init__(self, angle, radius, support_width, height, petal_width, bulge, thickness):
        self.angle = float(angle)
        self.radius = float(radius)
        self.support_width = float(support_width)
        self.z = float(height)
        self.petal_width = float(petal_width)
        self.bulge = float(bulge)
        self.thickness = float(thickness)
    
    def build(self):
        # --- Calculating Bottom Points ---
    
        angle_change = self.support_width / self.radius
        center = Point.ByCoordinates(0,0, self.z)
        
        # Middle point of support that touches the ground
        x = self.radius * math.cos(self.angle)
        y = self.radius * math.sin(self.angle)
        mpt = Point.ByCoordinates(x, y, 0.3*self.thickness)
        
        # Left point of support that touches the ground
        xl = self.radius * math.cos(self.angle - angle_change)
        yl = self.radius * math.sin(self.angle - angle_change)
        lpt = Point.ByCoordinates(xl, yl, 0.3*self.thickness)
        
        # Right point of support that touches the ground
        xr = self.radius * math.cos(self.angle + angle_change)
        yr = self.radius * math.sin(self.angle + angle_change)
        rpt = Point.ByCoordinates(xr, yr, 0.3*self.thickness)
        
        # --- Constructing Curves ---
        
        # Middle Curve
        mid_m = Point.ByCoordinates(x * 1.005, y * 1.005, self.z - 0.6*self.z + 2 * self.bulge)
        mid_m2 = Point.ByCoordinates(x * 0.5, y * 0.5, self.z + 400 + self.bulge)
        mid_m3 = Point.ByCoordinates(x * 0.1, y * 0.1, self.z + 0.3 * self.bulge)
        curve_m = NurbsCurve.ByControlPoints([mpt, mid_m, mid_m2, mid_m3, center])
        
        # Rotate vector 90° for lateral push
        bx = -y * (self.petal_width / self.radius)
        by =  x * (self.petal_width / self.radius)
        
        # Left Curve
        mid_L = Point.ByCoordinates(xl - bx, yl - by, self.z - 150)
        mid_L2 = Point.ByCoordinates(xl/2 - bx, yl/2 - by, self.z - 80)
        curve_L = NurbsCurve.ByControlPoints([lpt, mid_L, mid_L2, center])
        
        # Right Curve
        mid_R = Point.ByCoordinates(xr + bx, yr + by, self.z - 150)                   
        mid_R2 = Point.ByCoordinates(xr/2 + bx, yr/2 + by, self.z - 80)
        curve_R = NurbsCurve.ByControlPoints([rpt, mid_R, mid_R2, center])
     
        # --- Contruct Solid ---
        
        # Left Petal Piece
        petal_loft_L = Surface.ByLoft([curve_L, curve_m])
        perimeter_L = PolyCurve.ByJoinedCurves(petal_loft_L.PerimeterCurves())
        solid_L = perimeter_L.ExtrudeAsSolid(self.thickness) # Control thickness
        
        # Right Petal Piece
        petal_loft_R = Surface.ByLoft([curve_R, curve_m])
        perimeter_R = PolyCurve.ByJoinedCurves(petal_loft_R.PerimeterCurves())
        solid_R = perimeter_R.ExtrudeAsSolid(-self.thickness) # Control thickness
        
        # --- Calculate Volume ---
        petal_volume = solid_R.Volume + solid_L.Volume
        
        return [solid_L, solid_R], petal_volume
      
OUT = FRP_Petal
       
        
        
   
        
        
        
        
# ----------------------------------------
steel_ribs = Python()  # CPython3; unwired: IN[0]
# ---------- steel_ribs.python (76 lines) ----------
# Load the Python Standard and DesignScript Libraries
import sys
import clr
import math
clr.AddReference('ProtoGeometry')
from Autodesk.DesignScript.Geometry import *

class Steel_Ribs:
    def __init__(self, angle, radius, support_width, height, petal_width, bulge, steel_radius):
        self.angle = float(angle)
        self.radius = float(radius)
        self.support_width = float(support_width)
        self.z = float(height)
        self.petal_width = float(petal_width)
        self.bulge = float(bulge)
        self.steel_radius = float(steel_radius)
    
    def build(self):
        # --- Calculating Bottom Points ---
    
        angle_change = self.support_width / self.radius
        center = Point.ByCoordinates(0,0, self.z)
        
        # Middle point of support that touches the ground
        x = self.radius * math.cos(self.angle)
        y = self.radius * math.sin(self.angle)
        mpt = Point.ByCoordinates(x, y)
        
        # Left point of support that touches the ground
        xl = self.radius * math.cos(self.angle - angle_change)
        yl = self.radius * math.sin(self.angle - angle_change)
        lpt = Point.ByCoordinates(xl, yl)
        
        # Right point of support that touches the ground
        xr = self.radius * math.cos(self.angle + angle_change)
        yr = self.radius * math.sin(self.angle + angle_change)
        rpt = Point.ByCoordinates(xr, yr)
        
        # --- Constructing Curves ---
        
        # Middle Curve
        mid_m = Point.ByCoordinates(x * 1.005, y * 1.005, self.z - 0.6*self.z + 2 * self.bulge)
        mid_m2 = Point.ByCoordinates(x * 0.5, y * 0.5, self.z + 400 + self.bulge)
        mid_m3 = Point.ByCoordinates(x * 0.1, y * 0.1, self.z + 0.3 * self.bulge)
        curve_m = NurbsCurve.ByControlPoints([mpt, mid_m, mid_m2, mid_m3, center])
        
        # Rotate vector 90° for lateral push
        bx = -y * (self.petal_width / self.radius)
        by =  x * (self.petal_width / self.radius)
        
        # Left Curve
        mid_L = Point.ByCoordinates(xl - bx, yl - by, self.z - 150)
        mid_L2 = Point.ByCoordinates(xl/2 - bx, yl/2 - by, self.z - 80)
        curve_L = NurbsCurve.ByControlPoints([lpt, mid_L, mid_L2, center])
        
        # Right Curve
        mid_R = Point.ByCoordinates(xr + bx, yr + by, self.z - 150)                   
        mid_R2 = Point.ByCoordinates(xr/2 + bx, yr/2 + by, self.z - 80)
        curve_R = NurbsCurve.ByControlPoints([rpt, mid_R, mid_R2, center])
        
        # Construct Ribs
        radius = self.steel_radius
        steel_profile_m = Circle.ByCenterPointRadius(mpt, radius)
        steel_profile_L = Circle.ByCenterPointRadius(lpt, radius)
        steel_profile_R = Circle.ByCenterPointRadius(rpt, radius)
        
        rib_M = steel_profile_m.SweepAsSolid(curve_m)
        rib_L = steel_profile_L.SweepAsSolid(curve_L)
        rib_R = steel_profile_R.SweepAsSolid(curve_R)
        
        # --- Calculate Volume ---
        steel_volume = rib_M.Volume + rib_L.Volume + rib_R.Volume
        
        return [rib_M, rib_L, rib_R], steel_volume
        
OUT = Steel_Ribs
# ----------------------------------------

# group: Parametric Control
# Control parameters here.
# *Note: It may take a while for the changes to apply*
number_of_petals = DoubleSlider(6, range=3..10 step 1)
radius = DoubleSlider(4800, range=3700..4800 step 10)
width_of_support = DoubleSlider(480, range=0..1000 step 10)
height = DoubleSlider(5000, range=1000..8000 step 100)
petal_width = DoubleSlider(1310, range=0..4000 step 10)
vertical_petal_bulge = DoubleSlider(900, range=0..1600 step 10)
thickness_of_petal = DoubleSlider(140, range=10..500 step 10)
steel_radius = DoubleSlider(80, range=0..200 step 10)

# group: Material Volumes
# Calculation and display of material volumes here.
frp_volume = Python(IN[0]=frp_fiber_reinforced_plastic, IN[1]=number_of_petals, IN[2]=radius, IN[3]=width_of_support, IN[4]=height, IN[5]=petal_width, IN[6]=vertical_petal_bulge, IN[7]=thickness_of_petal)  # CPython3
# ---------- frp_volume.python (25 lines) ----------
# Load the Python Standard and DesignScript Libraries
import sys
import clr
import math
clr.AddReference('ProtoGeometry')
from Autodesk.DesignScript.Geometry import *

FRP_Petal = IN[0]
N_Petals = IN[1]
radius = IN[2]
support_width = IN[3]
height = IN[4]
petal_width = IN[5]
bulge = IN[6]
thickness = IN[7]

angle = 2 * math.pi / N_Petals

# FRP volume
petal = FRP_Petal(angle, radius, support_width, height, petal_width, bulge, thickness)
solid, petal_volume = petal.build()

total_petal_volume = str(petal_volume * int(N_Petals)) + " mm^3"

OUT = total_petal_volume
# ----------------------------------------
total_frp_petals_volume = Watch(frp_volume)
steel_volume = Python(IN[0]=steel_ribs, IN[1]=number_of_petals, IN[2]=radius, IN[3]=width_of_support, IN[4]=height, IN[5]=petal_width, IN[6]=vertical_petal_bulge, IN[7]=steel_radius)  # CPython3
# ---------- steel_volume.python (26 lines) ----------
# Load the Python Standard and DesignScript Libraries
import sys
import clr
import math
clr.AddReference('ProtoGeometry')
from Autodesk.DesignScript.Geometry import *

Steel_Ribs = IN[0]
N_Petals = IN[1]
radius = IN[2]
support_width = IN[3]
height = IN[4]
petal_width = IN[5]
bulge = IN[6]
steel_radius = IN[7]


angle = 2 * math.pi / N_Petals

# Steel volume
steel = Steel_Ribs(angle, radius, support_width, height, petal_width, bulge, steel_radius)
ribs, steel_volume = steel.build()

total_steel_volume = str(steel_volume * int(N_Petals)) + " mm^3"

OUT = total_steel_volume
# ----------------------------------------
total_steel_ribs_volume = Watch(steel_volume)

# group: Series of Instances
# Creates the repeating petal arrangement in a circle.
series_of_instances_for_frp = Python(IN[0]=frp_fiber_reinforced_plastic, IN[1]=number_of_petals, IN[2]=radius, IN[3]=width_of_support, IN[4]=height, IN[5]=petal_width, IN[6]=vertical_petal_bulge, IN[7]=thickness_of_petal)  # "Series of Instances for FRP Petals"; CPython3
# ---------- series_of_instances_for_frp.python (27 lines) ----------
# Load the Python Standard and DesignScript Libraries
import sys
import clr
import math
clr.AddReference('ProtoGeometry')
from Autodesk.DesignScript.Geometry import *

FRP_Petal = IN[0]
N_Petals = IN[1]
radius = IN[2]
support_width = IN[3]
height = IN[4]
petal_width = IN[5]
bulge = IN[6]
thickness = IN[7]

total_petals = []

for i in range(int(N_Petals)):
    a = 2 * math.pi / N_Petals
    angle = i * a
    
    petal = FRP_Petal(angle, radius, support_width, height, petal_width, bulge, thickness)
    petal_solids, volume = petal.build()
    total_petals.append(petal_solids)

OUT = total_petals
# ----------------------------------------
series_of_instances_for_steel = Python(IN[0]=steel_ribs, IN[1]=number_of_petals, IN[2]=radius, IN[3]=width_of_support, IN[4]=height, IN[5]=petal_width, IN[6]=vertical_petal_bulge, IN[7]=steel_radius)  # "Series of Instances for Steel Ribs"; CPython3
# ---------- series_of_instances_for_steel.python (27 lines) ----------
# Load the Python Standard and DesignScript Libraries
import sys
import clr
import math
clr.AddReference('ProtoGeometry')
from Autodesk.DesignScript.Geometry import *

Steel_Ribs = IN[0]
N_Petals = IN[1]
radius = IN[2]
support_width = IN[3]
height = IN[4]
petal_width = IN[5]
bulge = IN[6]
steel_radius = IN[7]

total_ribs = []

for i in range(int(N_Petals)):
    a = 2 * math.pi / N_Petals
    angle = i * a
    
    ribs = Steel_Ribs(angle, radius, support_width, height, petal_width, bulge, steel_radius)
    rib_solids, volume = ribs.build()
    total_ribs.append(rib_solids)

OUT = total_ribs
# ----------------------------------------

# group: Colour
# Colours the surfaces for visual appeal.
petal_color = CodeBlock { 255; 182; 193; }
function_node = Color.ByARGB(red=petal_color.out0, green=petal_color.out1, blue=petal_color.out2)
coloured_petals = Modifiers.GeometryColor.ByGeometryColor(geometry=series_of_instances_for_frp, color=function_node)
rib_color = CodeBlock { 255; 233; 150; }
function_node_2 = Color.ByARGB(red=rib_color.out0, green=rib_color.out1, blue=rib_color.out2)
coloured_ribs = Modifiers.GeometryColor.ByGeometryColor(geometry=series_of_instances_for_steel, color=function_node_2)
