# Dynamo graph 1854086.dyn (Dynamo 3.6.0.9395)

# group: Don't Touch This Ground
code_block = CodeBlock { -5000; -5000; -200; }
byCoordinates = Point.ByCoordinates(x=code_block.out0, y=code_block.out1, z=code_block.out2)
code_block_2 = CodeBlock { 5000; 5000; 0; }
byCoordinates_2 = Point.ByCoordinates(x=code_block_2.out0, y=code_block_2.out1, z=code_block_2.out2)
byCorners = Cuboid.ByCorners(lowPoint=byCoordinates, highPoint=byCoordinates_2)
code_block_3 = CodeBlock { 0; 100; 0; }
byARGB = Color.ByARGB(red=code_block_3.out0, green=code_block_3.out1, blue=code_block_3.out2)
byGeometryColor = Modifiers.GeometryColor.ByGeometryColor(geometry=byCorners, color=byARGB)

code_block_4 = CodeBlock { 4000; }
byCoordinates_3 = Point.ByCoordinates(x=code_block_4)
code_block_5 = CodeBlock { 2500; }
byCoordinates_4 = Point.ByCoordinates(z=code_block_5)
code_block_6 = CodeBlock { -4000; }
byCoordinates_5 = Point.ByCoordinates(x=code_block_6)
byThreePoints = Arc.ByThreePoints(firstPoint=byCoordinates_3, secondPoint=byCoordinates_4, thirdPoint=byCoordinates_5)
code_block_7 = CodeBlock { 100; }
planeAtParameter = Curve.PlaneAtParameter(curve=byThreePoints, param=code_block_7)
points = IntegerSlider(48, range=1..100 step 1)
code_block_8 = CodeBlock(n=points) { n; 0..1..#n; }
pointAtParameter = Curve.PointAtParameter(curve=byThreePoints, param=code_block_8.out1)
code_block_9 = CodeBlock { 4000; -4000; }
byCoordinates_6 = Point.ByCoordinates(x=code_block_9.out0, y=code_block_9.out1)
code_block_10 = CodeBlock { -4500; }
byCoordinates_7 = Point.ByCoordinates(y=code_block_10)
code_block_11 = CodeBlock { -4000; -4000; }
byCoordinates_8 = Point.ByCoordinates(x=code_block_11.out0, y=code_block_11.out1)
byThreePoints_2 = Arc.ByThreePoints(firstPoint=byCoordinates_6, secondPoint=byCoordinates_7, thirdPoint=byCoordinates_8)
splitByParameter = Curve.SplitByParameter(curve=byThreePoints_2, parameters=code_block_8.out1)
endPoint = Curve.EndPoint(curve=splitByParameter)
waveAmplitude = DoubleSlider(48, range=1..250 step 1)
code_block_12 = CodeBlock(n=waveAmplitude) { a = 0..15*n..#48; 1000-1000*Math.Cos(a); }
watch = Watch(code_block_12.out1)
translate = Geometry.Translate(geometry=endPoint, zTranslation=watch)
byPoints = NurbsCurve.ByPoints(points=translate)
list_create = List.Create(item0=byPoints, item1=byThreePoints)
byLoft = Surface.ByLoft(crossSections=list_create)
code_block_13 = CodeBlock { uCount = 20; u = 0..1..(1.0/(uCount-1)); }
code_block_14 = CodeBlock { vCount = 10; v = 0..1..(1.0/(vCount-1)); }
ptsGrid = Surface.PointAtParameter(surface=byLoft, u=code_block_13.u, v=code_block_14.v, lacing=CrossProduct)
transpose = List.Transpose(lists=ptsGrid)
number = DoubleInput(1)
shiftIndices = List.ShiftIndices(list=transpose@L2, amount=number)
byStartPointEndPoint = Line.ByStartPointEndPoint(startPoint=transpose, endPoint=shiftIndices, lacing=CrossProduct)
number_2 = DoubleInput(0)
translate_2 = Geometry.Translate(geometry=byStartPointEndPoint, zTranslation=number_2)
glass = Python()  # CPython3; unwired: IN[0]
# ---------- glass.python (19 lines) ----------
import clr
clr.AddReference('ProtoGeometry')
from Autodesk.DesignScript.Geometry import *

class GlassSurface(object):
    def __init__(self, surface, thickness):
        self.surface   = surface
        self.thickness = thickness

    def make_geometry(self):
        # Thicken the surface to make a solid glass panel
        solid = self.surface.Thicken(self.thickness, False)
        return solid

    def measure_volume(self):
        solid = self.make_geometry()
        return solid.Volume

OUT = GlassSurface
# ----------------------------------------
glassThickness = DoubleSlider(35, range=0..100 step 0.1)
glassInstance = Python(IN[0]=glass, IN[1]=byLoft, IN[2]=glassThickness)  # CPython3
# ---------- glassInstance.python (13 lines) ----------
import clr
clr.AddReference('ProtoGeometry')
from Autodesk.DesignScript.Geometry import *

GlassSurface = IN[0]   # class from first node
baseSurface  = IN[1]   # Surface.ByLoft
thickness    = IN[2]   # number (panel thickness)

panel  = GlassSurface(baseSurface, thickness)
solid  = panel.make_geometry()
volume = panel.measure_volume()

OUT = solid, volume
# ----------------------------------------
code_block_15 = CodeBlock { 0; }
getItemAtIndex = List.GetItemAtIndex(list=glassInstance, index=code_block_15)
glassOpacity = DoubleSlider(70, range=0..100 step 1)
code_block_16 = CodeBlock { 180; 220; 255; }
byARGB_2 = Color.ByARGB(alpha=glassOpacity, red=code_block_16.out0, green=code_block_16.out1, blue=code_block_16.out2)
byGeometryColor_2 = Modifiers.GeometryColor.ByGeometryColor(geometry=getItemAtIndex, color=byARGB_2)
steelRod = Python()  # CPython3; unwired: IN[0]
# ---------- steelRod.python (39 lines) ----------
import clr
clr.AddReference('ProtoGeometry')
from Autodesk.DesignScript.Geometry import *

# One steel rod swept along a curve
class SteelRod(object):
    def __init__(self, centerline, radius):
        self.centerline = centerline  # Curve / PolyCurve
        self.radius     = radius      # rod radius (model units)

    def make_solid(self):
        """
        Sweep a circular profile along the centerline.
        Uses a plane normal to the curve at the start to avoid twist.
        Skips bad curves by returning None.
        """
        start = self.centerline.StartPoint
        try:
            tan   = self.centerline.TangentAtParameter(0)
        except:
            # if it fails (very short/degenerate curve)
            tan = Vector.ZAxis()

        plane   = Plane.ByOriginNormal(start, tan)
        profile = Circle.ByPlaneRadius(plane, self.radius)

        try:
            solid = Solid.BySweep(profile, self.centerline)
        except:
            solid = None  # self-intersecting / bad sweep
        return solid

    def volume(self):
        solid = self.make_solid()
        if solid is None:
            return 0.0
        return solid.Volume

OUT = SteelRod
# ----------------------------------------
boolean = BoolSelector(false)
rows = PolyCurve.ByPoints(points=ptsGrid, connectLastToFirst=boolean)
cols = PolyCurve.ByPoints(points=transpose, connectLastToFirst=boolean)
list_create_2 = List.Create(item0=byPoints, item1=byThreePoints, item2=rows, item3=cols)
radius = DoubleSlider(20, range=1..100 step 0.1)
seriesInstances = Python(IN[0]=steelRod, IN[1]=list_create_2, IN[2]=radius)  # CPython3
# ---------- seriesInstances.python (39 lines) ----------
import clr
clr.AddReference('ProtoGeometry')
from Autodesk.DesignScript.Geometry import *

from collections.abc import Iterable

SteelRod   = IN[0]  # class from first node
centerlines = IN[1] # nested lists of curves / polycurves
radius      = IN[2] # rod radius

def iter_curves(obj):
    """
    Recursively walk nested lists to pull out curve-like objects.
    We treat anything with a StartPoint attribute as a curve.
    """
    if isinstance(obj, Iterable) and not hasattr(obj, "StartPoint"):
        for sub in obj:
            for c in iter_curves(sub):
                yield c
    else:
        yield obj

curves  = list(iter_curves(centerlines))

solids  = []
volumes = []

for cl in curves:
    rod   = SteelRod(cl, radius)
    solid = rod.make_solid()
    if solid is None:
        continue          # skip failed sweeps
    vol = rod.volume()
    solids.append(solid)
    volumes.append(vol)

totalVolume = sum(volumes)

OUT = solids, volumes, totalVolume
# ----------------------------------------
code_block_17 = CodeBlock { 0; }
getItemAtIndex_2 = List.GetItemAtIndex(list=seriesInstances, index=code_block_17)
code_block_18 = CodeBlock { 255; 0; 0; 0; }
byARGB_3 = Color.ByARGB(alpha=code_block_18.out0, red=code_block_18.out1, green=code_block_18.out2, blue=code_block_18.out3)
byGeometryColor_3 = Modifiers.GeometryColor.ByGeometryColor(geometry=getItemAtIndex_2, color=byARGB_3)
code_block_19 = CodeBlock { 2; }
getItemAtIndex_3 = List.GetItemAtIndex(list=seriesInstances, index=code_block_19)
code_block_20 = CodeBlock(n=getItemAtIndex_3) { v = 2*n; }
volumesteel_mm_3 = Watch(code_block_20)
code_block_21 = CodeBlock { 1; }
getItemAtIndex_4 = List.GetItemAtIndex(list=glassInstance, index=code_block_21)
code_block_22 = CodeBlock(n=getItemAtIndex_4) { v = 2*n; }
volumeglass_mm_3 = Watch(code_block_22)
XZ = Plane.XZ()
mirror = Geometry.Mirror(geometry=getItemAtIndex_2, mirrorPlane=XZ)
byGeometryColor_4 = Modifiers.GeometryColor.ByGeometryColor(geometry=mirror, color=byARGB_3)
mirror_2 = Geometry.Mirror(geometry=getItemAtIndex, mirrorPlane=XZ)
byGeometryColor_5 = Modifiers.GeometryColor.ByGeometryColor(geometry=mirror_2, color=byARGB_2)
