# Dynamo graph 1854136.dyn (Dynamo 3.6.0.9395)

# group: Don't touch this ground
code_block = CodeBlock { -5000; -5000; -200; }  # frozen
byCoordinates = Point.ByCoordinates(x=code_block.out0, y=code_block.out1, z=code_block.out2)  # frozen
code_block_2 = CodeBlock { 5000; 5000; 0; }  # frozen
byCoordinates_2 = Point.ByCoordinates(x=code_block_2.out0, y=code_block_2.out1, z=code_block_2.out2)  # frozen
byCorners = Cuboid.ByCorners(lowPoint=byCoordinates, highPoint=byCoordinates_2)  # frozen
code_block_3 = CodeBlock { 0; 100; 0; }  # frozen
byARGB = Color.ByARGB(red=code_block_3.out0, green=code_block_3.out1, blue=code_block_3.out2)  # frozen
byGeometryColor = Modifiers.GeometryColor.ByGeometryColor(geometry=byCorners, color=byARGB)  # frozen

watch = Watch()  # unwired: arg0
pavillion_width = DoubleSlider(8300, range=2000..9000 step 100)
pavillion_length = DoubleSlider(9000, range=2000..9000 step 100)
column_height = DoubleSlider(6000, range=3000..6000 step 100)
column_spacing = DoubleSlider(1350, range=1000..2500 step 50)
python_script = Python(IN[0]=pavillion_width, IN[1]=pavillion_length, IN[2]=column_height, IN[3]=column_spacing)  # CPython3
# ---------- python_script.python (68 lines) ----------
import clr
clr.AddReference('ProtoGeometry')
from Autodesk.DesignScript.Geometry import *
import math

class TimberColumn:
    def __init__(self, x, y, height):
        self.x = x
        self.y = y
        self.height = height
        self.radius = 150  
    
    def create_geometry(self):
        base_point = Point.ByCoordinates(self.x, self.y, 0)
        return Cylinder.ByPointsRadius(base_point, Point.ByCoordinates(self.x, self.y, self.height), self.radius)
    
    def get_volume(self):
        return math.pi * (self.radius ** 2) * self.height

class SteelPanel:
    def __init__(self, x, y, width, length, height):
        self.x = x
        self.y = y
        self.w = width
        self.l = length
        self.z = height
        self.thickness = 50 
        
    def create_geometry(self):
        origin = Point.ByCoordinates(self.x, self.y, self.z)
        return Cuboid.ByLengths(origin, self.w, self.l, self.thickness)
        
    def get_volume(self):
        return self.w * self.l * self.thickness

pav_width = IN[0]
pav_length = IN[1]
col_height = IN[2]
spacing = IN[3]

columns = []
roofs = []
total_vol_timber = 0.0
total_vol_steel = 0.0

num_x = int(pav_width / spacing)
num_y = int(pav_length / spacing)

start_x = -(num_x * spacing) / 2
start_y = -(num_y * spacing) / 2

for i in range(num_x + 1):
    for j in range(num_y + 1):
        x = start_x + (i * spacing)
        y = start_y + (j * spacing)
        
        col_instance = TimberColumn(x, y, col_height)
        col_geom = col_instance.create_geometry()
        columns.append(col_geom)
        total_vol_timber += col_instance.get_volume()
        
        panel_size = spacing * 0.8 
        roof_instance = SteelPanel(x, y, panel_size, panel_size, col_height)
        roof_geom = roof_instance.create_geometry()
        roofs.append(roof_geom)
        total_vol_steel += roof_instance.get_volume()

OUT = [columns, roofs, total_vol_timber, total_vol_steel]
# ----------------------------------------
code_block_4 = CodeBlock(data=python_script) { cols   = data[0]; roofs  = data[1]; v_wood = data[2]; v_steel= data[3]; }
total_timber_volume_mm_3 = Watch(code_block_4.v_wood)
total_steel_volume_mm_3 = Watch(code_block_4.v_steel)

# group: Timber Color
number = DoubleInput(255)
number_2 = DoubleInput(139)
number_3 = DoubleInput(69)
number_4 = DoubleInput(19)

steel_grey = Color.ByARGB(alpha=number, red=number_2, green=number_3, blue=number_4)
timber = Modifiers.GeometryColor.ByGeometryColor(geometry=code_block_4.cols, color=steel_grey)

# group: Steel Color
number_5 = DoubleInput(255)
number_6 = DoubleInput(169)
number_7 = DoubleInput(169)
number_8 = DoubleInput(169)

steel_grey_2 = Color.ByARGB(alpha=number_5, red=number_6, green=number_7, blue=number_8)
steel_roofs = Modifiers.GeometryColor.ByGeometryColor(geometry=code_block_4.roofs, color=steel_grey_2)
