# Dynamo graph 1854199.dyn (Dynamo 3.6.0.9395)

code_block = CodeBlock { -5000; -5000; -200; }
byCoordinates = Point.ByCoordinates(x=code_block.out0, y=code_block.out1, z=code_block.out2)
code_block_2 = CodeBlock { 5000; 5000; 0; }
byCoordinates_2 = Point.ByCoordinates(x=code_block_2.out0, y=code_block_2.out1, z=code_block_2.out2)
byCorners = Cuboid.ByCorners(lowPoint=byCoordinates, highPoint=byCoordinates_2)
code_block_3 = CodeBlock { 0; 100; 0; }
byARGB = Color.ByARGB(red=code_block_3.out0, green=code_block_3.out1, blue=code_block_3.out2)
byGeometryColor = Modifiers.GeometryColor.ByGeometryColor(geometry=byCorners, color=byARGB)
code_block_4 = CodeBlock { 0; 0; 1500; }
byCoordinates_3 = Point.ByCoordinates(x=code_block_4.out0, y=code_block_4.out1, z=code_block_4.out2)
XAxis = Vector.XAxis()
code_block_5 = CodeBlock { -4900; 1430; 1000; }
byCoordinates_4 = Point.ByCoordinates(x=code_block_5.out0, y=code_block_5.out1, z=code_block_5.out2)
tightness_of_curl = DoubleSlider(3200, range=2500..3200 step 1)
code_block_6 = CodeBlock { 1010; }
byAxis = Helix.ByAxis(axisPoint=byCoordinates_3, axisDirection=XAxis, startPoint=byCoordinates_4, pitch=tightness_of_curl, angleTurns=code_block_6)
planeAtParameter = Curve.PlaneAtParameter(curve=byAxis)
frame_thickness = DoubleSlider(80, range=50..80 step 1)
byPlaneRadius = Circle.ByPlaneRadius(plane=planeAtParameter, radius=frame_thickness)
bySweep = Solid.BySweep(profile=byPlaneRadius, path=byAxis)
code_block_7 = CodeBlock { -5000; 0; 1500; }
byCoordinates_5 = Point.ByCoordinates(x=code_block_7.out0, y=code_block_7.out1, z=code_block_7.out2)
code_block_8 = CodeBlock { 4900; 0; 1500; }
byCoordinates_6 = Point.ByCoordinates(x=code_block_8.out0, y=code_block_8.out1, z=code_block_8.out2)
center_rod_thickness = DoubleSlider(50, range=50..75 step 1)
class_steelrod = Python()  # CPython3; unwired: IN[0]
# ---------- class_steelrod.python (19 lines) ----------
import clr
clr.AddReference('ProtoGeometry')
from Autodesk.DesignScript.Geometry import *
import math

class SteelRod:
    def __init__(self, start_point, end_point, radius):
        self.start = start_point
        self.end = end_point
        self.radius = radius

    def make_geometry(self):
        return Cylinder.ByPointsRadius(self.start, self.end, self.radius)
        
    def find_volume(self):
        return self.end.DistanceTo(self.start)*self.radius**2*(math.pi)
        

OUT = SteelRod
# ----------------------------------------
steelrod_instance = Python(IN[0]=byCoordinates_5, IN[1]=byCoordinates_6, IN[2]=center_rod_thickness, IN[3]=class_steelrod)  # CPython3
# ---------- steelrod_instance.python (3 lines) ----------
SteelRod= IN[3]
g = SteelRod(IN[0],IN[1],IN[2])
OUT= g.make_geometry()
# ----------------------------------------
steelrod_volume = Python(IN[0]=byCoordinates_5, IN[1]=byCoordinates_6, IN[2]=center_rod_thickness, IN[3]=class_steelrod)  # CPython3
# ---------- steelrod_volume.python (3 lines) ----------
SteelRod= IN[3]
v = SteelRod(IN[0],IN[1],IN[2])
OUT= v.find_volume()
# ----------------------------------------
steelrod_volume_mm_2 = Watch(steelrod_volume)
code_block_9 = CodeBlock { 100; 0.01; }
sequence = Sequence(amount=code_block_9.out0, step=code_block_9.out1)
code_block_10 = CodeBlock { n; }  # unwired: n
amount_of_rods = IntegerSlider(1, range=1..5 step 1)
slice = List.Slice(list=sequence, start=code_block_10, end=code_block_10, step=amount_of_rods)
pointAtParameter = Curve.PointAtParameter(curve=byAxis, param=slice)
code_block_11 = CodeBlock { 9900; }
byStartPointDirectionLength = Line.ByStartPointDirectionLength(startPoint=byCoordinates_5, direction=XAxis, length=code_block_11)
pointAtParameter_2 = Curve.PointAtParameter(curve=byStartPointDirectionLength, param=slice)
rod_thickness = DoubleSlider(10.7, range=1..30 step 0.1)
progressive_beam_thickness = DoubleSlider(50, range=10..50 step 1)
sequence_2 = Sequence(start=rod_thickness, amount=progressive_beam_thickness)
class_aluminiumbars = Python()  # CPython3; unwired: IN[0]
# ---------- class_aluminiumbars.python (19 lines) ----------
import clr
clr.AddReference('ProtoGeometry')
from Autodesk.DesignScript.Geometry import *
import math

class AluminiumBars:
    def __init__(self, bottom_point, top_point, radius):
        self.bottom = bottom_point
        self.top = top_point
        self.radius = radius

    def make_geometry(self):
        return Cylinder.ByPointsRadius(self.bottom, self.top, self.radius)
    def measure_volume(self):
        return self.bottom.DistanceTo(self.top)*self.radius**2*(math.pi)
        
        

OUT = AluminiumBars
# ----------------------------------------
aluminiumbars_connect_instance = Python(IN[0]=pointAtParameter, IN[1]=pointAtParameter_2, IN[2]=sequence_2, IN[3]=class_aluminiumbars)  # CPython3
# ---------- aluminiumbars_connect_instance.python (20 lines) ----------
AluminiumBars=IN[3]
curvepoints= IN[0]
linepoints= IN[1]
radius= IN[2]

rods=[]
volumes=[]
count= min(len(curvepoints),len(linepoints))

for i in range(count):
    r=radius[i] if i <len(radius) else radius[-1]
    curve= curvepoints[i]
    line=linepoints[i]
    
    rod=AluminiumBars(curve,line,r)
    rods.append(rod.make_geometry())
    volumes.append(rod.measure_volume())
    
totalVolume=sum(volumes)
OUT = totalVolume,rods,
# ----------------------------------------
aluminiumbars_volume_mm_2 = Watch(aluminiumbars_connect_instance)
