# Dynamo graph 1854235.dyn "Start (without the group)" (Dynamo 3.6.0.9395)

code_block = CodeBlock { -5000; -5000; -200; }  # frozen
byCoordinates = Point.ByCoordinates(x=code_block.out0, y=code_block.out1, z=code_block.out2)
code_block_2 = CodeBlock { 5000; 5000; 0; }  # frozen
byCoordinates_2 = Point.ByCoordinates(x=code_block_2.out0, y=code_block_2.out1, z=code_block_2.out2)
byCorners = Cuboid.ByCorners(lowPoint=byCoordinates, highPoint=byCoordinates_2)
code_block_3 = CodeBlock { 0; 100; 0; }  # frozen
byARGB = Color.ByARGB(red=code_block_3.out0, green=code_block_3.out1, blue=code_block_3.out2)
byGeometryColor = Modifiers.GeometryColor.ByGeometryColor(geometry=byCorners, color=byARGB)
number = DoubleInput(-4500)
number_2 = DoubleInput(-4500)
number_3 = DoubleInput(0)
byCoordinates_3 = Point.ByCoordinates(x=number, y=number_2, z=number_3)
number_4 = DoubleInput(4500)
number_5 = DoubleInput(4500)
number_6 = DoubleInput(100)
byCoordinates_4 = Point.ByCoordinates(x=number_4, y=number_5, z=number_6)
byCorners_2 = Cuboid.ByCorners(lowPoint=byCoordinates_3, highPoint=byCoordinates_4)
number_7 = DoubleInput(0)
number_8 = DoubleInput(0)
byCoordinates_5 = Point.ByCoordinates(x=number_7, y=number_8, z=number_6)
height = IntegerSlider(3000, range=3000..3400 step 50)
byCoordinates_6 = Point.ByCoordinates(x=number_7, y=number_8, z=height)
radius = IntegerSlider(4000, range=3800..4000 step 50)
byPointsRadius = Cylinder.ByPointsRadius(startPoint=byCoordinates_5, endPoint=byCoordinates_6, radius=radius)
number_9 = DoubleInput(0)
number_10 = DoubleInput(0)
number_11 = DoubleInput(2000)
byCoordinates_7 = Point.ByCoordinates(x=number_9, y=number_10, z=number_11)
byCenterPointRadius = Sphere.ByCenterPointRadius(centerPoint=byCoordinates_7, radius=radius)
number_12 = DoubleInput(3800)
number_13 = DoubleInput(3800)
number_14 = DoubleInput(0)
byCoordinates_8 = Point.ByCoordinates(x=number_12, y=number_13, z=number_14)
number_15 = DoubleInput(8000)
byCoordinates_9 = Point.ByCoordinates(x=number_12, y=number_13, z=number_15)
width = IntegerSlider(350, range=200..350 step 50)
byPointsRadius_2 = Cylinder.ByPointsRadius(startPoint=byCoordinates_8, endPoint=byCoordinates_9, radius=width)
byCenterPointRadius_2 = Sphere.ByCenterPointRadius(centerPoint=byCoordinates_9, radius=width)
number_16 = DoubleInput(0)
number_17 = DoubleInput(0)
number_18 = DoubleInput(6000)
byCoordinates_10 = Point.ByCoordinates(x=number_16, y=number_17, z=number_18)
byCenterPointRadius_3 = Sphere.ByCenterPointRadius(centerPoint=byCoordinates_10, radius=width)
byCoordinates_11 = Point.ByCoordinates()
byStartPointEndPoint = Line.ByStartPointEndPoint(startPoint=byCoordinates_9, endPoint=byCoordinates_10)
length = IntegerSlider(200, range=150..200 step 25)
byPointsRadius_3 = Cylinder.ByPointsRadius(endPoint=byCoordinates_10, radius=length)
