# Dynamo graph 1854299.dyn (Dynamo 3.6.0.9395)

# group: Don't touch this ground
code_block = CodeBlock { -5000; -5000; -200; }
byCoordinates = Point.ByCoordinates(x=code_block.out0, y=code_block.out1, z=code_block.out2)
code_block_2 = CodeBlock { 5000; 5000; 0; }
byCoordinates_2 = Point.ByCoordinates(x=code_block_2.out0, y=code_block_2.out1, z=code_block_2.out2)
byCorners = Cuboid.ByCorners(lowPoint=byCoordinates, highPoint=byCoordinates_2)
code_block_3 = CodeBlock { 0; 100; 0; }
byARGB = Color.ByARGB(red=code_block_3.out0, green=code_block_3.out1, blue=code_block_3.out2)
byGeometryColor = Modifiers.GeometryColor.ByGeometryColor(geometry=byCorners, color=byARGB)

height_slider = DoubleSlider(9324.3, range=9000..10000 step 0.1)
center_of_circle = Point.ByCoordinates(z=height_slider)
radius_of_pole_circle_slider = DoubleSlider(4746.5, range=4000..5000 step 0.1)
top_circle = Circle.ByCenterPointRadius(centerPoint=center_of_circle, radius=radius_of_pole_circle_slider)
code_block_4 = CodeBlock { 0; 0; 0; }
center_of_circle_2 = Point.ByCoordinates(x=code_block_4.out0, y=code_block_4.out1, z=code_block_4.out2)
bottom_circle = Circle.ByCenterPointRadius(centerPoint=center_of_circle_2, radius=radius_of_pole_circle_slider)
number_of_poles = DoubleSlider(8, range=3..20 step 1)
code_block_5 = CodeBlock(n=number_of_poles) { n; 0..1..#n+1; }
bottom_points = Curve.PointAtParameter(curve=bottom_circle, param=code_block_5.out1)
byCoordinates_3 = Vector.ByCoordinates(z=height_slider)
top_points = Point.Add(point=bottom_points, vectorToAdd=byCoordinates_3)
vertical_poles = Line.ByStartPointEndPoint(startPoint=bottom_points, endPoint=top_points)
radius_of_poles_slider = DoubleSlider(326.9, range=200..700 step 0.1)
class_circular_rod = Python()  # CPython3; unwired: IN[0]
# ---------- class_circular_rod.python (24 lines) ----------
# Load the Python Standard and DesignScript Libraries
import sys
import clr
clr.AddReference('ProtoGeometry')
from Autodesk.DesignScript.Geometry import *
import math

class CircularRod:
    def __init__(self, centerline, radius):
        self.centerline = centerline
        self.radius = radius
    
    def endpoints(self):
        return self.centerline.StartPoint, self.centerline.EndPoint
        
    def make_geometry(self):
        end1, end2 = self.endpoints()
        
        return Cylinder.ByPointsRadius(end1,end2,self.radius)
        
    def measure_volume(self):
        end1, end2 = self.endpoints()
        return end1.DistanceTo(end2)*self.radius*self.radius*math.pi
OUT = CircularRod
# ----------------------------------------
instance_circular_rod = Python(IN[0]=vertical_poles, IN[1]=radius_of_poles_slider, IN[2]=class_circular_rod)  # CPython3
# ---------- instance_circular_rod.python (11 lines) ----------
Centerlines = IN[0]
radius = IN[1]
CircularRod = IN[2]

rods = [CircularRod(cl, radius)  for cl in Centerlines]

geometries = [rod.make_geometry() for rod in rods]

volume_total = sum(rod.measure_volume() for rod in rods)

OUT = ["Timber Posts", geometries, "Total Volume: " + str(volume_total) + " mm^3"]
# ----------------------------------------
watch = Watch(instance_circular_rod)
code_block_6 = CodeBlock { 6000; 4000; 10000; }
roof_thickness = DoubleSlider(10500, range=10001..10500 step 0.1)
class_steel_ring = Python(IN[0]=center_of_circle, IN[1]=code_block_6.out0, IN[2]=code_block_6.out1, IN[3]=code_block_6.out2, IN[4]=roof_thickness)  # CPython3
# ---------- class_steel_ring.python (44 lines) ----------
# Load the Python Standard and DesignScript Libraries
import sys
import clr
clr.AddReference('ProtoGeometry')
from Autodesk.DesignScript.Geometry import *
import math
from Autodesk.DesignScript.Geometry import Cylinder, Solid, CoordinateSystem

class SteelRing:
    def __init__(self, center_point, outer_radius, inner_radius, h_min, h_max):
        self.center = center_point
        self.outer_r = outer_radius
        self.inner_r = inner_radius
        self.h_min = h_min
        self.h_max = h_max
    
    def make_geometry(self):
        ring_height = self.h_max - self.h_min
        
        cs = CoordinateSystem.ByOrigin(self.center)
        
        outer = Cylinder.ByRadiusHeight(cs, self.outer_r, ring_height)
        
        inner = Cylinder.ByRadiusHeight(cs, self.inner_r, ring_height)
        
        ring = Solid.Difference(outer, inner)
        return ring
    
    def measure_volume(self):
        ring_height = self.h_max - self.h_min
        vol_outer = math.pi*self.outer_r*self.outer_r*ring_height
        vol_inner = math.pi*self.inner_r*self.inner_r*ring_height
        return vol_outer - vol_inner
        
center = IN[0]
outer_r = IN[1]
inner_r = IN[2]
h_min = IN[3]
h_max = IN[4]
        
ring = SteelRing(center, outer_r, inner_r, h_min, h_max)
        
OUT = ["Steel Ring", ring.make_geometry(), "Volume: " + str(ring.measure_volume()) + " mm^3"]
        
# ----------------------------------------
watch_2 = Watch(class_steel_ring)
