# Dynamo graph 1854346.dyn "Carter Brinkman_1854346_HomeAssignment#2 - Elytra Pavillion" (Dynamo 4.0.0.3277)

# group: Greenspace (10 X 10 m)
code_block = CodeBlock { -5000; -5000; -200; }
byCoordinates = Point.ByCoordinates(x=code_block.out0, y=code_block.out1, z=code_block.out2)
code_block_2 = CodeBlock { 5000; 5000; 0; }
byCoordinates_2 = Point.ByCoordinates(x=code_block_2.out0, y=code_block_2.out1, z=code_block_2.out2)
byCorners = Cuboid.ByCorners(lowPoint=byCoordinates, highPoint=byCoordinates_2)
code_block_3 = CodeBlock { 0; 100; 0; }
byARGB = Color.ByARGB(red=code_block_3.out0, green=code_block_3.out1, blue=code_block_3.out2)
byGeometryColor = Modifiers.GeometryColor.ByGeometryColor(geometry=byCorners, color=byARGB)

# group: Middle Sprout > Vertical Column
bottom_point = CodeBlock { 0; 0; 0; }
byCoordinates_3 = Point.ByCoordinates(x=bottom_point.out0, y=bottom_point.out1, z=bottom_point.out2)
topPoint = CodeBlock { 0; 0; }
height = DoubleSlider(7000, range=6000..7000 step 1)
byCoordinates_4 = Point.ByCoordinates(x=topPoint.out0, y=topPoint.out1, z=height)
radius = DoubleSlider(194, range=0..300 step 1)
column = Python()  # PythonNet3; unwired: IN[0]
# ---------- column.python (15 lines) ----------
# Load the Python Standard and DesignScript Libraries
import sys
import clr
clr.AddReference('ProtoGeometry')
from Autodesk.DesignScript.Geometry import *

class CircularRod:
    def __init__(self, bottom_point, top_point, radius):
        self.bottom = bottom_point
        self.top = top_point
        self.radius = radius
    
    def make_geometry(self):
        return Cylinder.ByPointsRadius(self.bottom, self.top, self.radius)
OUT = CircularRod
# ----------------------------------------
single_instance = Python(IN[0]=byCoordinates_3, IN[1]=byCoordinates_4, IN[2]=radius, IN[3]=column)  # PythonNet3
# ---------- single_instance.python (3 lines) ----------
CircularRod = IN[3]
b = CircularRod(IN[0],IN[1],IN[2])
OUT = b.make_geometry()
# ----------------------------------------

# group: Middle Sprout > First Cylinder
bottom_point_2 = CodeBlock { 0; 0; 7000; }
byCoordinates_5 = Point.ByCoordinates(x=bottom_point_2.out0, y=bottom_point_2.out1, z=bottom_point_2.out2)
topPoint_2 = CodeBlock { 0; 0; }
height_2 = DoubleSlider(6000, range=6000..7000 step 1)
byCoordinates_6 = Point.ByCoordinates(x=topPoint_2.out0, y=topPoint_2.out1, z=height_2)
radius_2 = DoubleSlider(1262, range=1000..1500 step 1)
column_2 = Python()  # PythonNet3; unwired: IN[0]; same code as column
single_instance_2 = Python(IN[0]=byCoordinates_5, IN[1]=byCoordinates_6, IN[2]=radius_2, IN[3]=column_2)  # PythonNet3; same code as single_instance

# group: Middle Sprout > Second Cylinder
bottom_point_3 = CodeBlock { 0; 0; 7000; }
byCoordinates_7 = Point.ByCoordinates(x=bottom_point_3.out0, y=bottom_point_3.out1, z=bottom_point_3.out2)
topPoint_3 = CodeBlock { 0; 0; }
height_3 = DoubleSlider(5000, range=5000..6000 step 1)
byCoordinates_8 = Point.ByCoordinates(x=topPoint_3.out0, y=topPoint_3.out1, z=height_3)
radius_3 = DoubleSlider(750, range=500..750 step 1)
column_3 = Python()  # PythonNet3; unwired: IN[0]; same code as column
single_instance_3 = Python(IN[0]=byCoordinates_7, IN[1]=byCoordinates_8, IN[2]=radius_3, IN[3]=column_3)  # PythonNet3; same code as single_instance

# group: Middle Sprout > Third Cylinder
bottom_point_4 = CodeBlock { 0; 0; 7000; }
byCoordinates_9 = Point.ByCoordinates(x=bottom_point_4.out0, y=bottom_point_4.out1, z=bottom_point_4.out2)
topPoint_4 = CodeBlock { 0; 0; }
height_4 = DoubleSlider(4000, range=4000..5000 step 1)
byCoordinates_10 = Point.ByCoordinates(x=topPoint_4.out0, y=topPoint_4.out1, z=height_4)
radius_4 = DoubleSlider(375, range=250..375 step 1)
column_4 = Python()  # PythonNet3; unwired: IN[0]; same code as column
single_instance_4 = Python(IN[0]=byCoordinates_9, IN[1]=byCoordinates_10, IN[2]=radius_4, IN[3]=column_4)  # PythonNet3; same code as single_instance

# group: Quadrant 1 Sprout > First Cylinder
bottom_point_5 = CodeBlock { 3000; 3000; 7000; }
byCoordinates_11 = Point.ByCoordinates(x=bottom_point_5.out0, y=bottom_point_5.out1, z=bottom_point_5.out2)
topPoint_5 = CodeBlock { 3000; 3000; }
height_5 = DoubleSlider(6104, range=6000..7000 step 1)
byCoordinates_12 = Point.ByCoordinates(x=topPoint_5.out0, y=topPoint_5.out1, z=height_5)
radius_5 = DoubleSlider(1262, range=1000..1500 step 1)
column_5 = Python()  # PythonNet3; unwired: IN[0]; same code as column
single_instance_5 = Python(IN[0]=byCoordinates_11, IN[1]=byCoordinates_12, IN[2]=radius_5, IN[3]=column_5)  # PythonNet3; same code as single_instance

# group: Quadrant 1 Sprout > Second Cylinder
bottom_point_6 = CodeBlock { 3000; 3000; 7000; }
byCoordinates_13 = Point.ByCoordinates(x=bottom_point_6.out0, y=bottom_point_6.out1, z=bottom_point_6.out2)
topPoint_6 = CodeBlock { 3000; 3000; }
height_6 = DoubleSlider(5000, range=4500..6000 step 1)
byCoordinates_14 = Point.ByCoordinates(x=topPoint_6.out0, y=topPoint_6.out1, z=height_6)
radius_6 = DoubleSlider(750, range=500..750 step 1)
column_6 = Python()  # PythonNet3; unwired: IN[0]; same code as column
single_instance_6 = Python(IN[0]=byCoordinates_13, IN[1]=byCoordinates_14, IN[2]=radius_6, IN[3]=column_6)  # PythonNet3; same code as single_instance

# group: Quadrant 1 Sprout > Third Cylinder
bottom_point_7 = CodeBlock { 3000; 3000; 7000; }
byCoordinates_15 = Point.ByCoordinates(x=bottom_point_7.out0, y=bottom_point_7.out1, z=bottom_point_7.out2)
topPoint_7 = CodeBlock { 3000; 3000; }
height_7 = DoubleSlider(4000, range=3000..5000 step 1)
byCoordinates_16 = Point.ByCoordinates(x=topPoint_7.out0, y=topPoint_7.out1, z=height_7)
radius_7 = DoubleSlider(375, range=250..375 step 1)
column_7 = Python()  # PythonNet3; unwired: IN[0]; same code as column
single_instance_7 = Python(IN[0]=byCoordinates_15, IN[1]=byCoordinates_16, IN[2]=radius_7, IN[3]=column_7)  # PythonNet3; same code as single_instance

# group: Quadrant 2 Sprout > Vertical Column
bottom_point_8 = CodeBlock { -3000; 3000; 0; }
byCoordinates_17 = Point.ByCoordinates(x=bottom_point_8.out0, y=bottom_point_8.out1, z=bottom_point_8.out2)
topPoint_8 = CodeBlock { -3000; 3000; }
height_8 = DoubleSlider(6945, range=6000..7000 step 1)
byCoordinates_18 = Point.ByCoordinates(x=topPoint_8.out0, y=topPoint_8.out1, z=height_8)
radius_8 = DoubleSlider(194, range=0..300 step 1)
column_8 = Python()  # PythonNet3; unwired: IN[0]; same code as column
single_instance_8 = Python(IN[0]=byCoordinates_17, IN[1]=byCoordinates_18, IN[2]=radius_8, IN[3]=column_8)  # PythonNet3; same code as single_instance

# group: Quadrant 2 Sprout > First Cylinder
bottom_point_9 = CodeBlock { -3000; 3000; 7000; }
byCoordinates_19 = Point.ByCoordinates(x=bottom_point_9.out0, y=bottom_point_9.out1, z=bottom_point_9.out2)
topPoint_9 = CodeBlock { -3000; 3000; }
height_9 = DoubleSlider(6104, range=6000..7000 step 1)
byCoordinates_20 = Point.ByCoordinates(x=topPoint_9.out0, y=topPoint_9.out1, z=height_9)
radius_9 = DoubleSlider(1262, range=1000..1500 step 1)
column_9 = Python()  # PythonNet3; unwired: IN[0]; same code as column
single_instance_9 = Python(IN[0]=byCoordinates_19, IN[1]=byCoordinates_20, IN[2]=radius_9, IN[3]=column_9)  # PythonNet3; same code as single_instance

# group: Quadrant 2 Sprout > Second Cylinder
bottom_point_10 = CodeBlock { -3000; 3000; 7000; }
byCoordinates_21 = Point.ByCoordinates(x=bottom_point_10.out0, y=bottom_point_10.out1, z=bottom_point_10.out2)
topPoint_10 = CodeBlock { -3000; 3000; }
height_10 = DoubleSlider(5000, range=5000..6000 step 1)
byCoordinates_22 = Point.ByCoordinates(x=topPoint_10.out0, y=topPoint_10.out1, z=height_10)
radius_10 = DoubleSlider(750, range=500..750 step 1)
column_10 = Python()  # PythonNet3; unwired: IN[0]; same code as column
single_instance_10 = Python(IN[0]=byCoordinates_21, IN[1]=byCoordinates_22, IN[2]=radius_10, IN[3]=column_10)  # PythonNet3; same code as single_instance

# group: Quadrant 2 Sprout > Third Cylinder
bottom_point_11 = CodeBlock { -3000; 3000; 7000; }
byCoordinates_23 = Point.ByCoordinates(x=bottom_point_11.out0, y=bottom_point_11.out1, z=bottom_point_11.out2)
topPoint_11 = CodeBlock { -3000; 3000; }
height_11 = DoubleSlider(4000, range=4000..5000 step 1)
byCoordinates_24 = Point.ByCoordinates(x=topPoint_11.out0, y=topPoint_11.out1, z=height_11)
radius_11 = DoubleSlider(375, range=250..375 step 1)
column_11 = Python()  # PythonNet3; unwired: IN[0]; same code as column
single_instance_11 = Python(IN[0]=byCoordinates_23, IN[1]=byCoordinates_24, IN[2]=radius_11, IN[3]=column_11)  # PythonNet3; same code as single_instance

# group: Quadrant 3 Sprout > Vertical Column
bottom_point_12 = CodeBlock { -3000; -3000; 0; }
byCoordinates_25 = Point.ByCoordinates(x=bottom_point_12.out0, y=bottom_point_12.out1, z=bottom_point_12.out2)
topPoint_12 = CodeBlock { -3000; -3000; }
height_12 = DoubleSlider(6945, range=6000..7000 step 1)
byCoordinates_26 = Point.ByCoordinates(x=topPoint_12.out0, y=topPoint_12.out1, z=height_12)
radius_12 = DoubleSlider(194, range=0..300 step 1)
column_12 = Python()  # PythonNet3; unwired: IN[0]; same code as column
single_instance_12 = Python(IN[0]=byCoordinates_25, IN[1]=byCoordinates_26, IN[2]=radius_12, IN[3]=column_12)  # PythonNet3; same code as single_instance

# group: Quadrant 3 Sprout > First Cylinder
bottom_point_13 = CodeBlock { -3000; -3000; 7000; }
byCoordinates_27 = Point.ByCoordinates(x=bottom_point_13.out0, y=bottom_point_13.out1, z=bottom_point_13.out2)
topPoint_13 = CodeBlock { -3000; -3000; }
height_13 = DoubleSlider(6104, range=6000..7000 step 1)
byCoordinates_28 = Point.ByCoordinates(x=topPoint_13.out0, y=topPoint_13.out1, z=height_13)
radius_13 = DoubleSlider(1262, range=1000..1500 step 1)
column_13 = Python()  # PythonNet3; unwired: IN[0]; same code as column
single_instance_13 = Python(IN[0]=byCoordinates_27, IN[1]=byCoordinates_28, IN[2]=radius_13, IN[3]=column_13)  # PythonNet3; same code as single_instance

# group: Quadrant 3 Sprout > Second Cylinder
bottom_point_14 = CodeBlock { -3000; -3000; 7000; }
byCoordinates_29 = Point.ByCoordinates(x=bottom_point_14.out0, y=bottom_point_14.out1, z=bottom_point_14.out2)
topPoint_14 = CodeBlock { -3000; -3000; }
height_14 = DoubleSlider(5000, range=5000..6000 step 1)
byCoordinates_30 = Point.ByCoordinates(x=topPoint_14.out0, y=topPoint_14.out1, z=height_14)
radius_14 = DoubleSlider(750, range=500..750 step 1)
column_14 = Python()  # PythonNet3; unwired: IN[0]; same code as column
single_instance_14 = Python(IN[0]=byCoordinates_29, IN[1]=byCoordinates_30, IN[2]=radius_14, IN[3]=column_14)  # PythonNet3; same code as single_instance

# group: Quadrant 3 Sprout > Third Cylinder
bottom_point_15 = CodeBlock { -3000; -3000; 7000; }
byCoordinates_31 = Point.ByCoordinates(x=bottom_point_15.out0, y=bottom_point_15.out1, z=bottom_point_15.out2)
topPoint_15 = CodeBlock { -3000; -3000; }
height_15 = DoubleSlider(4000, range=4000..5000 step 1)
byCoordinates_32 = Point.ByCoordinates(x=topPoint_15.out0, y=topPoint_15.out1, z=height_15)
radius_15 = DoubleSlider(375, range=250..375 step 1)
column_15 = Python()  # PythonNet3; unwired: IN[0]; same code as column
single_instance_15 = Python(IN[0]=byCoordinates_31, IN[1]=byCoordinates_32, IN[2]=radius_15, IN[3]=column_15)  # PythonNet3; same code as single_instance

# group: Quadrant 4 Sprout > Vertical Column
bottom_point_16 = CodeBlock { 3000; -3000; 0; }
byCoordinates_33 = Point.ByCoordinates(x=bottom_point_16.out0, y=bottom_point_16.out1, z=bottom_point_16.out2)
topPoint_16 = CodeBlock { 3000; -3000; }
height_16 = DoubleSlider(6945, range=6000..7000 step 1)
byCoordinates_34 = Point.ByCoordinates(x=topPoint_16.out0, y=topPoint_16.out1, z=height_16)
radius_16 = DoubleSlider(194, range=0..300 step 1)
column_16 = Python()  # PythonNet3; unwired: IN[0]; same code as column
single_instance_16 = Python(IN[0]=byCoordinates_33, IN[1]=byCoordinates_34, IN[2]=radius_16, IN[3]=column_16)  # PythonNet3; same code as single_instance

# group: Quadrant 4 Sprout > First Cylinder
bottom_point_17 = CodeBlock { 3000; -3000; 7000; }
byCoordinates_35 = Point.ByCoordinates(x=bottom_point_17.out0, y=bottom_point_17.out1, z=bottom_point_17.out2)
topPoint_17 = CodeBlock { 3000; -3000; }
height_17 = DoubleSlider(6104, range=6000..7000 step 1)
byCoordinates_36 = Point.ByCoordinates(x=topPoint_17.out0, y=topPoint_17.out1, z=height_17)
radius_17 = DoubleSlider(1262, range=1000..1500 step 1)
column_17 = Python()  # PythonNet3; unwired: IN[0]; same code as column
single_instance_17 = Python(IN[0]=byCoordinates_35, IN[1]=byCoordinates_36, IN[2]=radius_17, IN[3]=column_17)  # PythonNet3; same code as single_instance

# group: Quadrant 4 Sprout > Second Cylinder
bottom_point_18 = CodeBlock { 3000; -3000; 7000; }
byCoordinates_37 = Point.ByCoordinates(x=bottom_point_18.out0, y=bottom_point_18.out1, z=bottom_point_18.out2)
topPoint_18 = CodeBlock { 3000; -3000; }
height_18 = DoubleSlider(5000, range=5000..6000 step 1)
byCoordinates_38 = Point.ByCoordinates(x=topPoint_18.out0, y=topPoint_18.out1, z=height_18)
radius_18 = DoubleSlider(750, range=500..750 step 1)
column_18 = Python()  # PythonNet3; unwired: IN[0]; same code as column
single_instance_18 = Python(IN[0]=byCoordinates_37, IN[1]=byCoordinates_38, IN[2]=radius_18, IN[3]=column_18)  # PythonNet3; same code as single_instance

# group: Quadrant 4 Sprout > Third Cylinder
bottom_point_19 = CodeBlock { 3000; -3000; 7000; }
byCoordinates_39 = Point.ByCoordinates(x=bottom_point_19.out0, y=bottom_point_19.out1, z=bottom_point_19.out2)
topPoint_19 = CodeBlock { 3000; -3000; }
height_19 = DoubleSlider(4000, range=4000..5000 step 1)
byCoordinates_40 = Point.ByCoordinates(x=topPoint_19.out0, y=topPoint_19.out1, z=height_19)
radius_19 = DoubleSlider(375, range=250..375 step 1)
column_19 = Python()  # PythonNet3; unwired: IN[0]; same code as column
single_instance_19 = Python(IN[0]=byCoordinates_39, IN[1]=byCoordinates_40, IN[2]=radius_19, IN[3]=column_19)  # PythonNet3; same code as single_instance

# group: Hexagonal Netting Lattice (Upper)
radius_20 = DoubleSlider(227, range=0..1000 step 1)
x_position = DoubleSlider(4000, range=0..4000 step 1)
y_position = DoubleSlider(4000, range=0..4000 step 1)
height_20 = DoubleSlider(6984, range=0..6984 step 1)
hexagonal_lattice = Python(IN[0]=radius_20, IN[1]=x_position, IN[2]=y_position, IN[3]=height_20)  # PythonNet3
# ---------- hexagonal_lattice.python (64 lines) ----------
import clr
import math

# Load Dynamo geometry library
clr.AddReference('ProtoGeometry')
from Autodesk.DesignScript.Geometry import Point, PolyCurve

# --- Inputs ---
r = float(IN[0])          # hex radius

extentX = float(IN[1])    # symmetric range in X: -extentX .. +extentX
extentY = float(IN[2])    # symmetric range in Y: -extentY .. +extentY

# zOffset optional
try:
    zOffset = float(IN[3])
except:
    zOffset = 0.0

# Use absolute values so slider can be +/- but we treat it as size
extentX = abs(extentX)
extentY = abs(extentY)

minX = -extentX
maxX =  extentX
minY = -extentY
maxY =  extentY

width  = maxX - minX
height = maxY - minY

# Flat-top hex spacing
xStep = 1.5 * r
yStep = math.sqrt(3) * r

# How many rows/cols to cover region (with padding)
approxCols = int(math.ceil(width  / xStep)) + 2
approxRows = int(math.ceil(height / yStep)) + 2

hexes = []

for i in range(approxRows):
    for j in range(approxCols):
        # Base honeycomb layout starting from minX, minY
        x = minX + xStep * j + (i % 2) * xStep
        y = minY + yStep * i

        # Only keep hexes whose centers are near the region
        if x < (minX - r) or x > (maxX + r) or y < (minY - r) or y > (maxY + r):
            continue

        # Build one flat-top hexagon around (x, y)
        pts = []
        for k in range(6):
            angle = math.radians(60 * k)  # 0°, 60°, ... 300°
            px = x + r * math.cos(angle)
            py = y + r * math.sin(angle)
            pts.append(Point.ByCoordinates(px, py, zOffset))

        # Close the polycurve
        pts.append(pts[0])
        hexes.append(PolyCurve.ByPoints(pts))

OUT = hexes
# ----------------------------------------
code_block_4 = CodeBlock { 255; 0; 128; 0; }
byARGB_2 = Color.ByARGB(alpha=code_block_4.out0, red=code_block_4.out1, green=code_block_4.out2, blue=code_block_4.out3)
byGeometryColor_2 = Modifiers.GeometryColor.ByGeometryColor(geometry=hexagonal_lattice, color=byARGB_2)

# group: Hexagonal Netting Lattice (Lower)
radius_21 = DoubleSlider(227, range=0..1000 step 1)
x_position_2 = DoubleSlider(4000, range=0..4000 step 1)
y_position_2 = DoubleSlider(4000, range=0..4000 step 1)
height_21 = DoubleSlider(6731, range=0..6984 step 1)
hexagonal_lattice_2 = Python(IN[0]=radius_21, IN[1]=x_position_2, IN[2]=y_position_2, IN[3]=height_21)  # PythonNet3; same code as hexagonal_lattice
code_block_5 = CodeBlock { 255; 230; 184; 0; }
byARGB_3 = Color.ByARGB(alpha=code_block_5.out0, red=code_block_5.out1, green=code_block_5.out2, blue=code_block_5.out3)
byGeometryColor_3 = Modifiers.GeometryColor.ByGeometryColor(geometry=hexagonal_lattice_2, color=byARGB_3)

# group: Quadrant 1 Sprout > Vertical Column
bottom_point_20 = CodeBlock { 3000; 3000; 0; }
byCoordinates_41 = Point.ByCoordinates(x=bottom_point_20.out0, y=bottom_point_20.out1, z=bottom_point_20.out2)
topPoint_20 = CodeBlock { 3000; 3000; }
height_22 = DoubleSlider(7000, range=6000..7000 step 1)
byCoordinates_42 = Point.ByCoordinates(x=topPoint_20.out0, y=topPoint_20.out1, z=height_22)
radius_22 = DoubleSlider(194, range=0..300 step 1)
column_20 = Python()  # PythonNet3; unwired: IN[0]; same code as column
single_instance_20 = Python(IN[0]=byCoordinates_41, IN[1]=byCoordinates_42, IN[2]=radius_22, IN[3]=column_20)  # PythonNet3; same code as single_instance
volume = Solid.Volume(solid=single_instance_20)
total_volume_m_3 = Watch(volume)
