# Dynamo graph 1854362.dyn (Dynamo 3.6.0.9395)

# group: Don't touch this ground
code_block = CodeBlock { -5000; -5000; -200; }
byCoordinates = Point.ByCoordinates(x=code_block.out0, y=code_block.out1, z=code_block.out2)
code_block_2 = CodeBlock { 5000; 5000; 0; }
byCoordinates_2 = Point.ByCoordinates(x=code_block_2.out0, y=code_block_2.out1, z=code_block_2.out2)
byCorners = Cuboid.ByCorners(lowPoint=byCoordinates, highPoint=byCoordinates_2)
code_block_3 = CodeBlock { 0; 100; 0; }
byARGB = Color.ByARGB(red=code_block_3.out0, green=code_block_3.out1, blue=code_block_3.out2)
byGeometryColor = Modifiers.GeometryColor.ByGeometryColor(geometry=byCorners, color=byARGB)

code_block_4 = CodeBlock { 0; 0; }
top_of_concrete_rectangle_height = DoubleSlider(600, range=600..1000 step 1)
byCoordinates_3 = Point.ByCoordinates(x=code_block_4.out0, y=code_block_4.out1, z=top_of_concrete_rectangle_height)
rod_length_from_outside = DoubleSlider(2290, range=1200..3000 step 1)
outer_circle = Circle.ByCenterPointRadius(centerPoint=byCoordinates_3, radius=rod_length_from_outside)
code_block_5 = CodeBlock { 0; 13; 1/16; }
sequence = Sequence(start=code_block_5.out0, amount=code_block_5.out1, step=code_block_5.out2)
pointAtParameter = Curve.PointAtParameter(curve=outer_circle, param=sequence)
code_block_6 = CodeBlock { 0; 0; }
inner_circle_height = DoubleSlider(475, range=300..600 step 1)
byCoordinates_4 = Point.ByCoordinates(x=code_block_6.out0, y=code_block_6.out1, z=inner_circle_height)
rod_length_from_inside = DoubleSlider(550, range=500..2000 step 1)
inner_circle = Circle.ByCenterPointRadius(centerPoint=byCoordinates_4, radius=rod_length_from_inside)
code_block_7 = CodeBlock { 0; 13; 1/16; }
sequence_2 = Sequence(start=code_block_7.out0, amount=code_block_7.out1, step=code_block_7.out2)
pointAtParameter_2 = Curve.PointAtParameter(curve=inner_circle, param=sequence_2)
code_block_8 = CodeBlock { 110; 12; 1; }
sequence_3 = Sequence(start=code_block_8.out0, amount=code_block_8.out1, step=code_block_8.out2)
class_circular_brass_rod = Python()  # CPython3; unwired: IN[0]
# ---------- class_circular_brass_rod.python (27 lines) ----------
# Load the Python Standard and DesignScript Libraries
import sys
import clr
clr.AddReference('ProtoGeometry')
from Autodesk.DesignScript.Geometry import *

class Circular_Brass_Rod:
    def __init__(self, bottom_point, top_point, radius):
        self.bottom = bottom_point
        self.top = top_point
        self.radius = radius
        
    def make_geometry(self):
        # These ARE solids, but Solid.ByUnion requires a LIST
        rod = Cylinder.ByPointsRadius(self.bottom, self.top, self.radius)
        tip = Sphere.ByCenterPointRadius(self.bottom, self.radius)

        # Union must take a LIST
        united = Solid.ByUnion([rod, tip])

        return united
        
    def material_volume(self):
        solid = self.make_geometry()
        return solid.Volume

OUT = Circular_Brass_Rod
# ----------------------------------------
series_of_instances_of_circular = Python(IN[0]=pointAtParameter, IN[1]=pointAtParameter_2, IN[2]=sequence_3, IN[3]=class_circular_brass_rod)  # "Series of Instances of Circular Brass Rod"; CPython3
# ---------- series_of_instances_of_circular.python (31 lines) ----------
Circular_Brass_Rod = IN[3]

def to_list(x):
    return x if isinstance(x, list) else [x]

bottom_points = to_list(IN[0])
top_points    = to_list(IN[1])
radii         = to_list(IN[2])

count = min(len(bottom_points), len(top_points))

solids = []
volumes = []

for i in range(count):
    btm = bottom_points[i]
    top = top_points[i]
    r   = radii[i] if i < len(radii) else radii[-1]

    rod = Circular_Brass_Rod(btm, top, r)

    
    solid = rod.make_geometry()
    solids.append(solid)

    
    volumes.append(rod.material_volume())
    
  

OUT = (solids, volumes)
# ----------------------------------------
volumes_of_each_brass_rod = Watch(series_of_instances_of_circular)
adding_the_volumes_of_the_rods = Python(IN[0]=volumes_of_each_brass_rod)  # "Adding the Volumes of the rods together"; CPython3
# ---------- adding_the_volumes_of_the_rods.python (13 lines) ----------
volumes = IN[0]

# Always work with a list
if not isinstance(volumes, list):
    volumes = [volumes]

# Remove None values
clean_volumes = [v for v in volumes if isinstance(v, (int, float))]

# If everything failed, output 0 instead of crashing
total_volume = sum(clean_volumes) if clean_volumes else 0

OUT = total_volume
# ----------------------------------------
code_block_9 = CodeBlock { 1500; -1500; }
byCoordinates_5 = Point.ByCoordinates(x=code_block_9.out0, y=code_block_9.out1, z=inner_circle_height)
code_block_10 = CodeBlock { 900; -900; 2000; }
byCoordinates_6 = Point.ByCoordinates(x=code_block_10.out1, y=code_block_10.out0, z=code_block_10.out2)
number = DoubleInput(120)
number_2 = DoubleInput(50)
brass_cone_dial = Cone.ByPointsRadii(startPoint=byCoordinates_5, endPoint=byCoordinates_6, startRadius=number, endRadius=number_2)
volume = Solid.Volume(solid=brass_cone_dial)
brass_dial_sphere_tip = Sphere.ByCenterPointRadius(centerPoint=byCoordinates_6, radius=number_2)
volume_2 = Solid.Volume(solid=brass_dial_sphere_tip)
code_block_11 = CodeBlock { 00; 00; }
byCoordinates_7 = Point.ByCoordinates(x=code_block_11.out0, y=code_block_11.out1, z=inner_circle_height)
code_block_12 = CodeBlock { 500; -500; 1100; }
byCoordinates_8 = Point.ByCoordinates(x=code_block_12.out0, y=code_block_12.out1, z=code_block_12.out2)
number_3 = DoubleInput(120)
number_4 = DoubleInput(50)
brass_cone_dial_support = Cone.ByPointsRadii(startPoint=byCoordinates_7, endPoint=byCoordinates_8, startRadius=number_3, endRadius=number_4)
volume_3 = Solid.Volume(solid=brass_cone_dial_support)
add = volume_2 + volume_3
add_2 = volume + add
volume_of_brass_dial = Watch(add_2)
add_3 = adding_the_volumes_of_the_rods + volume_of_brass_dial
final_volume_of_brass_in_mm_3 = Watch(add_3)
class_rectangular_concrete_slab = Python()  # CPython3; unwired: IN[0]
# ---------- class_rectangular_concrete_slab.python (25 lines) ----------
# Load the Python Standard and DesignScript Libraries
import sys
import clr
clr.AddReference('ProtoGeometry')
from Autodesk.DesignScript.Geometry import *

class concrete_rectangular_slab:
    def __init__(self, width, length, height):
        
        self.width = width
        self.length = length
        self.height = height

    def material_volume(self):
        
        geom = self.make_geometry()
        return geom.Volume

    def make_geometry(self):
        
        geom = Cuboid.ByLengths(self.width, self.length, self.height)
        return geom.Translate(0, 0, self.height / 2)


OUT = concrete_rectangular_slab
# ----------------------------------------
number_5 = DoubleInput(3000)
top_of_concrete_rectangle_height_2 = DoubleSlider(300, range=100..600 step 1)
instance_of_rectangular_concrete = Python(IN[0]=class_rectangular_concrete_slab, IN[1]=number_5, IN[2]=number_5, IN[3]=top_of_concrete_rectangle_height_2)  # "Instance of Rectangular Concrete Slab"; CPython3
# ---------- instance_of_rectangular_concrete.python (12 lines) ----------
slabClass = IN[0]
width = IN[1]
length = IN[2]
height = IN[3]

slab = slabClass(width, length, height)

geom = slab.make_geometry()

vol = slab.material_volume()

OUT = (geom, vol)
# ----------------------------------------
watch = Watch(instance_of_rectangular_concrete)
code_block_13 = CodeBlock { 0; 0; }
byCoordinates_9 = Point.ByCoordinates(x=code_block_13.out0, y=code_block_13.out1, z=top_of_concrete_rectangle_height_2)
code_block_14 = CodeBlock { 0; 0; }
byCoordinates_10 = Point.ByCoordinates(x=code_block_14.out0, y=code_block_14.out1, z=top_of_concrete_rectangle_height)
number_6 = DoubleInput(2500)
concrete_cylinder_base_slab = Cylinder.ByPointsRadius(startPoint=byCoordinates_9, endPoint=byCoordinates_10, radius=number_6)
volume_4 = Solid.Volume(solid=concrete_cylinder_base_slab)
watch_2 = Watch(volume_4)
add_4 = watch + watch_2
final_volume_of_concrete_slab_in = Watch(add_4)  # "Final Volume of concrete Slab in mm^3"
adding_the_volumes_of_the_slabs = Python(IN[0]=final_volume_of_concrete_slab_in)  # "Adding the Volumes of the Slabs together"; CPython3; same code as adding_the_volumes_of_the_rods
final_volume_of_concrete_slab_in_2 = Watch(adding_the_volumes_of_the_slabs)  # "Final Volume of concrete Slab in mm^3"
