# Dynamo graph 1854364.dyn (Dynamo 4.0.0.3277)

# group: Ground
code_block = CodeBlock { -5000; -5000; -200; }  # frozen
byCoordinates = Point.ByCoordinates(x=code_block.out0, y=code_block.out1, z=code_block.out2)  # frozen
code_block_2 = CodeBlock { 5000; 5000; 0; }  # frozen
byCoordinates_2 = Point.ByCoordinates(x=code_block_2.out0, y=code_block_2.out1, z=code_block_2.out2)  # frozen
byCorners = Cuboid.ByCorners(lowPoint=byCoordinates, highPoint=byCoordinates_2)  # frozen
code_block_3 = CodeBlock { 0; 100; 0; }  # frozen
byARGB = Color.ByARGB(red=code_block_3.out0, green=code_block_3.out1, blue=code_block_3.out2)  # frozen
byGeometryColor = Modifiers.GeometryColor.ByGeometryColor(geometry=byCorners, color=byARGB)  # frozen

class_steel_dome = Python()  # PythonNet3; unwired: IN[0]
# ---------- class_steel_dome.python (34 lines) ----------
import clr
import math
clr.AddReference('ProtoGeometry')
from Autodesk.DesignScript.Geometry import *

class MushroomCap:
    def __init__(self, profile_curve, thickness):
        self.profile_curve = profile_curve
        self.thickness = thickness
        
    def create_geometry(self):
        axis_point = Point.ByCoordinates(0, 0, 0)
        axis_vector = Vector.ZAxis()
        cap_surface = Surface.ByRevolve(
            self.profile_curve, 
            axis_point, 
            axis_vector, 
            0, 360
        )
        cap_solid = cap_surface.Thicken(self.thickness)
        return cap_solid
        
    def calculate_volume(self):
        cap_surface = Surface.ByRevolve(
            self.profile_curve, 
            Point.ByCoordinates(0, 0, 0), 
            Vector.ZAxis(), 
            0, 360
        )
        surface_area = cap_surface.Area
        volume = surface_area * self.thickness
        return volume

OUT = MushroomCap
# ----------------------------------------
column_height = DoubleSlider(6000, range=5000..7000 step 100)
column_end_points_radius = DoubleSlider(3000, range=2000..3000 step 10)
number_of_stems = DoubleSlider(12, range=6..12 step 1)
code_block_4 = CodeBlock(Column_End_Height=column_height, Column_End_Radius=column_end_points_radius, Number_of_Stems=number_of_stems)
# ---------- code_block_4.designscript (11 lines) ----------
end_height = Column_End_Height;
end_radius = Column_End_Radius;
num_stems = Number_of_Stems;

angles = 0..(360-360/num_stems)..#num_stems;

end_pts = Point.ByCoordinates(
    end_radius * Math.Cos(angles),
    end_radius * Math.Sin(angles),
    end_height
);
# ----------------------------------------
roof_edge_points_horizontal = DoubleSlider(0.6, range=0.5..1 step 0.1)  # "Roof Edge Points Horizontal Offset"
roof_edge_points_vertical_offset = DoubleSlider(-1401, range=-2000..-200 step 1)
code_block_5 = CodeBlock(end_pts=code_block_4.end_pts, Horizontal_Offset=roof_edge_points_horizontal, Vertical_Offset=roof_edge_points_vertical_offset)
# ---------- code_block_5.designscript (17 lines) ----------
end_pts;
horizontal_offset = Horizontal_Offset;
vertical_offset = Vertical_Offset;

center = Point.ByCoordinates(0, 0, 0);
dir_x = end_pts.X - center.X;
dir_y = end_pts.Y - center.Y;

length = Math.Sqrt(dir_x*dir_x + dir_y*dir_y);
dir_x_norm = dir_x / length;
dir_y_norm = dir_y / length;

offset_pts = Point.ByCoordinates(
    end_pts.X + (dir_x * horizontal_offset),
    end_pts.Y + (dir_y * horizontal_offset),
    end_pts.Z + vertical_offset
);
# ----------------------------------------
code_block_6 = CodeBlock(offset_pts=code_block_5.offset_pts, end_pts=code_block_4.end_pts) { offset_pts; end_pts; offset_pt = offset_pts[0]; end_pt = end_pts[0]; }
dome_height = DoubleSlider(550, range=550..2000 step 100)
code_block_7 = CodeBlock(end_pts=code_block_4.end_pts, dome_height=dome_height)
# ---------- code_block_7.designscript (6 lines) ----------
end_pts;
dome_height;

total_height = end_pts[0].Z + dome_height;

control_pt = Point.ByCoordinates(0, 0, total_height);
# ----------------------------------------
list_create = List.Create(item0=code_block_6.offset_pt, item1=code_block_6.end_pt, item2=code_block_7.control_pt)
byPoints = NurbsCurve.ByPoints(points=list_create)
dome_thickness = DoubleSlider(250, range=100..500 step 10)
instance_of_a_steel_dome = Python(IN[0]=class_steel_dome, IN[1]=byPoints, IN[2]=dome_thickness)  # PythonNet3
# ---------- instance_of_a_steel_dome.python (13 lines) ----------
import clr
clr.AddReference('ProtoGeometry')
from Autodesk.DesignScript.Geometry import *

SteelDome_class = IN[0]
profile_curve = IN[1]
dome_thickness = IN[2]

dome_instance = SteelDome_class(profile_curve, dome_thickness)
dome_geometry = dome_instance.create_geometry()
dome_volume = dome_instance.calculate_volume()

OUT = [dome_geometry, dome_volume]
# ----------------------------------------
code_block_8 = CodeBlock { 1; 0; }
getItemAtIndex = List.GetItemAtIndex(list=instance_of_a_steel_dome, index=code_block_8.out0)
class_curved_steel_column = Python()  # PythonNet3; unwired: IN[0]
# ---------- class_curved_steel_column.python (132 lines) ----------
import clr
import math
clr.AddReference('ProtoGeometry')
from Autodesk.DesignScript.Geometry import *

class CurvedColumn:
    def __init__(self, base_point, top_point, curvature, thickness, dome_geometry=None, base_height=None):
        self.base_point = base_point
        self.top_point = top_point
        self.curvature = curvature
        self.thickness = thickness
        self.dome_geometry = dome_geometry
        self.base_height = base_height

    def create_geometry(self):
        # direction vector
        dx = self.base_point.X
        dy = self.base_point.Y
        dist = math.sqrt(dx*dx + dy*dy)

        dir_x = dx / dist
        dir_y = dy / dist

        # creates curve
        curve_strength = 1200 * self.curvature
        control_point = Point.ByCoordinates(
            self.base_point.X + dir_x * curve_strength,
            self.base_point.Y + dir_y * curve_strength,
            (self.base_point.Z + self.top_point.Z) * 0.5
        )

        curve = NurbsCurve.ByPoints([self.base_point, control_point, self.top_point])
        
        # creates column solid
        tangent = curve.TangentAtParameter(0.0)
        plane = Plane.ByOriginNormal(self.base_point, tangent)
        circle = Circle.ByPlaneRadius(plane, self.thickness)
        column = circle.SweepAsSolid(curve)

        dome_solid = self.dome_geometry[0]
            
        # performs solid difference with steel dome
        try:
            result = column.Difference(dome_solid)
            
            # tries to separate into individual solids
            try:
                separated_pieces = result.Separate()
                
                # only process if there are multiple pieces
                if separated_pieces and len(separated_pieces) > 1:
                    # finds and keeps only the bottom piece (lowest centroid Z)
                    bottom_piece = None
                    lowest_z = float('inf')
                    
                    for piece in separated_pieces:
                        centroid = piece.Centroid()
                        if centroid.Z < lowest_z:
                            if bottom_piece is not None:
                                bottom_piece.Dispose()
                            bottom_piece = piece
                            lowest_z = centroid.Z
                        else:
                            piece.Dispose()  # disposes of top pieces
                    
                    column.Dispose()
                    column = bottom_piece
                else:
                    # single piece result, keep it
                    column.Dispose()
                    if separated_pieces and len(separated_pieces) == 1:
                        column = separated_pieces[0]
                    else:
                        column = result
                        
            except:
                # if Separate() fails, keeps the result as is
                column.Dispose()
                column = result
                
        except:
            # if difference fails, keeps original column
            pass

        # cuts geometry below base height using a cutting plane
        if self.base_height is not None:
            try:
                # creates a horizontal cutting plane at base height
                cutting_plane = Plane.ByOriginNormal(
                    Point.ByCoordinates(0, 0, self.base_height),
                    Vector.ZAxis()
                )
                
                # splits the column at the cutting plane
                split_results = column.Split(cutting_plane)
                
                if split_results and len(split_results) > 0:
                    # keeps only the part above base height
                    top_piece = None
                    highest_z = float('-inf')
                    
                    for piece in split_results:
                        centroid = piece.Centroid()
                        if centroid.Z > highest_z:
                            if top_piece is not None:
                                top_piece.Dispose()
                            top_piece = piece
                            highest_z = centroid.Z
                        else:
                            piece.Dispose()  # disposes of bottom piece
                    
                    column.Dispose()
                    column = top_piece
                
                cutting_plane.Dispose()
            except:
                pass
        
        control_point.Dispose()
        curve.Dispose()
        tangent.Dispose()
        plane.Dispose()
        circle.Dispose()
        
        return column

    def calculate_volume(self, column_geometry):
        if hasattr(column_geometry, 'Volume'):
            return column_geometry.Volume
        return 0

OUT = CurvedColumn
# ----------------------------------------
concrete_base_radius = DoubleInput(4000)
base_points_offset = DoubleSlider(1500, range=1000..1500 step 1)
base_height = DoubleSlider(100, range=100..250 step 1)
code_block_9 = CodeBlock(Concrete_Base_Radius=concrete_base_radius, Base_Point_Offset=base_points_offset, Base_Height=base_height, Number_of_Stems=number_of_stems)
# ---------- code_block_9.designscript (13 lines) ----------
base_radius = Concrete_Base_Radius;
point_offset = Base_Point_Offset;
base_height = Base_Height;
num_stems = Number_of_Stems;

angles = 0..(360-360/num_stems)..#num_stems;
point_radius = base_radius - point_offset;

base_pts = Point.ByCoordinates(
    point_radius * Math.Cos(angles),
    point_radius * Math.Sin(angles),
    base_height
);
# ----------------------------------------
stem_curvature = DoubleSlider(-1.5, range=-1.5..0 step 0.1)
stem_thickness = DoubleSlider(100, range=50..100 step 10)
series_of_instances_of_curved = Python(IN[0]=class_curved_steel_column, IN[1]=code_block_9.base_pts, IN[2]=code_block_4.end_pts, IN[3]=stem_curvature, IN[4]=stem_thickness, IN[5]=instance_of_a_steel_dome, IN[6]=base_height)  # "series of instances of curved steel columns"; PythonNet3
# ---------- series_of_instances_of_curved.python (24 lines) ----------
import clr
clr.AddReference('ProtoGeometry')
from Autodesk.DesignScript.Geometry import *

CurvedColumn = IN[0]
base_points = IN[1]
top_points = IN[2]
curvature = IN[3]
thickness = IN[4]
dome_geometry = IN[5]
base_height = IN[6]  

columns = []
volumes = []

for i in range(len(base_points)):
    column = CurvedColumn(base_points[i], top_points[i], curvature, thickness, dome_geometry, base_height)
    column_geometry = column.create_geometry()
    volume = column.calculate_volume(column_geometry)
    
    columns.append(column_geometry)
    volumes.append(volume)

OUT = [columns, volumes]
# ----------------------------------------
code_block_10 = CodeBlock { 1; 0; }
getItemAtIndex_2 = List.GetItemAtIndex(list=series_of_instances_of_curved, index=code_block_10.out0)
list_create_2 = List.Create(item0=getItemAtIndex, item1=getItemAtIndex_2)
flatten = List.Flatten(list=list_create_2)
sum = Math.Sum(values=flatten)
string_from_object = FromObject(object=sum)
string = StringInput(" mm³")
concat = String.Concat(string0=string_from_object, string1=string)
total_steel_volume = Watch(concat)
class_concrete_bench = Python()  # PythonNet3; unwired: IN[0]
# ---------- class_concrete_bench.python (46 lines) ----------
import clr
import math
clr.AddReference('ProtoGeometry')
from Autodesk.DesignScript.Geometry import *

class Bench:
    def __init__(self, bottom_center_point, width, depth, height, rotation_angle=0):        
        self.bottom_center_point = bottom_center_point
        self.width = width
        self.depth = depth
        self.height = height
        self.rotation_angle = rotation_angle
        
    def create_geometry(self):
        # moves the coordinate system up by half the height so the bench sits correctly
        center_point = Point.ByCoordinates(
            self.bottom_center_point.X,
            self.bottom_center_point.Y,
            self.bottom_center_point.Z + self.height / 2
        )
        
        # creates a coordinate system at the adjusted center point
        rotation_angle_rad = math.radians(self.rotation_angle)
        rotated_cs = CoordinateSystem.ByOriginVectors(
            center_point,
            Vector.ByCoordinates(math.cos(rotation_angle_rad), math.sin(rotation_angle_rad), 0),
            Vector.ByCoordinates(-math.sin(rotation_angle_rad), math.cos(rotation_angle_rad), 0),
            Vector.ZAxis()
        )
        
        # creates bench as a rectangular prism
        bench = Cuboid.ByLengths(
            rotated_cs,
            self.width,
            self.depth,
            self.height
        )
        
        return bench
        
    def calculate_volume(self, bench_geometry):
        if hasattr(bench_geometry, 'Volume'):
            return bench_geometry.Volume
        return 0

OUT = Bench
# ----------------------------------------
bench_count = DoubleSlider(6, range=4..8 step 1)
bench_width = DoubleSlider(400, range=300..400 step 0.1)
bench_depth = DoubleSlider(1500, range=1000..1500 step 0.1)
bench_height = DoubleSlider(600, range=500..900 step 1)
bench_offset = DoubleSlider(200, range=150..200 step 0.1)
code_block_11 = CodeBlock(base_height=base_height) { x=0; y=0; z=base_height; }
byCoordinates_3 = Point.ByCoordinates(x=code_block_11.x, y=code_block_11.y, z=code_block_11.z)
series_of_instances_of_concrete = Python(IN[0]=class_concrete_bench, IN[1]=bench_count, IN[2]=bench_width, IN[3]=bench_depth, IN[4]=bench_height, IN[5]=bench_offset, IN[6]=byCoordinates_3, IN[7]=code_block_9.base_pts)  # "series of instances of concrete benches"; PythonNet3
# ---------- series_of_instances_of_concrete.python (53 lines) ----------
import clr
import math
clr.AddReference('ProtoGeometry')
from Autodesk.DesignScript.Geometry import *

Bench = IN[0]
bench_count = int(IN[1])
bench_width = IN[2]
bench_depth = IN[3]
bench_height = IN[4]
bench_offset = IN[5]
center_point = IN[6]
base_points = IN[7]  

benches = []
volumes = []

# calculates base radius from first point
first_point = base_points[0]
base_radius = math.sqrt(
    (first_point.X - center_point.X)**2 + 
    (first_point.Y - center_point.Y)**2
)

# creates benches
for i in range(bench_count):
    angle = (360.0 / bench_count) * i
    angle_rad = math.radians(angle)
    
    # direction vector
    dir_x = math.cos(angle_rad)
    dir_y = math.sin(angle_rad)
    
    # distance from center to bench center
    distance = base_radius + bench_offset + (bench_width / 2)
    
    # bench position
    x = center_point.X + distance * dir_x
    y = center_point.Y + distance * dir_y
    z = center_point.Z
    
    bench_bottom_center = Point.ByCoordinates(x, y, z)
    
    rotation_angle = angle + 180  
    
    bench = Bench(bench_bottom_center, bench_width, bench_depth, bench_height, rotation_angle)
    bench_geometry = bench.create_geometry()
    volume = bench.calculate_volume(bench_geometry)
    
    benches.append(bench_geometry)
    volumes.append(volume)

OUT = [benches, volumes]
# ----------------------------------------
code_block_12 = CodeBlock { 1; 0; }
getItemAtIndex_3 = List.GetItemAtIndex(list=series_of_instances_of_concrete, index=code_block_12.out0)
class_concrete_base = Python()  # PythonNet3; unwired: IN[0]
# ---------- class_concrete_base.python (34 lines) ----------
import clr
clr.AddReference('ProtoGeometry')
from Autodesk.DesignScript.Geometry import *

class ConcreteBase:
    def __init__(self, center_point, radius, height):
        self.center_point = center_point
        self.radius = radius
        self.height = height
        
    def create_geometry(self):
        base_plane = Plane.ByOriginNormal(
            Point.ByCoordinates(self.center_point.X, self.center_point.Y, 0),
            Vector.ZAxis()
        )
        
        # creates the base circle
        base_circle = Circle.ByPlaneRadius(base_plane, self.radius)
        
        # extrudes the circle vertically to create a cylinder
        base_solid = base_circle.ExtrudeAsSolid(Vector.ByCoordinates(0, 0, self.height))
        
        # removes temporary geometry
        base_plane.Dispose()
        base_circle.Dispose()
        
        return base_solid
        
    def calculate_volume(self, base_geometry):
        if hasattr(base_geometry, 'Volume'):
            return base_geometry.Volume
        return 0

OUT = ConcreteBase
# ----------------------------------------
code_block_13 = CodeBlock { x = 0; y = 0; z = 0; }
byCoordinates_4 = Point.ByCoordinates(x=code_block_13.x, y=code_block_13.y, z=code_block_13.z)
instance_of_a_concrete_base = Python(IN[0]=class_concrete_base, IN[1]=byCoordinates_4, IN[2]=concrete_base_radius, IN[3]=base_height)  # PythonNet3
# ---------- instance_of_a_concrete_base.python (11 lines) ----------
ConcreteBase = IN[0]
center_point = IN[1]  
radius = IN[2]        
height = IN[3]        

# creates the base
base = ConcreteBase(center_point, radius, height)
base_geometry = base.create_geometry()
volume = base.calculate_volume(base_geometry)

OUT = [base_geometry, volume]
# ----------------------------------------
code_block_14 = CodeBlock { 1; 0; }
getItemAtIndex_4 = List.GetItemAtIndex(list=instance_of_a_concrete_base, index=code_block_14.out0)
list_create_3 = List.Create(item0=getItemAtIndex_3, item1=getItemAtIndex_4)
flatten_2 = List.Flatten(list=list_create_3)
sum_2 = Math.Sum(values=flatten_2)
string_from_object_2 = FromObject(object=sum_2)
concat_2 = String.Concat(string0=string_from_object_2, string1=string)
total_concrete_volume = Watch(concat_2)
getItemAtIndex_5 = List.GetItemAtIndex(list=instance_of_a_concrete_base, index=code_block_14.out1)
code_block_15 = CodeBlock { alpha = 255; red = 180; green = 180; blue = 180; }
byARGB_2 = Color.ByARGB(alpha=code_block_15.alpha, red=code_block_15.red, green=code_block_15.green, blue=code_block_15.blue)
byGeometryColor_2 = Modifiers.GeometryColor.ByGeometryColor(geometry=getItemAtIndex_5, color=byARGB_2)
getItemAtIndex_6 = List.GetItemAtIndex(list=series_of_instances_of_concrete, index=code_block_12.out1)
code_block_16 = CodeBlock { alpha = 255; red = 180; green = 180; blue = 180; }
byARGB_3 = Color.ByARGB(alpha=code_block_16.alpha, red=code_block_16.red, green=code_block_16.green, blue=code_block_16.blue)
byGeometryColor_3 = Modifiers.GeometryColor.ByGeometryColor(geometry=getItemAtIndex_6, color=byARGB_3)
getItemAtIndex_7 = List.GetItemAtIndex(list=instance_of_a_steel_dome, index=code_block_8.out1)
code_block_17 = CodeBlock { alpha = 255; red = 220; green = 220; blue = 230; }
byARGB_4 = Color.ByARGB(alpha=code_block_17.alpha, red=code_block_17.red, green=code_block_17.green, blue=code_block_17.blue)
byGeometryColor_4 = Modifiers.GeometryColor.ByGeometryColor(geometry=getItemAtIndex_7, color=byARGB_4)
getItemAtIndex_8 = List.GetItemAtIndex(list=series_of_instances_of_curved, index=code_block_10.out1)
code_block_18 = CodeBlock { alpha = 255; red = 200; green = 200; blue = 210; }
byARGB_5 = Color.ByARGB(alpha=code_block_18.alpha, red=code_block_18.red, green=code_block_18.green, blue=code_block_18.blue)
byGeometryColor_5 = Modifiers.GeometryColor.ByGeometryColor(geometry=getItemAtIndex_8, color=byARGB_5)
