# Dynamo graph 1854420.dyn (Dynamo 3.6.0.9395)

# group: Don't touch this ground
code_block = CodeBlock { -5000; -5000; -200; }
byCoordinates = Point.ByCoordinates(x=code_block.out0, y=code_block.out1, z=code_block.out2)
code_block_2 = CodeBlock { 5000; 5000; 0; }
byCoordinates_2 = Point.ByCoordinates(x=code_block_2.out0, y=code_block_2.out1, z=code_block_2.out2)
byCorners = Cuboid.ByCorners(lowPoint=byCoordinates, highPoint=byCoordinates_2)
code_block_3 = CodeBlock { 0; 100; 0; }
byARGB = Color.ByARGB(red=code_block_3.out0, green=code_block_3.out1, blue=code_block_3.out2)
byGeometryColor = Modifiers.GeometryColor.ByGeometryColor(geometry=byCorners, color=byARGB)

byCoordinates_3 = Point.ByCoordinates()
code_block_4 = CodeBlock { 0; 0; 4000; }
byCoordinates_4 = Point.ByCoordinates(x=code_block_4.out0, y=code_block_4.out1, z=code_block_4.out2)
trunk_radius = DoubleSlider(200, range=100..500 step 100)
circular_steeltrunk = Python()  # CPython3; unwired: IN[0]
# ---------- circular_steeltrunk.python (21 lines) ----------
# Load the Python Standard and DesignScript Libraries
import sys
import clr
clr.AddReference('ProtoGeometry')
from Autodesk.DesignScript.Geometry import *
import math

class SteelTrunk:
    def __init__(self, bottom_point, top_point, radius):
        self.bottom = bottom_point
        self.top = top_point
        self.radius = radius

    def make_geometry(self):
        return Cylinder.ByPointsRadius(self.bottom, self.top, self.radius)

    def volume(self):
        h = self.bottom.DistanceTo(self.top)
        return math.pi * (self.radius ** 2) * h

OUT = SteelTrunk
# ----------------------------------------
single_instance_trunk = Python(IN[0]=byCoordinates_3, IN[1]=byCoordinates_4, IN[2]=trunk_radius, IN[3]=circular_steeltrunk)  # CPython3
# ---------- single_instance_trunk.python (10 lines) ----------
SteelTrunk = IN[3]
bottom_pt = IN[0]
top_pt = IN[1]
radius = IN[2]

t = SteelTrunk(bottom_pt, top_pt, radius)
geom = t.make_geometry()
vol = t.volume()

OUT = [geom, vol]
# ----------------------------------------
code_block_5 = CodeBlock { 0; 0; 3950; }
byCoordinates_5 = Point.ByCoordinates(x=code_block_5.out0, y=code_block_5.out1, z=code_block_5.out2)
branch_count = IntegerSlider(15, range=3..30 step 10)
ofRepeatedItem = List.OfRepeatedItem(item=byCoordinates_5, amount=branch_count)
roof_radius = DoubleSlider(3000, range=1000..4500 step 3000)
byCenterPointRadius = Circle.ByCenterPointRadius(centerPoint=byCoordinates_4, radius=roof_radius)
code_block_6 = CodeBlock(BranchCount=branch_count) { 0..1..(1.0/BranchCount); }
pointAtParameter = Curve.PointAtParameter(curve=byCenterPointRadius, param=code_block_6)
branch_radius = DoubleSlider(80, range=75..80 step 1)
circular_timberbranch = Python()  # CPython3; unwired: IN[0]
# ---------- circular_timberbranch.python (21 lines) ----------
# Load the Python Standard and DesignScript Libraries
import sys
import clr
clr.AddReference('ProtoGeometry')
from Autodesk.DesignScript.Geometry import *
import math

class TimberBranch:
    def __init__(self, bottom_point, top_point, radius):
        self.bottom = bottom_point
        self.top = top_point
        self.radius = radius

    def make_geometry(self):
        return Cylinder.ByPointsRadius(self.bottom, self.top, self.radius)

    def volume(self):
        h = self.bottom.DistanceTo(self.top)
        return math.pi * (self.radius ** 2) * h

OUT = TimberBranch
# ----------------------------------------
series_of_instances_branches = Python(IN[0]=ofRepeatedItem, IN[1]=pointAtParameter, IN[2]=branch_radius, IN[3]=circular_timberbranch)  # CPython3
# ---------- series_of_instances_branches.python (26 lines) ----------
TimberBranch = IN[3]
bottom_points = IN[0]
top_points = IN[1]
radii = IN[2]

branches = []
branch_volumes = []

count = min(len(bottom_points), len(top_points))

for i in range(count):
    if isinstance(radii, list):
        r = radii[i] if i < len(radii) else radii[-1]
    else:
        r = radii

    btm = bottom_points[i]
    top = top_points[i]

    b = TimberBranch(btm, top, r)
    branches.append(b.make_geometry())
    branch_volumes.append(b.volume())

total_timber_volume = sum(branch_volumes)

OUT = [branches, branch_volumes, total_timber_volume]
# ----------------------------------------
final_target = Python(IN[0]=single_instance_trunk, IN[1]=series_of_instances_branches)  # CPython3
# ---------- final_target.python (12 lines) ----------
trunk_data = IN[0]
trunk_geom = trunk_data[0]
steel_vol = trunk_data[1]

branch_data = IN[1]
branch_geoms = branch_data[0]
branch_vols = branch_data[1]
timber_total = branch_data[2]

all_geometry = [trunk_geom] + branch_geoms

OUT = [all_geometry, steel_vol, timber_total]
# ----------------------------------------
code_block_7 = CodeBlock { 1; }
steel_volume_index = List.GetItemAtIndex(list=final_target, index=code_block_7)
steel_volume_mm_3 = Watch(steel_volume_index)
code_block_8 = CodeBlock { 2; }
timber_volume_index = List.GetItemAtIndex(list=final_target, index=code_block_8)
timber_volume_mm_3 = Watch(timber_volume_index)
