# Dynamo graph 1854438.dyn (Dynamo 3.6.0.9395)

class_circular_steel = Python()  # CPython3; unwired: IN[0]
# ---------- class_circular_steel.python (24 lines) ----------
import sys
import clr
clr.AddReference('ProtoGeometry')
from Autodesk.DesignScript.Geometry import *
import math

class CircularSteel(object):
    def __init__(self, centerline, radius):
        self.centerline = centerline
        self.radius = radius

    def make_geometry(self):
        # circle at the start of the rib
        start = self.centerline.StartPoint
        profile = Circle.ByCenterPointRadius(start, self.radius)
        # sweep the circle along the rib curve
        solid = Solid.BySweep(profile, self.centerline)
        return solid

    def measure_volume(self):
        solid = self.make_geometry()
        return solid.Volume

OUT = CircularSteel
# ----------------------------------------
code_block = CodeBlock { 10000; }
number_of_ribs = IntegerSlider(20, range=1..100 step 1)  # graph input
code_block_2 = CodeBlock(Lengths=code_block, NumberofRibs=number_of_ribs) { Lengths; NumberofRibs; Interval = 0..1..#NumberofRibs; Xpoint = Interval * Lengths; }
code_block_3 = CodeBlock(x=code_block_2.Xpoint) { x - 5000; }
code_block_4 = CodeBlock { y1 = -5000; y2 = 5000; }
start = Point.ByCoordinates(x=code_block_3, y=code_block_4.y1)
frequency_of_sin = DoubleSlider(0.1, range=0.1..1.5 step 0.01)
frequency_of_cos = DoubleSlider(0.1, range=0.1..1.5 step 0.01)
code_block_5 = CodeBlock(x=code_block_2.Xpoint, FreqA=frequency_of_sin, FreqB=frequency_of_cos)
# ---------- code_block_5.designscript (4 lines) ----------
x;
z1 = 3.8 * Math.Sin(FreqA * x + 14.5)
    - 3.2 * Math.Cos(FreqB * x + 19.3);
z1;
# ----------------------------------------
amplitude_of_wave = DoubleSlider(34.5, range=0..100 step 0.1)
code_block_6 = CodeBlock(z3=code_block_5.out2, Amp=amplitude_of_wave) { zAmp = 4000+ (z3 * Amp); }
middle = Point.ByCoordinates(x=code_block_3, z=code_block_6)
end = Point.ByCoordinates(x=code_block_3, y=code_block_4.y2)
ribs = Arc.ByThreePoints(firstPoint=start, secondPoint=middle, thirdPoint=end)
radius_of_steel_rods = DoubleSlider(62.4, range=0..100 step 0.1)
series_of_instances_of_steel = Python(IN[0]=class_circular_steel, IN[1]=ribs, IN[2]=radius_of_steel_rods)  # "Series of Instances of Steel Rods"; CPython3
# ---------- series_of_instances_of_steel.python (36 lines) ----------
import sys
import clr
clr.AddReference('ProtoGeometry')
from Autodesk.DesignScript.Geometry import *
import math
from collections.abc import Iterable

CircularSteel = IN[0]   # the class
centerlines   = IN[1]   # rib curves
radius        = IN[2]   # mm

def iter_curves(obj):
    # Recursively walk through nested lists to find curves
    if isinstance(obj, Iterable) and not hasattr(obj, "StartPoint"):
        for sub in obj:
            for c in iter_curves(sub):
                yield c
    else:
        yield obj

curves = list(iter_curves(centerlines))

solids  = []
volumes = []

for cl in curves:
    steel  = CircularSteel(cl, radius)
    solid  = steel.make_geometry()
    vol    = steel.measure_volume()
    solids.append(solid)
    volumes.append(vol)

# Total volume in mm³
totalVolume = sum(volumes)

OUT = solids, volumes, totalVolume
# ----------------------------------------
watch = Watch(series_of_instances_of_steel)
code_block_7 = CodeBlock { 2; }
getItemAtIndex = List.GetItemAtIndex(list=watch, index=code_block_7)
total_volume_of_cylindrical = Watch(getItemAtIndex)  # "Total Volume of Cylindrical Steel (mm^3)"
code_block_8 = CodeBlock { 1; }
getItemAtIndex_2 = List.GetItemAtIndex(list=watch, index=code_block_8)
volume_per_ribs = Watch(getItemAtIndex_2)
class_wood_beam = Python()  # CPython3; unwired: IN[0]
# ---------- class_wood_beam.python (32 lines) ----------
import sys
import clr
clr.AddReference('ProtoGeometry')
from Autodesk.DesignScript.Geometry import *
import math

class RectangularBeam(object):
    def __init__(self, centerline, width, depth):
        self.centerline = centerline
        self.width = width      # beam width (mm)
        self.depth = depth      # beam depth (mm)

    def make_geometry(self):
        # profile at start of the diagonal
        start = self.centerline.StartPoint

        # simple coordinate system at the start point
        cs = CoordinateSystem.ByOrigin(start)

        # rectangular profile (like wood beam section)
        # width = x direction, depth = y direction
        profile = Rectangle.ByWidthLength(cs, self.width, self.depth)

        # sweep profile along the diagonal line/curve
        solid = Solid.BySweep(profile, self.centerline)
        return solid

    def measure_volume(self):
        solid = self.make_geometry()
        return solid.Volume

OUT = RectangularBeam
# ----------------------------------------
cross_brace_density = IntegerSlider(67, range=0..100 step 1)
code_block_9 = CodeBlock(n=cross_brace_density) { n; 0..1..#n; }
ribs_sections = Curve.SplitByParameter(curve=ribs, parameters=code_block_9.out1)
rib_section_points = Curve.EndPoint(curve=ribs_sections)
code_block_10 = CodeBlock(ribsPts=rib_section_points) { ribsPts; i = 0..List.Count(ribsPts)-1; maskEven = i % 2 == 0; }
code_block_11 = CodeBlock { 2; 0; }
A = List.DropEveryNthItem(list=code_block_10.ribsPts@@L2, n=code_block_11.out0, offset=code_block_11.out1)
code_block_12 = CodeBlock(A=A) { List.Count(A) - 1; }
takeItems = List.TakeItems(list=A, amount=code_block_12)
code_block_13 = CodeBlock { 2; 1; }
B = List.DropEveryNthItem(list=code_block_10.ribsPts@@L2, n=code_block_13.out0, offset=code_block_13.out1)
code_block_14 = CodeBlock { 1; }
dropItems = List.DropItems(list=B, amount=code_block_14)
byStartPointEndPoint = Line.ByStartPointEndPoint(startPoint=takeItems@L2, endPoint=dropItems@@L2)
code_block_15 = CodeBlock(B=B) { List.Count(B) - 1; }
takeItems_2 = List.TakeItems(list=B, amount=code_block_15)
code_block_16 = CodeBlock { 1; }
dropItems_2 = List.DropItems(list=A, amount=code_block_16)
byStartPointEndPoint_2 = Line.ByStartPointEndPoint(startPoint=takeItems_2@L2, endPoint=dropItems_2@@L2)
list_create = List.Create(item0=byStartPointEndPoint, item1=byStartPointEndPoint_2)
beam_width = DoubleSlider(56, range=0..100 step 0.1)
beam_depth = DoubleSlider(56, range=0..100 step 0.1)
series_of_instances_of_wood = Python(IN[0]=class_wood_beam, IN[1]=list_create, IN[2]=beam_width, IN[3]=beam_depth)  # "Series of Instances of Wood Beams"; CPython3
# ---------- series_of_instances_of_wood.python (37 lines) ----------
import sys
import clr
clr.AddReference('ProtoGeometry')
from Autodesk.DesignScript.Geometry import *
import math
from collections.abc import Iterable

RectangularBeam = IN[0]
centerlines     = IN[1]   # diagonals (lines/curves)
width           = IN[2]   # mm
depth           = IN[3]   # mm

# --- helper: get every curve from any nested list structure ---
def iter_curves(obj):
    if isinstance(obj, Iterable) and not hasattr(obj, "StartPoint"):
        for sub in obj:
            for c in iter_curves(sub):
                yield c
    else:
        yield obj

curves = list(iter_curves(centerlines))

solids  = []
volumes = []

for cl in curves:
    beam  = RectangularBeam(cl, width, depth)
    solid = beam.make_geometry()
    vol   = beam.measure_volume()
    solids.append(solid)
    volumes.append(vol)

totalVolume = sum(volumes)   # mm³

# [0] = solids, [1] = per-beam volumes, [2] = total volume
OUT = [solids, volumes, totalVolume]
# ----------------------------------------
watch_2 = Watch(series_of_instances_of_wood)
code_block_17 = CodeBlock { 1; 2; }
getItemAtIndex_3 = List.GetItemAtIndex(list=watch_2, index=code_block_17.out0)
volume_per_brace = Watch(getItemAtIndex_3)
getItemAtIndex_4 = List.GetItemAtIndex(list=watch_2, index=code_block_17.out1)
total_volume_of_wood_beams_mm_3 = Watch(getItemAtIndex_4)

# group: Don't touch this ground
code_block_18 = CodeBlock { -5000; -5000; -200; }
byCoordinates = Point.ByCoordinates(x=code_block_18.out0, y=code_block_18.out1, z=code_block_18.out2)
code_block_19 = CodeBlock { 5000; 5000; 0; }
byCoordinates_2 = Point.ByCoordinates(x=code_block_19.out0, y=code_block_19.out1, z=code_block_19.out2)
byCorners = Cuboid.ByCorners(lowPoint=byCoordinates, highPoint=byCoordinates_2)
code_block_20 = CodeBlock { 0; 100; 0; }
byARGB = Color.ByARGB(red=code_block_20.out0, green=code_block_20.out1, blue=code_block_20.out2)
byGeometryColor = Modifiers.GeometryColor.ByGeometryColor(geometry=byCorners, color=byARGB)

code_block_21 = CodeBlock { 0; }
getItemAtIndex_5 = List.GetItemAtIndex(list=series_of_instances_of_steel, index=code_block_21)
code_block_22 = CodeBlock { 255; 0; 0; 0; }
byARGB_2 = Color.ByARGB(alpha=code_block_22.out0, red=code_block_22.out1, green=code_block_22.out2, blue=code_block_22.out3)
byGeometryColor_2 = Modifiers.GeometryColor.ByGeometryColor(geometry=getItemAtIndex_5, color=byARGB_2)
code_block_23 = CodeBlock { 0; }
getItemAtIndex_6 = List.GetItemAtIndex(list=series_of_instances_of_wood, index=code_block_23)
code_block_24 = CodeBlock { 255; 139; 92; 62; }
byARGB_3 = Color.ByARGB(alpha=code_block_24.out0, red=code_block_24.out1, green=code_block_24.out2, blue=code_block_24.out3)
byGeometryColor_3 = Modifiers.GeometryColor.ByGeometryColor(geometry=getItemAtIndex_6, color=byARGB_3)
