# Dynamo graph 1854698.dyn (Dynamo 3.6.0.9395)

code_block = CodeBlock { -5000; -5000; -200; }
byCoordinates = Point.ByCoordinates(x=code_block.out0, y=code_block.out1, z=code_block.out2)
code_block_2 = CodeBlock { 5000; 5000; 0; }
byCoordinates_2 = Point.ByCoordinates(x=code_block_2.out0, y=code_block_2.out1, z=code_block_2.out2)
byCorners = Cuboid.ByCorners(lowPoint=byCoordinates, highPoint=byCoordinates_2)
code_block_3 = CodeBlock { 0; 100; 0; }
byARGB = Color.ByARGB(red=code_block_3.out0, green=code_block_3.out1, blue=code_block_3.out2)
byGeometryColor = Modifiers.GeometryColor.ByGeometryColor(geometry=byCorners, color=byARGB)
code_block_4 = CodeBlock { -4500..4500..#15; }
sin = Math.Sin(angle=code_block_4)
wave_amp = DoubleSlider(1500, range=500..2500 step 100)
mul = sin * wave_amp
byCoordinates_3 = Point.ByCoordinates(x=code_block_4, z=mul)
code_block_5 = CodeBlock { x=0; y=-2500; }
centering = DoubleSlider(-5000, range=-5000..0 step 500)
z_offset = DoubleSlider(1500, range=0..2500 step 5)
translate = Geometry.Translate(geometry=byCoordinates_3, xTranslation=code_block_5.x, yTranslation=centering, zTranslation=z_offset)
byPoints = NurbsCurve.ByPoints(points=translate)
length = DoubleSlider(10000, range=5000..10000 step 500)
rib_count = DoubleSlider(25, range=10..50 step 1)
code_block_6 = CodeBlock(L=length, C=rib_count) { 0..L..#C; }
translate_2 = Geometry.Translate(geometry=byPoints, yTranslation=code_block_6, lacing=Longest)
firstItem = List.FirstItem(list=translate_2)
middle_of_arch = DoubleInput(0.5)
first = Curve.PointAtParameter(curve=firstItem, param=middle_of_arch)
lastItem = List.LastItem(list=translate_2)
last = Curve.PointAtParameter(curve=lastItem, param=middle_of_arch)
byStartPointEndPoint = Line.ByStartPointEndPoint(startPoint=first, endPoint=last)
steel_rod_radius = DoubleSlider(500, range=1..500 step 5)
steel_rod = Python(IN[0]=byStartPointEndPoint, IN[1]=steel_rod_radius)  # CPython3
# ---------- steel_rod.python (34 lines) ----------
import sys
import clr
clr.AddReference('ProtoGeometry')
from Autodesk.DesignScript.Geometry import *
from Autodesk.DesignScript.Geometry import Point 

#Class 2 - Steel Rod
class SteelRod:
    def __init__(self, start_point, end_point, radius):
        self.start = start_point
        self.end = end_point
        self.radius = radius

    def generate_geometry(self):
        line = Line.ByStartPointEndPoint(self.start, self.end)
        
        # Return the geometry components and the radius as a list
        return [self.start, self.end, self.radius] 

    def get_volume(self):
        # Volume calculation remains inside the class to meet requirements
        length = self.start.DistanceTo(self.end)
        return 3.1415926535 * (self.radius ** 2) * length

line_in = IN[0]  
radius = IN[1]   

#Single Instance and extract start and end points for steel rod.
steel_rod = SteelRod(line_in.StartPoint, line_in.EndPoint, radius)

# --- OUTPUT ---
# OUT[0] now contains the geometry components [StartPoint, EndPoint, Radius]
# OUT[1] contains the volume
OUT = steel_rod.generate_geometry(), steel_rod.get_volume()
# ----------------------------------------
code_block_7 = CodeBlock(IN=steel_rod) { pts=IN[0]; }
startpoint_list = DoubleInput(0)
getItemAtIndex = List.GetItemAtIndex(list=code_block_7, index=startpoint_list)
endpoint_list = DoubleInput(1)
getItemAtIndex_2 = List.GetItemAtIndex(list=code_block_7, index=endpoint_list)
radius_list = DoubleInput(2)
getItemAtIndex_3 = List.GetItemAtIndex(list=code_block_7, index=radius_list)
byPointsRadius = Cylinder.ByPointsRadius(startPoint=getItemAtIndex, endPoint=getItemAtIndex_2, radius=getItemAtIndex_3)
watch = Watch(byCoordinates_3)
rib_width = DoubleSlider(30, range=30..150 step 10)
rib_depth = DoubleInput(300)
timber_beam_sin_wave = Python(IN[0]=translate_2, IN[1]=rib_width, IN[2]=rib_depth)  # CPython3
# ---------- timber_beam_sin_wave.python (54 lines) ----------
import sys
import clr
clr.AddReference('ProtoGeometry')
from Autodesk.DesignScript.Geometry import *
from Autodesk.DesignScript.Geometry import Solid, Vector, NurbsCurve, CoordinateSystem, Point, Line

#Class 1 - Timber Rib(wave)
class TimberRib:
    def __init__(self, curve, width, depth):
        self.curve = curve
        self.width = max(width, 1.0) 
        self.depth = max(depth, 1.0)

    def generate_geometry(self):
        w = self.width / 2.0  # half width 
        d = self.depth / 2.0  # half depth 
        
        cs = self.curve.CoordinateSystemAtParameter(0.0) 

        p_local_1 = Point.ByCoordinates(w, 0.0, d)
        p_local_2 = Point.ByCoordinates(w, 0.0, -d)
        p_local_3 = Point.ByCoordinates(-w, 0.0, -d)
        p_local_4 = Point.ByCoordinates(-w, 0.0, d)
        
        p1 = p_local_1.Transform(cs)
        p2 = p_local_2.Transform(cs)
        p3 = p_local_3.Transform(cs)
        p4 = p_local_4.Transform(cs)
        
        #Create the closed profile using NurbsCurve
        profile = NurbsCurve.ByPoints([p1, p2, p3, p4, p1])
        
        #Sweep the closed profile along the curve path
        rib_solid = Solid.BySweep(profile, self.curve)
        
        return rib_solid

    def get_volume(self):
        return self.curve.Length * self.width * self.depth

curves_list = IN[0]  
rib_width = IN[1]    
rib_depth = IN[2]    

geometry_output = []
volume_output = []

for crv in curves_list:
    my_rib = TimberRib(crv, rib_width, rib_depth)
    geometry_output.append(my_rib.generate_geometry())
    volume_output.append(my_rib.get_volume())

# --- OUTPUT ---
OUT = geometry_output, volume_output
# ----------------------------------------
volume_list = CodeBlock(data=timber_beam_sin_wave) { data[1]; }
collect_volume = Math.Sum(values=volume_list)
sin_wave_volume_mm_3 = Watch(collect_volume)
volume_list_2 = CodeBlock(data=steel_rod) { data[1]; }
collect_volume_2 = Math.Sum(values=volume_list_2)
steel_rod_volume_mm_3 = Watch(collect_volume_2)
