# Dynamo graph 1854810.dyn (Dynamo 4.0.0.3277)

# group: Don't touch this ground
code_block = CodeBlock { -5000; -5000; -200; }
byCoordinates = Point.ByCoordinates(x=code_block.out0, y=code_block.out1, z=code_block.out2)
code_block_2 = CodeBlock { 5000; 5000; 0; }
byCoordinates_2 = Point.ByCoordinates(x=code_block_2.out0, y=code_block_2.out1, z=code_block_2.out2)
byCorners = Cuboid.ByCorners(lowPoint=byCoordinates, highPoint=byCoordinates_2)
code_block_3 = CodeBlock { 0; 100; 0; }
byARGB = Color.ByARGB(red=code_block_3.out0, green=code_block_3.out1, blue=code_block_3.out2)
byGeometryColor = Modifiers.GeometryColor.ByGeometryColor(geometry=byCorners, color=byARGB)

# group: Roof Parameters
roofLength = DoubleSlider(3400, range=1500..5000 step 100)
roofWidth = DoubleSlider(3505, range=5..7000 step 50)
numRoofs = DoubleSlider(3, range=3..10 step 1)
originalAngle = DoubleSlider(28, range=0..35 step 1)
roofHeight = DoubleSlider(2700, range=2000..3500 step 100)
roofThickness = DoubleSlider(120, range=50..200 step 10)

# group: Spacing
code_block_4 = CodeBlock(roofLength=roofLength) { roofLength * 0.2; }
code_block_5 = CodeBlock { 0; }
spacing = DoubleSlider(0.8, range=0.4..2 step 0.05)
code_block_6 = CodeBlock(roofLength=roofLength, Spacing=spacing) { roofLength * Spacing; }
sequence = Sequence(start=code_block_5, amount=numRoofs, step=code_block_6)

# group: Point Numbers
x_0 = DoubleInput(0)
y_0 = DoubleInput(0)
z_0 = DoubleInput(0)
x_1 = DoubleInput(1)

# group: Coordinates
n0_0_0 = Point.ByCoordinates(x=x_0, y=y_0, z=z_0)  # "0,0,0"
n1_0_0 = Point.ByCoordinates(x=x_1, y=y_0, z=z_0)  # "1,0,0"

# group: Structure Movement
width_increment = DoubleSlider(-530, range=-1000..-100 step 10)
sequence_2 = Sequence(start=roofWidth, amount=numRoofs, step=width_increment)
roofOffsetX = DoubleSlider(0, range=-5000..5000 step 100)
roofOffestY = DoubleSlider(-2900, range=-5000..5000 step 100)
code_block_7 = CodeBlock(seq=sequence, roofOffset=roofOffestY) { seq + roofOffset; }

# group: Roof Plane
ZAxis = Vector.ZAxis()
byOriginNormal = Plane.ByOriginNormal(origin=n0_0_0, normal=ZAxis)
byWidthLength = Rectangle.ByWidthLength(plane=byOriginNormal, width=sequence_2, length=roofLength)

# group: Angle Variation
angleStep = DoubleSlider(-13.9, range=-20..20 step 0.1)
sequence_3 = Sequence(start=originalAngle, amount=numRoofs, step=angleStep)

# group: Roof Rotation
byTwoPoints = Vector.ByTwoPoints(start=n0_0_0, end=n1_0_0)
rotate = Geometry.Rotate(geometry=byWidthLength, origin=n0_0_0, axis=byTwoPoints, degrees=sequence_3)

# group: Roof Height
byCoordinates_3 = Vector.ByCoordinates(x=roofOffsetX, y=code_block_7, z=roofHeight)
translate = Geometry.Translate(geometry=rotate, direction=byCoordinates_3)

# group: Thinkness
byPatch = Surface.ByPatch(closedCurve=translate)
thicken = Surface.Thicken(surface=byPatch, thickness=roofThickness)

# group: Timber Roofs
class_timberroofs = Python(IN[0]=byPatch, IN[1]=roofThickness)  # PythonNet3
# ---------- class_timberroofs.python (31 lines) ----------
import clr
clr.AddReference('ProtoGeometry')
from Autodesk.DesignScript.Geometry import *

roofs = IN[0]
thk = IN[1]
#creating class
class TimberRoofs:
    def __init__(self, surface, thickness):
        self.surface = surface
        self.thickness = thickness
        self.solid = None
#making the surrface
    def make(self):
        self.solid = self.surface.Thicken(self.thickness)
        return self.solid

    def volume(self):
        if self.solid is None:
            self.make()
        return self.solid.Volume

solids = []
volumes = []

for s in roofs:
    obj = TimberRoofs(s, thk)
    solids.append(obj.make())
    volumes.append(obj.volume())

OUT = solids, volumes
# ----------------------------------------
solids = List.GetItemAtIndex(list=class_timberroofs, index=x_0)
get_volume = List.GetItemAtIndex(list=class_timberroofs, index=x_1)
list_create = List.Create(item0=get_volume)
material_volume_1_mm_2 = Watch(list_create)

# group: Column points
perimeterCurves = Surface.PerimeterCurves(surface=byPatch)
startPoint = Curve.StartPoint(curve=perimeterCurves)
number = DoubleInput(1)
flatten = List.Flatten(list=startPoint, amount=number)
X = Point.X(point=flatten)
Y = Point.Y(point=flatten)
number_2 = DoubleInput(0)
byCoordinates_4 = Point.ByCoordinates(x=X, y=Y, z=number_2)

# group: Steel Columns
columnRadius = DoubleSlider(80, range=50..400 step 10)
class_steel_columns = Python(IN[0]=byCoordinates_4, IN[1]=flatten, IN[2]=columnRadius)  # PythonNet3
# ---------- class_steel_columns.python (34 lines) ----------
import clr
clr.AddReference('ProtoGeometry')
from Autodesk.DesignScript.Geometry import *
#defining variables
pts_bottom = IN[0]   
pts_top    = IN[1]   
r          = IN[2]   
#creating class
class SteelColumn:
    def __init__(self, p_bottom, p_top, radius):
        self.p_bottom = p_bottom
        self.p_top = p_top
        self.radius = radius
        self.solid = None
#making the solids
    def make(self):
        self.solid = Cylinder.ByPointsRadius(self.p_bottom, self.p_top, self.radius)
        return self.solid
#calculating the volume
    def volume(self):
        if self.solid is None:
            self.make()
        return self.solid.Volume

solids = []
volumes = []

#making the information ready for output
for b, t in zip(pts_bottom, pts_top):
    obj = SteelColumn(b, t, r)
    solids.append(obj.make())
    volumes.append(obj.volume())

OUT = solids, volumes
# ----------------------------------------
number_3 = DoubleInput(0)
solids_list = List.GetItemAtIndex(list=class_steel_columns, index=number_3)
volumes_list = List.GetItemAtIndex(list=class_steel_columns, index=x_1)
list_create_2 = List.Create(item0=volumes_list)
material_volume_2_mm_2 = Watch(list_create_2)

n4 = Point.ByCoordinates(z=number_3)  # "4"
