# Dynamo graph 1854866.dyn (Dynamo 3.6.0.9395)

# group: Don't touch this ground
code_block = CodeBlock { -5000; -5000; -200; }
byCoordinates = Point.ByCoordinates(x=code_block.out0, y=code_block.out1, z=code_block.out2)
code_block_2 = CodeBlock { 5000; 5000; 0; }
byCoordinates_2 = Point.ByCoordinates(x=code_block_2.out0, y=code_block_2.out1, z=code_block_2.out2)
byCorners = Cuboid.ByCorners(lowPoint=byCoordinates, highPoint=byCoordinates_2)
code_block_3 = CodeBlock { 0; 100; 0; }
byARGB = Color.ByARGB(red=code_block_3.out0, green=code_block_3.out1, blue=code_block_3.out2)
byGeometryColor = Modifiers.GeometryColor.ByGeometryColor(geometry=byCorners, color=byARGB)

number = DoubleInput(0)
byCoordinates_3 = Point.ByCoordinates(x=number, y=number, z=number)
pavilionRadius = DoubleSlider(5000, range=3000..5000 step 100)
byCenterPointRadius = Circle.ByCenterPointRadius(centerPoint=byCoordinates_3, radius=pavilionRadius)
columnCount = DoubleSlider(9, range=6..24 step 1)
code_block_4 = CodeBlock(n=columnCount) { n; 0..1..#n; }
pointAtParameter = Curve.PointAtParameter(curve=byCenterPointRadius, param=code_block_4.out1)
ZAxis = Vector.ZAxis()
roofOffset = DoubleSlider(1500, range=300..1500 step 100)
scale = Vector.Scale(vector=ZAxis, scale_factor=roofOffset)
columnTopPoints = Geometry.Translate(geometry=pointAtParameter, direction=scale)
number_2 = DoubleInput(0)
roofcentrepoint = Point.ByCoordinates(x=number_2, y=number_2, z=roofOffset)
byStartPointEndPoint = Line.ByStartPointEndPoint(startPoint=columnTopPoints, endPoint=roofcentrepoint)
byPoints = PolyCurve.ByPoints(points=columnTopPoints)
number_3 = DoubleInput(900)
innerRoofCircle = Circle.ByCenterPointRadius(centerPoint=roofcentrepoint, radius=number_3)
pointAtParameter_2 = Curve.PointAtParameter(curve=innerRoofCircle, param=code_block_4.out1)
innerRoofPoly = PolyCurve.ByPoints(points=pointAtParameter_2)
list_create = List.Create(item0=byPoints, item1=innerRoofPoly)
byLoft = Surface.ByLoft(crossSections=list_create)
panelThickness = DoubleSlider(200, range=10..200 step 0.1)
thicken = Surface.Thicken(surface=byLoft, thickness=panelThickness)
railingHeight = DoubleInput(900)
scale_2 = Vector.Scale(vector=ZAxis, scale_factor=railingHeight)
translate = Geometry.Translate(geometry=byCenterPointRadius, direction=scale_2)
byOrigin = CoordinateSystem.ByOrigin(origin=pointAtParameter)
columnRadius = DoubleSlider(75, range=75..200 step 5)
columnHeight = DoubleSlider(2500, range=2500..4500 step 100)
byRadiusHeight = Cylinder.ByRadiusHeight(coordinateSystem=byOrigin, radius=columnRadius, height=columnHeight)
class_series_steelcolumn = Python(colGeoms=byRadiusHeight, colRadius=columnRadius, colHeight=columnHeight)  # CPython3
# ---------- class_series_steelcolumn.python (34 lines) ----------
import clr
clr.AddReference('ProtoGeometry')
from Autodesk.DesignScript.Geometry import *
import math


col_geoms = IN[0]
r = IN[1]
h = IN[2]

class SteelColumn(object):
    def __init__(self, geom, radius, height):
        self.geom = geom          
        self.radius = radius
        self.height = height

    def geometry(self):
        
        return self.geom

    def volume(self):
        
        return math.pi * (self.radius ** 2) * self.height

instances = []
volumes = []

for g in col_geoms:
    col = SteelColumn(g, r, h)
    instances.append(col)
    volumes.append(col.volume())

total_volume = sum(volumes)  
OUT = (instances, volumes, total_volume)
# ----------------------------------------
steelcolumn_instances_list = Watch(class_series_steelcolumn)
number_4 = DoubleInput(2)
getItemAtIndex = List.GetItemAtIndex(list=class_series_steelcolumn, index=number_4)
material_volume_1_steel_columns = Watch(getItemAtIndex)  # "Material Volume 1 – steel columns (mm^3)"
class_instances_roofpanel = Python(roofsurfaces=byLoft, thickness=panelThickness)  # CPython3
# ---------- class_instances_roofpanel.python (33 lines) ----------
import clr
clr.AddReference('ProtoGeometry')
from Autodesk.DesignScript.Geometry import *


class RoofPanel:
    def __init__(self, surface, thickness):
        self.surface = surface      
        self.thickness = thickness  

    def geometry(self):
        
        return self.surface

    def volume(self):
        
        area = self.surface.Area    # mm^2
        return area * self.thickness


surfaces = IN[0]      
thickness = IN[1]     
if not isinstance(surfaces, list):
    surfaces = [surfaces]


panels = [RoofPanel(s, thickness) for s in surfaces]


total_volume = sum(p.volume() for p in panels)


OUT = (panels, total_volume)
# ----------------------------------------
number_5 = DoubleInput(0)
getItemAtIndex_2 = List.GetItemAtIndex(list=class_instances_roofpanel, index=number_5)
class_instances_roofpanel_2 = Watch(getItemAtIndex_2)
number_6 = DoubleInput(1)
getItemAtIndex_3 = List.GetItemAtIndex(list=class_instances_roofpanel, index=number_6)
material_volume_2_roof_panels_mm = Watch(getItemAtIndex_3)  # "Material Volume 2 – roof panels (mm^3)"
