# Dynamo graph 1855125.dyn (Dynamo 3.6.0.9395)

# group: Don't touch this ground
code_block = CodeBlock { -5000; -5000; -200; }
byCoordinates = Point.ByCoordinates(x=code_block.out0, y=code_block.out1, z=code_block.out2)
code_block_2 = CodeBlock { 5000; 5000; 0; }
byCoordinates_2 = Point.ByCoordinates(x=code_block_2.out0, y=code_block_2.out1, z=code_block_2.out2)
byCorners = Cuboid.ByCorners(lowPoint=byCoordinates, highPoint=byCoordinates_2)
code_block_3 = CodeBlock { 0; 100; 0; }
byARGB = Color.ByARGB(red=code_block_3.out0, green=code_block_3.out1, blue=code_block_3.out2)
byGeometryColor = Modifiers.GeometryColor.ByGeometryColor(geometry=byCorners, color=byARGB)

height = IntegerSlider(3400, range=3000..5000 step 1)
code_block_4 = CodeBlock(Heights=height) { -4250; -4250; -100; 0; 0; Heights; -2125; -2125; 0.75*Heights; }
byCoordinates_3 = Point.ByCoordinates(x=code_block_4.out3, y=code_block_4.out4, z=code_block_4.Heights)
byCoordinates_4 = Point.ByCoordinates(x=code_block_4.out6, y=code_block_4.out7, z=code_block_4.out8)
byCoordinates_5 = Point.ByCoordinates(x=code_block_4.out0, y=code_block_4.out1, z=code_block_4.out2)
byThreePoints = Arc.ByThreePoints(firstPoint=byCoordinates_3, secondPoint=byCoordinates_4, thirdPoint=byCoordinates_5)
number = DoubleInput(0)
amount = IntegerSlider(28, range=20..40 step 1)
step = DoubleSlider(0.037, range=0..0.1 step 0.001)
sequence = Sequence(start=number, amount=amount, step=step)
pointAtParameter = Curve.PointAtParameter(curve=byThreePoints, param=sequence)
code_block_5 = CodeBlock(Heights=height) { 0; 0; Heights; -2125; 2125; 0.75*Heights; -4250; 4250; -100; }
byCoordinates_6 = Point.ByCoordinates(x=code_block_5.out6, y=code_block_5.out7, z=code_block_5.out8)
byCoordinates_7 = Point.ByCoordinates(x=code_block_5.out3, y=code_block_5.out4, z=code_block_5.out5)
byCoordinates_8 = Point.ByCoordinates(x=code_block_5.out0, y=code_block_5.out1, z=code_block_5.Heights)
byThreePoints_2 = Arc.ByThreePoints(firstPoint=byCoordinates_6, secondPoint=byCoordinates_7, thirdPoint=byCoordinates_8)
pointAtParameter_2 = Curve.PointAtParameter(curve=byThreePoints_2, param=sequence)
code_block_6 = CodeBlock(Heights=height) { 0; 0; Heights; 2125; -2125; 0.75*Heights; 4250; -4250; -100; }
byCoordinates_9 = Point.ByCoordinates(x=code_block_6.out0, y=code_block_6.out1, z=code_block_6.Heights)
byCoordinates_10 = Point.ByCoordinates(x=code_block_6.out3, y=code_block_6.out4, z=code_block_6.out5)
byCoordinates_11 = Point.ByCoordinates(x=code_block_6.out6, y=code_block_6.out7, z=code_block_6.out8)
byThreePoints_3 = Arc.ByThreePoints(firstPoint=byCoordinates_9, secondPoint=byCoordinates_10, thirdPoint=byCoordinates_11)
pointAtParameter_3 = Curve.PointAtParameter(curve=byThreePoints_3, param=sequence)
code_block_7 = CodeBlock(Heights=height) { 0; 0; Heights; 2125; 2125; 0.75*Heights; 4250; 4250; -100; }
byCoordinates_12 = Point.ByCoordinates(x=code_block_7.out6, y=code_block_7.out7, z=code_block_7.out8)
byCoordinates_13 = Point.ByCoordinates(x=code_block_7.out3, y=code_block_7.out4, z=code_block_7.out5)
byCoordinates_14 = Point.ByCoordinates(x=code_block_7.out0, y=code_block_7.out1, z=code_block_7.Heights)
byThreePoints_4 = Arc.ByThreePoints(firstPoint=byCoordinates_12, secondPoint=byCoordinates_13, thirdPoint=byCoordinates_14)
pointAtParameter_4 = Curve.PointAtParameter(curve=byThreePoints_4, param=sequence)
thickness = DoubleSlider(21.6, range=0..100 step 0.1)
number_2 = DoubleInput(0)
sequence_2 = Sequence(start=thickness, step=number_2)
class_rope = Python()  # CPython3; unwired: IN[0]
# ---------- class_rope.python (18 lines) ----------
import clr
clr.AddReference('ProtoGeometry')
from Autodesk.DesignScript.Geometry import *

class CircularRod:
    def __init__(self, bottom_point, top_point, radius):
        self.bottom = bottom_point
        self.top = top_point
        self.radius = radius       
 
    def make_geometry(self):
        return Cylinder.ByPointsRadius(self.bottom, self.top, self.radius)
        
    def volume(self):
        cyl = self.make_geometry()
        return cyl.Volume

OUT = CircularRod
# ----------------------------------------
series_of_instances_of_ropes_x = Python(IN[0]=pointAtParameter, IN[1]=pointAtParameter_2, IN[2]=pointAtParameter_3, IN[3]=pointAtParameter_4, IN[4]=sequence_2, IN[5]=class_rope)  # CPython3
# ---------- series_of_instances_of_ropes_x.python (42 lines) ----------
# IN[0] = list of start points (-x)
# IN[1] = list of end points (-x)
# IN[4] = list of start points (+x) 
# IN[5] = list of end points (+x) 
# IN[2] = list of radii 
# IN[3] = class CircularRod from Box #1 


CircularRod = IN[5]
neg_start_points = IN[0]
neg_end_points = IN[1]
radii = IN[4]
pos_start_points = IN[2]
pos_end_points = IN[3]

rods = []
volumes = []

ncount = min(len(neg_start_points), len(neg_end_points))
pcount = min(len(pos_start_points), len(pos_end_points))

for i in range(ncount):
  
    r = radii[i] if i < len(radii) else radii[-1]
    nstart = neg_start_points[i]
    nend = neg_end_points[i]
    
    rod = CircularRod(nstart, nend, r)
    rods.append(rod.make_geometry())
    volumes.append(rod.volume())

for i in range(pcount):
  
    r = radii[i] if i < len(radii) else radii[-1]
    pstart = pos_start_points[i]
    pend = pos_end_points[i]
    
    rod = CircularRod(pstart, pend, r)
    rods.append(rod.make_geometry())
    volumes.append(rod.volume())

OUT = rods, sum(volumes)
# ----------------------------------------
byThreePoints_5 = Arc.ByThreePoints(firstPoint=byCoordinates_5, secondPoint=byCoordinates_4, thirdPoint=byCoordinates_3)
pointAtParameter_5 = Curve.PointAtParameter(curve=byThreePoints_5, param=sequence)
byThreePoints_6 = Arc.ByThreePoints(firstPoint=byCoordinates_14, secondPoint=byCoordinates_13, thirdPoint=byCoordinates_12)
pointAtParameter_6 = Curve.PointAtParameter(curve=byThreePoints_6, param=sequence)
series_of_instances_of_ropes_y = Python(IN[0]=pointAtParameter_3, IN[1]=pointAtParameter_5, IN[2]=pointAtParameter_2, IN[3]=pointAtParameter_6, IN[4]=sequence_2, IN[5]=class_rope)  # CPython3; same code as series_of_instances_of_ropes_x
list_create = List.Create(item0=series_of_instances_of_ropes_x, item1=series_of_instances_of_ropes_y)
color_palette = ColorPalette({R: 195, G: 149, B: 110, A: 255})
byGeometryColor_2 = Modifiers.GeometryColor.ByGeometryColor(geometry=list_create, color=color_palette)
code_block_8 = CodeBlock { 1; }
getItemAtIndex = List.GetItemAtIndex(list=series_of_instances_of_ropes_x, index=code_block_8)
volume_of_rope_mm_3 = Watch(getItemAtIndex)
code_block_9 = CodeBlock { 1; }
getItemAtIndex_2 = List.GetItemAtIndex(list=series_of_instances_of_ropes_y, index=code_block_9)
volume_of_rope_mm_3_2 = Watch(getItemAtIndex_2)
list_create_2 = List.Create(item0=volume_of_rope_mm_3, item1=volume_of_rope_mm_3_2)
sum = Math.Sum(values=list_create_2)
total_volume_of_ropes_mm_3 = Watch(sum)
code_block_10 = CodeBlock(Heights=height) { 0; 0; Heights; }
byCoordinates_15 = Point.ByCoordinates(x=code_block_10.out0, y=code_block_10.out1, z=code_block_10.Heights)
top_points = List.Create(item0=byCoordinates_15, item1=byCoordinates_15, item2=byCoordinates_15, item3=byCoordinates_15)
middle_points = List.Create(item0=byCoordinates_4, item1=byCoordinates_7, item2=byCoordinates_13, item3=byCoordinates_10)
bottom_points = List.Create(item0=byCoordinates_5, item1=byCoordinates_6, item2=byCoordinates_12, item3=byCoordinates_11)
rod_thickness = IntegerSlider(90, range=0..100 step 1)
class_steel_rods = Python()  # CPython3; unwired: IN[0]
# ---------- class_steel_rods.python (44 lines) ----------
import clr
clr.AddReference("ProtoGeometry")
from Autodesk.DesignScript.Geometry import *

class SteelRods:
    def __init__(self, p1, p2, p3, radius):
        self.p1 = p1
        self.p2 = p2
        self.p3 = p3
        self.radius = radius

        self.curve = self.make_curve()
        self.full_solid = self.make_full_solid()
        self.trimmed_solid = self.trim_at_ground()
        self.volume = self.trimmed_solid.Volume   

    def make_curve(self):
        return Arc.ByThreePoints(self.p1, self.p2, self.p3)

    def make_full_solid(self):
        param = self.curve.ParameterAtPoint(self.p1)
        t = self.curve.TangentAtParameter(param).Normalized()

        plane = Plane.ByOriginNormal(self.p1, t)
        circle = Circle.ByPlaneRadius(plane, self.radius)
        return circle.SweepAsSolid(self.curve)

    def trim_at_ground(self):
        ground = Plane.ByOriginNormal(Point.ByCoordinates(0,0,0), Vector.ZAxis())

        pieces = self.full_solid.Split(ground)
        
        selected = self.full_solid
        for p in pieces:
            try:
                if p.Centroid().Z > 0:
                    selected = p
            except:
                pass

        return selected


OUT = SteelRods
# ----------------------------------------
instances_of_steel_rods = Python(IN[0]=top_points, IN[1]=middle_points, IN[2]=bottom_points, IN[3]=rod_thickness, IN[4]=class_steel_rods)  # CPython3
# ---------- instances_of_steel_rods.python (27 lines) ----------
import clr
clr.AddReference('ProtoGeometry')
from Autodesk.DesignScript.Geometry import *

# Bottom points of Rods
# Middle points of Rods
# Top points of Rods
# Radius of Rods

btm = IN[0]
mid = IN[1]
top = IN[2]
radii = IN[3]
SteelRods = IN[4]

if not isinstance(radii, list):
    radii = [radii] * len(btm)

instances = []
volumes = []

for a,b,c,r in zip(btm, mid, top, radii):
    rod = SteelRods(a,b,c,r)
    instances.append(rod.trimmed_solid)
    volumes.append(rod.volume)

OUT = instances, sum(volumes)
# ----------------------------------------
code_block_11 = CodeBlock { 1; }
getItemAtIndex_3 = List.GetItemAtIndex(list=instances_of_steel_rods, index=code_block_11)
volume_of_rods_mm_3 = Watch(getItemAtIndex_3)
