# Dynamo graph 1855126.dyn "Pavilion Project - Jacques Henning (1855126)" (Dynamo 3.6.0.9395)

# group: Don't touch this ground
code_block = CodeBlock { -5000; -5000; -200; }
byCoordinates = Point.ByCoordinates(x=code_block.out0, y=code_block.out1, z=code_block.out2)
code_block_2 = CodeBlock { 5000; 5000; 0; }
byCoordinates_2 = Point.ByCoordinates(x=code_block_2.out0, y=code_block_2.out1, z=code_block_2.out2)
byCorners = Cuboid.ByCorners(lowPoint=byCoordinates, highPoint=byCoordinates_2)
code_block_3 = CodeBlock { 0; 100; 0; }
byARGB = Color.ByARGB(red=code_block_3.out0, green=code_block_3.out1, blue=code_block_3.out2)
byGeometryColor = Modifiers.GeometryColor.ByGeometryColor(geometry=byCorners, color=byARGB)

columns_x_direction = IntegerSlider(2, range=2..6 step 1)
columns_y_direction = IntegerSlider(5, range=2..6 step 1)
column_height = DoubleSlider(3000, range=1000..5000 step 100)
roof_thickness = DoubleSlider(100, range=100..500 step 50)
column_radius = DoubleSlider(100, range=10..200 step 10)
python_script = Python(IN[0]=columns_x_direction, IN[1]=columns_y_direction, IN[2]=column_height, IN[3]=roof_thickness, IN[4]=column_radius)  # CPython3
# ---------- python_script.python (90 lines) ----------
import sys
import clr
import math

clr.AddReference("ProtoGeometry")
from Autodesk.DesignScript.Geometry import *

# CLASS: Column

class Column:
    def __init__(self, pos_x, pos_y, rad, height):
        self.pos_x = pos_x
        self.pos_y = pos_y
        self.rad = rad
        self.height = height

    def geometry(self):
        base_pt = Point.ByCoordinates(self.pos_x, self.pos_y, 0)
        top_pt = Point.ByCoordinates(self.pos_x, self.pos_y, self.height)
        return Cylinder.ByPointsRadius(base_pt, top_pt, self.rad)

    def volume(self):
        return math.pi * (self.rad ** 2) * self.height

# CLASS: Roof

class Roof:
    def __init__(self, width, depth, elev, thick):
        self.width = width
        self.depth = depth
        self.elev = elev
        self.thick = thick

    def geometry(self):
        origin = Point.ByCoordinates(0, 0, self.elev)
        return Cuboid.ByLengths(origin, self.width, self.depth, self.thick)

    def volume(self):
        return self.width * self.depth * self.thick

# INPUTS

num_cols_x   = IN[0]
num_cols_y   = IN[1]
col_height   = IN[2]
roof_thick   = IN[3]
col_radius   = IN[4]

# PARAMETERS

site_w = 8000
site_d = 8000
col_geometries = []
col_volumes = []

# COLUMN GRID 

step_x = site_w / (num_cols_x - 1)
step_y = site_d / (num_cols_y - 1)

x_val = -site_w / 2

for _ in range(num_cols_x):
    y_val = -site_d / 2

    for _ in range(num_cols_y):
        column = Column(x_val, y_val, col_radius, col_height)
        col_geometries.append(column.geometry())
        col_volumes.append(column.volume())
        y_val += step_y

    x_val += step_x

# ROOF CREATION

roof_elev = col_height + roof_thick * 0.5
roof = Roof(site_w + 500, site_d + 500, roof_elev, roof_thick)

roof_geo = roof.geometry()
roof_vol = roof.volume()



# OUTPUT

OUT = [
    col_geometries + [roof_geo],   
    sum(col_volumes),              
    roof_vol                       
]
# ----------------------------------------
code_block_4 = CodeBlock(data=python_script) { Base_points = data[0]; Volume_of_steel = data[1]; Volume_of_timber = data[2]; }
watch = Watch(code_block_4.Volume_of_steel)
watch_2 = Watch(code_block_4.Volume_of_timber)
