# Dynamo graph 1855156.dyn "Pavilion" (Dynamo 4.0.0.3277)

code_block = CodeBlock { -5000; -5000; -200; }
byCoordinates = Point.ByCoordinates(x=code_block.out0, y=code_block.out1, z=code_block.out2)
code_block_2 = CodeBlock { 5000; 5000; 0; }
byCoordinates_2 = Point.ByCoordinates(x=code_block_2.out0, y=code_block_2.out1, z=code_block_2.out2)
byCorners = Cuboid.ByCorners(lowPoint=byCoordinates, highPoint=byCoordinates_2)
code_block_3 = CodeBlock { 0; 100; 0; }
byARGB = Color.ByARGB(red=code_block_3.out0, green=code_block_3.out1, blue=code_block_3.out2)
byGeometryColor = Modifiers.GeometryColor.ByGeometryColor(geometry=byCorners, color=byARGB)
concrete_bench_class = Python()  # PythonNet3; unwired: IN[0]
# ---------- concrete_bench_class.python (75 lines) ----------
# Load the Python Standard and DesignScript Libraries
import sys
import clr
clr.AddReference('ProtoGeometry')
from Autodesk.DesignScript.Geometry import *
import math

class concrete_bench:
    def __init__(self, base_point, length,width):
        self.base_point = base_point
        self.length = length
        self.width = width
        
    def create_cuboid(self,i):
        cuboid = Cuboid.ByLengths(self.base_point[i],self.width,self.length, 450)
        cuboid = Geometry.Translate(cuboid,0,0,225)
        
        return cuboid
        
    def add_features(self,i):
        base_point = self.base_point[i]
        length = self.length
        width = self.width
       
        
        cyl_bot_pt1 = Geometry.Translate(base_point,0,length/2,0)
        
        cyl_bot_pt2 = Geometry.Translate(base_point,0,-length/2,0)
        
        cyl_top_pt1 = Geometry.Translate(base_point,0,length/2,370)
        
        cyl_top_pt2 =Geometry.Translate(base_point,0,-length/2,370)
        
        neg_cube1_pt = Geometry.Translate(base_point,width*5/12,0,450*3/8)
        
        neg_cube2_pt = Geometry.Translate(base_point,-width*5/12,0,450*3/8)
        
        
        
        cylinder1 = Cylinder.ByPointsRadius(cyl_bot_pt1,cyl_top_pt1,width/4)
        cylinder2 = Cylinder.ByPointsRadius(cyl_bot_pt2,cyl_top_pt2,width/4)
        neg_cuboid1 = Cuboid.ByLengths(neg_cube1_pt,1/6*width, length*0.8, 340)
        neg_cuboid2 = Cuboid.ByLengths(neg_cube2_pt,1/6*width, length*0.8, 340)
        cuboid = self.create_cuboid(i)
        
        
        bench = Solid.Difference(cuboid,cylinder1)
        bench = Solid.Difference(bench,cylinder2)
        bench = Solid.Difference(bench,neg_cuboid1)
        bench = Solid.Difference(bench,neg_cuboid2)
        return bench
        
    def rotate(self,i):
        
        base_point = self.base_point[i]
        rot_axis = Vector.ByCoordinates(0,0,1)
        base_pt_vector =Vector.ByCoordinates(base_point.X,base_point.Y,base_point.Z)
        x_axis = Vector.ByCoordinates(1,0,0)
        
        bench = self.add_features(i)
       
        degrees=Vector.AngleAboutAxis(x_axis,base_pt_vector,rot_axis)
        
        bench = Geometry.Rotate(bench,base_point,rot_axis,degrees)
        
        return bench
        
    def calc_volume(self,i):
        bench = self.add_features(i)
        bench_volume = bench.Volume
        return bench_volume
        
        
OUT = concrete_bench
        
# ----------------------------------------
origin = Point.Origin()
bench_circle_radius = IntegerSlider(1806, range=1000..3500 step 1)
byCenterPointRadius = Circle.ByCenterPointRadius(centerPoint=origin, radius=bench_circle_radius)
number_of_benches = IntegerSlider(6, range=1..10 step 1)
code_block_4 = CodeBlock(n=number_of_benches) { 0..(1-1/(n))..0.999/(n); }
pointAtParameter = Curve.PointAtParameter(curve=byCenterPointRadius, param=code_block_4)
length = IntegerSlider(1001, range=0..1500 step 1)
width = IntegerSlider(517, range=0..1500 step 1)
series_of_concrete_benches = Python(IN[0]=concrete_bench_class, IN[1]=pointAtParameter, IN[2]=length, IN[3]=width)  # PythonNet3
# ---------- series_of_concrete_benches.python (29 lines) ----------
# Load the Python Standard and DesignScript Libraries
import sys
import clr
clr.AddReference('ProtoGeometry')
from Autodesk.DesignScript.Geometry import *


concrete_bench = IN[0]
base_points = IN[1]
length = IN[2]
width = IN[3]

bench_object = concrete_bench(base_points,length,width)

n = len(base_points)

benches = []
concrete_volume = 0


for i in range(n):
    bench = bench_object.rotate(i)
    benches.append(bench)
    volume = bench_object.calc_volume(i)
    concrete_volume = concrete_volume + volume

volume_str = str(round(concrete_volume,1))+" mm^3"

OUT = benches,volume_str
# ----------------------------------------
code_block_5 = CodeBlock { 0; 1; }
getItemAtIndex = List.GetItemAtIndex(list=series_of_concrete_benches, index=code_block_5.out0)
concrete_bench_colour = ColorPalette({R: 193, G: 192, B: 192, A: 255})
byGeometryColor_2 = Modifiers.GeometryColor.ByGeometryColor(geometry=getItemAtIndex, color=concrete_bench_colour)
steel_leaf_class = Python()  # PythonNet3; unwired: IN[0]
# ---------- steel_leaf_class.python (222 lines) ----------
# Load the Python Standard and DesignScript Libraries
import sys
import clr
clr.AddReference('ProtoGeometry')
from Autodesk.DesignScript.Geometry import *
import math

class steel_leaf:
    def __init__(self, dist_from_z,arc_radius, arc_length, rotation):
        self.dist_from_z = dist_from_z
        self.arc_radius = arc_radius
        self.arc_length = arc_length
        self.rotation = rotation
      
    def centerline_pts(self,i):
   
        arc_angle = self.arc_length[i]/self.arc_radius[i]
        
        end_point_phi = 1.4-arc_angle
       
        start_point_x = round(self.dist_from_z[i])
        change_in_x = round(self.arc_radius[i] * (math.sin(1.4)-math.sin(end_point_phi)))
        
        end_point_x = start_point_x + change_in_x
        
        x_pts = list(range(start_point_x, end_point_x,40))
        
        x_pts.append(end_point_x)
        
        y_pts = []
        
        z_pts = []
        
        implemented_pts=[]
        for k in x_pts:
            distx_arc_centre = self.arc_radius[i]*math.sin(1.4) - k + start_point_x #Horizontal distance of x point to centre of arc
            phi_of_pt = math.asin(distx_arc_centre/ self.arc_radius[i])
            distz_arc_centre = self.arc_radius[i] * math.cos(phi_of_pt) #Vertical distance of point to centre of arc
            z = distz_arc_centre - math.cos(1.4)*self.arc_radius[i]
            z_pts.append(z)
            y_pts.append(0)
            
        for m in range(len(x_pts)):
            implemented_pt = Point.ByCoordinates(x_pts[m],y_pts[m],z_pts[m])
            implemented_pts.append(implemented_pt)
   
        return implemented_pts
     
    def edgeline_pts(self,i):
         
        arc2_radius = self.arc_radius[i] * (self.arc_length[i]/self.arc_radius[i])**0.09/ 0.96
         
        distz_start_arc2_cntr = (arc2_radius - self.arc_radius[i]) + math.cos(1.4)*self.arc_radius[i]
       
        start_point2_phi = math.acos(distz_start_arc2_cntr / arc2_radius)
        
        start_point2_x = round(self.dist_from_z[i] - (arc2_radius*math.sin(start_point2_phi)-self.arc_radius[i] * math.sin(1.4)))
        
        arc1_angle = self.arc_length[i]/self.arc_radius[i]
        
        end_point1_phi = 1.4-arc1_angle
        
        end_point1_x = round(self.dist_from_z[i])+round(self.arc_radius[i] * (math.sin(1.4)-math.sin(end_point1_phi)))
        
        end_point1_z = self.arc_radius[i]*(math.cos(end_point1_phi) -math.cos(1.4))
        
        end_point2_x = round( self.dist_from_z[i] + self.arc_radius[i] * (math.sin(1.4) - math.sin(end_point1_phi)))
        
        end_point2_phi = math.asin(  self.arc_radius[i]*math.sin(end_point1_phi) /arc2_radius)
   
        x_pts_s = list(range(start_point2_x,start_point2_x + 10, 1 ))
        x_pts_e = list(range(start_point2_x + 10,end_point2_x,30))
        x_pts = x_pts_s + x_pts_e
        
        phi_pts = []
        
        y_pts = []
        
        z_pts = []
        
        implemented_pts=[]
        
        for k in x_pts:
            
            distx_arc2_centre = arc2_radius * math.sin(start_point2_phi) - k + start_point2_x
            phi_of_pt = math.asin(distx_arc2_centre/arc2_radius)
            phi_pts.append(phi_of_pt)
         
        for l in phi_pts:
            distz_arc2_centre = arc2_radius * math.cos(l)
            z = distz_arc2_centre - math.cos(start_point2_phi)*arc2_radius
            
            z_pts.append(z)
     
        for f in range(len(z_pts)):
            diffz = z_pts[-1] - end_point1_z
            diffx = end_point1_x - x_pts[-1]
  
            z_pts[f] = z_pts[f] - diffz
            
            x_pts[f] = x_pts[f] + diffx
     
        while z_pts[0] < 0:
            x_pts.pop(0)
            phi_pts.pop(0)
            z_pts.pop(0)
        
        arc2_angle = phi_pts[0] - phi_pts[-1]
        
        arc2_length = arc2_radius * arc2_angle 
        
        arc_leng_specimen = 37*10 # Arc length of the actual test leaf measured in mm
        
        scl_fact = arc2_length / arc_leng_specimen # How much the specimen is caled by to create instance
        
        scl_fact_rcp = 1 / scl_fact # Reciprical of the scale ratio
  
        for j in phi_pts:
            y = 10*scl_fact * (0.202 * (arc2_radius/10 * scl_fact_rcp * (j-end_point2_phi)) - 0.0112 * (arc2_radius/10 * scl_fact_rcp * (j- end_point2_phi))**2 + 0.000162 * (arc2_radius/10 * scl_fact_rcp * (j-end_point2_phi))**3)
            y_pts.append(y)
        
        for e in range(len(y_pts)):
            
            diffy= y_pts[-1]
            
            y_pts[e] = y_pts[e] - diffy
        
        for m in range(len(x_pts)):
            implemented_pt = Point.ByCoordinates(x_pts[m],y_pts[m],z_pts[m])
            implemented_pts.append(implemented_pt)
    
        return implemented_pts
    
    def create_lines(self,i):
        centerline = NurbsCurve.ByPoints(self.centerline_pts(i))
        edgeline = NurbsCurve.ByPoints(self.edgeline_pts(i))
        lines = [centerline,edgeline]
        return lines
    def create_cross_sections(self,i):
     
        centerline_pts = self.centerline_pts(i)
        edgeline_pts = self.edgeline_pts(i)
    
        base_section = Arc.ByStartPointEndPointStartTangent(centerline_pts[0],edgeline_pts[0], Vector.ByCoordinates(0,1,0))
        
        mid_index_center = round(len(centerline_pts)/2)
     
        mid_index_edge = round(len(edgeline_pts)/1.9)
        
        three_quart_index_center = round(len(centerline_pts)*0.75)
        three_quart_index_edge = round(len(edgeline_pts)*0.765)
        
        straight_section1 = Line.ByStartPointEndPoint(centerline_pts[mid_index_center],edgeline_pts[mid_index_edge])
        
        straight_section2 = Line.ByStartPointEndPoint(centerline_pts[three_quart_index_center],edgeline_pts[three_quart_index_edge])
        
        end_point_line = Line.ByStartPointEndPoint(centerline_pts[-2],edgeline_pts[-2])
        
        cross_sections = [end_point_line,straight_section2,straight_section1,base_section]
      
        return cross_sections
      
    def create_surface(self,i):
        guide_curves = self.create_lines(i)
        cross_sections = self.create_cross_sections(i)
        surface = Surface.ByLoft(cross_sections,guide_curves)
        surface =Surface.ApproximateWithTolerance(surface,100)
        return surface
   
    def mirror_surface(self,i):
        
        surface = self.create_surface(i)
       
        plane_vector = Vector.ByCoordinates(0,1,0)
        
        origin = Point.ByCoordinates(0,0,0)
        
        mirror_plane = Plane.ByOriginNormal( origin , plane_vector)
        
        mrrd_surface = Geometry.Mirror(surface,mirror_plane)
        
        return surface,mrrd_surface
    
    def rotated_surface(self,i):
        surfaces = self.mirror_surface(i)
        origin = Point.ByCoordinates(0,0,0)
        z_axis = Vector.ByCoordinates(0,0,1)
        degrees= self.rotation[i]
        rotated_surfaces =[]
        
        rotated_surface_0 = Geometry.Rotate(surfaces[0],origin,z_axis,degrees)
        rotated_surfaces.append(rotated_surface_0)
        rotated_surface_1 = Geometry.Rotate(surfaces[1],origin,z_axis,degrees)
        rotated_surfaces.append(rotated_surface_1)
       
        return rotated_surfaces
    
    def solidify(self,i):     
        
        surfaces = self.rotated_surface(i)
        solids = []
        
        solid0 = Surface.Thicken(surfaces[0],20, False)
        solid1 = Surface.Thicken(surfaces[1],-20, False)
        solids.append(solid0)
        solids.append(solid1)
        
        return solids
      
    def unified_leaf(self,i):
   
        solids = self.solidify(i)
  
        whole_leaf = Solid.ByUnion(solids)
        
        return whole_leaf
    def calc_volume(self,i):
        leaf = self.unified_leaf(i)
        leaf_volume = leaf.Volume
        return leaf_volume
    
OUT = steel_leaf
# ----------------------------------------
leaf_distance_step_parameter = IntegerSlider(370, range=0..1000 step 10)
distance_from_z_axis_of_largest = IntegerSlider(127, range=20..400 step 1)  # "Distance From Z-Axis of Largest Leaf"
number_of_steel_leaves = IntegerSlider(5, range=1..5 step 1)
distances_of_leaves_from_center = Python(IN[0]=leaf_distance_step_parameter, IN[1]=distance_from_z_axis_of_largest, IN[2]=number_of_steel_leaves)  # PythonNet3
# ---------- distances_of_leaves_from_center.python (16 lines) ----------
# Load the Python Standard and DesignScript Libraries
import sys
import clr
clr.AddReference('ProtoGeometry')
from Autodesk.DesignScript.Geometry import *

step = IN[0]
dist = IN[1]
n = IN[2]

distances = list(range((n-1)*step**3 + dist**3,dist**3 - step**3 , -step**3))

for i in range(len(distances)):
    distances[i] = distances[i]**(1/3)
    
OUT = distances
# ----------------------------------------
start_leaf_radius = IntegerSlider(5000, range=4500..5200 step 25)
leaf_radius_step = IntegerSlider(290, range=250..330 step 10)
radii_of_leaves = Sequence(start=start_leaf_radius, amount=number_of_steel_leaves, step=leaf_radius_step)
start_leaf_arc_length = IntegerSlider(5000, range=4500..5000 step 25)
leaf_arc_length_step = IntegerSlider(430, range=200..450 step 10)
arc_lengths_of_leaves = Sequence(start=start_leaf_arc_length, amount=number_of_steel_leaves, step=leaf_arc_length_step)
first_leaf_rotation_degrees = IntegerSlider(92, range=0..500 step 1)
rotation_step_degrees = IntegerSlider(140, range=0..270 step 5)
roations_of_leaves = Sequence(start=first_leaf_rotation_degrees, amount=number_of_steel_leaves, step=rotation_step_degrees)
series_of_steel_leaves = Python(IN[0]=steel_leaf_class, IN[1]=distances_of_leaves_from_center, IN[2]=radii_of_leaves, IN[3]=arc_lengths_of_leaves, IN[4]=roations_of_leaves)  # PythonNet3
# ---------- series_of_steel_leaves.python (40 lines) ----------
# Load the Python Standard and DesignScript Libraries
import sys
import clr
clr.AddReference('ProtoGeometry')
from Autodesk.DesignScript.Geometry import *

steel_leaf = IN[0]
dist_from_z = IN[1] 
arc_radius = IN[2] 
arc_length =IN[3] 
rotation= IN[4]

leaves = []
steel_volume = 0

leaf_object = steel_leaf(dist_from_z , arc_radius, arc_length, rotation)


num = min(len(dist_from_z),len(arc_radius),len(arc_length),len(rotation))

for i in range(num):

   arc_angle = arc_length[i] / arc_radius [i]
   
   
   if arc_angle > 1.35:
        leaf_object.arc_length[i] = arc_radius[i] * 1.35
   
   
   finlzd_leaf= leaf_object.unified_leaf(i)
   
   volume = leaf_object.calc_volume(i)
   
   leaves.append(finlzd_leaf)
   
   steel_volume = steel_volume + volume

volume_str = str(round(steel_volume,1)) + " mm^3"

OUT = leaves,volume_str
# ----------------------------------------
code_block_6 = CodeBlock { 0; 1; }
getItemAtIndex_2 = List.GetItemAtIndex(list=series_of_steel_leaves, index=code_block_6.out0)
steel_leaf_colour = ColorPalette({R: 156, G: 145, B: 136, A: 255})
byGeometryColor_3 = Modifiers.GeometryColor.ByGeometryColor(geometry=getItemAtIndex_2, color=steel_leaf_colour)
getItemAtIndex_3 = List.GetItemAtIndex(list=series_of_steel_leaves, index=code_block_6.out1)
steel_volume = Watch(getItemAtIndex_3)
getItemAtIndex_4 = List.GetItemAtIndex(list=series_of_concrete_benches, index=code_block_5.out1)
concrete_volume = Watch(getItemAtIndex_4)
