# Dynamo graph 1855166.dyn (Dynamo 4.0.0.3277)

# group: Group
code_block = CodeBlock { -5000; -5000; -200; }
byCoordinates = Point.ByCoordinates(x=code_block.out0, y=code_block.out1, z=code_block.out2)
code_block_2 = CodeBlock { 5000; 5000; 0; }
byCoordinates_2 = Point.ByCoordinates(x=code_block_2.out0, y=code_block_2.out1, z=code_block_2.out2)
byCorners = Cuboid.ByCorners(lowPoint=byCoordinates, highPoint=byCoordinates_2)
code_block_3 = CodeBlock { 0; 100; 0; }
byARGB = Color.ByARGB(red=code_block_3.out0, green=code_block_3.out1, blue=code_block_3.out2)
byGeometryColor = Modifiers.GeometryColor.ByGeometryColor(geometry=byCorners, color=byARGB)

byCorners_2 = Cuboid.ByCorners()
byLengths = Cuboid.ByLengths()
length = Cuboid.Length(cuboid=byLengths)
steel_rod_class = Python()  # PythonNet3; unwired: IN[0]
# ---------- steel_rod_class.python (19 lines) ----------
# Load the Python Standard and DesignScript Libraries
import sys
import clr
clr.AddReference('ProtoGeometry')
from Autodesk.DesignScript.Geometry import *

# The inputs to this node will be stored as a list in the IN variables.
dataEnteringNode = IN

# Place your code below this line
class SteelBar:
    def __init__ (self, bottom_point, top_point, radius):
        self.bottom = bottom_point
        self.top = top_point
        self.radius = radius
        
    def make_geometry(self):
        return Cylinder.ByPointsRadius(self.bottom, self.top, self.radius)
OUT = SteelBar
# ----------------------------------------
code_block_4 = CodeBlock { 4500; 4500; 0; }
byCoordinates_3 = Point.ByCoordinates(x=code_block_4.out0, y=code_block_4.out1, z=code_block_4.out2)
height_of_beams_taller_beams = DoubleSlider(3000, range=3000..4000 step 5)
byCoordinates_4 = Point.ByCoordinates(x=code_block_4.out0, y=code_block_4.out1, z=height_of_beams_taller_beams)
radius_of_bars = DoubleSlider(149.5, range=100..200 step 0.5)
steel_bar_instance_last_tall = Python(IN[0]=steel_rod_class, IN[1]=byCoordinates_3, IN[2]=byCoordinates_4, IN[3]=radius_of_bars)  # "Steel Bar (Instance) (last tall side)"; PythonNet3
# ---------- steel_bar_instance_last_tall.python (3 lines) ----------
SteelBar = IN[0]
b = SteelBar(IN[1], IN[2], IN[3])
OUT = b.make_geometry()
# ----------------------------------------
code_block_5 = CodeBlock { 4500; -4500; 0; }
byCoordinates_5 = Point.ByCoordinates(x=code_block_5.out0, y=code_block_5.out1, z=code_block_5.out2)
height_of_shorter_side = DoubleSlider(3000, range=2000..3000 step 1)
byCoordinates_6 = Point.ByCoordinates(x=code_block_5.out0, y=code_block_5.out1, z=height_of_shorter_side)
steel_bar_last_short_instance = Python(IN[0]=steel_rod_class, IN[1]=byCoordinates_5, IN[2]=byCoordinates_6, IN[3]=radius_of_bars)  # PythonNet3; same code as steel_bar_instance_last_tall
starting_x_point = CodeBlock { -4500; }
number_of_rods = CodeBlock { 14; }
distance_between_rods = DoubleSlider(650, range=500..650 step 0.1)
sequence_of_x_coordinates = Sequence(start=starting_x_point, amount=number_of_rods, step=distance_between_rods)
y_coordinates = CodeBlock { -4500; }
bottom_points = Point.ByCoordinates(x=sequence_of_x_coordinates, y=y_coordinates)
code_block_6 = CodeBlock { -4500; 1000; }
top_points = Point.ByCoordinates(x=sequence_of_x_coordinates, y=code_block_6.out0, z=height_of_shorter_side)
series_of_steel_rods_shorter = Python(IN[0]=steel_rod_class, IN[1]=bottom_points, IN[2]=top_points, IN[3]=radius_of_bars)  # "Series of Steel Rods (Shorter Side)"; PythonNet3
# ---------- series_of_steel_rods_shorter.python (18 lines) ----------
SteelBar = IN[0]
bottom_points = IN[1]
top_points = IN[2]
radius = IN[3]

bars = []

count = min(len(bottom_points), len(top_points))

for i in range(count):
    btm = bottom_points[i]
    top = top_points[i]
    
    bar = SteelBar(btm, top, radius)
  
    bars.append(bar.make_geometry())
    
OUT = bars
# ----------------------------------------
starting_point_and_of_rods = CodeBlock { -4500; 14; }
sequence_of_x_coordinates_2 = Sequence(start=starting_point_and_of_rods.out0, amount=starting_point_and_of_rods.out1, step=distance_between_rods)
x_and_z_coordinates = CodeBlock { 4500; 0; }
bottom_points_2 = Point.ByCoordinates(x=sequence_of_x_coordinates_2, y=x_and_z_coordinates.out0, z=x_and_z_coordinates.out1)
code_block_7 = CodeBlock { 4500; }
top_points_2 = Point.ByCoordinates(x=sequence_of_x_coordinates_2, y=code_block_7, z=height_of_beams_taller_beams)
series_of_steel_rods_taller_side = Python(IN[0]=steel_rod_class, IN[1]=bottom_points_2, IN[2]=top_points_2, IN[3]=radius_of_bars)  # PythonNet3; same code as series_of_steel_rods_shorter
list_of_steel_bars = List.Create(item0=steel_bar_instance_last_tall, item1=steel_bar_last_short_instance, item2=series_of_steel_rods_shorter, item3=series_of_steel_rods_taller_side)
volume = Solid.Volume(solid=list_of_steel_bars)
sum = Math.Sum(values=volume)
watch = Watch(sum)
wood_beam_class = Python()  # PythonNet3; unwired: IN[0]
# ---------- wood_beam_class.python (18 lines) ----------
# Load the Python Standard and DesignScript Libraries
import sys
import clr
clr.AddReference('ProtoGeometry')
from Autodesk.DesignScript.Geometry import *

# The inputs to this node will be stored as a list in the IN variables.
dataEnteringNode = IN

# Place your code below this line
class WoodBeam:
    def __init__ (self, bottom_point, top_point):
        self.bottom = bottom_point
        self.top = top_point
        
    def make_geometry(self):
        return Cuboid.ByCorners(self.bottom, self.top)
OUT = WoodBeam
# ----------------------------------------
code_block_8 = CodeBlock { -4600; 4300; }
byCoordinates_7 = Point.ByCoordinates(x=code_block_8.out0, y=code_block_8.out1, z=height_of_beams_taller_beams)
code_block_9 = CodeBlock { 4800; 4700; 4500; }
byCoordinates_8 = Point.ByCoordinates(x=code_block_9.out0, y=code_block_9.out1, z=code_block_9.out2)
vertical_beam_instance = Python(IN[0]=wood_beam_class, IN[1]=byCoordinates_7, IN[2]=byCoordinates_8)  # PythonNet3
# ---------- vertical_beam_instance.python (20 lines) ----------
# Load the Python Standard and DesignScript Libraries
import sys
import clr
clr.AddReference('ProtoGeometry')
from Autodesk.DesignScript.Geometry import *

# Inputs:
# IN[0] = WoodBeam class from Node 1
# IN[1] = bottom point
# IN[2] = top point

WoodBeamClass = IN[0]
bottom = IN[1]
top = IN[2]

# Create instance
beam = WoodBeamClass(bottom, top)

# Output both instance and geometry
OUT = beam, beam.make_geometry()
# ----------------------------------------
volume_2 = Solid.Volume(solid=vertical_beam_instance)
code_block_10 = CodeBlock { -4500; 0; 0; }
byCoordinates_9 = Point.ByCoordinates(x=code_block_10.out0, y=code_block_10.out1, z=height_of_beams_taller_beams)
code_block_11 = CodeBlock { 4500; 4000; }
thickness_of_beams = DoubleSlider(350, range=0..350 step 1)
byCoordinates_10 = Point.ByCoordinates(x=code_block_11.out0, y=thickness_of_beams, z=code_block_11.out1)
vertical_beam_instance_2 = Python(IN[0]=wood_beam_class, IN[1]=byCoordinates_9, IN[2]=byCoordinates_10)  # PythonNet3; same code as vertical_beam_instance
code_block_12 = CodeBlock { -4500; 0; 0; }
byCoordinates_11 = Point.ByCoordinates(x=code_block_12.out0, y=code_block_12.out1, z=code_block_12.out2)
code_block_13 = CodeBlock { -4150; 200; 4000; }
byCoordinates_12 = Point.ByCoordinates(x=code_block_13.out0, y=thickness_of_beams, z=height_of_beams_taller_beams)
beam_instance = Python(IN[0]=wood_beam_class, IN[1]=byCoordinates_11, IN[2]=byCoordinates_12)  # PythonNet3; same code as vertical_beam_instance
code_block_14 = CodeBlock { -175; 0; 0; }
byCoordinates_13 = Point.ByCoordinates(x=code_block_14.out0, y=code_block_14.out1, z=code_block_14.out2)
code_block_15 = CodeBlock { 175; 3000; }
byCoordinates_14 = Point.ByCoordinates(x=code_block_15.out0, y=thickness_of_beams, z=height_of_beams_taller_beams)
centre_beam_instance = Python(IN[0]=wood_beam_class, IN[1]=byCoordinates_13, IN[2]=byCoordinates_14)  # PythonNet3; same code as vertical_beam_instance
code_block_16 = CodeBlock { 4500; 0; 0; }
byCoordinates_15 = Point.ByCoordinates(x=code_block_16.out0, y=code_block_16.out1, z=code_block_16.out2)
code_block_17 = CodeBlock { 4150; 4000; }
byCoordinates_16 = Point.ByCoordinates(x=code_block_17.out0, y=thickness_of_beams, z=height_of_beams_taller_beams)
centre_beam_instance_2 = Python(IN[0]=wood_beam_class, IN[1]=byCoordinates_15, IN[2]=byCoordinates_16)  # PythonNet3; same code as vertical_beam_instance
list_create = List.Create(item0=vertical_beam_instance, item1=vertical_beam_instance_2, item2=beam_instance, item3=centre_beam_instance, item4=centre_beam_instance_2)
volume_3 = Solid.Volume(solid=list_create)
code_block_18 = CodeBlock(num1=volume_3) { num2 = Math.Sum(num1); }
watch_2 = Watch(code_block_18)
python_script = Python()  # PythonNet3; unwired: IN[0]
# ---------- python_script.python (18 lines) ----------
# Load the Python Standard and DesignScript Libraries
import sys
import clr
clr.AddReference('ProtoGeometry')
from Autodesk.DesignScript.Geometry import *

# The inputs to this node will be stored as a list in the IN variables.
dataEnteringNode = IN

# Place your code below this line
class SteelRoof:
    def __init__ (self, bottom_point, top_point):
        self.bottom = bottom_point
        self.top = top_point
        
    def make_geometry(self):
        return Cuboid.ByCorners(self.bottom, self.top)
OUT = SteelRoof
# ----------------------------------------
code_block_19 = CodeBlock { -4800; 0; 4000; }
byCoordinates_17 = Point.ByCoordinates(x=code_block_19.out0, y=code_block_19.out1, z=code_block_19.out2)
code_block_20 = CodeBlock { 4800; 4800; }
number_slider = DoubleSlider(4500, range=4000..4500 step 1)
byCoordinates_18 = Point.ByCoordinates(x=code_block_20.out0, y=code_block_20.out1, z=number_slider)
steel_roof_tall_side_instance = Python(IN[0]=python_script, IN[1]=byCoordinates_17, IN[2]=byCoordinates_18)  # PythonNet3
# ---------- steel_roof_tall_side_instance.python (20 lines) ----------
# Load the Python Standard and DesignScript Libraries
import sys
import clr
clr.AddReference('ProtoGeometry')
from Autodesk.DesignScript.Geometry import *

# Inputs:
# IN[0] = WoodBeam class from Node 1
# IN[1] = bottom point
# IN[2] = top point

SteelRoof = IN[0]
bottom = IN[1]
top = IN[2]

# Create instance
roof = SteelRoof(bottom, top)

# Output both instance and geometry
OUT = roof, roof.make_geometry()
# ----------------------------------------
code_block_21 = CodeBlock { -4600; 0; }
byCoordinates_19 = Point.ByCoordinates(x=code_block_21.out0, y=code_block_21.out1, z=height_of_shorter_side)
code_block_22 = CodeBlock { 4600; -4800; 3000; }
number_slider_2 = DoubleSlider(3200, range=3000..3200 step 0.1)
byCoordinates_20 = Point.ByCoordinates(x=code_block_22.out0, y=code_block_22.out1, z=number_slider_2)
steel_roof_short_side_instance = Python(IN[0]=python_script, IN[1]=byCoordinates_19, IN[2]=byCoordinates_20)  # PythonNet3; same code as vertical_beam_instance
list_create_2 = List.Create(item0=steel_roof_tall_side_instance, item1=steel_roof_short_side_instance)
volume_4 = Solid.Volume(solid=list_create_2)
sum_2 = Math.Sum(values=volume_4)
watch_3 = Watch(sum_2)
