# Dynamo graph 1855317.dyn (Dynamo 3.6.0.9395)

# group: Don't touch this ground
code_block = CodeBlock { -5000; -5000; -200; }
byCoordinates = Point.ByCoordinates(x=code_block.out0, y=code_block.out1, z=code_block.out2)
code_block_2 = CodeBlock { 5000; 5000; 0; }
byCoordinates_2 = Point.ByCoordinates(x=code_block_2.out0, y=code_block_2.out1, z=code_block_2.out2)
byCorners = Cuboid.ByCorners(lowPoint=byCoordinates, highPoint=byCoordinates_2)
code_block_3 = CodeBlock { 0; 100; 0; }
byARGB = Color.ByARGB(red=code_block_3.out0, green=code_block_3.out1, blue=code_block_3.out2)
byGeometryColor = Modifiers.GeometryColor.ByGeometryColor(geometry=byCorners, color=byARGB)

number_of_arches = DoubleSlider(20, range=10..30 step 1)
arch_span = DoubleSlider(8000, range=4000..8000 step 100)
max_height = DoubleSlider(4500, range=3000..6000 step 100)
wave_factor = DoubleSlider(1200, range=0..2000 step 50)
class_definitions_timber_and = Python(IN[0]=number_of_arches, IN[1]=arch_span, IN[2]=max_height, IN[3]=wave_factor)  # "Class definitions timber and steel"; CPython3
# ---------- class_definitions_timber_and.python (68 lines) ----------
import sys
import clr
import math


clr.AddReference('ProtoGeometry')
from Autodesk.DesignScript.Geometry import *


class TimberArch:
    def __init__(self, x_pos, span, height):
        self.x = x_pos
        self.span = span
        self.h = height
        self.width_x = 200  
        self.depth_radial = 300 
    
    def create_geometry(self):
        p1 = Point.ByCoordinates(self.x, -self.span/2, 0)
        p2 = Point.ByCoordinates(self.x, 0, self.h)
        p3 = Point.ByCoordinates(self.x, self.span/2, 0)
        
        base_arc = Arc.ByThreePoints(p1, p2, p3)
        ribbon_surf = base_arc.Extrude(Vector.ByCoordinates(self.width_x, 0, 0))
        solid_arch = ribbon_surf.Thicken(self.depth_radial, False)
        return solid_arch

    def get_volume(self):
        p1 = Point.ByCoordinates(self.x, -self.span/2, 0)
        p2 = Point.ByCoordinates(self.x, 0, self.h)
        p3 = Point.ByCoordinates(self.x, self.span/2, 0)
        return Arc.ByThreePoints(p1, p2, p3).Length * self.width_x * self.depth_radial


class SteelRod:
    def __init__(self, x_start, x_end, height):
        self.x1 = x_start
        self.x2 = x_end
        self.z = height - 400 
        self.radius = 60 
        
    def create_geometry(self):
        start = Point.ByCoordinates(self.x1 + 100, 0, self.z)
        end = Point.ByCoordinates(self.x2 + 100, 0, self.z)
        return Cylinder.ByPointsRadius(start, end, self.radius)
        
    def get_volume(self):
        length = abs(self.x2 - self.x1)
        return math.pi * (self.radius ** 2) * length


class BaseRunner:
    def __init__(self, length, y_pos):
        self.len = length
        self.y = y_pos
        self.width = 400
        self.height = 100 
        
    def create_geometry(self):
        
        mid_pt = Point.ByCoordinates(0, self.y, 50)
        return Cuboid.ByLengths(mid_pt, self.len, self.width, 100)
    
    def get_volume(self):
        return self.len * self.width * 100


OUT = [TimberArch, SteelRod, BaseRunner]
# ----------------------------------------
instantces = Python(IN[0]=class_definitions_timber_and, IN[1]=number_of_arches, IN[2]=arch_span, IN[3]=max_height, IN[4]=wave_factor)  # CPython3
# ---------- instantces.python (85 lines) ----------
import sys
import clr
import math


clr.AddReference('ProtoGeometry')
from Autodesk.DesignScript.Geometry import *


TimberArch = IN[0][0]
SteelRod = IN[0][1]
BaseRunner = IN[0][2] 


num_arches = IN[1]
span_width = IN[2]
max_height = IN[3]
wave_factor = IN[4]


arches = []
rods = []
runners = []


start_x = -4000
end_x = 4000
total_len = 8000
step = total_len / max(1, (num_arches - 1))


for i in range(int(num_arches)):
    curr_x = start_x + (i * step)
    
    
    angle = (i / num_arches) * 360 
    curr_h = max_height - (math.sin(math.radians(angle)) * wave_factor)
    
    
    arch = TimberArch(curr_x, span_width, curr_h)
    arches.append(arch)
    
    
    if i < (num_arches - 1):
        next_x = start_x + ((i + 1) * step)
        next_angle = ((i+1) / num_arches) * 360
        next_h = max_height - (math.sin(math.radians(next_angle)) * wave_factor)
        avg_h = (curr_h + next_h) / 2
        
        rod = SteelRod(curr_x, next_x, avg_h)
        rods.append(rod)


runner_len = total_len + 1000 
left_runner = BaseRunner(runner_len, -span_width/2)
right_runner = BaseRunner(runner_len, span_width/2)

runners.append(left_runner)
runners.append(right_runner)


geo_arches = []
vol_arches = 0
geo_rods = []
vol_rods = 0
geo_runners = []
vol_runners = 0 

for a in arches:
    geo_arches.append(a.create_geometry())
    vol_arches += a.get_volume()

for r in rods:
    geo_rods.append(r.create_geometry())
    vol_rods += r.get_volume()

for b in runners:
    geo_runners.append(b.create_geometry())
    vol_runners += b.get_volume()


final_timber_geo = geo_arches + geo_runners
final_timber_vol = vol_arches + vol_runners

OUT = [final_timber_geo, geo_rods, final_timber_vol, vol_rods]
# ----------------------------------------
code_block_4 = CodeBlock(x=instantces) { x[2]; x[3]; }
timber_volume = Watch(code_block_4.out0)
steel_volume = Watch(code_block_4.out1)
