# Dynamo graph 1855718.dyn (Dynamo 3.5.2.8914)

# group: Don't touch this ground
code_block = CodeBlock { -5000; -5000; -200; }
byCoordinates = Point.ByCoordinates(x=code_block.out0, y=code_block.out1, z=code_block.out2)
code_block_2 = CodeBlock { 5000; 5000; 0; }
byCoordinates_2 = Point.ByCoordinates(x=code_block_2.out0, y=code_block_2.out1, z=code_block_2.out2)
byCorners = Cuboid.ByCorners(lowPoint=byCoordinates, highPoint=byCoordinates_2)
code_block_3 = CodeBlock { 0; 100; 0; }
byARGB = Color.ByARGB(red=code_block_3.out0, green=code_block_3.out1, blue=code_block_3.out2)
byGeometryColor = Modifiers.GeometryColor.ByGeometryColor(geometry=byCorners, color=byARGB)

# group: pavilion
pavilion_height = DoubleSlider(14.6, range=1..100 step 0.1)
number_of_ribs = IntegerSlider(16, range=2..50 step 1)
thickness_of_ribs = DoubleSlider(45.7, range=1..100 step 0.1)
number_of_ties = IntegerSlider(26, range=1..80 step 1)
number_of_hand_rails = IntegerSlider(8, range=5..20 step 1)
class_generation_script = Python(IN[0]=pavilion_height, IN[1]=number_of_ribs, IN[2]=thickness_of_ribs, IN[3]=number_of_ties, IN[4]=number_of_hand_rails)  # CPython3
# ---------- class_generation_script.python (318 lines) ----------
import clr
import math

# Import Standard Geometry Library
clr.AddReference('ProtoGeometry')
from Autodesk.DesignScript.Geometry import *

# ==========================================
# 1. PARAMETRIC SURFACE GENERATOR
# ==========================================
try:
    pavilion_height = float(IN[0])
    if pavilion_height < 100: pavilion_height = 3000.0
except:
    pavilion_height = 3000.0

# Fixed Dimensions (10m x 10m)
WIDTH = 10000
LENGTH = 10000
RESOLUTION = 15 

pts = []
for i in range(RESOLUTION + 1):
    row_pts = []
    # Normalized U parameter (0 to 1)
    u = i / float(RESOLUTION)
    # Centered X: -5000 to 5000
    x = (u * WIDTH) - (WIDTH / 2)
    
    for j in range(RESOLUTION + 1):
        # Normalized V parameter (0 to 1)
        v = j / float(RESOLUTION)
        # Centered Y: -5000 to 5000
        y = (v * LENGTH) - (LENGTH / 2)
        
        # --- PARAMETRIC FORMULA ---
        z_base = math.sin(u * math.pi) * pavilion_height
        ripple = math.sin(v * math.pi * 2) * (pavilion_height * 0.1)
        z_final = max(0, z_base + ripple)
            
        row_pts.append(Point.ByCoordinates(x, y, z_final))
    
    pts.append(row_pts)

input_surface = NurbsSurface.ByPoints(pts)


# ==========================================
# 2. CLASS DEFINITIONS
# ==========================================
class TimberRib:
    """Represents a primary structural Glulam beam."""
    def __init__(self, base_surface, param, depth, width=150):
        self.surface = base_surface
        self.param = param 
        self.depth = depth
        self.width = width
        self.geometry = None
        self.volume = 0.0
        
    def _detect_curvature_direction(self):
        u_iso = self.surface.GetIsoline(0, 0.5)
        v_iso = self.surface.GetIsoline(1, 0.5)
        
        # Simple tortuosity check
        u_len = u_iso.Length
        u_dist = u_iso.StartPoint.DistanceTo(u_iso.EndPoint)
        v_len = v_iso.Length
        v_dist = v_iso.StartPoint.DistanceTo(v_iso.EndPoint)
        
        u_ratio = u_len / u_dist if u_dist > 0 else 1
        v_ratio = v_len / v_dist if v_dist > 0 else 1
        
        return 0 if u_ratio > v_ratio else 1

    def generate_geometry(self):
        try:
            direction = self._detect_curvature_direction()
            base_curve = self.surface.GetIsoline(direction, self.param)
            # Extrude UP (+Z)
            surf_strip = base_curve.Extrude(Vector.ByCoordinates(0,0,1), self.depth)
            self.geometry = surf_strip.Thicken(self.width/2.0) 
            return self.geometry
        except:
            return None
        
    def compute_volume(self):
        if self.geometry: self.volume = self.geometry.Volume
        return self.volume

class SteelTie:
    """Represents a steel connecting rod/bracing."""
    def __init__(self, start_pt, end_pt, diameter=40):
        self.start = start_pt
        self.end = end_pt
        self.radius = diameter / 2.0
        self.geometry = None
        self.volume = 0.0
        
    def generate_geometry(self):
        try:
            if self.start.DistanceTo(self.end) > 1.0: # Prevent zero length error
                self.geometry = Cylinder.ByPointsRadius(self.start, self.end, self.radius)
        except:
            self.geometry = None
        return self.geometry
        
    def compute_volume(self):
        if self.geometry: self.volume = self.geometry.Volume
        return self.volume

class Bench:
    """Represents a timber bench running along the side."""
    def __init__(self, base_surface, side_param):
        self.surface = base_surface
        self.u_loc = side_param # e.g. 0.1 or 0.9
        self.height = 450.0 # Standard seat height
        self.width = 400.0  # Standard seat depth
        self.geometry = None
        self.volume = 0.0

    def _detect_flat_direction(self):
        """Finds the flat direction (Length) to place the bench."""
        u_iso = self.surface.GetIsoline(0, 0.5)
        v_iso = self.surface.GetIsoline(1, 0.5)
        
        def get_ratio(curve):
            str_len = curve.StartPoint.DistanceTo(curve.EndPoint)
            actual_len = curve.Length
            if str_len == 0: return 1 
            return actual_len / str_len

        u_ratio = get_ratio(u_iso)
        v_ratio = get_ratio(v_iso)
        
        # If U is curvier (ratio > 1), then V (1) is the flat length.
        if u_ratio > v_ratio:
            return 1
        else:
            return 0

    def generate_geometry(self):
        # FIX: Safer Extrusion Method
        try:
            direction = self._detect_flat_direction()
            
            # Get the curve to find the start and end coordinates
            base_curve = self.surface.GetIsoline(direction, self.u_loc)
            p1 = base_curve.StartPoint
            p2 = base_curve.EndPoint
            
            # Flatten points to Z=0 explicitly
            flat_p1 = Point.ByCoordinates(p1.X, p1.Y, 0)
            flat_p2 = Point.ByCoordinates(p2.X, p2.Y, 0)
            
            # Create straight line on floor
            floor_line = Line.ByStartPointEndPoint(flat_p1, flat_p2)
            
            # Extrude UP
            seat_surf = floor_line.Extrude(Vector.ByCoordinates(0,0,1), self.height)
            
            # Thicken
            self.geometry = seat_surf.Thicken(self.width)
            return self.geometry
        except:
            return None
    
    def compute_volume(self):
        if self.geometry: self.volume = self.geometry.Volume
        return self.volume

class RailingPost:
    """Represents horizontal slats on the bench."""
    def __init__(self, location_pt, base_z=450, length=400, diameter=50, vector=None):
        self.loc = location_pt
        self.base_z = base_z # Z height where slat sits
        self.length = length # Length of slat (Bench Width)
        self.radius = diameter / 2.0
        self.vector = vector # Direction of slat
        self.geometry = None
        self.volume = 0.0
    
    def generate_geometry(self):
        try:
            # Center point at top of bench (base_z + radius to sit on top)
            z_pos = self.base_z + self.radius
            center_pt = Point.ByCoordinates(self.loc.X, self.loc.Y, z_pos)
            
            # Default vector to X axis if none provided
            vec = self.vector if self.vector else Vector.ByCoordinates(1,0,0)
            
            # Create horizontal slat geometry
            start_pt = center_pt.Translate(vec, -self.length / 2.0)
            end_pt = center_pt.Translate(vec, self.length / 2.0)
            
            self.geometry = Cylinder.ByPointsRadius(start_pt, end_pt, self.radius)
            return self.geometry
        except:
            return None

    def compute_volume(self):
        if self.geometry: self.volume = self.geometry.Volume
        return self.volume

# ==========================================
# 3. MAIN EXECUTION
# ==========================================
try:
    num_ribs = int(IN[1])    
    rib_depth = float(IN[2])        
    brace_count = int(IN[3])
    railing_count = int(IN[4]) 
except:
    num_ribs = 10
    rib_depth = 400
    brace_count = 5
    railing_count = 15

# Containers
geo_ribs = []
geo_ties = []
geo_benches = []   
geo_railings = []  

total_vol_timber = 0.0
total_vol_steel = 0.0

# --- A. Generate Timber Ribs ---
if num_ribs > 1: step = 1.0 / (num_ribs - 1)
else: step = 1.0 
params = [i * step for i in range(num_ribs)]

rib_curves_ref = [] 

for p in params:
    rib_obj = TimberRib(input_surface, p, rib_depth)
    solid = rib_obj.generate_geometry()
    if solid:
        geo_ribs.append(solid)
        total_vol_timber += rib_obj.compute_volume()
    
    # Store ref for ties
    d = rib_obj._detect_curvature_direction()
    rib_curves_ref.append(input_surface.GetIsoline(d, p))

# --- B. Generate Steel Ties ---
for i in range(len(rib_curves_ref) - 1):
    crv_a = rib_curves_ref[i]
    crv_b = rib_curves_ref[i+1]
    for k in range(brace_count):
        # CHANGED: Span full length 0.0 to 1.0 to include bottom braces
        t = k * (1.0 / (brace_count - 1)) if brace_count > 1 else 0.5
        
        pt_a = crv_a.PointAtParameter(t)
        pt_b = crv_b.PointAtParameter(t)
        tie_obj = SteelTie(pt_a, pt_b)
        solid = tie_obj.generate_geometry()
        if solid: 
            geo_ties.append(solid)
            total_vol_steel += tie_obj.compute_volume()

# --- C. Generate Benches (Sides) ---
# MOVED IN: Changed from 0.1/0.9 to 0.15/0.85 (500mm shift)
bench_locations = [0.15, 0.85]
for b_loc in bench_locations:
    bench = Bench(input_surface, b_loc)
    solid = bench.generate_geometry()
    if solid:
        geo_benches.append(solid)
        total_vol_timber += bench.compute_volume()

# --- D. Generate Railings (Slats) ---
# Detect Flat Direction for Railings
# (Mirroring the logic in the Bench class)
u_test = input_surface.GetIsoline(0, 0.5)
v_test = input_surface.GetIsoline(1, 0.5)
u_d = u_test.StartPoint.DistanceTo(u_test.EndPoint)
v_d = v_test.StartPoint.DistanceTo(v_test.EndPoint)
u_rat = u_test.Length / u_d if u_d > 0 else 1
v_rat = v_test.Length / v_d if v_d > 0 else 1
# If U is curvier (ratio > 1), use V (1) as the rail direction
rail_dir = 1 if u_rat > v_rat else 0

# Determine Slat Orientation Vector (ROTATED 90 DEGREES)
# Was: Perpendicular to rail_dir. Now: Parallel to rail_dir.
# If rail is along Y (1), Slat is along Y (Vector 0,1,0)
slat_vec = Vector.ByCoordinates(0,1,0) if rail_dir == 1 else Vector.ByCoordinates(1,0,0)

# Match Bench Locations (0.15, 0.85)
railing_locations = [0.15, 0.85]
for r_loc in railing_locations:
    # Get the curve for this side using detected direction
    rail_curve = input_surface.GetIsoline(rail_dir, r_loc)
    
    # Divide curve to place posts
    for r in range(railing_count):
        # Parameter along the length (0 to 1)
        t = r / float(railing_count - 1) if railing_count > 1 else 0.5
        pt = rail_curve.PointAtParameter(t)
        
        # Horizontal Slat: Length=400, Vector=slat_vec
        post = RailingPost(pt, base_z=450, length=400, vector=slat_vec)
        solid = post.generate_geometry()
        if solid:
            geo_railings.append(solid)
            total_vol_steel += post.compute_volume()

# ==========================================
# OUTPUTS
# ==========================================
# 0: Ribs 
# 1: Ties 
# 2: Benches
# 3: Railings
# 4: Vol Timber
# 5: Vol Steel
# 6: Surface (Use this for Glass Skin)
OUT = [geo_ribs, geo_ties, geo_benches, geo_railings, total_vol_timber, total_vol_steel, input_surface]
# ----------------------------------------
data_outputs = CodeBlock(data=class_generation_script)  # unwired: dat
# ---------- data_outputs.designscript (6 lines) ----------
geo_ribs = data[0];
geo_ties = data[1];
geo_benches = data[2];
geo_railings = dat[3];
total_vol_timber = data[4];
total_vol_steel = data[5];
# ----------------------------------------
total_voulme_of_timber = Watch(data_outputs.total_vol_timber)
total_volume_of_steel = Watch(data_outputs.total_vol_steel)
code_outputs = CodeBlock(out=class_generation_script) { tim = out[0]; stl = out[1]; ben = out[2]; rail = out[3]; out[6]; }
timber_color = ColorPalette({R: 162, G: 89, B: 5, A: 255})
geometrycolor_ribs = Modifiers.GeometryColor.ByGeometryColor(geometry=code_outputs.tim, color=timber_color)
fix_tie_colour = Solid.ByUnion(solids=code_outputs.stl)
steel_color = ColorPalette({R: 34, G: 34, B: 34, A: 255})
geometrycolor_ties = Modifiers.GeometryColor.ByGeometryColor(geometry=fix_tie_colour, color=steel_color)
skin_color_code = CodeBlock { 100; 0; 100; 0; }
green_clear_skin = Color.ByARGB(alpha=skin_color_code.out0, red=skin_color_code.out1, green=skin_color_code.out2, blue=skin_color_code.out3)
geometrycolor_skin = Modifiers.GeometryColor.ByGeometryColor(geometry=code_outputs.out4, color=green_clear_skin)
outputs_of_code = Watch(class_generation_script)
geometrycolor_benches = Modifiers.GeometryColor.ByGeometryColor(geometry=code_outputs.ben, color=timber_color)
geometrycolor_railing = Modifiers.GeometryColor.ByGeometryColor(geometry=code_outputs.rail, color=steel_color)
