# Dynamo graph 1855755.dyn "Flowing Pavillion" (Dynamo 4.0.0.3277)

# group: Don't touch this ground
code_block = CodeBlock { -5000; -5000; -200; }
byCoordinates = Point.ByCoordinates(x=code_block.out0, y=code_block.out1, z=code_block.out2)
code_block_2 = CodeBlock { 5000; 5000; 0; }
byCoordinates_2 = Point.ByCoordinates(x=code_block_2.out0, y=code_block_2.out1, z=code_block_2.out2)
byCorners = Cuboid.ByCorners(lowPoint=byCoordinates, highPoint=byCoordinates_2)
code_block_3 = CodeBlock { 0; 100; 0; }
byARGB = Color.ByARGB(red=code_block_3.out0, green=code_block_3.out1, blue=code_block_3.out2)
byGeometryColor = Modifiers.GeometryColor.ByGeometryColor(geometry=byCorners, color=byARGB)

# group: Class 1: Timber Beams
cylindrical_beam_class = Python()  # PythonNet3; unwired: IN[0]
# ---------- cylindrical_beam_class.python (21 lines) ----------
# Load the Python Standard and DesignScript Libraries
import sys
import clr
clr.AddReference('ProtoGeometry')
from Autodesk.DesignScript.Geometry import *
import math

class CylindricalBeam:
    def __init__(self, bottom_point, top_point, radius):
        self.bottom = bottom_point
        self.top = top_point
        self.radius = radius
        
    def make_geometry(self):
        return Cylinder.ByPointsRadius(self.bottom, self.top, self.radius)
        
    def measure_volume(self):
        height = self.bottom.DistanceTo(self.top)
        return math.pi * (self.radius ** 2) * height
       
OUT = CylindricalBeam
# ----------------------------------------

# group: Parameters
width = DoubleSlider(3000, range=3000..5000 step 100)
length = DoubleSlider(3000, range=3000..5000 step 100)
height = DoubleSlider(3000, range=3000..6000 step 0.1)
radius_of_cylindrical_beam = DoubleSlider(150, range=100..150 step 1)
number_of_cylindrical_beams_on = DoubleSlider(5, range=5..10 step 1)  # "Number of Cylindrical Beams on Each Side"
thickness_of_cross_section = DoubleSlider(150, range=50..150 step 1)

code_block_4 = CodeBlock(x=width, y=length) { -x; y; 0; }
bottom_point_front_right_beam = Point.ByCoordinates(x=code_block_4.out0, y=code_block_4.y, z=code_block_4.out2)
code_block_5 = CodeBlock(x=width, y=length, z=height) { -x; y; z; }
right_point_curve_1 = Point.ByCoordinates(x=code_block_5.out0, y=code_block_5.y, z=code_block_5.z)

# group: Instance 1
instance_1_front_right_beam = Python(IN[0]=cylindrical_beam_class, IN[1]=bottom_point_front_right_beam, IN[2]=right_point_curve_1, IN[3]=radius_of_cylindrical_beam)  # PythonNet3
# ---------- instance_1_front_right_beam.python (3 lines) ----------
CylindricalBeam = IN[0]
rightside = CylindricalBeam(IN[1],IN[2],IN[3])
OUT = [rightside.make_geometry(), rightside.measure_volume()]
# ----------------------------------------

code_block_6 = CodeBlock(x=width, y=length) { x; y; 0; }
bottom_point_front_left_beam = Point.ByCoordinates(x=code_block_6.x, y=code_block_6.y, z=code_block_6.out2)
code_block_7 = CodeBlock(x=width, y=length, z=height) { x; y; z; }
left_point_curve_1 = Point.ByCoordinates(x=code_block_7.x, y=code_block_7.y, z=code_block_7.z)

# group: Instance 2
instance_2_front_left_beam = Python(IN[0]=cylindrical_beam_class, IN[1]=bottom_point_front_left_beam, IN[2]=left_point_curve_1, IN[3]=radius_of_cylindrical_beam)  # PythonNet3
# ---------- instance_2_front_left_beam.python (3 lines) ----------
CylindricalBeam = IN[0]
leftside = CylindricalBeam(IN[1],IN[2],IN[3])
OUT = [leftside.make_geometry(), leftside.measure_volume()]
# ----------------------------------------

code_block_8 = CodeBlock(x=width, y=length) { x; -y; 0; }
bottom_point_back_left_beam = Point.ByCoordinates(x=code_block_8.x, y=code_block_8.out1, z=code_block_8.out2)
code_block_9 = CodeBlock(x=width, y=length, z=height) { x; -y; z; }
left_point_curve_3 = Point.ByCoordinates(x=code_block_9.x, y=code_block_9.out1, z=code_block_9.z)

# group: Instance 3
instance_3_back_left_beam = Python(IN[0]=cylindrical_beam_class, IN[1]=bottom_point_back_left_beam, IN[2]=left_point_curve_3, IN[3]=radius_of_cylindrical_beam)  # PythonNet3; same code as instance_2_front_left_beam

code_block_10 = CodeBlock(x=width, y=length) { -x; -y; 0; }
bottom_point_back_right_beam = Point.ByCoordinates(x=code_block_10.out0, y=code_block_10.out1, z=code_block_10.out2)
code_block_11 = CodeBlock(x=width, y=length, z=height) { -x; -y; z; }
right_point_curve_3 = Point.ByCoordinates(x=code_block_11.out0, y=code_block_11.out1, z=code_block_11.z)

# group: Instance 4
instance_4_back_right_beam = Python(IN[0]=cylindrical_beam_class, IN[1]=bottom_point_back_right_beam, IN[2]=right_point_curve_3, IN[3]=radius_of_cylindrical_beam)  # PythonNet3; same code as instance_1_front_right_beam

bottom_right_line = Line.ByStartPointEndPoint(startPoint=bottom_point_front_right_beam, endPoint=bottom_point_back_right_beam)
code_block_12 = CodeBlock(n=number_of_cylindrical_beams_on) { 0..1..#n; }
right_bottom_points = Curve.PointAtParameter(curve=bottom_right_line, param=code_block_12)
code_block_13 = CodeBlock(x=width, z=height) { -x; 0; z*0.9; }
right_point_curve_2 = Point.ByCoordinates(x=code_block_13.out0, y=code_block_13.out1, z=code_block_13.out2)
right_side_arc = Arc.ByThreePoints(firstPoint=right_point_curve_1, secondPoint=right_point_curve_2, thirdPoint=right_point_curve_3)
code_block_14 = CodeBlock(n=number_of_cylindrical_beams_on) { 0..1..#n; }
right_top_points = Curve.PointAtParameter(curve=right_side_arc, param=code_block_14)
left_bottom_line = Line.ByStartPointEndPoint(startPoint=bottom_point_front_left_beam, endPoint=bottom_point_back_left_beam)
left_bottom_points = Curve.PointAtParameter(curve=left_bottom_line, param=code_block_12)
code_block_15 = CodeBlock(x=width, y=length, z=height) { x; y; z; }
left_point_curve_1_2 = Point.ByCoordinates(x=code_block_15.x, y=code_block_15.y, z=code_block_15.z)
code_block_16 = CodeBlock(x=width, z=height) { x; 0; z*0.9; }
left_point_curve_2 = Point.ByCoordinates(x=code_block_16.x, y=code_block_16.out1, z=code_block_16.out2)
code_block_17 = CodeBlock(x=width, y=length, z=height) { x; -y; z; }
left_point_curve_3_2 = Point.ByCoordinates(x=code_block_17.x, y=code_block_17.out1, z=code_block_17.z)
left_side_arc = Arc.ByThreePoints(firstPoint=left_point_curve_1_2, secondPoint=left_point_curve_2, thirdPoint=left_point_curve_3_2)
left_top_points = Curve.PointAtParameter(curve=left_side_arc, param=code_block_14)

# group: Series of Instances
series_of_instances_cylindrical = Python(IN[0]=cylindrical_beam_class, IN[1]=right_bottom_points, IN[2]=right_top_points, IN[3]=radius_of_cylindrical_beam)  # "Series of Instances (Cylindrical Beams Right)"; PythonNet3
# ---------- series_of_instances_cylindrical.python (23 lines) ----------
CylindricalBeam = IN[0]
bottom_points = IN[1]
top_points = IN[2]
radius = IN[3]

geometry = []
volumes = []

for i in range(len(bottom_points)):
    
    bottom_point = bottom_points[i]
   
    top_point = top_points[i]
    
    cylindrical_beam = CylindricalBeam(bottom_point, top_point, radius)
    
    geometry.append(cylindrical_beam.make_geometry())
    
    volume = cylindrical_beam.measure_volume()
    
    volumes.append(cylindrical_beam.measure_volume())
    
OUT = (geometry, volumes) 
# ----------------------------------------
series_of_instances_cylindrical_2 = Python(IN[0]=cylindrical_beam_class, IN[1]=left_bottom_points, IN[2]=left_top_points, IN[3]=radius_of_cylindrical_beam)  # "Series of Instances (Cylindrical Beams Left)"; PythonNet3
# ---------- series_of_instances_cylindrical_2.python (24 lines) ----------
CylindricalBeam = IN[0]
bottom_points = IN[1]
top_points = IN[2]
radius = IN[3]

geometry = []

volumes = []

for i in range(len(bottom_points)):
    
    bottom_point = bottom_points[i]
   
    top_point = top_points[i]
    
    cylindrical_beam = CylindricalBeam(bottom_point, top_point, radius)
    
    geometry.append(cylindrical_beam.make_geometry())
    
    volume = cylindrical_beam.measure_volume()
    
    volumes.append(cylindrical_beam.measure_volume())
    
OUT = (geometry, volumes) 
# ----------------------------------------

# group: Class 2: Steel Curves
# Volume for this class cannot be computed as the class defines curves rather than geometric shapes.
curve_class = Python()  # PythonNet3; unwired: IN[0]
# ---------- curve_class.python (15 lines) ----------
# Load the Python Standard and DesignScript Libraries
import sys
import clr
clr.AddReference('ProtoGeometry')
from Autodesk.DesignScript.Geometry import *

class Curve:
    def __init__(self, points, degree):
        self.points = points
        self.degree = degree
        
    def make_curve(self):
        return NurbsCurve.ByPoints(self.points, self.degree)
        
OUT = Curve
# ----------------------------------------

code_block_18 = CodeBlock(y=length) { 0; y; 100; }
middle_point_curve_1 = Point.ByCoordinates(x=code_block_18.out0, y=code_block_18.y, z=code_block_18.out2)
curve_1 = List.Create(item0=right_point_curve_1, item1=middle_point_curve_1, item2=left_point_curve_1)
degree = CodeBlock { 2; }

# group: Curve 1
instance_5_curve_1 = Python(IN[0]=curve_class, IN[1]=curve_1, IN[2]=degree)  # PythonNet3
# ---------- instance_5_curve_1.python (3 lines) ----------
Curve = IN[0]
curve1 = Curve(IN[1],IN[2])
OUT = curve1.make_curve()
# ----------------------------------------

code_block_19 = CodeBlock(x=width, z=height) { x; 0; z*0.9; }
left_point_curve_2_2 = Point.ByCoordinates(x=code_block_19.x, y=code_block_19.out1, z=code_block_19.out2)
code_block_20 = CodeBlock(z=height) { 0; 0; z*0.3; }
middle_point_curve_2 = Point.ByCoordinates(x=code_block_20.out0, y=code_block_20.out1, z=code_block_20.out2)
curve_2 = List.Create(item0=left_point_curve_2_2, item1=middle_point_curve_2, item2=right_point_curve_2)

# group: Curve 2
instance_6_curve_2 = Python(IN[0]=curve_class, IN[1]=curve_2, IN[2]=degree)  # PythonNet3; same code as instance_5_curve_1

code_block_21 = CodeBlock(y=length, z=height) { 0; -y; z*1.2; }
middle_point_curve_3 = Point.ByCoordinates(x=code_block_21.out0, y=code_block_21.out1, z=code_block_21.out2)
curve_3 = List.Create(item0=left_point_curve_3, item1=middle_point_curve_3, item2=right_point_curve_3)

# group: Curve 3
instance_7_curve_3 = Python(IN[0]=curve_class, IN[1]=curve_3, IN[2]=degree)  # PythonNet3; same code as instance_5_curve_1

list_create = List.Create(item0=instance_5_curve_1, item1=instance_6_curve_2, item2=instance_7_curve_3)
byLoft = Surface.ByLoft(crossSections=list_create)
code_block_22 = CodeBlock { 1; }
code_block_23 = CodeBlock { 21; 0.05; }
sequence = Sequence(amount=code_block_23.out0, step=code_block_23.out1)
y_direction = Surface.GetIsoline(surface=byLoft, isoDirection=code_block_22, parameter=sequence)
code_block_24 = CodeBlock(n=thickness_of_cross_section) { n; }
XAxis = Vector.XAxis()
byThickeningCurveNormal = PolyCurve.ByThickeningCurveNormal(curve=y_direction, thickness=code_block_24, normal=XAxis)
extrudeAsSolid = Curve.ExtrudeAsSolid(curve=byThickeningCurveNormal, distance=code_block_24)
code_block_25 = CodeBlock { 0; }
x_direction = Surface.GetIsoline(surface=byLoft, isoDirection=code_block_25, parameter=sequence)
YAxis = Vector.YAxis()
byThickeningCurveNormal_2 = PolyCurve.ByThickeningCurveNormal(curve=x_direction, thickness=code_block_24, normal=YAxis)
extrudeAsSolid_2 = Curve.ExtrudeAsSolid(curve=byThickeningCurveNormal_2, distance=code_block_24)

# group: Cross Section
union = Solid.Union(solid=extrudeAsSolid, solid_2=extrudeAsSolid_2)

# note: The volume of the cross section could not be computed through code because the instances of the three curves defining the cross section are used as guides to create a surface. Instead, I used this node to calculate the volume of the 21 line segments.
volume_of_the_cross_section = Solid.Volume(solid=union)
