# Dynamo graph 1855880.dyn (Dynamo 3.6.0.9395)

# group: Don't touch this ground
code_block = CodeBlock { -5000; -5000; -200; }
byCoordinates = Point.ByCoordinates(x=code_block.out0, y=code_block.out1, z=code_block.out2)
code_block_2 = CodeBlock { 5000; 5000; 0; }
byCoordinates_2 = Point.ByCoordinates(x=code_block_2.out0, y=code_block_2.out1, z=code_block_2.out2)
byCorners = Cuboid.ByCorners(lowPoint=byCoordinates, highPoint=byCoordinates_2)
code_block_3 = CodeBlock { 0; 100; 0; }
byARGB = Color.ByARGB(red=code_block_3.out0, green=code_block_3.out1, blue=code_block_3.out2)
byGeometryColor = Modifiers.GeometryColor.ByGeometryColor(geometry=byCorners, color=byARGB)

circular_steel_rod = Python()  # CPython3; unwired: IN[0]
# ---------- circular_steel_rod.python (25 lines) ----------
# Load the Python Standard and DesignScript Libraries
import sys
import clr
clr.AddReference('ProtoGeometry')
from Autodesk.DesignScript.Geometry import *
import math

class CircularSteel:
    def __init__(self, centerline, radius):
        self.centerline = centerline
        self.radius = radius
        
    def endpoints (self):
        return self.centerline.StartPoint, self.centerline.EndPoint
    
    def make_geometry(self):
        end1, end2 = self.endpoints()
        
        return Cylinder.ByPointsRadius(end1, end2,self.radius)
           
    def measure_volume(self):
        end1, end2 = self.endpoints()
        return end1.DistanceTo(end2)*self.radius*self.radius*math.pi
        
OUT = CircularSteel
# ----------------------------------------
code_block_4 = CodeBlock { 0; 0; 0; }
byCoordinates_3 = Point.ByCoordinates(x=code_block_4.out0, y=code_block_4.out1, z=code_block_4.out2)
ZAxis = Vector.ZAxis()
center_steel_beam_height = DoubleSlider(8200, range=1000..9000 step 100)
endpoint_of_line_of_center_steel = Geometry.Translate(geometry=byCoordinates_3, direction=ZAxis, distance=center_steel_beam_height)  # "Endpoint of line of center steel beam"
line_representing_height_of = Line.ByStartPointEndPoint(startPoint=byCoordinates_3, endPoint=endpoint_of_line_of_center_steel)  # "Line representing height of center steel beam"
center_steel_beam_radius = DoubleSlider(500, range=500..3000 step 10)
steel_rod_instance = Python(IN[0]=circular_steel_rod, IN[1]=line_representing_height_of, IN[2]=center_steel_beam_radius)  # CPython3
# ---------- steel_rod_instance.python (4 lines) ----------
CircularSteel = IN[0]
bottomSteel = CircularSteel(IN[1],IN[2])

OUT = [bottomSteel.make_geometry(), bottomSteel.measure_volume()]
# ----------------------------------------
watch = Watch(steel_rod_instance)
circular_recyled_plastic_rod = Python()  # "Circular Recyled Plastic Rod Class"; CPython3; unwired: IN[0]
# ---------- circular_recyled_plastic_rod.python (38 lines) ----------
# Load the Python Standard and DesignScript Libraries
import sys
import clr
clr.AddReference('ProtoGeometry')
from Autodesk.DesignScript.Geometry import *
import math

class RecycledPlastic:
    def __init__(self, centerline, radius):
        # Accepts a single line OR a list of lines
        if isinstance(centerline, list):
            self.centerlines = centerline
        else:
            self.centerlines = [centerline]  # convert single to list
        
        self.radius = radius
        
    def endpoints(self, line):
        return line.StartPoint, line.EndPoint
    
    def make_geometry(self):
        cylinders = []
        for ln in self.centerlines:
            end1, end2 = self.endpoints(ln)
            cylinders.append(
                Cylinder.ByPointsRadius(end1, end2, self.radius)
            )
        return cylinders
           
    def measure_volume(self):
        volumes = []
        for ln in self.centerlines:
            end1, end2 = self.endpoints(ln)
            vol = end1.DistanceTo(end2) * self.radius * self.radius * math.pi
            volumes.append(vol)
        return volumes
        
OUT = RecycledPlastic
# ----------------------------------------
dip_of_recycled_plastic = DoubleSlider(6000, range=2000..6000 step 100)  # "Dip of recycled plastic cylinders"
code_block_5 = CodeBlock(height=dip_of_recycled_plastic) { 0; 0; height; }
byCoordinates_4 = Point.ByCoordinates(x=code_block_5.out0, y=code_block_5.out1, z=code_block_5.height)
ZAxis_2 = Vector.ZAxis()
translate = Geometry.Translate(geometry=byCoordinates_4, direction=ZAxis_2)
spread_out_of_top_cylinders = DoubleSlider(4700, range=1000..6000 step 100)
circle_defining_tree_leaves = Circle.ByCenterPointRadius(centerPoint=translate, radius=spread_out_of_top_cylinders)
number_of_cylinders_on_the_top = DoubleSlider(30, range=10..30 step 1)
points_on_circle = Python(IN[0]=circle_defining_tree_leaves, IN[1]=number_of_cylinders_on_the_top)  # CPython3
# ---------- points_on_circle.python (17 lines) ----------
# Load the Python Standard and DesignScript Libraries
import sys
import clr
clr.AddReference('ProtoGeometry')
from Autodesk.DesignScript.Geometry import *

# Inputs
circle = IN[0]   # Circle input
n = int(IN[1])        # Number of points, made into integers

# Generate equally spaced parameters
params = [i/float(n) for i in range(n)]

# Get points at parameters
points = [circle.PointAtParameter(p) for p in params]

OUT = points
# ----------------------------------------
byStartPointEndPoint = Line.ByStartPointEndPoint(startPoint=endpoint_of_line_of_center_steel, endPoint=points_on_circle)
radius_of_recycled_plastic = DoubleSlider(370, range=200..1000 step 10)  # "Radius of recycled plastic cylinders"
instance_of_recycled_plastic = Python(IN[0]=circular_recyled_plastic_rod, IN[1]=byStartPointEndPoint, IN[2]=radius_of_recycled_plastic)  # "Instance of Recycled Plastic cylinders"; CPython3
# ---------- instance_of_recycled_plastic.python (4 lines) ----------
RecycledPlastic = IN[0]
bottomPlastic = RecycledPlastic(IN[1],IN[2])

OUT = [bottomPlastic.make_geometry(), bottomPlastic.measure_volume()]
# ----------------------------------------
watch_2 = Watch(instance_of_recycled_plastic)
