# Dynamo graph 1855979.dyn (Dynamo 4.0.0.3277)

# group: Don't touch this ground
code_block = CodeBlock { -5000; -5000; -200; }
byCoordinates = Point.ByCoordinates(x=code_block.out0, y=code_block.out1, z=code_block.out2)
code_block_2 = CodeBlock { 5000; 5000; 0; }
byCoordinates_2 = Point.ByCoordinates(x=code_block_2.out0, y=code_block_2.out1, z=code_block_2.out2)
byCorners = Cuboid.ByCorners(lowPoint=byCoordinates, highPoint=byCoordinates_2)
code_block_3 = CodeBlock { 0; 100; 0; }
byARGB = Color.ByARGB(red=code_block_3.out0, green=code_block_3.out1, blue=code_block_3.out2)
byGeometryColor = Modifiers.GeometryColor.ByGeometryColor(geometry=byCorners, color=byARGB)

single_steel_support = Python()  # PythonNet3; unwired: IN[0]
# ---------- single_steel_support.python (22 lines) ----------
# Load the Python Standard and DesignScript Libraries
import sys
import clr
clr.AddReference('ProtoGeometry')
from Autodesk.DesignScript.Geometry import *

class SteelSupports:
    def __init__(self, top_point, radius):
        self.top = top_point
        self.radius = radius

    def make(self):
        bottom = Point.ByCoordinates(
            self.top.X, self.top.Y, 0)

        return Cylinder.ByPointsRadius(
            self.top,
            bottom,
            self.radius
        )

OUT = SteelSupports
# ----------------------------------------
length_of_roof = DoubleSlider(8000, range=1..8000 step 0.1)
amount_of_points_in_each_curve = IntegerSlider(17, range=10..23 step 1)
code_block_4 = CodeBlock(Lengths=length_of_roof, SliceNumber=amount_of_points_in_each_curve) { Lengths; SliceNumber; Interval = 0..1..#SliceNumber; Xpoint = -4000 + Interval * Lengths; }
code_block_5 = CodeBlock { 4000; }
amplitude_of_both_curves = DoubleSlider(1.5, range=0..2 step 0.1)
height_of_roof = DoubleSlider(4969.2, range=2000..10000 step 0.1)
code_block_6 = CodeBlock(x=code_block_4.Xpoint, amp=amplitude_of_both_curves, height=height_of_roof) { x; amp; height; z1 = 1000*Math.Sin(amp*x+10) + height; }
byCoordinates_3 = Point.ByCoordinates(x=code_block_4.Xpoint, y=code_block_5, z=code_block_6.z1)
code_block_7 = CodeBlock { 80; }
series_of_steel_supports = Python(IN[0]=single_steel_support, IN[1]=byCoordinates_3, IN[2]=code_block_7)  # PythonNet3
# ---------- series_of_steel_supports.python (35 lines) ----------
# Load the Python Standard and DesignScript Libraries
import sys
import clr
clr.AddReference('ProtoGeometry')
from Autodesk.DesignScript.Geometry import *

SteelSupports = IN[0]
points = IN[1]
radius = IN[2]

supports = []
volumes = []

for pt in points:
    beam = SteelSupports(pt, radius)
    supports.append(beam.make())

v = 0.0
for s in supports:
    try:
        v = s.Volume
    except:
        v = 0.0
volumes.append(v)

volume_unit = "mm^2"

volume_labels = []
for v in volumes:
    volume_labels.append("{0:.2f} {1}".format(v, volume_unit))
    
total_volume = sum(volumes)
total_volume_label = "{0:.2f} {1}".format(total_volume, volume_unit)

OUT = (supports, volume_labels, total_volume_label)
# ----------------------------------------
code_block_8 = CodeBlock { 1; }
getItemAtIndex = List.GetItemAtIndex(list=series_of_steel_supports, index=code_block_8)
volume_of_steel_supports_one = Watch(getItemAtIndex)  # "Volume of Steel Supports (One side)"
code_block_9 = CodeBlock { -4000; }
code_block_10 = CodeBlock(x=code_block_4.Xpoint, amp=amplitude_of_both_curves, height=height_of_roof) { x; amp; height; z2 = 1000*Math.Cos(amp*x+60) + height; }
byCoordinates_4 = Point.ByCoordinates(x=code_block_4.Xpoint, y=code_block_9, z=code_block_10.z2)
series_of_steel_supports_2 = Python(IN[0]=single_steel_support, IN[1]=byCoordinates_4, IN[2]=code_block_7)  # PythonNet3
# ---------- series_of_steel_supports_2.python (41 lines) ----------
# Load the Python Standard and DesignScript Libraries
import sys
import clr
clr.AddReference('ProtoGeometry')
from Autodesk.DesignScript.Geometry import *

# Load the Python Standard and DesignScript Libraries
import sys
import clr
clr.AddReference('ProtoGeometry')
from Autodesk.DesignScript.Geometry import *

SteelSupports = IN[0]
points = IN[1]
radius = IN[2]

supports = []
volumes = []

for pt in points:
    beam = SteelSupports(pt, radius)
    supports.append(beam.make())
    
v = 0.0
for s in supports:
    try:
        v = s.Volume
    except:
        v = 0.0
volumes.append(v)

volume_unit = "mm^2"

volume_labels = []
for v in volumes:
    volume_labels.append("{0:.2f} {1}".format(v, volume_unit))
    
total_volume = sum(volumes)
total_volume_label = "{0:.2f} {1}".format(total_volume, volume_unit)

OUT = (supports, volume_labels, total_volume_label)
# ----------------------------------------
code_block_11 = CodeBlock { 1; }
getItemAtIndex_2 = List.GetItemAtIndex(list=series_of_steel_supports_2, index=code_block_11)
volume_of_steel_supports_one_2 = Watch(getItemAtIndex_2)  # "Volume of Steel Supports (One side)"
single_timber_beam = Python()  # PythonNet3; unwired: IN[0]
# ---------- single_timber_beam.python (15 lines) ----------
# Load the Python Standard and DesignScript Libraries
import sys
import clr
clr.AddReference('ProtoGeometry')
from Autodesk.DesignScript.Geometry import *

class TimberBeams:
    def __init__(self, pta, ptb, radius):
        self.a = pta
        self.b = ptb
        self.radius = radius
        
    def make_geometry(self):
        return Cylinder.ByPointsRadius(self.a, self.b, self.radius)
OUT = TimberBeams
# ----------------------------------------
code_block_12 = CodeBlock(n=amount_of_points_in_each_curve) { n; radii=550-10*n; }
series_of_timber_beams = Python(IN[0]=single_timber_beam, IN[1]=byCoordinates_3, IN[2]=byCoordinates_4, IN[3]=code_block_12.radii)  # PythonNet3
# ---------- series_of_timber_beams.python (45 lines) ----------
# Load the Python Standard and DesignScript Libraries
import sys
import clr
clr.AddReference('ProtoGeometry')
from Autodesk.DesignScript.Geometry import *

TimberBeams = IN[0]
pta = IN[1]
ptb = IN[2]
radius_list = IN[3]

if isinstance(radius_list, (int, float)):
    radius_list = [radius_list]

beams = []
volumes = []

count = min(len(pta), len(ptb))

for i in range(count):
    r = radius_list[i] if i < len(radius_list) else radius_list[-1]
    curveApoint = pta[i]
    curveBpoint = ptb[i]
    
    beam = TimberBeams(curveApoint, curveBpoint, r)
    beams.append(beam.make_geometry())

v = 0.0
for b in beams:
    try:
        v = b.Volume
    except:
        v = 0.0
volumes.append(v)

volume_unit = "mm^2"

volume_labels = []
for v in volumes:
    volume_labels.append("{0:.2f} {1}".format(v, volume_unit))
    
total_volume = sum(volumes)
total_volume_label = "{0:.2f} {1}".format(total_volume, volume_unit)

OUT = (beams, total_volume_label, volume_unit)
# ----------------------------------------
code_block_13 = CodeBlock { 1; }
getItemAtIndex_3 = List.GetItemAtIndex(list=series_of_timber_beams, index=code_block_13)
volume_of_timber_beams = Watch(getItemAtIndex_3)
code_block_14 = CodeBlock { 0; }
getItemAtIndex_4 = List.GetItemAtIndex(list=series_of_timber_beams, index=code_block_14)
color_palette = ColorPalette({R: 77, G: 38, B: 0, A: 255})
byGeometryColor_2 = Modifiers.GeometryColor.ByGeometryColor(geometry=getItemAtIndex_4, color=color_palette)
