# Dynamo graph 1856239.dyn (Dynamo 3.3.0.6316)

# group: Grass
code_block = CodeBlock { -5000; -5000; -200; }
byCoordinates = Point.ByCoordinates(x=code_block.out0, y=code_block.out1, z=code_block.out2)
code_block_2 = CodeBlock { 5000; 5000; 0; }
byCoordinates_2 = Point.ByCoordinates(x=code_block_2.out0, y=code_block_2.out1, z=code_block_2.out2)
byCorners = Cuboid.ByCorners(lowPoint=byCoordinates, highPoint=byCoordinates_2)
code_block_3 = CodeBlock { 0; 100; 0; }
byARGB = Color.ByARGB(red=code_block_3.out0, green=code_block_3.out1, blue=code_block_3.out2)
byGeometryColor = Modifiers.GeometryColor.ByGeometryColor(geometry=byCorners, color=byARGB)

# group: Roof rods
code_block_4 = CodeBlock { -4500; -3000; 0; }
byCoordinates_3 = Point.ByCoordinates(x=code_block_4.out0, y=code_block_4.out1, z=code_block_4.out2)
code_block_5 = CodeBlock { 4500; -4700; 0; }
byCoordinates_4 = Point.ByCoordinates(x=code_block_5.out0, y=code_block_5.out1, z=code_block_5.out2)
byStartPointEndPoint = Line.ByStartPointEndPoint(startPoint=byCoordinates_3, endPoint=byCoordinates_4)
number_of_the_roof_rods = IntegerSlider(45, range=25..45 step 1)
code_block_6 = CodeBlock(n=number_of_the_roof_rods) { 0; n; 1/n; }
sequence = Sequence(start=code_block_6.out0, amount=code_block_6.n, step=code_block_6.out2)
pointAtParameter = Curve.PointAtParameter(curve=byStartPointEndPoint, param=sequence)
code_block_7 = CodeBlock { -4500; -1500; 2500; }
byCoordinates_5 = Point.ByCoordinates(x=code_block_7.out0, y=code_block_7.out1, z=code_block_7.out2)
code_block_8 = CodeBlock { 4500; 4000; 5500; }
byCoordinates_6 = Point.ByCoordinates(x=code_block_8.out0, y=code_block_8.out1, z=code_block_8.out2)
byStartPointEndPoint_2 = Line.ByStartPointEndPoint(startPoint=byCoordinates_5, endPoint=byCoordinates_6)
pointAtParameter_2 = Curve.PointAtParameter(curve=byStartPointEndPoint_2, param=sequence)
step_of_the_roof_rods = CodeBlock(n=number_of_the_roof_rods) { s = 9000/n; }
radius_of_rods = CodeBlock(S=step_of_the_roof_rods) { R = (S/2)-10; }
roof_made_of_circular_wooden = Python(IN[0]=pointAtParameter, IN[1]=pointAtParameter_2, IN[2]=radius_of_rods)  # "Roof made of circular wooden rods"; CPython3
# ---------- roof_made_of_circular_wooden.python (67 lines) ----------
# Load the Python Standard and DesignScript Libraries
import sys
import clr
clr.AddReference('ProtoGeometry')
from Autodesk.DesignScript.Geometry import *

class Circular_rod:
    def __init__(self, bottom_point, top_point, radius):
        self.bottom = bottom_point
        self.top = top_point
        self.radius = radius
        
    def make_geometry(self):
        # Reject invalid inputs
        if self.bottom is None or self.top is None:
            return None
        if not hasattr(self.bottom, "X") or not hasattr(self.top, "X"):
            return None
        if self.radius is None or self.radius <= 0:
            return None
        # Reject zero-length rods
        if self.bottom.DistanceTo(self.top) == 0:
            return None

        return Cylinder.ByPointsRadius(self.bottom, self.top, self.radius)
    
    def volume(self):
        geo = self.make_geometry()
        return geo.Volume if geo else 0


# Inputs
bottom_points = IN[0]
top_points = IN[1]
radii = IN[2]

# Ensure lists
def ensure_list(x):
    return x if isinstance(x, list) else [x]

bottom_points = ensure_list(bottom_points)
top_points = ensure_list(top_points)
radii = ensure_list(radii)

geometries = []
vol_sum = 0

# --- Loop through each column/series ---
for col in range(len(bottom_points)):
    column_bottoms = ensure_list(bottom_points[col])
    column_tops = ensure_list(top_points[col])

    count = min(len(column_bottoms), len(column_tops))

    for i in range(count):
        r = radii[i] if i < len(radii) else radii[-1]

        rod = Circular_rod(column_bottoms[i], column_tops[i], r)
        geo = rod.make_geometry()

        # Only append valid geometry (VERY IMPORTANT for colour)
        if geo:
            geometries.append(geo)
            vol_sum += geo.Volume

# --- OUTPUT MUST BE GEOMETRY ONLY (flat list) ---
OUT = geometries
# ----------------------------------------
code_block_9 = CodeBlock { 255; 255; 255; }
white_colour = Color.ByARGB(red=code_block_9.out0, green=code_block_9.out1, blue=code_block_9.out2)
roof = Modifiers.GeometryColor.ByGeometryColor(geometry=roof_made_of_circular_wooden, color=white_colour)
python_script = Python(IN[0]=roof_made_of_circular_wooden)  # CPython3
# ---------- python_script.python (16 lines) ----------
Geometry_volume = IN[0]

total_volume = 0

# Ensure it's a proper list
if not isinstance(Geometry_volume, list):
    geos = [geos]

for g in Geometry_volume:
    if g is None:
        continue
    # only objects with Volume property
    if hasattr(g, "Volume"):
        total_volume += g.Volume

OUT = total_volume
# ----------------------------------------
volume_of_wood_needed_in_mm_3 = Watch(python_script)

# group: Column supports
code_block_10 = CodeBlock { -4500; -1600; 0; }
byCoordinates_7 = Point.ByCoordinates(x=code_block_10.out0, y=code_block_10.out1, z=code_block_10.out2)
code_block_11 = CodeBlock { 4500; 3900; 0; }
byCoordinates_8 = Point.ByCoordinates(x=code_block_11.out0, y=code_block_11.out1, z=code_block_11.out2)
byStartPointEndPoint_3 = Line.ByStartPointEndPoint(startPoint=byCoordinates_7, endPoint=byCoordinates_8)
code_block_12 = CodeBlock { 0; 3; 1/3; }
sequence_2 = Sequence(start=code_block_12.out0, amount=code_block_12.out1, step=code_block_12.out2)
pointAtParameter_3 = Curve.PointAtParameter(curve=byStartPointEndPoint_3, param=sequence_2)
code_block_13 = CodeBlock { -4500; -1600; 2300; }
byCoordinates_9 = Point.ByCoordinates(x=code_block_13.out0, y=code_block_13.out1, z=code_block_13.out2)
code_block_14 = CodeBlock { 4500; 3900; 5400; }
byCoordinates_10 = Point.ByCoordinates(x=code_block_14.out0, y=code_block_14.out1, z=code_block_14.out2)
byStartPointEndPoint_4 = Line.ByStartPointEndPoint(startPoint=byCoordinates_9, endPoint=byCoordinates_10)
code_block_15 = CodeBlock { 0; 3; 1/3; }
sequence_3 = Sequence(start=code_block_15.out0, amount=code_block_15.out1, step=code_block_15.out2)
pointAtParameter_4 = Curve.PointAtParameter(curve=byStartPointEndPoint_4, param=sequence_3)
radius_of_the_support_columns = IntegerSlider(100, range=80..150 step 10)
concrete_support_columns = Python(IN[0]=pointAtParameter_3, IN[1]=pointAtParameter_4, IN[2]=radius_of_the_support_columns)  # CPython3
# ---------- concrete_support_columns.python (66 lines) ----------
# Load the Python Standard and DesignScript Libraries
import sys
import clr
clr.AddReference('ProtoGeometry')
from Autodesk.DesignScript.Geometry import *

class Support_rod:
    def __init__(self, bottom_point, top_point, radius):
        self.bottom = bottom_point
        self.top = top_point
        self.radius = radius
        
    def make_geometry(self):
        # Reject invalid inputs
        if self.bottom is None or self.top is None:
            return None
        if not hasattr(self.bottom, "X") or not hasattr(self.top, "X"):
            return None
        if self.radius is None or self.radius <= 0:
            return None
        # Reject zero-length rods
        if self.bottom.DistanceTo(self.top) == 0:
            return None

        return Cylinder.ByPointsRadius(self.bottom, self.top, self.radius)
    
    def volume(self):
        geo = self.make_geometry()
        return geo.Volume if geo else 0


# Inputs
bottom_points = IN[0]
top_points = IN[1]
radii = IN[2]

def ensure_list(x):
    return x if isinstance(x, list) else [x]

bottom_points = ensure_list(bottom_points)
top_points = ensure_list(top_points)
radii = ensure_list(radii)

geometries = []
vol_sum = 0

# --- Loop series (columns) ---
for col in range(len(bottom_points)):
    column_bottoms = ensure_list(bottom_points[col])
    column_tops = ensure_list(top_points[col])

    count = min(len(column_bottoms), len(column_tops))

    for i in range(count):
        r = radii[i] if i < len(radii) else radii[-1]

        rod = Support_rod(column_bottoms[i], column_tops[i], r)
        geo = rod.make_geometry()

        # Only append valid geometry
        if geo:
            geometries.append(geo)
            vol_sum += geo.Volume

# OUT must be geometry only, for color
OUT = geometries
# ----------------------------------------
code_block_16 = CodeBlock { 128; 128; 128; }
white_colour_2 = Color.ByARGB(red=code_block_16.out0, green=code_block_16.out1, blue=code_block_16.out2)
concrete_support_columns_with = Modifiers.GeometryColor.ByGeometryColor(geometry=concrete_support_columns, color=white_colour_2)  # "Concrete support columns with colour"
python_script_2 = Python(IN[0]=concrete_support_columns)  # CPython3; same code as python_script
volume_of_concrete_needed_in_mm = Watch(python_script_2)  # "Volume of concrete needed in mm^3"

# group: Seats
code_block_17 = CodeBlock { -1500; 233.33333333; }
byCoordinates_11 = Point.ByCoordinates(x=code_block_17.out0, y=code_block_17.out1)
height_of_the_seats = IntegerSlider(430, range=430..500 step 10)
code_block_18 = CodeBlock(z=height_of_the_seats) { -1500; 233.33333333; z; }
byCoordinates_12 = Point.ByCoordinates(x=code_block_18.out0, y=code_block_18.out1, z=code_block_18.z)
radius_of_the_seats = IntegerSlider(1000, range=900..1050 step 50)
code_for_the_timber_wood_seats = Python()  # CPython3; unwired: IN[0]
# ---------- code_for_the_timber_wood_seats.python (22 lines) ----------
# Load the Python Standard and DesignScript Libraries
import sys
import clr
clr.AddReference('ProtoGeometry')
from Autodesk.DesignScript.Geometry import *

# Load the Python Standard and DesignScript Libraries
import sys
import clr
clr.AddReference('ProtoGeometry')
from Autodesk.DesignScript.Geometry import *

class Seat:
    def __init__(self, bottom_point, top_point, radius):
        self.bottom = bottom_point
        self.top = top_point
        self.radius = radius
        
        
    def make_geometry(self):
        return Cylinder.ByPointsRadius(self.bottom, self.top, self.radius)
OUT = Seat
# ----------------------------------------
timber_wood_seats = Python(IN[0]=byCoordinates_11, IN[1]=byCoordinates_12, IN[2]=radius_of_the_seats, IN[3]=code_for_the_timber_wood_seats)  # CPython3
# ---------- timber_wood_seats.python (25 lines) ----------
Seat = IN[3]
bottom_points = IN[0]
top_points = IN[1]
radius = IN[2]

# --- Force all inputs to be lists ---
def ensure_list(x):
    return x if isinstance(x, list) else [x]

bottom_points = ensure_list(bottom_points)
top_points = ensure_list(top_points)
radius = ensure_list(radius)

seats = []
count = min(len(bottom_points), len(top_points))

for i in range(count):
    r = radius[i] if i < len(radius) else radius[-1]
    btm = bottom_points[i]
    top = top_points[i]

    seat = Seat(btm, top, r)
    seats.append(seat.make_geometry())

OUT = seats
# ----------------------------------------
code_block_19 = CodeBlock { 255; 217; 125; }
white_colour_3 = Color.ByARGB(red=code_block_19.out0, green=code_block_19.out1, blue=code_block_19.out2)
timber_wood_seats_with_colour = Modifiers.GeometryColor.ByGeometryColor(geometry=timber_wood_seats, color=white_colour_3)
code_block_20 = CodeBlock { 1500; 2066.67; }
byCoordinates_13 = Point.ByCoordinates(x=code_block_20.out0, y=code_block_20.out1)
code_block_21 = CodeBlock(z=height_of_the_seats) { 1500; 2066.67; z; }
byCoordinates_14 = Point.ByCoordinates(x=code_block_21.out0, y=code_block_21.out1, z=code_block_21.z)
timber_wood_seats_2 = Python(IN[0]=byCoordinates_13, IN[1]=byCoordinates_14, IN[2]=radius_of_the_seats, IN[3]=code_for_the_timber_wood_seats)  # CPython3; same code as timber_wood_seats
timber_wood_seats_with_colour_2 = Modifiers.GeometryColor.ByGeometryColor(geometry=timber_wood_seats_2, color=white_colour_3)
code_block_22 = CodeBlock(z=height_of_the_seats, r=radius_of_the_seats) { V = 2 * z * 3.14 * r * r; }
volume_of_the_timber_wood_seats = Watch(code_block_22)  # "Volume of the timber wood seats in mm^3"

# group: Seats
code_block_23 = CodeBlock(z=height_of_the_seats) { -1500; 233.33333333; z; }
byCoordinates_15 = Point.ByCoordinates(x=code_block_23.out0, y=code_block_23.out1)
height_of_seat_supports = IntegerSlider(300, range=250..450 step 50)
code_block_24 = CodeBlock(z=height_of_the_seats, d=height_of_seat_supports) { -1500; 233.33333333; z + d; }
byCoordinates_16 = Point.ByCoordinates(x=code_block_24.out0, y=code_block_24.out1, z=code_block_24.out2)
radius_of_the_seats_supports = IntegerSlider(450, range=150..450 step 50)
code_for_the_timber_wood_seat = Python()  # "Code for the timber wood seat supports"; CPython3; unwired: IN[0]
# ---------- code_for_the_timber_wood_seat.python (21 lines) ----------
# Load the Python Standard and DesignScript Libraries
import sys
import clr
clr.AddReference('ProtoGeometry')
from Autodesk.DesignScript.Geometry import *

import sys
import clr
clr.AddReference('ProtoGeometry')
from Autodesk.DesignScript.Geometry import *

class Seat_support:
    def __init__(self, bottom_point, top_point, radius):
        self.bottom = bottom_point
        self.top = top_point
        self.radius = radius

    def make_geometry(self):
        return Cylinder.ByPointsRadius(self.bottom, self.top, self.radius)

OUT = Seat_support
# ----------------------------------------
timber_wood_seat_supports = Python(IN[0]=byCoordinates_15, IN[1]=byCoordinates_16, IN[2]=radius_of_the_seats_supports, IN[3]=code_for_the_timber_wood_seat)  # CPython3
# ---------- timber_wood_seat_supports.python (26 lines) ----------
Seat_support = IN[3]           # Class coming from the first Python block
bottom_points = IN[0]
top_points = IN[1]
radius = IN[2]

# --- Force all inputs to be lists ---
def ensure_list(x):
    return x if isinstance(x, list) else [x]

bottom_points = ensure_list(bottom_points)
top_points = ensure_list(top_points)
radius = ensure_list(radius)

supports = []
count = min(len(bottom_points), len(top_points))

for i in range(count):
    r = radius[i] if i < len(radius) else radius[-1]
    btm = bottom_points[i]
    top = top_points[i]

    # Use the class coming from the first script block
    support = Seat_support(btm, top, r)
    supports.append(support.make_geometry())

OUT = supports
# ----------------------------------------
code_block_25 = CodeBlock { 255; 217; 125; }
white_colour_4 = Color.ByARGB(red=code_block_25.out0, green=code_block_25.out1, blue=code_block_25.out2)
timber_wood_seat_supports_with = Modifiers.GeometryColor.ByGeometryColor(geometry=timber_wood_seat_supports, color=white_colour_4)  # "Timber wood seat supports with colour"
code_block_26 = CodeBlock(z=height_of_the_seats) { 1500; 2066.67; z; }
byCoordinates_17 = Point.ByCoordinates(x=code_block_26.out0, y=code_block_26.out1)
code_block_27 = CodeBlock(z=height_of_the_seats, d=height_of_seat_supports) { 1500; 2066.67; z + d; }
byCoordinates_18 = Point.ByCoordinates(x=code_block_27.out0, y=code_block_27.out1, z=code_block_27.out2)
timber_wood_seat_supports_2 = Python(IN[0]=byCoordinates_17, IN[1]=byCoordinates_18, IN[2]=radius_of_the_seats_supports, IN[3]=code_for_the_timber_wood_seat)  # CPython3; same code as timber_wood_seat_supports
timber_wood_seat_supports_with_2 = Modifiers.GeometryColor.ByGeometryColor(geometry=timber_wood_seat_supports_2, color=white_colour_4)  # "Timber wood seat supports with colour"
code_block_28 = CodeBlock(d=height_of_seat_supports, r=radius_of_the_seats_supports) { V = 2 * d * 3.14 * r * r; }
volume_of_the_timber_wood_seat = Watch(code_block_28)  # "Volume of the timber wood seat supports in mm^3"
