# Dynamo graph 1856466.dyn (Dynamo 3.6.0.9395)

code_block = CodeBlock { -5000; -5000; -200; }
byCoordinates = Point.ByCoordinates(x=code_block.out0, y=code_block.out1, z=code_block.out2)
code_block_2 = CodeBlock { 5000; 5000; 0; }
byCoordinates_2 = Point.ByCoordinates(x=code_block_2.out0, y=code_block_2.out1, z=code_block_2.out2)
byCorners = Cuboid.ByCorners(lowPoint=byCoordinates, highPoint=byCoordinates_2)
code_block_3 = CodeBlock { 0; 100; 0; }
byARGB = Color.ByARGB(red=code_block_3.out0, green=code_block_3.out1, blue=code_block_3.out2)
byGeometryColor = Modifiers.GeometryColor.ByGeometryColor(geometry=byCorners, color=byARGB)
code_block_4 = CodeBlock { 0; 0; 0; }
byCoordinates_3 = Point.ByCoordinates(x=code_block_4.out0, y=code_block_4.out1, z=code_block_4.out2)
size_of_conrete_dome = DoubleSlider(5000, range=3500..5000 step 0.1)
code_block_5 = CodeBlock(S=size_of_conrete_dome) { S; S*0.99; -S; }
concrete_dome = Python()  # CPython3; unwired: IN[0]
# ---------- concrete_dome.python (21 lines) ----------
# Load the Python Standard and DesignScript Libraries
import sys
import clr
clr.AddReference('ProtoGeometry')
from Autodesk.DesignScript.Geometry import *
class ConcreteDome:
    def __init__(self, center, radius):
        self.center = center
        self.radius = radius
        self.sphere = None

    def make_geometry(self):
        self.sphere = Sphere.ByCenterPointRadius(self.center, self.radius)
        return self.sphere
        
    def volume(self):
        # ensure geometry exists
        if self.sphere is None:
            self.make_geometry()
        return self.sphere.Volume
OUT = ConcreteDome
# ----------------------------------------
single_instance_of_concrete_dome = Python(IN[0]=byCoordinates_3, IN[1]=code_block_5.S, IN[2]=concrete_dome)  # CPython3
# ---------- single_instance_of_concrete_dome.python (3 lines) ----------
ConcreteDome = IN[2]
b = ConcreteDome(IN[0], IN[1])
OUT = b.make_geometry()
# ----------------------------------------
code_block_6 = CodeBlock { 10000; 10000; -5000; }
byLengths = Cuboid.ByLengths(width=code_block_6.out0, length=code_block_6.out1, height=code_block_6.out2)
code_block_7 = CodeBlock { -2500; }
translate = Geometry.Translate(geometry=byLengths, zTranslation=code_block_7)
code_block_8 = CodeBlock { 10000; 5000; 10000; }
byLengths_2 = Cuboid.ByLengths(width=code_block_8.out0, length=code_block_8.out1, height=code_block_8.out2)
code_block_9 = CodeBlock { 2500; }
translate_2 = Geometry.Translate(geometry=byLengths_2, yTranslation=code_block_9)
union = Solid.Union(solid=translate, solid_2=translate_2)
difference = Solid.Difference(solid=single_instance_of_concrete_dome, other=union)
code_block_10 = CodeBlock { 0; 0; 0; }
byCoordinates_4 = Point.ByCoordinates(x=code_block_10.out0, y=code_block_10.out1, z=code_block_10.out2)
byCenterPointRadius = Sphere.ByCenterPointRadius(centerPoint=byCoordinates_4, radius=code_block_5.out1)
difference_2 = Solid.Difference(solid=difference, other=byCenterPointRadius)
code_block_11 = CodeBlock { 3000; -4000; 1000; }
byCoordinates_5 = Point.ByCoordinates(x=code_block_11.out0, y=code_block_11.out1, z=code_block_11.out2)
pavillion_entrance_size = DoubleSlider(2107.7, range=1500..2500 step 0.1)
byCenterPointRadius_2 = Sphere.ByCenterPointRadius(centerPoint=byCoordinates_5, radius=pavillion_entrance_size)
difference_3 = Solid.Difference(solid=difference_2, other=byCenterPointRadius_2)
code_block_12 = CodeBlock { -3000; -4000; 1000; }
byCoordinates_6 = Point.ByCoordinates(x=code_block_12.out0, y=code_block_12.out1, z=code_block_12.out2)
byCenterPointRadius_3 = Sphere.ByCenterPointRadius(centerPoint=byCoordinates_6, radius=pavillion_entrance_size)
difference_4 = Solid.Difference(solid=difference_3, other=byCenterPointRadius_3)
volume = Solid.Volume(solid=difference_4)
material_volume_of_concrete = Watch(volume)  # "Material Volume of Concrete domes (mm^2)"
wave_pavillion = Cylinder.ByPointsRadius()
volume_2 = Solid.Volume(solid=wave_pavillion)
material_volume_of_wave = Watch(volume_2)  # "Material Volume of Wave Pavillion"
code_block_13 = CodeBlock { 5000; 0; }
byCoordinates_7 = Point.ByCoordinates(x=code_block_13.out0, y=code_block_13.out1)
code_block_14 = CodeBlock { 5000; 5000; }
byCoordinates_8 = Point.ByCoordinates(y=code_block_14.out0, z=code_block_14.out1)
code_block_15 = CodeBlock { -5000; 2000; }
byCoordinates_9 = Point.ByCoordinates(x=code_block_15.out0, y=code_block_15.out1)
byThreePoints = Arc.ByThreePoints(firstPoint=byCoordinates_7, secondPoint=byCoordinates_8, thirdPoint=byCoordinates_9)
code_block_16 = CodeBlock { 0..1..#50; }
pointAtParameter = Curve.PointAtParameter(curve=byThreePoints, param=code_block_16)
wave_pavillion_roof_curvature = DoubleSlider(56.2, range=0..100 step 0.1)
code_block_17 = CodeBlock(n=wave_pavillion_roof_curvature) { a=0..45*n..#50; z=1000+1000*Math.Cos(a); }
translate_3 = Geometry.Translate(geometry=pointAtParameter, zTranslation=code_block_17.z)
byControlPoints = NurbsCurve.ByControlPoints(points=translate_3)
code_block_18 = CodeBlock { 0..1..#2000; }
pointAtParameter_2 = Curve.PointAtParameter(curve=byControlPoints, param=code_block_18)
byCoordinates_10 = Point.ByCoordinates(x=code_block_5.S)
byCoordinates_11 = Point.ByCoordinates(z=code_block_5.out1)
byCoordinates_12 = Point.ByCoordinates(x=code_block_5.out2)
byThreePoints_2 = Arc.ByThreePoints(firstPoint=byCoordinates_10, secondPoint=byCoordinates_11, thirdPoint=byCoordinates_12)
pointAtParameter_3 = Curve.PointAtParameter(curve=byThreePoints_2, param=code_block_18)
thickness_of_wave_pavillion = DoubleSlider(100, range=0..100 step 0.1)
wave_pavillion_2 = Python()  # CPython3; unwired: IN[0]
# ---------- wave_pavillion_2.python (18 lines) ----------
import clr
clr.AddReference('ProtoGeometry')
from Autodesk.DesignScript.Geometry import *

class CircularRod:
    def __init__(self, bottom_point, top_point, radius):
        self.bottom = bottom_point
        self.top = top_point
        self.radius = radius

    def make_geometry(self):
        return Cylinder.ByPointsRadius(self.bottom, self.top, self.radius)
    def volume(self):
        # ensure geometry exists
        if not self.geom:
            self.make_geometry()
        return self.geom.Volume
OUT = CircularRod
# ----------------------------------------
series_of_instances_of_wave = Python(IN[0]=pointAtParameter_2, IN[1]=pointAtParameter_3, IN[2]=thickness_of_wave_pavillion, IN[3]=wave_pavillion_2)  # "Series of Instances of Wave Pavillion"; CPython3
# ---------- series_of_instances_of_wave.python (25 lines) ----------
# IN[0] = list of bottom points
# IN[1] = list of top points
# IN[2] = list of radii
# IN[3] = class CircularRod from Box #1

CircularRod = IN[3]
bottom_points = IN[0]
top_points = IN[1]
radii = IN[2]

if isinstance(radii, (int, float)):
    radii = [radii] * len(bottom_points)
rods = []
count = min(len(bottom_points), len(top_points))

for i in range(count):
  
    r = radii[i]
    btm = bottom_points[i]
    top = top_points[i]
    
    rod = CircularRod(btm, top, r)
    rods.append(rod.make_geometry())

OUT = rods
# ----------------------------------------
code_block_19 = CodeBlock {  }
