# Dynamo graph 1856953.dyn (Dynamo 3.6.0.9395)

# group: Don't touch this ground
code_block = CodeBlock { -5000; -5000; -200; }
byCoordinates = Point.ByCoordinates(x=code_block.out0, y=code_block.out1, z=code_block.out2)
code_block_2 = CodeBlock { 5000; 5000; 0; }
byCoordinates_2 = Point.ByCoordinates(x=code_block_2.out0, y=code_block_2.out1, z=code_block_2.out2)
byCorners = Cuboid.ByCorners(lowPoint=byCoordinates, highPoint=byCoordinates_2)
code_block_3 = CodeBlock { 0; 100; 0; }
byARGB = Color.ByARGB(red=code_block_3.out0, green=code_block_3.out1, blue=code_block_3.out2)
byGeometryColor = Modifiers.GeometryColor.ByGeometryColor(geometry=byCorners, color=byARGB)

cylindricalsteel_rod = Python()  # CPython3; unwired: IN[0]
# ---------- cylindricalsteel_rod.python (24 lines) ----------
# Load the Python Standard and DesignScript Libraries
import sys
import clr
clr.AddReference('ProtoGeometry')
from Autodesk.DesignScript.Geometry import *
import math

class CircularSteel:
    def __init__(self, centerline, radius):
        self.centerline = centerline
        self.radius = radius
        
    def endpoints(self):
        return self.centerline.StartPoint, self.centerline.EndPoint
        
    def make_geometry(self):
        end1, end2 = self.endpoints()
        
        return Cylinder.ByPointsRadius(end1,end2,self.radius)
        
    def measure_volume(self):
        end1, end2 = self.endpoints()
        return end1.DistanceTo(end2)*self.radius*self.radius*math.pi
OUT = CircularSteel
# ----------------------------------------
max_height_roof = DoubleSlider(2500, range=1000..5000 step 0.1)
point2 = CodeBlock(n=max_height_roof) { 5000; -5000; n; }
byCoordinates_3 = Point.ByCoordinates(x=point2.out0, y=point2.out1, z=point2.n)
max_height_of_the_the_pyramid = DoubleSlider(5000, range=3000..10000 step 0.1)  # "Max Height of the the pyramid and wood centre"
top_point = CodeBlock(n=max_height_of_the_the_pyramid) { 0; 0; n; }
byCoordinates_4 = Point.ByCoordinates(x=top_point.out0, y=top_point.out1, z=top_point.n)
byStartPointEndPoint = Line.ByStartPointEndPoint(startPoint=byCoordinates_3, endPoint=byCoordinates_4)
radius_steel_and_wood_cylinder = DoubleSlider(100, range=0..5000 step 50)
diagonal_roof_cylinder = Python(IN[0]=cylindricalsteel_rod, IN[1]=byStartPointEndPoint, IN[2]=radius_steel_and_wood_cylinder)  # CPython3
# ---------- diagonal_roof_cylinder.python (4 lines) ----------
CircularSteel = IN[0]
bottomSteel = CircularSteel(IN[1],IN[2])

OUT = [bottomSteel.make_geometry(), bottomSteel.measure_volume()]
# ----------------------------------------
point1 = CodeBlock(n=max_height_roof) { -5000; -5000; n; }
byCoordinates_5 = Point.ByCoordinates(x=point1.out0, y=point1.out1, z=point1.n)
byStartPointEndPoint_2 = Line.ByStartPointEndPoint(startPoint=byCoordinates_5, endPoint=byCoordinates_4)
diagonal_roof_cylinder_2 = Python(IN[0]=cylindricalsteel_rod, IN[1]=byStartPointEndPoint_2, IN[2]=radius_steel_and_wood_cylinder)  # CPython3; same code as diagonal_roof_cylinder
point3 = CodeBlock(n=max_height_roof) { 5000; 5000; n; }
byCoordinates_6 = Point.ByCoordinates(x=point3.out0, y=point3.out1, z=point3.n)
byStartPointEndPoint_3 = Line.ByStartPointEndPoint(startPoint=byCoordinates_6, endPoint=byCoordinates_4)
diagonal_roof_cylinder_3 = Python(IN[0]=cylindricalsteel_rod, IN[1]=byStartPointEndPoint_3, IN[2]=radius_steel_and_wood_cylinder)  # CPython3; same code as diagonal_roof_cylinder
point4 = CodeBlock(n=max_height_roof) { -5000; 5000; n; }
byCoordinates_7 = Point.ByCoordinates(x=point4.out0, y=point4.out1, z=point4.n)
byStartPointEndPoint_4 = Line.ByStartPointEndPoint(startPoint=byCoordinates_7, endPoint=byCoordinates_4)
diagonal_roof_cylinder_4 = Python(IN[0]=cylindricalsteel_rod, IN[1]=byStartPointEndPoint_4, IN[2]=radius_steel_and_wood_cylinder)  # CPython3; same code as diagonal_roof_cylinder
woodenCenterPillar = Python()  # CPython3; unwired: IN[0]
# ---------- woodenCenterPillar.python (24 lines) ----------
# Load the Python Standard and DesignScript Libraries
import sys
import clr
clr.AddReference('ProtoGeometry')
from Autodesk.DesignScript.Geometry import *
import math

class CircularWood:
    def __init__(self, centerline, radius):
        self.centerline = centerline
        self.radius = radius
        
    def endpoints(self):
        return self.centerline.StartPoint, self.centerline.EndPoint
        
    def make_geometry(self):
        end1, end2 = self.endpoints()
        
        return Cylinder.ByPointsRadius(end1,end2,self.radius)
        
    def measure_volume(self):
        end1, end2 = self.endpoints()
        return end1.DistanceTo(end2)*self.radius*self.radius*math.pi
OUT = CircularWood
# ----------------------------------------
code_block_4 = CodeBlock { 0; 0; 0; }
byCoordinates_8 = Point.ByCoordinates(x=code_block_4.out0, y=code_block_4.out1, z=code_block_4.out2)
byStartPointEndPoint_5 = Line.ByStartPointEndPoint(startPoint=byCoordinates_8, endPoint=byCoordinates_4)
center_wooden_beam = Python(IN[0]=woodenCenterPillar, IN[1]=byStartPointEndPoint_5, IN[2]=radius_steel_and_wood_cylinder)  # CPython3
# ---------- center_wooden_beam.python (4 lines) ----------
CircularWood = IN[0]
bottomSteel = CircularWood(IN[1],IN[2])

OUT = [bottomSteel.make_geometry(), bottomSteel.measure_volume()]
# ----------------------------------------
number_of_roof_cylinders = DoubleSlider(100, range=0..100 step 1)
code_block_5 = CodeBlock(n=number_of_roof_cylinders) { n; 0..1..#n; }
pointAtParameter = Curve.PointAtParameter(curve=byStartPointEndPoint_2, param=code_block_5.out1)
pointAtParameter_2 = Curve.PointAtParameter(curve=byStartPointEndPoint, param=code_block_5.out1)
pointAtParameter_3 = Curve.PointAtParameter(curve=byStartPointEndPoint_3, param=code_block_5.out1)
pointAtParameter_4 = Curve.PointAtParameter(curve=byStartPointEndPoint_4, param=code_block_5.out1)
radius_of_smaller_sylinder = DoubleSlider(121.2, range=0..10000 step 0.1)
circularGlass = Python()  # CPython3; unwired: IN[0]
# ---------- circularGlass.python (24 lines) ----------
# Load the Python Standard and DesignScript Libraries
import sys
import clr
clr.AddReference('ProtoGeometry')
from Autodesk.DesignScript.Geometry import *
import math

class CircularGlass:
    def __init__(self, centerline, radius):
        self.centerline = centerline
        self.radius = radius
        
    def endpoints(self):
        return self.centerline.StartPoint, self.centerline.EndPoint
        
    def make_geometry(self):
        end1, end2 = self.endpoints()
        
        return Cylinder.ByPointsRadius(end1,end2,self.radius)
        
    def measure_volume(self):
        end1, end2 = self.endpoints()
        return end1.DistanceTo(end2)*self.radius*self.radius*math.pi
OUT = CircularGlass
# ----------------------------------------
face_of_roof = Python(IN[0]=pointAtParameter_3, IN[1]=pointAtParameter_4, IN[2]=radius_of_smaller_sylinder, IN[3]=circularGlass)  # CPython3
# ---------- face_of_roof.python (35 lines) ----------
import clr
clr.AddReference('ProtoGeometry')
from Autodesk.DesignScript.Geometry import Line

CircularGlass = IN[3]
line1_points = IN[0]
line2_points = IN[1]
radius_input = IN[2]

if not isinstance(line1_points, list):
    line1_points = [line1_points]
if not isinstance(line2_points, list):
    line2_points = [line2_points]

if isinstance(radius_input, list):
    radius_list = radius_input
else:
    radius_list = [radius_input] * max(len(line1_points), len(line2_points))

rods = []
count = min(len(line1_points), len(line2_points), len(radius_list))

for i in range(count):
    p1 = line1_points[i]
    p2 = line2_points[i]
    r = radius_list[i]

    if p1.DistanceTo(p2) < 1e-6:
        continue

    centerline = Line.ByStartPointEndPoint(p1, p2)
    rod = CircularGlass(centerline, r)
    rods.append(rod.make_geometry())

OUT = rods
# ----------------------------------------
watch = Watch()  # unwired: arg0
pointAtParameter_5 = Curve.PointAtParameter(curve=byStartPointEndPoint, param=code_block_5.out1)
pointAtParameter_6 = Curve.PointAtParameter(curve=byStartPointEndPoint_3, param=code_block_5.out1)
face_of_roof_2 = Python(IN[0]=pointAtParameter_5, IN[1]=pointAtParameter_6, IN[2]=number_of_roof_cylinders, IN[3]=circularGlass)  # CPython3; same code as face_of_roof
pointAtParameter_7 = Curve.PointAtParameter(curve=byStartPointEndPoint_2, param=code_block_5.out1)
pointAtParameter_8 = Curve.PointAtParameter(curve=byStartPointEndPoint, param=code_block_5.out1)
face_of_roof_3 = Python(IN[0]=pointAtParameter_7, IN[1]=pointAtParameter_8, IN[2]=number_of_roof_cylinders, IN[3]=circularGlass)  # CPython3; same code as face_of_roof
pointAtParameter_9 = Curve.PointAtParameter(curve=byStartPointEndPoint_2, param=code_block_5.out1)
pointAtParameter_10 = Curve.PointAtParameter(curve=byStartPointEndPoint_4, param=code_block_5.out1)
face_of_roof_4 = Python(IN[0]=pointAtParameter_9, IN[1]=pointAtParameter_10, IN[2]=radius_of_smaller_sylinder, IN[3]=circularGlass)  # CPython3; same code as face_of_roof
code_block_6 = CodeBlock { -5000; -5000; 0; }
byCoordinates_9 = Point.ByCoordinates(x=code_block_6.out0, y=code_block_6.out1, z=code_block_6.out2)
byStartPointEndPoint_6 = Line.ByStartPointEndPoint(startPoint=byCoordinates_9, endPoint=byCoordinates_5)
base_cylinder = Python(IN[0]=cylindricalsteel_rod, IN[1]=byStartPointEndPoint_6, IN[2]=radius_steel_and_wood_cylinder)  # CPython3; same code as diagonal_roof_cylinder
code_block_7 = CodeBlock { 5000; -5000; 0; }
byCoordinates_10 = Point.ByCoordinates(x=code_block_7.out0, y=code_block_7.out1, z=code_block_7.out2)
byStartPointEndPoint_7 = Line.ByStartPointEndPoint(startPoint=byCoordinates_10, endPoint=byCoordinates_3)
base_cylinder_2 = Python(IN[0]=cylindricalsteel_rod, IN[1]=byStartPointEndPoint_7, IN[2]=radius_steel_and_wood_cylinder)  # CPython3; same code as diagonal_roof_cylinder
code_block_8 = CodeBlock { -5000; 5000; 0; }
byCoordinates_11 = Point.ByCoordinates(x=code_block_8.out0, y=code_block_8.out1, z=code_block_8.out2)
byStartPointEndPoint_8 = Line.ByStartPointEndPoint(startPoint=byCoordinates_7, endPoint=byCoordinates_11)
base_cylinder_3 = Python(IN[0]=cylindricalsteel_rod, IN[1]=byStartPointEndPoint_8, IN[2]=radius_steel_and_wood_cylinder)  # CPython3; same code as diagonal_roof_cylinder
code_block_9 = CodeBlock { 5000; 5000; 0; }
byCoordinates_12 = Point.ByCoordinates(x=code_block_9.out0, y=code_block_9.out1, z=code_block_9.out2)
byStartPointEndPoint_9 = Line.ByStartPointEndPoint(startPoint=byCoordinates_12, endPoint=byCoordinates_6)
base_cylinder_4 = Python(IN[0]=cylindricalsteel_rod, IN[1]=byStartPointEndPoint_9, IN[2]=radius_steel_and_wood_cylinder)  # CPython3; same code as diagonal_roof_cylinder
