# Dynamo graph 1857314.dyn "Pavillion" (Dynamo 3.6.0.9395)

# group: Base
code_block = CodeBlock { -5000; -5000; -200; }
byCoordinates = Point.ByCoordinates(x=code_block.out0, y=code_block.out1, z=code_block.out2)
code_block_2 = CodeBlock { 5000; 5000; 0; }
byCoordinates_2 = Point.ByCoordinates(x=code_block_2.out0, y=code_block_2.out1, z=code_block_2.out2)
byCorners = Cuboid.ByCorners(lowPoint=byCoordinates, highPoint=byCoordinates_2)
code_block_3 = CodeBlock { 0; 100; 0; }
byARGB = Color.ByARGB(red=code_block_3.out0, green=code_block_3.out1, blue=code_block_3.out2)
byGeometryColor = Modifiers.GeometryColor.ByGeometryColor(geometry=byCorners, color=byARGB)

divider_cylinders_class = Python()  # CPython3; unwired: IN[0]
# ---------- divider_cylinders_class.python (20 lines) ----------
# Load the Python Standard and DesignScript Libraries
import sys
import clr
clr.AddReference('ProtoGeometry')
from Autodesk.DesignScript.Geometry import *
import math

class Divider:
    def __init__(self, inner_point, outer_point, radius):
        self.inner = inner_point
        self.outer = outer_point
        self.radius = radius
    
    def make_geometry(self):
        return Cylinder.ByPointsRadius(self.inner, self.outer, self.radius)
        
    def find_volume(self):
        return self.inner.DistanceTo(self.outer)*self.radius*self.radius*math.pi
         
OUT = Divider
# ----------------------------------------
inner_point_x_y = CodeBlock { x=0; y=0; }
height_of_center = IntegerSlider(4500, range=500..5000 step 10)
inner_point = Point.ByCoordinates(x=inner_point_x_y.x, y=inner_point_x_y.y, z=height_of_center)
height_of_posts_edge_of_outer = DoubleSlider(2340, range=2100..4000 step 10)  # "Height of Posts (edge of outer circle)"
center_point = Point.ByCoordinates(x=inner_point_x_y.x, y=inner_point_x_y.y, z=height_of_posts_edge_of_outer)
outer_point_radius = DoubleSlider(4750, range=3500..5000 step 10)
circle_for_outer_points = Circle.ByCenterPointRadius(centerPoint=center_point, radius=outer_point_radius)
number_of_dividers = DoubleSlider(12, range=4..16 step 4)
regularPolygon = Polygon.RegularPolygon(circle=circle_for_outer_points, numberSides=number_of_dividers)
outer_points = Curve.PointsAtEqualSegmentLength(curve=regularPolygon, divisions=number_of_dividers)
divider_radius = DoubleSlider(50, range=30..150 step 1)
steel_divider_multiple_instance = Python(IN[0]=divider_cylinders_class, IN[1]=inner_point, IN[2]=outer_points, IN[3]=divider_radius)  # CPython3
# ---------- steel_divider_multiple_instance.python (11 lines) ----------
Divider = IN[0]
inner_point = IN[1]
outer_point = IN[2]
radius = IN[3]

rods = []
for i in range(len(outer_point)):
    rod = Divider(inner_point,outer_point[i],radius)
    rods.append(rod.make_geometry())

OUT = rods
# ----------------------------------------
posts_cylinders_class = Python()  # CPython3; unwired: IN[0]
# ---------- posts_cylinders_class.python (21 lines) ----------
# Load the Python Standard and DesignScript Libraries
import sys
import clr
clr.AddReference('ProtoGeometry')
from Autodesk.DesignScript.Geometry import *
import math

class Posts:
    def __init__(self, top_point, base_point, radius):
        self.top = top_point
        self.base = base_point
        self.radius = radius
        
    def make_geometry(self):
        return Cylinder.ByPointsRadius(self.top, self.base, self.radius)
        
    def find_volume(self):
        return self.top.DistanceTo(self.base)*self.radius*self.radius*math.pi
       
        
OUT = Posts     
# ----------------------------------------
ZAxis = Vector.ZAxis()
flip_height_to_be_down = CodeBlock(IN=height_of_posts_edge_of_outer) { height = IN; new = height*(-1); }
base_points = Geometry.Translate(geometry=outer_points, direction=ZAxis, distance=flip_height_to_be_down.new)
steel_posts_multiple_instance = Python(IN[0]=posts_cylinders_class, IN[1]=outer_points, IN[2]=base_points, IN[3]=divider_radius)  # CPython3
# ---------- steel_posts_multiple_instance.python (12 lines) ----------
Posts = IN[0]
top_point = IN[1]
base_point = IN[2]
radius = IN[3]

posts = []
for i in range(len(top_point)):
    post = Posts(top_point[i],base_point[i],radius)
    posts.append(post.make_geometry())
    
OUT = posts
  
# ----------------------------------------

# group: Steel Post Volume
steel_post_volume = Python(IN[0]=posts_cylinders_class, IN[1]=outer_points, IN[2]=base_points, IN[3]=divider_radius)  # CPython3
# ---------- steel_post_volume.python (11 lines) ----------
Posts = IN[0]
top_point = IN[1]
base_point = IN[2]
radius = IN[3]

vol = 0
for i in range(len(top_point)):
    post = Posts(top_point[i], base_point[i], radius)
    vol = vol + post.find_volume()
    
OUT = vol
# ----------------------------------------
steel_post_volume_mm_3 = Watch(steel_post_volume)

# group: Steel Divider Volume
steel_divider_volume = Python(IN[0]=divider_cylinders_class, IN[1]=inner_point, IN[2]=outer_points, IN[3]=divider_radius)  # CPython3
# ---------- steel_divider_volume.python (11 lines) ----------
Divider = IN[0]
inner_point = IN[1]
outer_point = IN[2]
radius = IN[3]

vol = 0
for i in range(len(outer_point)):
    rod = Divider(outer_point[i], inner_point, radius)
    vol = vol + rod.find_volume()
    
OUT = vol
# ----------------------------------------
steel_divider_volume_mm_3 = Watch(steel_divider_volume)

start_points = Python(IN[0]=outer_points)  # CPython3
# ---------- start_points.python (6 lines) ----------
end_points = IN[0]
end_points.append(end_points[0])
end = end_points.remove(end_points[0])


OUT = end_points
# ----------------------------------------
profile_for_solid_arcs = Circle.ByCenterPointRadius(centerPoint=start_points, radius=divider_radius)
code_block_4 = CodeBlock { x=0; y=0; z=0; }
origin = Point.ByCoordinates(x=code_block_4.x, y=code_block_4.y, z=code_block_4.z)
ZAxis_2 = Vector.ZAxis()
code_block_5 = CodeBlock(IN=number_of_dividers) { num_dividers = IN; degrees = 360/num_dividers/2; }
rotate = Geometry.Rotate(geometry=regularPolygon, origin=origin, axis=ZAxis_2, degrees=code_block_5.degrees)
center_points = Curve.PointsAtEqualSegmentLength(curve=rotate, divisions=number_of_dividers)
code_block_6 = CodeBlock { x=0; y=0; z=1064; }
height_of_arcs = DoubleSlider(1000, range=10..1300 step 1)
byCoordinates_3 = Vector.ByCoordinates(x=code_block_6.x, y=code_block_6.y, z=height_of_arcs)
height_to_midpoint_of_arc = Geometry.Translate(geometry=center_points, direction=byCoordinates_3)
byThreePoints = Arc.ByThreePoints(firstPoint=start_points, secondPoint=height_to_midpoint_of_arc, thirdPoint=outer_points)
solid_arcs = Solid.BySweep(profile=profile_for_solid_arcs, path=byThreePoints)

# group: Steel Arc Volume
volume = Solid.Volume(solid=solid_arcs)
sum = Math.Sum(values=volume)
steel_arcs_volume_mm_3 = Watch(sum)

start_point_line_in_to_out = Line.ByStartPointEndPoint(startPoint=inner_point, endPoint=start_points)
code_block_7 = CodeBlock { x=10; }
series_of_arc_starts = Curve.PointsAtEqualSegmentLength(curve=start_point_line_in_to_out, divisions=code_block_7)
tip_of_arcs = Line.ByStartPointEndPoint(startPoint=inner_point, endPoint=height_to_midpoint_of_arc)
series_of_arc_midpoints = Curve.PointsAtEqualSegmentLength(curve=tip_of_arcs, divisions=code_block_7)
end_point_line_in_to_out = Line.ByStartPointEndPoint(startPoint=inner_point, endPoint=outer_points)
series_of_arc_ends = Curve.PointsAtEqualSegmentLength(curve=end_point_line_in_to_out, divisions=code_block_7)
series_of_arcs = Arc.ByThreePoints(firstPoint=series_of_arc_starts, secondPoint=series_of_arc_midpoints, thirdPoint=series_of_arc_ends)
surface_connecting_arcs = Surface.ByLoft(crossSections=series_of_arcs)
thicken = Surface.Thicken(surface=surface_connecting_arcs, thickness=divider_radius)

# group: Stained Glass Volume
volume_2 = Solid.Volume(solid=thicken)
sum_2 = Math.Sum(values=volume_2)
stained_glass_volume_mm_3 = Watch(sum_2)

# group: Total Steel Volume
list_create = List.Create(item0=sum, item1=steel_divider_volume, item2=steel_post_volume)
total_steel_frame_volume = Math.Sum(values=list_create)
total_steel_volume_mm_3 = Watch(total_steel_frame_volume)

# group: Glass Colors
integer_slider = IntegerSlider(4, range=4..12 step 4)
takeEveryNthItem = List.TakeEveryNthItem(list=thicken, n=integer_slider)
code_block_8 = CodeBlock { a = 210; r =0; g =128; b =254; }
byARGB_2 = Color.ByARGB(alpha=code_block_8.a, red=code_block_8.r, green=code_block_8.g, blue=code_block_8.b)
byGeometryColor_2 = Modifiers.GeometryColor.ByGeometryColor(geometry=takeEveryNthItem, color=byARGB_2)
firstItem = List.FirstItem(list=thicken)
addItemToEnd = List.AddItemToEnd(item=firstItem, list=thicken)
code_block_9 = CodeBlock { a = 0; }
removeItemAtIndex = List.RemoveItemAtIndex(list=addItemToEnd, indices=code_block_9)
takeEveryNthItem_2 = List.TakeEveryNthItem(list=removeItemAtIndex, n=integer_slider)
code_block_10 = CodeBlock { a = 210; r =0; g =254; b =1; }
byARGB_3 = Color.ByARGB(alpha=code_block_10.a, red=code_block_10.r, green=code_block_10.g, blue=code_block_10.b)
byGeometryColor_3 = Modifiers.GeometryColor.ByGeometryColor(geometry=takeEveryNthItem_2, color=byARGB_3)
firstItem_2 = List.FirstItem(list=thicken)
addItemToEnd_2 = List.AddItemToEnd(item=firstItem_2, list=thicken)
code_block_11 = CodeBlock { a = 0; }
removeItemAtIndex_2 = List.RemoveItemAtIndex(list=addItemToEnd_2, indices=code_block_11)
firstItem_3 = List.FirstItem(list=removeItemAtIndex_2)
addItemToEnd_3 = List.AddItemToEnd(item=firstItem_3, list=removeItemAtIndex_2)
code_block_12 = CodeBlock { a = 0; }
removeItemAtIndex_3 = List.RemoveItemAtIndex(list=addItemToEnd_3, indices=code_block_12)
takeEveryNthItem_3 = List.TakeEveryNthItem(list=removeItemAtIndex_3, n=integer_slider)
code_block_13 = CodeBlock { a = 210; r =225; g =0; b =0; }
byARGB_4 = Color.ByARGB(alpha=code_block_13.a, red=code_block_13.r, green=code_block_13.g, blue=code_block_13.b)
byGeometryColor_4 = Modifiers.GeometryColor.ByGeometryColor(geometry=takeEveryNthItem_3, color=byARGB_4)
firstItem_4 = List.FirstItem(list=thicken)
addItemToEnd_4 = List.AddItemToEnd(item=firstItem_4, list=thicken)
code_block_14 = CodeBlock { a = 0; }
removeItemAtIndex_4 = List.RemoveItemAtIndex(list=addItemToEnd_4, indices=code_block_14)
firstItem_5 = List.FirstItem(list=removeItemAtIndex_4)
addItemToEnd_5 = List.AddItemToEnd(item=firstItem_5, list=removeItemAtIndex_4)
code_block_15 = CodeBlock { a = 0; }
removeItemAtIndex_5 = List.RemoveItemAtIndex(list=addItemToEnd_5, indices=code_block_15)
firstItem_6 = List.FirstItem(list=removeItemAtIndex_5)
addItemToEnd_6 = List.AddItemToEnd(item=firstItem_6, list=removeItemAtIndex_5)
code_block_16 = CodeBlock { a = 0; }
removeItemAtIndex_6 = List.RemoveItemAtIndex(list=addItemToEnd_6, indices=code_block_16)
takeEveryNthItem_4 = List.TakeEveryNthItem(list=removeItemAtIndex_6, n=integer_slider)
code_block_17 = CodeBlock { a = 210; r =255; g =255; b =0; }
byARGB_5 = Color.ByARGB(alpha=code_block_17.a, red=code_block_17.r, green=code_block_17.g, blue=code_block_17.b)
byGeometryColor_5 = Modifiers.GeometryColor.ByGeometryColor(geometry=takeEveryNthItem_4, color=byARGB_5)
