# Dynamo graph 1857397.dyn (Dynamo 3.6.0.9395)

# group: Don't touch this ground
code_block = CodeBlock { -5000; -5000; -200; }
byCoordinates = Point.ByCoordinates(x=code_block.out0, y=code_block.out1, z=code_block.out2)
code_block_2 = CodeBlock { 5000; 5000; 0; }
byCoordinates_2 = Point.ByCoordinates(x=code_block_2.out0, y=code_block_2.out1, z=code_block_2.out2)
byCorners = Cuboid.ByCorners(lowPoint=byCoordinates, highPoint=byCoordinates_2)
code_block_3 = CodeBlock { 0; 100; 0; }
byARGB = Color.ByARGB(red=code_block_3.out0, green=code_block_3.out1, blue=code_block_3.out2)
byGeometryColor = Modifiers.GeometryColor.ByGeometryColor(geometry=byCorners, color=byARGB)

class_steel_fingers = Python()  # CPython3; unwired: IN[0]
# ---------- class_steel_fingers.python (20 lines) ----------
# Load the Python Standard and DesignScript Libraries
import sys
import clr
clr.AddReference('ProtoGeometry')
from Autodesk.DesignScript.Geometry import *
import math

class SteelFingers:
    def __init__ (self, top, bottom, radius):
        self.top = top
        self.bottom = bottom
        self.radius = radius
    
    def Fingers (self):
        return Cylinder.ByPointsRadius(self.top, self.bottom, self.radius)
        
    def Volume (self):
        return (self.top*math.pi*radius**2)
    
OUT = SteelFingers
# ----------------------------------------
code_block_4 = CodeBlock { 0; -5000; 0; }
byCoordinates_3 = Point.ByCoordinates(x=code_block_4.out0, y=code_block_4.out1, z=code_block_4.out2)
code_block_5 = CodeBlock { -5000; 0; 2500; }
byCoordinates_4 = Point.ByCoordinates(x=code_block_5.out0, y=code_block_5.out1, z=code_block_5.out2)
code_block_6 = CodeBlock { 0; 5000; 0; }
byCoordinates_5 = Point.ByCoordinates(x=code_block_6.out0, y=code_block_6.out1, z=code_block_6.out2)
veritcal_negative_arc = Arc.ByThreePoints(firstPoint=byCoordinates_3, secondPoint=byCoordinates_4, thirdPoint=byCoordinates_5)
number_of_fingers = DoubleSlider(7, range=0..100 step 1)
code_block_7 = CodeBlock(n=number_of_fingers) { n; 0..1..#n+1; }
short_finger_top_points = Curve.PointAtParameter(curve=veritcal_negative_arc, param=code_block_7.out1)
watch = Watch(short_finger_top_points)
code_block_8 = CodeBlock { 0; }
removeItemAtIndex = List.RemoveItemAtIndex(list=watch, indices=code_block_8)
code_block_9 = CodeBlock(i=number_of_fingers) { i-1; }
short_fingers_top_points_updated = List.RemoveItemAtIndex(list=removeItemAtIndex, indices=code_block_9)
bottom_curve_minimum_x = DoubleSlider(-2500, range=-2500..0 step 100)
code_block_10 = CodeBlock(x=bottom_curve_minimum_x) { x; 0; 0; }
byCoordinates_6 = Point.ByCoordinates(x=code_block_10.x, y=code_block_10.out1, z=code_block_10.out2)
flat_negative_arc = Arc.ByThreePoints(firstPoint=byCoordinates_3, secondPoint=byCoordinates_6, thirdPoint=byCoordinates_5)
short_finger_bottom_point = Curve.PointAtParameter(curve=flat_negative_arc, param=code_block_7.out1)
watch_2 = Watch(short_finger_bottom_point)
removeItemAtIndex_2 = List.RemoveItemAtIndex(list=watch_2, indices=code_block_8)
short_fingers_bottom_points = List.RemoveItemAtIndex(list=removeItemAtIndex_2, indices=code_block_9)  # "Short Fingers Bottom Points Updated"
watch_3 = Watch(short_fingers_bottom_points)
radius_of_fingers = DoubleSlider(250, range=0..250 step 1)
series_of_instances_of_shorter = Python(IN[0]=class_steel_fingers, IN[1]=short_fingers_top_points_updated, IN[2]=watch_3, IN[3]=radius_of_fingers, IN[4]=code_block_7.n)  # "Series of Instances of Shorter Steel Fingers"; CPython3
# ---------- series_of_instances_of_shorter.python (22 lines) ----------
SteelFingers = IN[0]

#IN[1] is top points
#IN[2] is bottom points
#IN[3] is radius
top_points_list = IN[1]
bottom_points_list = IN[2]
radius = IN[3]
n = IN[4]
x = n-1
single_fingers = []

for i in range(int(x)):
    
    
    top_point = top_points_list[i]
    bottom_point = bottom_points_list[i]
    radius = radius
    
    finger = SteelFingers(top_point, bottom_point, radius)
    single_fingers.append(finger.Fingers())
OUT = single_fingers
# ----------------------------------------
code_block_11 = CodeBlock { 5000; 0; 5000; }
byCoordinates_7 = Point.ByCoordinates(x=code_block_11.out0, y=code_block_11.out1, z=code_block_11.out2)
vertical_positive_arc = Arc.ByThreePoints(firstPoint=byCoordinates_3, secondPoint=byCoordinates_7, thirdPoint=byCoordinates_5)
tall_finger_top_points = Curve.PointAtParameter(curve=vertical_positive_arc, param=code_block_7.out1)
watch_4 = Watch(tall_finger_top_points)
removeItemAtIndex_3 = List.RemoveItemAtIndex(list=watch_4, indices=code_block_8)
tall_fingers_top_points_updated = List.RemoveItemAtIndex(list=removeItemAtIndex_3, indices=code_block_9)
bottom_curve_maximum_x = DoubleSlider(2500, range=0..2500 step 100)
code_block_12 = CodeBlock(x=bottom_curve_maximum_x) { x; 0; 0; }
byCoordinates_8 = Point.ByCoordinates(x=code_block_12.x, y=code_block_12.out1, z=code_block_12.out2)
flat_positive_arc = Arc.ByThreePoints(firstPoint=byCoordinates_3, secondPoint=byCoordinates_8, thirdPoint=byCoordinates_5)
tall_finger_bottom_point = Curve.PointAtParameter(curve=flat_positive_arc, param=code_block_7.out1)
watch_5 = Watch(tall_finger_bottom_point)
removeItemAtIndex_4 = List.RemoveItemAtIndex(list=watch_5, indices=code_block_8)
tall_fingers_bottom_points = List.RemoveItemAtIndex(list=removeItemAtIndex_4, indices=code_block_9)  # "Tall Fingers Bottom Points Updated"
series_of_instances_of_taller = Python(IN[0]=class_steel_fingers, IN[1]=tall_fingers_top_points_updated, IN[2]=tall_fingers_bottom_points, IN[3]=radius_of_fingers, IN[4]=code_block_7.n)  # "Series of Instances of Taller Steel Fingers"; CPython3
# ---------- series_of_instances_of_taller.python (17 lines) ----------
SteelFingers = IN[0]
top_points_list = IN[1]
bottom_points_list = IN[2]
radius = IN[3]
n = IN[4]
x = n-1
single_fingers = []

for i in range(int(x)):
    
    top_point = top_points_list[i]
    bottom_point = bottom_points_list[i]
    radius = radius
    
    finger = SteelFingers(top_point, bottom_point, radius)
    single_fingers.append(finger.Fingers())
OUT = single_fingers
# ----------------------------------------
class_wooden_stairs = Python()  # CPython3; unwired: IN[0]
# ---------- class_wooden_stairs.python (24 lines) ----------
# Load the Python Standard and DesignScript Libraries
import sys
import clr
clr.AddReference('ProtoGeometry')
from Autodesk.DesignScript.Geometry import *

class WoodenStairs:
    def __init__ (self, bottom_corner, top_corner):
        self.bottom_corner = bottom_corner
        self.top_corner = top_corner
        
    def Stairs(self):
        return Cuboid.ByCorners(self.bottom_corner, self.top_corner)
        
    def Volume(self, length, width, thickness,number_of_stairs):
        self.length = length
        self. width = width
        self.thickness = thickness
        self.number_of_stairs = n
    
        return(self.length*self.width*self.thickness*self.number_of_stairs)
    
    
OUT = WoodenStairs
# ----------------------------------------
code_block_13 = CodeBlock { -5000; 5000; 2500; }
byCoordinates_9 = Point.ByCoordinates(x=code_block_13.out0, y=code_block_13.out1, z=code_block_13.out2)
code_block_14 = CodeBlock { 5000; 5000; 5000; }
byCoordinates_10 = Point.ByCoordinates(x=code_block_14.out0, y=code_block_14.out1, z=code_block_14.out2)
positive_y_line = Line.ByStartPointEndPoint(startPoint=byCoordinates_9, endPoint=byCoordinates_10)
number_of_stairs = DoubleSlider(10, range=0..100 step 1)
code_block_15 = CodeBlock(n=number_of_stairs) { n; 0..1..#n+1; n; }
pointAtParameter = Curve.PointAtParameter(curve=positive_y_line, param=code_block_15.out1)
code_block_16 = CodeBlock { 0; }
top_corner_list = List.RemoveItemAtIndex(list=pointAtParameter, indices=code_block_16)
code_block_17 = CodeBlock { -5000; -5000; 2500; }
byCoordinates_11 = Point.ByCoordinates(x=code_block_17.out0, y=code_block_17.out1, z=code_block_17.out2)
code_block_18 = CodeBlock { 5000; -5000; 5000; }
byCoordinates_12 = Point.ByCoordinates(x=code_block_18.out0, y=code_block_18.out1, z=code_block_18.out2)
negative_y_line = Line.ByStartPointEndPoint(startPoint=byCoordinates_11, endPoint=byCoordinates_12)
pointAtParameter_2 = Curve.PointAtParameter(curve=negative_y_line, param=code_block_15.out1)
bottom_corner_list = List.RemoveItemAtIndex(list=pointAtParameter_2, indices=code_block_15.out2)
series_of_instances_of_wooden = Python(IN[0]=class_wooden_stairs, IN[1]=top_corner_list, IN[2]=bottom_corner_list, IN[3]=code_block_15.out0)  # "Series of Instances of Wooden Stairs"; CPython3
# ---------- series_of_instances_of_wooden.python (15 lines) ----------
WoodenStairs = IN[0]
top_corner_list = IN[1]
bottom_corner_list = IN[2]
n = IN[3]
single_stair = []

for i in range(int(n)):
    top_corner = top_corner_list[i]
    bottom_corner = bottom_corner_list[i]
    
    stair = WoodenStairs(bottom_corner, top_corner)
    
    single_stair.append(stair.Stairs())
    
OUT = single_stair
# ----------------------------------------
watch_6 = Watch(top_corner_list)
watch_7 = Watch(bottom_corner_list)
