# Dynamo graph 1857564.dyn (Dynamo 3.6.0.9395)

# group: Don't touch this ground
code_block = CodeBlock { -5000; -5000; -200; }
byCoordinates = Point.ByCoordinates(x=code_block.out0, y=code_block.out1, z=code_block.out2)
code_block_2 = CodeBlock { 5000; 5000; 0; }
byCoordinates_2 = Point.ByCoordinates(x=code_block_2.out0, y=code_block_2.out1, z=code_block_2.out2)
byCorners = Cuboid.ByCorners(lowPoint=byCoordinates, highPoint=byCoordinates_2)
code_block_3 = CodeBlock { 0; 100; 0; }
byARGB = Color.ByARGB(red=code_block_3.out0, green=code_block_3.out1, blue=code_block_3.out2)
byGeometryColor = Modifiers.GeometryColor.ByGeometryColor(geometry=byCorners, color=byARGB)

# group: Roof Controls
# they are all wired up, but the wires are hidden to reduce clutter
roof_height_side = DoubleSlider(4100, range=0..7000 step 100)
roof_peak_height_difference = DoubleSlider(1700, range=200..2500 step 100)
roof_dimensions_square = IntegerSlider(7600, range=7000..10000 step 200)
roof_beam_width = DoubleSlider(350, range=150..800 step 10)

# group: Column and Crossbeam Controls
# all wired up, invisibly
roof_support_column_length_they = DoubleSlider(300, range=50..300 step 10)  # "Roof Support Column length (they are twice as wide)"
roof_support_column_wall = DoubleSlider(20, range=-1..200 step 1)  # "Roof Support Column wall thickness (it's a hollow beam)"
roof_suport_column_fillet_radius = DoubleSlider(20, range=0..100 step 1)

# group: Gateway to Discovery
# all the code, hidden for cleanliness
class_constructor_concrete_u = Python()  # "Class Constructor: Concrete U Beam"; CPython3
# ---------- class_constructor_concrete_u.python (64 lines) ----------
# Load the Python Standard and DesignScript Libraries
import sys
import clr
clr.AddReference('ProtoGeometry')
from Autodesk.DesignScript.Geometry import *

# The inputs to this node will be stored as a list in the IN variables.

# Place your code below this line
class uBeam_Concrete:
    # this class is intended for roof beams, where the U shape representing university appears.
    def __init__(self,start,end,beamWidth):
               
        self.width = beamWidth
        self.startPoint = start
        self.endPoint = end
        
        self.path = PolyCurve.ByPoints([start,end]) #this will be our path to make the beam later
        
    def makeNewBeam(self,angles = (-90,90)):
        startAngle = angles[0]
        endAngle = angles[1]
        normal = Vector.ByTwoPoints(self.startPoint,self.endPoint)
        semiCircle = Arc.ByCenterPointRadiusAngle(self.startPoint,self.width,startAngle,endAngle,normal) 
        line = Line.ByStartPointEndPoint(semiCircle.StartPoint,semiCircle.EndPoint)
        closedCurve = PolyCurve.ByJoinedCurves([semiCircle,line])
        #it needs to be closed to be a solid when swept
        
        semiCylinder = Curve.SweepAsSolid(closedCurve,self.path)
        
        cutout = Cylinder.ByPointsRadius(self.startPoint,self.endPoint,self.width/2)
        
        beam = Solid.Difference(semiCylinder,cutout)
        self.solid = beam
        
    def trimPeak(self,peak):
        beam = self.solid
        try:
            trimmedBeam = beam.Difference(Cylinder.ByPointsRadius(peak.startPoint,peak.endPoint,peak.width))
            self.solid = trimmedBeam
        except:
            pass
        
    def copyBeam(self,listOfPoints):
        #it was super slow to make each beam over and over, so this will allow us to just copy it over a given list of points.
        #listOFPoints[0] is the starting point of this beam
        beamLocation = listOfPoints[0]
        beams = [self.solid]
        for point in listOfPoints:
            moveTo = Vector.ByTwoPoints(beamLocation,point)
            newBeam = Geometry.Translate(self.solid,moveTo)
            beams.append(newBeam)
        return beams
        
    def calculateVolumes(self):
        try:
            volume = Solid.Volume(beam)
            return (volume)
        except:
            error = "Error in Calculating Volume: "+repr(sys.exception())
            return 0
        
# Assign your output to the OUT variable.
OUT = uBeam_Concrete
# ----------------------------------------
data_processing = CodeBlock(t1=roof_dimensions_square, t2=roof_beam_width) { length = t1; width = t2; start = -t1/2+t2; end = t1/2-t2; xLocations = (start..end..width); xEdge = end; yEdge = t1/2; }
series_of_instances_of_ubeam = Python(uBeam_Concrete=class_constructor_concrete_u, roofHeight=roof_height_side, PeakHeight=roof_peak_height_difference, beamWidth=data_processing.width, roofWidth=roof_dimensions_square, XLocations=data_processing.xLocations)  # "series of instances of uBeam_Concrete"; CPython3
# ---------- series_of_instances_of_ubeam.python (70 lines) ----------
# Load the Python Standard and DesignScript Libraries
import sys
import clr
clr.AddReference('ProtoGeometry')
from Autodesk.DesignScript.Geometry import *

# The inputs to this node will be stored as a list in the IN variables.
uBeam_Concrete = IN[0] #class of steel beams in u shape
roofHeight = IN[1] #the height of the side of the roof. (It's an A frame)
PeakHeight = IN[2] #the DIFFERENCE  in height between the top of the A frame and the roof height
width = IN[3]/2 #the width of the beams, which will be repeated to cover the whole roof (more on this below)
roofWidth = IN[4] #width from sides of A, must be smaller than or same as ground
beamLocationsX = IN[5]
# Place your code below this line
amount = len(IN[5])
def makeInitialBeam(start,end,flip=False): 
    #turn the angle inputs into a simple boolean to flip the beam
    newBeam = uBeam_Concrete(start,end,width)
    if flip:
        newBeam.makeNewBeam((-180,0))
    else:
        newBeam.makeNewBeam((0,180))
    return newBeam
def volumeTakeOff(listOfBeams):
    volume=0
    for i in listOfBeams:
        volume=volume + i.Volume
    return volume
#is our roof length good? because I would rather not make garbage, just say that my inputs are bad.
def points():
    #make list of points
    pointsR = []
    pointsL = []
    y = roofWidth/2
    z = roofHeight
    for x in beamLocationsX:
        pointsR.append(Point.ByCoordinates(x,y,z))
        pointsL.append(Point.ByCoordinates(x,-y,z))
    return (pointsR,pointsL)

#build roof beam
def PeakBeam():
    front = Point.ByCoordinates(beamLocationsX[0]-width,0,roofHeight+PeakHeight)
    back = Point.ByCoordinates(beamLocationsX[-1]+width,0,roofHeight+PeakHeight)
    peak = uBeam_Concrete(front,back,width*2)
    peak.makeNewBeam()
    return peak

#build roof
frontTopPoint = Point.ByCoordinates(beamLocationsX[0],0,roofHeight+PeakHeight)
backTopPoint = Point.ByCoordinates(beamLocationsX[-1],0,roofHeight+PeakHeight)

peak = PeakBeam()

(pointsR,pointsL)=points()

frontBeamR = makeInitialBeam(pointsR[0],frontTopPoint,True)
frontBeamR.trimPeak(peak)

frontBeamL = makeInitialBeam(pointsL[0],frontTopPoint)
frontBeamL.trimPeak(peak)

beamsR = frontBeamR.copyBeam(pointsR)
beamsL = frontBeamL.copyBeam(pointsL)

volumeR = volumeTakeOff(beamsR)
volumeL = volumeTakeOff(beamsL)
volume = volumeR+volumeL
# Assign your output to the OUT variable.
OUT = [peak.solid,beamsR,beamsL,volume]
# ----------------------------------------
class_constructor_steel_hollow = Python()  # "Class constructor: Steel Hollow Tube"; CPython3
# ---------- class_constructor_steel_hollow.python (78 lines) ----------
# Load the Python Standard and DesignScript Libraries
import sys
import clr
clr.AddReference('ProtoGeometry')
from Autodesk.DesignScript.Geometry import *

# The inputs to this node will be stored as a list in the IN variables

# Place your code below this line
class hollowTube:
    def __init__(self,startPoints,x,y,height,thick=10,fillet_radius=0):
        self.locations = startPoints
        self.width = x
        self.length = y
        self.height = height
        self.fillet=fillet_radius
        self.thickness = thick
    
    def makeTubes(self):
        def makeTubeOrigin():
            path = PolyCurve.ByPoints([Point.Origin(),Point.ByCoordinates(0,0,self.height)])
            radius = self.fillet
            if self.thickness > 1 and self.thickness<=min(self.width,self.length)/2:
                t = self.thickness*2
                outer = Rectangle.ByWidthLength(self.width,self.length)
                inner = Rectangle.ByWidthLength(self.width-t,self.length-t)
                outer = PolyCurve.Fillet(outer,radius,True)
                inner = PolyCurve.Fillet(inner,radius,True)
                box = Solid.BySweep(outer,path) 
                cutout = Solid.BySweep(inner,path)   
                tube = Solid.Difference(box,cutout)
            
            else:
                outer = Rectangle.ByWidthLength(self.width,self.length)
                outer = PolyCurve.Fillet(outer,radius,True)
                path = PolyCurve.ByPoints([Point.Origin(),Point.ByCoordinates(0,0,self.height)])
                tube = Solid.BySweep(outer,path) 
            
            try:
                self.totalVolume = tube.Volume*len(self.locations)
            except:
                self.totalVolume = 0
            self.solids = (tube)
            return tube
            
            
        def placeTubes(tube):
            tubes = []
            for point in self.locations:
                vector = point.AsVector()
                tubes.append(Geometry.Translate(tube, vector))
            self.solids = tubes
        tube = makeTubeOrigin()
        placeTubes(tube)
    
    def rotateAboutAxis(self,angle,axis='x'):
        solids = []
        if axis == 'x':
            ax = Vector.XAxis()
        elif axis == 'y':
            ax = Vector.YAxis()
        else:
            return solids #stop execution of method, invalid input
            
        solids = []
        n = len(self.locations)
        for i in range(n):
            point = self.locations[i]
            tube = self.solids[i]
            newTube = Geometry.Rotate(tube,point,ax,angle)
            solids.append(newTube)
        self.solids = solids
        return solids 

        

# Assign your output to the OUT variable.
OUT = hollowTube
# ----------------------------------------
series_of_instances_of_hollow = Python(xEdge=data_processing.xEdge, yEdge=data_processing.yEdge, length=roof_support_column_length_they, height=roof_height_side, thickness=roof_support_column_wall, fillet_radius=roof_suport_column_fillet_radius, class=class_constructor_steel_hollow)  # "series of instances of Hollow Beam"; CPython3
# ---------- series_of_instances_of_hollow.python (67 lines) ----------
import clr
clr.AddReference('ProtoGeometry')
from Autodesk.DesignScript.Geometry import *

# ----------------------
# Inputs
# ----------------------
# IN[0] → xEdge
# IN[1] → yEdge
# IN[2] → length
# IN[3] → height
# IN[4] → thickness
# IN[5] → fillet radius
# IN[6] → hollowTube class

xEdge = IN[0]
yEdge = IN[1]
length = IN[2]
height = IN[3]
thickness = IN[4]
fillet = IN[5] 
hollowTube = IN[6]


# ----------------------
# Compute beam width (2x length)
width = 2 * length
halfWidth = width / 2
halfLength = length / 2

# SW quadrant (negative X, negative Y)
q1 = Point.ByCoordinates(-xEdge + width, -yEdge + length)
# SE quadrant (positive X, negative Y)
q2 = Point.ByCoordinates(xEdge - width, -yEdge + length)
# NW quadrant (negative X, positive Y)
q3 = Point.ByCoordinates(-xEdge + width, yEdge - length)
# NE quadrant (positive X, positive Y)
q4 = Point.ByCoordinates(xEdge - width, yEdge - length)

up = Vector.ByCoordinates(0,length/2,height-length)

eastTop = Point.Add(q2,up)
westTop = Point.Add(q1,up)

placementPoints = [q1, q2, q3, q4]

# ----------------------
# Create class instance and generate tubes
# ----------------------
tubeObj = hollowTube(placementPoints, width, length, height, thickness, fillet)

tubeObj.makeTubes()   # builds tube at origin and places it at all 4 points

# -------------------------
# Create instance for cross beams
# ------------------------
crossObj = hollowTube([eastTop,westTop],width,length,(yEdge*2)-(length*3),thickness, fillet)
crossObj.makeTubes()
crossBeams = crossObj.rotateAboutAxis(-90,'x')



# ----------------------
# Output
# ----------------------
#
OUT = [tubeObj.solids,crossBeams,tubeObj.totalVolume+crossObj.totalVolume]
# ----------------------------------------
volume_takeoff = Python(IN[0]=series_of_instances_of_ubeam, IN[1]=series_of_instances_of_hollow)  # CPython3
# ---------- volume_takeoff.python (18 lines) ----------
# Load the Python Standard and DesignScript Libraries
import sys
import clr
clr.AddReference('ProtoGeometry')
from Autodesk.DesignScript.Geometry import *

# The inputs to this node will be stored as a list in the IN variables.
conc = IN[0][3]
column = IN[1][2]

# Place your code below this line

# Format the string with 2 decimal places and unit "mm²"
Concrete = "{:.2f} mm³ of Concrete".format(conc)
Steel = "{:.2f} mm³ of Steel".format(column)

# Output
OUT = Steel+"\n"+Concrete
# ----------------------------------------

volumes = Watch(volume_takeoff)
