# Dynamo graph 1857695.dyn (Dynamo 3.6.0.9395)

# group: ;) > Don't touch this ground
code_block = CodeBlock { -5000; -5000; -200; }
byCoordinates = Point.ByCoordinates(x=code_block.out0, y=code_block.out1, z=code_block.out2)
code_block_2 = CodeBlock { 5000; 5000; 0; }
byCoordinates_2 = Point.ByCoordinates(x=code_block_2.out0, y=code_block_2.out1, z=code_block_2.out2)
byCorners = Cuboid.ByCorners(lowPoint=byCoordinates, highPoint=byCoordinates_2)
code_block_3 = CodeBlock { 0; 100; 0; }
byARGB = Color.ByARGB(red=code_block_3.out0, green=code_block_3.out1, blue=code_block_3.out2)
byGeometryColor = Modifiers.GeometryColor.ByGeometryColor(geometry=byCorners, color=byARGB)

# group: CONCRETE slab class
class_concrete_slab = Python()  # CPython3; unwired: IN[0]
# ---------- class_concrete_slab.python (22 lines) ----------
# Load the Python Standard and DesignScript Libraries
import sys
import clr
clr.AddReference('ProtoGeometry')
from Autodesk.DesignScript.Geometry import *

class ConcreteSlab:
    def __init__(self, length, height):
        self.L = length
        self.h = height
    def corners(self):
        corner1 = Point.ByCoordinates(self.L/2, self.L/2, self.h/2)
        corner2 = Point.ByCoordinates(-self.L/2, -self.L/2, -self.h/2)
        return corner1, corner2
    def makeGeo(self):
        corner1, corner2 = self.corners()
        return Cuboid.ByCorners(corner1,corner2)
    def calcVol(self):
        volume = self.L**2 * self.h
        return volume
        
OUT = ConcreteSlab
# ----------------------------------------
permanent_parameters = CodeBlock { 7000; 90; }
slab_integers = Python(IN[0]=class_concrete_slab, IN[1]=permanent_parameters.out0, IN[2]=permanent_parameters.out1)  # CPython3
# ---------- slab_integers.python (8 lines) ----------
slab = IN[0]
length = IN[1]
height = IN[2]
SLAB = slab(length, height)

geometry = SLAB.makeGeo()
volume = SLAB.calcVol()
OUT = [SLAB.makeGeo(), SLAB.calcVol()]
# ----------------------------------------

# group: 4 Diffrent sliders controlling the different parameters of the pavillion
height_of_pavillion = DoubleSlider(4661.4, range=3000..5000 step 0.1)
thickness_of_beam = DoubleSlider(455, range=250..500 step 5)
number_of_pillar_supports = DoubleSlider(2, range=2..8 step 1)
change_of_grid_size = DoubleSlider(1081, range=1..1630 step 540)

# group: CONCRETE Corner beams
corner_beams_class = Python()  # CPython3; unwired: IN[0]
# ---------- corner_beams_class.python (46 lines) ----------
import sys
import clr
clr.AddReference('ProtoGeometry')
from Autodesk.DesignScript.Geometry import *

class MSCB:
    def __init__(self, footprint, blockHeight, blockSize, count):
        self.F = footprint
        self.H = blockHeight
        self.S = blockSize
        self.count = int(count)  
    def edgePoints(self):
        half = self.F / 2
        pts = []
        for i in range(self.count):
            t = i / (self.count - 1) if self.count > 1 else 0
            x = -half + t * self.F
            pts.append(Point.ByCoordinates(x, half, 0))
        for i in range(self.count):
            t = i / (self.count - 1) if self.count > 1 else 0
            x = -half + t * self.F
            pts.append(Point.ByCoordinates(x, -half, 0))
        for i in range(self.count):
            t = i / (self.count - 1) if self.count > 1 else 0
            y = -half + t * self.F
            pts.append(Point.ByCoordinates(-half, y, 0))
        for i in range(self.count):
            t = i / (self.count - 1) if self.count > 1 else 0
            y = -half + t * self.F
            pts.append(Point.ByCoordinates(half, y, 0))
        return pts
    def makeGeo(self):
        pts = self.edgePoints()
        blocks = []
        halfS = self.S / 2
        for c in pts:
            c1 = Point.ByCoordinates(c.X - halfS, c.Y - halfS, 0)
            c2 = Point.ByCoordinates(c.X + halfS, c.Y + halfS, self.H)
            block = Cuboid.ByCorners(c1, c2)
            blocks.append(block)
        return blocks
    def calcVol(self):
        totalPosts = self.count * 4
        return totalPosts * (self.S * self.S * self.H)

OUT = MSCB
# ----------------------------------------
distance_from_centre = CodeBlock { 6500; }
python_script = Python(IN[0]=corner_beams_class, IN[1]=distance_from_centre, IN[2]=height_of_pavillion, IN[3]=thickness_of_beam, IN[4]=number_of_pillar_supports)  # CPython3
# ---------- python_script.python (10 lines) ----------
Cls = IN[0]
footprint = IN[1]
blockHeight = IN[2]
blockSize = IN[3]
count = IN[4]

obj = Cls(footprint, blockHeight, blockSize, count)
geometry = obj.makeGeo()
volume = obj.calcVol()
OUT = [obj.makeGeo(), obj.calcVol()]
# ----------------------------------------

# group: STEEL Grid roof Class
grid_class = Python()  # CPython3; unwired: IN[0]
# ---------- grid_class.python (51 lines) ----------
import sys
import clr
clr.AddReference('ProtoGeometry')
from Autodesk.DesignScript.Geometry import *

class RoofGrid:
    def __init__(self, footprint, spacing, beamHeight, beamWidth, roofHeight):
        self.F = footprint
        self.S = spacing
        self.h = beamHeight
        self.w = beamWidth
        self.z = roofHeight
    def makeGeo(self):
        half = self.F / 2
        spacing = self.S
        count = int(half // spacing)
        beams = []
        for i in range(-count, count + 1):
            y = i * spacing
            p1 = Point.ByCoordinates(-half, y, self.z)
            p2 = Point.ByCoordinates( half, y, self.z)
            line = Line.ByStartPointEndPoint(p1, p2)
            beams.append(self._beamFromLine(line))
        for i in range(-count, count + 1):
            x = i * spacing
            p1 = Point.ByCoordinates(x, -half, self.z)
            p2 = Point.ByCoordinates(x,  half, self.z)
            line = Line.ByStartPointEndPoint(p1, p2)
            beams.append(self._beamFromLine(line))
        return beams
    def _beamFromLine(self, line):
        start = line.StartPoint
        end = line.EndPoint
        dx = end.X - start.X
        dy = end.Y - start.Y
        if abs(dy) < 0.001:
            corner1 = Point.ByCoordinates(start.X, start.Y - self.w/2, self.z)
            corner2 = Point.ByCoordinates(end.X,   end.Y + self.w/2, self.z + self.h)
        else:
            corner1 = Point.ByCoordinates(start.X - self.w/2, start.Y, self.z)
            corner2 = Point.ByCoordinates(end.X + self.w/2,   end.Y, self.z + self.h)
        return Cuboid.ByCorners(corner1, corner2)
    def calcVol(self):
        half = self.F / 2
        count = int(half // self.S)
        numBeams = (count * 2 + 1) * 2  
        avgLength = self.F
        return numBeams * (self.w * self.h * avgLength)


OUT = RoofGrid
# ----------------------------------------
do_no_touhc = CodeBlock { 8000; 160; 150; }
grid_integers = Python(IN[0]=grid_class, IN[1]=do_no_touhc.out0, IN[2]=change_of_grid_size, IN[3]=do_no_touhc.out1, IN[4]=do_no_touhc.out2, IN[5]=height_of_pavillion)  # CPython3
# ---------- grid_integers.python (11 lines) ----------
Cls = IN[0]
footprint = IN[1]
spacing = IN[2]
beamHeight = IN[3]
beamHalfWidth = IN[4]
pillarHeight = IN[5]

obj = Cls(footprint, spacing, beamHeight, beamHalfWidth, pillarHeight)
geometry = obj.makeGeo()
volume = obj.calcVol()
OUT = [ obj.makeGeo(), obj.calcVol() ]
# ----------------------------------------

# group: VOLUME CALCULATIONS OF TWO DIFFRENT MATERIALS
watch = Watch(slab_integers)
watch_2 = Watch(python_script)
total_volume_of_material_1 = Python(IN[0]=watch, IN[1]=watch_2)  # CPython3
# ---------- total_volume_of_material_1.python (6 lines) ----------
slabVol = IN[0]
pillarVol = IN[1]

material1_total = slabVol + pillarVol

OUT = material1_total
# ----------------------------------------
final_volume_of_concrete_in_mm_3 = Watch(total_volume_of_material_1)
watch_3 = Watch(grid_integers)
total_volume_of_material_2 = Python(IN[0]=watch_3)  # CPython3
# ---------- total_volume_of_material_2.python (3 lines) ----------
steelVol = IN[0]

OUT = steelVol
# ----------------------------------------
final_volume_of_steel_in_mm_3 = Watch(total_volume_of_material_2)
