# Dynamo graph 1857846.dyn (Dynamo 4.0.0.3277)

# group: Don't touch this ground
code_block = CodeBlock { -5000; -5000; -200; }
byCoordinates = Point.ByCoordinates(x=code_block.out0, y=code_block.out1, z=code_block.out2)
code_block_2 = CodeBlock { 5000; 5000; 0; }
byCoordinates_2 = Point.ByCoordinates(x=code_block_2.out0, y=code_block_2.out1, z=code_block_2.out2)
byCorners = Cuboid.ByCorners(lowPoint=byCoordinates, highPoint=byCoordinates_2)
code_block_3 = CodeBlock { 0; 100; 0; }
byARGB = Color.ByARGB(red=code_block_3.out0, green=code_block_3.out1, blue=code_block_3.out2)
byGeometryColor = Modifiers.GeometryColor.ByGeometryColor(geometry=byCorners, color=byARGB)

# group: Parameters
pavilion_length = DoubleSlider(10000, range=6000..10000 step 500)
numColsX = IntegerSlider(3, range=3..8 step 1)
pavilion_width = DoubleSlider(10000, range=6000..10000 step 500)
numColsY = IntegerSlider(3, range=3..8 step 1)
colHeight = DoubleSlider(2500, range=2500..4000 step 100)
colRadius = DoubleSlider(150, range=50..150 step 10)
roof_curvature = DoubleSlider(2000, range=0..2000 step 100)
ribThickness = DoubleSlider(130, range=50..200 step 10)

code_block_4 = CodeBlock(pavilionLength=pavilion_length, numColsX=numColsX) { -pavilionLength/2; pavilionLength/(numColsX-1); }
sequenceX = Sequence(start=code_block_4.out0, amount=numColsX, step=code_block_4.out1)
code_block_5 = CodeBlock(pavilionWidth=pavilion_width, numColsY=numColsY) { -pavilionWidth/2; pavilionWidth/(numColsY-1); }
sequenceY = Sequence(start=code_block_5.out0, amount=numColsY, step=code_block_5.out1)
base_points = Point.ByCoordinates(x=sequenceX, y=sequenceY, lacing=CrossProduct)
vectorUp = Vector.ZAxis()
topPoints = Geometry.Translate(geometry=base_points, direction=vectorUp, distance=colHeight)
colCenterLines = Line.ByStartPointEndPoint(startPoint=base_points, endPoint=topPoints)
class_steel_column = Python()  # PythonNet3; unwired: IN[0]
# ---------- class_steel_column.python (14 lines) ----------
import clr
clr.AddReference('ProtoGeometry')
from Autodesk.DesignScript.Geometry import *

class CircularRod:
    def __init__(self, bottom_point, top_point, radius):
        self.bottom = bottom_point
        self.top = top_point
        self.radius = radius

    def make_geometry(self):
        return Cylinder.ByPointsRadius(self.bottom, self.top, self.radius)

OUT = CircularRod
# ----------------------------------------
instances_steel_columns = Python(IN[0]=base_points, IN[1]=topPoints, IN[2]=colRadius, IN[3]=class_steel_column)  # PythonNet3
# ---------- instances_steel_columns.python (45 lines) ----------
# IN[0] = list of bottom points
# IN[1] = list of top points
# IN[2] = radius 
# IN[3] = class steel column

steel_column   = IN[3]
bottom_points = IN[0]
top_points    = IN[1]
radius  = IN[2]

# ---- helper: flatten one level of nested lists ----
def flatten_one_level(data):
    flat = []
    for item in data:
        if isinstance(item, (list, tuple)):
            flat.extend(item)
        else:
            flat.append(item)
    return flat

# flatten 2D grids of points into 1D lists
bottom_points = flatten_one_level(bottom_points)
top_points    = flatten_one_level(top_points)

# ---- handle radius input (slider or list) ----
try:
    # if this works, it's already list-like
    _ = len(radius)
    radii = list(radius)
except TypeError:
    # single number from a slider -> repeat for all points
    radii = [radius] * len(bottom_points)

rods  = []
count = min(len(bottom_points), len(top_points), len(radii))

for i in range(count):
    btm = bottom_points[i]
    top = top_points[i]
    r   = radii[i]

    rod = steel_column(btm, top, r)
    rods.append(rod.make_geometry())

OUT = rods
# ----------------------------------------
roofRibCurve = Python(IN[0]=sequenceY, IN[1]=pavilion_length, IN[2]=colHeight, IN[3]=roof_curvature)  # PythonNet3
# ---------- roofRibCurve.python (28 lines) ----------
import clr
clr.AddReference('ProtoGeometry')
from Autodesk.DesignScript.Geometry import Point, Arc

SequenceY         = IN[0]
pavilionLength    = IN[1]
colHeight    = IN[2]
roofCurvature     = IN[3]

# make sure seqY is a plain list
if not isinstance(SequenceY, (list, tuple)):
    SequenceY = [SequenceY]

leftX  = -pavilionLength / 2.0
midX   = 0.0
rightX =  pavilionLength / 2.0

ribs = []

for y in SequenceY:
    p1 = Point.ByCoordinates(leftX,  y, colHeight)
    p2 = Point.ByCoordinates(midX,   y, colHeight + roofCurvature)
    p3 = Point.ByCoordinates(rightX, y, colHeight)

    arc = Arc.ByThreePoints(p1, p2, p3)
    ribs.append(arc)

OUT = ribs
# ----------------------------------------
class_woodrib = Python()  # PythonNet3; unwired: IN[0]
# ---------- class_woodrib.python (23 lines) ----------
import sys
import clr
clr.AddReference('ProtoGeometry')
from Autodesk.DesignScript.Geometry import *
import math

class WoodRib:
    def __init__(self, centerline, radius):
        self.centerline = centerline
        self.radius = radius
    
    def endpoints(self):
        return self.centerline.StartPoint, self.centerline.EndPoint
    
    def make_geometry(self):
        end1, end2 = self.endpoints()
        return Cylinder.ByPointsRadius(end1, end2, self.radius)
    
    def measure_volume(self):
        end1, end2 = self.endpoints()
        return end1.DistanceTo(end2) * self.radius * self.radius * math.pi  

OUT = WoodRib
# ----------------------------------------
instances_woodrib = Python(IN[0]=roofRibCurve, IN[1]=ribThickness, IN[2]=class_woodrib)  # PythonNet3
# ---------- instances_woodrib.python (22 lines) ----------
centerlines_in = IN[0]
rib_radius = IN[1]
WoodRib = IN[2]

curves = []
if isinstance(centerlines_in, (list, tuple)):
    for item in centerlines_in:
        if isinstance(item, (list, tuple)):
            curves.extend(item)
        else:
            curves.append(item)
else:
    curves = [centerlines_in]

ribs = []
for cl in curves:
    if cl is None:
        continue
    rib = WoodRib(cl, rib_radius)
    ribs.append(rib.make_geometry())

OUT = ribs
# ----------------------------------------
walls = Python(IN[0]=pavilion_length, IN[1]=pavilion_width, IN[2]=colHeight)  # PythonNet3
# ---------- walls.python (49 lines) ----------
import clr
clr.AddReference('ProtoGeometry')
from Autodesk.DesignScript.Geometry import Point, PolyCurve, Surface

pav_len  = IN[0]
pav_wid  = IN[1]
height   = IN[2]

# half dimensions
half_len = pav_len / 2.0
half_wid = pav_wid / 2.0

# corner coordinates on ground
leftX   = -half_len
rightX  =  half_len
frontY  = -half_wid
backY   =  half_wid

# bottom corners
p1 = Point.ByCoordinates(leftX,  frontY, 0)   
p2 = Point.ByCoordinates(rightX, frontY, 0)   
p3 = Point.ByCoordinates(rightX, backY,  0)   
p4 = Point.ByCoordinates(leftX,  backY,  0)  

# top corners
p1t = Point.ByCoordinates(leftX,  frontY, height)
p2t = Point.ByCoordinates(rightX, frontY, height)
p3t = Point.ByCoordinates(rightX, backY,  height)
p4t = Point.ByCoordinates(leftX,  backY,  height)

walls = []

# front wall
front_loop = PolyCurve.ByPoints([p1, p2, p2t, p1t], True)
walls.append(Surface.ByPatch(front_loop))

# right wall
right_loop = PolyCurve.ByPoints([p2, p3, p3t, p2t], True)
walls.append(Surface.ByPatch(right_loop))

# back wall 
back_loop = PolyCurve.ByPoints([p3, p4, p4t, p3t], True)
walls.append(Surface.ByPatch(back_loop))

# left wall 
left_loop = PolyCurve.ByPoints([p4, p1, p1t, p4t], True)
walls.append(Surface.ByPatch(left_loop))

OUT = walls
# ----------------------------------------
ribCurvesFlat = List.Flatten(list=roofRibCurve)
roof_surface = Surface.ByLoft(crossSections=ribCurvesFlat)
endwall = Python(IN[0]=roofRibCurve)  # PythonNet3
# ---------- endwall.python (36 lines) ----------
import clr
clr.AddReference('ProtoGeometry')
from Autodesk.DesignScript.Geometry import Line, Surface


curves_in = IN[0]


curves = []
if isinstance(curves_in, (list, tuple)):
    for item in curves_in:
        if isinstance(item, (list, tuple)):
            curves.extend(item)
        else:
            curves.append(item)
else:
    curves = [curves_in]

if len(curves) < 2:
    OUT = []
else:
    front_arc = curves[0]      # first rib (front)
    back_arc  = curves[-1]     # last rib (back)

    def make_end_surface(arc):
        
        p1 = arc.StartPoint
        p2 = arc.EndPoint
        top_line = Line.ByStartPointEndPoint(p1, p2)
     
        return Surface.ByLoft([top_line, arc])

    front_surf = make_end_surface(front_arc)
    back_surf  = make_end_surface(back_arc)

    OUT = [front_surf, back_surf]
# ----------------------------------------
