# Dynamo graph 1858200.dyn (Dynamo 3.3.0.6316)

code_block = CodeBlock { -5000; -5000; -200; }
byCoordinates = Point.ByCoordinates(x=code_block.out0, y=code_block.out1, z=code_block.out2)
code_block_2 = CodeBlock { 5000; 5000; 0; }
byCoordinates_2 = Point.ByCoordinates(x=code_block_2.out0, y=code_block_2.out1, z=code_block_2.out2)
byCorners = Cuboid.ByCorners(lowPoint=byCoordinates, highPoint=byCoordinates_2)
code_block_3 = CodeBlock { 0; 100; 0; }
byARGB = Color.ByARGB(red=code_block_3.out0, green=code_block_3.out1, blue=code_block_3.out2)
byGeometryColor = Modifiers.GeometryColor.ByGeometryColor(geometry=byCorners, color=byARGB)
code_block_4 = CodeBlock { 2500; -2500; 0; }
lower_right_bottom_point = Point.ByCoordinates(x=code_block_4.out0, y=code_block_4.out1, z=code_block_4.out2)
code_block_5 = CodeBlock { -2500; 2500; 0; }
upper_left_bottom_point = Point.ByCoordinates(x=code_block_5.out0, y=code_block_5.out1, z=code_block_5.out2)
code_block_6 = CodeBlock { 0; 0; 0; }
mid_bottom_point = Point.ByCoordinates(x=code_block_6.out0, y=code_block_6.out1, z=code_block_6.out2)
list_create = List.Create(item0=lower_right_bottom_point, item1=upper_left_bottom_point, item2=mid_bottom_point)
code_block_7 = CodeBlock { 5000; -2500; 5000; }
lower_right_top_point = Point.ByCoordinates(x=code_block_7.out0, y=code_block_7.out1, z=code_block_7.out2)
code_block_8 = CodeBlock { -2500; 5000; 5000; }
upper_left_top_point = Point.ByCoordinates(x=code_block_8.out0, y=code_block_8.out1, z=code_block_8.out2)
code_block_9 = CodeBlock { -2500; -2500; 5000; }
mid_top_point = Point.ByCoordinates(x=code_block_9.out0, y=code_block_9.out1, z=code_block_9.out2)
list_create_2 = List.Create(item0=lower_right_top_point, item1=upper_left_top_point, item2=mid_top_point)
width_of_steel_rods = DoubleSlider(150, range=150..200 step 1)
depth_of_steel_rods = DoubleSlider(150, range=150..200 step 1)
class_rectangular_steel_rod = Python()  # CPython3; unwired: IN[0]
# ---------- class_rectangular_steel_rod.python (26 lines) ----------
import clr
clr.AddReference('ProtoGeometry')
from Autodesk.DesignScript.Geometry import *

class RectangularRod:
    def __init__(self, bottom_point, top_point, width, depth):
        self.bottom = bottom_point
        self.top = top_point
        self.width = width   # X direction size
        self.depth = depth   # Y direction size
        
    def make_geometry(self):
        # Line along the support
        path = Line.ByStartPointEndPoint(self.bottom, self.top)
        
        # Horizontal plane at the bottom point
        pln = Plane.ByOriginNormal(self.bottom, Vector.ZAxis())
        
        # Rectangle centered on bottom point, lying in that plane
        rect = Rectangle.ByWidthLength(pln, self.width, self.depth)
        
        # Sweep the rectangle along the path to make a solid "rectangular rod"
        solid = Solid.BySweep(rect, path)
        return solid

OUT = RectangularRod
# ----------------------------------------
instances_of_rectangular_steel = Python(IN[0]=list_create, IN[1]=list_create_2, IN[2]=width_of_steel_rods, IN[3]=depth_of_steel_rods, IN[4]=class_rectangular_steel_rod)  # "Instances of Rectangular Steel Rods"; CPython3
# ---------- instances_of_rectangular_steel.python (22 lines) ----------
# IN[0] = list of bottom points
# IN[1] = list of top points
# IN[2] = single width
# IN[3] = single depth
# IN[4] = class RectangularRod from Box #1

RectangularRod = IN[4]
bottom_points = IN[0]
top_points = IN[1]
width = IN[2]
depth = IN[3]

supports = []
count = min(len(bottom_points), len(top_points))

for i in range(count):
    btm = bottom_points[i]
    top = top_points[i]
    rod = RectangularRod(btm, top, width, depth)
    supports.append(rod.make_geometry())

OUT = supports
# ----------------------------------------
code_block_10 = CodeBlock { 5000; 5000; 0; }
lower_right_bottom_point_2 = Point.ByCoordinates(x=code_block_10.out0, y=code_block_10.out1, z=code_block_10.out2)
code_block_11 = CodeBlock { 5000; 5000; 0; }
upper_left_bottom_point_2 = Point.ByCoordinates(x=code_block_11.out0, y=code_block_11.out1, z=code_block_11.out2)
code_block_12 = CodeBlock { -5000; -5000; 0; }
mid_bottom_point_2 = Point.ByCoordinates(x=code_block_12.out0, y=code_block_12.out1, z=code_block_12.out2)
list_create_3 = List.Create(item0=lower_right_bottom_point_2, item1=upper_left_bottom_point_2, item2=mid_bottom_point_2)
code_block_13 = CodeBlock { 5000; -2500; 5000; }
lower_right_top_point_2 = Point.ByCoordinates(x=code_block_13.out0, y=code_block_13.out1, z=code_block_13.out2)
code_block_14 = CodeBlock { -2500; 5000; 5000; }
upper_left_top_point_2 = Point.ByCoordinates(x=code_block_14.out0, y=code_block_14.out1, z=code_block_14.out2)
code_block_15 = CodeBlock { -2500; -2500; 5000; }
mid_top_point_2 = Point.ByCoordinates(x=code_block_15.out0, y=code_block_15.out1, z=code_block_15.out2)
list_create_4 = List.Create(item0=lower_right_top_point_2, item1=upper_left_top_point_2, item2=mid_top_point_2)
radius_of_steel_rods = DoubleSlider(100, range=100..150 step 1)
class_circular_rod = Python()  # CPython3
# ---------- class_circular_rod.python (14 lines) ----------
import clr
clr.AddReference('ProtoGeometry')
from Autodesk.DesignScript.Geometry import *

class CircularRod:
    def __init__(self, bottom_point, top_point, radius):
        self.bottom = bottom_point
        self.top = top_point
        self.radius = radius

    def make_geometry(self):
        return Cylinder.ByPointsRadius(self.bottom, self.top, self.radius)

OUT = CircularRod
# ----------------------------------------
instances_of_circular_steel_rods = Python(IN[0]=list_create_3, IN[1]=list_create_4, IN[2]=radius_of_steel_rods, IN[3]=class_circular_rod)  # CPython3
# ---------- instances_of_circular_steel_rods.python (18 lines) ----------
CircularRod = IN[3]
bottom_points = IN[0]
top_points = IN[1]
radius = IN[2]

rods = []
count = min(len(bottom_points),len(top_points))

for i in range(count):
   
    btm = bottom_points[i]
    top = top_points[i]
    
    rod = CircularRod(btm, top, radius)
    rods.append(rod.make_geometry())
    
OUT = rods
   
# ----------------------------------------
steel_material_list = List.Create(item0=instances_of_rectangular_steel, item1=instances_of_circular_steel_rods)
lists_of_vloumes_of_steel_in_m_3 = Solid.Volume(solid=steel_material_list)
number = DoubleInput(1000000000)
convert_to_mm_3 = lists_of_vloumes_of_steel_in_m_3 * number
sum_of_lists_of_steel_volumes = Math.Sum(values=convert_to_mm_3)
total_volume_of_steel_in_mm_3 = Math.Sum(values=sum_of_lists_of_steel_volumes)
watch = Watch(total_volume_of_steel_in_mm_3)
code_block_16 = CodeBlock { -5000; -5000; 0; }
lower_left_point = Point.ByCoordinates(x=code_block_16.out0, y=code_block_16.out1, z=code_block_16.out2)
code_block_17 = CodeBlock { -2500; -2500; 5000; }
mid_point = Point.ByCoordinates(x=code_block_17.out0, y=code_block_17.out1, z=code_block_17.out2)
byStartPointEndPoint = Line.ByStartPointEndPoint(startPoint=lower_left_point, endPoint=mid_point)
code_block_18 = CodeBlock { 0; 25; 1/24; }
sequence = Sequence(start=code_block_18.out0, amount=code_block_18.out1, step=code_block_18.out2)
pointAtParameter = Curve.PointAtParameter(curve=byStartPointEndPoint, param=sequence)
code_block_19 = CodeBlock { 5000; -2500; 5000; }
lower_right_corner = Point.ByCoordinates(x=code_block_19.out0, y=code_block_19.out1, z=code_block_19.out2)
code_block_20 = CodeBlock { 5000; 5000; 0; }
upper_right_corner = Point.ByCoordinates(x=code_block_20.out0, y=code_block_20.out1, z=code_block_20.out2)
byStartPointEndPoint_2 = Line.ByStartPointEndPoint(startPoint=lower_right_corner, endPoint=upper_right_corner)
code_block_21 = CodeBlock { 0; 25; 1/24; }
sequence_2 = Sequence(start=code_block_21.out0, amount=code_block_21.out1, step=code_block_21.out2)
pointAtParameter_2 = Curve.PointAtParameter(curve=byStartPointEndPoint_2, param=sequence_2)
radius_of_timber_rods = DoubleSlider(75, range=50..100 step 1)
series_of_instances_of_circular = Python(IN[0]=pointAtParameter, IN[1]=pointAtParameter_2, IN[2]=radius_of_timber_rods, IN[3]=class_circular_rod)  # "Series of Instances of Circular Timber Rods"; CPython3; same code as instances_of_circular_steel_rods
code_block_22 = CodeBlock { -2500; 5000; 5000; }
upper_left_corner = Point.ByCoordinates(x=code_block_22.out0, y=code_block_22.out1, z=code_block_22.out2)
code_block_23 = CodeBlock { 5000; 5000; 0; }
upper_right_corner_2 = Point.ByCoordinates(x=code_block_23.out0, y=code_block_23.out1, z=code_block_23.out2)
byStartPointEndPoint_3 = Line.ByStartPointEndPoint(startPoint=upper_left_corner, endPoint=upper_right_corner_2)
code_block_24 = CodeBlock { 0; 25; 1/24; }
sequence_3 = Sequence(start=code_block_24.out0, amount=code_block_24.out1, step=code_block_24.out2)
pointAtParameter_3 = Curve.PointAtParameter(curve=byStartPointEndPoint_3, param=sequence_3)
code_block_25 = CodeBlock { -5000; -5000; 0; }
lower_left_corner = Point.ByCoordinates(x=code_block_25.out0, y=code_block_25.out1, z=code_block_25.out2)
code_block_26 = CodeBlock { -2500; -2500; 5000; }
mid_point_2 = Point.ByCoordinates(x=code_block_26.out0, y=code_block_26.out1, z=code_block_26.out2)
byStartPointEndPoint_4 = Line.ByStartPointEndPoint(startPoint=lower_left_corner, endPoint=mid_point_2)
code_block_27 = CodeBlock { 0; 25; 1/24; }
sequence_4 = Sequence(start=code_block_27.out0, amount=code_block_27.out1, step=code_block_27.out2)
pointAtParameter_4 = Curve.PointAtParameter(curve=byStartPointEndPoint_4, param=sequence_4)
radius_of_timber_rods_2 = DoubleSlider(75, range=50..100 step 1)
series_of_instances_of_circular_2 = Python(IN[0]=pointAtParameter_3, IN[1]=pointAtParameter_4, IN[2]=radius_of_timber_rods_2, IN[3]=class_circular_rod)  # "Series of Instances of Circular Timber Rods"; CPython3; same code as instances_of_circular_steel_rods
timber_material_list = List.Create(item0=series_of_instances_of_circular, item1=series_of_instances_of_circular_2)
lists_of_volumes_of_timber_in_m = Solid.Volume(solid=timber_material_list)  # "Lists of Volumes of Timber in m^3"
number_2 = DoubleInput(1000000000)
convert_to_mm_3_2 = lists_of_volumes_of_timber_in_m * number_2
sum_of_lists_of_timber_volumes = Math.Sum(values=convert_to_mm_3_2)
total_volume_of_timber_in_mm_3 = Math.Sum(values=sum_of_lists_of_timber_volumes)
watch_2 = Watch(total_volume_of_timber_in_mm_3)
