# Dynamo graph 1858348.dyn "1858248" (Dynamo 4.0.0.3277)

# group: Don't touch this ground
code_block = CodeBlock { -5000; -5000; -200; }
byCoordinates = Point.ByCoordinates(x=code_block.out0, y=code_block.out1, z=code_block.out2)
code_block_2 = CodeBlock { 5000; 5000; 0; }
byCoordinates_2 = Point.ByCoordinates(x=code_block_2.out0, y=code_block_2.out1, z=code_block_2.out2)
byCorners = Cuboid.ByCorners(lowPoint=byCoordinates, highPoint=byCoordinates_2)
code_block_3 = CodeBlock { 0; 100; 0; }
byARGB = Color.ByARGB(red=code_block_3.out0, green=code_block_3.out1, blue=code_block_3.out2)
byGeometryColor = Modifiers.GeometryColor.ByGeometryColor(geometry=byCorners, color=byARGB)

# group: Control of Pavilion
number_of_main_arches = IntegerSlider(8, range=2..8 step 1)
decay_factor_of_roof = DoubleSlider(2, range=0..2 step 0.1)
radius_of_main_arches = IntegerSlider(25, range=25..100 step 1)
number_of_small_arches = IntegerSlider(30, range=10..30 step 1)  # "Number of Small Arches/Connections"
radius_of_small_arches = IntegerSlider(20, range=20..50 step 1)  # "Radius of Small Arches/Connections"
glass_block_out_light = BoolSelector(false)

# group: Main Lines
code_block_4 = CodeBlock { -3500; -3500; 0; }
byCoordinates_3 = Point.ByCoordinates(x=code_block_4.out0, y=code_block_4.out1, z=code_block_4.out2)
code_block_5 = CodeBlock { 4500; 4500; 0; }
byCoordinates_4 = Point.ByCoordinates(x=code_block_5.out0, y=code_block_5.out1, z=code_block_5.out2)
number = DoubleInput(7)
main_arches_lines = Python(start_pt=byCoordinates_3, end_pt=byCoordinates_4, num_arches=number_of_main_arches, dz=number, Decay_Factor=decay_factor_of_roof)  # PythonNet3
# ---------- main_arches_lines.python (30 lines) ----------
import clr
clr.AddReference('ProtoGeometry')
from Autodesk.DesignScript.Geometry import Point, NurbsCurve

start_pt = IN[0]
end_pt   = IN[1]
num_arches = IN[2]
dz = IN[3]
decay_factor = IN[4]

thick_standard = 500   # All arches are set to 500 thickness

arches = []

for i in range(num_arches):
    factor = (i + 1) / (num_arches + 1)
    t = 0.5

    # extra -2000 in X and Y
    mx = (1 - t) * start_pt.X + t * end_pt.X + 500 * i - 1000
    my = (1 - t) * start_pt.Y + t * end_pt.Y - 500 * i - 1000

    exponential_drop = dz * (decay_factor ** i)
    mz = max(start_pt.Z, end_pt.Z) + 6000 - exponential_drop

    if mz >= 0:
        mid_pt = Point.ByCoordinates(mx, my, mz)
        arches.append(NurbsCurve.ByPoints([start_pt, mid_pt, end_pt]))

OUT = arches
# ----------------------------------------

# group: Large Arches
number_2 = DoubleInput(50)
main_arches = Python(IN[0]=main_arches_lines, IN[1]=radius_of_main_arches, IN[2]=number_2)  # PythonNet3
# ---------- main_arches.python (36 lines) ----------
import clr
clr.AddReference('ProtoGeometry')
from Autodesk.DesignScript.Geometry import *
import math

arches = IN[0]         # List of NurbsCurves
rod_radius = IN[1]     # e.g., 50
num_segments = IN[2]   # e.g., 100 (more segments = smoother rod)

all_lofts = []

for arch in arches:
    profiles = []
    for i in range(num_segments + 1):
        t = i / float(num_segments)
        pt = arch.PointAtParameter(t)
        tangent = arch.TangentAtParameter(t).Normalized()
        perp_vec = tangent.Cross(Vector.ZAxis())
        if perp_vec.Length == 0:
            perp_vec = tangent.Cross(Vector.XAxis())
        perp_vec = perp_vec.Normalized()
        perp_vec2 = tangent.Cross(perp_vec).Normalized()
        circle_pts = []
        for k in range(12):  # 12-sided for smoothness
            angle = 2 * math.pi * k / 12
            v = perp_vec.Scale(math.cos(angle)).Add(perp_vec2.Scale(math.sin(angle)))
            pt_circle = pt.Add(v.Scale(rod_radius))
            circle_pts.append(pt_circle)
        circle_pts.append(circle_pts[0])
        profile = PolyCurve.ByPoints(circle_pts)
        profiles.append(profile)
    # Loft through all circle profiles to create a single smooth solid rod
    loft = Solid.ByLoft(profiles)
    all_lofts.append(loft)

OUT = all_lofts
# ----------------------------------------
number_3 = DoubleInput(67)
number_4 = DoubleInput(70)
number_5 = DoubleInput(75)
byARGB_2 = Color.ByARGB(red=number_3, green=number_4, blue=number_5)
byGeometryColor_2 = Modifiers.GeometryColor.ByGeometryColor(geometry=main_arches, color=byARGB_2)

# group: Steel Connection Small arch/strait part
connection_small_arches_lines = Python(IN[0]=main_arches_lines, IN[1]=number_of_small_arches)  # PythonNet3
# ---------- connection_small_arches_lines.python (36 lines) ----------
import clr
clr.AddReference('ProtoGeometry')
from Autodesk.DesignScript.Geometry import *

arches = IN[0]           # List of NurbsCurves (big arches)
num_connect = IN[1]      # Integer slider: how many connection "rows"

arch_connectors = []     # curved connectors
line_connectors = []     # straight connectors

tol = 1e-4               # tolerance for coincident points

for i in range(len(arches) - 1):
    arch0 = arches[i]
    arch1 = arches[i+1]

    for k in range(num_connect):
        t = k / float(max(num_connect - 1, 1))

        pt0 = arch0.PointAtParameter(t)
        pt1 = arch1.PointAtParameter(t)

        # curved arch
        mid_x = (pt0.X + pt1.X) / 2.0
        mid_y = (pt0.Y + pt1.Y) / 2.0
        mid_z = (pt0.Z + pt1.Z) / 2.0 + 250
        mid_pt = Point.ByCoordinates(mid_x, mid_y, mid_z)
        arch_curve = NurbsCurve.ByPoints([pt0, mid_pt, pt1])
        arch_connectors.append(arch_curve)

        # straight line only if points are not coincident
        if pt0.DistanceTo(pt1) > tol:
            line_curve = Line.ByStartPointEndPoint(pt0, pt1)
            line_connectors.append(line_curve)

OUT = [arch_connectors, line_connectors]
# ----------------------------------------
connection_small_arches = Python(IN[0]=connection_small_arches_lines, IN[1]=radius_of_small_arches)  # PythonNet3
# ---------- connection_small_arches.python (56 lines) ----------
import clr
clr.AddReference('ProtoGeometry')
from Autodesk.DesignScript.Geometry import *
import math

curves_in = IN[0]   # can be [arches, lines] or deeper nested
r         = IN[1]

# strict flatten
def flatten(lst, out=None):
    if out is None:
        out = []
    for x in lst:
        if isinstance(x, list):
            flatten(x, out)
        else:
            out.append(x)
    return out

all_items = flatten(curves_in)

solid_rods = []

for crv in all_items:
    # make sure this is a Geometry curve object
    if not hasattr(crv, "StartPoint"):
        continue
    if crv is None:
        continue
    if crv.StartPoint.DistanceTo(crv.EndPoint) < 1e-3:
        continue

    try:
        pt = crv.PointAtParameter(0)
        tangent = crv.TangentAtParameter(0).Normalized()

        perp1 = tangent.Cross(Vector.ZAxis())
        if perp1.Length == 0:
            perp1 = tangent.Cross(Vector.XAxis())
        perp1 = perp1.Normalized()
        perp2 = tangent.Cross(perp1).Normalized()

        circle_pts = []
        for k in range(12):
            ang = 2 * math.pi * k / 12.0
            v = perp1.Scale(math.cos(ang)).Add(perp2.Scale(math.sin(ang)))
            circle_pts.append(pt.Add(v.Scale(r)))
        circle_pts.append(circle_pts[0])

        profile = PolyCurve.ByPoints(circle_pts)
        rod = Solid.BySweep(profile, crv)
        solid_rods.append(rod)
    except:
        continue

OUT = solid_rods
# ----------------------------------------
number_6 = DoubleInput(70)
byARGB_3 = Color.ByARGB(red=number_6, green=number_6, blue=number_6)
byGeometryColor_3 = Modifiers.GeometryColor.ByGeometryColor(geometry=connection_small_arches, color=byARGB_3)

# group: Glass section
number_7 = DoubleInput(50)
number_8 = DoubleInput(12)
glass_panles = Python(IN[0]=main_arches_lines, IN[1]=number_7, IN[2]=number_8)  # PythonNet3
# ---------- glass_panles.python (30 lines) ----------
import clr
clr.AddReference('ProtoGeometry')
from Autodesk.DesignScript.Geometry import *

big_arches  = IN[0]    # list of main arches
num_samples = IN[1]    # e.g. 30
thickness   = IN[2]    # e.g. 200 (positive number)

rows = len(big_arches)
cols = num_samples + 1
pt_grid = []

for i in range(rows):
    crv = big_arches[i]
    row = []
    for j in range(cols):
        t = j / float(cols - 1)
        p = crv.PointAtParameter(t)
        zc = max(p.Z, 0.0)
        row.append(Point.ByCoordinates(p.X, p.Y, zc))
    pt_grid.append(row)

u_deg = 3
v_deg = 3
surf = NurbsSurface.ByPoints(pt_grid, u_deg, v_deg)

# thicken to a solid (offset normal both sides)
solid = surf.Thicken(thickness, True)

OUT = solid
# ----------------------------------------
number_9 = DoubleInput(200)
number_10 = DoubleInput(100)
python_script = Python(IN[0]=number_9, IN[1]=number_10, IN[2]=glass_block_out_light)  # PythonNet3
# ---------- python_script.python (8 lines) ----------
A = IN[0]
B = IN[1]
switch = IN[2]

if switch:
    OUT = A
else:
    OUT = B
# ----------------------------------------
red = DoubleInput(224)
green = DoubleInput(255)
blue = DoubleInput(255)
byARGB_4 = Color.ByARGB(alpha=python_script, red=red, green=green, blue=blue)
byGeometryColor_4 = Modifiers.GeometryColor.ByGeometryColor(geometry=glass_panles, color=byARGB_4)

# group: Base Plates
code_block_6 = CodeBlock { -3500; -3500; 100; }
byCoordinates_5 = Point.ByCoordinates(x=code_block_6.out0, y=code_block_6.out1, z=code_block_6.out2)
code_block_7 = CodeBlock { -3500; -3500; 0; }
byCoordinates_6 = Point.ByCoordinates(x=code_block_7.out0, y=code_block_7.out1, z=code_block_7.out2)
number_11 = DoubleInput(300)
byPointsRadius = Cylinder.ByPointsRadius(startPoint=byCoordinates_5, endPoint=byCoordinates_6, radius=number_11)
number_12 = DoubleInput(67)
number_13 = DoubleInput(70)
number_14 = DoubleInput(75)
byARGB_5 = Color.ByARGB(red=number_12, green=number_13, blue=number_14)
byGeometryColor_5 = Modifiers.GeometryColor.ByGeometryColor(geometry=byPointsRadius, color=byARGB_5)
code_block_8 = CodeBlock { 4500; 4500; 100; }
byCoordinates_7 = Point.ByCoordinates(x=code_block_8.out0, y=code_block_8.out1, z=code_block_8.out2)
code_block_9 = CodeBlock { 4500; 4500; 0; }
byCoordinates_8 = Point.ByCoordinates(x=code_block_9.out0, y=code_block_9.out1, z=code_block_9.out2)
number_15 = DoubleInput(300)
byPointsRadius_2 = Cylinder.ByPointsRadius(startPoint=byCoordinates_7, endPoint=byCoordinates_8, radius=number_15)
number_16 = DoubleInput(67)
number_17 = DoubleInput(70)
number_18 = DoubleInput(75)
byARGB_6 = Color.ByARGB(red=number_16, green=number_17, blue=number_18)
byGeometryColor_6 = Modifiers.GeometryColor.ByGeometryColor(geometry=byPointsRadius_2, color=byARGB_6)

# group: Steel Connection Small arch/strait part > Volume of Small Arches
python_script_2 = Python(IN[0]=connection_small_arches)  # PythonNet3
# ---------- python_script_2.python (19 lines) ----------
# IN[0] = list or nested lists of Solids

solids_in = IN[0]

def flatten(lst, out=None):
    if out is None: out = []
    for x in lst:
        if isinstance(x, list):
            flatten(x, out)
        else:
            out.append(x)
    return out

solids = [s for s in flatten(solids_in) if s is not None]

volumes = [s.Volume for s in solids]   # list of each volume
total_volume = sum(volumes)            # one total value

OUT = total_volume
# ----------------------------------------
watch = Watch(python_script_2)

# group: Large Arches > Volume of Main Arches
python_script_3 = Python(IN[0]=main_arches)  # PythonNet3; same code as python_script_2
watch_2 = Watch(python_script_3)

# group: Glass section > Volume of Large Glass
python_script_4 = Python(IN[0]=glass_panles)  # PythonNet3
# ---------- python_script_4.python (16 lines) ----------
import clr
clr.AddReference('ProtoGeometry')
from Autodesk.DesignScript.Geometry import *

solid_in = IN[0]   # can be one solid or a list

# handle single or multiple solids
if isinstance(solid_in, list):
    solids = [s for s in solid_in if s is not None]
else:
    solids = [solid_in] if solid_in is not None else []

volumes = [s.Volume for s in solids]   # volume of each solid[web:22]
total_volume = sum(volumes)            # summed material volume[web:22]

OUT = total_volume
# ----------------------------------------
watch_3 = Watch(python_script_4)

# group: Base Plates > Volume of Large Base 1
python_script_5 = Python(IN[0]=byPointsRadius_2)  # PythonNet3; same code as python_script_4
watch_4 = Watch(python_script_5)

# group: Base Plates > Volume of Large Base 1
python_script_6 = Python(IN[0]=byPointsRadius)  # PythonNet3; same code as python_script_4
watch_5 = Watch(python_script_6)
