# Dynamo graph 1858643.dyn (Dynamo 3.6.0.9395)

# group: Don't touch this ground
code_block = CodeBlock { -5000; -5000; -200; }
byCoordinates = Point.ByCoordinates(x=code_block.out0, y=code_block.out1, z=code_block.out2)
code_block_2 = CodeBlock { 5000; 5000; 0; }
byCoordinates_2 = Point.ByCoordinates(x=code_block_2.out0, y=code_block_2.out1, z=code_block_2.out2)
byCorners = Cuboid.ByCorners(lowPoint=byCoordinates, highPoint=byCoordinates_2)
code_block_3 = CodeBlock { 0; 100; 0; }
byARGB = Color.ByARGB(red=code_block_3.out0, green=code_block_3.out1, blue=code_block_3.out2)
byGeometryColor = Modifiers.GeometryColor.ByGeometryColor(geometry=byCorners, color=byARGB)

steel_slider = DoubleSlider(96.3, range=75..150 step 0.1)

# group: Inner main beam
code_block_4 = CodeBlock { 5000; 2000; }
byCoordinates_3 = Point.ByCoordinates(x=code_block_4.out0, y=code_block_4.out1)
code_block_5 = CodeBlock { 4000; 100; }
byCoordinates_4 = Point.ByCoordinates(y=code_block_5.out1, z=code_block_5.out0)
code_block_6 = CodeBlock { -5000; 2000; }
byCoordinates_5 = Point.ByCoordinates(x=code_block_6.out0, y=code_block_6.out1)
byThreePoints = Arc.ByThreePoints(firstPoint=byCoordinates_3, secondPoint=byCoordinates_4, thirdPoint=byCoordinates_5)
planeAtParameter = Curve.PlaneAtParameter(curve=byThreePoints)
byPlaneRadius = Circle.ByPlaneRadius(plane=planeAtParameter, radius=steel_slider)
bySweep = Solid.BySweep(profile=byPlaneRadius, path=byThreePoints)
XZ = Plane.XZ()
mirror = Geometry.Mirror(geometry=bySweep, mirrorPlane=XZ)

# group: Outer COS beams
code_block_7 = CodeBlock { 5000; 2000; }
byCoordinates_6 = Point.ByCoordinates(x=code_block_7.out0, y=code_block_7.out1)
code_block_8 = CodeBlock { 5000; }
byCoordinates_7 = Point.ByCoordinates(y=code_block_8)
code_block_9 = CodeBlock { -5000; 2000; }
byCoordinates_8 = Point.ByCoordinates(x=code_block_9.out0, y=code_block_9.out1)
byThreePoints_2 = Arc.ByThreePoints(firstPoint=byCoordinates_6, secondPoint=byCoordinates_7, thirdPoint=byCoordinates_8)
code_block_10 = CodeBlock { 0..1..#48; }
pointAtParameter = Curve.PointAtParameter(curve=byThreePoints_2, param=code_block_10)
integer_slider = IntegerSlider(96, range=0..100 step 1)
code_block_11 = CodeBlock(n=integer_slider) { angle=0..15*n..#48; z=1000-1000*Math.Cos(angle); }
translate = Geometry.Translate(geometry=pointAtParameter, zTranslation=code_block_11.z)
byControlPoints = NurbsCurve.ByControlPoints(points=translate)
code_block_12 = CodeBlock { 0.05..0.95..#128; }
planeAtParameter_2 = Curve.PlaneAtParameter(curve=byControlPoints)
byPlaneRadius_2 = Circle.ByPlaneRadius(plane=planeAtParameter_2, radius=steel_slider)
bySweep_2 = Solid.BySweep(profile=byPlaneRadius_2, path=byControlPoints)
XZ_2 = Plane.XZ()
mirror_2 = Geometry.Mirror(geometry=bySweep_2, mirrorPlane=XZ_2)

pointAtParameter_2 = Curve.PointAtParameter(curve=byControlPoints, param=code_block_12)
pointAtParameter_3 = Curve.PointAtParameter(curve=byThreePoints, param=code_block_12)

# group: SWEEP TO CONNECT BEAMS
byStartPointEndPoint = Line.ByStartPointEndPoint(startPoint=pointAtParameter_2, endPoint=pointAtParameter_3)
code_block_13 = CodeBlock { 0.5; }
pointAtParameter_4 = Curve.PointAtParameter(curve=byStartPointEndPoint, param=code_block_13)
code_block_14 = CodeBlock { -500; }
translate_2 = Geometry.Translate(geometry=pointAtParameter_4, zTranslation=code_block_14)
byThreePoints_3 = Arc.ByThreePoints(firstPoint=pointAtParameter_2, secondPoint=translate_2, thirdPoint=pointAtParameter_3)
planeAtParameter_3 = Curve.PlaneAtParameter(curve=byThreePoints_3)
wood_thickness = DoubleSlider(25, range=20..50 step 0.1)
byPlaneRadius_3 = Circle.ByPlaneRadius(plane=planeAtParameter_3, radius=wood_thickness)
bySweep_3 = Solid.BySweep(profile=byPlaneRadius_3, path=byThreePoints_3)
XZ_3 = Plane.XZ()
mirror_3 = Geometry.Mirror(geometry=bySweep_3, mirrorPlane=XZ_3)

instance_steel_lips_wooden_shell = Python(IN[0]=byCoordinates_6, IN[1]=byCoordinates_7, IN[2]=byCoordinates_8, IN[3]=byCoordinates_3, IN[4]=byCoordinates_4, IN[5]=byCoordinates_5, IN[6]=integer_slider, IN[7]=steel_slider, IN[8]=wood_thickness)  # CPython3
# ---------- instance_steel_lips_wooden_shell.python (111 lines) ----------
import sys
import clr
clr.AddReference('ProtoGeometry')
from Autodesk.DesignScript.Geometry import *
import math

class SteelLip:
    def __init__(self, points, thickness, angle, is_clamp=False):
        self.material = "Steel"
        self.points = points  
        self.thickness = thickness
        self.angle = math.radians(angle)
        self.is_clamp = is_clamp
        self.geometry = None
        
    def generate_geometry(self):
        curve = Arc.ByThreePoints(self.points[0], self.points[1], self.points[2])
        
        param_points = []
        num_pts = 7 if self.is_clamp else 5
        
        for i in range(num_pts):
            t = i / (num_pts - 1)
            pt = curve.PointAtParameter(t)
            variation = self.thickness * 0.5 * math.cos(self.angle * t * math.pi)
            
            if self.is_clamp:
                new_pt = Point.ByCoordinates(pt.X, pt.Y, pt.Z + variation)
            else:
                new_pt = Point.ByCoordinates(pt.X, pt.Y + variation, pt.Z)
                
            param_points.append(new_pt)
        
        varied_curve = NurbsCurve.ByControlPoints(param_points, 3)
        plane = varied_curve.PlaneAtParameter(0.5)
        profile = Circle.ByPlaneRadius(plane, self.thickness/2)
        
        self.geometry = Solid.BySweep(profile, varied_curve)
        return self.geometry
    
    def compute_volume(self):
        if not self.geometry:
            self.generate_geometry()
        return self.geometry.Volume

class WoodenShell:
    def __init__(self, points, thickness, angle):
        self.material = "Wood"
        self.points = points  
        self.thickness = thickness
        self.angle = math.radians(angle)
        self.geometry = None
        
    def generate_geometry(self):
        curve = Arc.ByThreePoints(self.points[0], self.points[1], self.points[2])
        
        param_points = []
        for i in range(9):
            t = i / 8.0
            pt = curve.PointAtParameter(t)
            variation = self.thickness * 0.8 * math.cos(self.angle * t * math.pi)
            new_pt = Point.ByCoordinates(pt.X, pt.Y, pt.Z + variation)
            param_points.append(new_pt)
        
        varied_curve = NurbsCurve.ByControlPoints(param_points, 3)
        plane = varied_curve.PlaneAtParameter(0.5)
        profile = Circle.ByPlaneRadius(plane, self.thickness/2)
        
        self.geometry = Solid.BySweep(profile, varied_curve)
        return self.geometry
    
    def compute_volume(self):
        if not self.geometry:
            self.generate_geometry()
        return self.geometry.Volume

lip_pt1 = IN[0]
lip_pt2 = IN[1]
lip_pt3 = IN[2]

shell_pt1 = IN[3]
shell_pt2 = IN[4]
shell_pt3 = IN[5]

angle = IN[6]
steel_thick = IN[7]
wood_thick = IN[8]

lip_points = [lip_pt1, lip_pt2, lip_pt3]
shell_points = [shell_pt1, shell_pt2, shell_pt3]

steel_lip = SteelLip(lip_points, steel_thick, angle, is_clamp=False)
wooden_shell = WoodenShell(shell_points, wood_thick, angle)

lip_geom = steel_lip.generate_geometry()
shell_geom = wooden_shell.generate_geometry()

mirror_plane = Plane.ByOriginNormal(Point.ByCoordinates(0, 0, 0), Vector.XAxis())
mirrored_lip = lip_geom.Mirror(mirror_plane)
mirrored_shell = shell_geom.Mirror(mirror_plane)

lip_volume = steel_lip.compute_volume()
shell_volume = wooden_shell.compute_volume()

lip_volume_formatted = f"{lip_volume:.2f} mm³"
shell_volume_formatted = f"{shell_volume:.2f} mm³"

OUT = [
    lip_volume_formatted,
    shell_volume_formatted
]
# ----------------------------------------
code_block_15 = CodeBlock { 0; }
getItemAtIndex = List.GetItemAtIndex(list=instance_steel_lips_wooden_shell, index=code_block_15)
steel_volume_mm_3 = Watch(getItemAtIndex)
code_block_16 = CodeBlock { 1; }
getItemAtIndex_2 = List.GetItemAtIndex(list=instance_steel_lips_wooden_shell, index=code_block_16)
wood_volume_mm_3 = Watch(getItemAtIndex_2)
