# Dynamo graph 1858668.dyn (Dynamo 3.6.0.9395)

# group: Don't touch this ground
code_block = CodeBlock { -5000; -5000; -200; }
byCoordinates = Point.ByCoordinates(x=code_block.out0, y=code_block.out1, z=code_block.out2)
code_block_2 = CodeBlock { 5000; 5000; 0; }
byCoordinates_2 = Point.ByCoordinates(x=code_block_2.out0, y=code_block_2.out1, z=code_block_2.out2)
byCorners = Cuboid.ByCorners(lowPoint=byCoordinates, highPoint=byCoordinates_2)
code_block_3 = CodeBlock { 0; 100; 0; }
byARGB = Color.ByARGB(red=code_block_3.out0, green=code_block_3.out1, blue=code_block_3.out2)
byGeometryColor = Modifiers.GeometryColor.ByGeometryColor(geometry=byCorners, color=byARGB)

code_block_4 = CodeBlock { 0; 0; 0; }
lower_point_foundation = Point.ByCoordinates(x=code_block_4.out0, y=code_block_4.out1, z=code_block_4.out2)
code_block_5 = CodeBlock { 0; 0; 150; }
upper_point_foundation = Point.ByCoordinates(x=code_block_5.out0, y=code_block_5.out1, z=code_block_5.out2)
ZAxis = Vector.ZAxis()
height_from_foundation_to_roof = DoubleSlider(5000, range=0..10000 step 0.1)
upper_point_roof = Geometry.Translate(geometry=upper_point_foundation, direction=ZAxis, distance=height_from_foundation_to_roof)
byStartPointEndPoint = Line.ByStartPointEndPoint(startPoint=lower_point_foundation, endPoint=upper_point_roof)
byCenterPointRadius = Circle.ByCenterPointRadius(centerPoint=upper_point_foundation)
foundations = Python()  # CPython3; unwired: IN[0]
# ---------- foundations.python (25 lines) ----------
# Load the Python Standard and DesignScript Libraries
import sys
import clr
clr.AddReference('ProtoGeometry')
from Autodesk.DesignScript.Geometry import *
import math

class CircularSteel:
    def __init__(self, centerline, radius):
        self.centerline = centerline
        self.radius = radius
        
    def endpoints(self):
        return self.centerline.StartPoint, self.centerline.EndPoint
        
    def make_geometry(self):
        end1, end2 = self.endpoints()
        
        return Cylinder.ByPointsRadius(end1, end2, self.radius)
        
    def measure_volume(self):
        end1, end2 = self.endpoints()
        return end1.DistanceTo(end2)*self.radius*self.radius*math.pi

OUT = CircularSteel
# ----------------------------------------
lower_point_roof = Geometry.Translate(geometry=lower_point_foundation, direction=ZAxis, distance=height_from_foundation_to_roof)
byStartPointEndPoint_2 = Line.ByStartPointEndPoint(startPoint=lower_point_roof, endPoint=upper_point_roof)
radius_of_roof = DoubleSlider(4000, range=0..10000 step 0.1)
roof_instance = Python(IN[0]=foundations, IN[1]=byStartPointEndPoint_2, IN[2]=radius_of_roof)  # CPython3
# ---------- roof_instance.python (4 lines) ----------
CircularSteel = IN[0]
bottomSteel = CircularSteel(IN[1],IN[2])

OUT = [bottomSteel.make_geometry(), bottomSteel.measure_volume()]
# ----------------------------------------
byStartPointEndPoint_3 = Line.ByStartPointEndPoint(startPoint=lower_point_foundation, endPoint=upper_point_foundation)
radius_of_foundation = DoubleSlider(2000, range=0..10000 step 0.1)
bottom_foundation_instance = Python(IN[0]=foundations, IN[1]=byStartPointEndPoint_3, IN[2]=radius_of_foundation)  # CPython3; same code as roof_instance
rod_radius = DoubleSlider(150, range=0..500 step 0.1)
rod_pillars = Python()  # CPython3; unwired: IN[0]
# ---------- rod_pillars.python (24 lines) ----------
import clr
clr.AddReference('ProtoGeometry')
from Autodesk.DesignScript.Geometry import *
import math

class CircularRod:
    def __init__(self, bottom_point, top_point, radius):
        self.bottom = bottom_point
        self.top = top_point
        self.radius = radius
        
    def endpoints(self):
        return self.bottom, self.top

    def make_geometry(self):
        return Cylinder.ByPointsRadius(self.bottom, self.top, self.radius)
       
    def measure_volume(self):
        end1, end2 = self.endpoints()
        length = end1.DistanceTo(end2)
        volume=(length*self.radius**2*math.pi)
        return volume

OUT = CircularRod
# ----------------------------------------
centre_bar = Python(IN[0]=upper_point_foundation, IN[1]=lower_point_roof, IN[2]=rod_radius, IN[3]=rod_pillars)  # CPython3
# ---------- centre_bar.python (10 lines) ----------
# IN[0] = bottom point
# IN[1] = top point
radius = IN[2] 
# IN[3] = class object from previous node

CircularRod = IN[3]
b = CircularRod(IN[0], IN[1], IN[2])


OUT = b.make_geometry(), b.measure_volume()
# ----------------------------------------
code_block_6 = CodeBlock { r= 1000; opr = -r; 0; }
code_block_7 = CodeBlock { 90; }
northpoint = Point.ByCoordinates(x=code_block_6.r, y=code_block_6.out2, z=code_block_7)
code_block_8 = CodeBlock { r= 3500; 0; opr = -r; 5070; }
northTop = Point.ByCoordinates(x=code_block_8.r, y=code_block_8.out1, z=code_block_8.out3)
north_rod = Python(IN[0]=northpoint, IN[1]=northTop, IN[2]=rod_radius, IN[3]=rod_pillars)  # CPython3; same code as centre_bar
west_bottom = Point.ByCoordinates(x=code_block_6.out2, y=code_block_6.r, z=code_block_7)
north_top_to_west_bottom = Python(IN[0]=west_bottom, IN[1]=northTop, IN[2]=rod_radius, IN[3]=rod_pillars)  # CPython3; same code as centre_bar
east_point = Point.ByCoordinates(x=code_block_6.out2, y=code_block_6.opr, z=code_block_7)
southTop = Point.ByCoordinates(x=code_block_8.opr, y=code_block_8.out1, z=code_block_8.out3)
east_top_to_south_bottom = Python(IN[0]=east_point, IN[1]=southTop, IN[2]=rod_radius, IN[3]=rod_pillars)  # CPython3; same code as centre_bar
south_point = Point.ByCoordinates(x=code_block_6.opr, y=code_block_6.out2, z=code_block_7)
south_top_to_south_bottom = Python(IN[0]=south_point, IN[1]=southTop, IN[2]=rod_radius, IN[3]=rod_pillars)  # CPython3; same code as centre_bar
eastTop = Point.ByCoordinates(x=code_block_8.out1, y=code_block_8.opr, z=code_block_8.out3)
east_bottom_to_east_top = Python(IN[0]=east_point, IN[1]=eastTop, IN[2]=rod_radius, IN[3]=rod_pillars)  # CPython3; same code as centre_bar
westTop = Point.ByCoordinates(x=code_block_8.out1, y=code_block_8.r, z=code_block_8.out3)
west_top_to_west_bottom = Python(IN[0]=west_bottom, IN[1]=westTop, IN[2]=rod_radius, IN[3]=rod_pillars)  # CPython3; same code as centre_bar
east_top_to_north_bottom = Python(IN[0]=east_point, IN[1]=northTop, IN[2]=rod_radius, IN[3]=rod_pillars)  # CPython3; same code as centre_bar
west_top_to_south_bottom = Python(IN[0]=south_point, IN[1]=westTop, IN[2]=rod_radius, IN[3]=rod_pillars)  # CPython3; same code as centre_bar
python_script = Python(IN[0]=roof_instance, IN[1]=bottom_foundation_instance, IN[2]=centre_bar, IN[3]=north_rod, IN[4]=north_top_to_west_bottom, IN[5]=east_top_to_south_bottom, IN[6]=south_top_to_south_bottom, IN[7]=east_bottom_to_east_top, IN[8]=west_top_to_west_bottom, IN[9]=east_top_to_north_bottom, IN[10]=west_top_to_south_bottom)  # CPython3
# ---------- python_script.python (26 lines) ----------
# Load the Python Standard and DesignScript Libraries
import sys
import clr
clr.AddReference('ProtoGeometry')
from Autodesk.DesignScript.Geometry import *
import math

Roof_Instance = IN[0]
botto_instance = IN[1]
Centre_bar = IN[2]
North_rod= IN[3]
NorthT_WestB = IN[4]
EastT_Southb = IN[5]
SouthT_SouthT = IN[6] 
Eastb_EastT = IN[7]
WestT_Westb = IN[8]
Eastt_Northb = IN[9]
WestT_Southb = IN[10]

Wood_vol = Roof_Instance[1] + botto_instance[1]

Steel_vol = Centre_bar[1]+North_rod[1] +NorthT_WestB[1] +EastT_Southb[1] +SouthT_SouthT[1] +Eastb_EastT[1] +WestT_Westb[1] +Eastt_Northb[1] +WestT_Southb[1]



OUT = Wood_vol, Steel_vol
# ----------------------------------------
wood_vol_roof_and_foundation_and = Watch(python_script)  # "wood_vol(roof and foundation) and steel_vol(pillars)"
watch = Watch(bottom_foundation_instance)
watch_2 = Watch(roof_instance)
watch_3 = Watch(centre_bar)
