# Dynamo graph 1858901.dyn (Dynamo 3.6.0.9395)

# group: Don't touch this ground
code_block = CodeBlock { -5000; -5000; -200; }
byCoordinates = Point.ByCoordinates(x=code_block.out0, y=code_block.out1, z=code_block.out2)
code_block_2 = CodeBlock { 5000; 5000; 0; }
byCoordinates_2 = Point.ByCoordinates(x=code_block_2.out0, y=code_block_2.out1, z=code_block_2.out2)
byCorners = Cuboid.ByCorners(lowPoint=byCoordinates, highPoint=byCoordinates_2)
code_block_3 = CodeBlock { 0; 100; 0; }
byARGB = Color.ByARGB(red=code_block_3.out0, green=code_block_3.out1, blue=code_block_3.out2)
byGeometryColor = Modifiers.GeometryColor.ByGeometryColor(geometry=byCorners, color=byARGB)

# group: Arch Nodes
maximum_front_height = DoubleSlider(7000, range=5000..9000 step 1000)
number_of_intermediate_arches = DoubleSlider(2, range=1..5 step 1)
span_of_arches = CodeBlock { 8000; }
radius_of_arch = CodeBlock { 100; }
series_of_instances_steel_arches = Python(IN[0]=maximum_front_height, IN[1]=number_of_intermediate_arches, IN[2]=span_of_arches, IN[3]=radius_of_arch)  # CPython3
# ---------- series_of_instances_steel_arches.python (54 lines) ----------
# Load the Python Standard and DesignScript Libraries
import sys
import clr
clr.AddReference('ProtoGeometry')
from Autodesk.DesignScript.Geometry import *
import math

FrontHeight        = IN[0]
IntermediateArches = IN[1]
Span               = IN[2]
ArchRadius         = IN[3]

# Restate Class
class Arch:
    def __init__(self, span, height, y):
        self.span = span
        self.height = height
        self.y = y
        
        p0 = Point.ByCoordinates(-span/2, y, 0)
        p1 = Point.ByCoordinates(0,       y, height)
        p2 = Point.ByCoordinates(span/2,  y, 0)
        
        self.curve = NurbsCurve.ByPoints([p0, p1, p2])

# Instances:

arches_curves = []
m = int(IntermediateArches)
step = -8000 / (m + 1)

FrontArch = Arch(Span, FrontHeight, 4000)
arches_curves.append(FrontArch.curve)

for k in range(1, m + 1):
    y = 4000 + k * step
    t = float(k) / float(m + 1)
    h = FrontHeight * (1 - t/2)
    midArch = Arch(Span, h, y)
    arches_curves.append(midArch.curve)

BackArch = Arch(Span, FrontHeight/2, -4000)
arches_curves.append(BackArch.curve)

# Volume
area = math.pi * (ArchRadius ** 2)

totalVolume = 0.0
for curve in arches_curves:
    if curve is None:
        continue
    totalVolume += curve.Length * area

OUT = [arches_curves, totalVolume]
# ----------------------------------------
code_block_4 = CodeBlock(IN=series_of_instances_steel_arches) { IN[0]; IN[1]; }
pointAtParameter = Curve.PointAtParameter(curve=code_block_4.out0)
byCenterPointRadius = Circle.ByCenterPointRadius(centerPoint=pointAtParameter, radius=radius_of_arch)
surface_of_arch = Solid.BySweep(profile=byCenterPointRadius, path=code_block_4.out0)
class_steel_arches = Python()  # CPython3; unwired: IN[0]
# ---------- class_steel_arches.python (18 lines) ----------
# Load the Python Standard and DesignScript Libraries
import sys
import clr
clr.AddReference('ProtoGeometry')
from Autodesk.DesignScript.Geometry import *

class Arch:
    def __init__(self, span, height, y):
        self.span = span
        self.height = height
        self.y = y
        
        p0 = Point.ByCoordinates(-span/2, y, 0)
        p1 = Point.ByCoordinates(0,        y, height)
        p2 = Point.ByCoordinates(span/2, y, 0)
        
        self.curve = NurbsCurve.ByPoints([p0, p1, p2])
OUT = 0
# ----------------------------------------
material_volume_1_mm_3 = Watch(code_block_4.out1)

# group: Helix Nodes
number_of_orbits = DoubleSlider(3, range=1..4 step 1)
radius_away_from_arch = DoubleSlider(550, range=250..750 step 50)
number_of_turns = DoubleSlider(4, range=1..8 step 1)
radius_of_helix_rod = DoubleSlider(220, range=100..300 step 10)
series_of_instances_wooden = Python(IN[0]=code_block_4.out0, IN[1]=number_of_orbits, IN[2]=radius_away_from_arch, IN[3]=number_of_turns, IN[4]=radius_of_helix_rod)  # "Series of Instances: Wooden Helixes"; CPython3
# ---------- series_of_instances_wooden.python (77 lines) ----------
# Load the Python Standard and DesignScript Libraries
import clr
clr.AddReference('ProtoGeometry')
from Autodesk.DesignScript.Geometry import *
import math

ArchesCurves = IN[0]
HelixCount   = IN[1]
HelixRadius  = IN[2]
HelixTurns   = IN[3]
RodRadius    = IN[4]

# Restate Class
class WoodenHelixes:
    def __init__(self, archCurve, count, radius, turns, rodRadius):
        self.curves = []
        self.totalVolume = 0

        count = int(count)
        area = math.pi * (rodRadius ** 2)

        for k in range(count):
            pts = []
            prevXDir = None

            for i in range(180):
                t = i / 179

                pt  = archCurve.PointAtParameter(t)
                tan = archCurve.TangentAtParameter(t).Normalized()
                
                zAxis = Vector.ZAxis()
                if abs(tan.Dot(zAxis)) > 0.9:
                    zAxis = Vector.XAxis()

                xDir = tan.Cross(zAxis)
                if xDir.Length != 0:
                    xDir = xDir.Normalized()
                else:
                    xDir = prevXDir or Vector.XAxis()

                yDir = tan.Cross(xDir).Normalized()

                if prevXDir is not None and xDir.Dot(prevXDir) < 0:
                    xDir = xDir.Reverse()
                    yDir = yDir.Reverse()

                prevXDir = xDir

                theta = 2.0 * math.pi * (turns * t + float(k) / count)

                offset = xDir.Scale(radius * math.cos(theta))
                offset = offset.Add(yDir.Scale(radius * math.sin(theta)))

                pts.append(pt.Add(offset))

            crv = NurbsCurve.ByPoints(pts)
            self.curves.append(crv)

            self.totalVolume += crv.Length * area

# Instances
allHelixCurves = []
grandTotalVolume = 0.0

if not isinstance(ArchesCurves, list):
    ArchesCurves = [ArchesCurves]

for crv in ArchesCurves:
    if crv is None:
        continue

    bundle = WoodenHelixes(crv, HelixCount, HelixRadius, HelixTurns, RodRadius)
    allHelixCurves.extend(bundle.curves)
    grandTotalVolume += bundle.totalVolume

OUT = [allHelixCurves, grandTotalVolume]
# ----------------------------------------
code_block_5 = CodeBlock(IN=series_of_instances_wooden) { IN[0]; IN[1]; }
pointAtParameter_2 = Curve.PointAtParameter(curve=code_block_5.out0)
byCenterPointRadius_2 = Circle.ByCenterPointRadius(centerPoint=pointAtParameter_2, radius=radius_of_helix_rod)
bySweep = Solid.BySweep(profile=byCenterPointRadius_2, path=code_block_5.out0)
brown_colour = CodeBlock { 255; 150; 110; 70; }
byARGB_2 = Color.ByARGB(alpha=brown_colour.out0, red=brown_colour.out1, green=brown_colour.out2, blue=brown_colour.out3)
material_volume_2_mm_3 = Watch(code_block_5.out1)
class_wooden_helixes = Python()  # CPython3; unwired: IN[0]
# ---------- class_wooden_helixes.python (57 lines) ----------
# Load the Python Standard and DesignScript Libraries
import sys
import clr
clr.AddReference('ProtoGeometry')
from Autodesk.DesignScript.Geometry import *
import math


class WoodenHelixes:
    def __init__(self, archCurve, count, radius, turns, rodRadius):
        self.curves = []
        self.totalVolume = 0

        count = int(count)
        area = math.pi * (rodRadius ** 2)

        for k in range(count):
            pts = []
            prevXDir = None

            for i in range(180):
                t = i / 179

                pt  = archCurve.PointAtParameter(t)
                tan = archCurve.TangentAtParameter(t).Normalized()
                
                zAxis = Vector.ZAxis()
                if abs(tan.Dot(zAxis)) > 0.9:
                    zAxis = Vector.XAxis()

                xDir = tan.Cross(zAxis)
                if xDir.Length != 0:
                    xDir = xDir.Normalized()
                else:
                    xDir = prevXDir or Vector.XAxis()

                yDir = tan.Cross(xDir).Normalized()

                if prevXDir is not None and xDir.Dot(prevXDir) < 0:
                    xDir = xDir.Reverse()
                    yDir = yDir.Reverse()

                prevXDir = xDir

                theta = 2.0 * math.pi * (turns * t + float(k) / count)

                offset = xDir.Scale(radius * math.cos(theta))
                offset = offset.Add(yDir.Scale(radius * math.sin(theta)))

                pts.append(pt.Add(offset))

            crv = NurbsCurve.ByPoints(pts)
            self.curves.append(crv)

            self.totalVolume += crv.Length * area

OUT = 0
# ----------------------------------------

# group: Ground Cutoff
# Ensures helixes don't go below the ground.
code_block_6 = CodeBlock { -400; }
byCoordinates_3 = Point.ByCoordinates(z=code_block_6)
code_block_7 = CodeBlock { 10000; 10000; 600; }
byLengths = Cuboid.ByLengths(origin=byCoordinates_3, width=code_block_7.out0, length=code_block_7.out1, height=code_block_7.out2)
differenceAll = Solid.DifferenceAll(solid=bySweep, others=byLengths)

# group (continued): Helix Nodes
helix_colour_and_geometry = Modifiers.GeometryColor.ByGeometryColor(geometry=differenceAll, color=byARGB_2)

# group: Arch Connector Nodes
# For structural stability.
midpoint_of_arch = CodeBlock { 0.5; }
pointAtParameter_3 = Curve.PointAtParameter(curve=code_block_4.out0, param=midpoint_of_arch)
byPoints = NurbsCurve.ByPoints(points=pointAtParameter_3)
code_block_8 = CodeBlock { 0..1..#20; }
pointAtParameter_4 = Curve.PointAtParameter(curve=byPoints, param=code_block_8)
code_block_9 = CodeBlock { 500; 700; 200; }
cuboid_connector = Cuboid.ByLengths(origin=pointAtParameter_4, width=code_block_9.out0, length=code_block_9.out1, height=code_block_9.out2)
