# Dynamo graph 1859494.dyn (Dynamo 3.6.0.9395)

# group: Don't touch this ground
code_block = CodeBlock { -5000; -5000; -200; }
byCoordinates = Point.ByCoordinates(x=code_block.out0, y=code_block.out1, z=code_block.out2)
code_block_2 = CodeBlock { 5000; 5000; 0; }
byCoordinates_2 = Point.ByCoordinates(x=code_block_2.out0, y=code_block_2.out1, z=code_block_2.out2)
byCorners = Cuboid.ByCorners(lowPoint=byCoordinates, highPoint=byCoordinates_2)
code_block_3 = CodeBlock { 0; 100; 0; }
byARGB = Color.ByARGB(red=code_block_3.out0, green=code_block_3.out1, blue=code_block_3.out2)
byGeometryColor = Modifiers.GeometryColor.ByGeometryColor(geometry=byCorners, color=byARGB)

inital_radius_center_spiral = DoubleSlider(1.2, range=1..3 step 0.1)
growth_factor_spiral = DoubleSlider(0.84, range=0.3..1 step 0.01)
degrees_spiral = IntegerSlider(380, range=0..720 step 1)
num_cylinders_pts_spiral = IntegerSlider(42, range=10..80 step 1)
spiral_points = Python(IN[0]=inital_radius_center_spiral, IN[1]=growth_factor_spiral, IN[2]=degrees_spiral, IN[3]=num_cylinders_pts_spiral)  # CPython3
# ---------- spiral_points.python (30 lines) ----------
import clr
clr.AddReference('ProtoGeometry')
from Autodesk.DesignScript.Geometry import Point, PolyCurve
import math

# Inputs from Dynamo
base_radius = IN[0]*1000    # Starting radius (e.g., 1)
growth_factor = IN[1]*100  # How much radius changes per step (e.g., 0.05)
rotation_angle = IN[2]   # Total rotation in degrees (e.g., 720 for two turns)
points_count = IN[3]     # Number of points (e.g., 200)

# Generate angles in radians
angle_start = 0
angle_end = rotation_angle
angles = [angle_start + i * (angle_end - angle_start) / (points_count - 1) for i in range(points_count)]
angles_rad = [math.radians(a) for a in angles]

# Generate spiral points
points = []
for i, angle in enumerate(angles_rad):
    radius = base_radius + growth_factor * i  # Radius grows with each step
    x = radius * math.cos(angle)
    y = radius * math.sin(angle)
    points.append(Point.ByCoordinates(x, y, 0))

# Create spiral curve


# Output
OUT = points
# ----------------------------------------
x_points = Point.X(point=spiral_points)
grass_dim = CodeBlock { -5000; 5000; }
grass_dim_2 = x_points <= grass_dim.out1
grass_dim_3 = x_points >= grass_dim.out0
and_ = And(bool0=grass_dim_2, bool1=grass_dim_3)
y_points = Point.Y(point=spiral_points)
grass_dim_4 = y_points <= grass_dim.out1
grass_dim_5 = y_points >= grass_dim.out0
and_2 = And(bool0=grass_dim_4, bool1=grass_dim_5)
and_3 = And(bool0=and_, bool1=and_2)
code_block_4 = CodeBlock { false; }
creates_list_of_points_inside = List.FirstIndexOf(list=and_3, item=code_block_4)  # "Creates list of points inside green space"
count = List.Count(list=spiral_points)
code_block_5 = CodeBlock(i=creates_list_of_points_inside, count=count) { index = (i == -1) ? count : i; }
takeItems = List.TakeItems(list=spiral_points, amount=code_block_5)
creates_curve_for_visual_aid = PolyCurve.ByPoints(points=takeItems)
wooden_rod = Python()  # CPython3; unwired: IN[0]
# ---------- wooden_rod.python (22 lines) ----------
import clr
clr.AddReference('ProtoGeometry')
from Autodesk.DesignScript.Geometry import Cylinder
import math

class WoodenCircularRod:
    """Wooden circular rod (cylinder) in mm."""
    def __init__(self, start_point, end_point, diameter_mm):
        self.start = start_point
        self.end = end_point
        self.diameter = float(diameter_mm)

    def make_geometry(self):
        radius = self.diameter / 2.0
        return Cylinder.ByPointsRadius(self.start, self.end, radius)

    def volume(self):
        r = self.diameter / 2.0
        h = self.start.DistanceTo(self.end)   # mm
        return math.pi * (r ** 2) * h        # mm^3

OUT = "WoodenCircularRod class defined"
# ----------------------------------------
code_block_6 = CodeBlock { 0; }
get_some_point_from_spiral = List.GetItemAtIndex(list=takeItems, index=code_block_6)
starting_height_of_rod = DoubleSlider(950, range=200..3000 step 0.1)
wooden_diameter = DoubleSlider(288.7, range=50..500 step 0.1)
wooden_rod_instance = Python(IN[0]=get_some_point_from_spiral, IN[1]=starting_height_of_rod, IN[2]=wooden_diameter)  # CPython3
# ---------- wooden_rod_instance.python (29 lines) ----------
import clr
clr.AddReference('ProtoGeometry')
from Autodesk.DesignScript.Geometry import Point, Cylinder
import math

# --- CLASS COPY HERE ---
class WoodenCircularRod:
    def __init__(self, start_point, end_point, diameter_mm):
        self.start = start_point
        self.end = end_point
        self.diameter = float(diameter_mm)
    def make_geometry(self):
        radius = self.diameter / 2.0
        return Cylinder.ByPointsRadius(self.start, self.end, radius)
    def volume(self):
        r = self.diameter / 2.0
        h = self.start.DistanceTo(self.end)
        return math.pi * (r ** 2) * h

# --- INSTANCE CREATION ---
start_pt = IN[0]
height_mm = IN[1]
diameter_mm = IN[2]

end_pt = Point.ByCoordinates(start_pt.X, start_pt.Y, start_pt.Z + height_mm)

rod = WoodenCircularRod(start_pt, end_pt, diameter_mm)

OUT = rod.make_geometry(), rod.volume(), end_pt
# ----------------------------------------
metal_class = Python()  # CPython3; unwired: IN[0]
# ---------- metal_class.python (22 lines) ----------
import clr
clr.AddReference('ProtoGeometry')
from Autodesk.DesignScript.Geometry import Cylinder
import math

class MetalCylinderCap:
    """Metal cylinder sitting on top of wooden rod."""
    def __init__(self, start_point, end_point, diameter_mm):
        self.start = start_point
        self.end = end_point
        self.diameter = float(diameter_mm)

    def make_geometry(self):
        radius = self.diameter / 2.0
        return Cylinder.ByPointsRadius(self.start, self.end, radius)

    def volume(self):
        r = self.diameter / 2.0
        h = self.start.DistanceTo(self.end)
        return math.pi * (r ** 2) * h

OUT = "MetalCylinderCap class loaded"
# ----------------------------------------
metal_rod_height = DoubleSlider(258, range=10..1000 step 1)
metal_diameter = DoubleSlider(446.4, range=50..500 step 0.1)
metal_rod_instance = Python(IN[0]=get_some_point_from_spiral, IN[1]=metal_rod_height, IN[2]=metal_diameter)  # CPython3
# ---------- metal_rod_instance.python (30 lines) ----------
import clr
clr.AddReference('ProtoGeometry')
from Autodesk.DesignScript.Geometry import Point, Cylinder
import math

# --- CLASS COPY ---
class MetalCylinderCap:
    def __init__(self, start_point, end_point, diameter_mm):
        self.start = start_point
        self.end = end_point
        self.diameter = float(diameter_mm)
    def make_geometry(self):
        radius = self.diameter / 2.0
        return Cylinder.ByPointsRadius(self.start, self.end, radius)
    def volume(self):
        r = self.diameter / 2.0
        h = self.start.DistanceTo(self.end)
        return math.pi * (r ** 2) * h

# --- SINGLE INSTANCE CREATION ---
rod_top = IN[0]
metal_height = IN[1]
metal_diameter = IN[2]

start_pt = rod_top
end_pt = Point.ByCoordinates(rod_top.X, rod_top.Y, rod_top.Z + metal_height)

mc = MetalCylinderCap(start_pt, end_pt, metal_diameter)

OUT = mc.make_geometry(), mc.volume(), end_pt
# ----------------------------------------
wooden_height_increase_for_each = DoubleSlider(152.5, range=0..300 step 0.1)  # "wooden Height increase for each rod"
series_of_instances_of_circular = Python(IN[0]=takeItems, IN[1]=starting_height_of_rod, IN[2]=wooden_height_increase_for_each, IN[3]=wooden_diameter)  # "series of instances of circular wooden rods"; CPython3
# ---------- series_of_instances_of_circular.python (39 lines) ----------
import clr
clr.AddReference('ProtoGeometry')
from Autodesk.DesignScript.Geometry import Point, Cylinder
import math

# --- CLASS COPY HERE ---
class WoodenCircularRod:
    def __init__(self, start_point, end_point, diameter_mm):
        self.start = start_point
        self.end = end_point
        self.diameter = float(diameter_mm)
    def make_geometry(self):
        radius = self.diameter / 2.0
        return Cylinder.ByPointsRadius(self.start, self.end, radius)
    def volume(self):
        r = self.diameter / 2.0
        h = self.start.DistanceTo(self.end)
        return math.pi * (r ** 2) * h

# --- SERIES CREATION ---
base_points = IN[0]
base_height_mm = IN[1]
height_step_mm = IN[2]
diameter_mm = IN[3]

rods_geo = []
rods_vol = []
rod_end_points = []

for i, p in enumerate(base_points):
    this_height = base_height_mm + (height_step_mm * i)
    end_pt = Point.ByCoordinates(p.X, p.Y, p.Z + this_height)
    
    rod = WoodenCircularRod(p, end_pt, diameter_mm)
    rods_geo.append(rod.make_geometry())
    rods_vol.append(rod.volume())
    rod_end_points.append(end_pt)

OUT = rods_geo, rods_vol, sum(rods_vol), rod_end_points
# ----------------------------------------
code_block_7 = CodeBlock { 3; }
getItemAtIndex = List.GetItemAtIndex(list=series_of_instances_of_circular, index=code_block_7)
series_of_instances_of_circular_2 = Python(IN[0]=getItemAtIndex, IN[1]=metal_rod_height, IN[2]=metal_diameter)  # "series of instances of circular metal rods"; CPython3
# ---------- series_of_instances_of_circular_2.python (46 lines) ----------
import clr
clr.AddReference('ProtoGeometry')
from Autodesk.DesignScript.Geometry import Point, Cylinder
import math

# --- CLASS DEFINITION ---
class MetalCylinderCap:
    """Metal cylinder sitting on top of wooden rod."""
    def __init__(self, start_point, end_point, diameter_mm):
        self.start = start_point
        self.end = end_point
        self.diameter = float(diameter_mm)

    def make_geometry(self):
        radius = self.diameter / 2.0
        return Cylinder.ByPointsRadius(self.start, self.end, radius)

    def volume(self):
        r = self.diameter / 2.0
        h = self.start.DistanceTo(self.end)
        return math.pi * (r ** 2) * h

# --- SERIES OF INSTANCES ---
rod_tops = IN[0]       # List of top points from wooden rods
metal_height = IN[1]   # Fixed height for all metal cylinders
metal_diameter = IN[2] # Diameter of cylinders

metal_geometries = []
metal_volumes = []

for top_pt in rod_tops:
    start_pt = top_pt
    end_pt = Point.ByCoordinates(top_pt.X, top_pt.Y, top_pt.Z + metal_height)
    
    mc = MetalCylinderCap(start_pt, end_pt, metal_diameter)
    
    # Generate geometry and volume for this cylinder
    geom = mc.make_geometry()
    vol  = mc.volume()
    
    metal_geometries.append(geom)
    metal_volumes.append(vol)

total_volume = sum(metal_volumes)

OUT = metal_geometries, metal_volumes, total_volume
# ----------------------------------------
code_block_8 = CodeBlock { 0; }
metal_geometry = List.GetItemAtIndex(list=series_of_instances_of_circular_2, index=code_block_8)
color_palette = ColorPalette({R: 255, G: 199, B: 16, A: 255})
changes_colour_of_metal = Modifiers.GeometryColor.ByGeometryColor(geometry=metal_geometry, color=color_palette)
code_block_9 = CodeBlock { 2; }
gets_vol_from_out = List.GetItemAtIndex(list=series_of_instances_of_circular_2, index=code_block_9)
total_volume_of_metal_rod_mm_2 = Watch(gets_vol_from_out)
code_block_10 = CodeBlock { 2; }
gets_vol_from_out_2 = List.GetItemAtIndex(list=series_of_instances_of_circular, index=code_block_10)
total_volume_of_wooden_rod_mm_2 = Watch(gets_vol_from_out_2)
code_block_11 = CodeBlock { 0; }
plaque_height = DoubleSlider(343, range=100..1000 step 1)
low_point_plaque = Point.ByCoordinates(x=code_block_11, y=code_block_11, z=plaque_height)
plaque_width = DoubleSlider(800, range=100..1000 step 1)
plaque_length = DoubleSlider(800, range=100..1000 step 1)
high_point_plaque = Point.ByCoordinates(x=plaque_width, y=plaque_length, z=code_block_11)
plaque = Cuboid.ByCorners(lowPoint=low_point_plaque, highPoint=high_point_plaque)
metal_geometry_2 = List.GetItemAtIndex(list=series_of_instances_of_circular, index=code_block_8)
color_palette_2 = ColorPalette({R: 19, G: 77, B: 1, A: 255})
changes_colour_of_metal_2 = Modifiers.GeometryColor.ByGeometryColor(geometry=metal_geometry_2, color=color_palette_2)
volume_of_plaque = CodeBlock(height=plaque_height, width=plaque_width, length=plaque_length) { height * width * length; }
volume_of_plaque_mm_2 = Watch(volume_of_plaque)
