# Dynamo graph 1859720.dyn (Dynamo 3.6.0.9395)

# group: Don't touch this ground
code_block = CodeBlock { -5000; -5000; -200; }
byCoordinates = Point.ByCoordinates(x=code_block.out0, y=code_block.out1, z=code_block.out2)
code_block_2 = CodeBlock { 5000; 5000; 0; }
byCoordinates_2 = Point.ByCoordinates(x=code_block_2.out0, y=code_block_2.out1, z=code_block_2.out2)
byCorners = Cuboid.ByCorners(lowPoint=byCoordinates, highPoint=byCoordinates_2)
code_block_3 = CodeBlock { 0; 100; 0; }
byARGB = Color.ByARGB(red=code_block_3.out0, green=code_block_3.out1, blue=code_block_3.out2)
byGeometryColor = Modifiers.GeometryColor.ByGeometryColor(geometry=byCorners, color=byARGB)

center_point = CodeBlock { Point.ByCoordinates(0, 0, 0); }

# group: SLIDERS
pavillion_size = DoubleSlider(8000, range=6000..9000 step 500)
number_of_columns = DoubleSlider(8, range=4..12 step 1)
column_lean_factor = DoubleSlider(0.8, range=0.45..1 step 0.05)
roof_height = DoubleSlider(4000, range=3000..6000 step 100)
peak_height = DoubleSlider(1500, range=0..2000 step 50)

base_circle_radius = CodeBlock(size=pavillion_size) { size/2; }
base_circle = Circle.ByCenterPointRadius(centerPoint=center_point, radius=base_circle_radius)
number_of_columns_1 = CodeBlock(num=number_of_columns) { num+1; }
code_block_4 = CodeBlock(num=number_of_columns_1) { 0..1..#num; }
column_locations_on_floor_level = Curve.PointAtParameter(curve=base_circle, param=code_block_4)
column_ground_x = Point.X(point=column_locations_on_floor_level)
column_ground_y = Point.Y(point=column_locations_on_floor_level)
column_top_point = CodeBlock(base_x=column_ground_x, lean=column_lean_factor, base_y=column_ground_y, height=roof_height)
# ---------- column_top_point.designscript (5 lines) ----------
Point.ByCoordinates(
    base_x * lean,
    base_y * lean,
    height
);
# ----------------------------------------
code_block_5 = CodeBlock(start_pt=column_locations_on_floor_level, end_pt=column_top_point) { Vector.ByTwoPoints(start_pt, end_pt); }
highest_point_on_roof = CodeBlock(height=roof_height, peak=peak_height) { Point.ByCoordinates(0, 0, height + peak); }
roof_hole_radius = CodeBlock { 200; }
roof_hole = Circle.ByCenterPointRadius(centerPoint=highest_point_on_roof, radius=roof_hole_radius)
roof_outline = PolyCurve.ByPoints(points=column_top_point)
list_create = List.Create(item0=roof_hole, item1=roof_outline)
create_roof = Surface.ByLoft(crossSections=list_create)
roof_thickness = CodeBlock { 50; }
thicken_roof = Surface.Thicken(surface=create_roof, thickness=roof_thickness)
class_aluminum_roof = Python(IN[0]=create_roof, IN[1]=roof_thickness)  # CPython3
# ---------- class_aluminum_roof.python (34 lines) ----------
# Load the Python Standard and DesignScript Libraries
import sys
import clr
clr.AddReference('ProtoGeometry')
from Autodesk.DesignScript.Geometry import *

# The inputs to this node will be stored as a list in the IN variables.
dataEnteringNode = IN


# Class: Aluminum Roof Panel
class AluminumRoof:
    def __init__(self, surface, thickness):
        self.surface = surface
        self.thickness = thickness
    
    def create_geometry(self):
        # Thicken surface to create solid panel
        solid = self.surface.Thicken(self.thickness)
        return solid
    
    def calculate_volume(self):
        solid = self.create_geometry()
        return solid.Volume

# Get inputs
surface = IN[0]
thickness = IN[1]

roof = AluminumRoof(surface, thickness)
geometry = roof.create_geometry()
volume = roof.calculate_volume()

OUT = [geometry, volume]
# ----------------------------------------
list_create_2 = List.Create(item0=class_aluminum_roof)
roof_geometry_volume = Watch(list_create_2)
flatten = CodeBlock { -1; }
flatten_lists_into_one = List.Flatten(list=roof_geometry_volume, amount=flatten)
index = CodeBlock { 1; }
extract_roof_volume = List.GetItemAtIndex(list=flatten_lists_into_one, index=index)
repeated_point_index = CodeBlock(num=number_of_columns) { num; }
remove_repeated_point = List.RemoveItemAtIndex(list=column_locations_on_floor_level, indices=repeated_point_index)
column_diameter = CodeBlock { 200; }
column_length_base_projection = CodeBlock(x=column_ground_x, y=column_ground_y, l=column_lean_factor) { Math.Sqrt(x*x+y*y)-Math.Sqrt(l*x*x+l*y*y); }
column_length = CodeBlock(h=roof_height, b=column_length_base_projection) { Math.Sqrt(h*h+b*b); }
any_column = CodeBlock { 0; }
getItemAtIndex = List.GetItemAtIndex(list=column_length, index=any_column)
class_steel_column = Python(IN[0]=remove_repeated_point, IN[1]=column_top_point, IN[2]=column_diameter, IN[3]=getItemAtIndex)  # CPython3
# ---------- class_steel_column.python (64 lines) ----------
# Load the Python Standard and DesignScript Libraries
import sys
import clr
clr.AddReference('ProtoGeometry')
from Autodesk.DesignScript.Geometry import *

# The inputs to this node will be stored as a list in the IN variables.
dataEnteringNode = IN

# Place your code below this line

# Class: Steel Column
class SteelColumn:
    def __init__(self, start_point, end_point, diameter, length):
        self.start_point = start_point
        self.end_point = end_point
        self.diameter = diameter
        self.length = length
    
    def create_geometry(self):
        # Create circle at base
        circle = Circle.ByCenterPointRadius(
            self.start_point, 
            self.diameter / 2
        )
        # Create line from start to end (the slanted path)
        line = Line.ByStartPointEndPoint(self.start_point, self.end_point)
        # Sweep circle along the line
        solid = circle.SweepAsSolid(line)
        return solid
    
    def calculate_volume(self):
        # Calculate volume using cylinder formula: π * r² * length
        import math
        radius = self.diameter / 2
        volume = math.pi * (radius ** 2) * self.length
        return volume

# Get inputs
start_points = IN[0]  # Ground points
end_points = IN[1]    # Slanted top points
diameter = IN[2]
lengths = IN[3]       # Your length calculations

geometries = []
volumes = []

# Create column for each pair of points
if isinstance(start_points, list) and isinstance(end_points, list):
    # Handle if lengths is a single value or a list
    if not isinstance(lengths, list):
        lengths = [lengths] * len(start_points)
    
    # Use zip to pair them correctly
    for start_pt, end_pt, length in zip(start_points, end_points, lengths):
        column = SteelColumn(start_pt, end_pt, diameter, length)
        geometries.append(column.create_geometry())
        volumes.append(column.calculate_volume())
else:
    column = SteelColumn(start_points, end_points, diameter, lengths)
    geometries = column.create_geometry()
    volumes = column.calculate_volume()

OUT = geometries, volumes
# ----------------------------------------
list_create_3 = List.Create(item0=class_steel_column)
column_geometries_volumes = Watch(list_create_3)
code_block_6 = CodeBlock { -1; }
flatten_lists_into_one_2 = List.Flatten(list=column_geometries_volumes, amount=code_block_6)
getItemAtIndex_2 = List.GetItemAtIndex(list=flatten_lists_into_one_2, index=number_of_columns)

# group: VOLUMES
# Roof volume, single column volume, and combined volume of columns.
roof_volume = Watch(extract_roof_volume)
column_volume = Watch(getItemAtIndex_2)

code_block_7 = CodeBlock(v=column_volume, num=number_of_columns) { v*num; }

# group (continued): VOLUMES
total_column_volume = Watch(code_block_7)
