# Dynamo graph 1859917.dyn (Dynamo 4.0.0.3277)

# group: Don't touch this ground
code_block = CodeBlock { -5000; -5000; -200; }
byCoordinates = Point.ByCoordinates(x=code_block.out0, y=code_block.out1, z=code_block.out2)
code_block_2 = CodeBlock { 5000; 5000; 0; }
byCoordinates_2 = Point.ByCoordinates(x=code_block_2.out0, y=code_block_2.out1, z=code_block_2.out2)
byCorners = Cuboid.ByCorners(lowPoint=byCoordinates, highPoint=byCoordinates_2)
code_block_3 = CodeBlock { 0; 100; 0; }
byARGB = Color.ByARGB(red=code_block_3.out0, green=code_block_3.out1, blue=code_block_3.out2)
byGeometryColor = Modifiers.GeometryColor.ByGeometryColor(geometry=byCorners, color=byARGB)

height = DoubleSlider(4500, range=3000..6000 step 250)
slices = DoubleSlider(15, range=5..50 step 1)
code_block_4 = CodeBlock(Lengths=height, Slices=slices) { Lengths; Slices; Interval = 0..1..#Slices; x = Interval*Lengths; }
depth = IntegerSlider(4, range=1..5 step 1)
left_r = CodeBlock(Lengths=height, z=code_block_4.x, Depth=depth) { Lengths; z; d = 10000-1500*Depth; x = -(z-Lengths/2)*(z-Lengths/2)/d; }
middle = DoubleSlider(500, range=100..1000 step 100)
middle_cutout = Python(IN[0]=left_r.x, IN[1]=middle)  # PythonNet3
# ---------- middle_cutout.python (20 lines) ----------
x_values = IN[0]
min_value_input = IN[1]


if x_values is None:
    x_values = []   
if min_value_input is None:
    min_value = -100
      
else:
    min_value = -min_value_input

adjusted_values = []
for val in x_values:
    if val is None or val > min_value:
        adjusted_values.append(min_value)
    else:
        adjusted_values.append(val)

OUT = adjusted_values
# ----------------------------------------
code_block_5 = CodeBlock { 0; }
byCoordinates_3 = Point.ByCoordinates(x=middle_cutout, y=code_block_5, z=left_r.z)
right_r = CodeBlock(Lengths=height, z=code_block_4.x, Depth=depth) { Lengths; z; d = 10000-1500*Depth; x = (z-Lengths/2)*(z-Lengths/2)/d; }
middle_cutout_2 = Python(IN[0]=right_r.x, IN[1]=middle)  # PythonNet3
# ---------- middle_cutout_2.python (20 lines) ----------
x_values = IN[0]
min_value_input = IN[1]


if x_values is None:
    x_values = []   
if min_value_input is None:
    min_value = 100
      
else:
    min_value = min_value_input

adjusted_values = []
for val in x_values:
    if val is None or val < min_value:
        adjusted_values.append(min_value)
    else:
        adjusted_values.append(val)

OUT = adjusted_values
# ----------------------------------------
byCoordinates_4 = Point.ByCoordinates(x=middle_cutout_2, y=code_block_5, z=right_r.z)
byStartPointEndPoint = Line.ByStartPointEndPoint(startPoint=byCoordinates_3, endPoint=byCoordinates_4)
length = Curve.Length(curve=byStartPointEndPoint)
code_block_6 = CodeBlock(total_height=height, bench_number=slices) { total_height; bench_number; created = bench_number - 1; bench_height = total_height / created; bench_height; }
bench_height = Watch(code_block_6.out4)
concrete_pillar_from_series = Python(IN[0]=byStartPointEndPoint, IN[1]=code_block_6.out4)  # PythonNet3
# ---------- concrete_pillar_from_series.python (58 lines) ----------
import clr
import math
clr.AddReference('ProtoGeometry')
from Autodesk.DesignScript.Geometry import *

lines = IN[0]
height_val = IN[1]

class ConcreteStackedCylinder:
    def __init__(self, lines, height):
        self.lines = lines
        self.height = float(height[0] if isinstance(height, list) and height else height)
        
    def make(self):
        cylinders = []
        current_z = 0
        
        if not self.lines or len(self.lines) < 2:
            return cylinders
            
        for i in range(len(self.lines) - 1):
            L1, L2 = self.lines[i], self.lines[i+1]
            
            m1 = L1.PointAtParameter(0.5)
            m2 = L2.PointAtParameter(0.5)
            center_x = (m1.X + m2.X) / 2
            center_y = (m1.Y + m2.Y) / 2
            
            radius = (L1.Length + L2.Length) / 4
            
            bottom = Point.ByCoordinates(center_x, center_y, current_z)
            top = Point.ByCoordinates(center_x, center_y, current_z + self.height)
            cylinder = Cylinder.ByPointsRadius(bottom, top, radius)
            cylinders.append(cylinder)
            
            current_z += self.height
            
        return cylinders
        
    def calculate_volume(self):
        total = 0
        
        if not self.lines or len(self.lines) < 2:
            return total
            
        for i in range(len(self.lines) - 1):
            L1, L2 = self.lines[i], self.lines[i+1]
            radius = (L1.Length + L2.Length) / 4
            total += math.pi * radius * radius * self.height
            
        return total


maker = ConcreteStackedCylinder(lines, height_val)
cylinders = maker.make()
volume = maker.calculate_volume()

OUT = cylinders, volume
# ----------------------------------------
code_block_7 = CodeBlock { 1; }
code_block_8 = CodeBlock { 2; }
vol_extract = List.Slice(list=concrete_pillar_from_series, start=code_block_7, end=code_block_8, step=code_block_8)
volume_concrete_for_series = Watch(vol_extract)  # "Volume Concrete for Series Pillar mm^3"
code_block_9 = CodeBlock { 0; }
code_block_10 = CodeBlock { 1; }
radius_extract = List.Slice(list=concrete_pillar_from_series, start=code_block_9, end=code_block_10, step=code_block_10)
deconstruct = List.Deconstruct(list=radius_extract)
deconstruct_2 = List.Deconstruct(list=deconstruct.first)
max_radius = Python(IN[0]=deconstruct_2.first)  # PythonNet3
# ---------- max_radius.python (9 lines) ----------
radius = IN[0]

def get_cylinder_radius(cylinder):
    s = str(cylinder)
    start = s.find("Radius = ") + 9
    end = s.find(",", start)
    return float(s[start:end])
max_radius = get_cylinder_radius(radius) 
OUT = max_radius
# ----------------------------------------
watch = Watch(max_radius)
z_max = Python(IN[0]=byStartPointEndPoint)  # PythonNet3
# ---------- z_max.python (9 lines) ----------
input_lines = IN[0]  
z_values = []

for line in input_lines:
    end_point = line.EndPoint
    z = end_point.Z
    z_values.append(z)

OUT = z_values
# ----------------------------------------
maximumItem = List.MaximumItem(list=z_max)
offset = CodeBlock { 0.5; }
pointAtParameter = Curve.PointAtParameter(curve=byStartPointEndPoint, param=offset)
center_point = Python(IN[0]=maximumItem, IN[1]=pointAtParameter)  # PythonNet3
# ---------- center_point.python (10 lines) ----------
z_max = IN[0]
center_points = IN[1]

center_max = []

for Point in center_points:
    if abs(Point.Z - z_max) < 0.01:
        center_max.append(Point)

OUT = center_max    
# ----------------------------------------
roof_height = DoubleSlider(1300, range=500..1500 step 100)
roof_size = DoubleSlider(2.3, range=1..5 step 0.1)
straw_cone_roof = Python(IN[0]=center_point, IN[1]=max_radius, IN[2]=roof_height, IN[3]=roof_size)  # PythonNet3
# ---------- straw_cone_roof.python (46 lines) ----------
import clr
import math
clr.AddReference('ProtoGeometry')
from Autodesk.DesignScript.Geometry import *

center_pt = IN[0]
radius_val = IN[1]
height_val = IN[2]
multiplier_val = IN[3]

class StrawCone:
    def __init__(self, center, radius, height, mult):
        self.center = center[0] if isinstance(center, list) and center else center
        self.radius = float(radius[0] if isinstance(radius, list) and radius else radius)
        self.height = float(height[0] if isinstance(height, list) and height else height)
        self.mult = float(mult[0] if isinstance(mult, list) and mult else mult)
        
    def make(self):
        if not self.center:
            return None
            
        true_radius = self.radius * self.mult
        if true_radius > 4999:
            true_radius = 4999
            
        apex = Point.ByCoordinates(
            self.center.X,
            self.center.Y,
            self.center.Z + self.height
        )
        
        return Cone.ByPointsRadius(self.center, apex, true_radius)
    
    def calculate_volume(self):
        true_radius = self.radius * self.mult
        if true_radius > 4999:
            true_radius = 4999
            
        return (1/3) * math.pi * true_radius * true_radius * self.height


cone_maker = StrawCone(center_pt, radius_val, height_val, multiplier_val)
final_cone = cone_maker.make()
volume = cone_maker.calculate_volume()

OUT = final_cone, volume
# ----------------------------------------
vol_extract_2 = List.Slice(list=straw_cone_roof, start=code_block_7, end=code_block_8, step=code_block_7)
volume_straw_for_roof_mm_3 = Watch(vol_extract_2)
debug = Watch(byCoordinates_3)
debug_2 = Watch(byCoordinates_4)
debug_3 = Watch(maximumItem)
debug_4 = Watch(pointAtParameter)
debug_5 = Watch(radius_extract)
debug_6 = Watch(max_radius)
