# Dynamo graph 1859940.dyn (Dynamo 3.6.0.9395)

# group: Don't touch this ground
code_block = CodeBlock { -5000; -5000; -200; }
byCoordinates = Point.ByCoordinates(x=code_block.out0, y=code_block.out1, z=code_block.out2)
code_block_2 = CodeBlock { 5000; 5000; 0; }
byCoordinates_2 = Point.ByCoordinates(x=code_block_2.out0, y=code_block_2.out1, z=code_block_2.out2)
byCorners = Cuboid.ByCorners(lowPoint=byCoordinates, highPoint=byCoordinates_2)
code_block_3 = CodeBlock { 0; 100; 0; }
byARGB = Color.ByARGB(red=code_block_3.out0, green=code_block_3.out1, blue=code_block_3.out2)
byGeometryColor = Modifiers.GeometryColor.ByGeometryColor(geometry=byCorners, color=byARGB)

# group: Parameters
column_height_h_col = DoubleSlider(3900, range=3000..5000 step 50)
sphere_radius_r_ball = DoubleSlider(1300, range=1000..2500 step 50)
angle_spread_x_spread = DoubleSlider(1800, range=1000..4500 step 50)
column_radius_r_col = DoubleSlider(340, range=150..600 step 10)

# group: Sphere
z_base = CodeBlock { 0; }
byCoordinates_3 = Point.ByCoordinates(x=z_base, y=z_base, z=column_height_h_col)
byCenterPointRadius = Sphere.ByCenterPointRadius(centerPoint=byCoordinates_3, radius=sphere_radius_r_ball)
class_sphere_structure_material = Python(IN[0]=byCenterPointRadius)  # "Class: Sphere Structure (Material A)"; CPython3
# ---------- class_sphere_structure_material.python (18 lines) ----------
import clr
clr.AddReference('ProtoGeometry')
from Autodesk.DesignScript.Geometry import *

solid_geometry = IN[0] 

class SphereStructure:
    def __init__(self, geometry):
        self.geometry = geometry
        self.volume = self.calculate_volume()

    def generate_geometry(self):
        return self.geometry

    def calculate_volume(self):
        return self.geometry.Volume

OUT = SphereStructure
# ----------------------------------------
instance_sphere_volume_1 = Python(IN[0]=class_sphere_structure_material, IN[1]=byCenterPointRadius)  # CPython3
# ---------- instance_sphere_volume_1.python (11 lines) ----------
import clr
clr.AddReference('ProtoGeometry')
from Autodesk.DesignScript.Geometry import *

ClassDefinition = IN[0]
SolidGeometry = IN[1]

MySphere = ClassDefinition(SolidGeometry)
Volume_mm3 = MySphere.volume

OUT = str(Volume_mm3) + " mm^3"
# ----------------------------------------
material_volume_1_mm_3 = Watch(instance_sphere_volume_1)
code_block_4 = CodeBlock { 255; 215; 0; }
material_a_the_gold_sphere = Color.ByARGB(alpha=code_block_4.out0, red=code_block_4.out0, green=code_block_4.out1, blue=code_block_4.out2)
byGeometryColor_2 = Modifiers.GeometryColor.ByGeometryColor(geometry=byCenterPointRadius, color=material_a_the_gold_sphere)

# group: Columns
SPREAD_VALUES = CodeBlock(X_Spread=angle_spread_x_spread) { [X_Spread, -X_Spread]; }
byCoordinates_4 = Point.ByCoordinates(x=SPREAD_VALUES, y=SPREAD_VALUES, z=z_base, lacing=CrossProduct)
byStartPointEndPoint = Line.ByStartPointEndPoint(startPoint=byCoordinates_4, endPoint=byCoordinates_3, lacing=Longest)
class_column_structure_material = Python()  # "Class: Column Structure (Material B)"; CPython3; unwired: IN[0]
# ---------- class_column_structure_material.python (19 lines) ----------
import clr
clr.AddReference('ProtoGeometry')
from Autodesk.DesignScript.Geometry import *
        
# This node defines the class structure and does NOT require geometry input.
        
class ColumnStructure:
    # Constructor takes a single geometry instance
    def __init__(self, single_geometry):
        self.geometry = single_geometry
        self.volume = self.calculate_volume()

    def calculate_volume(self):
        # This is where the error trace points. It must receive a single solid.
        if self.geometry:
            return self.geometry.Volume
        return 0

OUT = ColumnStructure
# ----------------------------------------
byPointsRadius = Cylinder.ByPointsRadius(startPoint=byCoordinates_4, endPoint=byCoordinates_3, radius=column_radius_r_col)
series_of_instances_column = Python(IN[0]=class_column_structure_material, IN[1]=byPointsRadius)  # "Series of Instances: Column Volume 2"; CPython3
# ---------- series_of_instances_column.python (46 lines) ----------
import clr
clr.AddReference('ProtoGeometry')
from Autodesk.DesignScript.Geometry import *
import sys

# Define a function to check if something is a list
def is_list_like(obj):
    return hasattr(obj, '__iter__') and not isinstance(obj, str)

ClassDefinition = IN[0]
List_of_Solids = IN[1]

Total_Volume_mm3 = 0.0

# Ensure the primary input is iterable
if not is_list_like(List_of_Solids):
    # Handle case where only a single solid was provided (unlikely here, but safe)
    List_of_Solids = [List_of_Solids]

# Iterate over the potentially complex list structure
for item in List_of_Solids:
    solid_to_process = item
    
    # Check if the item is an unexpected nested list (the source of the error)
    if is_list_like(item):
        # Assuming the actual solid is the first element, or it's a list of solids
        for potential_solid in item:
            if hasattr(potential_solid, 'Volume'):
                solid_to_process = potential_solid
                break
            else:
                continue # Skip nested list item if it's not a solid

    # Only process if we have a solid object (it has a 'Volume' attribute)
    if hasattr(solid_to_process, 'Volume'):
        try:
            # Create an instance of the class for the current solid
            ColumnInstance = ClassDefinition(solid_to_process)
            
            # Sum the instance's volume to the running total
            Total_Volume_mm3 += ColumnInstance.volume
        except Exception as e:
             # Fallback: if class creation fails, try reading volume directly
             Total_Volume_mm3 += solid_to_process.Volume

OUT = str(Total_Volume_mm3) + " mm^3"
# ----------------------------------------
watch = Watch(series_of_instances_column)
code_block_5 = CodeBlock { 255; 0; 102; 51; }
material_b_the_green_columns = Color.ByARGB(alpha=code_block_5.out0, red=code_block_5.out1, green=code_block_5.out2, blue=code_block_5.out3)
byGeometryColor_3 = Modifiers.GeometryColor.ByGeometryColor(geometry=byPointsRadius, color=material_b_the_green_columns)
