# Dynamo graph 1859965.dyn "Start (without the group)" (Dynamo 4.0.0.3277)

code_block = CodeBlock { -5000; -5000; -200; }
byCoordinates = Point.ByCoordinates(x=code_block.out0, y=code_block.out1, z=code_block.out2)
code_block_2 = CodeBlock { 5000; 5000; 0; }
byCoordinates_2 = Point.ByCoordinates(x=code_block_2.out0, y=code_block_2.out1, z=code_block_2.out2)
byCorners = Cuboid.ByCorners(lowPoint=byCoordinates, highPoint=byCoordinates_2)
code_block_3 = CodeBlock { 0; 100; 0; }
byARGB = Color.ByARGB(red=code_block_3.out0, green=code_block_3.out1, blue=code_block_3.out2)
byGeometryColor = Modifiers.GeometryColor.ByGeometryColor(geometry=byCorners, color=byARGB)
class_gold_arches = Python()  # PythonNet3
# ---------- class_gold_arches.python (22 lines) ----------
# Load the Python Standard and DesignScript Libraries
import sys
import clr
clr.AddReference('ProtoGeometry')
from Autodesk.DesignScript.Geometry import *

import Autodesk.DesignScript.Geometry as DG

class ArchBuilder:
    def __init__(self, height):
        self.h = height

    def create_arch(self, p0, p1):

        mid = DG.Point.ByCoordinates(
            (p0.X + p1.X) / 2,
            (p0.Y + p1.Y) / 2,
            (p0.Z + p1.Z) / 2 + self.h
        )
        return DG.NurbsCurve.ByPoints([p0, mid, p1])

OUT = ArchBuilder
# ----------------------------------------
code_block_4 = CodeBlock { 0; 0; }
height_of_pavilion = DoubleSlider(5000, range=3600..5000 step 600)
byCoordinates_3 = Point.ByCoordinates(x=code_block_4.out0, y=code_block_4.out1, z=height_of_pavilion)
radious_of_pavilion = DoubleSlider(4500, range=0..5000 step 500)
number_of_divisions = DoubleSlider(32, range=8..48 step 8)
code_block_5 = CodeBlock { no; }  # unwired: no
sphere = Mesh.Sphere(origin=byCoordinates_3, radius=radious_of_pavilion, divisions=number_of_divisions, icosphere=code_block_5)
vertexPositions = Mesh.VertexPositions(mesh=sphere)
middle_section_of_sphere = Python(IN[0]=vertexPositions, IN[1]=height_of_pavilion)  # PythonNet3
# ---------- middle_section_of_sphere.python (23 lines) ----------
# Load the Python Standard and DesignScript Libraries
import sys
import clr
clr.AddReference('ProtoGeometry')
from Autodesk.DesignScript.Geometry import *

points = IN[0]          # list of lines or single line
cutoff = IN[1]         

def filter_points(points, cutoff):
 
    if not isinstance(points, list):
        points = [points]
        
    cleaned = []
    for p in points:    
        if int(cutoff - 50) < int(p.Z) <= int(cutoff + 50):
            cleaned.append(p)

    return cleaned


OUT = filter_points(points, cutoff)
# ----------------------------------------
width_of_middle_section = DoubleSlider(-1000, range=-1500..0 step 500)
lower_middle_section = Geometry.Translate(geometry=middle_section_of_sphere, zTranslation=width_of_middle_section)
base_height_of_arches = CodeBlock(x=height_of_pavilion, Y=width_of_middle_section) { Max = -(x + Y); }
base_points_for_arches = Geometry.Translate(geometry=lower_middle_section, zTranslation=base_height_of_arches)
arch_height = DoubleSlider(3500, range=0..3500 step 500)
python_script = Python(IN[0]=class_gold_arches, IN[1]=base_points_for_arches, IN[2]=arch_height)  # PythonNet3
# ---------- python_script.python (19 lines) ----------
ArchBuilder = IN[0]   # class from node 1
pts = IN[1]           # list of circle points
height = IN[2]        # arch height

# Create instance of ArchBuilder
AB = ArchBuilder(height)

# Select every other point
filtered_pts = pts[::2]

arches = []

# Create arches between consecutive points
for i in range(len(filtered_pts)):
    p0 = filtered_pts[i]
    p1 = filtered_pts[(i + 1) % len(filtered_pts)]   # wrap-around using modulo
    arches.append(AB.create_arch(p0, p1))

OUT = arches
# ----------------------------------------
class_circular_steel = Python()  # PythonNet3
# ---------- class_circular_steel.python (27 lines) ----------
# Load the Python Standard and DesignScript Libraries
import sys
import clr
import math

clr.AddReference('ProtoGeometry')
from Autodesk.DesignScript.Geometry import *

class CircularSteel:
    def __init__(self, centerline, radius):
        self.centerline = centerline
        self.radius = radius
        
    def endpoints(self):
        return self.centerline.StartPoint, self.centerline.EndPoint
        
    def geometry(self):
        end1, end2 = self.endpoints()
        
        return Cylinder.ByPointsRadius(end1, end2, self.radius)
        
    def volume_rods(self):
        end1, end2 = self.endpoints()
        length = end1.DistanceTo(end2)
        return length * (self.radius**2) * math.pi
        
OUT = CircularSteel
# ----------------------------------------
edges = Mesh.Edges(mesh=sphere)
top_half_of_sphere = Python(IN[0]=edges, IN[1]=height_of_pavilion)  # PythonNet3
# ---------- top_half_of_sphere.python (25 lines) ----------
# Load the Python Standard and DesignScript Libraries
import sys
import clr
clr.AddReference('ProtoGeometry')
from Autodesk.DesignScript.Geometry import *

lines = IN[0]          # list of lines or single line
cutoff = IN[1]         # Z-value (or 

def filter_lines(lines, cutoff):
    # ensure input is a list
    if not isinstance(lines, list):
        lines = [lines]

    cleaned = []
    for l in lines:
        p1 = l.StartPoint
        p2 = l.EndPoint

        if int(p1.Z) >= (cutoff-50) and int(p2.Z) >= (cutoff-50):
            cleaned.append(l)

    return cleaned

OUT = filter_lines(lines, cutoff)
# ----------------------------------------
list_of_dome_edges = Watch(top_half_of_sphere)
thickness_of_dome_rods = DoubleSlider(80, range=0..200 step 10)
series_of_instances_of_circular = Python(IN[0]=class_circular_steel, IN[1]=list_of_dome_edges, IN[2]=thickness_of_dome_rods)  # "Series of instances of circular steel rods"; PythonNet3
# ---------- series_of_instances_of_circular.python (15 lines) ----------
CircularSteel = IN[0]
lines = IN[1]
radius = IN[2]

def process(line):
    obj = CircularSteel(line, radius)
    return obj.geometry(), obj.volume_rods()

# If input is a list of lines:
if isinstance(lines, list):
    OUT = [process(l) for l in lines]

# If input is a single line:
else:
    OUT = process(lines)
# ----------------------------------------
total_volume_of_steel = Python(IN[0]=series_of_instances_of_circular)  # PythonNet3
# ---------- total_volume_of_steel.python (13 lines) ----------
# Load the Python Standard and DesignScript Libraries
import sys
import clr
clr.AddReference('ProtoGeometry')
from Autodesk.DesignScript.Geometry import *

data = IN[0]    
volumes = []

for item in data:
    volumes.append(item[1])   # second element is the volume

OUT = sum(volumes)
# ----------------------------------------
class_circular_steel_2 = Python()  # PythonNet3; same code as class_circular_steel
top_middle_section_circle = Python(IN[0]=middle_section_of_sphere)  # PythonNet3
# ---------- top_middle_section_circle.python (22 lines) ----------
# Load the Python Standard and DesignScript Libraries
import sys
import clr
clr.AddReference('ProtoGeometry')
from Autodesk.DesignScript.Geometry import Line


pts = IN[0]   # list of points

lines = []

for i in range(len(pts)):
    if pts[i] != pts[-1]:
        p1 = pts[i]
        p2 = pts[(i + 1)] 
        lines.append(Line.ByStartPointEndPoint(p1, p2))
    if pts[i] == pts[-1]:
        p1 = pts[-1]
        p2 = pts[0]
        lines.append(Line.ByStartPointEndPoint(p1, p2))

OUT = lines
# ----------------------------------------
number_slider = DoubleSlider(200, range=0..200 step 10)
series_of_instances_of_circular_2 = Python(IN[0]=class_circular_steel_2, IN[1]=top_middle_section_circle, IN[2]=number_slider)  # "Series of instances of circular steel rods"; PythonNet3
# ---------- series_of_instances_of_circular_2.python (18 lines) ----------
CircularSteel = IN[0]
lines = IN[1]
radius = IN[2]

def process(line):
    obj = CircularSteel(line, radius)
    return obj.geometry(), obj.volume_rods()

# If input is a list of lines:
if isinstance(lines, list):
    OUT = [process(l) for l in lines]

# If input is a single line:
else:
    OUT = process(lines)


#OUT = [sphere_steel.geometry(), sphere_steel.volume_rods()]
# ----------------------------------------
total_volume_of_steel_2 = Python(IN[0]=series_of_instances_of_circular_2)  # PythonNet3
# ---------- total_volume_of_steel_2.python (13 lines) ----------
# Load the Python Standard and DesignScript Libraries
import sys
import clr
clr.AddReference('ProtoGeometry')
from Autodesk.DesignScript.Geometry import *

data = IN[0]     
volumes = []

for item in data:
    volumes.append(item[1])  

OUT = sum(volumes)
# ----------------------------------------
middle_section_vertical_lines = Line.ByStartPointEndPoint(startPoint=middle_section_of_sphere, endPoint=lower_middle_section)
series_of_instances_of_circular_3 = Python(IN[0]=class_circular_steel_2, IN[1]=middle_section_vertical_lines, IN[2]=number_slider)  # "Series of instances of circular steel rods"; PythonNet3; same code as series_of_instances_of_circular_2
total_volume_of_steel_3 = Python(IN[0]=series_of_instances_of_circular_3)  # PythonNet3; same code as total_volume_of_steel_2
bottom_middle_section_circle = Python(IN[0]=lower_middle_section)  # PythonNet3; same code as top_middle_section_circle
series_of_instances_of_circular_4 = Python(IN[0]=class_circular_steel_2, IN[1]=bottom_middle_section_circle, IN[2]=number_slider)  # "Series of instances of circular steel rods"; PythonNet3; same code as series_of_instances_of_circular_2
total_volume_of_steel_4 = Python(IN[0]=series_of_instances_of_circular_4)  # PythonNet3
# ---------- total_volume_of_steel_4.python (13 lines) ----------
# Load the Python Standard and DesignScript Libraries
import sys
import clr
clr.AddReference('ProtoGeometry')
from Autodesk.DesignScript.Geometry import *

data = IN[0]    
volumes = []

for item in data:
    volumes.append(item[1])  

OUT = sum(volumes)
# ----------------------------------------
class_circular_steel_3 = Python()  # PythonNet3; same code as class_circular_steel
gold_arch_instances = Python(IN[0]=class_gold_arches, IN[1]=base_points_for_arches, IN[2]=arch_height)  # PythonNet3
# ---------- gold_arch_instances.python (19 lines) ----------
ArchBuilder = IN[0]   # class from node 1
pts = IN[1]           # list of circle points
height = IN[2]        # arch height


AB = ArchBuilder(height)

# Select every other point
filtered_pts = pts[::2]

arches = []


for i in range(len(filtered_pts)):
    p0 = filtered_pts[i]
    p1 = filtered_pts[(i + 1) % len(filtered_pts)]   
    arches.append(AB.create_arch(p0, p1))

OUT = arches
# ----------------------------------------
arch_bottom_point = Curve.StartPoint(curve=gold_arch_instances)
code_block_6 = CodeBlock { 0.5; }
arch_top_point = Curve.PointAtParameter(curve=gold_arch_instances, param=code_block_6)
bottom_circle_of_middle = Python(IN[0]=arch_bottom_point, IN[1]=arch_top_point)  # PythonNet3
# ---------- bottom_circle_of_middle.python (16 lines) ----------
# Load the Python Standard and DesignScript Libraries
import sys
import clr
clr.AddReference('ProtoGeometry')
from Autodesk.DesignScript.Geometry import *

list1 = IN[0]   # [1,2,3,...]
list2 = IN[1]   # [A,B,C,...]

result = []

for i in range(min(len(list1), len(list2))):
    result.append(list1[i])
    result.append(list2[i])

OUT = result
# ----------------------------------------
vertical_lines_ontop_of_arches = Line.ByStartPointEndPoint(startPoint=bottom_circle_of_middle, endPoint=lower_middle_section)
thickness_of_vertical_lines = DoubleSlider(80, range=0..200 step 10)  # "Thickness of Vertical Lines ontop of Arches"
series_of_instances_of_circular_5 = Python(IN[0]=class_circular_steel_3, IN[1]=vertical_lines_ontop_of_arches, IN[2]=thickness_of_vertical_lines)  # "Series of instances of circular steel rods"; PythonNet3; same code as series_of_instances_of_circular_2
total_volume_of_steel_5 = Python(IN[0]=series_of_instances_of_circular_5)  # PythonNet3
# ---------- total_volume_of_steel_5.python (13 lines) ----------
# Load the Python Standard and DesignScript Libraries
import sys
import clr
clr.AddReference('ProtoGeometry')
from Autodesk.DesignScript.Geometry import *

data = IN[0]     
volumes = []

for item in data:
    volumes.append(item[1])   

OUT = sum(volumes)
# ----------------------------------------
top_circle_of_middle = Python(IN[0]=arch_top_point)  # PythonNet3; same code as top_middle_section_circle
series_of_instances_of_circular_6 = Python(IN[0]=class_circular_steel_3, IN[1]=top_circle_of_middle, IN[2]=thickness_of_vertical_lines)  # "Series of instances of circular steel rods"; PythonNet3; same code as series_of_instances_of_circular_2
total_volume_of_steel_6 = Python(IN[0]=series_of_instances_of_circular_6)  # PythonNet3
# ---------- total_volume_of_steel_6.python (13 lines) ----------
# Load the Python Standard and DesignScript Libraries
import sys
import clr
clr.AddReference('ProtoGeometry')
from Autodesk.DesignScript.Geometry import *

data = IN[0]    
volumes = []

for item in data:
    volumes.append(item[1])   

OUT = sum(volumes)
# ----------------------------------------
list_create = List.Create(item0=total_volume_of_steel, item1=total_volume_of_steel_2, item2=total_volume_of_steel_3, item3=total_volume_of_steel_4, item4=total_volume_of_steel_5, item5=total_volume_of_steel_6)
sum = Math.Sum(values=list_create)
total_volume_steel_mm_2 = Watch(sum)
byGeometryColor_2 = Modifiers.GeometryColor.ByGeometryColor(geometry=byCorners, color=byARGB)
watch = Watch(gold_arch_instances)
startPoint = Curve.StartPoint(curve=watch)
tangentAtParameter = Curve.TangentAtParameter(curve=watch)
byOriginNormal = Plane.ByOriginNormal(origin=startPoint, normal=tangentAtParameter)
thickness_of_arch_steel = DoubleSlider(81, range=1..100 step 10)
byPlaneRadius = Circle.ByPlaneRadius(plane=byOriginNormal, radius=thickness_of_arch_steel)
gold_arches_geometry = Solid.BySweep(profile=byPlaneRadius, path=gold_arch_instances)
volume = Solid.Volume(solid=gold_arches_geometry)
sum_2 = Math.Sum(values=volume)
gold_volume_mm_2 = Watch(sum_2)
