# Dynamo graph 1860052.dyn "start" (Dynamo 4.0.0.3277)

code_block = CodeBlock { -5000; -5000; -200; }
byCoordinates = Point.ByCoordinates(x=code_block.out0, y=code_block.out1, z=code_block.out2)
code_block_2 = CodeBlock { 5000; 5000; 0; }
byCoordinates_2 = Point.ByCoordinates(x=code_block_2.out0, y=code_block_2.out1, z=code_block_2.out2)
byCorners = Cuboid.ByCorners(lowPoint=byCoordinates, highPoint=byCoordinates_2)
code_block_3 = CodeBlock { 0; 100; 0; }
byARGB = Color.ByARGB(red=code_block_3.out0, green=code_block_3.out1, blue=code_block_3.out2)
byGeometryColor = Modifiers.GeometryColor.ByGeometryColor(geometry=byCorners, color=byARGB)
span = DoubleSlider(3500, range=3500..4800 step 0.1)
roofheight = DoubleSlider(1500, range=1500..4500 step 0.1)
ringcount = DoubleSlider(2, range=2..8 step 0.1)
tube_r = DoubleSlider(15, range=15..80 step 0.1)
ringscale = DoubleSlider(0.85, range=0.6..0.95 step 0.1)
py2 = Python(IN[0]=span, IN[1]=roofheight, IN[2]=ringcount, IN[3]=tube_r, IN[4]=ringscale)  # PythonNet3
# ---------- py2.python (54 lines) ----------
try:
    import clr
    clr.AddReference('ProtoGeometry')
except:
    pass

from Autodesk.DesignScript.Geometry import *

class SteelRing(object):
    def __init__(self, center, R, r, z):
        self.c = Point.ByCoordinates(center.X, center.Y, float(z))
        self.R = float(R)
        self.r = float(r)

    def solid(self):
        path = Circle.ByCenterPointRadius(self.c, self.R)
        sp = path.StartPoint
        tan = path.TangentAtParameter(0.0)
        pl = Plane.ByOriginNormal(sp, tan)
        prof = Circle.ByPlaneRadius(pl, self.r)  
        return Solid.BySweep(prof, path)

span      = float(IN[0])
roofHeight= float(IN[1])
ringCount = int(IN[2])
tubeR     = float(IN[3])
ringScale = float(IN[4])

span = max(500.0, min(span, 5000.0))
roofHeight = max(10.0, roofHeight)
ringCount = max(0, ringCount)
tubeR = max(0.1, tubeR)
ringScale = max(0.2, min(ringScale, 0.98))

center = Point.ByCoordinates(0,0,0)
solids = []
vol = 0.0

for j in range(ringCount):
    tj = float(j + 1) / float(ringCount + 1)
    z = roofHeight * tj
    R = span * ringScale * (1.0 - 0.25 * tj)
    R = max(tubeR * 3.0, R)

    ring = SteelRing(center, R, tubeR, z)

    try:
        s = ring.solid()
        solids.append(s)
        vol += s.Volume
    except:
        solids.append(None)

OUT = (solids, vol)
# ----------------------------------------
ribcount = DoubleSlider(8, range=8..30 step 1)
sway = DoubleSlider(1, range=0..2000 step 0.1)
beamwidth = DoubleSlider(50, range=50..200 step 0.1)
beamden = DoubleSlider(300, range=50..300 step 0.1)
py1 = Python(IN[0]=span, IN[1]=ribcount, IN[2]=roofheight, IN[3]=sway, IN[4]=beamwidth, IN[5]=beamden)  # PythonNet3; graph output
# ---------- py1.python (57 lines) ----------
import math
try:
    import clr
    clr.AddReference('ProtoGeometry')
except:
    pass

from Autodesk.DesignScript.Geometry import *

class TimberRib(object):
    def __init__(self, curve, w, d):
        self.curve = curve
        self.w = float(w)
        self.d = float(d)

    def solid(self):
        sp = self.curve.StartPoint
        tan = self.curve.TangentAtParameter(0.0)
        pl = Plane.ByOriginNormal(sp, tan)
        prof = Rectangle.ByWidthLength(pl, self.w, self.d)
        return Solid.BySweep(prof, self.curve)

span      = float(IN[0])
ribCount  = int(IN[1])
roofHeight= float(IN[2])
sway      = float(IN[3])
beamW     = float(IN[4])
beamD     = float(IN[5])


span = max(500.0, min(span, 5000.0))
ribCount = max(2, ribCount)
roofHeight = max(10.0, roofHeight)
beamW = max(1.0, beamW)
beamD = max(1.0, beamD)

solids = []
vol = 0.0

for i in range(ribCount):
    t = float(i) / float(ribCount - 1)
    y = -span + 2.0 * span * t
    p0 = Point.ByCoordinates(-span, y, 0)
    pm = Point.ByCoordinates(0, y + sway * math.sin(2*math.pi*t), roofHeight)
    p1 = Point.ByCoordinates(span, y, 0)

    crv = NurbsCurve.ByControlPoints([p0, pm, p1], 2)
    rib = TimberRib(crv, beamW, beamD)

    try:
        s = rib.solid()
        solids.append(s)
        vol += s.Volume
    except:
        solids.append(None)

OUT = (solids, vol)
# ----------------------------------------
code_block_4 = CodeBlock { 1; }
getItemAtIndex = List.GetItemAtIndex(list=py1, index=code_block_4)
getItemAtIndex_2 = List.GetItemAtIndex()  # unwired: list, index
integer_slider = IntegerSlider(1, range=0..1 step 1)
integer_slider_2 = IntegerSlider(1, range=0..1 step 1)
