# Dynamo graph 1860513.dyn (Dynamo 3.6.0.9395)

code_block = CodeBlock { 0; 10000; 10000; }
byOrigin = CoordinateSystem.ByOrigin(x=code_block.out0, y=code_block.out0, z=code_block.out0)
byLengths = Cuboid.ByLengths(origin=byOrigin, width=code_block.out1, length=code_block.out2)
code_block_2 = CodeBlock { 5000; -5000; }
byCoordinates = Point.ByCoordinates(x=code_block_2.out0, y=code_block_2.out0)
byCoordinates_2 = Point.ByCoordinates(x=code_block_2.out0, y=code_block_2.out1)
byCoordinates_3 = Point.ByCoordinates(x=code_block_2.out1, y=code_block_2.out0)
byCoordinates_4 = Point.ByCoordinates(x=code_block_2.out1, y=code_block_2.out1)
code_block_3 = CodeBlock { 0; 0; 6000; 4980; }
byCoordinates_5 = Point.ByCoordinates(x=code_block_3.out0, y=code_block_3.out1, z=code_block_3.out2)
byCenterPointRadius = Circle.ByCenterPointRadius(centerPoint=byCoordinates_5, radius=code_block_3.out3)
code_block_4 = CodeBlock { 0; 0; 8000; 4500; }
byCoordinates_6 = Point.ByCoordinates(x=code_block_4.out0, y=code_block_4.out1, z=code_block_4.out2)
byCenterPointRadius_2 = Circle.ByCenterPointRadius(centerPoint=byCoordinates_6, radius=code_block_4.out3)
list_create = List.Create(item0=byCenterPointRadius, item1=byCenterPointRadius_2)
byLoft = Surface.ByLoft(crossSections=list_create)
bot_of_canopy_leaf_transparency = DoubleSlider(175, range=0..250 step 1)
code_block_5 = CodeBlock { 112; 139; 75; }
byARGB = Color.ByARGB(alpha=bot_of_canopy_leaf_transparency, red=code_block_5.out0, green=code_block_5.out1, blue=code_block_5.out2)
byGeometryColor = Modifiers.GeometryColor.ByGeometryColor(geometry=byLoft, color=byARGB)
code_block_6 = CodeBlock { 0; 0; 10000; 3600; }
byCoordinates_7 = Point.ByCoordinates(x=code_block_6.out0, y=code_block_6.out1, z=code_block_6.out2)
byCenterPointRadius_3 = Circle.ByCenterPointRadius(centerPoint=byCoordinates_7, radius=code_block_6.out3)
list_create_2 = List.Create(item0=byCenterPointRadius_2, item1=byCenterPointRadius_3)
byLoft_2 = Surface.ByLoft(crossSections=list_create_2)
top_of_canopy_leaf_transparency = DoubleSlider(217, range=0..250 step 1)
byARGB_2 = Color.ByARGB(alpha=top_of_canopy_leaf_transparency, red=code_block_5.out0, green=code_block_5.out1, blue=code_block_5.out2)
byGeometryColor_2 = Modifiers.GeometryColor.ByGeometryColor(geometry=byLoft_2, color=byARGB_2)
code_block_7 = CodeBlock { 0; 0; 0; }
byCoordinates_8 = Point.ByCoordinates(x=code_block_7.out0, y=code_block_7.out1, z=code_block_7.out2)
tree_band_radius = DoubleSlider(3000, range=3000..5000 step 1)
byCenterPointRadius_4 = Circle.ByCenterPointRadius(centerPoint=byCoordinates_8, radius=tree_band_radius)
tree_band_radius_2 = DoubleSlider(1.5, range=1.5..1.8 step 0.2)
scale = Geometry.Scale(geometry=byCenterPointRadius_4, xamount=tree_band_radius_2, yamount=tree_band_radius_2)
code_block_8 = CodeBlock { 8000; 5000; 9000; 10000; 2000; 7000; 6000; }
translate = Geometry.Translate(geometry=scale, zTranslation=code_block_8.out0)
code_block_9 = CodeBlock { 8; -1; }
code_block_10 = CodeBlock(n=code_block_9.out0) { 0..1..#n; }
dropItems = List.DropItems(list=code_block_10, amount=code_block_9.out1)
pointAtParameter = Curve.PointAtParameter(curve=translate, param=dropItems)
tree_band_radius_3 = DoubleSlider(1.2, range=0.5..1.3 step 0.1)
scale_2 = Geometry.Scale(geometry=byCenterPointRadius_4, xamount=tree_band_radius_3, yamount=tree_band_radius_3)
translate_2 = Geometry.Translate(geometry=scale_2, zTranslation=code_block_8.out3)
pointAtParameter_2 = Curve.PointAtParameter(curve=translate_2, param=dropItems)
byStartPointEndPoint = Line.ByStartPointEndPoint(startPoint=pointAtParameter, endPoint=pointAtParameter_2)
tree_band_radius_4 = DoubleSlider(1.66, range=1..2 step 0.1)
scale_3 = Geometry.Scale(geometry=byCenterPointRadius_4, xamount=tree_band_radius_4, yamount=tree_band_radius_4)
translate_3 = Geometry.Translate(geometry=scale_3, zTranslation=code_block_8.out6)
pointAtParameter_3 = Curve.PointAtParameter(curve=translate_3, param=dropItems)
byStartPointEndPoint_2 = Line.ByStartPointEndPoint(startPoint=pointAtParameter_3, endPoint=pointAtParameter)
tree_band_radius_5 = DoubleSlider(1.2, range=1..1.5 step 0.1)
scale_4 = Geometry.Scale(geometry=byCenterPointRadius_4, xamount=tree_band_radius_5, yamount=tree_band_radius_5)
translate_4 = Geometry.Translate(geometry=scale_4, zTranslation=code_block_8.out2)
pointAtParameter_4 = Curve.PointAtParameter(curve=translate_4, param=code_block_10)
byStartPointEndPoint_3 = Line.ByStartPointEndPoint(startPoint=pointAtParameter_4, endPoint=pointAtParameter_2)
list_create_3 = List.Create(item0=byStartPointEndPoint, item1=byStartPointEndPoint_2, item2=byStartPointEndPoint_3)
tree_rod_radius = DoubleSlider(75, range=50..100 step 1)
boolean = BoolSelector(true)
buildPipes = TSpline.TSplineSurface.BuildPipes(curves=list_create_3, defaultRadius=tree_rod_radius, inSmoothMode=boolean)
code_block_11 = CodeBlock { 72; 94; 44; 255; }
byARGB_3 = Color.ByARGB(alpha=code_block_11.out3, red=code_block_11.out0, green=code_block_11.out1, blue=code_block_11.out2)
byGeometryColor_3 = Modifiers.GeometryColor.ByGeometryColor(geometry=buildPipes, color=byARGB_3)
color_palette = ColorPalette({R: 175, G: 167, B: 136, A: 255})
code_block_12 = CodeBlock { 0; 0; 10000; 3600; 1000; }
byOrigin_2 = CoordinateSystem.ByOrigin(x=code_block_12.out0, y=code_block_12.out1, z=code_block_12.out2)
byCoordinateSystemHeightRadii = Cone.ByCoordinateSystemHeightRadii(cs=byOrigin_2, height=code_block_12.out4, startRadius=code_block_12.out3, endRadius=code_block_12.out4)
byGeometryColor_4 = Modifiers.GeometryColor.ByGeometryColor(geometry=byCoordinateSystemHeightRadii, color=byARGB_3)
list_create_4 = List.Create(item0=translate, item1=translate_3, item2=translate_2)
buildPipes_2 = TSpline.TSplineSurface.BuildPipes(curves=list_create_4, defaultRadius=tree_rod_radius, inSmoothMode=boolean)
byGeometryColor_5 = Modifiers.GeometryColor.ByGeometryColor(geometry=buildPipes_2, color=byARGB_3)
number_slider = DoubleSlider(25, range=15..25 step 1)
code_block_13 = CodeBlock(n=number_slider) { 0..1..#n-1; 3; -1; }
dropItems_2 = List.DropItems(list=code_block_13.out0, amount=code_block_13.out2)
pointAtParameter_5 = Curve.PointAtParameter(curve=byCenterPointRadius_4, param=dropItems_2)
tree_band_radius_6 = DoubleSlider(0.5, range=0.4..0.6 step 0.1)
scale_5 = Geometry.Scale(geometry=byCenterPointRadius_4, xamount=tree_band_radius_6, yamount=tree_band_radius_6)
translate_5 = Geometry.Translate(geometry=scale_5, zTranslation=code_block_8.out4)
pointAtParameter_6 = Curve.PointAtParameter(curve=translate_5, param=dropItems_2)
shiftIndices = List.ShiftIndices(list=pointAtParameter_6, amount=code_block_13.out1)
byStartPointEndPoint_4 = Line.ByStartPointEndPoint(startPoint=pointAtParameter_5, endPoint=shiftIndices)
tree_band_radius_7 = DoubleSlider(0.7, range=0.6..1 step 0.1)
scale_6 = Geometry.Scale(geometry=byCenterPointRadius_4, xamount=tree_band_radius_7, yamount=tree_band_radius_7)
translate_6 = Geometry.Translate(geometry=scale_6, zTranslation=code_block_8.out1)
pointAtParameter_7 = Curve.PointAtParameter(curve=translate_6, param=dropItems_2)
shiftIndices_2 = List.ShiftIndices(list=pointAtParameter_7, amount=code_block_13.out1)
byStartPointEndPoint_5 = Line.ByStartPointEndPoint(startPoint=pointAtParameter_6, endPoint=shiftIndices_2)
tree_band_radius_8 = DoubleSlider(1, range=1..1.4 step 0.1)
scale_7 = Geometry.Scale(geometry=byCenterPointRadius_4, xamount=tree_band_radius_8, yamount=tree_band_radius_8)
translate_7 = Geometry.Translate(geometry=scale_7, zTranslation=code_block_8.out5)
pointAtParameter_8 = Curve.PointAtParameter(curve=translate_7, param=dropItems_2)
shiftIndices_3 = List.ShiftIndices(list=pointAtParameter_8, amount=code_block_13.out1)
byStartPointEndPoint_6 = Line.ByStartPointEndPoint(startPoint=pointAtParameter_7, endPoint=shiftIndices_3)
pointAtParameter_9 = Curve.PointAtParameter(curve=translate_4, param=dropItems_2)
shiftIndices_4 = List.ShiftIndices(list=pointAtParameter_9, amount=code_block_13.out1)
byStartPointEndPoint_7 = Line.ByStartPointEndPoint(startPoint=pointAtParameter_8, endPoint=shiftIndices_4)
translate_8 = Geometry.Translate(geometry=scale_4, zTranslation=code_block_8.out2)
list_create_5 = List.Create(item0=byStartPointEndPoint_4, item1=byStartPointEndPoint_5, item2=byStartPointEndPoint_6, item3=byStartPointEndPoint_7, item4=translate_8, item5=translate_4, item6=translate_6, item7=translate_5, item8=byCenterPointRadius_4, item9=translate_7)
buildPipes_3 = TSpline.TSplineSurface.BuildPipes(curves=list_create_5, defaultRadius=tree_rod_radius, inSmoothMode=boolean)
code_block_14 = CodeBlock { 175; 167; 136; 255; }
byARGB_4 = Color.ByARGB(alpha=code_block_14.out3, red=code_block_14.out0, green=code_block_14.out1, blue=code_block_14.out2)
byGeometryColor_6 = Modifiers.GeometryColor.ByGeometryColor(geometry=buildPipes_3, color=byARGB_4)
code_block_15 = CodeBlock { 0; 600; 500; 400; 480; 460; 450; 300; 25; 200; -600; -300; }
byCoordinates_9 = Point.ByCoordinates(y=code_block_15.out1, z=code_block_15.out2)
byCoordinates_10 = Point.ByCoordinates(y=code_block_15.out7, z=code_block_15.out6)
byStartPointEndPoint_8 = Line.ByStartPointEndPoint(startPoint=byCoordinates_9, endPoint=byCoordinates_10)
byCoordinates_11 = Point.ByCoordinates(y=code_block_15.out10, z=code_block_15.out2)
byCoordinates_12 = Point.ByCoordinates(y=code_block_15.out11, z=code_block_15.out6)
byStartPointEndPoint_9 = Line.ByStartPointEndPoint(startPoint=byCoordinates_11, endPoint=byCoordinates_12)
byCoordinates_13 = Point.ByCoordinates(x=code_block_15.out0, y=code_block_15.out0, z=code_block_15.out0)
code_block_16 = CodeBlock { 0; 450; 300; }
byCoordinates_14 = Point.ByCoordinates(x=code_block_16.out0, y=code_block_16.out0, z=code_block_16.out0)
byCoordinates_15 = Point.ByCoordinates(x=code_block_16.out0, y=code_block_16.out0, z=code_block_16.out1)
byPointsRadius = Cylinder.ByPointsRadius(startPoint=byCoordinates_14, endPoint=byCoordinates_15, radius=code_block_16.out2)
list_create_6 = List.Create(item0=byPointsRadius)
code_block_17 = CodeBlock { 450; 212; -212; 1200; }
byCoordinates_16 = Point.ByCoordinates(x=code_block_17.out2, y=code_block_17.out2, z=code_block_17.out0)
byCoordinates_17 = Point.ByCoordinates(x=code_block_15.out11, z=code_block_15.out6)
byCoordinates_18 = Point.ByCoordinates(x=code_block_17.out2, y=code_block_17.out1, z=code_block_17.out0)
list_create_7 = List.Create(item0=byCoordinates_12, item1=byCoordinates_16, item2=byCoordinates_17, item3=byCoordinates_18, item4=byCoordinates_10)
byPoints = NurbsCurve.ByPoints(points=list_create_7)
byCoordinates_19 = Point.ByCoordinates(y=code_block_15.out11, z=code_block_17.out3)
byCoordinates_20 = Point.ByCoordinates(x=code_block_17.out2, y=code_block_17.out2, z=code_block_17.out3)
byCoordinates_21 = Point.ByCoordinates(x=code_block_15.out11, z=code_block_17.out3)
byCoordinates_22 = Point.ByCoordinates(x=code_block_17.out2, y=code_block_17.out1, z=code_block_17.out3)
byCoordinates_23 = Point.ByCoordinates(y=code_block_15.out7, z=code_block_17.out3)
list_create_8 = List.Create(item0=byCoordinates_19, item1=byCoordinates_20, item2=byCoordinates_21, item3=byCoordinates_22, item4=byCoordinates_23)
byPoints_2 = NurbsCurve.ByPoints(points=list_create_8)
list_create_9 = List.Create(item0=byPoints, item1=byPoints_2)
byLoft_3 = Surface.ByLoft(crossSections=list_create_9)
code_block_18 = CodeBlock { 500; 0; 1.2; 500; }
byCoordinates_24 = Point.ByCoordinates(x=code_block_18.out1, y=code_block_18.out1, z=code_block_18.out1)
byCenterPointRadius_5 = Circle.ByCenterPointRadius(centerPoint=byCoordinates_24, radius=code_block_18.out0)
scale_8 = Geometry.Scale(geometry=byCenterPointRadius_5, xamount=code_block_18.out2, yamount=code_block_18.out2)
translate_9 = Geometry.Translate(geometry=scale_8, zTranslation=code_block_18.out3)
list_create_10 = List.Create(item0=translate_9, item1=byCenterPointRadius_5)
byLoft_4 = PolySurface.ByLoft(crossSections=list_create_10)
list_create_11 = List.Create(item0=byLoft_3, item1=byLoft_4)
code_block_19 = CodeBlock { 5; }
thicken = Surface.Thicken(surface=list_create_11, thickness=code_block_19)
list_create_12 = List.Create(item0=list_create_6, item1=thicken)
code_block_20 = CodeBlock { 2800; -2800; 30; -60; 60; }
translate_10 = Geometry.Translate(geometry=list_create_12, xTranslation=code_block_20.out0, yTranslation=code_block_20.out0)
XY = Plane.XY()
rotate = Geometry.Rotate(geometry=translate_10, basePlane=XY, degrees=code_block_20.out3)
translate_11 = Geometry.Translate(geometry=list_create_12, xTranslation=code_block_20.out0, yTranslation=code_block_20.out1)
rotate_2 = Geometry.Rotate(geometry=translate_11, basePlane=XY, degrees=code_block_20.out4)
list_create_13 = List.Create(item0=rotate, item1=translate_10, item2=rotate_2, item3=translate_11)
code_block_21 = CodeBlock { 177; 141; 64; 255; }
byARGB_5 = Color.ByARGB(alpha=code_block_21.out3, red=code_block_21.out0, green=code_block_21.out1, blue=code_block_21.out2)
byGeometryColor_7 = Modifiers.GeometryColor.ByGeometryColor(geometry=list_create_13, color=byARGB_5)
color_palette_2 = ColorPalette({R: 171, G: 158, B: 145, A: 255})
YZ = Plane.YZ()
mirror = Geometry.Mirror(geometry=list_create_13, mirrorPlane=YZ)
byGeometryColor_8 = Modifiers.GeometryColor.ByGeometryColor(geometry=mirror, color=byARGB_5)
code_block_22 = CodeBlock { 1275; 35; -50; 1500; 25; 25; 1400; -275; }
byCoordinates_25 = Point.ByCoordinates(x=code_block_22.out2, z=code_block_22.out0)
byCenterPointRadius_6 = Circle.ByCenterPointRadius(centerPoint=byCoordinates_25, radius=code_block_22.out1)
byCoordinates_26 = Point.ByCoordinates(x=code_block_22.out2, y=code_block_22.out2, z=code_block_22.out3)
byCenterPointRadius_7 = Circle.ByCenterPointRadius(centerPoint=byCoordinates_26, radius=code_block_22.out4)
list_create_14 = List.Create(item0=byCenterPointRadius_6, item1=byCenterPointRadius_7)
byLoft_5 = Solid.ByLoft(crossSections=list_create_14)
byCoordinates_27 = Point.ByCoordinates(x=code_block_22.out5, y=code_block_22.out7, z=code_block_22.out6)
byCenterPointRadius_8 = Circle.ByCenterPointRadius(centerPoint=byCoordinates_27, radius=code_block_22.out5)
list_create_15 = List.Create(item0=byCenterPointRadius_7, item1=byCenterPointRadius_8)
byLoft_6 = Solid.ByLoft(crossSections=list_create_15)
list_create_16 = List.Create(item0=byLoft_5, item1=byLoft_6)
code_block_23 = CodeBlock { 141.4; -141.4; 200; -200; 1275; }
byCoordinates_28 = Point.ByCoordinates(y=code_block_23.out2, z=code_block_23.out4)
byCoordinates_29 = Point.ByCoordinates(x=code_block_23.out1, y=code_block_23.out0, z=code_block_23.out4)
byCoordinates_30 = Point.ByCoordinates(x=code_block_23.out3, z=code_block_23.out4)
byCoordinates_31 = Point.ByCoordinates(x=code_block_23.out1, y=code_block_23.out1, z=code_block_23.out4)
byCoordinates_32 = Point.ByCoordinates(y=code_block_23.out3, z=code_block_23.out4)
list_create_17 = List.Create(item0=byCoordinates_28, item1=byCoordinates_29, item2=byCoordinates_30, item3=byCoordinates_31, item4=byCoordinates_32)
byPoints_3 = NurbsCurve.ByPoints(points=list_create_17)
code_block_24 = CodeBlock { 1275; 200; -200; }
byCoordinates_33 = Point.ByCoordinates(y=code_block_24.out1, z=code_block_24.out0)
byCoordinates_34 = Point.ByCoordinates(y=code_block_24.out2, z=code_block_24.out0)
byStartPointEndPoint_10 = Line.ByStartPointEndPoint(startPoint=byCoordinates_33, endPoint=byCoordinates_34)
list_create_18 = List.Create(item0=byPoints_3, item1=byStartPointEndPoint_10)
byJoinedCurves = PolyCurve.ByJoinedCurves(curves=list_create_18)
byPatch = Surface.ByPatch(closedCurve=byJoinedCurves)
list_create_19 = List.Create(item0=byCoordinates_28, item1=byCoordinates_29, item2=byCoordinates_30, item3=byCoordinates_31, item4=byCoordinates_32)
byPoints_4 = NurbsCurve.ByPoints(points=list_create_19)
list_create_20 = List.Create(item0=byPoints_2, item1=byPoints_4)
byLoft_7 = Surface.ByLoft(crossSections=list_create_20)
code_block_25 = CodeBlock { 318; -318; 450; -450; }
acorn_cupule_semi_circle = DoubleSlider(1200, range=1000..1250 step 10)  # "Acorn Cupule Semi-Circle Positioning"
byCoordinates_35 = Point.ByCoordinates(y=code_block_25.out2, z=acorn_cupule_semi_circle)
byCoordinates_36 = Point.ByCoordinates(y=code_block_25.out3, z=acorn_cupule_semi_circle)
list_create_21 = List.Create(item0=byCoordinates_23, item1=byCoordinates_35, item2=byCoordinates_28, item3=byCoordinates_32, item4=byCoordinates_36, item5=byCoordinates_19)
boolean_2 = BoolSelector(true)
byPoints_5 = PolyCurve.ByPoints(points=list_create_21, connectLastToFirst=boolean_2)
byPatch_2 = Surface.ByPatch(closedCurve=byPoints_5)
code_block_26 = CodeBlock { 500; 750; -750; 530; -530; }
byCoordinates_37 = Point.ByCoordinates(y=code_block_26.out2, z=code_block_26.out0)
code_block_27 = CodeBlock { 601; -601; 850; -850; }
acorn_cupule_semi_circle_2 = DoubleSlider(630, range=500..750 step 10)  # "Acorn Cupule Semi-Circle Positioning"
byCoordinates_38 = Point.ByCoordinates(y=code_block_27.out3, z=acorn_cupule_semi_circle_2)
code_block_28 = CodeBlock { 530; -530; 750; -750; }
acorn_cupule_semi_circle_3 = DoubleSlider(950, range=800..1000 step 10)  # "Acorn Cupule Semi-Circle Positioning"
byCoordinates_39 = Point.ByCoordinates(y=code_block_28.out3, z=acorn_cupule_semi_circle_3)
list_create_22 = List.Create(item0=byCoordinates_12, item1=byCoordinates_11, item2=byCoordinates_37, item3=byCoordinates_38, item4=byCoordinates_39, item5=byCoordinates_36, item6=byCoordinates_19)
byPoints_6 = PolyCurve.ByPoints(points=list_create_22, connectLastToFirst=boolean_2)
byPatch_3 = Surface.ByPatch(closedCurve=byPoints_6)
byCoordinates_40 = Point.ByCoordinates(y=code_block_28.out2, z=acorn_cupule_semi_circle_3)
byCoordinates_41 = Point.ByCoordinates(x=code_block_28.out1, y=code_block_28.out0, z=acorn_cupule_semi_circle_3)
byCoordinates_42 = Point.ByCoordinates(x=code_block_28.out3, z=acorn_cupule_semi_circle_3)
byCoordinates_43 = Point.ByCoordinates(x=code_block_28.out1, y=code_block_28.out1, z=acorn_cupule_semi_circle_3)
list_create_23 = List.Create(item0=byCoordinates_40, item1=byCoordinates_41, item2=byCoordinates_42, item3=byCoordinates_43, item4=byCoordinates_39)
byPoints_7 = NurbsCurve.ByPoints(points=list_create_23)
byCoordinates_44 = Point.ByCoordinates(x=code_block_25.out1, y=code_block_25.out0, z=acorn_cupule_semi_circle)
byCoordinates_45 = Point.ByCoordinates(x=code_block_25.out3, z=acorn_cupule_semi_circle)
byCoordinates_46 = Point.ByCoordinates(x=code_block_25.out1, y=code_block_25.out1, z=acorn_cupule_semi_circle)
list_create_24 = List.Create(item0=byCoordinates_35, item1=byCoordinates_44, item2=byCoordinates_45, item3=byCoordinates_46, item4=byCoordinates_36)
byPoints_8 = NurbsCurve.ByPoints(points=list_create_24)
list_create_25 = List.Create(item0=byPoints_7, item1=byPoints_8)
byLoft_8 = Surface.ByLoft(crossSections=list_create_25)
byCoordinates_47 = Point.ByCoordinates(y=code_block_27.out2, z=acorn_cupule_semi_circle_2)
byCoordinates_48 = Point.ByCoordinates(x=code_block_27.out1, y=code_block_27.out0, z=acorn_cupule_semi_circle_2)
byCoordinates_49 = Point.ByCoordinates(x=code_block_27.out3, z=acorn_cupule_semi_circle_2)
byCoordinates_50 = Point.ByCoordinates(x=code_block_27.out1, y=code_block_27.out1, z=acorn_cupule_semi_circle_2)
list_create_26 = List.Create(item0=byCoordinates_47, item1=byCoordinates_48, item2=byCoordinates_49, item3=byCoordinates_50, item4=byCoordinates_38)
byPoints_9 = NurbsCurve.ByPoints(points=list_create_26)
list_create_27 = List.Create(item0=byPoints_9, item1=byPoints_7)
byLoft_9 = Surface.ByLoft(crossSections=list_create_27)
list_create_28 = List.Create(item0=byPoints_8, item1=byPoints_4)
byLoft_10 = Surface.ByLoft(crossSections=list_create_28)
byCoordinates_51 = Point.ByCoordinates(y=code_block_15.out3, z=code_block_15.out5)
byCoordinates_52 = Point.ByCoordinates(y=code_block_15.out2, z=code_block_15.out4)
code_block_29 = CodeBlock { 500; 600; -600; 424; -424; }
byCoordinates_53 = Point.ByCoordinates(y=code_block_29.out1, z=code_block_26.out0)
byCoordinates_54 = Point.ByCoordinates(y=code_block_26.out1, z=code_block_26.out0)
list_create_29 = List.Create(item0=byCoordinates_10, item1=byCoordinates_51, item2=byCoordinates_52, item3=byCoordinates_53, item4=byCoordinates_54, item5=byCoordinates_47, item6=byCoordinates_40, item7=byCoordinates_35, item8=byCoordinates_23)
byPoints_10 = PolyCurve.ByPoints(points=list_create_29, connectLastToFirst=boolean_2)
byPatch_4 = Surface.ByPatch(closedCurve=byPoints_10)
byCoordinates_55 = Point.ByCoordinates(x=code_block_26.out4, y=code_block_26.out3, z=code_block_26.out0)
byCoordinates_56 = Point.ByCoordinates(x=code_block_26.out2, z=code_block_26.out0)
byCoordinates_57 = Point.ByCoordinates(x=code_block_26.out4, y=code_block_26.out4, z=code_block_26.out0)
list_create_30 = List.Create(item0=byCoordinates_54, item1=byCoordinates_55, item2=byCoordinates_56, item3=byCoordinates_57, item4=byCoordinates_37)
byPoints_11 = NurbsCurve.ByPoints(points=list_create_30)
list_create_31 = List.Create(item0=byPoints_11, item1=byPoints_9)
byLoft_11 = Surface.ByLoft(crossSections=list_create_31)
byCoordinates_58 = Point.ByCoordinates(x=code_block_29.out4, y=code_block_29.out3, z=code_block_29.out0)
byCoordinates_59 = Point.ByCoordinates(x=code_block_29.out2, z=code_block_29.out0)
byCoordinates_60 = Point.ByCoordinates(x=code_block_29.out4, y=code_block_29.out4, z=code_block_29.out0)
byCoordinates_61 = Point.ByCoordinates(y=code_block_29.out2, z=code_block_29.out0)
list_create_32 = List.Create(item0=byCoordinates_53, item1=byCoordinates_58, item2=byCoordinates_59, item3=byCoordinates_60, item4=byCoordinates_61)
byPoints_12 = NurbsCurve.ByPoints(points=list_create_32)
list_create_33 = List.Create(item0=byPoints_12, item1=byPoints_11)
byLoft_12 = Surface.ByLoft(crossSections=list_create_33)
byThreePoints = Circle.ByThreePoints(p1=byCoordinates_10, p2=byCoordinates_12, p3=byCoordinates_17)
list_create_34 = List.Create(item0=translate_9, item1=byThreePoints)
byLoft_13 = Surface.ByLoft(crossSections=list_create_34)
list_create_35 = List.Create(item0=byPatch, item1=byLoft_7, item2=byPatch_2, item3=byPatch_3, item4=byLoft_8, item5=byLoft_9, item6=byLoft_10, item7=byPatch_4, item8=byLoft_11, item9=byLoft_12, item10=byLoft_13)
code_block_30 = CodeBlock { 5; }
thicken_2 = Surface.Thicken(surface=list_create_35, thickness=code_block_30)
list_create_36 = List.Create(item0=list_create_16, item1=thicken_2)
code_block_31 = CodeBlock { 2800; -2800; 30; -60; 60; }
translate_12 = Geometry.Translate(geometry=list_create_36, xTranslation=code_block_31.out0, yTranslation=code_block_31.out0)
XY_2 = Plane.XY()
rotate_3 = Geometry.Rotate(geometry=translate_12, basePlane=XY_2, degrees=code_block_31.out3)
translate_13 = Geometry.Translate(geometry=list_create_36, xTranslation=code_block_31.out0, yTranslation=code_block_31.out1)
rotate_4 = Geometry.Rotate(geometry=translate_13, basePlane=XY_2, degrees=code_block_31.out4)
list_create_37 = List.Create(item0=rotate_3, item1=translate_12, item2=rotate_4, item3=translate_13)
code_block_32 = CodeBlock { 171; 158; 145; 255; }
byARGB_6 = Color.ByARGB(alpha=code_block_32.out3, red=code_block_32.out0, green=code_block_32.out1, blue=code_block_32.out2)
byGeometryColor_9 = Modifiers.GeometryColor.ByGeometryColor(geometry=list_create_37, color=byARGB_6)
YZ_2 = Plane.YZ()
mirror_2 = Geometry.Mirror(geometry=list_create_37, mirrorPlane=YZ_2)
byGeometryColor_10 = Modifiers.GeometryColor.ByGeometryColor(geometry=mirror_2, color=byARGB_6)
list_create_38 = List.Create(item0=pointAtParameter_5, item1=pointAtParameter_6, item2=pointAtParameter_7, item3=pointAtParameter_8)
list_create_39 = List.Create(item0=shiftIndices, item1=shiftIndices_2, item2=shiftIndices_3, item3=shiftIndices_4)
list_create_40 = List.Create(item0=translate_12, item1=translate_10)
list_create_41 = List.Create(item0=rotate_4, item1=rotate_2)
list_create_42 = List.Create(item0=rotate_3, item1=rotate)
list_create_43 = List.Create(item0=translate_13, item1=translate_11)
list_create_44 = List.Create(item0=mirror_2)
code_block_33 = CodeBlock { 0; 1; 2; 3; }
getItemAtIndex = List.GetItemAtIndex(list=list_create_44, index=code_block_33.out0)
getItemAtIndex_2 = List.GetItemAtIndex(list=getItemAtIndex, index=code_block_33.out3)
list_create_45 = List.Create(item0=mirror)
code_block_34 = CodeBlock { 0; 1; 2; 3; }
getItemAtIndex_3 = List.GetItemAtIndex(list=list_create_45, index=code_block_34.out0)
getItemAtIndex_4 = List.GetItemAtIndex(list=getItemAtIndex_3, index=code_block_34.out3)
list_create_46 = List.Create(item0=getItemAtIndex_2, item1=getItemAtIndex_4)
getItemAtIndex_5 = List.GetItemAtIndex(list=getItemAtIndex, index=code_block_33.out0)
getItemAtIndex_6 = List.GetItemAtIndex(list=getItemAtIndex_3, index=code_block_34.out0)
list_create_47 = List.Create(item0=getItemAtIndex_5, item1=getItemAtIndex_6)
getItemAtIndex_7 = List.GetItemAtIndex(list=getItemAtIndex, index=code_block_33.out2)
getItemAtIndex_8 = List.GetItemAtIndex(list=getItemAtIndex_3, index=code_block_34.out2)
list_create_48 = List.Create(item0=getItemAtIndex_7, item1=getItemAtIndex_8)
getItemAtIndex_9 = List.GetItemAtIndex(list=getItemAtIndex, index=code_block_33.out1)
getItemAtIndex_10 = List.GetItemAtIndex(list=getItemAtIndex_3, index=code_block_34.out1)
list_create_49 = List.Create(item0=getItemAtIndex_9, item1=getItemAtIndex_10)
list_create_50 = List.Create(item0=list_create_40, item1=list_create_41, item2=list_create_42, item3=list_create_43, item4=list_create_46, item5=list_create_47, item6=list_create_48, item7=list_create_49)
class_acorn_seat = Python()  # CPython3
# ---------- class_acorn_seat.python (42 lines) ----------
import clr
clr.AddReference('ProtoGeometry')
from Autodesk.DesignScript.Geometry import *

class AcornSeat:
    def __init__(self, geoms):
        # Store geometry for this seat (can be list or nested)
        self.geoms = geoms

    def geometry(self):
        return self.geoms

    def volume(self):
        """
        Material quantity as mm^2 (surface area).
        Works for Surfaces, PolySurfaces, and Solids.
        """
        total = 0.0

        # Flatten nested geometry lists
        flat = []

        def _flatten(x):
            if isinstance(x, list):
                for y in x:
                    _flatten(y)
            else:
                if x is not None:
                    flat.append(x)

        _flatten(self.geoms)

        # Sum surface area in mm^2
        for g in flat:
            try:
                total += g.Area
            except:
                pass

        return total

OUT = AcornSeat
# ----------------------------------------
instance_acorn_seat = Python(IN[0]=list_create_50, IN[1]=class_acorn_seat)  # CPython3
# ---------- instance_acorn_seat.python (21 lines) ----------
import clr
clr.AddReference('ProtoGeometry')

# IN[0] = list of seats' geometry
#         e.g. [ [outerA, innerA], [outerB, innerB], ..., [outerH, innerH] ]
# IN[1] = AcornSeat class (from the class node)

seat_geom_list = IN[0]
SeatClass      = IN[1]

all_geom  = []   # geometry for each seat (for display)
all_vols  = []   # volume per seat (bounding-box based)

for parts in seat_geom_list:
    seat = SeatClass(parts)   # create one AcornSeat instance
    all_geom.append(seat.geometry())
    all_vols.append(seat.volume())

# OUT[0] = geometry (for preview in Dynamo)
# OUT[1] = per-seat volume values
OUT = all_geom, all_vols
# ----------------------------------------
code_block_35 = CodeBlock { 0; 1; }
geometry_of_acorn_seats = List.GetItemAtIndex(list=instance_acorn_seat, index=code_block_35.out0)
list_create_51 = List.Create(item0=pointAtParameter_5, item1=pointAtParameter_6, item2=pointAtParameter_7, item3=pointAtParameter_8)
flatten = List.Flatten(list=list_create_51)
list_create_52 = List.Create(item0=shiftIndices, item1=shiftIndices_2, item2=shiftIndices_3, item3=shiftIndices_4)
flatten_2 = List.Flatten(list=list_create_52)
number_slider_2 = DoubleSlider(75, range=50..100 step 1)
class_rod = Python()  # CPython3
# ---------- class_rod.python (22 lines) ----------
import clr
clr.AddReference('ProtoGeometry')
from Autodesk.DesignScript.Geometry import *

class Rod:
    def __init__(self, p0, p1, radius):
        self.p0 = p0
        self.p1 = p1
        self.radius = radius

    def geometry(self):
        return Cylinder.ByPointsRadius(self.p0, self.p1, self.radius)

    def volume(self):
        """
        Returns surface area of the rod (mm^2).
        Only the lateral surface is used: A = 2πrL
        """
        length = self.p0.DistanceTo(self.p1)
        return 2 * 3.14159 * self.radius * length

OUT = Rod
# ----------------------------------------
instance_rod = Python(IN[0]=flatten, IN[1]=flatten_2, IN[2]=number_slider_2, IN[3]=class_rod)  # CPython3
# ---------- instance_rod.python (36 lines) ----------
import clr
clr.AddReference('ProtoGeometry')
from Autodesk.DesignScript.Geometry import *

# Inputs:
p0_list = IN[0]   # Should be a flat list of Points
p1_list = IN[1]   # Should be a flat list of Points
r = IN[2]         # Slider value (float)
RodClass = IN[3]  # Output of Rod class node

def unwrap(item):
    # If the item is a list of a single item, unwrap it
    while isinstance(item, list) and len(item) == 1:
        item = item[0]
    return item

# Apply unwrapping to entire lists
p0_list = [unwrap(x) for x in p0_list]
p1_list = [unwrap(x) for x in p1_list]

# --- SANITY CHECK: Must be point objects ---
for p0, p1 in zip(p0_list, p1_list):
    if not isinstance(p0, Point) or not isinstance(p1, Point):
        OUT = "Error: One of the inputs is not a Point. Got: ", type(p0), type(p1)
        raise Exception("Rod inputs must be Points, not lists.")

# Build rods
rods = []
volumes = []

for p0, p1 in zip(p0_list, p1_list):
    rod = RodClass(p0, p1, r)
    rods.append(rod.geometry())
    volumes.append(rod.volume())

OUT = rods, volumes
# ----------------------------------------
code_block_36 = CodeBlock { 0; 1; }
getItemAtIndex_11 = List.GetItemAtIndex(list=instance_rod, index=code_block_36.out0)
getItemAtIndex_12 = List.GetItemAtIndex(list=instance_rod, index=code_block_36.out1)
total_rod_volume = Math.Sum(values=getItemAtIndex_12)
watch = Watch(total_rod_volume)
volume_of_acorn_seats = List.GetItemAtIndex(list=instance_acorn_seat, index=code_block_35.out1)
total_acorn_seats_volume = Math.Sum(values=volume_of_acorn_seats)
watch_2 = Watch(total_acorn_seats_volume)
