# Dynamo graph 1860658.dyn "Home Assignment 2, wrong scale - Copy" (Dynamo 3.6.0.9395)

rod_center = CodeBlock { 0; 0; 0; }
rod_center_2 = Point.ByCoordinates(x=rod_center.out0, y=rod_center.out1, z=rod_center.out2)
single_rod_height = CodeBlock { 0; 0; 2; }
rod_height = Point.ByCoordinates(x=single_rod_height.out0, y=single_rod_height.out1, z=single_rod_height.out2)
single_rod_width = DoubleSlider(0.7, range=0..2 step 0.1)
rod_class = Python()  # CPython3; unwired: IN[0]
# ---------- rod_class.python (28 lines) ----------
import clr
clr.AddReference('ProtoGeometry')
from Autodesk.DesignScript.Geometry import *

class SquareRod:
    def __init__(self, bottom_point, top_point, width):
        self.bottom = bottom_point
        self.top = top_point
        self.width = width  

    def make_geometry(self):
        
        direction = Vector.ByTwoPoints(self.bottom, self.top)
        height = direction.Length
        
        square_base = Rectangle.ByWidthLength(self.width, self.width)
        
        square_base = square_base.Translate(self.bottom.X, self.bottom.Y, self.bottom.Z)
       
        rod = square_base.Extrude(direction)
        return rod
        
        
    def volume(self):
        rod = self.make_geometry()
        return rod.Volume

OUT = SquareRod
# ----------------------------------------
single_instance = Python(IN[0]=rod_center_2, IN[1]=rod_height, IN[2]=single_rod_width, IN[3]=rod_class)  # CPython3
# ---------- single_instance.python (9 lines) ----------
SquareRodClass = IN[3]
b = SquareRodClass(IN[0], IN[1], IN[2])
rod_geometry = b.make_geometry()



    

OUT = rod_geometry
# ----------------------------------------
code_block = CodeBlock { -5; -5; -0.2; }
byCoordinates = Point.ByCoordinates(x=code_block.out0, y=code_block.out1, z=code_block.out2)
code_block_2 = CodeBlock { 5; 5; 0; }
byCoordinates_2 = Point.ByCoordinates(x=code_block_2.out0, y=code_block_2.out1, z=code_block_2.out2)
byCorners = Cuboid.ByCorners(lowPoint=byCoordinates, highPoint=byCoordinates_2)
code_block_3 = CodeBlock { 0; 100; 0; }
byARGB = Color.ByARGB(red=code_block_3.out0, green=code_block_3.out1, blue=code_block_3.out2)
byGeometryColor = Modifiers.GeometryColor.ByGeometryColor(geometry=byCorners, color=byARGB)
sphere_class = Python()  # CPython3; unwired: IN[0]
# ---------- sphere_class.python (36 lines) ----------
import clr
clr.AddReference("ProtoGeometry")
from Autodesk.DesignScript.Geometry import *

class IterableSphere:
    def __init__(self, centers, radii):
        
        if not isinstance(centers, list):
            centers = [centers]
        if not isinstance(radii, list):
            radii = [radii]

        
        self.centers = [c for c in centers if isinstance(c, Point)]
        self.radii   = [float(r) for r in radii]

        
        maxlen = max(len(self.centers), len(self.radii))
        if len(self.centers) != maxlen:
            self.centers = (self.centers * maxlen)[:maxlen]
        if len(self.radii) != maxlen:
            self.radii   = (self.radii * maxlen)[:maxlen]

        
        self.spheres = []
        for i in range(maxlen):
            self.spheres.append(Sphere.ByCenterPointRadius(self.centers[i], self.radii[i]))

    def geometry(self):
        return self.spheres
        
    
            
   
   
OUT = IterableSphere
# ----------------------------------------
x_y_center = CodeBlock { 0; 0; }
elevation = DoubleSlider(4.1, range=0..5 step 0.1)
sphere_center = Point.ByCoordinates(x=x_y_center.out0, y=x_y_center.out1, z=elevation)
radius = DoubleSlider(2.5, range=0..5 step 0.1)
sphere_itteration = Python(IN[0]=sphere_class, IN[1]=sphere_center, IN[2]=radius)  # CPython3
# ---------- sphere_itteration.python (10 lines) ----------
IterableSphere = IN[0]

centers = IN[1]
radii   = IN[2]



s = IterableSphere(centers, radii)

OUT = s.geometry()
# ----------------------------------------
sphere_surface_volume = Solid.Volume(solid=sphere_itteration)
meter_to_millimeter_conversion = CodeBlock(V=sphere_surface_volume) { V_mm3 = V * 1000000000; output = Math.Ceiling(V_mm3) + " mm3"; }
sphere_volume_display = Watch(meter_to_millimeter_conversion.output)
rod_spacing_bottom = CodeBlock { 0..300..15; }
bottom_radius = DoubleSlider(4.5, range=0..10 step 0.1)
rod_spacing_top = Point.ByCylindricalCoordinates(angle=rod_spacing_bottom, radius=bottom_radius)
rod_spacing_top_2 = CodeBlock { 15..315..15; }
top_rod_circle_radius = DoubleSlider(5.4, range=0..10 step 0.1)
rod_tilt_angle = DoubleSlider(2.5, range=0..10 step 0.1)
rod_spacing_bottom_2 = Point.ByCylindricalCoordinates(angle=rod_spacing_top_2, elevation=top_rod_circle_radius, radius=rod_tilt_angle)
rod_side_width = DoubleSlider(0.5, range=0..5 step 0.1)
series_of_instances = Python(IN[0]=rod_spacing_top, IN[1]=rod_spacing_bottom_2, IN[2]=rod_side_width, IN[3]=rod_class)  # CPython3
# ---------- series_of_instances.python (57 lines) ----------
import clr
clr.AddReference("ProtoGeometry")
from Autodesk.DesignScript.Geometry import *
import math

SquareRod = IN[3]
bottom_points = IN[0]
top_points = IN[1]
width = IN[2]

try:
    _ = width[0]
except:
    width = [width]

sx = 0.0
sy = 0.0
count = len(bottom_points)
if len(top_points) < count:
    count = len(top_points)

for i in range(count):
    bp = bottom_points[i]
    sx += bp.X
    sy += bp.Y

center = Point.ByCoordinates(sx / count, sy / count, 0)

theta = math.radians(15)
angled_top_points = []

for i in range(count):
    bp = bottom_points[i]
    tp = top_points[i]
    height = bp.DistanceTo(tp)
    offset = math.tan(theta) * height
    inward_vec = Vector.ByTwoPoints(tp, center).Normalized()
    tp_new = tp.Add(inward_vec.Scale(offset))
    angled_top_points.append(tp_new)

top_points = angled_top_points

rods = []

for i in range(count):
    try:
        r = width[i]
    except:
        r = width[-1]

    bp = bottom_points[i]
    tp = top_points[i]

    rod = SquareRod(bp, tp, r)
    rods.append(rod.make_geometry())

OUT = rods
# ----------------------------------------
perimeterCurves = Surface.PerimeterCurves(surface=series_of_instances)
flatten = List.Flatten(list=perimeterCurves)
byGroupedCurves = PolyCurve.ByGroupedCurves(curves=flatten)
extrudeAsSolid = Curve.ExtrudeAsSolid(curve=byGroupedCurves)
creates_a_list_of_values = Python(IN[0]=sphere_itteration)  # "Creates A List Of Values Intersecting The Sphere"; CPython3
# ---------- creates_a_list_of_values.python (11 lines) ----------
# Load the Python Standard and DesignScript Libraries
import sys
import clr
clr.AddReference('ProtoGeometry')
from Autodesk.DesignScript.Geometry import *

sphere=IN[0]
listsphere=[]
for i in range(40):
    listsphere.append(sphere)
OUT=listsphere
# ----------------------------------------
rod_sphere_intersect = Geometry.Intersect(geometry=extrudeAsSolid, other=creates_a_list_of_values)
lists_which_value_does_and_does = Watch(rod_sphere_intersect)  # "Lists Which Value Does and Does Not Intersect The Sphere"
returns_every_second_entry = Python(IN[0]=rod_sphere_intersect)  # CPython3
# ---------- returns_every_second_entry.python (12 lines) ----------
# Load the Python Standard and DesignScript Libraries
import sys
import clr
clr.AddReference('ProtoGeometry')
from Autodesk.DesignScript.Geometry import *

rods=IN[0]
newrods=[]
for rod in rods:
    if rods.index(rod)%2==1:
        newrods.append(rod)
OUT=newrods
# ----------------------------------------
rod_intersect_volume = Solid.Volume(solid=returns_every_second_entry)
watch = Watch(rod_intersect_volume)
lists_the_start_end_points = Watch(flatten)
rod_solid_volume = Solid.Volume(solid=extrudeAsSolid)
meter_to_millimeter_conversion_2 = CodeBlock(V=rod_solid_volume) { list= V * 1000000000; thing= Math.Sum(list); thingR = Math.Round(thing); }
rod_volume_display = Watch(meter_to_millimeter_conversion_2.thingR)
flatten_2 = List.Flatten(list=rod_intersect_volume)
meter_to_millimeter_conversion_3 = CodeBlock(V=flatten_2) { list= V * 1000000000; thing= Math.Sum(list); thingR = Math.Round(thing); }
rod_volume_intersect = Watch(meter_to_millimeter_conversion_3.thingR)
subtracts_rod_sphere = Python(IN[0]=rod_volume_display, IN[1]=rod_volume_intersect)  # "Subtracts Rod / Sphere Intersection"; CPython3
# ---------- subtracts_rod_sphere.python (13 lines) ----------
# Load the Python Standard and DesignScript Libraries
import sys
import clr
clr.AddReference('ProtoGeometry')
from Autodesk.DesignScript.Geometry import *

Total = IN[0]
Cut = IN[1]

Result = Total - Cut


OUT = Result
# ----------------------------------------
removes_decimals_and_adds_mm3 = CodeBlock(v=subtracts_rod_sphere) { list = Math.Floor(v) + " mm3"; output = (list); }
rod_volume_display_2 = Watch(removes_decimals_and_adds_mm3.list)
