# Dynamo graph 1860937.dyn (Dynamo 3.6.0.9395)

# group: Don't touch this ground
code_block = CodeBlock { -5000; -5000; -200; }
byCoordinates = Point.ByCoordinates(x=code_block.out0, y=code_block.out1, z=code_block.out2)
code_block_2 = CodeBlock { 5000; 5000; 0; }
byCoordinates_2 = Point.ByCoordinates(x=code_block_2.out0, y=code_block_2.out1, z=code_block_2.out2)
byCorners = Cuboid.ByCorners(lowPoint=byCoordinates, highPoint=byCoordinates_2)
code_block_3 = CodeBlock { 0; 100; 0; }
byARGB = Color.ByARGB(red=code_block_3.out0, green=code_block_3.out1, blue=code_block_3.out2)
byGeometryColor = Modifiers.GeometryColor.ByGeometryColor(geometry=byCorners, color=byARGB)

left_w_coordinates = CodeBlock()
# ---------- left_w_coordinates.designscript (6 lines) ----------
w1 = Point.ByCoordinates(5000,-5000,7000);
w2 = Point.ByCoordinates(5000,-4000,4000);
w3 = Point.ByCoordinates(5000,-3250,5750);
w4 = Point.ByCoordinates(5000,-2000,4000);
w5 = Point.ByCoordinates(5000,-1750,6375);
[w1,w2,w3,w4,w5];
# ----------------------------------------
left_w = PolyCurve.ByPoints(points=left_w_coordinates.out5)
height_of_pavilion = DoubleSlider(700, range=-1500..5000 step 100)
front_left_w_translation = Geometry.Translate(geometry=left_w, zTranslation=height_of_pavilion)
loop_1_of_o_coordinates = CodeBlock()
# ---------- loop_1_of_o_coordinates.designscript (3 lines) ----------
c1 = Point.ByCoordinates(5000,-1750,6375);
c2 = Point.ByCoordinates(5000,1000,5750);
c3 = Point.ByCoordinates(5000,0,5000);
# ----------------------------------------
loop_1_of_o = Arc.ByThreePoints(firstPoint=loop_1_of_o_coordinates.c1, secondPoint=loop_1_of_o_coordinates.c2, thirdPoint=loop_1_of_o_coordinates.c3)
front_loop_1_of_o_translation = Geometry.Translate(geometry=loop_1_of_o, zTranslation=height_of_pavilion)
loop_2_of_o_coordinates = CodeBlock()
# ---------- loop_2_of_o_coordinates.designscript (3 lines) ----------
c4 = Point.ByCoordinates(5000,1750,6375);
c5 = Point.ByCoordinates(5000,-1000,5750);
c6 = Point.ByCoordinates(5000,0,5000);
# ----------------------------------------
loop_2_of_o = Arc.ByThreePoints(firstPoint=loop_2_of_o_coordinates.c4, secondPoint=loop_2_of_o_coordinates.c5, thirdPoint=loop_2_of_o_coordinates.c6)
front_loop_2_of_o_translation = Geometry.Translate(geometry=loop_2_of_o, zTranslation=height_of_pavilion)
right_w_coordinates = CodeBlock()
# ---------- right_w_coordinates.designscript (6 lines) ----------
w6 = Point.ByCoordinates(5000,1750,6375);
w7 = Point.ByCoordinates(5000,2000,4000);
w8 = Point.ByCoordinates(5000,3250,5750);
w9 = Point.ByCoordinates(5000,4000,4000);
w10 = Point.ByCoordinates(5000,5000,7000);
[w6,w7,w8,w9,w10];
# ----------------------------------------
right_w = PolyCurve.ByPoints(points=right_w_coordinates.out5)
front_right_w_translation = Geometry.Translate(geometry=right_w, zTranslation=height_of_pavilion)
wow_curve = CodeBlock(left=front_left_w_translation, right_arc=front_loop_1_of_o_translation, left_arc=front_loop_2_of_o_translation, right=front_right_w_translation) { left; right_arc; left_arc; right; [left,right_arc,left_arc,right]; }
front_wow = PolyCurve.ByJoinedCurves(curves=wow_curve.out4)
length_of_pavillion = DoubleSlider(-10000, range=-10000..-1000 step 100)
rear_wow = Geometry.Translate(geometry=front_wow, xTranslation=length_of_pavillion)
number_of_circular_rods = DoubleSlider(132, range=100..1000 step 1)
rods = CodeBlock(rods=number_of_circular_rods) { 0; rods; 1/(rods-1); }
sequence = Sequence(start=rods.out0, amount=rods.rods, step=rods.out2)
rears = Curve.PointAtParameter(curve=rear_wow, param=sequence)
fronts = Curve.PointAtParameter(curve=front_wow, param=sequence)
radii_of_circular_rods = DoubleSlider(76, range=1..150 step 1)
radii = CodeBlock(r=radii_of_circular_rods) { [r]; }
circular_rod_class = Python()  # CPython3; unwired: IN[0]
# ---------- circular_rod_class.python (16 lines) ----------
# Load the Python Standard and DesignScript Libraries
import sys
import clr
clr.AddReference('ProtoGeometry')
from Autodesk.DesignScript.Geometry import *

class CircularRod:
    def __init__(self, rear_point, front_point, radius):
        self.rear = rear_point
        self.front = front_point
        self.radius = radius

    def make_geometry(self):
        return Cylinder.ByPointsRadius(self.rear, self.front, self.radius)

OUT = CircularRod
# ----------------------------------------
circular_rod_series = Python(Rears=rears, Fronts=fronts, Radii=radii, Class=circular_rod_class)  # CPython3
# ---------- circular_rod_series.python (18 lines) ----------
CircularRod = IN[3]
rear_points = IN[0]
front_points = IN[1]
radii = IN[2]

rods = []
count = min(len(rear_points), len(front_points))

for i in range(count):
  
    r = radii[i] if i < len(radii) else radii[-1]
    rear = rear_points[i]
    front = front_points[i]
    
    rod = CircularRod(rear, front, r)
    rods.append(rod.make_geometry())

OUT = rods
# ----------------------------------------
volumes_of_circular_aluminium = Solid.Volume(solid=circular_rod_series)  # "Volumes of Circular Aluminium Rods"
sum = Math.Sum(values=volumes_of_circular_aluminium)
volume_of_circular_aluminium = Watch(sum)  # "Volume of Circular Aluminium Rods (mm^2)"
left_arc_coordinates = CodeBlock { Point.ByCoordinates(5000,-4000,4000); Point.ByCoordinates(5000,-4000,2500); Point.ByCoordinates(5000,-5000,0); }
left_arc_top_translation = Geometry.Translate(geometry=left_arc_coordinates.out0, zTranslation=height_of_pavilion)
left_arc_midpoint_translation = Geometry.Translate(geometry=left_arc_coordinates.out1, zTranslation=height_of_pavilion)
front_left_arc = Arc.ByThreePoints(firstPoint=left_arc_top_translation, secondPoint=left_arc_midpoint_translation, thirdPoint=left_arc_coordinates.out2)
rear_left_arc = Geometry.Translate(geometry=front_left_arc, xTranslation=length_of_pavillion)
right_arc_coordinates = CodeBlock { Point.ByCoordinates(5000,4000,4000); Point.ByCoordinates(5000,4000,2500); Point.ByCoordinates(5000,5000,0); }
right_arc_top_translation = Geometry.Translate(geometry=right_arc_coordinates.out0, zTranslation=height_of_pavilion)
right_arc_midpoint_translation = Geometry.Translate(geometry=right_arc_coordinates.out1, zTranslation=height_of_pavilion)
front_right_arc = Arc.ByThreePoints(firstPoint=right_arc_top_translation, secondPoint=right_arc_midpoint_translation, thirdPoint=right_arc_coordinates.out2)
rear_right_arc = Geometry.Translate(geometry=front_right_arc, xTranslation=length_of_pavillion)
arcs = CodeBlock(a1=front_left_arc, a2=rear_left_arc, a3=front_right_arc, a4=rear_right_arc) { [a1,a2]; [a3,a4]; }
arc_surface_class = Python()  # CPython3; unwired: IN[0]
# ---------- arc_surface_class.python (17 lines) ----------
# Load the Python Standard and DesignScript Libraries
import sys
import clr
clr.AddReference('ProtoGeometry')
from Autodesk.DesignScript.Geometry import *

class ArcSurface:
    def __init__(self, arcs):
        self.arcs = arcs
        
    def makegeometry(self):
        return Surface.ByLoft(self.arcs)
    def thicken(self,thickness):
        surface = self.makegeometry()
        solid = surface.Thicken(thickness)
        return solid
OUT = ArcSurface
# ----------------------------------------
thickness_of_columns_and_walls = CodeBlock(r=radii_of_circular_rods) { r; thickness = 2*r; }
left_arc_surface_instance = Python(Arcs=arcs.out0, Class=arc_surface_class, Thickness=thickness_of_columns_and_walls.thickness)  # "Left Arc Surface Instance - Exterior Wall"; CPython3
# ---------- left_arc_surface_instance.python (8 lines) ----------
arcs = IN[0]
ArcSurface = IN[1]
thickness = IN[2]

surface = ArcSurface(arcs)


OUT = surface.thicken(thickness)
# ----------------------------------------
right_arc_surface_instance = Python(Arcs=arcs.out1, Class=arc_surface_class, Thickness=thickness_of_columns_and_walls.thickness)  # "Right Arc Surface Instance - Exterior Wall"; CPython3; same code as left_arc_surface_instance
left_arc_surface_instance_wall = Python(Arcs=arcs.out0, Class=arc_surface_class, Thickness=radii_of_circular_rods)  # "Left Arc Surface Instance - Wall Frame"; CPython3; same code as left_arc_surface_instance
right_arc_surface_instance_wall = Python(Arcs=arcs.out1, Class=arc_surface_class, Thickness=radii_of_circular_rods)  # "Right Arc Surface Instance - Wall Frame"; CPython3; same code as left_arc_surface_instance
walls = CodeBlock(s1=left_arc_surface_instance, s2=right_arc_surface_instance, s3=left_arc_surface_instance_wall, s4=right_arc_surface_instance_wall) { wall = [s1,s2]; steel = [s3,s4]; plywood = [Solid.Difference(s1,s3),Solid.Difference(s2,s4)]; }
volumes_of_steel_wall_frames = Solid.Volume(solid=walls.steel)
sum_2 = Math.Sum(values=volumes_of_steel_wall_frames)
volume_of_steel_wall_frame_mm_2 = Watch(sum_2)
brown_plywood = CodeBlock { Color.ByARGB(255,150,75,0); }
plywood = Modifiers.GeometryColor.ByGeometryColor(geometry=walls.wall, color=brown_plywood)
green_coated_aluminium = CodeBlock { Color.ByARGB(255,34,139,34); }
aluminium = Modifiers.GeometryColor.ByGeometryColor(geometry=circular_rod_series, color=green_coated_aluminium)
rear_left_w_translation = Geometry.Translate(geometry=left_w, xTranslation=length_of_pavillion, zTranslation=height_of_pavilion)
rear_loop_1_of_o_translation = Geometry.Translate(geometry=loop_1_of_o, xTranslation=length_of_pavillion, zTranslation=height_of_pavilion)
rear_loop_2_of_o_translation = Geometry.Translate(geometry=loop_2_of_o, xTranslation=length_of_pavillion, zTranslation=height_of_pavilion)
rear_right_w_translation = Geometry.Translate(geometry=right_w, xTranslation=length_of_pavillion, zTranslation=height_of_pavilion)
code_block_4 = CodeBlock(w1=front_left_w_translation, w2=rear_left_w_translation, o1=front_loop_1_of_o_translation, o2=rear_loop_1_of_o_translation, o3=front_loop_2_of_o_translation, o4=rear_loop_2_of_o_translation, w3=front_right_w_translation, w4=rear_right_w_translation) { left = [w1,w2]; first_loop = [o1,o2]; second_loop = [o3,o4]; right = [w3,w4]; }
left_w_surface = PolySurface.ByLoft(crossSections=code_block_4.left)
left_w_polycarbonate_sheet = Surface.Thicken(surface=left_w_surface)
loop_1_of_o_surface = PolySurface.ByLoft(crossSections=code_block_4.first_loop)
loop_1_of_o_polycarbonate_sheet = Surface.Thicken(surface=loop_1_of_o_surface)
loop_2_of_o_surface = PolySurface.ByLoft(crossSections=code_block_4.second_loop)
loop_1_of_o_polycarbonate_sheet_2 = Surface.Thicken(surface=loop_2_of_o_surface)
right_w_surface = PolySurface.ByLoft(crossSections=code_block_4.right)
right_w_polycarbonate_sheet = Surface.Thicken(surface=right_w_surface)
code_block_5 = CodeBlock(s1=left_w_polycarbonate_sheet, s2=loop_1_of_o_polycarbonate_sheet, s3=loop_1_of_o_polycarbonate_sheet_2, s4=right_w_polycarbonate_sheet) { [s1,s2,s3,s4]; }
polycarbonate_rooftop = Solid.ByUnion(solids=code_block_5)
translucent_green_polycarbonate = CodeBlock { Color.ByARGB(128, 0, 120, 0); }
polycarbonate = Modifiers.GeometryColor.ByGeometryColor(geometry=polycarbonate_rooftop, color=translucent_green_polycarbonate)
volume_of_polycarbonate_rooftop = Solid.Volume(solid=polycarbonate_rooftop)
volume_of_polycarbonate_rooftop_2 = Watch(volume_of_polycarbonate_rooftop)  # "Volume of Polycarbonate Rooftop (mm^2)"
code_block_6 = CodeBlock(z=height_of_pavilion) { origin = Point.ByCoordinates(5000,-2000,2000); z/2; }
translation_of_column_line_start = Geometry.Translate(geometry=code_block_6.origin, zTranslation=code_block_6.out1)
code_block_7 = CodeBlock(x=length_of_pavillion, z=height_of_pavilion) { 5000+x; -2000; 2000+z/2; }
column_line_end = Point.ByCoordinates(x=code_block_7.out0, y=code_block_7.out1, z=code_block_7.out2)
column_line = Line.ByStartPointEndPoint(startPoint=translation_of_column_line_start, endPoint=column_line_end)
number_of_columns = DoubleSlider(5, range=2..5 step 1)
code_block_8 = CodeBlock(columns=number_of_columns) { 0; columns; 1/(columns-1); }
sequence_2 = Sequence(start=code_block_8.out0, amount=code_block_8.columns, step=code_block_8.out2)
column_origins = Curve.PointAtParameter(curve=column_line, param=sequence_2)
code_block_9 = CodeBlock(z=height_of_pavilion) { 4000+z; }
left_columns = Cuboid.ByLengths(origin=column_origins, width=thickness_of_columns_and_walls.thickness, length=thickness_of_columns_and_walls.thickness, height=code_block_9)
volumes_of_timber_columns = Solid.Volume(solid=left_columns)
code_block_10 = CodeBlock(v_columns=volumes_of_timber_columns) { 2*Math.Sum(v_columns); }
volume_of_timber_columns_mm_2 = Watch(code_block_10)
code_block_11 = CodeBlock { 4000; }
right_columns = Geometry.Translate(geometry=left_columns, yTranslation=code_block_11)
code_block_12 = CodeBlock(c1=left_columns, c2=right_columns) { [c1,c2]; }
brown_timber = CodeBlock { Color.ByARGB(255,150,75,0); }
timber = Modifiers.GeometryColor.ByGeometryColor(geometry=code_block_12, color=brown_timber)
volumes_of_plywood_wall = Solid.Volume(solid=walls.plywood)  # "Volumes of Plywood Wall Exteriors"
sum_3 = Math.Sum(values=volumes_of_plywood_wall)
volume_of_plywood_wall_exterior = Watch(sum_3)  # "Volume of Plywood Wall Exterior (mm^2)"
