# Dynamo graph 1861262.dyn "Omar_Sakr_1861262_ Pavillion(gg)" (Dynamo 4.0.0.3277)

# group: Don't touch this ground
code_block = CodeBlock { -5000; -5000; -200; }
byCoordinates = Point.ByCoordinates(x=code_block.out0, y=code_block.out1, z=code_block.out2)
code_block_2 = CodeBlock { 5000; 5000; 0; }
byCoordinates_2 = Point.ByCoordinates(x=code_block_2.out0, y=code_block_2.out1, z=code_block_2.out2)
byCorners = Cuboid.ByCorners(lowPoint=byCoordinates, highPoint=byCoordinates_2)
code_block_3 = CodeBlock { 0; 100; 0; }
byARGB = Color.ByARGB(red=code_block_3.out0, green=code_block_3.out1, blue=code_block_3.out2)
byGeometryColor = Modifiers.GeometryColor.ByGeometryColor(geometry=byCorners, color=byARGB)

number_of_arches = IntegerSlider(35, range=5..50 step 1)
arch_height_mm = DoubleSlider(5000, range=2500..5000 step 100)
pavillion_width_mm = DoubleSlider(8000, range=4000..8000 step 100)
wave_amplitude = DoubleSlider(1000, range=0..1000 step 50)
python_script = Python(IN[0]=number_of_arches, IN[1]=arch_height_mm, IN[2]=pavillion_width_mm, IN[3]=wave_amplitude)  # PythonNet3
# ---------- python_script.python (130 lines) ----------
import sys
import clr
import math

clr.AddReference('ProtoGeometry')
from Autodesk.DesignScript.Geometry import *

# CLASS DEFINITIONS

class TimberArch:
    def __init__(self, x, w, h, thk):
        self.x = x
        self.w = w
        self.h = h
        self.thk = thk
        self.geo = None
    
    def create(self):
        # Create points
        p1 = Point.ByCoordinates(self.x, -self.w/2, 0)
        p2 = Point.ByCoordinates(self.x, 0, self.h)
        p3 = Point.ByCoordinates(self.x, self.w/2, 0)
        
        #Create the Arc Curve
        arc = Arc.ByThreePoints(p1, p2, p3)
        
        # Create Solid 
 
        vec = Vector.ByCoordinates(self.thk, 0, 0)
        surf = arc.Extrude(vec)
        
        # Thicken the surface to make it a solid volume
        solid = surf.Thicken(self.thk)
        
        self.geo = solid
        return solid

    def get_vol(self):
        if self.geo: 
            return self.geo.Volume
        return 0

class SteelRod:
    def __init__(self, p_start, p_end, dia):
        self.start = p_start
        self.end = p_end
        self.dia = dia
        self.geo = None
    
    def create(self):
        # Create the path line
        line = Line.ByStartPointEndPoint(self.start, self.end)
        
        #Create Circle Profile
        vec = Vector.ByTwoPoints(self.start, self.end)
        plane = Plane.ByOriginNormal(self.start, vec)
        circ = Circle.ByPlaneRadius(plane, self.dia/2)
        
        # create solid rod
        solid = Solid.BySweep(circ, line)
        self.geo = solid
        return solid

    def get_vol(self):
        if self.geo: 
            return self.geo.Volume
        return 0

# Input parameters
num_arches = IN[0]
base_height = IN[1]
width = IN[2]
wave_amp = IN[3]

#LOGIC

timbers = []
steels = []

# Count verification to avoid errors
count = int(num_arches)
if count < 2: count = 2

# Space definitions
start_x = -4000.0
end_x = 4000.0
step = (end_x - start_x) / (count - 1)

prev_peak = None

for i in range(count):
    # Calculate X position
    curr_x = start_x + (i * step)
    
    # Calculate Height 
    angle = (float(i) / count) * 360
    rads = math.radians(angle * 2)
    h = base_height + (math.sin(rads) * wave_amp)
    
    # Create Timber Object
    t = TimberArch(curr_x, width, h, 200) 
    timbers.append(t)
    
    # Create Steel Object 
    curr_peak = Point.ByCoordinates(curr_x, 0, h)
    if prev_peak:
        s = SteelRod(prev_peak, curr_peak, 50) 
        steels.append(s)
    prev_peak = curr_peak

#OUTPUT 

# Generate Timber Geometry and Volume
t_geo = []
t_vol = 0.0
for t in timbers:
    g = t.create()
    t_geo.append(g)
    t_vol += t.get_vol()

# Generate Steel Geometry and Volume
s_geo = []
s_vol = 0.0
for s in steels:
    g = s.create()
    s_geo.append(g)
    s_vol += s.get_vol()

# Output
OUT = [t_geo, s_geo, t_vol, s_vol]
# ----------------------------------------
code_block_4 = CodeBlock(data=python_script) { data[0]; data[1]; data[2]; data[3]; }
timber_volume = Watch(code_block_4.out2)
code_block_5 = CodeBlock()
# ---------- code_block_5.designscript (24 lines) ----------
//Grid Settings
gap = 200;

//Letter Definitions
gx = [4,3,2,1,0, 0,0,0,0, 1,2,3,4, 4,4, 2,3,4];
gz = [4,4,4,4,4, 3,2,1,0, 0,0,0,0, 1,2, 2,2,2];

ax = [0,0,0,0,0, 4,4,4,4,4, 1,2,3, 1,2,3];
az = [0,1,2,3,4, 0,1,2,3,4, 4,4,4, 2,2,2];

nx = [0,0,0,0,0, 4,4,4,4,4, 1,2,3];
nz = [0,1,2,3,4, 0,1,2,3,4, 3,2,1];

//Create Points

L1 = Point.ByCoordinates(gx * gap, -5000, (gz * gap) + 75);
L2 = Point.ByCoordinates((ax + 6) * gap, -5000, (az * gap) + 75);
L3 = Point.ByCoordinates((ax + 12) * gap, -5000, (az * gap) + 75);
L4 = Point.ByCoordinates((nx + 18) * gap, -5000, (nz * gap) + 75);
L5 = Point.ByCoordinates((gx + 24) * gap, -5000, (gz * gap) + 75);

//Center the Sign
all_points = List.Flatten([L1, L2, L3, L4, L5], -1);
Sign_Loc = Geometry.Translate(all_points, -2800, 0, 0);
# ----------------------------------------
sign_generator = Python(IN[0]=code_block_5.Sign_Loc)  # PythonNet3
# ---------- sign_generator.python (35 lines) ----------
import clr
clr.AddReference('ProtoGeometry')
from Autodesk.DesignScript.Geometry import *

# Define the Pixel Class
class SignPixel:
    def __init__(self, size):
        self.size = size 
    
    def create_geometry(self, point):
        # Create a Coordinate System at the point
        cs = CoordinateSystem.ByOrigin(point)
        # Create the Cube
        return Cuboid.ByLengths(cs, self.size, self.size, self.size)
    
    def get_volume(self):
        # Volume 
        return self.size * self.size * self.size

# Logic
points = IN[0]
pixel = SignPixel(150)

geometry_list = []
total_volume = 0

# Loop through every point 
for p in points:
    # Create the cube and add to list
    geometry_list.append(pixel.create_geometry(p))
    # Add the volume of this cube to the total
    total_volume += pixel.get_volume()

# Output
OUT = [geometry_list, total_volume]
# ----------------------------------------
code_block_6 = CodeBlock(out=sign_generator) { out[1]; }
add = code_block_4.out3 + code_block_6
steel_volume = Watch(add)
