# Dynamo graph 1861379.dyn "1861379__Final" (Dynamo 3.6.0.9395)

# group: Don't touch this ground
code_block = CodeBlock { -5000; -5000; -200; }
byCoordinates = Point.ByCoordinates(x=code_block.out0, y=code_block.out1, z=code_block.out2)
code_block_2 = CodeBlock { 5000; 5000; 0; }
byCoordinates_2 = Point.ByCoordinates(x=code_block_2.out0, y=code_block_2.out1, z=code_block_2.out2)
byCorners = Cuboid.ByCorners(lowPoint=byCoordinates, highPoint=byCoordinates_2)
code_block_3 = CodeBlock { 0; 100; 0; }
byARGB = Color.ByARGB(red=code_block_3.out0, green=code_block_3.out1, blue=code_block_3.out2)
byGeometryColor = Modifiers.GeometryColor.ByGeometryColor(geometry=byCorners, color=byARGB)

class_Concrete_Foundation = Python()  # CPython3; unwired: IN[0]
# ---------- class_Concrete_Foundation.python (27 lines) ----------
# Load the Python Standard and DesignScript Libraries
import sys
import clr
clr.AddReference('ProtoGeometry')
from Autodesk.DesignScript.Geometry import *
import math

class ConcreteFoundation(object):
    def __init__(self, circle, thickness):
        self.circle = circle
        self.thickness = thickness
        
        # get center and radius from circle
        center = circle.CenterPoint    # property, no ()
        r = circle.Radius
        
        # start and end points for cylindrical slab
        start = Point.ByCoordinates(center.X, center.Y, center.Z)
        end   = Point.ByCoordinates(center.X, center.Y, center.Z + thickness)
        
        # circular slab geometry (cylinder with small height)
        self.geometry = Cylinder.ByPointsRadius(start, end, r)
        
        # volume in mm^3: π r^2 h
        self.volume = math.pi * (r ** 2) * thickness

OUT = ConcreteFoundation
# ----------------------------------------
code_block_4 = CodeBlock { 0; 0; 0; }
byCoordinates_3 = Point.ByCoordinates(x=code_block_4.out0, y=code_block_4.out1, z=code_block_4.out2)
base_Arc = DoubleSlider(2600, range=0..5000 step 100)
byCenterPointRadius = Circle.ByCenterPointRadius(centerPoint=byCoordinates_3, radius=base_Arc)
concrete_Thickness = DoubleSlider(200, range=10..1000 step 10)
instance_concrete_foundation = Python(IN[0]=class_Concrete_Foundation, IN[1]=byCenterPointRadius, IN[2]=concrete_Thickness)  # CPython3
# ---------- instance_concrete_foundation.python (11 lines) ----------
import clr
clr.AddReference('ProtoGeometry')
from Autodesk.DesignScript.Geometry import *

FoundationClass = IN[0]   # class from previous node
circle          = IN[1]   # Circle.ByCenterPointRadius output
thick           = IN[2]   # Concrete_Thickness slider

slab = FoundationClass(circle, thick)

OUT = (slab.geometry, slab.volume)
# ----------------------------------------
code_block_5 = CodeBlock { 1; }
getItemAtIndex = List.GetItemAtIndex(list=instance_concrete_foundation, index=code_block_5)
watch_material_volume_1_concrete = Watch(getItemAtIndex)  # "Watch | Material Volume 1 — Concrete Foundation (mm³)"
code_block_6 = CodeBlock { 0; 0; 0; }
byCoordinates_4 = Point.ByCoordinates(x=code_block_6.out0, y=code_block_6.out1, z=code_block_6.out2)
start_Angle = DoubleSlider(0, range=0..360 step 10)
end_Angle = DoubleSlider(270, range=0..360 step 10)
byCenterPointRadiusAngle = Arc.ByCenterPointRadiusAngle(center=byCoordinates_4, radius=base_Arc, startAngle=start_Angle, endAngle=end_Angle)
code_block_7 = CodeBlock { 0; 30; 1/29; }
sequence = Sequence(start=code_block_7.out0, amount=code_block_7.out1, step=code_block_7.out2)
pointAtParameter = Curve.PointAtParameter(curve=byCenterPointRadiusAngle, param=sequence)
code_block_8 = CodeBlock { -1000; 0; }
peak_Height = DoubleSlider(9200, range=0..10000 step 100)
byCoordinates_5 = Point.ByCoordinates(x=code_block_8.out0, y=code_block_8.out1, z=peak_Height)
code_block_9 = CodeBlock { 5000; 5000; 5000; }
byCoordinates_6 = Point.ByCoordinates(x=code_block_9.out0, y=code_block_9.out1, z=code_block_9.out2)
code_block_10 = CodeBlock { -4000; 1000; 3000; }
byCoordinates_7 = Point.ByCoordinates(x=code_block_10.out0, y=code_block_10.out1, z=code_block_10.out2)
code_block_11 = CodeBlock { 0; -1800; 1000; }
byCoordinates_8 = Point.ByCoordinates(x=code_block_11.out0, y=code_block_11.out1, z=code_block_11.out2)
list_create = List.Create(item0=byCoordinates_5, item1=byCoordinates_6, item2=byCoordinates_7, item3=byCoordinates_8)
byControlPoints = NurbsCurve.ByControlPoints(points=list_create)
code_block_12 = CodeBlock { 0; 30; 1/29; }
sequence_2 = Sequence(start=code_block_12.out0, amount=code_block_12.out1, step=code_block_12.out2)
pointAtParameter_2 = Curve.PointAtParameter(curve=byControlPoints, param=sequence_2)
radius_Of_Rods = DoubleSlider(100, range=0..500 step 10)
code_block_13 = CodeBlock { 20; 0; }
sequence_3 = Sequence(start=radius_Of_Rods, amount=code_block_13.out0, step=code_block_13.out1)
class_Circular_Rod = Python()  # CPython3; unwired: IN[0]
# ---------- class_Circular_Rod.python (20 lines) ----------
# Load the Python Standard and DesignScript Libraries
import sys
import clr
clr.AddReference('ProtoGeometry')
from Autodesk.DesignScript.Geometry import *
import math

class CircularRod:
    def __init__(self, bottom_point,top_point, radius):
        self.bottom = bottom_point
        self.top = top_point
        self.radius = radius 
        
    def make_geometry(self):
        return Cylinder.ByPointsRadius (self.bottom, self.top, self.radius)
    
    def volume(self):
        h = self.bottom.DistanceTo(self.top)
        return math.pi * (self.radius ** 2) * h
OUT = CircularRod
# ----------------------------------------
instances_circular_timber_rods = Python(IN[0]=pointAtParameter, IN[1]=pointAtParameter_2, IN[2]=sequence_3, IN[3]=class_Circular_Rod)  # CPython3
# ---------- instances_circular_timber_rods.python (23 lines) ----------
# Load the Python Standard and DesignScript Libraries
import sys
import clr
clr.AddReference('ProtoGeometry')
from Autodesk.DesignScript.Geometry import *

CircularRod = IN[3]
bottom_points = IN[0]
top_points = IN[1]
radii = IN[2]

rods =[]
count = min(len(bottom_points), len(top_points))

for i in range(count):
    r = radii[i] if i < len(radii) else radii[-1]
    btm = bottom_points[i]
    top = top_points[i]
    
    rod = CircularRod(btm, top, r)
    rods.append(rod.make_geometry())
    
OUT = rods
# ----------------------------------------
volume = Solid.Volume(solid=instances_circular_timber_rods)
sum = Math.Sum(values=volume)
watch_material_volume_2_circular = Watch(sum)  # "Watch | Material Volume 2 – Circular Steel Rods (mm³)"
code_block_14 = CodeBlock { 255; 165; 115; 70; }
byARGB_2 = Color.ByARGB(alpha=code_block_14.out0, red=code_block_14.out1, green=code_block_14.out2, blue=code_block_14.out3)
byGeometryColor_2 = Modifiers.GeometryColor.ByGeometryColor(geometry=instances_circular_timber_rods, color=byARGB_2)
code_block_15 = CodeBlock { 0; }
getItemAtIndex_2 = List.GetItemAtIndex(list=instance_concrete_foundation, index=code_block_15)
code_block_16 = CodeBlock { 255; 40; 40; 40; }
byARGB_3 = Color.ByARGB(alpha=code_block_16.out0, red=code_block_16.out1, green=code_block_16.out2, blue=code_block_16.out3)
byGeometryColor_3 = Modifiers.GeometryColor.ByGeometryColor(geometry=getItemAtIndex_2, color=byARGB_3)
