# Dynamo graph 1861457.dyn (Dynamo 3.6.0.9395)

# group: Don't touch this ground
code_block = CodeBlock { -5000; -5000; -200; }
byCoordinates = Point.ByCoordinates(x=code_block.out0, y=code_block.out1, z=code_block.out2)
code_block_2 = CodeBlock { 5000; 5000; 0; }
byCoordinates_2 = Point.ByCoordinates(x=code_block_2.out0, y=code_block_2.out1, z=code_block_2.out2)
byCorners = Cuboid.ByCorners(lowPoint=byCoordinates, highPoint=byCoordinates_2)
code_block_3 = CodeBlock { 0; 100; 0; }
byARGB = Color.ByARGB(red=code_block_3.out0, green=code_block_3.out1, blue=code_block_3.out2)
byGeometryColor = Modifiers.GeometryColor.ByGeometryColor(geometry=byCorners, color=byARGB)

class_rectangular_steel_beams = Python()  # CPython3
# ---------- class_rectangular_steel_beams.python (37 lines) ----------
# Load the Python Standard and DesignScript Libraries
import sys
import clr
clr.AddReference('ProtoGeometry')
from Autodesk.DesignScript.Geometry import *

class RectSteel(object):
    def __init__(self, start, end, width, height):
        self.start  = start
        self.end    = end
        self.width  = width
        self.height = height

    def axis(self):
        # centre line of the beam
        return Line.ByStartPointEndPoint(self.start, self.end)

    def profiles(self):
        # 1) Make a rectangle in XY, centred at the origin
        r0 = Rectangle.ByWidthLength(self.width, self.height)

        # 2) Move it to the start point
        r0 = r0.Translate(self.start.X, self.start.Y, self.start.Z)

        # 3) Copy it to the end point (same orientation, shifted)
        v = Vector.ByTwoPoints(self.start, self.end)
        r1 = r0.Translate(v.X, v.Y, v.Z)

        return r0, r1

    def solid(self):
        p0, p1 = self.profiles()
        # Loft between the two identical profiles
        return Solid.ByLoft([p0, p1])


OUT = RectSteel
# ----------------------------------------
number_of_panels = DoubleSlider(5, range=0..10 step 1)
theta = DoubleSlider(32, range=10..80 step 1)
finalTheta = DoubleSlider(75, range=10..80 step 1)
phi = DoubleSlider(110, range=10..170 step 1)
finalPhi = DoubleSlider(91, range=10..170 step 1)
length_factor = DoubleSlider(7000, range=2500..7000 step 100)
panel_length_factor = DoubleSlider(0.73, range=0..1 step 0.01)
beam_height = DoubleSlider(240, range=60..500 step 20)
beam_thickness = DoubleSlider(100, range=50..500 step 10)
start_and_end_points = Python(IN[0]=number_of_panels, IN[1]=theta, IN[2]=finalTheta, IN[3]=phi, IN[4]=finalPhi, IN[5]=length_factor, IN[6]=panel_length_factor, IN[7]=beam_height, IN[8]=beam_thickness)  # CPython3
# ---------- start_and_end_points.python (63 lines) ----------
"""
This script generates ALL points used for the construction of the structure. Other scripts simply use the points calculated here to generate geometry. 
"""


import sys
import clr
clr.AddReference('ProtoGeometry')
from Autodesk.DesignScript.Geometry import *
import math
numberOfBeams = int(IN[0])


theta = math.radians(IN[1])         #initial angle from the positive z-axis
finalTheta = math.radians(IN[2])    #final angle from the positive z-axis, 
phi = math.radians(IN[3])           #initial angle from the positive x-axis
finalPhi = math.radians(IN[4])      #final angle from the positive z-axis
length = IN[5]                      #length factor of the beams, does not tranlate directly to their lengths
plate_length_factor = IN[6]         #height of the plates as a factor of the length of the beams (how much of         
                                    #beam they cover
beam_height = IN[7]                 #height of the beam in the z direction, used to keep the beams on the 
                                    #green boundary
beam_width = IN[8]                  #same idea as the height, used to keep the beams in-bound

start, end = [], []                         #lists for the start and end coordinates
start_ymirrored, end_reversed = [], []      #start coordinates reflected across the y-axis (xz plane)
                                            #end coordinates' order will be revered later, design purposes

xlim, ylim = (-5000,5000), (-5000,5000)     #limits of construction, 10mx10m area total


xpos, ypos, zpos = xlim[0], ylim[0], 0

for i in range(numberOfBeams):
    start.append(Point.ByCoordinates(xpos-beam_width*0.5 if xpos > 0 else (xpos+beam_width if xpos < 0 else 0),ypos+beam_height*0.7,zpos)) # the part on the y-coord brings the value "coser to zero to keep beams inside the square
    start_ymirrored.append(Point.ByCoordinates(xpos-beam_width*0.5 if xpos > 0 else (xpos+beam_width if xpos < 0 else 0),-(ypos+beam_height*0.7),zpos))
    xpos += (xlim[1]-xlim[0])/numberOfBeams
start.append(Point.ByCoordinates(xpos,ypos+beam_height*0.7,zpos))
start_ymirrored.append(Point.ByCoordinates(xpos,-(ypos+beam_height*0.7),zpos))

for point in start:
    uv = (math.sin(theta)*math.cos(phi),math.sin(theta)*math.sin(phi), math.cos(theta)) #sprical -> cartesian
    theta += (finalTheta - theta)/numberOfBeams
    phi += (finalPhi - phi)/numberOfBeams
    ex, ey, ez = point.X + uv[0]*length, point.Y + uv[1]*length, point.Z + uv[2]*length
    end.append(Point.ByCoordinates(ex,ey,ez))
    
end_reversed = end[::-1]

p1 , p2 = end[:], end[:]  #copies of end list 
p3 = []
p1.pop()
p2.pop(0)

for point in p1:
    v = Vector.ByTwoPoints(point,start[p1.index(point)]) #start and end of the same beam
    p3.append(point.Add(v.Scale(plate_length_factor)))   #scaling of the vector by plate_length_factor, append

OUT = {"start points": start+start_ymirrored, 
         "end points": end+end_reversed, 
           "panel p1": p1,
           "panel p2": p2,
           "panel p3": p3}
# ----------------------------------------
dictionary_keys = CodeBlock { "start points"; "end points"; }
start_points = DesignScript.Builtin.Dictionary.ValueAtKey(dictionary=start_and_end_points, key=dictionary_keys.out0)
end_points = DesignScript.Builtin.Dictionary.ValueAtKey(dictionary=start_and_end_points, key=dictionary_keys.out1)
series_of_instances_of_steel = Python(IN[0]=class_rectangular_steel_beams, IN[1]=start_points, IN[2]=end_points, IN[3]=beam_thickness, IN[4]=beam_height)  # "Series of Instances of Steel Beams"; CPython3
# ---------- series_of_instances_of_steel.python (34 lines) ----------
RectSteel = IN[0] #class RectSteel
starts  = IN[1]   #Point or list[Points]
ends    = IN[2]   #Point or list[Points]
widths  = IN[3]   #number or list[numbers]
heights = IN[4]   #number or list[numbers]

#if input is not a list, this will convert is to a list that has n elements
def convert_to_list(x, n):
    if isinstance(x, list):
        return x
    else:
        return [x] * n

#if the user passed a single point, treat it as one-element list
if not isinstance(starts, list):
    starts = [starts]

n = len(starts)

ends    = convert_to_list(ends,    n)
widths  = convert_to_list(widths,  n)
heights = convert_to_list(heights, n)

solids = []
volume = 0

for s, e, w, h in zip(starts, ends, widths, heights):
    b = RectSteel(s, e, w, h)
    solids.append(b.solid())
    volume +=  b.solid().Volume


OUT = { "Beams":solids, 
       "Volume":str(volume) + " mm^3"}
# ----------------------------------------
dictionary_keys_2 = CodeBlock { "Volume"; "Beams"; }
volume = DesignScript.Builtin.Dictionary.ValueAtKey(dictionary=series_of_instances_of_steel, key=dictionary_keys_2.out0)
volume_of_steel = Watch(volume)
beams = DesignScript.Builtin.Dictionary.ValueAtKey(dictionary=series_of_instances_of_steel, key=dictionary_keys_2.out1)
class_tinted_glass_panels = Python()  # CPython3
# ---------- class_tinted_glass_panels.python (44 lines) ----------
# Load the Python Standard and DesignScript Libraries
import sys
import clr
clr.AddReference('ProtoGeometry')
from Autodesk.DesignScript.Geometry import *

class Panel:
    def __init__(self, p0, p1, p2, thickness):
        self.p0 = p0        #origin corner
        self.p1 = p1        #corner along first edge
        self.p2 = p2        #corner along second edge
        self.t  = thickness #panel thickness

    #geometric plane through the three points
    def plane(self):
        return Plane.ByThreePoints(self.p0, self.p1, self.p2)

    #2D profile (parallelogram) lying in that plane
    def profile(self):
        #edge vectors
        v1 = Vector.ByTwoPoints(self.p0, self.p1)
        v2 = Vector.ByTwoPoints(self.p0, self.p2)

        #other two corners of the panel
        p3 = self.p0.Add(v1)      # p0 + v1
        p4 = self.p0.Add(v2)      # p0 + v2
        p5 = p4.Add(v1)           # p4 + v1  (fourth corner)

        #order points around the boundary
        pts = [self.p0, self.p1, p5, p4]

        return Polygon.ByPoints(pts)

    #solid “thin box” Panel
    def solid(self):
        pl = self.plane()
        n  = pl.Normal
        prof0 = self.profile()
        #second profile offset along the plane normal by thickness
        prof1 = prof0.Translate(n.X * self.t, n.Y * self.t, n.Z * self.t)
        #loft between the two profiles to get a thin solid
        return Solid.ByLoft([prof0, prof1])

OUT = Panel
# ----------------------------------------
dictionary_keys_3 = CodeBlock { "panel p1"; "panel p2"; "panel p3"; }
panel_p1 = DesignScript.Builtin.Dictionary.ValueAtKey(dictionary=start_and_end_points, key=dictionary_keys_3.out0)
panel_p2 = DesignScript.Builtin.Dictionary.ValueAtKey(dictionary=start_and_end_points, key=dictionary_keys_3.out1)
panel_p3 = DesignScript.Builtin.Dictionary.ValueAtKey(dictionary=start_and_end_points, key=dictionary_keys_3.out2)
panel_thickness = DoubleSlider(2, range=1..10 step 0.5)
series_of_instances_of_glass = Python(IN[0]=class_tinted_glass_panels, IN[1]=panel_p1, IN[2]=panel_p2, IN[3]=panel_p3, IN[4]=panel_thickness)  # "Series of Instances of Glass Panels"; CPython3
# ---------- series_of_instances_of_glass.python (39 lines) ----------
# Load the Python Standard and DesignScript Libraries
import sys
import clr
clr.AddReference('ProtoGeometry')
from Autodesk.DesignScript.Geometry import *

Panel = IN[0]  #Class

p0s = IN[1]    #Point or list[Points]
p1s = IN[2]    #Point or list[Points]
p2s = IN[3]    #Point or list[Points]
ts  = IN[4]    #Number or list[Numbers]

def convert_to_list(x, n):
    if isinstance(x, list):
        return x
    else:
        return [x] * n

#ensure p0s is a list
if not isinstance(p0s, list):
    p0s = [p0s]

n = len(p0s)

p1s = convert_to_list(p1s, n)
p2s = convert_to_list(p2s, n)
ts  = convert_to_list(ts,  n)

solids   = []
volume = 0

for p0, p1, p2, t in zip(p0s, p1s, p2s, ts):
    panel = Panel(p0, p1, p2, t)
    solids.append(panel.solid())
    volume += panel.solid().Volume

OUT = { "Panels":solids,
        "Volume":str(volume) + " mm^3"} 
# ----------------------------------------
dictionary_keys_4 = CodeBlock { "Panels"; "Volume"; }
volume_2 = DesignScript.Builtin.Dictionary.ValueAtKey(dictionary=series_of_instances_of_glass, key=dictionary_keys_4.out1)
volume_of_glass = Watch(volume_2)
code_block_4 = CodeBlock {  }
panels = DesignScript.Builtin.Dictionary.ValueAtKey(dictionary=series_of_instances_of_glass, key=dictionary_keys_4.out0)
colour_rbg = CodeBlock { 85; 97; 77; }
panel_color = Color.ByARGB(red=colour_rbg.out0, green=colour_rbg.out1, blue=colour_rbg.out2)
colored_panels = Modifiers.GeometryColor.ByGeometryColor(geometry=panels, color=panel_color)
