# Dynamo graph 1861508.dyn (Dynamo 3.5.2.8914)

# group: Don't touch this ground
code_block = CodeBlock { -5000; -5000; -200; }
byCoordinates = Point.ByCoordinates(x=code_block.out0, y=code_block.out1, z=code_block.out2)
code_block_2 = CodeBlock { 5000; 5000; 0; }
byCoordinates_2 = Point.ByCoordinates(x=code_block_2.out0, y=code_block_2.out1, z=code_block_2.out2)
byCorners = Cuboid.ByCorners(lowPoint=byCoordinates, highPoint=byCoordinates_2)
code_block_3 = CodeBlock { 0; 100; 0; }
byARGB = Color.ByARGB(red=code_block_3.out0, green=code_block_3.out1, blue=code_block_3.out2)
byGeometryColor = Modifiers.GeometryColor.ByGeometryColor(geometry=byCorners, color=byARGB)

number_of_timber_arches = IntegerSlider(5, range=3..8 step 1)
timber_arch_complexity = IntegerSlider(10, range=1..10 step 1)
timber_arch_spacing = IntegerSlider(840, range=500..1000 step 10)
max_height = IntegerSlider(2250, range=1000..5000 step 10)
instance_setup_pavilion_arch = Python(IN[0]=number_of_timber_arches, IN[1]=timber_arch_complexity, IN[2]=timber_arch_spacing, IN[3]=max_height)  # "Instance Setup: Pavilion Arch Points"; CPython3
# ---------- instance_setup_pavilion_arch.python (47 lines) ----------
import math
import random
from Autodesk.DesignScript.Geometry import Point

# Inputs from sliders
num_ribs       = IN[0]   # Number of Rings
complexity     = IN[1]   # Arch Complexity (randomness)
ring_spacing   = IN[2]   # Ring Spacing
max_height     = IN[3]   # Max Height

pavilion_center_x = 0
pavilion_center_y = 0
pavilion_width    = 8000.0   # fixed standard arch width

random.seed(int(complexity * 1000))

rings = []
num_pts_per_arch = 10

for rib_idx in range(num_ribs):
    rib_points = []
    x = pavilion_center_x - (num_ribs - 1) * ring_spacing / 2.0 + rib_idx * ring_spacing
    
    for pt_idx in range(num_pts_per_arch):
        t = pt_idx / float(num_pts_per_arch - 1)
        
        base_y = pavilion_center_y - pavilion_width / 2.0 + t * pavilion_width
        base_z = max_height * 4.0 * t * (1.0 - t)
        
        if pt_idx == 0 or pt_idx == num_pts_per_arch - 1:
            y = base_y
            z = 0.0
        else:
            y_jitter_amp = (complexity / 10.0) * ring_spacing * 0.2
            z_jitter_amp = (complexity / 10.0) * max_height  * 0.2
            
            y_jitter = y_jitter_amp * (random.random() - 0.5)
            z_jitter = z_jitter_amp * (random.random() - 0.5)
            
            y = base_y + y_jitter
            z = max(base_z + z_jitter, 0.0)
        
        rib_points.append(Point.ByCoordinates(x, y, z))
    
    rings.append(rib_points)

OUT = rings
# ----------------------------------------
class_timber_arches_series_of = Python(IN[0]=instance_setup_pavilion_arch)  # "Class: Timber Arches - Series of Instances"; CPython3
# ---------- class_timber_arches_series_of.python (38 lines) ----------
import clr
clr.AddReference('ProtoGeometry')
from Autodesk.DesignScript.Geometry import *

# IN[0] = rings_of_points from first Python node (list of lists of Points)
rings_of_points = IN[0]

# Fixed cross-section (mm) for each arch
width  = 200.0   # mm
height = 200.0   # mm
area   = width * height   # mm^2

curves  = []
lengths = []
volumes = []

if rings_of_points:
    for ring_pts in rings_of_points:
        if not ring_pts or len(ring_pts) < 2:
            continue
        
        # Make a NurbsCurve (arch) from the points
        crv = NurbsCurve.ByPoints(ring_pts)
        if crv is None:
            continue
        
        try:
            L = crv.Length
        except:
            L = 0.0
        
        curves.append(crv)
        lengths.append(L)
        volumes.append(L * area)

total_volume = sum(volumes) if volumes else 0.0

OUT = curves, total_volume
# ----------------------------------------
number = DoubleInput(1)
getItemAtIndex = List.GetItemAtIndex(list=class_timber_arches_series_of, index=number)
timber_volume_mm³ = Watch(getItemAtIndex)  # graph output
steel_panel_thickness = IntegerSlider(44, range=10..100 step 1)
class_steel_panel_series_of = Python(IN[0]=instance_setup_pavilion_arch, IN[1]=steel_panel_thickness)  # "Class: Steel Panel - Series of Instances"; CPython3
# ---------- class_steel_panel_series_of.python (67 lines) ----------
import clr
clr.AddReference('ProtoGeometry')
from Autodesk.DesignScript.Geometry import *

# IN[0] = rings_of_points: list of lists of Points (from first Python node)
# IN[1] = steel_thickness slider (mm)
rings_of_points = IN[0]
steel_thickness = IN[1]

panels = []
panel_volumes = []

# 1. Convert point lists to curves
curves = []
if rings_of_points:
    for ring_pts in rings_of_points:
        if ring_pts and len(ring_pts) >= 2:
            crv = NurbsCurve.ByPoints(ring_pts)
            if crv and crv.Length > 0:
                curves.append(crv)

# 2. Build panels between neighboring curves
if curves and len(curves) >= 2:
    num_div = 8  # number of segments along each arch

    # divide each curve into points
    divided = []
    for crv in curves:
        pts = []
        for i in range(num_div + 1):
            t = float(i) / num_div
            pts.append(crv.PointAtParameter(t))
        divided.append(pts)

    # create panels between neighboring ribs
    for i in range(len(divided) - 1):
        ribA = divided[i]
        ribB = divided[i + 1]

        for j in range(num_div):
            p1 = ribA[j]
            p2 = ribA[j + 1]
            p3 = ribB[j + 1]
            p4 = ribB[j]

            try:
                poly = PolyCurve.ByPoints([p1, p2, p3, p4, p1])
                surf = Surface.ByPatch(poly)
            except:
                surf = None

            if surf:
                try:
                    panel = surf.Thicken(steel_thickness, False)
                except:
                    panel = None

                if panel:
                    panels.append(panel)
                    try:
                        panel_volumes.append(panel.Volume)
                    except:
                        panel_volumes.append(0.0)

total_steel_volume = sum(panel_volumes) if panel_volumes else 0.0

OUT = [panels, total_steel_volume]
# ----------------------------------------
number_2 = DoubleInput(1)
getItemAtIndex_2 = List.GetItemAtIndex(list=class_steel_panel_series_of, index=number_2)
steel_volume_mm³ = Watch(getItemAtIndex_2)
