# Dynamo graph 1862235.dyn (Dynamo 3.6.0.9395)

# group: Don't touch this ground
code_block = CodeBlock { -5000; -5000; -200; }
byCoordinates = Point.ByCoordinates(x=code_block.out0, y=code_block.out1, z=code_block.out2)
code_block_2 = CodeBlock { 5000; 5000; 0; }
byCoordinates_2 = Point.ByCoordinates(x=code_block_2.out0, y=code_block_2.out1, z=code_block_2.out2)
byCorners = Cuboid.ByCorners(lowPoint=byCoordinates, highPoint=byCoordinates_2)
code_block_3 = CodeBlock { 0; 100; 0; }
byARGB = Color.ByARGB(red=code_block_3.out0, green=code_block_3.out1, blue=code_block_3.out2)
byGeometryColor = Modifiers.GeometryColor.ByGeometryColor(geometry=byCorners, color=byARGB)

code_block_4 = CodeBlock { -5000; -5000; 0; }
P1 = Point.ByCoordinates(x=code_block_4.out0, y=code_block_4.out1, z=code_block_4.out2)
code_block_5 = CodeBlock { 5000; -5000; 0; }
P2 = Point.ByCoordinates(x=code_block_5.out0, y=code_block_5.out1, z=code_block_5.out2)
code_block_6 = CodeBlock { 5000; 5000; 0; }
P3 = Point.ByCoordinates(x=code_block_6.out0, y=code_block_6.out1, z=code_block_6.out2)
code_block_7 = CodeBlock { -5000; 5000; 0; }
P4 = Point.ByCoordinates(x=code_block_7.out0, y=code_block_7.out1, z=code_block_7.out2)
list_create = List.Create(item0=P1, item1=P2, item2=P3, item3=P4, item4=P1)
byPoints = PolyCurve.ByPoints(points=list_create)
byPatch = Surface.ByPatch(closedCurve=byPoints)
byStartPointEndPoint = Line.ByStartPointEndPoint(startPoint=P1, endPoint=P2)
ribCount = DoubleSlider(15, range=5..30 step 1)
code_block_8 = CodeBlock(RibCount=ribCount) { 0; 1; 1/(RibCount-1); }
range = Range(start=code_block_8.out0, end=code_block_8.out1, step=code_block_8.out2)
pointAtParameter = Curve.PointAtParameter(curve=byStartPointEndPoint, param=range)
ribThickness = DoubleSlider(150, range=50..300 step 10)
code_block_9 = CodeBlock(RibThickness=ribThickness) { RibThickness/2; }
byCenterPointRadius = Circle.ByCenterPointRadius(centerPoint=pointAtParameter, radius=code_block_9)
xb = Point.X(point=pointAtParameter)
byStartPointEndPoint_2 = Line.ByStartPointEndPoint(startPoint=P4, endPoint=P3)
pointAtParameter_2 = Curve.PointAtParameter(curve=byStartPointEndPoint_2, param=range)
xt = Point.X(point=pointAtParameter_2)
code_block_10 = CodeBlock(Xb=xb, Xt=xt) { (Xb+Xt)/2; }
yb = Point.Y(point=pointAtParameter)
yt = Point.Y(point=pointAtParameter_2)
code_block_11 = CodeBlock(Yb=yb, Yt=yt) { (Yb+Yt/2); }
waveAmplitude = DoubleSlider(1000, range=0..2000 step 100)
pavilionHeight = DoubleSlider(3000, range=1500..5000 step 100)
code_block_12 = CodeBlock(WaveAmplitude=waveAmplitude, t=range, PavilionHeight=pavilionHeight) { WaveAmplitude * Math.Sin(Math.PI * t) + PavilionHeight; }
byCoordinates_3 = Point.ByCoordinates(x=code_block_10, y=code_block_11, z=code_block_12)
list_create_2 = List.Create(item0=pointAtParameter, item1=byCoordinates_3, item2=pointAtParameter_2)
transpose = List.Transpose(lists=list_create_2)
byPoints_2 = NurbsCurve.ByPoints(points=transpose)
bySweep = Solid.BySweep(profile=byCenterPointRadius, path=byPoints_2)
list_create_3 = List.Create(item0=P1, item1=P2, item2=P3, item3=P4)
columnRadius = DoubleSlider(125, range=75..300 step 10)
byCenterPointRadius_2 = Circle.ByCenterPointRadius(centerPoint=list_create_3, radius=columnRadius)
X = Point.X(point=list_create_3)
Y = Point.Y(point=list_create_3)
columnHeight = DoubleSlider(2500, range=2000..4000 step 100)
byCoordinates_4 = Point.ByCoordinates(x=X, y=Y, z=columnHeight)
byStartPointEndPoint_3 = Line.ByStartPointEndPoint(startPoint=list_create_3, endPoint=byCoordinates_4)
bySweep_2 = Solid.BySweep(profile=byCenterPointRadius_2, path=byStartPointEndPoint_3)
length = Curve.Length(curve=byPoints_2)
python_script = Python(IN[0]=length, IN[1]=ribThickness)  # CPython3
# ---------- python_script.python (30 lines) ----------
import math

# IN[0] : list of rib lengths
# IN[1] : rib thickness (square cross-section, mm)

class TimberBeam(object):
    def __init__(self, length, thickness):
        self.length = length        # mm
        self.thickness = thickness  # mm

    def volume(self):
        # volume in cubic millimeters
        return self.length * self.thickness * self.thickness

rib_lengths = IN[0]
t = IN[1]

beams = []
volumes = []

for L in rib_lengths:
    b = TimberBeam(L, t)
    beams.append(b)
    volumes.append(b.volume())

total_volume = sum(volumes)

# OUT[0] : list of volumes per rib
# OUT[1] : total timber volume
OUT = (volumes, total_volume)
# ----------------------------------------
timber_rib_volumes_mm_3 = Watch(python_script)
total_timber_volume_mm_3 = Watch(python_script)
byStartPointEndPoint_4 = Line.ByStartPointEndPoint()  # unwired: startPoint, endPoint
length_2 = Curve.Length(curve=byStartPointEndPoint_3)
python_script_2 = Python(IN[0]=length_2, IN[1]=columnRadius)  # CPython3
# ---------- python_script_2.python (30 lines) ----------
import math

# IN[0]: list of column heights (mm)
# IN[1]: column radius (mm)

class SteelColumn(object):
    def __init__(self, height, radius):
        self.height = height
        self.radius = radius

    def volume(self):
        area = math.pi * self.radius ** 2
        return area * self.height   # mm^3

heights = IN[0]
r = IN[1]

columns = []
volumes = []

for h in heights:
    c = SteelColumn(h, r)
    columns.append(c)
    volumes.append(c.volume())

total_volume = sum(volumes)

# OUT[0]: list of volumes per column (mm^3)
# OUT[1]: total steel volume (mm^3)
OUT = (volumes, total_volume)
# ----------------------------------------
steel_column_volumes_mm_3 = Watch(python_script_2)
total_steel_volume_mm_3 = Watch(python_script_2)
