# Dynamo graph 1862543.dyn (Dynamo 3.6.0.9395)

# group: Don't touch this ground
code_block = CodeBlock { -5000; -5000; -200; }
byCoordinates = Point.ByCoordinates(x=code_block.out0, y=code_block.out1, z=code_block.out2)
code_block_2 = CodeBlock { 5000; 5000; 0; }
byCoordinates_2 = Point.ByCoordinates(x=code_block_2.out0, y=code_block_2.out1, z=code_block_2.out2)
byCorners = Cuboid.ByCorners(lowPoint=byCoordinates, highPoint=byCoordinates_2)
code_block_3 = CodeBlock { 0; 100; 0; }
byARGB = Color.ByARGB(red=code_block_3.out0, green=code_block_3.out1, blue=code_block_3.out2)
byGeometryColor = Modifiers.GeometryColor.ByGeometryColor(geometry=byCorners, color=byARGB)

C1 = CodeBlock { -4000; 0; 0; }
P_Left = Point.ByCoordinates(x=C1.out0, y=C1.out1, z=C1.out2)
ribheight = DoubleSlider(500, range=500..3000 step 100)
code_block_4 = CodeBlock(Ribheight=ribheight) { 0; 0; Ribheight; }
P_top = Point.ByCoordinates(x=code_block_4.out0, y=code_block_4.out1, z=code_block_4.Ribheight)
code_block_5 = CodeBlock { 4000; 0; 0; }
P_right = Point.ByCoordinates(x=code_block_5.out0, y=code_block_5.out1, z=code_block_5.out2)
list_create = List.Create(item0=P_Left, item1=P_top, item2=P_right)
ribcurve = NurbsCurve.ByPoints(points=list_create)
yaxis = CodeBlock { Vector.YAxis(); }
base = DoubleInput(-2000)
ribcount = DoubleSlider(17, range=5..30 step 1)
ribspacing = DoubleSlider(200, range=200..1000 step 50)
sequence = Sequence(start=base, amount=ribcount, step=ribspacing)
y_translate_rib = Geometry.Translate(geometry=ribcurve, direction=yaxis, distance=sequence)
code_block_6 = CodeBlock { Vector.ZAxis(); }
code_block_7 = CodeBlock { t1 = 0; }
code_block_8 = CodeBlock(x=sequence, WaveAmplitude=code_block_7) { Math.Sin(x/500) * WaveAmplitude; }
wave_translate = Geometry.Translate(geometry=y_translate_rib, direction=code_block_6, distance=code_block_8)
translate = Geometry.Translate(geometry=wave_translate, direction=code_block_6, distance=ribheight)
ribstart_point = Curve.StartPoint(curve=translate)
watch = Watch(ribstart_point)
material1_rib_Solids = Watch(translate)
ribwidth = DoubleSlider(50, range=50..300 step 1)
material1_rib_Volume = Watch(ribwidth)
ribthickness = DoubleSlider(20, range=20..200 step 1)
material1_ribs_with_instances = Python(IN[0]=material1_rib_Solids, IN[1]=material1_rib_Volume, IN[2]=ribthickness)  # CPython3
# ---------- material1_ribs_with_instances.python (43 lines) ----------
import clr
clr.AddReference('ProtoGeometry')
from Autodesk.DesignScript.Geometry import *

class RibMaterial:
    def __init__(self, curve, width, thickness):
        self.curve = curve
        self.width = width
        self.thickness = thickness

    def make_solid(self):
        start = self.curve.StartPoint

        # rectangle profile at start point
        profile = Rectangle.ByWidthLength(self.width, self.thickness)
        profile = profile.Translate(start.X, start.Y, start.Z)

        # sweep profile along curve
        solid = Solid.BySweep(profile, self.curve, False)

        return solid

    def volume(self):
        s = self.make_solid()
        return s, s.Volume

curves = IN[0]
width = IN[1]
thickness = IN[2]

if not isinstance(curves, list):
    curves = [curves]

solids = []
volumes = []

for c in curves:
    rib = RibMaterial(c, width, thickness)
    s, v = rib.volume()
    solids.append(s)
    volumes.append(v)

OUT = (solids, sum(volumes))
# ----------------------------------------
ribend_point = Curve.EndPoint(curve=translate)
list_create_2 = List.Create(item0=ribstart_point, item1=ribend_point)
flatten = List.Flatten(list=list_create_2)
material2_pillar_Solids = Watch(flatten)
pillar_radius = DoubleSlider(65, range=50..300 step 1)
material2_pillar_Volume = Watch(pillar_radius)
material2_pillars_with_instances = Python(IN[0]=material2_pillar_Solids, IN[1]=material2_pillar_Volume)  # CPython3
# ---------- material2_pillars_with_instances.python (50 lines) ----------
import clr
clr.AddReference('ProtoGeometry')
from Autodesk.DesignScript.Geometry import *
class PillarMaterial:
    def __init__(self, top_point, radius):
        self.top = top_point
        self.radius = radius

    def make_solid(self):
       
        base_z = 0.0

        
        base = Point.ByCoordinates(self.top.X, self.top.Y, base_z)

        
        top = self.top

        if abs(top.Z - base_z) < 1e-6:
            top = Point.ByCoordinates(self.top.X, self.top.Y, base_z + 10.0)

        cyl = Cylinder.ByPointsRadius(base, top, self.radius)
        return cyl

    def volume(self):
        solid = self.make_solid()
        return solid, solid.Volume


points = IN[0]
radius = IN[1]

if not isinstance(points, list):
    points = [points]

pillars = []
volumes = []

for pt in points:
    if pt is None:
        continue

    p = PillarMaterial(pt, radius)
    solid, vol = p.volume()
    pillars.append(solid)
    volumes.append(vol)

total_volume = sum(volumes) if volumes else 0

OUT = (pillars, total_volume)
# ----------------------------------------
