# Dynamo graph 1862694.dyn (Dynamo 3.6.0.9395)

# group: Don't touch this ground
code_block = CodeBlock { -5000; -5000; -200; }
byCoordinates = Point.ByCoordinates(x=code_block.out0, y=code_block.out1, z=code_block.out2)
code_block_2 = CodeBlock { 5000; 5000; 0; }
byCoordinates_2 = Point.ByCoordinates(x=code_block_2.out0, y=code_block_2.out1, z=code_block_2.out2)
byCorners = Cuboid.ByCorners(lowPoint=byCoordinates, highPoint=byCoordinates_2)
code_block_3 = CodeBlock { 0; 100; 0; }
byARGB = Color.ByARGB(red=code_block_3.out0, green=code_block_3.out1, blue=code_block_3.out2)
byGeometryColor = Modifiers.GeometryColor.ByGeometryColor(geometry=byCorners, color=byARGB)

numColumns = DoubleSlider(5, range=3..10 step 1)
code_block_4 = CodeBlock(numColumns=numColumns) { -4800..4800..9600/(numColumns-1); }
code_block_5 = CodeBlock(numColumns=numColumns) { -4800..4800..9600/(numColumns-1); }
code_block_6 = CodeBlock { 0; }
byCoordinates_3 = Point.ByCoordinates(x=code_block_4, y=code_block_5, z=code_block_6, lacing=CrossProduct)
flatten = List.Flatten(list=byCoordinates_3)
columnHeight = DoubleSlider(3000, range=2000..4000 step 100)
columnradius = DoubleSlider(200, range=100..300 step 10)
class_timber_column = Python(IN[0]=flatten, IN[1]=columnHeight, IN[2]=columnradius)  # CPython3
# ---------- class_timber_column.python (24 lines) ----------
import clr
clr.AddReference('ProtoGeometry')
from Autodesk.DesignScript.Geometry import *
import math

#Define Timber Column class
class TimberColumn:
    def __init__(self, basePoint, height, radius):
        self.basePoint = basePoint
        self.height = height
        self.radius = radius
    
    #Create the cylinder geometry
    def create_geometry(self):
        end_point = self.basePoint.Add(Vector.ByCoordinates(0, 0, self.height))
        column = Cylinder.ByPointsRadius(self.basePoint, end_point, self.radius)
        return column
    
    #Calculate the cylinder volume
    def calculate_volume(self):
        volume = math.pi * (self.radius ** 2) * self.height
        return volume

OUT = TimberColumn
# ----------------------------------------
instances_timber_columns = Python(IN[0]=class_timber_column, IN[1]=flatten, IN[2]=columnHeight, IN[3]=columnradius)  # CPython3
# ---------- instances_timber_columns.python (32 lines) ----------
import clr
clr.AddReference('ProtoGeometry')
from Autodesk.DesignScript.Geometry import *

#points = points where the columns will be created
#height = column height
#radius = column radius
ColumnClass = IN[0]
points = IN[1]
height = IN[2]
radius = IN[3]

if not isinstance(points, list):
    points = [points]

geometries = []
volumes = []


#Create a column
for point in points:
    column_instance = ColumnClass(point, height, radius)
    
    #Create Geometry
    geom = column_instance.create_geometry()
    geometries.append(geom)
    
    #Calculate Volume
    vol = column_instance.calculate_volume()
    volumes.append(vol)

OUT = [geometries, sum(volumes)]
# ----------------------------------------
code_block_7 = CodeBlock { 1; }
getItemAtIndex = List.GetItemAtIndex(list=instances_timber_columns, index=code_block_7)
timber_column_volume_mm_3 = Watch(getItemAtIndex)
watch = Watch(byCoordinates_3)
x = CodeBlock { -5000..5000..50; }
y = CodeBlock { -5000..5000..50; }
waveHeight = DoubleSlider(750, range=500..2000 step 100)
instances_steel_wavy_roof = Python(IN[0]=x, IN[1]=y, IN[2]=waveHeight)  # CPython3
# ---------- instances_steel_wavy_roof.python (39 lines) ----------
import clr
clr.AddReference('ProtoGeometry')
from Autodesk.DesignScript.Geometry import *
import math

#Inputs
x_range = IN[0]
y_range = IN[1]
wave_height = IN[2]

base_height = 3000  #Column height(minimums touch column tops)

#Column positions: -4900 to 4900
pillar_start = -4900
pillar_end = 4900
pillar_span = pillar_end - pillar_start  

#Number of columns
num_columns = 5
wave_cycles = num_columns - 1  #4 waves for 5 pillars

points = []

for y in y_range:
    row = []
    for x in x_range:
        
        #x from -4900..4900 to 0..1
        xN = (x - pillar_start) / pillar_span
        
        #Create wave:(minimum at column positions)
        z_offset = wave_height * (1 - math.cos(xN * wave_cycles * 2 * math.pi)) / 2
        z = base_height + z_offset
        
        point = Point.ByCoordinates(x, y, z)
        row.append(point)
    points.append(row)

OUT = points
# ----------------------------------------
byPoints = NurbsSurface.ByPoints(points=instances_steel_wavy_roof)
code_block_8 = CodeBlock { 200; }
thicken = Surface.Thicken(surface=byPoints, thickness=code_block_8)
class_steel_wavy_roof = Python(IN[0]=thicken)  # CPython3
# ---------- class_steel_wavy_roof.python (23 lines) ----------
import clr
clr.AddReference('ProtoGeometry')
from Autodesk.DesignScript.Geometry import *

class WavyRoofPanel:
    def __init__(self, geometry):
        self.geometry = geometry
        self.material = "Translucent Polycarbonate"
        
    #Calculate volume in mm³
    def get_volume(self):
        if self.geometry:
            return self.geometry.Volume
        return 0
    
    def get_geometry(self):
        return self.geometry

#Class definition
roof_geom = IN[0]
roof_panel = WavyRoofPanel(roof_geom)

OUT = roof_panel
# ----------------------------------------
output_volume_steel_wavy_roof = Python(IN[0]=class_steel_wavy_roof)  # CPython3
# ---------- output_volume_steel_wavy_roof.python (4 lines) ----------
#Output Volume of Wavy Roof
roof_instance = IN[0]
volume_mm3 = roof_instance.get_volume()
OUT = volume_mm3
# ----------------------------------------
steel_wavy_roof_volume_mm_3 = Watch(output_volume_steel_wavy_roof)
