# Dynamo graph 1862887.dyn (Dynamo 3.6.0.9395)

# group: Pavlilion Parameters
height = DoubleSlider(3500, range=2000..5000 step 100)
radius = DoubleSlider(4500, range=2000..4500 step 100)
innerFactor = DoubleSlider(1.5, range=0.2..1.5 step 0.05)
ribCount = IntegerSlider(10, range=6..32 step 1)

# group: Top Ring
number = DoubleInput(0)
byCoordinates = Point.ByCoordinates(x=number, y=number, z=height)
innerRadius = radius * innerFactor
byCenterPointRadius = Circle.ByCenterPointRadius(centerPoint=byCoordinates, radius=innerRadius)
code_block = CodeBlock(RibCount=ribCount) { 0..1..#RibCount; }
pointAtParameter = Curve.PointAtParameter(curve=byCenterPointRadius, param=code_block)
number_2 = DoubleInput(0)

# group: TopCurve
number_3 = DoubleInput(3)
byPoints = NurbsCurve.ByPoints(points=pointAtParameter, degree=number_3)

# group: Roof
number_4 = DoubleInput(0)
byCoordinates_2 = Point.ByCoordinates(x=number_4, y=number_4, z=height)
byPatch = Surface.ByPatch(closedCurve=byCenterPointRadius)
roofThickness = DoubleSlider(100, range=50..300 step 0.1)
roofSurface = Surface.Thicken(surface=byPatch, thickness=roofThickness)
number_5 = DoubleInput(255)
number_6 = DoubleInput(190)
number_7 = DoubleInput(150)
number_8 = DoubleInput(100)
byARGB = Color.ByARGB(alpha=number_5, red=number_6, green=number_7, blue=number_8)
byGeometryColor = Modifiers.GeometryColor.ByGeometryColor(geometry=roofSurface, color=byARGB)
innerRadius_2 = radius * innerFactor
code_block_2 = CodeBlock(radius=innerRadius_2) { radius+500; }
overhang = Circle.ByCenterPointRadius(centerPoint=byCoordinates_2, radius=code_block_2)
number_9 = DoubleInput(0)
number_10 = DoubleInput(-250)
movesUp = Geometry.Translate(geometry=overhang, xTranslation=number_9, zTranslation=number_10)
list_create = List.Create(item0=movesUp, item1=byCenterPointRadius)
byLoft = Surface.ByLoft(crossSections=list_create)
thicken = Surface.Thicken(surface=byLoft, thickness=roofThickness)
byARGB_2 = Color.ByARGB(alpha=number_5, red=number_6, green=number_7, blue=number_8)
byGeometryColor_2 = Modifiers.GeometryColor.ByGeometryColor(geometry=thicken, color=byARGB_2)
byPatch_2 = Surface.ByPatch(closedCurve=list_create)
byARGB_3 = Color.ByARGB(alpha=number_5, red=number_6, green=number_7, blue=number_8)
byGeometryColor_3 = Modifiers.GeometryColor.ByGeometryColor(geometry=byPatch_2, color=byARGB_3)

# group: Solar Panel
panellRadiusFactor = DoubleSlider(0.5, range=0..1 step 0.1)
panelRadius = CodeBlock(Radius=radius, PanelRadiusFactor=panellRadiusFactor) { PanelRadius = Radius * PanelRadiusFactor; }
byCenterPointRadius_2 = Circle.ByCenterPointRadius(centerPoint=byCoordinates_2, radius=panelRadius)
byPatch_3 = Surface.ByPatch(closedCurve=byCenterPointRadius_2)
panelOffset = DoubleSlider(30, range=0..300 step 10)
translate = Geometry.Translate(geometry=byPatch_3, zTranslation=panelOffset)
XAxis = Vector.XAxis()
panelTiltDegrees = DoubleSlider(0, range=0..45 step 1)
rotate = Geometry.Rotate(geometry=translate, origin=byCoordinates_2, axis=XAxis, degrees=panelTiltDegrees)
thickness = DoubleSlider(75, range=20..150 step 5)
thicken_2 = Surface.Thicken(surface=rotate, thickness=thickness)
number_11 = DoubleInput(255)
number_12 = DoubleInput(20)
number_13 = DoubleInput(40)
number_14 = DoubleInput(90)
byARGB_4 = Color.ByARGB(alpha=number_11, red=number_12, green=number_13, blue=number_14)
byGeometryColor_4 = Modifiers.GeometryColor.ByGeometryColor(geometry=thicken_2, color=byARGB_4)

# group: Bottom Ring
number_15 = DoubleInput(0)
byCoordinates_3 = Point.ByCoordinates(x=number_15, y=number_15, z=number_15)
byCenterPointRadius_3 = Circle.ByCenterPointRadius(centerPoint=byCoordinates_3, radius=radius)
pointAtParameter_2 = Curve.PointAtParameter(curve=byCenterPointRadius_3, param=code_block)

# group: Braces
braceRadius = DoubleSlider(75, range=20..200 step 0.1)
byCenterPointRadius_4 = Circle.ByCenterPointRadius(centerPoint=pointAtParameter_2, radius=braceRadius)
number_16 = DoubleInput(1)
topPtsShifted = List.ShiftIndices(list=pointAtParameter, amount=number_16)
byStartPointEndPoint = Line.ByStartPointEndPoint(startPoint=pointAtParameter_2, endPoint=topPtsShifted)
bySweep = Solid.BySweep(profile=byCenterPointRadius_4, path=byStartPointEndPoint)

# group: Ribs
ribRadius = DoubleSlider(75, range=20..200 step 0.1)
byCenterPointRadius_5 = Circle.ByCenterPointRadius(centerPoint=pointAtParameter_2, radius=ribRadius)
number_17 = DoubleInput(0)
ribEmbed = DoubleSlider(-14.4, range=-500..100 step 0.1)
translate_2 = Geometry.Translate(geometry=pointAtParameter, xTranslation=number_17, yTranslation=number_17, zTranslation=ribEmbed)
byStartPointEndPoint_2 = Line.ByStartPointEndPoint(startPoint=pointAtParameter_2, endPoint=translate_2)
bySweep_2 = Solid.BySweep(profile=byCenterPointRadius_5, path=byStartPointEndPoint_2)

# group: Brace and Rib Colour
number_18 = DoubleInput(255)
number_19 = DoubleInput(180)
number_20 = DoubleInput(190)
byARGB_5 = Color.ByARGB(alpha=number_18, red=number_19, green=number_19, blue=number_20)
byGeometryColor_5 = Modifiers.GeometryColor.ByGeometryColor(geometry=bySweep, color=byARGB_5)
byARGB_6 = Color.ByARGB(alpha=number_18, red=number_19, green=number_19, blue=number_20)
byGeometryColor_6 = Modifiers.GeometryColor.ByGeometryColor(geometry=bySweep_2, color=byARGB_6)

# group: Footings
number_21 = DoubleInput(0)
footingHeight = DoubleSlider(100, range=0..500 step 0.1)
code_block_3 = CodeBlock(FootingHeight=footingHeight) { FootingHeight; }
footingBottomPoints = Geometry.Translate(geometry=pointAtParameter_2, xTranslation=number_21, yTranslation=number_21, zTranslation=code_block_3)
footingRadius = DoubleSlider(200, range=0..300 step 0.1)
byPointsRadius = Cylinder.ByPointsRadius(startPoint=footingBottomPoints, endPoint=pointAtParameter_2, radius=footingRadius)
number_22 = DoubleInput(255)
number_23 = DoubleInput(120)
byARGB_7 = Color.ByARGB(alpha=number_22, red=number_23, green=number_23, blue=number_23)
byGeometryColor_7 = Modifiers.GeometryColor.ByGeometryColor(geometry=byPointsRadius, color=byARGB_7)

# group: Don't touch this ground
code_block_4 = CodeBlock { -5000; -5000; -200; }
byCoordinates_4 = Point.ByCoordinates(x=code_block_4.out0, y=code_block_4.out1, z=code_block_4.out2)
code_block_5 = CodeBlock { 5000; 5000; 0; }
byCoordinates_5 = Point.ByCoordinates(x=code_block_5.out0, y=code_block_5.out1, z=code_block_5.out2)
byCorners = Cuboid.ByCorners(lowPoint=byCoordinates_4, highPoint=byCoordinates_5)
code_block_6 = CodeBlock { 0; 100; 0; }
byARGB_8 = Color.ByARGB(red=code_block_6.out0, green=code_block_6.out1, blue=code_block_6.out2)
byGeometryColor_8 = Modifiers.GeometryColor.ByGeometryColor(geometry=byCorners, color=byARGB_8)

# group: Puck Lights
lightDrop = DoubleInput(-325)
lightDrop_2 = Geometry.Translate(geometry=pointAtParameter, xTranslation=number_2, yTranslation=number_2, zTranslation=lightDrop)
lightRadius = DoubleInput(75)
lightBody = Cylinder.ByPointsRadius(startPoint=lightDrop_2, endPoint=pointAtParameter, radius=lightRadius)
number_24 = DoubleInput(255)
number_25 = DoubleInput(255)
number_26 = DoubleInput(140)
byARGB_9 = Color.ByARGB(alpha=number_24, red=number_24, green=number_25, blue=number_26)
byGeometryColor_9 = Modifiers.GeometryColor.ByGeometryColor(geometry=lightBody, color=byARGB_9)

# group: Planters
shiftPlanters = DoubleInput(1)
shiftIndices = List.ShiftIndices(list=pointAtParameter_2, amount=shiftPlanters)
betweenVectors = Vector.ByTwoPoints(start=pointAtParameter_2, end=shiftIndices)
number_27 = DoubleInput(0.5)
halfVectors = Vector.Scale(vector=betweenVectors, scale_factor=number_27)
planterBottoms = Point.Add(point=pointAtParameter_2, vectorToAdd=halfVectors)
number_28 = DoubleInput(0)
planterHeight = DoubleSlider(400, range=0..400 step 0.1)
planterTops = Geometry.Translate(geometry=planterBottoms, xTranslation=number_28, yTranslation=number_28, zTranslation=planterHeight)
planterRadius = DoubleSlider(300, range=0..900 step 0.1)
byPointsRadius_2 = Cylinder.ByPointsRadius(startPoint=planterBottoms, endPoint=planterTops, radius=planterRadius)
code_block_7 = CodeBlock {  }

# group: TreeTrunks
ZAxis = Vector.ZAxis()
trunkHeight = DoubleSlider(1000, range=100..3000 step 150)
scale = Vector.Scale(vector=ZAxis, scale_factor=trunkHeight)
trunkTopPoint = Point.Add(point=planterTops, vectorToAdd=scale)
trunkRadius = DoubleSlider(75, range=50..400 step 10)
byPointsRadius_3 = Cylinder.ByPointsRadius(startPoint=planterTops, endPoint=trunkTopPoint, radius=trunkRadius)
number_29 = DoubleInput(255)
number_30 = DoubleInput(80)
number_31 = DoubleInput(60)
number_32 = DoubleInput(40)
byARGB_10 = Color.ByARGB(alpha=number_29, red=number_30, green=number_31, blue=number_32)
byGeometryColor_10 = Modifiers.GeometryColor.ByGeometryColor(geometry=byPointsRadius_3, color=byARGB_10)

# group: Tree Foliage
ZAxis_2 = Vector.ZAxis()
canopyHeightOffset = DoubleInput(1000)
scale_2 = Vector.Scale(vector=ZAxis_2, scale_factor=canopyHeightOffset)
canopyCenterPoint = Point.Add(point=planterTops, vectorToAdd=scale_2)
canopyRadiusMax = DoubleInput(475)
canopy = Sphere.ByCenterPointRadius(centerPoint=canopyCenterPoint, radius=canopyRadiusMax)
number_33 = DoubleInput(255)
number_34 = DoubleInput(40)
number_35 = DoubleInput(120)
byARGB_11 = Color.ByARGB(alpha=number_33, red=number_34, green=number_35, blue=number_34)
byGeometryColor_11 = Modifiers.GeometryColor.ByGeometryColor(geometry=canopy, color=byARGB_11)

# group: VolumesOfMaterial
steelBraces_Python = Python(BraceBttm=pointAtParameter_2, BraceTop=topPtsShifted, BraceRadius=braceRadius)  # CPython3
# ---------- steelBraces_Python.python (41 lines) ----------
import clr
clr.AddReference("ProtoGeometry")
from Autodesk.DesignScript.Geometry import *

# Inputs
brace_starts = IN[0]   # list of start points (rib bottoms)
brace_ends   = IN[1]   # list of end points (rib tops)
brace_radius = IN[2]   # number (same radius you used for ribs)

# ------------------------
# Class: SteelBrace
# ------------------------
class SteelBrace(object):
    def __init__(self, p0, p1, radius):
        self.p0 = p0
        self.p1 = p1
        self.radius = radius

    def make_geometry(self):
        # Cylinder between two points
        return Cylinder.ByPointsRadius(self.p0, self.p1, self.radius)

    def volume(self):
        cyl = self.make_geometry()
        v = cyl.Volume
        cyl.Dispose()
        return v

# ------------------------
# Create instances & sum volumes
# ------------------------
volumes = []

for s, e in zip(brace_starts, brace_ends):
    brace = SteelBrace(s, e, brace_radius)
    volumes.append(brace.volume())

total_steel_volume = sum(volumes)

# Single output: total volume of all steel braces
OUT = total_steel_volume
# ----------------------------------------
material_1_steel_braces_volume = Watch(steelBraces_Python)  # "Material_1_Steel_Braces_Volume_mm^3"
number_36 = DoubleInput(1000000000)
div = material_1_steel_braces_volume / number_36
material_1_steel_braces_volume_m = Watch(div)  # "Material_1_Steel_Braces_Volume_m^3"
concrete_Footings_Python = Python(FootingBasePoints=footingBottomPoints, FootingHeight=footingHeight, FootingRadius=footingRadius)  # CPython3
# ---------- concrete_Footings_Python.python (42 lines) ----------
import clr
clr.AddReference("ProtoGeometry")
from Autodesk.DesignScript.Geometry import *

# Inputs
base_points   = IN[0]   # list of points on the ground
footing_height = IN[1]  # number
footing_radius = IN[2]  # number

# ------------------------
# Class: ConcreteFooting
# ------------------------
class ConcreteFooting(object):
    def __init__(self, base_pt, height, radius):
        self.base = base_pt
        self.height = height
        self.radius = radius

    def make_geometry(self):
        # Make a local coordinate system at the base point
        cs = CoordinateSystem.ByOrigin(self.base)
        return Cylinder.ByRadiusHeight(cs, self.radius, self.height)

    def volume(self):
        cyl = self.make_geometry()
        v = cyl.Volume
        cyl.Dispose()
        return v

# ------------------------
# Create instances & sum volumes
# ------------------------
volumes = []

for pt in base_points:
    footing = ConcreteFooting(pt, footing_height, footing_radius)
    volumes.append(footing.volume())

total_footer_volume = sum(volumes)

# Single output: total volume of all concrete footings
OUT = total_footer_volume
# ----------------------------------------
material_2_concrete_footings = Watch(concrete_Footings_Python)  # "Material_2_Concrete_Footings_Volume_mm^3"
div_2 = material_2_concrete_footings / number_36
material_2_concrete_footings_2 = Watch(div_2)  # "Material_2_Concrete_Footings_Volume_m^3"
