# Dynamo graph 1863371.dyn (Dynamo 3.6.0.9395)

# group: Don't touch this ground
code_block = CodeBlock { 0; 0; -200; }
byCoordinates = Point.ByCoordinates(x=code_block.out0, y=code_block.out1, z=code_block.out2)
code_block_2 = CodeBlock { 10000; 10000; 0; }
byCoordinates_2 = Point.ByCoordinates(x=code_block_2.out0, y=code_block_2.out1, z=code_block_2.out2)
byCorners = Cuboid.ByCorners(lowPoint=byCoordinates, highPoint=byCoordinates_2)
code_block_3 = CodeBlock { 0; 100; 0; }
byARGB = Color.ByARGB(red=code_block_3.out0, green=code_block_3.out1, blue=code_block_3.out2)
byGeometryColor = Modifiers.GeometryColor.ByGeometryColor(geometry=byCorners, color=byARGB)

# group: Twisted Column
code_block_4 = CodeBlock { 0; 0; 0; }
base_point = Point.ByCoordinates(x=code_block_4.out0, y=code_block_4.out1, z=code_block_4.out2)
code_block_5 = CodeBlock { 0; 0; 10000; }
top_point = Point.ByCoordinates(x=code_block_5.out0, y=code_block_5.out1, z=code_block_5.out2)
center_line_of_column = Line.ByStartPointEndPoint(startPoint=base_point, endPoint=top_point)
number_of_boxes = DoubleSlider(500, range=0..1000 step 0.5)
code_block_6 = CodeBlock(n=number_of_boxes) { n; 0..1..#n+1; }
code_block_7 = CodeBlock { 0; }
removeItemAtIndex = List.RemoveItemAtIndex(list=code_block_6.out1, indices=code_block_7)
pointAtParameter = Curve.PointAtParameter(curve=center_line_of_column, param=removeItemAtIndex)
distanceTo = Geometry.DistanceTo(geometry=base_point, other=top_point)
code_block_8 = CodeBlock(length_of_the_Cline=distanceTo, number_of_boxes=number_of_boxes)
# ---------- code_block_8.designscript (5 lines) ----------
length_of_the_Cline;
number_of_boxes;

Height_of_boxes = length_of_the_Cline/number_of_boxes;
half_down = -(Height_of_boxes/2);
# ----------------------------------------
translate = Geometry.Translate(geometry=pointAtParameter, zTranslation=code_block_8.half_down)
width_slider = DoubleSlider(500, range=0..5000 step 10)
length_slider = DoubleSlider(500, range=0..5000 step 10)
byLengths = Cuboid.ByLengths(origin=translate, width=width_slider, length=length_slider, height=code_block_8.Height_of_boxes)
ZAxis = Vector.ZAxis()
number_of_rotations = DoubleSlider(0.8, range=0..4 step 0.1)
code_block_9 = CodeBlock(number_of_boxes=number_of_boxes, number_of_rotations=number_of_rotations) { number_of_boxes; number_of_rotations; 0..number_of_rotations*360..#number_of_boxes; }
rotate = Geometry.Rotate(geometry=byLengths, origin=translate, axis=ZAxis, degrees=code_block_9.out2)

# group: Left Pavillion
start_point_of_pavillion_base = CodeBlock { -5000; -5000; 0; }
byCoordinates_3 = Point.ByCoordinates(x=start_point_of_pavillion_base.out0, y=start_point_of_pavillion_base.out1, z=start_point_of_pavillion_base.out2)
end_point_of_pavillion_base = CodeBlock { 5000; -5000; 0; }
byCoordinates_4 = Point.ByCoordinates(x=end_point_of_pavillion_base.out0, y=end_point_of_pavillion_base.out1, z=end_point_of_pavillion_base.out2)
line_of_base_of_1st_pavillion = Line.ByStartPointEndPoint(startPoint=byCoordinates_3, endPoint=byCoordinates_4)
code_block_10 = CodeBlock { 0; 50; 1/49; }
amount_of_columns_attached_to = Sequence(start=code_block_10.out0, amount=code_block_10.out1, step=code_block_10.out2)  # "Amount of columns attached to base"
base_points = Curve.PointAtParameter(curve=line_of_base_of_1st_pavillion, param=amount_of_columns_attached_to)
start_point_of_pavillion_top = CodeBlock { -5000; -5000; 5000; }
byCoordinates_5 = Point.ByCoordinates(x=start_point_of_pavillion_top.out0, y=start_point_of_pavillion_top.out1, z=start_point_of_pavillion_top.out2)
end_point_of_pavillion_top = CodeBlock { 5000; 5000; 10000; }
byCoordinates_6 = Point.ByCoordinates(x=end_point_of_pavillion_top.out0, y=end_point_of_pavillion_top.out1, z=end_point_of_pavillion_top.out2)
line_of_top_of_1st_pavillion = Line.ByStartPointEndPoint(startPoint=byCoordinates_5, endPoint=byCoordinates_6)
code_block_11 = CodeBlock { 0; 50; 1/49; }
amount_of_columns_attached_to_2 = Sequence(start=code_block_11.out0, amount=code_block_11.out1, step=code_block_11.out2)  # "Amount of columns attached to top"
top_points = Curve.PointAtParameter(curve=line_of_top_of_1st_pavillion, param=amount_of_columns_attached_to_2)
radius_size_step = CodeBlock { 50; 50; 0.25; }
change_in_radii = Sequence(start=radius_size_step.out0, amount=radius_size_step.out1, step=radius_size_step.out2)
circular_rod = Python()  # CPython3; unwired: IN[0]
# ---------- circular_rod.python (14 lines) ----------
import clr
clr.AddReference('ProtoGeometry')
from Autodesk.DesignScript.Geometry import *

class CircularRod:
    def __init__(self, bottom_point, top_point, radius):
        self.bottom = bottom_point
        self.top = top_point
        self.radius = radius

    def make_geometry(self):
        return Cylinder.ByPointsRadius(self.bottom, self.top, self.radius)

OUT = CircularRod
# ----------------------------------------
left_pavillion = Python(IN[0]=base_points, IN[1]=top_points, IN[2]=change_in_radii, IN[3]=circular_rod)  # CPython3
# ---------- left_pavillion.python (23 lines) ----------
# IN[0] = list of bottom points
# IN[1] = list of top points
# IN[2] = list of radii
# IN[3] = class CircularRod from Box #1

CircularRod = IN[3]
bottom_points = IN[0]
top_points = IN[1]
radii = IN[2]

rods = []
count = min(len(bottom_points), len(top_points))

for i in range(count):
  
    r = radii[i] if i < len(radii) else radii[-1]
    btm = bottom_points[i]
    top = top_points[i]
    
    rod = CircularRod(btm, top, r)
    rods.append(rod.make_geometry())

OUT = rods
# ----------------------------------------

width = DoubleSlider(10000, range=0..10000 step 1)
number_of_ribs = DoubleSlider(8, range=2..20 step 1)
width_ofribs = width / number_of_ribs
range = Range(end=width, step=width_ofribs)
code_block_12 = CodeBlock { 0; 0; }
base_point_2 = Point.ByCoordinates(x=range, y=code_block_12.out0, z=code_block_12.out1)
column_radius = DoubleSlider(142, range=0..150 step 1)
byCenterPointRadius = Circle.ByCenterPointRadius(centerPoint=base_point_2, radius=column_radius)
depth = DoubleSlider(5501, range=1..10000 step 1)
number = DoubleInput(2)
depth_2 = depth / number
height_of_curve_midpoint = IntegerSlider(3618, range=0..10000 step 1)
mid_point = Point.ByCoordinates(x=range, y=depth_2, z=height_of_curve_midpoint)
code_block_13 = CodeBlock { 0; 5000; 10000; }
byCoordinates_7 = Point.ByCoordinates(x=code_block_13.out0, y=code_block_13.out1, z=code_block_13.out2)
code_block_14 = CodeBlock { 10000; 10000; 0; }
byCoordinates_8 = Point.ByCoordinates(x=code_block_14.out0, y=code_block_14.out1, z=code_block_14.out2)
top_line = Line.ByStartPointEndPoint(startPoint=byCoordinates_7, endPoint=byCoordinates_8)
code_block_15 = CodeBlock(n=number_of_ribs) { 1/(n-1); }
sequence = Sequence(amount=number_of_ribs, step=code_block_15)
pointAtParameter_2 = Curve.PointAtParameter(curve=top_line, param=sequence)
arches = Arc.ByThreePoints(firstPoint=base_point_2, secondPoint=mid_point, thirdPoint=pointAtParameter_2)
bySweep = Solid.BySweep(profile=byCenterPointRadius, path=arches)
string = StringInput("Glulam")
timber_columns = Python(IN[0]=bySweep, IN[1]=string)  # CPython3
# ---------- timber_columns.python (34 lines) ----------
# Load the Python Standard and DesignScript Libraries
import sys
import clr
clr.AddReference('ProtoGeometry')
from Autodesk.DesignScript.Geometry import *

rib_solids = IN[0]
material_name = IN[1]

class TimberRib:
    def __init__(self, solid, material):
        self.solid = solid
        self.material = material
        
    def volume(self):
        try:
            return self.solid.Volume
        except:
            return None
        
ribs = []
volumes = []

if rib_solids is None:
    rib_solids = []
    
for s in rib_solids:
    rib = TimberRib(s, material_name)
    ribs.append(rib)
    volumes.append(rib.volume())
    
OUT = ribs, volumes

       
# ----------------------------------------
code_block_16 = CodeBlock { 1; }
getItemAtIndex = List.GetItemAtIndex(list=timber_columns, index=code_block_16)
sum = Math.Sum(values=getItemAtIndex)
number_2 = DoubleInput(0)
arches_minus_first_item = List.RemoveItemAtIndex(list=arches, indices=number_2)
count = List.Count(list=arches)
number_3 = DoubleInput(1)
removes_last_item = count - number_3
arches_minus_last_item = List.RemoveItemAtIndex(list=arches, indices=removes_last_item)
list_create = List.Create(item0=arches_minus_first_item, item1=arches_minus_last_item)
transpose = List.Transpose(lists=list_create)
byLoft = Surface.ByLoft(crossSections=transpose)
number_4 = DoubleInput(5)
thicken = Surface.Thicken(surface=byLoft, thickness=number_4)
string_2 = StringInput("Solar Curtain")
solar_curtain = Python(IN[0]=thicken, IN[1]=string_2)  # CPython3
# ---------- solar_curtain.python (32 lines) ----------
# Load the Python Standard and DesignScript Libraries
import sys
import clr
clr.AddReference('ProtoGeometry')
from Autodesk.DesignScript.Geometry import *

panel_solids = IN[0]       
material_name = IN[1]      

class SteelPanel:
    def __init__(self, solid, material):
        self.solid = solid
        self.material = material

    def volume(self):
        try:
            return self.solid.Volume
        except:
            return None

panels = []
volumes = []

if panel_solids is None:
    panel_solids = []

for s in panel_solids:
    panel = SteelPanel(s, material_name)
    panels.append(panel)
    volumes.append(panel.volume())

OUT = panels, volumes
# ----------------------------------------
code_block_17 = CodeBlock { 1; }
getItemAtIndex_2 = List.GetItemAtIndex(list=solar_curtain, index=code_block_17)
sum_2 = Math.Sum(values=getItemAtIndex_2)
code_block_18 = CodeBlock(TimberVol=sum, CurtainVol=sum_2) { "Total Timber Volume (mm^3)= " + TimberVol; "Total Curtain Volume (mm^3)= " + CurtainVol; }
watch = Watch(code_block_18.out0)
watch_2 = Watch(code_block_18.out1)
code_block_19 = CodeBlock { 255; 205; 170; 100; }
byARGB_2 = Color.ByARGB(alpha=code_block_19.out0, red=code_block_19.out1, green=code_block_19.out2, blue=code_block_19.out3)
byGeometryColor_2 = Modifiers.GeometryColor.ByGeometryColor(geometry=bySweep, color=byARGB_2)
code_block_20 = CodeBlock { 100; 70; 110; 160; }
byARGB_3 = Color.ByARGB(alpha=code_block_20.out0, red=code_block_20.out1, green=code_block_20.out2, blue=code_block_20.out3)
byGeometryColor_3 = Modifiers.GeometryColor.ByGeometryColor(geometry=thicken, color=byARGB_3)
watch_3 = Watch(sequence)
