# Dynamo graph 1863373.dyn (Dynamo 4.0.0.3277)

# group: Don't touch this ground
code_block = CodeBlock { -5000; -5000; -200; }  # frozen
byCoordinates = Point.ByCoordinates(x=code_block.out0, y=code_block.out1, z=code_block.out2)  # frozen
code_block_2 = CodeBlock { 5000; 5000; 0; }  # frozen
byCoordinates_2 = Point.ByCoordinates(x=code_block_2.out0, y=code_block_2.out1, z=code_block_2.out2)  # frozen
byCorners = Cuboid.ByCorners(lowPoint=byCoordinates, highPoint=byCoordinates_2)  # frozen
code_block_3 = CodeBlock { 0; 100; 0; }  # frozen
byARGB = Color.ByARGB(red=code_block_3.out0, green=code_block_3.out1, blue=code_block_3.out2)  # frozen
byGeometryColor = Modifiers.GeometryColor.ByGeometryColor(geometry=byCorners, color=byARGB)  # frozen

numRadial = IntegerSlider(20, range=4..72 step 1)
numRINGS = IntegerSlider(5, range=1..12 step 1)
beamD = DoubleSlider(40, range=5..200 step 0.1)
timberB = Python(IN[0]=numRadial, IN[1]=numRINGS, IN[2]=beamD)  # PythonNet3
# ---------- timberB.python (34 lines) ----------
# Load the Python Standard and DesignScript Libraries
import sys
import clr
clr.AddReference('ProtoGeometry')
from Autodesk.DesignScript.Geometry import *

# The inputs to this node will be stored as a list in the IN variables.
dataEnteringNode = IN

import math
# Dynamo imports are expected inside Dynamo's Python Script environment.
# This file contains the Python class text to paste into a Dynamo Python Script node.
class TimberBeam:
    def __init__(self, start_pt, end_pt, diameter_mm):
        self.start = start_pt
        self.end = end_pt
        self.d = float(diameter_mm)

    def length(self):
        return self.start.DistanceTo(self.end)

    def generate_geometry(self):
        from Autodesk.DesignScript.Geometry import Cylinder
        cyl = Cylinder.ByStartPointRadiusHeight(self.start, self.d/2.0, self.length())
        return cyl

    def compute_volume(self):
        r = self.d/2.0
        h = self.length()
        return math.pi * r * r * h  # mm^3

    def compute_area(self):
        r = self.d/2.0
        return math.pi * r * r  # mm^2
# ----------------------------------------
archH = DoubleSlider(1473.6, range=0..5000 step 0.1)
panelT = DoubleSlider(3.4, range=0.1..10 step 0.1)
steel_p = Python(IN[0]=archH, IN[1]=panelT)  # PythonNet3
# ---------- steel_p.python (30 lines) ----------
# Load the Python Standard and DesignScript Libraries
import sys
import clr
clr.AddReference('ProtoGeometry')
from Autodesk.DesignScript.Geometry import *

# The inputs to this node will be stored as a list in the IN variables.
dataEnteringNode = IN

class SteelPanel:
    def __init__(self, corner_points):
        self.corners = corner_points

    def generate_geometry(self):
        from Autodesk.DesignScript.Geometry import Polygon, Surface
        try:
            poly = Polygon.ByPoints(self.corners)
            surf = Surface.ByPatch(poly)
            return surf
        except:
            return None

    def compute_area(self):
        geom = self.generate_geometry()
        if geom is None:
            return 0.0
        return geom.Area

    def compute_volume(self, thickness_mm):
        return self.compute_area() * float(thickness_mm)
# ----------------------------------------
insTimber = Python(IN[0]=numRadial, IN[1]=numRINGS, IN[2]=beamD, IN[3]=archH)  # PythonNet3
# ---------- insTimber.python (83 lines) ----------
# Load the Python Standard and DesignScript Libraries
import sys
import clr
clr.AddReference('ProtoGeometry')
from Autodesk.DesignScript.Geometry import *
import math
# The inputs to this node will be stored as a list in the IN variables.
class TimberBeam:
    def __init__(self, start_pt, end_pt, diameter_mm):
        self.start = start_pt
        self.end = end_pt
        self.d = float(diameter_mm)
    
    def length(self):
        return self.start.DistanceTo(self.end)
    
    def generate_geometry(self):
        # Correct Dynamo method → Cylinder.ByPointsRadius
        r = self.d / 2.0
        cyl = Cylinder.ByPointsRadius(self.start, self.end, r)
        return cyl
    
    def compute_volume(self):
        r = self.d / 2.0
        h = self.length()
        return math.pi * r * r * h
    
    def compute_area(self):
        r = self.d / 2.0
        return math.pi * r * r

# -------------------------------------------------------------------
# Inputs
# -------------------------------------------------------------------
num_radial = int(IN[0])
num_rings  = int(IN[1])
beam_d     = float(IN[2])
arch_h     = float(IN[3])

# Pavilion max radius within 10m x 10m footprint
R = 5000.0   # 5 m

beams = []
volumes = []

# -------------------------------------------------------------------
# Generate radial–ring pavilion nodes + beams
# -------------------------------------------------------------------
for ring_i in range(num_rings):
    t = (ring_i + 1) / float(num_rings)
    radius = R * t

    for r_idx in range(num_radial):
        theta = 2.0 * math.pi * r_idx / float(num_radial)

        x = radius * math.cos(theta)
        y = radius * math.sin(theta)
        z = arch_h * (1.0 - (radius / R)**2)

        pt = Point.ByCoordinates(x, y, z)

        # Create timber beam to previous ring
        if ring_i > 0:
            prev_radius = R * (ring_i / float(num_rings))

            x0 = prev_radius * math.cos(theta)
            y0 = prev_radius * math.sin(theta)
            z0 = arch_h * (1.0 - (prev_radius / R)**2)

            pt0 = Point.ByCoordinates(x0, y0, z0)

            beam = TimberBeam(pt0, pt, beam_d)
            geom = beam.generate_geometry()

            beams.append(geom)
            volumes.append(beam.compute_volume())

# -------------------------------------------------------------------
# Final outputs
# -------------------------------------------------------------------
total_volume = sum(volumes)

OUT = (beams, total_volume)
# ----------------------------------------
number = DoubleInput(1)
getItemAtIndex = List.GetItemAtIndex(list=insTimber, index=number)
total_timber = Watch(getItemAtIndex)
watch_3d = Watch3D(insTimber)
insPanel = Python(IN[0]=numRadial, IN[1]=numRINGS, IN[2]=panelT, IN[3]=archH)  # PythonNet3
# ---------- insPanel.python (70 lines) ----------
# Load the Python Standard and DesignScript Libraries
import sys
import clr
clr.AddReference('ProtoGeometry')
from Autodesk.DesignScript.Geometry import *

# The inputs to this node will be stored as a list in the IN variables.
dataEnteringNode = IN

import math
import clr
clr.AddReference('ProtoGeometry')
from Autodesk.DesignScript.Geometry import Point
class SteelPanel:
    def __init__(self, corner_points):
        self.corners = corner_points
    def generate_geometry(self):
        from Autodesk.DesignScript.Geometry import Polygon, Surface
        try:
            poly = Polygon.ByPoints(self.corners)
            surf = Surface.ByPatch(poly)
            return surf
        except:
            return None
    def compute_area(self):
        geom = self.generate_geometry()
        if geom is None:
            return 0.0
        return geom.Area
    def compute_volume(self, thickness_mm):
        return self.compute_area() * float(thickness_mm)

num_radial = int(IN[0])
num_rings = int(IN[1])
thick = float(IN[2])
arch_h = float(IN[3])

R = 5000.0
panels = []
volumes = []
areas = []

for ring_i in range(num_rings - 1):
    t_inner = (ring_i + 1) / float(num_rings)
    t_outer = (ring_i + 2) / float(num_rings)
    r_inner = R * t_inner
    r_outer = R * t_outer
    for r_idx in range(num_radial):
        theta = 2.0 * math.pi * r_idx / float(num_radial)
        theta_next = 2.0 * math.pi * ((r_idx + 1) % num_radial) / float(num_radial)
        xi = r_inner * math.cos(theta)
        yi = r_inner * math.sin(theta)
        zi = arch_h * (1.0 - (r_inner / R)**2)
        xo = r_outer * math.cos(theta)
        yo = r_outer * math.sin(theta)
        zo = arch_h * (1.0 - (r_outer / R)**2)
        xo2 = r_outer * math.cos(theta_next)
        yo2 = r_outer * math.sin(theta_next)
        zo2 = arch_h * (1.0 - (r_outer / R)**2)
        p1 = Point.ByCoordinates(xi, yi, zi)
        p2 = Point.ByCoordinates(xo, yo, zo)
        p3 = Point.ByCoordinates(xo2, yo2, zo2)
        panel = SteelPanel([p1, p2, p3])
        geom = panel.generate_geometry()
        if geom:
            panels.append(geom)
            areas.append(panel.compute_area())
            volumes.append(panel.compute_volume(thick))

OUT = (panels, sum(volumes), sum(areas))
# ----------------------------------------
watch_3d_2 = Watch3D(insPanel)
steelV = Watch(insPanel)
number_2 = DoubleInput(1)
getItemAtIndex_2 = List.GetItemAtIndex(list=steelV, index=number_2)
total_steel = Watch(getItemAtIndex_2)
