# Dynamo graph 1863710.dyn (Dynamo 4.0.0.3277)

# group: Don't touch this ground
code_block = CodeBlock { -5000; -5000; -200; }
byCoordinates = Point.ByCoordinates(x=code_block.out0, y=code_block.out1, z=code_block.out2)
code_block_2 = CodeBlock { 5000; 5000; 0; }
byCoordinates_2 = Point.ByCoordinates(x=code_block_2.out0, y=code_block_2.out1, z=code_block_2.out2)
byCorners = Cuboid.ByCorners(lowPoint=byCoordinates, highPoint=byCoordinates_2)
code_block_3 = CodeBlock { 0; 100; 0; }
byARGB = Color.ByARGB(red=code_block_3.out0, green=code_block_3.out1, blue=code_block_3.out2)
byGeometryColor = Modifiers.GeometryColor.ByGeometryColor(geometry=byCorners, color=byARGB)

steel_rod = Python()  # PythonNet3; unwired: IN[0]
# ---------- steel_rod.python (29 lines) ----------
# Load the Python Standard and DesignScript Libraries
import sys
import clr
clr.AddReference('ProtoGeometry')
from Autodesk.DesignScript.Geometry import *
import math

class CircularSteel:
    def __init__(self, centerline, radius):
        self.centerline = centerline
        self.radius = radius
    
    def endpoints(self):
        return self.centerline.StartPoint, self.centerline.EndPoint
    
    def make_geometry(self):
        start = self.centerline.StartPoint
        tangent = self.centerline.TangentAtParameter(0)
        plane = Plane.ByOriginNormal(start, tangent)
        profile = Circle.ByPlaneRadius(plane, self.radius)

        solid = Solid.BySweep(profile, self.centerline)
        return solid
    
    def measure_volume(self):
        solid = self.make_geometry()
        return solid.Volume

OUT = CircularSteel
# ----------------------------------------
code_block_4 = CodeBlock { 0; 0; 0; }
startpoint = Point.ByCoordinates(x=code_block_4.out0, y=code_block_4.out1, z=code_block_4.out2)
code_block_5 = CodeBlock { 5000; 5000; 0; }
endPoint1 = Point.ByCoordinates(x=code_block_5.out0, y=code_block_5.out1, z=code_block_5.out2)
first_half = Line.ByStartPointEndPoint(startPoint=startpoint, endPoint=endPoint1)
number_of_rods = DoubleSlider(21, range=10..30 step 1)
code_block_6 = CodeBlock(n=number_of_rods) { n; 0..1..#n; }
splitByParameter = Curve.SplitByParameter(curve=first_half, parameters=code_block_6.out1)
points_on_first_half = Curve.EndPoint(curve=splitByParameter)
code_block_7 = CodeBlock { -2500; 1500; }
height = DoubleSlider(2500, range=2500..5000 step 1)
byCoordinates_3 = Point.ByCoordinates(x=code_block_7.out0, y=code_block_7.out1, z=height)
code_block_8 = CodeBlock { 0; 5000; }
y_coord_of_intersection = DoubleSlider(-4572, range=-5000..-4250 step 1)
change_in_point_location = CodeBlock(IN=y_coord_of_intersection) { y = IN; first_half = y; second_half = -y; }
byCoordinates_4 = Point.ByCoordinates(x=code_block_8.out0, y=change_in_point_location.second_half, z=code_block_8.out1)
byStartPointEndPoint = Line.ByStartPointEndPoint(startPoint=byCoordinates_3, endPoint=byCoordinates_4)
splitByParameter_2 = Curve.SplitByParameter(curve=byStartPointEndPoint, parameters=code_block_6.out1)
midpoints_on_second_half = Curve.EndPoint(curve=splitByParameter_2)
code_block_9 = CodeBlock { 4850; -4850; }
height_of_beam = DoubleSlider(500, range=0..1000 step 1)
intersection_point_1 = Point.ByCoordinates(x=code_block_9.out1, y=change_in_point_location.second_half, z=height_of_beam)
first_half_arc = Arc.ByThreePoints(firstPoint=points_on_first_half, secondPoint=midpoints_on_second_half, thirdPoint=intersection_point_1)
rod_radius = DoubleSlider(62.3, range=50..100 step 0.1)
first_half_of_steel_rods = Python(IN[0]=steel_rod, IN[1]=first_half_arc, IN[2]=rod_radius)  # PythonNet3
# ---------- first_half_of_steel_rods.python (21 lines) ----------
CircularSteel = IN[0]
lines = IN[1]
radius = IN[2]

def covert(item):
    cs = CircularSteel(item,radius)
    return cs.make_geometry(), cs.measure_volume()

def walk(data):
    if isinstance(data, list):
        geos, vols = [],[]
        for d in data:
            g,v = walk(d)
            geos.append(g)
            vols.append(v)
        return geos,vols   
    else:
        return covert(data)  
        
geos, vols = walk(lines)
OUT = (geos,vols)  
# ----------------------------------------
volume_of_first_half_of_steel = Watch(first_half_of_steel_rods)  # "Volume of First Half of Steel Rods"
code_block_10 = CodeBlock { -5000; -5000; 0; }
endpoint2 = Point.ByCoordinates(x=code_block_10.out0, y=code_block_10.out1, z=code_block_10.out2)
second_half = Line.ByStartPointEndPoint(startPoint=startpoint, endPoint=endpoint2)
splitByParameter_3 = Curve.SplitByParameter(curve=second_half, parameters=code_block_6.out1)
bottom_points_on_second_half = Curve.EndPoint(curve=splitByParameter_3)
code_block_11 = CodeBlock { 2500; -1500; }
byCoordinates_5 = Point.ByCoordinates(x=code_block_11.out0, y=code_block_11.out1, z=height)
byCoordinates_6 = Point.ByCoordinates(x=code_block_8.out0, y=change_in_point_location.first_half, z=code_block_8.out1)
byStartPointEndPoint_2 = Line.ByStartPointEndPoint(startPoint=byCoordinates_5, endPoint=byCoordinates_6)
splitByParameter_4 = Curve.SplitByParameter(curve=byStartPointEndPoint_2, parameters=code_block_6.out1)
midpoints_on_second_half_2 = Curve.EndPoint(curve=splitByParameter_4)
intersection_point_2 = Point.ByCoordinates(x=code_block_9.out0, y=change_in_point_location.first_half, z=height_of_beam)
second_half_arc = Arc.ByThreePoints(firstPoint=bottom_points_on_second_half, secondPoint=midpoints_on_second_half_2, thirdPoint=intersection_point_2)
second_half_of_steel_rods = Python(IN[0]=steel_rod, IN[1]=second_half_arc, IN[2]=rod_radius)  # PythonNet3; same code as first_half_of_steel_rods
volume_of_second_half_of_steel = Watch(second_half_of_steel_rods)  # "Volume of Second Half of Steel Rods"
first_half_of_canvas_panel = Python(IN[0]=first_half_arc, IN[1]=rod_radius)  # PythonNet3
# ---------- first_half_of_canvas_panel.python (13 lines) ----------
# Load the Python Standard and DesignScript Libraries
import sys
import clr
clr.AddReference('ProtoGeometry')
from Autodesk.DesignScript.Geometry import *

arc = IN[0]

surface = Surface.ByLoft(arc)

area = surface.Area

OUT = surface, area
# ----------------------------------------
surface_area_of_first_half_of = Watch(first_half_of_canvas_panel)  # "Surface Area of First Half of Canvas"
second_half_of_canvas_panel = Python(IN[0]=second_half_arc, IN[1]=rod_radius)  # PythonNet3; same code as first_half_of_canvas_panel
surface_area_of_second_half_of = Watch(second_half_of_canvas_panel)  # "Surface Area of Second Half of Canvas"
timber_beam = Python()  # PythonNet3; unwired: IN[0]
# ---------- timber_beam.python (37 lines) ----------
# Load the Python Standard and DesignScript Libraries
import sys
import clr
clr.AddReference('ProtoGeometry')
from Autodesk.DesignScript.Geometry import *
import math

class RectangularTimber:
    def __init__(self, centerline, width, height):
        self.centerline = centerline
        self.width = width
        self.height = height
    
    def endpoints(self):
        return self.centerline.StartPoint, self.centerline.EndPoint
    
    def make_geometry(self):
        start = self.centerline.StartPoint
        tangent = self.centerline.TangentAtParameter(0)
        plane = Plane.ByOriginNormal(start, tangent)
        center_width = self.width/2
        center_height = self.height/2
        
        p1 = plane.Origin.Add(plane.XAxis.Scale(center_width)).Add(plane.YAxis.Scale(center_height))
        p2 = plane.Origin.Add(plane.XAxis.Scale(-center_width)).Add(plane.YAxis.Scale(center_height))
        p3 = plane.Origin.Add(plane.XAxis.Scale(-center_width)).Add(plane.YAxis.Scale(-center_height))
        p4 = plane.Origin.Add(plane.XAxis.Scale(center_width)).Add(plane.YAxis.Scale(-center_height))

        profile = Polygon.ByPoints([p1, p2, p3, p4])
        solid = Solid.BySweep(profile, self.centerline)
        return solid
    
    def measure_volume(self):
        solid = self.make_geometry()
        return solid.Volume

OUT = RectangularTimber
# ----------------------------------------
code_block_12 = CodeBlock { 0; }
byCoordinates_7 = Point.ByCoordinates(x=code_block_9.out1, y=change_in_point_location.second_half, z=code_block_12)
byCoordinates_8 = Point.ByCoordinates(x=code_block_9.out1, y=change_in_point_location.second_half, z=height_of_beam)
firsthalf_timber_line = Line.ByStartPointEndPoint(startPoint=byCoordinates_7, endPoint=byCoordinates_8)
code_block_13 = CodeBlock { 150; }
timber_beam_2 = Python(IN[0]=timber_beam, IN[1]=firsthalf_timber_line, IN[2]=code_block_13, IN[3]=code_block_13)  # PythonNet3
# ---------- timber_beam_2.python (22 lines) ----------
RectangularTimber = IN[0]
lines = IN[1]
width = IN[2]
height = IN[3]

def covert(item):
    rt = RectangularTimber(item,width,height)
    return rt.make_geometry(), rt.measure_volume()

def walk(data):
    if isinstance(data, list):
        geos, vols = [],[]
        for d in data:
            g,v = walk(d)
            geos.append(g)
            vols.append(v)
        return geos,vols   
    else:
        return covert(data)  
        
geos, vols = walk(lines)
OUT = (geos,vols)  
# ----------------------------------------
volume_of_beam_2 = Watch(timber_beam_2)
byCoordinates_9 = Point.ByCoordinates(x=code_block_9.out0, y=change_in_point_location.first_half, z=code_block_12)
byCoordinates_10 = Point.ByCoordinates(x=code_block_9.out0, y=change_in_point_location.first_half, z=height_of_beam)
secondhalf_timber_line = Line.ByStartPointEndPoint(startPoint=byCoordinates_9, endPoint=byCoordinates_10)
timber_beam_1 = Python(IN[0]=timber_beam, IN[1]=secondhalf_timber_line, IN[2]=code_block_13, IN[3]=code_block_13)  # PythonNet3; same code as timber_beam_2
volume_of_beam_1 = Watch(timber_beam_1)
