# Dynamo graph 1864004.dyn "Start-1" (Dynamo 3.6.1.9895)

# group: Don't touch this ground
code_block = CodeBlock { -5000; -5000; -200; }
byCoordinates = Point.ByCoordinates(x=code_block.out0, y=code_block.out1, z=code_block.out2)
code_block_2 = CodeBlock { 5000; 5000; 0; }
byCoordinates_2 = Point.ByCoordinates(x=code_block_2.out0, y=code_block_2.out1, z=code_block_2.out2)
byCorners = Cuboid.ByCorners(lowPoint=byCoordinates, highPoint=byCoordinates_2)
code_block_3 = CodeBlock { 0; 100; 0; }
byARGB = Color.ByARGB(red=code_block_3.out0, green=code_block_3.out1, blue=code_block_3.out2)
byGeometryColor = Modifiers.GeometryColor.ByGeometryColor(geometry=byCorners, color=byARGB)

number_slider = DoubleSlider(3620, range=10..10000 step 0.1)
number_slider_2 = DoubleSlider(4295.2, range=5..5000 step 0.1)
integer_slider = IntegerSlider(10, range=10..40 step 1)
number_slider_3 = DoubleSlider(127.8, range=100..200 step 0.1)
number_slider_4 = DoubleSlider(2272.9, range=1..3000 step 0.1)
steel_egg_dome = Python(h=number_slider, r=number_slider_2, samples=integer_slider, thickness=number_slider_3, cylinder_radius=number_slider_4)  # CPython3
# ---------- steel_egg_dome.python (50 lines) ----------
# Load the Python Standard and DesignScript Libraries
import sys
import clr
import math
clr.AddReference('ProtoGeometry')
from Autodesk.DesignScript.Geometry import *

# The inputs to this node will be stored as a list in the IN variables.
h = IN[0]
r = IN[1]
samples = IN[2]
thickness = IN[3]
cylinder_radius = IN[4]

# Place your code below this line
zs = [(h/1) * (i / float(samples)) for i in range(samples + 1)]
circles = []

for z in zs:
    t = z / h  
    scale = 1 - 0.4 * t  
    rad = r * scale
    c = Circle.ByCenterPointRadius(Point.ByCoordinates(0, 0, z), rad)
    circles.append(c)  
    
eggBottom = Surface.ByLoft(circles)

thickEgg = eggBottom.Thicken(thickness, False)


start_pointX = Point.ByCoordinates(-5000, 0, 0)
end_pointX = Point.ByCoordinates(5000, 0, 0)

start_pointY = Point.ByCoordinates(0, -5000, 0)
end_pointY = Point.ByCoordinates(0, 5000, 0)


cylinderX = Cylinder.ByPointsRadius(start_pointX, end_pointX, cylinder_radius) 

cylinderY = Cylinder.ByPointsRadius(start_pointY, end_pointY, cylinder_radius)

combined_cutter = cylinderX.Union(cylinderY)

egg_with_opening = thickEgg.Difference(combined_cutter)       


eggVolume = egg_with_opening.Volume
eggVolumeUnits = "{:,} mm³".format(eggVolume)

OUT = egg_with_opening, eggVolumeUnits
# ----------------------------------------
steel_egg_dome_volume = Watch(steel_egg_dome)
cylRadius = DoubleSlider(200.2, range=0.2..800 step 0.1)
cylHeight = DoubleSlider(3000, range=0.5..3000 step 0.1)
count = IntegerSlider(50, range=50..200 step 1)
cyl_volume = Python(cylRadius=cylRadius, cylHeight=cylHeight, count=count)  # CPython3
# ---------- cyl_volume.python (18 lines) ----------
# Load the Python Standard and DesignScript Libraries
import sys
import clr
import math
clr.AddReference('ProtoGeometry')
from Autodesk.DesignScript.Geometry import *

# The inputs to this node will be stored as a list in the IN variables.
cylRadius = IN[0]
cylHeight = IN[1]
count = IN[2]

# Place your code below this line
cylVolume = math.pi * cylRadius**2 * cylHeight
spiralVolume = cylVolume * count
spiralVolumeUnits = "{:,} mm³".format(spiralVolume)
# Assign your output to the OUT variable.
OUT = spiralVolumeUnits
# ----------------------------------------
cyl_volume_2 = Watch(cyl_volume)
turns = DoubleSlider(3, range=1..3 step 0.1)
series_of_wood_cylinders = Python(h=number_slider, r=number_slider_2, turns=turns, cylRadius=cylRadius, cylHeight=cylHeight, count=count)  # CPython3
# ---------- series_of_wood_cylinders.python (57 lines) ----------
# Load the Python Standard and DesignScript Libraries
import sys
import clr
import math
clr.AddReference('ProtoGeometry')
from Autodesk.DesignScript.Geometry import *


# The inputs to this node will be stored as a list in the IN variables.
h = IN[0]
r = IN[1]
turns = IN[2]
cylRadius = IN[3]
cylHeight = IN[4]
count = IN[5]

# Place your code below this line
spiralPts = []
for i in range(count):
    t = i / float(count - 1)
    z = t * h
 
    ang = t * turns * 2 * 3.14159
    
    scale = 1 - 0.4 * t
    rad = r * scale * 1.01  
    x = rad * math.cos(ang)
    y = rad * math.sin(ang)
    spiralPts.append(Point.ByCoordinates(x, y, z))

spiral = PolyCurve.ByPoints(spiralPts)

cyls = []

for i in range(count):
    p = spiralPts[i]
    
    
    if i < count - 1:
        p2 = spiralPts[i+1]
    else:
        p2 = spiralPts[i-1]
    tangent = Vector.ByTwoPoints(p, p2).Normalized()
    cs = CoordinateSystem.ByOriginVectors(p, tangent, Vector.ZAxis().Cross(tangent))
    
    
    pA = cs.Origin.Add(tangent.Scale(-cylHeight/2.0))
    pB = cs.Origin.Add(tangent.Scale(cylHeight/2.0))
    
    cyl = Cylinder.ByPointsRadius(pA, pB, cylRadius)
    cyls.append(cyl)

cylVolume = math.pi * cylRadius**2 * cylHeight
spiralVolume = cylVolume * count
spiralVolumeUnits = "{:,} mm³".format(spiralVolume)

OUT = cyls
# ----------------------------------------
code_block_4 = CodeBlock { alpha = 255; red = 139; green = 69; blue = 19; }
byARGB_2 = Color.ByARGB(alpha=code_block_4.alpha, red=code_block_4.red, green=code_block_4.green, blue=code_block_4.blue)
byGeometryColor_2 = Modifiers.GeometryColor.ByGeometryColor(geometry=series_of_wood_cylinders, color=byARGB_2)
