# Dynamo graph 1865218.dyn (Dynamo 3.5.2.8914)

# group: Don't touch this ground
code_block = CodeBlock { -5000; -5000; -200; }
byCoordinates = Point.ByCoordinates(x=code_block.out0, y=code_block.out1, z=code_block.out2)
code_block_2 = CodeBlock { 5000; 5000; 0; }
byCoordinates_2 = Point.ByCoordinates(x=code_block_2.out0, y=code_block_2.out1, z=code_block_2.out2)
byCorners = Cuboid.ByCorners(lowPoint=byCoordinates, highPoint=byCoordinates_2)
code_block_3 = CodeBlock { 0; 100; 0; }
byARGB = Color.ByARGB(red=code_block_3.out0, green=code_block_3.out1, blue=code_block_3.out2)
byGeometryColor = Modifiers.GeometryColor.ByGeometryColor(geometry=byCorners, color=byARGB)

timber_and_steel = Python()  # CPython3; unwired: IN[0]
# ---------- timber_and_steel.python (41 lines) ----------
import clr
clr.AddReference('ProtoGeometry')
from Autodesk.DesignScript.Geometry import Point, Vector, CoordinateSystem, Solid, Cylinder, Polygon, Surface


class TimberBeam(object):
    def __init__(self, width_mm=60.0, height_mm=120.0, length_mm=3000.0, material_name="Timber"):
        self.w = float(width_mm)
        self.h = float(height_mm)
        self.l = float(length_mm)
        self.material = material_name

    def geometry(self, base_point, direction_vector):
       
        axis = Vector.ByCoordinates(direction_vector.X, direction_vector.Y, direction_vector.Z)
       
        cs = CoordinateSystem.ByOriginVectors(base_point, axis, axis.Cross(Vector.ZAxis()))
      
        box = Box.ByLengths(base_point, self.w, self.l, self.h)  
        return box

    def volume_mm3(self):
        return self.w * self.h * self.l  
class SteelPanel(object):
    def __init__(self, thickness_mm=5.0, material_name="Steel"):
        self.t = float(thickness_mm)
        self.material = material_name

    def geometry_from_triangle(self, p1, p2, p3):
       
        triangle = Polygon.ByPoints([p1,p2,p3])
        surf = Surface.ByPatch(triangle)
      
        extruded = surf.Thicken(self.t, True) if hasattr(surf, "Thicken") else surf  
        return extruded

    def volume_mm3(self, area_mm2):
       
        return area_mm2 * self.t

OUT = "TimberBeam and SteelPanel classes defined"
# ----------------------------------------
integer_slider = IntegerSlider(12, range=3..48 step 1)
radius = DoubleSlider(3000, range=1000..5000 step 1)
thickness = DoubleSlider(60, range=20..150 step 1)
height = DoubleSlider(120, range=20..800 step 1)
instances = Python(IN[0]=integer_slider, IN[1]=radius, IN[2]=thickness, IN[3]=height)  # CPython3
# ---------- instances.python (52 lines) ----------
import clr
clr.AddReference('ProtoGeometry')
from Autodesk.DesignScript.Geometry import Point, Line, Polygon, Surface
import math


num_ribs = IN[0]    
radius = IN[1]       
beam_w = IN[2]      
beam_h = IN[3]       

beam_lines = []
panels = []
beam_volumes = []
panel_volumes = []


def circle_pt(angle_deg, r, z=0.0):
    a = math.radians(angle_deg)
    return Point.ByCoordinates(r * math.cos(a), r * math.sin(a), z)


for i in range(num_ribs):
    angle = 360.0 * i / num_ribs
  
    p0 = Point.ByCoordinates(0, 0, beam_h / 2.0)
    p1 = circle_pt(angle, radius, beam_h / 2.0)
    line = Line.ByStartPointEndPoint(p0, p1)
    beam_lines.append(line)
    length = p0.DistanceTo(p1)  
    beam_volumes.append(beam_w * beam_h * length)


for i in range(num_ribs):
    pA = circle_pt(360.0 * i / num_ribs, radius, 0.0)
    pB = circle_pt(360.0 * (i + 1) / num_ribs, radius, 0.0)
    pC = Point.ByCoordinates(0, 0, beam_h)  
    tri = Polygon.ByPoints([pA, pB, pC])
    surf = Surface.ByPatch(tri)
    panels.append(surf)
 
    base = pA.DistanceTo(pB)
    
   
    height_est = radius * 0.5
    area = 0.5 * base * height_est  
    panel_volumes.append(area * 1.0)   
total_beam_vol_mm3 = sum(beam_volumes)
total_panel_vol_mm3 = sum(panel_volumes)


OUT = (beam_lines, panels, total_beam_vol_mm3, total_panel_vol_mm3)
# ----------------------------------------
number = DoubleInput(3)
getItemAtIndex = List.GetItemAtIndex(list=instances, index=number)
watch_2 = Watch(getItemAtIndex)
number_2 = DoubleInput(2)
getItemAtIndex_2 = List.GetItemAtIndex(list=instances, index=number_2)
watch_1 = Watch(getItemAtIndex_2)
