# Dynamo graph 1865439.dyn "HomeAssignment2" (Dynamo 3.6.0.9395)

# group: Don't touch this ground
code_block = CodeBlock { -5000; -5000; -200; }
byCoordinates = Point.ByCoordinates(x=code_block.out0, y=code_block.out1, z=code_block.out2)
code_block_2 = CodeBlock { 5000; 5000; 0; }
byCoordinates_2 = Point.ByCoordinates(x=code_block_2.out0, y=code_block_2.out1, z=code_block_2.out2)
byCorners = Cuboid.ByCorners(lowPoint=byCoordinates, highPoint=byCoordinates_2)
code_block_3 = CodeBlock { 0; 100; 0; }
byARGB = Color.ByARGB(red=code_block_3.out0, green=code_block_3.out1, blue=code_block_3.out2)
byGeometryColor = Modifiers.GeometryColor.ByGeometryColor(geometry=byCorners, color=byARGB)

radius = DoubleSlider(4500, range=2000..4500 step 100)
domeHeight = DoubleSlider(1500, range=500..2000 step 50)
glassThickness = DoubleSlider(60, range=10..1000 step 10)
nPanels = DoubleSlider(16, range=8..32 step 1)
nBeams = DoubleSlider(8, range=4..16 step 1)
beamHeight = DoubleSlider(3000, range=1000..3500 step 25)
beamWidth = DoubleSlider(150, range=100..300 step 0.1)
beamDepth = DoubleSlider(100, range=100..300 step 0.1)
python_script = Python(IN[0]=radius, IN[1]=domeHeight, IN[2]=glassThickness, IN[3]=nPanels, IN[4]=nBeams, IN[5]=beamHeight, IN[6]=beamWidth, IN[7]=beamDepth)  # CPython3
# ---------- python_script.python (209 lines) ----------
import clr
clr.AddReference('ProtoGeometry')
from Autodesk.DesignScript.Geometry import *

import math

# Inputs from Dynamo 
radius          = IN[0]    
domeHeight      = IN[1]    
glassThickness  = IN[2]    
nPanels         = int(IN[3])
nBeams          = int(IN[4])
beamHeight      = IN[5]    
beamWidth       = IN[6]    
beamDepth       = IN[7]    

nPanels = max(nPanels, 3)
nBeams  = max(nBeams, 1)

maxRadius = 4500.0
radius = min(radius, maxRadius)

# extra parameters
frameThickness   = glassThickness        
ringThickness    = beamWidth            
glassInsetScale  = 0.85                  
ringWidth        = beamWidth             


def shrink_point_towards_center(p, c, factor):
    return Point.ByCoordinates(
        c.X + (p.X - c.X) * factor,
        c.Y + (p.Y - c.Y) * factor,
        c.Z + (p.Z - c.Z) * factor
    )


# Classes

class GlassPanel(object):
    def __init__(self, p1, p2, p3, thickness):
        self.p1 = p1
        self.p2 = p2
        self.p3 = p3
        self.thickness = thickness
        self._geom = None

    def generate_geometry(self):
        if self._geom:
            return self._geom
        poly = PolyCurve.ByPoints([self.p1, self.p2, self.p3, self.p1])
        surf = Surface.ByPatch(poly)
        solid = surf.Thicken(self.thickness, True)
        self._geom = solid
        return solid

    def volume(self):
        return self.generate_geometry().Volume


class SteelFrame(object):
    def __init__(self, p1, p2, p3, thickness):
        self.p1 = p1
        self.p2 = p2
        self.p3 = p3
        self.thickness = thickness
        self._geom = None

    def generate_geometry(self):
        if self._geom:
            return self._geom
        poly = PolyCurve.ByPoints([self.p1, self.p2, self.p3, self.p1])
        surf = Surface.ByPatch(poly)
        solid = surf.Thicken(self.thickness, True)
        self._geom = solid
        return solid

    def volume(self):
        return self.generate_geometry().Volume


class SteelBeam(object):
    def __init__(self, base_point, height, width, depth):
        self.base_point = base_point
        self.height = height
        self.width = width
        self.depth = depth
        self._geom = None

    def generate_geometry(self):
        if self._geom:
            return self._geom
        p = self.base_point
        p1 = Point.ByCoordinates(p.X - self.width/2.0,
                                 p.Y - self.depth/2.0,
                                 p.Z)
        p2 = Point.ByCoordinates(p.X + self.width/2.0,
                                 p.Y + self.depth/2.0,
                                 p.Z + self.height)
        beam = Cuboid.ByCorners(p1, p2)
        self._geom = beam
        return beam

    def volume(self):
        return self.generate_geometry().Volume


# Dome sits on top of the beams
ringZ = beamHeight
apex  = Point.ByCoordinates(0, 0, ringZ + domeHeight)

rim_points = []
for i in range(nPanels):
    ang = 2.0 * math.pi * i / float(nPanels)
    x = radius * math.cos(ang)
    y = radius * math.sin(ang)
    rim_points.append(Point.ByCoordinates(x, y, ringZ))


# Glass panels instance

glass_panels       = []
glass_geoms        = []
steel_frame_elems  = []
steel_frame_geoms  = []

for i in range(nPanels):
    p1 = rim_points[i]
    p2 = rim_points[(i + 1) % nPanels]
    p3 = apex

    cx = (p1.X + p2.X + p3.X) / 3.0
    cy = (p1.Y + p2.Y + p3.Y) / 3.0
    cz = (p1.Z + p2.Z + p3.Z) / 3.0
    center = Point.ByCoordinates(cx, cy, cz)

    g1 = shrink_point_towards_center(p1, center, glassInsetScale)
    g2 = shrink_point_towards_center(p2, center, glassInsetScale)
    g3 = shrink_point_towards_center(p3, center, glassInsetScale)

    gp = GlassPanel(g1, g2, g3, glassThickness)
    glass_panels.append(gp)
    glass_geoms.append(gp.generate_geometry())

    sf = SteelFrame(p1, p2, p3, frameThickness)
    steel_frame_elems.append(sf)
    steel_frame_geoms.append(sf.generate_geometry())

glass_volume_total = sum([p.volume() for p in glass_panels])


# Steel beams instance

beam_points = []
for i in range(nBeams):
    idx    = int(i * float(nPanels) / float(nBeams))
    rim_pt = rim_points[idx % nPanels]
    bp     = Point.ByCoordinates(rim_pt.X, rim_pt.Y, 0)
    beam_points.append(bp)

steel_beams      = []
steel_beam_geoms = []
for bp in beam_points:
    b = SteelBeam(bp, beamHeight, beamWidth, beamDepth)
    steel_beams.append(b)
    steel_beam_geoms.append(b.generate_geometry())

steel_beams_volume = sum([b.volume() for b in steel_beams])


# Steel ring on top of beams

ring_centerZ = ringZ - ringThickness / 2.0   # <-- this was missing
ring_center  = Point.ByCoordinates(0, 0, ring_centerZ)

ringWidth = beamWidth * 1.5   

inner_radius = max(radius - ringWidth * 0.6, radius * 0.3)
outer_radius = radius + ringWidth * 0.4

outer_circle = Circle.ByCenterPointRadius(ring_center, outer_radius)
inner_circle = Circle.ByCenterPointRadius(ring_center, inner_radius)

outer_surf = Surface.ByPatch(outer_circle)
inner_surf = Surface.ByPatch(inner_circle)

outer_solid = outer_surf.Thicken(ringThickness, True)
inner_solid = inner_surf.Thicken(ringThickness * 2.0, True)

ring_bool = Solid.Difference(outer_solid, inner_solid)

try:
    steel_ring = ring_bool[0]
except TypeError:
    steel_ring = ring_bool

steel_ring_volume = steel_ring.Volume


# Total steel (frames + beams + ring)

steel_frame_volume = sum([f.volume() for f in steel_frame_elems])
steel_volume_total = steel_beams_volume + steel_frame_volume + steel_ring_volume

all_steel_geoms = steel_beam_geoms + steel_frame_geoms + [steel_ring]


# Outputs
OUT = [glass_geoms, all_steel_geoms, glass_volume_total, steel_volume_total]
# ----------------------------------------
code_block_4 = CodeBlock { 2; }
getItemAtIndex = List.GetItemAtIndex(list=python_script, index=code_block_4)
total_glass_volume_mm_3 = Watch(getItemAtIndex)
code_block_5 = CodeBlock { 3; }
getItemAtIndex_2 = List.GetItemAtIndex(list=python_script, index=code_block_5)
total_steel_volume_mm_3 = Watch(getItemAtIndex_2)
