# Dynamo graph 1865859.dyn (Dynamo 3.6.0.9395)

# group: Don't touch this ground
code_block = CodeBlock { -5000; -5000; -200; }
byCoordinates = Point.ByCoordinates(x=code_block.out0, y=code_block.out1, z=code_block.out2)
code_block_2 = CodeBlock { 5000; 5000; 0; }
byCoordinates_2 = Point.ByCoordinates(x=code_block_2.out0, y=code_block_2.out1, z=code_block_2.out2)
byCorners = Cuboid.ByCorners(lowPoint=byCoordinates, highPoint=byCoordinates_2)
code_block_3 = CodeBlock { 0; 100; 0; }
byARGB = Color.ByARGB(red=code_block_3.out0, green=code_block_3.out1, blue=code_block_3.out2)
byGeometryColor = Modifiers.GeometryColor.ByGeometryColor(geometry=byCorners, color=byARGB)

code_block_4 = CodeBlock { 0; 0; 0; }
byCoordinates_3 = Point.ByCoordinates(x=code_block_4.out0, y=code_block_4.out1, z=code_block_4.out2)
code_block_5 = CodeBlock { 0; 0; 0; }
number_slider = DoubleSlider(2302, range=0..6000 step 2)
byCoordinates_4 = Point.ByCoordinates(x=code_block_5.out0, y=code_block_5.out2, z=number_slider)
code_block_6 = CodeBlock { 0; 0; }
funnel_height = DoubleSlider(15000, range=2000..15000 step 50)
byCoordinates_5 = Point.ByCoordinates(x=code_block_6.out0, y=code_block_6.out1, z=funnel_height)
byStartPointEndPoint = Line.ByStartPointEndPoint(startPoint=byCoordinates_4, endPoint=byCoordinates_5)
number_of_wooden_frames = DoubleSlider(29, range=11..51 step 2)
code_block_7 = CodeBlock(n=number_of_wooden_frames) { 0..1..#n; }
planeAtParameter = Curve.PlaneAtParameter(curve=byStartPointEndPoint, param=code_block_7)
code_block_8 = CodeBlock { 0; 0; }
bottom_funnel_height = DoubleSlider(563, range=0..2000 step 1)
byCoordinates_6 = Point.ByCoordinates(x=code_block_8.out0, y=code_block_8.out1, z=bottom_funnel_height)
middle_funnel_circle_radius = DoubleSlider(1250, range=1250..5000 step 20)
middle_funnel_height = DoubleSlider(5800, range=1000..6000 step 20)
byCoordinates_7 = Point.ByCoordinates(y=middle_funnel_circle_radius, z=middle_funnel_height)
top_of_funnel_circle_radius = DoubleSlider(8000, range=1000..8000 step 20)
byCoordinates_8 = Point.ByCoordinates(y=top_of_funnel_circle_radius, z=funnel_height)
byThreePoints = Arc.ByThreePoints(firstPoint=byCoordinates_6, secondPoint=byCoordinates_7, thirdPoint=byCoordinates_8)
number_slider_2 = DoubleSlider(200, range=200..5000 step 50)
byCenterPointRadius = Circle.ByCenterPointRadius(centerPoint=byCoordinates_4, radius=number_slider_2)
bySweep = Surface.BySweep(profile=byThreePoints, path=byCenterPointRadius)
intersectAll = Geometry.IntersectAll(geometry=planeAtParameter, others=bySweep)
number_slider_3 = DoubleSlider(100, range=0..100 step 0.1)
thicken = Surface.Thicken(surface=bySweep, thickness=number_slider_3)
code_block_9 = CodeBlock { 215; 186; 137; }
byARGB_2 = Color.ByARGB(red=code_block_9.out0, green=code_block_9.out1, blue=code_block_9.out2)
byGeometryColor_2 = Modifiers.GeometryColor.ByGeometryColor(geometry=thicken, color=byARGB_2)
number_slider_4 = DoubleSlider(2000, range=1000..2000 step 50)
number_slider_5 = DoubleSlider(1380, range=300..2000 step 40)
bench = Cylinder.ByRadiusHeight(radius=number_slider_4, height=number_slider_5)
code_block_10 = CodeBlock { 215; 186; 137; }
byARGB_3 = Color.ByARGB(red=code_block_10.out0, green=code_block_10.out1, blue=code_block_10.out2)
byGeometryColor_3 = Modifiers.GeometryColor.ByGeometryColor(geometry=bench, color=byARGB_3)
python_script = Python(IN[0]=thicken)  # CPython3
# ---------- python_script.python (40 lines) ----------
import clr
clr.AddReference('ProtoGeometry')
from Autodesk.DesignScript.Geometry import *

# CLASS 1
class FunnelStructure:
    def __init__(self, base_r, top_r, height, origin):
        self.base_r, self.top_r, self.height, self.origin = base_r, top_r, height, origin
    def generate_geometry(self):
        base = Circle.ByCenterPointRadius(self.origin, self.base_r)
        top = Circle.ByCenterPointRadius(Point.ByCoordinates(self.origin.X, self.origin.Y, self.origin.Z + self.height), self.top_r)
        return Surface.ByLoft([base, top])
    def compute_volume(self, thickness=10):
        solid = self.generate_geometry().Thicken(thickness)
        return solid.Volume if solid else 0

# CLASS 2
class CylinderStructure:
    def __init__(self, radius, height, origin):
        self.radius, self.height, self.origin = radius, height, origin
    def generate_geometry(self):
        circle = Circle.ByCenterPointRadius(self.origin, self.radius)
        return circle.ExtrudeAsSolid(Vector.ZAxis(), self.height)
    def compute_volume(self):
        return self.generate_geometry().Volume

# YOUR VOLUME FUNCTION (unchanged)
geometry = IN[0]
def calculate_volume(geom):
    if isinstance(geom, Solid): return geom.Volume
    elif isinstance(geom, Surface):
        thickness = IN[1] if len(IN) > 1 else 100
        thickened = geom.Thicken(thickness)
        return thickened.Volume if thickened and isinstance(thickened, Solid) else 0
    elif hasattr(geom, 'Solids'):
        return sum(solid.Volume for solid in geom.Solids)
    else: return 0

volume_value = calculate_volume(geometry)
OUT = f"{volume_value:,.2f} mm³"
# ----------------------------------------
code_block_11 = CodeBlock { 0; }
getItemAtIndex = List.GetItemAtIndex(list=python_script, index=code_block_11)
volume_of_funnel = Watch(getItemAtIndex)
python_script_2 = Python(IN[0]=bench)  # CPython3; same code as python_script
code_block_12 = CodeBlock { 0; }
getItemAtIndex_2 = List.GetItemAtIndex(list=python_script_2, index=code_block_12)
volume_of_cylinder_bench = Watch(getItemAtIndex_2)
