# Dynamo graph 1866699.dyn (Dynamo 3.6.0.9395)

# group: Don't touch this ground
code_block = CodeBlock { -5000; -5000; -200; }
byCoordinates = Point.ByCoordinates(x=code_block.out0, y=code_block.out1, z=code_block.out2)
code_block_2 = CodeBlock { 5000; 5000; 0; }
byCoordinates_2 = Point.ByCoordinates(x=code_block_2.out0, y=code_block_2.out1, z=code_block_2.out2)
byCorners = Cuboid.ByCorners(lowPoint=byCoordinates, highPoint=byCoordinates_2)
code_block_3 = CodeBlock { 0; 100; 0; }
byARGB = Color.ByARGB(red=code_block_3.out0, green=code_block_3.out1, blue=code_block_3.out2)
byGeometryColor = Modifiers.GeometryColor.ByGeometryColor(geometry=byCorners, color=byARGB)

origin_plane = Plane.ByOriginNormal()
cylinder_radius_slider = DoubleSlider(434, range=1..1000 step 1)
circle_shape_starts_at_origin = Circle.ByPlaneRadius(plane=origin_plane, radius=cylinder_radius_slider)
center_point_0_0_0 = CodeBlock { x=0; y=0; z=0; }
center_point = Point.ByCoordinates(x=center_point_0_0_0.x, y=center_point_0_0_0.y, z=center_point_0_0_0.z)
x_slider_for_endpoint = DoubleSlider(5000, range=-5000..5000 step 1)
division_slider_x = DoubleSlider(2, range=2..100 step 1)
x_mid_point = x_slider_for_endpoint / division_slider_x
y_slider_for_endpoint = DoubleSlider(0, range=-5000..5000 step 1)
division_slider_y = DoubleSlider(1, range=1..1000 step 1)
div = y_slider_for_endpoint / division_slider_y
z_slider_for_height_of_midpoint = DoubleSlider(10000, range=1..10000 step 10)
mid_point_arc = Point.ByCoordinates(x=x_mid_point, y=div, z=z_slider_for_height_of_midpoint)
endpoint_z_value_fixed = CodeBlock { z=0; }
endpoint_arc = Point.ByCoordinates(x=x_slider_for_endpoint, y=y_slider_for_endpoint, z=endpoint_z_value_fixed)
arc_shape_cylinder = Arc.ByThreePoints(firstPoint=center_point, secondPoint=mid_point_arc, thirdPoint=endpoint_arc)
arc_fraction = DoubleSlider(0.1, range=0..1 step 0.01)
finds_a_point_at_x_of_the = Curve.PointAtParameter(curve=arc_shape_cylinder, param=arc_fraction)  # "Finds a Point at (x) of the original shape"
splits_the_arc_by_the_point = Curve.SplitByPoints(curve=arc_shape_cylinder, points=finds_a_point_at_x_of_the)
index_0_for_first_item = CodeBlock { x=0; }
gets_the_first_half_of_the_arc = List.GetItemAtIndex(list=splits_the_arc_by_the_point, index=index_0_for_first_item)
cylinder_shape_along_arc = Solid.BySweep(profile=circle_shape_starts_at_origin, path=gets_the_first_half_of_the_arc, cutEndOff=finds_a_point_at_x_of_the)
cogLength = DoubleSlider(500, range=0..500 step 1)
cog_height = DoubleSlider(1, range=0..100 step 0.1)
cogWidth = DoubleSlider(155, range=0..500 step 1)
outerRad = DoubleSlider(560, range=0..1000 step 0.1)
number_slider = DoubleSlider(0, range=0..1 step 0.1)
curve_normalatparameter_normal = Curve.NormalAtParameter(curve=gets_the_first_half_of_the_arc, param=number_slider)  # "Curve.NormalAtParameter(normal to the cylinder end surface)"
outer_circle_normal_to_cylinder = Circle.ByCenterPointRadiusNormal(centerPoint=finds_a_point_at_x_of_the, radius=outerRad, normal=curve_normalatparameter_normal)  # "Outer Circle normal to cylinder end"
outer = Surface.ByPatch(closedCurve=outer_circle_normal_to_cylinder)
thickness_height = DoubleSlider(4997, range=1..10000 step 1)
code_block_4 = CodeBlock { true; }
outer_2 = Surface.Thicken(surface=outer, thickness=thickness_height, both_sides=code_block_4)
innerRad = DoubleSlider(200, range=0..1000 step 0.1)
inner_circle_normal_to_cylinder = Circle.ByCenterPointRadiusNormal(centerPoint=finds_a_point_at_x_of_the, radius=innerRad, normal=curve_normalatparameter_normal)  # "Inner Circle normal to cylinder end"
inner = Surface.ByPatch(closedCurve=inner_circle_normal_to_cylinder)
inner_2 = Surface.Thicken(surface=inner, thickness=thickness_height, both_sides=code_block_4)
difference = Solid.Difference(solid=outer_2, other=inner_2)
petalLength = DoubleSlider(6700, range=1..10000 step 1)
petalWidth = DoubleSlider(2000, range=1..5000 step 1)
petalinitialshape_v1 = Ellipse.ByOriginRadii(xAxisRadius=petalLength, yAxisRadius=petalWidth)
byOriginNormal = Plane.ByOriginNormal(origin=finds_a_point_at_x_of_the, normal=curve_normalatparameter_normal)
byPlaneRadii = Ellipse.ByPlaneRadii(plane=byOriginNormal, xAxisRadius=petalLength, yAxisRadius=petalWidth)
code_block_5 = CodeBlock(OuterRad=outerRad, X=petalLength) { EdgeToCircle = Vector.ByCoordinates(0,0,OuterRad+(0.3*X)); }
translate = Geometry.Translate(geometry=byPlaneRadii, direction=code_block_5)
prongCount = DoubleSlider(5, range=1..5 step 1)
code_block_6 = CodeBlock { start=0; step=1; }
sequence = Sequence(start=code_block_6.start, amount=prongCount, step=code_block_6.step)
degree_of_rotation = CodeBlock(ProngCount=prongCount, i=sequence) { Angle = (360/ProngCount)*i; }
rotate = Geometry.Rotate(geometry=translate, origin=finds_a_point_at_x_of_the, axis=curve_normalatparameter_normal, degrees=degree_of_rotation)
list_create = List.Create(item0=rotate)
byPatch = Surface.ByPatch(closedCurve=list_create)
number_slider_2 = DoubleSlider(100, range=1..100 step 1)
thicken = Surface.Thicken(surface=byPatch, thickness=number_slider_2)
byUnion = Solid.ByUnion(solids=thicken)
byPlaneRadii_2 = Ellipse.ByPlaneRadii()
hollowCircularRod = Python()  # CPython3; unwired: IN[0]
# ---------- hollowCircularRod.python (32 lines) ----------
# Load the Python Standard and DesignScript Libraries
import sys
import clr
clr.AddReference('ProtoGeometry')
from Autodesk.DesignScript.Geometry import *

class HollowCircularRod:

    def __init__(self, inner_radius, outer_radius, height, center_point, normal_vector):
        self.inner_radius =inner_radius
        self.outer_radius =outer_radius
        self.height = height
        self.center_point =center_point
        

    def generate_geometry(self):
        outer_circle = Circle.ByCenterPointRadius(self.center_point, self.outer_radius)
        inner_circle = Circle.ByCenterPointRadius(self.center_point, self.inner_radius)

        outer_surf = Surface.ByPatch(outer_circle)
        inner_surf = Surface.ByPatch(inner_circle)

        outer_solid = outer_surf.Thicken(self.height)
        inner_solid = inner_surf.Thicken(self.height)

        pipe = Solid.Difference(outer_solid, inner_solid)
        return pipe

    def compute_volume(self):
        return 3.141592653589793 * (self.outer_radius**2 - self.inner_radius**2) * self.height

OUT = HollowCircularRod
# ----------------------------------------
hollowcircularrod_instance = Python(IN[0]=hollowCircularRod, IN[1]=innerRad, IN[2]=outerRad, IN[3]=thickness_height, IN[4]=finds_a_point_at_x_of_the, IN[5]=curve_normalatparameter_normal)  # CPython3
# ---------- hollowcircularrod_instance.python (14 lines) ----------
HollowCircularRod = IN[0]
inner_radius = IN[1]
outer_radius = IN[2]
height = IN[3]
center_point = IN[4]
normal_vector = IN[5]

rod = HollowCircularRod(inner_radius,outer_radius,height,center_point,normal_vector)

rod_solid = rod.generate_geometry()

rod_volume = rod.compute_volume()

OUT = rod_solid, rod_volume
# ----------------------------------------
watch = Watch(hollowcircularrod_instance)
