# Dynamo graph 1868982.dyn "Home_Assignment_2_1868982_The_Social_Sail" (Dynamo 4.0.0.3277)

# group: Don't touch this ground
code_block = CodeBlock { -5000; -5000; -200; }
byCoordinates = Point.ByCoordinates(x=code_block.out0, y=code_block.out1, z=code_block.out2)
code_block_2 = CodeBlock { 5000; 5000; 0; }
byCoordinates_2 = Point.ByCoordinates(x=code_block_2.out0, y=code_block_2.out1, z=code_block_2.out2)
byCorners = Cuboid.ByCorners(lowPoint=byCoordinates, highPoint=byCoordinates_2)
code_block_3 = CodeBlock { 0; 100; 0; }
byARGB = Color.ByARGB(red=code_block_3.out0, green=code_block_3.out1, blue=code_block_3.out2)
byGeometryColor = Modifiers.GeometryColor.ByGeometryColor(geometry=byCorners, color=byARGB)

# group: Slide Parameters
# Sets lengths, widths, and heights of certain values.
pavillion_length = DoubleSlider(8000, range=2000..10000 step 100)
pavillion_width = DoubleSlider(7800, range=2000..10000 step 100)
corner_height_1 = DoubleSlider(0, range=0..4500 step 100)
corner_height_2 = DoubleSlider(4500, range=1500..4500 step 100)
corner_height_3 = DoubleSlider(0, range=0..4500 step 100)
corner_height_4 = DoubleSlider(4500, range=1500..4500 step 100)
tube_diameter = DoubleSlider(150, range=150..300 step 10)
curvature = DoubleSlider(3000, range=0..6000 step 100)
membrane_thickness = DoubleSlider(15, range=5..50 step 1)

# group: Calculators
# Calculates the postion of the points the poles will start and end at.
x_max = CodeBlock(L=pavillion_length) { L/2; }
y_min = CodeBlock(W=pavillion_width) { -W/2; }
y_max = CodeBlock(W=pavillion_width) { W/2; }
x_min = CodeBlock(L=pavillion_length) { -L/2; }
diameter_calculator = CodeBlock(D=tube_diameter) { D/2; }
x_mid = CodeBlock(XMIN=x_min, XMAX=x_max) { (XMIN+XMAX)/2; }
z_mid_1 = CodeBlock(CH1=corner_height_1, CH2=corner_height_2) { (CH1+CH2)/2; }
y_mid = CodeBlock(YMIN=y_min, YMAX=y_max) { (YMIN+YMAX)/2; }
z_mid_4 = CodeBlock(CH4=corner_height_4, CH1=corner_height_1) { (CH4+CH1)/2; }
z_mid_2 = CodeBlock(CH2=corner_height_2, CH3=corner_height_3) { (CH2+CH3)/2; }
z_mid_3 = CodeBlock(CH3=corner_height_3, CH4=corner_height_4) { (CH3+CH4)/2; }

# group: Corner Points
# The corners of the pavillion
p2_base_values = CodeBlock(L=x_max, W=y_min) { X=L; Y=W; Z=0; }
p2_base = Point.ByCoordinates(x=p2_base_values.X, y=p2_base_values.Y, z=p2_base_values.Z)
p3_base_values = CodeBlock(L=x_max, W=y_max) { X=L; Y=W; Z=0; }
p3_base = Point.ByCoordinates(x=p3_base_values.X, y=p3_base_values.Y, z=p3_base_values.Z)
p4_base_values = CodeBlock(L=x_min, W=y_max) { X=L; Y=W; Z=0; }
p4_base = Point.ByCoordinates(x=p4_base_values.X, y=p4_base_values.Y, z=p4_base_values.Z)
p1_values = CodeBlock(L=x_min, W=y_min, CH1=corner_height_1) { X=L; Y=W; Z=CH1; }
P1 = Point.ByCoordinates(x=p1_values.X, y=p1_values.Y, z=p1_values.Z)
p2_values = CodeBlock(L=x_max, W=y_min, CH2=corner_height_2) { X=L; Y=W; Z=CH2; }
P2 = Point.ByCoordinates(x=p2_values.X, y=p2_values.Y, z=p2_values.Z)
p3_values = CodeBlock(L=x_max, W=y_max, CH3=corner_height_3) { X=L; Y=W; Z=CH3; }
P3 = Point.ByCoordinates(x=p3_values.X, y=p3_values.Y, z=p3_values.Z)
p4_values = CodeBlock(L=x_min, W=y_max, CH4=corner_height_4) { X=L; Y=W; Z=CH4; }
P4 = Point.ByCoordinates(x=p4_values.X, y=p4_values.Y, z=p4_values.Z)
p1_base_values = CodeBlock(L=x_min, W=y_min) { X=L; Y=W; Z=0; }
p1_base = Point.ByCoordinates(x=p1_base_values.X, y=p1_base_values.Y, z=p1_base_values.Z)
mid_1 = Point.ByCoordinates(x=x_mid, y=y_min, z=z_mid_1)
mid_2 = Point.ByCoordinates(x=x_min, y=y_mid, z=z_mid_4)
mid_3 = Point.ByCoordinates(x=x_mid, y=y_mid, z=curvature)
mid_4 = Point.ByCoordinates(x=x_max, y=y_mid, z=z_mid_2)
mid_5 = Point.ByCoordinates(x=x_mid, y=y_max, z=z_mid_3)

# group: Organizer
# Creates a list for The polyLine.
corner_point_list = List.Create(item0=P1, item1=P2, item2=P3, item3=P4)
row_1 = List.Create(item0=P1, item1=mid_1, item2=P2)
row_2 = List.Create(item0=mid_2, item1=mid_3, item2=mid_4)
row_3 = List.Create(item0=P4, item1=mid_5, item2=P3)
grid_organizer = List.Create(item0=row_1, item1=row_2, item2=row_3)

# group: Membrane and Tube Generators
# Creates the membrane and Tube Locations
code_block_4 = CodeBlock { true; }
membrane_generator = PolyCurve.ByPoints(points=corner_point_list, connectLastToFirst=code_block_4)
steel_tube_generator = Line.ByStartPointEndPoint(startPoint=P1, endPoint=P2)
steel_tube_generator_2 = Line.ByStartPointEndPoint(startPoint=P2, endPoint=P3)
steel_tube_generator_3 = Line.ByStartPointEndPoint(startPoint=P3, endPoint=P4)
steel_tube_generator_4 = Line.ByStartPointEndPoint(startPoint=P4, endPoint=p1_base)

# group: Steel Tube Maker
# Makes the steel Tubes
steel_tube_point_list = List.Create(item0=steel_tube_generator, item1=steel_tube_generator_2, item2=steel_tube_generator_3, item3=steel_tube_generator_4)
steel_tube_start = Curve.StartPoint(curve=steel_tube_point_list)
steel_tube_end = Curve.EndPoint(curve=steel_tube_point_list)
steel_tube_maker = Cylinder.ByPointsRadius(startPoint=steel_tube_start, endPoint=steel_tube_end, radius=diameter_calculator)
steel_tube_volume = Python(IN[0]=steel_tube_maker)  # PythonNet3
# ---------- steel_tube_volume.python (32 lines) ----------
# Load the Python Standard and DesignScript Libraries
import sys
import clr
clr.AddReference('ProtoGeometry')
from Autodesk.DesignScript.Geometry import *

# The inputs to this node will be stored as a list in the IN variables.
dataEnteringNode = IN

# Place your code below this line

tubes_in = IN[0]

if isinstance(tubes_in, list):
    tube_list = tubes_in
else:
    tube_list = [tubes_in]

total_volume = 0.0

for tube in tube_list:
    if tube is None:
        continue
    
    try:
        vol = tube.Volume
    except:
        continue
    
    total_volume = total_volume + vol

OUT = str(total_volume) + " mm^2"
# ----------------------------------------
steel_volume = Watch(steel_tube_volume)

# group: Membrane Maker
# Creates and gives from to the membrane
center_of_membrane_raiser = NurbsSurface.ByPoints(points=grid_organizer)
boolean = CodeBlock { false; }
membrane_maker = Surface.Thicken(surface=center_of_membrane_raiser, thickness=membrane_thickness, both_sides=boolean)
fabric_volume = Python(IN[0]=membrane_maker)  # PythonNet3
# ---------- fabric_volume.python (30 lines) ----------
# Load the Python Standard and DesignScript Libraries
import sys
import clr
clr.AddReference('ProtoGeometry')
from Autodesk.DesignScript.Geometry import *

# The inputs to this node will be stored as a list in the IN variables.
dataEnteringNode = IN

# Place your code below this line

panels_in = IN[0]

if isinstance(panels_in, list):
    panel_list = panels_in
else:
    panel_list = [panels_in]

total_volume = 0.0

for p in panel_list:
    if p is None:
        continue
    try:
        vol = p.Volume
        total_volume = total_volume + vol
    except:
        continue
        
OUT = OUT = str(total_volume) + " mm^2"
# ----------------------------------------
fabric_volume_2 = Watch(fabric_volume)
