# Dynamo graph 1869312.dyn "Start-1" (Dynamo 4.0.0.3277)

# group: Don't touch this ground
code_block = CodeBlock { -5000; -5000; -200; }
byCoordinates = Point.ByCoordinates(x=code_block.out0, y=code_block.out1, z=code_block.out2)
code_block_2 = CodeBlock { 5000; 5000; 0; }
byCoordinates_2 = Point.ByCoordinates(x=code_block_2.out0, y=code_block_2.out1, z=code_block_2.out2)
byCorners = Cuboid.ByCorners(lowPoint=byCoordinates, highPoint=byCoordinates_2)
code_block_3 = CodeBlock { 0; 100; 0; }
byARGB = Color.ByARGB(red=code_block_3.out0, green=code_block_3.out1, blue=code_block_3.out2)
byGeometryColor = Modifiers.GeometryColor.ByGeometryColor(geometry=byCorners, color=byARGB)

radius_of_circle = DoubleSlider(1650, range=10..2000 step 10)

# group: Steel Base Pillars
code_block_4 = CodeBlock { 350; }
byCoordinates_3 = Point.ByCoordinates(z=code_block_4)
code_block_5 = CodeBlock { 4000; }
byCenterPointRadius = Circle.ByCenterPointRadius(centerPoint=byCoordinates_3, radius=code_block_5)
number_slider = DoubleSlider(47, range=0..100 step 1)
code_block_6 = CodeBlock(N_Points=number_slider) { 0; 100; 0..1..1/N_Points; }
sequence = Sequence(start=code_block_6.out0, amount=code_block_6.out1, step=code_block_6.out2)
pointAtParameter = Curve.PointAtParameter(curve=byCenterPointRadius, param=sequence)
watch = Watch(pointAtParameter)
code_block_7 = CodeBlock { 1; }
allIndicesOf = List.AllIndicesOf(list=pointAtParameter, item=code_block_7)
removeItemAtIndex = List.RemoveItemAtIndex(list=pointAtParameter, indices=allIndicesOf)
watch_2 = Watch(removeItemAtIndex)
byCenterPointRadius_2 = Circle.ByCenterPointRadius(radius=code_block_5)
code_block_8 = CodeBlock(N_Points=number_slider) { 0; 100; 0..1..1/N_Points; }
sequence_2 = Sequence(start=code_block_8.out0, amount=code_block_8.out1, step=code_block_8.out2)
pointAtParameter_2 = Curve.PointAtParameter(curve=byCenterPointRadius_2, param=sequence_2)
code_block_9 = CodeBlock { 200; 100; 0; }
sequence_3 = Sequence(start=code_block_9.out0, amount=code_block_9.out1, step=code_block_9.out2)
steel_circular_rod = Python()  # PythonNet3; unwired: IN[0]
# ---------- steel_circular_rod.python (14 lines) ----------
import clr
clr.AddReference('ProtoGeometry')
from Autodesk.DesignScript.Geometry import *

class CircularRod:
    def __init__(self, bottom_point, top_point, radius):
        self.bottom = bottom_point
        self.top = top_point
        self.radius = radius

    def make_geometry(self):
        return Cylinder.ByPointsRadius(self.bottom, self.top, self.radius)

OUT = CircularRod
# ----------------------------------------
series_of_base_pillars = Python(IN[0]=removeItemAtIndex, IN[1]=pointAtParameter_2, IN[2]=sequence_3, IN[3]=steel_circular_rod)  # PythonNet3
# ---------- series_of_base_pillars.python (45 lines) ----------
import clr
from collections.abc import Iterable 

CircularRod = IN[3]
bottom_points_raw = IN[0]
top_points_raw = IN[1]
radii_raw = IN[2]

rods = []

def flatten(lst):
    result = []
    
 
    if isinstance(lst, Iterable) and not isinstance(lst, (str, bytes)):
        
        for item in lst: 
            is_dynamo_object = hasattr(item, 'X') or hasattr(item, 'Z')
            
            if isinstance(item, Iterable) and not isinstance(item, (str, bytes)) and not is_dynamo_object:
                result.extend(flatten(item))
            else:
                result.append(item)
    else:    
        result.append(lst)
        
    return result

bottom_points = flatten(bottom_points_raw)
top_points = flatten(top_points_raw)
radii = flatten(radii_raw)

count = min(len(bottom_points) if bottom_points else 0, 
            len(top_points) if top_points else 0)

for i in range(count):
    r = radii[i] if i < len(radii) else radii[-1]
    
    btm = bottom_points[i]
    top = top_points[i]
   
    rod = CircularRod(btm, top, r)
    rods.append(rod.make_geometry())
    
OUT = rods
# ----------------------------------------

max_radius = DoubleSlider(4000, range=4000..5000 step 10)
hive_height = DoubleSlider(5000, range=5000..8000 step 10)

# group: Base Shape (Revolved Shape)
code_block_10 = CodeBlock { y=0; z=0; }
starting_pt = Point.ByCoordinates(x=max_radius, y=code_block_10.y, z=code_block_10.z)
code_block_11 = CodeBlock(Max_R=max_radius, Hive_H=hive_height) { Max_R; Hive_H; x=Max_R*1.05; y=0; z=Hive_H*0.2; }
midpoint = Point.ByCoordinates(x=code_block_11.x, y=code_block_11.y, z=code_block_11.z)
code_block_12 = CodeBlock(Max_R=max_radius, Hive_H=hive_height) { Max_R; Hive_H; x=Max_R*0.9; y=0; z=Hive_H*0.5; }
curve_pt = Point.ByCoordinates(x=code_block_12.x, y=code_block_12.y, z=code_block_12.z)
code_block_13 = CodeBlock(Max_R=max_radius, Hive_H=hive_height) { Max_R; Hive_H; x=Max_R*0.6; y=0; z=Hive_H*0.8; }
shoulder = Point.ByCoordinates(x=code_block_13.x, y=code_block_13.y, z=code_block_13.z)
code_block_14 = CodeBlock(Hive_H=hive_height) { Hive_H; x=0; y=0; z=Hive_H; }
top_center_pt = Point.ByCoordinates(x=code_block_14.x, y=code_block_14.y, z=code_block_14.z)
hive_pts = List.Create(item0=starting_pt, item1=midpoint, item2=curve_pt, item3=shoulder, item4=top_center_pt)
hive_revolve_line = NurbsCurve.ByPoints(points=hive_pts)
degree = DoubleSlider(360, range=0..360 step 10)
base_shape_revolve = Surface.ByRevolve(profile=hive_revolve_line, sweepAngle=degree)

hexagon_side_length = DoubleSlider(100, range=100..300 step 5)

# group: Wooden Dome Creation(Triangle, Square, Hexagon or Circles)
grid_pts_of_dome_shape = Python(IN[0]=base_shape_revolve, IN[1]=hive_height, IN[2]=hexagon_side_length, IN[3]=max_radius)  # PythonNet3
# ---------- grid_pts_of_dome_shape.python (62 lines) ----------
import clr
clr.AddReference('ProtoGeometry')
from Autodesk.DesignScript.Geometry import *
import math

surface = IN[0]          
Hive_H = IN[1]           
Hex_Side_L = IN[2]       
Max_R = IN[3]           

class SurfacePointGrid:
    def __init__(self, surface, Hive_H, Hex_Side_L, Max_R):
        self.surface = surface
        self.Hive_H = Hive_H
        self.Hex_Side_L = Hex_Side_L
        self.Max_R = Max_R

    def compute_steps(self):
        U = self.Hive_H / self.Hex_Side_L
        V = (2 * math.pi * self.Max_R) / self.Hex_Side_L

        step_U = 5.0 / U   
        step_V = 9.0 / V   

        return step_U, step_V

    def generate_uv_params(self):
        step_U, step_V = self.compute_steps()

        u_vals = []
        v_vals = []

        u = 0.0
        while u <= 1.0 + 1e-6:
            u_vals.append(u)
            u += step_U

        v = 0.0
        while v <= 1.0 + 1e-6:
            v_vals.append(v)
            v += step_V

        if u_vals[-1] > 1.0:
            u_vals[-1] = 1.0
        if v_vals[-1] > 1.0:
            v_vals[-1] = 1.0

        return u_vals, v_vals

    def generate_points(self):
        u_params, v_params = self.generate_uv_params()
        points = []

        for u in u_params:
            for v in v_params:
                pt = self.surface.PointAtParameter(u, v)
                points.append(pt)

        return points

grid = SurfacePointGrid(surface, Hive_H, Hex_Side_L, Max_R)
OUT = grid.generate_points()
# ----------------------------------------
watch_3 = Watch(grid_pts_of_dome_shape)
shape_changer = IntegerSlider(5, range=3..16 step 1)
radius_of_circle_2 = DoubleSlider(400, range=10..500 step 10)
length_of_extrusion = DoubleSlider(500, range=0..500 step 10)
thickness = DoubleSlider(100, range=0..200 step 10)
normal_of_surface_for_each_pt = Surface.NormalAtPoint(surface=base_shape_revolve, point=grid_pts_of_dome_shape)
circles_on_pt = Circle.ByCenterPointRadiusNormal(centerPoint=grid_pts_of_dome_shape, radius=radius_of_circle_2, normal=normal_of_surface_for_each_pt)
hexagons = Polygon.RegularPolygon(circle=circles_on_pt, numberSides=shape_changer)
extrude = Curve.Extrude(curve=hexagons, distance=length_of_extrusion)
thickness_of_shapes = Surface.Thicken(surface=extrude, thickness=thickness)

# group: Volumes
volume_of_dome_with_whatever = Python(IN[0]=shape_changer, IN[1]=radius_of_circle_2, IN[2]=length_of_extrusion, IN[3]=thickness)  # "Volume of Dome (with whatever shape)"; PythonNet3
# ---------- volume_of_dome_with_whatever.python (38 lines) ----------
import clr
clr.AddReference('ProtoGeometry')
from Autodesk.DesignScript.Geometry import *
import math

NUM_EDGES = IN[0]          
RADIUS = IN[1]             
EXTRUSION_LENGTH = IN[2]    
THICKNESS = IN[3]         

NUM_EDGES = 0 if NUM_EDGES is None else int(NUM_EDGES)
RADIUS = 1.0 if RADIUS is None else float(RADIUS)
EXTRUSION_LENGTH = 1.0 if EXTRUSION_LENGTH is None else float(EXTRUSION_LENGTH)
THICKNESS = 0.0 if THICKNESS is None else float(THICKNESS)

def polygon_area(n, r):
    if n == 0 or n >=7:
        return math.pi * r * r
    else:
        return (n * r * r * math.sin(2 * math.pi / n)) / 2

def polygon_perimeter(n, r):
    if n == 0:
        return 2 * math.pi * r
    else:
        side_length = 2 * r * math.sin(math.pi / n)
        return n * side_length                       

cross_section_area = polygon_area(NUM_EDGES, RADIUS)
base_volume = cross_section_area * EXTRUSION_LENGTH

perimeter = polygon_perimeter(NUM_EDGES, RADIUS)
surface_area = perimeter * EXTRUSION_LENGTH + 2 * cross_section_area

thickening_volume = surface_area * THICKNESS
total_volume = base_volume + thickening_volume

OUT = total_volume 
# ----------------------------------------
volume_by_mm_3 = Watch(volume_of_dome_with_whatever)
volume_of_base_pillars = Python(IN[0]=removeItemAtIndex, IN[1]=pointAtParameter_2, IN[2]=sequence_3)  # PythonNet3
# ---------- volume_of_base_pillars.python (52 lines) ----------
import math
from collections.abc import Iterable

bottom_points_raw = IN[0] if len(IN) > 0 and IN[0] is not None else []
top_points_raw    = IN[1] if len(IN) > 1 and IN[1] is not None else []
radii_raw        = IN[2] if len(IN) > 2 and IN[2] is not None else []
num_edges        = IN[3] if len(IN) > 3 and IN[3] is not None else 0 

def flatten(lst):
    result = []
    if isinstance(lst, Iterable) and not isinstance(lst, (str, bytes)):
        for item in lst:
            is_point = hasattr(item, "X") and hasattr(item, "Y") and hasattr(item, "Z")
            if isinstance(item, Iterable) and not isinstance(item, (str, bytes)) and not is_point:
                result.extend(flatten(item))
            else:
                result.append(item)
    else:
        result.append(lst)
    return result

def polygon_area(n, r):
    if n == 0:
        return math.pi * r * r
    else:
        return (n * r * r * math.sin(2 * math.pi / n)) / 2

bottom_points = [pt for pt in flatten(bottom_points_raw) if pt is not None]
top_points    = [pt for pt in flatten(top_points_raw) if pt is not None]
radii         = [r for r in flatten(radii_raw) if r is not None]

if not radii:
    radii = [1.0]

total_volume = 0.0
count = min(len(bottom_points), len(top_points))

for i in range(count):
    btm = bottom_points[i]
    top = top_points[i]
    r = radii[i] if i < len(radii) else radii[-1]

    dx = top.X - btm.X
    dy = top.Y - btm.Y
    dz = top.Z - btm.Z
    h = math.sqrt(dx*dx + dy*dy + dz*dz)

    area = polygon_area(num_edges, r)
    vol = area * h
    total_volume += vol

OUT = total_volume
# ----------------------------------------
volume_by_mm_3_2 = Watch(volume_of_base_pillars)
code_block_15 = CodeBlock(Vol_Dome=volume_by_mm_3, Vol_PillarBase=volume_by_mm_3_2) { Vol_Dome; Vol_PillarBase; Total_Vol = Vol_Dome + Vol_PillarBase; }
watch_4 = Watch(code_block_15.Total_Vol)

# group: Entrance creation (Difference)
code_block_16 = CodeBlock(Hive_H=hive_height) { z = Hive_H+100; }
byCoordinates_4 = Point.ByCoordinates(z=code_block_16)
byCoordinates_5 = Point.ByCoordinates()
radius_of_circle_3 = DoubleSlider(1650, range=10..2000 step 10)
byPointsRadius = Cylinder.ByPointsRadius(startPoint=byCoordinates_4, endPoint=byCoordinates_5, radius=radius_of_circle_3)
code_block_17 = CodeBlock { 0; 5000; 500; }
byCoordinates_6 = Point.ByCoordinates(y=code_block_17.out1, z=code_block_17.out2)
code_block_18 = CodeBlock { 0; -5000; }
byCoordinates_7 = Point.ByCoordinates(y=code_block_18.out1, z=code_block_17.out2)
radius_of_circle_4 = DoubleSlider(1650, range=10..2000 step 10)
byPointsRadius_2 = Cylinder.ByPointsRadius(startPoint=byCoordinates_6, endPoint=byCoordinates_7, radius=radius_of_circle_4)
union = Solid.Union(solid=byPointsRadius, solid_2=byPointsRadius_2)
code_block_19 = CodeBlock { -1000; }
byCoordinates_8 = Point.ByCoordinates(z=code_block_19)
code_block_20 = CodeBlock { 10000; }
number_slider_2 = DoubleSlider(-1730, range=-5000..0 step 10)
byLengths = Cuboid.ByLengths(origin=byCoordinates_8, width=code_block_20, length=code_block_20, height=number_slider_2)
union_2 = Solid.Union(solid=union, solid_2=byLengths)

final_shape = Solid.DifferenceAll(solid=thickness_of_shapes, others=union_2)
color_palette = ColorPalette({R: 154, G: 114, B: 3, A: 255})
byGeometryColor_2 = Modifiers.GeometryColor.ByGeometryColor(geometry=final_shape, color=color_palette)
color_palette_2 = ColorPalette({R: 152, G: 152, B: 152, A: 255})
byGeometryColor_3 = Modifiers.GeometryColor.ByGeometryColor(geometry=series_of_base_pillars, color=color_palette_2)
