# Dynamo graph 1869702.dyn (Dynamo 4.0.0.3277)

# group: Don't touch this ground
code_block = CodeBlock { -5000; -5000; -200; }
byCoordinates = Point.ByCoordinates(x=code_block.out0, y=code_block.out1, z=code_block.out2)
code_block_2 = CodeBlock { 5000; 5000; 0; }
byCoordinates_2 = Point.ByCoordinates(x=code_block_2.out0, y=code_block_2.out1, z=code_block_2.out2)
byCorners = Cuboid.ByCorners(lowPoint=byCoordinates, highPoint=byCoordinates_2)
code_block_3 = CodeBlock { 0; 100; 0; }
byARGB = Color.ByARGB(red=code_block_3.out0, green=code_block_3.out1, blue=code_block_3.out2)
byGeometryColor = Modifiers.GeometryColor.ByGeometryColor(geometry=byCorners, color=byARGB)

timber_beam_and_steel_rod = Python()  # PythonNet3; unwired: IN[0]
# ---------- timber_beam_and_steel_rod.python (61 lines) ----------
# Load the Python Standard and DesignScript Libraries
import sys
import clr
clr.AddReference('ProtoGeometry')
from Autodesk.DesignScript.Geometry import *
import math

#timberbeam class
class TimberBeam:
    #Rectangular timber beam, runs everytime a new timber beam object is created
    def __init__(self, start_pt, end_pt, width, thickness):
        self.start = start_pt
        self.end = end_pt
        self.width = width
        self.thickness = thickness
        #Geometry initially is nothing
        self._geom = None

    #Compute length between two points, pick the larger width/thickness then converts that into radius of the cylinder
    def create_geometry(self):
        length = self.start.DistanceTo(self.end)
        radius = max(self.width, self.thickness)/2.0
        #Creates a cylindrical beam
        cyl = Cylinder.ByPointsRadius(self.start, self.end, radius)
        #Save the cylinder in _geom
        self._geom = cyl
        return self._geom #Return geometry

    #Volume of Cylinder calculations
    def volume(self):
        length = self.start.DistanceTo(self.end)
        radius = max(self.width, self.thickness)/2.0
        return math.pi * radius**2 * length

#Steelrodclass, same idea as the timberbeam class but now steel rod
class SteelRod:
    #Circular Steel Rod
    def __init__(self, start_pt, end_pt, diameter):
        self.start = start_pt
        self.end = end_pt
        self.diameter = diameter
        self._geom = None

    #compute the radius then creates a cylinder storing it in _geom
    def create_geometry(self):
        radius = self.diameter/2.0
        cyl = Cylinder.ByPointsRadius(self.start, self.end, radius)
        self._geom = cyl
        return self._geom

    #Volume calculation as it is a cylinder
    def volume(self):
        length = self.start.DistanceTo(self.end)
        r = self.diameter/2.0
        return math.pi * r**2 * length

#Output a dictionary to call in the second python code block
OUT = {
    "TimberBeam": TimberBeam,
    "SteelRod": SteelRod
}
# ----------------------------------------
number_of_radial_rods = DoubleSlider(20, range=10..40 step 1)
code_block_4 = CodeBlock { ringnum=9; r=5000; }
height_of_dome = DoubleSlider(3000, range=2500..3000 step 100)
thickness_of_timberbeam = DoubleSlider(750, range=650..750 step 50)
diameter_of_steel_rods = DoubleSlider(70, range=50..100 step 10)
instances_of_timberbeam_and = Python(IN[0]=timber_beam_and_steel_rod, IN[1]=number_of_radial_rods, IN[2]=code_block_4.ringnum, IN[3]=height_of_dome, IN[4]=thickness_of_timberbeam, IN[5]=diameter_of_steel_rods, IN[6]=code_block_4.r)  # "Instances of TimberBeam and SteelRods, volume calculations"; PythonNet3
# ---------- instances_of_timberbeam_and.python (135 lines) ----------
import sys
import clr
clr.AddReference('ProtoGeometry')
from Autodesk.DesignScript.Geometry import * 
import math

#Note to self: For some reason it reads a float? which shouldn't happen? Maybe I fixed it before but just incase keep int.

#Inputs
class_dict = IN[0]
num_radials = int(IN[1])  #convert to integer for loops
num_rings = int(IN[2])    #convert to integer for loops
dome_height = IN[3]
beam_thickness = IN[4]
rod_diameter = IN[5]
footprint_radius = IN[6]

#Calling the dictionary to know the premade class
TimberBeam = class_dict["TimberBeam"]
SteelRod = class_dict["SteelRod"]

geometry_list = []
timber_instances = []
steel_instances = []
beam_midpoints = []
midpoint_angles = []

#Makes sure that the ground rings are at z=0
ground_radius = footprint_radius

#Compute concentric ring radii, making sure ring isn't rad=0 and from touching the outer footprint (5000), distributing rings evenly between the center and the boundary. This is interior dome rings which doesn't include the ground ring at z=0
interior_rings = [footprint_radius*(i+1)/(num_rings+1) for i in range(num_rings)]

#Actual list of rings all together, ground to interior then to the max
ring_radii = [ground_radius] + interior_rings

#Dome height function, at center (r=0) height is the slider value "dome_height" but at the very edge (r=footprint_radius) it'll be 0 giving a smooth decrease in height following a shape of a parabola.
def dome_z(r):
   if r==footprint_radius:
       return 0 #Ground level
   return dome_height*(1 - (r/footprint_radius)**2)

#Timber beams: circular ring made of many straight beams
#take the last value of interior_rings which will act as the outermost ring's radius
outer_radius = interior_rings[-1]
#Circle divided into many small segments always 50 or half the num_radials whichever is larger. Creating a smooth and not blocky ring.
num_edge_segments = max(50, int(num_radials / 2))

#Each loop will create one beam segment
for k in range(num_edge_segments):
    #Mark two adjacent points on the circle using angles where theta1 represents starting angle of segment k and theta2 is ending angle
    theta1 = 2 * math.pi * k / num_edge_segments
    theta2 = 2 * math.pi * (k + 1) / num_edge_segments
    
    #x and y coordinates of the two ends of the beam, converts theta1 and theta2 to coordinates on a cirle, giving two endpoints of a beam that sits on the outer circle
    x1, y1 = outer_radius * math.cos(theta1), outer_radius * math.sin(theta1)
    x2, y2 = outer_radius * math.cos(theta2), outer_radius * math.sin(theta2)

    #Making it so that the beam's bottom sits at z=0 and its center is at z=beam_radius, making sure that the timber beam doesn't sit below the z axis aka negative value therefore touching the "Don't touch this ground"
    radius = beam_thickness / 2.0
    z_beam = radius
    
    #Create two points that define the endpoints of each small beam piece
    p1 = Point.ByCoordinates(x1, y1, z_beam)
    p2 = Point.ByCoordinates(x2, y2, z_beam)

    #Create a straight cylindrical beam between the points then storing the geometry to call later
    beam = TimberBeam(p1, p2, beam_thickness, beam_thickness)
    geometry_list.append(beam.create_geometry())
    timber_instances.append(beam)
    
    #Midpoint calculation to be used as the initial points where the steel rods will be formed from
    mid_x = (x1 + x2)/2
    mid_y = (y1 + y2)/2
    mid_z = z_beam
    mid = Point.ByCoordinates(mid_x, mid_y, mid_z)
    beam_midpoints.append(mid)

#Steel Rods: They come out of the midpoints calculated above making the dome shape
#List of points, which then computes the angle of the point measured from the origin 
for mid in beam_midpoints:
    midpoint_angles.append(math.atan2(mid.Y, mid.X))

#Outer loop that creates radial rods around the dome
for i in range(num_radials):
    
    #Gives the angle where the i-th radial would be if all the radials are equally spaced 
    theta = 2 * math.pi * i / num_radials

    #find the angle difference between midpoints and target radial angle computing the smallest wrapped angular difference between the two so that the comparison works correctly even across the entire circle (0 to 360 degrees). Always picking the shortest direction and ensures that the difference is always between 0 and pi.
    diffs = [(abs((a - theta + math.pi) % (2 * math.pi) - math.pi), idx)
             for idx, a in enumerate(midpoint_angles)]
             
    #finds the tuple with the smallest angular difference, where best_index indexes in midpoint_angles of the beams whose midpoints is closest to the radial's target angle. Ensuring that each radial aligns with the nearest beam midpoint rather than being placed at uniform angles keeping the structure of the dome consistent with the geometry of the beams
    _, best_index = min(diffs)

    #Simply picks the beam midpoint whose angle was closest to the radial's target angle and uses that midpoint as the starting point for the radial
    p_start = beam_midpoints[best_index]
    
    
    #NOTE: This isn't what I fully imagined however this creates the same idea I wanted but not fully what I imagined. It is outside my knowledge on how to fully fix and so I am deciding to keep it and to me it creates character for the build. The three steel rods is not on purpose however it is this line of code that creates it and it isn't on purpose
    
    #Goes through each radius value in ring_radii starting from the midpoint chosen earlier "p_start". For each ring it calculates the next point "p_end" that lies along the same angular direction but at a larger radius using cos and sin to place it on the dome surface and giving it the correct height. Once it reaches the final ring it uses the top of the dome as the final endpoint. 
    for j, r in enumerate (ring_radii):    
        if j < len(ring_radii)-1:
            r_next=ring_radii[j+1]
            x2=r_next*math.cos(theta)
            y2=r_next*math.sin(theta)
            z2=dome_z(r_next)
        else:
            x2,y2,z2 = 0,0,dome_height
        
        #End point
        p_end=Point.ByCoordinates(x2,y2,z2)
        
        #Creates a steel rod from p_start to this new end point "p_end"
        rod=SteelRod(p_start, p_end, rod_diameter)
        geometry_list.append(rod.create_geometry())
        steel_instances.append(rod)
        
        #so the next rod segment continues upward from the point just created creating one continuous radial rod from the timberbeam midpoint to the dome's peak
        p_start = p_end
        
#Calculate total volumes
total_timber_vol = sum([b.volume() for b in timber_instances])
total_steel_vol = sum([s.volume() for s in steel_instances])

#output a dictionary to call later, maybe change into list later??
OUT = {
    "geometry": geometry_list,
    "timber_volume_mm3": total_timber_vol,
    "steel_volume_mm3": total_steel_vol,
    "timber_instances": timber_instances,
    "steel_instances": steel_instances
}
# ----------------------------------------
string = StringInput("geometry")
valueAtKey = DesignScript.Builtin.Dictionary.ValueAtKey(dictionary=instances_of_timberbeam_and, key=string)
code_block_5 = CodeBlock { x=5100; y=0; z=0; }
byCoordinates_3 = Point.ByCoordinates(x=code_block_5.x, y=code_block_5.y, z=code_block_5.z)
code_block_6 = CodeBlock { x=-5100; y=0; z=0; }
byCoordinates_4 = Point.ByCoordinates(x=code_block_6.x, y=code_block_6.y, z=code_block_6.z)
code_block_7 = CodeBlock { r_cyl=500; }
byPointsRadius = Cylinder.ByPointsRadius(startPoint=byCoordinates_3, endPoint=byCoordinates_4, radius=code_block_7)
difference = Solid.Difference(solid=valueAtKey, other=byPointsRadius)
code_block_8 = CodeBlock { x=0; y=5100; z=0; }
byCoordinates_5 = Point.ByCoordinates(x=code_block_8.x, y=code_block_8.y, z=code_block_8.z)
code_block_9 = CodeBlock { x=0; y=-5100; z=0; }
byCoordinates_6 = Point.ByCoordinates(x=code_block_9.x, y=code_block_9.y, z=code_block_9.z)
code_block_10 = CodeBlock { r_cyl=500; }
byPointsRadius_2 = Cylinder.ByPointsRadius(startPoint=byCoordinates_5, endPoint=byCoordinates_6, radius=code_block_10)
creates_the_entrances_for_the = Solid.Difference(solid=difference, other=byPointsRadius_2)  # "Creates the entrances for the pavillion"
string_2 = StringInput("timber_volume_mm3")
valueAtKey_2 = DesignScript.Builtin.Dictionary.ValueAtKey(dictionary=instances_of_timberbeam_and, key=string_2)
outer_timberbeam_volume = Watch(valueAtKey_2)
string_3 = StringInput("steel_volume_mm3")
valueAtKey_3 = DesignScript.Builtin.Dictionary.ValueAtKey(dictionary=instances_of_timberbeam_and, key=string_3)
steel_volume = Watch(valueAtKey_3)
central_beam = Python(IN[0]=timber_beam_and_steel_rod, IN[1]=height_of_dome, IN[2]=thickness_of_timberbeam)  # PythonNet3
# ---------- central_beam.python (34 lines) ----------
# Load the Python Standard and DesignScript Libraries
import sys
import clr
clr.AddReference('ProtoGeometry')
from Autodesk.DesignScript.Geometry import *
import math

#Inputs
class_dict = IN[0]
dome_height = IN[1]
beam_thickness = IN[2]

TimberBeam = class_dict["TimberBeam"]

geometry_list = []
timber_instances = []

#From the middlepoint (0,0,0) to the apex (z=dome_height) create a beam with beam_thickness to act like a support under the timberbeam class
p_start = Point.ByCoordinates(0,0,0)
p_end = Point.ByCoordinates(0,0,dome_height)
center_beam = TimberBeam(p_start,p_end,600,beam_thickness)
beam_geo = center_beam.create_geometry()
geometry_list.append(beam_geo)
timber_instances.append(center_beam)

#Volume calculation for this shape only
total_timber_vol = [b.volume() for b in timber_instances]

#Dictionary to call, primarily care about volume and geometry
OUT = {
    "geometry": geometry_list,
    "timber_instances":  timber_instances,
    "timber_volume_mm3": total_timber_vol,
}
# ----------------------------------------
string_4 = StringInput("timber_volume_mm3")
valueAtKey_4 = DesignScript.Builtin.Dictionary.ValueAtKey(dictionary=central_beam, key=string_4)
volume_of_timber_center = Watch(valueAtKey_4)
string_5 = StringInput("geometry")
valueAtKey_5 = DesignScript.Builtin.Dictionary.ValueAtKey(dictionary=central_beam, key=string_5)
code_block_11 = CodeBlock { x=0; y=0; z=0; r=5000; }
byCoordinates_7 = Point.ByCoordinates(x=code_block_11.x, y=code_block_11.y, z=code_block_11.z)
byCenterPointRadius = Circle.ByCenterPointRadius(centerPoint=byCoordinates_7, radius=code_block_11.r)
