# Dynamo graph 1869722.dyn (Dynamo 3.6.0.9395)

# group: Main shape (timber beams)
# I would not be able to generate the volume since it is an open shape
code_block = CodeBlock()
# ---------- code_block.designscript (8 lines) ----------
pts =
[
    Point.ByCoordinates(0, 0, 0),
    Point.ByCoordinates(500, 200, 0),
    Point.ByCoordinates(1000, 300, 0),
    Point.ByCoordinates(1500, 400, 0),
    Point.ByCoordinates(2000, 4000, 0)
];
# ----------------------------------------
byPoints = NurbsCurve.ByPoints(points=code_block)
pointAtParameter = Curve.PointAtParameter(curve=byPoints)
code_block_2 = CodeBlock { 1000; 180; 360; }
tangentAtParameter = Curve.TangentAtParameter(curve=byPoints)
byCenterPointRadiusAngle = Arc.ByCenterPointRadiusAngle(center=pointAtParameter, radius=code_block_2.out0, startAngle=code_block_2.out1, endAngle=code_block_2.out2, normal=tangentAtParameter)
bySweep = Surface.BySweep(profile=byCenterPointRadiusAngle, path=byPoints)
pointAtParameter_2 = Surface.PointAtParameter(surface=bySweep)
perimeterCurves = Surface.PerimeterCurves()  # unwired: surface

# group: Main shape (timber beams) > Wavy Curve
N = DoubleSlider(200, range=10..200 step 10)
amplitude = DoubleSlider(0.1, range=0..0.5 step 0.1)
frequency = DoubleSlider(2, range=1..10 step 1)
code_block_3 = CodeBlock(N=N, Amplitude=amplitude, Frequency=frequency) { t = 0..1..#N; u = t; v = 0.5 + Amplitude * Math.Sin(2*Math.PI*Frequency*t); u; v; }
M = DoubleSlider(30, range=3..30 step 10)
python_script = Python(IN[0]=bySweep, IN[1]=N, IN[2]=M, IN[3]=amplitude, IN[4]=frequency)  # CPython3
# ---------- python_script.python (67 lines) ----------
# Load the Python Standard and DesignScript Libraries
import sys
import clr
clr.AddReference('ProtoGeometry')
from Autodesk.DesignScript.Geometry import *

import clr
import math

# Import Dynamo geometry library
clr.AddReference('ProtoGeometry')
from Autodesk.DesignScript.Geometry import *


surface   = IN[0]    
N         = IN[1]    
M         = IN[2]    
Amplitude = IN[3]    
Frequency = IN[4]    


def clamp(v, vmin=0.0, vmax=1.0):
    return max(vmin, min(vmax, v))


N = max(int(N), 2)
M = max(int(M), 1)

all_rows_pts = []   
all_curves   = []   

for i in range(M):
    
    if M == 1:
        v_base = 0.5
    else:
        v_base = float(i) / float(M - 1)

    row_pts = []

    for j in range(N):
        
        if N == 1:
            t = 0.0
        else:
            t = float(j) / float(N - 1)

        u = t

        
        v_offset = Amplitude * math.sin(2.0 * math.pi * Frequency * t)

        
        v = clamp(v_base + v_offset, 0.0, 1.0)

        
        pt = surface.PointAtParameter(u, v)
        row_pts.append(pt)

    all_rows_pts.append(row_pts)

   
    crv = NurbsCurve.ByPoints(row_pts)
    all_curves.append(crv)


OUT = [all_rows_pts, all_curves]
# ----------------------------------------

# group: Don't touch this ground
code_block_4 = CodeBlock {  }
code_block_5 = CodeBlock { -5000; -5000; -200; }  # frozen
byCoordinates = Point.ByCoordinates(x=code_block_5.out0, y=code_block_5.out1, z=code_block_5.out2)  # frozen
code_block_6 = CodeBlock { 5000; 5000; 0; }  # frozen
byCoordinates_2 = Point.ByCoordinates(x=code_block_6.out0, y=code_block_6.out1, z=code_block_6.out2)  # frozen
byCorners = Cuboid.ByCorners(lowPoint=byCoordinates, highPoint=byCoordinates_2)  # frozen
code_block_7 = CodeBlock { 0; 100; 0; }  # frozen
byARGB = Color.ByARGB(red=code_block_7.out0, green=code_block_7.out1, blue=code_block_7.out2)  # frozen
byGeometryColor = Modifiers.GeometryColor.ByGeometryColor(geometry=byCorners, color=byARGB)  # frozen

# group: Gates and Borders (steel panels)
perimeterCurves_2 = Surface.PerimeterCurves(surface=bySweep)
byJoinedCurves = PolyCurve.ByJoinedCurves(curves=perimeterCurves_2)
ZAxis = Vector.ZAxis()
code_block_8 = CodeBlock { 5; }
translate = Geometry.Translate(geometry=byJoinedCurves, direction=ZAxis, distance=code_block_8)
code_block_9 = CodeBlock { 0; }
pointAtParameter_3 = Curve.PointAtParameter(curve=byPoints, param=code_block_9)
code_block_10 = CodeBlock { 1000; 180; 360; }
tangentAtParameter_2 = Curve.TangentAtParameter(curve=byPoints, param=code_block_9)
byCenterPointRadiusAngle_2 = Arc.ByCenterPointRadiusAngle(center=pointAtParameter_3, radius=code_block_10.out0, startAngle=code_block_10.out1, endAngle=code_block_10.out2, normal=tangentAtParameter_2)
code_block_11 = CodeBlock { 1; }
pointAtParameter_4 = Curve.PointAtParameter(curve=byPoints, param=code_block_11)
tangentAtParameter_3 = Curve.TangentAtParameter(curve=byPoints, param=code_block_11)
byCenterPointRadiusAngle_3 = Arc.ByCenterPointRadiusAngle(center=pointAtParameter_4, radius=code_block_10.out0, startAngle=code_block_10.out1, endAngle=code_block_10.out2, normal=tangentAtParameter_3)
list_create = List.Create(item0=byCenterPointRadiusAngle_2, item1=byCenterPointRadiusAngle_3, item2=byJoinedCurves)
steel_radius = DoubleSlider(150, range=50..300 step 10)
python_script_2 = Python(IN[0]=list_create, IN[1]=steel_radius)  # CPython3
# ---------- python_script_2.python (46 lines) ----------
# Load the Python Standard and DesignScript Libraries
import sys
import clr
clr.AddReference('ProtoGeometry')
from Autodesk.DesignScript.Geometry import *

import clr
import math
clr.AddReference('ProtoGeometry')
from Autodesk.DesignScript.Geometry import *


geo_in = IN[0]
radius = float(IN[1])   

def flatten(data):
    result = []
    if isinstance(data, (list, tuple)):
        for x in data:
            result.extend(flatten(x))
    elif data is not None:
        result.append(data)
    return result

curves = flatten(geo_in)


lengths = []
for c in curves:
    try:
        L = c.Length   
        lengths.append(L)
    except:
        pass

total_length = sum(lengths) if lengths else 0.0


area = math.pi * radius * radius

total_volume_mm3 = area * total_length


summary = "Material 2 (Steel) Volume = {:.2f} mm³".format(total_volume_mm3)

OUT = [lengths, total_length, total_volume_mm3, summary]
# ----------------------------------------
VOLUME = Watch(python_script_2)
