# Dynamo graph 1869723.dyn (Dynamo 3.6.0.9395)

# group: Don't touch this ground
code_block = CodeBlock { -5000; -5000; -200; }  # frozen
byCoordinates = Point.ByCoordinates(x=code_block.out0, y=code_block.out1, z=code_block.out2)  # frozen
code_block_2 = CodeBlock { 5000; 5000; 0; }  # frozen
byCoordinates_2 = Point.ByCoordinates(x=code_block_2.out0, y=code_block_2.out1, z=code_block_2.out2)  # frozen
byCorners = Cuboid.ByCorners(lowPoint=byCoordinates, highPoint=byCoordinates_2)  # frozen
code_block_3 = CodeBlock { 0; 100; 0; }  # frozen
byARGB = Color.ByARGB(red=code_block_3.out0, green=code_block_3.out1, blue=code_block_3.out2)  # frozen
byGeometryColor = Modifiers.GeometryColor.ByGeometryColor(geometry=byCorners, color=byARGB)  # frozen

byCoordinates_3 = Point.ByCoordinates()
code_block_4 = CodeBlock { 10000; 10000; 10; }
# note: Due to the ground plane not displaying when importing start.dyn, I recreated the required 10 m × 10 m site surface to ensure the correct footprint boundary is maintained.
# The reconstructed plane follows the exact dimensions specified in the assignment.
byLengths = Cuboid.ByLengths(origin=byCoordinates_3, width=code_block_4.out0, length=code_block_4.out1, height=code_block_4.out2)
coordinate = CodeBlock { 0; 45; 100; }
sequence = Sequence(start=coordinate.out0, amount=coordinate.out1, step=coordinate.out2)
coordinate_2 = CodeBlock { 4500; 0; }
coordination_point = Point.ByCoordinates(x=sequence, y=coordinate_2.out0, z=coordinate_2.out1)
coordinate_3 = CodeBlock { 1000; 4000; }
coordination_point_2 = Point.ByCoordinates(x=sequence, y=coordinate_3.out0, z=coordinate_3.out1)
radius_of_cylinders = DoubleSlider(105, range=50..300 step 5)
coordinate_4 = CodeBlock(n=radius_of_cylinders) { n; 45; 0; }
sequence_2 = Sequence(start=coordinate_4.n, amount=coordinate_4.out1, step=coordinate_4.out2)
circular_rod = Python()  # CPython3; unwired: IN[0]
# ---------- circular_rod.python (20 lines) ----------
# Load the Python Standard and DesignScript Libraries
import sys
import clr
clr.AddReference('ProtoGeometry')
from Autodesk.DesignScript.Geometry import *
import math

class Circularrod:
    def __init__(self, bottom_point, top_point, radius):
        self.bottom = bottom_point
        self.top = top_point
        self.radius = radius
        
    def make_geometry(self):
        return Cylinder.ByPointsRadius(self.bottom, self.top, self.radius) 
    def measure_volume(self):
        height = self.bottom.DistanceTo(self.top)
        return math.pi * (self.radius ** 2) * height  
        
OUT = Circularrod
# ----------------------------------------
left_wall = Python(IN[0]=coordination_point, IN[1]=coordination_point_2, IN[2]=sequence_2, IN[3]=circular_rod)  # CPython3
# ---------- left_wall.python (21 lines) ----------
Circularrod = IN[3]
bottom_points = IN[0]
top_points = IN[1]
radii = IN[2]

rods = []
count = min(len(bottom_points),len(top_points))
volumes = []  # collect volumes (in source units)

for i in range(count):
    r = radii[i] if i <len(radii) else radii[-1]
    btm = bottom_points[i]
    top = top_points[i]
    
    rod = Circularrod(btm, top, r)
    rods.append(rod.make_geometry())
    vol = rod.measure_volume()        # <-- thêm dòng này (tính volume theo unit source)
    volumes.append(vol)               # <-- lưu volume cho mỗi instance

    OUT = rods,volumes
    
# ----------------------------------------
coordinate_5 = CodeBlock { 0; 45; 100; }
sequence_3 = Sequence(start=coordinate_5.out0, amount=coordinate_5.out1, step=coordinate_5.out2)
coordinate_6 = CodeBlock { -4000; 5000; }
coordination_point_3 = Point.ByCoordinates(x=sequence_3, y=coordinate_6.out0, z=coordinate_6.out1)
coordinate_7 = CodeBlock { 00; 4600; }
coordination_point_4 = Point.ByCoordinates(x=sequence_3, y=coordinate_7.out0, z=coordinate_7.out1)
radius_of_cylinders_2 = DoubleSlider(50, range=20..300 step 5)
coordinate_8 = CodeBlock(n=radius_of_cylinders_2) { n; 45; 0; }
sequence_4 = Sequence(start=coordinate_8.n, amount=coordinate_8.out1, step=coordinate_8.out2)
circular_rod_2 = Python()  # CPython3; unwired: IN[0]; same code as circular_rod
top_panel = Python(IN[0]=coordination_point_3, IN[1]=coordination_point_4, IN[2]=sequence_4, IN[3]=circular_rod_2)  # CPython3; same code as left_wall
coordinate_9 = CodeBlock { 0; 45; 100; }
sequence_5 = Sequence(start=coordinate_9.out0, amount=coordinate_9.out1, step=coordinate_9.out2)
coordinate_10 = CodeBlock { 1000; 4000; }
coordination_point_5 = Point.ByCoordinates(x=sequence_5, y=coordinate_10.out0, z=coordinate_10.out1)
coordinate_11 = CodeBlock { 00; 4600; }
coordination_point_6 = Point.ByCoordinates(x=sequence_5, y=coordinate_11.out0, z=coordinate_11.out1)
radius_of_cylinders_3 = DoubleSlider(90, range=20..300 step 5)
coordinate_12 = CodeBlock(n=radius_of_cylinders_3) { n; 45; 0; }
sequence_6 = Sequence(start=coordinate_12.n, amount=coordinate_12.out1, step=coordinate_12.out2)
circular_rod_3 = Python()  # CPython3; unwired: IN[0]; same code as circular_rod
top_left_panel = Python(IN[0]=coordination_point_5, IN[1]=coordination_point_6, IN[2]=sequence_6, IN[3]=circular_rod_3)  # CPython3; same code as left_wall
coordinate_13 = CodeBlock { 0; 45; 100; }
sequence_7 = Sequence(start=coordinate_13.out0, amount=coordinate_13.out1, step=coordinate_13.out2)
coordinate_14 = CodeBlock { -4000; 0; }
coordination_point_7 = Point.ByCoordinates(x=sequence_7, y=coordinate_14.out0, z=coordinate_14.out1)
coordinate_15 = CodeBlock { -4000; 5000; }
coordination_point_8 = Point.ByCoordinates(x=sequence_7, y=coordinate_15.out0, z=coordinate_15.out1)
radius_of_cylinders_4 = DoubleSlider(50, range=20..300 step 5)
coordinate_16 = CodeBlock(n=radius_of_cylinders_4) { n; 45; 0; }
sequence_8 = Sequence(start=coordinate_16.n, amount=coordinate_16.out1, step=coordinate_16.out2)
circular_rod_4 = Python()  # CPython3; unwired: IN[0]; same code as circular_rod
right_wall = Python(IN[0]=coordination_point_7, IN[1]=coordination_point_8, IN[2]=sequence_8, IN[3]=circular_rod_4)  # CPython3
# ---------- right_wall.python (18 lines) ----------
Circularrod = IN[3]
bottom_points = IN[0]
top_points = IN[1]
radii = IN[2]

rods = []
count = min(len(bottom_points),len(top_points))

for i in range(count):
    r = radii[i] if i <len(radii) else radii[-1]
    btm = bottom_points[i]
    top = top_points[i]
    
    rod = Circularrod(btm, top, r)
    rods.append(rod.make_geometry())
    
    OUT = rods
    
# ----------------------------------------
horizontal_movement_of_the_hole = DoubleSlider(2000, range=1500..2500 step 50)
verticle_movement_of_the_hole = DoubleSlider(2500, range=1500..3500 step 10)
coordinate_17 = CodeBlock(k=horizontal_movement_of_the_hole, m=verticle_movement_of_the_hole) { k; -4000; m; }
coordination_point_9 = Point.ByCoordinates(x=coordinate_17.k, y=coordinate_17.out1, z=coordinate_17.m)
radius_of_the_hole = DoubleSlider(1075, range=700..1300 step 5)
byCenterPointRadius = Sphere.ByCenterPointRadius(centerPoint=coordination_point_9, radius=radius_of_the_hole)
differenceAll = Solid.DifferenceAll(solid=right_wall, others=byCenterPointRadius)
