# Dynamo graph 1869867.dyn (Dynamo 4.0.0.3277)

# group: Don't touch this ground
code_block = CodeBlock { -5000; -5000; -200; }
byCoordinates = Point.ByCoordinates(x=code_block.out0, y=code_block.out1, z=code_block.out2)
code_block_2 = CodeBlock { 5000; 5000; 0; }
byCoordinates_2 = Point.ByCoordinates(x=code_block_2.out0, y=code_block_2.out1, z=code_block_2.out2)
byCorners = Cuboid.ByCorners(lowPoint=byCoordinates, highPoint=byCoordinates_2)
code_block_3 = CodeBlock { 0; 100; 0; }
byARGB = Color.ByARGB(red=code_block_3.out0, green=code_block_3.out1, blue=code_block_3.out2)
byGeometryColor = Modifiers.GeometryColor.ByGeometryColor(geometry=byCorners, color=byARGB)

code_block_4 = CodeBlock { -4000; 3000; 0; -4000; -1000; 0; 0; -4000; 0; 0; 0; 0; 4000; -3000; 0; 4000; 1000; 0; }
byCoordinates_3 = Point.ByCoordinates(x=code_block_4.out0, y=code_block_4.out1, z=code_block_4.out2)
byCoordinates_4 = Point.ByCoordinates(x=code_block_4.out3, y=code_block_4.out4, z=code_block_4.out5)
byCoordinates_5 = Point.ByCoordinates(x=code_block_4.out6, y=code_block_4.out7, z=code_block_4.out8)
byCoordinates_6 = Point.ByCoordinates(x=code_block_4.out9, y=code_block_4.out10, z=code_block_4.out11)
byCoordinates_7 = Point.ByCoordinates(x=code_block_4.out12, y=code_block_4.out13, z=code_block_4.out14)
byCoordinates_8 = Point.ByCoordinates(x=code_block_4.out15, y=code_block_4.out16, z=code_block_4.out17)
amplitude = DoubleSlider(1500, range=1..1500 step 1)
w = DoubleSlider(50, range=1..100 step 1)
C = DoubleSlider(-1232, range=-4000..0 step 1)
top_and_bottom_curves = CodeBlock { length = 8000; Slicenumber = 8; Interval = 0..1..#Slicenumber; Xpoint = (Interval * length)-4000; }
curve_of_den = CodeBlock(x=top_and_bottom_curves.Xpoint) { x; y = 2200 *Math.Sin(30000*x+21000) + 2000; y; 0; }
byCoordinates_9 = Point.ByCoordinates(x=curve_of_den.x, y=curve_of_den.out1, z=curve_of_den.out3)
top_curve = NurbsCurve.ByControlPoints(points=byCoordinates_9)
byCoordinates_10 = Point.ByCoordinates(x=curve_of_den.x, y=curve_of_den.out1, z=curve_of_den.out3)
number_slider = DoubleSlider(-5000, range=-5000..4000 step 1)
bottom_curve_translation = Geometry.Translate(geometry=byCoordinates_10, yTranslation=number_slider)
bottom_curve = NurbsCurve.ByControlPoints(points=bottom_curve_translation)
cuboid = Python()  # PythonNet3; unwired: IN[0]
# ---------- cuboid.python (34 lines) ----------
# Load the Python Standard and DesignScript Libraries
import sys
import clr
clr.AddReference('ProtoGeometry')
from Autodesk.DesignScript.Geometry import *

class Cuboid:
    def __init__(self, origin, width, height, length):
        if isinstance(origin, list):
            origin = origin[0]
        self.origin = origin
        self.width = width
        self.height = height
        self.length = length
        self.geometry = None
        
    def create_geometry(self):
        def unwrap(item):
            while isinstance(item, list):
                item = item[0]
            return item
        p0 = unwrap(self.origin)
        p1 = Point.ByCoordinates(p0.X + self.width, p0.Y, p0.Z)
        p2 = Point.ByCoordinates(p0.X + self.width, p0.Y + self.length, p0.Z)
        p3 = Point.ByCoordinates(p0.X, p0.Y + self.length, p0.Z)
        base_poly = PolyCurve.ByPoints([p0, p1, p2, p3, p0])
        base_surface = Surface.ByPatch(base_poly)
        self.geometry = base_surface.Extrude(Vector.ZAxis(), self.height)
        return self.geometry
        
    def volume(self):
        return self.width * self.height * self.length  
        
OUT = Cuboid
# ----------------------------------------
byCoordinates_11 = Point.ByCoordinates(x=curve_of_den.x, y=curve_of_den.out1, z=curve_of_den.out3)
beam_curve_translation = DoubleSlider(-2500, range=-4000..4000 step 1)
translate = Geometry.Translate(geometry=byCoordinates_11, yTranslation=beam_curve_translation)
beam_height_translation = DoubleSlider(2500, range=1..2500 step 1)
translate_2 = Geometry.Translate(geometry=translate, zTranslation=beam_height_translation)
den_arc = Arc.ByThreePoints(firstPoint=bottom_curve_translation, secondPoint=translate_2, thirdPoint=byCoordinates_9)
n = DoubleSlider(8, range=8..21 step 1)
number_of_boxes_along_each_arc = Curve.PointsAtEqualSegmentLength(curve=den_arc, divisions=n)
cuboid_width = DoubleSlider(702, range=1..1000 step 1)
cuboid_height = DoubleSlider(576, range=1..2000 step 1)
cuboid_length = DoubleSlider(508, range=1..2000 step 1)
instance = Python(IN[0]=cuboid, IN[1]=number_of_boxes_along_each_arc, IN[2]=cuboid_width, IN[3]=cuboid_height, IN[4]=cuboid_length)  # PythonNet3
# ---------- instance.python (9 lines) ----------
Cuboid = IN[0]
origin = IN[1]
width = IN[2]
height = IN[3]
length = IN[4]

box = Cuboid(origin, width, height, length)

OUT = box.create_geometry(), box.volume()
# ----------------------------------------
timberBeam = Python()  # PythonNet3; unwired: IN[0]
# ---------- timberBeam.python (24 lines) ----------
# Load the Python Standard and DesignScript Libraries
import sys
import clr
clr.AddReference('ProtoGeometry')
from Autodesk.DesignScript.Geometry import *
import math

class Timberbeam:
    def __init__(self, centerline, radius):
        self.centerline = centerline
        self.radius = radius
        
    def endpoints(self):
        return self.centerline.StartPoint, self.centerline.EndPoint
        
    def make_geometry(self):
        end1, end2 = self.endpoints()
        
        return Cylinder.ByStartPointEndPointRadius(end1,end2,self.radius)
        
    def measure_volume(self):
        end1, end2 = self.endpoints()
        return end1.DistanceTo(end2)*self.radius*self.radius*math.pi
OUT = Timberbeam
# ----------------------------------------
beam_line = NurbsCurve.ByControlPoints(points=translate)
number_slider_2 = DoubleSlider(4, range=1..8 step 1)
number_of_beams_bottom = Curve.PointsAtEqualSegmentLength(curve=beam_line, divisions=number_slider_2)
height_of_den = NurbsCurve.ByControlPoints(points=translate_2)
number_of_beams_top = Curve.PointsAtEqualSegmentLength(curve=height_of_den, divisions=number_slider_2)
beam_placement = Line.ByStartPointEndPoint(startPoint=number_of_beams_bottom, endPoint=number_of_beams_top)
radius = DoubleSlider(1, range=1..2000 step 1)
instance_timberbeam = Python(IN[0]=timberBeam, IN[1]=beam_placement, IN[2]=radius)  # PythonNet3
# ---------- instance_timberbeam.python (13 lines) ----------
Timberbeam = IN[0]
lines = IN[1]
radius = IN[2]

geometries = []
volumes = []

for line in lines:
    beam = Timberbeam(line, radius)
    geometries.append(beam.make_geometry())
    volumes.append(beam.measure_volume())

OUT = geometries, volumes
# ----------------------------------------
