# Dynamo graph 1870179.dyn (Dynamo 3.6.1.9895)

code_block = CodeBlock { -5000; -5000; -200; }
byCoordinates = Point.ByCoordinates(x=code_block.out0, y=code_block.out1, z=code_block.out2)
code_block_2 = CodeBlock { 5000; 5000; 0; }
byCoordinates_2 = Point.ByCoordinates(x=code_block_2.out0, y=code_block_2.out1, z=code_block_2.out2)
byCorners = Cuboid.ByCorners(lowPoint=byCoordinates, highPoint=byCoordinates_2)
code_block_3 = CodeBlock { 0; 100; 0; }
byARGB = Color.ByARGB(red=code_block_3.out0, green=code_block_3.out1, blue=code_block_3.out2)
byGeometryColor = Modifiers.GeometryColor.ByGeometryColor(geometry=byCorners, color=byARGB)

# group: Global Parameters
pavilionLength_mm = DoubleSlider(9000, range=4000..9000 step 100)
passageWidth_mm = DoubleSlider(3000, range=2000..3500 step 100)
numFrames = IntegerSlider(12, range=4..14 step 1)
columnHeightStart_mm = DoubleSlider(2500, range=2500..3500 step 100)
columnEndHeight_mm = DoubleSlider(4400, range=3000..4500 step 100)
columnRadius = DoubleSlider(110, range=80..180 step 10)
beamRadius_mm = DoubleSlider(120, range=60..160 step 10)
waveAmplitude_mm = DoubleSlider(0, range=0..1000 step 10)

# group: class:TimberColumn - instances and total volume
python_script = Python(IN[0]=pavilionLength_mm, IN[1]=passageWidth_mm, IN[2]=numFrames, IN[3]=columnHeightStart_mm, IN[4]=columnEndHeight_mm, IN[5]=columnRadius)  # CPython3
# ---------- python_script.python (78 lines) ----------
import clr
clr.AddReference("ProtoGeometry")
from Autodesk.DesignScript.Geometry import Point, Cylinder

# ------------ Inputs -------------
pavilion_length = float(IN[0])      # mm
passage_width   = float(IN[1])      # mm
num_frames      = int(IN[2])        # number of frames
h_start         = float(IN[3])      # mm
h_end           = float(IN[4])      # mm
col_radius      = float(IN[5])      # mm

base_elev = 0.0

# ------------ Class definition: Material 1 (TimberColumn) -------------
class TimberColumn:
    def __init__(self, base_point, height, radius):
        self.base_point = base_point
        self.height = height
        self.radius = radius

    def geometry(self):
        top_point = Point.ByCoordinates(
            self.base_point.X,
            self.base_point.Y,
            self.base_point.Z + self.height
        )
        col = Cylinder.ByPointsRadius(self.base_point, top_point, self.radius)
        return col, top_point

    def volume(self):
        g, _ = self.geometry()
        return g.Volume

# ------------ Generate columns in two rows -------------
columns_geom  = []   # all cylinders
volumes       = []   # each column volume
top_pts_left  = []   # top points for left row
top_pts_right = []   # top points for right row

# parameters from 0..1 along the length
if num_frames < 2:
    t_values = [0.0]
else:
    step = 1.0 / float(num_frames - 1)
    t_values = [i * step for i in range(num_frames)]

for t in t_values:
    # x location along pavilion (centered at origin)
    x = (t - 0.5) * pavilion_length

    # left/right y locations
    y_left  = -passage_width / 2.0
    y_right =  passage_width / 2.0

    # height interpolated between start and end
    height = h_start + t * (h_end - h_start)

    # LEFT column
    base_left = Point.ByCoordinates(x, y_left, base_elev)
    col_left = TimberColumn(base_left, height, col_radius)
    g_left, top_left = col_left.geometry()
    columns_geom.append(g_left)
    volumes.append(col_left.volume())
    top_pts_left.append(top_left)

    # RIGHT column
    base_right = Point.ByCoordinates(x, y_right, base_elev)
    col_right = TimberColumn(base_right, height, col_radius)
    g_right, top_right = col_right.geometry()
    columns_geom.append(g_right)
    volumes.append(col_right.volume())
    top_pts_right.append(top_right)

total_volume_columns = sum(volumes)  # mm^3

# Pack everything into one OUT list
OUT = [columns_geom, total_volume_columns, top_pts_left, top_pts_right]
# ----------------------------------------

# group: Material Volume 1 (timber) mm^3
n1 = DoubleSlider(1, range=1..1 step 0.1)  # "1"
getItemAtIndex = List.GetItemAtIndex(list=python_script, index=n1)
watch = Watch(getItemAtIndex)

# group: Left top points
number_slider = DoubleSlider(2, range=2..2 step 2)
getItemAtIndex_2 = List.GetItemAtIndex(list=python_script, index=number_slider)

# group: Right top points
number_slider_2 = DoubleSlider(3, range=3..3 step 3)
getItemAtIndex_3 = List.GetItemAtIndex(list=python_script, index=number_slider_2)

# group: class: SteelBeam – instances and total volume
python_script_2 = Python(IN[0]=getItemAtIndex_2, IN[1]=getItemAtIndex_3, IN[2]=beamRadius_mm, IN[3]=waveAmplitude_mm)  # CPython3
# ---------- python_script_2.python (72 lines) ----------
import clr
clr.AddReference("ProtoGeometry")
from Autodesk.DesignScript.Geometry import Point, Cylinder
import math

# ---------- Inputs ----------
top_pts_left  = IN[0]          # list of left column top points
top_pts_right = IN[1]          # list of right column top points
beam_radius   = float(IN[2])   # mm (beamRadius_mm slider)
wave_amp      = float(IN[3])   # mm (waveAmplitude_mm slider)

# ---------- SteelBeam class (Material 2) ----------
class SteelBeam:
    def __init__(self, pt_left, pt_right, t, wave_amp, radius):
        self.pt_left  = pt_left
        self.pt_right = pt_right
        self.t = t                  # parameter 0..1 along pavilion
        self.wave_amp = wave_amp
        self.radius = radius

    def end_points(self):
        # vertical offset for this frame using a sine wave
        z_offset = self.wave_amp * math.sin(2.0 * math.pi * self.t)

        # raise both ends by the same amount
        p1 = Point.ByCoordinates(
            self.pt_left.X,
            self.pt_left.Y,
            self.pt_left.Z + z_offset
        )
        p2 = Point.ByCoordinates(
            self.pt_right.X,
            self.pt_right.Y,
            self.pt_right.Z + z_offset
        )

        # full-span beam from left to right
        return p1, p2

    def geometry(self):
        p1, p2 = self.end_points()
        return Cylinder.ByPointsRadius(p1, p2, self.radius)

    def volume(self):
        return self.geometry().Volume

# ---------- Generate beams ----------
beams_geom = []
beams_vol  = []

n = min(len(top_pts_left), len(top_pts_right))

if n < 2:
    t_values = [0.0]
else:
    t_values = [i / float(n - 1) for i in range(n)]

for i in range(n):
    ptL = top_pts_left[i]
    ptR = top_pts_right[i]
    t   = t_values[i]

    beam = SteelBeam(ptL, ptR, t, wave_amp, beam_radius)
    g = beam.geometry()
    beams_geom.append(g)
    beams_vol.append(beam.volume())

total_beam_volume = sum(beams_vol)

# OUT[0] = list of beam geometries
# OUT[1] = total steel volume [mm^3]
OUT = [beams_geom, total_beam_volume]
# ----------------------------------------

# group: roof boundary curves
byPoints = PolyCurve.ByPoints(points=getItemAtIndex_2)
byPoints_2 = PolyCurve.ByPoints(points=getItemAtIndex_3)

list_create = List.Create(item0=byPoints, item1=byPoints_2)
byLoft = Surface.ByLoft(crossSections=list_create)
