# Dynamo graph 1871305.dyn (Dynamo 3.6.0.9395)

code_block = CodeBlock { -5000; -5000; -200; }
byCoordinates = Point.ByCoordinates(x=code_block.out0, y=code_block.out1, z=code_block.out2)
code_block_2 = CodeBlock { 5000; 5000; 0; }
byCoordinates_2 = Point.ByCoordinates(x=code_block_2.out0, y=code_block_2.out1, z=code_block_2.out2)
byCorners = Cuboid.ByCorners(lowPoint=byCoordinates, highPoint=byCoordinates_2)
code_block_3 = CodeBlock { 0; 100; 0; }
byARGB = Color.ByARGB(red=code_block_3.out0, green=code_block_3.out1, blue=code_block_3.out2)
byGeometryColor = Modifiers.GeometryColor.ByGeometryColor(geometry=byCorners, color=byARGB)
start_point_and_amount_of_rods = CodeBlock { -4000; 50; 0; }
sequence = Sequence(start=start_point_and_amount_of_rods.out0, amount=start_point_and_amount_of_rods.out1, step=start_point_and_amount_of_rods.out2)
code_block_4 = CodeBlock { -4000; -4000; }
height_of_rods_and_beam_off = DoubleSlider(1406.2, range=1..5000 step 0.1)  # "Height of Rods and Beam off Ground"
points_of_ends_of_rods_touching = Point.ByCoordinates(x=sequence, y=code_block_4.out0, z=height_of_rods_and_beam_off)  # "Points of Ends of Rods Touching Top of Steel Beam"
start_and_amount_of_rods = CodeBlock { -4000; 50; }  # "Start and Amount of Rods Touching Ground"
spacing_of_rods = DoubleSlider(175, range=1..175 step 0.1)
sequence_2 = Sequence(start=start_and_amount_of_rods.out0, amount=start_and_amount_of_rods.out1, step=spacing_of_rods)
distance_of_bottom_of_rods_from = DoubleSlider(718.4, range=-4000..4000 step 0.1)  # "Distance of Bottom of Rods from Steel Beam"
points_of_end_of_rods_touching = Point.ByCoordinates(x=sequence_2, y=distance_of_bottom_of_rods_from)  # "Points of End of Rods Touching Ground"
radius_of_rods_and_volume_of = DoubleSlider(30, range=1..100 step 0.1)  # "Radius of Rods and Volume of Steel Beam"
class_circular_wooden_rods = Python()  # CPython3; unwired: IN[0]
# ---------- class_circular_wooden_rods.python (19 lines) ----------
# Load the Python Standard and DesignScript Libraries
import sys
import clr
clr.AddReference('ProtoGeometry')
from Autodesk.DesignScript.Geometry import *


# Place your code below this line
class woodenRod:
    def __init__(self, lowPoint, highPoint, radius):
        self.low = lowPoint
        self.high = highPoint
        self.radius = radius
        
    def makeGeometry(self):
        return Cylinder.ByPointsRadius(self.low, self.high, self.radius)
        
# Assign your output to the OUT variable.
OUT = woodenRod
# ----------------------------------------
series_of_instances_of_circular = Python(IN[0]=points_of_ends_of_rods_touching, IN[1]=points_of_end_of_rods_touching, IN[2]=radius_of_rods_and_volume_of, IN[3]=class_circular_wooden_rods)  # "Series of Instances of Circular Wooden Rods"; CPython3
# ---------- series_of_instances_of_circular.python (22 lines) ----------
#IN[0] = list of low points
#IN[1] = list of high points
#IN[2] = radius of rods
#IN[3] = class woodenRod

woodenRod = IN[3]
lowPoint = IN[0]
highPoint = IN[1]
radius = IN[2]
count = min(len(lowPoint), len(highPoint))

list = []


for i in range(count):
    low = lowPoint[i]
    high = highPoint[i]
    
    rod = woodenRod(low, high, radius)
    list.append(rod.makeGeometry())
    
OUT = list
# ----------------------------------------
get_volume_of_each_rod = Solid.Volume(solid=series_of_instances_of_circular)
calculate_volume_of_wooden_rods = Python(IN[0]=get_volume_of_each_rod)  # CPython3
# ---------- calculate_volume_of_wooden_rods.python (20 lines) ----------
# Load the Python Standard and DesignScript Libraries
import sys
import clr
clr.AddReference('ProtoGeometry')
from Autodesk.DesignScript.Geometry import *

# The inputs to this node will be stored as a list in the IN variables.
dataEnteringNode = IN

# Place your code below this line
list = IN[0]
counter = 0
sumVolume = 0

for i in range(len(list)):
    sumVolume = sumVolume + list[i]
    
    
# Assign your output to the OUT variable.
OUT = str(sumVolume) + "mm\u00b2"
# ----------------------------------------
material_volume_1_wooden_rods = Watch(calculate_volume_of_wooden_rods)
origin_point_of_steel_beam = CodeBlock { -4000; -4000; 0; }
origin_point_of_steel_beam_2 = Point.ByCoordinates(x=origin_point_of_steel_beam.out0, y=origin_point_of_steel_beam.out1, z=origin_point_of_steel_beam.out2)
class_rectangular_steel_beam = Python()  # CPython3; unwired: IN[0]
# ---------- class_rectangular_steel_beam.python (23 lines) ----------
# Load the Python Standard and DesignScript Libraries
import sys
import clr
clr.AddReference('ProtoGeometry')
from Autodesk.DesignScript.Geometry import *

# The inputs to this node will be stored as a list in the IN variables.
dataEnteringNode = IN

# Place your code below this line

class steelBeam:
    def __init__(self, originPoint, width, length, height):
        self.origin = originPoint
        self.width = width
        self.length = length
        self.height = height
        
    def makeGeometry(self):
        return Cuboid.ByLengths(self.origin, self.width, self.length, self.height)
        
# Assign your output to the OUT variable.
OUT = steelBeam
# ----------------------------------------
instance_of_a_rectangular_steel = Python(IN[0]=origin_point_of_steel_beam_2, IN[1]=radius_of_rods_and_volume_of, IN[2]=radius_of_rods_and_volume_of, IN[3]=height_of_rods_and_beam_off, IN[4]=class_rectangular_steel_beam)  # "Instance of a Rectangular Steel Beam"; CPython3
# ---------- instance_of_a_rectangular_steel.python (8 lines) ----------
originPoint = IN[0]
width = IN[1]
length = IN[2]
height = 2*IN[3]
steelBeam = IN[4]

beam = steelBeam(originPoint, width, length, height)
OUT = beam.makeGeometry()
# ----------------------------------------
get_volume_of_steel_beam = Solid.Volume(solid=instance_of_a_rectangular_steel)  # "Get Volume of Steel Beam (Includes half below the ground)"
calculate_volume_of_steel_beam = Python(IN[0]=get_volume_of_steel_beam)  # CPython3
# ---------- calculate_volume_of_steel_beam.python (18 lines) ----------
# Load the Python Standard and DesignScript Libraries
import sys
import clr
clr.AddReference('ProtoGeometry')
from Autodesk.DesignScript.Geometry import *

# The inputs to this node will be stored as a list in the IN variables.
dataEnteringNode = IN

# Place your code below this line
totalVolume = IN[0]

actualVolume = totalVolume/2



# Assign your output to the OUT variable.
OUT = str(actualVolume) + "mm\u00b2"
# ----------------------------------------
material_volume_2_steel_beam = Watch(calculate_volume_of_steel_beam)
