# Dynamo graph 1871480.dyn "RibCage-1871480" (Dynamo 3.6.0.9395)

# group: Don't touch this ground
code_block = CodeBlock { -5000; -5000; -200; }
byCoordinates = Point.ByCoordinates(x=code_block.out0, y=code_block.out1, z=code_block.out2)
code_block_2 = CodeBlock { 5000; 5000; 0; }
byCoordinates_2 = Point.ByCoordinates(x=code_block_2.out0, y=code_block_2.out1, z=code_block_2.out2)
byCorners = Cuboid.ByCorners(lowPoint=byCoordinates, highPoint=byCoordinates_2)
code_block_3 = CodeBlock { 0; 100; 0; }
byARGB = Color.ByARGB(red=code_block_3.out0, green=code_block_3.out1, blue=code_block_3.out2)
byGeometryColor = Modifiers.GeometryColor.ByGeometryColor(geometry=byCorners, color=byARGB)

cylindricalsteel_class = Python()  # CPython3; unwired: IN[0]
# ---------- cylindricalsteel_class.python (16 lines) ----------
# Load the Python Standard and DesignScript Libraries
import sys
import clr
clr.AddReference('ProtoGeometry')
from Autodesk.DesignScript.Geometry import *
import math 

class CylindricalSteel: 
    def __init__(self, bottom_point, top_point, radius):
        self.bottom = bottom_point
        self.top = top_point
        self.radius = radius
        
    def make_geometry(self):
        return Cylinder.ByPointsRadius(self.bottom, self.top, self.radius)
OUT = CylindricalSteel
# ----------------------------------------
code_block_4 = CodeBlock { -3000; -3000; 0; }
byCoordinates_3 = Point.ByCoordinates(x=code_block_4.out0, y=code_block_4.out1, z=code_block_4.out2)
code_block_5 = CodeBlock { 3000; -3000; 0; }
byCoordinates_4 = Point.ByCoordinates(x=code_block_5.out0, y=code_block_5.out1, z=code_block_5.out2)
byStartPointEndPoint = Line.ByStartPointEndPoint(startPoint=byCoordinates_3, endPoint=byCoordinates_4)
code_block_6 = CodeBlock { 0; 5+1; 1/5; }
sequence = Sequence(start=code_block_6.out0, amount=code_block_6.out1, step=code_block_6.out2)
pointAtParameter = Curve.PointAtParameter(curve=byStartPointEndPoint, param=sequence)
code_block_7 = CodeBlock { -3000; -3000; 0; }
number_slider_steel_cylinder = DoubleSlider(1279, range=0..3000 step 1)  # "Number Slider (Steel Cylinder Heights)"
byCoordinates_5 = Point.ByCoordinates(x=code_block_7.out0, y=code_block_7.out1, z=number_slider_steel_cylinder)
code_block_8 = CodeBlock { 3000; -3000; 0; }
byCoordinates_6 = Point.ByCoordinates(x=code_block_8.out0, y=code_block_8.out1, z=number_slider_steel_cylinder)
byStartPointEndPoint_2 = Line.ByStartPointEndPoint(startPoint=byCoordinates_5, endPoint=byCoordinates_6)
code_block_9 = CodeBlock { 0; 6; 1/5; }
sequence_2 = Sequence(start=code_block_9.out0, amount=code_block_9.out1, step=code_block_9.out2)
pointAtParameter_2 = Curve.PointAtParameter(curve=byStartPointEndPoint_2, param=sequence_2)
steel_cylinder_thickness = DoubleSlider(150, range=100..600 step 0.1)
steel_series_instance = Python(IN[0]=cylindricalsteel_class, IN[1]=pointAtParameter, IN[2]=pointAtParameter_2, IN[3]=steel_cylinder_thickness)  # CPython3
# ---------- steel_series_instance.python (26 lines) ----------
import math
CircularRod = IN[0]
bottom_points = IN[1] ##these should be lists as they form a series 
top_points = IN[2]
radii = IN[3]

rods = [] #final output is a list which we add instances into
count = min(len(bottom_points),len(top_points)) #this is more of a check where the amount of points in a list must match both top and bottom
volumes = []

for i in range(count):
    
    btm = bottom_points[i]
    top = top_points[i]
    
    
    rod = CircularRod(btm, top, radii)
    geometry = rod.make_geometry()
    
    rods.append(geometry)
    volumes.append(geometry.Volume)
    total_volume = round(sum(volumes) / 1e9,3)
    formatted = f"{total_volume:.4f} m³"
    
    
OUT = rods, volumes, formatted
# ----------------------------------------
code_block_10 = CodeBlock { -3000; 3000; 0; }
byCoordinates_7 = Point.ByCoordinates(x=code_block_10.out0, y=code_block_10.out1, z=code_block_10.out2)
code_block_11 = CodeBlock { 3000; 3000; 0; }
byCoordinates_8 = Point.ByCoordinates(x=code_block_11.out0, y=code_block_11.out1, z=code_block_11.out2)
byStartPointEndPoint_3 = Line.ByStartPointEndPoint(startPoint=byCoordinates_7, endPoint=byCoordinates_8)
code_block_12 = CodeBlock { 0; 6; 1/5; }
sequence_3 = Sequence(start=code_block_12.out0, amount=code_block_12.out1, step=code_block_12.out2)
pointAtParameter_3 = Curve.PointAtParameter(curve=byStartPointEndPoint_3, param=sequence_3)
code_block_13 = CodeBlock { -3000; 3000; 0; }
byCoordinates_9 = Point.ByCoordinates(x=code_block_13.out0, y=code_block_13.out1, z=number_slider_steel_cylinder)
code_block_14 = CodeBlock { 3000; 3000; 0; }
byCoordinates_10 = Point.ByCoordinates(x=code_block_14.out0, y=code_block_14.out1, z=number_slider_steel_cylinder)
byStartPointEndPoint_4 = Line.ByStartPointEndPoint(startPoint=byCoordinates_9, endPoint=byCoordinates_10)
code_block_15 = CodeBlock { 0; 6; 1/5; }
sequence_4 = Sequence(start=code_block_15.out0, amount=code_block_15.out1, step=code_block_15.out2)
pointAtParameter_4 = Curve.PointAtParameter(curve=byStartPointEndPoint_4, param=sequence_4)
steel_series_instance_2 = Python(IN[0]=cylindricalsteel_class, IN[1]=pointAtParameter_3, IN[2]=pointAtParameter_4, IN[3]=steel_cylinder_thickness)  # CPython3
# ---------- steel_series_instance_2.python (26 lines) ----------
import math
CircularRod = IN[0]
bottom_points = IN[1] ##these should be lists as they form a series 
top_points = IN[2]
radii = IN[3]

rods = [] #final output is a list which we add instances into
count = min(len(bottom_points),len(top_points)) #this is more of a check where the amount of points in a list must match both top and bottom
volumes = []

for i in range(count):
    
    btm = bottom_points[i]
    top = top_points[i]
    
    
    rod = CircularRod(btm, top, radii)
    geometry = rod.make_geometry()
    
    rods.append(geometry)
    volumes.append(geometry.Volume)
    total_volume = 2*round(sum(volumes) / 1e9,3)
    formatted = f"{total_volume:.4f} m³"
    
    
OUT = rods, volumes, formatted
# ----------------------------------------
code_block_16 = CodeBlock { 2; }
getItemAtIndex = List.GetItemAtIndex(list=steel_series_instance_2, index=code_block_16)
total_volume_of_steel_cylinders = Watch(getItemAtIndex)
curved_aluminum_class = Python()  # CPython3; unwired: IN[0]
# ---------- curved_aluminum_class.python (23 lines) ----------
# Load the Python Standard and DesignScript Libraries
import sys
import clr
clr.AddReference('ProtoGeometry')
from Autodesk.DesignScript.Geometry import *
import math

class CircularAlum: 
    def __init__(self, centerline, radius):
        self.centerline = centerline
        self.radius = radius
    def endpoints(self):
        return self.centerline.StartPoint, self.centerline.EndPoint
    
    def make_geometry(self):
        end1, end2 = self.endpoints() 
        
        return Cylinder.ByPointsRadius(end1,end2,self.radius)
        
    def measure_volume(self):
        end1, end2 = self.endpoints()
        return end1.DistanceTo(end2)*self.radius*self.radius*math.pi
OUT = CircularAlum
# ----------------------------------------
aluminum_cylinder_thickness = DoubleSlider(150, range=100..600 step 0.1)
horizontal_aluminum_instances = Python(IN[0]=curved_aluminum_class, IN[1]=byStartPointEndPoint_2, IN[2]=aluminum_cylinder_thickness)  # CPython3
# ---------- horizontal_aluminum_instances.python (4 lines) ----------
CircularAlum = IN[0] 
topAlum = CircularAlum(IN[1],IN[2])

OUT = [topAlum.make_geometry(), topAlum.measure_volume()]
# ----------------------------------------
code_block_17 = CodeBlock { 200; }
horizontal_aluminum_instances_2 = Python(IN[0]=curved_aluminum_class, IN[1]=byStartPointEndPoint_4, IN[2]=aluminum_cylinder_thickness)  # CPython3
# ---------- horizontal_aluminum_instances_2.python (8 lines) ----------
CircularAlum = IN[0] 
topAlum = CircularAlum(IN[1],IN[2])

volume = topAlum.measure_volume()
Tvolume = (volume / 1e9)*2
formatted = "{:.4f} m³".format(Tvolume)

OUT = [topAlum.make_geometry(), formatted]
# ----------------------------------------
code_block_18 = CodeBlock { 1; }
getItemAtIndex_2 = List.GetItemAtIndex(list=horizontal_aluminum_instances_2, index=code_block_18)
total_volume_of_horizontal_steel = Watch(getItemAtIndex_2)  # "Total Volume of Horizontal Steel Cylinders"
python_script = Python()  # CPython3; unwired: IN[0]
# ---------- python_script.python (27 lines) ----------
import sys
import clr
clr.AddReference('ProtoGeometry')
from Autodesk.DesignScript.Geometry import *
import math

class CircularAlum: 
    def __init__(self, centerline, radius):
        self.centerline = centerline
        self.radius = radius
        
    def make_geometry(self):
        # Get the starting plane perpendicular to the curve
        start_pt = self.centerline.StartPoint
        start_tangent = self.centerline.TangentAtParameter(0)
        start_plane = Plane.ByOriginNormal(start_pt, start_tangent)
        
        # Build the circular profile at the start
        circle = Circle.ByPlaneRadius(start_plane, self.radius)
        
        # Sweep the circle along the arc
        return Solid.BySweep(circle, self.centerline, False)
        
    def measure_volume(self):
        geom = self.make_geometry()
        return geom.Volume       
OUT = CircularAlum
# ----------------------------------------
pointAtParameter_5 = Curve.PointAtParameter(curve=byStartPointEndPoint_2, param=sequence_2)
code_block_19 = CodeBlock { -3000; 0; 0; }
curved_aluminum_cylinder_height = DoubleSlider(2211, range=100..3000 step 0.1)
byCoordinates_11 = Point.ByCoordinates(x=code_block_19.out0, y=code_block_19.out1, z=curved_aluminum_cylinder_height)
code_block_20 = CodeBlock { 3000; 0; 0; }
byCoordinates_12 = Point.ByCoordinates(x=code_block_20.out0, y=code_block_20.out1, z=curved_aluminum_cylinder_height)
byStartPointEndPoint_5 = Line.ByStartPointEndPoint(startPoint=byCoordinates_11, endPoint=byCoordinates_12)
code_block_21 = CodeBlock { 0; 6; 1/5; }
sequence_5 = Sequence(start=code_block_21.out0, amount=code_block_21.out1, step=code_block_21.out2)
pointAtParameter_6 = Curve.PointAtParameter(curve=byStartPointEndPoint_5, param=sequence_5)
pointAtParameter_7 = Curve.PointAtParameter(curve=byStartPointEndPoint_4, param=sequence_4)
byThreePoints = Arc.ByThreePoints(firstPoint=pointAtParameter_5, secondPoint=pointAtParameter_6, thirdPoint=pointAtParameter_7)
curved_aluminum_instances = Python(IN[0]=python_script, IN[1]=byThreePoints, IN[2]=aluminum_cylinder_thickness)  # CPython3
# ---------- curved_aluminum_instances.python (25 lines) ----------
import math
CircularAlum = IN[0]     
centerlines = IN[1]      
radius = IN[2]           

rods = []
volumes = []

count = len(centerlines)

for i in range(count):

    cl = centerlines[i]

    rod = CircularAlum(cl, radius)
    geometry = rod.make_geometry()

    rods.append(geometry)
    volumes.append(geometry.Volume)


total_volume = round(sum(volumes) / 1e9, 3)
formatted = f"{total_volume:.4f} m³"

OUT = rods, volumes, formatted
# ----------------------------------------
code_block_22 = CodeBlock { 2; }
getItemAtIndex_3 = List.GetItemAtIndex(list=curved_aluminum_instances, index=code_block_22)
total_volume_of_curved_steel = Watch(getItemAtIndex_3)  # "Total Volume of Curved Steel Cylinders"
