# Dynamo graph 1871963(1).dyn (Dynamo 3.6.0.9395)

# group: Don't touch this ground
code_block = CodeBlock { -5000; -5000; -200; }
byCoordinates = Point.ByCoordinates(x=code_block.out0, y=code_block.out1, z=code_block.out2)
code_block_2 = CodeBlock { 5000; 5000; 0; }
byCoordinates_2 = Point.ByCoordinates(x=code_block_2.out0, y=code_block_2.out1, z=code_block_2.out2)
byCorners = Cuboid.ByCorners(lowPoint=byCoordinates, highPoint=byCoordinates_2)
code_block_3 = CodeBlock { 0; 100; 0; }
byARGB = Color.ByARGB(red=code_block_3.out0, green=code_block_3.out1, blue=code_block_3.out2)
byGeometryColor = Modifiers.GeometryColor.ByGeometryColor(geometry=byCorners, color=byARGB)

arc_center = Point.Origin()
x_location_slider = IntegerSlider(1000, range=800..1200 step 2)
start_and_end_adjuster = CodeBlock(n=x_location_slider) { n; start = n; end = -1*n; }
y_start_end = IntegerSlider(3800, range=3800..4200 step 20)
start_of_arc = Point.ByCoordinates(x=start_and_end_adjuster.end, y=y_start_end)
end_of_arc = Point.ByCoordinates(x=start_and_end_adjuster.start, y=y_start_end)
bottom_arc = Arc.ByCenterPointStartPointEndPoint(centerPoint=arc_center, startPoint=start_of_arc, endPoint=end_of_arc)
of_crossmembers = IntegerSlider(14, range=14..24 step 2)
parameter_range = CodeBlock(Vertcross=of_crossmembers) { Vertcross; 0..1..#Vertcross; }
bottom_points = Curve.PointAtParameter(curve=bottom_arc, param=parameter_range.out1)
zeros = CodeBlock { 0; }
crossmember_height = IntegerSlider(3500, range=3500..5000 step 1)
crossmeber_height = Point.ByCoordinates(x=zeros, y=zeros, z=crossmember_height)
entrance_arc_points = Point.ByCoordinates(x=start_and_end_adjuster.end, y=y_start_end, z=crossmember_height)
upper_arc_points = Point.ByCoordinates(x=start_and_end_adjuster.start, y=y_start_end, z=crossmember_height)
upper_arc = Arc.ByCenterPointStartPointEndPoint(centerPoint=crossmeber_height, startPoint=entrance_arc_points, endPoint=upper_arc_points)
top_points = Curve.PointAtParameter(curve=upper_arc, param=parameter_range.out1)
crossmember_radius = IntegerSlider(85, range=80..120 step 1)
radius_calulation = CodeBlock(r=crossmember_radius) { r; upper_lower_r = r * (3/2.5); }
gussets_crossmembers_class = Python()  # CPython3; unwired: IN[0]
# ---------- gussets_crossmembers_class.python (15 lines) ----------
# Load the Python Standard and DesignScript Libraries
import sys
import clr
clr.AddReference('ProtoGeometry')
from Autodesk.DesignScript.Geometry import *

class CircularRod:
    def __init__(self, bottom_point, top_point, radius):
        self.bottom = bottom_point
        self.top = top_point
        self.radius = radius
    
    def make_geometry(self):
        return Cylinder.ByPointsRadius(self.bottom, self.top, self.radius)
OUT = CircularRod
# ----------------------------------------
crossmembers = Python(IN[0]=bottom_points, IN[1]=top_points, IN[2]=radius_calulation.r, IN[3]=gussets_crossmembers_class)  # CPython3
# ---------- crossmembers.python (19 lines) ----------
import math

CircularRod = IN[3]
Bot_points = IN[0] 
Top_points = IN[1]
rad = IN[2]

rods = []

for i in range(len(Bot_points)):
    btmpts = Bot_points[i]
    tppts = Top_points[i]
     
    rod = CircularRod(btmpts, tppts, rad)
    rods.append(rod.make_geometry())
    
    vol = (i+1)*2*3.14159265359*rad*tppts.Z
    
OUT = rods, vol
# ----------------------------------------
index = CodeBlock { 1; 0; }
vol_1 = List.GetItemAtIndex(list=crossmembers, index=index.out0)
bottom_points_2 = Python(IN[0]=bottom_points, IN[1]=top_points)  # CPython3
# ---------- bottom_points_2.python (16 lines) ----------
# Load the Python Standard and DesignScript Libraries
import sys
import clr
clr.AddReference('ProtoGeometry')
from Autodesk.DesignScript.Geometry import *

lower = IN[0]
upper = IN[1]

endpoints = []
for i in range(len(upper)-1):
     if i % 2 == 0:
        ends = lower[i+1]
        endpoints.append(ends)
  
OUT = endpoints
# ----------------------------------------
top_points_2 = Python(IN[0]=top_points)  # CPython3
# ---------- top_points_2.python (15 lines) ----------
# Load the Python Standard and DesignScript Libraries
import sys
import clr
clr.AddReference('ProtoGeometry')
from Autodesk.DesignScript.Geometry import *

upper = IN[0]

startpoints = []
for i in range(len(upper)-1):
     if i % 2 == 0:
        start = upper[i]
        startpoints.append(start)
       
OUT = startpoints
# ----------------------------------------
positive_gussets = Python(IN[0]=bottom_points_2, IN[1]=top_points_2, IN[2]=radius_calulation.r, IN[3]=gussets_crossmembers_class)  # CPython3
# ---------- positive_gussets.python (20 lines) ----------
import math

CircularRod = IN[3]
Bot_points = IN[0] 
Top_points = IN[1]
rad = IN[2]

rods = []

for i in range(len(Bot_points)):
    btmpts = Bot_points[i]
    tppts = Top_points[i]
    
    rod = CircularRod(btmpts, tppts, rad)
    rods.append(rod.make_geometry())
    
    height = [c.Height for c in rods]
    vol = (i+1)*2*3.14159265359*rad*height[i]
    
OUT = rods, vol
# ----------------------------------------
vol_2 = List.GetItemAtIndex(list=positive_gussets, index=index.out0)
top_points_offset = Python(IN[0]=top_points)  # CPython3
# ---------- top_points_offset.python (15 lines) ----------
# Load the Python Standard and DesignScript Libraries
import sys
import clr
clr.AddReference('ProtoGeometry')
from Autodesk.DesignScript.Geometry import *

upper = IN[0]

startpoints = []
for i in range(len(upper)-1):
     if i % 2 != 0:
        start = upper[i+1]
        startpoints.append(start)
       
OUT = startpoints
# ----------------------------------------
negative_gussets = Python(IN[0]=top_points_offset, IN[1]=bottom_points_2, IN[2]=radius_calulation.r, IN[3]=gussets_crossmembers_class)  # CPython3
# ---------- negative_gussets.python (21 lines) ----------
import math

CircularRod = IN[3]
Bot_points = IN[0] 
Top_points = IN[1]
rad = IN[2]

rods = []

for i in range(len(Bot_points)):
    btmpts = Bot_points[i]
    tppts = Top_points[i]
     
    
    rod = CircularRod(btmpts, tppts, rad)
    rods.append(rod.make_geometry())
    
    height = [c.Height for c in rods]
    vol = (i+1)*2*3.14159265359*rad*height[i]
    
OUT = rods, vol
# ----------------------------------------
vol_3 = List.GetItemAtIndex(list=negative_gussets, index=index.out0)
list_of_volumes = List.Create(item0=vol_1, item1=vol_2, item2=vol_3)
summation_of_volumes = Math.Sum(values=list_of_volumes)
adding_script = CodeBlock(Voltot=summation_of_volumes) { Voltot; script = String.FromObject(Voltot) + " mm^3"; }
volume_crossmembers_gussets = Watch(adding_script.script)
entrance_arc = Arc.ByCenterPointStartPointEndPoint(centerPoint=crossmeber_height, startPoint=upper_arc_points, endPoint=entrance_arc_points)
entrance_length = Curve.Length(curve=entrance_arc)
vector_for_angle_1 = Vector.ByTwoPoints(start=crossmeber_height, end=upper_arc_points)
vector_for_angle_2 = Vector.ByTwoPoints(start=crossmeber_height, end=entrance_arc_points)
entrance_angle = Vector.AngleWithVector(vector=vector_for_angle_1, otherVector=vector_for_angle_2)
radius_calcuation = CodeBlock(s=entrance_length, Theta=entrance_angle, up_low_rad=radius_calulation.upper_lower_r) { s; Theta; up_low_rad; Rads = Theta * (3.14159265359/180); r = s/Rads; }
volume_calculation = CodeBlock(r=radius_calcuation.up_low_rad, R=radius_calcuation.r) { r; R; Vol = 2*3.14159265359*3.14159265359*r*r*R; script = String.FromObject(Vol) + " mm^3"; }
volume_of_torus = Watch(volume_calculation.script)
steel_torus = TSpline.TSplineSurface.ByTorusCenterRadii(center=crossmeber_height, innerRadius=radius_calcuation.up_low_rad, outerRadius=radius_calcuation.r, innerRadiusSpans=radius_calulation.upper_lower_r, outerRadiusSpans=radius_calulation.upper_lower_r)
steel_grey = ColorPalette({R: 91, G: 89, B: 94, A: 255})
coloured_torus = Modifiers.GeometryColor.ByGeometryColor(geometry=steel_torus, color=steel_grey)
height_offset = CodeBlock(Xh=crossmember_height) { 0; Xh; H = Xh + 1000; }
byCoordinates_3 = Point.ByCoordinates(x=height_offset.out0, y=height_offset.out0, z=height_offset.H)
repeated_parameter_endpoints_for = CodeBlock(numlines=of_crossmembers, endpoints=byCoordinates_3) { numlines; endpoints; List.Repeat(endpoints, numlines); }  # "repeated parameter (endpoints for polylines)"
start_points_and_end_points = Python(IN[0]=top_points, IN[1]=repeated_parameter_endpoints_for.out2)  # "Start points and end points (tuples)"; CPython3
# ---------- start_points_and_end_points.python (12 lines) ----------
# Load the Python Standard and DesignScript Libraries
import sys
import clr
clr.AddReference('ProtoGeometry')
from Autodesk.DesignScript.Geometry import *

start_points = IN[0]
end_points = IN[1]

tuples = list(zip(start_points, end_points))
    
OUT = tuples
# ----------------------------------------
crossmemebr_to_center_lines = PolyCurve.ByPoints(points=start_points_and_end_points)
straight_lines_for_roof = Line.ByStartPointEndPoint(startPoint=top_points, endPoint=byCoordinates_3)
repeated_parameter_midpoint_for = CodeBlock(numlines=of_crossmembers) { numlines; List.Repeat(0.5, numlines); }  # "repeated parameter (midpoint for lines)"
center_points_for_arcs = Curve.PointAtParameter(curve=straight_lines_for_roof, param=repeated_parameter_midpoint_for.out1)
arc_of_roof_flaps = Arc.ByCenterPointStartPointEndPoint(centerPoint=center_points_for_arcs, startPoint=top_points, endPoint=byCoordinates_3)
creation_of_the_closed_poly = Python(IN[0]=crossmemebr_to_center_lines, IN[1]=arc_of_roof_flaps)  # "creation of the closed poly curve"; CPython3
# ---------- creation_of_the_closed_poly.python (18 lines) ----------
import sys
import clr
clr.AddReference('ProtoGeometry')
from Autodesk.DesignScript.Geometry import *

line = IN[0]
arc = IN[1]

curves = []
pcurves=[]

for i in range(len(line)):
    curves.append((arc[i],line[i]))
    
for k in range(len(line)):
    pcurves.append(PolyCurve.ByJoinedCurves(curves[k]))
  
OUT = pcurves
# ----------------------------------------
roof_flaps = Surface.ByPatch(closedCurve=creation_of_the_closed_poly)
thickness = DoubleSlider(31.8, range=10..40 step 0.1)
solid_creation = Surface.Thicken(surface=roof_flaps, thickness=thickness)
list_of_flaps_volumes = Solid.Volume(solid=solid_creation)
summation_of_volumes_2 = Math.Sum(values=list_of_flaps_volumes)
adding_script_2 = CodeBlock(Voltot=summation_of_volumes_2) { Voltot; script = String.FromObject(Voltot) + " mm^3"; }
final_roof_volume = Watch(adding_script_2.script)
origin = Point.Origin()
origin_2 = Point.Origin()
vertical_centerline = Line.ByStartPointEndPoint(startPoint=origin_2, endPoint=byCoordinates_3)
number_of_rings = IntegerSlider(51, range=30..75 step 1)
parameter_range_2 = CodeBlock(n=number_of_rings) { n; 0..1..#n+1; }
index_2 = CodeBlock { 0; }
removal_of_the_first_point = List.RemoveItemAtIndex(list=parameter_range_2.out1, indices=index_2)
parameter_of_centerpoints = Curve.PointAtParameter(curve=vertical_centerline, param=removal_of_the_first_point)
distance_of_points = Geometry.DistanceTo(geometry=origin_2, other=byCoordinates_3)
radius_calcualtion = CodeBlock(lenCenterLine=distance_of_points, Nboxes=number_of_rings) { lenCenterLine; Nboxes; H_of_box = lenCenterLine/Nboxes; transtation = -(H_of_box/2); }
center_points_for_rings = Geometry.Translate(geometry=parameter_of_centerpoints, zTranslation=[radius_calcualtion.transtation, radius_calcualtion.transtation])
radius_and_index = CodeBlock { 75; -1; }
end_point = List.GetItemAtIndex(list=center_points_for_rings, index=radius_and_index.out1)
center_post = Python(IN[0]=origin, IN[1]=end_point, IN[2]=radius_and_index.out0, IN[3]=gussets_crossmembers_class)  # CPython3
# ---------- center_post.python (15 lines) ----------
import math

CircularRod = IN[3]
Bot_points = IN[0] 
Top_points = IN[1]
rad = IN[2]


rod = CircularRod(Bot_points, Top_points, rad)   

rods = rod.make_geometry()

vol = 2*3.14159265359*rad*Top_points.Z   

OUT = rods, vol
# ----------------------------------------
post_volume = List.GetItemAtIndex(list=center_post, index=radius_and_index.out1)
adding_script_3 = CodeBlock(Voltot=post_volume) { Voltot; script = String.FromObject(Voltot) + " mm^3"; }
center_post_volume = Watch(adding_script_3.script)
revolved_radius = CodeBlock(n=number_of_rings) { 0; n; m = (300..125..#n); }
heights_of_center_points = Python(IN[0]=center_points_for_rings)  # CPython3
# ---------- heights_of_center_points.python (15 lines) ----------
# Load the Python Standard and DesignScript Libraries
import sys
import clr
clr.AddReference('ProtoGeometry')
from Autodesk.DesignScript.Geometry import *

points = IN[0]

heights = []

for i in range(len(points)-1):
    z_cord = points[i].Z
    heights.append(z_cord)
    
OUT = heights
# ----------------------------------------
center_for_profile = Point.ByCoordinates(y=revolved_radius.m, z=heights_of_center_points)
radius_of_profile = CodeBlock(h=[radius_calcualtion.H_of_box, radius_calcualtion.H_of_box]) { h; h/2; }
direction_of_profile = Vector.XAxis()
profile_circle = Circle.ByCenterPointRadiusNormal(centerPoint=center_for_profile, radius=radius_of_profile.out1, normal=direction_of_profile)
ax_og = Point.ByCoordinates()
ax_di = Vector.ZAxis()
start_and_sweep = CodeBlock { 0; 360; }
center_ring_class = Python()  # CPython3; unwired: IN[0]
# ---------- center_ring_class.python (18 lines) ----------
# Load the Python Standard and DesignScript Libraries
import sys
import clr
clr.AddReference('ProtoGeometry')
from Autodesk.DesignScript.Geometry import *

class Revolved:
    def __init__(self, profile, ax_og, ax_di, start, sweep):
        self.profile = profile
        self.ax_og = ax_og
        self.ax_di = ax_di
        self.start = start
        self.sweep = sweep
    
    def make_geometry(self):
        return Solid.ByRevolve(self.profile, self.ax_og, self.ax_di, self.start, self.sweep)
      
OUT = Revolved 
# ----------------------------------------
series_of_ring_instance = Python(IN[0]=profile_circle, IN[1]=ax_og, IN[2]=ax_di, IN[3]=start_and_sweep.out0, IN[4]=start_and_sweep.out1, IN[5]=center_ring_class, IN[6]=radius_of_profile.out1, IN[7]=center_for_profile)  # CPython3
# ---------- series_of_ring_instance.python (28 lines) ----------
# Load the Python Standard and DesignScript Libraries
import sys
import clr
clr.AddReference('ProtoGeometry')
from Autodesk.DesignScript.Geometry import *

Revolved = IN[5]
profile = IN[0]
ax_og = IN[1]
ax_di = IN[2]
start = IN[3]
sweep = IN[4]

profile_rad = IN[6]
ring_rad = IN[7]

rings = []
ring_vol = []


for i in range(len(profile)):
    solid_obj = Revolved(profile[i], ax_og, ax_di, start, sweep)
    
    rings.append(solid_obj.make_geometry())
    
    ring_vol.append((3.14159265359**2) * (profile_rad**2) * ring_rad[i].Y)

OUT = rings, ring_vol
# ----------------------------------------
index_3 = CodeBlock { 0; 1; }
list_of_volumes_2 = List.GetItemAtIndex(list=series_of_ring_instance, index=index_3.out1)
summation_of_volumes_3 = Math.Sum(values=list_of_volumes_2)
adding_script_4 = CodeBlock(Voltot=summation_of_volumes_3) { Voltot; script = String.FromObject(Voltot) + " mm^3"; }
center_rings_volume = Watch(adding_script_4.script)
seperation_of_flaps = Python(IN[0]=solid_creation)  # CPython3
# ---------- seperation_of_flaps.python (12 lines) ----------
# Load the Python Standard and DesignScript Libraries
import sys
import clr
clr.AddReference('ProtoGeometry')
from Autodesk.DesignScript.Geometry import *

solids = IN[0]

greens = solids[0::2]
golds = solids[1::2]

OUT = greens, golds
# ----------------------------------------
index_4 = CodeBlock { 0; 1; }
gold_flaps = List.GetItemAtIndex(list=seperation_of_flaps, index=index_4.out1)
gold = ColorPalette({R: 255, G: 192, B: 0, A: 255})
gold_flaps_showing = Modifiers.GeometryColor.ByGeometryColor(geometry=gold_flaps, color=gold)
green_flaps = List.GetItemAtIndex(list=seperation_of_flaps, index=index_4.out0)
green = ColorPalette({R: 0, G: 77, B: 1, A: 255})
green_flaps_showing = Modifiers.GeometryColor.ByGeometryColor(geometry=green_flaps, color=green)
crossmembers_list = List.GetItemAtIndex(list=crossmembers, index=index.out1)
crossmembers_2 = Modifiers.GeometryColor.ByGeometryColor(geometry=crossmembers_list, color=steel_grey)
negative_gusset_list = List.GetItemAtIndex(list=negative_gussets, index=index.out1)
gold_2 = ColorPalette({R: 255, G: 192, B: 0, A: 255})
gold_gussets = Modifiers.GeometryColor.ByGeometryColor(geometry=negative_gusset_list, color=gold_2)
positive_gusset_list = List.GetItemAtIndex(list=positive_gussets, index=index.out1)
green_2 = ColorPalette({R: 0, G: 77, B: 1, A: 255})
green_gussets = Modifiers.GeometryColor.ByGeometryColor(geometry=positive_gusset_list, color=green_2)
list_of_ring_instances = List.GetItemAtIndex(list=series_of_ring_instance, index=index_3.out0)
steel_coloured_rings = Modifiers.GeometryColor.ByGeometryColor(geometry=list_of_ring_instances, color=steel_grey)
