# Dynamo graph 1873764.dyn (Dynamo 3.6.0.9395)

# group: Don't touch this ground
code_block = CodeBlock { -5000; -5000; -200; }
byCoordinates = Point.ByCoordinates(x=code_block.out0, y=code_block.out1, z=code_block.out2)
code_block_2 = CodeBlock { 5000; 5000; 0; }
byCoordinates_2 = Point.ByCoordinates(x=code_block_2.out0, y=code_block_2.out1, z=code_block_2.out2)
byCorners = Cuboid.ByCorners(lowPoint=byCoordinates, highPoint=byCoordinates_2)
code_block_3 = CodeBlock { 0; 100; 0; }
byARGB = Color.ByARGB(red=code_block_3.out0, green=code_block_3.out1, blue=code_block_3.out2)
byGeometryColor = Modifiers.GeometryColor.ByGeometryColor(geometry=byCorners, color=byARGB)

count = List.Count()  # unwired: list
class_rectangular_timber_planks = Python()  # CPython3; unwired: IN[0]
# ---------- class_rectangular_timber_planks.python (19 lines) ----------
# Load the Python Standard and DesignScript Libraries
import sys
import clr
clr.AddReference('ProtoGeometry')
from Autodesk.DesignScript.Geometry import *

class RectangularTimberPlank:
    def __init__(self, origin, width, length, height):
        self.origin = origin
        self.width = width
        self.length = length
        self.height = height
    
    def make_geometry(self):
        return Cuboid.ByLengths(self.origin, self.width, self.length, self.height)
    
    def measure_volume(self):
        return self.width*self.length*self.height
OUT = RectangularTimberPlank
# ----------------------------------------
code_block_4 = CodeBlock { 0; 0; 0; }
byCoordinates_3 = Point.ByCoordinates(x=code_block_4.out0, y=code_block_4.out1, z=code_block_4.out2)
code_block_5 = CodeBlock { -5000; 0; 0; }
byCoordinates_4 = Point.ByCoordinates(x=code_block_5.out0, y=code_block_5.out1, z=code_block_5.out2)
code_block_6 = CodeBlock { 0; 0; }
circular_steel_rod_height = DoubleSlider(6100, range=4000..8000 step 100)
byCoordinates_5 = Point.ByCoordinates(x=code_block_6.out0, y=code_block_6.out1, z=circular_steel_rod_height)
byStartPointEndPoint = Line.ByStartPointEndPoint(startPoint=byCoordinates_4, endPoint=byCoordinates_5)
number_slider = DoubleSlider(14, range=1..25 step 1)
code_block_7 = CodeBlock(n=number_slider) { n; 0..1..#n; }
watch = Watch(code_block_7.out1)
splitByParameter = Curve.SplitByParameter(curve=byStartPointEndPoint, parameters=watch)
endPoint = Curve.EndPoint(curve=splitByParameter)
addItemToFront = List.AddItemToFront(item=byCoordinates_3, list=endPoint)
code_block_8 = CodeBlock { 4800; 4800; 0; }
byCoordinates_6 = Point.ByCoordinates(x=code_block_8.out0, y=code_block_8.out1, z=code_block_8.out2)
byStartPointEndPoint_2 = Line.ByStartPointEndPoint(startPoint=byCoordinates_6, endPoint=byCoordinates_5)
splitByParameter_2 = Curve.SplitByParameter(curve=byStartPointEndPoint_2, parameters=watch)
endPoint_2 = Curve.EndPoint(curve=splitByParameter_2)
addItemToFront_2 = List.AddItemToFront(item=byCoordinates_3, list=endPoint_2)
count_2 = List.Count(list=addItemToFront_2)
code_block_9 = CodeBlock(list_length=count_2) { list_length; [0, list_length-1]; }
removeItemAtIndex = List.RemoveItemAtIndex(list=addItemToFront, indices=code_block_9.out1)
timber_plank_width = DoubleSlider(281, range=10..500 step 1)
list_create = List.Create(item0=timber_plank_width)
removeItemAtIndex_2 = List.RemoveItemAtIndex(list=addItemToFront_2, indices=code_block_9.out1)
code_block_10 = CodeBlock { -4800; 4800; 0; }
byCoordinates_7 = Point.ByCoordinates(x=code_block_10.out0, y=code_block_10.out1, z=code_block_10.out2)
byStartPointEndPoint_3 = Line.ByStartPointEndPoint(startPoint=byCoordinates_7, endPoint=byCoordinates_5)
splitByParameter_3 = Curve.SplitByParameter(curve=byStartPointEndPoint_3, parameters=watch)
endPoint_3 = Curve.EndPoint(curve=splitByParameter_3)
addItemToFront_3 = List.AddItemToFront(item=byCoordinates_3, list=endPoint_3)
removeItemAtIndex_3 = List.RemoveItemAtIndex(list=addItemToFront_3, indices=code_block_9.out1)
byStartPointEndPoint_4 = Line.ByStartPointEndPoint(startPoint=removeItemAtIndex_2, endPoint=removeItemAtIndex_3)
length = Curve.Length(curve=byStartPointEndPoint_4)
length_2 = Curve.Length(curve=byStartPointEndPoint_3)
code_block_11 = CodeBlock(Len_line=length_2, N_planks=code_block_7.n) { Len_line; N_planks; H_planks_max = Len_line/(2*N_planks); }
list_create_2 = List.Create(item0=code_block_11.H_planks_max)
series_of_instances_of = Python(IN[0]=class_rectangular_timber_planks, IN[1]=removeItemAtIndex, IN[2]=list_create, IN[3]=length, IN[4]=list_create_2)  # "Series of instances of Rectangular Timber Planks"; CPython3
# ---------- series_of_instances_of.python (29 lines) ----------
# Load the Python Standard and DesignScript Libraries
import sys
import clr
clr.AddReference('ProtoGeometry')
from Autodesk.DesignScript.Geometry import *
import math

RectangularTimberPlank = IN[0]
origins = IN[1]
widths = IN[2]
lengths = IN[3]
heights = IN[4]

planks = []
plank_volumes = []

count = len(origins)
for i in range(count):
    w = widths[i] if i<len(widths) else widths[-1]
    h = heights[i] if i<len(heights) else heights[-1]
    o = origins[i]
    l = lengths[i] 
  
    plank = RectangularTimberPlank(o, w, l, h)
    planks.append(plank.make_geometry())
    plank_volumes.append(plank.measure_volume())

     
OUT = (planks, sum(plank_volumes))
# ----------------------------------------
code_block_12 = CodeBlock { 1; }
getItemAtIndex = List.GetItemAtIndex(list=series_of_instances_of, index=code_block_12)
watch_volume_of_series_of = Watch(getItemAtIndex)  # "Watch Volume of Series of Instances of Timber PLanks #2 (mm^2)"
code_block_13 = CodeBlock { 0; 5000; 0; }
byCoordinates_8 = Point.ByCoordinates(x=code_block_13.out0, y=code_block_13.out1, z=code_block_13.out2)
byStartPointEndPoint_5 = Line.ByStartPointEndPoint(startPoint=byCoordinates_8, endPoint=byCoordinates_5)
splitByParameter_4 = Curve.SplitByParameter(curve=byStartPointEndPoint_5, parameters=watch)
endPoint_4 = Curve.EndPoint(curve=splitByParameter_4)
addItemToFront_4 = List.AddItemToFront(item=byCoordinates_3, list=endPoint_4)
removeItemAtIndex_4 = List.RemoveItemAtIndex(list=addItemToFront_4, indices=code_block_9.out1)
code_block_14 = CodeBlock { -4800; -4800; 0; }
byCoordinates_9 = Point.ByCoordinates(x=code_block_14.out0, y=code_block_14.out1, z=code_block_14.out2)
byStartPointEndPoint_6 = Line.ByStartPointEndPoint(startPoint=byCoordinates_9, endPoint=byCoordinates_5)
splitByParameter_5 = Curve.SplitByParameter(curve=byStartPointEndPoint_6, parameters=watch)
endPoint_5 = Curve.EndPoint(curve=splitByParameter_5)
addItemToFront_5 = List.AddItemToFront(item=byCoordinates_3, list=endPoint_5)
removeItemAtIndex_5 = List.RemoveItemAtIndex(list=addItemToFront_5, indices=code_block_9.out1)
byStartPointEndPoint_7 = Line.ByStartPointEndPoint(startPoint=removeItemAtIndex_5, endPoint=removeItemAtIndex_3)
length_3 = Curve.Length(curve=byStartPointEndPoint_7)
series_of_instances_of_2 = Python(IN[0]=class_rectangular_timber_planks, IN[1]=removeItemAtIndex_4, IN[2]=length_3, IN[3]=list_create, IN[4]=list_create_2)  # "Series of Instances of Rectangular Timber Planks"; CPython3
# ---------- series_of_instances_of_2.python (29 lines) ----------
# Load the Python Standard and DesignScript Libraries
import sys
import clr
clr.AddReference('ProtoGeometry')
from Autodesk.DesignScript.Geometry import *
import math

RectangularTimberPlank = IN[0]
origins = IN[1]
widths = IN[2]
lengths = IN[3]
heights = IN[4]

planks = []
plank_volumes = []

count = len(origins)
for i in range(count):
    l = lengths[i] if i<len(lengths) else lengths[-1]
    h = heights[i] if i<len(heights) else heights[-1]
    o = origins[i]
    w = widths[i] 
  
    plank = RectangularTimberPlank(o, w, l, h)
    planks.append(plank.make_geometry())
    plank_volumes.append(plank.measure_volume())

     
OUT = (planks, sum(plank_volumes))
# ----------------------------------------
getItemAtIndex_2 = List.GetItemAtIndex(list=series_of_instances_of_2, index=code_block_12)
watch_volume_of_series_of_2 = Watch(getItemAtIndex_2)  # "Watch Volume of Series of Instanes of Timber planks #1 (mm^2)"
list_create_3 = List.Create(item0=watch_volume_of_series_of, item1=watch_volume_of_series_of_2)
sum = Math.Sum(values=list_create_3)
python_script = Python(IN[0]=sum)  # CPython3
# ---------- python_script.python (9 lines) ----------
# Load the Python Standard and DesignScript Libraries
import sys
import clr
clr.AddReference('ProtoGeometry')
from Autodesk.DesignScript.Geometry import *

vol_Timber_Planks = IN[0]
Total_vol_Timber_Planks = str(vol_Timber_Planks) + " mm^3"
OUT = Total_vol_Timber_Planks
# ----------------------------------------
total_volume_of_timber_planks = Watch(python_script)
class_circular_steel_rod = Python()  # CPython3; unwired: IN[0]
# ---------- class_circular_steel_rod.python (24 lines) ----------
# Load the Python Standard and DesignScript Libraries
import sys
import clr
clr.AddReference('ProtoGeometry')
from Autodesk.DesignScript.Geometry import *
import math

class CircularSteelRod:
    def __init__(self, centerline, radius):
        self.centerline = centerline
        self.radius = radius
    
    def endpoints(self):
        return self.centerline.StartPoint, self.centerline.EndPoint
    
    def make_geometry(self):
        end1, end2 = self.endpoints()
        
        return Cylinder.ByPointsRadius(end1, end2, self.radius) 
    
    def measure_volume(self):
        end1, end2 = self.endpoints()
        return end1.DistanceTo(end2)*self.radius*self.radius*math.pi              
OUT = CircularSteelRod
# ----------------------------------------
radius_of_circular_steel_rod = IntegerSlider(128, range=80..150 step 1)
instance_of_a_circular_steel_rod = Python(IN[0]=class_circular_steel_rod, IN[1]=byStartPointEndPoint_6, IN[2]=radius_of_circular_steel_rod)  # CPython3
# ---------- instance_of_a_circular_steel_rod.python (10 lines) ----------
# Load the Python Standard and DesignScript Libraries
import sys
import clr
clr.AddReference('ProtoGeometry')
from Autodesk.DesignScript.Geometry import *
import math

CircularSteelRod = IN[0]
b = CircularSteelRod(IN[1], IN[2])
OUT = [b.make_geometry(), b.measure_volume()]
# ----------------------------------------
code_block_15 = CodeBlock { 1; }
getItemAtIndex_3 = List.GetItemAtIndex(list=instance_of_a_circular_steel_rod, index=code_block_15)
watch_volume_of_rod_1 = Watch(getItemAtIndex_3)
instance_of_a_circular_steel_rod_2 = Python(IN[0]=class_circular_steel_rod, IN[1]=byStartPointEndPoint_2, IN[2]=radius_of_circular_steel_rod)  # CPython3; same code as instance_of_a_circular_steel_rod
getItemAtIndex_4 = List.GetItemAtIndex(list=instance_of_a_circular_steel_rod_2, index=code_block_15)
watch_volume_of_rod_2 = Watch(getItemAtIndex_4)
instance_of_a_circular_steel_rod_3 = Python(IN[0]=class_circular_steel_rod, IN[1]=byStartPointEndPoint_3, IN[2]=radius_of_circular_steel_rod)  # CPython3; same code as instance_of_a_circular_steel_rod
getItemAtIndex_5 = List.GetItemAtIndex(list=instance_of_a_circular_steel_rod_3, index=code_block_15)
watch_volume_of_rod_3 = Watch(getItemAtIndex_5)
list_create_4 = List.Create(item0=watch_volume_of_rod_1, item1=watch_volume_of_rod_2, item2=watch_volume_of_rod_3)
sum_2 = Math.Sum(values=list_create_4)
python_script_2 = Python(IN[0]=sum_2)  # CPython3
# ---------- python_script_2.python (9 lines) ----------
# Load the Python Standard and DesignScript Libraries
import sys
import clr
clr.AddReference('ProtoGeometry')
from Autodesk.DesignScript.Geometry import *

vol_Steel_Cylinders = IN[0]
Total_vol_Steel_Cylinders = str(vol_Steel_Cylinders) + " mm^3"
OUT = Total_vol_Steel_Cylinders
# ----------------------------------------
watch_total_volume_of_circular = Watch(python_script_2)  # "Watch Total Volume of Circular Steel Rods"
