# Dynamo graph 1873837.dyn "GurinderLohat#dyn, like 1873837" (Dynamo 4.0.0.3277)

# group: Don't touch this ground
code_block = CodeBlock { -5000; -5000; -200; }
byCoordinates = Point.ByCoordinates(x=code_block.out0, y=code_block.out1, z=code_block.out2)
code_block_2 = CodeBlock { 5000; 5000; 0; }
byCoordinates_2 = Point.ByCoordinates(x=code_block_2.out0, y=code_block_2.out1, z=code_block_2.out2)
byCorners = Cuboid.ByCorners(lowPoint=byCoordinates, highPoint=byCoordinates_2)
code_block_3 = CodeBlock { 0; 100; 0; }
byARGB = Color.ByARGB(red=code_block_3.out0, green=code_block_3.out1, blue=code_block_3.out2)
byGeometryColor = Modifiers.GeometryColor.ByGeometryColor(geometry=byCorners, color=byARGB)

classes_steelrod_concretefooting = Python()  # PythonNet3; unwired: IN[0]
# ---------- classes_steelrod_concretefooting.python (37 lines) ----------
import clr
clr.AddReference('ProtoGeometry')
from Autodesk.DesignScript.Geometry import Point, Cylinder, Cuboid

class SteelRod:
    
    def __init__(self, p0, p1, r):
        self.p0 = p0
        self.p1 = p1
        self.r = r

    def geometry(self):
        return Cylinder.ByPointsRadius(self.p0, self.p1, self.r)

    def volume(self):
        return self.geometry().Volume  


class ConcreteFooting:
    
    def __init__(self, center_xy_point, w, d, h):
        self.c = center_xy_point
        self.w = w
        self.d = d
        self.h = h

    def geometry(self):
        x = self.c.X
        y = self.c.Y
        pmin = Point.ByCoordinates(x - self.w/2.0, y - self.d/2.0, 0)
        pmax = Point.ByCoordinates(x + self.w/2.0, y + self.d/2.0, self.h)
        return Cuboid.ByCorners(pmin, pmax)

    def volume(self):
        return self.geometry().Volume  

OUT = (SteelRod, ConcreteFooting)
# ----------------------------------------
spanX = DoubleSlider(8000, range=4000..9000 step 1)
segmentsPerRib = DoubleSlider(35, range=6..60 step 1)
code_block_4 = CodeBlock(SpanX=spanX, Segments=segmentsPerRib) { x = (-SpanX/2)..(SpanX/2)..#(Segments+1); }
rizeZ = DoubleSlider(3500, range=1500..5000 step 1)
code_block_5 = CodeBlock(Rise=rizeZ, x=code_block_4, SpanX=spanX) { z = Rise * (1 - Math.Pow(x/(SpanX/2), 2)); }
byCoordinates_3 = Point.ByCoordinates(x=code_block_4, z=code_block_5)
byPoints = NurbsCurve.ByPoints(points=byCoordinates_3)
lengthY = DoubleSlider(6000, range=2000..9000 step 1)
ribsCount = DoubleSlider(14, range=3..25 step 1)
code_block_6 = CodeBlock(LengthY=lengthY, Ribs=ribsCount) { y = (-LengthY/2)..(LengthY/2)..#Ribs; }
byCoordinates_4 = Vector.ByCoordinates(y=code_block_6)
translate = Geometry.Translate(geometry=byPoints, direction=byCoordinates_4)
rodRadius = DoubleSlider(80, range=20..200 step 1)
footingW = DoubleSlider(600, range=200..1200 step 1)
footingD = DoubleSlider(600, range=200..1200 step 1)
footingH = DoubleSlider(300, range=100..800 step 1)
instances_steelrods_footings = Python(IN[0]=classes_steelrod_concretefooting, IN[1]=translate, IN[2]=segmentsPerRib, IN[3]=rodRadius, IN[4]=footingW, IN[5]=footingD, IN[6]=footingH)  # "Instances: SteelRods + Footings + VolumeTakeoff"; PythonNet3
# ---------- instances_steelrods_footings.python (61 lines) ----------
import clr
clr.AddReference('ProtoGeometry')
from Autodesk.DesignScript.Geometry import Point



SteelRod, ConcreteFooting = IN[0]
ribCurves = IN[1]
segments = int(IN[2])
rodR = float(IN[3])
footW = float(IN[4])
footD = float(IN[5])
footH = float(IN[6])

if not isinstance(ribCurves, list):
    ribCurves = [ribCurves]

def start_point(curve):
    sp = curve.StartPoint
    return sp() if callable(sp) else sp

def end_point(curve):
    ep = curve.EndPoint
    return ep() if callable(ep) else ep


rod_solids = []
rod_volume_total = 0.0

t_values = [i / float(segments) for i in range(segments + 1)]

for c in ribCurves:
    pts = [c.PointAtParameter(t) for t in t_values]
    for i in range(len(pts) - 1):
        rod = SteelRod(pts[i], pts[i+1], rodR)
        solid = rod.geometry()
        rod_solids.append(solid)
        rod_volume_total += solid.Volume


foot_solids = []
foot_volume_total = 0.0

for c in ribCurves:
    sp = start_point(c)
    ep = end_point(c)

    sp_xy = Point.ByCoordinates(sp.X, sp.Y, 0)
    ep_xy = Point.ByCoordinates(ep.X, ep.Y, 0)

    f1 = ConcreteFooting(sp_xy, footW, footD, footH)
    s1 = f1.geometry()
    foot_solids.append(s1)
    foot_volume_total += s1.Volume

    f2 = ConcreteFooting(ep_xy, footW, footD, footH)
    s2 = f2.geometry()
    foot_solids.append(s2)
    foot_volume_total += s2.Volume

OUT = (rod_solids, foot_solids, rod_volume_total, foot_volume_total)
# ----------------------------------------
steelRods = Watch(instances_steelrods_footings)
concreteFooting = Watch(classes_steelrod_concretefooting)
