# Dynamo graph 1874083.dyn (Dynamo 4.0.0.3277)

code_block = CodeBlock { -5000; -5000; -200; }
byCoordinates = Point.ByCoordinates(x=code_block.out0, y=code_block.out1, z=code_block.out2)
code_block_2 = CodeBlock { 5000; 5000; 0; }
byCoordinates_2 = Point.ByCoordinates(x=code_block_2.out0, y=code_block_2.out1, z=code_block_2.out2)
byCorners = Cuboid.ByCorners(lowPoint=byCoordinates, highPoint=byCoordinates_2)
code_block_3 = CodeBlock { 0; 100; 0; }
byARGB = Color.ByARGB(red=code_block_3.out0, green=code_block_3.out1, blue=code_block_3.out2)
byGeometryColor = Modifiers.GeometryColor.ByGeometryColor(geometry=byCorners, color=byARGB)
leanAngle = DoubleSlider(10, range=0..20 step 1)
number_slider = DoubleSlider(-4293.114, range=-4293.114..100 step 0.1)
heightFront = DoubleSlider(2500, range=2200..3200 step 100)
heightBack = DoubleSlider(3200, range=2600..4000 step 100)
code_block_4 = CodeBlock(heightFront=heightFront, heightBack=heightBack)
# ---------- code_block_4.designscript (14 lines) ----------
halfWidth = 4000;
 // width in Y (±4m);
offsetBase = 300;
 // small inward offset at ground;

y0_left  = -halfWidth;
y0_right =  halfWidth;

y1_left  = y0_left  + offsetBase;
y1_right = y0_right - offsetBase;

z0       = 0;
zFront   = heightFront;
zBack    = heightBack;
# ----------------------------------------
left_base = Point.ByCoordinates(x=number_slider, y=code_block_4.y0_left, z=code_block_4.z0)
number_slider_2 = DoubleSlider(-4805.574, range=-5145.005..100 step 0.1)
left_top_column = Point.ByCoordinates(x=number_slider_2, y=code_block_4.y1_left, z=code_block_4.zBack)
number_slider_3 = DoubleSlider(-3358.066, range=-6243.886..30910.766 step 0.1)
number_slider_4 = DoubleSlider(930.155, range=-37565.051..10553.493 step 0.1)
ridge_front = Point.ByCoordinates(x=number_slider_3, y=number_slider_4, z=code_block_4.zFront)
number_slider_5 = DoubleSlider(-3576.708, range=-3959.377..100 step 0.1)
right_top_column = Point.ByCoordinates(x=number_slider_5, y=code_block_4.y1_right, z=code_block_4.zBack)
number_slider_6 = DoubleSlider(-3725.57, range=-8826.928..521.683 step 0.1)
right_base = Point.ByCoordinates(x=number_slider_6, y=code_block_4.y0_right, z=code_block_4.z0)
list_create = List.Create(item0=left_base, item1=left_top_column, item2=ridge_front, item3=right_top_column, item4=right_base, item5=left_base)
byPoints = PolyCurve.ByPoints(points=list_create)
frameCount = IntegerSlider(10, range=5..20 step 1)
frameSpacing = DoubleSlider(800, range=400..1200 step 100)
code_block_5 = CodeBlock(frameCount=frameCount, frameSpacing=frameSpacing) { xs = 0..((frameCount - 1) * frameSpacing)..frameSpacing; }
code_block_6 = CodeBlock { 0; }
translate = Geometry.Translate(geometry=byPoints, xTranslation=code_block_5, yTranslation=code_block_6)
woodWidth = DoubleSlider(140, range=80..200 step 10)
woodDepth = DoubleSlider(200, range=80..250 step 10)
python_script = Python(IN[0]=translate, IN[1]=woodWidth, IN[2]=woodDepth)  # PythonNet3
# ---------- python_script.python (54 lines) ----------
import clr
clr.AddReference('ProtoGeometry')
from Autodesk.DesignScript.Geometry import *

# IN[0] = list of frame center curves (PolyCurves)
# IN[1] = wood width (mm)
# IN[2] = wood depth (mm)

frames = IN[0]
w = IN[1]
d = IN[2]

class WoodFrame(object):
    def __init__(self, curve, width, depth):
        self.curve = curve
        self.width = width
        self.depth = depth

    def makeGeometry(self):
        # Offset by translating left/right in X to create two side curves
        half_w = self.width / 2.0

        v_pos = Vector.ByCoordinates( half_w, 0, 0)
        v_neg = Vector.ByCoordinates(-half_w, 0, 0)

        c1 = self.curve.Translate(v_pos)
        c2 = self.curve.Translate(v_neg)

        # Loft between the two curves → surface "strip"
        surf = Surface.ByLoft([c1, c2])

        # Thicken the surface → solid wood frame
        solid = surf.Thicken(self.depth, True)
        return solid

    def volume(self):
        return self.makeGeometry().Volume

solids = []
vols = []

# Make sure we always iterate over a list
if isinstance(frames, list):
    curves = frames
else:
    curves = [frames]

for c in curves:
    wf = WoodFrame(c, w, d)
    s = wf.makeGeometry()
    solids.append(s)
    vols.append(wf.volume())

OUT = solids, vols
# ----------------------------------------
code_block_7 = CodeBlock { 0; }
getItemAtIndex = List.GetItemAtIndex(list=python_script, index=code_block_7)
alpha = DoubleSlider(255, range=0..255 step 1)
red = DoubleSlider(180, range=0..255 step 1)
green = DoubleSlider(140, range=0..255 step 1)
blue = DoubleSlider(100, range=0..255 step 1)
byARGB_2 = Color.ByARGB(alpha=alpha, red=red, green=green, blue=blue)
byGeometryColor_2 = Modifiers.GeometryColor.ByGeometryColor(geometry=getItemAtIndex, color=byARGB_2)
pavilionnLength = DoubleSlider(8000, range=4000..9000 step 250)
code_block_8 = CodeBlock(pavilionLength=pavilionnLength, frameSpacing=frameSpacing) { xs = 0..pavilionLength..frameSpacing; }
code_block_9 = CodeBlock { 1; }
getItemAtIndex_2 = List.GetItemAtIndex(list=python_script, index=code_block_9)
sum = Math.Sum(values=getItemAtIndex_2)
material_volume = Watch(sum)
leftRoofBase = Line.ByStartPointEndPoint(startPoint=left_top_column, endPoint=ridge_front)
code_block_10 = CodeBlock { 0; }
code_block_11 = CodeBlock { 0; }
leftRoofCurves = Geometry.Translate(geometry=leftRoofBase, xTranslation=code_block_5, yTranslation=code_block_10, zTranslation=code_block_11)
watch = Watch(leftRoofCurves)
leftRoofBase_2 = List.Create(item0=left_top_column, item1=ridge_front)
rightRoofBase = List.Create(item0=ridge_front, item1=right_top_column)
code_block_12 = CodeBlock { 0; }
leftRoofLinesFlat = List.GetItemAtIndex(list=leftRoofCurves, index=code_block_12)
watch_2 = Watch(leftRoofLinesFlat)
byLoft = Surface.ByLoft(crossSections=leftRoofCurves)
alpha_2 = DoubleSlider(168, range=0..255 step 1)
red_2 = DoubleSlider(170, range=0..255 step 1)
green_2 = DoubleSlider(210, range=0..255 step 1)
blue_2 = DoubleSlider(255, range=0..255 step 1)
byARGB_3 = Color.ByARGB(alpha=alpha_2, red=red_2, green=green_2, blue=blue_2)
byGeometryColor_3 = Modifiers.GeometryColor.ByGeometryColor(geometry=byLoft, color=byARGB_3)
glassThickness = DoubleSlider(30, range=10..40 step 2)
python_script_2 = Python(IN[0]=byLoft, IN[1]=glassThickness)  # PythonNet3
# ---------- python_script_2.python (39 lines) ----------
import clr
clr.AddReference('ProtoGeometry')
from Autodesk.DesignScript.Geometry import *

# IN[0] = glass surface or list of surfaces
# IN[1] = glass thickness (mm)

surfaces = IN[0]
t = IN[1]

class GlassPanel(object):
    def __init__(self, surface, thickness):
        self.surface = surface
        self.thickness = thickness

    def makeGeometry(self):
        # Thicken the surface to make a solid
        solid = self.surface.Thicken(self.thickness, True)
        return solid

    def volume(self):
        return self.makeGeometry().Volume

glass_solids = []
glass_vols = []

# Make sure we always iterate over a list
if isinstance(surfaces, list):
    surfs = surfaces
else:
    surfs = [surfaces]

for s in surfs:
    gp = GlassPanel(s, t)
    solid = gp.makeGeometry()
    glass_solids.append(solid)
    glass_vols.append(gp.volume())

OUT = glass_solids, glass_vols
# ----------------------------------------
code_block_13 = CodeBlock { 0; }
glass_solids = List.GetItemAtIndex(list=python_script_2, index=code_block_13)
code_block_14 = CodeBlock { 1; }
glass_volumes = List.GetItemAtIndex(list=python_script_2, index=code_block_14)
sum_2 = Math.Sum(values=glass_volumes)
material_volume_2_glass_mm³ = Watch(sum_2)
