# Dynamo graph 1874901.dyn "Final_Project" (Dynamo 3.6.0.9395)

# group: Don't touch this ground
code_block = CodeBlock { -5000; -5000; -200; }
byCoordinates = Point.ByCoordinates(x=code_block.out0, y=code_block.out1, z=code_block.out2)
code_block_2 = CodeBlock { 5000; 5000; 0; }
byCoordinates_2 = Point.ByCoordinates(x=code_block_2.out0, y=code_block_2.out1, z=code_block_2.out2)
byCorners = Cuboid.ByCorners(lowPoint=byCoordinates, highPoint=byCoordinates_2)
code_block_3 = CodeBlock { 0; 100; 0; }
byARGB = Color.ByARGB(red=code_block_3.out0, green=code_block_3.out1, blue=code_block_3.out2)
byGeometryColor = Modifiers.GeometryColor.ByGeometryColor(geometry=byCorners, color=byARGB)

circular_metal_rod_class = Python()  # CPython3; unwired: IN[0]
# ---------- circular_metal_rod_class.python (20 lines) ----------
# Load the Python Standard and DesignScript Libraries
import sys
import clr
clr.AddReference('ProtoGeometry')
from Autodesk.DesignScript.Geometry import *
import math

class CircularRods:
    def __init__(self, bottom_point, top_point, radius):
        self.bottom = bottom_point
        self.top = top_point
        self.radius = radius
        
    def make_geometry(self):
        return Cylinder.ByPointsRadius(self.bottom, self.top, self.radius)
        
    def steel_volume(self):
        h = self.bottom.DistanceTo(self.top)
        return h*self.radius*self.radius*math.pi
OUT = CircularRods
# ----------------------------------------
platform_radius = DoubleSlider(3250, range=2000..3250 step 1)
variables_changed_by_platform = CodeBlock(plat_size=platform_radius)  # "Variables Changed by Platform Size"
# ---------- variables_changed_by_platform.designscript (8 lines) ----------
plat_size;
roof_base = plat_size * 1.1;
x = 0;
y = 0;
z = 0;
cone_height = plat_size * 0.1;
plat_base = plat_size * 1.5;
platform_to_columncenter = plat_size * 0.9;
# ----------------------------------------
center_of_platform = Point.ByCoordinates(x=variables_changed_by_platform.x, y=variables_changed_by_platform.y, z=variables_changed_by_platform.cone_height)
circle_for_aligning_columns = Circle.ByCenterPointRadius(centerPoint=center_of_platform, radius=variables_changed_by_platform.platform_to_columncenter)
number_of_columns = DoubleSlider(8, range=4..10 step 1)
list_for_columns = CodeBlock(n=number_of_columns) { n; 0..1..#n+1; }
column_start_points = Curve.PointAtParameter(curve=circle_for_aligning_columns, param=list_for_columns.out1)
ZAxis = Vector.ZAxis()
roof_height = DoubleSlider(2756, range=2250..3500 step 1)
column_length = CodeBlock(column_h=roof_height, cone_h=variables_changed_by_platform.cone_height) { column_h; cone_h; end_pt = column_h - cone_h; }
column_endpoints = Geometry.Translate(geometry=column_start_points, direction=ZAxis, distance=column_length.end_pt)
column_radius = DoubleSlider(100, range=75..125 step 1)
series_of_column_instances = Python(IN[0]=circular_metal_rod_class, IN[1]=column_start_points, IN[2]=column_endpoints, IN[3]=column_radius)  # CPython3
# ---------- series_of_column_instances.python (27 lines) ----------
CircularRods = IN[0]
bottom_points = IN[1]
top_points = IN[2]
radius = IN[3]

volume_unit = "mm³"
total_volume = 0.0

columns = []
count = min(len(bottom_points), len(top_points))

for i in range(count):
  
    r = radius
    btm = bottom_points[i]
    top = top_points[i]
    
    column = CircularRods(btm, top, r)
    
    current_volume = column.steel_volume()
    total_volume += current_volume
    
    columns.append(column.make_geometry())

total_volume_label = "{0:.2f} {1}".format(total_volume, volume_unit)

OUT = (columns, total_volume_label)
# ----------------------------------------
pick_from_instance_output = CodeBlock { 0; 1; }
pick_volume = List.GetItemAtIndex(list=series_of_column_instances, index=pick_from_instance_output.out1)
steel_volume = Watch(pick_volume)
wooden_cone_class = Python()  # CPython3; unwired: IN[0]
# ---------- wooden_cone_class.python (27 lines) ----------
# Load the Python Standard and DesignScript Libraries
import sys
import clr
clr.AddReference('ProtoGeometry')
from Autodesk.DesignScript.Geometry import *
import math

class WoodenCone:
    def __init__(self, centerline, start_radius, end_radius):
        self.centerline = centerline
        self.start_radius = start_radius
        self.end_radius = end_radius
    def endpoints(self):
        return self.centerline.StartPoint, self.centerline.EndPoint
        
    def make_geometry(self):
        end1, end2 = self.endpoints()
        
        return Cone.ByPointsRadii(end1, end2, self.start_radius, self.end_radius)
    
    def wood_volume(self):
        end1, end2 = self.endpoints()
        h = end1.DistanceTo(end2)
        R = self.start_radius
        r = self.end_radius
        return (1.0/3.0)*math.pi*h*(R*R + R*r + r*r)
OUT = WoodenCone
# ----------------------------------------
origin = Point.ByCoordinates(x=variables_changed_by_platform.x, y=variables_changed_by_platform.y, z=variables_changed_by_platform.z)
centerline_of_platform = Line.ByStartPointDirectionLength(startPoint=origin, direction=ZAxis, length=variables_changed_by_platform.cone_height)
centerline_of_roof = Geometry.Translate(geometry=centerline_of_platform, direction=ZAxis, distance=roof_height)
roof_and_platform_instance = Python(IN[0]=wooden_cone_class, IN[1]=centerline_of_roof, IN[2]=variables_changed_by_platform.roof_base, IN[3]=variables_changed_by_platform.plat_size, IN[4]=centerline_of_platform, IN[5]=variables_changed_by_platform.plat_base, IN[6]=platform_radius)  # CPython3
# ---------- roof_and_platform_instance.python (11 lines) ----------
WoodenCone = IN[0]
roof = WoodenCone(IN[1],IN[2],IN[3])
platform = WoodenCone(IN[4],IN[5],IN[6])

volume_unit = "mm³"

total_volume = roof.wood_volume() + platform.wood_volume()

total_volume_label = "{0:.2f} {1}".format(total_volume, volume_unit)

OUT = ([roof.make_geometry(), platform.make_geometry()], total_volume_label)
# ----------------------------------------
pick_volume_2 = List.GetItemAtIndex(list=roof_and_platform_instance, index=pick_from_instance_output.out1)
wood_volume = Watch(pick_volume_2)
pick_geometry = List.GetItemAtIndex(list=roof_and_platform_instance, index=pick_from_instance_output.out0)
wood_color = ColorPalette({R: 255, G: 255, B: 0, A: 255})
byGeometryColor_2 = Modifiers.GeometryColor.ByGeometryColor(geometry=pick_geometry, color=wood_color)
pick_geometry_2 = List.GetItemAtIndex(list=series_of_column_instances, index=pick_from_instance_output.out0)
steel_color = ColorPalette({R: 0, G: 77, B: 20, A: 255})
byGeometryColor_3 = Modifiers.GeometryColor.ByGeometryColor(geometry=pick_geometry_2, color=steel_color)
