# Dynamo graph 1875554.dyn (Dynamo 3.6.0.9395)

# group: Don't touch this ground
code_block = CodeBlock { -5000; -5000; -200; }
byCoordinates = Point.ByCoordinates(x=code_block.out0, y=code_block.out1, z=code_block.out2)
code_block_2 = CodeBlock { 5000; 5000; 0; }
byCoordinates_2 = Point.ByCoordinates(x=code_block_2.out0, y=code_block_2.out1, z=code_block_2.out2)
byCorners = Cuboid.ByCorners(lowPoint=byCoordinates, highPoint=byCoordinates_2)
code_block_3 = CodeBlock { 0; 100; 0; }
byARGB = Color.ByARGB(red=code_block_3.out0, green=code_block_3.out1, blue=code_block_3.out2)
byGeometryColor = Modifiers.GeometryColor.ByGeometryColor(geometry=byCorners, color=byARGB)

origin = CodeBlock { 0; 0; 0; }
origin_point = Point.ByCoordinates(x=origin.out0, y=origin.out1, z=origin.out2)
distance_between_pillars = DoubleSlider(2000, range=1000..2000 step 0.1)
pillar_thickness = DoubleSlider(200, range=100..200 step 10)
cylinder_heights = IntegerSlider(4000, range=4000..6000 step 1)
pillar_class = Python()  # CPython3; unwired: IN[0]
# ---------- pillar_class.python (26 lines) ----------
# Load the Python Standard and DesignScript Libraries
import sys
import clr
import math
clr.AddReference('ProtoGeometry')
from Autodesk.DesignScript.Geometry import *
from DSCore import Color

# defines the class pillar, this material is made out of wood 
class Pillar:
    def __init__(self, bottom_point, top_point, radius):
        self.bottom = bottom_point
        self.top = top_point
        self.radius = radius
        self.color = Pillar.default_color = Color.ByARGB(255, 130, 72, 23)
        
    def show_Pillar(self):
        return Cylinder.ByPointsRadius(self.bottom, self.top, self.radius)
    def Volume_calculation(self):
        height = self.bottom.DistanceTo(self.top)
        return (math.pi)*(self.radius)**(2)*(height)
    def display(self):
        return self.show_Pillar(), self.color

        
OUT = Pillar
# ----------------------------------------
pillar_instance_showing_4 = Python(IN[0]=origin_point, IN[1]=distance_between_pillars, IN[2]=pillar_thickness, IN[3]=cylinder_heights, IN[4]=pillar_class)  # "Pillar Instance Showing 4 Distict Pillars"; CPython3
# ---------- pillar_instance_showing_4.python (42 lines) ----------
# Load the Python Standard and DesignScript Libraries
import sys
import clr


clr.AddReference('ProtoGeometry')
from Autodesk.DesignScript.Geometry  import * 

center = IN[0]
half_size = IN[1]
radius = IN[2]
height = IN[3]
Pillar = IN[4]       


offsets = [
    (half_size,  half_size),
    (half_size, -half_size),
    (-half_size, half_size),
    (-half_size,-half_size)
]

pillars_on_grid = []

for distance_x, distance_y in offsets:
    
    bottom = Point.ByCoordinates(center.X + distance_x,
                                 center.Y + distance_y,
                                 center.Z)

    
    top = Point.ByCoordinates(bottom.X,
                              bottom.Y,
                              bottom.Z + height)

    
    p = Pillar(bottom, top, radius)

    
    pillars_on_grid.append(p.show_Pillar())

OUT = pillars_on_grid
# ----------------------------------------
call_wave_2 = Python()  # CPython3; frozen; unwired: IN[0], IN[1], IN[2], IN[3], IN[4], IN[5]
# ---------- call_wave_2.python (18 lines) ----------
# Load the Python Standard and DesignScript Libraries
import sys
import clr
clr.AddReference('ProtoGeometry')
from Autodesk.DesignScript.Geometry import *

wave_surface = IN[0]
origin = IN[1]
length = -IN[2]
points_amount = IN[3]
amplitude = IN[4]
frequency = IN[5]

wave = wave_surface(origin, length, points_amount, amplitude, frequency)

surface = wave.build_surface()

OUT = surface
# ----------------------------------------
wave_class_2 = Python()  # CPython3; frozen; unwired: IN[0]
# ---------- wave_class_2.python (60 lines) ----------
# Load the Python Standard and DesignScript Libraries
import sys
import clr
import math
clr.AddReference('ProtoGeometry')
from Autodesk.DesignScript.Geometry import *

class wave_surface_2:
    
    def __init__(self, origin, size = 10, points_amount = 20, amplitude = 1, frequency = 1, direction_x = 1, direction_y = 1):
        self.origin = origin
        self.size = size
        self.points_amount = points_amount
        self.amplitude = amplitude
        self.frequency = frequency
        self.points = None
        self.surface = None
        self.direction_x = direction_x
        self.direction_y = direction_y
    
    # Default wave function: sin(x) 
    def wave_function(self, x, y):
        return self.amplitude * math.sin(self.frequency * x) 
    
    # Generate grid of wave-modified points
    def build_points(self):
        pts = []
        step = self.size / float(self.points_amount - 1)
        
        for i in range(self.points_amount):
            row = []
            for j in range(self.points_amount):
                
                x = self.origin.X + self.direction_x * (i * step)
                y = self.origin.Y + self.direction_y * (j * step)
                z = self.origin.Z + self.wave_function(x, y)
                
                row.append(Point.ByCoordinates(x, y, z))
            
            pts.append(row)
        
        self.points = pts
        return pts
    
    # Build a Nurbs surface
    def build_surface(self):
        if self.points is None:
            self.build_points()
        
        self.surface = NurbsSurface.ByPoints(self.points)
        return self.surface
    
    # Utility: rebuild if parameters change
    def regenerate(self, **kwargs):
        for key, val in kwargs.items():
            setattr(self, key, val)
        return self.build_surface()


OUT = wave_surface_2
# ----------------------------------------
python_script = Python()  # CPython3; frozen; unwired: IN[0], IN[1], IN[2], IN[3], IN[4], IN[5], IN[6], IN[7]
# ---------- python_script.python (21 lines) ----------
# Load the Python Standard and DesignScript Libraries
import sys
import clr
import math
clr.AddReference('ProtoGeometry')
from Autodesk.DesignScript.Geometry import *

wave_surface = IN[0]
origin = IN[1]
length = -IN[2]
points_amount = IN[3]
amplitude = IN[4]
frequency = IN[5]
direction_x = IN[6]
direction_y = IN[7]

wave = wave_surface(origin, length, points_amount, amplitude, frequency)

surface = wave.build_surface()

OUT = surface
# ----------------------------------------
integer_slider = IntegerSlider(51, range=-1..100 step 1)  # frozen
integer_slider_2 = IntegerSlider(1, range=0..100 step 1)  # frozen
top = CodeBlock { 0; 0; }
top_point = Point.ByCoordinates(x=top.out0, y=top.out1, z=cylinder_heights)
one_pillar_instance = Python(IN[0]=origin_point, IN[1]=top_point, IN[2]=pillar_thickness, IN[3]=pillar_class)  # CPython3
# ---------- one_pillar_instance.python (15 lines) ----------
# Load the Python Standard and DesignScript Libraries
import sys
import clr
clr.AddReference('ProtoGeometry')
from Autodesk.DesignScript.Geometry import *

#This code calls the Pillar class and then builds a single pillar.
Pillar = IN[3]

a = Pillar(IN[0],IN[1],IN[2])

volume_of_cylinders = 5*a.Volume_calculation()

#This output both shows the pillar and then illustrates the total voulume of all of the pillars (5 in total).
OUT = [a.show_Pillar(), volume_of_cylinders]
# ----------------------------------------
volume_of_all_5_cylinders_in_mm = Watch(one_pillar_instance)  # "Volume of all 5 Cylinders in mm^2"
wave_class = Python()  # CPython3; unwired: IN[0]
# ---------- wave_class.python (66 lines) ----------
# Load the Python Standard and DesignScript Libraries
import sys
import clr
import math
clr.AddReference('ProtoGeometry')
from Autodesk.DesignScript.Geometry import *

# defines the wave class, this material is made out of steel represented by the gray like colour of the roof
class wave_surface:
    def __init__(self, origin, length = 10, points_amount = 20, amplitude = 1, frequency = 1):
        self.origin = origin
        self.length = length
        self.points_amount = points_amount
        self.amplitude = amplitude
        self.frequency = frequency
       
    
    # This defines the wave funcxion, here I am using a base sin(x) command 
    def wave_function(self, x, y):
        return self.amplitude * math.sin(self.frequency * x) 
    
    # This generates the grid of the surface with modified points
    def build_points(self, direction_x, direction_y):
        pts = []
        step = self.length / float(self.points_amount - 1)
        
        for i in range(self.points_amount):
            row = []
            for j in range(self.points_amount):
                
                x = self.origin.X + direction_x * i * step
                y = self.origin.Y + direction_y * j * step
                z = self.origin.Z + self.wave_function(x, y)
                
                row.append(Point.ByCoordinates(x, y, z))
            
            pts.append(row)
        
        return NurbsSurface.ByPoints(pts)
        
    
    # This section builds the wavy surface  
    def build_surface(self):
        bottom_right = self.build_points(1,-1)
        bottom_left = self.build_points(-1,-1)
        top_right = self.build_points(1,1)
        top_left = self.build_points(-1,1)
        
        return [bottom_right, bottom_left, top_right, top_left]
    # This section calculates the total volume of the wavy surface acting as the roof    
    def volume_calculation_wave(self, thickness = 10):
        surface_of_wave = self.build_surface()
        wave_volumes = []
        
        for i in surface_of_wave:
            
            solid = i.Thicken(thickness, False)
            
            if solid:
                wave_volumes.append(solid.Volume)
            else:
                wave_volumes.append(None)
        volume_calculation_wave_total = sum([v for v in wave_volumes if v is not None])   
        return volume_calculation_wave_total
        
OUT = wave_surface
# ----------------------------------------
length_of_roof = IntegerSlider(4000, range=4000..5000 step 1)
number_of_points = IntegerSlider(21, range=20..25 step 1)
amplitude = IntegerSlider(150, range=100..150 step 1)
frequency = IntegerSlider(5, range=0..10 step 1)
wave_instance = Python(IN[0]=wave_class, IN[1]=top_point, IN[2]=length_of_roof, IN[3]=number_of_points, IN[4]=amplitude, IN[5]=frequency)  # CPython3
# ---------- wave_instance.python (18 lines) ----------
# Load the Python Standard and DesignScript Libraries
import sys
import clr
clr.AddReference('ProtoGeometry')
from Autodesk.DesignScript.Geometry import *

# This defines all of the inputs that will be used to create the wavy roof
wave_surface = IN[0]
origin = IN[1]
length = IN[2]
points_amount = IN[3]
amplitude = IN[4]
frequency = IN[5]

wave = wave_surface(origin, length, points_amount, amplitude, frequency)


OUT = [wave.build_surface(), wave.volume_calculation_wave()]
# ----------------------------------------
volume_of_wavy_roof_in_mm_2 = Watch(wave_instance)
