# Dynamo graph 1876913.dyn (Dynamo 3.6.0.9395)

# group: Don't touch this ground
code_block = CodeBlock { -5000; -5000; -200; }
byCoordinates = Point.ByCoordinates(x=code_block.out0, y=code_block.out1, z=code_block.out2)
code_block_2 = CodeBlock { 5000; 5000; 0; }
byCoordinates_2 = Point.ByCoordinates(x=code_block_2.out0, y=code_block_2.out1, z=code_block_2.out2)
byCorners = Cuboid.ByCorners(lowPoint=byCoordinates, highPoint=byCoordinates_2)
code_block_3 = CodeBlock { 0; 100; 0; }
byARGB = Color.ByARGB(red=code_block_3.out0, green=code_block_3.out1, blue=code_block_3.out2)
byGeometryColor = Modifiers.GeometryColor.ByGeometryColor(geometry=byCorners, color=byARGB)

code_block_4 = CodeBlock { 0; 0; 0; }
byCoordinates_3 = Point.ByCoordinates(x=code_block_4.out0, y=code_block_4.out1, z=code_block_4.out2)
radius_of_cirlce = DoubleSlider(4800, range=2000..4999 step 50)
byCenterPointRadius = Circle.ByCenterPointRadius(centerPoint=byCoordinates_3, radius=radius_of_cirlce)
numberofRods = DoubleSlider(49, range=8..100 step 1)
code_block_5 = CodeBlock(numbofrods=numberofRods) { 0..1..#numbofrods; }
pointAtParameter = Curve.PointAtParameter(curve=byCenterPointRadius, param=code_block_5)
X = Point.X(point=pointAtParameter)
Y = Point.Y(point=pointAtParameter)
rodHeight = DoubleSlider(4000, range=1000..4000 step 100)
byCoordinates_4 = Point.ByCoordinates(x=X, y=Y, z=rodHeight)
rodRadiusSlider = DoubleSlider(171.9, range=0..300 step 0.1)
class_circularsteelrod = Python()  # CPython3; unwired: IN[0]
# ---------- class_circularsteelrod.python (16 lines) ----------
# Load the Python Standard and DesignScript Libraries
import sys
import clr
clr.AddReference('ProtoGeometry')
from Autodesk.DesignScript.Geometry import *

class CircularRod:
    def __init__(self, bottom_point, top_point, radius):
        self.bottom = bottom_point
        self.top = top_point
        self.radius = radius
        
    def make_geometry(self):
        return Cylinder.ByPointsRadius(self.bottom, self.top, self.radius)

OUT = CircularRod
# ----------------------------------------
series_of_instances_for = Python(IN[0]=pointAtParameter, IN[1]=byCoordinates_4, IN[2]=rodRadiusSlider, IN[3]=class_circularsteelrod)  # "Series of instances for: CircularSteelRod"; CPython3
# ---------- series_of_instances_for.python (19 lines) ----------
CircularRod = IN[3]
bottom_points = IN[0]
top_points = IN[1]
radius = IN[2]



if not isinstance(bottom_points, list):
    bottom_points = [bottom_points]
if not isinstance(top_points, list):
    top_points = [top_points]

rods = []

for btm, top in zip(bottom_points, top_points):
    rod = CircularRod(btm, top, radius)
    rods.append(rod.make_geometry())

OUT = rods
# ----------------------------------------
volumesOfCircularSteelRods = Solid.Volume(solid=series_of_instances_for)
sumOfCircularSteelRods = Math.Sum(values=volumesOfCircularSteelRods)
code_block_6 = CodeBlock(v=sumOfCircularSteelRods) { "Volume(mm³):" + v; }
watch = Watch(code_block_6)
rodcircleRadius = DoubleSlider(3200, range=1000..4000 step 50)
bottom = Circle.ByCenterPointRadius(centerPoint=byCoordinates_4, radius=rodcircleRadius)
rodCount = DoubleSlider(50, range=5..50 step 0.1)
code_block_7 = CodeBlock(RodCount=rodCount) { 0; 1/RodCount; }
sequence = Sequence(start=code_block_7.out0, amount=rodCount, step=code_block_7.out1)
pointAtParameter_2 = Curve.PointAtParameter(curve=bottom, param=sequence)
code_block_8 = CodeBlock { 0; 0; 0; }
byCoordinates_5 = Point.ByCoordinates(x=code_block_8.out0, y=code_block_8.out1, z=code_block_8.out2)
roofCircleRadius = DoubleSlider(3000, range=0..3000 step 50)
top = Circle.ByCenterPointRadius(centerPoint=byCoordinates_5, radius=roofCircleRadius)
pointAtParameter_3 = Curve.PointAtParameter(curve=top, param=sequence)
beamWidth = DoubleSlider(1128.1, range=0..4000 step 0.1)
beamHeight = DoubleSlider(0, range=0..2500 step 0.1)
class_circulartimberbeams = Python()  # CPython3; unwired: IN[0]
# ---------- class_circulartimberbeams.python (27 lines) ----------
# Load the Python Standard and DesignScript Libraries
import sys
import clr
clr.AddReference('ProtoGeometry')
from Autodesk.DesignScript.Geometry import *

class TimberBeam:
    def __init__(self, start_point, end_point, width, height):
        self.start = start_point
        self.end = end_point
        self.width = width
        self.height = height

    def make_geometry(self):
        # Adjust top point based on height slider
        adjusted_top = Point.ByCoordinates(self.end.X, self.end.Y, self.start.Z + self.height)
        
        # Cylinder radius = width / 2
        radius = self.width / 2
        
        # Create cylinder from bottom to adjusted top
        beam = Cylinder.ByPointsRadius(self.start, adjusted_top, radius)
        
        return beam  # ← make sure this is just 'return beam'

# OUTPUT the class itself
OUT = TimberBeam
# ----------------------------------------
seriesofinstances_for = Python(IN[0]=pointAtParameter_2, IN[1]=pointAtParameter_3, IN[2]=beamWidth, IN[3]=beamHeight, IN[4]=class_circulartimberbeams)  # "SeriesOfInstances for: CircularTimberBeams"; CPython3
# ---------- seriesofinstances_for.python (14 lines) ----------
TimberBeam = IN[4]
bottom_points = IN[0]
top_points = IN[1]
width = IN[2]
height = IN[3]

beams = []
count = min(len(bottom_points), len(top_points))

for i in range(count):
    beam = TimberBeam(bottom_points[i], top_points[i], width, height)
    beams.append(beam.make_geometry())

OUT = beams
# ----------------------------------------
volumeoftimberbeams_mm³ = Solid.Volume(solid=seriesofinstances_for)
sumOfCircularSteelRods_2 = Math.Sum(values=volumeoftimberbeams_mm³)
code_block_9 = CodeBlock(v=sumOfCircularSteelRods_2) { "Volume(mm³):" + v; }
watch_2 = Watch(code_block_9)
