# Dynamo graph 1880267.dyn (Dynamo 3.3.0.6316)

# group: Don't touch this ground
code_block = CodeBlock { -5000; -5000; -200; }  # frozen
byCoordinates = Point.ByCoordinates(x=code_block.out0, y=code_block.out1, z=code_block.out2)  # frozen
code_block_2 = CodeBlock { 5000; 5000; 0; }  # frozen
byCoordinates_2 = Point.ByCoordinates(x=code_block_2.out0, y=code_block_2.out1, z=code_block_2.out2)  # frozen
byCorners = Cuboid.ByCorners(lowPoint=byCoordinates, highPoint=byCoordinates_2)  # frozen
code_block_3 = CodeBlock { 0; 100; 0; }  # frozen
byARGB = Color.ByARGB(red=code_block_3.out0, green=code_block_3.out1, blue=code_block_3.out2)  # frozen
byGeometryColor = Modifiers.GeometryColor.ByGeometryColor(geometry=byCorners, color=byARGB)  # frozen

cylinder_radius = DoubleSlider(1100, range=0..1900 step 100)
block_height = DoubleSlider(5250, range=0..5750 step 250)
foundation_shape = Python(IN[0]=cylinder_radius, IN[1]=block_height)  # CPython3
# ---------- foundation_shape.python (39 lines) ----------
# Load the Python Standard and DesignScript Libraries
import sys
import clr
clr.AddReference('ProtoGeometry')
from Autodesk.DesignScript.Geometry import *

# The inputs to this node will be stored as a list in the IN variables.
dataEnteringNode = IN

cylinder_radius = IN[0]
block_height = IN[1]

#Had to add the code of each shape together because I could not figure out how to do it seperately.

origin = Point.ByCoordinates(0, 0, 0)
height = 6000
radius_x = 5000
radius_y = 3000

ellipse_curve = Ellipse.ByOriginRadii(origin, radius_x, radius_y)
ellipse_shape = Curve.ExtrudeAsSolid(ellipse_curve, Vector.ZAxis(), height)

cylinder_origin = Point.ByCoordinates(-3000, 0, 0) 
cylinder_curve = Circle.ByCenterPointRadius(cylinder_origin, cylinder_radius) 
cylinder_shape = Curve.ExtrudeAsSolid(cylinder_curve, Vector.ZAxis(), height) 

block_origin = Point.ByCoordinates(0, 0, 3000)
block_shape = Cuboid.ByLengths(block_origin, 10000, 10000, block_height)

removing_cylinder = Solid.Difference(ellipse_shape, cylinder_shape)

final_result = Solid.Difference(removing_cylinder, block_shape)

OUT = final_result

ellipse_shape.Dispose()
cylinder_shape.Dispose()
block_shape.Dispose()
removing_cylinder.Dispose()
# ----------------------------------------
width = DoubleSlider(800, range=0..1000 step 50)
length = DoubleSlider(400, range=0..1000 step 50)
floor_amount = DoubleSlider(17, range=0..20 step 1)
angle = DoubleSlider(330, range=0..720 step 10)
medium_tower = Python(IN[0]=width, IN[1]=length, IN[2]=floor_amount, IN[3]=angle, IN[4]=block_height)  # CPython3
# ---------- medium_tower.python (42 lines) ----------
# Load the Python Standard and DesignScript Libraries
import sys
import clr
clr.AddReference('ProtoGeometry')
from Autodesk.DesignScript.Geometry import *

# The inputs to this node will be stored as a list in the IN variables.
dataEnteringNode = IN

width = IN[0]
length = IN[1]
floor_amount = int(IN[2]) 
total_angle = IN[3]

total_height = 5625 - 375

block_thickness = total_height / floor_amount

blocks = []

degrees_per_floor = total_angle / (floor_amount - 1) 

axis = Vector.ByCoordinates(0, 0, 1)

for i in range(floor_amount):
    
    bottom_z_pos = 375 + (i * block_thickness)
    current_rotation = i * degrees_per_floor

    origin = Point.ByCoordinates(0, 0, bottom_z_pos)

    cs = CoordinateSystem.Identity().Translate(0, 0, bottom_z_pos).Rotate(origin, axis, current_rotation)
    
    block_curve = Rectangle.ByWidthLength(cs, width, length)

    extrusion_vector = Vector.ByCoordinates(0, 0, block_thickness)

    block_solid = Curve.ExtrudeAsSolid(block_curve, extrusion_vector)

    blocks.append(block_solid)
    
OUT = blocks
# ----------------------------------------
width_2 = DoubleSlider(550, range=0..1000 step 50)
length_2 = DoubleSlider(300, range=0..1000 step 50)
floor_amount_2 = DoubleSlider(20, range=0..20 step 1)
angle_2 = DoubleSlider(360, range=0..720 step 10)
small_tower = Python(IN[0]=width_2, IN[1]=length_2, IN[2]=floor_amount_2, IN[3]=angle_2, IN[4]=block_height)  # CPython3
# ---------- small_tower.python (42 lines) ----------
# Load the Python Standard and DesignScript Libraries
import sys
import clr
clr.AddReference('ProtoGeometry')
from Autodesk.DesignScript.Geometry import *

# The inputs to this node will be stored as a list in the IN variables.
dataEnteringNode = IN

width = IN[0]
length = IN[1]
floor_amount = int(IN[2]) 
total_angle = IN[3]

total_height = 5625 - 375

block_thickness = total_height / floor_amount

blocks = []

degrees_per_floor = total_angle / (floor_amount - 1) 

axis = Vector.ByCoordinates(0, 0, 1)

for i in range(floor_amount):
    
    bottom_z_pos = 375 + (i * block_thickness)
    current_rotation = i * degrees_per_floor

    origin = Point.ByCoordinates(1750, -1250, bottom_z_pos)

    cs = CoordinateSystem.Identity().Translate(1750, -1250, bottom_z_pos).Rotate(origin, axis, current_rotation)
    
    block_curve = Rectangle.ByWidthLength(cs, width, length)

    extrusion_vector = Vector.ByCoordinates(0, 0, block_thickness)

    block_solid = Curve.ExtrudeAsSolid(block_curve, extrusion_vector)

    blocks.append(block_solid)
    
OUT = blocks
# ----------------------------------------
width_3 = DoubleSlider(1100, range=0..1500 step 50)
length_3 = DoubleSlider(600, range=0..1000 step 50)
floor_amount_3 = DoubleSlider(15, range=0..20 step 1)
angle_3 = DoubleSlider(290, range=0..720 step 10)
big_tower = Python(IN[0]=width_3, IN[1]=length_3, IN[2]=floor_amount_3, IN[3]=angle_3, IN[4]=block_height)  # CPython3
# ---------- big_tower.python (42 lines) ----------
# Load the Python Standard and DesignScript Libraries
import sys
import clr
clr.AddReference('ProtoGeometry')
from Autodesk.DesignScript.Geometry import *

# The inputs to this node will be stored as a list in the IN variables.
dataEnteringNode = IN

width = IN[0]
length = IN[1]
floor_amount = int(IN[2]) 
total_angle = IN[3]

total_height = 5625 - 375

block_thickness = total_height / floor_amount

blocks = []

degrees_per_floor = total_angle / (floor_amount - 1) 

axis = Vector.ByCoordinates(0, 0, 1)

for i in range(floor_amount):
    
    bottom_z_pos = 375 + (i * block_thickness)
    current_rotation = i * degrees_per_floor

    origin = Point.ByCoordinates(2500, 1250, bottom_z_pos)

    cs = CoordinateSystem.Identity().Translate(2500, 1250, bottom_z_pos).Rotate(origin, axis, current_rotation)
    
    block_curve = Rectangle.ByWidthLength(cs, width, length)

    extrusion_vector = Vector.ByCoordinates(0, 0, block_thickness)

    block_solid = Curve.ExtrudeAsSolid(block_curve, extrusion_vector)

    blocks.append(block_solid)
    
OUT = blocks
# ----------------------------------------
code_block_4 = CodeBlock { 0; 0; }
bottom_origin_z = Python(IN[0]=block_height)  # CPython3
# ---------- bottom_origin_z.python (14 lines) ----------
# Load the Python Standard and DesignScript Libraries
import sys
import clr
clr.AddReference('ProtoGeometry')
from Autodesk.DesignScript.Geometry import *

# The inputs to this node will be stored as a list in the IN variables.
dataEnteringNode = IN

block_height = IN[0]

bottom_origin_z = (6000 - block_height)/2

OUT = [bottom_origin_z]
# ----------------------------------------
bottom_origin = Point.ByCoordinates(x=code_block_4.out0, y=code_block_4.out1, z=bottom_origin_z)
code_block_5 = CodeBlock { 4900; 2900; }
bottom_ellipse_curve = Ellipse.ByOriginRadii(origin=bottom_origin, xAxisRadius=code_block_5.out0, yAxisRadius=code_block_5.out1)
amount_of_cylinders = DoubleSlider(100, range=0..100 step 1)
bottom_points = Curve.PointsAtEqualChordLength(curve=bottom_ellipse_curve, divisions=amount_of_cylinders)
code_block_6 = CodeBlock { 0; 0; }
top_origin_z = Python(IN[0]=block_height)  # CPython3
# ---------- top_origin_z.python (14 lines) ----------
# Load the Python Standard and DesignScript Libraries
import sys
import clr
clr.AddReference('ProtoGeometry')
from Autodesk.DesignScript.Geometry import *

# The inputs to this node will be stored as a list in the IN variables.
dataEnteringNode = IN

block_height = IN[0]

top_origin_z = block_height + (6000 - block_height)/2

OUT = [top_origin_z]
# ----------------------------------------
top_origin = Point.ByCoordinates(x=code_block_6.out0, y=code_block_6.out1, z=top_origin_z)
top_ellipse_curve = Ellipse.ByOriginRadii(origin=top_origin, xAxisRadius=code_block_5.out0, yAxisRadius=code_block_5.out1)
top_points = Curve.PointsAtEqualChordLength(curve=top_ellipse_curve, divisions=amount_of_cylinders)
radius_of_cylinders = DoubleSlider(11, range=0..100 step 1)
cylinders_on_points = Cylinder.ByPointsRadius(startPoint=bottom_points, endPoint=top_points, radius=radius_of_cylinders)
code_block_7 = CodeBlock { 2000; 0; 3000; }
cube_origin = Point.ByCoordinates(x=code_block_7.out0, y=code_block_7.out1, z=code_block_7.out2)
code_block_8 = CodeBlock { 8000; 7000; }
cube_to_earase = Cuboid.ByLengths(origin=cube_origin, width=code_block_8.out0, length=code_block_8.out1, height=block_height)
difference = Solid.Difference(solid=cylinders_on_points, other=cube_to_earase)
volume_for_foundation = Python(IN[0]=cylinder_radius, IN[1]=block_height)  # CPython3
# ---------- volume_for_foundation.python (99 lines) ----------
# Load the Python Standard and DesignScript Libraries
import sys
import clr
clr.AddReference('ProtoGeometry')
from Autodesk.DesignScript.Geometry import *

# The inputs to this node will be stored as a list in the IN variables.
dataEnteringNode = IN

cylinder_radius = IN[0]
block_height = IN[1]



class Timber_Ellipse:
    
    def __init__(self, radiusX, radiusY, height):
        self.height = 6000
        self.radiusX = 5000
        self.radiusY = 3000

    def geometry(self, origin):
        ellipse = Ellipse.ByOriginRadii(origin, self.radiusX, self.radiusY)
        solid = Curve.ExtrudeAsSolid(ellipse, Vector.ZAxis(), self.height)
        return solid

    def volume(self, solid):
        return solid.Volume


class Steel_Ellipse:
    def __init__(self, radiusX, radiusY, height):
        self.radiusX = 5000
        self.radiusY = 3000
        self.height = 6000

    def geometry(self, origin):
        ellipse = Ellipse.ByOriginRadii(origin, self.radiusX, self.radiusY)
        solid = Curve.ExtrudeAsSolid(ellipse, Vector.ZAxis(), self.height)
        return solid

    def volume(self, solid):
        return solid.Volume



timber = Timber_Ellipse(5000, 3000, 6000)
steel = Steel_Ellipse(5000, 3000, 6000)

origin = Point.ByCoordinates(0, 0, 0)

ellipse_timber = timber.geometry(origin)
ellipse_steel = steel.geometry(origin)

cylinder_radius_timber = cylinder_radius
cylinder_radius_steel = cylinder_radius - 500

cylinder_origin = Point.ByCoordinates(-3000, 0, 0) 

cylinder_timber = Curve.ExtrudeAsSolid(
    Circle.ByCenterPointRadius(cylinder_origin, cylinder_radius_timber),
    Vector.ZAxis(), 6000)

cylinder_steel = Curve.ExtrudeAsSolid(
    Circle.ByCenterPointRadius(cylinder_origin, cylinder_radius_steel),
    Vector.ZAxis(), 6000)
    
block_origin_vol = Point.ByCoordinates(0, 0, 3000)
    
block_for_vol = Cuboid.ByLengths(block_origin_vol, 1000, 1000, block_height)

vol_timber = timber.volume(ellipse_timber) - cylinder_timber.Volume - block_for_vol.Volume
vol_steel = steel.volume(ellipse_steel) - cylinder_steel.Volume - block_for_vol.Volume

height = 6000
radius_x = 5000
radius_y = 3000

ellipse_curve = Ellipse.ByOriginRadii(origin, radius_x, radius_y)
ellipse_shape = Curve.ExtrudeAsSolid(ellipse_curve, Vector.ZAxis(), height)

cylinder_curve = Circle.ByCenterPointRadius(cylinder_origin, cylinder_radius) 
cylinder_shape = Curve.ExtrudeAsSolid(cylinder_curve, Vector.ZAxis(), height) 

block_origin = Point.ByCoordinates(0, 0, 3000)
block_shape = Cuboid.ByLengths(block_origin, 10000, 10000, block_height)

removing_cylinder = Solid.Difference(ellipse_shape, cylinder_shape)

final_result = Solid.Difference(removing_cylinder, block_shape)


OUT = [vol_timber, vol_steel]


ellipse_shape.Dispose()
cylinder_shape.Dispose()
block_shape.Dispose()
removing_cylinder.Dispose()
# ----------------------------------------
timber = CodeBlock { 0; }
timber_2 = List.GetItemAtIndex(list=volume_for_foundation, index=timber)
volume_timber_mm_2 = Watch(timber_2)
steel = CodeBlock { 1; }
steel_2 = List.GetItemAtIndex(list=volume_for_foundation, index=steel)
volume_steel_mm_2 = Watch(steel_2)
