# Dynamo graph 1880329.dyn "Finished 3.1" (Dynamo 3.2.1.5366)

code_block = CodeBlock { -5000; -5000; -200; }
byCoordinates = Point.ByCoordinates(x=code_block.out0, y=code_block.out1, z=code_block.out2)
code_block_2 = CodeBlock { 5000; 5000; 0; }
byCoordinates_2 = Point.ByCoordinates(x=code_block_2.out0, y=code_block_2.out1, z=code_block_2.out2)
byCorners = Cuboid.ByCorners(lowPoint=byCoordinates, highPoint=byCoordinates_2)
code_block_3 = CodeBlock { 0; 100; 0; }
byARGB = Color.ByARGB(red=code_block_3.out0, green=code_block_3.out1, blue=code_block_3.out2)
code_block_4 = CodeBlock(cuboid1=byCorners, color1=byARGB) { geometrycolor1 = GeometryColor.ByGeometryColor(cuboid1, color1); }
code_block_5 = CodeBlock { 4500; -4500; }
code_block_6 = CodeBlock { 200; 20; }
code_block_7 = CodeBlock { -3800; 4500; }
curve = IntegerSlider(6500, range=0..9000 step 1)
rod_distance = Python(IN[0]=curve)  # CPython3
# ---------- rod_distance.python (7 lines) ----------
Roddis=IN[0]
class number:
    def distance(self):
        newdis=Roddis/2
        return newdis

OUT = number().distance()
# ----------------------------------------
code_block_8 = CodeBlock { 4700; 2800; 0; }
byCoordinates_3 = Point.ByCoordinates(x=code_block_7.out0, y=rod_distance, z=code_block_8.out2)
byCoordinates_4 = Point.ByCoordinates(x=code_block_7.out1, y=rod_distance, z=code_block_8.out1)
steel_rod_radius = IntegerSlider(200, range=100..400 step 1)
byPointsRadius = Cylinder.ByPointsRadius(startPoint=byCoordinates_3, endPoint=byCoordinates_4, radius=steel_rod_radius)
volume = Solid.Volume(solid=byPointsRadius)
watch = Watch(volume)
rod_distance_2 = Python(IN[0]=curve)  # CPython3
# ---------- rod_distance_2.python (7 lines) ----------
Roddis=IN[0]
class number:
    def distance(self):
        newdis=-Roddis/2
        return newdis

OUT = number().distance()
# ----------------------------------------
byCoordinates_5 = Point.ByCoordinates(x=code_block_7.out0, y=rod_distance_2, z=code_block_8.out2)
byCoordinates_6 = Point.ByCoordinates(x=code_block_7.out1, y=rod_distance_2, z=code_block_8.out1)
byPointsRadius_2 = Cylinder.ByPointsRadius(startPoint=byCoordinates_5, endPoint=byCoordinates_6, radius=steel_rod_radius)
volume_2 = Solid.Volume(solid=byPointsRadius_2)
watch_2 = Watch(volume_2)
curve_2 = IntegerSlider(4, range=0..100 step 1)
thickness = IntegerSlider(200, range=100..1000 step 1)
pavillionGenerator = Python(IN[0]=curve_2, IN[1]=thickness)  # CPython3
# ---------- pavillionGenerator.python (29 lines) ----------
import math
import Autodesk.DesignScript.Geometry as DS

curve=int(IN[0])
thick=int(IN[1])
class buildsin:
    def build(self):
        pts = []
        for i in range(curve):
            row = []
            x = -4800 + (i/(curve-1)) * (4300 + 4800) #x1-x2
            for j in range(2):
                y = -5000 + j * (5000 + 5000) #Y1 - y2
                z = 1800 + 1200 * math.sin((i/(curve-1)) * math.pi*50)
                row.append(DS.Point.ByCoordinates(x, y, z+2000))
            pts.append(row)
        surface = DS.NurbsSurface.ByPoints(pts)
        surface = surface.Thicken(thick)
        return surface, pts
        
class shape:
    def generate(self):
        #build the surface
        surface, pts = buildsin().build()
        angle = 10
        surf_rot = surface.Rotate( DS.Point.ByCoordinates(0,0,0), DS.Vector.ByCoordinates(0,1,0), 10)
        return surf_rot

OUT = shape().generate()
# ----------------------------------------
volume_3 = Solid.Volume(solid=pavillionGenerator)
watch_3 = Watch(volume_3)
code_block_9 = CodeBlock { 2200; }
code_block_10 = CodeBlock { 4500; -4500; }
code_block_11 = CodeBlock { 0; }
byCoordinates_7 = Point.ByCoordinates(x=code_block_9, y=code_block_10.out0, z=code_block_11)
byCoordinates_8 = Point.ByCoordinates(x=code_block_7.out0, y=rod_distance, z=code_block_8.out0)
byPointsRadius_3 = Cylinder.ByPointsRadius(startPoint=byCoordinates_7, endPoint=byCoordinates_8, radius=steel_rod_radius)
volume_4 = Solid.Volume(solid=byPointsRadius_3)
watch_4 = Watch(volume_4)
byPointsRadius_4 = Cylinder.ByPointsRadius(startPoint=byCoordinates_7, endPoint=byCoordinates_4, radius=steel_rod_radius)
volume_5 = Solid.Volume(solid=byPointsRadius_4)
watch_5 = Watch(volume_5)
byCoordinates_9 = Point.ByCoordinates(x=code_block_9, y=code_block_10.out1, z=code_block_11)
byPointsRadius_5 = Cylinder.ByPointsRadius(startPoint=byCoordinates_9, endPoint=byCoordinates_6, radius=steel_rod_radius)
volume_6 = Solid.Volume(solid=byPointsRadius_5)
watch_6 = Watch(volume_6)
byCoordinates_10 = Point.ByCoordinates(x=code_block_7.out0, y=rod_distance_2, z=code_block_8.out0)
byPointsRadius_6 = Cylinder.ByPointsRadius(startPoint=byCoordinates_9, endPoint=byCoordinates_10, radius=steel_rod_radius)
volume_7 = Solid.Volume(solid=byPointsRadius_6)
watch_7 = Watch(volume_7)
