# Dynamo graph 1882167.dyn "Assignment 2" (Dynamo 4.0.0.3277)

# group: Don't touch this ground
code_block = CodeBlock { -5000; -5000; -200; }  # frozen
byCoordinates = Point.ByCoordinates(x=code_block.out0, y=code_block.out1, z=code_block.out2)  # frozen
code_block_2 = CodeBlock { 5000; 5000; 0; }  # frozen
byCoordinates_2 = Point.ByCoordinates(x=code_block_2.out0, y=code_block_2.out1, z=code_block_2.out2)  # frozen
byCorners = Cuboid.ByCorners(lowPoint=byCoordinates, highPoint=byCoordinates_2)  # frozen
code_block_3 = CodeBlock { 0; 100; 0; }  # frozen
byARGB = Color.ByARGB(red=code_block_3.out0, green=code_block_3.out1, blue=code_block_3.out2)  # frozen
byGeometryColor = Modifiers.GeometryColor.ByGeometryColor(geometry=byCorners, color=byARGB)  # frozen

number = DoubleInput(-5000)
number_2 = DoubleInput(-5000)
byCoordinates_3 = Point.ByCoordinates(x=number, y=number_2)
number_3 = DoubleInput(5000)
number_4 = DoubleInput(-5000)
byCoordinates_4 = Point.ByCoordinates(x=number_3, y=number_4)
number_5 = DoubleInput(5000)
number_6 = DoubleInput(5000)
byCoordinates_5 = Point.ByCoordinates(x=number_5, y=number_6)
number_7 = DoubleInput(-5000)
number_8 = DoubleInput(5000)
byCoordinates_6 = Point.ByCoordinates(x=number_7, y=number_8)
list_create = List.Create(item0=byCoordinates_3, item1=byCoordinates_4, item2=byCoordinates_5, item3=byCoordinates_6, item4=byCoordinates_3)
byPoints = PolyCurve.ByPoints(points=list_create)
ground_surface = Surface.ByPatch(closedCurve=byPoints)
number_9 = DoubleInput(255)
number_10 = DoubleInput(0)
number_11 = DoubleInput(255)
number_12 = DoubleInput(0)
byARGB_2 = Color.ByARGB(alpha=number_9, red=number_10, green=number_11, blue=number_12)
byGeometryColor_2 = Modifiers.GeometryColor.ByGeometryColor(geometry=ground_surface, color=byARGB_2)

# group: sweep profile TWO PARAMETERS (Height and pathway width left)
miscellaneous = DoubleInput(-1500)
miscellaneous_2 = DoubleInput(-2500)
byCoordinates_7 = Point.ByCoordinates(x=miscellaneous, y=miscellaneous_2)
pathway_width_1_m_to_1_5_m_left = DoubleSlider(-2500, range=-3000..-2500 step 100)
code_block_4 = CodeBlock(w=pathway_width_1_m_to_1_5_m_left) { w/2; }
height = DoubleSlider(4000, range=2300..4000 step 100)
byCoordinates_8 = Point.ByCoordinates(x=code_block_4, z=height)
miscellaneous_3 = DoubleInput(-2500)
byCoordinates_9 = Point.ByCoordinates(x=pathway_width_1_m_to_1_5_m_left, y=miscellaneous_3)
list_create_2 = List.Create(item0=byCoordinates_7, item1=byCoordinates_8, item2=byCoordinates_9)
code_block_5 = CodeBlock { 2; }
byPoints_2 = NurbsCurve.ByPoints(points=list_create_2, degree=code_block_5)

# group: Sweep path two parameters ( curve and pathway width right)
code_block_6 = CodeBlock {  }
miscellaneous_4 = DoubleInput(0)
curve = DoubleSlider(4000, range=3000..4000 step 100)  # graph output
byCoordinates_10 = Point.ByCoordinates(x=miscellaneous_4, y=curve)
pathway_width_1_m_to_1_5_m_right = DoubleSlider(3000, range=2500..3000 step 100)
miscellaneous_5 = DoubleInput(-2000)
byCoordinates_11 = Point.ByCoordinates(x=pathway_width_1_m_to_1_5_m_right, y=miscellaneous_5)
byThreePoints = Arc.ByThreePoints(firstPoint=byCoordinates_7, secondPoint=byCoordinates_10, thirdPoint=byCoordinates_11)

# note: arcs
bySweep = Surface.BySweep(profile=byPoints_2, path=byThreePoints)
code_block_7 = CodeBlock(surface1=bySweep) { n = 0.1; t1 = (1 / n) + 1; t2 = (0..#t1..0.1); curve1 = Surface.GetIsoline(surface1, 0, t2); }

# group: main element
startPoint = Curve.StartPoint(curve=code_block_7.curve1)
code_block_8 = CodeBlock { 20; }
byCenterPointRadiusNormal = Circle.ByCenterPointRadiusNormal(centerPoint=startPoint, radius=code_block_8)
bySweep_2 = Solid.BySweep(profile=byCenterPointRadiusNormal, path=code_block_7.curve1, cutEndOff=byCenterPointRadiusNormal)
byUnion = Solid.ByUnion(solids=bySweep_2)

# group: Class:steelrods
python_script = Python(IN[0]=startPoint, IN[1]=pathway_width_1_m_to_1_5_m_left)  # PythonNet3
# ---------- python_script.python (36 lines) ----------
import clr
clr.AddReference('ProtoGeometry')
from Autodesk.DesignScript.Geometry import *

class SteelRod:
    def __init__(self, curve, radius):
        self.curve = curve
        self.radius = radius

    def createGeometry(self):
        # circular profile at start of curve
        start = self.curve.StartPoint
        normal = Vector.ZAxis()
        circle = Circle.ByCenterPointRadiusNormal(start, self.radius, normal)
        solid = Solid.BySweep(circle, self.curve)
        return solid

    def volume(self):
        return self.createGeometry().Volume

# ---------- INPUTS ----------
curves_in = IN[0]   # main element curves
radius = IN[1]      # main radius

# make sure we always have a list, and ignore None
if curves_in is None:
    curves = []
elif isinstance(curves_in, list):
    curves = [c for c in curves_in if c is not None]
else:
    curves = [curves_in]

# create instances
instances = [SteelRod(c, radius) for c in curves]

OUT = instances
# ----------------------------------------

# group: solids & compute volumes
python_script_2 = Python(IN[0]=code_block_7.curve1, IN[1]=byThreePoints)  # PythonNet3
# ---------- python_script_2.python (35 lines) ----------
# IN[0] : SteelRod instances
# IN[1] : TimberRod instances

main_instances = IN[0]
small_instances = IN[1]

def safe_list(obj):
    if obj is None:
        return []
    if isinstance(obj, list):
        return [x for x in obj if x is not None]
    return [obj]

main_instances = safe_list(main_instances)
small_instances = safe_list(small_instances)

# create geometry
main_solids = [inst.createGeometry() for inst in main_instances]
small_solids = [inst.createGeometry() for inst in small_instances]

# compute volumes
main_volumes = [inst.volume() for inst in main_instances]
small_volumes = [inst.volume() for inst in small_instances]

# totals
total_main_volume = sum(main_volumes) if main_volumes else 0
total_small_volume = sum(small_volumes) if small_volumes else 0

# ----- IMPORTANT -----
OUT = [
    main_solids,
    small_solids,
    total_main_volume,
    total_small_volume
]
# ----------------------------------------

watch = Watch(python_script_2)

# group: Arc. even
count = List.Count(list=code_block_7.curve1)
code_block_9 = CodeBlock(c=count) { c-1; }
integer_slider = IntegerSlider(15, range=5..15 step 1)

# group: arc-0dd
code_block_10 = CodeBlock { 2; }
code_block_11 = CodeBlock { 1; }
range = Range(start=code_block_11, end=code_block_9, step=code_block_10)
getItemAtIndex = List.GetItemAtIndex(list=code_block_7.curve1, index=range)

# group (continued): Arc. even
range_2 = Range(end=code_block_9, step=code_block_10)
getItemAtIndex_2 = List.GetItemAtIndex(list=code_block_7.curve1, index=range_2)

# group: points
pointsAtEqualSegmentLength = Curve.PointsAtEqualSegmentLength(curve=getItemAtIndex_2, divisions=integer_slider)
code_block_12 = CodeBlock(n=integer_slider) { n+4; }
pointsAtEqualSegmentLength_2 = Curve.PointsAtEqualSegmentLength(curve=getItemAtIndex, divisions=code_block_12)
code_block_13 = CodeBlock { 2; }
dropItems = List.DropItems(list=pointsAtEqualSegmentLength_2@L2, amount=code_block_13)
code_block_14 = CodeBlock { -2; }
dropItems_2 = List.DropItems(list=dropItems@L2, amount=code_block_14)
code_block_15 = CodeBlock { 1; }
dropItems_3 = List.DropItems(list=pointsAtEqualSegmentLength, amount=code_block_15)

# group: small elements
byStartPointEndPoint = Line.ByStartPointEndPoint(startPoint=pointsAtEqualSegmentLength, endPoint=dropItems_2)
flatten = List.Flatten(list=byStartPointEndPoint)
byStartPointEndPoint_2 = Line.ByStartPointEndPoint(startPoint=dropItems_3, endPoint=dropItems_2)
flatten_2 = List.Flatten(list=byStartPointEndPoint_2)
list_create_3 = List.Create(item0=flatten, item1=flatten_2)
code_block_16 = CodeBlock { 0.03; }
ZAxis = Vector.ZAxis()
byThickeningCurveNormal = PolyCurve.ByThickeningCurveNormal(curve=list_create_3, thickness=code_block_16, normal=ZAxis)
extrudeAsSolid = Curve.ExtrudeAsSolid(curve=byThickeningCurveNormal, distance=code_block_16)
byUnion_2 = Solid.ByUnion(solids=extrudeAsSolid)

# group: Class:TimberRod
python_script_3 = Python(IN[0]=extrudeAsSolid, IN[1]=pathway_width_1_m_to_1_5_m_right)  # PythonNet3
# ---------- python_script_3.python (33 lines) ----------
import clr
clr.AddReference('ProtoGeometry')
from Autodesk.DesignScript.Geometry import *

class TimberRod:
    def __init__(self, curve, radius):
        self.curve = curve
        self.radius = radius

    def createGeometry(self):
        start = self.curve.StartPoint
        normal = Vector.ZAxis()
        circle = Circle.ByCenterPointRadiusNormal(start, self.radius, normal)
        solid = Solid.BySweep(circle, self.curve)
        return solid

    def volume(self):
        return self.createGeometry().Volume

# ---------- INPUTS ----------
curves_in = IN[0]   # small element curves
radius = IN[1]      # small radius

if curves_in is None:
    curves = []
elif isinstance(curves_in, list):
    curves = [c for c in curves_in if c is not None]
else:
    curves = [curves_in]

instances = [TimberRod(c, radius) for c in curves]

OUT = instances
# ----------------------------------------
