# Dynamo graph 1883814.dyn "rudelich Home Assignment V1" (Dynamo 3.6.0.9395)

# group: Don't touch this ground
code_block = CodeBlock { -5000; -5000; -200; }
byCoordinates = Point.ByCoordinates(x=code_block.out0, y=code_block.out1, z=code_block.out2)
code_block_2 = CodeBlock { 5000; 5000; 0; }
byCoordinates_2 = Point.ByCoordinates(x=code_block_2.out0, y=code_block_2.out1, z=code_block_2.out2)
byCorners = Cuboid.ByCorners(lowPoint=byCoordinates, highPoint=byCoordinates_2)
code_block_3 = CodeBlock { 0; 100; 0; }
byARGB = Color.ByARGB(red=code_block_3.out0, green=code_block_3.out1, blue=code_block_3.out2)
byGeometryColor = Modifiers.GeometryColor.ByGeometryColor(geometry=byCorners, color=byARGB)

steel_column_class = Python()  # CPython3; unwired: IN[0]
# ---------- steel_column_class.python (24 lines) ----------
# Load the Python Standard and DesignScript Libraries
import sys
import clr
clr.AddReference('ProtoGeometry')
from Autodesk.DesignScript.Geometry import *
import math

class CircularColumn:
    def __init__(self, centerline, radius):
        self.centerline = centerline
        self.radius = radius
    
    def endpoints(self):
        return self.centerline.StartPoint, self.centerline.EndPoint
    
    def make_geometry(self):
        end1, end2 = self.endpoints()
        
        return Cylinder.ByPointsRadius(end1,end2,self.radius) 
    
    def measure_volume(self):
        end1, end2 = self.endpoints()
        return end1.DistanceTo(end2)*self.radius*self.radius*math.pi  
OUT = CircularColumn 
# ----------------------------------------
code_block_4 = CodeBlock { 2500; 2500; 0; }
ne_bottom_steel_colunm = Point.ByCoordinates(x=code_block_4.out0, y=code_block_4.out1, z=code_block_4.out2)
code_block_5 = CodeBlock { 2500; 2500; }
height_of_steel_columns = DoubleSlider(5126, range=0..10000 step 1)
ne_top_steel_colunm = Point.ByCoordinates(x=code_block_5.out0, y=code_block_5.out1, z=height_of_steel_columns)
ne_vert_line = Line.ByStartPointEndPoint(startPoint=ne_bottom_steel_colunm, endPoint=ne_top_steel_colunm)
raduis_of_steel_column = DoubleSlider(556, range=0..1000 step 1)
steel_column_instance = Python(IN[0]=steel_column_class, IN[1]=ne_vert_line, IN[2]=raduis_of_steel_column)  # CPython3
# ---------- steel_column_instance.python (4 lines) ----------
CircularColumn = IN[0]
bottomColumn = CircularColumn(IN[1],IN[2])

OUT = [bottomColumn.make_geometry(), bottomColumn.measure_volume()]
# ----------------------------------------
code_block_6 = CodeBlock { -2500; 2500; 0; }
nw_bottom_steel_colunm = Point.ByCoordinates(x=code_block_6.out0, y=code_block_6.out1)
code_block_7 = CodeBlock { -2500; 2500; }
nw_top_steel_column = Point.ByCoordinates(x=code_block_7.out0, y=code_block_7.out1, z=height_of_steel_columns)
nw_vert_line = Line.ByStartPointEndPoint(startPoint=nw_bottom_steel_colunm, endPoint=nw_top_steel_column)
steel_column_instance_2 = Python(IN[0]=steel_column_class, IN[1]=nw_vert_line, IN[2]=raduis_of_steel_column)  # CPython3; same code as steel_column_instance
code_block_8 = CodeBlock { 2500; -2500; 0; }
se_bottom_steel_column = Point.ByCoordinates(x=code_block_8.out0, y=code_block_8.out1, z=code_block_8.out2)
code_block_9 = CodeBlock { 2500; -2500; }
se_top_steel_column = Point.ByCoordinates(x=code_block_9.out0, y=code_block_9.out1, z=height_of_steel_columns)
se_vert_line = Line.ByStartPointEndPoint(startPoint=se_bottom_steel_column, endPoint=se_top_steel_column)
steel_column_instance_3 = Python(IN[0]=steel_column_class, IN[1]=se_vert_line, IN[2]=raduis_of_steel_column)  # CPython3; same code as steel_column_instance
code_block_10 = CodeBlock { -2500; -2500; 0; }
sw_bottom_steel_column = Point.ByCoordinates(x=code_block_10.out0, y=code_block_10.out1, z=code_block_10.out2)
code_block_11 = CodeBlock { -2500; -2500; }
sw_top_steel_column = Point.ByCoordinates(x=code_block_11.out0, y=code_block_11.out1, z=height_of_steel_columns)
sw_vert_line = Line.ByStartPointEndPoint(startPoint=sw_bottom_steel_column, endPoint=sw_top_steel_column)
steel_column_instance_4 = Python(IN[0]=steel_column_class, IN[1]=sw_vert_line, IN[2]=raduis_of_steel_column)  # CPython3; same code as steel_column_instance
height_of_steel_frame_and_wood = DoubleSlider(299, range=0..500 step 1)  # "Height of Steel Frame and Wood Beams"
code_block_12 = CodeBlock(raduis=raduis_of_steel_column) { diameter = raduis * 2; }
line_between_se_sw_colums = Line.ByStartPointEndPoint(startPoint=sw_bottom_steel_column, endPoint=se_bottom_steel_column)
se_sw_column_dist = Curve.Length(curve=line_between_se_sw_colums)
total_length_from_outside_of = CodeBlock(diameter=code_block_12, curveLength=se_sw_column_dist) { totalLength = diameter + curveLength; }  # "total length from outside of column to outside"
total_length_from_inside_of = CodeBlock(curveLength=se_sw_column_dist, raduis=raduis_of_steel_column) { totalLength =  curveLength - raduis; }  # "total length from inside of column to inside"
volume_steel_frame_calculation = CodeBlock(hO=height_of_steel_frame_and_wood, wO=total_length_from_outside_of, lO=total_length_from_outside_of, hI=height_of_steel_frame_and_wood, wI=total_length_from_inside_of, lI=total_length_from_inside_of) { frameVolume = (hO * wO * lO)-(hI * wI * lI); }
code_block_13 = CodeBlock(C1=steel_column_instance, C2=steel_column_instance_2, C3=steel_column_instance_3, C4=steel_column_instance_4, F1=volume_steel_frame_calculation) { totalWoofVolume = C1 + C2 + C3 + C4 + F1; }
code_block_14 = CodeBlock { 0; }
removeItemAtIndex = List.RemoveItemAtIndex(list=code_block_13, indices=code_block_14)
total_steel_volume_mm_3 = Watch(removeItemAtIndex)
steel_frame_volume = Watch(volume_steel_frame_calculation)
wood_beam_class = Python()  # CPython3; unwired: IN[0]
# ---------- wood_beam_class.python (23 lines) ----------
import sys
import clr
clr.AddReference('ProtoGeometry')
from Autodesk.DesignScript.Geometry import *
import math

class woodBeam(object):
    def __init__(self, basePoint, width, length, angle):
        self.basePoint = basePoint
        self.width = width
        self.length = length
        self.angle = angle

    def makeGeometry(self):
    
        beam = Cuboid.ByLengths(self.basePoint, self.length, self.width, self.width) #square beem use width twice for smae dimension
       
        return beam.Rotate(self.basePoint, Vector.ZAxis(), self.angle)

    def volume(self):
        return self.width * self.width * self.length

OUT = woodBeam
# ----------------------------------------
code_block_15 = CodeBlock { 0; 0; }
calculation_of_top_of_steel_from = CodeBlock(topColumn=height_of_steel_columns, frameHeight=height_of_steel_frame_and_wood) { topSteelFrame = topColumn + frameHeight; }
center_at_top_of_steel_frame = Point.ByCoordinates(x=code_block_15.out1, y=code_block_15.out0, z=calculation_of_top_of_steel_from)
code_block_16 = CodeBlock { raduisInside = 3500; }
code_block_17 = CodeBlock { lengthWoodBeam=6000; }
number_of_beams = DoubleSlider(14, range=0..30 step 1)
series_of_wood_beam_instance = Python(IN[0]=wood_beam_class, IN[1]=center_at_top_of_steel_frame, IN[2]=code_block_16, IN[3]=height_of_steel_frame_and_wood, IN[4]=code_block_17, IN[5]=number_of_beams)  # CPython3
# ---------- series_of_wood_beam_instance.python (33 lines) ----------
import sys
import clr
clr.AddReference('ProtoGeometry')
from Autodesk.DesignScript.Geometry import *
import math

woodBeam = IN[0]
center = IN[1]
radius = IN[2]
beamHeight = IN[3]
beamLength = IN[4]
numberBeams = IN[5]

n_beams = int(numberBeams)
beams = []

for i in range(n_beams):
    thetaRadians = 2.0 * math.pi * i / float(n_beams) #radians between beams

    x = center.X + radius * math.cos(thetaRadians) #get the center of the circle x-component
    y = center.Y + radius * math.sin(thetaRadians) #get the center of the circle y-component
    base_pt = Point.ByCoordinates(x, y, center.Z)  #center point

    angleDegrees = math.degrees(thetaRadians) ##convert radians to degrees

    beam = woodBeam(base_pt, beamHeight, beamLength, angleDegrees) 
    beams.append(beam)

beamsCreated = [b.makeGeometry() for b in beams]
volumes = [b.volume() for b in beams]
totalVolume = sum(volumes)

OUT = [beamsCreated, totalVolume]
# ----------------------------------------
code_block_18 = CodeBlock { 1; }
dropItems = List.DropItems(list=series_of_wood_beam_instance, amount=code_block_18)
volume_wood_beams_mm_3 = Watch(dropItems)
list_create = List.Create(item0=steel_column_instance_4, item1=steel_column_instance_3, item2=steel_column_instance_2, item3=steel_column_instance)
color_palette = ColorPalette({R: 48, G: 43, B: 43, A: 255})
byGeometryColor_2 = Modifiers.GeometryColor.ByGeometryColor(geometry=list_create, color=color_palette)
center_at_top_of_columns = Point.ByCoordinates(x=code_block_15.out1, y=code_block_15.out0, z=height_of_steel_columns)
outer_cubiod = Cuboid.ByLengths(origin=center_at_top_of_columns, width=total_length_from_outside_of, length=total_length_from_outside_of, height=height_of_steel_frame_and_wood)
inner_cubiod = Cuboid.ByLengths(origin=center_at_top_of_columns, width=total_length_from_inside_of, length=total_length_from_inside_of, height=height_of_steel_frame_and_wood)
steel_frame = Solid.Difference(solid=outer_cubiod, other=inner_cubiod)
byGeometryColor_3 = Modifiers.GeometryColor.ByGeometryColor(geometry=steel_frame, color=color_palette)
color_palette_2 = ColorPalette({R: 133, G: 99, B: 7, A: 255})
byGeometryColor_4 = Modifiers.GeometryColor.ByGeometryColor(geometry=series_of_wood_beam_instance, color=color_palette_2)
