# Dynamo graph 1884666.dyn "ooo" (Dynamo 3.2.1.5366)

# group: Don't touch this ground
code_block = CodeBlock { -5000; -5000; -200; }
byCoordinates = Point.ByCoordinates(x=code_block.out0, y=code_block.out1, z=code_block.out2)
code_block_2 = CodeBlock { 5000; 5000; 0; }
byCoordinates_2 = Point.ByCoordinates(x=code_block_2.out0, y=code_block_2.out1, z=code_block_2.out2)
byCorners = Cuboid.ByCorners(lowPoint=byCoordinates, highPoint=byCoordinates_2)
code_block_3 = CodeBlock { 0; 100; 0; }
byARGB = Color.ByARGB(red=code_block_3.out0, green=code_block_3.out1, blue=code_block_3.out2)
byGeometryColor = Modifiers.GeometryColor.ByGeometryColor(geometry=byCorners, color=byARGB)

code_block_4 = CodeBlock { x=0; y=4000; z=5000; }
byCoordinates_3 = Point.ByCoordinates(x=code_block_4.x, y=code_block_4.y)
code_block_5 = CodeBlock { x=-0; y=-4000; z=5000; }
byCoordinates_4 = Point.ByCoordinates(x=code_block_5.x, y=code_block_5.y)
byStartPointEndPoint = Line.ByStartPointEndPoint(startPoint=byCoordinates_3, endPoint=byCoordinates_4)
code_block_6 = CodeBlock { x=2500; y=-4000; z=5000; }
byCoordinates_5 = Point.ByCoordinates(x=code_block_6.x, y=code_block_6.y, z=code_block_6.z)
code_block_7 = CodeBlock { x=-2500; y=-4000; z=5000; }
byCoordinates_6 = Point.ByCoordinates(x=code_block_7.x, y=code_block_7.y, z=code_block_7.z)
byStartPointEndPoint_2 = Line.ByStartPointEndPoint(startPoint=byCoordinates_5, endPoint=byCoordinates_6)
code_block_8 = CodeBlock { x=4000; y=4000; z=0; }
byCoordinates_7 = Point.ByCoordinates(x=code_block_8.x, y=code_block_8.y, z=code_block_8.z)
code_block_9 = CodeBlock { x=2500; y=4000; z=5000; }
byCoordinates_8 = Point.ByCoordinates(x=code_block_9.x, y=code_block_9.y, z=code_block_9.z)
byStartPointEndPoint_3 = Line.ByStartPointEndPoint(startPoint=byCoordinates_7, endPoint=byCoordinates_8)
code_block_10 = CodeBlock { x=-2500; y=4000; z=5000; }
byCoordinates_9 = Point.ByCoordinates(x=code_block_10.x, y=code_block_10.y, z=code_block_10.z)
byStartPointEndPoint_4 = Line.ByStartPointEndPoint(startPoint=byCoordinates_9, endPoint=byCoordinates_8)
code_block_11 = CodeBlock { x=-4000; y=4000; z=0; }
byCoordinates_10 = Point.ByCoordinates(x=code_block_11.x, y=code_block_11.y, z=code_block_11.z)
byStartPointEndPoint_5 = Line.ByStartPointEndPoint(startPoint=byCoordinates_9, endPoint=byCoordinates_10)
code_block_12 = CodeBlock { x=4000; y=-4000; z=0; }
byCoordinates_11 = Point.ByCoordinates(x=code_block_12.x, y=code_block_12.y, z=code_block_12.z)
byStartPointEndPoint_6 = Line.ByStartPointEndPoint(startPoint=byCoordinates_5, endPoint=byCoordinates_11)
code_block_13 = CodeBlock { x=-4000; y=-4000; z=0; }
byCoordinates_12 = Point.ByCoordinates(x=code_block_13.x, y=code_block_13.y, z=code_block_13.z)
byStartPointEndPoint_7 = Line.ByStartPointEndPoint(startPoint=byCoordinates_12, endPoint=byCoordinates_6)
code_block_14 = CodeBlock { x=4000; y=4000; z=0; }
byCoordinates_13 = Point.ByCoordinates(x=code_block_14.x, y=code_block_14.y, z=code_block_14.z)
code_block_15 = CodeBlock { x=2500; y=4000; z=5000; }
byCoordinates_14 = Point.ByCoordinates(x=code_block_15.x, y=code_block_15.y, z=code_block_15.z)
number_slider = DoubleSlider(60, range=10..1000 step 0.1)
byPointsRadius = Cylinder.ByPointsRadius(startPoint=byCoordinates_13, endPoint=byCoordinates_14, radius=number_slider)
code_block_16 = CodeBlock { x=-4000; y=-4000; z=0; }
byCoordinates_15 = Point.ByCoordinates(x=code_block_16.x, y=code_block_16.y, z=code_block_16.z)
code_block_17 = CodeBlock { x=-2500; y=-4000; z=5000; }
byCoordinates_16 = Point.ByCoordinates(x=code_block_17.x, y=code_block_17.y, z=code_block_17.z)
number_slider_2 = DoubleSlider(60, range=10..1000 step 0.1)
byPointsRadius_2 = Cylinder.ByPointsRadius(startPoint=byCoordinates_15, endPoint=byCoordinates_16, radius=number_slider_2)
code_block_18 = CodeBlock { x=-4000; y=4000; z=0; }
byCoordinates_17 = Point.ByCoordinates(x=code_block_18.x, y=code_block_18.y, z=code_block_18.z)
code_block_19 = CodeBlock { x=-2500; y=4000; z=5000; }
byCoordinates_18 = Point.ByCoordinates(x=code_block_19.x, y=code_block_19.y, z=code_block_19.z)
number_slider_3 = DoubleSlider(60, range=10..1000 step 0.1)
byPointsRadius_3 = Cylinder.ByPointsRadius(startPoint=byCoordinates_17, endPoint=byCoordinates_18, radius=number_slider_3)
code_block_20 = CodeBlock { x=4000; y=-4000; z=0; }
byCoordinates_19 = Point.ByCoordinates(x=code_block_20.x, y=code_block_20.y, z=code_block_20.z)
code_block_21 = CodeBlock { x=2500; y=4000; z=5000; }
byCoordinates_20 = Point.ByCoordinates(x=code_block_21.x, y=code_block_21.y, z=code_block_21.z)
number_slider_4 = DoubleSlider(60, range=10..1000 step 0.1)
byPointsRadius_4 = Cylinder.ByPointsRadius(startPoint=byCoordinates_19, endPoint=byCoordinates_20, radius=number_slider_4)
code_block_22 = CodeBlock { x=-4000; y=-4000; z=0; }
byCoordinates_21 = Point.ByCoordinates(x=code_block_22.x, y=code_block_22.y, z=code_block_22.z)
code_block_23 = CodeBlock { x=-2500; y=4000; z=5000; }
byCoordinates_22 = Point.ByCoordinates(x=code_block_23.x, y=code_block_23.y, z=code_block_23.z)
number_slider_5 = DoubleSlider(60, range=10..1000 step 0.1)
byPointsRadius_5 = Cylinder.ByPointsRadius(startPoint=byCoordinates_21, endPoint=byCoordinates_22, radius=number_slider_5)
code_block_24 = CodeBlock { x=4000; y=-4000; z=0; }
byCoordinates_23 = Point.ByCoordinates(x=code_block_24.x, y=code_block_24.y, z=code_block_24.z)
code_block_25 = CodeBlock { x=-2500; y=4000; z=5000; }
byCoordinates_24 = Point.ByCoordinates(x=code_block_25.x, y=code_block_25.y, z=code_block_25.z)
number_slider_6 = DoubleSlider(60, range=10..1000 step 0.1)
byPointsRadius_6 = Cylinder.ByPointsRadius(startPoint=byCoordinates_23, endPoint=byCoordinates_24, radius=number_slider_6)
code_block_26 = CodeBlock { x=4000; y=4000; z=0; }
code_block_27 = CodeBlock { x=4000; y=4000; z=0; }
byCoordinates_25 = Point.ByCoordinates(x=code_block_27.x, y=code_block_27.y, z=code_block_27.z)
code_block_28 = CodeBlock { x=2500; y=4000; z=5000; }
byCoordinates_26 = Point.ByCoordinates(x=code_block_28.x, y=code_block_28.y, z=code_block_28.z)
number_slider_7 = DoubleSlider(60, range=10..1000 step 0.1)
byPointsRadius_7 = Cylinder.ByPointsRadius(startPoint=byCoordinates_25, endPoint=byCoordinates_26, radius=number_slider_7)
code_block_29 = CodeBlock { x=4000; y=-4000; z=0; }
byCoordinates_27 = Point.ByCoordinates(x=code_block_29.x, y=code_block_29.y, z=code_block_29.z)
code_block_30 = CodeBlock { x=2500; y=-4000; z=5000; }
byCoordinates_28 = Point.ByCoordinates(x=code_block_30.x, y=code_block_30.y, z=code_block_30.z)
number_slider_8 = DoubleSlider(60, range=10..1000 step 0.1)
byPointsRadius_8 = Cylinder.ByPointsRadius(startPoint=byCoordinates_27, endPoint=byCoordinates_28, radius=number_slider_8)
code_block_31 = CodeBlock { x=2500; y=-4000; z=5000; }
byCoordinates_29 = Point.ByCoordinates(x=code_block_31.x, y=code_block_31.y, z=code_block_31.z)
code_block_32 = CodeBlock { x=-4000; y=4000; z=000; }
byCoordinates_30 = Point.ByCoordinates(x=code_block_32.x, y=code_block_32.y, z=code_block_32.z)
number_slider_9 = DoubleSlider(60, range=10..1000 step 0.1)
byPointsRadius_9 = Cylinder.ByPointsRadius(startPoint=byCoordinates_29, endPoint=byCoordinates_30, radius=number_slider_9)
code_block_33 = CodeBlock { x=2500; y=-4000; z=5000; }
byCoordinates_31 = Point.ByCoordinates(x=code_block_33.x, y=code_block_33.y, z=code_block_33.z)
code_block_34 = CodeBlock { x=2500; y=4000; z=5000; }
byCoordinates_32 = Point.ByCoordinates(x=code_block_34.x, y=code_block_34.y, z=code_block_34.z)
number_slider_10 = DoubleSlider(60, range=10..1000 step 0.1)
byPointsRadius_10 = Cylinder.ByPointsRadius(startPoint=byCoordinates_31, endPoint=byCoordinates_32, radius=number_slider_10)
code_block_35 = CodeBlock { x=-2500; y=-4000; z=5000; }
byCoordinates_33 = Point.ByCoordinates(x=code_block_35.x, y=code_block_35.y, z=code_block_35.z)
code_block_36 = CodeBlock { x=-2500; y=4000; z=5000; }
byCoordinates_34 = Point.ByCoordinates(x=code_block_36.x, y=code_block_36.y, z=code_block_36.z)
number_slider_11 = DoubleSlider(60, range=30..100 step 0.1)
byPointsRadius_11 = Cylinder.ByPointsRadius(startPoint=byCoordinates_33, endPoint=byCoordinates_34, radius=number_slider_11)
code_block_37 = CodeBlock { x=2500; y=4000; z=5000; }
byCoordinates_35 = Point.ByCoordinates(x=code_block_37.x, y=code_block_37.y, z=code_block_37.z)
code_block_38 = CodeBlock { x=-2500; y=4000; z=5000; }
byCoordinates_36 = Point.ByCoordinates(x=code_block_38.x, y=code_block_38.y, z=code_block_38.z)
number_slider_12 = DoubleSlider(60, range=30..100 step 0.1)
byPointsRadius_12 = Cylinder.ByPointsRadius(startPoint=byCoordinates_35, endPoint=byCoordinates_36, radius=number_slider_12)
code_block_39 = CodeBlock { x=-2500; y=-4000; z=5000; }
byCoordinates_37 = Point.ByCoordinates(x=code_block_39.x, y=code_block_39.y, z=code_block_39.z)
code_block_40 = CodeBlock { x=2500; y=-4000; z=5000; }
byCoordinates_38 = Point.ByCoordinates(x=code_block_40.x, y=code_block_40.y, z=code_block_40.z)
number_slider_13 = DoubleSlider(60, range=30..100 step 0.1)
byPointsRadius_13 = Cylinder.ByPointsRadius(startPoint=byCoordinates_37, endPoint=byCoordinates_38, radius=number_slider_13)
code_block_41 = CodeBlock { x=4200; y=-3800; }
number_slider_14 = DoubleSlider(200, range=0..1500 step 100)
byCoordinates_39 = Point.ByCoordinates(x=code_block_41.x, y=code_block_41.y, z=number_slider_14)
x_and_y = CodeBlock { x=-3800; y=4200; }
Z = DoubleSlider(200, range=0..1500 step 100)
center_of_cube = Point.ByCoordinates(x=x_and_y.x, y=x_and_y.y, z=Z)
x_and_y_2 = CodeBlock { x=-3800; y=-3800; }
Z_2 = DoubleSlider(200, range=0..1500 step 100)
center_of_cube_2 = Point.ByCoordinates(x=x_and_y_2.x, y=x_and_y_2.y, z=Z_2)
x_and_y_3 = CodeBlock { x=4200; y=4200; }
Z_3 = DoubleSlider(200, range=0..1500 step 100)
center_of_cube_3 = Point.ByCoordinates(x=x_and_y_3.x, y=x_and_y_3.y, z=Z_3)
list_create = List.Create(item0=byCoordinates_39, item1=center_of_cube, item2=center_of_cube_2, item3=center_of_cube_3)
number_slider_15 = DoubleSlider(450, range=0..1000 step 50)
cube = Python()  # CPython3; unwired: IN[0]
# ---------- cube.python (28 lines) ----------
import clr
clr.AddReference('ProtoGeometry')
from Autodesk.DesignScript.Geometry import *

class SimpleCube:
    def __init__(self, center, size):
        self.center = center
        self.size = size
        self.geometry = self.create_cube()
    
    def create_cube(self):
        half = self.size / 2.0
        corner = Point.ByCoordinates(
            self.center.X - half,
            self.center.Y - half,
            self.center.Z - half
        )
        return Cuboid.ByLengths(corner, self.size, self.size, self.size)

    def get_properties(self):
        return {
            "Volume": self.size ** 3,
            "SurfaceArea": 6 * (self.size ** 2),
            "SideLength": self.size,
            "Center": self.center
        }

OUT = SimpleCube
# ----------------------------------------
python_script = Python(IN[0]=list_create, IN[1]=number_slider_15, IN[2]=cube)  # CPython3
# ---------- python_script.python (26 lines) ----------
import clr
clr.AddReference('ProtoGeometry')
from Autodesk.DesignScript.Geometry import *

# inputs
centers = IN[0]
sizes = IN[1]
CubeClass = IN[2]   # the class passed in

# normalize inputs
if not isinstance(centers, list):
    centers = [centers]

if not isinstance(sizes, list):
    sizes = [sizes] * len(centers)

instances = []
properties = []

# create instances
for c, s in zip(centers, sizes):
    cube = CubeClass(c, s)
    instances.append(cube.geometry)
    properties.append(cube.get_properties())

OUT = instances, properties
# ----------------------------------------
code_block_42 = CodeBlock { 1; }
getItemAtIndex = List.GetItemAtIndex(list=python_script, index=code_block_42)
code_block_43 = CodeBlock { "Volume"; }
valueAtKey = DesignScript.Builtin.Dictionary.ValueAtKey(dictionary=getItemAtIndex, key=code_block_43)
sum = Math.Sum(values=valueAtKey)
watch = Watch(sum)
code_block_44 = CodeBlock { 4000; -4000; 000; }
byCoordinates_40 = Point.ByCoordinates(x=code_block_44.out0, y=code_block_44.out1, z=code_block_44.out2)
code_block_45 = CodeBlock { -2500; 4000; 5000; }
byCoordinates_41 = Point.ByCoordinates(x=code_block_45.out0, y=code_block_45.out1, z=code_block_45.out2)
byStartPointEndPoint_8 = Line.ByStartPointEndPoint(startPoint=byCoordinates_40, endPoint=byCoordinates_41)
code_block_46 = CodeBlock { 0; 10; 1/11; }
sequence = Sequence(start=code_block_46.out0, amount=code_block_46.out1, step=code_block_46.out2)
pointAtParameter = Curve.PointAtParameter(curve=byStartPointEndPoint_8, param=sequence)
code_block_47 = CodeBlock { -2500; 4000; 5000; }
byCoordinates_42 = Point.ByCoordinates(x=code_block_47.out0, y=code_block_47.out1, z=code_block_47.out2)
code_block_48 = CodeBlock { -4000; -4000; 0; }
byCoordinates_43 = Point.ByCoordinates(x=code_block_48.out0, y=code_block_48.out1, z=code_block_48.out2)
byStartPointEndPoint_9 = Line.ByStartPointEndPoint(startPoint=byCoordinates_42, endPoint=byCoordinates_43)
code_block_49 = CodeBlock { 0; 10; 1/9; }
sequence_2 = Sequence(start=code_block_49.out0, amount=code_block_49.out1, step=code_block_49.out2)
pointAtParameter_2 = Curve.PointAtParameter(curve=byStartPointEndPoint_9, param=sequence_2)
code_block_50 = CodeBlock { 5; 10; 7; }
sequence_3 = Sequence(start=code_block_50.out0, amount=code_block_50.out1, step=code_block_50.out2)
circular_rod = Python()  # CPython3; unwired: IN[0]
# ---------- circular_rod.python (14 lines) ----------
import clr
clr.AddReference('ProtoGeometry')
from Autodesk.DesignScript.Geometry import *

class CircularRod:
    def __init__(self, bottom_point, top_point, radius):
        self.bottom = bottom_point
        self.top = top_point
        self.radius = radius

    def make_geometry(self):
        return Cylinder.ByPointsRadius(self.bottom, self.top, self.radius)

OUT = CircularRod
# ----------------------------------------
final_target = Python(IN[0]=pointAtParameter, IN[1]=pointAtParameter_2, IN[2]=sequence_3, IN[3]=circular_rod)  # CPython3
# ---------- final_target.python (23 lines) ----------
# IN[0] = list of bottom points
# IN[1] = list of top points
# IN[2] = list of radii
# IN[3] = class CircularRod from Box #1

CircularRod = IN[3]
bottom_points = IN[0]
top_points = IN[1]
radii = IN[2]

rods = []
count = min(len(bottom_points), len(top_points))

for i in range(count):
  
    r = radii[i] if i < len(radii) else radii[-1]
    btm = bottom_points[i]
    top = top_points[i]
    
    rod = CircularRod(btm, top, r)
    rods.append(rod.make_geometry())

OUT = rods
# ----------------------------------------
code_block_51 = CodeBlock { 4000; -4000; 000; }
byCoordinates_44 = Point.ByCoordinates(x=code_block_51.out0, y=code_block_51.out1, z=code_block_51.out2)
code_block_52 = CodeBlock { 2500; -4000; 5000; }
byCoordinates_45 = Point.ByCoordinates(x=code_block_52.out0, y=code_block_52.out1, z=code_block_52.out2)
byStartPointEndPoint_10 = Line.ByStartPointEndPoint(startPoint=byCoordinates_44, endPoint=byCoordinates_45)
code_block_53 = CodeBlock { 0; 10; 1/11; }
sequence_4 = Sequence(start=code_block_53.out0, amount=code_block_53.out1, step=code_block_53.out2)
pointAtParameter_3 = Curve.PointAtParameter(curve=byStartPointEndPoint_10, param=sequence_4)
code_block_54 = CodeBlock { -2500; -4000; 5000; }
byCoordinates_46 = Point.ByCoordinates(x=code_block_54.out0, y=code_block_54.out1, z=code_block_54.out2)
code_block_55 = CodeBlock { -4000; -4000; 0; }
byCoordinates_47 = Point.ByCoordinates(x=code_block_55.out0, y=code_block_55.out1, z=code_block_55.out2)
byStartPointEndPoint_11 = Line.ByStartPointEndPoint(startPoint=byCoordinates_46, endPoint=byCoordinates_47)
code_block_56 = CodeBlock { 0; 10; 1/9; }
sequence_5 = Sequence(start=code_block_56.out0, amount=code_block_56.out1, step=code_block_56.out2)
pointAtParameter_4 = Curve.PointAtParameter(curve=byStartPointEndPoint_11, param=sequence_5)
code_block_57 = CodeBlock { 5; 10; 7; }
sequence_6 = Sequence(start=code_block_57.out0, amount=code_block_57.out1, step=code_block_57.out2)
circular_rod_2 = Python()  # CPython3; unwired: IN[0]; same code as circular_rod
final_target_2 = Python(IN[0]=pointAtParameter_3, IN[1]=pointAtParameter_4, IN[2]=sequence_6, IN[3]=circular_rod_2)  # CPython3; same code as final_target
code_block_58 = CodeBlock { -4000; 4000; 000; }
byCoordinates_48 = Point.ByCoordinates(x=code_block_58.out0, y=code_block_58.out1, z=code_block_58.out2)
code_block_59 = CodeBlock { -2500; 4000; 5000; }
byCoordinates_49 = Point.ByCoordinates(x=code_block_59.out0, y=code_block_59.out1, z=code_block_59.out2)
byStartPointEndPoint_12 = Line.ByStartPointEndPoint(startPoint=byCoordinates_48, endPoint=byCoordinates_49)
code_block_60 = CodeBlock { 0; 10; 1/11; }
sequence_7 = Sequence(start=code_block_60.out0, amount=code_block_60.out1, step=code_block_60.out2)
pointAtParameter_5 = Curve.PointAtParameter(curve=byStartPointEndPoint_12, param=sequence_7)
code_block_61 = CodeBlock { 2500; 4000; 5000; }
byCoordinates_50 = Point.ByCoordinates(x=code_block_61.out0, y=code_block_61.out1, z=code_block_61.out2)
code_block_62 = CodeBlock { 4000; 4000; 0; }
byCoordinates_51 = Point.ByCoordinates(x=code_block_62.out0, y=code_block_62.out1, z=code_block_62.out2)
byStartPointEndPoint_13 = Line.ByStartPointEndPoint(startPoint=byCoordinates_50, endPoint=byCoordinates_51)
code_block_63 = CodeBlock { 0; 10; 1/9; }
sequence_8 = Sequence(start=code_block_63.out0, amount=code_block_63.out1, step=code_block_63.out2)
pointAtParameter_6 = Curve.PointAtParameter(curve=byStartPointEndPoint_13, param=sequence_8)
code_block_64 = CodeBlock { 5; 10; 7; }
sequence_9 = Sequence(start=code_block_64.out0, amount=code_block_64.out1, step=code_block_64.out2)
circular_rod_3 = Python()  # CPython3; unwired: IN[0]; same code as circular_rod
final_target_3 = Python(IN[0]=pointAtParameter_5, IN[1]=pointAtParameter_6, IN[2]=sequence_9, IN[3]=circular_rod_3)  # CPython3; same code as final_target
code_block_65 = CodeBlock { -4000; 4000; 000; }
byCoordinates_52 = Point.ByCoordinates(x=code_block_65.out0, y=code_block_65.out1, z=code_block_65.out2)
code_block_66 = CodeBlock { 2500; -4000; 5000; }
byCoordinates_53 = Point.ByCoordinates(x=code_block_66.out0, y=code_block_66.out1, z=code_block_66.out2)
byStartPointEndPoint_14 = Line.ByStartPointEndPoint(startPoint=byCoordinates_52, endPoint=byCoordinates_53)
code_block_67 = CodeBlock { 0; 10; 1/11; }
sequence_10 = Sequence(start=code_block_67.out0, amount=code_block_67.out1, step=code_block_67.out2)
pointAtParameter_7 = Curve.PointAtParameter(curve=byStartPointEndPoint_14, param=sequence_10)
code_block_68 = CodeBlock { 2500; 4000; 5000; }
byCoordinates_54 = Point.ByCoordinates(x=code_block_68.out0, y=code_block_68.out1, z=code_block_68.out2)
code_block_69 = CodeBlock { 4000; -4000; 0; }
byCoordinates_55 = Point.ByCoordinates(x=code_block_69.out0, y=code_block_69.out1, z=code_block_69.out2)
byStartPointEndPoint_15 = Line.ByStartPointEndPoint(startPoint=byCoordinates_54, endPoint=byCoordinates_55)
code_block_70 = CodeBlock { 0; 10; 1/9; }
sequence_11 = Sequence(start=code_block_70.out0, amount=code_block_70.out1, step=code_block_70.out2)
pointAtParameter_8 = Curve.PointAtParameter(curve=byStartPointEndPoint_15, param=sequence_11)
code_block_71 = CodeBlock { 5; 10; 7; }
sequence_12 = Sequence(start=code_block_71.out0, amount=code_block_71.out1, step=code_block_71.out2)
circular_rod_4 = Python()  # CPython3; unwired: IN[0]; same code as circular_rod
final_target_4 = Python(IN[0]=pointAtParameter_7, IN[1]=pointAtParameter_8, IN[2]=sequence_12, IN[3]=circular_rod_4)  # CPython3; same code as final_target
list_create_2 = List.Create(item0=final_target, item1=final_target_2, item2=final_target_3, item3=final_target_4)
volume = Solid.Volume(solid=list_create_2)
sum_2 = Math.Sum(values=volume)
sum_3 = Math.Sum(values=sum_2)
watch_2 = Watch(sum_3)
