# Dynamo graph 1884921.dyn (Dynamo 3.6.0.9395)

code_block = CodeBlock { -5000; -5000; -200; }
byCoordinates = Point.ByCoordinates(x=code_block.out0, y=code_block.out1, z=code_block.out2)
code_block_2 = CodeBlock { 5000; 5000; 0; }
byCoordinates_2 = Point.ByCoordinates(x=code_block_2.out0, y=code_block_2.out1, z=code_block_2.out2)
byCorners = Cuboid.ByCorners(lowPoint=byCoordinates, highPoint=byCoordinates_2)
code_block_3 = CodeBlock { 0; 100; 0; }
byARGB = Color.ByARGB(red=code_block_3.out0, green=code_block_3.out1, blue=code_block_3.out2)
byGeometryColor = Modifiers.GeometryColor.ByGeometryColor(geometry=byCorners, color=byARGB)
code_block_4 = CodeBlock { -2500; 2500; 0; }
byCoordinates_3 = Point.ByCoordinates(x=code_block_4.out0, y=code_block_4.out1, z=code_block_4.out2)
code_block_5 = CodeBlock { 2500; 2500; 0; }
byCoordinates_4 = Point.ByCoordinates(x=code_block_5.out0, y=code_block_5.out1, z=code_block_5.out2)
byStartPointEndPoint = Line.ByStartPointEndPoint(startPoint=byCoordinates_3, endPoint=byCoordinates_4)
code_block_6 = CodeBlock { 0; 5000; 5000; }
sequence = Sequence(start=code_block_6.out0, amount=code_block_6.out1, step=code_block_6.out2)
code_block_7 = CodeBlock { 0; 0; }
byCoordinates_5 = Point.ByCoordinates(x=sequence, y=code_block_7.out0, z=code_block_7.out1)
code_block_8 = CodeBlock { 0; 10000; }
byCoordinates_6 = Point.ByCoordinates(x=sequence, y=code_block_8.out0, z=code_block_8.out1)
code_block_9 = CodeBlock { 1; 5; 1000; }
sequence_2 = Sequence(start=code_block_9.out0, amount=code_block_9.out1, step=code_block_9.out2)
steel_rod_class = Python()  # CPython3; unwired: IN[0]
# ---------- steel_rod_class.python (21 lines) ----------
import clr
import math
clr.AddReference('ProtoGeometry')
from Autodesk.DesignScript.Geometry import *

class CircularRod:
    def __init__(self, bottom_point, top_point, radius):
        self.bottom = bottom_point
        self.top = top_point
        self.radius = radius

    def make_geometry(self):
        
        return Cylinder.ByPointsRadius(self.bottom, self.top, self.radius)

    def volume(self):
        
        height = self.bottom.DistanceTo(self.top)
        return math.pi * (self.radius ** 2) * height

OUT = CircularRod
# ----------------------------------------
series_of_instances = Python(IN[0]=byCoordinates_5, IN[1]=byCoordinates_6, IN[2]=sequence_2, IN[3]=steel_rod_class)  # CPython3
# ---------- series_of_instances.python (23 lines) ----------
# IN[0] = list of bottom points
# IN[1] = list of top points
# IN[2] = list of radii
# IN[3] = class CircularRod from Box #1

CircularRod = IN[3]
bottom_points = IN[0]
top_points = IN[1]
radii = IN[2]

rods = []
count = min(len(bottom_points), len(top_points))

for i in range(count):
  
    r = radii[i] if i < len(radii) else radii[-1]
    btm = bottom_points[i]
    top = top_points[i]
    
    rod = CircularRod(btm, top, r)
    rods.append(rod.make_geometry())

OUT = rods
# ----------------------------------------
code_block_10 = CodeBlock { 0; 0; 0; }
byCoordinates_7 = Point.ByCoordinates(x=code_block_10.out0, y=code_block_10.out1, z=code_block_10.out2)
code_block_11 = CodeBlock { 0; 0; 5000; }
byCoordinates_8 = Point.ByCoordinates(x=code_block_11.out0, y=code_block_11.out1, z=code_block_11.out2)
code_block_12 = CodeBlock { 3000; }
instance_of_steel_rod = Python(IN[0]=byCoordinates_7, IN[1]=byCoordinates_8, IN[2]=code_block_12, IN[3]=steel_rod_class)  # CPython3
# ---------- instance_of_steel_rod.python (8 lines) ----------
# IN[0] = bottom point
# IN[1] = top point
# IN[2] = radius
# IN[3] = class object from previous node

CircularRod = IN[3]
b = CircularRod(IN[0], IN[1], IN[2])
OUT = b.make_geometry()
# ----------------------------------------
code_block_13 = CodeBlock { 0; 5000; 5000; }
sequence_3 = Sequence(start=code_block_13.out0, amount=code_block_13.out1, step=code_block_13.out2)
code_block_14 = CodeBlock { 0; 0; }
byCoordinates_9 = Point.ByCoordinates(x=sequence_3, y=code_block_14.out0, z=code_block_14.out1)
code_block_15 = CodeBlock { 0; 10000; }
byCoordinates_10 = Point.ByCoordinates(x=sequence_3, y=code_block_15.out0, z=code_block_15.out1)
code_block_16 = CodeBlock { 1; 5; 1000; }
sequence_4 = Sequence(start=code_block_16.out0, amount=code_block_16.out1, step=code_block_16.out2)
circular_rod = Python()  # CPython3; unwired: IN[0]
# ---------- circular_rod.python (21 lines) ----------
import clr
import math
clr.AddReference('ProtoGeometry')
from Autodesk.DesignScript.Geometry import *

class CircularRod:
    def __init__(self, bottom_point, top_point, radius):
        self.bottom = bottom_point
        self.top = top_point
        self.radius = radius

    def make_geometry(self):
        
        return Cylinder.ByPointsRadius(self.bottom, self.top, self.radius)

    def volume(self):
       
        height = self.bottom.DistanceTo(self.top)
        return math.pi * (self.radius ** 2) * height

OUT = CircularRod
# ----------------------------------------
series_of_instances_of_steel = Python(IN[0]=byCoordinates_9, IN[1]=byCoordinates_10, IN[2]=sequence_4, IN[3]=circular_rod)  # "Series of Instances of Steel Rods"; CPython3; same code as series_of_instances
code_block_17 = CodeBlock { 0; 0; 0; }
byCoordinates_11 = Point.ByCoordinates(x=code_block_17.out0, y=code_block_17.out1, z=code_block_17.out2)
code_block_18 = CodeBlock { 0; 0; 5000; }
byCoordinates_12 = Point.ByCoordinates(x=code_block_18.out0, y=code_block_18.out1, z=code_block_18.out2)
code_block_19 = CodeBlock { 3000; }
instance_of_steel_rod_2 = Python(IN[0]=byCoordinates_11, IN[1]=byCoordinates_12, IN[2]=code_block_19, IN[3]=circular_rod)  # CPython3; same code as instance_of_steel_rod
code_block_20 = CodeBlock { 0; 5000; 5000; }
sequence_5 = Sequence(start=code_block_20.out0, amount=code_block_20.out1, step=code_block_20.out2)
code_block_21 = CodeBlock { 0; 0; }
byCoordinates_13 = Point.ByCoordinates(x=sequence_5, y=code_block_21.out0, z=code_block_21.out1)
code_block_22 = CodeBlock { 0; 10000; }
byCoordinates_14 = Point.ByCoordinates(x=sequence_5, y=code_block_22.out0, z=code_block_22.out1)
code_block_23 = CodeBlock { 1; 5; 1000; }
sequence_6 = Sequence(start=code_block_23.out0, amount=code_block_23.out1, step=code_block_23.out2)
circular_bench_concrete = Python()  # CPython3; unwired: IN[0]
# ---------- circular_bench_concrete.python (21 lines) ----------
import clr
import math
clr.AddReference('ProtoGeometry')
from Autodesk.DesignScript.Geometry import *

class CircularRod:
    def __init__(self, bottom_point, top_point, radius):
        self.bottom = bottom_point
        self.top = top_point
        self.radius = radius

    def make_geometry(self):
       
        return Cylinder.ByPointsRadius(self.bottom, self.top, self.radius)

    def volume(self):
        
        height = self.bottom.DistanceTo(self.top)
        return math.pi * (self.radius ** 2) * height

OUT = CircularRod
# ----------------------------------------
series_of_benches = Python(IN[0]=byCoordinates_13, IN[1]=byCoordinates_14, IN[2]=sequence_6, IN[3]=circular_bench_concrete)  # CPython3; same code as series_of_instances
code_block_24 = CodeBlock { 0; 0; 0; }
byCoordinates_15 = Point.ByCoordinates(x=code_block_24.out0, y=code_block_24.out1, z=code_block_24.out2)
code_block_25 = CodeBlock { 0; 0; 5000; }
byCoordinates_16 = Point.ByCoordinates(x=code_block_25.out0, y=code_block_25.out1, z=code_block_25.out2)
code_block_26 = CodeBlock { 3000; }
single_instance_of_a_concrete = Python(IN[0]=byCoordinates_15, IN[1]=byCoordinates_16, IN[2]=code_block_26, IN[3]=circular_bench_concrete)  # "Single Instance of a Concrete Bench"; CPython3; same code as instance_of_steel_rod
code_block_27 = CodeBlock { 0; 3000; 0; 0; 3000; 500; }
byCoordinates_17 = Point.ByCoordinates(x=code_block_27.out0, y=code_block_27.out1, z=code_block_27.out2)
byCoordinates_18 = Point.ByCoordinates(x=code_block_27.out3, y=code_block_27.out4, z=code_block_27.out5)
radius_of_podium = DoubleSlider(1280, range=100..2000 step 20)
concrete_bench_podium = Cylinder.ByPointsRadius(startPoint=byCoordinates_17, endPoint=byCoordinates_18, radius=radius_of_podium)
volume = Solid.Volume(solid=concrete_bench_podium)
volume_of_concrete_podium = Watch(volume)
code_block_28 = CodeBlock { 0; 2000; 300; 180; 0; }
byCoordinates_19 = Point.ByCoordinates(x=code_block_28.out0, y=code_block_28.out1, z=code_block_28.out2)
radius_of_cylindrical_benches = DoubleSlider(2300, range=100..4000 step 100)
byCenterPointRadiusAngle = Arc.ByCenterPointRadiusAngle(center=byCoordinates_19, radius=radius_of_cylindrical_benches, startAngle=code_block_28.out3, endAngle=code_block_28.out4)
code_block_29 = CodeBlock { 0; 10; 1/9; }
sequence_7 = Sequence(start=code_block_29.out0, amount=code_block_29.out1, step=code_block_29.out2)
pointAtParameter = Curve.PointAtParameter(curve=byCenterPointRadiusAngle, param=sequence_7)
code_block_30 = CodeBlock { 0; 2000; 0; 180; 0; }
byCoordinates_20 = Point.ByCoordinates(x=code_block_30.out0, y=code_block_30.out1, z=code_block_30.out2)
radius_of_cylindrical_benches_2 = DoubleSlider(2300, range=100..4000 step 100)
byCenterPointRadiusAngle_2 = Arc.ByCenterPointRadiusAngle(center=byCoordinates_20, radius=radius_of_cylindrical_benches_2, startAngle=code_block_30.out3, endAngle=code_block_30.out4)
code_block_31 = CodeBlock { 0; 10; 1/9; }
sequence_8 = Sequence(start=code_block_31.out0, amount=code_block_31.out1, step=code_block_31.out2)
pointAtParameter_2 = Curve.PointAtParameter(curve=byCenterPointRadiusAngle_2, param=sequence_8)
code_block_32 = CodeBlock { 220; 10; 0; }
sequence_9 = Sequence(start=code_block_32.out0, amount=code_block_32.out1, step=code_block_32.out2)
final_target_for_concrete = Python(IN[0]=pointAtParameter, IN[1]=pointAtParameter_2, IN[2]=sequence_9, IN[3]=circular_bench_concrete)  # "Final Target For Concrete benches"; CPython3
# ---------- final_target_for_concrete.python (33 lines) ----------
# IN[0] = bottom_points (list of points)
# IN[1] = top_points (list of points)
# IN[2] = radii (list of numbers)
# IN[3] = CircularRod class

CircularRod = IN[3]
bottom_points = IN[0]
top_points = IN[1]
radii = IN[2]

rods = []             
total_volume = 0

count = min(len(bottom_points), len(top_points))

for i in range(count):
    r = radii[i] if i < len(radii) else radii[-1]
    btm = bottom_points[i]
    top = top_points[i]
    
    rod = CircularRod(btm, top, r)
    
    
    rods.append(rod.make_geometry())
    
    
    total_volume += rod.volume()


total_volume_formatted = f"{round(total_volume, 2)} mm³"


OUT = rods, total_volume_formatted
# ----------------------------------------
lastItem = List.LastItem(list=final_target_for_concrete)
volume_of_support_arch_steel = Watch(lastItem)  # "Volume of Support Arch (Steel Rods)"
code_block_33 = CodeBlock { -1000; 2500; 5000; }
byCoordinates_21 = Point.ByCoordinates(x=code_block_33.out0, y=code_block_33.out1, z=code_block_33.out2)
code_block_34 = CodeBlock { 1000; 2500; 5000; 100; }
top_connecting_sphere = Sphere.ByCenterPointRadius(centerPoint=byCoordinates_21, radius=code_block_34.out3)
byCoordinates_22 = Point.ByCoordinates(x=code_block_34.out0, y=code_block_34.out1, z=code_block_34.out2)
top_connecting_sphere_2 = Sphere.ByCenterPointRadius(centerPoint=byCoordinates_22, radius=code_block_34.out3)
top_connecting_rod = Cylinder.ByPointsRadius(startPoint=byCoordinates_21, endPoint=byCoordinates_22, radius=code_block_34.out3)
list_create = List.Create(item0=top_connecting_sphere, item1=top_connecting_sphere_2, item2=top_connecting_rod)
find_volumes_and_display = Python(IN[0]=list_create)  # CPython3
# ---------- find_volumes_and_display.python (18 lines) ----------
# IN[0] = list of Cylinder objects

cylinders = IN[0]

volumes_m3 = []

for c in cylinders:
    if c is None:
        continue
   
    volumes_m3.append(c.Volume)


total_mm3 = sum(volumes_m3)
total_mm3 = round(total_mm3, 2)


OUT = "{} mm³".format(total_mm3)
# ----------------------------------------
volume_of_connecting_rods_steel = Watch(find_volumes_and_display)  # "Volume of Connecting Rods (Steel Rods)"
byARGB_2 = Color.ByARGB()
code_block_35 = CodeBlock { -3750; 3750; 1500; }
byCoordinates_23 = Point.ByCoordinates(x=code_block_35.out0, y=code_block_35.out1, z=code_block_35.out2)
number_slider = DoubleSlider(550, range=0..1000 step 50)
class_of_decorative_brass_post = Python()  # "Class of Decorative Brass Post (Sphere)"; CPython3; unwired: IN[0]
# ---------- class_of_decorative_brass_post.python (23 lines) ----------
import clr
clr.AddReference('ProtoGeometry')
from Autodesk.DesignScript.Geometry import *

class SphereObj:
    def __init__(self, centerPoint, radius):
        
        if radius is None:
            radius = 1  # fallback value

        
        try:
            self.radius = abs(float(radius))
        except:
            self.radius = 1  

        self.center = centerPoint
        self.solid = Sphere.ByCenterPointRadius(self.center, self.radius)

    def geometry(self):
        return self.solid

OUT = SphereObj
# ----------------------------------------
instance_of_decorative_brass = Python(IN[0]=byCoordinates_23, IN[1]=number_slider, IN[2]=class_of_decorative_brass_post)  # "Instance of Decorative Brass Post (Sphere)"; CPython3
# ---------- instance_of_decorative_brass.python (3 lines) ----------
SphereObj = IN[2]
inst = SphereObj(IN[0], IN[1])
OUT = inst.geometry()
# ----------------------------------------
code_block_36 = CodeBlock { 255; 181; 166; 66; }
byARGB_3 = Color.ByARGB(alpha=code_block_36.out0, red=code_block_36.out1, green=code_block_36.out2, blue=code_block_36.out3)
byGeometryColor_2 = Modifiers.GeometryColor.ByGeometryColor(geometry=instance_of_decorative_brass, color=byARGB_3)
code_block_37 = CodeBlock { -3500; 3500; 0; -4000; 4000; 1500; }
byCoordinates_24 = Point.ByCoordinates(x=code_block_37.out3, y=code_block_37.out4, z=code_block_37.out5)
byCoordinates_25 = Point.ByCoordinates(x=code_block_37.out0, y=code_block_37.out1, z=code_block_37.out2)
class_of_decorative_brass_post_2 = Python()  # "Class of Decorative Brass Post (Cuboid)"; CPython3; unwired: IN[0]
# ---------- class_of_decorative_brass_post_2.python (16 lines) ----------
import clr
clr.AddReference('ProtoGeometry')
from Autodesk.DesignScript.Geometry import *

class CuboidRod:
    def __init__(self, c1, c2):
        
        self.corner1 = c1
        self.corner2 = c2
        self.solid = Cuboid.ByCorners(self.corner1, self.corner2)
        
    def make_geometry(self):
        return self.solid


OUT = CuboidRod
# ----------------------------------------
instance_of_decorative_brass_2 = Python(IN[0]=byCoordinates_24, IN[1]=byCoordinates_25, IN[2]=class_of_decorative_brass_post_2)  # "Instance of Decorative Brass Post (Cuboid)"; CPython3
# ---------- instance_of_decorative_brass_2.python (11 lines) ----------
# IN[0] = corner1
# IN[1] = corner2
# IN[2] = CuboidRod class 

CuboidRod = IN[2]

a = CuboidRod(IN[0], IN[1])
b = a.make_geometry()


OUT = b
# ----------------------------------------
code_block_38 = CodeBlock { 255; 181; 166; 66; }
byARGB_4 = Color.ByARGB(alpha=code_block_38.out0, red=code_block_38.out1, green=code_block_38.out2, blue=code_block_38.out3)
byGeometryColor_3 = Modifiers.GeometryColor.ByGeometryColor(geometry=instance_of_decorative_brass_2, color=byARGB_4)
code_block_39 = CodeBlock { 3750; 3750; 1500; }
byCoordinates_26 = Point.ByCoordinates(x=code_block_39.out0, y=code_block_39.out1, z=code_block_39.out2)
number_slider_2 = DoubleSlider(550, range=0..1000 step 50)
class_of_decorative_brass_post_3 = Python()  # "Class of Decorative Brass Post (Sphere)"; CPython3; unwired: IN[0]
# ---------- class_of_decorative_brass_post_3.python (23 lines) ----------
import clr
clr.AddReference('ProtoGeometry')
from Autodesk.DesignScript.Geometry import *

class SphereObj:
    def __init__(self, centerPoint, radius):
        
        if radius is None:
            radius = 1  

        
        try:
            self.radius = abs(float(radius))
        except:
            self.radius = 1  # final fallback

        self.center = centerPoint
        self.solid = Sphere.ByCenterPointRadius(self.center, self.radius)

    def geometry(self):
        return self.solid

OUT = SphereObj
# ----------------------------------------
instance_of_decorative_brass_3 = Python(IN[0]=byCoordinates_26, IN[1]=number_slider_2, IN[2]=class_of_decorative_brass_post_3)  # "Instance of Decorative Brass Post (Sphere)"; CPython3; same code as instance_of_decorative_brass
code_block_40 = CodeBlock { 255; 181; 166; 66; }
byARGB_5 = Color.ByARGB(alpha=code_block_40.out0, red=code_block_40.out1, green=code_block_40.out2, blue=code_block_40.out3)
byGeometryColor_4 = Modifiers.GeometryColor.ByGeometryColor(geometry=instance_of_decorative_brass_3, color=byARGB_5)
code_block_41 = CodeBlock { 3500; 3500; 0; 4000; 4000; 1500; }
byCoordinates_27 = Point.ByCoordinates(x=code_block_41.out3, y=code_block_41.out4, z=code_block_41.out5)
byCoordinates_28 = Point.ByCoordinates(x=code_block_41.out0, y=code_block_41.out1, z=code_block_41.out2)
class_of_decorative_brass_post_4 = Python()  # "Class of Decorative Brass Post (Cuboid)"; CPython3; unwired: IN[0]
# ---------- class_of_decorative_brass_post_4.python (15 lines) ----------
import clr
clr.AddReference('ProtoGeometry')
from Autodesk.DesignScript.Geometry import *

class CuboidRod:
    def __init__(self, c1, c2):
       
        self.corner1 = c1
        self.corner2 = c2
        self.solid = Cuboid.ByCorners(self.corner1, self.corner2)
        
    def make_geometry(self):
        return self.solid

OUT = CuboidRod
# ----------------------------------------
instance_of_decorative_brass_4 = Python(IN[0]=byCoordinates_27, IN[1]=byCoordinates_28, IN[2]=class_of_decorative_brass_post_4)  # "Instance of Decorative Brass Post (Cuboid)"; CPython3
# ---------- instance_of_decorative_brass_4.python (11 lines) ----------
# IN[0] = corner1
# IN[1] = corner2
# IN[2] = CuboidRod class 
CuboidRod = IN[2]


a = CuboidRod(IN[0], IN[1])
b = a.make_geometry()


OUT = b
# ----------------------------------------
code_block_42 = CodeBlock { 255; 181; 166; 66; }
byARGB_6 = Color.ByARGB(alpha=code_block_42.out0, red=code_block_42.out1, green=code_block_42.out2, blue=code_block_42.out3)
byGeometryColor_5 = Modifiers.GeometryColor.ByGeometryColor(geometry=instance_of_decorative_brass_4, color=byARGB_6)
code_block_43 = CodeBlock { 255; 150; 150; 150; }
byARGB_7 = Color.ByARGB(alpha=code_block_43.out0, red=code_block_43.out1, green=code_block_43.out2, blue=code_block_43.out3)
byGeometryColor_6 = Modifiers.GeometryColor.ByGeometryColor(geometry=final_target_for_concrete, color=byARGB_7)
code_block_44 = CodeBlock { 0; 0; 0; 0; 0; 100; }
byCoordinates_29 = Point.ByCoordinates(x=code_block_44.out0, y=code_block_44.out1, z=code_block_44.out2)
byCoordinates_30 = Point.ByCoordinates(x=code_block_44.out3, y=code_block_44.out4, z=code_block_44.out5)
radius_of_concrete_base = DoubleSlider(4300, range=100..5000 step 100)
concrete_base_of_pavilion = Cylinder.ByPointsRadius(startPoint=byCoordinates_29, endPoint=byCoordinates_30, radius=radius_of_concrete_base)
code_block_45 = CodeBlock { 255; 150; 150; 150; }
byARGB_8 = Color.ByARGB(alpha=code_block_45.out0, red=code_block_45.out1, green=code_block_45.out2, blue=code_block_45.out3)
byGeometryColor_7 = Modifiers.GeometryColor.ByGeometryColor(geometry=concrete_base_of_pavilion, color=byARGB_8)
code_block_46 = CodeBlock { 255; 150; 150; 150; }
byARGB_9 = Color.ByARGB(alpha=code_block_46.out0, red=code_block_46.out1, green=code_block_46.out2, blue=code_block_46.out3)
byGeometryColor_8 = Modifiers.GeometryColor.ByGeometryColor(geometry=concrete_bench_podium, color=byARGB_9)
code_block_47 = CodeBlock { -1000; 2500; 5000; }
byCoordinates_31 = Point.ByCoordinates(x=code_block_47.out0, y=code_block_47.out1, z=code_block_47.out2)
code_block_48 = CodeBlock { 1000; 2500; 5000; }
byCoordinates_32 = Point.ByCoordinates(x=code_block_48.out0, y=code_block_48.out1, z=code_block_48.out2)
top_points_of_main_arch = Line.ByStartPointEndPoint(startPoint=byCoordinates_31, endPoint=byCoordinates_32)
code_block_49 = CodeBlock { 0; 10; 1/9; }
sequence_10 = Sequence(start=code_block_49.out0, amount=code_block_49.out1, step=code_block_49.out2)
pointAtParameter_3 = Curve.PointAtParameter(curve=top_points_of_main_arch, param=sequence_10)
code_block_50 = CodeBlock { 0; 0; 0; 180; 0; }
point_for_main_arch = Point.ByCoordinates(x=code_block_50.out0, y=code_block_50.out1, z=code_block_50.out2)
radius_of_main_arch = DoubleSlider(4000, range=100..4000 step 100)
base_of_main_arch = Arc.ByCenterPointRadiusAngle(center=point_for_main_arch, radius=radius_of_main_arch, startAngle=code_block_50.out3, endAngle=code_block_50.out4)
code_block_51 = CodeBlock { 0; 10; 1/9; }
sequence_11 = Sequence(start=code_block_51.out0, amount=code_block_51.out1, step=code_block_51.out2)
base_curve_for_main_arch = Curve.PointAtParameter(curve=base_of_main_arch, param=sequence_11)
code_block_52 = CodeBlock { 100; 10; 0; }
sequence_12 = Sequence(start=code_block_52.out0, amount=code_block_52.out1, step=code_block_52.out2)
final_steel_rods_for_main_arch = Python(IN[0]=pointAtParameter_3, IN[1]=base_curve_for_main_arch, IN[2]=sequence_12, IN[3]=circular_rod)  # CPython3
# ---------- final_steel_rods_for_main_arch.python (31 lines) ----------
# IN[0] = bottom_points 
# IN[1] = top_points 
# IN[2] = radii 
# IN[3] = CircularRod class

CircularRod = IN[3]
bottom_points = IN[0]
top_points = IN[1]
radii = IN[2]

rods = []             
total_volume = 0

count = min(len(bottom_points), len(top_points))

for i in range(count):
    r = radii[i] if i < len(radii) else radii[-1]
    btm = bottom_points[i]
    top = top_points[i]
    
    rod = CircularRod(btm, top, r)
    
    
    rods.append(rod.make_geometry())
    
   
    total_volume += rod.volume()


total_volume_format = f"{round(total_volume, 2)} mm³"
OUT = rods, total_volume_format
# ----------------------------------------
lastItem_2 = List.LastItem(list=final_steel_rods_for_main_arch)
volume_of_support_arch_steel_2 = Watch(lastItem_2)  # "Volume of Support Arch (Steel Rods)"
code_block_53 = CodeBlock { 1000; 2500; 5000; }
byCoordinates_33 = Point.ByCoordinates(x=code_block_53.out0, y=code_block_53.out1, z=code_block_53.out2)
code_block_54 = CodeBlock { -1000; 2500; 5000; }
byCoordinates_34 = Point.ByCoordinates(x=code_block_54.out0, y=code_block_54.out1, z=code_block_54.out2)
byStartPointEndPoint_2 = Line.ByStartPointEndPoint(startPoint=byCoordinates_33, endPoint=byCoordinates_34)
code_block_55 = CodeBlock { 0; 10; 1/9; }
sequence_13 = Sequence(start=code_block_55.out0, amount=code_block_55.out1, step=code_block_55.out2)
pointAtParameter_4 = Curve.PointAtParameter(curve=byStartPointEndPoint_2, param=sequence_13)
code_block_56 = CodeBlock { 0; 3000; 0; 0; 180; }
byCoordinates_35 = Point.ByCoordinates(x=code_block_56.out0, y=code_block_56.out1, z=code_block_56.out2)
radius_of_support_arch = DoubleSlider(1100, range=100..2000 step 100)
byCenterPointRadiusAngle_3 = Arc.ByCenterPointRadiusAngle(center=byCoordinates_35, radius=radius_of_support_arch, startAngle=code_block_56.out3, endAngle=code_block_56.out4)
code_block_57 = CodeBlock { 0; 10; 1/9; }
sequence_14 = Sequence(start=code_block_57.out0, amount=code_block_57.out1, step=code_block_57.out2)
pointAtParameter_5 = Curve.PointAtParameter(curve=byCenterPointRadiusAngle_3, param=sequence_14)
code_block_58 = CodeBlock { 100; 12; 0; }
sequence_15 = Sequence(start=code_block_58.out0, amount=code_block_58.out1, step=code_block_58.out2)
final_steel_rod_output = Python(IN[0]=pointAtParameter_4, IN[1]=pointAtParameter_5, IN[2]=sequence_15, IN[3]=steel_rod_class)  # CPython3
# ---------- final_steel_rod_output.python (31 lines) ----------
# IN[0] = bottom_points (list of points)
# IN[1] = top_points (list of points)
# IN[2] = radii (list of numbers)
# IN[3] = CircularRod class

CircularRod = IN[3]
bottom_points = IN[0]
top_points = IN[1]
radii = IN[2]

rods = []            
total_volume = 0

count = min(len(bottom_points), len(top_points))

for i in range(count):
    r = radii[i] if i < len(radii) else radii[-1]
    btm = bottom_points[i]
    top = top_points[i]
    
    rod = CircularRod(btm, top, r)
    
    
    rods.append(rod.make_geometry())
    
    
    total_volume += rod.volume()


total_volume_format = f"{round(total_volume, 2)} mm³"
OUT = rods, total_volume_format
# ----------------------------------------
lastItem_3 = List.LastItem(list=final_steel_rod_output)
volume_of_support_arch_steel_3 = Watch(lastItem_3)  # "Volume of Support Arch (Steel Rods)"
