# Dynamo graph 1890680.dyn "HomeAssignment - Copy" (Dynamo 4.0.0.3277)

# group: Don't touch this ground
code_block = CodeBlock { -5000; -5000; -200; }
byCoordinates = Point.ByCoordinates(x=code_block.out0, y=code_block.out1, z=code_block.out2)
code_block_2 = CodeBlock { 5000; 5000; 0; }
byCoordinates_2 = Point.ByCoordinates(x=code_block_2.out0, y=code_block_2.out1, z=code_block_2.out2)
byCorners = Cuboid.ByCorners(lowPoint=byCoordinates, highPoint=byCoordinates_2)
code_block_3 = CodeBlock { 0; 100; 0; }
byARGB = Color.ByARGB(red=code_block_3.out0, green=code_block_3.out1, blue=code_block_3.out2)
byGeometryColor = Modifiers.GeometryColor.ByGeometryColor(geometry=byCorners, color=byARGB)

code_block_4 = CodeBlock { 4000; 4000; }
beam_height = DoubleSlider(7000, range=3000..7000 step 100)
ceiling_thickness = Python(IN[0]=beam_height)  # PythonNet3
# ---------- ceiling_thickness.python (3 lines) ----------
height = IN[0]
thickness = height + 500
OUT = thickness
# ----------------------------------------
roof_low_points = Point.ByCoordinates(x=code_block_4.out0, y=code_block_4.out1, z=ceiling_thickness)
code_block_5 = CodeBlock { -4000; -4000; 5000; }
roof_high_points = Point.ByCoordinates(x=code_block_5.out0, y=code_block_5.out1, z=beam_height)
steel_roof = Python()  # PythonNet3; unwired: IN[0]
# ---------- steel_roof.python (16 lines) ----------
# Load the Python Standard and DesignScript Libraries
import sys
import clr
clr.AddReference('ProtoGeometry')
from Autodesk.DesignScript.Geometry import *

class SteelRoof():
    def __init__(self, lowpoint, highpoint):
        self.lowpoint = lowpoint 
        self.highpoint = highpoint
        
    def make_geometry(self):
        return Cuboid.ByCorners(self.lowpoint, self.highpoint)
   
        
OUT = SteelRoof
# ----------------------------------------
instance_of_steel_roof = Python(IN[0]=roof_low_points, IN[1]=roof_high_points, IN[2]=steel_roof)  # PythonNet3
# ---------- instance_of_steel_roof.python (9 lines) ----------
low_point = IN[0]
high_point = IN[1]
SteelRoof = IN[2]

roof = SteelRoof(low_point, high_point)

roof  = roof.make_geometry()

OUT = roof
# ----------------------------------------
code_block_6 = CodeBlock { 0; 0; }
height_translation_for_hole = Python(IN[0]=beam_height)  # PythonNet3
# ---------- height_translation_for_hole.python (3 lines) ----------
Height = IN[0]
Sphere_height = Height + 250
OUT = Sphere_height
# ----------------------------------------
hole_center_point = Point.ByCoordinates(x=code_block_6.out0, y=code_block_6.out1, z=height_translation_for_hole)
hole_radius = DoubleSlider(1400, range=500..2000 step 100)
steel_roof_hole = Python(IN[0]=instance_of_steel_roof, IN[1]=hole_center_point, IN[2]=hole_radius)  # PythonNet3
# ---------- steel_roof_hole.python (14 lines) ----------
import sys
import clr
clr.AddReference('ProtoGeometry')
from Autodesk.DesignScript.Geometry import *

base_solid = IN[0]
center     = IN[1]
radius     = IN[2]

cut_sphere = Sphere.ByCenterPointRadius(center, radius)

result = Solid.Difference(base_solid, cut_sphere)

OUT = result
# ----------------------------------------
code_block_7 = CodeBlock { -3500; -3500; }
height_fix = Python(IN[0]=beam_height)  # PythonNet3
# ---------- height_fix.python (5 lines) ----------
height = IN[0]
z = height / 2
OUT = z

#The Cuboid.Origin.width.length.height will create geomtry away from the origin which so the height would be cut in half. This python is only here to address that. 
# ----------------------------------------
east_start_point = Point.ByCoordinates(x=code_block_7.out0, y=code_block_7.out1, z=height_fix)
code_block_8 = CodeBlock { 3500; -3500; }
east_end_point = Point.ByCoordinates(x=code_block_8.out0, y=code_block_8.out1, z=height_fix)
east_line = Line.ByStartPointEndPoint(startPoint=east_start_point, endPoint=east_end_point)
number_of_beams = DoubleSlider(10, range=2..10 step 2)
code_block_9 = CodeBlock(n=number_of_beams) { n; 0..1..#n+1; }
wall_east = Curve.PointAtParameter(curve=east_line, param=code_block_9.out1)
code_block_10 = CodeBlock { 3500; 3500; }
west_start_point = Point.ByCoordinates(x=code_block_10.out0, y=code_block_10.out1, z=height_fix)
code_block_11 = CodeBlock { -3500; 3500; }
west_end_point = Point.ByCoordinates(x=code_block_11.out0, y=code_block_11.out1, z=height_fix)
west_line = Line.ByStartPointEndPoint(startPoint=west_start_point, endPoint=west_end_point)
wall_west = Curve.PointAtParameter(curve=west_line, param=code_block_9.out1)
remove_middle_beam = Python(IN[0]=wall_east, IN[1]=wall_west)  # PythonNet3
# ---------- remove_middle_beam.python (8 lines) ----------
east_points = IN[0]
west_points = IN[1]

Removed_East = len(east_points)/2 - 1
Removed_West = len(west_points)/2 - 1


OUT = Removed_East and Removed_West
# ----------------------------------------
removeItemAtIndex = List.RemoveItemAtIndex(list=wall_east, indices=remove_middle_beam)
removeItemAtIndex_2 = List.RemoveItemAtIndex(list=wall_west, indices=remove_middle_beam)
wood_beam_width = DoubleSlider(500, range=300..500 step 10)
wooden_beam = Python()  # PythonNet3; unwired: IN[0]
# ---------- wooden_beam.python (18 lines) ----------
# Load the Python Standard and DesignScript Libraries
import sys
import clr
clr.AddReference('ProtoGeometry')
from Autodesk.DesignScript.Geometry import *

class WoodenBeam:
    def __init__(self, coord, width, length, height):
        self.coord = coord
        self.width = width
        self.length = length
        self.height = height

    def make_geometry(self):
        return Cuboid.ByLengths(self.coord, self.width, self.length, self.height)


OUT = WoodenBeam
# ----------------------------------------
instances_of_wooden_beam = Python(IN[0]=removeItemAtIndex, IN[1]=removeItemAtIndex_2, IN[2]=beam_height, IN[3]=wood_beam_width, IN[4]=wooden_beam)  # PythonNet3
# ---------- instances_of_wooden_beam.python (28 lines) ----------
import clr
clr.AddReference('ProtoGeometry')
from Autodesk.DesignScript.Geometry import *

east_points = IN[0]
west_points = IN[1]
height = IN[2]
width = IN[3]
length = width
WoodenBeam = IN[4]


All_points = east_points + west_points
beams = []

for btm in All_points:
  
    top = Point.ByCoordinates(btm.X, btm.Y, btm.Z)
    

   
    beam = WoodenBeam(btm, width, length, height)

   
    beams.append(beam.make_geometry())


OUT = beams
# ----------------------------------------
volume_calculation = Python(IN[0]=instance_of_steel_roof, IN[1]=instances_of_wooden_beam, IN[2]=hole_radius, IN[3]=roof_low_points, IN[4]=roof_high_points)  # PythonNet3
# ---------- volume_calculation.python (25 lines) ----------
import sys
import clr
clr.AddReference('ProtoGeometry')
from Autodesk.DesignScript.Geometry import *
import math

roof_instance = IN[0]
beam_instances = IN[1]
hole_radius = IN[2]
low_point   = IN[3]
high_point  = IN[4]

#Steel Roof Volume 
roof = roof_instance.Volume

thickness = abs(high_point.Z - low_point.Z)

hole = math.pi * (hole_radius**2) * thickness 

roof_volume = roof - hole

#Wooden Beams Volume
beams_volume = sum([b.Volume for b in beam_instances])

OUT = roof_volume, beams_volume
# ----------------------------------------
watch = Watch(volume_calculation)
