# Dynamo graph 1898788.dyn "AT_HOME_PROJECT_2_FINAL" (Dynamo 3.6.0.9395)

code_block = CodeBlock()  # //The number slider above controlls the amount of circular beams that cross the structure and can be adjusted
code_block_2 = CodeBlock()
# ---------- code_block_2.designscript (21 lines) ----------
w = 60;
l = 60;


h_edge = 25;
h_mid = 10;


p1_start = Point.ByCoordinates(-w/2, 0, 0);
p1_mid = Point.ByCoordinates(-w/2, l/2, h_edge);
p1_end = Point.ByCoordinates(-w/2, l, 0);


p2_start = Point.ByCoordinates(0, 0, 0);
p2_mid = Point.ByCoordinates(0, l/2, h_mid);
p2_end = Point.ByCoordinates(0, l, 0);


p3_start = Point.ByCoordinates(w/2, 0, 0);
p3_mid = Point.ByCoordinates(w/2, l/2, h_edge);
p3_end = Point.ByCoordinates(w/2, l, 0);
# ----------------------------------------
list_create = List.Create(item0=code_block_2.p1_start, item1=code_block_2.p1_mid, item2=code_block_2.p1_end)
left_curve = NurbsCurve.ByPoints(points=list_create)
list_create_2 = List.Create(item0=code_block_2.p2_start, item1=code_block_2.p2_mid, item2=code_block_2.p2_end)
middle_curve = NurbsCurve.ByPoints(points=list_create_2)
list_create_3 = List.Create(item0=code_block_2.p3_start, item1=code_block_2.p3_mid, item2=code_block_2.p3_end)
right_curve = NurbsCurve.ByPoints(points=list_create_3)
list_create_4 = List.Create(item0=left_curve, item1=middle_curve, item2=right_curve)
byLoft = Surface.ByLoft(crossSections=list_create_4)
code_block_3 = CodeBlock { 1; }
number_slider = DoubleSlider(20, range=10..25 step 1)
code_block_4 = CodeBlock(divisions=number_slider) { 0..1..#divisions; }
getIsoline = Surface.GetIsoline(surface=byLoft, isoDirection=code_block_3, parameter=code_block_4)
code_block_5 = CodeBlock { 0; }
planeAtParameter = Curve.PlaneAtParameter(curve=getIsoline, param=code_block_5)
number = DoubleInput(0.3)
byPlaneRadius = Circle.ByPlaneRadius(plane=planeAtParameter, radius=number)
bySweep = Solid.BySweep(profile=byPlaneRadius, path=getIsoline)
getIsoline_2 = Surface.GetIsoline(surface=byLoft, parameter=code_block_4)
planeAtParameter_2 = Curve.PlaneAtParameter(curve=getIsoline_2, param=code_block_5)
byPlaneRadius_2 = Circle.ByPlaneRadius(plane=planeAtParameter_2, radius=number)
bySweep_2 = Solid.BySweep(profile=byPlaneRadius_2, path=getIsoline_2)
list_create_5 = List.Create(item0=bySweep, item1=bySweep_2)
code_block_6 = CodeBlock { A = 255; }
number_slider_2 = DoubleSlider(120, range=0..255 step 1)
byARGB = Color.ByARGB(alpha=code_block_6, red=number_slider_2, green=number_slider_2, blue=number_slider_2)
byGeometryColor = Modifiers.GeometryColor.ByGeometryColor(geometry=list_create_5, color=byARGB)
number_2 = DoubleInput(0.1)
thicken = Surface.Thicken(surface=byLoft, thickness=number_2)
code_block_7 = CodeBlock { R = 150; G = 200; B = 240; }
byARGB_2 = Color.ByARGB(red=code_block_7.R, green=code_block_7.G, blue=code_block_7.B)
byGeometryColor_2 = Modifiers.GeometryColor.ByGeometryColor(geometry=thicken, color=byARGB_2)
list_create_6 = List.Create(item0=byGeometryColor, item1=byGeometryColor_2)
number_3 = DoubleInput(10)
code_block_8 = CodeBlock { R = 150; G = 200; B = 240; }
byARGB_3 = Color.ByARGB(alpha=number_3, red=code_block_8.R, green=code_block_8.G, blue=code_block_8.B)
byGeometryColor_3 = Modifiers.GeometryColor.ByGeometryColor(geometry=byLoft, color=byARGB_3)
