# Dynamo graph 1898875.dyn "Dynamo Home Assignment" (Dynamo 4.0.0.3277)

# group: Don't touch this ground
code_block = CodeBlock { -5000; -5000; -200; }  # frozen
byCoordinates = Point.ByCoordinates(x=code_block.out0, y=code_block.out1, z=code_block.out2)  # frozen
code_block_2 = CodeBlock { 5000; 5000; 0; }  # frozen
byCoordinates_2 = Point.ByCoordinates(x=code_block_2.out0, y=code_block_2.out1, z=code_block_2.out2)  # frozen
byCorners = Cuboid.ByCorners(lowPoint=byCoordinates, highPoint=byCoordinates_2)  # frozen
code_block_3 = CodeBlock { 0; 100; 0; }  # frozen
byARGB = Color.ByARGB(red=code_block_3.out0, green=code_block_3.out1, blue=code_block_3.out2)  # frozen
byGeometryColor = Modifiers.GeometryColor.ByGeometryColor(geometry=byCorners, color=byARGB)  # frozen

zero = DoubleInput(0)
zero_2 = DoubleInput(0)

# group: Parameters
posts_per_long_edge = DoubleSlider(3, range=2..6 step 1)
post_Radius = DoubleSlider(75, range=75..100 step 5)
post_height = DoubleSlider(3130, range=1000..5000 step 10)
truss_Count = DoubleSlider(6, range=2..6 step 2)
roof_rise = DoubleSlider(1980, range=100..3000 step 10)

footprint_Y = DoubleInput(10000)
one = DoubleInput(1)
number_of_posts_1 = posts_per_long_edge - one
post_spacing = footprint_Y / number_of_posts_1
post_positions_on_y_axis = Sequence(start=zero_2, amount=posts_per_long_edge, step=post_spacing)
left_post_points = Point.ByCoordinates(x=zero, y=post_positions_on_y_axis, z=zero)
footprint_X = DoubleInput(10000)
right_post_points = Point.ByCoordinates(x=footprint_X, y=post_positions_on_y_axis, z=zero)
list_create = List.Create(item0=left_post_points, item1=right_post_points)
all_post_points = List.Flatten(list=list_create)
radius = Circle.ByCenterPointRadius(centerPoint=all_post_points, radius=post_Radius)
zero_3 = DoubleInput(0)
height = Vector.ByCoordinates(x=zero_3, y=zero_3, z=post_height)
extrude = Curve.Extrude(curve=radius, distance=height)
zero_4 = DoubleInput(0)
zero_5 = DoubleInput(0)
one_2 = DoubleInput(1)
number_of_trusses_1 = truss_Count - one_2
truss_spacing = footprint_Y / number_of_trusses_1
truss_positions_on_y_axis = Sequence(start=zero_5, amount=truss_Count, step=truss_spacing)
left_truss_points = Point.ByCoordinates(x=zero_4, y=truss_positions_on_y_axis, z=post_height)
center_point = DoubleInput(5000)
posts_truss_height = roof_rise + post_height
top_of_truss = Point.ByCoordinates(x=center_point, y=truss_positions_on_y_axis, z=posts_truss_height)
left_rafters = Line.ByStartPointEndPoint(startPoint=left_truss_points, endPoint=top_of_truss)
right_truss_points = Point.ByCoordinates(x=footprint_X, y=truss_positions_on_y_axis, z=post_height)
top_cables = Line.ByStartPointEndPoint(startPoint=left_truss_points, endPoint=right_truss_points)
right_rafters = Line.ByStartPointEndPoint(startPoint=right_truss_points, endPoint=top_of_truss)
list_create_2 = List.Create(item0=left_rafters, item1=top_cables, item2=right_rafters)
truss_lines = List.Flatten(list=list_create_2)
radius_2 = DoubleInput(50)
trusses = TSpline.TSplineSurface.BuildPipes(curves=truss_lines, defaultRadius=radius_2)
watch_3d = Watch3D(trusses)
volume_output = Python(IN[0]=all_post_points, IN[1]=post_Radius, IN[2]=post_height)  # PythonNet3
# ---------- volume_output.python (38 lines) ----------
import clr
clr.AddReference('ProtoGeometry')
from Autodesk.DesignScript.Geometry import *
import math

class WoodenPost:
    def __init__(self, base_point, radius, height):
        self.base = base_point
        self.radius = radius
        self.height = height
        self.geometry = None
    
    def generate_geometry(self):
        cs = CoordinateSystem.Identity().Translate(self.base.X, self.base.Y, self.base.Z)
        self.geometry = Cylinder.ByRadiusHeight(cs, self.radius, self.height)
        
        return self.geometry
    
    #volume formula
    def volume(self):
        return math.pi * (self.radius ** 2) * self.height

# inputs
points = IN[0] 
raw_radius = IN[1] 
raw_height = IN[2] 

#seems to give the values in lists. Convert to float so vaues can be used
radius = float(raw_radius[0]) if isinstance(raw_radius, list) else float(raw_radius)
height = float(raw_height[0]) if isinstance(raw_height, list) else float(raw_height)

#instance s
wooden_posts = [WoodenPost(p, radius, height) for p in points]
geometries = [wp.generate_geometry() for wp in wooden_posts]
total_volume = sum(wp.volume() for wp in wooden_posts)

#outputs 
OUT = geometries, total_volume
# ----------------------------------------
wooden_post = Watch3D(volume_output)
wooden_post_volume = Watch(volume_output)
