# Dynamo graph 1908066.dyn "1908966" (Dynamo 3.6.0.9395)

# group: Can't touch this
code_block = CodeBlock { -5000; -5000; -200; }
byCoordinates = Point.ByCoordinates(x=code_block.out0, y=code_block.out1, z=code_block.out2)
code_block_2 = CodeBlock { 5000; 5000; 0; }
byCoordinates_2 = Point.ByCoordinates(x=code_block_2.out0, y=code_block_2.out1, z=code_block_2.out2)
byCorners = Cuboid.ByCorners(lowPoint=byCoordinates, highPoint=byCoordinates_2)
code_block_3 = CodeBlock { 0; 100; 0; }
byARGB = Color.ByARGB(red=code_block_3.out0, green=code_block_3.out1, blue=code_block_3.out2)
byGeometryColor = Modifiers.GeometryColor.ByGeometryColor(geometry=byCorners, color=byARGB)

outside_radius = IntegerSlider(4500, range=3400..4500 step 100)
byCoordinates_3 = Point.ByCoordinates(x=outside_radius)
pavillion_additional_height = IntegerSlider(500, range=0..1000 step 100)

# group: Curve 1
code_block_4 = CodeBlock(R=outside_radius, H=pavillion_additional_height) { R; H; x = 4*R/10; z = H+(4*R/10); r = 6*R/10; angle1 = 270; angle2 = 360; }
byCoordinates_4 = Point.ByCoordinates(x=code_block_4.x, z=code_block_4.z)
YAxis = Vector.YAxis()
byCenterPointRadiusAngle = Arc.ByCenterPointRadiusAngle(center=byCoordinates_4, radius=code_block_4.r, startAngle=code_block_4.angle1, endAngle=code_block_4.angle2, normal=YAxis)

# group: Curve 2
code_block_5 = CodeBlock(R=outside_radius, H=pavillion_additional_height) { R; H; x = 3*R/10+250+R/40; z = H+(7*R/10); r = 3*R/10; angle1 = 180; angle2 = 270; }
byCoordinates_5 = Point.ByCoordinates(x=code_block_5.x, z=code_block_5.z)
YAxis_2 = Vector.YAxis()
byCenterPointRadiusAngle_2 = Arc.ByCenterPointRadiusAngle(center=byCoordinates_5, radius=code_block_5.r, startAngle=code_block_5.angle1, endAngle=code_block_5.angle2, normal=YAxis_2)

# group: Curve 3
code_block_6 = CodeBlock(R=outside_radius) { R; x = 3*R/10+250+R/40; z = 4*R/10; r = 3*R/10; angle1 = 90; angle2 = 180; }
byCoordinates_6 = Point.ByCoordinates(x=code_block_6.x, z=code_block_6.z)
YAxis_3 = Vector.YAxis()
byCenterPointRadiusAngle_3 = Arc.ByCenterPointRadiusAngle(center=byCoordinates_6, radius=code_block_6.r, startAngle=code_block_6.angle1, endAngle=code_block_6.angle2, normal=YAxis_3)

code_block_7 = CodeBlock(R=outside_radius) { R; 4*R/10+125; R/10; }
byCoordinates_7 = Point.ByCoordinates(x=code_block_7.out1, z=code_block_7.out2)

# group: Straight Rods Between Curves
endPoint = Curve.EndPoint(curve=byCenterPointRadiusAngle)
byStartPointEndPoint = Line.ByStartPointEndPoint(startPoint=byCoordinates_3, endPoint=endPoint)
startPoint = Curve.StartPoint(curve=byCenterPointRadiusAngle)
endPoint_2 = Curve.EndPoint(curve=byCenterPointRadiusAngle_2)
byStartPointEndPoint_2 = Line.ByStartPointEndPoint(startPoint=startPoint, endPoint=endPoint_2)
startPoint_2 = Curve.StartPoint(curve=byCenterPointRadiusAngle_2)
endPoint_3 = Curve.EndPoint(curve=byCenterPointRadiusAngle_3)
byStartPointEndPoint_3 = Line.ByStartPointEndPoint(startPoint=startPoint_2, endPoint=endPoint_3)
startPoint_3 = Curve.StartPoint(curve=byCenterPointRadiusAngle_3)
byStartPointEndPoint_4 = Line.ByStartPointEndPoint(startPoint=startPoint_3, endPoint=byCoordinates_7)

# group: Combination of Curves
join = Curve.Join(curve=byStartPointEndPoint, curves=byCenterPointRadiusAngle)
join_2 = Curve.Join(curve=byStartPointEndPoint_2, curves=byCenterPointRadiusAngle_2)
join_3 = Curve.Join(curve=join, curves=join_2)
join_4 = Curve.Join(curve=byStartPointEndPoint_3, curves=byCenterPointRadiusAngle_3)
join_5 = Curve.Join(curve=join_4, curves=byStartPointEndPoint_4)
join_6 = Curve.Join(curve=join_3, curves=join_5)

number_of_objects = IntegerSlider(9, range=5..9 step 1)

# group: Rotation of Primary Curve around Z-axis
XY = Plane.XY()
code_block_8 = CodeBlock(n=number_of_objects) { n; 0..360..#n+1; }
rotate = Geometry.Rotate(geometry=join_6, basePlane=XY, degrees=code_block_8.out1)

# group: Circular Rod Geometry
circularRod = Python()  # CPython3; unwired: IN[0]
# ---------- circularRod.python (38 lines) ----------
# Load the Python Standard and DesignScript Libraries
import sys
import clr
clr.AddReference('ProtoGeometry')
from Autodesk.DesignScript.Geometry import *

class CircularRod:
    def __init__(self, centerline, radius):
        self.centerline = centerline
        self.radius = radius/40   
        
    def startpoint(self):
        return self.centerline.StartPoint
        
    def startvector(self):
        return self.centerline.TangentAtParameter(0)
        
    def startcircle(self):
        startpoint = self.startpoint()
        radius = self.radius
        vector = self.startvector()
        return Circle.ByCenterPointRadiusNormal(startpoint, radius, vector)
        
    def make_geometry(self):
        circle = self.startcircle()
        curve = self.centerline
        endpoint = self.startpoint()
        radius = self.radius
        rod = Solid.BySweep(circle, curve)
        endcap = Sphere.ByCenterPointRadius(endpoint, radius)
        return Solid.Union(rod, endcap)
        
    def find_volume(self):
        solid = self.make_geometry()
        return solid.Volume
        
        
OUT = CircularRod
# ----------------------------------------
series_of_rods = Python(IN[0]=circularRod, IN[1]=rotate, IN[2]=outside_radius)  # CPython3
# ---------- series_of_rods.python (14 lines) ----------
CircularRod = IN[0]
centerline = IN[1]
radius = IN[2]

bars = []
volumes = 0
count = len(centerline)

for i in range(count):
    bar = CircularRod(centerline[i], radius)
    bars.append(bar.make_geometry())
OUT = bars

    
# ----------------------------------------

# group: Colour
code_block_9 = CodeBlock { 0; 208; 82; }
byARGB_2 = Color.ByARGB(red=code_block_9.out0, green=code_block_9.out1, blue=code_block_9.out2)
byGeometryColor_2 = Modifiers.GeometryColor.ByGeometryColor(geometry=series_of_rods, color=byARGB_2)

square_bar_quantity = IntegerSlider(26, range=20..30 step 1)

# group: Points For Horizontal Bars
code_block_10 = CodeBlock(n=square_bar_quantity) { n; 0..1..#n+1; }
pointAtParameter = Curve.PointAtParameter(curve=join_5, param=code_block_10.out1)
boolean = BoolSelector(true)
normalAtParameter = Curve.NormalAtParameter(curve=join_5, param=code_block_10.out1, side=boolean)
code_block_11 = CodeBlock(R=outside_radius) { R; d = R/40 + 20; }
scale = Vector.Scale(vector=normalAtParameter, scale_factor=code_block_11.d)
add = Point.Add(point=pointAtParameter, vectorToAdd=scale)

# group: Centerlines For Horizontal Bars
Z = Point.Z(point=add)
code_block_12 = CodeBlock(Z=Z) { 0; 0; Z; }
byCoordinates_8 = Point.ByCoordinates(x=code_block_12.out0, y=code_block_12.out1, z=code_block_12.Z)
X = Point.X(point=add)
code_block_13 = CodeBlock { 0; 360; }
ZAxis = Vector.ZAxis()
byCenterPointRadiusAngle_4 = Arc.ByCenterPointRadiusAngle(center=byCoordinates_8, radius=X, startAngle=code_block_13.out0, endAngle=code_block_13.out1, normal=ZAxis)

# group: Switching X-axis for some reason
X_2 = Vector.X(vector=normalAtParameter)
code_block_14 = CodeBlock(X=X_2) { X; x = -X; }
Y = Vector.Y(vector=normalAtParameter)
Z_2 = Vector.Z(vector=normalAtParameter)
byCoordinates_9 = Vector.ByCoordinates(x=code_block_14.x, y=Y, z=Z_2)

# group: Square Bar Geometry
squareBar = Python()  # CPython3; unwired: IN[0]
# ---------- squareBar.python (37 lines) ----------
# Load the Python Standard and DesignScript Libraries
import sys
import clr
clr.AddReference('ProtoGeometry')
from Autodesk.DesignScript.Geometry import *

class SquareBar:
    def __init__(self, centerline, size, direction):
        self.centerline = centerline
        self.size = size
        self.direction = direction
        
    def startpoint(self):
        return self.centerline.StartPoint
        
    def startvector(self):
        return self.centerline.TangentAtParameter(0)
        
    def startplane(self):
        origin = self.startpoint()
        normal = self.startvector()
        x_axis = self.direction
        return Plane.ByOriginNormalXAxis(origin, normal, x_axis)
        
    def startsquare(self):
        size = self.size
        plane = self.startplane()
        return Rectangle.ByWidthLength(plane, size, size)
        
    def make_geometry(self):
        square = self.startsquare()
        curve = self.centerline
        roughbar = Solid.BySweep(square, curve)

        return roughbar
        
OUT = SquareBar   
# ----------------------------------------
code_block_15 = CodeBlock { 40; }
series_of_bars = Python(IN[0]=squareBar, IN[1]=byCenterPointRadiusAngle_4, IN[2]=code_block_15, IN[3]=byCoordinates_9)  # CPython3
# ---------- series_of_bars.python (15 lines) ----------
SquareBar = IN[0]
centerline = IN[1]
size = IN[2]
direction = IN[3]

bars = []
count = len(centerline)

for i in range(count):
    bar = SquareBar(centerline[i], size, direction[i])
    bars.append(bar.make_geometry())
    
OUT = bars

    
# ----------------------------------------

# group: Colour
code_block_16 = CodeBlock { 255; 255; 0; }
byARGB_3 = Color.ByARGB(red=code_block_16.out0, green=code_block_16.out1, blue=code_block_16.out2)
byGeometryColor_3 = Modifiers.GeometryColor.ByGeometryColor(geometry=series_of_bars, color=byARGB_3)

# group: Circular Concrete Post
code_block_17 = CodeBlock { 0; 0; 4000; }
byCoordinates_10 = Point.ByCoordinates(x=code_block_17.out0, y=code_block_17.out1, z=code_block_17.out2)
code_block_18 = CodeBlock { 0; 0; 250; }
byCenterPointRadius = Sphere.ByCenterPointRadius(centerPoint=byCoordinates_10, radius=code_block_18.out2)
code_block_19 = CodeBlock { 0; 0; 0; }
byCoordinates_11 = Point.ByCoordinates(x=code_block_19.out0, y=code_block_19.out1, z=code_block_19.out2)
byPointsRadius = Cylinder.ByPointsRadius(startPoint=byCoordinates_11, endPoint=byCoordinates_10, radius=code_block_18.out2)
combined_parts = List.Create(item0=byPointsRadius)

# group: Volume Calculations
volume_calculation = Python(IN[0]=series_of_rods)  # CPython3
# ---------- volume_calculation.python (13 lines) ----------
# Load the Python Standard and DesignScript Libraries
import sys
import clr
clr.AddReference('ProtoGeometry')
from Autodesk.DesignScript.Geometry import *

solids = IN[0]
solid_combination = Solid.ByUnion(solids)
units_mm = " mm\u00b3"

volume = solid_combination.Volume

OUT = str(round(volume, 1)) + units_mm
# ----------------------------------------
volume_calculation_2 = Python(IN[0]=series_of_bars)  # CPython3; same code as volume_calculation
volume_calculation_3 = Python(IN[0]=combined_parts)  # CPython3; same code as volume_calculation

# group: Total Volumes
circular_rod_volume = Watch(volume_calculation)
concrete_post_volume = Watch(volume_calculation_2)
square_bar_volume = Watch(volume_calculation_3)
