# Dynamo graph 1921364.dyn "Pavillion_Doherty" (Dynamo 3.6.0.9395)

# group: Don't touch this ground
code_block = CodeBlock { -5000; -5000; -200; }
byCoordinates = Point.ByCoordinates(x=code_block.out0, y=code_block.out1, z=code_block.out2)
code_block_2 = CodeBlock { 5000; 5000; 0; }
byCoordinates_2 = Point.ByCoordinates(x=code_block_2.out0, y=code_block_2.out1, z=code_block_2.out2)
byCorners = Cuboid.ByCorners(lowPoint=byCoordinates, highPoint=byCoordinates_2)
code_block_3 = CodeBlock { 0; 100; 0; }
byARGB = Color.ByARGB(red=code_block_3.out0, green=code_block_3.out1, blue=code_block_3.out2)
byGeometryColor = Modifiers.GeometryColor.ByGeometryColor(geometry=byCorners, color=byARGB)

code_block_4 = CodeBlock { x=0; y=0; }
byCoordinates_3 = Point.ByCoordinates(x=code_block_4.x, y=code_block_4.y)
pavillion_radius = DoubleSlider(2600, range=2000..4000 step 100)
byCenterPointRadius = Circle.ByCenterPointRadius(centerPoint=byCoordinates_3, radius=pavillion_radius)
column_count = DoubleSlider(12, range=3..12 step 1)
base_points_of_columns = Curve.PointsAtEqualChordLength(curve=byCenterPointRadius, divisions=column_count)
radius = DoubleSlider(166.8, range=100..1000 step 0.1)
column_height = DoubleSlider(2810, range=1500..3500 step 10)
class_cylcolumn = Python()  # CPython3
# ---------- class_cylcolumn.python (27 lines) ----------
# Load the Python Standard and DesignScript Libraries
import sys
import clr
clr.AddReference('ProtoGeometry')
from Autodesk.DesignScript.Geometry import *

# Load Libraries
import sys
import clr
clr.AddReference('ProtoGeometry')
from Autodesk.DesignScript.Geometry import Cylinder, Vector

class CyColumn:
    def __init__(self, base_pt, radius, height):
        self.base = base_pt
        self.radius = radius
        self.height = height

    def build(self):
        # move the base point up in Z by height
        top = self.base.Translate(Vector.ZAxis(), self.height)
        return Cylinder.ByPointsRadius(self.base, top, self.radius)

    def volume(self):
        return 3.14159 * self.radius**2 * self.height

OUT = CyColumn
# ----------------------------------------
instances_cycolumn = Python(IN[0]=base_points_of_columns, IN[1]=radius, IN[2]=column_height, IN[3]=class_cylcolumn)  # CPython3
# ---------- instances_cycolumn.python (24 lines) ----------
# Load the Python Standard and DesignScript Libraries
import sys
import clr
clr.AddReference('ProtoGeometry')
from Autodesk.DesignScript.Geometry import *

import sys
import clr
clr.AddReference('ProtoGeometry')
from Autodesk.DesignScript.Geometry import *

# inputs
basePts = IN[0]  # list of points for columns
radius = IN[1]
height = IN[2]
CyColumn = IN[3]  # class coming from class node

# create a column at each base point
columns = []
for pt in basePts:
    col = CyColumn(pt, radius, height)
    columns.append(col.build())

OUT = columns
# ----------------------------------------
code_block_5 = CodeBlock { 0; 0; }
dome_centre = Point.ByCoordinates(x=code_block_5.out0, y=code_block_5.out1, z=column_height)
dome_radius = DoubleSlider(2760, range=2000..4500 step 10)
class_dome = Python()  # CPython3
# ---------- class_dome.python (28 lines) ----------
# Load the Python Standard and DesignScript Libraries
import sys
import clr
clr.AddReference('ProtoGeometry')
from Autodesk.DesignScript.Geometry import *

import sys
import clr
clr.AddReference('ProtoGeometry')
from Autodesk.DesignScript.Geometry import Sphere, Plane, Vector

class Dome:
    def __init__(self, center, radius):
        self.c = center
        self.r = radius

    def build(self):
        # full sphere
        s = Sphere.ByCenterPointRadius(self.c, self.r)
        # split in half at equator
        plane = Plane.ByOriginNormal(self.c, Vector.ZAxis())
        return s.Split(plane)[0]  # upper hemisphere

    def volume(self):
        # hemisphere volume = 2/3 * pi * r^3
        return 2/3 * 3.14159 * self.r**3

OUT = Dome
# ----------------------------------------
instances_dome = Python(IN[0]=dome_centre, IN[1]=dome_radius, IN[2]=class_dome)  # CPython3
# ---------- instances_dome.python (17 lines) ----------
# Load the Python Standard and DesignScript Libraries
import sys
import clr
clr.AddReference('ProtoGeometry')
from Autodesk.DesignScript.Geometry import *

import sys
import clr
clr.AddReference('ProtoGeometry')
from Autodesk.DesignScript.Geometry import *

center = IN[0]
radius = IN[1]
DomeClass = IN[2]

d = DomeClass(center, radius)
OUT = d.build()
# ----------------------------------------
