# Dynamo graph 1928428 .dyn "1928428" (Dynamo 4.0.0.3277)

# group: Don't touch this ground
code_block = CodeBlock { -5000; -5000; -200; }
byCoordinates = Point.ByCoordinates(x=code_block.out0, y=code_block.out1, z=code_block.out2)
code_block_2 = CodeBlock { 5000; 5000; 0; }
byCoordinates_2 = Point.ByCoordinates(x=code_block_2.out0, y=code_block_2.out1, z=code_block_2.out2)
byCorners = Cuboid.ByCorners(lowPoint=byCoordinates, highPoint=byCoordinates_2)
code_block_3 = CodeBlock { 0; 100; 0; }
byARGB = Color.ByARGB(red=code_block_3.out0, green=code_block_3.out1, blue=code_block_3.out2)
byGeometryColor = Modifiers.GeometryColor.ByGeometryColor(geometry=byCorners, color=byARGB)

code_block_4 = CodeBlock { Point.ByCoordinates(0,0,0); }
byOriginNormal = Plane.ByOriginNormal(origin=code_block_4)
code_block_5 = CodeBlock { 5000; }

# group: Beams
code_block_6 = CodeBlock { 4000; }
byPlaneRadius = Circle.ByPlaneRadius(plane=byOriginNormal, radius=code_block_6)
code_block_7 = CodeBlock { 6; }
regularPolygon = Polygon.RegularPolygon(circle=byPlaneRadius, numberSides=code_block_7)
corners = Polygon.Corners(polygon=regularPolygon)
translate = Geometry.Translate(geometry=regularPolygon, zTranslation=code_block_5)
corners_2 = Polygon.Corners(polygon=translate)
byStartPointEndPoint = Line.ByStartPointEndPoint(startPoint=corners, endPoint=corners_2)
number_slider = DoubleSlider(141.5, range=0..500 step 0.1)
byPointsRadius = Cylinder.ByPointsRadius(startPoint=corners, endPoint=corners_2, radius=number_slider)
volume = Solid.Volume(solid=byPointsRadius)
sum = Math.Sum(values=volume)

# group: Ground floor and stairs
byPlaneRadius_2 = Circle.ByPlaneRadius(plane=byOriginNormal, radius=code_block_5)
number_slider_2 = DoubleSlider(181.3, range=100..500 step 0.1)
byCoordinates_3 = Point.ByCoordinates(z=number_slider_2)
byTwoPoints = Vector.ByTwoPoints(start=code_block_4, end=byCoordinates_3)
extrudeAsSolid = Curve.ExtrudeAsSolid(curve=byPlaneRadius_2, distance=byTwoPoints)
volume_2 = Solid.Volume(solid=extrudeAsSolid)
code_block_8 = CodeBlock { 4700; }
byCenterPointRadius = Circle.ByCenterPointRadius(centerPoint=byCoordinates_3, radius=code_block_8)
byTwoPoints_2 = Vector.ByTwoPoints(start=code_block_4, end=byCoordinates_3)
extrudeAsSolid_2 = Curve.ExtrudeAsSolid(curve=byCenterPointRadius, distance=byTwoPoints_2)
volume_3 = Solid.Volume(solid=extrudeAsSolid_2)
code_block_9 = CodeBlock { 4500; }
byCenterPointRadius_2 = Circle.ByCenterPointRadius(centerPoint=byCoordinates_3, radius=code_block_9)
code_block_10 = CodeBlock { 600; }
byCoordinates_4 = Point.ByCoordinates(z=code_block_10)
byTwoPoints_3 = Vector.ByTwoPoints(start=byCoordinates_3, end=byCoordinates_4)
extrudeAsSolid_3 = Curve.ExtrudeAsSolid(curve=byCenterPointRadius_2, distance=byTwoPoints_3)
volume_4 = Solid.Volume(solid=extrudeAsSolid_3)
list_create = List.Create(item0=volume_2, item1=volume_3, item2=volume_4)
sum_2 = Math.Sum(values=list_create)

# group: Roof
byCoordinates_5 = Point.ByCoordinates(z=code_block_5)
number_slider_3 = DoubleSlider(7313.1, range=6000..8000 step 0.1)
byCoordinates_6 = Point.ByCoordinates(z=number_slider_3)
number_slider_4 = DoubleSlider(5398.8, range=4500..6000 step 0.1)
byPointsRadius_2 = Cone.ByPointsRadius(startPoint=byCoordinates_5, endPoint=byCoordinates_6, startRadius=number_slider_4)
volume_5 = Solid.Volume(solid=byPointsRadius_2)
byCenterPointRadius_3 = Circle.ByCenterPointRadius(centerPoint=code_block_4, radius=code_block_5)
translate_2 = Geometry.Translate(geometry=byCenterPointRadius_3, zTranslation=code_block_5)
code_block_11 = CodeBlock { 50; }
extrudeAsSolid_4 = Curve.ExtrudeAsSolid(curve=translate_2, distance=code_block_11)
volume_6 = Solid.Volume(solid=extrudeAsSolid_4)
list_create_2 = List.Create(item0=volume_5, item1=volume_6)
sum_3 = Math.Sum(values=list_create_2)

# group: Volumes
volume_of_the_ground_floor = Watch(sum_2)
volume_of_the_material_of_the = Watch(sum_3)  # "Volume of the material of the floor"
volume_of_the_material_of_the_2 = Watch(sum)  # "Volume of the material of the beams"
