# Dynamo graph 1932636.dyn (Dynamo 4.0.0.3277)

# group: Don't touch this ground
code_block = CodeBlock { -5000; -5000; -200; }
byCoordinates = Point.ByCoordinates(x=code_block.out0, y=code_block.out1, z=code_block.out2)
code_block_2 = CodeBlock { 5000; 5000; 0; }
byCoordinates_2 = Point.ByCoordinates(x=code_block_2.out0, y=code_block_2.out1, z=code_block_2.out2)
byCorners = Cuboid.ByCorners(lowPoint=byCoordinates, highPoint=byCoordinates_2)
code_block_3 = CodeBlock { 0; 100; 0; }
byARGB = Color.ByARGB(red=code_block_3.out0, green=code_block_3.out1, blue=code_block_3.out2)
byGeometryColor = Modifiers.GeometryColor.ByGeometryColor(geometry=byCorners, color=byARGB)

height_of_columns = DoubleSlider(5000, range=4000..5000 step 500)
byCoordinates_3 = Point.ByCoordinates(z=height_of_columns)
height_of_roof = DoubleSlider(8000, range=7000..8000 step 10)
byCoordinates_4 = Point.ByCoordinates(z=height_of_roof)
distance_from_origin = DoubleSlider(4000, range=3000..4000 step 1000)
radius_of_columns = DoubleSlider(300, range=200..300 step 20)
add = distance_from_origin + radius_of_columns
radius_of_roof = DoubleSlider(1000, range=50..1000 step 100)
add_2 = add + radius_of_roof
byPointsRadius = Cone.ByPointsRadius(startPoint=byCoordinates_3, endPoint=byCoordinates_4, startRadius=add_2)
code_block_4 = CodeBlock { 200; }
byCoordinates_5 = Point.ByCoordinates(z=code_block_4)
code_block_5 = CodeBlock { 5000; }
byPointsRadius_2 = Cylinder.ByPointsRadius(endPoint=byCoordinates_5, radius=code_block_5)
code_block_6 = CodeBlock { 400; }
byCoordinates_6 = Point.ByCoordinates(z=code_block_6)
byPointsRadius_3 = Cylinder.ByPointsRadius(startPoint=byCoordinates_5, endPoint=byCoordinates_6, radius=distance_from_origin)
classes_woodcolumn_steelroof = Python()  # PythonNet3; graph output
# ---------- classes_woodcolumn_steelroof.python (36 lines) ----------
import clr
clr.AddReference('ProtoGeometry')
from Autodesk.DesignScript.Geometry import *

class WoodColumn:
    def __init__(self, radius, height):
        self.radius = float(radius)
        self.height = float(height)
        self.material = "Wood"

    def solid(self, x, y):
        base = Point.ByCoordinates(x, y, 0)
        top = Point.ByCoordinates(x, y, self.height)
        return Cylinder.ByPointsRadius(base, top, self.radius)

    def volume(self):
        return 3.14159 * self.radius * self.radius * self.height

class SteelRoof:
    def __init__(self, radius, height):
        self.radius = float(radius)
        self.height = float(height)
        self.material = "Steel"

    def solid(self):
        base = Point.ByCoordinates(0, 0, 0)
        apex = Point.ByCoordinates(0, 0, self.height)
        return Cone.ByPointsRadius(base, apex, self.radius, 0)

    def volume(self):
        return (1/3) * 3.14159 * self.radius * self.radius * self.height

OUT = {
    "WoodColumn": WoodColumn,
    "SteelRoof": SteelRoof
}
# ----------------------------------------
code_block_7 = CodeBlock { "WoodColumn"; }
valueAtKey = DesignScript.Builtin.Dictionary.ValueAtKey(dictionary=classes_woodcolumn_steelroof, key=code_block_7)
column_count = DoubleSlider(10, range=4..10 step 2)
series_of_woodcolumn_instances = Python(IN[0]=valueAtKey, IN[1]=column_count, IN[2]=distance_from_origin, IN[3]=radius_of_columns, IN[4]=height_of_columns)  # PythonNet3
# ---------- series_of_woodcolumn_instances.python (30 lines) ----------
import clr
clr.AddReference('ProtoGeometry')
from Autodesk.DesignScript.Geometry import *
import math

# Inputs
WoodColumn = IN[0]
count = int(IN[1])
circleRadius = float(IN[2])
colRadius = float(IN[3])
colHeight = float(IN[4])

# Make the column type
columnMaker = WoodColumn(colRadius, colHeight)

columns = []

# LOOP TO GENERATE CORRECT ANGLES
for i in range(count):
    angle_deg = 360.0 * i / count
    angle_rad = math.radians(angle_deg)

    # Correct X and Y positions
    x = circleRadius * math.cos(angle_rad)
    y = circleRadius * math.sin(angle_rad)

    col = columnMaker.solid(x, y)
    columns.append(col)

OUT = columns
# ----------------------------------------
code_block_8 = CodeBlock { "SteelRoof"; }
valueAtKey_2 = DesignScript.Builtin.Dictionary.ValueAtKey(dictionary=classes_woodcolumn_steelroof, key=code_block_8)
material_volumes_quantity = Python(IN[0]=series_of_woodcolumn_instances, IN[1]=valueAtKey, IN[2]=valueAtKey_2, IN[3]=radius_of_roof, IN[4]=height_of_roof, IN[5]=radius_of_columns, IN[6]=height_of_columns)  # "Material Volumes (Quantity Takeoff)"; PythonNet3
# ---------- material_volumes_quantity.python (26 lines) ----------
import clr
clr.AddReference('ProtoGeometry')
from Autodesk.DesignScript.Geometry import *

# Inputs
wood_columns = IN[0]       # list of cylinder geometries
WoodColumn = IN[1]         # class
SteelRoof = IN[2]          # class
roof_radius = float(IN[3])
roof_height = float(IN[4])
column_radius = float(IN[5])
column_height = float(IN[6])

# --- WOOD VOLUME ---
wood_count = len(wood_columns)

wood_instance = WoodColumn(column_radius, column_height)
volume_each_wood = wood_instance.volume()
total_wood_volume = volume_each_wood * wood_count

# --- STEEL ROOF VOLUME ---
steel_instance = SteelRoof(roof_radius, roof_height)
total_steel_volume = steel_instance.volume()

# Output
OUT = total_wood_volume, total_steel_volume
# ----------------------------------------
watch = Watch(material_volumes_quantity)
